# Dynamo graph 2021_00-1_BIMACON_Deletar Ambientes (Rooms) ou Espaços (Spaces)_R01_script.dyn "2021_00-1_BIMACON_Deletar Ambientes (Rooms) ou Espaços (Spaces)_R01" (Dynamo 2.6.1.8786)
# Deleta todos espaços ou ambientes do projeto.
# packages: archi-lab.net 2023.213.1722, Data-Shapes 2022.2.105, Orchid 2.6.8.6198

# group: SELECIONE O MODELO ARQ LINKADO
code_block = CodeBlock()  # //archilab
code_block_2 = CodeBlock()  # //Data-Shapes
code_block_3 = CodeBlock { "Selecione Ambientes ou Espaços para serem deletados:"; }
file_path = Filename("..\..\..\..\..\05 - BIMACON\01 - EMPRESA BIMACON\00 - Logos e imagens - BIMACON\ARTE BIMACON\reddonda-removebg-preview.png")
file_from_path = FileObject(path=file_path)
readFromFile = Image.ReadFromFile(file=file_from_path)
string = StringInput("Confirmar")
code_block_4 = CodeBlock { "Ambientes"; "Espaços"; }
list_create = List.Create(item0=code_block_4.out0, item1=code_block_4.out1)
element_types = ElementTypes("Room")  # graph input
element_types_2 = ElementTypes("Space")  # graph input
list_create_2 = List.Create(item0=element_types, item1=element_types_2)
code_block_5 = CodeBlock { 0; }
dropdown_data = Custom[DropDown Data](Keys=list_create, Values=list_create_2, DefaultValueIndex=code_block_5)  # package Data-Shapes; Create data for DropDown input in UI.MultiInputForm ++ . Check out www.data-shapes.net for more infos.
boolean = BoolSelector(true)
string_2 = StringInput("Cancelar")
multipleinputform = Custom[MultipleInputForm ++](Description_optional=code_block_3, Logo_optional=readFromFile, ButtonText_optional=string, Inputs=dropdown_data, Toggle=boolean, CancelButtonText_optional=string_2)  # package Data-Shapes; Create a form with multiple inputs. see www.data-shapes.net for tutorials and infos!

# group: Deletar espaços (spaces) ou Ambientes (Rooms) do modelo
all_elements_of_type = ElementsOfType(element_type=multipleinputform.User_Inputs)
delete = archilab.Revit.Elements.Elements.Delete(element=all_elements_of_type)

# group: Mensagem final
count = List.Count(list=delete@L2)
code_block_6 = CodeBlock { 0; }
gt = count > code_block_6
code_block_7 = CodeBlock(N=count) { ["Feito! você deletou "+N+" elementos em seu projeto"]; }
code_block_8 = CodeBlock { ["Nenhum elemento foi deletado"]; }
if_ = If(test=gt, true=code_block_7, false=code_block_8)

flatten = List.Flatten(list=if_)

# group (continued): Mensagem final
o_string_fromlist = Orchid.Common.String.FromList(list=flatten)
python_script = Python(IN[0]=o_string_fromlist)
# ---------- python_script.python (21 lines) ----------
# Importar as bibliotecas necessárias do Revit
import clr
clr.AddReference("RevitServices")
from RevitServices.Persistence import DocumentManager

clr.AddReference("RevitAPI")
clr.AddReference("RevitAPIUI")
from Autodesk.Revit.UI import TaskDialog

# Pegar a entrada do Dynamo
mensagem = IN[0]

# Criar a TaskDialog
task_dialog = TaskDialog("Ok")
task_dialog.MainInstruction = mensagem

# Exibir a TaskDialog
task_dialog.Show()

# Saída do script
OUT = "Sucesso!"
# ----------------------------------------
