# Dynamo graph 2021_00-3_BIMACON_Excluir Espaços redundantes_script.dyn "ok 2021_00-3_BIMACON_Excluir Espaços redundantes" (Dynamo 2.6.1.8786)
# Exclui Espaços redundantes do projeto
# packages: DynaMEP 2.0.1, Orchid 2.6.8.6198

categories = Categories("OST_MEPSpaces")
all_elements_of_category = ElementsOfCategory(Category=categories)
code_block = CodeBlock { "Área"; }
getParameterValueByName = Element.GetParameterValueByName(element=all_elements_of_category, parameterName=code_block)
code_block_2 = CodeBlock { ""; }
eq = getParameterValueByName == code_block_2
boolean = BoolSelector(true)
boolean_2 = BoolSelector(false)
if_ = If(test=eq, true=boolean, false=boolean_2)
filterByBoolMask = List.FilterByBoolMask(list=all_elements_of_category, mask=if_)
flatten = List.Flatten(list=filterByBoolMask.in)
deleteElement = RevitModel.Element.DeleteElement(element=flatten)

# group: Mensagem final
count = List.Count(list=deleteElement)
code_block_3 = CodeBlock { 0; }
gt = count > code_block_3
code_block_4 = CodeBlock(N=count) { ["Feito! Você excluiu "+N+" Espaços redundantes em seu projeto"]; }
code_block_5 = CodeBlock { ["Nenhum Espaço precisou ser excluído"]; }
if_2 = If(test=gt, true=code_block_4, false=code_block_5)
flatten_2 = List.Flatten(list=if_2)
o_string_fromlist = Orchid.Common.String.FromList(list=flatten_2)
python_script = Python(IN[0]=o_string_fromlist)
# ---------- python_script.python (21 lines) ----------
# Importar as bibliotecas necessárias do Revit
import clr
clr.AddReference("RevitServices")
from RevitServices.Persistence import DocumentManager

clr.AddReference("RevitAPI")
clr.AddReference("RevitAPIUI")
from Autodesk.Revit.UI import TaskDialog

# Pegar a entrada do Dynamo
mensagem = IN[0]

# Criar a TaskDialog
task_dialog = TaskDialog("Ok")
task_dialog.MainInstruction = mensagem

# Exibir a TaskDialog
task_dialog.Show()

# Saída do script
OUT = "Sucesso!"
# ----------------------------------------
