# Dynamo graph 2021_00-5_BIMACON_Criar Massas 3D de Espaços ou Ambientes_script.dyn "ok 2021_00-5_BIMACON_Criar Massas 3D de Espaços ou Ambientes" (Dynamo 2.6.1.8786)
# packages: Orchid 2.6.8.6198

categories = Categories("OST_Rooms")  # graph input
all_elements_of_category = ElementsOfCategory(Category=categories)
geometry = Element.Geometry(element=all_elements_of_category)
categories_2 = Categories("OST_Mass")  # graph input
code_block = CodeBlock { "ACABAMENTO EM PINTURA AMARELA"; }
byName = Material.ByName(name=code_block)
code_block_2 = CodeBlock { "Nome"; }
getParameterValueByName = Element.GetParameterValueByName(element=all_elements_of_category, parameterName=code_block_2)
byGeometry = DirectShape.ByGeometry(geometry=geometry, category=categories_2, material=byName, name=getParameterValueByName)

# group: Mensagem final
count = List.Count(list=byGeometry)
code_block_3 = CodeBlock { 0; }
gt = count > code_block_3
code_block_4 = CodeBlock(N=count) { ["Feito! você criou "+N+" Massas"]; }
code_block_5 = CodeBlock { ["Nenhuma Massa foi criada"]; }
if_ = If(test=gt, true=code_block_4, false=code_block_5)
flatten = List.Flatten(list=if_)
o_string_fromlist = Orchid.Common.String.FromList(list=flatten)
python_script = Python(IN[0]=o_string_fromlist)
# ---------- python_script.python (21 lines) ----------
# Importar as bibliotecas necessárias do Revit
import clr
clr.AddReference("RevitServices")
from RevitServices.Persistence import DocumentManager

clr.AddReference("RevitAPI")
clr.AddReference("RevitAPIUI")
from Autodesk.Revit.UI import TaskDialog

# Pegar a entrada do Dynamo
mensagem = IN[0]

# Criar a TaskDialog
task_dialog = TaskDialog("Ok")
task_dialog.MainInstruction = mensagem

# Exibir a TaskDialog
task_dialog.Show()

# Saída do script
OUT = "Sucesso!"
# ----------------------------------------
