# Dynamo graph 2021_00-0_BIMACON_Copiar Ambientes de modelo-LINK_script.dyn (Dynamo 2.6.1.8786)
# Copiar Ambientes do arquivo Linkado e transformar em Espaços para Análise
# packages: archi-lab.net 2023.213.1722, Rhythm 2023.4.2024, Clockwork for Dynamo 1.x 1.0.2, Data-Shapes 2022.2.105, Genius Loci 2023.2.21, Crumple 2021.9.24, Orchid 2.16.5.6198, Orchid 2.6.8.6198

# group: SELECIONE O MODELO ARQ LINKADO
code_block = CodeBlock()  # //Data-Shapes
code_block_2 = CodeBlock()  # //archilab
code_block_3 = CodeBlock { "Selecione o arquivo para obter os Ambientes:"; }
file_path = Filename("..\..\..\..\..\05 - BIMACON\01 - EMPRESA BIMACON\00 - Logos e imagens - BIMACON\ARTE BIMACON\reddonda-removebg-preview.png")
file_from_path = FileObject(path=file_path)
readFromFile = Image.ReadFromFile(file=file_from_path)
string = StringInput("Confirmar")
get_alldocuments = Custom[Get AllDocuments]()  # package Genius Loci; Get documents (linked and opened in background). The first document is the active document.
code_block_4 = CodeBlock { 0; }
dropdown_data = Custom[DropDown Data](Keys=get_alldocuments.FileName, Values=get_alldocuments.Document, DefaultValueIndex=code_block_4)  # package Data-Shapes; Create data for DropDown input in UI.MultiInputForm ++ . Check out www.data-shapes.net for more infos.
boolean = BoolSelector(true)
string_2 = StringInput("Cancelar")
multipleinputform = Custom[MultipleInputForm ++](Description_optional=code_block_3, Logo_optional=readFromFile, ButtonText_optional=string, Inputs=dropdown_data, Toggle=boolean, CancelButtonText_optional=string_2)  # package Data-Shapes; Create a form with multiple inputs. see www.data-shapes.net for tutorials and infos!

number_slider = DoubleSlider(0, range=0..4 step 1)
getItemAtIndex = List.GetItemAtIndex(list=multipleinputform.User_Inputs, index=number_slider)

# group: Deletar Ambientes do modelo
element_types = ElementTypes("Room")
all_elements_of_type = ElementsOfType(element_class=element_types)
delete = archilab.Revit.Elements.Elements.Delete(element=all_elements_of_type)

passthrough = Custom[Passthrough](passThrough=getItemAtIndex, waitFor=delete)  # package Clockwork for Dynamo 1.x; Forces a sequential order of execution. The node wired into the output of the Passthrough node will be executed *after* the node wired into the waitFor input (e.g. important for some Revit operations). The value of the passThrough input will be passed on to the node wired into the output port of the Passthrough node.
categoria_a_ser_copiada = Categories("OST_Rooms")  # graph input
get_all_elements_from_linked = Custom[Get All Elements From Linked Model](linkDoc=passthrough, category=categoria_a_ser_copiada)  # package archi-lab.net; This node is based on code posted by Julien Benoit. Big thanks to Julien for sharing his work. This node will retrieve all elements of a given category from a given linked model.
ʳʰʸᵗʰᵐ_documents = Rhythm.Revit.Application.Documents.CopyElementsFromDocument(sourceDocument=passthrough, elements=get_all_elements_from_linked)

# group: Tag Rooms
code_block_5 = CodeBlock { true; }
currentview = Custom[© CurrentView](refresh=code_block_5)  # package Crumple; Given the current document, return the active view.
flatten = List.Flatten(list=ʳʰʸᵗʰᵐ_documents)
family_types = FamilyTypes("Tag de Ambientes:TAG Ambiente com área")
location = Orchid.RevitProject.Elements.SpatialElement.Location(spatialElement=ʳʰʸᵗʰᵐ_documents)
flatten_2 = List.Flatten(list=location)
bySpatialElementAndLocation = Orchid.RevitProject.Annotations.Tag.BySpatialElementAndLocation(view=currentview, spatialElement=flatten, tagType=family_types, location=flatten_2)

# group: Mensagem Final
count = List.Count(list=ʳʰʸᵗʰᵐ_documents)
code_block_6 = CodeBlock { 0; }
gt = count > code_block_6
code_block_7 = CodeBlock(N=count) { ["Feito! Você copiou "+N+" ambientes"]; }
code_block_8 = CodeBlock { ["Nenhum Ambiente foi copiado"]; }
if_ = If(test=gt, true=code_block_7, false=code_block_8)

o_string_fromlist = Orchid.Common.String.FromList(list=if_)

# group (continued): Mensagem Final
python_script = Python(IN[0]=o_string_fromlist)
# ---------- python_script.python (21 lines) ----------
# Importar as bibliotecas necessárias do Revit
import clr
clr.AddReference("RevitServices")
from RevitServices.Persistence import DocumentManager

clr.AddReference("RevitAPI")
clr.AddReference("RevitAPIUI")
from Autodesk.Revit.UI import TaskDialog

# Pegar a entrada do Dynamo
mensagem = IN[0]

# Criar a TaskDialog
task_dialog = TaskDialog("Ok")
task_dialog.MainInstruction = mensagem

# Exibir a TaskDialog
task_dialog.Show()

# Saída do script
OUT = "Sucesso!"
# ----------------------------------------
