# Dynamo graph 2021_01-0_BIMACON_Criar Espaços dos ambientes(Rooms)-LINK_R01_script.dyn "ok 2021_01-0_BIMACON_Criar Espaços dos ambientes(Rooms)-LINK_R01" (Dynamo 2.6.1.8786)
# Criar espaços por meio da seleção do arquivo linkado. Se Nele existir os Ambientes será feita a importação
# packages: archi-lab.net 2023.213.1722, Clockwork for Dynamo 1.x 1.34.0, DynamoMEP 1.0.3, Crumple 2021.9.24, Orchid 2.16.5.6198, Data-Shapes 2022.2.105, Orchid 2.6.8.6198, Genius Loci 2023.2.21

# group: SELECIONE O MODELO ARQ LINKADO
code_block = CodeBlock { "Selecione o arquivo para obter os Espaços:"; }
file_path = Filename("..\..\..\..\..\05 - BIMACON\01 - EMPRESA BIMACON\00 - Logos e imagens - BIMACON\ARTE BIMACON\reddonda-removebg-preview.png")
file_from_path = FileObject(path=file_path)
readFromFile = Image.ReadFromFile(file=file_from_path)
string = StringInput("Confirmar")
get_alldocuments = Custom[Get AllDocuments]()  # package Genius Loci; Get documents (linked and opened in background). The first document is the active document.
code_block_2 = CodeBlock { 0; }
dropdown_data = Custom[DropDown Data](Keys=get_alldocuments.FileName, Values=get_alldocuments.Document, DefaultValueIndex=code_block_2)  # package Data-Shapes; Create data for DropDown input in UI.MultiInputForm ++ . Check out www.data-shapes.net for more infos.
boolean = BoolSelector(true)
string_2 = StringInput("Cancelar")
multipleinputform = Custom[MultipleInputForm ++](Description_optional=code_block, Logo_optional=readFromFile, ButtonText_optional=string, Inputs=dropdown_data, Toggle=boolean, CancelButtonText_optional=string_2)  # package Data-Shapes; Create a form with multiple inputs. see www.data-shapes.net for tutorials and infos!
code_block_3 = CodeBlock()  # //Data-Shapes
code_block_4 = CodeBlock()  # //archilab

number_slider = DoubleSlider(0, range=0..4 step 1)
getItemAtIndex = List.GetItemAtIndex(list=multipleinputform.User_Inputs, index=number_slider)

# group: Deletar espaços do modelo
element_types = ElementTypes("Space")
all_elements_of_type = ElementsOfType(element_type=element_types)
delete = archilab.Revit.Elements.Elements.Delete(element=all_elements_of_type)

passthrough = Custom[Passthrough](passThrough=getItemAtIndex, waitFor=delete)  # package Clockwork for Dynamo 1.x; Forces a sequential order of execution. The node wired into the output of the Passthrough node will be executed *after* the node wired into the waitFor input (e.g. important for some Revit operations). The value of the passThrough input will be passed on to the node wired into the output port of the Passthrough node.
categories = Categories("OST_Rooms")  # graph input

# group: CRIAR ESPAÇOS DOS AMBIENTES LINKADOS - COPIAR NOME E NÚMERO DO AMBIENTE
code_block_5 = CodeBlock()  # //archilab
get_all_elements_from_linked = Custom[Get All Elements From Linked Model](linkDoc=passthrough, category=categories, lacing=Longest)  # package archi-lab.net; This node is based on code posted by Julien Benoit. Big thanks to Julien for sharing his work. This node will retrieve all elements of a given category from a given linked model.
getLocation = Element.GetLocation(element=get_all_elements_from_linked)
byPoint = DynamoMEP.Space.ByPoint(point=getLocation)
end = Revit.Transaction.Transaction.End(input=byPoint)
code_block_6 = CodeBlock { "Nome"; "Número"; "Deslocamento do limite"; }
getParameterValueByName = Element.GetParameterValueByName(element=get_all_elements_from_linked, parameterName=code_block_6.out0)
setParameterByName = Element.SetParameterByName(element=end, parameterName=code_block_6.out0, value=getParameterValueByName)
getParameterValueByName_2 = Element.GetParameterValueByName(element=get_all_elements_from_linked, parameterName=code_block_6.out1)
setParameterByName_2 = Element.SetParameterByName(element=setParameterByName, parameterName=code_block_6.out1, value=getParameterValueByName_2)
getParameterValueByName_3 = Element.GetParameterValueByName(element=get_all_elements_from_linked, parameterName=code_block_6.out2)
setParameterByName_3 = Element.SetParameterByName(element=setParameterByName_2, parameterName=code_block_6.out2, value=getParameterValueByName_3)
byCoordinates = Point.ByCoordinates()

# group: LIGAÇÃO
code_block_7 = CodeBlock()  # //Clockwork
code_block_8 = CodeBlock(passthrough=byPoint, waitfor=setParameterByName_2) { [passthrough,waitfor][0]; }

# group: AJUSTE O LIMITE SUPERIOR E A COMPENSAÇÃO DO LIMITE
code_block_9 = CodeBlock()  # //archilab
code_block_10 = CodeBlock { "Limite superior"; }
code_block_11 = CodeBlock { "Nível"; }
getParameterValueByName_4 = Element.GetParameterValueByName(element=code_block_8, parameterName=code_block_11)
getLevelByName = archilab.Revit.Selection.Select.GetLevelByName(name=getParameterValueByName_4, lacing=Longest)
levelAbove = Custom[Level.LevelAbove](level=getLevelByName)  # package archi-lab.net; This node takes an input of level and returns level above it.
setParameterByName_4 = Element.SetParameterByName(element=code_block_8, parameterName=code_block_10, value=levelAbove)

watch = Watch(setParameterByName_3)

# group: Tag Spaces
code_block_12 = CodeBlock { true; }
currentview = Custom[© CurrentView](refresh=code_block_12)  # package Crumple; Given the current document, return the active view.
flatten = List.Flatten(list=byPoint)
family_types = FamilyTypes("Tag de Spaces com Area e Perimetro:Tag para Spaces com Área e Perímetro")
flatten_2 = List.Flatten(list=getLocation)
bySpatialElementAndLocation = Orchid.RevitProject.Annotations.Tag.BySpatialElementAndLocation(view=currentview, spatialElement=flatten, tagType=family_types, location=flatten_2)

# group: Mensagem Final
count = List.Count(list=setParameterByName_4)
code_block_13 = CodeBlock { 0; }
gt = count > code_block_13
code_block_14 = CodeBlock(N=count) { ["Feito! Você copiou "+N+" Espaços"]; }
code_block_15 = CodeBlock { ["Nenhum Espaço foi criado"]; }
if_ = If(test=gt, true=code_block_14, false=code_block_15)
o_string_fromlist = Orchid.Common.String.FromList(list=if_)
python_script = Python(IN[0]=o_string_fromlist)
# ---------- python_script.python (21 lines) ----------
# Importar as bibliotecas necessárias do Revit
import clr
clr.AddReference("RevitServices")
from RevitServices.Persistence import DocumentManager

clr.AddReference("RevitAPI")
clr.AddReference("RevitAPIUI")
from Autodesk.Revit.UI import TaskDialog

# Pegar a entrada do Dynamo
mensagem = IN[0]

# Criar a TaskDialog
task_dialog = TaskDialog("Ok")
task_dialog.MainInstruction = mensagem

# Exibir a TaskDialog
task_dialog.Show()

# Saída do script
OUT = "Sucesso!"
# ----------------------------------------
