# Dynamo graph 2021_01-1_BIMACON_Criar Níveis do LINK_script.dyn "2021_01-0_BIMACON_Criar Níveis do LINK" (Dynamo 2.6.1.8786)
# packages: Clockwork for Dynamo 2.x 2.4.0, Data-Shapes 2022.2.105, Genius Loci 2023.2.21, Orchid 2.6.10.6373, Crumple 2021.9.24

# group: SELECIONE O MODELO ARQ LINKADO
code_block = CodeBlock()  # //archilab
code_block_2 = CodeBlock()  # //Data-Shapes
get_alldocuments = Custom[Get AllDocuments]()  # package Genius Loci; Get documents (linked and opened in background). The first document is the active document.
code_block_3 = CodeBlock { "Selecione o link para obter os Níveis:"; }
file_path = Filename("..\..\..\..\..\05 - BIMACON\01 - EMPRESA BIMACON\00 - Logos e imagens - BIMACON\ARTE BIMACON\reddonda-removebg-preview.png")
file_from_path = FileObject(path=file_path)
readFromFile = Image.ReadFromFile(file=file_from_path)
string = StringInput("Confirmar")
code_block_4 = CodeBlock { "Escolha o Link"; }
revitlinks = Custom[© RevitLinks]()  # package Crumple; Returns all Revit link types in the current document, as well as all instance elements of those types.
code_block_5 = CodeBlock { 0; }
code_block_6 = CodeBlock { "Sufixo"; }
string_2 = StringInput(" - ELE")
textbox_data = Custom[TextBox Data](InputName=code_block_6, DefaultText=string_2)  # package Data-Shapes; Create Data for TextBox input in UI.MultipleInputForm ++ . Check out www.data-shapes.net for more informations
boolean = BoolSelector(true)
string_3 = StringInput("Cancelar")

flatten = List.Flatten(list=revitlinks.linkInstances)

# group (continued): SELECIONE O MODELO ARQ LINKADO
name = Element.Name(element=flatten)
dropdown_data = Custom[DropDown Data](InputName=code_block_4, Keys=name, Values=flatten, DefaultValueIndex=code_block_5)  # package Data-Shapes; Create data for DropDown input in UI.MultiInputForm ++ . Check out www.data-shapes.net for more infos.
list_create = List.Create(item0=dropdown_data, item1=textbox_data)
multipleinputform = Custom[MultipleInputForm ++](Description_optional=code_block_3, Logo_optional=readFromFile, ButtonText_optional=string, Inputs=list_create, Toggle=boolean, CancelButtonText_optional=string_3)  # package Data-Shapes; Create a form with multiple inputs. see www.data-shapes.net for tutorials and infos!

code_block_7 = CodeBlock { 0; }
getItemAtIndex = List.GetItemAtIndex(list=multipleinputform.User_Inputs, index=code_block_7)
python_script = Python()  # unwired: IN[0]
# ---------- python_script.python (65 lines) ----------
# Importando as bibliotecas do Revit e Windows Forms
import clr
clr.AddReference("RevitServices")
from RevitServices.Persistence import DocumentManager
from RevitServices.Transactions import TransactionManager

clr.AddReference("RevitAPI")
from Autodesk.Revit.DB import *

# Adicionando referência para System.Windows.Forms
clr.AddReference("System.Windows.Forms")
from System.Windows.Forms import MessageBox, MessageBoxButtons

# Obtendo o documento atual do Revit
doc = DocumentManager.Instance.CurrentDBDocument

# Função para obter a unidade de comprimento
def get_length_unit_format(doc):
    # Obtendo as unidades do documento
    units = doc.GetUnits()

    # Acessando as opções de formato para o comprimento
    format_options = units.GetFormatOptions(SpecTypeId.Length)

    # Obtendo o ID da unidade de comprimento atual
    unit_type_id = format_options.GetUnitTypeId()

    # Retornando a unidade de comprimento atual
    return unit_type_id

# Função para definir a unidade de comprimento para centímetros
def set_length_unit_to_meters(doc):
    # Iniciando uma transação para modificar as unidades
    TransactionManager.Instance.EnsureInTransaction(doc)

    # Obtendo as unidades atuais
    units = doc.GetUnits()

    # Criando novas opções de formato para definir como centímetros
    format_options = FormatOptions(UnitTypeId.Meters)

    # Definindo as opções para o comprimento (Length)
    units.SetFormatOptions(SpecTypeId.Length, format_options)

    # Aplicando as mudanças ao documento
    doc.SetUnits(units)

    # Finalizando a transação
    TransactionManager.Instance.TransactionTaskDone()

# Obtendo a unidade de comprimento atual
length_unit = get_length_unit_format(doc)

# Verificando se a unidade não é centímetros e mudando se necessário
if length_unit != UnitTypeId.Meters:
    set_length_unit_to_meters(doc)
    result = "Unidade de comprimento alterada para Metros"
else:
    result = "A unidade de comprimento já está em Metros"

# Exibir uma janela pop-up para o usuário confirmar a mensagem
MessageBox.Show(result, "Confirmação", MessageBoxButtons.OK)

# Retornar 1 para o Dynamo após o usuário clicar em OK
OUT = 1
# ----------------------------------------
passthrough = Custom[Passthrough](passThrough=getItemAtIndex, waitFor=python_script)  # package Clockwork for Dynamo 2.x; Forces a sequential order of execution. The node wired into the output of the Passthrough node will be executed *after* the node wired into the waitFor input (e.g. important for some Revit operations). The value of the passThrough input will be passed on to the node wired into the output port of the Passthrough node.
python_script_2 = Python(IN[0]=passthrough)
# ---------- python_script_2.python (41 lines) ----------
import clr
clr.AddReference('RevitServices')
clr.AddReference('RevitAPI')
clr.AddReference('RevitNodes')

from RevitServices.Persistence import DocumentManager
from Autodesk.Revit.DB import *

# Obter o documento ativo
doc = DocumentManager.Instance.CurrentDBDocument

# Entrada 0: Elemento do vínculo selecionado pelo usuário
vinculo_selecionado = UnwrapElement(IN[0])  # Desempacota o elemento Revit do Dynamo

# Verificar se o vínculo selecionado é válido
if vinculo_selecionado and isinstance(vinculo_selecionado, RevitLinkInstance):
    # Obter o documento vinculado (arquivo RVT vinculado)
    link_doc = vinculo_selecionado.GetLinkDocument()

    # Verificar se o documento vinculado existe
    if link_doc is None:
        OUT = "Erro: Documento vinculado não encontrado."
    else:
        # Coletar os níveis do vínculo
        niveis_vinculados = FilteredElementCollector(link_doc).OfCategory(BuiltInCategory.OST_Levels).WhereElementIsNotElementType().ToElements()

        # Criar duas listas, uma para os nomes e outra para as elevações usando o parâmetro 'Elevation'
        nomes_niveis = [nivel.Name for nivel in niveis_vinculados]
        elevacoes_niveis = []
        
        for nivel in niveis_vinculados:
            # Acessar o parâmetro "Elevação" do nível
            elevacao_param = nivel.get_Parameter(BuiltInParameter.LEVEL_ELEV).AsDouble()
            # Converter a elevação para metros (unidade padrão do Revit é pés)
            elevacao_metros = UnitUtils.ConvertFromInternalUnits(elevacao_param, UnitTypeId.Meters)
            elevacoes_niveis.append(elevacao_metros)

        # Saída: Duas listas - uma com os nomes dos níveis e outra com as elevações
        OUT = (nomes_niveis, elevacoes_niveis)
else:
    OUT = "Erro: Por favor, selecione um vínculo válido na entrada 0."
# ----------------------------------------
code_block_8 = CodeBlock { 0; 1; }
getItemAtIndex_2 = List.GetItemAtIndex(list=python_script_2, index=code_block_8.out1)
getItemAtIndex_3 = List.GetItemAtIndex(list=python_script_2, index=code_block_8.out0)
code_block_9 = CodeBlock { 1; }
getItemAtIndex_4 = List.GetItemAtIndex(list=multipleinputform.User_Inputs, index=code_block_9)
add = getItemAtIndex_3 + getItemAtIndex_4
byElevationAndName = Level.ByElevationAndName(elevation=getItemAtIndex_2, name=add)
byLevel = FloorPlanView.ByLevel(level=byElevationAndName)

# group: Mensagem Final
count = List.Count(list=byLevel)
code_block_10 = CodeBlock { 0; }
gt = count > code_block_10
code_block_11 = CodeBlock(N=count) { ["Feito! Você copiou "+N+" Níveis"]; }
code_block_12 = CodeBlock { ["Nenhum Nível foi copiado"]; }
if_ = If(test=gt, true=code_block_11, false=code_block_12)
o_string_fromlist = Orchid.Common.String.FromList(list=if_)
python_script_3 = Python(IN[0]=o_string_fromlist)
# ---------- python_script_3.python (21 lines) ----------
# Importar as bibliotecas necessárias do Revit
import clr
clr.AddReference("RevitServices")
from RevitServices.Persistence import DocumentManager

clr.AddReference("RevitAPI")
clr.AddReference("RevitAPIUI")
from Autodesk.Revit.UI import TaskDialog

# Pegar a entrada do Dynamo
mensagem = IN[0]

# Criar a TaskDialog
task_dialog = TaskDialog("Ok")
task_dialog.MainInstruction = mensagem

# Exibir a TaskDialog
task_dialog.Show()

# Saída do script
OUT = "Sucesso!"
# ----------------------------------------
