# Dynamo graph 07-1_BIMACON_Diagrama Unifilar MEDIDOR_R04_script.dyn (Dynamo 3.3.0.6316)
# author: Jose Nelson
# Criação de diagrama Unifilar para Medidor
# packages: Data-Shapes 2022.2.105, DynaMEP 2.0.1, Rhythm 2023.4.2021, MEPover 2022.10.30

# group: ENTRADAS PARA O USUÁRIO
code_block = CodeBlock { "Criar Diagrama unifilar do Medidor"; }
string = StringInput("LogoBimacon.png")
python_script = Python(IN[0]=string)  # IronPython2
# ---------- python_script.python (22 lines) ----------
import clr

# Adiciona referência ao ambiente .NET
clr.AddReference('System')
from System import Environment, IO

# Nome da imagem (entrada do usuário)
nome_arquivo_imagem = IN[0]

# Recupera o nome do usuário logado no Windows
usuario = Environment.UserName

# Monta o caminho completo para a pasta de imagens
caminho_base = r"C:\Users\{0}\AppData\Roaming\pyRevit\Extensions\Bimacon.extension\Bimacon.tab\Imagens_Bimacon".format(usuario)

# Junta o caminho base com o nome do arquivo
caminho_completo = IO.Path.Combine(caminho_base, nome_arquivo_imagem)

# Verifica se o arquivo existe
existe = IO.File.Exists(caminho_completo)

OUT = caminho_completo if existe else "Imagem não encontrada: {0}".format(caminho_completo)
# ----------------------------------------
file_from_path = FileObject(path=python_script)
readFromFile = Image.ReadFromFile(file=file_from_path)
string_2 = StringInput("Confirmar")
string_3 = StringInput("SELECIONE O MEDIDOR")
string_4 = StringInput("Selecione")
categories = Categories("OST_ElectricalEquipment")
boolean = BoolSelector(true)
selectmodelelements_data = Custom[SelectModelElements Data](InputName=string_3, ButtonText=string_4, CategoryFilter=categories, SelectSingleElement=boolean)  # package Data-Shapes; Creates a Revit element selection input for UI.MultipleInputForm++ . Check out www.data-shapes.net for more infos!
string_5 = StringInput("SELECIONE O DIAGRAMA")
string_6 = StringInput("Selecione")
categories_2 = Categories("OST_GenericAnnotation")
boolean_2 = BoolSelector(true)
selectmodelelements_data_2 = Custom[SelectModelElements Data](InputName=string_5, ButtonText=string_6, CategoryFilter=categories_2, SelectSingleElement=boolean_2)
list_create = List.Create(item0=selectmodelelements_data, item1=selectmodelelements_data_2)
boolean_3 = BoolSelector(true)
string_7 = StringInput("Cancelar")
number = DoubleInput(450)
number_2 = DoubleInput(175)
multipleinputform = Custom[MultipleInputForm ++](Description_optional=code_block, Logo_optional=readFromFile, ButtonText_optional=string_2, Inputs=list_create, Toggle=boolean_3, CancelButtonText_optional=string_7, Width_optional=number, LabelWidth_optional=number_2)  # package Data-Shapes; Create a form with multiple inputs. see www.data-shapes.net for tutorials and infos!
code_block_2 = CodeBlock()  # //archilab
code_block_3 = CodeBlock()  # //Data-Shapes

# group: Separar Entradas
code_block_4 = CodeBlock { 1; }
getItemAtIndex = List.GetItemAtIndex(list=multipleinputform.User_Inputs, index=code_block_4)
code_block_5 = CodeBlock { 0; }
getItemAtIndex_2 = List.GetItemAtIndex(list=multipleinputform.User_Inputs, index=code_block_5)

code_block_6 = CodeBlock { 2021; 2022; 2023; 2024; 2025; }

# group: Versão Revit
version = Python()  # "Document.Version"; IronPython2; unwired: IN[0]
# ---------- version.python (13 lines) ----------
# Importa as bibliotecas necessárias do Revit
import clr
clr.AddReference('RevitServices')
from RevitServices.Persistence import DocumentManager

# Obtém o documento ativo
doc = DocumentManager.Instance.CurrentUIApplication.Application

# Obtém o número da versão do Revit
revit_version = doc.VersionNumber

# Retorna o número da versão do Revit
OUT = "A versão do Revit é: {}".format(revit_version)
# ----------------------------------------
code_block_7 = CodeBlock { " "; }
split = String.Split(string=version, separator0=code_block_7)
lastItem = List.LastItem(list=split)
toNumber = String.ToNumber(string=lastItem)

# group: POTÊNCIA TOTAL CONECTADA
eq = code_block_6.out4 == toNumber
n2025 = CodeBlock { "Potência aparente conectada total"; }  # "2025"
n2021_2022_2023_2024 = CodeBlock { "Total conectado"; }  # "2021 - 2022 - 2023 - 2024"
if_ = If(test=eq, true=n2025, false=n2021_2022_2023_2024)

# group: DEMANDA TOTAL
eq_2 = code_block_6.out4 == toNumber
le = toNumber <= code_block_6.out2
n2021_2022_2023 = CodeBlock { "Demanda do total estimado"; }  # "2021 - 2022 - 2023"
if_2 = If(test=le, true=n2021_2022_2023, false=code_block_6.out1)
if_3 = If(test=eq_2, true=code_block_6.out4, false=code_block_6.out0)
eq_3 = if_2 == if_3
eq_4 = eq_2 == eq_3
ge = toNumber >= code_block_6.out3
if_4 = If(test=ge, true=toNumber, false=code_block_6.out4)
ge_2 = if_4 >= if_2
n2024 = CodeBlock { "Demanda total estimada"; }  # "2024"
if_5 = If(test=ge_2, true=n2024, false=n2021_2022_2023)
n2025_2 = CodeBlock { "Potência aparente de demanda total"; }  # "2025"
if_6 = If(test=eq_4, true=if_5, false=n2025_2)

# group: CIRCUITO MEDIDOR
do_2021_ao_2025 = CodeBlock { "Panel Name"; "Nome do painel"; }
categories_3 = Categories("OST_ElectricalCircuit")
all_elements_of_category = ElementsOfCategory(Category=categories_3)
do_2021_ao_2025_2 = CodeBlock { "Load Name"; "Nome da carga"; }
getParameterValueByName = Element.GetParameterValueByName(element=all_elements_of_category, parameterName=do_2021_ao_2025_2.out1)
getParameterValueByName_2 = Element.GetParameterValueByName(element=getItemAtIndex_2, parameterName=do_2021_ao_2025.out1)
eq_5 = getParameterValueByName == getParameterValueByName_2
filterByBoolMask = List.FilterByBoolMask(list=all_elements_of_category, mask=eq_5)

# group: CORRENTE DEMANDA
le_2 = toNumber <= code_block_6.out2
n2021_2022_2023_2 = CodeBlock { "Total de demanda de corrente estimada"; }  # "2021 - 2022 - 2023"
n2024_2025 = CodeBlock { "Total da corrente de demanda estimada"; }  # "2024 - 2025"
if_7 = If(test=le_2, true=n2021_2022_2023_2, false=n2024_2025)

# group: PARAMETROS MEDIDOR
do_2021_ao_2025_3 = CodeBlock { "N° de Fases"; "Total de corrente conectada"; "Potência Ativa (W)"; }
create = List.Create(item0=if_, item1=if_6, item2=do_2021_ao_2025.out1, item3=do_2021_ao_2025_3.out0, item4=do_2021_ao_2025_3.out1, item5=if_7, item6=do_2021_ao_2025_3.out2)
getParameterValueByName_3 = Element.GetParameterValueByName(element=getItemAtIndex_2, parameterName=create)
getParameterValueByName_4 = Element.GetParameterValueByName(element=getItemAtIndex_2, parameterName=if_7)
watch = Watch(getParameterValueByName_4)

# group: PARAMETROS UNIFILAR
code_block_8 = CodeBlock()
# ---------- code_block_8.designscript (7 lines) ----------
"POTÊNCIA INSTALADA";
"POTÊNCIA DEMANDADA";
"NOME";
"NF ENTRADA";
"Corrente Instalada";
"Corrente Demandada";
"POTÊNCIA ATIVA";
# ----------------------------------------
create_2 = List.Create(item0=code_block_8.out0, item1=code_block_8.out1, item2=code_block_8.out2, item3=code_block_8.out3, item4=code_block_8.out4, item5=code_block_8.out5, item6=code_block_8.out6)
setParameterByName = Element.SetParameterByName(element=getItemAtIndex, parameterName=create_2, value=getParameterValueByName_3)

# group: DISJUNTOR
eq_6 = code_block_6.out0 == toNumber
n2021 = CodeBlock { "Rating"; "Classificação"; }  # "2021"
n2022_2023_2024_2025 = CodeBlock { "Proteção do circuito"; }  # "2022 - 2023 - 2024 - 2025"
if_8 = If(test=eq_6, true=n2021.out1, false=n2022_2023_2024_2025)

# group: DISJUNTOR GERAL
code_block_9 = CodeBlock { 16; 20; 25; 32; 40; 50; 63; 70; 80; 100; 125; 150; 160; 175; 180; 200; 225; 250; }
create_3 = List.Create(item0=code_block_9.out0, item1=code_block_9.out1, item2=code_block_9.out2, item3=code_block_9.out3, item4=code_block_9.out4, item5=code_block_9.out5, item6=code_block_9.out6, item7=code_block_9.out7, item8=code_block_9.out8, item9=code_block_9.out9, item10=code_block_9.out10, item11=code_block_9.out11, item12=code_block_9.out12, item13=code_block_9.out13, item14=code_block_9.out14, item15=code_block_9.out15, item16=code_block_9.out16, item17=code_block_9.out17)
lt = create_3 < _  # unwired: y
map = List.Map(list=getParameterValueByName_4, function=lt)
code_block_10 = CodeBlock { false; }
allIndicesOf = List.AllIndicesOf(list=map@L2, item=code_block_10)
firstItem = List.FirstItem(list=allIndicesOf@L2)
getItemAtIndex_3 = List.GetItemAtIndex(list=create_3, index=firstItem)
watch_2 = Watch(getItemAtIndex_3)
code_block_11 = CodeBlock { "DJ ENTRADA"; }
setParameterByName_2 = Element.SetParameterByName(element=getItemAtIndex, parameterName=code_block_11, value=getItemAtIndex_3)
setParameterByName_3 = Element.SetParameterByName(element=filterByBoolMask.in, parameterName=if_8, value=getItemAtIndex_3)

# group: FIAÇÃO
do_2021_ao_2025_4 = CodeBlock { "Wire Size"; "Tamanho da fiação"; }
getParameterValueByName_5 = Element.GetParameterValueByName(element=setParameterByName_3, parameterName=do_2021_ao_2025_4.out1)
code_block_12 = CodeBlock { "-#"; }
split_2 = String.Split(string=getParameterValueByName_5, separator0=code_block_12)
code_block_13 = CodeBlock { 1; }
getItemAtIndex_4 = List.GetItemAtIndex(list=split_2@L2, index=code_block_13)
code_block_14 = CodeBlock { "("; }
split_3 = String.Split(string=getItemAtIndex_4, separator0=code_block_14)
code_block_15 = CodeBlock { 0; }
getItemAtIndex_5 = List.GetItemAtIndex(list=split_3@L2, index=code_block_15)
watch_3 = Watch(getItemAtIndex_5)
code_block_16 = CodeBlock { "SEÇÃO CONDUTOR"; }
setParameterByName_4 = Element.SetParameterByName(element=getItemAtIndex, parameterName=code_block_16, value=getItemAtIndex_5)

# group: POT EM WATTS
le_3 = toNumber <= code_block_6.out3
n2021_2022_2023_2024_2 = CodeBlock { "Carga real"; }  # "2021 - 2022 - 2023 - 2024"
n2025_3 = CodeBlock { "Potência real"; }  # "2025"
if_9 = If(test=le_3, true=n2021_2022_2023_2024_2, false=n2025_3)

# group: POTÊNCIA APARENTE
le_4 = toNumber <= code_block_6.out3
n2021_2022_2023_2024_3 = CodeBlock { "Total conectado"; }  # "2021 - 2022 - 2023 - 2024"
n2025_4 = CodeBlock { "Potência aparente conectada total"; }  # "2025"
if_10 = If(test=le_4, true=n2021_2022_2023_2024_3, false=n2025_4)

# group: Atribui Potência Ativa W
nome_do_parâmetro = StringInput("Potência Ativa (W)")
electricalCircuit = Custom[Element.ElectricalCircuit](element=getItemAtIndex_2)  # package MEPover; Returns the electrical circuit of the element
ʳʰʸᵗʰᵐ_elements = Rhythm.Revit.Elements.Elements.GetParameterValueByNameTypeOrInstance(element=electricalCircuit, parameterName=if_9)
maximumItem = List.MaximumItem(list=ʳʰʸᵗʰᵐ_elements)
unit_conversion = CodeBlock(n=maximumItem) { n<1>/[0.09290304]; }
setParameterValueByName = RevitModel.Element.SetParameterValueByName(element=getItemAtIndex, parameterName=nome_do_parâmetro, values=unit_conversion)
nome_do_parâmetro_2 = StringInput("Potência Aparente (VA)")
ʳʰʸᵗʰᵐ_elements_2 = Rhythm.Revit.Elements.Elements.GetParameterValueByNameTypeOrInstance(element=getItemAtIndex_2, parameterName=if_10)
unit_conversion_2 = CodeBlock(n=ʳʰʸᵗʰᵐ_elements_2) { n<1>/[0.09290304]; }
setParameterValueByName_2 = RevitModel.Element.SetParameterValueByName(element=getItemAtIndex_2, parameterName=nome_do_parâmetro_2, values=unit_conversion_2)
code_block_17 = CodeBlock { 0.1; }
code_block_18 = CodeBlock(N=ʳʰʸᵗʰᵐ_elements_2, step=code_block_17) { Maths.Round(N/step)*step; }
floor = Math.Floor(number=code_block_18)
code_block_19 = CodeBlock { 0.1; }
code_block_20 = CodeBlock(M=maximumItem, step=code_block_19) { Maths.Round(M/step)*step; }
floor_2 = Math.Floor(number=code_block_20)
setParameterValueByName_3 = RevitModel.Element.SetParameterValueByName(element=getItemAtIndex_2, parameterName=nome_do_parâmetro, values=unit_conversion)
