# Dynamo graph 07-0_BIMACON_Diagrama Unifilar QDC_R04_script.dyn (Dynamo 3.3.0.6316)
# author: José Nelson
# Criação do Diagrama Unifilar do QDC selecionado
# packages: Data-Shapes 2022.2.105, DynaMEP 2.0.1, Rhythm 2023.4.2021, MEPover 2022.10.30

# group: ENTRADAS PARA O USUÁRIO
code_block = CodeBlock { "Criar Diagrama unifilar do QDC"; }
string = StringInput("LogoBimacon.png")
python_script = Python(IN[0]=string)  # IronPython2
# ---------- python_script.python (22 lines) ----------
import clr

# Adiciona referência ao ambiente .NET
clr.AddReference('System')
from System import Environment, IO

# Nome da imagem (entrada do usuário)
nome_arquivo_imagem = IN[0]

# Recupera o nome do usuário logado no Windows
usuario = Environment.UserName

# Monta o caminho completo para a pasta de imagens
caminho_base = r"C:\Users\{0}\AppData\Roaming\pyRevit\Extensions\Bimacon.extension\Bimacon.tab\Imagens_Bimacon".format(usuario)

# Junta o caminho base com o nome do arquivo
caminho_completo = IO.Path.Combine(caminho_base, nome_arquivo_imagem)

# Verifica se o arquivo existe
existe = IO.File.Exists(caminho_completo)

OUT = caminho_completo if existe else "Imagem não encontrada: {0}".format(caminho_completo)
# ----------------------------------------
file_from_path = FileObject(path=python_script)
readFromFile = Image.ReadFromFile(file=file_from_path)
string_2 = StringInput("Confirmar")
string_3 = StringInput("SELECIONE O QUADRO")
string_4 = StringInput("Selecione")
categories = Categories("OST_ElectricalEquipment")
boolean = BoolSelector(true)
selectmodelelements_data = Custom[SelectModelElements Data](InputName=string_3, ButtonText=string_4, CategoryFilter=categories, SelectSingleElement=boolean)  # package Data-Shapes; Creates a Revit element selection input for UI.MultipleInputForm++ . Check out www.data-shapes.net for more infos!
string_5 = StringInput("SELECIONE O DIAGRAMA")
string_6 = StringInput("Selecione")
categories_2 = Categories("OST_GenericAnnotation")
boolean_2 = BoolSelector(true)
selectmodelelements_data_2 = Custom[SelectModelElements Data](InputName=string_5, ButtonText=string_6, CategoryFilter=categories_2, SelectSingleElement=boolean_2)
list_create = List.Create(item0=selectmodelelements_data, item1=selectmodelelements_data_2)
boolean_3 = BoolSelector(true)
string_7 = StringInput("Cancelar")
number = DoubleInput(450)
number_2 = DoubleInput(175)
multipleinputform = Custom[MultipleInputForm ++](Description_optional=code_block, Logo_optional=readFromFile, ButtonText_optional=string_2, Inputs=list_create, Toggle=boolean_3, CancelButtonText_optional=string_7, Width_optional=number, LabelWidth_optional=number_2)  # package Data-Shapes; Create a form with multiple inputs. see www.data-shapes.net for tutorials and infos!
code_block_2 = CodeBlock()  # //Data-Shapes
code_block_3 = CodeBlock()  # //archilab

# group: Separar Entradas
code_block_4 = CodeBlock { 0; }
getItemAtIndex = List.GetItemAtIndex(list=multipleinputform.User_Inputs, index=code_block_4)
code_block_5 = CodeBlock { 1; }
getItemAtIndex_2 = List.GetItemAtIndex(list=multipleinputform.User_Inputs, index=code_block_5)

# group: Versão Revit
version = Python()  # "Document.Version"; IronPython2; unwired: IN[0]
# ---------- version.python (13 lines) ----------
# Importa as bibliotecas necessárias do Revit
import clr
clr.AddReference('RevitServices')
from RevitServices.Persistence import DocumentManager

# Obtém o documento ativo
doc = DocumentManager.Instance.CurrentUIApplication.Application

# Obtém o número da versão do Revit
revit_version = doc.VersionNumber

# Retorna o número da versão do Revit
OUT = "A versão do Revit é: {}".format(revit_version)
# ----------------------------------------
code_block_6 = CodeBlock { " "; }
split = String.Split(string=version, separator0=code_block_6)
lastItem = List.LastItem(list=split)
toNumber = String.ToNumber(string=lastItem)

code_block_7 = CodeBlock { 2021; 2022; 2023; 2024; 2025; }

# group: NÚMERO DE LINHAS DA TABELA
eq = toNumber == code_block_7.out2
n2021_2022_2023 = CodeBlock { "Max #1 Pole Breakers"; "Número máximo de circuitos"; }  # "2021 - 2022 - 2023"
n2024_2025 = CodeBlock { "Número máx. de disjuntores de um polo"; }  # "2024 - 2025"
if_ = If(test=eq, true=n2021_2022_2023.out1, false=n2024_2025)

# group: NOME DO PAINEL
code_block_8 = CodeBlock { "Panel Name"; "Nome do painel"; }
getParameterValueByName = Element.GetParameterValueByName(element=getItemAtIndex, parameterName=code_block_8.out1)

# group: SELEÇAO E ORGANIZAÇÃO DOS CIRCUITOS
categories_3 = Categories("OST_ElectricalCircuit")
all_elements_of_category = ElementsOfCategory(Category=categories_3)
code_block_9 = CodeBlock { "Panel"; "Painel"; }
getParameterValueByName_2 = Element.GetParameterValueByName(element=all_elements_of_category, parameterName=code_block_9.out1)
eq_2 = getParameterValueByName_2 == getParameterValueByName
filterByBoolMask = List.FilterByBoolMask(list=all_elements_of_category, mask=eq_2)
code_block_10 = CodeBlock { "Circuit Number"; "Número do circuito"; }
getParameterValueByName_3 = Element.GetParameterValueByName(element=filterByBoolMask.in, parameterName=code_block_10.out1)
string_8 = StringInput(",")
split_2 = String.Split(string=getParameterValueByName_3, separator0=string_8)
code_block_11 = CodeBlock { "FCT"; }
FCT = DoubleInput(1)  # graph input
setParameterByName = Element.SetParameterByName(element=filterByBoolMask.in, parameterName=code_block_11, value=FCT)
firstItem = List.FirstItem(list=split_2@L2)
toNumber_2 = String.ToNumber(string=firstItem)
sortIndexByValue = List.SortIndexByValue(list=toNumber_2)
getItemAtIndex_3 = List.GetItemAtIndex(list=setParameterByName, index=sortIndexByValue)

# group: Max #1 Pole Breakers
count = List.Count(list=split_2@L1)
count_2 = List.Count(list=count)
code_block_12 = CodeBlock { 10; }
add = count_2 + code_block_12
setParameterByName_2 = Element.SetParameterByName(element=getItemAtIndex, parameterName=if_, value=add)

count_3 = List.Count(list=getItemAtIndex_3)
do_2021_ao_2025 = CodeBlock { "Número do circuito"; }

# group: N° de Fases/Polos
le = toNumber <= code_block_7.out1
n2021_2022 = CodeBlock { "Número de pólos"; }  # "2021 - 2022"
n2023_2024_2025 = CodeBlock { "Número de polos"; }  # "2023 - 2024 - 2025"
if_2 = If(test=le, true=n2021_2022, false=n2023_2024_2025)

do_2021_ao_2025_2 = CodeBlock { "Load Name"; "Nome da carga"; }

# group: POTÊNCIA APARENTE
eq_3 = code_block_7.out4 == toNumber
n2025 = CodeBlock { "Potência aparente"; }  # "2025"
n2021_2022_2023_2024 = CodeBlock { "Carga aparente"; }  # "2021 - 2022 - 2023 - 2024"
if_3 = If(test=eq_3, true=n2025, false=n2021_2022_2023_2024)

# group: DISJUNTOR
eq_4 = code_block_7.out0 == toNumber
n2021 = CodeBlock { "Rating"; "Classificação"; }  # "2021"
n2022_2023_2024_2025 = CodeBlock { "Proteção do circuito"; }  # "2022 - 2023 - 2024 - 2025"
if_4 = If(test=eq_4, true=n2021.out1, false=n2022_2023_2024_2025)

# group: DEMANDA
le_2 = toNumber <= code_block_7.out2
n2021_2022_2023_2 = CodeBlock { "Total Estimated Demand Current"; "Total de demanda de corrente estimada"; }  # "2021 - 2022 - 2023"
n2024_2025_2 = CodeBlock { "Total da corrente de demanda estimada"; }  # "2024 - 2025"
if_5 = If(test=le_2, true=n2021_2022_2023_2.out1, false=n2024_2025_2)

do_2021_ao_2025_3 = CodeBlock { "Apparent Current"; "Corrente aparente"; }

# group: CORRENTE CORRIGIDA
getParameterValueByName_4 = Element.GetParameterValueByName(element=getItemAtIndex_3, parameterName=do_2021_ao_2025_3.out1, lacing=CrossProduct)
code_block_13 = CodeBlock { "FCA"; "FCT"; }
getParameterValueByName_5 = Element.GetParameterValueByName(element=getItemAtIndex_3, parameterName=code_block_13.out0, lacing=CrossProduct)
getParameterValueByName_6 = Element.GetParameterValueByName(element=getItemAtIndex_3, parameterName=code_block_13.out1, lacing=CrossProduct)
IC = CodeBlock(x=getParameterValueByName_4, y=getParameterValueByName_5, z=getParameterValueByName_6) { x/y/z; }
code_block_14 = CodeBlock(n=count_3) { 1..n; "IC"; }
string_from_object = FromObject(object=code_block_14.out0)
code_block_15 = CodeBlock(CORRENT=code_block_14.out1, n=string_from_object) { CORRENT+n; }
setParameterByName_3 = Element.SetParameterByName(element=getItemAtIndex_2, parameterName=code_block_15, value=IC)

# group: DIMENSIONAMENTO DOS DISJUNTORES
cycle = List.Cycle(list=if_4, amount=count_3)
code_block_16 = CodeBlock { 10; 16; 20; 25; 32; 40; 50; 63; 70; 80; 100; 125; 150; 160; 175; 180; 200; 225; 250; }
create = List.Create(item0=code_block_16.out0, item1=code_block_16.out1, item2=code_block_16.out2, item3=code_block_16.out3, item4=code_block_16.out4, item5=code_block_16.out5, item6=code_block_16.out6, item7=code_block_16.out7, item8=code_block_16.out8, item9=code_block_16.out9, item10=code_block_16.out10, item11=code_block_16.out11, item12=code_block_16.out12, item13=code_block_16.out13, item14=code_block_16.out14, item15=code_block_16.out15, item16=code_block_16.out16, item17=code_block_16.out17, item18=code_block_16.out18)
flatten = List.Flatten(list=IC)
lt = create < _  # unwired: y
map = List.Map(list=flatten, function=lt)
code_block_17 = CodeBlock { false; }
allIndicesOf = List.AllIndicesOf(list=map@L2, item=code_block_17)
firstItem_2 = List.FirstItem(list=allIndicesOf@L2)
getItemAtIndex_4 = List.GetItemAtIndex(list=create, index=firstItem_2)
setParameterByName_4 = Element.SetParameterByName(element=getItemAtIndex_3, parameterName=cycle, value=getItemAtIndex_4)
flatten_2 = List.Flatten(list=setParameterByName_4)

# group: DISJUNTOR GERAL
code_block_18 = CodeBlock { 10; 16; 20; 25; 32; 40; 50; 63; 70; 80; 100; 125; 150; 160; 175; 180; 200; 225; 250; }
create_2 = List.Create(item0=code_block_18.out0, item1=code_block_18.out1, item2=code_block_18.out2, item3=code_block_18.out3, item4=code_block_18.out4, item5=code_block_18.out5, item6=code_block_18.out6, item7=code_block_18.out7, item8=code_block_18.out8, item9=code_block_18.out9, item10=code_block_18.out10, item11=code_block_18.out11, item12=code_block_18.out12, item13=code_block_18.out13, item14=code_block_18.out14, item15=code_block_18.out15, item16=code_block_18.out16, item17=code_block_18.out17, item18=code_block_18.out18)
getParameterValueByName_7 = Element.GetParameterValueByName(element=getItemAtIndex, parameterName=if_5)
lt_2 = create_2 < _  # unwired: y
map_2 = List.Map(list=getParameterValueByName_7, function=lt_2)
code_block_19 = CodeBlock { false; }
allIndicesOf_2 = List.AllIndicesOf(list=map_2@L2, item=code_block_19)
firstItem_3 = List.FirstItem(list=allIndicesOf_2@L2)
getItemAtIndex_5 = List.GetItemAtIndex(list=create_2, index=firstItem_3)
code_block_20 = CodeBlock { "DJ GERAL"; }
create_3 = List.Create(item0=getItemAtIndex_5, item1=getItemAtIndex_4)
transpose = List.Transpose(lists=create_3)
maximumItem = List.MaximumItem(list=transpose)
maximumItem_2 = List.MaximumItem(list=maximumItem@L2)
setParameterByName_5 = Element.SetParameterByName(element=getItemAtIndex_2, parameterName=code_block_20, value=maximumItem_2)

# group: CIRCUITO DE ALIMENTAÇÃO
categories_4 = Categories("OST_ElectricalCircuit")
all_elements_of_category_2 = ElementsOfCategory(Category=categories_4)
getParameterValueByName_8 = Element.GetParameterValueByName(element=all_elements_of_category_2, parameterName=do_2021_ao_2025_2.out1)
eq_5 = getParameterValueByName_8 == getParameterValueByName
filterByBoolMask_2 = List.FilterByBoolMask(list=all_elements_of_category_2, mask=eq_5)
setParameterByName_6 = Element.SetParameterByName(element=filterByBoolMask_2.in, parameterName=if_4, value=getItemAtIndex_5)
parameters = Element.Parameters(element=setParameterByName_6)
name = Parameter.Name(parameter=parameters)
contains = String.Contains(string=name, searchFor=if_3)
filterByBoolMask_3 = List.FilterByBoolMask(list=name, mask=contains)
flatten_3 = List.Flatten(list=filterByBoolMask_3.in)
code_block_21 = CodeBlock { "fase A"; "fase B"; "fase C"; }
boolean_4 = BoolSelector(true)
contains_2 = String.Contains(string=flatten_3, searchFor=code_block_21.out0, ignoreCase=boolean_4)
filterByBoolMask_4 = List.FilterByBoolMask(list=flatten_3, mask=contains_2)
contains_3 = String.Contains(string=flatten_3, searchFor=code_block_21.out1, ignoreCase=boolean_4)
filterByBoolMask_5 = List.FilterByBoolMask(list=flatten_3, mask=contains_3)
contains_4 = String.Contains(string=flatten_3, searchFor=code_block_21.out2, ignoreCase=boolean_4)
filterByBoolMask_6 = List.FilterByBoolMask(list=flatten_3, mask=contains_4)
code_block_22 = CodeBlock { "POGA"; "POGB"; "POGC"; }
create_4 = List.Create(item0=code_block_22.out0, item1=code_block_22.out1, item2=code_block_22.out2)
getParameterValueByName_9 = Element.GetParameterValueByName(element=setParameterByName_6, parameterName=flatten_3, lacing=Longest)
setParameterByName_7 = Element.SetParameterByName(element=getItemAtIndex_2, parameterName=create_4, value=getParameterValueByName_9, lacing=Longest)
code_block_23 = CodeBlock { 0; 1; 2; }
getItemAtIndex_6 = List.GetItemAtIndex(list=flatten_3, index=code_block_23.out0)
getItemAtIndex_7 = List.GetItemAtIndex(list=flatten_3, index=code_block_23.out1)
getItemAtIndex_8 = List.GetItemAtIndex(list=flatten_3, index=code_block_23.out2)

do_2021_ao_2025_4 = CodeBlock { "Wire Size"; "Tamanho da fiação"; }

# group: TENSÃO
eq_6 = code_block_7.out0 == toNumber
n2021_2 = CodeBlock { "Voltage"; "Voltagem"; }  # "2021"
n2022_2023_2024_2025_2 = CodeBlock { "Tensão"; }  # "2022 - 2023 - 2024 - 2025"
if_6 = If(test=eq_6, true=n2021_2.out1, false=n2022_2023_2024_2025_2)

# group: SEÇÃO PELA QUEDA DE TENSÃO
code_block_24 = CodeBlock { 1.5; 2.5; 4; 6; 10; 16; 25; 35; 50; 70; 95; 120; 150; 185; 240; 300; 400; }
create_5 = List.Create(item0=code_block_24.out0, item1=code_block_24.out1, item2=code_block_24.out2, item3=code_block_24.out3, item4=code_block_24.out4, item5=code_block_24.out5, item6=code_block_24.out6, item7=code_block_24.out7, item8=code_block_24.out8, item9=code_block_24.out9, item10=code_block_24.out10, item11=code_block_24.out11, item12=code_block_24.out12, item13=code_block_24.out13, item14=code_block_24.out14, item15=code_block_24.out15, item16=code_block_24.out16)
code_block_25 = CodeBlock { "L Considerado"; }
getParameterValueByName_10 = Element.GetParameterValueByName(element=getItemAtIndex_3, parameterName=code_block_25)
getParameterValueByName_11 = Element.GetParameterValueByName(element=getItemAtIndex_3, parameterName=do_2021_ao_2025_3.out1)
getParameterValueByName_12 = Element.GetParameterValueByName(element=getItemAtIndex_3, parameterName=if_6)
SCQ = CodeBlock(LCC=getParameterValueByName_10, INNN=getParameterValueByName_11, vol=getParameterValueByName_12) { 2*LCC*INNN/58/0.04/vol; }
lt_3 = create_5 < _  # unwired: y
map_3 = List.Map(list=SCQ, function=lt_3)
code_block_26 = CodeBlock { false; }
allIndicesOf_3 = List.AllIndicesOf(list=map_3@L2, item=code_block_26)
firstItem_4 = List.FirstItem(list=allIndicesOf_3@L2)
getItemAtIndex_9 = List.GetItemAtIndex(list=create_5, index=firstItem_4)

do_2021_ao_2025_5 = CodeBlock { "Nome do painel"; }

# group: POTÊNCIA TOTAL CONECTADA
eq_7 = code_block_7.out4 == toNumber
n2025_2 = CodeBlock { "Potência aparente conectada total"; }  # "2025"
n2021_2022_2023_2024_2 = CodeBlock { "Total conectado"; }  # "2021 - 2022 - 2023 - 2024"
if_7 = If(test=eq_7, true=n2025_2, false=n2021_2022_2023_2024_2)

# group: DEMANDA TOTAL
eq_8 = code_block_7.out4 == toNumber
le_3 = toNumber <= code_block_7.out2
n2021_2022_2023_3 = CodeBlock { "Demanda do total estimado"; }  # "2021 - 2022 - 2023"
if_8 = If(test=le_3, true=n2021_2022_2023_3, false=code_block_7.out1)
if_9 = If(test=eq_8, true=code_block_7.out4, false=code_block_7.out0)
eq_9 = if_8 == if_9
eq_10 = eq_8 == eq_9
ge = toNumber >= code_block_7.out3
if_10 = If(test=ge, true=toNumber, false=code_block_7.out4)
ge_2 = if_10 >= if_8
n2024 = CodeBlock { "Demanda total estimada"; }  # "2024"
if_11 = If(test=ge_2, true=n2024, false=n2021_2022_2023_3)
n2025_3 = CodeBlock { "Potência aparente de demanda total"; }  # "2025"
if_12 = If(test=eq_10, true=if_11, false=n2025_3)

do_2021_ao_2025_6 = CodeBlock { "Total de corrente conectada"; }

# group: CORRENTE DEMANDA
le_4 = toNumber <= code_block_7.out2
n2021_2022_2023_4 = CodeBlock { "Total de demanda de corrente estimada"; }  # "2021 - 2022 - 2023"
n2024_2025_3 = CodeBlock { "Total da corrente de demanda estimada"; }  # "2024 - 2025"
if_13 = If(test=le_4, true=n2021_2022_2023_4, false=n2024_2025_3)

# group: PARÂMETROS DOS CIRCUITOS
code_block_27 = CodeBlock { "IDR"; }
create_6 = List.Create(item0=do_2021_ao_2025, item1=if_2, item2=do_2021_ao_2025_2.out1, item3=if_3, item4=filterByBoolMask_4.in, item5=filterByBoolMask_5.in, item6=filterByBoolMask_6.in, item7=code_block_27)
flatten_4 = List.Flatten(list=create_6)
getParameterValueByName_13 = Element.GetParameterValueByName(element=getItemAtIndex_3, parameterName=flatten_4, lacing=CrossProduct)
code_block_28 = CodeBlock { "N° de Fases"; }
create_7 = List.Create(item0=do_2021_ao_2025_5, item1=if_7, item2=if_12, item3=do_2021_ao_2025_6, item4=if_13, item5=code_block_28)
getParameterValueByName_14 = Element.GetParameterValueByName(element=getItemAtIndex, parameterName=create_7, lacing=CrossProduct)

addItemToEnd = List.AddItemToEnd(item=count_3, list=getParameterValueByName_14)

# group: PARÂMETROS DO UNIFILAR
code_block_29 = CodeBlock(n=count_3) { 1..n; "CI"; "NP"; "DE"; "PO"; "PFA"; "PFB"; "PFC"; "IDR"; }
string_from_object_2 = FromObject(object=code_block_29.out0)
code_block_30 = CodeBlock(circuito=code_block_29.out1, n=string_from_object_2, numerodepolo=code_block_29.out2, descrição=code_block_29.out3, potencia=code_block_29.out4, POTA=code_block_29.out5, POTB=code_block_29.out6, POTC=code_block_29.out7, IDR=code_block_29.out8) { circuito+n; numerodepolo+n; descrição+n; potencia+n; POTA+n; POTB+n; POTC+n; IDR+n; }
create_8 = List.Create(item0=code_block_30.out0, item1=code_block_30.out1, item2=code_block_30.out2, item3=code_block_30.out3, item4=code_block_30.out4, item5=code_block_30.out5, item6=code_block_30.out6, item7=code_block_30.out7)
transpose_2 = List.Transpose(lists=create_8)
setParameterByName_8 = Element.SetParameterByName(element=getItemAtIndex_2, parameterName=transpose_2, value=getParameterValueByName_13)
flatten_5 = List.Flatten(list=setParameterByName_8)
code_block_31 = CodeBlock { "PAINEL"; "POT INST"; "POT DEM"; "COR"; "COR DEM"; "NFQ"; "POSIÇOES QUADRO"; }
create_9 = List.Create(item0=code_block_31.out0, item1=code_block_31.out1, item2=code_block_31.out2, item3=code_block_31.out3, item4=code_block_31.out4, item5=code_block_31.out5, item6=code_block_31.out6)
transpose_3 = List.Transpose(lists=create_9)
setParameterByName_9 = Element.SetParameterByName(element=getItemAtIndex_2, parameterName=transpose_3, value=addItemToEnd)
flatten_6 = List.Flatten(list=setParameterByName_9)

# group: DIMENSIONAMENTO DA FIAÇÃO
code_block_32 = CodeBlock(n=count_3) { 1..n; "BI"; }
string_from_object_3 = FromObject(object=code_block_32.out0)
code_block_33 = CodeBlock(bitola=code_block_32.out1, n=string_from_object_3) { bitola+n; }
getParameterValueByName_15 = Element.GetParameterValueByName(element=flatten_2, parameterName=do_2021_ao_2025_4.out1)
string_9 = StringInput("-#")
split_3 = String.Split(string=getParameterValueByName_15, separator0=string_9)
number_3 = DoubleInput(1)
getItemAtIndex_10 = List.GetItemAtIndex(list=split_3@L2, index=number_3)
string_10 = StringInput("(")
split_4 = String.Split(string=getItemAtIndex_10, separator0=string_10)
number_4 = DoubleInput(0)
getItemAtIndex_11 = List.GetItemAtIndex(list=split_4@L2, index=number_4)
string_11 = StringInput(",")
string_12 = StringInput(".")
replace = String.Replace(string=getItemAtIndex_11, searchFor=string_11, replaceWith=string_12)
toNumber_3 = String.ToNumber(string=replace)
create_10 = List.Create(item0=toNumber_3, item1=getItemAtIndex_9)
transpose_4 = List.Transpose(lists=create_10)
maximumItem_3 = List.MaximumItem(list=transpose_4)
watch = Watch(maximumItem_3)
setParameterByName_10 = Element.SetParameterByName(element=flatten_5, parameterName=code_block_33, value=watch)
string_13 = StringInput("Seção do Condutor Adotado (mm²)")
setParameterByName_11 = Element.SetParameterByName(element=flatten_2, parameterName=string_13, value=watch)
string_14 = StringInput("Seçao (Queda de Tensão)")
setParameterByName_12 = Element.SetParameterByName(element=flatten_2, parameterName=string_14, value=getItemAtIndex_9)

# group: SEÇAO ALIMENTAÇÃO
code_block_34 = CodeBlock { "SQG"; }
getParameterValueByName_16 = Element.GetParameterValueByName(element=filterByBoolMask_2.in, parameterName=do_2021_ao_2025_4.out1)
code_block_35 = CodeBlock { "-#"; }
split_5 = String.Split(string=getParameterValueByName_16, separator0=code_block_35)
number_5 = DoubleInput(1)
getItemAtIndex_12 = List.GetItemAtIndex(list=split_5@L2, index=number_5)
code_block_36 = CodeBlock { "("; }
split_6 = String.Split(string=getItemAtIndex_12, separator0=code_block_36)
number_6 = DoubleInput(0)
getItemAtIndex_13 = List.GetItemAtIndex(list=split_6@L2, index=number_6)
code_block_37 = CodeBlock { ","; "."; }
replace_2 = String.Replace(string=getItemAtIndex_13, searchFor=code_block_37.out0, replaceWith=code_block_37.out1)
toNumber_4 = String.ToNumber(string=replace_2)
create_11 = List.Create(item0=toNumber_4, item1=watch)
transpose_5 = List.Transpose(lists=create_11)
maximumItem_4 = List.MaximumItem(list=transpose_5)
maximumItem_5 = List.MaximumItem(list=maximumItem_4@L2)
setParameterByName_13 = Element.SetParameterByName(element=flatten_5, parameterName=code_block_34, value=maximumItem_5)

code_block_38 = CodeBlock { "ALIMENTADOR"; }
code_block_39 = CodeBlock { "Fornecimento de"; }
getParameterValueByName_17 = Element.GetParameterValueByName(element=getItemAtIndex, parameterName=code_block_39)
setParameterByName_14 = Element.SetParameterByName(element=getItemAtIndex_2, parameterName=code_block_38, value=getParameterValueByName_17)

# group: POTÊNCIA APARENTE FASE A
eq_11 = code_block_7.out4 == toNumber
n2025_4 = CodeBlock { "Potência aparente da fase A"; }  # "2025"
n2021_2022_2023_2024_3 = CodeBlock { "Carga aparente fase A"; }  # "2021 - 2022 - 2023 - 2024"
if_14 = If(test=eq_11, true=n2025_4, false=n2021_2022_2023_2024_3)

# group: POTÊNCIA APARENTE FASE B
eq_12 = code_block_7.out4 == toNumber
n2025_5 = CodeBlock { "Potência aparente da fase B"; }  # "2025"
n2021_2022_2023_2024_4 = CodeBlock { "Carga aparente fase B"; }  # "2021 - 2022 - 2023 - 2024"
if_15 = If(test=eq_12, true=n2025_5, false=n2021_2022_2023_2024_4)

# group: POTÊNCIA APARENTE FASE C
eq_13 = code_block_7.out4 == toNumber
n2025_6 = CodeBlock { "Potência aparente da fase C"; }  # "2025"
n2021_2022_2023_2024_5 = CodeBlock { "Carga aparente fase C"; }  # "2021 - 2022 - 2023 - 2024"
if_16 = If(test=eq_13, true=n2025_6, false=n2021_2022_2023_2024_5)

# group: POT EM WATTS
le_5 = toNumber <= code_block_7.out3
n2021_2022_2023_2024_6 = CodeBlock { "Carga real"; }  # "2021 - 2022 - 2023 - 2024"
n2025_7 = CodeBlock { "Potência real"; }  # "2025"
if_17 = If(test=le_5, true=n2021_2022_2023_2024_6, false=n2025_7)

# group: POTÊNCIA APARENTE
le_6 = toNumber <= code_block_7.out3
n2021_2022_2023_2024_7 = CodeBlock { "Total conectado"; }  # "2021 - 2022 - 2023 - 2024"
n2025_8 = CodeBlock { "Potência aparente conectada total"; }  # "2025"
if_18 = If(test=le_6, true=n2021_2022_2023_2024_7, false=n2025_8)

# group: Atribui Potência Ativa W
nome_do_parâmetro = StringInput("Potência Ativa (W)")
electricalCircuit = Custom[Element.ElectricalCircuit](element=getItemAtIndex)  # package MEPover; Returns the electrical circuit of the element
ʳʰʸᵗʰᵐ_elements = Rhythm.Revit.Elements.Elements.GetParameterValueByNameTypeOrInstance(element=electricalCircuit, parameterName=if_17)
maximumItem_6 = List.MaximumItem(list=ʳʰʸᵗʰᵐ_elements)
unit_conversion = CodeBlock(n=maximumItem_6) { n<1>/[0.09290304]; }
setParameterValueByName = RevitModel.Element.SetParameterValueByName(element=getItemAtIndex_2, parameterName=nome_do_parâmetro, values=unit_conversion)
nome_do_parâmetro_2 = StringInput("Potência Aparente (VA)")
ʳʰʸᵗʰᵐ_elements_2 = Rhythm.Revit.Elements.Elements.GetParameterValueByNameTypeOrInstance(element=getItemAtIndex, parameterName=if_18)
unit_conversion_2 = CodeBlock(n=ʳʰʸᵗʰᵐ_elements_2) { n<1>/[0.09290304]; }
setParameterValueByName_2 = RevitModel.Element.SetParameterValueByName(element=getItemAtIndex, parameterName=nome_do_parâmetro_2, values=unit_conversion_2)
code_block_40 = CodeBlock { 0.1; }
code_block_41 = CodeBlock(N=ʳʰʸᵗʰᵐ_elements_2, step=code_block_40) { Maths.Round(N/step)*step; }
floor = Math.Floor(number=code_block_41)
code_block_42 = CodeBlock { 0.1; }
code_block_43 = CodeBlock(M=maximumItem_6, step=code_block_42) { Maths.Round(M/step)*step; }
floor_2 = Math.Floor(number=code_block_43)
setParameterValueByName_3 = RevitModel.Element.SetParameterValueByName(element=getItemAtIndex, parameterName=nome_do_parâmetro, values=unit_conversion)
