# Dynamo graph ok 2021_00-1_BIMACON_Deletar Ambientes (Rooms) Espaços (Spaces) ou Areas_R04_script.dyn "ok 2021_00-1_BIMACON_Deletar Ambientes (Rooms) Espaços (Spaces) ou Areas_R03_script" (Dynamo 2.6.1.8786)
# Deleta todos espaços ou ambientes do projeto.
# packages: archi-lab.net 2023.213.1722, Data-Shapes 2022.2.105

# group: SELECIONE O MODELO ARQ LINKADO
code_block = CodeBlock()  # //archilab
code_block_2 = CodeBlock()  # //Data-Shapes
code_block_3 = CodeBlock { "Selecione Ambientes Espaços ou Áreas para serem deletados:"; }
file_path = Filename("..\..\..\..\..\05 - BIMACON\01 - EMPRESA BIMACON\00 - Logos e imagens - BIMACON\ARTE BIMACON\reddonda-removebg-preview.png")
file_from_path = FileObject(path=file_path)
readFromFile = Image.ReadFromFile(file=file_from_path)
string = StringInput("Confirmar")
code_block_4 = CodeBlock { "Ambientes"; "Espaços"; "Áreas"; }
list_create = List.Create(item0=code_block_4.out0, item1=code_block_4.out1, item2=code_block_4.out2)
element_types = ElementTypes("Room")  # graph input
element_types_2 = ElementTypes("Space")  # graph input
element_types_3 = ElementTypes("Area")  # graph input
list_create_2 = List.Create(item0=element_types, item1=element_types_2, item2=element_types_3)
code_block_5 = CodeBlock { 1; }
dropdown_data = Custom[DropDown Data](Keys=list_create, Values=list_create_2, DefaultValueIndex=code_block_5)  # package Data-Shapes; Create data for DropDown input in UI.MultiInputForm ++ . Check out www.data-shapes.net for more infos.
boolean = BoolSelector(true)
string_2 = StringInput("Cancelar")
multipleinputform = Custom[MultipleInputForm ++](Description_optional=code_block_3, Logo_optional=readFromFile, ButtonText_optional=string, Inputs=dropdown_data, Toggle=boolean, CancelButtonText_optional=string_2)  # package Data-Shapes; Create a form with multiple inputs. see www.data-shapes.net for tutorials and infos!

# group: Deletar espaços (spaces) ou Ambientes (Rooms) do modelo
all_elements_of_type = ElementsOfType(element_type=multipleinputform.User_Inputs)
delete = archilab.Revit.Elements.Elements.Delete(element=all_elements_of_type)

# group: Mensagem final
countTrue = List.CountTrue(list=delete)
code_block_6 = CodeBlock { 0; }
gt = countTrue > code_block_6
code_block_7 = CodeBlock(N=countTrue) { ["Feito! você deletou "+N+" elementos em seu projeto"]; }
code_block_8 = CodeBlock { ["Nenhum elemento foi deletado"]; }
if_ = If(test=gt, true=code_block_7, false=code_block_8)
flatten = List.Flatten(list=if_)
fromList = Python(IN[0]=flatten)  # "String.FromList"
# ---------- fromList.python (22 lines) ----------
# Carregar as bibliotecas DesignScript e padrão do Python
import sys
import clr
clr.AddReference('ProtoGeometry')
from Autodesk.DesignScript.Geometry import *

# Função para concatenar os valores de uma lista em uma única string com múltiplas linhas
def concatenate_list_to_string(input_list, delimiter="\n"):
    # Verifica se a entrada é uma lista
    if not isinstance(input_list, list):
        return "A entrada deve ser uma lista."
    
    # Converte todos os elementos para string e junta com o delimitador especificado
    result = delimiter.join(str(item) for item in input_list)
    return result

# Entrada pelo nó do Dynamo
lista = IN[0]  # Lista de valores a serem concatenados
delimitador = IN[1] if len(IN) > 1 else "\n"  # Delimitador opcional, padrão é nova linha

# Saída para o Dynamo
OUT = concatenate_list_to_string(lista, delimitador)
# ----------------------------------------
python_script = Python(IN[0]=fromList)
# ---------- python_script.python (21 lines) ----------
# Importar as bibliotecas necessárias do Revit
import clr
clr.AddReference("RevitServices")
from RevitServices.Persistence import DocumentManager

clr.AddReference("RevitAPI")
clr.AddReference("RevitAPIUI")
from Autodesk.Revit.UI import TaskDialog

# Pegar a entrada do Dynamo
mensagem = IN[0]

# Criar a TaskDialog
task_dialog = TaskDialog("Ok")
task_dialog.MainInstruction = mensagem

# Exibir a TaskDialog
task_dialog.Show()

# Saída do script
OUT = "Sucesso!"
# ----------------------------------------
