# Dynamo graph ok 2021_00-3_BIMACON_Excluir Espaços redundantes_R01_script.dyn "ok 2021_00-3_BIMACON_Excluir Espaços redundantes" (Dynamo 2.6.1.8786)
# Exclui Espaços redundantes do projeto
# packages: DynaMEP 2.0.1

categories = Categories("OST_MEPSpaces")
all_elements_of_category = ElementsOfCategory(Category=categories)
code_block = CodeBlock { "Área"; }
getParameterValueByName = Element.GetParameterValueByName(element=all_elements_of_category, parameterName=code_block)
code_block_2 = CodeBlock { ""; }
eq = getParameterValueByName == code_block_2
boolean = BoolSelector(true)
boolean_2 = BoolSelector(false)
if_ = If(test=eq, true=boolean, false=boolean_2)
filterByBoolMask = List.FilterByBoolMask(list=all_elements_of_category, mask=if_)
flatten = List.Flatten(list=filterByBoolMask.in)
deleteElement = RevitModel.Element.DeleteElement(element=flatten)

# group: Mensagem final
count = List.Count(list=deleteElement)
code_block_3 = CodeBlock { 0; }
gt = count > code_block_3
code_block_4 = CodeBlock(N=count) { ["Feito! Você excluiu "+N+" Espaços redundantes em seu projeto"]; }
code_block_5 = CodeBlock { ["Nenhum Espaço precisou ser excluído"]; }
if_2 = If(test=gt, true=code_block_4, false=code_block_5)
flatten_2 = List.Flatten(list=if_2)

fromList = Python(IN[0]=flatten_2)  # "String.FromList"
# ---------- fromList.python (22 lines) ----------
# Carregar as bibliotecas DesignScript e padrão do Python
import sys
import clr
clr.AddReference('ProtoGeometry')
from Autodesk.DesignScript.Geometry import *

# Função para concatenar os valores de uma lista em uma única string com múltiplas linhas
def concatenate_list_to_string(input_list, delimiter="\n"):
    # Verifica se a entrada é uma lista
    if not isinstance(input_list, list):
        return "A entrada deve ser uma lista."
    
    # Converte todos os elementos para string e junta com o delimitador especificado
    result = delimiter.join(str(item) for item in input_list)
    return result

# Entrada pelo nó do Dynamo
lista = IN[0]  # Lista de valores a serem concatenados
delimitador = IN[1] if len(IN) > 1 else "\n"  # Delimitador opcional, padrão é nova linha

# Saída para o Dynamo
OUT = concatenate_list_to_string(lista, delimitador)
# ----------------------------------------

# group (continued): Mensagem final
python_script = Python(IN[0]=fromList)
# ---------- python_script.python (21 lines) ----------
# Importar as bibliotecas necessárias do Revit
import clr
clr.AddReference("RevitServices")
from RevitServices.Persistence import DocumentManager

clr.AddReference("RevitAPI")
clr.AddReference("RevitAPIUI")
from Autodesk.Revit.UI import TaskDialog

# Pegar a entrada do Dynamo
mensagem = IN[0]

# Criar a TaskDialog
task_dialog = TaskDialog("Ok")
task_dialog.MainInstruction = mensagem

# Exibir a TaskDialog
task_dialog.Show()

# Saída do script
OUT = "Sucesso!"
# ----------------------------------------
