# Dynamo graph 00-5_BIMACON_Criar Massas 3D de Espaços ou Ambientes_R02_script.dyn (Dynamo 2.19.3.6394)
# author: Jose Nelson
# Cria Massas a parrtir dos Ambientes, serve para verificar geometrias
# packages: Data-Shapes 2022.2.105

# group: SELECIONE O MODELO ARQ LINKADO
code_block = CodeBlock { "Selecione Ambientes ou Espaços para criar as Massas"; }
string = StringInput("LogoBimacon.png")
string_2 = StringInput("Confirmar")
categories = Categories("OST_Rooms")  # graph input
categories_2 = Categories("OST_MEPSpaces")  # graph input
list_create = List.Create(item0=categories, item1=categories_2)
number = DoubleInput(1)
dropdown_data = Custom[DropDown Data](Keys=list_create, Values=list_create, DefaultValueIndex=number)  # package Data-Shapes; Create data for DropDown input in UI.MultiInputForm ++ . Check out www.data-shapes.net for more infos.
boolean = BoolSelector(true)
string_3 = StringInput("Cancelar")
code_block_2 = CodeBlock()  # //Data-Shapes
code_block_3 = CodeBlock()  # //archilab

python_script = Python(IN[0]=string)  # IronPython2
# ---------- python_script.python (22 lines) ----------
import clr

# Adiciona referência ao ambiente .NET
clr.AddReference('System')
from System import Environment, IO

# Nome da imagem (entrada do usuário)
nome_arquivo_imagem = IN[0]

# Recupera o nome do usuário logado no Windows
usuario = Environment.UserName

# Monta o caminho completo para a pasta de imagens
caminho_base = r"C:\Users\{0}\AppData\Roaming\pyRevit\Extensions\Bimacon.extension\Bimacon.tab\Imagens_Bimacon".format(usuario)

# Junta o caminho base com o nome do arquivo
caminho_completo = IO.Path.Combine(caminho_base, nome_arquivo_imagem)

# Verifica se o arquivo existe
existe = IO.File.Exists(caminho_completo)

OUT = caminho_completo if existe else "Imagem não encontrada: {0}".format(caminho_completo)
# ----------------------------------------

# group (continued): SELECIONE O MODELO ARQ LINKADO
file_from_path = FileObject(path=python_script)
readFromFile = Image.ReadFromFile(file=file_from_path)
multipleinputform = Custom[MultipleInputForm ++](Description_optional=code_block, Logo_optional=readFromFile, ButtonText_optional=string_2, Inputs=dropdown_data, Toggle=boolean, CancelButtonText_optional=string_3)  # package Data-Shapes; Create a form with multiple inputs. see www.data-shapes.net for tutorials and infos!

number_2 = DoubleInput(0)
getItemAtIndex = List.GetItemAtIndex(list=multipleinputform.User_Inputs, index=number_2)
all_elements_of_category = ElementsOfCategory(Category=getItemAtIndex)
geometry = Element.Geometry(element=all_elements_of_category)
categories_3 = Categories("OST_Mass")  # graph input
code_block_4 = CodeBlock { "Amarelo"; }
byName = Material.ByName(name=code_block_4)
code_block_5 = CodeBlock { "Nome"; }
getParameterValueByName = Element.GetParameterValueByName(element=all_elements_of_category, parameterName=code_block_5)
byGeometry = DirectShape.ByGeometry(geometry=geometry, category=categories_3, material=byName, name=getParameterValueByName)
code_block_6 = CodeBlock { "Comentários"; }
setParameterByName = Element.SetParameterByName(element=byGeometry, parameterName=code_block_6, value=getParameterValueByName)

# group: Mensagem final
count = List.Count(list=setParameterByName)
code_block_7 = CodeBlock { 0; }
gt = count > code_block_7
code_block_8 = CodeBlock(N=count) { ["Feito! você criou "+N+" Massas"]; }
code_block_9 = CodeBlock { ["Nenhuma Massa foi criada"]; }
if_ = If(test=gt, true=code_block_8, false=code_block_9)
flatten = List.Flatten(list=if_)
fromList = Python(IN[0]=flatten)  # "String.FromList"; IronPython2
# ---------- fromList.python (22 lines) ----------
# Carregar as bibliotecas DesignScript e padrão do Python
import sys
import clr
clr.AddReference('ProtoGeometry')
from Autodesk.DesignScript.Geometry import *

# Função para concatenar os valores de uma lista em uma única string com múltiplas linhas
def concatenate_list_to_string(input_list, delimiter="\n"):
    # Verifica se a entrada é uma lista
    if not isinstance(input_list, list):
        return "A entrada deve ser uma lista."
    
    # Converte todos os elementos para string e junta com o delimitador especificado
    result = delimiter.join(str(item) for item in input_list)
    return result

# Entrada pelo nó do Dynamo
lista = IN[0]  # Lista de valores a serem concatenados
delimitador = IN[1] if len(IN) > 1 else "\n"  # Delimitador opcional, padrão é nova linha

# Saída para o Dynamo
OUT = concatenate_list_to_string(lista, delimitador)
# ----------------------------------------
python_script_2 = Python(IN[0]=fromList)  # IronPython2
# ---------- python_script_2.python (21 lines) ----------
# Importar as bibliotecas necessárias do Revit
import clr
clr.AddReference("RevitServices")
from RevitServices.Persistence import DocumentManager

clr.AddReference("RevitAPI")
clr.AddReference("RevitAPIUI")
from Autodesk.Revit.UI import TaskDialog

# Pegar a entrada do Dynamo
mensagem = IN[0]

# Criar a TaskDialog
task_dialog = TaskDialog("Ok")
task_dialog.MainInstruction = mensagem

# Exibir a TaskDialog
task_dialog.Show()

# Saída do script
OUT = "Sucesso!"
# ----------------------------------------
