# Dynamo graph ok 2021_00-5_BIMACON_Criar Massas 3D de Espaços ou Ambientes_R01_script.dyn "ok 2021_00-5_BIMACON_Criar Massas 3D de Espaços ou Ambientes" (Dynamo 2.6.1.8786)

categories = Categories("OST_Rooms")  # graph input
all_elements_of_category = ElementsOfCategory(Category=categories)
geometry = Element.Geometry(element=all_elements_of_category)
categories_2 = Categories("OST_Mass")  # graph input
code_block = CodeBlock { "Amarelo"; }
byName = Material.ByName(name=code_block)
code_block_2 = CodeBlock { "Nome"; }
getParameterValueByName = Element.GetParameterValueByName(element=all_elements_of_category, parameterName=code_block_2)
byGeometry = DirectShape.ByGeometry(geometry=geometry, category=categories_2, material=byName, name=getParameterValueByName)

# group: Mensagem final
count = List.Count(list=byGeometry)
code_block_3 = CodeBlock { 0; }
gt = count > code_block_3
code_block_4 = CodeBlock(N=count) { ["Feito! você criou "+N+" Massas"]; }
code_block_5 = CodeBlock { ["Nenhuma Massa foi criada"]; }
if_ = If(test=gt, true=code_block_4, false=code_block_5)
flatten = List.Flatten(list=if_)
fromList = Python(IN[0]=flatten)  # "String.FromList"
# ---------- fromList.python (22 lines) ----------
# Carregar as bibliotecas DesignScript e padrão do Python
import sys
import clr
clr.AddReference('ProtoGeometry')
from Autodesk.DesignScript.Geometry import *

# Função para concatenar os valores de uma lista em uma única string com múltiplas linhas
def concatenate_list_to_string(input_list, delimiter="\n"):
    # Verifica se a entrada é uma lista
    if not isinstance(input_list, list):
        return "A entrada deve ser uma lista."
    
    # Converte todos os elementos para string e junta com o delimitador especificado
    result = delimiter.join(str(item) for item in input_list)
    return result

# Entrada pelo nó do Dynamo
lista = IN[0]  # Lista de valores a serem concatenados
delimitador = IN[1] if len(IN) > 1 else "\n"  # Delimitador opcional, padrão é nova linha

# Saída para o Dynamo
OUT = concatenate_list_to_string(lista, delimitador)
# ----------------------------------------
python_script = Python(IN[0]=fromList)
# ---------- python_script.python (21 lines) ----------
# Importar as bibliotecas necessárias do Revit
import clr
clr.AddReference("RevitServices")
from RevitServices.Persistence import DocumentManager

clr.AddReference("RevitAPI")
clr.AddReference("RevitAPIUI")
from Autodesk.Revit.UI import TaskDialog

# Pegar a entrada do Dynamo
mensagem = IN[0]

# Criar a TaskDialog
task_dialog = TaskDialog("Ok")
task_dialog.MainInstruction = mensagem

# Exibir a TaskDialog
task_dialog.Show()

# Saída do script
OUT = "Sucesso!"
# ----------------------------------------
