# Dynamo graph 00-0_BIMACON_Copiar Ambientes de modelo-LINK_R05_script.dyn "00-0_BIMACON_Copiar Ambientes de modelo-LINK_R04_script" (Dynamo 2.19.3.6394)
# author: Jose Nelson
# Criar espaços por meio da seleção do arquivo linkado. Se Nele existir os Ambientes será feita a importação
# packages: archi-lab.net 2023.213.1722, Clockwork for Dynamo 1.x 1.34.0, Data-Shapes 2022.2.105, Clockwork for Dynamo 2.x 2.4.0, DynamoMEP 1.0.3, Genius Loci 2023.2.21, Crumple 2021.9.24

# group: SELECIONE O MODELO ARQ LINKADO
code_block = CodeBlock { "Selecione o arquivo para obter os Ambientes:"; }
string = StringInput("LogoBimacon.png")
python_script = Python(IN[0]=string)  # IronPython2
# ---------- python_script.python (22 lines) ----------
import clr

# Adiciona referência ao ambiente .NET
clr.AddReference('System')
from System import Environment, IO

# Nome da imagem (entrada do usuário)
nome_arquivo_imagem = IN[0]

# Recupera o nome do usuário logado no Windows
usuario = Environment.UserName

# Monta o caminho completo para a pasta de imagens
caminho_base = r"C:\Users\{0}\AppData\Roaming\pyRevit\Extensions\Bimacon.extension\Bimacon.tab\Imagens_Bimacon".format(usuario)

# Junta o caminho base com o nome do arquivo
caminho_completo = IO.Path.Combine(caminho_base, nome_arquivo_imagem)

# Verifica se o arquivo existe
existe = IO.File.Exists(caminho_completo)

OUT = caminho_completo if existe else "Imagem não encontrada: {0}".format(caminho_completo)
# ----------------------------------------
file_from_path = FileObject(path=python_script)
readFromFile = Image.ReadFromFile(file=file_from_path)
string_2 = StringInput("Confirmar")
get_alldocuments = Custom[Get AllDocuments]()  # package Genius Loci; Get documents (linked and opened in background). The first document is the active document.
restOfItems = List.RestOfItems(list=get_alldocuments.FileName)
sort = List.Sort(list=restOfItems)
revitlinks = Custom[© RevitLinks]()  # package Crumple; Returns all Revit link types in the current document, as well as all instance elements of those types.
name = Element.Name(element=revitlinks.linkTypes)
restOfItems_2 = List.RestOfItems(list=name)
sort_2 = List.Sort(list=restOfItems_2)
length = String.Length(string=sort_2)
number = DoubleInput(4)
sub = length - number
remove = String.Remove(string=sort_2, startIndex=sub, count=number)
contains = List.Contains(list=sort, item=remove, lacing=Longest)
filterByBoolMask = List.FilterByBoolMask(list=sort, mask=contains)
restOfItems_3 = List.RestOfItems(list=get_alldocuments.Document)
sort_3 = List.Sort(list=restOfItems_3)
filterByBoolMask_2 = List.FilterByBoolMask(list=sort_3, mask=contains)
code_block_2 = CodeBlock { 0; }
dropdown_data = Custom[DropDown Data](Keys=filterByBoolMask.in, Values=filterByBoolMask_2.in, DefaultValueIndex=code_block_2)  # package Data-Shapes; Create data for DropDown input in UI.MultiInputForm ++ . Check out www.data-shapes.net for more infos.
boolean = BoolSelector(true)
string_3 = StringInput("Cancelar")
multipleinputform = Custom[MultipleInputForm ++](Description_optional=code_block, Logo_optional=readFromFile, ButtonText_optional=string_2, Inputs=dropdown_data, Toggle=boolean, CancelButtonText_optional=string_3)  # package Data-Shapes; Create a form with multiple inputs. see www.data-shapes.net for tutorials and infos!
code_block_3 = CodeBlock()  # //Data-Shapes
code_block_4 = CodeBlock()  # //archilab

number_slider = DoubleSlider(0, range=0..4 step 1)
getItemAtIndex = List.GetItemAtIndex(list=multipleinputform.User_Inputs, index=number_slider)

# group: Deletar Ambientes do modelo
element_types = ElementTypes("Room")
all_elements_of_type = ElementsOfType(element_type=element_types)
delete = archilab.Revit.Elements.Elements.Delete(element=all_elements_of_type)

# group: Deletar Separadores de ambientes do modelo
categories = Categories("OST_RoomSeparationLines")  # graph input
all_elements_of_category = ElementsOfCategory(Category=categories)
passthrough = Custom[Passthrough](passThrough=all_elements_of_category, waitFor=delete)  # package Clockwork for Dynamo 2.x; Forces a sequential order of execution. The node wired into the output of the Passthrough node will be executed *after* the node wired into the waitFor input (e.g. important for some Revit operations). The value of the passThrough input will be passed on to the node wired into the output port of the Passthrough node.
delete_2 = archilab.Revit.Elements.Elements.Delete(element=passthrough)

# group: LINHAS SEPARADOR ESPAÇOS
passthrough_2 = Custom[Passthrough](passThrough=getItemAtIndex, waitFor=delete_2)
categories_2 = Categories("OST_RoomSeparationLines")  # graph input
get_all_elements_from_linked = Custom[Get All Elements From Linked Model](linkDoc=passthrough_2, category=categories_2, lacing=Longest)  # package archi-lab.net; This node is based on code posted by Julien Benoit. Big thanks to Julien for sharing his work. This node will retrieve all elements of a given category from a given linked model.
getLocation = Element.GetLocation(element=get_all_elements_from_linked)

# group: Nível separador ambiente
categories_3 = Categories("OST_Levels")
all_elements_of_category_2 = ElementsOfCategory(Category=categories_3)
startPoint = Curve.StartPoint(curve=getLocation)
Z = Point.Z(point=startPoint)
projectElevation = Level.ProjectElevation(level=all_elements_of_category_2)
code_block_5 = CodeBlock { 0.01; }
eq = Equals(x=Z, y=projectElevation, tolerance=code_block_5, lacing=CrossProduct)
filterByBoolMask_3 = List.FilterByBoolMask(list=all_elements_of_category_2, mask=eq@L2)
flatten = List.Flatten(list=filterByBoolMask_3.in)
name_2 = Element.Name(element=flatten)
view_byname = Custom[View ByName](ViewName=name_2)  # package Genius Loci; Collect views by given name in the active or given document. Based on a Christian Gartland's script.

# group (continued): LINHAS SEPARADOR ESPAÇOS
byCurveAndView = DynamoMEP.RoomSeparator.ByCurveAndView(curve=getLocation, view=view_byname)

# group: CRIAR AMBIENTES DO ARQUIVO LINKADO - COPIAR NOME E NÚMERO DO AMBIENTE
code_block_6 = CodeBlock()  # //archilab
passthrough_3 = Custom[Passthrough](passThrough=getItemAtIndex, waitFor=byCurveAndView)
categories_4 = Categories("OST_Rooms")  # graph input
get_all_elements_from_linked_2 = Custom[Get All Elements From Linked Model](linkDoc=passthrough_3, category=categories_4, lacing=Longest)
boolean_2 = BoolSelector(false)
clean = List.Clean(list=get_all_elements_from_linked_2, preserveIndices=boolean_2)
code_block_7 = CodeBlock { "Área"; 0; }
getParameterValueByName = Element.GetParameterValueByName(element=clean, parameterName=code_block_7.out0)
gt = getParameterValueByName > code_block_7.out1
filterByBoolMask_4 = List.FilterByBoolMask(list=clean, mask=gt, lacing=Longest)
flatten_2 = List.Flatten(list=filterByBoolMask_4.in)
boolean_3 = BoolSelector(false)
clean_2 = List.Clean(list=flatten_2, preserveIndices=boolean_3)
getLocation_2 = Element.GetLocation(element=clean_2)
byPoint = DynamoMEP.Room.ByPoint(point=getLocation_2)
end = Revit.Transaction.Transaction.End(input=byPoint)
code_block_8 = CodeBlock { "Nome"; "Número"; "Deslocamento do limite"; }
getParameterValueByName_2 = Element.GetParameterValueByName(element=clean_2, parameterName=code_block_8.out0)
setParameterByName = Element.SetParameterByName(element=end, parameterName=code_block_8.out0, value=getParameterValueByName_2)
getParameterValueByName_3 = Element.GetParameterValueByName(element=clean_2, parameterName=code_block_8.out1)
setParameterByName_2 = Element.SetParameterByName(element=setParameterByName, parameterName=code_block_8.out1, value=getParameterValueByName_3)
getParameterValueByName_4 = Element.GetParameterValueByName(element=clean_2, parameterName=code_block_8.out2)
setParameterByName_3 = Element.SetParameterByName(element=setParameterByName_2, parameterName=code_block_8.out2, value=getParameterValueByName_4)
byCoordinates = Point.ByCoordinates()

# group: LIGAÇÃO
code_block_9 = CodeBlock()  # //Clockwork
code_block_10 = CodeBlock(passthrough=byPoint, waitfor=setParameterByName_2) { [passthrough,waitfor][0]; }

# group: AJUSTE O LIMITE SUPERIOR E A COMPENSAÇÃO DO LIMITE
code_block_11 = CodeBlock()  # //archilab
code_block_12 = CodeBlock { "Limite superior"; "Deslocamento do limite"; }
code_block_13 = CodeBlock { "Nível"; }
getParameterValueByName_5 = Element.GetParameterValueByName(element=code_block_10, parameterName=code_block_13)
getLevelByName = archilab.Revit.Selection.Select.GetLevelByName(name=getParameterValueByName_5, lacing=Longest)
levelAbove = Custom[Level.LevelAbove](level=getLevelByName)  # package archi-lab.net; This node takes an input of level and returns level above it.
python_script_2 = Python(IN[0]=levelAbove, IN[1]=getLevelByName)  # IronPython2
# ---------- python_script_2.python (19 lines) ----------
# Entradas do nó Python:
# IN[0] = listaA (com possíveis nulos)
# IN[1] = listaB (valores para substituir os nulos)

listaA = IN[0]
listaB = IN[1]

# Função que substitui valores nulos por valores da outra lista
resultado = []

for i in range(len(listaA)):
    itemA = listaA[i]
    itemB = listaB[i] if i < len(listaB) else None
    if itemA is None:
        resultado.append(itemB)
    else:
        resultado.append(itemA)

OUT = resultado
# ----------------------------------------
setParameterByName_4 = Element.SetParameterByName(element=code_block_10, parameterName=code_block_12.out0, value=python_script_2)
python_script_3 = Python(IN[0]=levelAbove)  # IronPython2
# ---------- python_script_3.python (14 lines) ----------
# Entradas do nó Python:
# IN[0] = listaA (com possíveis nulos)

listaA = IN[0]

resultado = []

for item in listaA:
    if item is None:
        resultado.append(2.8)
    else:
        resultado.append(0)

OUT = resultado
# ----------------------------------------
setParameterByName_5 = Element.SetParameterByName(element=code_block_10, parameterName=code_block_12.out1, value=python_script_3)

# group: Mensagem Final
count = List.Count(list=setParameterByName_4)
code_block_14 = CodeBlock { 0; }
gt_2 = count > code_block_14
code_block_15 = CodeBlock(N=count) { ["Feito! Você copiou "+N+" Ambientes"]; }
code_block_16 = CodeBlock { ["Nenhum Ambiente foi criado"]; }
if_ = If(test=gt_2, true=code_block_15, false=code_block_16)
fromList = Python(IN[0]=if_)  # "String.FromList"; IronPython2
# ---------- fromList.python (22 lines) ----------
# Carregar as bibliotecas DesignScript e padrão do Python
import sys
import clr
clr.AddReference('ProtoGeometry')
from Autodesk.DesignScript.Geometry import *

# Função para concatenar os valores de uma lista em uma única string com múltiplas linhas
def concatenate_list_to_string(input_list, delimiter="\n"):
    # Verifica se a entrada é uma lista
    if not isinstance(input_list, list):
        return "A entrada deve ser uma lista."
    
    # Converte todos os elementos para string e junta com o delimitador especificado
    result = delimiter.join(str(item) for item in input_list)
    return result

# Entrada pelo nó do Dynamo
lista = IN[0]  # Lista de valores a serem concatenados
delimitador = IN[1] if len(IN) > 1 else "\n"  # Delimitador opcional, padrão é nova linha

# Saída para o Dynamo
OUT = concatenate_list_to_string(lista, delimitador)
# ----------------------------------------
python_script_4 = Python(IN[0]=fromList)  # IronPython2
# ---------- python_script_4.python (21 lines) ----------
# Importar as bibliotecas necessárias do Revit
import clr
clr.AddReference("RevitServices")
from RevitServices.Persistence import DocumentManager

clr.AddReference("RevitAPI")
clr.AddReference("RevitAPIUI")
from Autodesk.Revit.UI import TaskDialog

# Pegar a entrada do Dynamo
mensagem = IN[0]

# Criar a TaskDialog
task_dialog = TaskDialog("Ok")
task_dialog.MainInstruction = mensagem

# Exibir a TaskDialog
task_dialog.Show()

# Saída do script
OUT = "Sucesso!"
# ----------------------------------------

# group: Nível separador ambiente
categories_5 = Categories("OST_Levels")
all_elements_of_category_3 = ElementsOfCategory(Category=categories_5)
Z_2 = Point.Z(point=getLocation_2)
projectElevation_2 = Level.ProjectElevation(level=all_elements_of_category_3)
code_block_17 = CodeBlock { 0.01; }
eq_2 = Equals(x=Z_2, y=projectElevation_2, tolerance=code_block_17, lacing=CrossProduct)
filterByBoolMask_5 = List.FilterByBoolMask(list=all_elements_of_category_3, mask=eq_2@L2)
flatten_3 = List.Flatten(list=filterByBoolMask_5.in)
name_3 = Element.Name(element=flatten_3)
view_byname_2 = Custom[View ByName](ViewName=name_3)

# group: Tag Spaces
flatten_4 = List.Flatten(list=getLocation_2)
family_types = FamilyTypes("Tag de Ambientes:TAG Ambiente com área")
flatten_5 = List.Flatten(list=byPoint)
code_block_18 = CodeBlock { _linkInstance: var = null; }
boolean_4 = BoolSelector(true)
tag_em_multiplas_vistas = Python(IN[0]=flatten_4, IN[1]=family_types, IN[2]=flatten_5, IN[3]=view_byname_2, IN[4]=code_block_18, IN[5]=boolean_4)  # IronPython2
# ---------- tag_em_multiplas_vistas.python (178 lines) ----------
# editado por BimaconTreinamentos

import clr
clr.AddReference('ProtoGeometry')
from Autodesk.DesignScript.Geometry import *

clr.AddReference("RevitNodes")
import Revit
clr.ImportExtensions(Revit.Elements)
clr.ImportExtensions(Revit.GeometryConversion)

clr.AddReference("RevitServices")
import RevitServices
from RevitServices.Persistence import DocumentManager
from RevitServices.Transactions import TransactionManager
doc = DocumentManager.Instance.CurrentDBDocument

clr.AddReference("RevitAPI")
import Autodesk
from Autodesk.Revit.DB import *

import sys
pyt_path = r'C:\Program Files (x86)\IronPython 2.7\Lib'
sys.path.append(pyt_path)

import System
from System import Convert

# ============================
# Entradas
# ============================
locationPts = UnwrapElement(IN[0])  # Pontos fornecidos (apenas para ambientes)
tagType = UnwrapElement(IN[1]) if IN[1] else None  # Tipo de tag
elements = UnwrapElement(IN[2])    # Espaços ou ambientes
views = [UnwrapElement(i) for i in IN[3]] if isinstance(IN[3], list) else UnwrapElement(IN[3])
RunIt = IN[5]

link = UnwrapElement(IN[4]) if IN[4] else None

# ============================
# Funções Auxiliares
# ============================
def toRvtPoint(point):
    """Converte Point do Dynamo para XYZ do Revit."""
    return point.ToXyz()

def toRvtId(_id):
    """Converte ID em ElementId."""
    if isinstance(_id, (int, str)):
        return ElementId(int(_id))
    elif isinstance(_id, ElementId):
        return _id

def GetUVPoint(pt):
    """Converte Point ou UV do Dynamo para UV do Revit."""
    if isinstance(pt, Autodesk.DesignScript.Geometry.Point):
        return Autodesk.Revit.DB.UV(pt.X, pt.Y)
    elif isinstance(pt, Autodesk.DesignScript.Geometry.UV):
        return Autodesk.Revit.DB.UV(pt.U, pt.V)

def CreateSpaceTag(space, uv, view):
    """Cria Tag de Espaço."""
    return doc.Create.NewSpaceTag(space, uv, view)

def GetSpaceCenter(space):
    """Obtém o ponto central do espaço."""
    if space.Location and hasattr(space.Location, 'Point'):
        return space.Location.Point
    elif hasattr(space, 'ClosedShell'):
        solid = space.ClosedShell
        bbox = solid.GetBoundingBox()
        return bbox.Min + ((bbox.Max - bbox.Min) / 2)
    return None

# ============================
# Validações
# ============================
if not tagType:
    OUT = "Erro: Nenhum tipo de tag foi fornecido."
else:
    try:
        errorReport = None
        if RunIt:
            tagTypeId = toRvtId(tagType.Id)

            # ============================
            # Inserção de Tags de Espaços (MEP) no Centro
            # ============================
            if tagType.Category.Id.IntegerValue == Convert.ToInt32(BuiltInCategory.OST_MEPSpaceTags):
                TransactionManager.Instance.EnsureInTransaction(doc)
                spaceTags = []
                if isinstance(views, list):
                    for space, view in zip(elements, views):
                        center = GetSpaceCenter(space)
                        if center:
                            uv = Autodesk.Revit.DB.UV(center.X, center.Y)
                            spaceTag = CreateSpaceTag(space, uv, view)
                            spaceTag.SpaceTagType = tagType
                            spaceTags.append(spaceTag)
                else:
                    for space in elements:
                        center = GetSpaceCenter(space)
                        if center:
                            uv = Autodesk.Revit.DB.UV(center.X, center.Y)
                            spaceTag = CreateSpaceTag(space, uv, views)
                            spaceTag.SpaceTagType = tagType
                            spaceTags.append(spaceTag)
                TransactionManager.Instance.TransactionTaskDone()
                result = spaceTags

            # ============================
            # Inserção de Tags de Ambientes
            # ============================
            elif tagType.Category.Id.IntegerValue == Convert.ToInt32(BuiltInCategory.OST_RoomTags):
                TransactionManager.Instance.EnsureInTransaction(doc)
                roomTags = []
                if isinstance(views, list):
                    for i, j, k in zip(elements, views, locationPts):
                        roomId = LinkElementId(i.Id)
                        location = Autodesk.Revit.DB.UV(toRvtPoint(k).X, toRvtPoint(k).Y)
                        roomTag = doc.Create.NewRoomTag(roomId, location, j.Id)
                        roomTag.RoomTagType = tagType
                        roomTags.append(roomTag)
                else:
                    for i, j in zip(elements, locationPts):
                        roomId = LinkElementId(i.Id) if not link else LinkElementId(link.Id, i.Id)
                        location = Autodesk.Revit.DB.UV(toRvtPoint(j).X, toRvtPoint(j).Y)
                        roomTag = doc.Create.NewRoomTag(roomId, location, views.Id)
                        roomTag.RoomTagType = tagType
                        roomTags.append(roomTag)
                TransactionManager.Instance.TransactionTaskDone()
                result = roomTags

            # ============================
            # Inserção de Outras Tags
            # ============================
            else:
                TransactionManager.Instance.EnsureInTransaction(doc)
                otherTags = []
                if isinstance(views, list):
                    for i, j, k in zip(elements, views, locationPts):
                        location = toRvtPoint(k)
                        tag = IndependentTag.Create(
                            doc, j.Id, Reference(i), False, 
                            TagMode.TM_ADDBY_CATEGORY, 
                            TagOrientation.Horizontal, 
                            location
                        )
                        tag.ChangeTypeId(tagTypeId)
                        otherTags.append(tag)
                else:
                    for i, j in zip(elements, locationPts):
                        location = toRvtPoint(j)
                        tag = IndependentTag.Create(
                            doc, views.Id, Reference(i), False, 
                            TagMode.TM_ADDBY_CATEGORY, 
                            TagOrientation.Horizontal, 
                            location
                        )
                        tag.ChangeTypeId(tagTypeId)
                        otherTags.append(tag)
                TransactionManager.Instance.TransactionTaskDone()
                result = otherTags

        else:
            result = "RunIt está definido como False."

    except Exception as e:
        import traceback
        errorReport = traceback.format_exc()

    # ============================
    # Saída
    # ============================
    if errorReport:
        OUT = "Erro durante a execução:\n{}".format(errorReport)
    else:
        OUT = result
# ----------------------------------------
