# Dynamo graph 01-1_BIMACON_Criar Espaços dos ambientes(Rooms)-LINK_R08_script.dyn (Dynamo 2.19.3.6394)
# author: Jose Nelson
# Criar espaços por meio da seleção do arquivo linkado. Se Nele existir os Ambientes será feita a importação
# packages: archi-lab.net 2023.213.1722, Clockwork for Dynamo 1.x 1.34.0, DynamoMEP 1.0.3, Clockwork for Dynamo 2.x 2.4.0, Genius Loci 2023.2.21, Data-Shapes 2022.2.105

# group: SELECIONE O MODELO ARQ LINKADO
code_block = CodeBlock { "Selecione o arquivo para obter os Ambientes:"; }
string = StringInput("LogoBimacon.png")
python_script = Python(IN[0]=string)  # IronPython2
# ---------- python_script.python (22 lines) ----------
import clr

# Adiciona referência ao ambiente .NET
clr.AddReference('System')
from System import Environment, IO

# Nome da imagem (entrada do usuário)
nome_arquivo_imagem = IN[0]

# Recupera o nome do usuário logado no Windows
usuario = Environment.UserName

# Monta o caminho completo para a pasta de imagens
caminho_base = r"C:\Users\{0}\AppData\Roaming\pyRevit\Extensions\Bimacon.extension\Bimacon.tab\Imagens_Bimacon".format(usuario)

# Junta o caminho base com o nome do arquivo
caminho_completo = IO.Path.Combine(caminho_base, nome_arquivo_imagem)

# Verifica se o arquivo existe
existe = IO.File.Exists(caminho_completo)

OUT = caminho_completo if existe else "Imagem não encontrada: {0}".format(caminho_completo)
# ----------------------------------------
file_from_path = FileObject(path=python_script)
readFromFile = Image.ReadFromFile(file=file_from_path)
string_2 = StringInput("Confirmar")
get_alldocuments = Custom[Get AllDocuments]()  # package Genius Loci; Get documents (linked and opened in background). The first document is the active document.
sort = List.Sort(list=get_alldocuments.FileName)
current = Document.Current()
name = Python(IN[0]=current)  # "Document.Name"; IronPython2
# ---------- name.python (27 lines) ----------
# Carregar as bibliotecas DesignScript e padrão do Python
import sys
import clr
clr.AddReference('ProtoGeometry')
from Autodesk.DesignScript.Geometry import *

# Importando as bibliotecas necessárias
import clr

# Adicionando a referência ao Revit API e ao DocumentManager
clr.AddReference("RevitServices")
from RevitServices.Persistence import DocumentManager

clr.AddReference("RevitAPI")
from Autodesk.Revit.DB import Document

# Função para obter o nome do documento atual
def obter_nome_documento_atual():
    # Obtém o documento atual usando o DocumentManager
    doc_atual = DocumentManager.Instance.CurrentDBDocument
    if doc_atual is not None:
        return doc_atual.Title
    else:
        return "Nenhum documento ativo encontrado."

# Saída com o nome do documento atual
OUT = obter_nome_documento_atual()
# ----------------------------------------
eq = sort == name
filterByBoolMask = List.FilterByBoolMask(list=sort, mask=eq)
indexOf = List.IndexOf(list=get_alldocuments.FileName, element=sort)
getItemAtIndex = List.GetItemAtIndex(list=get_alldocuments.Document, index=indexOf)
filterByBoolMask_2 = List.FilterByBoolMask(list=getItemAtIndex, mask=eq)
code_block_2 = CodeBlock { 0; }
dropdown_data = Custom[DropDown Data](Keys=filterByBoolMask.out, Values=filterByBoolMask_2.out, DefaultValueIndex=code_block_2)  # package Data-Shapes; Create data for DropDown input in UI.MultiInputForm ++ . Check out www.data-shapes.net for more infos.
boolean = BoolSelector(true)
string_3 = StringInput("Cancelar")
multipleinputform = Custom[MultipleInputForm ++](Description_optional=code_block, Logo_optional=readFromFile, ButtonText_optional=string_2, Inputs=dropdown_data, Toggle=boolean, CancelButtonText_optional=string_3)  # package Data-Shapes; Create a form with multiple inputs. see www.data-shapes.net for tutorials and infos!
code_block_3 = CodeBlock()  # //Data-Shapes
code_block_4 = CodeBlock()  # //archilab

number_slider = DoubleSlider(0, range=0..4 step 1)
getItemAtIndex_2 = List.GetItemAtIndex(list=multipleinputform.User_Inputs, index=number_slider)

# group: Deletar espaços do modelo
element_types = ElementTypes("Space")
all_elements_of_type = ElementsOfType(element_type=element_types)
delete = archilab.Revit.Elements.Elements.Delete(element=all_elements_of_type)

# group: Deletar Separadores de espaços do modelo
categories = Categories("OST_MEPSpaceSeparationLines")  # graph input
all_elements_of_category = ElementsOfCategory(Category=categories)
passthrough = Custom[Passthrough](passThrough=all_elements_of_category, waitFor=delete)  # package Clockwork for Dynamo 2.x; Forces a sequential order of execution. The node wired into the output of the Passthrough node will be executed *after* the node wired into the waitFor input (e.g. important for some Revit operations). The value of the passThrough input will be passed on to the node wired into the output port of the Passthrough node.
delete_2 = archilab.Revit.Elements.Elements.Delete(element=passthrough)

# group: LINHAS SEPARADOR ESPAÇOS
passthrough_2 = Custom[Passthrough](passThrough=getItemAtIndex_2, waitFor=delete_2)
categories_2 = Categories("OST_RoomSeparationLines")  # graph input
get_all_elements_from_linked = Custom[Get All Elements From Linked Model](linkDoc=passthrough_2, category=categories_2, lacing=Longest)  # package archi-lab.net; This node is based on code posted by Julien Benoit. Big thanks to Julien for sharing his work. This node will retrieve all elements of a given category from a given linked model.
getLocation = Element.GetLocation(element=get_all_elements_from_linked)

# group: Nível separador ambiente
categories_3 = Categories("OST_Levels")
all_elements_of_category_2 = ElementsOfCategory(Category=categories_3)
startPoint = Curve.StartPoint(curve=getLocation)
Z = Point.Z(point=startPoint)
projectElevation = Level.ProjectElevation(level=all_elements_of_category_2)
code_block_5 = CodeBlock { 0.01; }
eq_2 = Equals(x=Z, y=projectElevation, tolerance=code_block_5, lacing=CrossProduct)
filterByBoolMask_3 = List.FilterByBoolMask(list=all_elements_of_category_2, mask=eq_2@L2)
flatten = List.Flatten(list=filterByBoolMask_3.in)
name_2 = Element.Name(element=flatten)
view_byname = Custom[View ByName](ViewName=name_2)  # package Genius Loci; Collect views by given name in the active or given document. Based on a Christian Gartland's script.

# group (continued): LINHAS SEPARADOR ESPAÇOS
byCurveAndView = DynamoMEP.SpaceSeparator.ByCurveAndView(curve=getLocation, view=view_byname)

# group: CRIAR ESPAÇOS DOS AMBIENTES LINKADOS - COPIAR NOME E NÚMERO DO AMBIENTE
code_block_6 = CodeBlock()  # //archilab
passthrough_3 = Custom[Passthrough](passThrough=getItemAtIndex_2, waitFor=byCurveAndView)
categories_4 = Categories("OST_Rooms")  # graph input
get_all_elements_from_linked_2 = Custom[Get All Elements From Linked Model](linkDoc=passthrough_3, category=categories_4, lacing=Longest)
boolean_2 = BoolSelector(false)
clean = List.Clean(list=get_all_elements_from_linked_2, preserveIndices=boolean_2)
parameters = Element.Parameters(element=clean)
string_from_object = FromObject(object=parameters)
string_4 = StringInput("Fase")
contains = String.Contains(string=string_from_object, searchFor=string_4)
filterByBoolMask_4 = List.FilterByBoolMask(list=string_from_object, mask=contains)
flatten_2 = List.Flatten(list=filterByBoolMask_4.in)
code_block_7 = CodeBlock { 0; 7; }
remove = String.Remove(string=flatten_2, startIndex=code_block_7.out0, count=code_block_7.out1)
code_block_8 = CodeBlock { ["New Construction","Nova Construcão","Nova Construção","Construção nova"]; }
string_contains_varias_palavras = Python(IN[0]=remove, IN[1]=code_block_8)  # IronPython2
# ---------- string_contains_varias_palavras.python (14 lines) ----------
# Entrada IN[0]: lista de nomes dos espaços
# Entrada IN[1]: lista de palavras-chave a remover

names = IN[0]
terms = IN[1]

outList = []

for name in names:
    # Verifica se qualquer termo está contido no nome (ignora maiúsculas/minúsculas)
    found = any(term.lower() in name.lower() for term in terms)
    outList.append(not found)  # True se NÃO contiver, ou seja, deve ser mantido

OUT = outList
# ----------------------------------------
filterByBoolMask_5 = List.FilterByBoolMask(list=clean, mask=string_contains_varias_palavras)
code_block_9 = CodeBlock { "Área"; 0; }
getParameterValueByName = Element.GetParameterValueByName(element=filterByBoolMask_5.out, parameterName=code_block_9.out0)
gt = getParameterValueByName > code_block_9.out1
filterByBoolMask_6 = List.FilterByBoolMask(list=filterByBoolMask_5.out, mask=gt, lacing=Longest)
flatten_3 = List.Flatten(list=filterByBoolMask_6.in)
boolean_3 = BoolSelector(false)
clean_2 = List.Clean(list=flatten_3, preserveIndices=boolean_3)
getLocation_2 = Element.GetLocation(element=clean_2)
byPoint = DynamoMEP.Space.ByPoint(point=getLocation_2)
end = Revit.Transaction.Transaction.End(input=byPoint)
code_block_10 = CodeBlock { "Nome"; "Número"; "Deslocamento do limite"; }
getParameterValueByName_2 = Element.GetParameterValueByName(element=clean_2, parameterName=code_block_10.out0)
end_2 = Revit.Transaction.Transaction.End(input=getParameterValueByName_2)
python_script_2 = Python(IN[0]=end_2)  # IronPython2
# ---------- python_script_2.python (36 lines) ----------
# Importando as bibliotecas necessárias
import clr
clr.AddReference("RevitServices")
from RevitServices.Persistence import DocumentManager
from RevitServices.Transactions import TransactionManager

# Função para substituir caracteres acentuados por não acentuados
def remove_accents(text):
    # Mapear caracteres acentuados para seus equivalentes não acentuados
    accents_map = {
        'á': 'a', 'à': 'a', 'ã': 'a', 'â': 'a', 'ä': 'a',
        'Á': 'A', 'À': 'A', 'Ã': 'A', 'Â': 'A', 'Ä': 'A',
        'é': 'e', 'è': 'e', 'ê': 'e', 'ë': 'e',
        'É': 'E', 'È': 'E', 'Ê': 'E', 'Ë': 'E',
        'í': 'i', 'ì': 'i', 'î': 'i', 'ï': 'i',
        'Í': 'I', 'Ì': 'I', 'Î': 'I', 'Ï': 'I',
        'ó': 'o', 'ò': 'o', 'õ': 'o', 'ô': 'o', 'ö': 'o',
        'Ó': 'O', 'Ò': 'O', 'Õ': 'O', 'Ô': 'O', 'Ö': 'O',
        'ú': 'u', 'ù': 'u', 'û': 'u', 'ü': 'u',
        'Ú': 'U', 'Ù': 'U', 'Û': 'U', 'Ü': 'U',
        'ç': 'c', 'Ç': 'C',
        'ñ': 'n', 'Ñ': 'N'
    }
    # Substituir os caracteres usando o mapeamento
    for accented_char, unaccented_char in accents_map.items():
        text = text.replace(accented_char, unaccented_char)
    return text

# Entrada do Dynamo
input_strings = IN[0]  # Lista de strings a serem processadas

# Processando a lista de strings
output_strings = [remove_accents(s) for s in input_strings]

# Saída do Dynamo
OUT = output_strings
# ----------------------------------------
setParameterByName = Element.SetParameterByName(element=end, parameterName=code_block_10.out0, value=python_script_2)
getParameterValueByName_3 = Element.GetParameterValueByName(element=clean_2, parameterName=code_block_10.out1)
setParameterByName_2 = Element.SetParameterByName(element=setParameterByName, parameterName=code_block_10.out1, value=getParameterValueByName_3)
getParameterValueByName_4 = Element.GetParameterValueByName(element=clean_2, parameterName=code_block_10.out2)
setParameterByName_3 = Element.SetParameterByName(element=setParameterByName_2, parameterName=code_block_10.out2, value=getParameterValueByName_4)

# group: LIGAÇÃO
code_block_11 = CodeBlock()  # //Clockwork
code_block_12 = CodeBlock(passthrough=byPoint, waitfor=setParameterByName_2) { [passthrough,waitfor][0]; }

# group: AJUSTE O LIMITE SUPERIOR E A COMPENSAÇÃO DO LIMITE
code_block_13 = CodeBlock()  # //archilab
code_block_14 = CodeBlock { "Limite superior"; "Deslocamento do limite"; }
code_block_15 = CodeBlock { "Nível"; }
getParameterValueByName_5 = Element.GetParameterValueByName(element=code_block_12, parameterName=code_block_15)
getLevelByName = archilab.Revit.Selection.Select.GetLevelByName(name=getParameterValueByName_5, lacing=Longest)
levelAbove = Custom[Level.LevelAbove](level=getLevelByName)  # package archi-lab.net; This node takes an input of level and returns level above it.
python_script_3 = Python(IN[0]=levelAbove, IN[1]=getLevelByName)  # IronPython2
# ---------- python_script_3.python (19 lines) ----------
# Entradas do nó Python:
# IN[0] = listaA (com possíveis nulos)
# IN[1] = listaB (valores para substituir os nulos)

listaA = IN[0]
listaB = IN[1]

# Função que substitui valores nulos por valores da outra lista
resultado = []

for i in range(len(listaA)):
    itemA = listaA[i]
    itemB = listaB[i] if i < len(listaB) else None
    if itemA is None:
        resultado.append(itemB)
    else:
        resultado.append(itemA)

OUT = resultado
# ----------------------------------------
setParameterByName_4 = Element.SetParameterByName(element=code_block_12, parameterName=code_block_14.out0, value=python_script_3)
python_script_4 = Python(IN[0]=levelAbove)  # IronPython2
# ---------- python_script_4.python (14 lines) ----------
# Entradas do nó Python:
# IN[0] = listaA (com possíveis nulos)

listaA = IN[0]

resultado = []

for item in listaA:
    if item is None:
        resultado.append(2.8)
    else:
        resultado.append(0)

OUT = resultado
# ----------------------------------------
setParameterByName_5 = Element.SetParameterByName(element=code_block_12, parameterName=code_block_14.out1, value=python_script_4)

# group: Mensagem Final
count = List.Count(list=setParameterByName_4)
code_block_16 = CodeBlock { 0; }
gt_2 = count > code_block_16
code_block_17 = CodeBlock(N=count) { ["Feito! Você copiou "+N+" Espaços"]; }
code_block_18 = CodeBlock { ["Nenhum Espaço foi criado"]; }
if_ = If(test=gt_2, true=code_block_17, false=code_block_18)
fromList = Python(IN[0]=if_)  # "String.FromList"; IronPython2
# ---------- fromList.python (22 lines) ----------
# Carregar as bibliotecas DesignScript e padrão do Python
import sys
import clr
clr.AddReference('ProtoGeometry')
from Autodesk.DesignScript.Geometry import *

# Função para concatenar os valores de uma lista em uma única string com múltiplas linhas
def concatenate_list_to_string(input_list, delimiter="\n"):
    # Verifica se a entrada é uma lista
    if not isinstance(input_list, list):
        return "A entrada deve ser uma lista."
    
    # Converte todos os elementos para string e junta com o delimitador especificado
    result = delimiter.join(str(item) for item in input_list)
    return result

# Entrada pelo nó do Dynamo
lista = IN[0]  # Lista de valores a serem concatenados
delimitador = IN[1] if len(IN) > 1 else "\n"  # Delimitador opcional, padrão é nova linha

# Saída para o Dynamo
OUT = concatenate_list_to_string(lista, delimitador)
# ----------------------------------------
python_script_5 = Python(IN[0]=fromList)  # IronPython2
# ---------- python_script_5.python (21 lines) ----------
# Importar as bibliotecas necessárias do Revit
import clr
clr.AddReference("RevitServices")
from RevitServices.Persistence import DocumentManager

clr.AddReference("RevitAPI")
clr.AddReference("RevitAPIUI")
from Autodesk.Revit.UI import TaskDialog

# Pegar a entrada do Dynamo
mensagem = IN[0]

# Criar a TaskDialog
task_dialog = TaskDialog("Ok")
task_dialog.MainInstruction = mensagem

# Exibir a TaskDialog
task_dialog.Show()

# Saída do script
OUT = "Sucesso!"
# ----------------------------------------

# group: Nível separador ambiente
categories_5 = Categories("OST_Levels")
all_elements_of_category_3 = ElementsOfCategory(Category=categories_5)
Z_2 = Point.Z(point=getLocation_2)
projectElevation_2 = Level.ProjectElevation(level=all_elements_of_category_3)
code_block_19 = CodeBlock { 0.01; }
eq_3 = Equals(x=Z_2, y=projectElevation_2, tolerance=code_block_19, lacing=CrossProduct)
filterByBoolMask_7 = List.FilterByBoolMask(list=all_elements_of_category_3, mask=eq_3@L2)
flatten_4 = List.Flatten(list=filterByBoolMask_7.in)
name_3 = Element.Name(element=flatten_4)
view_byname_2 = Custom[View ByName](ViewName=name_3)

# group: Tag Spaces
flatten_5 = List.Flatten(list=getLocation_2)
family_types = FamilyTypes("Tag de Spaces com Area e Perimetro:Tag para Spaces com Área e Perímetro")
flatten_6 = List.Flatten(list=byPoint)
code_block_20 = CodeBlock { _linkInstance: var = null; }
boolean_4 = BoolSelector(true)
tag_em_multiplas_vistas = Python(IN[0]=flatten_5, IN[1]=family_types, IN[2]=flatten_6, IN[3]=view_byname_2, IN[4]=code_block_20, IN[5]=boolean_4)  # IronPython2
# ---------- tag_em_multiplas_vistas.python (178 lines) ----------
# editado por BimaconTreinamentos

import clr
clr.AddReference('ProtoGeometry')
from Autodesk.DesignScript.Geometry import *

clr.AddReference("RevitNodes")
import Revit
clr.ImportExtensions(Revit.Elements)
clr.ImportExtensions(Revit.GeometryConversion)

clr.AddReference("RevitServices")
import RevitServices
from RevitServices.Persistence import DocumentManager
from RevitServices.Transactions import TransactionManager
doc = DocumentManager.Instance.CurrentDBDocument

clr.AddReference("RevitAPI")
import Autodesk
from Autodesk.Revit.DB import *

import sys
pyt_path = r'C:\Program Files (x86)\IronPython 2.7\Lib'
sys.path.append(pyt_path)

import System
from System import Convert

# ============================
# Entradas
# ============================
locationPts = UnwrapElement(IN[0])  # Pontos fornecidos (apenas para ambientes)
tagType = UnwrapElement(IN[1]) if IN[1] else None  # Tipo de tag
elements = UnwrapElement(IN[2])    # Espaços ou ambientes
views = [UnwrapElement(i) for i in IN[3]] if isinstance(IN[3], list) else UnwrapElement(IN[3])
RunIt = IN[5]

link = UnwrapElement(IN[4]) if IN[4] else None

# ============================
# Funções Auxiliares
# ============================
def toRvtPoint(point):
    """Converte Point do Dynamo para XYZ do Revit."""
    return point.ToXyz()

def toRvtId(_id):
    """Converte ID em ElementId."""
    if isinstance(_id, (int, str)):
        return ElementId(int(_id))
    elif isinstance(_id, ElementId):
        return _id

def GetUVPoint(pt):
    """Converte Point ou UV do Dynamo para UV do Revit."""
    if isinstance(pt, Autodesk.DesignScript.Geometry.Point):
        return Autodesk.Revit.DB.UV(pt.X, pt.Y)
    elif isinstance(pt, Autodesk.DesignScript.Geometry.UV):
        return Autodesk.Revit.DB.UV(pt.U, pt.V)

def CreateSpaceTag(space, uv, view):
    """Cria Tag de Espaço."""
    return doc.Create.NewSpaceTag(space, uv, view)

def GetSpaceCenter(space):
    """Obtém o ponto central do espaço."""
    if space.Location and hasattr(space.Location, 'Point'):
        return space.Location.Point
    elif hasattr(space, 'ClosedShell'):
        solid = space.ClosedShell
        bbox = solid.GetBoundingBox()
        return bbox.Min + ((bbox.Max - bbox.Min) / 2)
    return None

# ============================
# Validações
# ============================
if not tagType:
    OUT = "Erro: Nenhum tipo de tag foi fornecido."
else:
    try:
        errorReport = None
        if RunIt:
            tagTypeId = toRvtId(tagType.Id)

            # ============================
            # Inserção de Tags de Espaços (MEP) no Centro
            # ============================
            if tagType.Category.Id.IntegerValue == Convert.ToInt32(BuiltInCategory.OST_MEPSpaceTags):
                TransactionManager.Instance.EnsureInTransaction(doc)
                spaceTags = []
                if isinstance(views, list):
                    for space, view in zip(elements, views):
                        center = GetSpaceCenter(space)
                        if center:
                            uv = Autodesk.Revit.DB.UV(center.X, center.Y)
                            spaceTag = CreateSpaceTag(space, uv, view)
                            spaceTag.SpaceTagType = tagType
                            spaceTags.append(spaceTag)
                else:
                    for space in elements:
                        center = GetSpaceCenter(space)
                        if center:
                            uv = Autodesk.Revit.DB.UV(center.X, center.Y)
                            spaceTag = CreateSpaceTag(space, uv, views)
                            spaceTag.SpaceTagType = tagType
                            spaceTags.append(spaceTag)
                TransactionManager.Instance.TransactionTaskDone()
                result = spaceTags

            # ============================
            # Inserção de Tags de Ambientes
            # ============================
            elif tagType.Category.Id.IntegerValue == Convert.ToInt32(BuiltInCategory.OST_RoomTags):
                TransactionManager.Instance.EnsureInTransaction(doc)
                roomTags = []
                if isinstance(views, list):
                    for i, j, k in zip(elements, views, locationPts):
                        roomId = LinkElementId(i.Id)
                        location = Autodesk.Revit.DB.UV(toRvtPoint(k).X, toRvtPoint(k).Y)
                        roomTag = doc.Create.NewRoomTag(roomId, location, j.Id)
                        roomTag.RoomTagType = tagType
                        roomTags.append(roomTag)
                else:
                    for i, j in zip(elements, locationPts):
                        roomId = LinkElementId(i.Id) if not link else LinkElementId(link.Id, i.Id)
                        location = Autodesk.Revit.DB.UV(toRvtPoint(j).X, toRvtPoint(j).Y)
                        roomTag = doc.Create.NewRoomTag(roomId, location, views.Id)
                        roomTag.RoomTagType = tagType
                        roomTags.append(roomTag)
                TransactionManager.Instance.TransactionTaskDone()
                result = roomTags

            # ============================
            # Inserção de Outras Tags
            # ============================
            else:
                TransactionManager.Instance.EnsureInTransaction(doc)
                otherTags = []
                if isinstance(views, list):
                    for i, j, k in zip(elements, views, locationPts):
                        location = toRvtPoint(k)
                        tag = IndependentTag.Create(
                            doc, j.Id, Reference(i), False, 
                            TagMode.TM_ADDBY_CATEGORY, 
                            TagOrientation.Horizontal, 
                            location
                        )
                        tag.ChangeTypeId(tagTypeId)
                        otherTags.append(tag)
                else:
                    for i, j in zip(elements, locationPts):
                        location = toRvtPoint(j)
                        tag = IndependentTag.Create(
                            doc, views.Id, Reference(i), False, 
                            TagMode.TM_ADDBY_CATEGORY, 
                            TagOrientation.Horizontal, 
                            location
                        )
                        tag.ChangeTypeId(tagTypeId)
                        otherTags.append(tag)
                TransactionManager.Instance.TransactionTaskDone()
                result = otherTags

        else:
            result = "RunIt está definido como False."

    except Exception as e:
        import traceback
        errorReport = traceback.format_exc()

    # ============================
    # Saída
    # ============================
    if errorReport:
        OUT = "Erro durante a execução:\n{}".format(errorReport)
    else:
        OUT = result
# ----------------------------------------
