# Dynamo graph 01-1_BIMACON_Criar Espaços dos ambientes(Rooms)-LINK_R12_script.dyn "01-1_BIMACON_Criar Espaços dos ambientes(Rooms)-LINK_R11_script" (Dynamo 3.6.1.9895)
# Criar espaços por meio da seleção do arquivo linkado. Se Nele existir os Ambientes será feita a importação
# packages: archi-lab.net 2023.213.1722, Clockwork for Dynamo 1.x 1.34.0, DynamoIronPython2.7 3.2.1, DynamoMEP 1.0.3, Clockwork for Dynamo 2.x 2.4.0, Genius Loci 2023.2.21, Data-Shapes 2022.2.105, Crumple 2021.9.24

# group: SELECIONE O MODELO ARQ LINKADO
code_block = CodeBlock { "Selecione o arquivo para obter os Espaços:"; }
string = StringInput("LogoBimacon.png")
python_script = Python(IN[0]=string)  # IronPython2
# ---------- python_script.python (22 lines) ----------
import clr

# Adiciona referência ao ambiente .NET
clr.AddReference('System')
from System import Environment, IO

# Nome da imagem (entrada do usuário)
nome_arquivo_imagem = IN[0]

# Recupera o nome do usuário logado no Windows
usuario = Environment.UserName

# Monta o caminho completo para a pasta de imagens
caminho_base = r"C:\Users\{0}\AppData\Roaming\pyRevit\Extensions\Bimacon.extension\Bimacon.tab\Imagens_Bimacon".format(usuario)

# Junta o caminho base com o nome do arquivo
caminho_completo = IO.Path.Combine(caminho_base, nome_arquivo_imagem)

# Verifica se o arquivo existe
existe = IO.File.Exists(caminho_completo)

OUT = caminho_completo if existe else "Imagem não encontrada: {0}".format(caminho_completo)
# ----------------------------------------
file_from_path = FileObject(path=python_script)
readFromFile = Image.ReadFromFile(file=file_from_path)
string_2 = StringInput("Confirmar")
get_alldocuments = Custom[Get AllDocuments]()  # package Genius Loci; Get documents (linked and opened in background). The first document is the active document.
sort = List.Sort(list=get_alldocuments.FileName)
current = Document.Current()
name = Python(IN[0]=current)  # "Document.Name"; IronPython2
# ---------- name.python (27 lines) ----------
# Carregar as bibliotecas DesignScript e padrão do Python
import sys
import clr
clr.AddReference('ProtoGeometry')
from Autodesk.DesignScript.Geometry import *

# Importando as bibliotecas necessárias
import clr

# Adicionando a referência ao Revit API e ao DocumentManager
clr.AddReference("RevitServices")
from RevitServices.Persistence import DocumentManager

clr.AddReference("RevitAPI")
from Autodesk.Revit.DB import Document

# Função para obter o nome do documento atual
def obter_nome_documento_atual():
    # Obtém o documento atual usando o DocumentManager
    doc_atual = DocumentManager.Instance.CurrentDBDocument
    if doc_atual is not None:
        return doc_atual.Title
    else:
        return "Nenhum documento ativo encontrado."

# Saída com o nome do documento atual
OUT = obter_nome_documento_atual()
# ----------------------------------------
eq = sort == name
filterByBoolMask = List.FilterByBoolMask(list=sort, mask=eq)
indexOf = List.IndexOf(list=get_alldocuments.FileName, element=sort)
getItemAtIndex = List.GetItemAtIndex(list=get_alldocuments.Document, index=indexOf)
filterByBoolMask_2 = List.FilterByBoolMask(list=getItemAtIndex, mask=eq)
code_block_2 = CodeBlock { 0; }
dropdown_data = Custom[DropDown Data](Keys=filterByBoolMask.out, Values=filterByBoolMask_2.out, DefaultValueIndex=code_block_2)  # package Data-Shapes; Create data for DropDown input in UI.MultiInputForm ++ . Check out www.data-shapes.net for more infos.
boolean = BoolSelector(true)
string_3 = StringInput("Cancelar")
multipleinputform = Custom[MultipleInputForm ++](Description_optional=code_block, Logo_optional=readFromFile, ButtonText_optional=string_2, Inputs=dropdown_data, Toggle=boolean, CancelButtonText_optional=string_3)  # package Data-Shapes; Create a form with multiple inputs. see www.data-shapes.net for tutorials and infos!
code_block_3 = CodeBlock()  # //Data-Shapes
code_block_4 = CodeBlock()  # //archilab

number_slider = DoubleSlider(0, range=0..4 step 1)
getItemAtIndex_2 = List.GetItemAtIndex(list=multipleinputform.User_Inputs, index=number_slider)

# group: Deletar espaços do modelo
element_types = ElementTypes("Space")
all_elements_of_type = ElementsOfType(element_type=element_types)
delete = archilab.Revit.Elements.Elements.Delete(element=all_elements_of_type)

# group: Deletar Separadores de espaços do modelo
categories = Categories("OST_MEPSpaceSeparationLines")  # graph input
all_elements_of_category = ElementsOfCategory(Category=categories)
passthrough = Custom[Passthrough](passThrough=all_elements_of_category, waitFor=delete)  # package Clockwork for Dynamo 2.x; Forces a sequential order of execution. The node wired into the output of the Passthrough node will be executed *after* the node wired into the waitFor input (e.g. important for some Revit operations). The value of the passThrough input will be passed on to the node wired into the output port of the Passthrough node.
delete_2 = archilab.Revit.Elements.Elements.Delete(element=passthrough)

# group: LINHAS SEPARADOR ESPAÇOS
passthrough_2 = Custom[Passthrough](passThrough=getItemAtIndex_2, waitFor=delete_2)
categories_2 = Categories("OST_RoomSeparationLines")  # graph input
get_all_elements_from_linked = Custom[Get All Elements From Linked Model](linkDoc=passthrough_2, category=categories_2, lacing=Longest)  # package archi-lab.net; This node is based on code posted by Julien Benoit. Big thanks to Julien for sharing his work. This node will retrieve all elements of a given category from a given linked model.
getLocation = Element.GetLocation(element=get_all_elements_from_linked)

# group: Nível separador ambiente
categories_3 = Categories("OST_Levels")
all_elements_of_category_2 = ElementsOfCategory(Category=categories_3)
startPoint = Curve.StartPoint(curve=getLocation)
Z = Point.Z(point=startPoint)
projectElevation = Level.ProjectElevation(level=all_elements_of_category_2)
code_block_5 = CodeBlock { 0.01; }
eq_2 = Equals(x=Z, y=projectElevation, tolerance=code_block_5, lacing=CrossProduct)
filterByBoolMask_3 = List.FilterByBoolMask(list=all_elements_of_category_2, mask=eq_2@L2)
flatten = List.Flatten(list=filterByBoolMask_3.in)
name_2 = Element.Name(element=flatten)
view_byname = Custom[View ByName](ViewName=name_2)  # package Genius Loci; Collect views by given name in the active or given document. Based on a Christian Gartland's script.

# group (continued): LINHAS SEPARADOR ESPAÇOS
byCurveAndView = DynamoMEP.SpaceSeparator.ByCurveAndView(curve=getLocation, view=view_byname)

# group: CRIAR ESPAÇOS DOS AMBIENTES LINKADOS - COPIAR NOME E NÚMERO DO AMBIENTE
code_block_6 = CodeBlock()  # //archilab
passthrough_3 = Custom[Passthrough](passThrough=getItemAtIndex_2, waitFor=byCurveAndView)
categories_4 = Categories("OST_Rooms")  # graph input
get_all_elements_from_linked_2 = Custom[Get All Elements From Linked Model](linkDoc=passthrough_3, category=categories_4, lacing=Longest)
boolean_2 = BoolSelector(false)
clean = List.Clean(list=get_all_elements_from_linked_2, preserveIndices=boolean_2)
code_block_7 = CodeBlock { "Área"; 0; }
getParameterValueByName = Element.GetParameterValueByName(element=clean, parameterName=code_block_7.out0)
gt = getParameterValueByName > code_block_7.out1
filterByBoolMask_4 = List.FilterByBoolMask(list=clean, mask=gt, lacing=Longest)
flatten_2 = List.Flatten(list=filterByBoolMask_4.in)
boolean_3 = BoolSelector(false)
clean_2 = List.Clean(list=flatten_2, preserveIndices=boolean_3)
getLocation_2 = Element.GetLocation(element=clean_2)
byPoint = DynamoMEP.Space.ByPoint(point=getLocation_2)
end = Revit.Transaction.Transaction.End(input=byPoint)
code_block_8 = CodeBlock { "Nome"; "Número"; "Deslocamento do limite"; }
getParameterValueByName_2 = Element.GetParameterValueByName(element=clean_2, parameterName=code_block_8.out0)
end_2 = Revit.Transaction.Transaction.End(input=getParameterValueByName_2)
python_script_2 = Python(IN[0]=end_2)  # IronPython2
# ---------- python_script_2.python (36 lines) ----------
# Importando as bibliotecas necessárias
import clr
clr.AddReference("RevitServices")
from RevitServices.Persistence import DocumentManager
from RevitServices.Transactions import TransactionManager

# Função para substituir caracteres acentuados por não acentuados
def remove_accents(text):
    # Mapear caracteres acentuados para seus equivalentes não acentuados
    accents_map = {
        'á': 'a', 'à': 'a', 'ã': 'a', 'â': 'a', 'ä': 'a',
        'Á': 'A', 'À': 'A', 'Ã': 'A', 'Â': 'A', 'Ä': 'A',
        'é': 'e', 'è': 'e', 'ê': 'e', 'ë': 'e',
        'É': 'E', 'È': 'E', 'Ê': 'E', 'Ë': 'E',
        'í': 'i', 'ì': 'i', 'î': 'i', 'ï': 'i',
        'Í': 'I', 'Ì': 'I', 'Î': 'I', 'Ï': 'I',
        'ó': 'o', 'ò': 'o', 'õ': 'o', 'ô': 'o', 'ö': 'o',
        'Ó': 'O', 'Ò': 'O', 'Õ': 'O', 'Ô': 'O', 'Ö': 'O',
        'ú': 'u', 'ù': 'u', 'û': 'u', 'ü': 'u',
        'Ú': 'U', 'Ù': 'U', 'Û': 'U', 'Ü': 'U',
        'ç': 'c', 'Ç': 'C',
        'ñ': 'n', 'Ñ': 'N'
    }
    # Substituir os caracteres usando o mapeamento
    for accented_char, unaccented_char in accents_map.items():
        text = text.replace(accented_char, unaccented_char)
    return text

# Entrada do Dynamo
input_strings = IN[0]  # Lista de strings a serem processadas

# Processando a lista de strings
output_strings = [remove_accents(s) for s in input_strings]

# Saída do Dynamo
OUT = output_strings
# ----------------------------------------
setParameterByName = Element.SetParameterByName(element=end, parameterName=code_block_8.out0, value=python_script_2)
getParameterValueByName_3 = Element.GetParameterValueByName(element=clean_2, parameterName=code_block_8.out1)
setParameterByName_2 = Element.SetParameterByName(element=setParameterByName, parameterName=code_block_8.out1, value=getParameterValueByName_3)
getParameterValueByName_4 = Element.GetParameterValueByName(element=clean_2, parameterName=code_block_8.out2)
setParameterByName_3 = Element.SetParameterByName(element=setParameterByName_2, parameterName=code_block_8.out2, value=getParameterValueByName_4)
parameters = Element.Parameters(element=clean)
string_from_object = FromObject(object=parameters)
string_4 = StringInput("Fase")
contains = String.Contains(string=string_from_object, searchFor=string_4)
filterByBoolMask_5 = List.FilterByBoolMask(list=string_from_object, mask=contains)
flatten_3 = List.Flatten(list=filterByBoolMask_5.in)
code_block_9 = CodeBlock { 0; 7; }
remove = String.Remove(string=flatten_3, startIndex=code_block_9.out0, count=code_block_9.out1)
currentview = Custom[© CurrentView]()  # package Crumple; Given the current document, return the active view.
phase = Custom[View.Phase](view=currentview)  # package Clockwork for Dynamo 2.x; Returns the phase of a given view
name_3 = Element.Name(element=phase)
string_contains_varias_palavras = Python(IN[0]=remove, IN[1]=name_3)  # IronPython2
# ---------- string_contains_varias_palavras.python (14 lines) ----------
# Entrada IN[0]: lista de nomes dos espaços
# Entrada IN[1]: lista de palavras-chave a remover

names = IN[0]
terms = IN[1]

outList = []

for name in names:
    # Verifica se qualquer termo está contido no nome (ignora maiúsculas/minúsculas)
    found = any(term.lower() in name.lower() for term in terms)
    outList.append(not found)  # True se NÃO contiver, ou seja, deve ser mantido

OUT = outList
# ----------------------------------------
filterByBoolMask_6 = List.FilterByBoolMask(list=clean, mask=string_contains_varias_palavras)

# group: AJUSTE O LIMITE SUPERIOR E A COMPENSAÇÃO DO LIMITE
code_block_10 = CodeBlock { "Limite superior"; }
parameters_2 = Element.Parameters(element=clean_2)
string_from_object_2 = FromObject(object=parameters_2)
code_block_11 = CodeBlock { "Limite superior"; }
contains_2 = String.Contains(string=string_from_object_2, searchFor=code_block_11)
filterByBoolMask_7 = List.FilterByBoolMask(list=string_from_object_2, mask=contains_2)
code_block_12 = CodeBlock { 0; 18; }
remove_2 = String.Remove(string=filterByBoolMask_7.in, startIndex=code_block_12.out0, count=code_block_12.out1)
flatten_4 = List.Flatten(list=remove_2)
code_block_13 = CodeBlock { " - ELE"; }
add = flatten_4 + code_block_13
getLevelByName = archilab.Revit.Selection.Select.GetLevelByName(name=add, lacing=Longest)
code_block_14 = CodeBlock { "Nível"; }
getParameterValueByName_5 = Element.GetParameterValueByName(element=clean_2, parameterName=code_block_14)
python_script_3 = Python(IN[0]=getLevelByName, IN[1]=getParameterValueByName_5)  # IronPython2
# ---------- python_script_3.python (19 lines) ----------
# Entradas do nó Python:
# IN[0] = listaA (com possíveis nulos)
# IN[1] = listaB (valores para substituir os nulos)

listaA = IN[0]
listaB = IN[1]

# Função que substitui valores nulos por valores da outra lista
resultado = []

for i in range(len(listaA)):
    itemA = listaA[i]
    itemB = listaB[i] if i < len(listaB) else None
    if itemA is None:
        resultado.append(itemB)
    else:
        resultado.append(itemA)

OUT = resultado
# ----------------------------------------
setParameterByName_4 = Element.SetParameterByName(element=setParameterByName_3, parameterName=code_block_10, value=python_script_3)

# group: Nível separador ambiente
categories_5 = Categories("OST_Levels")
all_elements_of_category_3 = ElementsOfCategory(Category=categories_5)
Z_2 = Point.Z(point=getLocation_2)
projectElevation_2 = Level.ProjectElevation(level=all_elements_of_category_3)
code_block_15 = CodeBlock { 0.01; }
eq_3 = Equals(x=Z_2, y=projectElevation_2, tolerance=code_block_15, lacing=CrossProduct)
filterByBoolMask_8 = List.FilterByBoolMask(list=all_elements_of_category_3, mask=eq_3@L2)
flatten_5 = List.Flatten(list=filterByBoolMask_8.in)
name_4 = Element.Name(element=flatten_5)
view_byname_2 = Custom[View ByName](ViewName=name_4)

# group: Tag Spaces
flatten_6 = List.Flatten(list=getLocation_2)
flatten_7 = List.Flatten(list=byPoint)
family_types = FamilyTypes("Tag de Spaces com Area e Perimetro:Tag para Spaces com Área e Perímetro")
tags_spaces_e_rooms_em_multiplas = Python(IN[0]=flatten_7, IN[1]=view_byname_2, IN[2]=family_types)  # "Tags spaces e rooms em multiplas vistas"; IronPython2
# ---------- tags_spaces_e_rooms_em_multiplas.python (122 lines) ----------
# SCRIPT DEFINITIVO - TAG PARA SPACES E ROOMS (LISTA 1:1) + FAMILY TYPE OPCIONAL
# Versão 6.0

import clr

# Dynamo <-> Revit
clr.AddReference("RevitNodes")
import Revit
clr.ImportExtensions(Revit.Elements)

clr.AddReference("RevitAPI")
from Autodesk.Revit.DB import *

clr.AddReference("RevitServices")
from RevitServices.Persistence import DocumentManager
from RevitServices.Transactions import TransactionManager

doc = DocumentManager.Instance.CurrentDBDocument

# ---------- Função robusta para flatten ----------
def deep_flatten(item):
    if isinstance(item, str):
        return [item]
    try:
        if hasattr(item, "__iter__") and not isinstance(item, (Element, View, ElementId)):
            flat = []
            for sub in item:
                flat.extend(deep_flatten(sub))
            return flat
    except:
        pass
    return [item]

def unwrap_list(data):
    return [UnwrapElement(x) if hasattr(x, "__iter__")==False else x for x in data]

# ---------- Função para calcular o ponto ----------
def get_center(elem, view):
    # 1) Tentar Location Point
    try:
        loc = elem.Location
        if hasattr(loc, "Point") and loc.Point:
            return UV(loc.Point.X, loc.Point.Y)
    except:
        pass

    # 2) bounding box da view
    try:
        bbox = elem.get_BoundingBox(view)
        if bbox:
            return UV((bbox.Min.X + bbox.Max.X)/2, (bbox.Min.Y + bbox.Max.Y)/2)
    except:
        pass

    # 3) bounding box global
    try:
        bbox = elem.get_BoundingBox(None)
        if bbox:
            return UV((bbox.Min.X + bbox.Max.X)/2, (bbox.Min.Y + bbox.Max.Y)/2)
    except:
        pass

    return None


# ---------- ENTRADAS ----------
elements = deep_flatten(IN[0])
views = deep_flatten(IN[1])
tagType = IN[2] if len(IN) > 2 else None

elements = unwrap_list(elements)
views = unwrap_list(views)

# processa family type
if tagType:
    tagType = UnwrapElement(tagType)

# validar tamanhos
if len(elements) != len(views):
    OUT = "Erro: A quantidade de elementos deve ser igual à quantidade de vistas."
else:
    created = []

    TransactionManager.Instance.EnsureInTransaction(doc)

    for elem, view in zip(elements, views):
        try:
            uv = get_center(elem, view)
            if uv is None:
                created.append("Falha ao obter ponto do elemento: {}".format(elem))
                continue

            typename = elem.GetType().FullName

            # ---- SPACE ----
            if "Autodesk.Revit.DB.Mechanical.Space" in typename:
                tag = doc.Create.NewSpaceTag(elem, uv, view)

            # ---- ROOM ----
            elif "Autodesk.Revit.DB.Architecture.Room" in typename:
                room_id = LinkElementId(elem.Id)
                tag = doc.Create.NewRoomTag(room_id, uv, view.Id)

                # aplica tipo opcional
                if tagType:
                    try:
                        tag.ChangeTypeId(tagType.Id)
                    except:
                        pass

            else:
                created.append("Elemento ignorado (não é Room nem Space): {}".format(elem))
                continue

            created.append(tag.ToDSType(False))

        except Exception as e:
            created.append("Erro ao processar elemento {}: {}".format(elem, e))

    TransactionManager.Instance.TransactionTaskDone()

    OUT = created
# ----------------------------------------
boolean_4 = BoolSelector(true)
watch = Watch(flatten_7)

# group: LIGAÇÃO
code_block_16 = CodeBlock()  # //Clockwork
code_block_17 = CodeBlock(passthrough=setParameterByName_4, waitfor=tags_spaces_e_rooms_em_multiplas) { [passthrough,waitfor][0]; }

# group: Mensagem Final
count = List.Count(list=code_block_17)
code_block_18 = CodeBlock { 0; }
gt_2 = count > code_block_18
code_block_19 = CodeBlock(N=count) { ["Feito! Você copiou "+N+" Espaços"]; }
code_block_20 = CodeBlock { ["Nenhum Espaço foi criado"]; }
if_ = If(test=gt_2, true=code_block_19, false=code_block_20)
fromList = Python(IN[0]=if_)  # "String.FromList"; IronPython2
# ---------- fromList.python (22 lines) ----------
# Carregar as bibliotecas DesignScript e padrão do Python
import sys
import clr
clr.AddReference('ProtoGeometry')
from Autodesk.DesignScript.Geometry import *

# Função para concatenar os valores de uma lista em uma única string com múltiplas linhas
def concatenate_list_to_string(input_list, delimiter="\n"):
    # Verifica se a entrada é uma lista
    if not isinstance(input_list, list):
        return "A entrada deve ser uma lista."
    
    # Converte todos os elementos para string e junta com o delimitador especificado
    result = delimiter.join(str(item) for item in input_list)
    return result

# Entrada pelo nó do Dynamo
lista = IN[0]  # Lista de valores a serem concatenados
delimitador = IN[1] if len(IN) > 1 else "\n"  # Delimitador opcional, padrão é nova linha

# Saída para o Dynamo
OUT = concatenate_list_to_string(lista, delimitador)
# ----------------------------------------
python_script_4 = Python(IN[0]=fromList)  # IronPython2
# ---------- python_script_4.python (21 lines) ----------
# Importar as bibliotecas necessárias do Revit
import clr
clr.AddReference("RevitServices")
from RevitServices.Persistence import DocumentManager

clr.AddReference("RevitAPI")
clr.AddReference("RevitAPIUI")
from Autodesk.Revit.UI import TaskDialog

# Pegar a entrada do Dynamo
mensagem = IN[0]

# Criar a TaskDialog
task_dialog = TaskDialog("Ok")
task_dialog.MainInstruction = mensagem

# Exibir a TaskDialog
task_dialog.Show()

# Saída do script
OUT = "Sucesso!"
# ----------------------------------------
