# Dynamo graph 2021_01-1_BIMACON_Criar Espaços dos ambientes(Rooms)-LINK_R05_script.dyn "ok 2021_01-1_BIMACON_Criar Espaços dos ambientes(Rooms)-LINK_R04_script" (Dynamo 2.19.3.6394)
# Criar espaços por meio da seleção do arquivo linkado. Se Nele existir os Ambientes será feita a importação
# packages: archi-lab.net 2023.213.1722, Clockwork for Dynamo 1.x 1.34.0, Orchid 2.16.5.6198, Data-Shapes 2022.2.105, Orchid 2.6.8.6198, Genius Loci 2023.2.21, DynamoMEP 1.0.3, Clockwork for Dynamo 2.x 2.4.0, Orchid 2.19.3.6373

# group: SELECIONE O MODELO ARQ LINKADO
code_block = CodeBlock { "Selecione o arquivo para obter os Espaços:"; }
file_path = Filename("..\..\..\..\..\05 - BIMACON\01 - EMPRESA BIMACON\00 - Logos e imagens - BIMACON\ARTE BIMACON\reddonda-removebg-preview.png")
file_from_path = FileObject(path=file_path)
readFromFile = Image.ReadFromFile(file=file_from_path)
string = StringInput("Confirmar")
get_alldocuments = Custom[Get AllDocuments]()  # package Genius Loci; Get documents (linked and opened in background). The first document is the active document.
current = Document.Current()
name = Orchid.RevitProject.Common.Document.Name(document=current)
eq = get_alldocuments.FileName == name
filterByBoolMask = List.FilterByBoolMask(list=get_alldocuments.FileName, mask=eq)
filterByBoolMask_2 = List.FilterByBoolMask(list=get_alldocuments.Document, mask=eq)
code_block_2 = CodeBlock { 0; }
dropdown_data = Custom[DropDown Data](Keys=filterByBoolMask.out, Values=filterByBoolMask_2.out, DefaultValueIndex=code_block_2)  # package Data-Shapes; Create data for DropDown input in UI.MultiInputForm ++ . Check out www.data-shapes.net for more infos.
boolean = BoolSelector(true)
string_2 = StringInput("Cancelar")
multipleinputform = Custom[MultipleInputForm ++](Description_optional=code_block, Logo_optional=readFromFile, ButtonText_optional=string, Inputs=dropdown_data, Toggle=boolean, CancelButtonText_optional=string_2)  # package Data-Shapes; Create a form with multiple inputs. see www.data-shapes.net for tutorials and infos!
code_block_3 = CodeBlock()  # //Data-Shapes
code_block_4 = CodeBlock()  # //archilab

number_slider = DoubleSlider(0, range=0..4 step 1)
getItemAtIndex = List.GetItemAtIndex(list=multipleinputform.User_Inputs, index=number_slider)

# group: Deletar espaços do modelo
element_types = ElementTypes("Space")
all_elements_of_type = ElementsOfType(element_type=element_types)
delete = archilab.Revit.Elements.Elements.Delete(element=all_elements_of_type)

# group: Deletar Separadores de espaços do modelo
categories = Categories("OST_MEPSpaceSeparationLines")  # graph input
all_elements_of_category = ElementsOfCategory(Category=categories)
passthrough = Custom[Passthrough](passThrough=all_elements_of_category, waitFor=delete)  # package Clockwork for Dynamo 2.x; Forces a sequential order of execution. The node wired into the output of the Passthrough node will be executed *after* the node wired into the waitFor input (e.g. important for some Revit operations). The value of the passThrough input will be passed on to the node wired into the output port of the Passthrough node.
delete_2 = archilab.Revit.Elements.Elements.Delete(element=passthrough)

# group: LINHAS SEPARADOR ESPAÇOS
# Descrição <Clique duas vezes aqui para editar a descrição do grupo>
passthrough_2 = Custom[Passthrough](passThrough=getItemAtIndex, waitFor=delete_2)
categories_2 = Categories("OST_RoomSeparationLines")  # graph input
get_all_elements_from_linked = Custom[Get All Elements From Linked Model](linkDoc=passthrough_2, category=categories_2, lacing=Longest)  # package archi-lab.net; This node is based on code posted by Julien Benoit. Big thanks to Julien for sharing his work. This node will retrieve all elements of a given category from a given linked model.
getLocation = Element.GetLocation(element=get_all_elements_from_linked)

# group: Nível separador ambiente
# Descrição <Clique duas vezes aqui para editar a descrição do grupo>
categories_3 = Categories("OST_Levels")
all_elements_of_category_2 = ElementsOfCategory(Category=categories_3)
startPoint = Curve.StartPoint(curve=getLocation)
Z = Point.Z(point=startPoint)
projectElevation = Level.ProjectElevation(level=all_elements_of_category_2)
code_block_5 = CodeBlock { 0.01; }
eq_2 = Equals(x=Z, y=projectElevation, tolerance=code_block_5, lacing=CrossProduct)
filterByBoolMask_3 = List.FilterByBoolMask(list=all_elements_of_category_2, mask=eq_2@L2)
flatten = List.Flatten(list=filterByBoolMask_3.in)
name_2 = Element.Name(element=flatten)
view_byname = Custom[View ByName](ViewName=name_2)  # package Genius Loci; Collect views by given name in the active or given document. Based on a Christian Gartland's script.

# group (continued): LINHAS SEPARADOR ESPAÇOS
byCurveAndView = DynamoMEP.SpaceSeparator.ByCurveAndView(curve=getLocation, view=view_byname)

# group: CRIAR ESPAÇOS DOS AMBIENTES LINKADOS - COPIAR NOME E NÚMERO DO AMBIENTE
code_block_6 = CodeBlock()  # //archilab
passthrough_3 = Custom[Passthrough](passThrough=getItemAtIndex, waitFor=byCurveAndView)
categories_4 = Categories("OST_Rooms")  # graph input
get_all_elements_from_linked_2 = Custom[Get All Elements From Linked Model](linkDoc=passthrough_3, category=categories_4, lacing=Longest)
getLocation_2 = Element.GetLocation(element=get_all_elements_from_linked_2)
byPoint = DynamoMEP.Space.ByPoint(point=getLocation_2)
end = Revit.Transaction.Transaction.End(input=byPoint)
code_block_7 = CodeBlock { "Nome"; "Número"; "Deslocamento do limite"; }
getParameterValueByName = Element.GetParameterValueByName(element=get_all_elements_from_linked_2, parameterName=code_block_7.out0)
python_script = Python(IN[0]=getParameterValueByName)  # CPython3
# ---------- python_script.python (36 lines) ----------
# Importando as bibliotecas necessárias
import clr
clr.AddReference("RevitServices")
from RevitServices.Persistence import DocumentManager
from RevitServices.Transactions import TransactionManager

# Função para substituir caracteres acentuados por não acentuados
def remove_accents(text):
    # Mapear caracteres acentuados para seus equivalentes não acentuados
    accents_map = {
        'á': 'a', 'à': 'a', 'ã': 'a', 'â': 'a', 'ä': 'a',
        'Á': 'A', 'À': 'A', 'Ã': 'A', 'Â': 'A', 'Ä': 'A',
        'é': 'e', 'è': 'e', 'ê': 'e', 'ë': 'e',
        'É': 'E', 'È': 'E', 'Ê': 'E', 'Ë': 'E',
        'í': 'i', 'ì': 'i', 'î': 'i', 'ï': 'i',
        'Í': 'I', 'Ì': 'I', 'Î': 'I', 'Ï': 'I',
        'ó': 'o', 'ò': 'o', 'õ': 'o', 'ô': 'o', 'ö': 'o',
        'Ó': 'O', 'Ò': 'O', 'Õ': 'O', 'Ô': 'O', 'Ö': 'O',
        'ú': 'u', 'ù': 'u', 'û': 'u', 'ü': 'u',
        'Ú': 'U', 'Ù': 'U', 'Û': 'U', 'Ü': 'U',
        'ç': 'c', 'Ç': 'C',
        'ñ': 'n', 'Ñ': 'N'
    }
    # Substituir os caracteres usando o mapeamento
    for accented_char, unaccented_char in accents_map.items():
        text = text.replace(accented_char, unaccented_char)
    return text

# Entrada do Dynamo
input_strings = IN[0]  # Lista de strings a serem processadas

# Processando a lista de strings
output_strings = [remove_accents(s) for s in input_strings]

# Saída do Dynamo
OUT = output_strings
# ----------------------------------------
setParameterByName = Element.SetParameterByName(element=end, parameterName=code_block_7.out0, value=python_script)
getParameterValueByName_2 = Element.GetParameterValueByName(element=get_all_elements_from_linked_2, parameterName=code_block_7.out1)
setParameterByName_2 = Element.SetParameterByName(element=setParameterByName, parameterName=code_block_7.out1, value=getParameterValueByName_2)
getParameterValueByName_3 = Element.GetParameterValueByName(element=get_all_elements_from_linked_2, parameterName=code_block_7.out2)
setParameterByName_3 = Element.SetParameterByName(element=setParameterByName_2, parameterName=code_block_7.out2, value=getParameterValueByName_3)
byCoordinates = Point.ByCoordinates()

# group: LIGAÇÃO
code_block_8 = CodeBlock()  # //Clockwork
code_block_9 = CodeBlock(passthrough=byPoint, waitfor=setParameterByName_2) { [passthrough,waitfor][0]; }

# group: AJUSTE O LIMITE SUPERIOR E A COMPENSAÇÃO DO LIMITE
code_block_10 = CodeBlock()  # //archilab
code_block_11 = CodeBlock { "Limite superior"; }
code_block_12 = CodeBlock { "Nível"; }
getParameterValueByName_4 = Element.GetParameterValueByName(element=code_block_9, parameterName=code_block_12)
getLevelByName = archilab.Revit.Selection.Select.GetLevelByName(name=getParameterValueByName_4, lacing=Longest)
levelAbove = Custom[Level.LevelAbove](level=getLevelByName)  # package archi-lab.net; This node takes an input of level and returns level above it.
setParameterByName_4 = Element.SetParameterByName(element=code_block_9, parameterName=code_block_11, value=levelAbove)

watch = Watch(setParameterByName_3)

# group: Nível separador ambiente
# Descrição <Clique duas vezes aqui para editar a descrição do grupo>
categories_5 = Categories("OST_Levels")
all_elements_of_category_3 = ElementsOfCategory(Category=categories_5)
Z_2 = Point.Z(point=getLocation_2)
projectElevation_2 = Level.ProjectElevation(level=all_elements_of_category_3)
code_block_13 = CodeBlock { 0.01; }
eq_3 = Equals(x=Z_2, y=projectElevation_2, tolerance=code_block_13, lacing=CrossProduct)
filterByBoolMask_4 = List.FilterByBoolMask(list=all_elements_of_category_3, mask=eq_3@L2)
flatten_2 = List.Flatten(list=filterByBoolMask_4.in)
name_3 = Element.Name(element=flatten_2)
view_byname_2 = Custom[View ByName](ViewName=name_3)

# group: Tag Spaces
flatten_3 = List.Flatten(list=byPoint)
family_types = FamilyTypes("Tag de Spaces com Area e Perimetro:Tag para Spaces com Área e Perímetro")
flatten_4 = List.Flatten(list=getLocation_2)
bySpatialElementAndLocation = Orchid.RevitProject.Annotations.Tag.BySpatialElementAndLocation(view=view_byname_2, spatialElement=flatten_3, tagType=family_types, location=flatten_4)

# group: Mensagem Final
count = List.Count(list=setParameterByName_4)
code_block_14 = CodeBlock { 0; }
gt = count > code_block_14
code_block_15 = CodeBlock(N=count) { ["Feito! Você copiou "+N+" Espaços"]; }
code_block_16 = CodeBlock { ["Nenhum Espaço foi criado"]; }
if_ = If(test=gt, true=code_block_15, false=code_block_16)
o_string_fromlist = Orchid.Common.String.FromList(list=if_)
python_script_2 = Python(IN[0]=o_string_fromlist)  # IronPython2
# ---------- python_script_2.python (21 lines) ----------
# Importar as bibliotecas necessárias do Revit
import clr
clr.AddReference("RevitServices")
from RevitServices.Persistence import DocumentManager

clr.AddReference("RevitAPI")
clr.AddReference("RevitAPIUI")
from Autodesk.Revit.UI import TaskDialog

# Pegar a entrada do Dynamo
mensagem = IN[0]

# Criar a TaskDialog
task_dialog = TaskDialog("Ok")
task_dialog.MainInstruction = mensagem

# Exibir a TaskDialog
task_dialog.Show()

# Saída do script
OUT = "Sucesso!"
# ----------------------------------------
