# Dynamo graph 01-0_BIMACON_Criar Niveis do LINK_R09_script.dyn "01-0_BIMACON_Criar Niveis do LINK_R08_script" (Dynamo 2.19.3.6394)
# author: Jose Nelson
# Importar Níveis
# packages: DynamoIronPython2.7 3.2.1, Clockwork for Dynamo 2.x 2.4.0, Data-Shapes 2022.2.105, Genius Loci 2023.2.21, archi-lab.net 2023.213.1722, BIMCoder Nodes - 2.X 2025.1.0, Rhythm 2023.4.2021, Data-Shapes 2025.3.120, archi-lab.net 2025.300.1225, Crumple 2021.9.24

# group: Mensagem
code_block = CodeBlock { ["Selecione o link a ser copiado os Níveis"]; }
code_block_2 = CodeBlock { ["Nenhum link foi selecionado"]; }
dialog_simple = Custom[👓 Dialog․Simple](message=code_block, flow=code_block_2)  # package BIMCoder Nodes - 2.X; Exibe uma mensagem de alerta ao usuário, sem botões de ação.
categories = Categories("OST_RvtLinks")
boolean = BoolSelector(true)
ʳʰʸᵗʰᵐ_selection_pick = Rhythm.Revit.Selection.Selection.Pick(runIt=dialog_simple, category=categories, singleSelection=boolean)

code_block_3 = CodeBlock { 0; 1; }
getItemAtIndex = List.GetItemAtIndex(list=ʳʰʸᵗʰᵐ_selection_pick, index=code_block_3.out0)
get_project_locations = Custom[Get Project Locations](docOrRevitLinkInstance=getItemAtIndex)  # package Genius Loci; Works only in Revit 2018 and later. Retrieves the project positions of the given document in the Survey Coordinate System. (Coordinates of Internal origin, project base point and survey point)
Z = Point.Z(point=get_project_locations.Project_Base_Point)
code_block_4 = CodeBlock(lista=Z) { lista[0]; }
python_script = Python(IN[0]=getItemAtIndex)  # IronPython2
# ---------- python_script.python (61 lines) ----------
import clr
# Importar bibliotecas necessárias do Revit e Dynamo
clr.AddReference('RevitServices')
clr.AddReference('RevitAPI')
clr.AddReference('RevitAPIUI')
clr.AddReference('RevitNodes')

from RevitServices.Persistence import DocumentManager
from Autodesk.Revit.DB import *
from RevitServices.Transactions import TransactionManager

# Obter o documento ativo do Dynamo
doc = DocumentManager.Instance.CurrentDBDocument

# Entrada 0: Elemento do vínculo selecionado pelo usuário
vinculo_selecionado = UnwrapElement(IN[0])  # Desempacotar o elemento Revit

# Verificar se o vínculo selecionado é válido
if vinculo_selecionado and isinstance(vinculo_selecionado, RevitLinkInstance):
    try:
        # Obter o documento vinculado (arquivo RVT vinculado)
        link_doc = vinculo_selecionado.GetLinkDocument()

        # Verificar se o documento vinculado existe
        if link_doc is None:
            OUT = "Erro: Documento vinculado não encontrado."
        else:
            # Coletar os níveis do vínculo
            niveis_vinculados = FilteredElementCollector(link_doc).OfCategory(BuiltInCategory.OST_Levels).WhereElementIsNotElementType().ToElements()

            # Criar uma lista para armazenar os níveis (nome e elevação)
            niveis_elevacoes = []

            for nivel in niveis_vinculados:
                # Obter o nome do nível
                nome_nivel = nivel.Name

                # Acessar o parâmetro "Elevação" do nível
                elevacao_param = nivel.get_Parameter(BuiltInParameter.LEVEL_ELEV).AsDouble()

                # Converter a elevação de pés para metros (unidade padrão do Revit é pés)
                elevacao_metros = UnitUtils.ConvertFromInternalUnits(elevacao_param, UnitTypeId.Meters)

                # Adicionar o nível como uma tupla (nome, elevação)
                niveis_elevacoes.append((nome_nivel, elevacao_metros))

            # Ordenar a lista de níveis por elevação (menor para maior)
            niveis_ordenados = sorted(niveis_elevacoes, key=lambda x: x[1])

            # Separar os nomes e elevações em listas distintas
            nomes_ordenados = [item[0] for item in niveis_ordenados]
            elevacoes_ordenadas = [item[1] for item in niveis_ordenados]

            # Saída: Duas listas ordenadas (nomes e elevações)
            OUT = (nomes_ordenados, elevacoes_ordenadas)
    except Exception as e:
        # Tratamento de exceção caso ocorra algum erro
        OUT = "Erro: " + str(e)
else:
    # Caso o vínculo selecionado seja inválido
    OUT = "Erro: Por favor, selecione um vínculo válido na entrada 0."
# ----------------------------------------
getItemAtIndex_2 = List.GetItemAtIndex(list=python_script, index=code_block_3.out1)
add = code_block_4 + getItemAtIndex_2
getItemAtIndex_3 = List.GetItemAtIndex(list=python_script, index=code_block_3.out0)
passThrough = Custom[PassThrough](passThrough=getItemAtIndex_3, waitFor=getItemAtIndex_2)  # package archi-lab.net; Ripped this off from Clockwork. Sorry Andy.

# group: SELECIONE O MODELO ARQ LINKADO
code_block_5 = CodeBlock()  # //archilab
code_block_6 = CodeBlock()  # //Data-Shapes
get_alldocuments = Custom[Get AllDocuments]()  # package Genius Loci; Get documents (linked and opened in background). The first document is the active document.
code_block_7 = CodeBlock { "Selecione os Níveis a serem Copiados o Modelo de Vista e o Sufixo"; }
string = StringInput("LogoBimacon.png")
string_2 = StringInput("Confirmar")
code_block_8 = CodeBlock { "Escolha os Níveis"; }
boolean_2 = BoolSelector(false)
listview_data = Custom[Listview Data](InputName=code_block_8, Keys=passThrough, Values=passThrough, SortItems_optionnal=boolean_2)  # package Data-Shapes; Create data for ListView input in UI.MultiInputForm ++ . Check out www.data-shapes.net for more infos.
string_3 = StringInput("Selecione o Modelo de Vista")
categories_2 = Categories("OST_Views")
all_elements_of_category = ElementsOfCategory(Category=categories_2)
boolean_3 = BoolSelector(false)
clean = List.Clean(list=all_elements_of_category, preserveIndices=boolean_3)
isViewTemplate = View.IsViewTemplate(view=clean)
filterByBoolMask = List.FilterByBoolMask(list=clean, mask=isViewTemplate)
string_from_object = FromObject(object=filterByBoolMask.in)
type = Object.Type(object=filterByBoolMask.in)
groupByKey = List.GroupByKey(list=string_from_object, keys=type)
list_sortnatural = Custom[List SortNatural](list=groupByKey.groups)  # package Genius Loci; Sorts a specified list in natural order in either ascending or descending order.
flatten = List.Flatten(list=list_sortnatural)
groupByKey_2 = List.GroupByKey(list=filterByBoolMask.in, keys=type)
list_sortnatural_2 = Custom[List SortNatural](list=groupByKey_2.groups)
flatten_2 = List.Flatten(list=list_sortnatural_2)
code_block_9 = CodeBlock { 20; }
boolean_4 = BoolSelector(false)
dropdown_data = Custom[DropDown Data](InputName=string_3, Keys=flatten, Values=flatten_2, DefaultValueIndex=code_block_9, Sorted_optional=boolean_4)  # package Data-Shapes; Create data for DropDown input in UI.MultiInputForm ++ . Check out www.data-shapes.net for more infos.
code_block_10 = CodeBlock { "Sufixo"; }
string_4 = StringInput(" - ELE")
textbox_data = Custom[TextBox Data](InputName=code_block_10, DefaultText=string_4)  # package Data-Shapes; Create Data for TextBox input in UI.MultipleInputForm ++ . Check out www.data-shapes.net for more informations
list_create = List.Create(item0=listview_data, item1=dropdown_data, item2=textbox_data)
boolean_5 = BoolSelector(true)
string_5 = StringInput("Cancelar")
number = DoubleInput(600)
number_2 = DoubleInput(200)

python_script_2 = Python(IN[0]=string)  # IronPython2
# ---------- python_script_2.python (22 lines) ----------
import clr

# Adiciona referência ao ambiente .NET
clr.AddReference('System')
from System import Environment, IO

# Nome da imagem (entrada do usuário)
nome_arquivo_imagem = IN[0]

# Recupera o nome do usuário logado no Windows
usuario = Environment.UserName

# Monta o caminho completo para a pasta de imagens
caminho_base = r"C:\Users\{0}\AppData\Roaming\pyRevit\Extensions\Bimacon.extension\Bimacon.tab\Imagens_Bimacon".format(usuario)

# Junta o caminho base com o nome do arquivo
caminho_completo = IO.Path.Combine(caminho_base, nome_arquivo_imagem)

# Verifica se o arquivo existe
existe = IO.File.Exists(caminho_completo)

OUT = caminho_completo if existe else "Imagem não encontrada: {0}".format(caminho_completo)
# ----------------------------------------

# group (continued): SELECIONE O MODELO ARQ LINKADO
file_from_path = FileObject(path=python_script_2)
readFromFile = Image.ReadFromFile(file=file_from_path)
multipleinputform = Custom[MultipleInputForm ++](Description_optional=code_block_7, Logo_optional=readFromFile, ButtonText_optional=string_2, Inputs=list_create, Toggle=boolean_5, CancelButtonText_optional=string_5, Width_optional=number, LabelWidth_optional=number_2)  # package Data-Shapes; Create a form with multiple inputs. see www.data-shapes.net for tutorials and infos!

# group: saidas
code_block_11 = CodeBlock { 0; }
getItemAtIndex_4 = List.GetItemAtIndex(list=multipleinputform.User_Inputs, index=code_block_11)
code_block_12 = CodeBlock { 2; }
getItemAtIndex_5 = List.GetItemAtIndex(list=multipleinputform.User_Inputs, index=code_block_12)
code_block_13 = CodeBlock { 1; }
getItemAtIndex_6 = List.GetItemAtIndex(list=multipleinputform.User_Inputs, index=code_block_13)

python_script_3 = Python()  # IronPython2; unwired: IN[0]
# ---------- python_script_3.python (65 lines) ----------
# Importando as bibliotecas do Revit e Windows Forms
import clr
clr.AddReference("RevitServices")
from RevitServices.Persistence import DocumentManager
from RevitServices.Transactions import TransactionManager

clr.AddReference("RevitAPI")
from Autodesk.Revit.DB import *

# Adicionando referência para System.Windows.Forms
clr.AddReference("System.Windows.Forms")
from System.Windows.Forms import MessageBox, MessageBoxButtons

# Obtendo o documento atual do Revit
doc = DocumentManager.Instance.CurrentDBDocument

# Função para obter a unidade de comprimento
def get_length_unit_format(doc):
    # Obtendo as unidades do documento
    units = doc.GetUnits()

    # Acessando as opções de formato para o comprimento
    format_options = units.GetFormatOptions(SpecTypeId.Length)

    # Obtendo o ID da unidade de comprimento atual
    unit_type_id = format_options.GetUnitTypeId()

    # Retornando a unidade de comprimento atual
    return unit_type_id

# Função para definir a unidade de comprimento para centímetros
def set_length_unit_to_meters(doc):
    # Iniciando uma transação para modificar as unidades
    TransactionManager.Instance.EnsureInTransaction(doc)

    # Obtendo as unidades atuais
    units = doc.GetUnits()

    # Criando novas opções de formato para definir como centímetros
    format_options = FormatOptions(UnitTypeId.Meters)

    # Definindo as opções para o comprimento (Length)
    units.SetFormatOptions(SpecTypeId.Length, format_options)

    # Aplicando as mudanças ao documento
    doc.SetUnits(units)

    # Finalizando a transação
    TransactionManager.Instance.TransactionTaskDone()

# Obtendo a unidade de comprimento atual
length_unit = get_length_unit_format(doc)

# Verificando se a unidade não é centímetros e mudando se necessário
if length_unit != UnitTypeId.Meters:
    set_length_unit_to_meters(doc)
    result = "Unidade de comprimento alterada para Metros"
else:
    result = "A unidade de comprimento já está em Metros"

# Exibir uma janela pop-up para o usuário confirmar a mensagem
MessageBox.Show(result, "Confirmação", MessageBoxButtons.OK)

# Retornar 1 para o Dynamo após o usuário clicar em OK
OUT = 1
# ----------------------------------------
passthrough = Custom[Passthrough](passThrough=getItemAtIndex_4, waitFor=python_script_3)  # package Clockwork for Dynamo 2.x; Forces a sequential order of execution. The node wired into the output of the Passthrough node will be executed *after* the node wired into the waitFor input (e.g. important for some Revit operations). The value of the passThrough input will be passed on to the node wired into the output port of the Passthrough node.
eq = passthrough == passThrough  # lacing=CrossProduct
filterByBoolMask_2 = List.FilterByBoolMask(list=add, mask=eq@L2)
filterByBoolMask_3 = List.FilterByBoolMask(list=getItemAtIndex_3, mask=eq@L2)
add_2 = filterByBoolMask_3.in + getItemAtIndex_5
byElevationAndName = Level.ByElevationAndName(elevation=filterByBoolMask_2.in, name=add_2)
byLevel = FloorPlanView.ByLevel(level=byElevationAndName)

# group: Mensagem Final
boolean_6 = BoolSelector(true)
isEmpty = List.IsEmpty(list=byLevel@L2)
count = List.Count(list=byLevel)
code_block_14 = CodeBlock(a=boolean_6, b=isEmpty, c=count) { a==b?0:c; }
firstItem = List.FirstItem(list=code_block_14)
code_block_15 = CodeBlock { 0; }
gt = firstItem > code_block_15
code_block_16 = CodeBlock(N=firstItem) { ["Feito, Voce copiou "+N+" Niveis"]; }
code_block_17 = CodeBlock { ["Nenhum Nivel foi copiado"]; }
code_block_18 = CodeBlock(a=gt, b=code_block_16, c=code_block_17) { a==true?b:c; }
fromList = Python(IN[0]=code_block_18)  # "String.FromList"; IronPython2
# ---------- fromList.python (22 lines) ----------
# Carregar as bibliotecas DesignScript e padrão do Python
import sys
import clr
clr.AddReference('ProtoGeometry')
from Autodesk.DesignScript.Geometry import *

# Função para concatenar os valores de uma lista em uma única string com múltiplas linhas
def concatenate_list_to_string(input_list, delimiter="\n"):
    # Verifica se a entrada é uma lista
    if not isinstance(input_list, list):
        return "A entrada deve ser uma lista."
    
    # Converte todos os elementos para string e junta com o delimitador especificado
    result = delimiter.join(str(item) for item in input_list)
    return result

# Entrada pelo nó do Dynamo
lista = IN[0]  # Lista de valores a serem concatenados
delimitador = IN[1] if len(IN) > 1 else "\n"  # Delimitador opcional, padrão é nova linha

# Saída para o Dynamo
OUT = concatenate_list_to_string(lista, delimitador)
# ----------------------------------------
python_script_4 = Python(IN[0]=fromList)  # IronPython2
# ---------- python_script_4.python (21 lines) ----------
# Importar as bibliotecas necessárias do Revit
import clr
clr.AddReference("RevitServices")
from RevitServices.Persistence import DocumentManager

clr.AddReference("RevitAPI")
clr.AddReference("RevitAPIUI")
from Autodesk.Revit.UI import TaskDialog

# Pegar a entrada do Dynamo
mensagem = IN[0]

# Criar a TaskDialog
task_dialog = TaskDialog("Ok")
task_dialog.MainInstruction = mensagem

# Exibir a TaskDialog
task_dialog.Show()

# Saída do script
OUT = "Sucesso!"
# ----------------------------------------
isNull = Object.IsNull(object=byLevel@L2)

setViewTemplate = archilab.Revit.Views.Views.SetViewTemplate(view=byLevel, viewTemplate=getItemAtIndex_6)
flatten_3 = List.Flatten(list=setViewTemplate)
code_block_19 = CodeBlock { 0; }
getItemAtIndex_7 = List.GetItemAtIndex(list=flatten_3, index=code_block_19)
viewopen = Custom[© ViewOpen](view=getItemAtIndex_7)  # package Crumple; Opens a Revit view (can also be a sheet).
