# Dynamo graph 2021_01-0_BIMACON_Criar Níveis do LINK_R04_script.dyn "ok 2021_01-0_BIMACON_Criar Níveis do LINK_R04_script" (Dynamo 2.19.3.6394)
# packages: Clockwork for Dynamo 2.x 2.4.0, Data-Shapes 2022.2.105, Genius Loci 2023.2.21, Orchid 2.6.10.6373, archi-lab.net 2023.213.1722, Crumple 2021.9.24

projectbasepoint = Custom[© ProjectBasePoint]()  # package Crumple; This node will return the Revit project base point as well as the NS, EW and elevation values.
convert_by_units = DynamoUnitConvert(projectbasepoint.Elevation, MeasurementType="autodesk.unit.quantity:length-1.0.4", FromConversion="autodesk.unit.unit:millimeters-1.0.1", ToConversion="autodesk.unit.unit:meters-1.0.0")

# group: Mensagem
categories = Categories("OST_RvtLinks")
boolean = BoolSelector(true)
code_block = CodeBlock { ["Selecione o link a ser copiado os Níveis e Clique em Concluir"]; }
code_block_2 = CodeBlock { ["Nenhum link foi selecionado"]; }
if_ = If(test=boolean, true=code_block, false=code_block_2)
o_string_fromlist = Orchid.Common.String.FromList(list=if_)
window_prompt_with_text = Python(IN[0]=o_string_fromlist)  # IronPython2
# ---------- window_prompt_with_text.python (26 lines) ----------
# Importando as bibliotecas necessárias da API do Revit
import clr
clr.AddReference('RevitServices')  # Referência aos serviços do Revit
from RevitServices.Persistence import DocumentManager

clr.AddReference('RevitAPI')  # Referência à API do Revit
clr.AddReference('RevitAPIUI')  # Referência à API de Interface de Usuário do Revit

from Autodesk.Revit.UI import TaskDialog, TaskDialogCommonButtons, TaskDialogResult

# Recebe o texto de instrução como entrada do nó
instrucoes = IN[0]

# Criando o TaskDialog
dialog = TaskDialog("Aviso")
dialog.MainInstruction = instrucoes
dialog.CommonButtons = TaskDialogCommonButtons.Ok

# Exibindo o dialog para o usuário e capturando a resposta
resultado = dialog.Show()

# Interpretando a resposta
if resultado == TaskDialogCommonButtons.Ok:
    OUT = "Ok"
else:
    OUT = "True"
# ----------------------------------------
select_model_elements_of = Custom[Select Model Elements of Category](Categories=categories, Toggle=window_prompt_with_text)  # package Data-Shapes; Allows to perform a manual selection with a category filter.

code_block_3 = CodeBlock { 0; 1; }
getItemAtIndex = List.GetItemAtIndex(list=select_model_elements_of, index=code_block_3.out0)
python_script = Python(IN[0]=getItemAtIndex)  # IronPython2
# ---------- python_script.python (61 lines) ----------
import clr
# Importar bibliotecas necessárias do Revit e Dynamo
clr.AddReference('RevitServices')
clr.AddReference('RevitAPI')
clr.AddReference('RevitAPIUI')
clr.AddReference('RevitNodes')

from RevitServices.Persistence import DocumentManager
from Autodesk.Revit.DB import *
from RevitServices.Transactions import TransactionManager

# Obter o documento ativo do Dynamo
doc = DocumentManager.Instance.CurrentDBDocument

# Entrada 0: Elemento do vínculo selecionado pelo usuário
vinculo_selecionado = UnwrapElement(IN[0])  # Desempacotar o elemento Revit

# Verificar se o vínculo selecionado é válido
if vinculo_selecionado and isinstance(vinculo_selecionado, RevitLinkInstance):
    try:
        # Obter o documento vinculado (arquivo RVT vinculado)
        link_doc = vinculo_selecionado.GetLinkDocument()

        # Verificar se o documento vinculado existe
        if link_doc is None:
            OUT = "Erro: Documento vinculado não encontrado."
        else:
            # Coletar os níveis do vínculo
            niveis_vinculados = FilteredElementCollector(link_doc).OfCategory(BuiltInCategory.OST_Levels).WhereElementIsNotElementType().ToElements()

            # Criar uma lista para armazenar os níveis (nome e elevação)
            niveis_elevacoes = []

            for nivel in niveis_vinculados:
                # Obter o nome do nível
                nome_nivel = nivel.Name

                # Acessar o parâmetro "Elevação" do nível
                elevacao_param = nivel.get_Parameter(BuiltInParameter.LEVEL_ELEV).AsDouble()

                # Converter a elevação de pés para metros (unidade padrão do Revit é pés)
                elevacao_metros = UnitUtils.ConvertFromInternalUnits(elevacao_param, UnitTypeId.Meters)

                # Adicionar o nível como uma tupla (nome, elevação)
                niveis_elevacoes.append((nome_nivel, elevacao_metros))

            # Ordenar a lista de níveis por elevação (menor para maior)
            niveis_ordenados = sorted(niveis_elevacoes, key=lambda x: x[1])

            # Separar os nomes e elevações em listas distintas
            nomes_ordenados = [item[0] for item in niveis_ordenados]
            elevacoes_ordenadas = [item[1] for item in niveis_ordenados]

            # Saída: Duas listas ordenadas (nomes e elevações)
            OUT = (nomes_ordenados, elevacoes_ordenadas)
    except Exception as e:
        # Tratamento de exceção caso ocorra algum erro
        OUT = "Erro: " + str(e)
else:
    # Caso o vínculo selecionado seja inválido
    OUT = "Erro: Por favor, selecione um vínculo válido na entrada 0."
# ----------------------------------------
getItemAtIndex_2 = List.GetItemAtIndex(list=python_script, index=code_block_3.out1)
add = convert_by_units + getItemAtIndex_2
getItemAtIndex_3 = List.GetItemAtIndex(list=python_script, index=code_block_3.out0)
passThrough = Custom[PassThrough](passThrough=getItemAtIndex_3, waitFor=getItemAtIndex_2)  # package archi-lab.net; Ripped this off from Clockwork. Sorry Andy.

# group: SELECIONE O MODELO ARQ LINKADO
code_block_4 = CodeBlock()  # //archilab
code_block_5 = CodeBlock()  # //Data-Shapes
get_alldocuments = Custom[Get AllDocuments]()  # package Genius Loci; Get documents (linked and opened in background). The first document is the active document.
code_block_6 = CodeBlock { "Selecione os Níveis a serem Copiados e o Sufixo"; }
file_path = Filename("..\..\..\..\..\05 - BIMACON\01 - EMPRESA BIMACON\00 - Logos e imagens - BIMACON\ARTE BIMACON\reddonda-removebg-preview.png")
file_from_path = FileObject(path=file_path)
readFromFile = Image.ReadFromFile(file=file_from_path)
string = StringInput("Confirmar")
code_block_7 = CodeBlock { "Escolha os Níveis"; }
boolean_2 = BoolSelector(false)
listview_data = Custom[Listview Data](InputName=code_block_7, Keys=passThrough, Values=passThrough, SortItems_optionnal=boolean_2)  # package Data-Shapes; Create data for ListView input in UI.MultiInputForm ++ . Check out www.data-shapes.net for more infos.
code_block_8 = CodeBlock { "Sufixo"; }
string_2 = StringInput(" - ELE")
textbox_data = Custom[TextBox Data](InputName=code_block_8, DefaultText=string_2)  # package Data-Shapes; Create Data for TextBox input in UI.MultipleInputForm ++ . Check out www.data-shapes.net for more informations
list_create = List.Create(item0=listview_data, item1=textbox_data)
boolean_3 = BoolSelector(true)
string_3 = StringInput("Cancelar")
multipleinputform = Custom[MultipleInputForm ++](Description_optional=code_block_6, Logo_optional=readFromFile, ButtonText_optional=string, Inputs=list_create, Toggle=boolean_3, CancelButtonText_optional=string_3)  # package Data-Shapes; Create a form with multiple inputs. see www.data-shapes.net for tutorials and infos!

# group: saidas
# Descrição <Clique duas vezes aqui para editar a descrição do grupo>
code_block_9 = CodeBlock { 0; }
getItemAtIndex_4 = List.GetItemAtIndex(list=multipleinputform.User_Inputs, index=code_block_9)
code_block_10 = CodeBlock { 1; }
getItemAtIndex_5 = List.GetItemAtIndex(list=multipleinputform.User_Inputs, index=code_block_10)

python_script_2 = Python()  # IronPython2; unwired: IN[0]
# ---------- python_script_2.python (65 lines) ----------
# Importando as bibliotecas do Revit e Windows Forms
import clr
clr.AddReference("RevitServices")
from RevitServices.Persistence import DocumentManager
from RevitServices.Transactions import TransactionManager

clr.AddReference("RevitAPI")
from Autodesk.Revit.DB import *

# Adicionando referência para System.Windows.Forms
clr.AddReference("System.Windows.Forms")
from System.Windows.Forms import MessageBox, MessageBoxButtons

# Obtendo o documento atual do Revit
doc = DocumentManager.Instance.CurrentDBDocument

# Função para obter a unidade de comprimento
def get_length_unit_format(doc):
    # Obtendo as unidades do documento
    units = doc.GetUnits()

    # Acessando as opções de formato para o comprimento
    format_options = units.GetFormatOptions(SpecTypeId.Length)

    # Obtendo o ID da unidade de comprimento atual
    unit_type_id = format_options.GetUnitTypeId()

    # Retornando a unidade de comprimento atual
    return unit_type_id

# Função para definir a unidade de comprimento para centímetros
def set_length_unit_to_meters(doc):
    # Iniciando uma transação para modificar as unidades
    TransactionManager.Instance.EnsureInTransaction(doc)

    # Obtendo as unidades atuais
    units = doc.GetUnits()

    # Criando novas opções de formato para definir como centímetros
    format_options = FormatOptions(UnitTypeId.Meters)

    # Definindo as opções para o comprimento (Length)
    units.SetFormatOptions(SpecTypeId.Length, format_options)

    # Aplicando as mudanças ao documento
    doc.SetUnits(units)

    # Finalizando a transação
    TransactionManager.Instance.TransactionTaskDone()

# Obtendo a unidade de comprimento atual
length_unit = get_length_unit_format(doc)

# Verificando se a unidade não é centímetros e mudando se necessário
if length_unit != UnitTypeId.Meters:
    set_length_unit_to_meters(doc)
    result = "Unidade de comprimento alterada para Metros"
else:
    result = "A unidade de comprimento já está em Metros"

# Exibir uma janela pop-up para o usuário confirmar a mensagem
MessageBox.Show(result, "Confirmação", MessageBoxButtons.OK)

# Retornar 1 para o Dynamo após o usuário clicar em OK
OUT = 1
# ----------------------------------------
passthrough = Custom[Passthrough](passThrough=getItemAtIndex_4, waitFor=python_script_2)  # package Clockwork for Dynamo 2.x; Forces a sequential order of execution. The node wired into the output of the Passthrough node will be executed *after* the node wired into the waitFor input (e.g. important for some Revit operations). The value of the passThrough input will be passed on to the node wired into the output port of the Passthrough node.
eq = passthrough == passThrough  # lacing=CrossProduct
filterByBoolMask = List.FilterByBoolMask(list=add, mask=eq@L2)
filterByBoolMask_2 = List.FilterByBoolMask(list=getItemAtIndex_3, mask=eq@L2)
add_2 = filterByBoolMask_2.in + getItemAtIndex_5
byElevationAndName = Level.ByElevationAndName(elevation=filterByBoolMask.in, name=add_2)
byLevel = FloorPlanView.ByLevel(level=byElevationAndName)

# group: Mensagem Final
boolean_4 = BoolSelector(true)
isEmpty = List.IsEmpty(list=byLevel@L2)
count = List.Count(list=byLevel)
code_block_11 = CodeBlock(a=boolean_4, b=isEmpty, c=count) { a==b?0:c; }
firstItem = List.FirstItem(list=code_block_11)
code_block_12 = CodeBlock { 0; }
gt = firstItem > code_block_12
code_block_13 = CodeBlock(N=firstItem) { ["Feito! Você copiou "+N+" Níveis"]; }
code_block_14 = CodeBlock { ["Nenhum Nível foi copiado"]; }
code_block_15 = CodeBlock(a=gt, b=code_block_13, c=code_block_14) { a==true?b:c; }
o_string_fromlist_2 = Orchid.Common.String.FromList(list=code_block_15)
python_script_3 = Python(IN[0]=o_string_fromlist_2)  # IronPython2
# ---------- python_script_3.python (21 lines) ----------
# Importar as bibliotecas necessárias do Revit
import clr
clr.AddReference("RevitServices")
from RevitServices.Persistence import DocumentManager

clr.AddReference("RevitAPI")
clr.AddReference("RevitAPIUI")
from Autodesk.Revit.UI import TaskDialog

# Pegar a entrada do Dynamo
mensagem = IN[0]

# Criar a TaskDialog
task_dialog = TaskDialog("Ok")
task_dialog.MainInstruction = mensagem

# Exibir a TaskDialog
task_dialog.Show()

# Saída do script
OUT = "Sucesso!"
# ----------------------------------------
