# Dynamo graph 01-2_BIMACON_Preencher tabela de Potências_R05_script.dyn (Dynamo 2.19.3.6394)
# author: Jose Nelson
# packages: DynaMEP 2.0.1, bimorphNodes 4.2.4, Clockwork for Dynamo 2.x 2.4.0, archi-lab.net 2023.213.1722

# group: Dados Tabela
categories = Categories("OST_Schedules")
all_elements_of_category = ElementsOfCategory(Category=categories)
name = Element.Name(element=all_elements_of_category)
string = StringInput("Potência")
contains = String.Contains(string=name, searchFor=string)
filterByBoolMask = List.FilterByBoolMask(list=all_elements_of_category, mask=contains)
number = DoubleInput(4)
getDataColumns = Revit.Schedule.GetDataColumns(scheduleView=filterByBoolMask.in, columnIndexes=number)
flatten = List.Flatten(list=getDataColumns)
restOfItems = List.RestOfItems(list=flatten)

# group: Espaços em Ordem de Nível
categories_2 = Categories("OST_MEPSpaces")
all_elements_of_category_2 = ElementsOfCategory(Category=categories_2)
number_2 = DoubleInput(1)
getDataColumns_2 = Revit.Schedule.GetDataColumns(scheduleView=filterByBoolMask.in, columnIndexes=number_2)
flatten_2 = List.Flatten(list=getDataColumns_2)
restOfItems_2 = List.RestOfItems(list=flatten_2)
name_2 = Space.Name(space=all_elements_of_category_2)
eq = restOfItems_2 == name_2  # lacing=CrossProduct
filterByBoolMask_2 = List.FilterByBoolMask(list=all_elements_of_category_2, mask=eq@L2)
flatten_3 = List.Flatten(list=filterByBoolMask_2.in)
uniqueItems = List.UniqueItems(list=flatten_3)
string_2 = StringInput("Nível")
getParameterValueByName = Element.GetParameterValueByName(parameterName=string_2)  # unwired: element
groupByFunction = List.GroupByFunction(list=uniqueItems, groupFunction=getParameterValueByName)
string_3 = StringInput("Nome")
getParameterValueByName_2 = Element.GetParameterValueByName(parameterName=string_3)  # unwired: element
sortByFunction = List.SortByFunction(list=groupByFunction@L2, sortFunction=getParameterValueByName_2)
flatten_4 = List.Flatten(list=sortByFunction)

# group: Distância máxima para tomadas em função do tipo de ambiente
nome_do_parâmetro = StringInput("Distância Máxima entre Tomadas")
name_3 = Space.Name(space=flatten_4)
string_4 = StringInput("5")
replace = String.Replace(string=name_3, searchFor=name_3, replaceWith=string_4)
code_block = CodeBlock { "Cozinha"; "Coz"; "Copa"; "Lavabo"; "Lavanderia"; "Area de Serviço"; "A.S"; "AS"; "A.S."; }
list_create = List.Create(item0=code_block.out0, item1=code_block.out1, item2=code_block.out2, item3=code_block.out3, item4=code_block.out4, item5=code_block.out5, item6=code_block.out6, item7=code_block.out7, item8=code_block.out8)
boolean = BoolSelector(true)
contains_2 = String.Contains(string=list_create, searchFor=name_3, ignoreCase=boolean, lacing=CrossProduct)
filterByBoolMask_3 = List.FilterByBoolMask(list=flatten_4, mask=contains_2@L2)
flatten_5 = List.Flatten(list=filterByBoolMask_3.in)
indexOf = List.IndexOf(list=flatten_4, element=flatten_5)
string_5 = StringInput("3,5")
replaceItemAtIndex = Custom[List.ReplaceItemAtIndex+](seq=replace, indices=indexOf, replacement=string_5)  # package Clockwork for Dynamo 2.x; Replaces the item at a given index of a list by another item. Unlike the OOTB node, it can replace items at multiple indeces.
setParameterValueByName = RevitModel.Element.SetParameterValueByName(element=flatten_4, parameterName=nome_do_parâmetro, values=replaceItemAtIndex)
name_4 = Space.Name(space=flatten_5)

end = Revit.Transaction.Transaction.End(input=setParameterValueByName)

# group: Dados Tabela
categories_3 = Categories("OST_Schedules")
all_elements_of_category_3 = ElementsOfCategory(Category=categories_3)
name_5 = Element.Name(element=all_elements_of_category_3)
string_6 = StringInput("Potências")
contains_3 = String.Contains(string=name_5, searchFor=string_6)
filterByBoolMask_4 = List.FilterByBoolMask(list=all_elements_of_category_3, mask=contains_3)

passThrough = Custom[PassThrough](passThrough=filterByBoolMask_4.in, waitFor=setParameterValueByName)  # package archi-lab.net; Ripped this off from Clockwork. Sorry Andy.
end_2 = Revit.Transaction.Transaction.End(input=passThrough)

# group: Quantidade minima de tomadas
nome_do_parâmetro_2 = StringInput("Quantidade Mínima de Tomadas")
number_3 = DoubleInput(7)
getDataColumns_3 = Revit.Schedule.GetDataColumns(scheduleView=end_2, columnIndexes=number_3)
flatten_6 = List.Flatten(list=getDataColumns_3)
restOfItems_3 = List.RestOfItems(list=flatten_6)
setParameterValueByName_2 = RevitModel.Element.SetParameterValueByName(element=end, parameterName=nome_do_parâmetro_2, values=restOfItems_3)

nome_do_parâmetro_3 = StringInput("Pot. de Iluminação (Spaces)")
toNumber = Python(IN[0]=restOfItems)  # "String.ToNumber"; IronPython2
# ---------- toNumber.python (24 lines) ----------
# Carregar as bibliotecas DesignScript e padrão do Python
import sys
import clr
clr.AddReference('ProtoGeometry')
from Autodesk.DesignScript.Geometry import *

# Entrada do nó
strings = IN[0]

# Função para converter string em número
def string_to_number(s):
    try:
        return float(s) if '.' in s else int(s)
    except ValueError:
        return None

# Convertendo as strings recebidas em números
if isinstance(strings, list):
    resultado = [string_to_number(s) for s in strings]
else:
    resultado = string_to_number(strings)

# Saída do nó
OUT = resultado
# ----------------------------------------
unit_conversion = CodeBlock(n=toNumber) { n<1>/[0.0929031299064465481842083259785]; }
setParameterValueByName_3 = RevitModel.Element.SetParameterValueByName(element=flatten_4, parameterName=nome_do_parâmetro_3, values=unit_conversion)
end_3 = Revit.Transaction.Transaction.End(input=setParameterValueByName_3)
passThrough_2 = Custom[PassThrough](passThrough=setParameterValueByName_2, waitFor=end_3)
end_4 = Revit.Transaction.Transaction.End(input=passThrough_2)
start = Revit.Transaction.Transaction.Start(input=end_4)

# group: Mensagem final
count = List.Count(list=start)
code_block_2 = CodeBlock { 0; }
gt = count > code_block_2
code_block_3 = CodeBlock(N=count) { ["Feito! Você atribuiu potência à "+N+" ambientes"]; }
code_block_4 = CodeBlock { ["Nenhuma Potência foi atribuída"]; }
if_ = If(test=gt, true=code_block_3, false=code_block_4)
flatten_7 = List.Flatten(list=if_)
fromList = Python(IN[0]=flatten_7)  # "String.FromList"; IronPython2
# ---------- fromList.python (22 lines) ----------
# Carregar as bibliotecas DesignScript e padrão do Python
import sys
import clr
clr.AddReference('ProtoGeometry')
from Autodesk.DesignScript.Geometry import *

# Função para concatenar os valores de uma lista em uma única string com múltiplas linhas
def concatenate_list_to_string(input_list, delimiter="\n"):
    # Verifica se a entrada é uma lista
    if not isinstance(input_list, list):
        return "A entrada deve ser uma lista."
    
    # Converte todos os elementos para string e junta com o delimitador especificado
    result = delimiter.join(str(item) for item in input_list)
    return result

# Entrada pelo nó do Dynamo
lista = IN[0]  # Lista de valores a serem concatenados
delimitador = IN[1] if len(IN) > 1 else "\n"  # Delimitador opcional, padrão é nova linha

# Saída para o Dynamo
OUT = concatenate_list_to_string(lista, delimitador)
# ----------------------------------------
end_5 = Revit.Transaction.Transaction.End(input=fromList)
python_script = Python(IN[0]=end_5)  # IronPython2
# ---------- python_script.python (21 lines) ----------
# Importar as bibliotecas necessárias do Revit
import clr
clr.AddReference("RevitServices")
from RevitServices.Persistence import DocumentManager

clr.AddReference("RevitAPI")
clr.AddReference("RevitAPIUI")
from Autodesk.Revit.UI import TaskDialog

# Pegar a entrada do Dynamo
mensagem = IN[0]

# Criar a TaskDialog
task_dialog = TaskDialog("Ok")
task_dialog.MainInstruction = mensagem

# Exibir a TaskDialog
task_dialog.Show()

# Saída do script
OUT = "Sucesso!"
# ----------------------------------------
