# Dynamo graph 2021_01-2_BIMACON_Preencher tabela de Potências_R01_script.dyn "2021_01-2_BIMACON_Preencher tabela de Potências_R01" (Dynamo 2.19.3.6394)
# packages: DynaMEP 2.0.1, Orchid 2.6.8.6198, bimorphNodes 4.2.4, Orchid 2.19.3.6373, Clockwork for Dynamo 2.x 2.4.0

# group: Dados Tabela
# Descrição <Clique duas vezes aqui para editar a descrição do grupo>
categories = Categories("OST_Schedules")
all_elements_of_category = ElementsOfCategory(Category=categories)
name = Element.Name(element=all_elements_of_category)
string = StringInput("Espaços")
contains = String.Contains(string=name, searchFor=string)
filterByBoolMask = List.FilterByBoolMask(list=all_elements_of_category, mask=contains)
number = DoubleInput(4)
getDataColumns = Revit.Schedule.GetDataColumns(scheduleView=filterByBoolMask.in, columnIndexes=number)
flatten = List.Flatten(list=getDataColumns)
restOfItems = List.RestOfItems(list=flatten)

# group: Espaços em Ordem de Nível
# Descrição <Clique duas vezes aqui para editar a descrição do grupo>
categories_2 = Categories("OST_MEPSpaces")
all_elements_of_category_2 = ElementsOfCategory(Category=categories_2)
number_2 = DoubleInput(1)
getDataColumns_2 = Revit.Schedule.GetDataColumns(scheduleView=filterByBoolMask.in, columnIndexes=number_2)
flatten_2 = List.Flatten(list=getDataColumns_2)
restOfItems_2 = List.RestOfItems(list=flatten_2)
name_2 = Space.Name(space=all_elements_of_category_2)
eq = restOfItems_2 == name_2  # lacing=CrossProduct
filterByBoolMask_2 = List.FilterByBoolMask(list=all_elements_of_category_2, mask=eq@L2)
flatten_3 = List.Flatten(list=filterByBoolMask_2.in)
uniqueItems = List.UniqueItems(list=flatten_3)
string_2 = StringInput("Nível")
getParameterValueByName = Element.GetParameterValueByName(parameterName=string_2)  # unwired: element
groupByFunction = List.GroupByFunction(list=uniqueItems, groupFunction=getParameterValueByName)
string_3 = StringInput("Nome")
getParameterValueByName_2 = Element.GetParameterValueByName(parameterName=string_3)  # unwired: element
sortByFunction = List.SortByFunction(list=groupByFunction@L2, sortFunction=getParameterValueByName_2)
flatten_4 = List.Flatten(list=sortByFunction)

# group: Quantidade minima de tomadas
# Descrição <Clique duas vezes aqui para editar a descrição do grupo>
nome_do_parâmetro = StringInput("Quantidade Mínima de Tomadas")
number_3 = DoubleInput(7)
getDataColumns_3 = Revit.Schedule.GetDataColumns(scheduleView=filterByBoolMask.in, columnIndexes=number_3)
flatten_5 = List.Flatten(list=getDataColumns_3)
restOfItems_3 = List.RestOfItems(list=flatten_5)
setParameterValueByName = RevitModel.Element.SetParameterValueByName(element=flatten_4, parameterName=nome_do_parâmetro, values=restOfItems_3)

# group: Mensagem final
count = List.Count(list=setParameterValueByName)
code_block = CodeBlock { 0; }
gt = count > code_block
code_block_2 = CodeBlock(N=count) { ["Feito! Você atribuiu potência à "+N+" ambientes"]; }
code_block_3 = CodeBlock { ["Nenhuma Potência foi atribuída"]; }
if_ = If(test=gt, true=code_block_2, false=code_block_3)
flatten_6 = List.Flatten(list=if_)
o_string_fromlist = Orchid.Common.String.FromList(list=flatten_6)
python_script = Python(IN[0]=o_string_fromlist)  # IronPython2
# ---------- python_script.python (21 lines) ----------
# Importar as bibliotecas necessárias do Revit
import clr
clr.AddReference("RevitServices")
from RevitServices.Persistence import DocumentManager

clr.AddReference("RevitAPI")
clr.AddReference("RevitAPIUI")
from Autodesk.Revit.UI import TaskDialog

# Pegar a entrada do Dynamo
mensagem = IN[0]

# Criar a TaskDialog
task_dialog = TaskDialog("Ok")
task_dialog.MainInstruction = mensagem

# Exibir a TaskDialog
task_dialog.Show()

# Saída do script
OUT = "Sucesso!"
# ----------------------------------------

nome_do_parâmetro_2 = StringInput("Pot. de Iluminação (Spaces)")
toNumber = Orchid.Common.String.ToNumber(string=restOfItems)
unit_conversion = CodeBlock(n=toNumber) { n<1>/[0.0929031299064465481842083259785]; }
setParameterValueByName_2 = RevitModel.Element.SetParameterValueByName(element=flatten_4, parameterName=nome_do_parâmetro_2, values=unit_conversion)

# group: Distância máxima para tomadas em função do tipo de ambiente
# Distância máxima para tomadas em função do tipo de ambiente
passthrough = Custom[Passthrough](passThrough=flatten_4, waitFor=setParameterValueByName_2)  # package Clockwork for Dynamo 2.x; Forces a sequential order of execution. The node wired into the output of the Passthrough node will be executed *after* the node wired into the waitFor input (e.g. important for some Revit operations). The value of the passThrough input will be passed on to the node wired into the output port of the Passthrough node.
code_block_4 = CodeBlock { "Cozinha"; "Copa"; "Lavabo"; "Lavanderia"; "Area de Serviço"; "A.S"; "AS"; }
list_create = List.Create(item0=code_block_4.out0, item1=code_block_4.out1, item2=code_block_4.out2, item3=code_block_4.out3, item4=code_block_4.out4, item5=code_block_4.out5, item6=code_block_4.out6)
name_3 = Space.Name(space=passthrough)
boolean = BoolSelector(true)
contains_2 = String.Contains(string=list_create, searchFor=name_3, ignoreCase=boolean, lacing=CrossProduct)
filterByBoolMask_3 = List.FilterByBoolMask(list=passthrough, mask=contains_2@L2)
flatten_7 = List.Flatten(list=filterByBoolMask_3.in)
watch = Watch(flatten_7)
name_4 = Space.Name(space=watch)
nome_do_parâmetro_3 = StringInput("Distância Máxima entre Tomadas")
string_4 = StringInput("5")
replace = String.Replace(string=name_3, searchFor=name_3, replaceWith=string_4)
indexOf = List.IndexOf(list=passthrough, element=watch)
string_5 = StringInput("3,5")
replaceItemAtIndex = Custom[List.ReplaceItemAtIndex+](seq=replace, indices=indexOf, replacement=string_5)  # package Clockwork for Dynamo 2.x; Replaces the item at a given index of a list by another item. Unlike the OOTB node, it can replace items at multiple indeces.
setParameterValueByName_3 = RevitModel.Element.SetParameterValueByName(element=passthrough, parameterName=nome_do_parâmetro_3, values=replaceItemAtIndex)
