# Dynamo graph 2021_01-2_BIMACON_Preencher tabela de Potências_R02_script.dyn "2021_01-2_BIMACON_Preencher tabela de Potências_R01" (Dynamo 2.19.3.6394)
# packages: DynaMEP 2.0.1, Orchid 2.6.8.6198, bimorphNodes 4.2.4, Orchid 2.19.3.6373, Clockwork for Dynamo 2.x 2.4.0, archi-lab.net 2023.213.1722

# group: Dados Tabela
# Descrição <Clique duas vezes aqui para editar a descrição do grupo>
categories = Categories("OST_Schedules")
all_elements_of_category = ElementsOfCategory(Category=categories)
name = Element.Name(element=all_elements_of_category)
string = StringInput("Potência")
contains = String.Contains(string=name, searchFor=string)
filterByBoolMask = List.FilterByBoolMask(list=all_elements_of_category, mask=contains)
number = DoubleInput(4)
getDataColumns = Revit.Schedule.GetDataColumns(scheduleView=filterByBoolMask.in, columnIndexes=number)
flatten = List.Flatten(list=getDataColumns)
restOfItems = List.RestOfItems(list=flatten)

# group: Espaços em Ordem de Nível
# Descrição <Clique duas vezes aqui para editar a descrição do grupo>
categories_2 = Categories("OST_MEPSpaces")
all_elements_of_category_2 = ElementsOfCategory(Category=categories_2)
number_2 = DoubleInput(1)
getDataColumns_2 = Revit.Schedule.GetDataColumns(scheduleView=filterByBoolMask.in, columnIndexes=number_2)
flatten_2 = List.Flatten(list=getDataColumns_2)
restOfItems_2 = List.RestOfItems(list=flatten_2)
name_2 = Space.Name(space=all_elements_of_category_2)
eq = restOfItems_2 == name_2  # lacing=CrossProduct
filterByBoolMask_2 = List.FilterByBoolMask(list=all_elements_of_category_2, mask=eq@L2)
flatten_3 = List.Flatten(list=filterByBoolMask_2.in)
uniqueItems = List.UniqueItems(list=flatten_3)
string_2 = StringInput("Nível")
getParameterValueByName = Element.GetParameterValueByName(parameterName=string_2)  # unwired: element
groupByFunction = List.GroupByFunction(list=uniqueItems, groupFunction=getParameterValueByName)
string_3 = StringInput("Nome")
getParameterValueByName_2 = Element.GetParameterValueByName(parameterName=string_3)  # unwired: element
sortByFunction = List.SortByFunction(list=groupByFunction@L2, sortFunction=getParameterValueByName_2)
flatten_4 = List.Flatten(list=sortByFunction)

nome_do_parâmetro = StringInput("Pot. de Iluminação (Spaces)")
toNumber = Orchid.Common.String.ToNumber(string=restOfItems)
unit_conversion = CodeBlock(n=toNumber) { n<1>/[0.0929031299064465481842083259785]; }
setParameterValueByName = RevitModel.Element.SetParameterValueByName(element=flatten_4, parameterName=nome_do_parâmetro, values=unit_conversion)

# group: Distância máxima para tomadas em função do tipo de ambiente
# Distância máxima para tomadas em função do tipo de ambiente
nome_do_parâmetro_2 = StringInput("Distância Máxima entre Tomadas")
name_3 = Space.Name(space=flatten_4)
string_4 = StringInput("5")
replace = String.Replace(string=name_3, searchFor=name_3, replaceWith=string_4)
code_block = CodeBlock { "Cozinha"; "Copa"; "Lavabo"; "Lavanderia"; "Area de Serviço"; "A.S"; "AS"; }
list_create = List.Create(item0=code_block.out0, item1=code_block.out1, item2=code_block.out2, item3=code_block.out3, item4=code_block.out4, item5=code_block.out5, item6=code_block.out6)
boolean = BoolSelector(true)
contains_2 = String.Contains(string=list_create, searchFor=name_3, ignoreCase=boolean, lacing=CrossProduct)
filterByBoolMask_3 = List.FilterByBoolMask(list=flatten_4, mask=contains_2@L2)
flatten_5 = List.Flatten(list=filterByBoolMask_3.in)
watch = Watch(flatten_5)
indexOf = List.IndexOf(list=flatten_4, element=watch)
string_5 = StringInput("3,5")
replaceItemAtIndex = Custom[List.ReplaceItemAtIndex+](seq=replace, indices=indexOf, replacement=string_5)  # package Clockwork for Dynamo 2.x; Replaces the item at a given index of a list by another item. Unlike the OOTB node, it can replace items at multiple indeces.
setParameterValueByName_2 = RevitModel.Element.SetParameterValueByName(element=flatten_4, parameterName=nome_do_parâmetro_2, values=replaceItemAtIndex)
name_4 = Space.Name(space=watch)

end = Revit.Transaction.Transaction.End(input=setParameterValueByName_2)

# group: Dados Tabela
# Descrição <Clique duas vezes aqui para editar a descrição do grupo>
categories_3 = Categories("OST_Schedules")
all_elements_of_category_3 = ElementsOfCategory(Category=categories_3)
name_5 = Element.Name(element=all_elements_of_category_3)
string_6 = StringInput("Potências")
contains_3 = String.Contains(string=name_5, searchFor=string_6)
filterByBoolMask_4 = List.FilterByBoolMask(list=all_elements_of_category_3, mask=contains_3)

passThrough = Custom[PassThrough](passThrough=filterByBoolMask_4.in, waitFor=setParameterValueByName_2)  # package archi-lab.net; Ripped this off from Clockwork. Sorry Andy.
end_2 = Revit.Transaction.Transaction.End(input=passThrough)

# group: Quantidade minima de tomadas
# Descrição <Clique duas vezes aqui para editar a descrição do grupo>
nome_do_parâmetro_3 = StringInput("Quantidade Mínima de Tomadas")
number_3 = DoubleInput(7)
getDataColumns_3 = Revit.Schedule.GetDataColumns(scheduleView=end_2, columnIndexes=number_3)
flatten_6 = List.Flatten(list=getDataColumns_3)
restOfItems_3 = List.RestOfItems(list=flatten_6)
setParameterValueByName_3 = RevitModel.Element.SetParameterValueByName(element=end, parameterName=nome_do_parâmetro_3, values=restOfItems_3)

# group: Mensagem final
count = List.Count(list=setParameterValueByName_3)
code_block_2 = CodeBlock { 0; }
gt = count > code_block_2
code_block_3 = CodeBlock(N=count) { ["Feito! Você atribuiu potência à "+N+" ambientes"]; }
code_block_4 = CodeBlock { ["Nenhuma Potência foi atribuída"]; }
if_ = If(test=gt, true=code_block_3, false=code_block_4)
flatten_7 = List.Flatten(list=if_)
o_string_fromlist = Orchid.Common.String.FromList(list=flatten_7)
python_script = Python(IN[0]=o_string_fromlist)  # IronPython2
# ---------- python_script.python (21 lines) ----------
# Importar as bibliotecas necessárias do Revit
import clr
clr.AddReference("RevitServices")
from RevitServices.Persistence import DocumentManager

clr.AddReference("RevitAPI")
clr.AddReference("RevitAPIUI")
from Autodesk.Revit.UI import TaskDialog

# Pegar a entrada do Dynamo
mensagem = IN[0]

# Criar a TaskDialog
task_dialog = TaskDialog("Ok")
task_dialog.MainInstruction = mensagem

# Exibir a TaskDialog
task_dialog.Show()

# Saída do script
OUT = "Sucesso!"
# ----------------------------------------
