# Dynamo graph 14-1_BIMACON_Deletar Eletrodutos Duplicados_R01_script.dyn "ok 2021_14-1_BIMACON_Deletar Eletrodutos Duplicados_R01_script" (Dynamo 2.19.3.6394)
# author: Jose Nelson
# Deleta eletroduos Duplicados (no mesmo local)
# packages: Clockwork for Dynamo 2.x 2.4.0, DynaMEP 2.0.1, BIMCoder Nodes - 2.X 2025.1.0, MEPover 2022.10.30

categories = Categories("OST_Conduit")
categories_2 = Categories("OST_CableTray")
list_create = List.Create(item0=categories, item1=categories_2)
all_elements_of_category = ElementsOfCategory(Category=list_create)
flatten = List.Flatten(list=all_elements_of_category)
location = Custom[Element.Location+](element=flatten)  # package Clockwork for Dynamo 2.x; Returns the location of an element as point, curve or curve loop, along with some booleans to help filtering the results. Unlike the OOTB Element.GetLocation node, it also retunrs sketch lines of sketch-based elements like floor slabs as well as the element's rotation property.
code_block = CodeBlock { 0; 1; }
getItemAtIndex = List.GetItemAtIndex(list=location.curveEndpoints@L2, index=code_block.out0)
getItemAtIndex_2 = List.GetItemAtIndex(list=location.curveEndpoints@L2, index=code_block.out1)
midpoint = Geometry.Points.Midpoint(startPoint=getItemAtIndex, endPoint=getItemAtIndex_2)
python_scripts = Python(IN[0]=midpoint)  # IronPython2
# ---------- python_scripts.python (41 lines) ----------
import clr
clr.AddReference('ProtoGeometry')
from Autodesk.DesignScript.Geometry import *

# Import DocumentManager and TransactionManager
clr.AddReference("RevitServices")
import RevitServices
from RevitServices.Persistence import DocumentManager
from RevitServices.Transactions import TransactionManager

# Import RevitAPI
clr.AddReference("RevitAPI")
import Autodesk
from Autodesk.Revit.DB import *

doc = DocumentManager.Instance.CurrentDBDocument
uiapp = DocumentManager.Instance.CurrentUIApplication
app = uiapp.Application

from System.Collections.Generic import *

# Import ToDSType(bool) extension method
clr.AddReference("RevitNodes")
import Revit
clr.ImportExtensions(Revit.Elements)

#The inputs to this node will be stored as a list in the IN variable.
dataEnteringNode = IN
mylist = IN[0]

i, seen, result = mylist, set(), []
for _index, item in enumerate(i):
    if item not in seen:
		# First time seeing the element
        seen.add(item)
    else:
		 # Already seen, add the index to the result
        result.append(_index)     

#Assign your output to the OUT variable
OUT = result
# ----------------------------------------
getItemAtIndex_3 = List.GetItemAtIndex(list=flatten, index=python_scripts)
directory_path = Directory("No file selected.")
code_block_2 = CodeBlock { "Del"; }
code_block_3 = CodeBlock { 0; }
python_scripts_2 = Python(IN[0]=midpoint)  # IronPython2
# ---------- python_scripts_2.python (59 lines) ----------
import clr

clr.AddReference('ProtoGeometry')
from Autodesk.DesignScript.Geometry import *

# Import DocumentManager and TransactionManager

clr.AddReference("RevitServices")
import RevitServices
from RevitServices.Persistence import DocumentManager
from RevitServices.Transactions import TransactionManager

# Import RevitAPI

clr.AddReference("RevitAPI")
import Autodesk
from Autodesk.Revit.DB import *


doc = DocumentManager.Instance.CurrentDBDocument

uiapp = DocumentManager.Instance.CurrentUIApplication

app = uiapp.Application

from System.Collections.Generic import *

# Import ToDSType(bool) extension method

clr.AddReference("RevitNodes")
import Revit

clr.ImportExtensions(Revit.Elements)

#The inputs to this node will be stored as a list in the IN variable.

dataEnteringNode = IN

mylist = IN[0]

# Cria um dicionário para armazenar os índices de cada elemento
element_indices = {}

# Itera sobre a lista e armazena os índices de cada elemento
for index, element in enumerate(mylist):
    if element not in element_indices:
        element_indices[element] = []
    element_indices[element].append(index)

# Cria uma lista para armazenar os índices dos elementos duplicados
duplicate_indices = []

# Itera sobre o dicionário e adiciona os índices dos elementos duplicados à lista
for element, indices in element_indices.items():
    if len(indices) > 1:
        duplicate_indices.extend(indices)

# Assign your output to the OUT variable
OUT = duplicate_indices
# ----------------------------------------
getItemAtIndex_4 = List.GetItemAtIndex(list=flatten, index=python_scripts_2)
connectors = Custom[👓 Connectors+](element=getItemAtIndex_4)  # package BIMCoder Nodes - 2.X; Obtém as propriedades mais relevantes dos conectores de elementos
isConnected = Custom[Connector.IsConnected](connector=connectors.Connectors)  # package MEPover; Returns a boolean indicating whether the connector is connected to a connector on different element
anyFalse = List.AnyFalse(list=isConnected@L2)
filterByBoolMask = List.FilterByBoolMask(list=getItemAtIndex_4, mask=anyFalse, lacing=Longest)
flatten_2 = List.Flatten(list=filterByBoolMask.in)
flatten_3 = List.Flatten(list=flatten_2)
id = Element.Id(element=flatten_2)
transpose = List.Transpose(lists=id)
list_create_2 = List.Create(item0=flatten_3, item1=transpose)
boolean = BoolSelector(true)
exportExcel = Data.ExportExcel(filePath=directory_path, sheetName=code_block_2, startRow=code_block_3, startColumn=code_block_3, data=list_create_2, overWrite=boolean)
delete = Element.Delete(element=flatten_2)

# group: Mensagem
count = List.Count(list=delete)
code_block_4 = CodeBlock { 0; }
gt = count > code_block_4
code_block_5 = CodeBlock(N=count) { ["Planilha gerada! Você deletou "+N+" elementos duplicados em seu projeto"]; }
code_block_6 = CodeBlock { ["Nenhum elemento foi deletado, verifique a Planilha gerada"]; }
if_ = If(test=gt, true=code_block_5, false=code_block_6)
string_fromlist_bimacon = Python(IN[0]=if_)  # IronPython2
# ---------- string_fromlist_bimacon.python (22 lines) ----------
# Carregar as bibliotecas DesignScript e padrão do Python
import sys
import clr
clr.AddReference('ProtoGeometry')
from Autodesk.DesignScript.Geometry import *

# Função para concatenar os valores de uma lista em uma única string com múltiplas linhas
def concatenate_list_to_string(input_list, delimiter="\n"):
    # Verifica se a entrada é uma lista
    if not isinstance(input_list, list):
        return "A entrada deve ser uma lista."
    
    # Converte todos os elementos para string e junta com o delimitador especificado
    result = delimiter.join(str(item) for item in input_list)
    return result

# Entrada pelo nó do Dynamo
lista = IN[0]  # Lista de valores a serem concatenados
delimitador = IN[1] if len(IN) > 1 else "\n"  # Delimitador opcional, padrão é nova linha

# Saída para o Dynamo
OUT = concatenate_list_to_string(lista, delimitador)
# ----------------------------------------
python_script = Python(IN[0]=string_fromlist_bimacon)  # IronPython2
# ---------- python_script.python (21 lines) ----------
# Importar as bibliotecas necessárias do Revit
import clr
clr.AddReference("RevitServices")
from RevitServices.Persistence import DocumentManager

clr.AddReference("RevitAPI")
clr.AddReference("RevitAPIUI")
from Autodesk.Revit.UI import TaskDialog

# Pegar a entrada do Dynamo
mensagem = IN[0]

# Criar a TaskDialog
task_dialog = TaskDialog("Ok")
task_dialog.MainInstruction = mensagem

# Exibir a TaskDialog
task_dialog.Show()

# Saída do script
OUT = "Sucesso!"
# ----------------------------------------

watch = Watch(filterByBoolMask.out)
