# Dynamo graph 18-3_BIMACON_Conduítes ParedexBandeja_R02_script.dyn "ok 2021_18-3_BIMACON_Conduítes ParedexBandeja_R02_script" (Dynamo 2.19.3.6394)
# author: Jose Nelson
# Cria eletrodutos entre pontos elétricos e bandejas/eletrocalhas
# packages: BIMCoder Nodes - 2.X 2025.1.0, MEPover 2024.7.11, BIMCoder Nodes - 2.X 2025.0.12, MEPover 2022.10.30, Genius Loci 2023.2.21, Data-Shapes 2025.3.118, Clockwork for Dynamo 2.x 2.4.0, Rhythm 2023.4.2021, archi-lab.net 2023.213.1722, DynaMEP 2.0.1, bimorphNodes 4.2.4

# group: ENTRADAS PARA O USUÁRIO
code_block = CodeBlock { "Eletrodutos Parede x Bandeja"; }
string = StringInput("LogoBimacon.png")
python_script = Python(IN[0]=string)  # IronPython2
# ---------- python_script.python (22 lines) ----------
import clr

# Adiciona referência ao ambiente .NET
clr.AddReference('System')
from System import Environment, IO

# Nome da imagem (entrada do usuário)
nome_arquivo_imagem = IN[0]

# Recupera o nome do usuário logado no Windows
usuario = Environment.UserName

# Monta o caminho completo para a pasta de imagens
caminho_base = r"C:\Users\{0}\AppData\Roaming\pyRevit\Extensions\Bimacon.extension\Bimacon.tab\Imagens_Bimacon".format(usuario)

# Junta o caminho base com o nome do arquivo
caminho_completo = IO.Path.Combine(caminho_base, nome_arquivo_imagem)

# Verifica se o arquivo existe
existe = IO.File.Exists(caminho_completo)

OUT = caminho_completo if existe else "Imagem não encontrada: {0}".format(caminho_completo)
# ----------------------------------------
file_from_path = FileObject(path=python_script)
readFromFile = Image.ReadFromFile(file=file_from_path)
string_2 = StringInput("Confirmar")
string_3 = StringInput("Tipo de Saída de Bandeja")
categories = Categories("OST_CableTrayFitting")
all_families_of_category = Custom[All Families Of Category](category=categories)  # package Clockwork for Dynamo 2.x; Gets all famiies of a given category in the model (does *not *work for system families)
boolean = BoolSelector(false)
clean = List.Clean(list=all_families_of_category, preserveIndices=boolean)
name = Family.Name(family=clean)
code_block_2 = CodeBlock { "_Saída"; }
contains = String.Contains(string=name, searchFor=code_block_2)
filterByBoolMask = List.FilterByBoolMask(list=clean, mask=contains)
name_2 = Family.Name(family=filterByBoolMask.in)
code_block_3 = CodeBlock { "em Perfilado"; }
contains_2 = String.Contains(string=name_2, searchFor=code_block_3)
filterByBoolMask_2 = List.FilterByBoolMask(list=filterByBoolMask.in, mask=contains_2)
types = Family.Types(family=filterByBoolMask_2.out)
flatten = List.Flatten(list=types)
uniqueItems = List.UniqueItems(list=flatten)
name_3 = FamilyType.Name(familyType=uniqueItems)
sortByKey = List.SortByKey(list=uniqueItems, keys=name_3)
boolean_2 = BoolSelector(false)
clean_2 = List.Clean(list=sortByKey.sortedKeys, preserveIndices=boolean_2)
clean_3 = List.Clean(list=sortByKey.sortedList, preserveIndices=boolean_2)
code_block_4 = CodeBlock { 3; }
boolean_3 = BoolSelector(false)
dropdown_data = Custom[DropDown Data](InputName=string_3, Keys=clean_2, Values=clean_3, DefaultValueIndex=code_block_4, Sorted_optional=boolean_3)  # package Data-Shapes; Create data for DropDown input in UI.MultiInputForm ++ . Check out www.data-shapes.net for more infos.
string_4 = StringInput("Selecione o Tipo de eletroduto")
element_classes = ElementTypes("ConduitType")
all_elements_of_class = ElementsOfType(element_class=element_classes)
name_4 = Family.Name(family=all_elements_of_class)
code_block_5 = CodeBlock { "Cabo"; }
contains_3 = String.Contains(string=name_4, searchFor=code_block_5)
filterByBoolMask_3 = List.FilterByBoolMask(list=all_elements_of_class, mask=contains_3)
flatten_2 = List.Flatten(list=filterByBoolMask_3.out)
uniqueItems_2 = List.UniqueItems(list=flatten_2)
name_5 = Element.Name(element=uniqueItems_2)
sortByKey_2 = List.SortByKey(list=uniqueItems_2, keys=name_5)
code_block_6 = CodeBlock { 9; }
boolean_4 = BoolSelector(false)
dropdown_data_2 = Custom[DropDown Data](InputName=string_4, Keys=sortByKey_2.sortedKeys, Values=sortByKey_2.sortedList, DefaultValueIndex=code_block_6, Sorted_optional=boolean_4)
string_5 = StringInput("Diâmetro eletroduto(mm)")
string_6 = StringInput("25")
boolean_5 = BoolSelector(true)
textbox_data = Custom[TextBox Data](InputName=string_5, DefaultText=string_6, IsNumberEntry=boolean_5)  # package Data-Shapes; Create Data for TextBox input in UI.MultipleInputForm ++ . Check out www.data-shapes.net for more informations
list_create = List.Create(item0=dropdown_data, item1=dropdown_data_2, item2=textbox_data)
boolean_6 = BoolSelector(true)
string_7 = StringInput("Cancelar")
number = DoubleInput(600)
number_2 = DoubleInput(200)
multipleinputform = Custom[MultipleInputForm ++](Description_optional=code_block, Logo_optional=readFromFile, ButtonText_optional=string_2, Inputs=list_create, Toggle=boolean_6, CancelButtonText_optional=string_7, Width_optional=number, LabelWidth_optional=number_2)  # package Data-Shapes; Create a form with multiple inputs. see www.data-shapes.net for tutorials and infos!
code_block_7 = CodeBlock()  # //Data-Shapes
code_block_8 = CodeBlock()  # //archilab
element_classes_2 = ElementTypes("CableTrayType")
all_elements_of_class_2 = ElementsOfType(element_class=element_classes_2)
name_6 = Family.Name(family=all_elements_of_class_2)
code_block_9 = CodeBlock { "Perfilado"; }
contains_4 = String.Contains(string=name_6, searchFor=code_block_9)
filterByBoolMask_4 = List.FilterByBoolMask(list=all_elements_of_class_2, mask=contains_4)

end = Revit.Transaction.Transaction.End(input=multipleinputform.Was_Cancelled)
start = Revit.Transaction.Transaction.Start(input=end)
passThrough = Custom[PassThrough](passThrough=start, waitFor=end)  # package archi-lab.net; Ripped this off from Clockwork. Sorry Andy.

# group: Selecionar ponto na parede
code_block_10 = CodeBlock { ["Pressione ESC para finalizar"]; }
code_block_11 = CodeBlock { ["Selecione o ponto na Parede"]; }
if_ = If(test=passThrough, true=code_block_10, false=code_block_11)
fromList = Python(IN[0]=if_)  # "String.FromList"; IronPython2
# ---------- fromList.python (22 lines) ----------
# Carregar as bibliotecas DesignScript e padrão do Python
import sys
import clr
clr.AddReference('ProtoGeometry')
from Autodesk.DesignScript.Geometry import *

# Função para concatenar os valores de uma lista em uma única string com múltiplas linhas
def concatenate_list_to_string(input_list, delimiter="\n"):
    # Verifica se a entrada é uma lista
    if not isinstance(input_list, list):
        return "A entrada deve ser uma lista."
    
    # Converte todos os elementos para string e junta com o delimitador especificado
    result = delimiter.join(str(item) for item in input_list)
    return result

# Entrada pelo nó do Dynamo
lista = IN[0]  # Lista de valores a serem concatenados
delimitador = IN[1] if len(IN) > 1 else "\n"  # Delimitador opcional, padrão é nova linha

# Saída para o Dynamo
OUT = concatenate_list_to_string(lista, delimitador)
# ----------------------------------------
window_prompt_with_text = Python(IN[0]=fromList)  # IronPython2
# ---------- window_prompt_with_text.python (32 lines) ----------
# Importando as bibliotecas necessárias da API do Revit
import clr
clr.AddReference('RevitServices')  # Referência aos serviços do Revit
from RevitServices.Persistence import DocumentManager

clr.AddReference('RevitAPI')  # Referência à API do Revit
clr.AddReference('RevitAPIUI')  # Referência à API de Interface de Usuário do Revit

from Autodesk.Revit.UI import TaskDialog, TaskDialogCommonButtons, TaskDialogResult

# Recebe o texto de instrução como entrada do nó
instrucoes = IN[0]

# Verifica se a entrada é "Cancelar"
if instrucoes.lower() == "Pressione ESC para finalizar":
    OUT = False
else:
    # Criando o TaskDialog
    dialog = TaskDialog("Aviso")
    dialog.MainInstruction = instrucoes
    dialog.CommonButtons = TaskDialogCommonButtons.Ok | TaskDialogCommonButtons.Cancel

    # Exibindo o dialog para o usuário e capturando a resposta
    resultado = dialog.Show()

    # Interpretando a resposta
    if resultado == TaskDialogResult.Ok:
        OUT = True
    elif resultado == TaskDialogResult.Cancel:
        OUT = False
    else:
        OUT = None
# ----------------------------------------
categories_2 = Categories("OST_LightingDevices")
categories_3 = Categories("OST_CommunicationDevices")
categories_4 = Categories("OST_DataDevices")
categories_5 = Categories("OST_TelephoneDevices")
categories_6 = Categories("OST_ElectricalFixtures")
categories_7 = Categories("OST_ElectricalEquipment")
categories_8 = Categories("OST_LightingFixtures")
categories_9 = Categories("OST_ConduitFitting")
categories_10 = Categories("OST_MechanicalEquipment")
list_create_2 = List.Create(item0=categories_2, item1=categories_3, item2=categories_4, item3=categories_5, item4=categories_6, item5=categories_7, item6=categories_8, item7=categories_9, item8=categories_10)
flatten_3 = List.Flatten(list=list_create_2)
boolean_7 = BoolSelector(true)
boolean_8 = BoolSelector(true)
ʳʰʸᵗʰᵐ_selection_pick = Rhythm.Revit.Selection.Selection.Pick(runIt=window_prompt_with_text, category=flatten_3, singleSelection=boolean_7, ordered=boolean_8)

passThrough_2 = Custom[PassThrough](passThrough=window_prompt_with_text, waitFor=ʳʰʸᵗʰᵐ_selection_pick)

# group: Selecionar Bandeja
code_block_12 = CodeBlock { ["Selecione a Bandeja de Cabos"]; }
code_block_13 = CodeBlock { ["Pressione ESC para finalizar"]; }
if_2 = If(test=passThrough_2, true=code_block_12, false=code_block_13)
fromList_2 = Python(IN[0]=if_2)  # "String.FromList"; IronPython2; same code as fromList
window_prompt_with_text_2 = Python(IN[0]=fromList_2)  # IronPython2
# ---------- window_prompt_with_text_2.python (32 lines) ----------
# Importando as bibliotecas necessárias da API do Revit
import clr
clr.AddReference('RevitServices')  # Referência aos serviços do Revit
from RevitServices.Persistence import DocumentManager

clr.AddReference('RevitAPI')  # Referência à API do Revit
clr.AddReference('RevitAPIUI')  # Referência à API de Interface de Usuário do Revit

from Autodesk.Revit.UI import TaskDialog, TaskDialogCommonButtons, TaskDialogResult

# Recebe o texto de instrução como entrada do nó
instrucoes = IN[0]

# Verifica se a entrada é "Cancelar"
if instrucoes.lower() == "Pressione ESC para finalizar":
    OUT = False
else:
    # Criando o TaskDialog
    dialog = TaskDialog("Aviso")
    dialog.MainInstruction = instrucoes
    dialog.CommonButtons = TaskDialogCommonButtons.Ok | TaskDialogCommonButtons.Cancel

    # Exibindo o dialog para o usuário e capturando a resposta
    resultado = dialog.Show()

    # Interpretando a resposta
    if resultado == TaskDialogResult.Ok:
        OUT = False
    elif resultado == TaskDialogResult.Cancel:
        OUT = False
    else:
        OUT = None
# ----------------------------------------
categories_11 = Categories("OST_CableTray")
boolean_9 = BoolSelector(true)
ʳʰʸᵗʰᵐ_selection_pick_2 = Rhythm.Revit.Selection.Selection.Pick(runIt=window_prompt_with_text_2, category=categories_11, singleSelection=boolean_9)

# group: ELETROCALHA
getLocation = Element.GetLocation(element=ʳʰʸᵗʰᵐ_selection_pick_2)

passThrough_3 = Custom[PassThrough](passThrough=ʳʰʸᵗʰᵐ_selection_pick, waitFor=ʳʰʸᵗʰᵐ_selection_pick_2)

# group: PONTOS NA PAREDE
connectors = Custom[👓 Connectors+](element=passThrough_3)  # package BIMCoder Nodes - 2.X; Obtém as propriedades mais relevantes dos conectores de elementos

# group: Processamento
isEmpty = List.IsEmpty(list=connectors.ConnectedElements@L2)
filterByBoolMask_5 = List.FilterByBoolMask(list=connectors.Connectors, mask=isEmpty)
filterByBoolMask_6 = List.FilterByBoolMask(list=connectors.Direction, mask=isEmpty)

# group: Connectores Superiores
Z = Vector.Z(vector=filterByBoolMask_6.in)
code_block_14 = CodeBlock { 1; }
eq = Z == code_block_14
filterByBoolMask_7 = List.FilterByBoolMask(list=Z, mask=eq)
firstItem = List.FirstItem(list=filterByBoolMask_7.in)
indexOf = List.IndexOf(list=Z, element=firstItem)
getItemAtIndex = List.GetItemAtIndex(list=filterByBoolMask_5.in, index=indexOf)

boolean_10 = BoolSelector(false)

# group: PONTO-A
clean_4 = List.Clean(list=getItemAtIndex, preserveIndices=boolean_10)
location = Custom[Connector.Location](connector=clean_4)  # package MEPover; Returns the location of a connector

# group: Ponto B
distanceTo = Geometry.DistanceTo(geometry=location@L1, other=getLocation)
sortIndexByValue = List.SortIndexByValue(list=distanceTo)
firstItem_2 = List.FirstItem(list=sortIndexByValue)
getItemAtIndex_2 = List.GetItemAtIndex(list=getLocation, index=firstItem_2, lacing=Longest)
closestPointTo = Geometry.ClosestPointTo(geometry=getLocation, other=location)

# group: Direção do conector
direction = Custom[Connector.Direction](connector=clean_4)  # package MEPover; Returns the direction of the CoordinateSystem of the Connector

# group: Copy new elements
# Descrição <Clique duas vezes aqui para editar a descrição do grupo>
count = List.Count(list=ʳʰʸᵗʰᵐ_selection_pick)
number_3 = DoubleInput(1)
add = count + number_3
cycle = List.Cycle(list=ʳʰʸᵗʰᵐ_selection_pick_2@L1, amount=add@L1)
byCoordinates = Vector.ByCoordinates()
# note: Clockwork
copyByVector = Custom[Element.CopyByVector](element=cycle@@L1, vector=byCoordinates)  # package Clockwork for Dynamo 2.x; Copies an element or a list of elements by a given vector.
flatten_4 = List.Flatten(list=copyByVector, lacing=Longest)

# group: length and sublength
# Descrição <Clique duas vezes aqui para editar a descrição do grupo>
getLocation_2 = Element.GetLocation(element=ʳʰʸᵗʰᵐ_selection_pick_2)
length = Curve.Length(curve=getLocation_2)

flatten_5 = List.Flatten(list=closestPointTo)

# group: split length into sublength
# Descrição <Clique duas vezes aqui para editar a descrição do grupo>
number_4 = DoubleInput(0)
startPoint = Curve.StartPoint(curve=getLocation_2)
distanceTo_2 = Geometry.DistanceTo(geometry=startPoint, other=flatten_5)
div = distanceTo_2 / length
list_create_3 = List.Create(item0=number_4, item1=div)
flatten_6 = List.Flatten(list=list_create_3@L3)
splitByParameter = Curve.SplitByParameter(curve=getLocation_2, parameters=flatten_6)
endPoint = Curve.EndPoint(curve=getLocation_2)

setLocation = Element.SetLocation(element=flatten_4, geometry=splitByParameter)

# group: Acessórios de união
# Descrição <Clique duas vezes aqui para editar a descrição do grupo>
passthrough = Custom[Passthrough](passThrough=flatten_4, waitFor=setLocation)  # package Clockwork for Dynamo 2.x; Forces a sequential order of execution. The node wired into the output of the Passthrough node will be executed *after* the node wired into the waitFor input (e.g. important for some Revit operations). The value of the passThrough input will be passed on to the node wired into the output port of the Passthrough node.
code_block_15 = CodeBlock { -1; }
dropItems = List.DropItems(list=passthrough, amount=code_block_15, lacing=Longest)
restOfItems = List.RestOfItems(list=passthrough, lacing=Longest)
byMEPCurves = Custom[MEPFitting.ByMEPCurves](MEPCurve1=dropItems, MEPCurve2=restOfItems, lacing=Longest)  # package MEPover; Creates a UnionFitting or ElbowFitting by 2 MEPCurves (Ducts, Cable Trays, Pipes or Conduits). The output may not always be all the fittings created as Revit sometimes creates extra transition fittings outside of the node transactions.

flatten_7 = List.Flatten(list=byMEPCurves)

# group: Separar Entradas
code_block_16 = CodeBlock { 0; }
getItemAtIndex_3 = List.GetItemAtIndex(list=multipleinputform.User_Inputs, index=code_block_16)
code_block_17 = CodeBlock { 1; }
getItemAtIndex_4 = List.GetItemAtIndex(list=multipleinputform.User_Inputs, index=code_block_17)
code_block_18 = CodeBlock { 2; }
getItemAtIndex_5 = List.GetItemAtIndex(list=multipleinputform.User_Inputs, index=code_block_18)

getLocation_3 = Element.GetLocation(element=byMEPCurves)
byPoint = FamilyInstance.ByPoint(familyType=getItemAtIndex_3, point=getLocation_3)

# group: Obtendo os parâmetros
code_block_19 = CodeBlock { "Diâmetro (tamanho comercial)"; "Largura"; "Altura"; }
getParameterValueByName = Element.GetParameterValueByName(element=ʳʰʸᵗʰᵐ_selection_pick_2, parameterName=code_block_19.out1)
convert_between_units = DynamoConvert(getParameterValueByName, MeasurementType="Length", FromConversion="Millimeters", ToConversion="Meters")
getParameterValueByName_2 = Element.GetParameterValueByName(element=ʳʰʸᵗʰᵐ_selection_pick_2, parameterName=code_block_19.out2)
convert_between_units_2 = DynamoConvert(getParameterValueByName_2, MeasurementType="Length", FromConversion="Millimeters", ToConversion="Meters")

# group: Parâmetro da família Largura
code_block_20 = CodeBlock { "Largura"; }
setParameterByName = Element.SetParameterByName(element=byPoint, parameterName=code_block_20, value=convert_between_units)

# group: Excluir elementos desatualizados
# Descrição <Clique duas vezes aqui para editar a descrição do grupo>
passthrough_2 = Custom[Passthrough](passThrough=flatten_7, waitFor=setParameterByName)
delete = archilab.Revit.Elements.Elements.Delete(element=passthrough_2)

passthrough_3 = Custom[Passthrough](passThrough=flatten_4, waitFor=delete)
firstItem_3 = List.FirstItem(list=passthrough_3@L2)
connectors_2 = Custom[👓 Connectors+](element=firstItem_3)
flatten_8 = List.Flatten(list=byPoint)
connectors_3 = Custom[👓 Connectors+](element=flatten_8)
passthrough_4 = Custom[Passthrough](passThrough=flatten_4, waitFor=delete)
number_5 = DoubleInput(1)
getItemAtIndex_6 = List.GetItemAtIndex(list=passthrough_4@L2, index=number_5)
connectors_4 = Custom[👓 Connectors+](element=getItemAtIndex_6)

# group: Conectar Bandeja
# Descrição <Clique duas vezes aqui para editar a descrição do grupo>
getConnectorClosestTo = MEP.Connectors.GetConnectorClosestTo(connectors=connectors_2.Connectors, point=connectors_3.Points)
location_2 = MEP.Connectors.Location(connector=getConnectorClosestTo)
getConnectorClosestTo_2 = MEP.Connectors.GetConnectorClosestTo(connectors=connectors_3.Connectors, point=location_2)
connectTo = Custom[Connector.ConnectTo](connector=getConnectorClosestTo, Connector2=getConnectorClosestTo_2)  # package MEPover; Connects a connector to another connector. Returns True if connection succeeded
getConnectorClosestTo_3 = MEP.Connectors.GetConnectorClosestTo(connectors=connectors_4.Connectors, point=connectors_3.Points)
location_3 = MEP.Connectors.Location(connector=getConnectorClosestTo_3)
getConnectorClosestTo_4 = MEP.Connectors.GetConnectorClosestTo(connectors=connectors_3.Connectors, point=location_3)
connectTo_2 = Custom[Connector.ConnectTo](connector=getConnectorClosestTo_3, Connector2=getConnectorClosestTo_4)

end_2 = Revit.Transaction.Transaction.End(input=connectTo)
end_3 = Revit.Transaction.Transaction.End(input=connectTo_2)
list_create_4 = List.Create(item0=end_2, item1=end_3)

# group: Conduites desconectados
code_block_21 = CodeBlock(waithFor=list_create_4, Pass=flatten_8) { [waithFor,Pass][1]; }
connectors_5 = Custom[👓 Connectors+](element=code_block_21)
isEmpty_2 = List.IsEmpty(list=connectors_5.ConnectedElements@L2, lacing=Longest)
filterByBoolMask_8 = List.FilterByBoolMask(list=connectors_5.Connectors@L2, mask=isEmpty_2)
flatten_9 = List.Flatten(list=filterByBoolMask_8.in)

# group: Ponto B
# Descrição <Clique duas vezes aqui para editar a descrição do grupo>
getConnectorClosestTo_5 = MEP.Connectors.GetConnectorClosestTo(connectors=flatten_9, point=location)
location_4 = MEP.Connectors.Location(connector=getConnectorClosestTo_5)

# group: PONTO C
code_block_22 = CodeBlock { 0; }
Z_2 = Point.Z(point=location_4)
Z_3 = Point.Z(point=location)
sub = Z_2 - Z_3
abs = Math.Abs(number=sub)
eq_2 = code_block_22 == abs
X = Point.X(point=closestPointTo)
Y = Point.Y(point=closestPointTo)
byCoordinates_2 = Point.ByCoordinates(x=X, y=Y, z=Z_2)
distanceTo_3 = Geometry.DistanceTo(geometry=byCoordinates_2, other=closestPointTo)
if_3 = RefactoredIf(test=eq_2, true=distanceTo_3, false=abs)

# group: Faz a linha na vertical da parede
byStartPointDirectionLength = Line.ByStartPointDirectionLength(startPoint=location, direction=direction, length=if_3)

# group: Pega o ponto do final da linha
endPoint_2 = Curve.EndPoint(curve=byStartPointDirectionLength)

byStartPointEndPoint = Line.ByStartPointEndPoint(startPoint=endPoint_2, endPoint=location_4)

# group: CRIAR ELETRODUTO ATÉ A ELETROCALHA
element_level = Custom[Element Level](element=passThrough_3)  # package Genius Loci; Gets an element's level. Based on a Clockwork's node
conduit_bylines = Custom[👓 Conduit․ByLines](lines=byStartPointEndPoint@L2, conduitType=getItemAtIndex_4, levels=element_level, Diameter=getItemAtIndex_5)  # package BIMCoder Nodes - 2.X; Modela conduítes (Conduit) com base em linhas (que devem ser geometrias)
flatten_10 = List.Flatten(list=conduit_bylines@L2)
firstItem_4 = List.FirstItem(list=conduit_bylines@L2)

firstItem_5 = List.FirstItem(list=passThrough_3)

# group: CRIAR ELETRODUTO E CONECTAR NA CAIXA
element_level_2 = Custom[Element Level](element=firstItem_5)
conduit_bylines_2 = Custom[👓 Conduit․ByLines](lines=byStartPointDirectionLength@L2, conduitType=getItemAtIndex_4, levels=element_level_2, Diameter=getItemAtIndex_5, lacing=Longest)
flatten_11 = List.Flatten(list=conduit_bylines_2)
connectors_6 = Custom[👓 Connectors+](element=flatten_11)
getConnectorClosestTo_6 = MEP.Connectors.GetConnectorClosestTo(connectors=connectors_6.Connectors, point=location)
connectTo_3 = Custom[Connector.ConnectTo](connector=clean_4, Connector2=getConnectorClosestTo_6)
watch = Watch(clean_4)

# group: SELECIONAR OS ELETRODUTOS E CRIAR CURVAS
join = List.Join(list0=firstItem_4, list1=flatten_11)
flatten_12 = List.Flatten(list=join)
placefittings = Custom[👓 PlaceFittings](elements=flatten_12)  # package BIMCoder Nodes - 2.X; Modela conexões (fittings) entre curvas MEP (eletrodutos, bandejas de cabos, tubulações e dutos).

# group: Parâmetro da família Altura
code_block_23 = CodeBlock { "Altura"; }
setParameterByName_2 = Element.SetParameterByName(element=byPoint, parameterName=code_block_23, value=convert_between_units_2)

# group: Obtendo os pontos de posicionamento
parameterAtPoint = Curve.ParameterAtPoint(curve=splitByParameter, point=getLocation_3)
normalAtParameter = Curve.NormalAtParameter(curve=splitByParameter, param=parameterAtPoint)

# group: Ângulo de orientação
X_2 = Vector.X(vector=normalAtParameter)
code_block_24 = CodeBlock { 0.0; 0.001; }
eq_3 = Equals(x=X_2, y=code_block_24.out0, tolerance=code_block_24.out1)
le = X_2 <= code_block_24.out0
ge = X_2 >= code_block_24.out0
reverse = Vector.Reverse(vector=normalAtParameter)
if_4 = If(test=ge, true=normalAtParameter, false=reverse)
code_block_25 = CodeBlock(Vector1=if_4) { Autodesk.DesignScript.Geometry.Vector.YAxis(); Vector1; Autodesk.DesignScript.Geometry.Vector.XAxis(); }
angleAboutAxis = Vector.AngleAboutAxis(vector=code_block_25.Vector1, otherVector=code_block_25.out0, rotationAxis=code_block_25.out2)
round = Math.Round(number=angleAboutAxis)

# group: Parâmetro da família - Ângulo
setRotation = FamilyInstance.SetRotation(familyInstance=byPoint, degree=round)

# group: Bandeja
connectors_7 = Custom[👓 Connectors+](element=ʳʰʸᵗʰᵐ_selection_pick_2)

# group: Todas conexões em bandejas
categories_12 = Categories("OST_CableTrayFitting")
all_elements_of_category = ElementsOfCategory(Category=categories_12)
flatten_13 = List.Flatten(list=all_elements_of_category)

# group: Selecionar conexões
location_5 = MEP.Connectors.Location(connector=connectors_7.Connectors)
code_block_26 = CodeBlock { 0.05; }
byCenterPointRadius = Sphere.ByCenterPointRadius(centerPoint=location_5, radius=code_block_26)
intersectsSolid = Revit.Element.IntersectsSolid(solids=byCenterPointRadius, elements=flatten_13)
intersectingElements = Results.SolidIntersectionResult.IntersectingElements(solidIntersectionResult=intersectsSolid)
boolean_11 = BoolSelector(true)
clean_5 = List.Clean(list=intersectingElements, preserveIndices=boolean_11)
firstItem_6 = List.FirstItem(list=clean_5@L2)
boolean_12 = BoolSelector(false)
clean_6 = List.Clean(list=firstItem_6, preserveIndices=boolean_12)
flatten_14 = List.Flatten(list=clean_6)
uniqueItems_3 = List.UniqueItems(list=flatten_14)
solids = Element.Solids(element=uniqueItems_3)

connectors_8 = Custom[👓 Connectors+](element=firstItem_4)
getConnectorClosestTo_7 = MEP.Connectors.GetConnectorClosestTo(connectors=connectors_8.Connectors, point=location_4)
connectTo_4 = Custom[Connector.ConnectTo](connector=getConnectorClosestTo_5, Connector2=getConnectorClosestTo_7)
passthrough_5 = Custom[Passthrough](passThrough=code_block_21, waitFor=connectTo_4)
connectors_9 = Custom[👓 Connectors+](element=passthrough_5)
isEmpty_3 = List.IsEmpty(list=connectors_9.ConnectedElements@L2, lacing=Longest)
filterByBoolMask_9 = List.FilterByBoolMask(list=connectors_9.ConnectedElements@L3, mask=isEmpty_3)
flatten_15 = List.Flatten(list=filterByBoolMask_9.out)
connectors_10 = Custom[👓 Connectors+](element=flatten_15)
flatten_16 = List.Flatten(list=connectors_10.Connectors)
passthrough_6 = Custom[Passthrough](passThrough=uniqueItems_3, waitFor=connectTo_4)
connectors_11 = Custom[👓 Connectors+](element=passthrough_6)
isConnected = MEP.Connectors.IsConnected(connector=connectors_11.Connectors)
filterByBoolMask_10 = List.FilterByBoolMask(list=connectors_11.Connectors, mask=isConnected)
location_6 = Custom[Connector.Location](connector=filterByBoolMask_10.out)
flatten_17 = List.Flatten(list=location_6)
getConnectorClosestTo_8 = MEP.Connectors.GetConnectorClosestTo(connectors=flatten_16, point=flatten_17)
flatten_18 = List.Flatten(list=filterByBoolMask_10.out)
connectTo_5 = Custom[Connector.ConnectTo](connector=getConnectorClosestTo_8, Connector2=flatten_18)
passthrough_7 = Custom[Passthrough](passThrough=passthrough_5, waitFor=connectTo_5)

# group: Ocultar Lado desconectado
# Descrição <Clique duas vezes aqui para editar a descrição do grupo>
mep_connector_info = Custom[MEP Connector info+](element=passthrough_7)  # package MEPover; This node will return the connectors and a lot of information about those connectors of the input elements
isConnected_2 = Custom[Connector.IsConnected](connector=mep_connector_info.Connectors)  # package MEPover; Returns a boolean indicating whether the connector is connected to a connector on different element
filterByBoolMask_11 = List.FilterByBoolMask(list=mep_connector_info.Description, mask=isConnected_2)
flatten_19 = List.Flatten(list=filterByBoolMask_11.out)
code_block_27 = CodeBlock { "ConduitConnector01"; "Saída 01"; "Saída 02"; }
eq_4 = flatten_19 == code_block_27.out0
condição_if = CodeBlock(test=eq_4, verd=code_block_27.out1, fals=code_block_27.out2)
# ---------- condição_if.designscript (2 lines) ----------
//Condições IF
test == true ? verd : fals;
# ----------------------------------------
code_block_28 = CodeBlock { 0; }
setParameterByName_3 = Element.SetParameterByName(element=passthrough_7, parameterName=condição_if, value=code_block_28)

watch_2 = Watch(flatten_19)
watch_3 = Watch(code_block_27.out0)

# group: Excluir elementos desatualizados
# Descrição <Clique duas vezes aqui para editar a descrição do grupo>
passthrough_8 = Custom[Passthrough](passThrough=ʳʰʸᵗʰᵐ_selection_pick_2, waitFor=passthrough)
delete_2 = archilab.Revit.Elements.Elements.Delete(element=passthrough_8)
