# Dynamo graph 18-2_BIMACON_Conduítes ParedexParede_R05_script.dyn "ok 2021_18-2_BIMACON_Conduítes ParedexParede_R05_script" (Dynamo 2.19.3.6394)
# author: Jose Nelson
# Cria eletrodutos entre pontos na parede
# packages: Genius Loci 2023.2.21, DynaMEP 2.0.1, MEPover 2022.10.30, archi-lab.net 2023.213.1722, Rhythm 2023.4.2021, BIMCoder Nodes - 2.X 2025.1.0, Data-Shapes 2022.2.105, Data-Shapes 2025.3.118

# group: ENTRADAS PARA O USUÁRIO
code_block = CodeBlock { "Eletrodutos Parede x Parede"; }
string = StringInput("LogoBimacon.png")
python_script = Python(IN[0]=string)  # IronPython2
# ---------- python_script.python (22 lines) ----------
import clr

# Adiciona referência ao ambiente .NET
clr.AddReference('System')
from System import Environment, IO

# Nome da imagem (entrada do usuário)
nome_arquivo_imagem = IN[0]

# Recupera o nome do usuário logado no Windows
usuario = Environment.UserName

# Monta o caminho completo para a pasta de imagens
caminho_base = r"C:\Users\{0}\AppData\Roaming\pyRevit\Extensions\Bimacon.extension\Bimacon.tab\Imagens_Bimacon".format(usuario)

# Junta o caminho base com o nome do arquivo
caminho_completo = IO.Path.Combine(caminho_base, nome_arquivo_imagem)

# Verifica se o arquivo existe
existe = IO.File.Exists(caminho_completo)

OUT = caminho_completo if existe else "Imagem não encontrada: {0}".format(caminho_completo)
# ----------------------------------------
file_from_path = FileObject(path=python_script)
readFromFile = Image.ReadFromFile(file=file_from_path)
string_2 = StringInput("Confirmar")
string_3 = StringInput("Selecione o Tipo de eletroduto")
element_classes = ElementTypes("ConduitType")
all_elements_of_class = ElementsOfType(element_class=element_classes)
name = Element.Name(element=all_elements_of_class)
code_block_2 = CodeBlock { 1; }
dropdown_data = Custom[DropDown Data](InputName=string_3, Keys=name, Values=all_elements_of_class, DefaultValueIndex=code_block_2)  # package Data-Shapes; Create data for DropDown input in UI.MultiInputForm ++ . Check out www.data-shapes.net for more infos.
string_4 = StringInput("Diâmetro conduíte (mm)")
string_5 = StringInput("25")
boolean = BoolSelector(true)
textbox_data = Custom[TextBox Data](InputName=string_4, DefaultText=string_5, IsNumberEntry=boolean)  # package Data-Shapes; Create Data for TextBox input in UI.MultipleInputForm ++ . Check out www.data-shapes.net for more informations
string_6 = StringInput("Ângulo Conduíte")
boolean_2 = BoolSelector(false)
string_7 = StringInput("90°")
boolean_input = Custom[Boolean input](InputName=string_6, DefaultValue=boolean_2, SideText=string_7)  # package Data-Shapes; Creates a boolean input for UI.MultipleInputForm ++ . Check out www.data-shapes.net for more infos!
list_create = List.Create(item0=dropdown_data, item1=textbox_data, item2=boolean_input)
boolean_3 = BoolSelector(true)
string_8 = StringInput("Cancelar")
number = DoubleInput(550)
number_2 = DoubleInput(200)
multipleinputform = Custom[MultipleInputForm ++](Description_optional=code_block, Logo_optional=readFromFile, ButtonText_optional=string_2, Inputs=list_create, Toggle=boolean_3, CancelButtonText_optional=string_8, Width_optional=number, LabelWidth_optional=number_2)  # package Data-Shapes; Create a form with multiple inputs. see www.data-shapes.net for tutorials and infos!
code_block_3 = CodeBlock()  # //Data-Shapes
code_block_4 = CodeBlock()  # //archilab

end = Revit.Transaction.Transaction.End(input=multipleinputform.Was_Cancelled)
start = Revit.Transaction.Transaction.Start(input=end)
passThrough = Custom[PassThrough](passThrough=start, waitFor=end)  # package archi-lab.net; Ripped this off from Clockwork. Sorry Andy.

# group: Selecionar os pontos
code_block_5 = CodeBlock { ["Pressione ESC para finalizar"]; }
code_block_6 = CodeBlock { ["Selecione o primeiro ponto"]; }
if_ = If(test=passThrough, true=code_block_5, false=code_block_6)
fromList = Python(IN[0]=if_)  # "String.FromList"; IronPython2
# ---------- fromList.python (22 lines) ----------
# Carregar as bibliotecas DesignScript e padrão do Python
import sys
import clr
clr.AddReference('ProtoGeometry')
from Autodesk.DesignScript.Geometry import *

# Função para concatenar os valores de uma lista em uma única string com múltiplas linhas
def concatenate_list_to_string(input_list, delimiter="\n"):
    # Verifica se a entrada é uma lista
    if not isinstance(input_list, list):
        return "A entrada deve ser uma lista."
    
    # Converte todos os elementos para string e junta com o delimitador especificado
    result = delimiter.join(str(item) for item in input_list)
    return result

# Entrada pelo nó do Dynamo
lista = IN[0]  # Lista de valores a serem concatenados
delimitador = IN[1] if len(IN) > 1 else "\n"  # Delimitador opcional, padrão é nova linha

# Saída para o Dynamo
OUT = concatenate_list_to_string(lista, delimitador)
# ----------------------------------------
window_prompt_with_text = Python(IN[0]=fromList)  # IronPython2
# ---------- window_prompt_with_text.python (32 lines) ----------
# Importando as bibliotecas necessárias da API do Revit
import clr
clr.AddReference('RevitServices')  # Referência aos serviços do Revit
from RevitServices.Persistence import DocumentManager

clr.AddReference('RevitAPI')  # Referência à API do Revit
clr.AddReference('RevitAPIUI')  # Referência à API de Interface de Usuário do Revit

from Autodesk.Revit.UI import TaskDialog, TaskDialogCommonButtons, TaskDialogResult

# Recebe o texto de instrução como entrada do nó
instrucoes = IN[0]

# Verifica se a entrada é "Cancelar"
if instrucoes.lower() == "Pressione ESC para finalizar":
    OUT = False
else:
    # Criando o TaskDialog
    dialog = TaskDialog("Aviso")
    dialog.MainInstruction = instrucoes
    dialog.CommonButtons = TaskDialogCommonButtons.Ok | TaskDialogCommonButtons.Cancel

    # Exibindo o dialog para o usuário e capturando a resposta
    resultado = dialog.Show()

    # Interpretando a resposta
    if resultado == TaskDialogResult.Ok:
        OUT = True
    elif resultado == TaskDialogResult.Cancel:
        OUT = False
    else:
        OUT = None
# ----------------------------------------
categories = Categories("OST_LightingDevices")
categories_2 = Categories("OST_CommunicationDevices")
categories_3 = Categories("OST_DataDevices")
categories_4 = Categories("OST_TelephoneDevices")
categories_5 = Categories("OST_ElectricalFixtures")
categories_6 = Categories("OST_ElectricalEquipment")
categories_7 = Categories("OST_MechanicalEquipment")
categories_8 = Categories("OST_LightingFixtures")
list_create_2 = List.Create(item0=categories, item1=categories_2, item2=categories_3, item3=categories_4, item4=categories_5, item5=categories_6, item6=categories_7, item7=categories_8)
flatten = List.Flatten(list=list_create_2)
boolean_4 = BoolSelector(true)
boolean_5 = BoolSelector(false)
ʳʰʸᵗʰᵐ_selection_pick = Rhythm.Revit.Selection.Selection.Pick(runIt=window_prompt_with_text, category=flatten, singleSelection=boolean_4, ordered=boolean_5)

getLocation = Element.GetLocation(element=ʳʰʸᵗʰᵐ_selection_pick)
passThrough_2 = Custom[PassThrough](passThrough=window_prompt_with_text, waitFor=ʳʰʸᵗʰᵐ_selection_pick)

# group: Selecionar 2º ponto
code_block_7 = CodeBlock { ["Selecione o segundo ponto"]; }
code_block_8 = CodeBlock { ["Pressione ESC para finalizar"]; }
if_2 = If(test=passThrough_2, true=code_block_7, false=code_block_8)
fromList_2 = Python(IN[0]=if_2)  # "String.FromList"; IronPython2; same code as fromList
window_prompt_with_text_2 = Python(IN[0]=fromList_2)  # IronPython2
# ---------- window_prompt_with_text_2.python (32 lines) ----------
# Importando as bibliotecas necessárias da API do Revit
import clr
clr.AddReference('RevitServices')  # Referência aos serviços do Revit
from RevitServices.Persistence import DocumentManager

clr.AddReference('RevitAPI')  # Referência à API do Revit
clr.AddReference('RevitAPIUI')  # Referência à API de Interface de Usuário do Revit

from Autodesk.Revit.UI import TaskDialog, TaskDialogCommonButtons, TaskDialogResult

# Recebe o texto de instrução como entrada do nó
instrucoes = IN[0]

# Verifica se a entrada é "Cancelar"
if instrucoes.lower() == "Pressione ESC para finalizar":
    OUT = False
else:
    # Criando o TaskDialog
    dialog = TaskDialog("Aviso")
    dialog.MainInstruction = instrucoes
    dialog.CommonButtons = TaskDialogCommonButtons.Ok | TaskDialogCommonButtons.Cancel

    # Exibindo o dialog para o usuário e capturando a resposta
    resultado = dialog.Show()

    # Interpretando a resposta
    if resultado == TaskDialogResult.Ok:
        OUT = False
    elif resultado == TaskDialogResult.Cancel:
        OUT = False
    else:
        OUT = None
# ----------------------------------------
list_create_3 = List.Create(item0=list_create_2)
flatten_2 = List.Flatten(list=list_create_3)
boolean_6 = BoolSelector(true)
ʳʰʸᵗʰᵐ_selection_pick_2 = Rhythm.Revit.Selection.Selection.Pick(runIt=window_prompt_with_text_2, category=flatten_2, singleSelection=boolean_6)

getLocation_2 = Element.GetLocation(element=ʳʰʸᵗʰᵐ_selection_pick_2)

# group: Mesma Posição
# Descrição <Clique duas vezes aqui para editar a descrição do grupo>
X = Point.X(point=getLocation)
X_2 = Point.X(point=getLocation_2)
number_3 = DoubleInput(0.001)
eq = Equals(x=X, y=X_2, tolerance=number_3)
Y = Point.Y(point=getLocation)
Y_2 = Point.Y(point=getLocation_2)
eq_2 = Equals(x=Y, y=Y_2, tolerance=number_3)
boolean_7 = BoolSelector(true)
boolean_8 = BoolSelector(false)
condição_if_de_lista = CodeBlock(test1=eq, test2=eq_2, verd=boolean_7, fals=boolean_8)
# ---------- condição_if_de_lista.designscript (3 lines) ----------
//Condições IF
indx = (test1) && (test2) ? 0 : 1;
rslt = [verd,fals][indx];
# ----------------------------------------

# group: Mesma altura
# Descrição <Clique duas vezes aqui para editar a descrição do grupo>
code_block_9 = CodeBlock { "Elevação do Ponto"; }
getParameterValueByName = Element.GetParameterValueByName(element=ʳʰʸᵗʰᵐ_selection_pick, parameterName=code_block_9)
getParameterValueByName_2 = Element.GetParameterValueByName(element=ʳʰʸᵗʰᵐ_selection_pick_2, parameterName=code_block_9)
Z = Point.Z(point=getLocation)
add = Z + getParameterValueByName
Z_2 = Point.Z(point=getLocation_2)
add_2 = Z_2 + getParameterValueByName_2
number_4 = DoubleInput(0.001)
eq_3 = Equals(x=add, y=add_2, tolerance=number_4)

passThrough_3 = Custom[PassThrough](passThrough=ʳʰʸᵗʰᵐ_selection_pick, waitFor=ʳʰʸᵗʰᵐ_selection_pick_2)
mep_connector_info = Custom[MEP Connector info+](element=passThrough_3)  # package MEPover; This node will return the connectors and a lot of information about those connectors of the input elements
isNull = Object.IsNull(object=mep_connector_info.Radius)
filterByBoolMask = List.FilterByBoolMask(list=mep_connector_info.Connectors, mask=isNull)
location = MEP.Connectors.Location(connector=filterByBoolMask.out)
Z_3 = Point.Z(point=location)
sortByKey = List.SortByKey(list=filterByBoolMask.out, keys=Z_3)
isConnected = MEP.Connectors.IsConnected(connector=sortByKey.sortedList)
filterByBoolMask_2 = List.FilterByBoolMask(list=sortByKey.sortedList, mask=isConnected)
direction = Custom[Connector.Direction](connector=filterByBoolMask_2.out)  # package MEPover; Returns the direction of the CoordinateSystem of the Connector
Z_4 = Vector.Z(vector=direction)
number_5 = DoubleInput(0)
eq_4 = Z_4 == number_5
filterByBoolMask_3 = List.FilterByBoolMask(list=filterByBoolMask_2.out, mask=eq_4)
condição_if_de_lista_aninhada = CodeBlock(test=condição_if_de_lista.rslt, x=getParameterValueByName, y=getParameterValueByName_2, cond1=filterByBoolMask_3.out, cond2=filterByBoolMask_3.in, cond3=filterByBoolMask.out) { indx = (test) ? 0 : (x > y) ? 0 : (x == y) ? 1 : 2; resultado = [cond1, cond2, cond3][indx]; }
direction_2 = Custom[Connector.Direction](connector=condição_if_de_lista_aninhada.resultado)
location_2 = MEP.Connectors.Location(connector=condição_if_de_lista_aninhada.resultado)
boundingBox = Element.BoundingBox(element=ʳʰʸᵗʰᵐ_selection_pick_2)
center = RevitModel.BoundingBox.Center(boundingBox=boundingBox)
byTwoPoints = Vector.ByTwoPoints(start=location_2, end=center)
dot = Vector.Dot(vector=direction_2, vec=byTwoPoints)
maximumItem = List.MaximumItem(list=dot)
indexOf = List.IndexOf(list=dot, element=maximumItem)

# group: A
getItemAtIndex = List.GetItemAtIndex(list=condição_if_de_lista_aninhada.resultado, index=indexOf)
location_3 = MEP.Connectors.Location(connector=getItemAtIndex)

getItemAtIndex_2 = List.GetItemAtIndex(list=direction_2, index=indexOf)
number_6 = DoubleInput(5)
byStartPointDirectionLength = Line.ByStartPointDirectionLength(startPoint=location_3, direction=getItemAtIndex_2, length=number_6)
mep_connector_info_2 = Custom[MEP Connector info+](element=ʳʰʸᵗʰᵐ_selection_pick_2)
isNull_2 = Object.IsNull(object=mep_connector_info_2.Radius)
filterByBoolMask_4 = List.FilterByBoolMask(list=mep_connector_info_2.Connectors, mask=isNull_2)
location_4 = MEP.Connectors.Location(connector=filterByBoolMask_4.out)
Z_5 = Point.Z(point=location_4)
sortByKey_2 = List.SortByKey(list=filterByBoolMask_4.out, keys=Z_5)
isConnected_2 = MEP.Connectors.IsConnected(connector=sortByKey_2.sortedList)
filterByBoolMask_5 = List.FilterByBoolMask(list=sortByKey_2.sortedList, mask=isConnected_2)
direction_3 = Custom[Connector.Direction](connector=filterByBoolMask_5.out)
Z_6 = Vector.Z(vector=direction_3)
number_7 = DoubleInput(0)
eq_5 = Z_6 == number_7
filterByBoolMask_6 = List.FilterByBoolMask(list=filterByBoolMask_5.out, mask=eq_5)
condição_if_de_lista_aninhada_2 = CodeBlock(test=condição_if_de_lista.rslt, x=getParameterValueByName, y=getParameterValueByName_2, cond1=filterByBoolMask_6.in, cond2=filterByBoolMask_5.out, cond3=filterByBoolMask_6.out) { indx = (test) ? 2 : (x > y) ? 0 : (x == y) ? 1 : 2; resultado = [cond1, cond2, cond3][indx]; }
direction_4 = Custom[Connector.Direction](connector=condição_if_de_lista_aninhada_2.resultado)
location_5 = MEP.Connectors.Location(connector=condição_if_de_lista_aninhada_2.resultado)
boundingBox_2 = Element.BoundingBox(element=ʳʰʸᵗʰᵐ_selection_pick)
center_2 = RevitModel.BoundingBox.Center(boundingBox=boundingBox_2)
byTwoPoints_2 = Vector.ByTwoPoints(start=location_5, end=center_2)
dot_2 = Vector.Dot(vector=direction_4, vec=byTwoPoints_2)
maximumItem_2 = List.MaximumItem(list=dot_2)
indexOf_2 = List.IndexOf(list=dot_2, element=maximumItem_2)

# group: C
getItemAtIndex_3 = List.GetItemAtIndex(list=condição_if_de_lista_aninhada_2.resultado, index=indexOf_2)
location_6 = MEP.Connectors.Location(connector=getItemAtIndex_3)

getItemAtIndex_4 = List.GetItemAtIndex(list=direction_4, index=indexOf_2)
byStartPointDirectionLength_2 = Line.ByStartPointDirectionLength(startPoint=location_6, direction=getItemAtIndex_4, length=number_6)
intersect = Geometry.Intersect(geometry=byStartPointDirectionLength, other=byStartPointDirectionLength_2, lacing=Longest)

# group: B
flatten_3 = List.Flatten(list=intersect)

type = Object.Type(object=flatten_3)
boolean_9 = BoolSelector(true)
boolean_10 = BoolSelector(false)
empty_list_verificação = CodeBlock(objType=type, test=eq_3, Verd=boolean_9, Fals=boolean_10)
# ---------- empty_list_verificação.designscript (3 lines) ----------
objTypeChecked = objType == null || DSCore.List.IsEmpty(objType) ? [] : objType;
indx = ((test && objType[0] == "Autodesk.DesignScript.Geometry.Line") || objTypeChecked[0] == "Empty") ? 0 : 1;
rslt = [Verd, Fals][indx];
# ----------------------------------------

# group: Separar Entradas
code_block_10 = CodeBlock { 2; }
getItemAtIndex_5 = List.GetItemAtIndex(list=multipleinputform.User_Inputs, index=code_block_10)
code_block_11 = CodeBlock { 0; }
getItemAtIndex_6 = List.GetItemAtIndex(list=multipleinputform.User_Inputs, index=code_block_11)
code_block_12 = CodeBlock { 1; }
getItemAtIndex_7 = List.GetItemAtIndex(list=multipleinputform.User_Inputs, index=code_block_12)

# group: Mesma parede
# Descrição <Clique duas vezes aqui para editar a descrição do grupo>
X_3 = Point.X(point=location_3)
X_4 = Point.X(point=location_6)
code_block_13 = CodeBlock { 0.05; true; false; }
eq_6 = Equals(x=X_3, y=X_4, tolerance=code_block_13.out0)
Y_3 = Point.Y(point=location_3)
Y_4 = Point.Y(point=location_6)
eq_7 = Equals(x=Y_3, y=Y_4, tolerance=code_block_13.out0)
condição_if_de_lista_2 = CodeBlock(test1=eq_6, test2=eq_7, verd=code_block_13.out1, fals=code_block_13.out2)
# ---------- condição_if_de_lista_2.designscript (3 lines) ----------
//Condições IF
indx = (test1) || (test2) ? 0 : 1;
rslt = [verd,fals][indx];
# ----------------------------------------

boolean_11 = BoolSelector(true)
boolean_12 = BoolSelector(false)
condição_if_de_lista_3 = CodeBlock(Noventa=getItemAtIndex_5, Parede=condição_if_de_lista_2.rslt, Altura=eq_3, verd=boolean_11, fals=boolean_12)
# ---------- condição_if_de_lista_3.designscript (3 lines) ----------
//Condições IF
indx = (Noventa) ? 0 : ((Noventa) == (Parede))? 0 : ((Altura) && (Parede))? 0 : 1;
rslt = [verd,fals][indx];
# ----------------------------------------
boolean_13 = BoolSelector(true)
boolean_14 = BoolSelector(false)
empty_list_verificação_2 = CodeBlock(objType=type, test2=condição_if_de_lista.rslt, test=eq_3, Verd=boolean_13, Fals=boolean_14)
# ---------- empty_list_verificação_2.designscript (3 lines) ----------
objTypeChecked = objType == null || DSCore.List.IsEmpty(objType) ? [] : objType;
indx = (test2) || ((test && objType[0] == "Autodesk.DesignScript.Geometry.Line") || objTypeChecked[0] == "Empty") ? 0 : 1;
rslt = [Verd, Fals][indx];
# ----------------------------------------

# group: 2
byStartPointEndPoint = Line.ByStartPointEndPoint(startPoint=location_3, endPoint=location_6)

intersection = Geometry.Curves.Intersection(curve1=byStartPointDirectionLength, curve2=byStartPointDirectionLength_2)
X_5 = Point.X(point=intersection)
Y_5 = Point.Y(point=intersection)
Z_7 = Point.Z(point=location_6)
byCoordinates = Point.ByCoordinates(x=X_5, y=Y_5, z=Z_7)
empty_list_verificação_3 = CodeBlock(test=eq_3, a=flatten_3, Verd=byCoordinates, Fals=flatten_3) { indx = (test) && DSCore.List.IsEmpty(a) ? 0 : 1; rslt = [Verd,Fals][indx]; }

# group: 1
byStartPointEndPoint_2 = Line.ByStartPointEndPoint(startPoint=location_3, endPoint=empty_list_verificação_3.rslt)

# group: 2
byStartPointEndPoint_3 = Line.ByStartPointEndPoint(startPoint=empty_list_verificação_3.rslt, endPoint=location_6)

join = List.Join(list0=byStartPointEndPoint_2, list1=byStartPointEndPoint_3)
condição_if_de_lista_4 = CodeBlock(test=[empty_list_verificação_2.rslt, empty_list_verificação_2.rslt], verd=byStartPointEndPoint, fals=join)
# ---------- condição_if_de_lista_4.designscript (3 lines) ----------
//Condições IF
indx = (test) ? 0 : 1;
rslt = [verd,fals][indx];
# ----------------------------------------
number_8 = DoubleInput(0.1)

# group: E
translate = Geometry.Translate(geometry=location_3, direction=getItemAtIndex_2, distance=number_8)

# group: 3
byStartPointEndPoint_4 = Line.ByStartPointEndPoint(startPoint=location_3, endPoint=translate)

# group: D
translate_2 = Geometry.Translate(geometry=location_6, direction=getItemAtIndex_4, distance=number_8)

# group: 4
byStartPointEndPoint_5 = Line.ByStartPointEndPoint(startPoint=translate, endPoint=translate_2)

# group: 5
byStartPointEndPoint_6 = Line.ByStartPointEndPoint(startPoint=translate_2, endPoint=location_6)

join_2 = List.Join(list0=byStartPointEndPoint_4, list1=byStartPointEndPoint_5, list2=byStartPointEndPoint_6)
condição_if_de_lista_5 = CodeBlock(test1=condição_if_de_lista_3.rslt, verd=condição_if_de_lista_4.rslt, fals=join_2)
# ---------- condição_if_de_lista_5.designscript (3 lines) ----------
//Condições IF
indx = (test1) ? 0 : 1;
rslt = [verd,fals][indx];
# ----------------------------------------

# group: Criar eletrodutos
code_block_14 = CodeBlock { []; }
element_level = Custom[Element Level](element=ʳʰʸᵗʰᵐ_selection_pick_2)  # package Genius Loci; Gets an element's level. Based on a Clockwork's node
conduit_bylines = Custom[👓 Conduit․ByLines](lines=condição_if_de_lista_5.rslt, conduitType=getItemAtIndex_6@L1, levels=element_level@L1, Diameter=getItemAtIndex_7)  # package BIMCoder Nodes - 2.X; Modela conduítes (Conduit) com base em linhas (que devem ser geometrias)
flatten_4 = List.Flatten(list=conduit_bylines@L3, lacing=Longest)
condição_if_de_lista_6 = CodeBlock(test=empty_list_verificação.rslt, verd=code_block_14, fals=flatten_4)
# ---------- condição_if_de_lista_6.designscript (3 lines) ----------
//Condições IF
indx = (test) ? 0 : 1;
rslt = [List.Flatten((verd), -1),List.Flatten((fals), -1)][indx];
# ----------------------------------------
placefittings = Custom[👓 PlaceFittings](elements=condição_if_de_lista_6.rslt@L2, lacing=Longest)  # package BIMCoder Nodes - 2.X; Modela conexões (fittings) entre curvas MEP (eletrodutos, bandejas de cabos, tubulações e dutos).
firstItem = List.FirstItem(list=flatten_4, lacing=Longest)
lastItem = List.LastItem(list=flatten_4, lacing=Longest)

end_2 = Revit.Transaction.Transaction.End(input=placefittings)
start_2 = Revit.Transaction.Transaction.Start(input=end_2)

# group: Conduites desconectados
code_block_15 = CodeBlock(waithFor=start_2, Pass=firstItem) { [waithFor,Pass][1]; }
connectors = RevitModel.Element.Connectors(elements=code_block_15)
isConnected_3 = MEP.Connectors.IsConnected(connector=connectors)
filterByBoolMask_7 = List.FilterByBoolMask(list=connectors, mask=isConnected_3, lacing=Longest)
flatten_5 = List.Flatten(list=filterByBoolMask_7.out)

# group: mesma posição
# Descrição <Clique duas vezes aqui para editar a descrição do grupo>
location_7 = MEP.Connectors.Location(connector=flatten_5)
isAlmostEqualTo = Geometry.IsAlmostEqualTo(geometry=location_7, other=location_3, lacing=CrossProduct)
flatten_6 = List.Flatten(list=isAlmostEqualTo)
filterByBoolMask_8 = List.FilterByBoolMask(list=flatten_5, mask=flatten_6, lacing=Longest)
flatten_7 = List.Flatten(list=filterByBoolMask_8.in)

connectTo = Custom[Connector.ConnectTo](connector=getItemAtIndex, Connector2=flatten_7)  # package MEPover; Connects a connector to another connector. Returns True if connection succeeded

# group: Conduites desconectados
code_block_16 = CodeBlock(waithFor=start_2, Pass=lastItem) { [waithFor,Pass][1]; }
connectors_2 = RevitModel.Element.Connectors(elements=code_block_16)
isConnected_4 = MEP.Connectors.IsConnected(connector=connectors_2)
filterByBoolMask_9 = List.FilterByBoolMask(list=connectors_2, mask=isConnected_4, lacing=Longest)
flatten_8 = List.Flatten(list=filterByBoolMask_9.out)

# group: mesma posição
# Descrição <Clique duas vezes aqui para editar a descrição do grupo>
location_8 = MEP.Connectors.Location(connector=flatten_8)
isAlmostEqualTo_2 = Geometry.IsAlmostEqualTo(geometry=location_8, other=location_6, lacing=CrossProduct)
flatten_9 = List.Flatten(list=isAlmostEqualTo_2)
filterByBoolMask_10 = List.FilterByBoolMask(list=flatten_8, mask=flatten_9, lacing=Longest)
flatten_10 = List.Flatten(list=filterByBoolMask_10.in)

connectTo_2 = Custom[Connector.ConnectTo](connector=getItemAtIndex_3, Connector2=flatten_10, lacing=Longest)
