# Dynamo graph ok 2021_18-2_BIMACON_Conduítes ParedexParede_R04_script.dyn "ok 2021_18-2_BIMACON_Conduítes ParedexParede_R03_script" (Dynamo 2.19.3.6394)
# packages: Genius Loci 2023.2.21, DynaMEP 2.0.1, MEPover 2022.10.30, archi-lab.net 2023.213.1722, Rhythm 2023.4.2021, BIMCoder Nodes - 2.X 2025.1.0, Data-Shapes 2022.2.105

# group: ENTRADAS PARA O USUÁRIO
code_block = CodeBlock { "Eletrodutos Parede x Parede"; }
file_path = Filename("..\..\..\..\..\05 - BIMACON\01 - EMPRESA BIMACON\00 - Logos e imagens - BIMACON\ARTE BIMACON\reddonda-removebg-preview.png")
file_from_path = FileObject(path=file_path)
readFromFile = Image.ReadFromFile(file=file_from_path)
string = StringInput("Confirmar")
string_2 = StringInput("Selecione o Tipo de eletroduto")
element_classes = ElementTypes("ConduitType")
all_elements_of_class = ElementsOfType(element_class=element_classes)
name = Element.Name(element=all_elements_of_class)
code_block_2 = CodeBlock { 1; }
dropdown_data = Custom[DropDown Data](InputName=string_2, Keys=name, Values=all_elements_of_class, DefaultValueIndex=code_block_2)  # package Data-Shapes; Create data for DropDown input in UI.MultiInputForm ++ . Check out www.data-shapes.net for more infos.
string_3 = StringInput("Diâmetro conduíte (mm)")
string_4 = StringInput("25")
boolean = BoolSelector(true)
textbox_data = Custom[TextBox Data](InputName=string_3, DefaultText=string_4, IsNumberEntry=boolean)  # package Data-Shapes; Create Data for TextBox input in UI.MultipleInputForm ++ . Check out www.data-shapes.net for more informations
list_create = List.Create(item0=dropdown_data, item1=textbox_data)
boolean_2 = BoolSelector(true)
string_5 = StringInput("Cancelar")
number = DoubleInput(550)
number_2 = DoubleInput(200)
multipleinputform = Custom[MultipleInputForm ++](Description_optional=code_block, Logo_optional=readFromFile, ButtonText_optional=string, Inputs=list_create, Toggle=boolean_2, CancelButtonText_optional=string_5, Width_optional=number, LabelWidth_optional=number_2)  # package Data-Shapes; Create a form with multiple inputs. see www.data-shapes.net for tutorials and infos!
code_block_3 = CodeBlock()  # //Data-Shapes
code_block_4 = CodeBlock()  # //archilab

end = Revit.Transaction.Transaction.End(input=multipleinputform.Was_Cancelled)
start = Revit.Transaction.Transaction.Start(input=end)
passThrough = Custom[PassThrough](passThrough=start, waitFor=end)  # package archi-lab.net; Ripped this off from Clockwork. Sorry Andy.

# group: Selecionar 1º ponto
code_block_5 = CodeBlock { ["Pressione ESC para finalizar"]; }
code_block_6 = CodeBlock { ["Selecione o primeiro ponto"]; }
if_ = If(test=passThrough, true=code_block_5, false=code_block_6)
fromList = Python(IN[0]=if_)  # "String.FromList"; IronPython2
# ---------- fromList.python (22 lines) ----------
# Carregar as bibliotecas DesignScript e padrão do Python
import sys
import clr
clr.AddReference('ProtoGeometry')
from Autodesk.DesignScript.Geometry import *

# Função para concatenar os valores de uma lista em uma única string com múltiplas linhas
def concatenate_list_to_string(input_list, delimiter="\n"):
    # Verifica se a entrada é uma lista
    if not isinstance(input_list, list):
        return "A entrada deve ser uma lista."
    
    # Converte todos os elementos para string e junta com o delimitador especificado
    result = delimiter.join(str(item) for item in input_list)
    return result

# Entrada pelo nó do Dynamo
lista = IN[0]  # Lista de valores a serem concatenados
delimitador = IN[1] if len(IN) > 1 else "\n"  # Delimitador opcional, padrão é nova linha

# Saída para o Dynamo
OUT = concatenate_list_to_string(lista, delimitador)
# ----------------------------------------
window_prompt_with_text = Python(IN[0]=fromList)  # IronPython2
# ---------- window_prompt_with_text.python (32 lines) ----------
# Importando as bibliotecas necessárias da API do Revit
import clr
clr.AddReference('RevitServices')  # Referência aos serviços do Revit
from RevitServices.Persistence import DocumentManager

clr.AddReference('RevitAPI')  # Referência à API do Revit
clr.AddReference('RevitAPIUI')  # Referência à API de Interface de Usuário do Revit

from Autodesk.Revit.UI import TaskDialog, TaskDialogCommonButtons, TaskDialogResult

# Recebe o texto de instrução como entrada do nó
instrucoes = IN[0]

# Verifica se a entrada é "Cancelar"
if instrucoes.lower() == "Pressione ESC para finalizar":
    OUT = False
else:
    # Criando o TaskDialog
    dialog = TaskDialog("Aviso")
    dialog.MainInstruction = instrucoes
    dialog.CommonButtons = TaskDialogCommonButtons.Ok | TaskDialogCommonButtons.Cancel

    # Exibindo o dialog para o usuário e capturando a resposta
    resultado = dialog.Show()

    # Interpretando a resposta
    if resultado == TaskDialogResult.Ok:
        OUT = True
    elif resultado == TaskDialogResult.Cancel:
        OUT = False
    else:
        OUT = None
# ----------------------------------------
categories = Categories("OST_LightingDevices")
categories_2 = Categories("OST_CommunicationDevices")
categories_3 = Categories("OST_DataDevices")
categories_4 = Categories("OST_TelephoneDevices")
categories_5 = Categories("OST_ElectricalFixtures")
categories_6 = Categories("OST_ElectricalEquipment")
categories_7 = Categories("OST_MechanicalEquipment")
categories_8 = Categories("OST_LightingFixtures")
list_create_2 = List.Create(item0=categories, item1=categories_2, item2=categories_3, item3=categories_4, item4=categories_5, item5=categories_6, item6=categories_7, item7=categories_8)
flatten = List.Flatten(list=list_create_2)
boolean_3 = BoolSelector(true)
boolean_4 = BoolSelector(false)
ʳʰʸᵗʰᵐ_selection_pick = Rhythm.Revit.Selection.Selection.Pick(runIt=window_prompt_with_text, category=flatten, singleSelection=boolean_3, ordered=boolean_4)

getLocation = Element.GetLocation(element=ʳʰʸᵗʰᵐ_selection_pick)
passThrough_2 = Custom[PassThrough](passThrough=window_prompt_with_text, waitFor=ʳʰʸᵗʰᵐ_selection_pick)

# group: Selecionar 2º ponto
code_block_7 = CodeBlock { ["Selecione o segundo ponto"]; }
code_block_8 = CodeBlock { ["Pressione ESC para finalizar"]; }
if_2 = If(test=passThrough_2, true=code_block_7, false=code_block_8)
fromList_2 = Python(IN[0]=if_2)  # "String.FromList"; IronPython2; same code as fromList
window_prompt_with_text_2 = Python(IN[0]=fromList_2)  # IronPython2
# ---------- window_prompt_with_text_2.python (32 lines) ----------
# Importando as bibliotecas necessárias da API do Revit
import clr
clr.AddReference('RevitServices')  # Referência aos serviços do Revit
from RevitServices.Persistence import DocumentManager

clr.AddReference('RevitAPI')  # Referência à API do Revit
clr.AddReference('RevitAPIUI')  # Referência à API de Interface de Usuário do Revit

from Autodesk.Revit.UI import TaskDialog, TaskDialogCommonButtons, TaskDialogResult

# Recebe o texto de instrução como entrada do nó
instrucoes = IN[0]

# Verifica se a entrada é "Cancelar"
if instrucoes.lower() == "Pressione ESC para finalizar":
    OUT = False
else:
    # Criando o TaskDialog
    dialog = TaskDialog("Aviso")
    dialog.MainInstruction = instrucoes
    dialog.CommonButtons = TaskDialogCommonButtons.Ok | TaskDialogCommonButtons.Cancel

    # Exibindo o dialog para o usuário e capturando a resposta
    resultado = dialog.Show()

    # Interpretando a resposta
    if resultado == TaskDialogResult.Ok:
        OUT = False
    elif resultado == TaskDialogResult.Cancel:
        OUT = False
    else:
        OUT = None
# ----------------------------------------
list_create_3 = List.Create(item0=list_create_2)
flatten_2 = List.Flatten(list=list_create_3)
boolean_5 = BoolSelector(true)
ʳʰʸᵗʰᵐ_selection_pick_2 = Rhythm.Revit.Selection.Selection.Pick(runIt=window_prompt_with_text_2, category=flatten_2, singleSelection=boolean_5)

getLocation_2 = Element.GetLocation(element=ʳʰʸᵗʰᵐ_selection_pick_2)

# group: Location
# Descrição <Clique duas vezes aqui para editar a descrição do grupo>
X = Point.X(point=getLocation)
X_2 = Point.X(point=getLocation_2)
eq = X == X_2
Y = Point.Y(point=getLocation)
Y_2 = Point.Y(point=getLocation_2)
eq_2 = Y == Y_2
boolean_6 = BoolSelector(true)
boolean_7 = BoolSelector(false)
condição_if_de_lista = CodeBlock(test1=eq, test2=eq_2, verd=boolean_6, fals=boolean_7)
# ---------- condição_if_de_lista.designscript (3 lines) ----------
//Condições IF
indx = (test1) && (test2) ? 0 : 1;
rslt = [verd,fals][indx];
# ----------------------------------------

# group: Condição de altura
# Descrição <Clique duas vezes aqui para editar a descrição do grupo>
code_block_9 = CodeBlock { "Elevação do Ponto"; }
getParameterValueByName = Element.GetParameterValueByName(element=ʳʰʸᵗʰᵐ_selection_pick, parameterName=code_block_9)
getParameterValueByName_2 = Element.GetParameterValueByName(element=ʳʰʸᵗʰᵐ_selection_pick_2, parameterName=code_block_9)
eq_3 = getParameterValueByName == getParameterValueByName_2

passThrough_3 = Custom[PassThrough](passThrough=ʳʰʸᵗʰᵐ_selection_pick, waitFor=ʳʰʸᵗʰᵐ_selection_pick_2)
mep_connector_info = Custom[MEP Connector info+](element=passThrough_3)  # package MEPover; This node will return the connectors and a lot of information about those connectors of the input elements
isNull = Object.IsNull(object=mep_connector_info.Radius)
filterByBoolMask = List.FilterByBoolMask(list=mep_connector_info.Connectors, mask=isNull)
location = MEP.Connectors.Location(connector=filterByBoolMask.out)
Z = Point.Z(point=location)
sortByKey = List.SortByKey(list=filterByBoolMask.out, keys=Z)
isConnected = MEP.Connectors.IsConnected(connector=sortByKey.sortedList)
filterByBoolMask_2 = List.FilterByBoolMask(list=sortByKey.sortedList, mask=isConnected)
direction = Custom[Connector.Direction](connector=filterByBoolMask_2.out)  # package MEPover; Returns the direction of the CoordinateSystem of the Connector
Z_2 = Vector.Z(vector=direction)
number_3 = DoubleInput(0)
eq_4 = Z_2 == number_3
filterByBoolMask_3 = List.FilterByBoolMask(list=filterByBoolMask_2.out, mask=eq_4)
condição_if_de_lista_aninhada = CodeBlock(test=condição_if_de_lista.rslt, x=getParameterValueByName, y=getParameterValueByName_2, cond1=filterByBoolMask_3.out, cond2=filterByBoolMask_3.in, cond3=filterByBoolMask.out) { indx = (test) ? 0 : (x > y) ? 0 : (x == y) ? 1 : 2; resultado = [cond1, cond2, cond3][indx]; }
direction_2 = Custom[Connector.Direction](connector=condição_if_de_lista_aninhada.resultado)
location_2 = MEP.Connectors.Location(connector=condição_if_de_lista_aninhada.resultado)
boundingBox = Element.BoundingBox(element=ʳʰʸᵗʰᵐ_selection_pick_2)
center = RevitModel.BoundingBox.Center(boundingBox=boundingBox)
byTwoPoints = Vector.ByTwoPoints(start=location_2, end=center)
dot = Vector.Dot(vector=direction_2, vec=byTwoPoints)
maximumItem = List.MaximumItem(list=dot)
indexOf = List.IndexOf(list=dot, element=maximumItem)

# group: A
getItemAtIndex = List.GetItemAtIndex(list=condição_if_de_lista_aninhada.resultado, index=indexOf)
location_3 = MEP.Connectors.Location(connector=getItemAtIndex)

getItemAtIndex_2 = List.GetItemAtIndex(list=direction_2, index=indexOf)
number_4 = DoubleInput(5)
byStartPointDirectionLength = Line.ByStartPointDirectionLength(startPoint=location_3, direction=getItemAtIndex_2, length=number_4)
mep_connector_info_2 = Custom[MEP Connector info+](element=ʳʰʸᵗʰᵐ_selection_pick_2)
isNull_2 = Object.IsNull(object=mep_connector_info_2.Radius)
filterByBoolMask_4 = List.FilterByBoolMask(list=mep_connector_info_2.Connectors, mask=isNull_2)
location_4 = MEP.Connectors.Location(connector=filterByBoolMask_4.out)
Z_3 = Point.Z(point=location_4)
sortByKey_2 = List.SortByKey(list=filterByBoolMask_4.out, keys=Z_3)
isConnected_2 = MEP.Connectors.IsConnected(connector=sortByKey_2.sortedList)
filterByBoolMask_5 = List.FilterByBoolMask(list=sortByKey_2.sortedList, mask=isConnected_2)
direction_3 = Custom[Connector.Direction](connector=filterByBoolMask_5.out)
Z_4 = Vector.Z(vector=direction_3)
number_5 = DoubleInput(0)
eq_5 = Z_4 == number_5
filterByBoolMask_6 = List.FilterByBoolMask(list=filterByBoolMask_5.out, mask=eq_5)
condição_if_de_lista_aninhada_2 = CodeBlock(test=condição_if_de_lista.rslt, x=getParameterValueByName, y=getParameterValueByName_2, cond1=filterByBoolMask_6.in, cond2=filterByBoolMask_5.out, cond3=filterByBoolMask_6.out) { indx = (test) ? 2 : (x > y) ? 0 : (x == y) ? 1 : 2; resultado = [cond1, cond2, cond3][indx]; }
direction_4 = Custom[Connector.Direction](connector=condição_if_de_lista_aninhada_2.resultado)
location_5 = MEP.Connectors.Location(connector=condição_if_de_lista_aninhada_2.resultado)
boundingBox_2 = Element.BoundingBox(element=ʳʰʸᵗʰᵐ_selection_pick)
center_2 = RevitModel.BoundingBox.Center(boundingBox=boundingBox_2)
byTwoPoints_2 = Vector.ByTwoPoints(start=location_5, end=center_2)
dot_2 = Vector.Dot(vector=direction_4, vec=byTwoPoints_2)
maximumItem_2 = List.MaximumItem(list=dot_2)
indexOf_2 = List.IndexOf(list=dot_2, element=maximumItem_2)

# group: C
getItemAtIndex_3 = List.GetItemAtIndex(list=condição_if_de_lista_aninhada_2.resultado, index=indexOf_2)
location_6 = MEP.Connectors.Location(connector=getItemAtIndex_3)

getItemAtIndex_4 = List.GetItemAtIndex(list=direction_4, index=indexOf_2)
byStartPointDirectionLength_2 = Line.ByStartPointDirectionLength(startPoint=location_6, direction=getItemAtIndex_4, length=number_4)
intersect = Geometry.Intersect(geometry=byStartPointDirectionLength, other=byStartPointDirectionLength_2, lacing=Longest)

# group: B
flatten_3 = List.Flatten(list=intersect)

type = Object.Type(object=flatten_3)
boolean_8 = BoolSelector(true)
boolean_9 = BoolSelector(false)
empty_list_verificação = CodeBlock(objType=type, test=eq_3, Verd=boolean_8, Fals=boolean_9)
# ---------- empty_list_verificação.designscript (3 lines) ----------
objTypeChecked = objType == null || DSCore.List.IsEmpty(objType) ? [] : objType;
indx = ((test && objType[0] == "Autodesk.DesignScript.Geometry.Line") || objTypeChecked[0] == "Empty") ? 0 : 1;
rslt = [Verd, Fals][indx];
# ----------------------------------------
boolean_10 = BoolSelector(true)
boolean_11 = BoolSelector(false)
empty_list_verificação_2 = CodeBlock(objType=type, test2=condição_if_de_lista.rslt, test=eq_3, Verd=boolean_10, Fals=boolean_11)
# ---------- empty_list_verificação_2.designscript (3 lines) ----------
objTypeChecked = objType == null || DSCore.List.IsEmpty(objType) ? [] : objType;
indx = (test2) || ((test && objType[0] == "Autodesk.DesignScript.Geometry.Line") || objTypeChecked[0] == "Empty") ? 0 : 1;
rslt = [Verd, Fals][indx];
# ----------------------------------------

# group: 2
byStartPointEndPoint = Line.ByStartPointEndPoint(startPoint=location_3, endPoint=location_6)

intersection = Geometry.Curves.Intersection(curve1=byStartPointDirectionLength, curve2=byStartPointDirectionLength_2)
X_3 = Point.X(point=intersection)
Y_3 = Point.Y(point=intersection)
Z_5 = Point.Z(point=location_6)
byCoordinates = Point.ByCoordinates(x=X_3, y=Y_3, z=Z_5)
empty_list_verificação_3 = CodeBlock(test=eq_3, a=flatten_3, Verd=byCoordinates, Fals=flatten_3) { indx = (test) && DSCore.List.IsEmpty(a) ? 0 : 1; rslt = [Verd,Fals][indx]; }

# group: 1
byStartPointEndPoint_2 = Line.ByStartPointEndPoint(startPoint=location_3, endPoint=empty_list_verificação_3.rslt)

# group: 2
byStartPointEndPoint_3 = Line.ByStartPointEndPoint(startPoint=empty_list_verificação_3.rslt, endPoint=location_6)

join = List.Join(list0=byStartPointEndPoint_2, list1=byStartPointEndPoint_3)
condição_if_de_lista_2 = CodeBlock(test=[empty_list_verificação_2.rslt, empty_list_verificação_2.rslt], verd=byStartPointEndPoint, fals=join)
# ---------- condição_if_de_lista_2.designscript (3 lines) ----------
//Condições IF
indx = (test) ? 0 : 1;
rslt = [verd,fals][indx];
# ----------------------------------------

# group: Separar Entradas
code_block_10 = CodeBlock { 0; }
getItemAtIndex_5 = List.GetItemAtIndex(list=multipleinputform.User_Inputs, index=code_block_10)
code_block_11 = CodeBlock { 1; }
getItemAtIndex_6 = List.GetItemAtIndex(list=multipleinputform.User_Inputs, index=code_block_11)

# group: Criar eletrodutos
code_block_12 = CodeBlock { []; }
element_level = Custom[Element Level](element=ʳʰʸᵗʰᵐ_selection_pick_2)  # package Genius Loci; Gets an element's level. Based on a Clockwork's node
conduit_bylines = Custom[👓 Conduit․ByLines](lines=condição_if_de_lista_2.rslt, conduitType=getItemAtIndex_5@L1, levels=element_level@L1, Diameter=getItemAtIndex_6)  # package BIMCoder Nodes - 2.X; Modela conduítes (Conduit) com base em linhas (que devem ser geometrias)
flatten_4 = List.Flatten(list=conduit_bylines@L3, lacing=Longest)
condição_if_de_lista_3 = CodeBlock(test=empty_list_verificação.rslt, verd=code_block_12, fals=flatten_4)
# ---------- condição_if_de_lista_3.designscript (3 lines) ----------
//Condições IF
indx = (test) ? 0 : 1;
rslt = [List.Flatten((verd), -1),List.Flatten((fals), -1)][indx];
# ----------------------------------------
placefittings = Custom[👓 PlaceFittings](elements=condição_if_de_lista_3.rslt@L2, lacing=Longest)  # package BIMCoder Nodes - 2.X; Modela conexões (fittings) entre curvas MEP (eletrodutos, bandejas de cabos, tubulações e dutos).
firstItem = List.FirstItem(list=flatten_4, lacing=Longest)
lastItem = List.LastItem(list=flatten_4, lacing=Longest)

end_2 = Revit.Transaction.Transaction.End(input=placefittings)
start_2 = Revit.Transaction.Transaction.Start(input=end_2)

# group: Conduites desconectados
code_block_13 = CodeBlock(waithFor=start_2, Pass=firstItem) { [waithFor,Pass][1]; }
connectors = RevitModel.Element.Connectors(elements=code_block_13)
isConnected_3 = MEP.Connectors.IsConnected(connector=connectors)
filterByBoolMask_7 = List.FilterByBoolMask(list=connectors, mask=isConnected_3, lacing=Longest)
flatten_5 = List.Flatten(list=filterByBoolMask_7.out)

connectTo = Custom[Connector.ConnectTo](connector=getItemAtIndex, Connector2=flatten_5)  # package MEPover; Connects a connector to another connector. Returns True if connection succeeded

# group: Conduites desconectados
code_block_14 = CodeBlock(waithFor=start_2, Pass=lastItem) { [waithFor,Pass][1]; }
connectors_2 = RevitModel.Element.Connectors(elements=code_block_14)
isConnected_4 = MEP.Connectors.IsConnected(connector=connectors_2)
filterByBoolMask_8 = List.FilterByBoolMask(list=connectors_2, mask=isConnected_4, lacing=Longest)
flatten_6 = List.Flatten(list=filterByBoolMask_8.out)

connectTo_2 = Custom[Connector.ConnectTo](connector=getItemAtIndex_3, Connector2=flatten_6, lacing=Longest)
minPoint = BoundingBox.MinPoint(boundingBox=boundingBox_2)
minPoint_2 = BoundingBox.MinPoint(boundingBox=boundingBox)
