# Dynamo graph 18-1_BIMACON_Conduítes ParedexTeto_R05_script.dyn "ok 2021_18-1_BIMACON_Conduítes ParedexTeto_R05_script" (Dynamo 2.19.3.6394)
# author: Jose Nelson
# Cria eletrodutos entre pontos da parede com teto
# packages: Genius Loci 2023.2.21, DynaMEP 2.0.1, MEPover 2022.10.30, archi-lab.net 2023.213.1722, Rhythm 2023.4.2021, Data-Shapes 2022.2.105, BIMCoder Nodes - 2.X 2025.1.0

# group: ENTRADAS PARA O USUÁRIO
code_block = CodeBlock { "Eletrodutos Parede x Teto"; }
string = StringInput("LogoBimacon.png")
python_script = Python(IN[0]=string)  # IronPython2
# ---------- python_script.python (22 lines) ----------
import clr

# Adiciona referência ao ambiente .NET
clr.AddReference('System')
from System import Environment, IO

# Nome da imagem (entrada do usuário)
nome_arquivo_imagem = IN[0]

# Recupera o nome do usuário logado no Windows
usuario = Environment.UserName

# Monta o caminho completo para a pasta de imagens
caminho_base = r"C:\Users\{0}\AppData\Roaming\pyRevit\Extensions\Bimacon.extension\Bimacon.tab\Imagens_Bimacon".format(usuario)

# Junta o caminho base com o nome do arquivo
caminho_completo = IO.Path.Combine(caminho_base, nome_arquivo_imagem)

# Verifica se o arquivo existe
existe = IO.File.Exists(caminho_completo)

OUT = caminho_completo if existe else "Imagem não encontrada: {0}".format(caminho_completo)
# ----------------------------------------
file_from_path = FileObject(path=python_script)
readFromFile = Image.ReadFromFile(file=file_from_path)
string_2 = StringInput("Confirmar")
string_3 = StringInput("Eletroduto Reforçado na Laje?")
boolean = BoolSelector(true)
string_4 = StringInput("Sim")
boolean_input = Custom[Boolean input](InputName=string_3, DefaultValue=boolean, SideText=string_4)  # package Data-Shapes; Creates a boolean input for UI.MultipleInputForm ++ . Check out www.data-shapes.net for more infos!
string_5 = StringInput("Diâmetro conduíte (mm)")
string_6 = StringInput("25")
boolean_2 = BoolSelector(true)
textbox_data = Custom[TextBox Data](InputName=string_5, DefaultText=string_6, IsNumberEntry=boolean_2)  # package Data-Shapes; Create Data for TextBox input in UI.MultipleInputForm ++ . Check out www.data-shapes.net for more informations
string_7 = StringInput("Com Luva?")
boolean_3 = BoolSelector(true)
string_8 = StringInput("Sim")
boolean_input_2 = Custom[Boolean input](InputName=string_7, DefaultValue=boolean_3, SideText=string_8)
string_9 = StringInput("Altura da Luva (m)")
string_10 = StringInput("2.6")
boolean_4 = BoolSelector(true)
textbox_data_2 = Custom[TextBox Data](InputName=string_9, DefaultText=string_10, IsNumberEntry=boolean_4)
list_create = List.Create(item0=boolean_input, item1=textbox_data, item2=boolean_input_2, item3=textbox_data_2)
boolean_5 = BoolSelector(true)
string_11 = StringInput("Cancelar")
number = DoubleInput(300)
number_2 = DoubleInput(200)
multipleinputform = Custom[MultipleInputForm ++](Description_optional=code_block, Logo_optional=readFromFile, ButtonText_optional=string_2, Inputs=list_create, Toggle=boolean_5, CancelButtonText_optional=string_11, Width_optional=number, LabelWidth_optional=number_2)  # package Data-Shapes; Create a form with multiple inputs. see www.data-shapes.net for tutorials and infos!
code_block_2 = CodeBlock()  # //archilab
code_block_3 = CodeBlock()  # //Data-Shapes

# group: Separar Entradas
code_block_4 = CodeBlock { 2; }
getItemAtIndex = List.GetItemAtIndex(list=multipleinputform.User_Inputs, index=code_block_4)
code_block_5 = CodeBlock { 3; }
getItemAtIndex_2 = List.GetItemAtIndex(list=multipleinputform.User_Inputs, index=code_block_5)
code_block_6 = CodeBlock { 0; }
getItemAtIndex_3 = List.GetItemAtIndex(list=multipleinputform.User_Inputs, index=code_block_6)
code_block_7 = CodeBlock { 1; }
getItemAtIndex_4 = List.GetItemAtIndex(list=multipleinputform.User_Inputs, index=code_block_7)

end = Revit.Transaction.Transaction.End(input=multipleinputform.Was_Cancelled)
start = Revit.Transaction.Transaction.Start(input=end)
passThrough = Custom[PassThrough](passThrough=start, waitFor=end)  # package archi-lab.net; Ripped this off from Clockwork. Sorry Andy.

# group: Selecionar ponto na parede
code_block_8 = CodeBlock { ["Pressione ESC para finalizar"]; }
code_block_9 = CodeBlock { ["Selecione os pontos na Parede e aperte ESC para Concluir"]; }
if_ = If(test=passThrough, true=code_block_8, false=code_block_9)
fromList = Python(IN[0]=if_)  # "String.FromList"; IronPython2
# ---------- fromList.python (22 lines) ----------
# Carregar as bibliotecas DesignScript e padrão do Python
import sys
import clr
clr.AddReference('ProtoGeometry')
from Autodesk.DesignScript.Geometry import *

# Função para concatenar os valores de uma lista em uma única string com múltiplas linhas
def concatenate_list_to_string(input_list, delimiter="\n"):
    # Verifica se a entrada é uma lista
    if not isinstance(input_list, list):
        return "A entrada deve ser uma lista."
    
    # Converte todos os elementos para string e junta com o delimitador especificado
    result = delimiter.join(str(item) for item in input_list)
    return result

# Entrada pelo nó do Dynamo
lista = IN[0]  # Lista de valores a serem concatenados
delimitador = IN[1] if len(IN) > 1 else "\n"  # Delimitador opcional, padrão é nova linha

# Saída para o Dynamo
OUT = concatenate_list_to_string(lista, delimitador)
# ----------------------------------------
window_prompt_with_text = Python(IN[0]=fromList)  # IronPython2
# ---------- window_prompt_with_text.python (32 lines) ----------
# Importando as bibliotecas necessárias da API do Revit
import clr
clr.AddReference('RevitServices')  # Referência aos serviços do Revit
from RevitServices.Persistence import DocumentManager

clr.AddReference('RevitAPI')  # Referência à API do Revit
clr.AddReference('RevitAPIUI')  # Referência à API de Interface de Usuário do Revit

from Autodesk.Revit.UI import TaskDialog, TaskDialogCommonButtons, TaskDialogResult

# Recebe o texto de instrução como entrada do nó
instrucoes = IN[0]

# Verifica se a entrada é "Cancelar"
if instrucoes.lower() == "Pressione ESC para finalizar":
    OUT = False
else:
    # Criando o TaskDialog
    dialog = TaskDialog("Aviso")
    dialog.MainInstruction = instrucoes
    dialog.CommonButtons = TaskDialogCommonButtons.Ok | TaskDialogCommonButtons.Cancel

    # Exibindo o dialog para o usuário e capturando a resposta
    resultado = dialog.Show()

    # Interpretando a resposta
    if resultado == TaskDialogResult.Ok:
        OUT = True
    elif resultado == TaskDialogResult.Cancel:
        OUT = False
    else:
        OUT = None
# ----------------------------------------
categories = Categories("OST_LightingDevices")
categories_2 = Categories("OST_CommunicationDevices")
categories_3 = Categories("OST_DataDevices")
categories_4 = Categories("OST_TelephoneDevices")
categories_5 = Categories("OST_ElectricalFixtures")
categories_6 = Categories("OST_ElectricalEquipment")
categories_7 = Categories("OST_LightingFixtures")
categories_8 = Categories("OST_ConduitFitting")
categories_9 = Categories("OST_MechanicalEquipment")
list_create_2 = List.Create(item0=categories, item1=categories_2, item2=categories_3, item3=categories_4, item4=categories_5, item5=categories_6, item6=categories_7, item7=categories_8, item8=categories_9)
flatten = List.Flatten(list=list_create_2)
boolean_6 = BoolSelector(false)
boolean_7 = BoolSelector(true)

ʳʰʸᵗʰᵐ_selection_pick = Rhythm.Revit.Selection.Selection.Pick(runIt=window_prompt_with_text, category=flatten, singleSelection=boolean_6, ordered=boolean_7)
passThrough_2 = Custom[PassThrough](passThrough=window_prompt_with_text, waitFor=ʳʰʸᵗʰᵐ_selection_pick)

# group: Selecionar ponto no Teto
code_block_10 = CodeBlock { ["Selecione o ponto no teto"]; }
code_block_11 = CodeBlock { ["Pressione ESC para finalizar"]; }
if_2 = If(test=passThrough_2, true=code_block_10, false=code_block_11)
fromList_2 = Python(IN[0]=if_2)  # "String.FromList"; IronPython2; same code as fromList
window_prompt_with_text_2 = Python(IN[0]=fromList_2)  # IronPython2
# ---------- window_prompt_with_text_2.python (32 lines) ----------
# Importando as bibliotecas necessárias da API do Revit
import clr
clr.AddReference('RevitServices')  # Referência aos serviços do Revit
from RevitServices.Persistence import DocumentManager

clr.AddReference('RevitAPI')  # Referência à API do Revit
clr.AddReference('RevitAPIUI')  # Referência à API de Interface de Usuário do Revit

from Autodesk.Revit.UI import TaskDialog, TaskDialogCommonButtons, TaskDialogResult

# Recebe o texto de instrução como entrada do nó
instrucoes = IN[0]

# Verifica se a entrada é "Cancelar"
if instrucoes.lower() == "Pressione ESC para finalizar":
    OUT = False
else:
    # Criando o TaskDialog
    dialog = TaskDialog("Aviso")
    dialog.MainInstruction = instrucoes
    dialog.CommonButtons = TaskDialogCommonButtons.Ok | TaskDialogCommonButtons.Cancel

    # Exibindo o dialog para o usuário e capturando a resposta
    resultado = dialog.Show()

    # Interpretando a resposta
    if resultado == TaskDialogResult.Ok:
        OUT = False
    elif resultado == TaskDialogResult.Cancel:
        OUT = False
    else:
        OUT = None
# ----------------------------------------
categories_10 = Categories("OST_LightingFixtures")
categories_11 = Categories("OST_ConduitFitting")
list_create_3 = List.Create(item0=categories_10, item1=categories_11)
flatten_2 = List.Flatten(list=list_create_3)
boolean_8 = BoolSelector(true)
ʳʰʸᵗʰᵐ_selection_pick_2 = Rhythm.Revit.Selection.Selection.Pick(runIt=window_prompt_with_text_2, category=flatten_2, singleSelection=boolean_8)

passThrough_3 = Custom[PassThrough](passThrough=ʳʰʸᵗʰᵐ_selection_pick, waitFor=ʳʰʸᵗʰᵐ_selection_pick_2)

# group: Linhas do conduite
mep_connector_info = Custom[MEP Connector info+](element=passThrough_3)  # package MEPover; This node will return the connectors and a lot of information about those connectors of the input elements
string_12 = StringInput("Superior")
contains = String.Contains(string=mep_connector_info.Description, searchFor=string_12)
filterByBoolMask = List.FilterByBoolMask(list=mep_connector_info.Connectors, mask=contains)
location = MEP.Connectors.Location(connector=filterByBoolMask.in)
isConnected = MEP.Connectors.IsConnected(connector=filterByBoolMask.in)
filterByBoolMask_2 = List.FilterByBoolMask(list=location, mask=isConnected)
Z = Point.Z(point=filterByBoolMask_2.out)
sortByKey = List.SortByKey(list=filterByBoolMask_2.out, keys=Z, lacing=Longest)
mep_connector_info_2 = Custom[MEP Connector info+](element=ʳʰʸᵗʰᵐ_selection_pick_2)
sortByKey_2 = List.SortByKey(list=mep_connector_info_2.Connectors, keys=mep_connector_info_2.Description)
isConnected_2 = MEP.Connectors.IsConnected(connector=mep_connector_info_2.Connectors)
filterByBoolMask_3 = List.FilterByBoolMask(list=sortByKey_2.sortedList, mask=isConnected_2)
location_2 = MEP.Connectors.Location(connector=filterByBoolMask_3.out)
flatten_3 = List.Flatten(list=location_2)
number_3 = DoubleInput(0.13)

# group: Linhas do conduite > A
lastItem = List.LastItem(list=sortByKey.sortedList, lacing=Longest)

# group (continued): Linhas do conduite
distanceTo = Geometry.DistanceTo(geometry=lastItem, other=flatten_3, lacing=CrossProduct)
sort = List.Sort(list=distanceTo)
indexOf = List.IndexOf(list=distanceTo, element=sort, lacing=Longest)
python_script_2 = Python(IN[0]=indexOf)  # IronPython2
# ---------- python_script_2.python (21 lines) ----------
import clr
clr.AddReference('ProtoGeometry')
from Autodesk.DesignScript.Geometry import *

# Entrada do Dynamo (listas aninhadas no nível 2)
listas_ordenadas = IN[0]  # Exemplo: [[4, 4, 6, 8, 6], [1, 6, 7, 7, 7], [6, 1, 4, 5, 4], [2, 7, 8, 6, 8], [7, 2, 1, 3, 1]]

# Lista para armazenar os números selecionados
resultado_final = []
usados = set()  # Conjunto para rastrear os números já utilizados

# Iterar sobre cada lista individualmente (nível 2)
for lista in listas_ordenadas:
    for item in lista:
        if item not in usados:  # Se o número ainda não foi usado
            resultado_final.append(item)
            usados.add(item)  # Marca como usado
            break  # Sai do loop e passa para a próxima lista

# Saída do Dynamo
OUT = resultado_final
# ----------------------------------------
X = Point.X(point=lastItem)
Y = Point.Y(point=lastItem)
eq = location == lastItem
filterByBoolMask_4 = List.FilterByBoolMask(list=filterByBoolMask.in, mask=eq)

# group: Linhas do conduite > E
getItemAtIndex_5 = List.GetItemAtIndex(list=filterByBoolMask_3.out, index=python_script_2)
location_3 = MEP.Connectors.Location(connector=getItemAtIndex_5)

# group: Linhas do conduite > Location
# Descrição <Clique duas vezes aqui para editar a descrição do grupo>
X_2 = Point.X(point=lastItem)
X_3 = Point.X(point=location_3)
code_block_12 = CodeBlock { 0.05; }
eq_2 = Equals(x=X_2, y=X_3, tolerance=code_block_12)
Y_2 = Point.Y(point=lastItem)
Y_3 = Point.Y(point=location_3)
eq_3 = Equals(x=Y_2, y=Y_3, tolerance=code_block_12)
boolean_9 = BoolSelector(true)
boolean_10 = BoolSelector(false)
condição_if_de_lista = CodeBlock(test1=eq_2, test2=eq_3, verd=boolean_9, fals=boolean_10)
# ---------- condição_if_de_lista.designscript (3 lines) ----------
//Condições IF
indx = (test1) || (test2) ? 0 : 1;
rslt = [verd,fals][indx];
# ----------------------------------------

getLocation = Element.GetLocation(element=ʳʰʸᵗʰᵐ_selection_pick_2)
Z_2 = Point.Z(point=getLocation)
add = Z_2 + getItemAtIndex_2

# group: Linhas do conduite > B
byCoordinates = Point.ByCoordinates(x=X, y=Y, z=add)

# group (continued): Linhas do conduite
Z_3 = Point.Z(point=location_3)
direction = Custom[Connector.Direction](connector=getItemAtIndex_5)  # package MEPover; Returns the direction of the CoordinateSystem of the Connector

# group: Linhas do conduite > C
byCoordinates_2 = Point.ByCoordinates(x=X, y=Y, z=Z_3)

# group: 2
byStartPointEndPoint = Line.ByStartPointEndPoint(startPoint=byCoordinates, endPoint=byCoordinates_2)

# group: 6
byStartPointEndPoint_2 = Line.ByStartPointEndPoint(startPoint=byCoordinates_2, endPoint=location_3)

# group: 2+6
list_create_4 = List.Create(item0=byStartPointEndPoint, item1=byStartPointEndPoint_2)

transpose = List.Transpose(lists=list_create_4)

# group: Linhas do conduite > D
translate = Geometry.Translate(geometry=location_3, direction=direction, distance=number_3)

# group: 3
byStartPointEndPoint_3 = Line.ByStartPointEndPoint(startPoint=byCoordinates_2, endPoint=translate)

# group: 4
byStartPointEndPoint_4 = Line.ByStartPointEndPoint(startPoint=translate, endPoint=location_3)

# group: 2+(3+4)
list_create_5 = List.Create(item0=byStartPointEndPoint, item1=byStartPointEndPoint_3, item2=byStartPointEndPoint_4)

transpose_2 = List.Transpose(lists=list_create_5)

# group: Alinhamento
condição_if_de_lista_2 = CodeBlock(test=condição_if_de_lista.rslt, verd=transpose, fals=transpose_2)
# ---------- condição_if_de_lista_2.designscript (3 lines) ----------
//Condições IF
indx = (test) ? 0 : 1;
rslt = [verd,fals][indx];
# ----------------------------------------

python_script_3 = Python(IN[0]=condição_if_de_lista_2.rslt)  # IronPython2
# ---------- python_script_3.python (23 lines) ----------
import clr
clr.AddReference('ProtoGeometry')
from Autodesk.DesignScript.Geometry import *

# Entrada de listas
listas = IN[0]  # Lista de listas

# Determina o número de listas
num_listas = len(listas)

# Cria uma nova lista para armazenar os resultados
nova_lista = []

# Percorre os índices respeitando o padrão desejado
for i in range(len(listas[0])):  # Baseia-se no tamanho da primeira lista
    grupo = []
    for j in range(num_listas):
        if i+j < len(listas[j]):  # Evita erro caso a lista seja menor
            grupo.append(listas[j][i+j])  
    nova_lista.append(grupo)

# Saída do script
OUT = nova_lista
# ----------------------------------------
firstItem = List.FirstItem(list=python_script_3)

# group: 3+4
list_create_6 = List.Create(item0=byStartPointEndPoint_3, item1=byStartPointEndPoint_4)

transpose_3 = List.Transpose(lists=list_create_6)

# group: Luva?
condição_if_de_lista_3 = CodeBlock(test=getItemAtIndex, verd=firstItem, fals=transpose_3)  # same code as condição_if_de_lista_2

# group: Tipo Eletroduto
# Descrição <Clique duas vezes aqui para editar a descrição do grupo>
element_classes = ElementTypes("ConduitType")
all_elements_of_class = ElementsOfType(element_class=element_classes)
name = Element.Name(element=all_elements_of_class)
string_13 = StringInput("Laranja")
contains_2 = String.Contains(string=name, searchFor=string_13)
filterByBoolMask_5 = List.FilterByBoolMask(list=all_elements_of_class, mask=contains_2)
flatten_4 = List.Flatten(list=filterByBoolMask_5.in)
string_14 = StringInput("Amarelo")
contains_3 = String.Contains(string=name, searchFor=string_14)
filterByBoolMask_6 = List.FilterByBoolMask(list=all_elements_of_class, mask=contains_3)
flatten_5 = List.Flatten(list=filterByBoolMask_6.in)

# group: Reforçado?
condição_if_de_lista_4 = CodeBlock(test=getItemAtIndex_3, verd=flatten_4, fals=flatten_5)  # same code as condição_if_de_lista_2

# group: Criar eletrodutos
element_level = Custom[Element Level](element=ʳʰʸᵗʰᵐ_selection_pick_2)  # package Genius Loci; Gets an element's level. Based on a Clockwork's node
conduit_bylines = Custom[👓 Conduit․ByLines](lines=condição_if_de_lista_3.rslt, conduitType=condição_if_de_lista_4.rslt@L1, levels=element_level@L1, Diameter=getItemAtIndex_4)  # package BIMCoder Nodes - 2.X; Modela conduítes (Conduit) com base em linhas (que devem ser geometrias)
flatten_6 = List.Flatten(list=conduit_bylines@L3, lacing=Longest)
placefittings = Custom[👓 PlaceFittings](elements=flatten_6@L2, lacing=Longest)  # package BIMCoder Nodes - 2.X; Modela conexões (fittings) entre curvas MEP (eletrodutos, bandejas de cabos, tubulações e dutos).
lastItem_2 = List.LastItem(list=flatten_6, lacing=Longest)
firstItem_2 = List.FirstItem(list=flatten_6, lacing=Longest)

# group: 1
byStartPointEndPoint_5 = Line.ByStartPointEndPoint(startPoint=lastItem, endPoint=byCoordinates)

transpose_4 = List.Transpose(lists=byStartPointEndPoint_5@L1)

# group: 5
byStartPointEndPoint_6 = Line.ByStartPointEndPoint(startPoint=lastItem, endPoint=byCoordinates_2)

transpose_5 = List.Transpose(lists=byStartPointEndPoint_6@L1)

# group: Luva?
condição_if_de_lista_5 = CodeBlock(test=getItemAtIndex, verd=transpose_4, fals=transpose_5)  # same code as condição_if_de_lista_2

conduit_bylines_2 = Custom[👓 Conduit․ByLines](lines=condição_if_de_lista_5.rslt@L2, conduitType=flatten_5, levels=element_level, Diameter=getItemAtIndex_4)
flatten_7 = List.Flatten(list=conduit_bylines_2)

# group: Conduites desconectados
code_block_13 = CodeBlock(waithFor=placefittings, Pass=flatten_7) { [waithFor,Pass][1]; }
connectors = RevitModel.Element.Connectors(elements=code_block_13)
isConnected_3 = MEP.Connectors.IsConnected(connector=connectors)
filterByBoolMask_7 = List.FilterByBoolMask(list=connectors, mask=isConnected_3, lacing=Longest)
flatten_8 = List.Flatten(list=filterByBoolMask_7.out)

connectTo = Custom[Connector.ConnectTo](connector=filterByBoolMask_4.in, Connector2=filterByBoolMask_7.out)  # package MEPover; Connects a connector to another connector. Returns True if connection succeeded
end_2 = Revit.Transaction.Transaction.End(input=placefittings)
start_2 = Revit.Transaction.Transaction.Start(input=end_2)

# group: Conduites desconectados
code_block_14 = CodeBlock(waithFor=start_2, Pass=lastItem_2) { [waithFor,Pass][1]; }
connectors_2 = RevitModel.Element.Connectors(elements=code_block_14)
isConnected_4 = MEP.Connectors.IsConnected(connector=connectors_2)
filterByBoolMask_8 = List.FilterByBoolMask(list=connectors_2, mask=isConnected_4, lacing=Longest)
flatten_9 = List.Flatten(list=filterByBoolMask_8.out)

connectTo_2 = Custom[Connector.ConnectTo](connector=getItemAtIndex_5, Connector2=flatten_9)
byMEPCurves = Custom[MEPFitting.ByMEPCurves](MEPCurve1=firstItem_2, MEPCurve2=flatten_7, lacing=Longest)  # package MEPover; Creates a UnionFitting or ElbowFitting by 2 MEPCurves (Ducts, Cable Trays, Pipes or Conduits). The output may not always be all the fittings created as Revit sometimes creates extra transition fittings outside of the node transactions.
