# Dynamo graph ok 2021_18-0_BIMACON_Conduítes ParedexTeto_R00_script.dyn "2021_18-0_BIMACON_Conduítes_R00_script" (Dynamo 2.6.1.8786)
# packages: BIMCoder Nodes - 2.X 2025.1.0, Genius Loci 2023.2.21, Universo_BIM 19.10.11, DynaMEP 2.0.1, MEPover 2022.10.30, archi-lab.net 2023.213.1722, Rhythm 2023.4.2021

# group: Selecionar ponto na parede
boolean = BoolSelector(true)
code_block = CodeBlock { ["Selecione o ponto na Parede"]; }
code_block_2 = CodeBlock { ["Nenhum ponto selecionado"]; }
if_ = If(test=boolean, true=code_block, false=code_block_2)
fromList = Python(IN[0]=if_)  # "String.FromList"
# ---------- fromList.python (22 lines) ----------
# Carregar as bibliotecas DesignScript e padrão do Python
import sys
import clr
clr.AddReference('ProtoGeometry')
from Autodesk.DesignScript.Geometry import *

# Função para concatenar os valores de uma lista em uma única string com múltiplas linhas
def concatenate_list_to_string(input_list, delimiter="\n"):
    # Verifica se a entrada é uma lista
    if not isinstance(input_list, list):
        return "A entrada deve ser uma lista."
    
    # Converte todos os elementos para string e junta com o delimitador especificado
    result = delimiter.join(str(item) for item in input_list)
    return result

# Entrada pelo nó do Dynamo
lista = IN[0]  # Lista de valores a serem concatenados
delimitador = IN[1] if len(IN) > 1 else "\n"  # Delimitador opcional, padrão é nova linha

# Saída para o Dynamo
OUT = concatenate_list_to_string(lista, delimitador)
# ----------------------------------------
window_prompt_with_text = Python(IN[0]=fromList)
# ---------- window_prompt_with_text.python (26 lines) ----------
# Importando as bibliotecas necessárias da API do Revit
import clr
clr.AddReference('RevitServices')  # Referência aos serviços do Revit
from RevitServices.Persistence import DocumentManager

clr.AddReference('RevitAPI')  # Referência à API do Revit
clr.AddReference('RevitAPIUI')  # Referência à API de Interface de Usuário do Revit

from Autodesk.Revit.UI import TaskDialog, TaskDialogCommonButtons, TaskDialogResult

# Recebe o texto de instrução como entrada do nó
instrucoes = IN[0]

# Criando o TaskDialog
dialog = TaskDialog("Aviso")
dialog.MainInstruction = instrucoes
dialog.CommonButtons = TaskDialogCommonButtons.Ok

# Exibindo o dialog para o usuário e capturando a resposta
resultado = dialog.Show()

# Interpretando a resposta
if resultado == TaskDialogCommonButtons.Ok:
    OUT = "Ok"
else:
    OUT = "True"
# ----------------------------------------
passThrough = Custom[PassThrough](passThrough=window_prompt_with_text, waitFor=window_prompt_with_text)  # package archi-lab.net; Ripped this off from Clockwork. Sorry Andy.
categories = Categories("OST_LightingDevices")
categories_2 = Categories("OST_CommunicationDevices")
categories_3 = Categories("OST_DataDevices")
categories_4 = Categories("OST_TelephoneDevices")
categories_5 = Categories("OST_ElectricalFixtures")
list_create = List.Create(item0=categories, item1=categories_2, item2=categories_3, item3=categories_4, item4=categories_5)
flatten = List.Flatten(list=list_create)
boolean_2 = BoolSelector(true)
ʳʰʸᵗʰᵐ_selection_pick = Rhythm.Revit.Selection.Selection.Pick(runIt=passThrough, category=flatten, singleSelection=boolean_2)

passThrough_2 = Custom[PassThrough](passThrough=window_prompt_with_text, waitFor=ʳʰʸᵗʰᵐ_selection_pick)

# group: Selecionar ponto na parede
code_block_3 = CodeBlock { ["Selecione o ponto no teto"]; }
code_block_4 = CodeBlock { ["Nenhum ponto selecionado"]; }
if_2 = If(test=passThrough_2, true=code_block_3, false=code_block_4)
fromList_2 = Python(IN[0]=if_2)  # "String.FromList"; same code as fromList
window_prompt_with_text_2 = Python(IN[0]=fromList_2)  # same code as window_prompt_with_text
passThrough_3 = Custom[PassThrough](passThrough=window_prompt_with_text_2, waitFor=window_prompt_with_text_2)
categories_6 = Categories("OST_LightingFixtures")
categories_7 = Categories("OST_ConduitFitting")
list_create_2 = List.Create(item0=categories_6, item1=categories_7)
flatten_2 = List.Flatten(list=list_create_2)
boolean_3 = BoolSelector(true)
ʳʰʸᵗʰᵐ_selection_pick_2 = Rhythm.Revit.Selection.Selection.Pick(runIt=passThrough_3, category=flatten_2, singleSelection=boolean_3)
boolean_4 = BoolSelector(true)

passThrough_4 = Custom[PassThrough](passThrough=ʳʰʸᵗʰᵐ_selection_pick, waitFor=ʳʰʸᵗʰᵐ_selection_pick_2)

# group: Linha do conduite
mep_connector_info = Custom[MEP Connector info+](element=passThrough_4)  # package MEPover; This node will return the connectors and a lot of information about those connectors of the input elements
string = StringInput("Superior")
contains = String.Contains(str=mep_connector_info.Description, searchFor=string)
filterByBoolMask = List.FilterByBoolMask(list=mep_connector_info.Connectors, mask=contains)
location = MEP.Connectors.Location(connector=filterByBoolMask.in)
isConnected = MEP.Connectors.IsConnected(connector=filterByBoolMask.in)
filterByBoolMask_2 = List.FilterByBoolMask(list=location, mask=isConnected)
flatten_3 = List.Flatten(list=filterByBoolMask_2.out)
getLocation = Element.GetLocation(element=passThrough_4)
mep_connector_info_2 = Custom[MEP Connector info+](element=ʳʰʸᵗʰᵐ_selection_pick_2)
isConnected_2 = MEP.Connectors.IsConnected(connector=mep_connector_info_2.Connectors)
filterByBoolMask_3 = List.FilterByBoolMask(list=mep_connector_info_2.Points, mask=isConnected_2)
flatten_4 = List.Flatten(list=filterByBoolMask_3.out)
closestPointTo = Geometry.Points.ClosestPointTo(point=flatten_3, points=flatten_4)
firstItem = List.FirstItem(list=closestPointTo)
Z = Point.Z(point=firstItem)

ponto_mais_alto_em_z = Python(IN[0]=flatten_3)
# ---------- ponto_mais_alto_em_z.python (13 lines) ----------
# Importa as bibliotecas necessárias
import clr
clr.AddReference('ProtoGeometry')
from Autodesk.DesignScript.Geometry import *

# Recebe a entrada
pontos = IN[0]

# Ordena os pontos por Z e pega o ponto mais alto
pontoMaisAlto = sorted(pontos, key=lambda p: p.Z, reverse=True)[0]

# Saída
OUT = pontoMaisAlto
# ----------------------------------------

# group (continued): Linha do conduite
Z_2 = Point.Z(point=ponto_mais_alto_em_z)
X = Point.X(point=ponto_mais_alto_em_z)
Y = Point.Y(point=ponto_mais_alto_em_z)
byCoordinates = Point.ByCoordinates(x=X, y=Y, z=Z)
byStartPointEndPoint = Line.ByStartPointEndPoint(startPoint=byCoordinates, endPoint=ponto_mais_alto_em_z)
byStartPointEndPoint_2 = Line.ByStartPointEndPoint(startPoint=firstItem, endPoint=byCoordinates)
join = List.Join(list0=byStartPointEndPoint, list1=byStartPointEndPoint_2)

eq = location == ponto_mais_alto_em_z
filterByBoolMask_4 = List.FilterByBoolMask(list=filterByBoolMask.in, mask=eq)

# group: Criar eletrodutos
string_2 = StringInput("PVC Corrugado Amarelo Flexivel")
byName = Elements.ConduitType.ByName(name=string_2)
element_level = Custom[Element Level](element=ʳʰʸᵗʰᵐ_selection_pick_2)  # package Genius Loci; Gets an element's level. Based on a Clockwork's node
number = DoubleInput(0.2)
conduit_bylines = Custom[👓 Conduit․ByLines](lines=join, conduitType=byName, levels=element_level@L1, Diameter=number)  # package BIMCoder Nodes - 2.X; Modela conduítes (Conduit) com base em linhas (que devem ser geometrias)
flatten_5 = List.Flatten(list=conduit_bylines)
firstItem_2 = List.FirstItem(list=flatten_5)
lastItem = List.LastItem(list=flatten_5)
byMEPCurves = Custom[MEPFitting.ByMEPCurves](MEPCurve1=firstItem_2, MEPCurve2=lastItem, lacing=CrossProduct)  # package MEPover; Creates a UnionFitting or ElbowFitting by 2 MEPCurves (Ducts, Cable Trays, Pipes or Conduits). The output may not always be all the fittings created as Revit sometimes creates extra transition fittings outside of the node transactions.

# group: Conduites desconectados
code_block_5 = CodeBlock(waithFor=byMEPCurves, Pass=firstItem_2) { [waithFor,Pass][1]; }
connectors = RevitModel.Element.Connectors(elements=code_block_5)
isConnected_3 = MEP.Connectors.IsConnected(connector=connectors)
filterByBoolMask_5 = List.FilterByBoolMask(list=connectors, mask=isConnected_3)
flatten_6 = List.Flatten(list=filterByBoolMask_5.out)

connectTo = Custom[Connector.ConnectTo](connector=filterByBoolMask_4.in, Connector2=flatten_6, lacing=Longest)  # package MEPover; Connects a connector to another connector. Returns True if connection succeeded
number_2 = DoubleInput(0.001)
verificar_ponto_igual = Python(IN[0]=firstItem, IN[1]=flatten_4, IN[2]=number_2)
# ---------- verificar_ponto_igual.python (25 lines) ----------
import clr
clr.AddReference('ProtoGeometry')
from Autodesk.DesignScript.Geometry import Point

# Entradas
pts1 = IN[0]  # Lista ou ponto único
pts2 = IN[1]  # Lista ou ponto único
tolerance = IN[2]  # Tolerância

# Função para verificar proximidade com tolerância
def is_close(p1, p2, tol):
    return p1.DistanceTo(p2) <= tol

# Verificando se são listas ou pontos únicos
if isinstance(pts1, list) and isinstance(pts2, list):
    resultados = [is_close(p1, p2, tolerance) for p1, p2 in zip(pts1, pts2)]
elif isinstance(pts1, list):
    resultados = [is_close(p, pts2, tolerance) for p in pts1]
elif isinstance(pts2, list):
    resultados = [is_close(pts1, p, tolerance) for p in pts2]
else:
    resultados = is_close(pts1, pts2, tolerance)

# Saída (Bool ou Lista de Bools)
OUT = resultados
# ----------------------------------------
filterByBoolMask_6 = List.FilterByBoolMask(list=mep_connector_info_2.Connectors, mask=verificar_ponto_igual)

# group: Conduites desconectados
code_block_6 = CodeBlock(waithFor=byMEPCurves, Pass=lastItem) { [waithFor,Pass][1]; }
connectors_2 = RevitModel.Element.Connectors(elements=code_block_6)
isConnected_4 = MEP.Connectors.IsConnected(connector=connectors_2)
filterByBoolMask_7 = List.FilterByBoolMask(list=connectors_2, mask=isConnected_4)
flatten_7 = List.Flatten(list=filterByBoolMask_7.out)

connectTo_2 = Custom[Connector.ConnectTo](connector=filterByBoolMask_6.in, Connector2=flatten_7, lacing=Longest)
