# Dynamo graph ok 2021_18-0_BIMACON_Conduítes ParedexTeto_R02_script.dyn (Dynamo 2.19.3.6394)
# packages: Genius Loci 2023.2.21, DynaMEP 2.0.1, MEPover 2022.10.30, archi-lab.net 2023.213.1722, Rhythm 2023.4.2021, Data-Shapes 2022.2.105, BIMCoder Nodes - 2.X 2025.1.0

# group: ENTRADAS PARA O USUÁRIO
code_block = CodeBlock { "Eletrodutos Parede x Teto"; }
file_path = Filename("..\..\..\..\..\05 - BIMACON\01 - EMPRESA BIMACON\00 - Logos e imagens - BIMACON\ARTE BIMACON\reddonda-removebg-preview.png")
file_from_path = FileObject(path=file_path)
readFromFile = Image.ReadFromFile(file=file_from_path)
string = StringInput("Confirmar")
string_2 = StringInput("Eletroduto Reforçado na Laje?")
boolean = BoolSelector(false)
string_3 = StringInput("Sim")
boolean_input = Custom[Boolean input](InputName=string_2, DefaultValue=boolean, SideText=string_3)  # package Data-Shapes; Creates a boolean input for UI.MultipleInputForm ++ . Check out www.data-shapes.net for more infos!
string_4 = StringInput("Diâmetro conduíte (mm)")
string_5 = StringInput("25")
boolean_2 = BoolSelector(true)
textbox_data = Custom[TextBox Data](InputName=string_4, DefaultText=string_5, IsNumberEntry=boolean_2)  # package Data-Shapes; Create Data for TextBox input in UI.MultipleInputForm ++ . Check out www.data-shapes.net for more informations
string_6 = StringInput("Com Luva?")
boolean_3 = BoolSelector(false)
string_7 = StringInput("Sim")
boolean_input_2 = Custom[Boolean input](InputName=string_6, DefaultValue=boolean_3, SideText=string_7)
string_8 = StringInput("Altura da Luva (m)")
string_9 = StringInput("2.6")
boolean_4 = BoolSelector(true)
textbox_data_2 = Custom[TextBox Data](InputName=string_8, DefaultText=string_9, IsNumberEntry=boolean_4)
list_create = List.Create(item0=boolean_input, item1=textbox_data, item2=boolean_input_2, item3=textbox_data_2)
boolean_5 = BoolSelector(true)
string_10 = StringInput("Cancelar")
number = DoubleInput(600)
number_2 = DoubleInput(185)
multipleinputform = Custom[MultipleInputForm ++](Description_optional=code_block, Logo_optional=readFromFile, ButtonText_optional=string, Inputs=list_create, Toggle=boolean_5, CancelButtonText_optional=string_10, Width_optional=number, LabelWidth_optional=number_2)  # package Data-Shapes; Create a form with multiple inputs. see www.data-shapes.net for tutorials and infos!
code_block_2 = CodeBlock()  # //archilab
code_block_3 = CodeBlock()  # //Data-Shapes

end = Revit.Transaction.Transaction.End(input=multipleinputform.Was_Cancelled)
start = Revit.Transaction.Transaction.Start(input=end)
passThrough = Custom[PassThrough](passThrough=start, waitFor=end)  # package archi-lab.net; Ripped this off from Clockwork. Sorry Andy.

# group: Selecionar ponto na parede
code_block_4 = CodeBlock { ["Pressione ESC para finalizar"]; }
code_block_5 = CodeBlock { ["Selecione os pontos na Parede e clique em Concluir"]; }
if_ = If(test=passThrough, true=code_block_4, false=code_block_5)
fromList = Python(IN[0]=if_)  # "String.FromList"; IronPython2
# ---------- fromList.python (22 lines) ----------
# Carregar as bibliotecas DesignScript e padrão do Python
import sys
import clr
clr.AddReference('ProtoGeometry')
from Autodesk.DesignScript.Geometry import *

# Função para concatenar os valores de uma lista em uma única string com múltiplas linhas
def concatenate_list_to_string(input_list, delimiter="\n"):
    # Verifica se a entrada é uma lista
    if not isinstance(input_list, list):
        return "A entrada deve ser uma lista."
    
    # Converte todos os elementos para string e junta com o delimitador especificado
    result = delimiter.join(str(item) for item in input_list)
    return result

# Entrada pelo nó do Dynamo
lista = IN[0]  # Lista de valores a serem concatenados
delimitador = IN[1] if len(IN) > 1 else "\n"  # Delimitador opcional, padrão é nova linha

# Saída para o Dynamo
OUT = concatenate_list_to_string(lista, delimitador)
# ----------------------------------------
window_prompt_with_text = Python(IN[0]=fromList)  # IronPython2
# ---------- window_prompt_with_text.python (32 lines) ----------
# Importando as bibliotecas necessárias da API do Revit
import clr
clr.AddReference('RevitServices')  # Referência aos serviços do Revit
from RevitServices.Persistence import DocumentManager

clr.AddReference('RevitAPI')  # Referência à API do Revit
clr.AddReference('RevitAPIUI')  # Referência à API de Interface de Usuário do Revit

from Autodesk.Revit.UI import TaskDialog, TaskDialogCommonButtons, TaskDialogResult

# Recebe o texto de instrução como entrada do nó
instrucoes = IN[0]

# Verifica se a entrada é "Cancelar"
if instrucoes.lower() == "Pressione ESC para finalizar":
    OUT = False
else:
    # Criando o TaskDialog
    dialog = TaskDialog("Aviso")
    dialog.MainInstruction = instrucoes
    dialog.CommonButtons = TaskDialogCommonButtons.Ok | TaskDialogCommonButtons.Cancel

    # Exibindo o dialog para o usuário e capturando a resposta
    resultado = dialog.Show()

    # Interpretando a resposta
    if resultado == TaskDialogResult.Ok:
        OUT = True
    elif resultado == TaskDialogResult.Cancel:
        OUT = False
    else:
        OUT = None
# ----------------------------------------
categories = Categories("OST_LightingDevices")
categories_2 = Categories("OST_CommunicationDevices")
categories_3 = Categories("OST_DataDevices")
categories_4 = Categories("OST_TelephoneDevices")
categories_5 = Categories("OST_ElectricalFixtures")
list_create_2 = List.Create(item0=categories, item1=categories_2, item2=categories_3, item3=categories_4, item4=categories_5)
flatten = List.Flatten(list=list_create_2)
boolean_6 = BoolSelector(false)
ʳʰʸᵗʰᵐ_selection_pick = Rhythm.Revit.Selection.Selection.Pick(runIt=window_prompt_with_text, category=flatten, singleSelection=boolean_6)

passThrough_2 = Custom[PassThrough](passThrough=window_prompt_with_text, waitFor=ʳʰʸᵗʰᵐ_selection_pick)

# group: Selecionar ponto no Teto
code_block_6 = CodeBlock { ["Selecione o ponto no teto"]; }
code_block_7 = CodeBlock { ["Pressione ESC para finalizar"]; }
if_2 = If(test=passThrough_2, true=code_block_6, false=code_block_7)
fromList_2 = Python(IN[0]=if_2)  # "String.FromList"; IronPython2; same code as fromList
window_prompt_with_text_2 = Python(IN[0]=fromList_2)  # IronPython2
# ---------- window_prompt_with_text_2.python (32 lines) ----------
# Importando as bibliotecas necessárias da API do Revit
import clr
clr.AddReference('RevitServices')  # Referência aos serviços do Revit
from RevitServices.Persistence import DocumentManager

clr.AddReference('RevitAPI')  # Referência à API do Revit
clr.AddReference('RevitAPIUI')  # Referência à API de Interface de Usuário do Revit

from Autodesk.Revit.UI import TaskDialog, TaskDialogCommonButtons, TaskDialogResult

# Recebe o texto de instrução como entrada do nó
instrucoes = IN[0]

# Verifica se a entrada é "Cancelar"
if instrucoes.lower() == "Pressione ESC para finalizar":
    OUT = False
else:
    # Criando o TaskDialog
    dialog = TaskDialog("Aviso")
    dialog.MainInstruction = instrucoes
    dialog.CommonButtons = TaskDialogCommonButtons.Ok | TaskDialogCommonButtons.Cancel

    # Exibindo o dialog para o usuário e capturando a resposta
    resultado = dialog.Show()

    # Interpretando a resposta
    if resultado == TaskDialogResult.Ok:
        OUT = False
    elif resultado == TaskDialogResult.Cancel:
        OUT = False
    else:
        OUT = None
# ----------------------------------------
categories_6 = Categories("OST_LightingFixtures")
list_create_3 = List.Create(item0=categories_6)
flatten_2 = List.Flatten(list=list_create_3)
boolean_7 = BoolSelector(true)
ʳʰʸᵗʰᵐ_selection_pick_2 = Rhythm.Revit.Selection.Selection.Pick(runIt=window_prompt_with_text_2, category=flatten_2, singleSelection=boolean_7)
categories_7 = Categories("OST_ConduitFitting")

passThrough_3 = Custom[PassThrough](passThrough=ʳʰʸᵗʰᵐ_selection_pick, waitFor=ʳʰʸᵗʰᵐ_selection_pick_2)

# group: Separar Entradas
code_block_8 = CodeBlock { 2; }
getItemAtIndex = List.GetItemAtIndex(list=multipleinputform.User_Inputs, index=code_block_8)
code_block_9 = CodeBlock { 3; }
getItemAtIndex_2 = List.GetItemAtIndex(list=multipleinputform.User_Inputs, index=code_block_9)
code_block_10 = CodeBlock { 0; }
getItemAtIndex_3 = List.GetItemAtIndex(list=multipleinputform.User_Inputs, index=code_block_10)
code_block_11 = CodeBlock { 1; }
getItemAtIndex_4 = List.GetItemAtIndex(list=multipleinputform.User_Inputs, index=code_block_11)

getLocation = Element.GetLocation(element=passThrough_3)
Z = Point.Z(point=getLocation)
add = Z + getItemAtIndex_2

# group: Linhas do conduite
mep_connector_info = Custom[MEP Connector info+](element=passThrough_3)  # package MEPover; This node will return the connectors and a lot of information about those connectors of the input elements
string_11 = StringInput("Superior")
contains = String.Contains(string=mep_connector_info.Description, searchFor=string_11)
filterByBoolMask = List.FilterByBoolMask(list=mep_connector_info.Connectors, mask=contains)
location = MEP.Connectors.Location(connector=filterByBoolMask.in)
isConnected = MEP.Connectors.IsConnected(connector=filterByBoolMask.in)
filterByBoolMask_2 = List.FilterByBoolMask(list=location, mask=isConnected)
flatten_3 = List.Flatten(list=filterByBoolMask_2.out)
ponto_mais_alto_em_z = Python(IN[0]=flatten_3)  # IronPython2
# ---------- ponto_mais_alto_em_z.python (13 lines) ----------
# Importa as bibliotecas necessárias
import clr
clr.AddReference('ProtoGeometry')
from Autodesk.DesignScript.Geometry import *

# Recebe a entrada
pontos = IN[0]

# Ordena os pontos por Z e pega o ponto mais alto
pontoMaisAlto = sorted(pontos, key=lambda p: p.Z, reverse=True)[0]

# Saída
OUT = pontoMaisAlto
# ----------------------------------------
eq = location == ponto_mais_alto_em_z
filterByBoolMask_3 = List.FilterByBoolMask(list=filterByBoolMask.in, mask=eq)
X = Point.X(point=ponto_mais_alto_em_z)
Y = Point.Y(point=ponto_mais_alto_em_z)
byCoordinates = Point.ByCoordinates(x=X, y=Y, z=add)
mep_connector_info_2 = Custom[MEP Connector info+](element=ʳʰʸᵗʰᵐ_selection_pick_2)
isConnected_2 = MEP.Connectors.IsConnected(connector=mep_connector_info_2.Connectors)
filterByBoolMask_4 = List.FilterByBoolMask(list=mep_connector_info_2.Points, mask=isConnected_2)
flatten_4 = List.Flatten(list=filterByBoolMask_4.out)
closestPointTo = Geometry.Points.ClosestPointTo(point=flatten_3, points=flatten_4)
firstItem = List.FirstItem(list=closestPointTo)
Z_2 = Point.Z(point=firstItem)
byCoordinates_2 = Point.ByCoordinates(x=X, y=Y, z=Z_2)
number_3 = DoubleInput(0.001)
verificar_ponto_igual = Python(IN[0]=firstItem, IN[1]=flatten_4, IN[2]=number_3)  # IronPython2
# ---------- verificar_ponto_igual.python (25 lines) ----------
import clr
clr.AddReference('ProtoGeometry')
from Autodesk.DesignScript.Geometry import Point

# Entradas
pts1 = IN[0]  # Lista ou ponto único
pts2 = IN[1]  # Lista ou ponto único
tolerance = IN[2]  # Tolerância

# Função para verificar proximidade com tolerância
def is_close(p1, p2, tol):
    return p1.DistanceTo(p2) <= tol

# Verificando se são listas ou pontos únicos
if isinstance(pts1, list) and isinstance(pts2, list):
    resultados = [is_close(p1, p2, tolerance) for p1, p2 in zip(pts1, pts2)]
elif isinstance(pts1, list):
    resultados = [is_close(p, pts2, tolerance) for p in pts1]
elif isinstance(pts2, list):
    resultados = [is_close(pts1, p, tolerance) for p in pts2]
else:
    resultados = is_close(pts1, pts2, tolerance)

# Saída (Bool ou Lista de Bools)
OUT = resultados
# ----------------------------------------
filterByBoolMask_5 = List.FilterByBoolMask(list=mep_connector_info_2.Connectors, mask=verificar_ponto_igual)
location_2 = MEP.Connectors.Location(connector=filterByBoolMask_5.in)
direction = Custom[Connector.Direction](connector=filterByBoolMask_5.in)  # package MEPover; Returns the direction of the CoordinateSystem of the Connector
number_4 = DoubleInput(0.1)
translate = Geometry.Translate(geometry=location_2, direction=direction, distance=number_4)

# group: 2
byStartPointEndPoint = Line.ByStartPointEndPoint(startPoint=byCoordinates, endPoint=byCoordinates_2)

# group: 3
byStartPointEndPoint_2 = Line.ByStartPointEndPoint(startPoint=byCoordinates_2, endPoint=translate)

# group: 4
byStartPointEndPoint_3 = Line.ByStartPointEndPoint(startPoint=translate, endPoint=firstItem)

# group: 2+3+4
join = List.Join(list0=byStartPointEndPoint, list1=byStartPointEndPoint_2, list2=byStartPointEndPoint_3)

# group: 3+4
join_2 = List.Join(list0=byStartPointEndPoint_2, list1=byStartPointEndPoint_3)

# group: Luva?
condição_if_de_lista = CodeBlock(test=getItemAtIndex, verd=join, fals=join_2)
# ---------- condição_if_de_lista.designscript (3 lines) ----------
//Condições IF
indx = (test) ? 0 : 1;
rslt = [verd,fals][indx];
# ----------------------------------------

flatten_5 = List.Flatten(list=condição_if_de_lista.rslt)

# group: Tipo Eletroduto
# Descrição <Clique duas vezes aqui para editar a descrição do grupo>
element_classes = ElementTypes("ConduitType")
all_elements_of_class = ElementsOfType(element_class=element_classes)
name = Element.Name(element=all_elements_of_class)
string_12 = StringInput("Laranja")
contains_2 = String.Contains(string=name, searchFor=string_12)
filterByBoolMask_6 = List.FilterByBoolMask(list=all_elements_of_class, mask=contains_2)
flatten_6 = List.Flatten(list=filterByBoolMask_6.in)
string_13 = StringInput("Amarelo")
contains_3 = String.Contains(string=name, searchFor=string_13)
filterByBoolMask_7 = List.FilterByBoolMask(list=all_elements_of_class, mask=contains_3)
flatten_7 = List.Flatten(list=filterByBoolMask_7.in)

# group: Reforçado?
condição_if_de_lista_2 = CodeBlock(test=getItemAtIndex_3, verd=flatten_6, fals=flatten_7)  # same code as condição_if_de_lista

# group: Criar eletrodutos
element_level = Custom[Element Level](element=ʳʰʸᵗʰᵐ_selection_pick_2)  # package Genius Loci; Gets an element's level. Based on a Clockwork's node
conduit_bylines = Custom[👓 Conduit․ByLines](lines=flatten_5, conduitType=condição_if_de_lista_2.rslt@L1, levels=element_level@L1, Diameter=getItemAtIndex_4)  # package BIMCoder Nodes - 2.X; Modela conduítes (Conduit) com base em linhas (que devem ser geometrias)
flatten_8 = List.Flatten(list=conduit_bylines)
placefittings = Custom[👓 PlaceFittings](elements=flatten_8)  # package BIMCoder Nodes - 2.X; Modela conexões (fittings) entre curvas MEP (eletrodutos, bandejas de cabos, tubulações e dutos).
lastItem = List.LastItem(list=flatten_8)
firstItem_2 = List.FirstItem(list=flatten_8)

# group: 1
byStartPointEndPoint_4 = Line.ByStartPointEndPoint(startPoint=ponto_mais_alto_em_z, endPoint=byCoordinates)

# group: 5
byStartPointEndPoint_5 = Line.ByStartPointEndPoint(startPoint=ponto_mais_alto_em_z, endPoint=byCoordinates_2)

# group: Luva?
condição_if_de_lista_3 = CodeBlock(test=getItemAtIndex, verd=byStartPointEndPoint_4, fals=byStartPointEndPoint_5)  # same code as condição_if_de_lista

conduit_bylines_2 = Custom[👓 Conduit․ByLines](lines=condição_if_de_lista_3.rslt, conduitType=flatten_7, levels=element_level, Diameter=getItemAtIndex_4)
flatten_9 = List.Flatten(list=conduit_bylines_2)

# group: Conduites desconectados
code_block_12 = CodeBlock(waithFor=placefittings, Pass=flatten_9) { [waithFor,Pass][1]; }
connectors = RevitModel.Element.Connectors(elements=code_block_12)
isConnected_3 = MEP.Connectors.IsConnected(connector=connectors)
filterByBoolMask_8 = List.FilterByBoolMask(list=connectors, mask=isConnected_3)
flatten_10 = List.Flatten(list=filterByBoolMask_8.out)

connectTo = Custom[Connector.ConnectTo](connector=filterByBoolMask_3.in, Connector2=flatten_10, lacing=Longest)  # package MEPover; Connects a connector to another connector. Returns True if connection succeeded
end_2 = Revit.Transaction.Transaction.End(input=placefittings)

# group: Conduites desconectados
code_block_13 = CodeBlock(waithFor=end_2, Pass=lastItem) { [waithFor,Pass][1]; }
connectors_2 = RevitModel.Element.Connectors(elements=code_block_13)
isConnected_4 = MEP.Connectors.IsConnected(connector=connectors_2)
filterByBoolMask_9 = List.FilterByBoolMask(list=connectors_2, mask=isConnected_4)
flatten_11 = List.Flatten(list=filterByBoolMask_9.out)

connectTo_2 = Custom[Connector.ConnectTo](connector=filterByBoolMask_5.in, Connector2=flatten_11, lacing=Longest)
byMEPCurves = Custom[MEPFitting.ByMEPCurves](MEPCurve1=firstItem_2, MEPCurve2=flatten_9, lacing=CrossProduct)  # package MEPover; Creates a UnionFitting or ElbowFitting by 2 MEPCurves (Ducts, Cable Trays, Pipes or Conduits). The output may not always be all the fittings created as Revit sometimes creates extra transition fittings outside of the node transactions.

# group: 5+3+4
join_3 = List.Join(list0=byStartPointEndPoint_5, list1=byStartPointEndPoint_2, list2=byStartPointEndPoint_3)
