# Dynamo graph 18-0_BIMACON_Conduítes TetoxTeto_R03_script.dyn "ok 2021_18-0_BIMACON_Conduítes TetoxTeto_R03_script" (Dynamo 2.19.3.6394)
# author: Jose Nelson
# Cria eletrodutos entre pontos no Teto
# packages: Genius Loci 2023.2.21, DynaMEP 2.0.1, MEPover 2022.10.30, archi-lab.net 2023.213.1722, Rhythm 2023.4.2021, BIMCoder Nodes - 2.X 2025.1.0, Data-Shapes 2022.2.105

# group: ENTRADAS PARA O USUÁRIO
code_block = CodeBlock { "Eletrodutos Teto x Teto"; }
string = StringInput("LogoBimacon.png")
python_script = Python(IN[0]=string)  # IronPython2
# ---------- python_script.python (22 lines) ----------
import clr

# Adiciona referência ao ambiente .NET
clr.AddReference('System')
from System import Environment, IO

# Nome da imagem (entrada do usuário)
nome_arquivo_imagem = IN[0]

# Recupera o nome do usuário logado no Windows
usuario = Environment.UserName

# Monta o caminho completo para a pasta de imagens
caminho_base = r"C:\Users\{0}\AppData\Roaming\pyRevit\Extensions\Bimacon.extension\Bimacon.tab\Imagens_Bimacon".format(usuario)

# Junta o caminho base com o nome do arquivo
caminho_completo = IO.Path.Combine(caminho_base, nome_arquivo_imagem)

# Verifica se o arquivo existe
existe = IO.File.Exists(caminho_completo)

OUT = caminho_completo if existe else "Imagem não encontrada: {0}".format(caminho_completo)
# ----------------------------------------
file_from_path = FileObject(path=python_script)
readFromFile = Image.ReadFromFile(file=file_from_path)
string_2 = StringInput("Confirmar")
string_3 = StringInput("Selecione o Tipo de eletroduto")
element_classes = ElementTypes("ConduitType")
all_elements_of_class = ElementsOfType(element_class=element_classes)
name = Element.Name(element=all_elements_of_class)
code_block_2 = CodeBlock { 2; }
dropdown_data = Custom[DropDown Data](InputName=string_3, Keys=name, Values=all_elements_of_class, DefaultValueIndex=code_block_2)  # package Data-Shapes; Create data for DropDown input in UI.MultiInputForm ++ . Check out www.data-shapes.net for more infos.
string_4 = StringInput("Diâmetro conduíte (mm)")
string_5 = StringInput("25")
boolean = BoolSelector(true)
textbox_data = Custom[TextBox Data](InputName=string_4, DefaultText=string_5, IsNumberEntry=boolean)  # package Data-Shapes; Create Data for TextBox input in UI.MultipleInputForm ++ . Check out www.data-shapes.net for more informations
list_create = List.Create(item0=dropdown_data, item1=textbox_data)
boolean_2 = BoolSelector(true)
string_6 = StringInput("Cancelar")
number = DoubleInput(550)
number_2 = DoubleInput(200)
multipleinputform = Custom[MultipleInputForm ++](Description_optional=code_block, Logo_optional=readFromFile, ButtonText_optional=string_2, Inputs=list_create, Toggle=boolean_2, CancelButtonText_optional=string_6, Width_optional=number, LabelWidth_optional=number_2)  # package Data-Shapes; Create a form with multiple inputs. see www.data-shapes.net for tutorials and infos!
code_block_3 = CodeBlock()  # //Data-Shapes
code_block_4 = CodeBlock()  # //archilab

end = Revit.Transaction.Transaction.End(input=multipleinputform.Was_Cancelled)
start = Revit.Transaction.Transaction.Start(input=end)
passThrough = Custom[PassThrough](passThrough=start, waitFor=end)  # package archi-lab.net; Ripped this off from Clockwork. Sorry Andy.

# group: Selecionar 1º ponto
code_block_5 = CodeBlock { ["Pressione ESC para finalizar"]; }
code_block_6 = CodeBlock { ["Selecione o primeiro ponto"]; }
if_ = If(test=passThrough, true=code_block_5, false=code_block_6)
fromList = Python(IN[0]=if_)  # "String.FromList"; IronPython2
# ---------- fromList.python (22 lines) ----------
# Carregar as bibliotecas DesignScript e padrão do Python
import sys
import clr
clr.AddReference('ProtoGeometry')
from Autodesk.DesignScript.Geometry import *

# Função para concatenar os valores de uma lista em uma única string com múltiplas linhas
def concatenate_list_to_string(input_list, delimiter="\n"):
    # Verifica se a entrada é uma lista
    if not isinstance(input_list, list):
        return "A entrada deve ser uma lista."
    
    # Converte todos os elementos para string e junta com o delimitador especificado
    result = delimiter.join(str(item) for item in input_list)
    return result

# Entrada pelo nó do Dynamo
lista = IN[0]  # Lista de valores a serem concatenados
delimitador = IN[1] if len(IN) > 1 else "\n"  # Delimitador opcional, padrão é nova linha

# Saída para o Dynamo
OUT = concatenate_list_to_string(lista, delimitador)
# ----------------------------------------
window_prompt_with_text = Python(IN[0]=fromList)  # IronPython2
# ---------- window_prompt_with_text.python (32 lines) ----------
# Importando as bibliotecas necessárias da API do Revit
import clr
clr.AddReference('RevitServices')  # Referência aos serviços do Revit
from RevitServices.Persistence import DocumentManager

clr.AddReference('RevitAPI')  # Referência à API do Revit
clr.AddReference('RevitAPIUI')  # Referência à API de Interface de Usuário do Revit

from Autodesk.Revit.UI import TaskDialog, TaskDialogCommonButtons, TaskDialogResult

# Recebe o texto de instrução como entrada do nó
instrucoes = IN[0]

# Verifica se a entrada é "Cancelar"
if instrucoes.lower() == "Pressione ESC para finalizar":
    OUT = False
else:
    # Criando o TaskDialog
    dialog = TaskDialog("Aviso")
    dialog.MainInstruction = instrucoes
    dialog.CommonButtons = TaskDialogCommonButtons.Ok | TaskDialogCommonButtons.Cancel

    # Exibindo o dialog para o usuário e capturando a resposta
    resultado = dialog.Show()

    # Interpretando a resposta
    if resultado == TaskDialogResult.Ok:
        OUT = True
    elif resultado == TaskDialogResult.Cancel:
        OUT = False
    else:
        OUT = None
# ----------------------------------------
categories = Categories("OST_LightingDevices")
categories_2 = Categories("OST_CommunicationDevices")
categories_3 = Categories("OST_DataDevices")
categories_4 = Categories("OST_TelephoneDevices")
categories_5 = Categories("OST_ElectricalFixtures")
categories_6 = Categories("OST_LightingFixtures")
list_create_2 = List.Create(item0=categories, item1=categories_2, item2=categories_3, item3=categories_4, item4=categories_5, item5=categories_6)
flatten = List.Flatten(list=list_create_2)
boolean_3 = BoolSelector(true)
boolean_4 = BoolSelector(false)
ʳʰʸᵗʰᵐ_selection_pick = Rhythm.Revit.Selection.Selection.Pick(runIt=window_prompt_with_text, category=flatten, singleSelection=boolean_3, ordered=boolean_4)

passThrough_2 = Custom[PassThrough](passThrough=window_prompt_with_text, waitFor=ʳʰʸᵗʰᵐ_selection_pick)

# group: Selecionar 2º ponto
code_block_7 = CodeBlock { ["Selecione o segundo ponto"]; }
code_block_8 = CodeBlock { ["Pressione ESC para finalizar"]; }
if_2 = If(test=passThrough_2, true=code_block_7, false=code_block_8)
fromList_2 = Python(IN[0]=if_2)  # "String.FromList"; IronPython2; same code as fromList
window_prompt_with_text_2 = Python(IN[0]=fromList_2)  # IronPython2
# ---------- window_prompt_with_text_2.python (32 lines) ----------
# Importando as bibliotecas necessárias da API do Revit
import clr
clr.AddReference('RevitServices')  # Referência aos serviços do Revit
from RevitServices.Persistence import DocumentManager

clr.AddReference('RevitAPI')  # Referência à API do Revit
clr.AddReference('RevitAPIUI')  # Referência à API de Interface de Usuário do Revit

from Autodesk.Revit.UI import TaskDialog, TaskDialogCommonButtons, TaskDialogResult

# Recebe o texto de instrução como entrada do nó
instrucoes = IN[0]

# Verifica se a entrada é "Cancelar"
if instrucoes.lower() == "Pressione ESC para finalizar":
    OUT = False
else:
    # Criando o TaskDialog
    dialog = TaskDialog("Aviso")
    dialog.MainInstruction = instrucoes
    dialog.CommonButtons = TaskDialogCommonButtons.Ok | TaskDialogCommonButtons.Cancel

    # Exibindo o dialog para o usuário e capturando a resposta
    resultado = dialog.Show()

    # Interpretando a resposta
    if resultado == TaskDialogResult.Ok:
        OUT = False
    elif resultado == TaskDialogResult.Cancel:
        OUT = False
    else:
        OUT = None
# ----------------------------------------
list_create_3 = List.Create(item0=list_create_2)
flatten_2 = List.Flatten(list=list_create_3)
boolean_5 = BoolSelector(true)
ʳʰʸᵗʰᵐ_selection_pick_2 = Rhythm.Revit.Selection.Selection.Pick(runIt=window_prompt_with_text_2, category=flatten_2, singleSelection=boolean_5)

passThrough_3 = Custom[PassThrough](passThrough=ʳʰʸᵗʰᵐ_selection_pick, waitFor=ʳʰʸᵗʰᵐ_selection_pick_2)
mep_connector_info = Custom[MEP Connector info+](element=passThrough_3)  # package MEPover; This node will return the connectors and a lot of information about those connectors of the input elements
isNull = Object.IsNull(object=mep_connector_info.Radius)
filterByBoolMask = List.FilterByBoolMask(list=mep_connector_info.Connectors, mask=isNull)
isConnected = MEP.Connectors.IsConnected(connector=filterByBoolMask.out)
filterByBoolMask_2 = List.FilterByBoolMask(list=filterByBoolMask.out, mask=isConnected)
direction = Custom[Connector.Direction](connector=filterByBoolMask_2.out)  # package MEPover; Returns the direction of the CoordinateSystem of the Connector
location = MEP.Connectors.Location(connector=filterByBoolMask_2.out)
boundingBox = Element.BoundingBox(element=ʳʰʸᵗʰᵐ_selection_pick_2)
center = RevitModel.BoundingBox.Center(boundingBox=boundingBox)
byTwoPoints = Vector.ByTwoPoints(start=location, end=center)
dot = Vector.Dot(vector=direction, vec=byTwoPoints)
maximumItem = List.MaximumItem(list=dot)
indexOf = List.IndexOf(list=dot, element=maximumItem)

# group: A
getItemAtIndex = List.GetItemAtIndex(list=filterByBoolMask_2.out, index=indexOf)
location_2 = MEP.Connectors.Location(connector=getItemAtIndex)

X = Point.X(point=location_2)
mep_connector_info_2 = Custom[MEP Connector info+](element=ʳʰʸᵗʰᵐ_selection_pick_2)
isNull_2 = Object.IsNull(object=mep_connector_info_2.Radius)
filterByBoolMask_3 = List.FilterByBoolMask(list=mep_connector_info_2.Connectors, mask=isNull_2)
isConnected_2 = MEP.Connectors.IsConnected(connector=filterByBoolMask_3.out)
filterByBoolMask_4 = List.FilterByBoolMask(list=filterByBoolMask_3.out, mask=isConnected_2)
direction_2 = Custom[Connector.Direction](connector=filterByBoolMask_4.out)
location_3 = MEP.Connectors.Location(connector=filterByBoolMask_4.out)
boundingBox_2 = Element.BoundingBox(element=ʳʰʸᵗʰᵐ_selection_pick)
center_2 = RevitModel.BoundingBox.Center(boundingBox=boundingBox_2)
byTwoPoints_2 = Vector.ByTwoPoints(start=location_3, end=center_2)
dot_2 = Vector.Dot(vector=direction_2, vec=byTwoPoints_2)
maximumItem_2 = List.MaximumItem(list=dot_2)
indexOf_2 = List.IndexOf(list=dot_2, element=maximumItem_2)

# group: D
getItemAtIndex_2 = List.GetItemAtIndex(list=filterByBoolMask_4.out, index=indexOf_2)
location_4 = MEP.Connectors.Location(connector=getItemAtIndex_2)

X_2 = Point.X(point=location_4)
eq = X == X_2
Y = Point.Y(point=location_2)
Y_2 = Point.Y(point=location_4)
eq_2 = Y == Y_2
boolean_6 = BoolSelector(true)
boolean_7 = BoolSelector(false)
condição_if_de_lista = CodeBlock(test1=eq, test2=eq_2, verd=boolean_6, fals=boolean_7)
# ---------- condição_if_de_lista.designscript (3 lines) ----------
//Condições IF
indx = (test1) || (test2) ? 0 : 1;
rslt = [verd,fals][indx];
# ----------------------------------------

# group: 4
byStartPointEndPoint = Line.ByStartPointEndPoint(startPoint=location_2, endPoint=location_4)

getItemAtIndex_3 = List.GetItemAtIndex(list=direction, index=indexOf)

# group: Location
# Descrição <Clique duas vezes aqui para editar a descrição do grupo>
X_3 = Point.X(point=location_2)
X_4 = Point.X(point=location_4)
code_block_9 = CodeBlock { 0.05; 0.4; 0.1; }
eq_3 = Equals(x=X_3, y=X_4, tolerance=code_block_9.out0)
Y_3 = Point.Y(point=location_2)
Y_4 = Point.Y(point=location_4)
eq_4 = Equals(x=Y_3, y=Y_4, tolerance=code_block_9.out0)
condição_if_de_lista_2 = CodeBlock(test1=eq_3, test2=eq_4, verd=code_block_9.out1, fals=code_block_9.out2)  # same code as condição_if_de_lista

# group: B
translate = Geometry.Translate(geometry=location_2, direction=getItemAtIndex_3, distance=condição_if_de_lista_2.rslt)

# group: 1
byStartPointEndPoint_2 = Line.ByStartPointEndPoint(startPoint=location_2, endPoint=translate)

getItemAtIndex_4 = List.GetItemAtIndex(list=direction_2, index=indexOf_2)

# group: C
translate_2 = Geometry.Translate(geometry=location_4, direction=getItemAtIndex_4, distance=condição_if_de_lista_2.rslt)

# group: 2
byStartPointEndPoint_3 = Line.ByStartPointEndPoint(startPoint=translate, endPoint=translate_2)

# group: 3
byStartPointEndPoint_4 = Line.ByStartPointEndPoint(startPoint=translate_2, endPoint=location_4)

join = List.Join(list0=byStartPointEndPoint_2, list1=byStartPointEndPoint_3, list2=byStartPointEndPoint_4)
condição_if_de_lista_3 = CodeBlock(test=condição_if_de_lista.rslt, verd=byStartPointEndPoint, fals=join)
# ---------- condição_if_de_lista_3.designscript (3 lines) ----------
//Condições IF
indx = (test) ? 0 : 1;
rslt = [List.Flatten((verd), -1),List.Flatten((fals), -1)][indx];
# ----------------------------------------

# group: Separar Entradas
code_block_10 = CodeBlock { 0; }
getItemAtIndex_5 = List.GetItemAtIndex(list=multipleinputform.User_Inputs, index=code_block_10)
code_block_11 = CodeBlock { 1; }
getItemAtIndex_6 = List.GetItemAtIndex(list=multipleinputform.User_Inputs, index=code_block_11)

# group: Criar eletrodutos
code_block_12 = CodeBlock { []; }
element_level = Custom[Element Level](element=ʳʰʸᵗʰᵐ_selection_pick_2)  # package Genius Loci; Gets an element's level. Based on a Clockwork's node
conduit_bylines = Custom[👓 Conduit․ByLines](lines=condição_if_de_lista_3.rslt, conduitType=getItemAtIndex_5@L1, levels=element_level@L1, Diameter=getItemAtIndex_6)  # package BIMCoder Nodes - 2.X; Modela conduítes (Conduit) com base em linhas (que devem ser geometrias)
flatten_3 = List.Flatten(list=conduit_bylines@L3, lacing=Longest)
condição_if_de_lista_4 = CodeBlock(test=condição_if_de_lista.rslt, verd=code_block_12, fals=flatten_3)
# ---------- condição_if_de_lista_4.designscript (3 lines) ----------
//Condições IF
indx = (test) ? 0 : 1;
rslt = [verd,fals][indx];
# ----------------------------------------
placefittings = Custom[👓 PlaceFittings](elements=condição_if_de_lista_4.rslt@L2, lacing=Longest)  # package BIMCoder Nodes - 2.X; Modela conexões (fittings) entre curvas MEP (eletrodutos, bandejas de cabos, tubulações e dutos).
firstItem = List.FirstItem(list=flatten_3, lacing=Longest)
lastItem = List.LastItem(list=flatten_3, lacing=Longest)

end_2 = Revit.Transaction.Transaction.End(input=placefittings)
start_2 = Revit.Transaction.Transaction.Start(input=end_2)

# group: Conduites desconectados
code_block_13 = CodeBlock(waithFor=start_2, Pass=firstItem) { [waithFor,Pass][1]; }
connectors = RevitModel.Element.Connectors(elements=code_block_13)
isConnected_3 = MEP.Connectors.IsConnected(connector=connectors)
filterByBoolMask_5 = List.FilterByBoolMask(list=connectors, mask=isConnected_3, lacing=Longest)
flatten_4 = List.Flatten(list=filterByBoolMask_5.out)

# group: mesma posição
# Descrição <Clique duas vezes aqui para editar a descrição do grupo>
location_5 = MEP.Connectors.Location(connector=flatten_4)
isAlmostEqualTo = Geometry.IsAlmostEqualTo(geometry=location_5, other=location_2, lacing=CrossProduct)
flatten_5 = List.Flatten(list=isAlmostEqualTo)
filterByBoolMask_6 = List.FilterByBoolMask(list=flatten_4, mask=flatten_5, lacing=Longest)
flatten_6 = List.Flatten(list=filterByBoolMask_6.in)

connectTo = Custom[Connector.ConnectTo](connector=getItemAtIndex, Connector2=flatten_6)  # package MEPover; Connects a connector to another connector. Returns True if connection succeeded

# group: Conduites desconectados
code_block_14 = CodeBlock(waithFor=start_2, Pass=lastItem) { [waithFor,Pass][1]; }
connectors_2 = RevitModel.Element.Connectors(elements=code_block_14)
isConnected_4 = MEP.Connectors.IsConnected(connector=connectors_2)
filterByBoolMask_7 = List.FilterByBoolMask(list=connectors_2, mask=isConnected_4, lacing=Longest)
flatten_7 = List.Flatten(list=filterByBoolMask_7.out)

# group: mesma posição
# Descrição <Clique duas vezes aqui para editar a descrição do grupo>
location_6 = MEP.Connectors.Location(connector=flatten_7)
isAlmostEqualTo_2 = Geometry.IsAlmostEqualTo(geometry=location_6, other=location_4, lacing=CrossProduct)
flatten_8 = List.Flatten(list=isAlmostEqualTo_2)
filterByBoolMask_8 = List.FilterByBoolMask(list=flatten_7, mask=flatten_8, lacing=Longest)
flatten_9 = List.Flatten(list=filterByBoolMask_8.in)

connectTo_2 = Custom[Connector.ConnectTo](connector=getItemAtIndex_2, Connector2=flatten_9, lacing=Longest)
number_3 = DoubleInput(0.1)
number_4 = DoubleInput(0.1)
