# Dynamo graph 2021_12-6_BIMACON_Unir Conexões_R00_script.dyn "2021_12-0_BIMACON_Unir Conexões_R00" (Dynamo 2.19.3.6394)
# packages: MEPover 2022.10.30, DynaMEP 2.0.1, Genius Loci 2023.2.21

# group: Selecionar curva e pegar conector
selecione_a_1ª_conexão = DSModelElementSelection()  # 1 picked in the model; graph input
connectors = Custom[Element.Connectors](element=selecione_a_1ª_conexão)  # package MEPover; Returns every connector on an element (also return connectors of a System)
isConnected = Custom[Connector.IsConnected](connector=connectors)  # package MEPover; Returns a boolean indicating whether the connector is connected to a connector on different element
filterByBoolMask = List.FilterByBoolMask(list=connectors, mask=isConnected)
location = Custom[Connector.Location](connector=filterByBoolMask.out)  # package MEPover; Returns the location of a connector

# group: Selecionar conexão
selecione_a_2ª_conexão = DSModelElementSelection()  # 1 picked in the model; graph input
mep_connector_info = Custom[MEP Connector info+](element=selecione_a_2ª_conexão)  # package MEPover; This node will return the connectors and a lot of information about those connectors of the input elements
isConnected_2 = Custom[Connector.IsConnected](connector=mep_connector_info.Connectors)
filterByBoolMask_2 = List.FilterByBoolMask(list=mep_connector_info.Connectors, mask=isConnected_2)
flatten = List.Flatten(list=filterByBoolMask_2.out)
location_2 = Custom[Connector.Location](connector=flatten)
elementType = Element.ElementType(element=selecione_a_1ª_conexão)
code_block = CodeBlock { "Comentários de tipos"; }
getParameterValueByName = Element.GetParameterValueByName(element=elementType, parameterName=code_block)

element_level = Custom[Element Level](element=selecione_a_1ª_conexão)  # package Genius Loci; Gets an element's level. Based on a Clockwork's node
code_block_2 = CodeBlock { "DN"; }
getParameterValueByName_2 = Element.GetParameterValueByName(element=selecione_a_1ª_conexão, parameterName=code_block_2)

# group: Criar conduite entre as curvas
element_types = ElementTypes("ConduitType")
all_elements_of_type = ElementsOfType(element_type=element_types)
code_block_3 = CodeBlock(x=all_elements_of_type) { x.Name; }
byStartPointEndPoint = Line.ByStartPointEndPoint(startPoint=location, endPoint=location_2)
code_block_4 = CodeBlock { "Comentários de tipos"; }
getParameterValueByName_3 = Element.GetParameterValueByName(element=all_elements_of_type, parameterName=code_block_4)
eq = getParameterValueByName == getParameterValueByName_3
filterByBoolMask_3 = List.FilterByBoolMask(list=all_elements_of_type, mask=eq)
code_block_5 = CodeBlock(x=filterByBoolMask_3.in) { x[0]; }
byLines = Custom[Conduit.ByLines](Lines=byStartPointEndPoint, code_block_5, level=element_level, Diameter=getParameterValueByName_2)  # package MEPover; Creates conduits by Line, ConduitType, Level and Diameter
watch = Watch(filterByBoolMask_3.in)

# group: Conectar eletroduto com curva
flatten_2 = List.Flatten(list=filterByBoolMask.out)
mep_connector_info_2 = Custom[MEP Connector info+](element=byLines)
isAlmostEqualTo = Geometry.IsAlmostEqualTo(geometry=location, other=mep_connector_info_2.Points)
filterByBoolMask_4 = List.FilterByBoolMask(list=mep_connector_info_2.Connectors, mask=isAlmostEqualTo)
flatten_3 = List.Flatten(list=filterByBoolMask_4.in)
connectTo = Custom[Connector.ConnectTo](connector=flatten_2, Connector2=flatten_3, lacing=Shortest)  # package MEPover; Connects a connector to another connector. Returns True if connection succeeded
flatten_4 = List.Flatten(list=filterByBoolMask_2.out)
isAlmostEqualTo_2 = Geometry.IsAlmostEqualTo(geometry=location_2, other=mep_connector_info_2.Points)
filterByBoolMask_5 = List.FilterByBoolMask(list=mep_connector_info_2.Connectors, mask=isAlmostEqualTo_2)
flatten_5 = List.Flatten(list=filterByBoolMask_5.in)
connectTo_2 = Custom[Connector.ConnectTo](connector=flatten_4, Connector2=flatten_5, lacing=Shortest)
owner = MEP.Connectors.Owner(connector=flatten_3)
owner_2 = MEP.Connectors.Owner(connector=flatten_5)

parameters = Element.Parameters(element=selecione_a_1ª_conexão)
