# Dynamo graph ok 2021_12-6_BIMACON_Unir Conexões_R01_script.dyn "2021_12-6_BIMACON_Unir Conexões_R00_script" (Dynamo 3.2.1.5366)
# packages: MEPover 2022.10.30, DynaMEP 2.0.1, Genius Loci 2023.2.21, Rhythm 2023.4.2021, archi-lab.net 2023.213.1722

# group: Mensagem
boolean = BoolSelector(true)
code_block = CodeBlock { ["Selecione a primeira conexão"]; }
code_block_2 = CodeBlock { ["Nenhum objeto selecionado"]; }
if_ = If(test=boolean, true=code_block, false=code_block_2)
fromList = Python(IN[0]=if_)  # "String.FromList"; IronPython2
# ---------- fromList.python (22 lines) ----------
# Carregar as bibliotecas DesignScript e padrão do Python
import sys
import clr
clr.AddReference('ProtoGeometry')
from Autodesk.DesignScript.Geometry import *

# Função para concatenar os valores de uma lista em uma única string com múltiplas linhas
def concatenate_list_to_string(input_list, delimiter="\n"):
    # Verifica se a entrada é uma lista
    if not isinstance(input_list, list):
        return "A entrada deve ser uma lista."
    
    # Converte todos os elementos para string e junta com o delimitador especificado
    result = delimiter.join(str(item) for item in input_list)
    return result

# Entrada pelo nó do Dynamo
lista = IN[0]  # Lista de valores a serem concatenados
delimitador = IN[1] if len(IN) > 1 else "\n"  # Delimitador opcional, padrão é nova linha

# Saída para o Dynamo
OUT = concatenate_list_to_string(lista, delimitador)
# ----------------------------------------
window_prompt_with_text = Python(IN[0]=fromList)  # IronPython2
# ---------- window_prompt_with_text.python (26 lines) ----------
# Importando as bibliotecas necessárias da API do Revit
import clr
clr.AddReference('RevitServices')  # Referência aos serviços do Revit
from RevitServices.Persistence import DocumentManager

clr.AddReference('RevitAPI')  # Referência à API do Revit
clr.AddReference('RevitAPIUI')  # Referência à API de Interface de Usuário do Revit

from Autodesk.Revit.UI import TaskDialog, TaskDialogCommonButtons, TaskDialogResult

# Recebe o texto de instrução como entrada do nó
instrucoes = IN[0]

# Criando o TaskDialog
dialog = TaskDialog("Aviso")
dialog.MainInstruction = instrucoes
dialog.CommonButtons = TaskDialogCommonButtons.Ok

# Exibindo o dialog para o usuário e capturando a resposta
resultado = dialog.Show()

# Interpretando a resposta
if resultado == TaskDialogCommonButtons.Ok:
    OUT = "Ok"
else:
    OUT = "True"
# ----------------------------------------

# group: ENTRADAS PARA O USUÁRIO
categories = Categories("OST_ConduitFitting")
categories_2 = Categories("OST_Conduit")
categories_3 = Categories("OST_CableTray")
categories_4 = Categories("OST_CableTrayFitting")
categories_5 = Categories("OST_ElectricalEquipment")
list_create = List.Create(item0=categories, item1=categories_2, item2=categories_3, item3=categories_4, item4=categories_5)
flatten = List.Flatten(list=list_create)

boolean_2 = BoolSelector(true)
ʳʰʸᵗʰᵐ_selection_pick = Rhythm.Revit.Selection.Selection.Pick(runIt=window_prompt_with_text, category=flatten, singleSelection=boolean_2)
passThrough = Custom[PassThrough](passThrough=window_prompt_with_text, waitFor=ʳʰʸᵗʰᵐ_selection_pick)  # package archi-lab.net; Ripped this off from Clockwork. Sorry Andy.

# group: Mensagem
code_block_3 = CodeBlock { ["Selecione a segunda conexão"]; }
code_block_4 = CodeBlock { ["Nenhum objeto selecionado"]; }
if_2 = If(test=passThrough, true=code_block_3, false=code_block_4)
fromList_2 = Python(IN[0]=if_2)  # "String.FromList"; IronPython2; same code as fromList
window_prompt_with_text_2 = Python(IN[0]=fromList_2)  # IronPython2; same code as window_prompt_with_text
boolean_3 = BoolSelector(true)

ʳʰʸᵗʰᵐ_selection_pick_2 = Rhythm.Revit.Selection.Selection.Pick(runIt=window_prompt_with_text_2, category=flatten, singleSelection=boolean_2)
passThrough_2 = Custom[PassThrough](passThrough=ʳʰʸᵗʰᵐ_selection_pick, waitFor=ʳʰʸᵗʰᵐ_selection_pick_2)

# group: Selecionar curva e pegar conector
connectors = Custom[Element.Connectors](element=passThrough_2)  # package MEPover; Returns every connector on an element (also return connectors of a System)
isConnected = Custom[Connector.IsConnected](connector=connectors)  # package MEPover; Returns a boolean indicating whether the connector is connected to a connector on different element
filterByBoolMask = List.FilterByBoolMask(list=connectors, mask=isConnected)
location = Custom[Connector.Location](connector=filterByBoolMask.out)  # package MEPover; Returns the location of a connector
element_level = Custom[Element Level](element=passThrough_2)  # package Genius Loci; Gets an element's level. Based on a Clockwork's node
code_block_5 = CodeBlock { "DN"; }
getParameterValueByName = Element.GetParameterValueByName(element=passThrough_2, parameterName=code_block_5)

# group: Selecionar conexão
mep_connector_info = Custom[MEP Connector info+](element=ʳʰʸᵗʰᵐ_selection_pick_2)  # package MEPover; This node will return the connectors and a lot of information about those connectors of the input elements
isConnected_2 = Custom[Connector.IsConnected](connector=mep_connector_info.Connectors)
filterByBoolMask_2 = List.FilterByBoolMask(list=mep_connector_info.Connectors, mask=isConnected_2)
flatten_2 = List.Flatten(list=filterByBoolMask_2.out)
location_2 = Custom[Connector.Location](connector=flatten_2)
elementType = Element.ElementType(element=passThrough_2)
code_block_6 = CodeBlock { "Comentários de tipos"; }
getParameterValueByName_2 = Element.GetParameterValueByName(element=elementType, parameterName=code_block_6)
selecione_a_2ª_conexão = DSModelElementSelection()  # 1 picked in the model; graph input

# group: Criar conduite entre as curvas
element_types = ElementTypes("ConduitType")
all_elements_of_type = ElementsOfType(element_type=element_types)
code_block_7 = CodeBlock(x=all_elements_of_type) { x.Name; }
byStartPointEndPoint = Line.ByStartPointEndPoint(startPoint=location, endPoint=location_2)
code_block_8 = CodeBlock { "Comentários de tipos"; }
getParameterValueByName_3 = Element.GetParameterValueByName(element=all_elements_of_type, parameterName=code_block_8)
eq = getParameterValueByName_2 == getParameterValueByName_3
filterByBoolMask_3 = List.FilterByBoolMask(list=all_elements_of_type, mask=eq)
code_block_9 = CodeBlock(x=filterByBoolMask_3.in) { x[0]; }
byLines = Custom[Conduit.ByLines](Lines=byStartPointEndPoint, code_block_9, level=element_level, Diameter=getParameterValueByName)  # package MEPover; Creates conduits by Line, ConduitType, Level and Diameter
watch = Watch(filterByBoolMask_3.in)

# group: Conectar eletroduto com curva
flatten_3 = List.Flatten(list=filterByBoolMask.out)
mep_connector_info_2 = Custom[MEP Connector info+](element=byLines)
isAlmostEqualTo = Geometry.IsAlmostEqualTo(geometry=location, other=mep_connector_info_2.Points)
filterByBoolMask_4 = List.FilterByBoolMask(list=mep_connector_info_2.Connectors, mask=isAlmostEqualTo)
flatten_4 = List.Flatten(list=filterByBoolMask_4.in)
connectTo = Custom[Connector.ConnectTo](connector=flatten_3, Connector2=flatten_4, lacing=Shortest)  # package MEPover; Connects a connector to another connector. Returns True if connection succeeded
flatten_5 = List.Flatten(list=filterByBoolMask_2.out)
isAlmostEqualTo_2 = Geometry.IsAlmostEqualTo(geometry=location_2, other=mep_connector_info_2.Points)
filterByBoolMask_5 = List.FilterByBoolMask(list=mep_connector_info_2.Connectors, mask=isAlmostEqualTo_2)
flatten_6 = List.Flatten(list=filterByBoolMask_5.in)
connectTo_2 = Custom[Connector.ConnectTo](connector=flatten_5, Connector2=flatten_6, lacing=Shortest)
owner = MEP.Connectors.Owner(connector=flatten_4)
owner_2 = MEP.Connectors.Owner(connector=flatten_6)
