# Dynamo graph 12-0_BIMACON_Conectar Conexões_R02_script.dyn "ok 2021_12-0_BIMACON_Conectar Conexões_R02_script" (Dynamo 2.19.3.6394)
# author: Jose Nelson
# Conecta conexões elétricas
# packages: archi-lab.net 2023.213.1722, Rhythm 2023.4.2021

# group: Mensagem
boolean = BoolSelector(true)
code_block = CodeBlock { ["Selecione o Elemento a ser conectado (será movido)"]; }
code_block_2 = CodeBlock { ["Nenhum objeto selecionado"]; }
if_ = If(test=boolean, true=code_block, false=code_block_2)
fromList = Python(IN[0]=if_)  # "String.FromList"; IronPython2
# ---------- fromList.python (22 lines) ----------
# Carregar as bibliotecas DesignScript e padrão do Python
import sys
import clr
clr.AddReference('ProtoGeometry')
from Autodesk.DesignScript.Geometry import *

# Função para concatenar os valores de uma lista em uma única string com múltiplas linhas
def concatenate_list_to_string(input_list, delimiter="\n"):
    # Verifica se a entrada é uma lista
    if not isinstance(input_list, list):
        return "A entrada deve ser uma lista."
    
    # Converte todos os elementos para string e junta com o delimitador especificado
    result = delimiter.join(str(item) for item in input_list)
    return result

# Entrada pelo nó do Dynamo
lista = IN[0]  # Lista de valores a serem concatenados
delimitador = IN[1] if len(IN) > 1 else "\n"  # Delimitador opcional, padrão é nova linha

# Saída para o Dynamo
OUT = concatenate_list_to_string(lista, delimitador)
# ----------------------------------------
window_prompt_with_text = Python(IN[0]=fromList)  # IronPython2
# ---------- window_prompt_with_text.python (26 lines) ----------
# Importando as bibliotecas necessárias da API do Revit
import clr
clr.AddReference('RevitServices')  # Referência aos serviços do Revit
from RevitServices.Persistence import DocumentManager

clr.AddReference('RevitAPI')  # Referência à API do Revit
clr.AddReference('RevitAPIUI')  # Referência à API de Interface de Usuário do Revit

from Autodesk.Revit.UI import TaskDialog, TaskDialogCommonButtons, TaskDialogResult

# Recebe o texto de instrução como entrada do nó
instrucoes = IN[0]

# Criando o TaskDialog
dialog = TaskDialog("Aviso")
dialog.MainInstruction = instrucoes
dialog.CommonButtons = TaskDialogCommonButtons.Ok

# Exibindo o dialog para o usuário e capturando a resposta
resultado = dialog.Show()

# Interpretando a resposta
if resultado == TaskDialogCommonButtons.Ok:
    OUT = "Ok"
else:
    OUT = "True"
# ----------------------------------------

# group: ENTRADAS PARA O USUÁRIO
categories = Categories("OST_ConduitFitting")
categories_2 = Categories("OST_Conduit")
categories_3 = Categories("OST_CableTray")
categories_4 = Categories("OST_CableTrayFitting")
categories_5 = Categories("OST_ElectricalEquipment")
categories_6 = Categories("OST_LightingFixtures")
categories_7 = Categories("OST_CommunicationDevices")
categories_8 = Categories("OST_DataDevices")
categories_9 = Categories("OST_LightingDevices")
categories_10 = Categories("OST_SecurityDevices")
categories_11 = Categories("OST_TelephoneDevices")
categories_12 = Categories("OST_ElectricalFixtures")
list_create = List.Create(item0=categories, item1=categories_2, item2=categories_3, item3=categories_4, item4=categories_5, item5=categories_6, item6=categories_7, item7=categories_8, item8=categories_9, item9=categories_10, item10=categories_11, item11=categories_12)
flatten = List.Flatten(list=list_create)

boolean_2 = BoolSelector(true)
ʳʰʸᵗʰᵐ_selection_pick = Rhythm.Revit.Selection.Selection.Pick(runIt=window_prompt_with_text, category=flatten, singleSelection=boolean_2)
passThrough = Custom[PassThrough](passThrough=window_prompt_with_text, waitFor=ʳʰʸᵗʰᵐ_selection_pick)  # package archi-lab.net; Ripped this off from Clockwork. Sorry Andy.

# group: Mensagem
code_block_3 = CodeBlock { ["Selecione o Elemento a conectar"]; }
code_block_4 = CodeBlock { ["Nenhum objeto selecionado"]; }
if_2 = If(test=passThrough, true=code_block_3, false=code_block_4)
fromList_2 = Python(IN[0]=if_2)  # "String.FromList"; IronPython2; same code as fromList
window_prompt_with_text_2 = Python(IN[0]=fromList_2)  # IronPython2; same code as window_prompt_with_text
boolean_3 = BoolSelector(true)

ʳʰʸᵗʰᵐ_selection_pick_2 = Rhythm.Revit.Selection.Selection.Pick(runIt=window_prompt_with_text_2, category=flatten, singleSelection=boolean_2)
passThrough_2 = Custom[PassThrough](passThrough=ʳʰʸᵗʰᵐ_selection_pick, waitFor=ʳʰʸᵗʰᵐ_selection_pick_2)
python_script = Python(IN[0]=passThrough_2, IN[1]=ʳʰʸᵗʰᵐ_selection_pick_2)  # IronPython2
# ---------- python_script.python (115 lines) ----------
# coding: utf-8
import clr
from math import pi

# ======= Importações Padrão do Dynamo e Revit =======
clr.AddReference('ProtoGeometry')
from Autodesk.DesignScript.Geometry import *

clr.AddReference('RevitServices')
import RevitServices
from RevitServices.Persistence import DocumentManager
from RevitServices.Transactions import TransactionManager

clr.AddReference('RevitAPI')
from Autodesk.Revit.DB import *

# Documento ativo do Revit
doc = DocumentManager.Instance.CurrentDBDocument

# ======= Funções Auxiliares =======

def get_connector_manager(element):
    """Retorna o ConnectorManager do elemento, se disponível."""
    if isinstance(element, MEPCurve):
        return element.ConnectorManager
    elif isinstance(element, FamilyInstance) and element.MEPModel is not None:
        return element.MEPModel.ConnectorManager
    return None

def get_unused_connectors(connector_manager):
    """Retorna os conectores não conectados."""
    if connector_manager is None:
        return []
    return [conn for conn in connector_manager.Connectors if not conn.IsConnected]

def get_connector_closest_to(connectors, xyz):
    """Retorna o conector mais próximo de um ponto XYZ."""
    min_distance = float('inf')
    closest_connector = None
    for connector in connectors:
        distance = connector.Origin.DistanceTo(xyz)
        if distance < min_distance:
            min_distance = distance
            closest_connector = connector
    return closest_connector

def rotate_element(element, axis_point, axis_direction, angle):
    """Rotaciona um elemento em torno de um eixo definido por um ponto e uma direção."""
    line = Line.CreateBound(axis_point, axis_point + axis_direction)
    try:
        element.Location.Rotate(line, angle)
    except Exception as e:
        raise Exception("Erro durante a rotação: {}".format(str(e)))

def move_element(element, translation_vector):
    """Move um elemento conforme um vetor de translação."""
    try:
        element.Location.Move(translation_vector)
    except Exception as e:
        raise Exception("Erro durante o movimento: {}".format(str(e)))

def connect_elements(elem1, elem2):
    """Realiza a conexão entre dois elementos com base em seus conectores."""
    connector_manager1 = get_connector_manager(elem1)
    connector_manager2 = get_connector_manager(elem2)

    if not connector_manager1 or not connector_manager2:
        raise Exception("Um ou ambos os elementos não possuem conectores.")

    connectors1 = get_unused_connectors(connector_manager1)
    connectors2 = get_unused_connectors(connector_manager2)

    if not connectors1 or not connectors2:
        raise Exception("Não há conectores livres em um ou ambos os elementos.")

    # Encontrar conectores mais próximos
    closest_connector1 = get_connector_closest_to(connectors1, connectors2[0].Origin)
    closest_connector2 = get_connector_closest_to(connectors2, closest_connector1.Origin)

    if closest_connector1.Domain != closest_connector2.Domain:
        raise Exception("Os conectores são de domínios diferentes e não podem ser conectados.")

    # Ajustar rotação para alinhar conectores
    direction1 = closest_connector1.CoordinateSystem.BasisZ
    direction2 = closest_connector2.CoordinateSystem.BasisZ
    angle = direction1.AngleTo(direction2)

    if angle and angle != pi:
        rotation_vector = direction1.CrossProduct(direction2)
        rotate_element(elem1, closest_connector1.Origin, rotation_vector, angle - pi)

    # Mover o elemento para alinhar as origens dos conectores
    translation_vector = closest_connector2.Origin - closest_connector1.Origin
    move_element(elem1, translation_vector)

    # Conectar os conectores
    closest_connector1.ConnectTo(closest_connector2)
    return "Conexão realizada com sucesso!"

# ======= Entradas do Dynamo =======
element1 = UnwrapElement(IN[0])  # Primeiro elemento
element2 = UnwrapElement(IN[1])  # Segundo elemento

# ======= Iniciar Transação =======
TransactionManager.Instance.EnsureInTransaction(doc)

try:
    resultado = connect_elements(element1, element2)
except Exception as e:
    resultado = "Erro: {}".format(str(e))

# ======= Finalizar Transação =======
TransactionManager.Instance.TransactionTaskDone()

OUT = resultado
# ----------------------------------------
python_script_2 = Python(IN[0]=python_script)  # IronPython2
# ---------- python_script_2.python (21 lines) ----------
# Importar as bibliotecas necessárias do Revit
import clr
clr.AddReference("RevitServices")
from RevitServices.Persistence import DocumentManager

clr.AddReference("RevitAPI")
clr.AddReference("RevitAPIUI")
from Autodesk.Revit.UI import TaskDialog

# Pegar a entrada do Dynamo
mensagem = IN[0]

# Criar a TaskDialog
task_dialog = TaskDialog("Ok")
task_dialog.MainInstruction = mensagem

# Exibir a TaskDialog
task_dialog.Show()

# Saída do script
OUT = "Sucesso!"
# ----------------------------------------
watch = Watch(python_script)
