# Dynamo graph 2021_12-0_BIMACON_Conectar Conexões_R00_script.dyn "2021_12-0_BIMACON_Juntar Conexões_R00" (Dynamo 2.6.1.8786)
# packages: Data-Shapes 2022.2.105

# group: ENTRADAS PARA O USUÁRIO
code_block = CodeBlock()  # //Data-Shapes
code_block_2 = CodeBlock()  # //archilab
code_block_3 = CodeBlock { "Emendar elementos por seleção"; }
file_path = Filename("..\..\..\..\..\05 - BIMACON\01 - EMPRESA BIMACON\00 - Logos e imagens - BIMACON\ARTE BIMACON\reddonda-removebg-preview.png")
file_from_path = FileObject(path=file_path)
readFromFile = Image.ReadFromFile(file=file_from_path)
string = StringInput("Concluir")
string_2 = StringInput("Selecione Objeto a ser Emendado")
string_3 = StringInput("Selecione")
categories = Categories("OST_ConduitFitting")
categories_2 = Categories("OST_CableTray")
boolean = BoolSelector(true)
string_4 = StringInput("Selecione 2ª Objeto ")
string_5 = StringInput("Selecione")
boolean_2 = BoolSelector(true)
boolean_3 = BoolSelector(true)
string_6 = StringInput("Cancelar")
number = DoubleInput(450)
number_2 = DoubleInput(205)

categories_3 = Categories("OST_Conduit")
categories_4 = Categories("OST_CableTrayFitting")
categories_5 = Categories("OST_ElectricalEquipment")
list_create = List.Create(item0=categories, item1=categories_3, item2=categories_2, item3=categories_4, item4=categories_5)
flatten = List.Flatten(list=list_create)

# group (continued): ENTRADAS PARA O USUÁRIO
selectmodelelements_data = Custom[SelectModelElements Data](InputName=string_2, ButtonText=string_3, CategoryFilter=flatten, SelectSingleElement=boolean)  # package Data-Shapes; Creates a Revit element selection input for UI.MultipleInputForm++ . Check out www.data-shapes.net for more infos!
selectmodelelements_data_2 = Custom[SelectModelElements Data](InputName=string_4, ButtonText=string_5, CategoryFilter=flatten, SelectSingleElement=boolean_2)
list_create_2 = List.Create(item0=selectmodelelements_data, item1=selectmodelelements_data_2)
multipleinputform = Custom[MultipleInputForm ++](Description_optional=code_block_3, Logo_optional=readFromFile, ButtonText_optional=string, Inputs=list_create_2, Toggle=boolean_3, CancelButtonText_optional=string_6, Width_optional=number, LabelWidth_optional=number_2)  # package Data-Shapes; Create a form with multiple inputs. see www.data-shapes.net for tutorials and infos!

# group: Separar Entradas
code_block_4 = CodeBlock { 0; }
getItemAtIndex = List.GetItemAtIndex(list=multipleinputform.User_Inputs, index=code_block_4)
code_block_5 = CodeBlock { 1; }
getItemAtIndex_2 = List.GetItemAtIndex(list=multipleinputform.User_Inputs, index=code_block_5)

python_script = Python(IN[0]=getItemAtIndex, IN[1]=getItemAtIndex_2)
# ---------- python_script.python (110 lines) ----------
# coding: utf-8
import clr
from math import pi

# Importações padrão do Dynamo
clr.AddReference('ProtoGeometry')
from Autodesk.DesignScript.Geometry import *

clr.AddReference('RevitNodes')
import Revit
clr.ImportExtensions(Revit.Elements)
clr.ImportExtensions(Revit.GeometryConversion)

clr.AddReference("RevitServices")
import RevitServices
from RevitServices.Persistence import DocumentManager
from RevitServices.Transactions import TransactionManager

clr.AddReference('RevitAPI')
clr.AddReference('RevitAPIUI')
from Autodesk.Revit.DB import *
from Autodesk.Revit.Exceptions import *

# Obter o documento ativo do Revit
doc = DocumentManager.Instance.CurrentDBDocument

# Funções Auxiliares
class NoConnectorManagerError(LookupError):
    pass

def get_connector_manager(element):
    """Retorna o ConnectorManager de um elemento."""
    try:
        return element.ConnectorManager  # Para elementos como pipes, ducts, etc.
    except AttributeError:
        pass
    try:
        return element.MEPModel.ConnectorManager  # Para FamilyInstances
    except AttributeError:
        raise NoConnectorManagerError("Não foi possível localizar o ConnectorManager no elemento fornecido.")

def get_connector_closest_to(connectors, xyz):
    """Obtém o conector mais próximo de um ponto XYZ."""
    min_distance = float("inf")
    closest_connector = None
    for connector in connectors:
        distance = connector.Origin.DistanceTo(xyz)
        if distance < min_distance:
            min_distance = distance
            closest_connector = connector
    return closest_connector

# Entradas do Dynamo
element1 = UnwrapElement(IN[0])  # Primeiro elemento selecionado
element2 = UnwrapElement(IN[1])  # Segundo elemento selecionado

try:
    # Obter os gerenciadores de conectores
    connector_manager1 = get_connector_manager(element1)
    connector_manager2 = get_connector_manager(element2)

    # Obter os conectores disponíveis (não utilizados)
    connectors1 = list(connector_manager1.Connectors)
    connectors2 = list(connector_manager2.Connectors)

    # Identificar os conectores mais próximos entre os dois elementos
    closest_connector1 = get_connector_closest_to(connectors1, connectors2[0].Origin)
    closest_connector2 = get_connector_closest_to(connectors2, closest_connector1.Origin)

    # Verificar se os conectores pertencem ao mesmo domínio
    if closest_connector1.Domain != closest_connector2.Domain:
        OUT = "Os conectores selecionados pertencem a domínios diferentes. Conexão inválida."
    else:
        # Obter direções dos conectores
        direction1 = closest_connector1.CoordinateSystem.BasisZ
        direction2 = closest_connector2.CoordinateSystem.BasisZ

        # Calcular o ângulo entre as direções
        angle = direction1.AngleTo(direction2)
        translation_vector = closest_connector2.Origin - closest_connector1.Origin

        # Inicia transação para mover e rotacionar o elemento
        TransactionManager.Instance.EnsureInTransaction(doc)

        # Se necessário, rotacionar o elemento para alinhar os conectores
        if angle != pi:
            if angle == 0:
                vector = closest_connector1.CoordinateSystem.BasisY
            else:
                vector = direction1.CrossProduct(direction2)
            try:
                line = Line.CreateBound(closest_connector1.Origin, closest_connector1.Origin + vector)
                element1.Location.Rotate(line, angle - pi)
            except ArgumentsInconsistentException:
                OUT = "Erro durante a rotação. Verifique os vetores ou ângulo."

        # Mover o elemento para alinhar os conectores
        element1.Location.Move(translation_vector)

        # Conectar os conectores
        closest_connector1.ConnectTo(closest_connector2)

        # Finaliza a transação
        TransactionManager.Instance.TransactionTaskDone()

        OUT = "Conexão realizada com sucesso!"
except NoConnectorManagerError as e:
    OUT = "Erro: {0}".format(str(e))
except Exception as e:
    OUT = "Erro inesperado: {0}".format(str(e))
# ----------------------------------------
python_script_2 = Python(IN[0]=python_script)
# ---------- python_script_2.python (21 lines) ----------
# Importar as bibliotecas necessárias do Revit
import clr
clr.AddReference("RevitServices")
from RevitServices.Persistence import DocumentManager

clr.AddReference("RevitAPI")
clr.AddReference("RevitAPIUI")
from Autodesk.Revit.UI import TaskDialog

# Pegar a entrada do Dynamo
mensagem = IN[0]

# Criar a TaskDialog
task_dialog = TaskDialog("Ok")
task_dialog.MainInstruction = mensagem

# Exibir a TaskDialog
task_dialog.Show()

# Saída do script
OUT = "Sucesso!"
# ----------------------------------------
