# Dynamo graph ok 2021_12-0_BIMACON_Conectar Conexões_R01_script.dyn (Dynamo 2.6.1.8786)
# packages: archi-lab.net 2023.213.1722, Rhythm 2023.4.2021

# group: Mensagem
boolean = BoolSelector(true)
code_block = CodeBlock { ["Selecione o Elemento a ser conectado (será movido)"]; }
code_block_2 = CodeBlock { ["Nenhum objeto selecionado"]; }
if_ = If(test=boolean, true=code_block, false=code_block_2)
fromList = Python(IN[0]=if_)  # "String.FromList"
# ---------- fromList.python (22 lines) ----------
# Carregar as bibliotecas DesignScript e padrão do Python
import sys
import clr
clr.AddReference('ProtoGeometry')
from Autodesk.DesignScript.Geometry import *

# Função para concatenar os valores de uma lista em uma única string com múltiplas linhas
def concatenate_list_to_string(input_list, delimiter="\n"):
    # Verifica se a entrada é uma lista
    if not isinstance(input_list, list):
        return "A entrada deve ser uma lista."
    
    # Converte todos os elementos para string e junta com o delimitador especificado
    result = delimiter.join(str(item) for item in input_list)
    return result

# Entrada pelo nó do Dynamo
lista = IN[0]  # Lista de valores a serem concatenados
delimitador = IN[1] if len(IN) > 1 else "\n"  # Delimitador opcional, padrão é nova linha

# Saída para o Dynamo
OUT = concatenate_list_to_string(lista, delimitador)
# ----------------------------------------
window_prompt_with_text = Python(IN[0]=fromList)
# ---------- window_prompt_with_text.python (26 lines) ----------
# Importando as bibliotecas necessárias da API do Revit
import clr
clr.AddReference('RevitServices')  # Referência aos serviços do Revit
from RevitServices.Persistence import DocumentManager

clr.AddReference('RevitAPI')  # Referência à API do Revit
clr.AddReference('RevitAPIUI')  # Referência à API de Interface de Usuário do Revit

from Autodesk.Revit.UI import TaskDialog, TaskDialogCommonButtons, TaskDialogResult

# Recebe o texto de instrução como entrada do nó
instrucoes = IN[0]

# Criando o TaskDialog
dialog = TaskDialog("Aviso")
dialog.MainInstruction = instrucoes
dialog.CommonButtons = TaskDialogCommonButtons.Ok

# Exibindo o dialog para o usuário e capturando a resposta
resultado = dialog.Show()

# Interpretando a resposta
if resultado == TaskDialogCommonButtons.Ok:
    OUT = "Ok"
else:
    OUT = "True"
# ----------------------------------------

# group: ENTRADAS PARA O USUÁRIO
categories = Categories("OST_ConduitFitting")
categories_2 = Categories("OST_Conduit")
categories_3 = Categories("OST_CableTray")
categories_4 = Categories("OST_CableTrayFitting")
categories_5 = Categories("OST_ElectricalEquipment")
list_create = List.Create(item0=categories, item1=categories_2, item2=categories_3, item3=categories_4, item4=categories_5)
flatten = List.Flatten(list=list_create)

boolean_2 = BoolSelector(true)
ʳʰʸᵗʰᵐ_selection_pick = Rhythm.Revit.Selection.Selection.Pick(runIt=window_prompt_with_text, category=flatten, singleSelection=boolean_2)
passThrough = Custom[PassThrough](passThrough=window_prompt_with_text, waitFor=ʳʰʸᵗʰᵐ_selection_pick)  # package archi-lab.net; Ripped this off from Clockwork. Sorry Andy.

# group: Mensagem
code_block_3 = CodeBlock { ["Selecione o Elemento a conectar"]; }
code_block_4 = CodeBlock { ["Nenhum objeto selecionado"]; }
if_2 = If(test=passThrough, true=code_block_3, false=code_block_4)
fromList_2 = Python(IN[0]=if_2)  # "String.FromList"; same code as fromList
window_prompt_with_text_2 = Python(IN[0]=fromList_2)  # same code as window_prompt_with_text
boolean_3 = BoolSelector(true)

ʳʰʸᵗʰᵐ_selection_pick_2 = Rhythm.Revit.Selection.Selection.Pick(runIt=window_prompt_with_text_2, category=flatten, singleSelection=boolean_2)
passThrough_2 = Custom[PassThrough](passThrough=ʳʰʸᵗʰᵐ_selection_pick, waitFor=ʳʰʸᵗʰᵐ_selection_pick_2)
python_script = Python(IN[0]=passThrough_2, IN[1]=ʳʰʸᵗʰᵐ_selection_pick_2)
# ---------- python_script.python (110 lines) ----------
# coding: utf-8
import clr
from math import pi

# Importações padrão do Dynamo
clr.AddReference('ProtoGeometry')
from Autodesk.DesignScript.Geometry import *

clr.AddReference('RevitNodes')
import Revit
clr.ImportExtensions(Revit.Elements)
clr.ImportExtensions(Revit.GeometryConversion)

clr.AddReference("RevitServices")
import RevitServices
from RevitServices.Persistence import DocumentManager
from RevitServices.Transactions import TransactionManager

clr.AddReference('RevitAPI')
clr.AddReference('RevitAPIUI')
from Autodesk.Revit.DB import *
from Autodesk.Revit.Exceptions import *

# Obter o documento ativo do Revit
doc = DocumentManager.Instance.CurrentDBDocument

# Funções Auxiliares
class NoConnectorManagerError(LookupError):
    pass

def get_connector_manager(element):
    """Retorna o ConnectorManager de um elemento."""
    try:
        return element.ConnectorManager  # Para elementos como pipes, ducts, etc.
    except AttributeError:
        pass
    try:
        return element.MEPModel.ConnectorManager  # Para FamilyInstances
    except AttributeError:
        raise NoConnectorManagerError("Não foi possível localizar o ConnectorManager no elemento fornecido.")

def get_connector_closest_to(connectors, xyz):
    """Obtém o conector mais próximo de um ponto XYZ."""
    min_distance = float("inf")
    closest_connector = None
    for connector in connectors:
        distance = connector.Origin.DistanceTo(xyz)
        if distance < min_distance:
            min_distance = distance
            closest_connector = connector
    return closest_connector

# Entradas do Dynamo
element1 = UnwrapElement(IN[0])  # Primeiro elemento selecionado
element2 = UnwrapElement(IN[1])  # Segundo elemento selecionado

try:
    # Obter os gerenciadores de conectores
    connector_manager1 = get_connector_manager(element1)
    connector_manager2 = get_connector_manager(element2)

    # Obter os conectores disponíveis (não utilizados)
    connectors1 = list(connector_manager1.Connectors)
    connectors2 = list(connector_manager2.Connectors)

    # Identificar os conectores mais próximos entre os dois elementos
    closest_connector1 = get_connector_closest_to(connectors1, connectors2[0].Origin)
    closest_connector2 = get_connector_closest_to(connectors2, closest_connector1.Origin)

    # Verificar se os conectores pertencem ao mesmo domínio
    if closest_connector1.Domain != closest_connector2.Domain:
        OUT = "Os conectores selecionados pertencem a domínios diferentes. Conexão inválida."
    else:
        # Obter direções dos conectores
        direction1 = closest_connector1.CoordinateSystem.BasisZ
        direction2 = closest_connector2.CoordinateSystem.BasisZ

        # Calcular o ângulo entre as direções
        angle = direction1.AngleTo(direction2)
        translation_vector = closest_connector2.Origin - closest_connector1.Origin

        # Inicia transação para mover e rotacionar o elemento
        TransactionManager.Instance.EnsureInTransaction(doc)

        # Se necessário, rotacionar o elemento para alinhar os conectores
        if angle != pi:
            if angle == 0:
                vector = closest_connector1.CoordinateSystem.BasisY
            else:
                vector = direction1.CrossProduct(direction2)
            try:
                line = Line.CreateBound(closest_connector1.Origin, closest_connector1.Origin + vector)
                element1.Location.Rotate(line, angle - pi)
            except ArgumentsInconsistentException:
                OUT = "Erro durante a rotação. Verifique os vetores ou ângulo."

        # Mover o elemento para alinhar os conectores
        element1.Location.Move(translation_vector)

        # Conectar os conectores
        closest_connector1.ConnectTo(closest_connector2)

        # Finaliza a transação
        TransactionManager.Instance.TransactionTaskDone()

        OUT = "Conexão realizada com sucesso!"
except NoConnectorManagerError as e:
    OUT = "Erro: {0}".format(str(e))
except Exception as e:
    OUT = "Erro inesperado: {0}".format(str(e))
# ----------------------------------------
python_script_2 = Python(IN[0]=python_script)
# ---------- python_script_2.python (21 lines) ----------
# Importar as bibliotecas necessárias do Revit
import clr
clr.AddReference("RevitServices")
from RevitServices.Persistence import DocumentManager

clr.AddReference("RevitAPI")
clr.AddReference("RevitAPIUI")
from Autodesk.Revit.UI import TaskDialog

# Pegar a entrada do Dynamo
mensagem = IN[0]

# Criar a TaskDialog
task_dialog = TaskDialog("Ok")
task_dialog.MainInstruction = mensagem

# Exibir a TaskDialog
task_dialog.Show()

# Saída do script
OUT = "Sucesso!"
# ----------------------------------------
