# Dynamo graph 12-1_BIMACON_Desconectar Conexões_R02_script.dyn "ok 2021_12-1_BIMACON_Desconectar Conexões_R02_script" (Dynamo 2.19.3.6394)
# author: Jose Nelson
# Desconecta conexões elétricas
# packages: Data-Shapes 2022.2.105

# group: ENTRADAS PARA O USUÁRIO
categories = Categories("OST_ConduitFitting")
categories_2 = Categories("OST_Conduit")
categories_3 = Categories("OST_CableTray")
categories_4 = Categories("OST_CableTrayFitting")
categories_5 = Categories("OST_ElectricalEquipment")
categories_6 = Categories("OST_LightingFixtures")
categories_7 = Categories("OST_CommunicationDevices")
categories_8 = Categories("OST_DataDevices")
categories_9 = Categories("OST_LightingDevices")
categories_10 = Categories("OST_SecurityDevices")
categories_11 = Categories("OST_TelephoneDevices")
categories_12 = Categories("OST_ElectricalFixtures")
list_create = List.Create(item0=categories, item1=categories_2, item2=categories_3, item3=categories_4, item4=categories_5, item5=categories_6, item6=categories_7, item7=categories_8, item8=categories_9, item9=categories_10, item10=categories_11, item11=categories_12)
flatten = List.Flatten(list=list_create)

# group: Mensagem
boolean = BoolSelector(true)
code_block = CodeBlock { ["Selecione Elementos a serem Desconectados e clique em Concluir"]; }
code_block_2 = CodeBlock { ["Nenhum objeto foi selecionado"]; }
if_ = If(test=boolean, true=code_block, false=code_block_2)
fromList = Python(IN[0]=if_)  # "String.FromList"; IronPython2
# ---------- fromList.python (22 lines) ----------
# Carregar as bibliotecas DesignScript e padrão do Python
import sys
import clr
clr.AddReference('ProtoGeometry')
from Autodesk.DesignScript.Geometry import *

# Função para concatenar os valores de uma lista em uma única string com múltiplas linhas
def concatenate_list_to_string(input_list, delimiter="\n"):
    # Verifica se a entrada é uma lista
    if not isinstance(input_list, list):
        return "A entrada deve ser uma lista."
    
    # Converte todos os elementos para string e junta com o delimitador especificado
    result = delimiter.join(str(item) for item in input_list)
    return result

# Entrada pelo nó do Dynamo
lista = IN[0]  # Lista de valores a serem concatenados
delimitador = IN[1] if len(IN) > 1 else "\n"  # Delimitador opcional, padrão é nova linha

# Saída para o Dynamo
OUT = concatenate_list_to_string(lista, delimitador)
# ----------------------------------------
window_prompt_with_text = Python(IN[0]=fromList)  # IronPython2
# ---------- window_prompt_with_text.python (26 lines) ----------
# Importando as bibliotecas necessárias da API do Revit
import clr
clr.AddReference('RevitServices')  # Referência aos serviços do Revit
from RevitServices.Persistence import DocumentManager

clr.AddReference('RevitAPI')  # Referência à API do Revit
clr.AddReference('RevitAPIUI')  # Referência à API de Interface de Usuário do Revit

from Autodesk.Revit.UI import TaskDialog, TaskDialogCommonButtons, TaskDialogResult

# Recebe o texto de instrução como entrada do nó
instrucoes = IN[0]

# Criando o TaskDialog
dialog = TaskDialog("Aviso")
dialog.MainInstruction = instrucoes
dialog.CommonButtons = TaskDialogCommonButtons.Ok

# Exibindo o dialog para o usuário e capturando a resposta
resultado = dialog.Show()

# Interpretando a resposta
if resultado == TaskDialogCommonButtons.Ok:
    OUT = "Ok"
else:
    OUT = "True"
# ----------------------------------------
select_model_elements_of = Custom[Select Model Elements of Category](Categories=flatten, Toggle=window_prompt_with_text)  # package Data-Shapes; Allows to perform a manual selection with a category filter.

flatten_2 = List.Flatten(list=select_model_elements_of)
python_script = Python(IN[0]=flatten_2)  # IronPython2
# ---------- python_script.python (86 lines) ----------
# coding: utf-8
import clr

# Importações padrão para o Dynamo
clr.AddReference('ProtoGeometry')
from Autodesk.DesignScript.Geometry import *

clr.AddReference('RevitNodes')
import Revit
clr.ImportExtensions(Revit.Elements)
clr.ImportExtensions(Revit.GeometryConversion)

clr.AddReference("RevitServices")
import RevitServices
from RevitServices.Persistence import DocumentManager
from RevitServices.Transactions import TransactionManager

clr.AddReference('RevitAPI')
clr.AddReference('RevitAPIUI')
from Autodesk.Revit.DB import *

# Obter o documento ativo do Revit
doc = DocumentManager.Instance.CurrentDBDocument

# Classe personalizada para tratar erros
class NoConnectorManagerError(LookupError):
    pass

# Funções auxiliares
def get_connector_manager(element):
    """Retorna o ConnectorManager de um elemento."""
    try:
        return element.ConnectorManager  # Para elementos como pipes, ducts, etc.
    except AttributeError:
        pass
    try:
        return element.MEPModel.ConnectorManager  # Para FamilyInstances
    except AttributeError:
        raise NoConnectorManagerError("Não foi possível localizar o ConnectorManager no elemento fornecido.")

def disconnect_all_connectors(element):
    """Desconecta todos os conectores do elemento selecionado."""
    connector_manager = get_connector_manager(element)
    for connector in connector_manager.Connectors:
        if not connector.IsConnected:
            continue
        for other_connector in connector.AllRefs:
            if other_connector == connector:
                continue
            connector.DisconnectFrom(other_connector)

        system = connector.MEPSystem
        if system and system.IsMultipleNetwork:
            system.DivideSystem(doc)

def process_elements(elements):
    """Processa recursivamente uma lista de elementos (incluindo listas aninhadas)."""
    results = []
    for el in elements:
        if isinstance(el, list):
            results.extend(process_elements(el))  # Recursão para listas aninhadas
        else:
            element_name = el.Name if hasattr(el, 'Name') else "Sem nome"
            try:
                disconnect_all_connectors(el)
                results.append("Conectores desconectados: {} (ID: {})".format(element_name, el.Id))
            except NoConnectorManagerError as e:
                results.append("Erro no elemento {} (ID: {}): {}".format(element_name, el.Id, str(e)))
            except Exception as e:
                results.append("Erro inesperado no elemento {} (ID: {}): {}".format(element_name, el.Id, str(e)))
    return results

# Entradas do Dynamo (lista com múltiplos níveis)
elements = [UnwrapElement(el) for el in IN[0]]

# Iniciar transação
TransactionManager.Instance.EnsureInTransaction(doc)

# Processar elementos
results = process_elements(elements)

# Finalizar transação
TransactionManager.Instance.TransactionTaskDone()

# Saída do script
OUT = results
# ----------------------------------------
fromList_2 = Python(IN[0]=python_script)  # "String.FromList"; IronPython2; same code as fromList
python_script_2 = Python(IN[0]=fromList_2)  # IronPython2
# ---------- python_script_2.python (21 lines) ----------
# Importar as bibliotecas necessárias do Revit
import clr
clr.AddReference("RevitServices")
from RevitServices.Persistence import DocumentManager

clr.AddReference("RevitAPI")
clr.AddReference("RevitAPIUI")
from Autodesk.Revit.UI import TaskDialog

# Pegar a entrada do Dynamo
mensagem = IN[0]

# Criar a TaskDialog
task_dialog = TaskDialog("Ok")
task_dialog.MainInstruction = mensagem

# Exibir a TaskDialog
task_dialog.Show()

# Saída do script
OUT = "Sucesso!"
# ----------------------------------------
