# Dynamo graph 2021_12-0_BIMACON_Desconectar Conexões_R00_script.dyn "2021_12-0_BIMACON_Desconectar Conexões_R00" (Dynamo 2.6.1.8786)
# packages: Data-Shapes 2022.2.105, Orchid 2.6.10.6373

# group: ENTRADAS PARA O USUÁRIO
code_block = CodeBlock()  # //Data-Shapes
code_block_2 = CodeBlock()  # //archilab
code_block_3 = CodeBlock { "Desconectar elementos por seleção"; }
file_path = Filename("..\..\..\..\..\05 - BIMACON\01 - EMPRESA BIMACON\00 - Logos e imagens - BIMACON\ARTE BIMACON\reddonda-removebg-preview.png")
file_from_path = FileObject(path=file_path)
readFromFile = Image.ReadFromFile(file=file_from_path)
string = StringInput("Concluir")
string_2 = StringInput("Selecione Objeto a ser Desconectado")
string_3 = StringInput("Selecione")
categories = Categories("OST_ConduitFitting")
categories_2 = Categories("OST_CableTray")
boolean = BoolSelector(true)
boolean_2 = BoolSelector(true)
string_4 = StringInput("Cancelar")
number = DoubleInput(450)
number_2 = DoubleInput(205)

categories_3 = Categories("OST_Conduit")
categories_4 = Categories("OST_CableTrayFitting")
categories_5 = Categories("OST_ElectricalEquipment")
list_create = List.Create(item0=categories, item1=categories_3, item2=categories_2, item3=categories_4, item4=categories_5)
flatten = List.Flatten(list=list_create)

# group (continued): ENTRADAS PARA O USUÁRIO
selectmodelelements_data = Custom[SelectModelElements Data](InputName=string_2, ButtonText=string_3, CategoryFilter=flatten, SelectSingleElement=boolean)  # package Data-Shapes; Creates a Revit element selection input for UI.MultipleInputForm++ . Check out www.data-shapes.net for more infos!
list_create_2 = List.Create(item0=selectmodelelements_data)
multipleinputform = Custom[MultipleInputForm ++](Description_optional=code_block_3, Logo_optional=readFromFile, ButtonText_optional=string, Inputs=list_create_2, Toggle=boolean_2, CancelButtonText_optional=string_4, Width_optional=number, LabelWidth_optional=number_2)  # package Data-Shapes; Create a form with multiple inputs. see www.data-shapes.net for tutorials and infos!

# group: Separar Entradas
code_block_4 = CodeBlock { 0; }
getItemAtIndex = List.GetItemAtIndex(list=multipleinputform.User_Inputs, index=code_block_4)

python_script = Python(IN[0]=getItemAtIndex)
# ---------- python_script.python (80 lines) ----------
# coding: utf-8
import clr

# Importações padrão para o Dynamo
clr.AddReference('ProtoGeometry')
from Autodesk.DesignScript.Geometry import *

clr.AddReference('RevitNodes')
import Revit
clr.ImportExtensions(Revit.Elements)
clr.ImportExtensions(Revit.GeometryConversion)

clr.AddReference("RevitServices")
import RevitServices
from RevitServices.Persistence import DocumentManager
from RevitServices.Transactions import TransactionManager

clr.AddReference('RevitAPI')
clr.AddReference('RevitAPIUI')
from Autodesk.Revit.DB import *

# Obter o documento ativo do Revit
doc = DocumentManager.Instance.CurrentDBDocument

# Classe personalizada para tratar erros
class NoConnectorManagerError(LookupError):
    pass

# Funções auxiliares
def get_connector_manager(element):
    """Retorna o ConnectorManager de um elemento."""
    try:
        return element.ConnectorManager  # Para elementos como pipes, ducts, etc.
    except AttributeError:
        pass
    try:
        return element.MEPModel.ConnectorManager  # Para FamilyInstances
    except AttributeError:
        raise NoConnectorManagerError("Não foi possível localizar o ConnectorManager no elemento fornecido.")

def disconnect_all_connectors(element):
    """Desconecta todos os conectores do elemento selecionado."""
    connector_manager = get_connector_manager(element)
    for connector in connector_manager.Connectors:
        # Ignorar conectores que não estão conectados
        if not connector.IsConnected:
            continue
        # Desconectar de todos os conectores ligados
        for other_connector in connector.AllRefs:
            if other_connector == connector:
                continue
            connector.DisconnectFrom(other_connector)

        # Dividir o sistema caso exista
        system = connector.MEPSystem
        if system and system.IsMultipleNetwork:
            system.DivideSystem(doc)

# Entradas do Dynamo
elements = [UnwrapElement(el) for el in IN]  # Lista de elementos fornecidos no Dynamo

# Iniciar transação
TransactionManager.Instance.EnsureInTransaction(doc)

# Desconectar conectores para cada elemento fornecido
results = []
for element in elements:
    try:
        disconnect_all_connectors(element)
        results.append("Conectores desconectados com sucesso: Elemento ID {}".format(element.Id))
    except NoConnectorManagerError as e:
        results.append("Erro no elemento ID {}: {}".format(element.Id, str(e)))
    except Exception as e:
        results.append("Erro inesperado no elemento ID {}: {}".format(element.Id, str(e)))

# Finalizar transação
TransactionManager.Instance.TransactionTaskDone()

# Saída do script
OUT = results
# ----------------------------------------
o_string_fromlist = Orchid.Common.String.FromList(list=python_script)
python_script_2 = Python(IN[0]=o_string_fromlist)
# ---------- python_script_2.python (21 lines) ----------
# Importar as bibliotecas necessárias do Revit
import clr
clr.AddReference("RevitServices")
from RevitServices.Persistence import DocumentManager

clr.AddReference("RevitAPI")
clr.AddReference("RevitAPIUI")
from Autodesk.Revit.UI import TaskDialog

# Pegar a entrada do Dynamo
mensagem = IN[0]

# Criar a TaskDialog
task_dialog = TaskDialog("Ok")
task_dialog.MainInstruction = mensagem

# Exibir a TaskDialog
task_dialog.Show()

# Saída do script
OUT = "Sucesso!"
# ----------------------------------------
