# Dynamo graph ok 2021_12-1_BIMACON_Desconectar Conexões_R01_script.dyn (Dynamo 2.6.1.8786)
# packages: Orchid 2.6.10.6373, Data-Shapes 2022.2.105

# group: ENTRADAS PARA O USUÁRIO
categories = Categories("OST_ConduitFitting")
categories_2 = Categories("OST_Conduit")
categories_3 = Categories("OST_CableTray")
categories_4 = Categories("OST_CableTrayFitting")
categories_5 = Categories("OST_ElectricalEquipment")
list_create = List.Create(item0=categories, item1=categories_2, item2=categories_3, item3=categories_4, item4=categories_5)
flatten = List.Flatten(list=list_create)

# group: Mensagem
boolean = BoolSelector(true)
code_block = CodeBlock { ["Selecione Objeto a ser Desconectado e clique em Concluir"]; }
code_block_2 = CodeBlock { ["Nenhum objeto foi selecionado"]; }
if_ = If(test=boolean, true=code_block, false=code_block_2)
o_string_fromlist = Orchid.Common.String.FromList(list=if_)
window_prompt_with_text = Python(IN[0]=o_string_fromlist)
# ---------- window_prompt_with_text.python (26 lines) ----------
# Importando as bibliotecas necessárias da API do Revit
import clr
clr.AddReference('RevitServices')  # Referência aos serviços do Revit
from RevitServices.Persistence import DocumentManager

clr.AddReference('RevitAPI')  # Referência à API do Revit
clr.AddReference('RevitAPIUI')  # Referência à API de Interface de Usuário do Revit

from Autodesk.Revit.UI import TaskDialog, TaskDialogCommonButtons, TaskDialogResult

# Recebe o texto de instrução como entrada do nó
instrucoes = IN[0]

# Criando o TaskDialog
dialog = TaskDialog("Aviso")
dialog.MainInstruction = instrucoes
dialog.CommonButtons = TaskDialogCommonButtons.Ok

# Exibindo o dialog para o usuário e capturando a resposta
resultado = dialog.Show()

# Interpretando a resposta
if resultado == TaskDialogCommonButtons.Ok:
    OUT = "Ok"
else:
    OUT = "True"
# ----------------------------------------
select_model_elements_of = Custom[Select Model Elements of Category](Categories=flatten, Toggle=window_prompt_with_text)  # package Data-Shapes; Allows to perform a manual selection with a category filter.

# group: Separar Entradas
code_block_3 = CodeBlock { 0; }
getItemAtIndex = List.GetItemAtIndex(list=select_model_elements_of, index=code_block_3)

python_script = Python(IN[0]=getItemAtIndex)
# ---------- python_script.python (80 lines) ----------
# coding: utf-8
import clr

# Importações padrão para o Dynamo
clr.AddReference('ProtoGeometry')
from Autodesk.DesignScript.Geometry import *

clr.AddReference('RevitNodes')
import Revit
clr.ImportExtensions(Revit.Elements)
clr.ImportExtensions(Revit.GeometryConversion)

clr.AddReference("RevitServices")
import RevitServices
from RevitServices.Persistence import DocumentManager
from RevitServices.Transactions import TransactionManager

clr.AddReference('RevitAPI')
clr.AddReference('RevitAPIUI')
from Autodesk.Revit.DB import *

# Obter o documento ativo do Revit
doc = DocumentManager.Instance.CurrentDBDocument

# Classe personalizada para tratar erros
class NoConnectorManagerError(LookupError):
    pass

# Funções auxiliares
def get_connector_manager(element):
    """Retorna o ConnectorManager de um elemento."""
    try:
        return element.ConnectorManager  # Para elementos como pipes, ducts, etc.
    except AttributeError:
        pass
    try:
        return element.MEPModel.ConnectorManager  # Para FamilyInstances
    except AttributeError:
        raise NoConnectorManagerError("Não foi possível localizar o ConnectorManager no elemento fornecido.")

def disconnect_all_connectors(element):
    """Desconecta todos os conectores do elemento selecionado."""
    connector_manager = get_connector_manager(element)
    for connector in connector_manager.Connectors:
        # Ignorar conectores que não estão conectados
        if not connector.IsConnected:
            continue
        # Desconectar de todos os conectores ligados
        for other_connector in connector.AllRefs:
            if other_connector == connector:
                continue
            connector.DisconnectFrom(other_connector)

        # Dividir o sistema caso exista
        system = connector.MEPSystem
        if system and system.IsMultipleNetwork:
            system.DivideSystem(doc)

# Entradas do Dynamo
elements = [UnwrapElement(el) for el in IN]  # Lista de elementos fornecidos no Dynamo

# Iniciar transação
TransactionManager.Instance.EnsureInTransaction(doc)

# Desconectar conectores para cada elemento fornecido
results = []
for element in elements:
    try:
        disconnect_all_connectors(element)
        results.append("Conectores desconectados com sucesso: Elemento ID {}".format(element.Id))
    except NoConnectorManagerError as e:
        results.append("Erro no elemento ID {}: {}".format(element.Id, str(e)))
    except Exception as e:
        results.append("Erro inesperado no elemento ID {}: {}".format(element.Id, str(e)))

# Finalizar transação
TransactionManager.Instance.TransactionTaskDone()

# Saída do script
OUT = results
# ----------------------------------------
o_string_fromlist_2 = Orchid.Common.String.FromList(list=python_script)
python_script_2 = Python(IN[0]=o_string_fromlist_2)
# ---------- python_script_2.python (21 lines) ----------
# Importar as bibliotecas necessárias do Revit
import clr
clr.AddReference("RevitServices")
from RevitServices.Persistence import DocumentManager

clr.AddReference("RevitAPI")
clr.AddReference("RevitAPIUI")
from Autodesk.Revit.UI import TaskDialog

# Pegar a entrada do Dynamo
mensagem = IN[0]

# Criar a TaskDialog
task_dialog = TaskDialog("Ok")
task_dialog.MainInstruction = mensagem

# Exibir a TaskDialog
task_dialog.Show()

# Saída do script
OUT = "Sucesso!"
# ----------------------------------------
