# Dynamo graph 17-1_BIMACON_Cotar Pontos Elétricos paralel_R06_script.dyn "ok 17-1_BIMACON_Cotar Pontos Elétricos paralel_R06_script" (Dynamo 2.19.3.6394)
# author: Jose Nelson
# Inseri cotas em Pontos elétricos com relação a arquitetura linkada
# packages: BIMCoder Nodes - 2.X 2025.1.0, Data-Shapes 2022.2.105

# group: SELECIONE O ESTILO DE COTA
code_block = CodeBlock()  # //Data-Shapes
code_block_2 = CodeBlock()  # //archilab
code_block_3 = CodeBlock { "Selecione o Estilo de Cotas:"; }
string = StringInput("LogoBimacon.png")
python_script = Python(IN[0]=string)  # IronPython2
# ---------- python_script.python (22 lines) ----------
import clr

# Adiciona referência ao ambiente .NET
clr.AddReference('System')
from System import Environment, IO

# Nome da imagem (entrada do usuário)
nome_arquivo_imagem = IN[0]

# Recupera o nome do usuário logado no Windows
usuario = Environment.UserName

# Monta o caminho completo para a pasta de imagens
caminho_base = r"C:\Users\{0}\AppData\Roaming\pyRevit\Extensions\Bimacon.extension\Bimacon.tab\Imagens_Bimacon".format(usuario)

# Junta o caminho base com o nome do arquivo
caminho_completo = IO.Path.Combine(caminho_base, nome_arquivo_imagem)

# Verifica se o arquivo existe
existe = IO.File.Exists(caminho_completo)

OUT = caminho_completo if existe else "Imagem não encontrada: {0}".format(caminho_completo)
# ----------------------------------------
file_from_path = FileObject(path=python_script)
readFromFile = Image.ReadFromFile(file=file_from_path)
string_2 = StringInput("Confirmar")
element_classes = ElementTypes("DimensionType")
all_elements_of_class = ElementsOfType(element_class=element_classes)
name = Element.Name(element=all_elements_of_class)
code_block_4 = CodeBlock { 23; }
dropdown_data = Custom[DropDown Data](Keys=name, Values=all_elements_of_class, DefaultValueIndex=code_block_4)  # package Data-Shapes; Create data for DropDown input in UI.MultiInputForm ++ . Check out www.data-shapes.net for more infos.
code_block_5 = CodeBlock { "Offset da Cota:"; }
string_3 = StringInput(".5")
boolean = BoolSelector(true)
textbox_data = Custom[TextBox Data](InputName=code_block_5, DefaultText=string_3, IsNumberEntry=boolean)  # package Data-Shapes; Create Data for TextBox input in UI.MultipleInputForm ++ . Check out www.data-shapes.net for more informations
list_create = List.Create(item0=dropdown_data, item1=textbox_data)
boolean_2 = BoolSelector(true)
string_4 = StringInput("Cancelar")
multipleinputform = Custom[MultipleInputForm ++](Description_optional=code_block_3, Logo_optional=readFromFile, ButtonText_optional=string_2, Inputs=list_create, Toggle=boolean_2, CancelButtonText_optional=string_4)  # package Data-Shapes; Create a form with multiple inputs. see www.data-shapes.net for tutorials and infos!
number = DoubleInput(0)
getItemAtIndex = List.GetItemAtIndex(list=multipleinputform.User_Inputs, index=number)
number_2 = DoubleInput(1)
getItemAtIndex_2 = List.GetItemAtIndex(list=multipleinputform.User_Inputs, index=number_2)

# group: Seleção dos elementos
categories = Categories("OST_ElectricalFixtures")
categories_2 = Categories("OST_LightingDevices")
categories_3 = Categories("OST_TelephoneDevices")
categories_4 = Categories("OST_DataDevices")
categories_5 = Categories("OST_ElectricalEquipment")
categories_6 = Categories("OST_LightingFixtures")
categories_7 = Categories("OST_SecurityDevices")
categories_8 = Categories("OST_CommunicationDevices")
categories_9 = Categories("OST_MechanicalEquipment")
categories_10 = Categories("OST_ConduitFitting")
list_create_2 = List.Create(item0=categories, item1=categories_2, item2=categories_3, item3=categories_4, item4=categories_5, item5=categories_6, item6=categories_7, item7=categories_8, item8=categories_9, item9=categories_10)
flatten = List.Flatten(list=list_create_2)
code_block_6 = CodeBlock { ["Selecione os pontos elétricos e clique em Concluir"]; }
dialog_simple = Custom[👓 Dialog․Simple](message=code_block_6, flow=getItemAtIndex)  # package BIMCoder Nodes - 2.X; Exibe uma mensagem de alerta ao usuário, sem botões de ação.

select_model_elements_of = Custom[Select Model Elements of Category](Categories=flatten, Toggle=dialog_simple)  # package Data-Shapes; Allows to perform a manual selection with a category filter.

# group: Filtrar os elementos
elementType = Element.ElementType(element=select_model_elements_of)
familyName = ElementType.FamilyName(elementType=elementType)
# note: Nome dos tipos para filtrar
code_block_7 = CodeBlock()
# ---------- code_block_7.designscript (14 lines) ----------
[

"Tomada",
"Interruptor",
"passagem",
"Quadro",
"Caixa",
"Sensor",
"Câmera",
"Lum.",
"Ar condicionado",
"Conjunto"

];
# ----------------------------------------
contains = String.Contains(string=familyName, searchFor=code_block_7@L1)
filterByBoolMask = List.FilterByBoolMask(list=select_model_elements_of, mask=contains@L2)

# group: Localização dos pontos
flatten_2 = List.Flatten(list=filterByBoolMask.in)
uniqueItems = List.UniqueItems(list=flatten_2)
familyinstance_referencebyname = Custom[👓 FamilyInstance․ReferenceByName](familyInstance=uniqueItems)  # package BIMCoder Nodes - 2.X; Obtém uma referência de uma família de instância dado o nome

# group: Linha Ref cota
getLocation = Element.GetLocation(element=uniqueItems)
facingOrientation = FamilyInstance.FacingOrientation(familyInstance=uniqueItems)
ZAxis = Vector.ZAxis()
number_3 = DoubleInput(90)
rotate = Vector.Rotate(vector=facingOrientation, axis=ZAxis, degrees=number_3)
byStartPointDirectionLength = Line.ByStartPointDirectionLength(startPoint=getLocation, direction=rotate)
firstItem = List.FirstItem(list=byStartPointDirectionLength)
firstItem_2 = List.FirstItem(list=facingOrientation)
reverse = Vector.Reverse(vector=firstItem_2)
translate = Geometry.Translate(geometry=firstItem, direction=reverse, distance=getItemAtIndex_2)

uniqueItems_2 = List.UniqueItems(list=familyinstance_referencebyname.Reference)

# group: Seleção de elementos e paredes
categories_11 = Categories("OST_Walls")
code_block_8 = CodeBlock { ["Selecione as paredes e clique em Concluir"]; }
select_linkedelementsofcategory = Custom[👓 Select․LinkedElementsOfCategory](category=categories_11, message=code_block_8, flow=select_model_elements_of)  # package BIMCoder Nodes - 2.X; Permite selecionar elementos vinculados e aplica um filtro de categoria

getLocation_2 = Element.GetLocation(element=select_linkedelementsofcategory.elementos)
transform = Geometry.Transform(geometry=getLocation_2, cs=select_linkedelementsofcategory.transform)
direction = Line.Direction(line=transform)
isParallel = Vector.IsParallel(vector=rotate, otherVector=direction)
filterByBoolMask_2 = List.FilterByBoolMask(list=select_linkedelementsofcategory.elementos, mask=isParallel)
wall_extractsurfaces = Custom[Wall․ExtractSurfaces](wall=filterByBoolMask_2.out)  # package BIMCoder Nodes - 2.X; Extrai as superfícies de uma parede, separando em superfícies da face (paralelas) e superfícies de espessura da parede (ortogonais)

# group: Inserir a cota das interseções
reference_bysurface = Custom[Reference․BySurface](surfaces=wall_extractsurfaces.parallelSurfaces)  # package BIMCoder Nodes - 2.X; Obtém a referência de uma superfície
flatten_3 = List.Flatten(list=reference_bysurface)
reference_linkreference = Custom[👓 Reference․LinkReference](RevitLinkInstance=select_linkedelementsofcategory.linkInstance, reference=flatten_3, lacing=Longest)  # package BIMCoder Nodes - 2.X; Converte referências de vínculos para referências reais do modelo Revit

# group: Unir pontos dos elementos com os pontos das faces
join = List.Join(list0=uniqueItems_2, list1=reference_linkreference)

flatten_4 = List.Flatten(list=join)
dimension_byreferences = Custom[Dimension․ByReferences](line=translate, references=flatten_4, dimensionType=getItemAtIndex)  # package BIMCoder Nodes - 2.X; Cria cotas (dimensions) dadas a vista, superfícies, linhas de inserção e tipo da cota
wall_extractsurfaces_2 = Custom[Wall․ExtractSurfaces](wall=filterByBoolMask_2.in)
string_5 = StringInput("Comprimento")
getParameterValueByName = Element.GetParameterValueByName(element=filterByBoolMask_2.out, parameterName=string_5)
maximumItem = List.MaximumItem(list=getParameterValueByName)
