# Dynamo graph ok 2021_17-1_BIMACON_Cotar Pontos Elétricos paralel_R04_script.dyn (Dynamo 2.19.3.6394)
# packages: BIMCoder Nodes - 2.X 2025.1.0, Rhythm 2023.4.2021, Data-Shapes 2022.2.105, Genius Loci 2023.2.21

# group: SELECIONE O ESTILO DE COTA
code_block = CodeBlock()  # //Data-Shapes
code_block_2 = CodeBlock()  # //archilab
code_block_3 = CodeBlock { "Selecione o Estilo de Cotas:"; }
file_path = Filename("..\..\..\..\..\05 - BIMACON\01 - EMPRESA BIMACON\00 - Logos e imagens - BIMACON\ARTE BIMACON\reddonda-removebg-preview.png")
file_from_path = FileObject(path=file_path)
readFromFile = Image.ReadFromFile(file=file_from_path)
string = StringInput("Confirmar")
element_classes = ElementTypes("DimensionType")
all_elements_of_class = ElementsOfType(element_class=element_classes)
name = Element.Name(element=all_elements_of_class)
code_block_4 = CodeBlock { 23; }
dropdown_data = Custom[DropDown Data](Keys=name, Values=all_elements_of_class, DefaultValueIndex=code_block_4)  # package Data-Shapes; Create data for DropDown input in UI.MultiInputForm ++ . Check out www.data-shapes.net for more infos.
code_block_5 = CodeBlock { "Distância da Linha de Cota:"; }
string_2 = StringInput("0.35")
boolean = BoolSelector(true)
textbox_data = Custom[TextBox Data](InputName=code_block_5, DefaultText=string_2, IsNumberEntry=boolean)  # package Data-Shapes; Create Data for TextBox input in UI.MultipleInputForm ++ . Check out www.data-shapes.net for more informations
list_create = List.Create(item0=dropdown_data, item1=textbox_data)
boolean_2 = BoolSelector(true)
string_3 = StringInput("Cancelar")
multipleinputform = Custom[MultipleInputForm ++](Description_optional=code_block_3, Logo_optional=readFromFile, ButtonText_optional=string, Inputs=list_create, Toggle=boolean_2, CancelButtonText_optional=string_3)  # package Data-Shapes; Create a form with multiple inputs. see www.data-shapes.net for tutorials and infos!
number = DoubleInput(1)
getItemAtIndex = List.GetItemAtIndex(list=multipleinputform.User_Inputs, index=number)
number_2 = DoubleInput(0)
getItemAtIndex_2 = List.GetItemAtIndex(list=multipleinputform.User_Inputs, index=number_2)

# group: Seleção dos elementos
code_block_6 = CodeBlock { ["Selecione os pontos e clique em Concluir"]; }
code_block_7 = CodeBlock { ["Nenhum ponto selecionado"]; }
boolean_3 = BoolSelector(true)
dialog_simple = Custom[👓 Dialog․Simple](message=code_block_6, flow=code_block_7, toggle=boolean_3)  # package BIMCoder Nodes - 2.X; Exibe uma mensagem de alerta ao usuário, sem botões de ação.
categories = Categories("OST_ElectricalFixtures")
categories_2 = Categories("OST_LightingDevices")
categories_3 = Categories("OST_TelephoneDevices")
categories_4 = Categories("OST_DataDevices")
categories_5 = Categories("OST_ElectricalEquipment")
categories_6 = Categories("OST_LightingFixtures")
categories_7 = Categories("OST_SecurityDevices")
categories_8 = Categories("OST_CommunicationDevices")
categories_9 = Categories("OST_MechanicalEquipment")
categories_10 = Categories("OST_ConduitFitting")
list_create_2 = List.Create(item0=categories, item1=categories_2, item2=categories_3, item3=categories_4, item4=categories_5, item5=categories_6, item6=categories_7, item7=categories_8, item8=categories_9, item9=categories_10)
boolean_4 = BoolSelector(false)

flatten = List.Flatten(list=list_create_2)

# group (continued): Seleção dos elementos
ʳʰʸᵗʰᵐ_selection_pick = Rhythm.Revit.Selection.Selection.Pick(runIt=dialog_simple, category=flatten, singleSelection=boolean_4)

# group: Filtrar os elementos
elementType = Element.ElementType(element=ʳʰʸᵗʰᵐ_selection_pick)
familyName = ElementType.FamilyName(elementType=elementType)
# note: Nome dos tipos para filtrar
code_block_8 = CodeBlock()
# ---------- code_block_8.designscript (14 lines) ----------
[

"Tomada",
"Interruptor",
"passagem",
"Quadro",
"Caixa",
"Sensor",
"Câmera",
"Lum.",
"Ar condicionado",
"Conjunto"

];
# ----------------------------------------
contains = String.Contains(string=familyName, searchFor=code_block_8@L1)
filterByBoolMask = List.FilterByBoolMask(list=ʳʰʸᵗʰᵐ_selection_pick, mask=contains@L2)

# group: Localização dos pontos
flatten_2 = List.Flatten(list=filterByBoolMask.in)
uniqueItems = List.UniqueItems(list=flatten_2)
familyinstance_referencebyname = Custom[👓 FamilyInstance․ReferenceByName](familyInstance=uniqueItems)  # package BIMCoder Nodes - 2.X; Obtém uma referência de uma família de instância dado o nome

# group: Linha Ref cota
getLocation = Element.GetLocation(element=uniqueItems)
facingOrientation = FamilyInstance.FacingOrientation(familyInstance=uniqueItems)
ZAxis = Vector.ZAxis()
number_3 = DoubleInput(90)
rotate = Vector.Rotate(vector=facingOrientation, axis=ZAxis, degrees=number_3)
byStartPointDirectionLength = Line.ByStartPointDirectionLength(startPoint=getLocation, direction=rotate)
firstItem = List.FirstItem(list=byStartPointDirectionLength)
firstItem_2 = List.FirstItem(list=facingOrientation)
reverse = Vector.Reverse(vector=firstItem_2)
translate = Geometry.Translate(geometry=firstItem, direction=reverse, distance=getItemAtIndex)

uniqueItems_2 = List.UniqueItems(list=familyinstance_referencebyname.Reference)

# group: Seleção das faces das paredes do vínculo de arquitetura
string_4 = StringInput("Selecione o link e as faces para cotar - aperte ESC para Continuar")
dialog_simple_2 = Custom[👓 Dialog․Simple](message=string_4)
select_surfacesonlinkedelement = Custom[👓 Select․SurfacesOnLinkedElement](flow=dialog_simple_2)  # package BIMCoder Nodes - 2.X; Permite selecionar várias superfícies no vínculo. Caso não seja fornecido o vínculo na entrada, será habilitada a seleção para o usuário
surface_reference = Custom[👓 Surface․Reference](surfaces=select_surfacesonlinkedelement.surface)  # package BIMCoder Nodes - 2.X; Obtém a referência de uma superfície

convert_linked_reference = Custom[Convert Linked Reference](reference=surface_reference, RevitLinkInstance=select_surfacesonlinkedelement.linkInstance)  # package Genius Loci; Creates a usable reference from a reference from a linked document.
lista_vazia = Python(IN[0]=convert_linked_reference)  # IronPython2
# ---------- lista_vazia.python (18 lines) ----------
# Importando as bibliotecas necessárias do Revit
import clr
clr.AddReference('RevitServices')
from RevitServices.Persistence import DocumentManager

# Entrada do nó
referencias = IN[0]

# Verifica se a entrada é uma lista
if isinstance(referencias, list):
    # Retorna a lista se não for vazia ou nula
    resultado = referencias if referencias else []
else:
    # Caso a entrada não seja uma lista, trata como única referência
    resultado = [referencias] if referencias else []

# Saída do nó
OUT = resultado
# ----------------------------------------
uniqueItems_3 = List.UniqueItems(list=lista_vazia)

# group: Unir pontos dos elementos com os pontos das faces
join = List.Join(list0=uniqueItems_2, list1=uniqueItems_3)

dimension_byreferences = Custom[Dimension․ByReferences](line=translate, references=join, dimensionType=getItemAtIndex_2)  # package BIMCoder Nodes - 2.X; Cria cotas (dimensions) dadas a vista, superfícies, linhas de inserção e tipo da cota
