# Dynamo graph ok 2021_17-1_BIMACON_Cotar Pontos Elétricos_R00_script.dyn "2021_17-1_BIMACON_Cotar Pontos Elétricos_R00_script" (Dynamo 2.6.1.8786)
# packages: BIMCoder Nodes - 2.X 2025.1.0, Rhythm 2023.4.2021

categories = Categories("OST_ConduitFitting")

# group: Seleção dos elementos
code_block = CodeBlock { ["Selecione os pontos e clique em Concluir"]; }
code_block_2 = CodeBlock { ["Nenhum ponto selecionado"]; }
boolean = BoolSelector(true)
dialog_simple = Custom[👓 Dialog․Simple](message=code_block, flow=code_block_2, toggle=boolean)  # package BIMCoder Nodes - 2.X; Exibe uma mensagem de alerta ao usuário, sem botões de ação.
categories_2 = Categories("OST_ElectricalFixtures")
categories_3 = Categories("OST_LightingDevices")
categories_4 = Categories("OST_TelephoneDevices")
categories_5 = Categories("OST_DataDevices")
categories_6 = Categories("OST_ElectricalEquipment")
categories_7 = Categories("OST_LightingFixtures")
categories_8 = Categories("OST_SecurityDevices")
categories_9 = Categories("OST_CommunicationDevices")
categories_10 = Categories("OST_MechanicalEquipment")
list_create = List.Create(item0=categories_2, item1=categories_3, item2=categories_4, item3=categories_5, item4=categories_6, item5=categories_7, item6=categories_8, item7=categories_9, item8=categories_10, item9=categories)
boolean_2 = BoolSelector(false)

flatten = List.Flatten(list=list_create)

# group (continued): Seleção dos elementos
ʳʰʸᵗʰᵐ_selection_pick = Rhythm.Revit.Selection.Selection.Pick(runIt=dialog_simple, category=flatten, singleSelection=boolean_2)

# group: Filtrar os elementos
elementType = Element.ElementType(element=ʳʰʸᵗʰᵐ_selection_pick)
familyName = ElementType.FamilyName(elementType=elementType)
# note: Nome dos tipos para filtrar
code_block_3 = CodeBlock()
# ---------- code_block_3.designscript (14 lines) ----------
[

"Tomada",
"Interruptor",
"passagem",
"Quadro",
"Caixa",
"Sensor",
"Câmera",
"Lum.",
"Ar condicionado",
"Conjunto"

];
# ----------------------------------------
contains = String.Contains(str=familyName, searchFor=code_block_3@L1)
filterByBoolMask = List.FilterByBoolMask(list=ʳʰʸᵗʰᵐ_selection_pick, mask=contains@L2)

# group: Localização dos pontos
flatten_2 = List.Flatten(list=filterByBoolMask.in)

uniqueItems = List.UniqueItems(list=flatten_2)

# group: Linha Ref cota
getLocation = Element.GetLocation(element=uniqueItems)
facingOrientation = FamilyInstance.FacingOrientation(familyInstance=uniqueItems)
ZAxis = Vector.ZAxis()
number = DoubleInput(90)
rotate = Vector.Rotate(vector=facingOrientation, axis=ZAxis, degrees=number)
byStartPointDirectionLength = Line.ByStartPointDirectionLength(startPoint=getLocation, direction=rotate)
firstItem = List.FirstItem(list=byStartPointDirectionLength)
firstItem_2 = List.FirstItem(list=facingOrientation)
reverse = Vector.Reverse(vector=firstItem_2)
number_2 = DoubleInput(0.35)
translate = Geometry.Translate(geometry=firstItem, direction=reverse, distance=number_2)

# group (continued): Localização dos pontos
familyinstance_referencebyname = Custom[👓 FamilyInstance․ReferenceByName](familyInstance=uniqueItems)  # package BIMCoder Nodes - 2.X; Obtém uma referência de uma família de instância dado o nome

uniqueItems_2 = List.UniqueItems(list=familyinstance_referencebyname.Reference)
boolean_3 = BoolSelector(true)

# group: Seleção das faces das paredes do vínculo de arquitetura
string = StringInput("Selecione o link e as faces para cotar - aperte ESC para Continuar")
dialog_simple_2 = Custom[👓 Dialog․Simple](message=string, toggle=boolean_3)
select_surfacesonlinkedelement = Custom[👓 Select․SurfacesOnLinkedElement](flow=dialog_simple_2)  # package BIMCoder Nodes - 2.X; Permite selecionar várias superfícies no vínculo. Caso não seja fornecido o vínculo na entrada, será habilitada a seleção para o usuário
surface_reference = Custom[👓 Surface․Reference](surfaces=select_surfacesonlinkedelement.surface)  # package BIMCoder Nodes - 2.X; Obtém a referência de uma superfície

lista_vazia = Python(IN[0]=surface_reference)
# ---------- lista_vazia.python (18 lines) ----------
# Importando as bibliotecas necessárias do Revit
import clr
clr.AddReference('RevitServices')
from RevitServices.Persistence import DocumentManager

# Entrada do nó
referencias = IN[0]

# Verifica se a entrada é uma lista
if isinstance(referencias, list):
    # Retorna a lista se não for vazia ou nula
    resultado = referencias if referencias else []
else:
    # Caso a entrada não seja uma lista, trata como única referência
    resultado = [referencias] if referencias else []

# Saída do nó
OUT = resultado
# ----------------------------------------
uniqueItems_3 = List.UniqueItems(list=lista_vazia)

# group: Unir pontos dos elementos com os pontos das faces
join = List.Join(list0=uniqueItems_2, list1=uniqueItems_3)

dimension_byreferences = Custom[👓 Dimension․ByReferences](line=translate, references=join)  # package BIMCoder Nodes - 2.X; Cria cotas (dimensions) dadas a vista, superfícies, linhas de inserção e tipo da cota
