# Dynamo graph ok 2021_17-1_BIMACON_Cotar Pontos Elétricos_R01_script.dyn (Dynamo 2.19.3.6394)
# packages: BIMCoder Nodes - 2.X 2025.1.0, Rhythm 2023.4.2021, Clockwork for Dynamo 2.x 2.4.0, Data-Shapes 2022.2.105

# group: SELECIONE O ESTILO DE COTA
code_block = CodeBlock()  # //Data-Shapes
code_block_2 = CodeBlock()  # //archilab
code_block_3 = CodeBlock { "Selecione o Estilo de Cotas:"; }
file_path = Filename("..\..\..\..\..\05 - BIMACON\01 - EMPRESA BIMACON\00 - Logos e imagens - BIMACON\ARTE BIMACON\reddonda-removebg-preview.png")
file_from_path = FileObject(path=file_path)
readFromFile = Image.ReadFromFile(file=file_from_path)
string = StringInput("Confirmar")
element_classes = ElementTypes("DimensionType")
all_elements_of_class = ElementsOfType(element_class=element_classes)
name = Element.Name(element=all_elements_of_class)
code_block_4 = CodeBlock { 0; }
dropdown_data = Custom[DropDown Data](Keys=name, Values=all_elements_of_class, DefaultValueIndex=code_block_4)  # package Data-Shapes; Create data for DropDown input in UI.MultiInputForm ++ . Check out www.data-shapes.net for more infos.
boolean = BoolSelector(true)
string_2 = StringInput("Cancelar")
multipleinputform = Custom[MultipleInputForm ++](Description_optional=code_block_3, Logo_optional=readFromFile, ButtonText_optional=string, Inputs=dropdown_data, Toggle=boolean, CancelButtonText_optional=string_2)  # package Data-Shapes; Create a form with multiple inputs. see www.data-shapes.net for tutorials and infos!
number = DoubleInput(0)
getItemAtIndex = List.GetItemAtIndex(list=multipleinputform.User_Inputs, index=number)

dimension_byreferences = Custom[Dimension․ByReferences]()  # package BIMCoder Nodes - 2.X; Cria cotas (dimensions) dadas a vista, superfícies, linhas de inserção e tipo da cota; unwired: line, references
code_block_5 = CodeBlock()
# ---------- code_block_5.designscript (2 lines) ----------
/*View to place dimension in*/
view: Revit.Elements.Views.View = Revit.Application.Document.Current.ActiveView;
# ----------------------------------------

# group: Seleção dos elementos
code_block_6 = CodeBlock { ["Selecione os pontos e clique em Concluir"]; }
code_block_7 = CodeBlock { ["Nenhum ponto selecionado"]; }
boolean_2 = BoolSelector(true)
dialog_simple = Custom[👓 Dialog․Simple](message=code_block_6, flow=code_block_7, toggle=boolean_2)  # package BIMCoder Nodes - 2.X; Exibe uma mensagem de alerta ao usuário, sem botões de ação.
categories = Categories("OST_ElectricalFixtures")
categories_2 = Categories("OST_LightingDevices")
categories_3 = Categories("OST_TelephoneDevices")
categories_4 = Categories("OST_DataDevices")
categories_5 = Categories("OST_ElectricalEquipment")
categories_6 = Categories("OST_LightingFixtures")
categories_7 = Categories("OST_SecurityDevices")
categories_8 = Categories("OST_CommunicationDevices")
categories_9 = Categories("OST_MechanicalEquipment")
categories_10 = Categories("OST_ConduitFitting")
list_create = List.Create(item0=categories, item1=categories_2, item2=categories_3, item3=categories_4, item4=categories_5, item5=categories_6, item6=categories_7, item7=categories_8, item8=categories_9, item9=categories_10)
boolean_3 = BoolSelector(false)

flatten = List.Flatten(list=list_create)

# group (continued): Seleção dos elementos
ʳʰʸᵗʰᵐ_selection_pick = Rhythm.Revit.Selection.Selection.Pick(runIt=dialog_simple, category=flatten, singleSelection=boolean_3)

# group: Filtrar os elementos
elementType = Element.ElementType(element=ʳʰʸᵗʰᵐ_selection_pick)
familyName = ElementType.FamilyName(elementType=elementType)
# note: Nome dos tipos para filtrar
code_block_8 = CodeBlock()
# ---------- code_block_8.designscript (14 lines) ----------
[

"Tomada",
"Interruptor",
"passagem",
"Quadro",
"Caixa",
"Sensor",
"Câmera",
"Lum.",
"Ar condicionado",
"Conjunto"

];
# ----------------------------------------
contains = String.Contains(string=familyName, searchFor=code_block_8@L1)
filterByBoolMask = List.FilterByBoolMask(list=ʳʰʸᵗʰᵐ_selection_pick, mask=contains@L2)

# group: Localização dos pontos
flatten_2 = List.Flatten(list=filterByBoolMask.in)
uniqueItems = List.UniqueItems(list=flatten_2)
familyinstance_referencebyname = Custom[👓 FamilyInstance․ReferenceByName](familyInstance=uniqueItems)  # package BIMCoder Nodes - 2.X; Obtém uma referência de uma família de instância dado o nome

uniqueItems_2 = List.UniqueItems(list=familyinstance_referencebyname.Reference)

# group: Seleção das faces das paredes do vínculo de arquitetura
string_3 = StringInput("Selecione o link e as faces para cotar - aperte ESC para Continuar")
dialog_simple_2 = Custom[👓 Dialog․Simple](message=string_3)
select_surfacesonlinkedelement = Custom[👓 Select․SurfacesOnLinkedElement](flow=dialog_simple_2)  # package BIMCoder Nodes - 2.X; Permite selecionar várias superfícies no vínculo. Caso não seja fornecido o vínculo na entrada, será habilitada a seleção para o usuário
surface_reference = Custom[👓 Surface․Reference](surfaces=select_surfacesonlinkedelement.surface)  # package BIMCoder Nodes - 2.X; Obtém a referência de uma superfície

lista_vazia = Python(IN[0]=surface_reference)  # IronPython2
# ---------- lista_vazia.python (18 lines) ----------
# Importando as bibliotecas necessárias do Revit
import clr
clr.AddReference('RevitServices')
from RevitServices.Persistence import DocumentManager

# Entrada do nó
referencias = IN[0]

# Verifica se a entrada é uma lista
if isinstance(referencias, list):
    # Retorna a lista se não for vazia ou nula
    resultado = referencias if referencias else []
else:
    # Caso a entrada não seja uma lista, trata como única referência
    resultado = [referencias] if referencias else []

# Saída do nó
OUT = resultado
# ----------------------------------------
uniqueItems_3 = List.UniqueItems(list=lista_vazia)

# group: Unir pontos dos elementos com os pontos das faces
join = List.Join(list0=uniqueItems_2, list1=uniqueItems_3)

# group: Linha Ref cota
# Descrição <Clique duas vezes aqui para editar a descrição do grupo>
string_4 = StringInput("Cota na Horizontal?")
passthrough = Custom[Passthrough](passThrough=string_4, waitFor=join)  # package Clockwork for Dynamo 2.x; Forces a sequential order of execution. The node wired into the output of the Passthrough node will be executed *after* the node wired into the waitFor input (e.g. important for some Revit operations). The value of the passThrough input will be passed on to the node wired into the output port of the Passthrough node.
mensagem_com_sim_ou_não = Python(IN[0]=passthrough)  # IronPython2
# ---------- mensagem_com_sim_ou_não.python (28 lines) ----------
# Importando as bibliotecas necessárias da API do Revit
import clr
clr.AddReference('RevitServices')  # Referência aos serviços do Revit
from RevitServices.Persistence import DocumentManager

clr.AddReference('RevitAPI')  # Referência à API do Revit
clr.AddReference('RevitAPIUI')  # Referência à API de Interface de Usuário do Revit

from Autodesk.Revit.UI import TaskDialog, TaskDialogCommonButtons, TaskDialogResult

# Recebe o texto de instrução como entrada do nó
instrucoes = IN[0]

# Criando o TaskDialog
dialog = TaskDialog("Aviso")
dialog.MainInstruction = instrucoes
dialog.CommonButtons = TaskDialogCommonButtons.Yes | TaskDialogCommonButtons.No | TaskDialogCommonButtons.Cancel

# Exibindo o dialog para o usuário e capturando a resposta
resultado = dialog.Show()

# Interpretando a resposta
if resultado == TaskDialogResult.Yes:
    OUT = True
elif resultado == TaskDialogResult.No:
    OUT = False
else:  # Caso o usuário pressione Cancelar ou feche a janela
    OUT = None  # Ou você pode definir como False se preferir
# ----------------------------------------
XAxis = Vector.XAxis()
YAxis = Vector.YAxis()
code_block_9 = CodeBlock(test=mensagem_com_sim_ou_não, verd=XAxis, fals=YAxis)
# ---------- code_block_9.designscript (2 lines) ----------
//Condições IF
test == true ? verd : fals;
# ----------------------------------------
passthrough_2 = Custom[Passthrough](passThrough=code_block_9, waitFor=mensagem_com_sim_ou_não)
python_script = Python(IN[0]=passthrough_2)  # CPython3
# ---------- python_script.python (44 lines) ----------
import clr
import sys
import System
from System.Collections.Generic import *

clr.AddReference('ProtoGeometry')
from Autodesk.DesignScript.Geometry import *

clr.AddReference('RevitNodes')
import Revit
clr.ImportExtensions(Revit.Elements)
clr.ImportExtensions(Revit.GeometryConversion)

clr.AddReference("RevitServices")
import RevitServices
from RevitServices.Persistence import DocumentManager
from RevitServices.Transactions import TransactionManager

clr.AddReference('RevitAPI')
clr.AddReference('RevitAPIUI')
import Autodesk
from Autodesk.Revit.DB import *
from Autodesk.Revit.UI import *
from Autodesk.Revit.UI import Selection

# Obtém o vetor do nó de entrada
vector_input = IN[0]

# Verifica se o vetor é válido antes de executar a seleção do ponto
if vector_input and isinstance(vector_input, Vector):
    doc = DocumentManager.Instance.CurrentDBDocument
    uiapp = DocumentManager.Instance.CurrentUIApplication
    app = uiapp.Application
    uidoc = uiapp.ActiveUIDocument

    # Pede ao usuário para selecionar um ponto no Revit
    point = uidoc.Selection.PickPoint("Selecione um ponto no Revit")
    
    # Converte o ponto para o formato do Dynamo
    point_dyn = point.ToPoint()

    OUT = point_dyn
else:
    OUT = "Aguardando um vetor válido no nó Passthrough."
# ----------------------------------------
byStartPointDirectionLength = Line.ByStartPointDirectionLength(startPoint=python_script, direction=code_block_9)

python_script_2 = Python(IN[0]=code_block_5, IN[1]=byStartPointDirectionLength, IN[2]=join, IN[3]=getItemAtIndex)  # IronPython2
# ---------- python_script_2.python (61 lines) ----------
# Desenvolvido por:
#Alban de Chasteigner 2019
#twitter : @geniusloci_bim
#geniusloci.bim@gmail.com

# Adaptado por: BIM Coder
# Conheça o Curso Método AutoRevit: www.bimcoder.net/

import clr
clr.AddReference('RevitAPI')
from Autodesk.Revit.DB import *

clr.AddReference('RevitNodes')
import Revit
clr.ImportExtensions(Revit.GeometryConversion)
clr.ImportExtensions(Revit.Elements)

clr.AddReference('RevitServices')
import RevitServices
from RevitServices.Persistence import DocumentManager
from RevitServices.Transactions import TransactionManager

doc = DocumentManager.Instance.CurrentDBDocument

def tolist(obj1):
    if hasattr(obj1,"__iter__"): return obj1
    else: return [obj1]

views = tolist(UnwrapElement(IN[0]))
lines = tolist(IN[1])
if any(isinstance(el, list) for el in IN[2]) : referenceList =  IN[2]
else : referenceList = [(IN[2])]
dimensionType = tolist(UnwrapElement(IN[3]))[0]
listRef,dimList = [], []

#Thanks to Gavin Crump for the list structure improvement
for references in referenceList :
	elementsRef = ReferenceArray()
	for reference in references :
		elementsRef.Append(reference)
	listRef.append(elementsRef)
	
TransactionManager.Instance.EnsureInTransaction(doc)
for view in views:
	dims = []
	for line,refer in zip(lines,listRef) :
		if doc.IsFamilyDocument == True :
			if IN[3]== None: 
				dims.append(doc.FamilyCreate.NewDimension(view, line.ToRevitType(), refer).ToDSType(True))
			else:
				dims.append(doc.FamilyCreate.NewDimension(view, line.ToRevitType(), refer, dimensionType).ToDSType(True))
		else:
			if IN[3]== None: 
				dims.append(doc.Create.NewDimension(view, line.ToRevitType(), refer).ToDSType(True))
			else:
				dims.append(doc.Create.NewDimension(view, line.ToRevitType(), refer, dimensionType).ToDSType(True))
	dimList.append(dims)
TransactionManager.Instance.TransactionTaskDone()

if isinstance(IN[0], list): OUT = dimList
else: OUT = dimList[0]
# ----------------------------------------
watch = Watch(python_script_2)
