# Dynamo graph 17-0_BIMACON_Cotar Pontos MEP_R00_script.dyn "ok 17-0_BIMACON_Cotar Pontos MEP_R00_script" (Dynamo 2.19.3.6394)
# author: Jose Nelson
# Inserção de cotas em pontos MEP Hid
# packages: BIMCoder Nodes - 2.X 2025.0.14, DynaMEP 2.0.1, BIMCoder Nodes - 2.X 2025.1.0, Rhythm 2023.4.2021

string = StringInput("Selecione o vínculo e a superfície de referência ")
dialog_simple = Custom[👓 Dialog․Simple](message=string)  # package BIMCoder Nodes - 2.X; Exibe uma mensagem de alerta ao usuário, sem botões de ação.

# group: Seleção da face de referência para a linha da cota
select_surfaceonlinkedelement = Custom[👓 Select․SurfaceOnLinkedElement](flow=dialog_simple)  # package BIMCoder Nodes - 2.X; Permite selecionar uma superfície em um elemento vinculado

# group: Obter a linha de referência e projetar os pontos
perimeterCurves = Surface.PerimeterCurves(surface=select_surfaceonlinkedelement.surface)
code_block = CodeBlock { 0.5; }
pointAtParameter = Curve.PointAtParameter(curve=perimeterCurves, param=code_block)
Z = Point.Z(point=pointAtParameter)
sortByKey = List.SortByKey(list=perimeterCurves, keys=Z)
# note: LINHA PRINCIPAL
firstItem = List.FirstItem(list=sortByKey.sortedList)

startPoint = Curve.StartPoint(curve=firstItem)
endPoint = Curve.EndPoint(curve=firstItem)
byStartPointEndPoint = Line.ByStartPointEndPoint(startPoint=startPoint, endPoint=endPoint)

# group: Seleção dos elementos
code_block_2 = CodeBlock { ["Selecione os pontos e clique em Concluir"]; }
code_block_3 = CodeBlock { ["Nenhum ponto selecionado"]; }
dialog_simple_2 = Custom[👓 Dialog․Simple](message=code_block_2, flow=code_block_3)
categories = Categories("OST_ElectricalFixtures")
categories_2 = Categories("OST_LightingDevices")
categories_3 = Categories("OST_TelephoneDevices")
categories_4 = Categories("OST_DataDevices")
categories_5 = Categories("OST_ElectricalEquipment")
list_create = List.Create(item0=categories, item1=categories_2, item2=categories_3, item3=categories_4, item4=categories_5)
flatten = List.Flatten(list=list_create)
boolean = BoolSelector(false)
ʳʰʸᵗʰᵐ_selection_pick = Rhythm.Revit.Selection.Selection.Pick(runIt=dialog_simple_2, category=flatten, singleSelection=boolean)

# group: Filtrar os elementos
elementType = Element.ElementType(element=ʳʰʸᵗʰᵐ_selection_pick)
familyName = ElementType.FamilyName(elementType=elementType)
# note: Nome dos tipos para filtrar
code_block_4 = CodeBlock()
# ---------- code_block_4.designscript (6 lines) ----------
[

"Tomada",
"Interruptor",
"Quadro"
];
# ----------------------------------------
contains = String.Contains(string=familyName, searchFor=code_block_4@L1)
filterByBoolMask = List.FilterByBoolMask(list=ʳʰʸᵗʰᵐ_selection_pick, mask=contains@L2)

# group: Localização dos pontos
flatten_2 = List.Flatten(list=filterByBoolMask.in)
getLocation = Element.GetLocation(element=flatten_2)

string_2 = StringInput("Selecione as faces para cotas e aperte ESC para finalizar")
dialog_simple_3 = Custom[👓 Dialog․Simple](message=string_2, flow=perimeterCurves)

# group: Seleção das faces das paredes do vínculo de arquitetura
select_surfacesonlinkedelement = Custom[👓 Select․SurfacesOnLinkedElement](flow=dialog_simple_3, linkInstance=select_surfaceonlinkedelement.linkInstance)  # package BIMCoder Nodes - 2.X; Permite selecionar várias superfícies no vínculo. Caso não seja fornecido o vínculo na entrada, será habilitada a seleção para o usuário

# group: Unir pontos dos elementos com os pontos das faces
join = List.Join(list0=getLocation, list1=select_surfacesonlinkedelement.pickPoint)

# group (continued): Obter a linha de referência e projetar os pontos
# note: PONTOS PROJETADOS
closestPointTo = Geometry.ClosestPointTo(geometry=firstItem, other=join)

# group: Organizar os pontos em ordem
direction = Line.Direction(line=byStartPointEndPoint)

# group: Corrigir a direção do vetor da linha principal
startPoint_2 = Curve.StartPoint(curve=firstItem)
X = Vector.X(vector=direction)
code_block_5 = CodeBlock(x=X, vector=direction)
# ---------- code_block_5.designscript (3 lines) ----------
x > 0?
vector:
Vector.Reverse(vector);
# ----------------------------------------
byStartPointDirectionLength = Line.ByStartPointDirectionLength(startPoint=startPoint_2, direction=code_block_5)

# group (continued): Organizar os pontos em ordem
point_sortbydirection = Custom[👓 Point․SortByDirection](points=closestPointTo, direction=code_block_5)  # package BIMCoder Nodes - 2.X; Ordena pontos com base em um vetor de direção

# group: Dividir a linha em trechos entre os pontos
line_splitatpoints = Custom[👓 Line․SplitAtPoints](line=byStartPointDirectionLength, points=point_sortbydirection)  # package BIMCoder Nodes - 2.X; Divide uma linha em diversos segmentos a partir dos pontos de entrada (que deverão estar ordenados - utilize o nó Point.SortByDirection caso necessário)

# group: Inserir as cotas na vista ativa
family_types = FamilyTypes("Cota_BIMACON_Diagonal:2.0mm Arial")
familyinstance_byline = Custom[👓 FamilyInstance․ByLine](familyType=family_types, line=line_splitatpoints)  # package BIMCoder Nodes - 2.X; Modela uma família de instância baseada em linha

# group: Ajustar o offset do texto da cota (centro)
string_3 = StringInput("Distancia_Texto")
length = Curve.Length(curve=line_splitatpoints)
code_block_6 = CodeBlock { 2; }
div = length / code_block_6
round = Math.Round(number=div, digits=code_block_6)
setParameterByName = Element.SetParameterByName(element=familyinstance_byline, parameterName=string_3, value=round)

# group: Offset da linha da cota
number = DoubleInput(0.15)

# group: Mover a cota para o offset desejado
start = Revit.Transaction.Transaction.Start(input=familyinstance_byline)
code_block_7 = CodeBlock { 0.5; }
normalAtParameter = Surface.NormalAtParameter(surface=select_surfaceonlinkedelement.surface, u=code_block_7, v=code_block_7)
normalized = Vector.Normalized(vector=normalAtParameter)
scale = Vector.Scale(vector=normalized, scale_factor=number)
moveByVector = Element.MoveByVector(element=start, vector=scale)

# group: Offset na linha principal utilizando o vetor e distância utilizados para mover as familias
translate = Geometry.Translate(geometry=firstItem, direction=scale, distance=number)

# group: Trazer os pontos para a altura da linha de referência e organizá-los
X_2 = Point.X(point=join)
Y = Point.Y(point=join)
startPoint_3 = Curve.StartPoint(curve=firstItem)
Z_2 = Point.Z(point=startPoint_3)
byCoordinates = Point.ByCoordinates(x=X_2, y=Y, z=Z_2)
point_sortbydirection_2 = Custom[👓 Point․SortByDirection](points=byCoordinates, direction=code_block_5)

distanceTo = Geometry.DistanceTo(geometry=translate, other=point_sortbydirection_2)

# group: Organizar os pontos em 2
python_script = Python(IN[0]=distanceTo)  # IronPython2
# ---------- python_script.python (8 lines) ----------
# Entradas
lista_original = IN[0]  # Exemplo: [a, b, c, d]

# Lógica para criar sublistas de elementos consecutivos
listas_depois = [[lista_original[i], lista_original[i+1]] for i in range(len(lista_original) - 1)]

# Saída
OUT = listas_depois
# ----------------------------------------

firstItem_2 = List.FirstItem(list=python_script@L2)
lastItem = List.LastItem(list=python_script@L2)

# group: Configurar comprimentos das linhas de chamada
string_4 = StringInput("Comprimento_Chamada_1")
setParameterByName_2 = Element.SetParameterByName(element=familyinstance_byline, parameterName=string_4, value=firstItem_2)
string_5 = StringInput("Comprimento_Chamada_2")
setParameterByName_3 = Element.SetParameterByName(element=familyinstance_byline, parameterName=string_5, value=lastItem)

toLine = Geometry.Curves.ToLine(curve=firstItem)
