# Dynamo graph 17-3_BIMACON_Cotas de paredes automáticas_R03_script.dyn "ok 17-3_BIMACON_Cotas de paredes automáticas_R03_script" (Dynamo 2.19.3.6394)
# author: Jose Nelson
# Cota as paredes automaticamente
# packages: BIMCoder Nodes 1.0.0, Data-Shapes 2022.2.105

# group: SELECIONE O ESTILO DE COTA
code_block = CodeBlock { "Selecione o Estilo de Cotas:"; }
string = StringInput("LogoBimacon.png")
python_script = Python(IN[0]=string)  # IronPython2
# ---------- python_script.python (22 lines) ----------
import clr

# Adiciona referência ao ambiente .NET
clr.AddReference('System')
from System import Environment, IO

# Nome da imagem (entrada do usuário)
nome_arquivo_imagem = IN[0]

# Recupera o nome do usuário logado no Windows
usuario = Environment.UserName

# Monta o caminho completo para a pasta de imagens
caminho_base = r"C:\Users\{0}\AppData\Roaming\pyRevit\Extensions\Bimacon.extension\Bimacon.tab\Imagens_Bimacon".format(usuario)

# Junta o caminho base com o nome do arquivo
caminho_completo = IO.Path.Combine(caminho_base, nome_arquivo_imagem)

# Verifica se o arquivo existe
existe = IO.File.Exists(caminho_completo)

OUT = caminho_completo if existe else "Imagem não encontrada: {0}".format(caminho_completo)
# ----------------------------------------
file_from_path = FileObject(path=python_script)
readFromFile = Image.ReadFromFile(file=file_from_path)
string_2 = StringInput("Confirmar")
element_classes = ElementTypes("DimensionType")
all_elements_of_class = ElementsOfType(element_class=element_classes)
name = Element.Name(element=all_elements_of_class)
code_block_2 = CodeBlock { 23; }
boolean = BoolSelector(false)
dropdown_data = Custom[DropDown Data](Keys=name, Values=all_elements_of_class, DefaultValueIndex=code_block_2, Sorted_optional=boolean)  # package Data-Shapes; Create data for DropDown input in UI.MultiInputForm ++ . Check out www.data-shapes.net for more infos.
code_block_3 = CodeBlock { "Selecione as Paredes depois em Concluir"; }
string_3 = StringInput("Selecione")
categories = Categories("OST_Walls")
selectmodelelements_data = Custom[SelectModelElements Data](InputName=code_block_3, ButtonText=string_3, CategoryFilter=categories)  # package Data-Shapes; Creates a Revit element selection input for UI.MultipleInputForm++ . Check out www.data-shapes.net for more infos!
code_block_4 = CodeBlock { "Offset da Cota"; }
string_4 = StringInput("0.5")
boolean_2 = BoolSelector(true)
textbox_data = Custom[TextBox Data](InputName=code_block_4, DefaultText=string_4, IsNumberEntry=boolean_2)  # package Data-Shapes; Create Data for TextBox input in UI.MultipleInputForm ++ . Check out www.data-shapes.net for more informations
code_block_5 = CodeBlock { "Cotar aberturas?"; }
boolean_3 = BoolSelector(false)
string_5 = StringInput("Sim")
boolean_input = Custom[Boolean input](InputName=code_block_5, DefaultValue=boolean_3, SideText=string_5)  # package Data-Shapes; Creates a boolean input for UI.MultipleInputForm ++ . Check out www.data-shapes.net for more infos!
code_block_6 = CodeBlock { "Cota geral?"; }
boolean_4 = BoolSelector(false)
string_6 = StringInput("Sim")
boolean_input_2 = Custom[Boolean input](InputName=code_block_6, DefaultValue=boolean_4, SideText=string_6)
list_create = List.Create(item0=dropdown_data, item1=selectmodelelements_data, item2=textbox_data, item3=boolean_input, item4=boolean_input_2)
boolean_5 = BoolSelector(true)
string_7 = StringInput("Cancelar")
number = DoubleInput(150)
multipleinputform = Custom[MultipleInputForm ++](Description_optional=code_block, Logo_optional=readFromFile, ButtonText_optional=string_2, Inputs=list_create, Toggle=boolean_5, CancelButtonText_optional=string_7, LabelWidth_optional=number)  # package Data-Shapes; Create a form with multiple inputs. see www.data-shapes.net for tutorials and infos!
number_2 = DoubleInput(3)
getItemAtIndex = List.GetItemAtIndex(list=multipleinputform.User_Inputs, index=number_2)
number_3 = DoubleInput(2)
getItemAtIndex_2 = List.GetItemAtIndex(list=multipleinputform.User_Inputs, index=number_3)
number_4 = DoubleInput(1)
getItemAtIndex_3 = List.GetItemAtIndex(list=multipleinputform.User_Inputs, index=number_4)
number_5 = DoubleInput(0)
getItemAtIndex_4 = List.GetItemAtIndex(list=multipleinputform.User_Inputs, index=number_5)
number_6 = DoubleInput(4)
getItemAtIndex_5 = List.GetItemAtIndex(list=multipleinputform.User_Inputs, index=number_6)
code_block_7 = CodeBlock()  # //Data-Shapes
code_block_8 = CodeBlock()  # //archilab

# group: Obter a superfície de referência e sua linha de localização
select_surfaceonelement = Custom[Select․SurfaceOnElement]()  # package BIMCoder Nodes; Habilita a seleção de uma superfície em um elemento
perimeterCurves = Surface.PerimeterCurves(surface=select_surfaceonelement)
flatten = List.Flatten(list=perimeterCurves)
code_block_9 = CodeBlock { 0.5; }
pointAtParameter = Curve.PointAtParameter(curve=flatten, param=code_block_9)
Z = Point.Z(point=pointAtParameter)
minimumItem = List.MinimumItem(list=Z)
indexOf = List.IndexOf(list=Z, element=minimumItem)
getItemAtIndex_6 = List.GetItemAtIndex(list=flatten, index=indexOf)
code_block_10 = CodeBlock { 0.5; }
normalAtParameter = Surface.NormalAtParameter(surface=select_surfaceonelement, u=code_block_10, v=code_block_10)
direction = Line.Direction(line=getItemAtIndex_6)

# group: Criar a linha base para inserir a cota
translate = Geometry.Translate(geometry=getItemAtIndex_6, direction=normalAtParameter, distance=getItemAtIndex_2)

# group: Separar as paredes em paredes paralelas/ ortogonais e extrair suas faces para cotas
getLocation = Element.GetLocation(element=getItemAtIndex_3)
direction_2 = Line.Direction(line=getLocation)
isParallel = Vector.IsParallel(vector=direction, otherVector=direction_2)
filterByBoolMask = List.FilterByBoolMask(list=getItemAtIndex_3, mask=isParallel)
wall_extractsurfaces = Custom[Wall․ExtractSurfaces](wall=filterByBoolMask.in)  # package BIMCoder Nodes; Extrai as superfícies de uma parede, separando em superfícies da face (paralelas) e superfícies de espessura da parede (ortogonais)
wall_extractsurfaces_2 = Custom[Wall․ExtractSurfaces](wall=filterByBoolMask.out)

# group: Inserir a cota de todas as dimensões -> vãos e interseções
code_block_11 = CodeBlock(teste=getItemAtIndex, line=translate)
# ---------- code_block_11.designscript (3 lines) ----------
teste?
line:
null;
# ----------------------------------------
join = List.Join(list0=wall_extractsurfaces.ortoSurfaces, list1=wall_extractsurfaces_2.parallelSurfaces)
reference_bysurface = Custom[Reference․BySurface](surfaces=join)  # package BIMCoder Nodes; Obtém a referência de uma superfície
flatten_2 = List.Flatten(list=reference_bysurface)
dimension_byreferences = Custom[Dimension․ByReferences](line=code_block_11, references=flatten_2, dimensionType=getItemAtIndex_4)  # package BIMCoder Nodes; Cria cotas (dimensions) dadas a vista, superfícies, linhas de inserção e tipo da cota

# group: Mover a linha base para o offset escolhido (orientação normal à superfície)
code_block_12 = CodeBlock { 0.5; }
normalAtParameter_2 = Surface.NormalAtParameter(surface=select_surfaceonelement, u=code_block_12, v=code_block_12)
code_block_13 = CodeBlock(teste1=getItemAtIndex, teste2=getItemAtIndex_5, x=getItemAtIndex_2)
# ---------- code_block_13.designscript (3 lines) ----------
teste1 && teste2 ?
x*2:
x;
# ----------------------------------------
translate_2 = Geometry.Translate(geometry=translate, direction=normalAtParameter_2, distance=code_block_13)

# group: Obter as superfícies do extremo das superfícies paralelas
flatten_3 = List.Flatten(list=wall_extractsurfaces_2.parallelSurfaces)
code_block_14 = CodeBlock { 0.5; }
pointAtParameter_2 = Surface.PointAtParameter(surface=flatten_3, u=code_block_14, v=code_block_14)
point_sortbydirection = Custom[Point․SortByDirection](points=pointAtParameter_2, direction=direction)  # package BIMCoder Nodes; Ordena pontos com base em um vetor de direção
indexOf_2 = List.IndexOf(list=pointAtParameter_2, element=point_sortbydirection)
getItemAtIndex_7 = List.GetItemAtIndex(list=flatten_3, index=indexOf_2)
firstItem = List.FirstItem(list=getItemAtIndex_7)
lastItem = List.LastItem(list=getItemAtIndex_7)
join_2 = List.Join(list0=firstItem, list1=lastItem)

# group: Inserir a cota geral
code_block_15 = CodeBlock(teste=getItemAtIndex_5, line=translate_2)  # same code as code_block_11
reference_bysurface_2 = Custom[Reference․BySurface](surfaces=join_2)
flatten_4 = List.Flatten(list=reference_bysurface_2)
dimension_byreferences_2 = Custom[Dimension․ByReferences](line=code_block_15, references=flatten_4, dimensionType=getItemAtIndex_4)

# group: Aviso para selecionar a superfície de referência
string_8 = StringInput("Selecione a superfície de referência")
dialog_simple = Custom[Dialog-Simple](message=string_8)  # package BIMCoder Nodes; Exibe uma mensagem de alerta ao usuário, sem botões de ação.

# group: Mover a linha base para o offset escolhido (orientação normal à superfície)
code_block_16 = CodeBlock { 0.5; }
normalAtParameter_3 = Surface.NormalAtParameter(surface=select_surfaceonelement, u=code_block_16, v=code_block_16)
code_block_17 = CodeBlock(teste=getItemAtIndex, dist=getItemAtIndex_2) { teste? dist:0; }
translate_3 = Geometry.Translate(geometry=translate, direction=normalAtParameter_3, distance=code_block_17)

# group: Inserir a cota das interseções
reference_bysurface_3 = Custom[Reference․BySurface](surfaces=wall_extractsurfaces_2.parallelSurfaces)
flatten_5 = List.Flatten(list=reference_bysurface_3)
dimension_byreferences_3 = Custom[Dimension․ByReferences](line=translate_3, references=flatten_5, dimensionType=getItemAtIndex_4)
