# Dynamo graph ok 2021_17-3_BIMACON_Cotas de paredes automáticas_R00_script.dyn (Dynamo 2.19.3.6394)
# packages: BIMCoder Nodes 1.0.0

# group: Aviso para selecionar a superfície de referência
string = StringInput("Selecione a superfície de referência")
dialog_simple = Custom[Dialog-Simple](message=string)  # package BIMCoder Nodes; Exibe uma mensagem de alerta ao usuário, sem botões de ação.

# group: Obter a superfície de referência e sua linha de localização
select_surfaceonelement = Custom[Select․SurfaceOnElement](refresh=dialog_simple)  # package BIMCoder Nodes; Habilita a seleção de uma superfície em um elemento
perimeterCurves = Surface.PerimeterCurves(surface=select_surfaceonelement)
flatten = List.Flatten(list=perimeterCurves)
code_block = CodeBlock { 0.5; }
pointAtParameter = Curve.PointAtParameter(curve=flatten, param=code_block)
Z = Point.Z(point=pointAtParameter)
minimumItem = List.MinimumItem(list=Z)
indexOf = List.IndexOf(list=Z, element=minimumItem)
getItemAtIndex = List.GetItemAtIndex(list=flatten, index=indexOf)
code_block_2 = CodeBlock { 0.5; }
normalAtParameter = Surface.NormalAtParameter(surface=select_surfaceonelement, u=code_block_2, v=code_block_2)
direction = Line.Direction(line=getItemAtIndex)

# group: Mover a linha base para o offset escolhido (orientação normal à superfície)
n02_offset_da_cota = DoubleInput(0.5)  # "02 - Offset da cota"; graph input
code_block_3 = CodeBlock { 0.5; }
normalAtParameter_2 = Surface.NormalAtParameter(surface=select_surfaceonelement, u=code_block_3, v=code_block_3)

# group: Criar a linha base para inserir a cota
translate = Geometry.Translate(geometry=getItemAtIndex, direction=normalAtParameter, distance=n02_offset_da_cota)

# group: Seleção das paredes
n01_selecione_as_paredes = DSModelElementsByCategorySelection("OST_Walls")  # "01 - Selecione as paredes"; 5 picked in the model; graph input

# group: Separar as paredes em paredes paralelas/ ortogonais e extrair suas faces para cotas
getLocation = Element.GetLocation(element=n01_selecione_as_paredes)
direction_2 = Line.Direction(line=getLocation)
isParallel = Vector.IsParallel(vector=direction, otherVector=direction_2)
filterByBoolMask = List.FilterByBoolMask(list=n01_selecione_as_paredes, mask=isParallel)
wall_extractsurfaces = Custom[Wall․ExtractSurfaces](wall=filterByBoolMask.in)  # package BIMCoder Nodes; Extrai as superfícies de uma parede, separando em superfícies da face (paralelas) e superfícies de espessura da parede (ortogonais)
wall_extractsurfaces_2 = Custom[Wall․ExtractSurfaces](wall=filterByBoolMask.out)

# group: Inserir a cota de todas as dimensões -> vãos e interseções
join = List.Join(list0=wall_extractsurfaces.ortoSurfaces, list1=wall_extractsurfaces_2.parallelSurfaces)
reference_bysurface = Custom[Reference․BySurface](surfaces=join)  # package BIMCoder Nodes; Obtém a referência de uma superfície
flatten_2 = List.Flatten(list=reference_bysurface)
dimension_byreferences = Custom[Dimension․ByReferences](line=translate, references=flatten_2)  # package BIMCoder Nodes; Cria cotas (dimensions) dadas a vista, superfícies, linhas de inserção e tipo da cota

# group: Obter as superfícies do extremo das superfícies paralelas
flatten_3 = List.Flatten(list=wall_extractsurfaces_2.parallelSurfaces)
code_block_4 = CodeBlock { 0.5; }
pointAtParameter_2 = Surface.PointAtParameter(surface=flatten_3, u=code_block_4, v=code_block_4)
point_sortbydirection = Custom[Point․SortByDirection](points=pointAtParameter_2, direction=direction)  # package BIMCoder Nodes; Ordena pontos com base em um vetor de direção
indexOf_2 = List.IndexOf(list=pointAtParameter_2, element=point_sortbydirection)
getItemAtIndex_2 = List.GetItemAtIndex(list=flatten_3, index=indexOf_2)
firstItem = List.FirstItem(list=getItemAtIndex_2)
lastItem = List.LastItem(list=getItemAtIndex_2)
join_2 = List.Join(list0=firstItem, list1=lastItem)

# group (continued): Mover a linha base para o offset escolhido (orientação normal à superfície)
translate_2 = Geometry.Translate(geometry=translate, direction=normalAtParameter_2, distance=n02_offset_da_cota)

# group: Inserir a cota das interseções
n03_cota_de_intersecções = BoolSelector(false)  # "03 - Cota de intersecções?"; graph input
code_block_5 = CodeBlock(teste=n03_cota_de_intersecções, line=translate_2)
# ---------- code_block_5.designscript (3 lines) ----------
teste?
line:
null;
# ----------------------------------------
reference_bysurface_2 = Custom[Reference․BySurface](surfaces=wall_extractsurfaces_2.parallelSurfaces)
flatten_4 = List.Flatten(list=reference_bysurface_2)
dimension_byreferences_2 = Custom[Dimension․ByReferences](line=code_block_5, references=flatten_4)

# group: Mover a linha base para o offset escolhido (orientação normal à superfície)
code_block_6 = CodeBlock { 0.5; }
normalAtParameter_3 = Surface.NormalAtParameter(surface=select_surfaceonelement, u=code_block_6, v=code_block_6)
code_block_7 = CodeBlock(teste=n03_cota_de_intersecções, x=n02_offset_da_cota)
# ---------- code_block_7.designscript (3 lines) ----------
teste?
x*2:
x;
# ----------------------------------------
translate_3 = Geometry.Translate(geometry=translate, direction=normalAtParameter_3, distance=code_block_7)

# group: Inserir a cota geral
n04_cota_geral = BoolSelector(true)  # "04 - Cota geral?"; graph input
code_block_8 = CodeBlock(teste=n04_cota_geral, line=translate_3)  # same code as code_block_5
reference_bysurface_3 = Custom[Reference․BySurface](surfaces=join_2)
flatten_5 = List.Flatten(list=reference_bysurface_3)
dimension_byreferences_3 = Custom[Dimension․ByReferences](line=code_block_8, references=flatten_5)
