# Dynamo graph ok 2021_17-3_BIMACON_Cotas de paredes automáticas_R01_script.dyn "ok 2021_17-3_BIMACON_Cotas de paredes automáticas_R00_script" (Dynamo 2.19.3.6394)
# packages: BIMCoder Nodes 1.0.0, Data-Shapes 2022.2.105

# group: Aviso para selecionar a superfície de referência
string = StringInput("Selecione a superfície de referência")
dialog_simple = Custom[Dialog-Simple](message=string)  # package BIMCoder Nodes; Exibe uma mensagem de alerta ao usuário, sem botões de ação.

# group: Obter a superfície de referência e sua linha de localização
select_surfaceonelement = Custom[Select․SurfaceOnElement](refresh=dialog_simple)  # package BIMCoder Nodes; Habilita a seleção de uma superfície em um elemento
perimeterCurves = Surface.PerimeterCurves(surface=select_surfaceonelement)
flatten = List.Flatten(list=perimeterCurves)
code_block = CodeBlock { 0.5; }
pointAtParameter = Curve.PointAtParameter(curve=flatten, param=code_block)
Z = Point.Z(point=pointAtParameter)
minimumItem = List.MinimumItem(list=Z)
indexOf = List.IndexOf(list=Z, element=minimumItem)
getItemAtIndex = List.GetItemAtIndex(list=flatten, index=indexOf)
code_block_2 = CodeBlock { 0.5; }
normalAtParameter = Surface.NormalAtParameter(surface=select_surfaceonelement, u=code_block_2, v=code_block_2)
direction = Line.Direction(line=getItemAtIndex)

# group: Mover a linha base para o offset escolhido (orientação normal à superfície)
n02_offset_da_cota = DoubleInput(0.5)  # "02 - Offset da cota"; graph input
code_block_3 = CodeBlock { 0.5; }
normalAtParameter_2 = Surface.NormalAtParameter(surface=select_surfaceonelement, u=code_block_3, v=code_block_3)

# group: Criar a linha base para inserir a cota
translate = Geometry.Translate(geometry=getItemAtIndex, direction=normalAtParameter, distance=n02_offset_da_cota)

# group: SELECIONE O ESTILO DE COTA
code_block_4 = CodeBlock { "Selecione o Estilo de Cotas:"; }
file_path = Filename("..\..\..\..\..\05 - BIMACON\01 - EMPRESA BIMACON\00 - Logos e imagens - BIMACON\ARTE BIMACON\reddonda-removebg-preview.png")
file_from_path = FileObject(path=file_path)
readFromFile = Image.ReadFromFile(file=file_from_path)
string_2 = StringInput("Confirmar")
element_classes = ElementTypes("DimensionType")
all_elements_of_class = ElementsOfType(element_class=element_classes)
name = Element.Name(element=all_elements_of_class)
code_block_5 = CodeBlock { 0; }
dropdown_data = Custom[DropDown Data](Keys=name, Values=all_elements_of_class, DefaultValueIndex=code_block_5)  # package Data-Shapes; Create data for DropDown input in UI.MultiInputForm ++ . Check out www.data-shapes.net for more infos.
code_block_6 = CodeBlock { "Selecione as Paredes depois em Concluir"; }
string_3 = StringInput("Selecione")
categories = Categories("OST_Walls")
selectmodelelements_data = Custom[SelectModelElements Data](InputName=code_block_6, ButtonText=string_3, CategoryFilter=categories)  # package Data-Shapes; Creates a Revit element selection input for UI.MultipleInputForm++ . Check out www.data-shapes.net for more infos!
list_create = List.Create(item0=dropdown_data, item1=selectmodelelements_data)
boolean = BoolSelector(true)
string_4 = StringInput("Cancelar")
multipleinputform = Custom[MultipleInputForm ++](Description_optional=code_block_4, Logo_optional=readFromFile, ButtonText_optional=string_2, Inputs=list_create, Toggle=boolean, CancelButtonText_optional=string_4)  # package Data-Shapes; Create a form with multiple inputs. see www.data-shapes.net for tutorials and infos!
number = DoubleInput(1)
getItemAtIndex_2 = List.GetItemAtIndex(list=multipleinputform.User_Inputs, index=number)
number_2 = DoubleInput(0)
getItemAtIndex_3 = List.GetItemAtIndex(list=multipleinputform.User_Inputs, index=number_2)
code_block_7 = CodeBlock()  # //Data-Shapes
code_block_8 = CodeBlock()  # //archilab

# group: Separar as paredes em paredes paralelas/ ortogonais e extrair suas faces para cotas
getLocation = Element.GetLocation(element=getItemAtIndex_2)
direction_2 = Line.Direction(line=getLocation)
isParallel = Vector.IsParallel(vector=direction, otherVector=direction_2)
filterByBoolMask = List.FilterByBoolMask(list=getItemAtIndex_2, mask=isParallel)
wall_extractsurfaces = Custom[Wall․ExtractSurfaces](wall=filterByBoolMask.in)  # package BIMCoder Nodes; Extrai as superfícies de uma parede, separando em superfícies da face (paralelas) e superfícies de espessura da parede (ortogonais)
wall_extractsurfaces_2 = Custom[Wall․ExtractSurfaces](wall=filterByBoolMask.out)

# group: Inserir a cota de todas as dimensões -> vãos e interseções
join = List.Join(list0=wall_extractsurfaces.ortoSurfaces, list1=wall_extractsurfaces_2.parallelSurfaces)
reference_bysurface = Custom[Reference․BySurface](surfaces=join)  # package BIMCoder Nodes; Obtém a referência de uma superfície
flatten_2 = List.Flatten(list=reference_bysurface)
dimension_byreferences = Custom[Dimension․ByReferences](line=translate, references=flatten_2, dimensionType=getItemAtIndex_3)  # package BIMCoder Nodes; Cria cotas (dimensions) dadas a vista, superfícies, linhas de inserção e tipo da cota

# group: Obter as superfícies do extremo das superfícies paralelas
flatten_3 = List.Flatten(list=wall_extractsurfaces_2.parallelSurfaces)
code_block_9 = CodeBlock { 0.5; }
pointAtParameter_2 = Surface.PointAtParameter(surface=flatten_3, u=code_block_9, v=code_block_9)
point_sortbydirection = Custom[Point․SortByDirection](points=pointAtParameter_2, direction=direction)  # package BIMCoder Nodes; Ordena pontos com base em um vetor de direção
indexOf_2 = List.IndexOf(list=pointAtParameter_2, element=point_sortbydirection)
getItemAtIndex_4 = List.GetItemAtIndex(list=flatten_3, index=indexOf_2)
firstItem = List.FirstItem(list=getItemAtIndex_4)
lastItem = List.LastItem(list=getItemAtIndex_4)
join_2 = List.Join(list0=firstItem, list1=lastItem)

# group (continued): Mover a linha base para o offset escolhido (orientação normal à superfície)
translate_2 = Geometry.Translate(geometry=translate, direction=normalAtParameter_2, distance=n02_offset_da_cota)

# group: Inserir a cota das interseções
n03_cota_de_intersecções = BoolSelector(false)  # "03 - Cota de intersecções?"; graph input
code_block_10 = CodeBlock(teste=n03_cota_de_intersecções, line=translate_2)
# ---------- code_block_10.designscript (3 lines) ----------
teste?
line:
null;
# ----------------------------------------
reference_bysurface_2 = Custom[Reference․BySurface](surfaces=wall_extractsurfaces_2.parallelSurfaces)
flatten_4 = List.Flatten(list=reference_bysurface_2)
dimension_byreferences_2 = Custom[Dimension․ByReferences](line=code_block_10, references=flatten_4, dimensionType=getItemAtIndex_3)

# group: Mover a linha base para o offset escolhido (orientação normal à superfície)
code_block_11 = CodeBlock { 0.5; }
normalAtParameter_3 = Surface.NormalAtParameter(surface=select_surfaceonelement, u=code_block_11, v=code_block_11)
code_block_12 = CodeBlock(teste=n03_cota_de_intersecções, x=n02_offset_da_cota)
# ---------- code_block_12.designscript (3 lines) ----------
teste?
x*2:
x;
# ----------------------------------------
translate_3 = Geometry.Translate(geometry=translate, direction=normalAtParameter_3, distance=code_block_12)

# group: Inserir a cota geral
n04_cota_geral = BoolSelector(true)  # "04 - Cota geral?"; graph input
code_block_13 = CodeBlock(teste=n04_cota_geral, line=translate_3)  # same code as code_block_10
reference_bysurface_3 = Custom[Reference․BySurface](surfaces=join_2)
flatten_5 = List.Flatten(list=reference_bysurface_3)
dimension_byreferences_3 = Custom[Dimension․ByReferences](line=code_block_13, references=flatten_5, dimensionType=getItemAtIndex_3)
