# Dynamo graph 06-2_BIMACON_Deletar Luvas e Conectar eletrodutos_R03_script.dyn "ok 06-2_BIMACON_Deletar Luvas e Conectar eletrodutos_R03_script" (Dynamo 2.19.3.6394)
# author: Jose Nelson
# Deleta as Luvas verticais  a uma determinada altura do projeto
# packages: MEPover 2022.10.30, archi-lab.net 2023.213.1722, bimorphNodes 4.2.4, DynaMEP 2.0.1, Data-Shapes 2022.2.105

# group: ENTRADAS PARA O USUÁRIO
code_block = CodeBlock { "IExcui todas Luvas de uma determinada altura e nível"; }
string = StringInput("LogoBimacon.png")
python_script = Python(IN[0]=string)  # IronPython2
# ---------- python_script.python (22 lines) ----------
import clr

# Adiciona referência ao ambiente .NET
clr.AddReference('System')
from System import Environment, IO

# Nome da imagem (entrada do usuário)
nome_arquivo_imagem = IN[0]

# Recupera o nome do usuário logado no Windows
usuario = Environment.UserName

# Monta o caminho completo para a pasta de imagens
caminho_base = r"C:\Users\{0}\AppData\Roaming\pyRevit\Extensions\Bimacon.extension\Bimacon.tab\Imagens_Bimacon".format(usuario)

# Junta o caminho base com o nome do arquivo
caminho_completo = IO.Path.Combine(caminho_base, nome_arquivo_imagem)

# Verifica se o arquivo existe
existe = IO.File.Exists(caminho_completo)

OUT = caminho_completo if existe else "Imagem não encontrada: {0}".format(caminho_completo)
# ----------------------------------------
file_from_path = FileObject(path=python_script)
readFromFile = Image.ReadFromFile(file=file_from_path)
string_2 = StringInput("Confirmar")
string_3 = StringInput("Selecione o Nível")
categories = Categories("OST_Levels")
all_elements_of_category = ElementsOfCategory(Category=categories)
elevation = Level.Elevation(level=all_elements_of_category)
sortByKey = List.SortByKey(list=all_elements_of_category, keys=elevation)
name = Level.Name(level=sortByKey.sortedList)
code_block_2 = CodeBlock { 0; }
boolean = BoolSelector(false)
dropdown_data = Custom[DropDown Data](InputName=string_3, Keys=name, Values=sortByKey.sortedList, DefaultValueIndex=code_block_2, Sorted_optional=boolean)  # package Data-Shapes; Create data for DropDown input in UI.MultiInputForm ++ . Check out www.data-shapes.net for more infos.
string_4 = StringInput("Altura das Luvas")
string_5 = StringInput("2.6")
boolean_2 = BoolSelector(true)
textbox_data = Custom[TextBox Data](InputName=string_4, DefaultText=string_5, IsNumberEntry=boolean_2)  # package Data-Shapes; Create Data for TextBox input in UI.MultipleInputForm ++ . Check out www.data-shapes.net for more informations
list_create = List.Create(item0=dropdown_data, item1=textbox_data)
boolean_3 = BoolSelector(true)
string_6 = StringInput("Cancelar")
number = DoubleInput(450)
number_2 = DoubleInput(200)
multipleinputform = Custom[MultipleInputForm ++](Description_optional=code_block, Logo_optional=readFromFile, ButtonText_optional=string_2, Inputs=list_create, Toggle=boolean_3, CancelButtonText_optional=string_6, Width_optional=number, LabelWidth_optional=number_2)  # package Data-Shapes; Create a form with multiple inputs. see www.data-shapes.net for tutorials and infos!
code_block_3 = CodeBlock()  # //Data-Shapes
code_block_4 = CodeBlock()  # //archilab

# group: Separar Entradas
code_block_5 = CodeBlock { 0; }
getItemAtIndex = List.GetItemAtIndex(list=multipleinputform.User_Inputs, index=code_block_5)
code_block_6 = CodeBlock { 1; }
getItemAtIndex_2 = List.GetItemAtIndex(list=multipleinputform.User_Inputs, index=code_block_6)

# group: Selecionar luvas
categories_2 = Categories("OST_ConduitFitting")
all_elements_of_category_2 = ElementsOfCategory(Category=categories_2)
string_7 = StringInput("Nível")
getParameterValueByName = Element.GetParameterValueByName(element=all_elements_of_category_2, parameterName=string_7)
name_2 = Level.Name(level=getParameterValueByName)
name_3 = Level.Name(level=getItemAtIndex)
eq = name_2 == name_3
filterByBoolMask = List.FilterByBoolMask(list=all_elements_of_category_2, mask=eq)
name_4 = Element.Name(element=filterByBoolMask.in)
string_8 = StringInput("Luva")
boolean_4 = BoolSelector(true)
contains = String.Contains(string=name_4, searchFor=string_8, ignoreCase=boolean_4)
filterByBoolMask_2 = List.FilterByBoolMask(list=filterByBoolMask.in, mask=contains)
string_9 = StringInput("Elevação do nível")
getParameterValueByName_2 = Element.GetParameterValueByName(element=filterByBoolMask_2.in, parameterName=string_9)
eq_2 = getParameterValueByName_2 == getItemAtIndex_2
filterByBoolMask_3 = List.FilterByBoolMask(list=filterByBoolMask_2.in, mask=eq_2)
watch = Watch(filterByBoolMask_3.in)

# group: Versão Revit
code_block_7 = CodeBlock { 2021; }
version = Python()  # "Document.Version"; IronPython2; unwired: IN[0]
# ---------- version.python (13 lines) ----------
# Importa as bibliotecas necessárias do Revit
import clr
clr.AddReference('RevitServices')
from RevitServices.Persistence import DocumentManager

# Obtém o documento ativo
doc = DocumentManager.Instance.CurrentUIApplication.Application

# Obtém o número da versão do Revit
revit_version = doc.VersionNumber

# Retorna o número da versão do Revit
OUT = "A versão do Revit é: {}".format(revit_version)
# ----------------------------------------
code_block_8 = CodeBlock { " "; }
split = String.Split(string=version, separator0=code_block_8)
lastItem = List.LastItem(list=split)
toNumber = String.ToNumber(string=lastItem)

# group: Altura Eletroduto
eq_3 = code_block_7 == toNumber
n2021 = CodeBlock { "Elevação superior"; }  # "2021"
n2022_2023_2024_2025 = CodeBlock { "Elevação da parte de cima da extremidade superior"; }  # "2022 - 2023 - 2024 - 2025"
if_ = If(test=eq_3, true=n2021, false=n2022_2023_2024_2025)

# group: Selecionar conduite a ser deletado
mep_connector_info = Custom[MEP Connector info+](element=filterByBoolMask_3.in)  # package MEPover; This node will return the connectors and a lot of information about those connectors of the input elements
getParameterValueByName_3 = Element.GetParameterValueByName(element=mep_connector_info.ConnectedElements, parameterName=if_)
code_block_9 = CodeBlock { 0.02; }
add = getItemAtIndex_2 + code_block_9
gt = getParameterValueByName_3 > add
filterByBoolMask_4 = List.FilterByBoolMask(list=mep_connector_info.ConnectedElements, mask=gt)
boolean_5 = BoolSelector(false)
clean = List.Clean(list=filterByBoolMask_4.in, preserveIndices=boolean_5)
flatten = List.Flatten(list=clean)
watch_2 = Watch(clean)
watch_3 = Watch(mep_connector_info.ConnectedElements)

# group: Luminárias por pavimento
categories_3 = Categories("OST_LightingFixtures")
all_elements_of_category_3 = ElementsOfCategory(Category=categories_3)
string_10 = StringInput("Nível")
getParameterValueByName_4 = Element.GetParameterValueByName(element=all_elements_of_category_3, parameterName=string_10)
name_5 = Level.Name(level=getParameterValueByName_4)
name_6 = Level.Name(level=getItemAtIndex)
eq_4 = name_5 == name_6
filterByBoolMask_5 = List.FilterByBoolMask(list=all_elements_of_category_3, mask=eq_4)
string_11 = StringInput("Elevação do Ponto")
getParameterValueByName_5 = Element.GetParameterValueByName(element=filterByBoolMask_5.in, parameterName=string_11)
maximumItem = List.MaximumItem(list=getParameterValueByName_5)

# group: Selecionar curva
mep_connector_info_2 = Custom[MEP Connector info+](element=flatten)
name_7 = Element.Name(element=mep_connector_info_2.ConnectedElements)
string_12 = StringInput("Curva")
boolean_6 = BoolSelector(true)
contains_2 = String.Contains(string=name_7, searchFor=string_12, ignoreCase=boolean_6)
filterByBoolMask_6 = List.FilterByBoolMask(list=mep_connector_info_2.ConnectedElements, mask=contains_2, lacing=Longest)
string_13 = StringInput("Elevação do nível")
getParameterValueByName_6 = Element.GetParameterValueByName(element=filterByBoolMask_6.in, parameterName=string_13)
gt_2 = getParameterValueByName_6 > maximumItem
filterByBoolMask_7 = List.FilterByBoolMask(list=filterByBoolMask_6.in, mask=gt_2)
boolean_7 = BoolSelector(false)
clean_2 = List.Clean(list=filterByBoolMask_7.in, preserveIndices=boolean_7)
flatten_2 = List.Flatten(list=clean_2)
watch_4 = Watch(clean_2)
watch_5 = Watch(mep_connector_info_2.ConnectedElements)

# group: Conduites a conectar
getParameterValueByName_7 = Element.GetParameterValueByName(element=mep_connector_info.ConnectedElements, parameterName=if_)
le = getParameterValueByName_7 <= add
filterByBoolMask_8 = List.FilterByBoolMask(list=mep_connector_info.ConnectedElements, mask=le)
boolean_8 = BoolSelector(false)
clean_3 = List.Clean(list=filterByBoolMask_8.in, preserveIndices=boolean_8)
flatten_3 = List.Flatten(list=clean_3)
solids = Element.Solids(element=flatten_3)

# group: Unir conduite da laje com da parede
mep_connector_info_3 = Custom[MEP Connector info+](element=flatten_2)
getParameterValueByName_8 = Element.GetParameterValueByName(element=mep_connector_info_3.ConnectedElements, parameterName=if_)
gt_3 = getParameterValueByName_8 > maximumItem
filterByBoolMask_9 = List.FilterByBoolMask(list=mep_connector_info_3.ConnectedElements, mask=gt_3)
flatten_4 = List.Flatten(list=filterByBoolMask_9.in)
solids_2 = Element.Solids(element=flatten_4)
watch_6 = Watch(filterByBoolMask_9.in)
watch_7 = Watch(mep_connector_info_3.ConnectedElements)
byMEPCurves = Custom[MEPFitting.ByMEPCurves](MEPCurve1=flatten_4, MEPCurve2=flatten_3, lacing=CrossProduct)  # package MEPover; Creates a UnionFitting or ElbowFitting by 2 MEPCurves (Ducts, Cable Trays, Pipes or Conduits). The output may not always be all the fittings created as Revit sometimes creates extra transition fittings outside of the node transactions.

# group: Deletar elemento obsoleto
# note: Archilab
code_block_10 = CodeBlock(waithFor=filterByBoolMask_9.in, Pass=flatten) { [waithFor,Pass][1]; }
delete = archilab.Revit.Elements.Elements.Delete(element=code_block_10)

# group: Deletar elemento obsoleto
# note: Archilab
code_block_11 = CodeBlock(waithFor=filterByBoolMask_9.in, Pass=clean_2) { [waithFor,Pass][1]; }
delete_2 = archilab.Revit.Elements.Elements.Delete(element=code_block_11)

watch_8 = Watch(filterByBoolMask.in)
boolean_9 = BoolSelector(false)
clean_4 = List.Clean(list=byMEPCurves, preserveIndices=boolean_9)
flatten_5 = List.Flatten(list=clean_4)

# group: Conduites desconectados
code_block_12 = CodeBlock(waithFor=flatten_5, Pass=mep_connector_info.ConnectedElements) { [waithFor,Pass][1]; }
flatten_6 = List.Flatten(list=code_block_12)
connectors = RevitModel.Element.Connectors(elements=flatten_6)
isConnected = MEP.Connectors.IsConnected(connector=connectors)
filterByBoolMask_10 = List.FilterByBoolMask(list=connectors, mask=isConnected)
flatten_7 = List.Flatten(list=filterByBoolMask_10.out)
owner = MEP.Connectors.Owner(connector=flatten_7)
flatten_8 = List.Flatten(list=filterByBoolMask_10.in)
owner_2 = MEP.Connectors.Owner(connector=flatten_8)

# group: Selecionar caixas
location = MEP.Connectors.Location(connector=flatten_7)
code_block_13 = CodeBlock { 0.05; }
byCenterPointRadius = Sphere.ByCenterPointRadius(centerPoint=location, radius=code_block_13)
intersectsSolid = Revit.Element.IntersectsSolid(solids=byCenterPointRadius, elements=filterByBoolMask.in)
intersectingElements = Results.SolidIntersectionResult.IntersectingElements(solidIntersectionResult=intersectsSolid)
boolean_10 = BoolSelector(true)
clean_5 = List.Clean(list=intersectingElements, preserveIndices=boolean_10)
firstItem = List.FirstItem(list=clean_5@L2)
boolean_11 = BoolSelector(false)
clean_6 = List.Clean(list=firstItem, preserveIndices=boolean_11)
flatten_9 = List.Flatten(list=clean_6)
uniqueItems = List.UniqueItems(list=flatten_9)

# group: Conectar eletrodutos e caixas
list_create_2 = List.Create(item0=owner, item1=uniqueItems)
flatten_10 = List.Flatten(list=list_create_2)
python_script_2 = Python(IN[0]=flatten_10)  # IronPython2
# ---------- python_script_2.python (73 lines) ----------
import clr

clr.AddReference("RevitServices")
import RevitServices
from RevitServices.Persistence import DocumentManager
from RevitServices.Transactions import TransactionManager
doc = DocumentManager.Instance.CurrentDBDocument

clr.AddReference("RevitAPI")
from Autodesk.Revit.DB import *

clr.AddReference("RevitNodes")
import Revit
clr.ImportExtensions(Revit.Elements)
clr.ImportExtensions(Revit.GeometryConversion)

def ConnectTo(connector, conn2):
    try:
        TransactionManager.Instance.EnsureInTransaction(doc)
        connector.ConnectTo(conn2)
        TransactionManager.Instance.TransactionTaskDone()
        return 1  # Retorna 1 para indicar uma conexão feita
    except:
        return 0  # Retorna 0 para indicar uma conexão não feita

conduits = UnwrapElement(IN[0])
margin = 0.01

connectors = {}
connlist = []
connections = 0  # Variável para armazenar o número de conexões feitas

for conduit in conduits:
    if conduit is None:
        continue

    try:
        conns = conduit.ConnectorManager.Connectors
    except AttributeError:
        try:
            conns = conduit.MEPModel.ConnectorManager.Connectors
        except AttributeError:
            continue

    for conn in conns:
        if conn.IsConnected:
            continue
        connectors[conn] = None
        connlist.append(conn)

for k in connectors.keys():
    mindist = 1000000
    closest = None
    for conn in connlist:
        if conn.Owner.Id.Equals(k.Owner.Id):
            continue
        dist = k.Origin.DistanceTo(conn.Origin)
        if dist < mindist:
            mindist = dist
            closest = conn
    if mindist > margin:
        continue
    connectors[k] = closest
    connlist.remove(closest)
    try:
        del connectors[closest]
    except:
        pass

for k, v in connectors.items():
    connections += ConnectTo(k, v)  # Incrementa a variável connections com o resultado da função ConnectTo

OUT = connections  # Saída com o número total de conexões feitas
# ----------------------------------------

solids_3 = Element.Solids(element=owner)

# group: Deletar Luvas
# note: Archilab
code_block_14 = CodeBlock(waithFor=flatten, Pass=filterByBoolMask_3.in) { [waithFor,Pass][1]; }
delete_3 = archilab.Revit.Elements.Elements.Delete(element=code_block_14)

filterByBoolMask_11 = List.FilterByBoolMask(list=code_block_14, mask=delete_3)
count = List.Count(list=filterByBoolMask_11.in)

# group: Mensagem
count_2 = List.Count(list=flatten_5)
code_block_15 = CodeBlock { 0; }
gt_4 = count_2 > code_block_15
code_block_16 = CodeBlock { ["Nenhuma Luva foi deletada"]; }

sub = count - count_2

# group (continued): Mensagem
code_block_17 = CodeBlock(N=count, N2=count_2, N3=sub)
# ---------- code_block_17.designscript (3 lines) ----------
["Feito! você deletou "+N+" luvas e"];
[" conectou "+N2+" curvas em seu projeto"];
[" faltaram "+N3+" conexões de eletrodutos."];
# ----------------------------------------
code_block_18 = CodeBlock(N=code_block_17.out0, N2=code_block_17.out1, N3=code_block_17.out2) { N+N2+N3; }
if_2 = If(test=gt_4, true=code_block_18, false=code_block_16)
flatten_11 = List.Flatten(list=if_2)
fromList = Python(IN[0]=flatten_11)  # "String.FromList"; IronPython2
# ---------- fromList.python (22 lines) ----------
# Carregar as bibliotecas DesignScript e padrão do Python
import sys
import clr
clr.AddReference('ProtoGeometry')
from Autodesk.DesignScript.Geometry import *

# Função para concatenar os valores de uma lista em uma única string com múltiplas linhas
def concatenate_list_to_string(input_list, delimiter="\n"):
    # Verifica se a entrada é uma lista
    if not isinstance(input_list, list):
        return "A entrada deve ser uma lista."
    
    # Converte todos os elementos para string e junta com o delimitador especificado
    result = delimiter.join(str(item) for item in input_list)
    return result

# Entrada pelo nó do Dynamo
lista = IN[0]  # Lista de valores a serem concatenados
delimitador = IN[1] if len(IN) > 1 else "\n"  # Delimitador opcional, padrão é nova linha

# Saída para o Dynamo
OUT = concatenate_list_to_string(lista, delimitador)
# ----------------------------------------
python_script_3 = Python(IN[0]=fromList)  # IronPython2
# ---------- python_script_3.python (21 lines) ----------
# Importar as bibliotecas necessárias do Revit
import clr
clr.AddReference("RevitServices")
from RevitServices.Persistence import DocumentManager

clr.AddReference("RevitAPI")
clr.AddReference("RevitAPIUI")
from Autodesk.Revit.UI import TaskDialog

# Pegar a entrada do Dynamo
mensagem = IN[0]

# Criar a TaskDialog
task_dialog = TaskDialog("Ok")
task_dialog.MainInstruction = mensagem

# Exibir a TaskDialog
task_dialog.Show()

# Saída do script
OUT = "Sucesso!"
# ----------------------------------------
