# Dynamo graph ok 06-3_BIMACON_Deletar Luvas e Conectar eletrodutos po Seleção_R02_script.dyn "ok 2021_06-3_BIMACON_Deletar Luvas e Conectar eletrodutos po Seleção_R02_script" (Dynamo 2.19.3.6394)
# author: Jose Nelson
# Deleta luvas verticais selecionando-as
# packages: MEPover 2022.10.30, archi-lab.net 2023.213.1722, bimorphNodes 4.2.4, DynaMEP 2.0.1, Rhythm 2023.4.2021

boolean = BoolSelector(false)

# group: Selecionar 1º ponto
code_block = CodeBlock { ["Pressione ESC para finalizar"]; }
code_block_2 = CodeBlock { ["Selecione a Luva a ser deletada"]; }
if_ = If(test=boolean, true=code_block, false=code_block_2)
fromList = Python(IN[0]=if_)  # "String.FromList"; IronPython2
# ---------- fromList.python (22 lines) ----------
# Carregar as bibliotecas DesignScript e padrão do Python
import sys
import clr
clr.AddReference('ProtoGeometry')
from Autodesk.DesignScript.Geometry import *

# Função para concatenar os valores de uma lista em uma única string com múltiplas linhas
def concatenate_list_to_string(input_list, delimiter="\n"):
    # Verifica se a entrada é uma lista
    if not isinstance(input_list, list):
        return "A entrada deve ser uma lista."
    
    # Converte todos os elementos para string e junta com o delimitador especificado
    result = delimiter.join(str(item) for item in input_list)
    return result

# Entrada pelo nó do Dynamo
lista = IN[0]  # Lista de valores a serem concatenados
delimitador = IN[1] if len(IN) > 1 else "\n"  # Delimitador opcional, padrão é nova linha

# Saída para o Dynamo
OUT = concatenate_list_to_string(lista, delimitador)
# ----------------------------------------
window_prompt_with_text = Python(IN[0]=fromList)  # IronPython2
# ---------- window_prompt_with_text.python (32 lines) ----------
# Importando as bibliotecas necessárias da API do Revit
import clr
clr.AddReference('RevitServices')  # Referência aos serviços do Revit
from RevitServices.Persistence import DocumentManager

clr.AddReference('RevitAPI')  # Referência à API do Revit
clr.AddReference('RevitAPIUI')  # Referência à API de Interface de Usuário do Revit

from Autodesk.Revit.UI import TaskDialog, TaskDialogCommonButtons, TaskDialogResult

# Recebe o texto de instrução como entrada do nó
instrucoes = IN[0]

# Verifica se a entrada é "Cancelar"
if instrucoes.lower() == "Pressione ESC para finalizar":
    OUT = False
else:
    # Criando o TaskDialog
    dialog = TaskDialog("Aviso")
    dialog.MainInstruction = instrucoes
    dialog.CommonButtons = TaskDialogCommonButtons.Ok | TaskDialogCommonButtons.Cancel

    # Exibindo o dialog para o usuário e capturando a resposta
    resultado = dialog.Show()

    # Interpretando a resposta
    if resultado == TaskDialogResult.Ok:
        OUT = True
    elif resultado == TaskDialogResult.Cancel:
        OUT = False
    else:
        OUT = None
# ----------------------------------------
categories = Categories("OST_ConduitFitting")
boolean_2 = BoolSelector(true)
boolean_3 = BoolSelector(false)
ʳʰʸᵗʰᵐ_selection_pick = Rhythm.Revit.Selection.Selection.Pick(runIt=window_prompt_with_text, category=categories, singleSelection=boolean_2, ordered=boolean_3)

# group: Versão Revit
code_block_3 = CodeBlock { 2021; }
version = Python()  # "Document.Version"; IronPython2; unwired: IN[0]
# ---------- version.python (13 lines) ----------
# Importa as bibliotecas necessárias do Revit
import clr
clr.AddReference('RevitServices')
from RevitServices.Persistence import DocumentManager

# Obtém o documento ativo
doc = DocumentManager.Instance.CurrentUIApplication.Application

# Obtém o número da versão do Revit
revit_version = doc.VersionNumber

# Retorna o número da versão do Revit
OUT = "A versão do Revit é: {}".format(revit_version)
# ----------------------------------------
code_block_4 = CodeBlock { " "; }
split = String.Split(string=version, separator0=code_block_4)
lastItem = List.LastItem(list=split)
toNumber = String.ToNumber(string=lastItem)

# group: Altura Eletroduto
eq = code_block_3 == toNumber
n2021 = CodeBlock { "Elevação superior"; }  # "2021"
n2022_2023_2024_2025 = CodeBlock { "Elevação da parte de cima da extremidade superior"; }  # "2022 - 2023 - 2024 - 2025"
if_2 = If(test=eq, true=n2021, false=n2022_2023_2024_2025)

# group: Selecionar conduite a ser deletado
mep_connector_info = Custom[MEP Connector info+](element=ʳʰʸᵗʰᵐ_selection_pick)  # package MEPover; This node will return the connectors and a lot of information about those connectors of the input elements
getParameterValueByName = Element.GetParameterValueByName(element=mep_connector_info.ConnectedElements, parameterName=if_2)
string = StringInput("Elevação do nível")
getParameterValueByName_2 = Element.GetParameterValueByName(element=ʳʰʸᵗʰᵐ_selection_pick, parameterName=string)
code_block_5 = CodeBlock { 0.02; }
add = getParameterValueByName_2 + code_block_5
gt = getParameterValueByName > add
filterByBoolMask = List.FilterByBoolMask(list=mep_connector_info.ConnectedElements, mask=gt)
boolean_4 = BoolSelector(false)
clean = List.Clean(list=filterByBoolMask.in, preserveIndices=boolean_4)
flatten = List.Flatten(list=clean)
watch = Watch(clean)
watch_2 = Watch(mep_connector_info.ConnectedElements)

# group: Selecionar curva
mep_connector_info_2 = Custom[MEP Connector info+](element=flatten)
name = Element.Name(element=mep_connector_info_2.ConnectedElements)
string_2 = StringInput("Curva")
boolean_5 = BoolSelector(true)
contains = String.Contains(string=name, searchFor=string_2, ignoreCase=boolean_5)
filterByBoolMask_2 = List.FilterByBoolMask(list=mep_connector_info_2.ConnectedElements, mask=contains, lacing=Longest)
boolean_6 = BoolSelector(false)
clean_2 = List.Clean(list=filterByBoolMask_2.in, preserveIndices=boolean_6)
flatten_2 = List.Flatten(list=clean_2)
string_3 = StringInput("Elevação do nível")
getParameterValueByName_3 = Element.GetParameterValueByName(element=filterByBoolMask_2.in, parameterName=string_3)
watch_3 = Watch(clean_2)
watch_4 = Watch(mep_connector_info_2.ConnectedElements)

# group: Conduites a conectar
string_4 = StringInput("Elevação superior")
getParameterValueByName_4 = Element.GetParameterValueByName(element=mep_connector_info.ConnectedElements, parameterName=if_2)
le = getParameterValueByName_4 <= add
filterByBoolMask_3 = List.FilterByBoolMask(list=mep_connector_info.ConnectedElements, mask=le)
boolean_7 = BoolSelector(false)
clean_3 = List.Clean(list=filterByBoolMask_3.in, preserveIndices=boolean_7)
flatten_3 = List.Flatten(list=clean_3)
solids = Element.Solids(element=flatten_3)

# group: Unir conduite da laje com da parede
mep_connector_info_3 = Custom[MEP Connector info+](element=flatten_2)
getParameterValueByName_5 = Element.GetParameterValueByName(element=mep_connector_info_3.ConnectedElements, parameterName=if_2)
gt_2 = getParameterValueByName_5@L2 > getParameterValueByName_3@L1
filterByBoolMask_4 = List.FilterByBoolMask(list=mep_connector_info_3.ConnectedElements, mask=gt_2, lacing=Longest)
flatten_4 = List.Flatten(list=filterByBoolMask_4.in)
solids_2 = Element.Solids(element=flatten_4)
watch_5 = Watch(filterByBoolMask_4.in)
byMEPCurves = Custom[MEPFitting.ByMEPCurves](MEPCurve1=flatten_4, MEPCurve2=flatten_3, lacing=CrossProduct)  # package MEPover; Creates a UnionFitting or ElbowFitting by 2 MEPCurves (Ducts, Cable Trays, Pipes or Conduits). The output may not always be all the fittings created as Revit sometimes creates extra transition fittings outside of the node transactions.

# group: Deletar elemento obsoleto
# note: Archilab
code_block_6 = CodeBlock(waithFor=filterByBoolMask_4.in, Pass=flatten) { [waithFor,Pass][1]; }
delete = archilab.Revit.Elements.Elements.Delete(element=code_block_6)

# group: Deletar Luvas
# note: Archilab
code_block_7 = CodeBlock(waithFor=flatten, Pass=ʳʰʸᵗʰᵐ_selection_pick) { [waithFor,Pass][1]; }
delete_2 = archilab.Revit.Elements.Elements.Delete(element=code_block_7)

# group: Deletar elemento obsoleto
# note: Archilab
code_block_8 = CodeBlock(waithFor=filterByBoolMask_4.in, Pass=clean_2) { [waithFor,Pass][1]; }
delete_3 = archilab.Revit.Elements.Elements.Delete(element=code_block_8)

boolean_8 = BoolSelector(false)
clean_4 = List.Clean(list=byMEPCurves, preserveIndices=boolean_8)
flatten_5 = List.Flatten(list=clean_4)

# group: Conduites desconectados
code_block_9 = CodeBlock(waithFor=flatten_5, Pass=flatten_3) { [waithFor,Pass][1]; }
flatten_6 = List.Flatten(list=code_block_9)
connectors = RevitModel.Element.Connectors(elements=flatten_6)
isConnected = MEP.Connectors.IsConnected(connector=connectors)
filterByBoolMask_5 = List.FilterByBoolMask(list=connectors, mask=isConnected)
flatten_7 = List.Flatten(list=filterByBoolMask_5.out)
owner = MEP.Connectors.Owner(connector=flatten_7)
flatten_8 = List.Flatten(list=filterByBoolMask_5.in)
owner_2 = MEP.Connectors.Owner(connector=flatten_8)

# group: Todas caixas
categories_2 = Categories("OST_ElectricalFixtures")
all_elements_of_category = ElementsOfCategory(Category=categories_2)
categories_3 = Categories("OST_LightingDevices")
all_elements_of_category_2 = ElementsOfCategory(Category=categories_3)
categories_4 = Categories("OST_ElectricalEquipment")
all_elements_of_category_3 = ElementsOfCategory(Category=categories_4)
list_create = List.Create(item0=all_elements_of_category, item1=all_elements_of_category_2, item2=all_elements_of_category_3)
flatten_9 = List.Flatten(list=list_create)

# group: Selecionar caixas
location = MEP.Connectors.Location(connector=flatten_7)
code_block_10 = CodeBlock { 0.05; }
byCenterPointRadius = Sphere.ByCenterPointRadius(centerPoint=location, radius=code_block_10)
intersectsSolid = Revit.Element.IntersectsSolid(solids=byCenterPointRadius, elements=flatten_9)
intersectingElements = Results.SolidIntersectionResult.IntersectingElements(solidIntersectionResult=intersectsSolid)
boolean_9 = BoolSelector(true)
clean_5 = List.Clean(list=intersectingElements, preserveIndices=boolean_9)
firstItem = List.FirstItem(list=clean_5@L2)
boolean_10 = BoolSelector(false)
clean_6 = List.Clean(list=firstItem, preserveIndices=boolean_10)
flatten_10 = List.Flatten(list=clean_6)
uniqueItems = List.UniqueItems(list=flatten_10)

# group: Conectar eletrodutos e caixas
list_create_2 = List.Create(item0=owner, item1=uniqueItems)
flatten_11 = List.Flatten(list=list_create_2)
python_script = Python(IN[0]=flatten_11)  # IronPython2
# ---------- python_script.python (73 lines) ----------
import clr

clr.AddReference("RevitServices")
import RevitServices
from RevitServices.Persistence import DocumentManager
from RevitServices.Transactions import TransactionManager
doc = DocumentManager.Instance.CurrentDBDocument

clr.AddReference("RevitAPI")
from Autodesk.Revit.DB import *

clr.AddReference("RevitNodes")
import Revit
clr.ImportExtensions(Revit.Elements)
clr.ImportExtensions(Revit.GeometryConversion)

def ConnectTo(connector, conn2):
    try:
        TransactionManager.Instance.EnsureInTransaction(doc)
        connector.ConnectTo(conn2)
        TransactionManager.Instance.TransactionTaskDone()
        return 1  # Retorna 1 para indicar uma conexão feita
    except:
        return 0  # Retorna 0 para indicar uma conexão não feita

conduits = UnwrapElement(IN[0])
margin = 0.01

connectors = {}
connlist = []
connections = 0  # Variável para armazenar o número de conexões feitas

for conduit in conduits:
    if conduit is None:
        continue

    try:
        conns = conduit.ConnectorManager.Connectors
    except AttributeError:
        try:
            conns = conduit.MEPModel.ConnectorManager.Connectors
        except AttributeError:
            continue

    for conn in conns:
        if conn.IsConnected:
            continue
        connectors[conn] = None
        connlist.append(conn)

for k in connectors.keys():
    mindist = 1000000
    closest = None
    for conn in connlist:
        if conn.Owner.Id.Equals(k.Owner.Id):
            continue
        dist = k.Origin.DistanceTo(conn.Origin)
        if dist < mindist:
            mindist = dist
            closest = conn
    if mindist > margin:
        continue
    connectors[k] = closest
    connlist.remove(closest)
    try:
        del connectors[closest]
    except:
        pass

for k, v in connectors.items():
    connections += ConnectTo(k, v)  # Incrementa a variável connections com o resultado da função ConnectTo

OUT = connections  # Saída com o número total de conexões feitas
# ----------------------------------------

solids_3 = Element.Solids(element=owner)
