# Dynamo graph 06-4_BIMACON_Inserir Emendas em Eletrodutos com mais de 3m_R02_script.dyn "ok 06-4_BIMACON_Inserir Emendas em Eletrodutos com mais de 3m_R02_script" (Dynamo 2.19.3.6394)
# author: Jose Nelson
# Inseri emendas em eletrodutos ou bandejas a uma determinada distância
# packages: Clockwork for Dynamo 2.x 2.4.0, MEPover 2022.10.30, Data-Shapes 2025.3.118, bimorphNodes 4.2.4, DynaMEP 2.0.1, BIMCoder Nodes - 2.X 2025.1.0, archi-lab.net 2023.213.1722

# group: Janela de Imputs
string = StringInput("Inserir emendas em eletrodutos/eletrocalhas")
string_2 = StringInput("LogoBimacon.png")
python_script = Python(IN[0]=string_2)  # IronPython2
# ---------- python_script.python (22 lines) ----------
import clr

# Adiciona referência ao ambiente .NET
clr.AddReference('System')
from System import Environment, IO

# Nome da imagem (entrada do usuário)
nome_arquivo_imagem = IN[0]

# Recupera o nome do usuário logado no Windows
usuario = Environment.UserName

# Monta o caminho completo para a pasta de imagens
caminho_base = r"C:\Users\{0}\AppData\Roaming\pyRevit\Extensions\Bimacon.extension\Bimacon.tab\Imagens_Bimacon".format(usuario)

# Junta o caminho base com o nome do arquivo
caminho_completo = IO.Path.Combine(caminho_base, nome_arquivo_imagem)

# Verifica se o arquivo existe
existe = IO.File.Exists(caminho_completo)

OUT = caminho_completo if existe else "Imagem não encontrada: {0}".format(caminho_completo)
# ----------------------------------------
file_from_path = FileObject(path=python_script)
readFromFile = Image.ReadFromFile(file=file_from_path)
string_3 = StringInput("Executar")
string_4 = StringInput("Selecione o tipo de eletroduto ou eletrocalha:")
code_block = CodeBlock()
# ---------- code_block.designscript (14 lines) ----------
"PVC Roscável Preto Rígido";
"PVC Condulete Top Rígido";
"Alumínio_Rígido Rosca BPS";
"Aço Galvanizado_(EME)";
"Aço Galvanizado_Com Conduletes Multiplos";
"Aço Galvanizado_Com Conduletes Rosca BSP";
"Aço Galvanizado_Com Conduletes sem Rosca";
"Aço Galvanizado_Com Curvas";
"Aço Galvanizado_Rígido Rosca BSP";
"Eletrocalha Lisa";
"Eletrocalha Perfurada";
"Leito para Cabos tipo escada";
"Perfilado Perfurado";
"Perfilado";
# ----------------------------------------
list_create = List.Create(item0=code_block.out0, item1=code_block.out1, item2=code_block.out2, item3=code_block.out3, item4=code_block.out4, item5=code_block.out5, item6=code_block.out6, item7=code_block.out7, item8=code_block.out8, item9=code_block.out9, item10=code_block.out10, item11=code_block.out11)
number = DoubleInput(0)
dropdown_data = Custom[DropDown Data](InputName=string_4, Keys=list_create, Values=list_create, DefaultValueIndex=number)  # package Data-Shapes; Create data for DropDown input in UI.MultiInputForm ++ . Check out www.data-shapes.net for more infos.
string_5 = StringInput("Comprimento Máximo (m):")
string_6 = StringInput("3")
boolean = BoolSelector(true)
textbox_data = Custom[TextBox Data](InputName=string_5, DefaultText=string_6, IsNumberEntry=boolean)  # package Data-Shapes; Create Data for TextBox input in UI.MultipleInputForm ++ . Check out www.data-shapes.net for more informations
list_create_2 = List.Create(item0=dropdown_data, item1=textbox_data)
boolean_2 = BoolSelector(true)
string_7 = StringInput("http://bimacon.wix.com/bimacon")
string_8 = StringInput("Cancelar")
number_2 = DoubleInput(550)
number_3 = DoubleInput(220)
multipleinputform = Custom[MultipleInputForm ++](Description_optional=string, Logo_optional=readFromFile, ButtonText_optional=string_3, Inputs=list_create_2, Toggle=boolean_2, LinkToHelp_optional=string_7, CancelButtonText_optional=string_8, Width_optional=number_2, LabelWidth_optional=number_3)  # package Data-Shapes; Create a form with multiple inputs. see www.data-shapes.net for tutorials and infos!

# group: Filter
# Descrição <Clique duas vezes aqui para editar a descrição do grupo>
code_block_2 = CodeBlock(IN=multipleinputform.User_Inputs) { texto1 = IN[0]; texto2 = IN[1]; }
watch = Watch(code_block_2.texto1)
categories = Categories("OST_Conduit")  # graph input
categories_2 = Categories("OST_CableTray")  # graph input
join = List.Join(list0=categories, list1=categories_2)
all_elements_of_category = ElementsOfCategory(Category=join)
name = Element.Name(element=all_elements_of_category)
contains = String.Contains(string=name, searchFor=code_block_2.texto1)
filterByBoolMask = List.FilterByBoolMask(list=all_elements_of_category, mask=contains)
boolean_3 = BoolSelector(false)
clean = List.Clean(list=filterByBoolMask.in, preserveIndices=boolean_3)

# group: Find elements to split
# Descrição <Clique duas vezes aqui para editar a descrição do grupo>
code_block_3 = CodeBlock { "Comprimento"; }
getParameterValueByName = Element.GetParameterValueByName(element=clean, parameterName=code_block_3)
code_block_4 = CodeBlock(len=getParameterValueByName, comp=code_block_2.texto2, elem=clean) { len >= comp ? elem : null; }
boolean_4 = BoolSelector(false)
clean_2 = List.Clean(list=code_block_4, preserveIndices=boolean_4)

watch_2 = Watch(clean_2)
flatten = List.Flatten(list=clean_2)

# group: length and sublength
# Descrição <Clique duas vezes aqui para editar a descrição do grupo>
getLocation = Element.GetLocation(element=flatten)
length = Curve.Length(curve=getLocation)

# group: Copy new elements
# Descrição <Clique duas vezes aqui para editar a descrição do grupo>
div = length / code_block_2.texto2
ceiling = Math.Ceiling(number=div)
cycle = List.Cycle(list=flatten@L1, amount=ceiling@L1)
byCoordinates = Vector.ByCoordinates()
# note: Clockwork
copyByVector = Custom[Element.CopyByVector](element=cycle@@L1, vector=byCoordinates)  # package Clockwork for Dynamo 2.x; Copies an element or a list of elements by a given vector.
flatten_2 = List.Flatten(list=copyByVector, lacing=Longest)

# group: split length into sublength
# Descrição <Clique duas vezes aqui para editar a descrição do grupo>
div_2 = code_block_2.texto2 / length
code_block_5 = CodeBlock(step=div_2) { 0..1..step; }
splitByParameter = Curve.SplitByParameter(curve=getLocation, parameters=code_block_5)

setLocation = Element.SetLocation(element=flatten_2, geometry=splitByParameter)

# group: Union fittings
# Descrição <Clique duas vezes aqui para editar a descrição do grupo>
code_block_6 = CodeBlock(waithFor=setLocation, Pass=flatten_2) { [waithFor,Pass][1]; }
code_block_7 = CodeBlock { -1; }
dropItems = List.DropItems(list=code_block_6, amount=code_block_7, lacing=Longest)
restOfItems = List.RestOfItems(list=code_block_6, lacing=Longest)
byMEPCurves = Custom[MEPFitting.ByMEPCurves](MEPCurve1=dropItems, MEPCurve2=restOfItems, lacing=Longest)  # package MEPover; Creates a UnionFitting or ElbowFitting by 2 MEPCurves (Ducts, Cable Trays, Pipes or Conduits). The output may not always be all the fittings created as Revit sometimes creates extra transition fittings outside of the node transactions.

flatten_3 = List.Flatten(list=byMEPCurves)
isNull = Object.IsNull(object=flatten_3)
firstItem = List.FirstItem(list=isNull)
code_block_8 = CodeBlock { []; }
condição_if_de_lista = CodeBlock(test=firstItem, verd=code_block_8, fals=flatten_3)
# ---------- condição_if_de_lista.designscript (3 lines) ----------
//Condições IF
indx = (test) ? 0 : 1;
rslt = [verd,fals][indx];
# ----------------------------------------

# group: Mensagem final
count = List.Count(list=condição_if_de_lista.rslt@L2)
code_block_9 = CodeBlock { 0; }
gt = count > code_block_9
code_block_10 = CodeBlock(N=count) { ["Feito! Você inseriu "+N+" emendas em seu projeto"]; }
code_block_11 = CodeBlock { ["Nenhum emenda foi inserida"]; }
if_ = If(test=gt, true=code_block_10, false=code_block_11)
flatten_4 = List.Flatten(list=if_)
fromList = Python(IN[0]=flatten_4)  # "String.FromList"; IronPython2
# ---------- fromList.python (22 lines) ----------
# Carregar as bibliotecas DesignScript e padrão do Python
import sys
import clr
clr.AddReference('ProtoGeometry')
from Autodesk.DesignScript.Geometry import *

# Função para concatenar os valores de uma lista em uma única string com múltiplas linhas
def concatenate_list_to_string(input_list, delimiter="\n"):
    # Verifica se a entrada é uma lista
    if not isinstance(input_list, list):
        return "A entrada deve ser uma lista."
    
    # Converte todos os elementos para string e junta com o delimitador especificado
    result = delimiter.join(str(item) for item in input_list)
    return result

# Entrada pelo nó do Dynamo
lista = IN[0]  # Lista de valores a serem concatenados
delimitador = IN[1] if len(IN) > 1 else "\n"  # Delimitador opcional, padrão é nova linha

# Saída para o Dynamo
OUT = concatenate_list_to_string(lista, delimitador)
# ----------------------------------------
python_script_2 = Python(IN[0]=fromList)  # IronPython2
# ---------- python_script_2.python (21 lines) ----------
# Importar as bibliotecas necessárias do Revit
import clr
clr.AddReference("RevitServices")
from RevitServices.Persistence import DocumentManager

clr.AddReference("RevitAPI")
clr.AddReference("RevitAPIUI")
from Autodesk.Revit.UI import TaskDialog

# Pegar a entrada do Dynamo
mensagem = IN[0]

# Criar a TaskDialog
task_dialog = TaskDialog("Ok")
task_dialog.MainInstruction = mensagem

# Exibir a TaskDialog
task_dialog.Show()

# Saída do script
OUT = "Sucesso!"
# ----------------------------------------

# group: Bandeja/Eletroduto
connectors = Custom[👓 Connectors+](element=flatten)  # package BIMCoder Nodes - 2.X; Obtém as propriedades mais relevantes dos conectores de elementos

# group: Todas conexões a emendar
categories_3 = Categories("OST_CableTrayFitting")
all_elements_of_category_2 = ElementsOfCategory(Category=categories_3)
name_2 = Element.Name(element=all_elements_of_category_2)
code_block_12 = CodeBlock { ["Saida_","Porca","Arruela","Parafuso"]; }
watch_3 = Watch(code_block_12)
contains_2 = Custom[Contains](stringList=name_2, filterList=watch_3)  # package archi-lab.net; This node takes a list of strings and checks if any string contains a matching string from filter input.
filterByBoolMask_2 = List.FilterByBoolMask(list=all_elements_of_category_2, mask=contains_2, lacing=Longest)
flatten_5 = List.Flatten(list=filterByBoolMask_2.out)
categories_4 = Categories("OST_ConduitFitting")
all_elements_of_category_3 = ElementsOfCategory(Category=categories_4)
name_3 = Element.Name(element=all_elements_of_category_3)
code_block_13 = CodeBlock { ["Arruela","Cabo","Conector","Caixa de Luz","Bucha","PVC 5 entradas","Unidut","Tampa","Adaptador"]; }
contains_3 = Custom[Contains](stringList=name_3, filterList=code_block_13)
filterByBoolMask_3 = List.FilterByBoolMask(list=all_elements_of_category_3, mask=contains_3)
flatten_6 = List.Flatten(list=filterByBoolMask_3.out)
categories_5 = Categories("OST_ElectricalFixtures")
all_elements_of_category_4 = ElementsOfCategory(Category=categories_5)
name_4 = Element.Name(element=all_elements_of_category_4)
code_block_14 = CodeBlock { [".Posição Livre","Haste","Disjuntor"]; }
contains_4 = Custom[Contains](stringList=name_4, filterList=code_block_14)
filterByBoolMask_4 = List.FilterByBoolMask(list=all_elements_of_category_4, mask=contains_4)
flatten_7 = List.Flatten(list=filterByBoolMask_4.out)
list_create_3 = List.Create(item0=flatten_5, item1=flatten_6, item2=flatten_7)
flatten_8 = List.Flatten(list=list_create_3)

# group: Selecionar conexões
location = MEP.Connectors.Location(connector=connectors.Connectors)
code_block_15 = CodeBlock { 0.11; }
byCenterPointRadius = Sphere.ByCenterPointRadius(centerPoint=location, radius=code_block_15)
intersectsSolid = Revit.Element.IntersectsSolid(solids=byCenterPointRadius, elements=flatten_8)
intersectingElements = Results.SolidIntersectionResult.IntersectingElements(solidIntersectionResult=intersectsSolid)
boolean_5 = BoolSelector(true)
clean_3 = List.Clean(list=intersectingElements, preserveIndices=boolean_5)
firstItem_2 = List.FirstItem(list=clean_3@L2)
boolean_6 = BoolSelector(false)
clean_4 = List.Clean(list=firstItem_2, preserveIndices=boolean_6)
flatten_9 = List.Flatten(list=clean_4)
uniqueItems = List.UniqueItems(list=flatten_9)
solids = Element.Solids(element=uniqueItems@L2, lacing=Longest)

# group: Adjust segment length
# Descrição <Clique duas vezes aqui para editar a descrição do grupo>
code_block_16 = CodeBlock { "Comprimento da curva"; }
getParameterValueByName_2 = Element.GetParameterValueByName(element=byMEPCurves, parameterName=code_block_16)
lastItem = List.LastItem(list=getParameterValueByName_2, lacing=Longest)
add = code_block_2.texto2 + lastItem
div_3 = add / length
code_block_17 = CodeBlock(step=div_3) { 0..1..step; }
splitByParameter_2 = Curve.SplitByParameter(curve=getLocation, parameters=code_block_17)
code_block_18 = CodeBlock { -1; }
dropItems_2 = List.DropItems(list=splitByParameter_2, amount=code_block_18, lacing=Longest)
endPoint = Curve.EndPoint(curve=dropItems_2)
setLocation_2 = Element.SetLocation(element=byMEPCurves, geometry=endPoint)

passthrough = Custom[Passthrough](passThrough=code_block_6, waitFor=setLocation_2)  # package Clockwork for Dynamo 2.x; Forces a sequential order of execution. The node wired into the output of the Passthrough node will be executed *after* the node wired into the waitFor input (e.g. important for some Revit operations). The value of the passThrough input will be passed on to the node wired into the output port of the Passthrough node.
flatten_10 = List.Flatten(list=passthrough)
connectors_2 = Custom[👓 Connectors+](element=flatten_10)
isConnected = MEP.Connectors.IsConnected(connector=connectors_2.Connectors)
filterByBoolMask_5 = List.FilterByBoolMask(list=connectors_2.Connectors, mask=isConnected)
flatten_11 = List.Flatten(list=filterByBoolMask_5.out)
passthrough_2 = Custom[Passthrough](passThrough=uniqueItems, waitFor=setLocation_2)
connectors_3 = Custom[👓 Connectors+](element=passthrough_2)
isConnected_2 = MEP.Connectors.IsConnected(connector=connectors_3.Connectors)
filterByBoolMask_6 = List.FilterByBoolMask(list=connectors_3.Points, mask=isConnected_2)
flatten_12 = List.Flatten(list=filterByBoolMask_6.out)
getConnectorClosestTo = MEP.Connectors.GetConnectorClosestTo(connectors=flatten_11, point=flatten_12)
filterByBoolMask_7 = List.FilterByBoolMask(list=connectors_3.Connectors, mask=isConnected_2)
flatten_13 = List.Flatten(list=filterByBoolMask_7.out)
connectTo = Custom[Connector.ConnectTo](connector=getConnectorClosestTo, Connector2=flatten_13)  # package MEPover; Connects a connector to another connector. Returns True if connection succeeded

# group: Delete outdated elements
# Descrição <Clique duas vezes aqui para editar a descrição do grupo>
code_block_19 = CodeBlock(waithFor=code_block_6, Pass=flatten) { [waithFor,Pass][1]; }
# note: Archilab
delete = archilab.Revit.Elements.Elements.Delete(element=code_block_19)
