# Dynamo graph 06-5_BIMACON_Inserir Emendas em Eletrodutos Seleção_R03_script.dyn "ok 06-5_BIMACON_Inserir Emendas em Eletrodutos Seleção_R03_script" (Dynamo 2.19.3.6394)
# author: Jose Nelson
# Inseri luvas a uma determinada distância de eletrodutos ou bandejas selecionadas
# packages: Clockwork for Dynamo 2.x 2.4.0, MEPover 2022.10.30, Data-Shapes 2025.3.118, bimorphNodes 4.2.4, DynaMEP 2.0.1, BIMCoder Nodes - 2.X 2025.1.0, archi-lab.net 2023.213.1722, Rhythm 2023.4.2021, Genius Loci 2023.2.21

# group: Janela de Imputs
string = StringInput("Inserir emendas em eletrodutos/eletrocalhas por seleção")
string_2 = StringInput("LogoBimacon.png")
python_script = Python(IN[0]=string_2)  # IronPython2
# ---------- python_script.python (22 lines) ----------
import clr

# Adiciona referência ao ambiente .NET
clr.AddReference('System')
from System import Environment, IO

# Nome da imagem (entrada do usuário)
nome_arquivo_imagem = IN[0]

# Recupera o nome do usuário logado no Windows
usuario = Environment.UserName

# Monta o caminho completo para a pasta de imagens
caminho_base = r"C:\Users\{0}\AppData\Roaming\pyRevit\Extensions\Bimacon.extension\Bimacon.tab\Imagens_Bimacon".format(usuario)

# Junta o caminho base com o nome do arquivo
caminho_completo = IO.Path.Combine(caminho_base, nome_arquivo_imagem)

# Verifica se o arquivo existe
existe = IO.File.Exists(caminho_completo)

OUT = caminho_completo if existe else "Imagem não encontrada: {0}".format(caminho_completo)
# ----------------------------------------
file_from_path = FileObject(path=python_script)
readFromFile = Image.ReadFromFile(file=file_from_path)
string_3 = StringInput("Executar")
string_4 = StringInput("Número de Emendas")
string_5 = StringInput("3")
boolean = BoolSelector(true)
textbox_data = Custom[TextBox Data](InputName=string_4, DefaultText=string_5, IsNumberEntry=boolean)  # package Data-Shapes; Create Data for TextBox input in UI.MultipleInputForm ++ . Check out www.data-shapes.net for more informations
boolean_2 = BoolSelector(true)
string_6 = StringInput("http://bimacon.wix.com/bimacon")
string_7 = StringInput("Cancelar")
number = DoubleInput(480)
number_2 = DoubleInput(180)
multipleinputform = Custom[MultipleInputForm ++](Description_optional=string, Logo_optional=readFromFile, ButtonText_optional=string_3, Inputs=textbox_data, Toggle=boolean_2, LinkToHelp_optional=string_6, CancelButtonText_optional=string_7, Width_optional=number, LabelWidth_optional=number_2)  # package Data-Shapes; Create a form with multiple inputs. see www.data-shapes.net for tutorials and infos!

# group: Filter
# Descrição <Clique duas vezes aqui para editar a descrição do grupo>
code_block = CodeBlock(IN=multipleinputform.User_Inputs) { texto1 = IN[0]; }
watch = Watch(code_block)

end = Revit.Transaction.Transaction.End(input=multipleinputform.Was_Cancelled)
start = Revit.Transaction.Transaction.Start(input=end)
passThrough = Custom[PassThrough](passThrough=start, waitFor=end)  # package archi-lab.net; Ripped this off from Clockwork. Sorry Andy.
not_ = Not(x=passThrough)

# group: Selecionar eletroduto
categories = Categories("OST_Conduit")
categories_2 = Categories("OST_CableTray")
list_create = List.Create(item0=categories, item1=categories_2)
flatten = List.Flatten(list=list_create)
boolean_3 = BoolSelector(true)
boolean_4 = BoolSelector(true)
ʳʰʸᵗʰᵐ_selection_pick = Rhythm.Revit.Selection.Selection.Pick(runIt=not_, category=flatten, singleSelection=boolean_3, ordered=boolean_4)

flatten_2 = List.Flatten(list=ʳʰʸᵗʰᵐ_selection_pick)

# group: Copy new elements
# Descrição <Clique duas vezes aqui para editar a descrição do grupo>
number_3 = DoubleInput(1)
add = code_block + number_3
cycle = List.Cycle(list=flatten_2@L1, amount=add@L1)
byCoordinates = Vector.ByCoordinates()
# note: Clockwork
copyByVector = Custom[Element.CopyByVector](element=cycle@@L1, vector=byCoordinates)  # package Clockwork for Dynamo 2.x; Copies an element or a list of elements by a given vector.
flatten_3 = List.Flatten(list=copyByVector, lacing=Longest)

watch_2 = Watch(flatten_2)

# group: Delete outdated elements
# Descrição <Clique duas vezes aqui para editar a descrição do grupo>
code_block_2 = CodeBlock(waithFor=flatten_3, Pass=watch_2) { [waithFor,Pass][1]; }
# note: Archilab
delete = archilab.Revit.Elements.Elements.Delete(element=code_block_2)

getLocation = Element.GetLocation(element=flatten_2)
length = Curve.Length(curve=getLocation)

# group: split length into sublength
# Descrição <Clique duas vezes aqui para editar a descrição do grupo>
div = length / add
div_2 = div / length
code_block_3 = CodeBlock(step=div_2) { 0..1..step; }
splitByParameter = Curve.SplitByParameter(curve=getLocation, parameters=code_block_3)

setLocation = Element.SetLocation(element=flatten_3, geometry=splitByParameter)

# group: Union fittings
# Descrição <Clique duas vezes aqui para editar a descrição do grupo>
code_block_4 = CodeBlock(waithFor=setLocation, Pass=flatten_3) { [waithFor,Pass][1]; }
code_block_5 = CodeBlock { -1; }
dropItems = List.DropItems(list=code_block_4, amount=code_block_5, lacing=Longest)
restOfItems = List.RestOfItems(list=code_block_4, lacing=Longest)
byMEPCurves = Custom[MEPFitting.ByMEPCurves](MEPCurve1=dropItems, MEPCurve2=restOfItems, lacing=Longest)  # package MEPover; Creates a UnionFitting or ElbowFitting by 2 MEPCurves (Ducts, Cable Trays, Pipes or Conduits). The output may not always be all the fittings created as Revit sometimes creates extra transition fittings outside of the node transactions.

# group: Versão Revit
code_block_6 = CodeBlock { 2021; }
version = Python()  # "Document.Version"; IronPython2; unwired: IN[0]
# ---------- version.python (13 lines) ----------
# Importa as bibliotecas necessárias do Revit
import clr
clr.AddReference('RevitServices')
from RevitServices.Persistence import DocumentManager

# Obtém o documento ativo
doc = DocumentManager.Instance.CurrentUIApplication.Application

# Obtém o número da versão do Revit
revit_version = doc.VersionNumber

# Retorna o número da versão do Revit
OUT = "A versão do Revit é: {}".format(revit_version)
# ----------------------------------------
code_block_7 = CodeBlock { " "; }
split = String.Split(string=version, separator0=code_block_7)
lastItem = List.LastItem(list=split)
toNumber = String.ToNumber(string=lastItem)

# group: Altura Eletroduto
eq = code_block_6 == toNumber
n2021 = CodeBlock { "Elevação superior"; "Elevação inferior"; }  # "2021"
n2022_2023_2024_2025 = CodeBlock { "Elevação da parte de cima da extremidade superior"; "Elevação da parte de baixo da extremidade inferior"; }  # "2022 - 2023 - 2024 - 2025"
if_ = If(test=eq, true=n2021.out0, false=n2022_2023_2024_2025.out0)
if_2 = If(test=eq, true=n2021.out1, false=n2022_2023_2024_2025.out1)

getParameterValueByName = Element.GetParameterValueByName(element=ʳʰʸᵗʰᵐ_selection_pick, parameterName=if_, lacing=Longest)
getParameterValueByName_2 = Element.GetParameterValueByName(element=ʳʰʸᵗʰᵐ_selection_pick, parameterName=if_2, lacing=Longest)
sub = getParameterValueByName - getParameterValueByName_2
code_block_8 = CodeBlock { 0.21; }
gt = sub > code_block_8
code_block_9 = CodeBlock { []; }
getLocation_2 = Element.GetLocation(element=byMEPCurves)

# group: Bandeja/Eletroduto
connectors = Custom[👓 Connectors+](element=flatten_2)  # package BIMCoder Nodes - 2.X; Obtém as propriedades mais relevantes dos conectores de elementos

code_block_10 = CodeBlock { []; }
condição_if_de_lista = CodeBlock(test=gt, verd=byMEPCurves, fals=code_block_10)
# ---------- condição_if_de_lista.designscript (3 lines) ----------
//Condições IF
indx = (test) ? 0 : 1;
rslt = [verd,fals][indx];
# ----------------------------------------
end_2 = Revit.Transaction.Transaction.End(input=byMEPCurves)
passThrough_2 = Custom[PassThrough](passThrough=condição_if_de_lista.rslt, waitFor=end_2)
start_2 = Revit.Transaction.Transaction.Start(input=passThrough_2)

# group: Plano da Parede
familyinstance_references = Custom[👓 FamilyInstance․References](familyInstance=start_2, lacing=Longest)  # package BIMCoder Nodes - 2.X; Obtém todas as referências de uma família de instância
string_8 = StringInput("Parede")
contains = String.Contains(string=familyinstance_references.ReferenceName, searchFor=string_8)
filterByBoolMask = List.FilterByBoolMask(list=familyinstance_references.Plane, mask=contains)
normal = Plane.Normal(plane=filterByBoolMask.in)
flatten_4 = List.Flatten(list=normal@L3)
origin = Plane.Origin(plane=filterByBoolMask.in)

condição_if_de_lista_2 = CodeBlock(test=gt, verd=code_block_4, fals=code_block_9)  # same code as condição_if_de_lista

# group: Todas conexões a emendar
categories_3 = Categories("OST_CableTrayFitting")
all_elements_of_category = ElementsOfCategory(Category=categories_3)
name = Element.Name(element=all_elements_of_category)
code_block_11 = CodeBlock { ["Saida_","Porca","Arruela","Parafuso"]; }
watch_3 = Watch(code_block_11)
contains_2 = Custom[Contains](stringList=name, filterList=watch_3)  # package archi-lab.net; This node takes a list of strings and checks if any string contains a matching string from filter input.
filterByBoolMask_2 = List.FilterByBoolMask(list=all_elements_of_category, mask=contains_2, lacing=Longest)
flatten_5 = List.Flatten(list=filterByBoolMask_2.out)
categories_4 = Categories("OST_ConduitFitting")
all_elements_of_category_2 = ElementsOfCategory(Category=categories_4)
name_2 = Element.Name(element=all_elements_of_category_2)
code_block_12 = CodeBlock { ["Arruela","Cabo","Conector","Caixa de Luz","Bucha","PVC 5 entradas","Unidut","Tampa","Adaptador"]; }
contains_3 = Custom[Contains](stringList=name_2, filterList=code_block_12)
filterByBoolMask_3 = List.FilterByBoolMask(list=all_elements_of_category_2, mask=contains_3)
flatten_6 = List.Flatten(list=filterByBoolMask_3.out)
categories_5 = Categories("OST_ElectricalFixtures")
all_elements_of_category_3 = ElementsOfCategory(Category=categories_5)
name_3 = Element.Name(element=all_elements_of_category_3)
code_block_13 = CodeBlock { [".Posição Livre","Haste","Disjuntor","x."]; }
contains_4 = Custom[Contains](stringList=name_3, filterList=code_block_13)
filterByBoolMask_4 = List.FilterByBoolMask(list=all_elements_of_category_3, mask=contains_4)
flatten_7 = List.Flatten(list=filterByBoolMask_4.out)
categories_6 = Categories("OST_LightingDevices")
all_elements_of_category_4 = ElementsOfCategory(Category=categories_6)
name_4 = Element.Name(element=all_elements_of_category_4)
code_block_14 = CodeBlock { ["Armação","Cabo","Terminal","Cabos","x.","1/4","1/2","3/16","5/16","9/16","5/32","3/8","TP"]; }
contains_5 = Custom[Contains](stringList=name_4, filterList=code_block_14)
filterByBoolMask_5 = List.FilterByBoolMask(list=all_elements_of_category_4, mask=contains_5)
flatten_8 = List.Flatten(list=filterByBoolMask_5.out)
categories_7 = Categories("OST_ElectricalEquipment")
all_elements_of_category_5 = ElementsOfCategory(Category=categories_7)
list_create_2 = List.Create(item0=flatten_5, item1=flatten_6, item2=flatten_7, item3=flatten_8, item4=all_elements_of_category_5)
flatten_9 = List.Flatten(list=list_create_2)
name_5 = Element.Name(element=all_elements_of_category_5)

# group: Selecionar conexões
location = MEP.Connectors.Location(connector=connectors.Connectors)
code_block_15 = CodeBlock { 0.11; }
byCenterPointRadius = Sphere.ByCenterPointRadius(centerPoint=location, radius=code_block_15)
intersectsSolid = Revit.Element.IntersectsSolid(solids=byCenterPointRadius, elements=flatten_9)
intersectingElements = Results.SolidIntersectionResult.IntersectingElements(solidIntersectionResult=intersectsSolid)
boolean_5 = BoolSelector(true)
clean = List.Clean(list=intersectingElements, preserveIndices=boolean_5)
firstItem = List.FirstItem(list=clean@L2)
boolean_6 = BoolSelector(false)
clean_2 = List.Clean(list=firstItem, preserveIndices=boolean_6)
flatten_10 = List.Flatten(list=clean_2)
uniqueItems = List.UniqueItems(list=flatten_10)

# group: Base
# Descrição <Clique duas vezes aqui para editar a descrição do grupo>
categories_8 = Categories("OST_Walls")
categories_9 = Categories("OST_BridgePiers")
categories_10 = Categories("OST_StructuralColumns")
categories_11 = Categories("OST_StructuralFraming")
list_create_3 = List.Create(item0=categories_8, item1=categories_9, item2=categories_10, item3=categories_11)
all_elements_of_category_6 = ElementsOfCategory(Category=list_create_3)
flatten_11 = List.Flatten(list=all_elements_of_category_6)
intersectsSolid_2 = Revit.Element.IntersectsSolid(solids=byCenterPointRadius, elements=flatten_11)
intersectingElements_2 = Results.SolidIntersectionResult.IntersectingElements(solidIntersectionResult=intersectsSolid_2)
flatten_12 = List.Flatten(list=intersectingElements_2)
uniqueItems_2 = List.UniqueItems(list=flatten_12)
faces = Element.Faces(element=uniqueItems_2)
solids = Element.Solids(element=uniqueItems_2)

# group: Rotacionar
# Descrição <Clique duas vezes aqui para editar a descrição do grupo>
flatten_13 = List.Flatten(list=byMEPCurves)
flatten_14 = List.Flatten(list=dropItems)
firstItem_2 = List.FirstItem(list=byCenterPointRadius@L2)
doesIntersect = Geometry.DoesIntersect(geometry=firstItem_2, other=faces@L1, lacing=Longest)
filterByBoolMask_6 = List.FilterByBoolMask(list=faces@L2, mask=doesIntersect@L2)
normalAtParameter = Surface.NormalAtParameter(surface=filterByBoolMask_6.in)
isParallel = Vector.IsParallel(vector=normalAtParameter@L2, otherVector=flatten_4@L2, lacing=Longest)
YAxis = Vector.YAxis()
ZAxis = Vector.ZAxis()
angleAboutAxis = Vector.AngleAboutAxis(vector=normalAtParameter, otherVector=YAxis, rotationAxis=ZAxis)
round = Math.Round(number=angleAboutAxis)
flatten_15 = List.Flatten(list=round)
YAxis_2 = Vector.YAxis()
ZAxis_2 = Vector.ZAxis()
angleAboutAxis_2 = Vector.AngleAboutAxis(vector=flatten_4, otherVector=YAxis_2, rotationAxis=ZAxis_2)
flatten_16 = List.Flatten(list=angleAboutAxis_2)
round_2 = Math.Round(number=flatten_16)
eq_2 = Equals(x=flatten_15, y=round_2)
code_block_16 = CodeBlock { 180; 0; }
condição_if_de_lista_3 = CodeBlock(test1=eq_2, Verd=code_block_16.out0, Fals=code_block_16.out1)
# ---------- condição_if_de_lista_3.designscript (2 lines) ----------
//Condições IF
test1 == true ? Verd : Fals;
# ----------------------------------------
sub_2 = flatten_15 - round_2
condição_if_de_lista_4 = CodeBlock(test=isParallel, verd=condição_if_de_lista_3, fals=sub_2)  # same code as condição_if_de_lista
flatten_17 = List.Flatten(list=condição_if_de_lista_4.rslt)
byStartPointDirectionLength = Line.ByStartPointDirectionLength(startPoint=getLocation_2, direction=normalAtParameter@L2, lacing=Longest)
byStartPointDirectionLength_2 = Line.ByStartPointDirectionLength(startPoint=getLocation_2, direction=flatten_4)

condição_if_de_lista_5 = CodeBlock(test=gt, verd=flatten_13, fals=code_block_9)  # same code as condição_if_de_lista

# group (continued): Rotacionar
passthrough = Custom[Passthrough](passThrough=condição_if_de_lista_5.rslt, waitFor=getLocation_2)  # package Clockwork for Dynamo 2.x; Forces a sequential order of execution. The node wired into the output of the Passthrough node will be executed *after* the node wired into the waitFor input (e.g. important for some Revit operations). The value of the passThrough input will be passed on to the node wired into the output port of the Passthrough node.
rotate_fitting = Custom[Rotate Fitting](fitting=passthrough, ConnectedElement=flatten_14, Angle=flatten_17, lacing=Longest)  # package Genius Loci; Rotates a fitting, at specified degree, around the axis of the primary MEP system element (pipe, duct, cable tray, conduit...). By MEPover on forum.dynamobim.com

# group: conectar desconectados
# Descrição <Clique duas vezes aqui para editar a descrição do grupo>
end_3 = Revit.Transaction.Transaction.End(input=rotate_fitting)
start_3 = Revit.Transaction.Transaction.Start(input=end_3)
passthrough_2 = Custom[Passthrough](passThrough=rotate_fitting, waitFor=start_3)
connectors_2 = Custom[👓 Connectors+](element=passthrough_2)
isConnected = MEP.Connectors.IsConnected(connector=connectors_2.Connectors)
filterByBoolMask_7 = List.FilterByBoolMask(list=connectors_2.Connectors, mask=isConnected)
flatten_18 = List.Flatten(list=filterByBoolMask_7.out)
passthrough_3 = Custom[Passthrough](passThrough=condição_if_de_lista_2.rslt, waitFor=start_3)
flatten_19 = List.Flatten(list=passthrough_3)
connectors_3 = Custom[👓 Connectors+](element=flatten_19)
isConnected_2 = MEP.Connectors.IsConnected(connector=connectors_3.Connectors)
filterByBoolMask_8 = List.FilterByBoolMask(list=connectors_3.Connectors, mask=isConnected_2)
flatten_20 = List.Flatten(list=filterByBoolMask_8.out)
location_2 = Custom[Connector.Location](connector=flatten_20)  # package MEPover; Returns the location of a connector
getConnectorClosestTo = MEP.Connectors.GetConnectorClosestTo(connectors=flatten_18, point=location_2, lacing=Shortest)
location_3 = Custom[Connector.Location](connector=flatten_18)
getConnectorClosestTo_2 = MEP.Connectors.GetConnectorClosestTo(connectors=flatten_20, point=location_3)
connectTo = Custom[Connector.ConnectTo](connector=getConnectorClosestTo, Connector2=getConnectorClosestTo_2)  # package MEPover; Connects a connector to another connector. Returns True if connection succeeded

end_4 = Revit.Transaction.Transaction.End(input=connectTo)
start_4 = Revit.Transaction.Transaction.Start(input=end_4)
passthrough_4 = Custom[Passthrough](passThrough=code_block_4, waitFor=start_4)

# group: Conectar
# Descrição <Clique duas vezes aqui para editar a descrição do grupo>
flatten_21 = List.Flatten(list=passthrough_4)
connectors_4 = Custom[👓 Connectors+](element=flatten_21)
isConnected_3 = MEP.Connectors.IsConnected(connector=connectors_4.Connectors)
filterByBoolMask_9 = List.FilterByBoolMask(list=connectors_4.Connectors, mask=isConnected_3)
flatten_22 = List.Flatten(list=filterByBoolMask_9.out)
location_4 = Custom[Connector.Location](connector=flatten_22)
Z = Point.Z(point=location_4)
sortByKey = List.SortByKey(list=flatten_22, keys=Z)
firstItem_3 = List.FirstItem(list=sortByKey.sortedList)
lastItem_2 = List.LastItem(list=sortByKey.sortedList)
list_create_4 = List.Create(item0=firstItem_3, item1=lastItem_2)
flatten_23 = List.Flatten(list=list_create_4)
passthrough_5 = Custom[Passthrough](passThrough=uniqueItems, waitFor=start_4)
connectors_5 = Custom[👓 Connectors+](element=passthrough_5)
isConnected_4 = MEP.Connectors.IsConnected(connector=connectors_5.Connectors)
filterByBoolMask_10 = List.FilterByBoolMask(list=connectors_5.Points, mask=isConnected_4)
flatten_24 = List.Flatten(list=filterByBoolMask_10.out)
filterByBoolMask_11 = List.FilterByBoolMask(list=connectors_5.Connectors, mask=isConnected_4)
flatten_25 = List.Flatten(list=filterByBoolMask_11.out)
location_5 = Custom[Connector.Location](connector=flatten_23)

# group: Conectar > Eletroduto
# Descrição <Clique duas vezes aqui para editar a descrição do grupo>
getConnectorClosestTo_3 = MEP.Connectors.GetConnectorClosestTo(connectors=flatten_23, point=flatten_24, lacing=Shortest)

# group: Conectar > Conexão
# Descrição <Clique duas vezes aqui para editar a descrição do grupo>
getConnectorClosestTo_4 = MEP.Connectors.GetConnectorClosestTo(connectors=flatten_25, point=location_5)

# group (continued): Conectar
connectTo_2 = Custom[Connector.ConnectTo](connector=getConnectorClosestTo_3, Connector2=getConnectorClosestTo_4)

end_5 = Revit.Transaction.Transaction.End(input=connectTo_2)
start_5 = Revit.Transaction.Transaction.Start(input=end_5)
passthrough_6 = Custom[Passthrough](passThrough=byMEPCurves, waitFor=start_5)
end_6 = Revit.Transaction.Transaction.End(input=passthrough_6)
start_6 = Revit.Transaction.Transaction.Start(input=end_6)
flatten_26 = List.Flatten(list=start_6)
isNull = Object.IsNull(object=flatten_26)
firstItem_4 = List.FirstItem(list=isNull)
empty = List.Empty()
condição_if_de_lista_6 = CodeBlock(test=firstItem_4, verd=empty, fals=flatten_26)  # same code as condição_if_de_lista

# group: Mensagem final
count = List.Count(list=condição_if_de_lista_6.rslt)
code_block_17 = CodeBlock { 0; }
gt_2 = count > code_block_17
code_block_18 = CodeBlock(N=count) { ["Feito! Você inseriu "+N+" emendas em seu projeto!"]; }
code_block_19 = CodeBlock { ["Nenhum emenda foi inserida"]; }
if_3 = RefactoredIf(test=gt_2, true=code_block_18, false=code_block_19)
condição_if_de_lista_7 = CodeBlock(test=gt_2, verd=code_block_18, fals=code_block_19)
# ---------- condição_if_de_lista_7.designscript (2 lines) ----------
//Condições IF
test == true ? verd : fals;
# ----------------------------------------
flatten_27 = List.Flatten(list=condição_if_de_lista_7)
fromList = Python(IN[0]=flatten_27)  # "String.FromList"; IronPython2
# ---------- fromList.python (22 lines) ----------
# Carregar as bibliotecas DesignScript e padrão do Python
import sys
import clr
clr.AddReference('ProtoGeometry')
from Autodesk.DesignScript.Geometry import *

# Função para concatenar os valores de uma lista em uma única string com múltiplas linhas
def concatenate_list_to_string(input_list, delimiter="\n"):
    # Verifica se a entrada é uma lista
    if not isinstance(input_list, list):
        return "A entrada deve ser uma lista."
    
    # Converte todos os elementos para string e junta com o delimitador especificado
    result = delimiter.join(str(item) for item in input_list)
    return result

# Entrada pelo nó do Dynamo
lista = IN[0]  # Lista de valores a serem concatenados
delimitador = IN[1] if len(IN) > 1 else "\n"  # Delimitador opcional, padrão é nova linha

# Saída para o Dynamo
OUT = concatenate_list_to_string(lista, delimitador)
# ----------------------------------------
python_script_2 = Python(IN[0]=fromList)  # IronPython2
# ---------- python_script_2.python (21 lines) ----------
# Importar as bibliotecas necessárias do Revit
import clr
clr.AddReference("RevitServices")
from RevitServices.Persistence import DocumentManager

clr.AddReference("RevitAPI")
clr.AddReference("RevitAPIUI")
from Autodesk.Revit.UI import TaskDialog

# Pegar a entrada do Dynamo
mensagem = IN[0]

# Criar a TaskDialog
task_dialog = TaskDialog("Ok")
task_dialog.MainInstruction = mensagem

# Exibir a TaskDialog
task_dialog.Show()

# Saída do script
OUT = "Sucesso!"
# ----------------------------------------

geometry = Element.Geometry(element=dropItems)
boundingBox = Element.BoundingBox(element=uniqueItems)
