# Dynamo graph ok 2021_06-5_BIMACON_Inserir Emendas em Eletrodutos Seleção_R01_script.dyn (Dynamo 3.2.1.5366)
# packages: Clockwork for Dynamo 2.x 2.4.0, MEPover 2022.10.30, Data-Shapes 2025.3.118, bimorphNodes 4.2.4, DynaMEP 2.0.1, BIMCoder Nodes - 2.X 2025.1.0, archi-lab.net 2023.213.1722, Rhythm 2023.4.2021, Genius Loci 2023.2.21

# group: Janela de Imputs
string = StringInput("Inserir emendas em eletrodutos/eletrocalhas por seleção")
file_path = Filename("C:\Users\jneng\Documents\logo.png")
file_from_path = FileObject(path=file_path)
readFromFile = Image.ReadFromFile(file=file_from_path)
string_2 = StringInput("Executar")
string_3 = StringInput("Número de Emendas")
string_4 = StringInput("1")
boolean = BoolSelector(true)
textbox_data = Custom[TextBox Data](InputName=string_3, DefaultText=string_4, IsNumberEntry=boolean)  # package Data-Shapes; Create Data for TextBox input in UI.MultipleInputForm ++ . Check out www.data-shapes.net for more informations
boolean_2 = BoolSelector(true)
string_5 = StringInput("http://bimacon.wix.com/bimacon")
string_6 = StringInput("Cancelar")
number = DoubleInput(480)
number_2 = DoubleInput(180)
multipleinputform = Custom[MultipleInputForm ++](Description_optional=string, Logo_optional=readFromFile, ButtonText_optional=string_2, Inputs=textbox_data, Toggle=boolean_2, LinkToHelp_optional=string_5, CancelButtonText_optional=string_6, Width_optional=number, LabelWidth_optional=number_2)  # package Data-Shapes; Create a form with multiple inputs. see www.data-shapes.net for tutorials and infos!

# group: Filter
# Descrição <Clique duas vezes aqui para editar a descrição do grupo>
code_block = CodeBlock(IN=multipleinputform.User_Inputs) { texto1 = IN[0]; }
watch = Watch(code_block)

end = Revit.Transaction.Transaction.End(input=multipleinputform.Was_Cancelled)
start = Revit.Transaction.Transaction.Start(input=end)
passThrough = Custom[PassThrough](passThrough=start, waitFor=end)  # package archi-lab.net; Ripped this off from Clockwork. Sorry Andy.

# group: Selecionar eletroduto
code_block_2 = CodeBlock { ["Pressione ESC para finalizar"]; }
code_block_3 = CodeBlock { ["Selecione o eletroduto ou Bandeja"]; }
if_ = If(test=passThrough, true=code_block_2, false=code_block_3)
fromList = Python(IN[0]=if_)  # "String.FromList"; IronPython2
# ---------- fromList.python (22 lines) ----------
# Carregar as bibliotecas DesignScript e padrão do Python
import sys
import clr
clr.AddReference('ProtoGeometry')
from Autodesk.DesignScript.Geometry import *

# Função para concatenar os valores de uma lista em uma única string com múltiplas linhas
def concatenate_list_to_string(input_list, delimiter="\n"):
    # Verifica se a entrada é uma lista
    if not isinstance(input_list, list):
        return "A entrada deve ser uma lista."
    
    # Converte todos os elementos para string e junta com o delimitador especificado
    result = delimiter.join(str(item) for item in input_list)
    return result

# Entrada pelo nó do Dynamo
lista = IN[0]  # Lista de valores a serem concatenados
delimitador = IN[1] if len(IN) > 1 else "\n"  # Delimitador opcional, padrão é nova linha

# Saída para o Dynamo
OUT = concatenate_list_to_string(lista, delimitador)
# ----------------------------------------
window_prompt_with_text = Python(IN[0]=fromList)  # IronPython2
# ---------- window_prompt_with_text.python (32 lines) ----------
# Importando as bibliotecas necessárias da API do Revit
import clr
clr.AddReference('RevitServices')  # Referência aos serviços do Revit
from RevitServices.Persistence import DocumentManager

clr.AddReference('RevitAPI')  # Referência à API do Revit
clr.AddReference('RevitAPIUI')  # Referência à API de Interface de Usuário do Revit

from Autodesk.Revit.UI import TaskDialog, TaskDialogCommonButtons, TaskDialogResult

# Recebe o texto de instrução como entrada do nó
instrucoes = IN[0]

# Verifica se a entrada é "Cancelar"
if instrucoes.lower() == "Pressione ESC para finalizar":
    OUT = False
else:
    # Criando o TaskDialog
    dialog = TaskDialog("Aviso")
    dialog.MainInstruction = instrucoes
    dialog.CommonButtons = TaskDialogCommonButtons.Ok | TaskDialogCommonButtons.Cancel

    # Exibindo o dialog para o usuário e capturando a resposta
    resultado = dialog.Show()

    # Interpretando a resposta
    if resultado == TaskDialogResult.Ok:
        OUT = True
    elif resultado == TaskDialogResult.Cancel:
        OUT = False
    else:
        OUT = None
# ----------------------------------------
categories = Categories("OST_Conduit")
categories_2 = Categories("OST_CableTray")
list_create = List.Create(item0=categories, item1=categories_2)
flatten = List.Flatten(list=list_create)
boolean_3 = BoolSelector(true)
boolean_4 = BoolSelector(false)
ʳʰʸᵗʰᵐ_selection_pick = Rhythm.Revit.Selection.Selection.Pick(runIt=window_prompt_with_text, category=flatten, singleSelection=boolean_3, ordered=boolean_4)

flatten_2 = List.Flatten(list=ʳʰʸᵗʰᵐ_selection_pick)

# group: Copy new elements
# Descrição <Clique duas vezes aqui para editar a descrição do grupo>
number_3 = DoubleInput(1)
add = code_block + number_3
cycle = List.Cycle(list=flatten_2@L1, amount=add@L1)
byCoordinates = Vector.ByCoordinates()
# note: Clockwork
copyByVector = Custom[Element.CopyByVector](element=cycle@@L1, vector=byCoordinates)  # package Clockwork for Dynamo 2.x; Copies an element or a list of elements by a given vector.
flatten_3 = List.Flatten(list=copyByVector, lacing=Longest)

getLocation = Element.GetLocation(element=flatten_2)
length = Curve.Length(curve=getLocation)

# group: split length into sublength
# Descrição <Clique duas vezes aqui para editar a descrição do grupo>
div = length / add
div_2 = div / length
code_block_4 = CodeBlock(step=div_2) { 0..1..step; }
splitByParameter = Curve.SplitByParameter(curve=getLocation, parameters=code_block_4)

setLocation = Element.SetLocation(element=flatten_3, geometry=splitByParameter)

# group: Union fittings
# Descrição <Clique duas vezes aqui para editar a descrição do grupo>
code_block_5 = CodeBlock(waithFor=setLocation, Pass=flatten_3) { [waithFor,Pass][1]; }
code_block_6 = CodeBlock { -1; }
dropItems = List.DropItems(list=code_block_5, amount=code_block_6, lacing=Longest)
restOfItems = List.RestOfItems(list=code_block_5, lacing=Longest)
byMEPCurves = Custom[MEPFitting.ByMEPCurves](MEPCurve1=dropItems, MEPCurve2=restOfItems, lacing=Longest)  # package MEPover; Creates a UnionFitting or ElbowFitting by 2 MEPCurves (Ducts, Cable Trays, Pipes or Conduits). The output may not always be all the fittings created as Revit sometimes creates extra transition fittings outside of the node transactions.

flatten_4 = List.Flatten(list=byMEPCurves)
flatten_5 = List.Flatten(list=flatten_3)
passthrough = Custom[Passthrough](passThrough=byMEPCurves, waitFor=byMEPCurves)  # package Clockwork for Dynamo 2.x; Forces a sequential order of execution. The node wired into the output of the Passthrough node will be executed *after* the node wired into the waitFor input (e.g. important for some Revit operations). The value of the passThrough input will be passed on to the node wired into the output port of the Passthrough node.
end_2 = Revit.Transaction.Transaction.End(input=passthrough)
start_2 = Revit.Transaction.Transaction.Start(input=end_2)
flatten_6 = List.Flatten(list=start_2)
isNull = Object.IsNull(object=flatten_6)
firstItem = List.FirstItem(list=isNull)
empty = List.Empty()
condição_if_de_lista = CodeBlock(test=firstItem, verd=empty, fals=flatten_6)
# ---------- condição_if_de_lista.designscript (3 lines) ----------
//Condições IF
indx = (test) ? 0 : 1;
rslt = [verd,fals][indx];
# ----------------------------------------

# group: Mensagem final
count = List.Count(list=condição_if_de_lista.rslt)
code_block_7 = CodeBlock { 0; }
gt = count > code_block_7
code_block_8 = CodeBlock(N=count) { ["Feito! Você inseriu "+N+" emendas em seu projeto! Deseja rotacionar as Emendas?"]; }
code_block_9 = CodeBlock { ["Nenhum emenda foi inserida"]; }
condição_if_de_lista_2 = CodeBlock(test=gt, verd=code_block_8, fals=code_block_9)
# ---------- condição_if_de_lista_2.designscript (2 lines) ----------
//Condições IF
test == true ? verd : fals;
# ----------------------------------------
flatten_7 = List.Flatten(list=condição_if_de_lista_2)
fromList_2 = Python(IN[0]=flatten_7)  # "String.FromList"; IronPython2; same code as fromList
python_script = Python(IN[0]=fromList_2)  # IronPython2
# ---------- python_script.python (30 lines) ----------
# Importando as bibliotecas necessárias da API do Revit
import clr
clr.AddReference('RevitServices')  # Referência aos serviços do Revit
from RevitServices.Persistence import DocumentManager

clr.AddReference('RevitAPI')  # Referência à API do Revit
clr.AddReference('RevitAPIUI')  # Referência à API de Interface de Usuário do Revit

from Autodesk.Revit.UI import TaskDialog, TaskDialogCommonButtons, TaskDialogResult

# Recebe o texto de instrução como entrada do nó
instrucoes = IN[0]

# Criando o TaskDialog
dialog = TaskDialog("Aviso")
dialog.MainInstruction = instrucoes
dialog.CommonButtons = TaskDialogCommonButtons.Yes | TaskDialogCommonButtons.No | TaskDialogCommonButtons.Close

# Exibindo o dialog para o usuário e capturando a resposta
resultado = dialog.Show()

# Interpretando a resposta
if resultado == TaskDialogResult.No:
    OUT = "Não"
elif resultado == TaskDialogResult.Yes:
    OUT = "Sim"
elif resultado == TaskDialogResult.Cancel:
    OUT = "Fechar"
else:
    OUT = "Nenhuma ação"
# ----------------------------------------
if_2 = RefactoredIf(test=gt, true=code_block_8, false=code_block_9)

# group: Inverter lado
code_block_10 = CodeBlock { true; false; }
code_block_11 = CodeBlock(x=python_script, y=code_block_10.out0, z=code_block_10.out1)
# ---------- code_block_11.designscript (5 lines) ----------
//Condições IF, OR, AND
x;
y;
z;
x == "Sim" ? y : z;
# ----------------------------------------
passThrough_2 = Custom[PassThrough](passThrough=code_block_11.out3, waitFor=python_script)
watch_2 = Watch(code_block_11.out3)

end_3 = Revit.Transaction.Transaction.End(input=passThrough_2)
start_3 = Revit.Transaction.Transaction.Start(input=end_3)
code_block_12 = CodeBlock { 0; 90; }
condição_if_de_lista_3 = CodeBlock(test=start_3, verd=code_block_12.out1, fals=code_block_12.out0)  # same code as condição_if_de_lista
rotate_fitting = Custom[Rotate Fitting](fitting=flatten_4, ConnectedElement=flatten_5, Angle=condição_if_de_lista_3.rslt@L1, lacing=Longest)  # package Genius Loci; Rotates a fitting, at specified degree, around the axis of the primary MEP system element (pipe, duct, cable tray, conduit...). By MEPover on forum.dynamobim.com
flatten_8 = List.Flatten(list=rotate_fitting)
end_4 = Revit.Transaction.Transaction.End(input=rotate_fitting)
start_4 = Revit.Transaction.Transaction.Start(input=end_4)
passThrough_3 = Custom[PassThrough](passThrough=start_4, waitFor=rotate_fitting)

# group: Mensagem final
count_2 = List.Count(list=passThrough_3)
code_block_13 = CodeBlock { 0; }
gt_2 = count_2 > code_block_13
code_block_14 = CodeBlock { ["Deseja Inverter as Emendas?"]; }
code_block_15 = CodeBlock { ["Nenhum emenda foi Invertida"]; }
condição_if_de_lista_4 = CodeBlock(test=gt_2, verd=code_block_14, fals=code_block_15)  # same code as condição_if_de_lista_2
flatten_9 = List.Flatten(list=condição_if_de_lista_4)
fromList_3 = Python(IN[0]=flatten_9)  # "String.FromList"; IronPython2; same code as fromList
python_script_2 = Python(IN[0]=fromList_3)  # IronPython2; same code as python_script
if_3 = RefactoredIf(test=gt_2, true=code_block_14, false=code_block_15)

code_block_16 = CodeBlock { true; false; }
code_block_17 = CodeBlock(x=python_script_2, y=code_block_16.out0, z=code_block_16.out1)  # same code as code_block_11
end_5 = Revit.Transaction.Transaction.End(input=code_block_17.out3)
start_5 = Revit.Transaction.Transaction.Start(input=end_5)
code_block_18 = CodeBlock { []; 180; }
condição_if_de_lista_5 = CodeBlock(test=start_5, verd=code_block_18.out1, fals=code_block_18.out0)  # same code as condição_if_de_lista
rotate_fitting_2 = Custom[Rotate Fitting](fitting=flatten_8, ConnectedElement=flatten_5, Angle=condição_if_de_lista_5.rslt, lacing=Longest)
end_6 = Revit.Transaction.Transaction.End(input=rotate_fitting_2)
start_6 = Revit.Transaction.Transaction.Start(input=end_6)
passthrough_2 = Custom[Passthrough](passThrough=code_block_5, waitFor=start_6)
flatten_10 = List.Flatten(list=passthrough_2)
connectors = Custom[👓 Connectors+](element=flatten_10)  # package BIMCoder Nodes - 2.X; Obtém as propriedades mais relevantes dos conectores de elementos
isConnected = MEP.Connectors.IsConnected(connector=connectors.Connectors)
filterByBoolMask = List.FilterByBoolMask(list=connectors.Connectors, mask=isConnected)
flatten_11 = List.Flatten(list=filterByBoolMask.out)
location = Custom[Connector.Location](connector=flatten_11)  # package MEPover; Returns the location of a connector
Z = Point.Z(point=location)
sortByKey = List.SortByKey(list=flatten_11, keys=Z)
firstItem_2 = List.FirstItem(list=sortByKey.sortedList)
lastItem = List.LastItem(list=sortByKey.sortedList)
list_create_2 = List.Create(item0=firstItem_2, item1=lastItem)
flatten_12 = List.Flatten(list=list_create_2)

# group: Bandeja/Eletroduto
connectors_2 = Custom[👓 Connectors+](element=flatten_2)

# group: Todas conexões a emendar
categories_3 = Categories("OST_CableTrayFitting")
all_elements_of_category = ElementsOfCategory(Category=categories_3)
name = Element.Name(element=all_elements_of_category)
code_block_19 = CodeBlock { ["Saida_","Porca","Arruela","Parafuso"]; }
watch_3 = Watch(code_block_19)
contains = Custom[Contains](stringList=name, filterList=watch_3)  # package archi-lab.net; This node takes a list of strings and checks if any string contains a matching string from filter input.
filterByBoolMask_2 = List.FilterByBoolMask(list=all_elements_of_category, mask=contains, lacing=Longest)
flatten_13 = List.Flatten(list=filterByBoolMask_2.out)
categories_4 = Categories("OST_ConduitFitting")
all_elements_of_category_2 = ElementsOfCategory(Category=categories_4)
name_2 = Element.Name(element=all_elements_of_category_2)
code_block_20 = CodeBlock { ["Arruela","Cabo","Conector","Caixa de Luz","Bucha","PVC 5 entradas","Unidut","Tampa","Adaptador"]; }
contains_2 = Custom[Contains](stringList=name_2, filterList=code_block_20)
filterByBoolMask_3 = List.FilterByBoolMask(list=all_elements_of_category_2, mask=contains_2)
flatten_14 = List.Flatten(list=filterByBoolMask_3.out)
categories_5 = Categories("OST_ElectricalFixtures")
all_elements_of_category_3 = ElementsOfCategory(Category=categories_5)
name_3 = Element.Name(element=all_elements_of_category_3)
code_block_21 = CodeBlock { [".Posição Livre","Haste","Disjuntor"]; }
contains_3 = Custom[Contains](stringList=name_3, filterList=code_block_21)
filterByBoolMask_4 = List.FilterByBoolMask(list=all_elements_of_category_3, mask=contains_3)
flatten_15 = List.Flatten(list=filterByBoolMask_4.out)
list_create_3 = List.Create(item0=flatten_13, item1=flatten_14, item2=flatten_15)
flatten_16 = List.Flatten(list=list_create_3)

# group: Selecionar conexões
location_2 = MEP.Connectors.Location(connector=connectors_2.Connectors)
code_block_22 = CodeBlock { 0.11; }
byCenterPointRadius = Sphere.ByCenterPointRadius(centerPoint=location_2, radius=code_block_22)
intersectsSolid = Revit.Element.IntersectsSolid(solids=byCenterPointRadius, elements=flatten_16)
intersectingElements = Results.SolidIntersectionResult.IntersectingElements(solidIntersectionResult=intersectsSolid)
boolean_5 = BoolSelector(true)
clean = List.Clean(list=intersectingElements, preserveIndices=boolean_5)
firstItem_3 = List.FirstItem(list=clean@L2)
boolean_6 = BoolSelector(false)
clean_2 = List.Clean(list=firstItem_3, preserveIndices=boolean_6)
flatten_17 = List.Flatten(list=clean_2)
uniqueItems = List.UniqueItems(list=flatten_17)

passthrough_3 = Custom[Passthrough](passThrough=uniqueItems, waitFor=byMEPCurves)
connectors_3 = Custom[👓 Connectors+](element=passthrough_3)
isConnected_2 = MEP.Connectors.IsConnected(connector=connectors_3.Connectors)
filterByBoolMask_5 = List.FilterByBoolMask(list=connectors_3.Points, mask=isConnected_2)
flatten_18 = List.Flatten(list=filterByBoolMask_5.out)
getConnectorClosestTo = MEP.Connectors.GetConnectorClosestTo(connectors=flatten_12, point=flatten_18)
filterByBoolMask_6 = List.FilterByBoolMask(list=connectors_3.Connectors, mask=isConnected_2)
flatten_19 = List.Flatten(list=filterByBoolMask_6.out)
connectTo = Custom[Connector.ConnectTo](connector=getConnectorClosestTo, Connector2=flatten_19)  # package MEPover; Connects a connector to another connector. Returns True if connection succeeded
watch_4 = Watch(flatten_2)

# group: Delete outdated elements
# Descrição <Clique duas vezes aqui para editar a descrição do grupo>
code_block_23 = CodeBlock(waithFor=flatten_3, Pass=watch_4) { [waithFor,Pass][1]; }
# note: Archilab
delete = archilab.Revit.Elements.Elements.Delete(element=code_block_23)

restOfItems_2 = List.RestOfItems(list=flatten_5)
