# Dynamo graph ok 2021_06-5_BIMACON_Inserir Emendas em Eletrodutos Seleção_R02_script.dyn (Dynamo 3.2.1.5366)
# packages: Clockwork for Dynamo 2.x 2.4.0, MEPover 2022.10.30, Data-Shapes 2025.3.118, bimorphNodes 4.2.4, DynaMEP 2.0.1, BIMCoder Nodes - 2.X 2025.1.0, archi-lab.net 2023.213.1722, Rhythm 2023.4.2021, Genius Loci 2023.2.21

# group: Janela de Imputs
string = StringInput("Inserir emendas em eletrodutos/eletrocalhas por seleção")
file_path = Filename("C:\Users\jneng\Documents\logo.png")
file_from_path = FileObject(path=file_path)
readFromFile = Image.ReadFromFile(file=file_from_path)
string_2 = StringInput("Executar")
string_3 = StringInput("Número de Emendas")
string_4 = StringInput("3")
boolean = BoolSelector(true)
textbox_data = Custom[TextBox Data](InputName=string_3, DefaultText=string_4, IsNumberEntry=boolean)  # package Data-Shapes; Create Data for TextBox input in UI.MultipleInputForm ++ . Check out www.data-shapes.net for more informations
boolean_2 = BoolSelector(true)
string_5 = StringInput("http://bimacon.wix.com/bimacon")
string_6 = StringInput("Cancelar")
number = DoubleInput(480)
number_2 = DoubleInput(180)
multipleinputform = Custom[MultipleInputForm ++](Description_optional=string, Logo_optional=readFromFile, ButtonText_optional=string_2, Inputs=textbox_data, Toggle=boolean_2, LinkToHelp_optional=string_5, CancelButtonText_optional=string_6, Width_optional=number, LabelWidth_optional=number_2)  # package Data-Shapes; Create a form with multiple inputs. see www.data-shapes.net for tutorials and infos!

# group: Filter
# Descrição <Clique duas vezes aqui para editar a descrição do grupo>
code_block = CodeBlock(IN=multipleinputform.User_Inputs) { texto1 = IN[0]; }
watch = Watch(code_block)

end = Revit.Transaction.Transaction.End(input=multipleinputform.Was_Cancelled)
start = Revit.Transaction.Transaction.Start(input=end)
passThrough = Custom[PassThrough](passThrough=start, waitFor=end)  # package archi-lab.net; Ripped this off from Clockwork. Sorry Andy.
not_ = Not(x=passThrough)

# group: Selecionar eletroduto
categories = Categories("OST_Conduit")
categories_2 = Categories("OST_CableTray")
list_create = List.Create(item0=categories, item1=categories_2)
flatten = List.Flatten(list=list_create)
boolean_3 = BoolSelector(true)
boolean_4 = BoolSelector(true)
ʳʰʸᵗʰᵐ_selection_pick = Rhythm.Revit.Selection.Selection.Pick(runIt=not_, category=flatten, singleSelection=boolean_3, ordered=boolean_4)

flatten_2 = List.Flatten(list=ʳʰʸᵗʰᵐ_selection_pick)

# group: Copy new elements
# Descrição <Clique duas vezes aqui para editar a descrição do grupo>
number_3 = DoubleInput(1)
add = code_block + number_3
cycle = List.Cycle(list=flatten_2@L1, amount=add@L1)
byCoordinates = Vector.ByCoordinates()
# note: Clockwork
copyByVector = Custom[Element.CopyByVector](element=cycle@@L1, vector=byCoordinates)  # package Clockwork for Dynamo 2.x; Copies an element or a list of elements by a given vector.
flatten_3 = List.Flatten(list=copyByVector, lacing=Longest)

watch_2 = Watch(flatten_2)

# group: Delete outdated elements
# Descrição <Clique duas vezes aqui para editar a descrição do grupo>
code_block_2 = CodeBlock(waithFor=flatten_3, Pass=watch_2) { [waithFor,Pass][1]; }
# note: Archilab
delete = archilab.Revit.Elements.Elements.Delete(element=code_block_2)

code_block_3 = CodeBlock { ["Pressione ESC para finalizar"]; }
code_block_4 = CodeBlock { ["Selecione o eletroduto ou Bandeja"]; }  # frozen
if_ = If(true=code_block_3, false=code_block_4)  # unwired: test
fromList = Python(IN[0]=if_)  # "String.FromList"; IronPython2
# ---------- fromList.python (22 lines) ----------
# Carregar as bibliotecas DesignScript e padrão do Python
import sys
import clr
clr.AddReference('ProtoGeometry')
from Autodesk.DesignScript.Geometry import *

# Função para concatenar os valores de uma lista em uma única string com múltiplas linhas
def concatenate_list_to_string(input_list, delimiter="\n"):
    # Verifica se a entrada é uma lista
    if not isinstance(input_list, list):
        return "A entrada deve ser uma lista."
    
    # Converte todos os elementos para string e junta com o delimitador especificado
    result = delimiter.join(str(item) for item in input_list)
    return result

# Entrada pelo nó do Dynamo
lista = IN[0]  # Lista de valores a serem concatenados
delimitador = IN[1] if len(IN) > 1 else "\n"  # Delimitador opcional, padrão é nova linha

# Saída para o Dynamo
OUT = concatenate_list_to_string(lista, delimitador)
# ----------------------------------------
window_prompt_with_text = Python(IN[0]=fromList)  # IronPython2
# ---------- window_prompt_with_text.python (32 lines) ----------
# Importando as bibliotecas necessárias da API do Revit
import clr
clr.AddReference('RevitServices')  # Referência aos serviços do Revit
from RevitServices.Persistence import DocumentManager

clr.AddReference('RevitAPI')  # Referência à API do Revit
clr.AddReference('RevitAPIUI')  # Referência à API de Interface de Usuário do Revit

from Autodesk.Revit.UI import TaskDialog, TaskDialogCommonButtons, TaskDialogResult

# Recebe o texto de instrução como entrada do nó
instrucoes = IN[0]

# Verifica se a entrada é "Cancelar"
if instrucoes.lower() == "Pressione ESC para finalizar":
    OUT = False
else:
    # Criando o TaskDialog
    dialog = TaskDialog("Aviso")
    dialog.MainInstruction = instrucoes
    dialog.CommonButtons = TaskDialogCommonButtons.Ok | TaskDialogCommonButtons.Cancel

    # Exibindo o dialog para o usuário e capturando a resposta
    resultado = dialog.Show()

    # Interpretando a resposta
    if resultado == TaskDialogResult.Ok:
        OUT = True
    elif resultado == TaskDialogResult.Cancel:
        OUT = False
    else:
        OUT = None
# ----------------------------------------
getLocation = Element.GetLocation(element=flatten_2)
length = Curve.Length(curve=getLocation)

# group: split length into sublength
# Descrição <Clique duas vezes aqui para editar a descrição do grupo>
div = length / add
div_2 = div / length
code_block_5 = CodeBlock(step=div_2) { 0..1..step; }
splitByParameter = Curve.SplitByParameter(curve=getLocation, parameters=code_block_5)

setLocation = Element.SetLocation(element=flatten_3, geometry=splitByParameter)

# group: Union fittings
# Descrição <Clique duas vezes aqui para editar a descrição do grupo>
code_block_6 = CodeBlock(waithFor=setLocation, Pass=flatten_3) { [waithFor,Pass][1]; }
code_block_7 = CodeBlock { -1; }
dropItems = List.DropItems(list=code_block_6, amount=code_block_7, lacing=Longest)
restOfItems = List.RestOfItems(list=code_block_6, lacing=Longest)
byMEPCurves = Custom[MEPFitting.ByMEPCurves](MEPCurve1=dropItems, MEPCurve2=restOfItems, lacing=Longest)  # package MEPover; Creates a UnionFitting or ElbowFitting by 2 MEPCurves (Ducts, Cable Trays, Pipes or Conduits). The output may not always be all the fittings created as Revit sometimes creates extra transition fittings outside of the node transactions.

getLocation_2 = Element.GetLocation(element=byMEPCurves)

# group: Bandeja/Eletroduto
connectors = Custom[👓 Connectors+](element=flatten_2)  # package BIMCoder Nodes - 2.X; Obtém as propriedades mais relevantes dos conectores de elementos

end_2 = Revit.Transaction.Transaction.End(input=byMEPCurves)
passThrough_2 = Custom[PassThrough](passThrough=byMEPCurves, waitFor=end_2)
start_2 = Revit.Transaction.Transaction.Start(input=passThrough_2)

# group: Plano da Parede
familyinstance_references = Custom[👓 FamilyInstance․References](familyInstance=start_2, lacing=Longest)  # package BIMCoder Nodes - 2.X; Obtém todas as referências de uma família de instância
string_7 = StringInput("Parede")
contains = String.Contains(string=familyinstance_references.ReferenceName, searchFor=string_7)
filterByBoolMask = List.FilterByBoolMask(list=familyinstance_references.Plane, mask=contains)
normal = Plane.Normal(plane=filterByBoolMask.in)
flatten_4 = List.Flatten(list=normal@L3)
origin = Plane.Origin(plane=filterByBoolMask.in)

# group: Todas conexões a emendar
categories_3 = Categories("OST_CableTrayFitting")
all_elements_of_category = ElementsOfCategory(Category=categories_3)
name = Element.Name(element=all_elements_of_category)
code_block_8 = CodeBlock { ["Saida_","Porca","Arruela","Parafuso"]; }
watch_3 = Watch(code_block_8)
contains_2 = Custom[Contains](stringList=name, filterList=watch_3)  # package archi-lab.net; This node takes a list of strings and checks if any string contains a matching string from filter input.
filterByBoolMask_2 = List.FilterByBoolMask(list=all_elements_of_category, mask=contains_2, lacing=Longest)
flatten_5 = List.Flatten(list=filterByBoolMask_2.out)
categories_4 = Categories("OST_ConduitFitting")
all_elements_of_category_2 = ElementsOfCategory(Category=categories_4)
name_2 = Element.Name(element=all_elements_of_category_2)
code_block_9 = CodeBlock { ["Arruela","Cabo","Conector","Caixa de Luz","Bucha","PVC 5 entradas","Unidut","Tampa","Adaptador"]; }
contains_3 = Custom[Contains](stringList=name_2, filterList=code_block_9)
filterByBoolMask_3 = List.FilterByBoolMask(list=all_elements_of_category_2, mask=contains_3)
flatten_6 = List.Flatten(list=filterByBoolMask_3.out)
categories_5 = Categories("OST_ElectricalFixtures")
all_elements_of_category_3 = ElementsOfCategory(Category=categories_5)
name_3 = Element.Name(element=all_elements_of_category_3)
code_block_10 = CodeBlock { [".Posição Livre","Haste","Disjuntor","x."]; }
contains_4 = Custom[Contains](stringList=name_3, filterList=code_block_10)
filterByBoolMask_4 = List.FilterByBoolMask(list=all_elements_of_category_3, mask=contains_4)
flatten_7 = List.Flatten(list=filterByBoolMask_4.out)
categories_6 = Categories("OST_LightingDevices")
all_elements_of_category_4 = ElementsOfCategory(Category=categories_6)
name_4 = Element.Name(element=all_elements_of_category_4)
code_block_11 = CodeBlock { ["Armação","Cabo","Terminal","Cabos","x.","1/4","1/2","3/16","5/16","9/16","5/32","3/8","TP"]; }
contains_5 = Custom[Contains](stringList=name_4, filterList=code_block_11)
filterByBoolMask_5 = List.FilterByBoolMask(list=all_elements_of_category_4, mask=contains_5)
flatten_8 = List.Flatten(list=filterByBoolMask_5.out)
categories_7 = Categories("OST_ElectricalEquipment")
all_elements_of_category_5 = ElementsOfCategory(Category=categories_7)
list_create_2 = List.Create(item0=flatten_5, item1=flatten_6, item2=flatten_7, item3=flatten_8, item4=all_elements_of_category_5)
flatten_9 = List.Flatten(list=list_create_2)
name_5 = Element.Name(element=all_elements_of_category_5)

# group: Selecionar conexões
location = MEP.Connectors.Location(connector=connectors.Connectors)
code_block_12 = CodeBlock { 0.11; }
byCenterPointRadius = Sphere.ByCenterPointRadius(centerPoint=location, radius=code_block_12)
intersectsSolid = Revit.Element.IntersectsSolid(solids=byCenterPointRadius, elements=flatten_9)
intersectingElements = Results.SolidIntersectionResult.IntersectingElements(solidIntersectionResult=intersectsSolid)
boolean_5 = BoolSelector(true)
clean = List.Clean(list=intersectingElements, preserveIndices=boolean_5)
firstItem = List.FirstItem(list=clean@L2)
boolean_6 = BoolSelector(false)
clean_2 = List.Clean(list=firstItem, preserveIndices=boolean_6)
flatten_10 = List.Flatten(list=clean_2)
uniqueItems = List.UniqueItems(list=flatten_10)

# group: Base
# Descrição <Clique duas vezes aqui para editar a descrição do grupo>
categories_8 = Categories("OST_Walls")
categories_9 = Categories("OST_BridgePiers")
categories_10 = Categories("OST_StructuralColumns")
categories_11 = Categories("OST_StructuralFraming")
list_create_3 = List.Create(item0=categories_8, item1=categories_9, item2=categories_10, item3=categories_11)
all_elements_of_category_6 = ElementsOfCategory(Category=list_create_3)
flatten_11 = List.Flatten(list=all_elements_of_category_6)
intersectsSolid_2 = Revit.Element.IntersectsSolid(solids=byCenterPointRadius, elements=flatten_11)
intersectingElements_2 = Results.SolidIntersectionResult.IntersectingElements(solidIntersectionResult=intersectsSolid_2)
flatten_12 = List.Flatten(list=intersectingElements_2)
uniqueItems_2 = List.UniqueItems(list=flatten_12)
faces = Element.Faces(element=uniqueItems_2)
solids = Element.Solids(element=uniqueItems_2)

# group: Rotacionar
# Descrição <Clique duas vezes aqui para editar a descrição do grupo>
flatten_13 = List.Flatten(list=byMEPCurves)
passthrough = Custom[Passthrough](passThrough=flatten_13, waitFor=getLocation_2)  # package Clockwork for Dynamo 2.x; Forces a sequential order of execution. The node wired into the output of the Passthrough node will be executed *after* the node wired into the waitFor input (e.g. important for some Revit operations). The value of the passThrough input will be passed on to the node wired into the output port of the Passthrough node.
flatten_14 = List.Flatten(list=dropItems)
firstItem_2 = List.FirstItem(list=byCenterPointRadius@L2)
doesIntersect = Geometry.DoesIntersect(geometry=firstItem_2, other=faces@L1, lacing=Longest)
filterByBoolMask_6 = List.FilterByBoolMask(list=faces@L2, mask=doesIntersect@L2)
normalAtParameter = Surface.NormalAtParameter(surface=filterByBoolMask_6.in)
isParallel = Vector.IsParallel(vector=normalAtParameter@L2, otherVector=flatten_4@L2, lacing=Longest)
YAxis = Vector.YAxis()
ZAxis = Vector.ZAxis()
angleAboutAxis = Vector.AngleAboutAxis(vector=normalAtParameter, otherVector=YAxis, rotationAxis=ZAxis)
round = Math.Round(number=angleAboutAxis)
flatten_15 = List.Flatten(list=round)
YAxis_2 = Vector.YAxis()
ZAxis_2 = Vector.ZAxis()
angleAboutAxis_2 = Vector.AngleAboutAxis(vector=flatten_4, otherVector=YAxis_2, rotationAxis=ZAxis_2)
flatten_16 = List.Flatten(list=angleAboutAxis_2)
round_2 = Math.Round(number=flatten_16)
eq = Equals(x=flatten_15, y=round_2)
code_block_13 = CodeBlock { 180; 0; }
condição_if_de_lista = CodeBlock(test1=eq, Verd=code_block_13.out0, Fals=code_block_13.out1)
# ---------- condição_if_de_lista.designscript (2 lines) ----------
//Condições IF
test1 == true ? Verd : Fals;
# ----------------------------------------
sub = round_2 - flatten_15
condição_if_de_lista_2 = CodeBlock(test=isParallel, verd=condição_if_de_lista, fals=sub)
# ---------- condição_if_de_lista_2.designscript (3 lines) ----------
//Condições IF
indx = (test) ? 0 : 1;
rslt = [verd,fals][indx];
# ----------------------------------------
flatten_17 = List.Flatten(list=condição_if_de_lista_2.rslt)
rotate_fitting = Custom[Rotate Fitting](fitting=passthrough, ConnectedElement=flatten_14, Angle=flatten_17, lacing=Longest)  # package Genius Loci; Rotates a fitting, at specified degree, around the axis of the primary MEP system element (pipe, duct, cable tray, conduit...). By MEPover on forum.dynamobim.com
byStartPointDirectionLength = Line.ByStartPointDirectionLength(startPoint=getLocation_2, direction=normalAtParameter@L2, lacing=Longest)
byStartPointDirectionLength_2 = Line.ByStartPointDirectionLength(startPoint=getLocation_2, direction=flatten_4)

# group: conectar desconectados
# Descrição <Clique duas vezes aqui para editar a descrição do grupo>
end_3 = Revit.Transaction.Transaction.End(input=rotate_fitting)
start_3 = Revit.Transaction.Transaction.Start(input=end_3)
passthrough_2 = Custom[Passthrough](passThrough=rotate_fitting, waitFor=start_3)
connectors_2 = Custom[👓 Connectors+](element=passthrough_2)
isConnected = MEP.Connectors.IsConnected(connector=connectors_2.Connectors)
filterByBoolMask_7 = List.FilterByBoolMask(list=connectors_2.Connectors, mask=isConnected)
flatten_18 = List.Flatten(list=filterByBoolMask_7.out)
passthrough_3 = Custom[Passthrough](passThrough=code_block_6, waitFor=start_3)
flatten_19 = List.Flatten(list=passthrough_3)
connectors_3 = Custom[👓 Connectors+](element=flatten_19)
isConnected_2 = MEP.Connectors.IsConnected(connector=connectors_3.Connectors)
filterByBoolMask_8 = List.FilterByBoolMask(list=connectors_3.Connectors, mask=isConnected_2)
flatten_20 = List.Flatten(list=filterByBoolMask_8.out)
location_2 = Custom[Connector.Location](connector=flatten_20)  # package MEPover; Returns the location of a connector
getConnectorClosestTo = MEP.Connectors.GetConnectorClosestTo(connectors=flatten_18, point=location_2, lacing=Shortest)
location_3 = Custom[Connector.Location](connector=flatten_18)
getConnectorClosestTo_2 = MEP.Connectors.GetConnectorClosestTo(connectors=flatten_20, point=location_3)
connectTo = Custom[Connector.ConnectTo](connector=getConnectorClosestTo, Connector2=getConnectorClosestTo_2)  # package MEPover; Connects a connector to another connector. Returns True if connection succeeded

end_4 = Revit.Transaction.Transaction.End(input=connectTo)
start_4 = Revit.Transaction.Transaction.Start(input=end_4)
passthrough_4 = Custom[Passthrough](passThrough=code_block_6, waitFor=start_4)

# group: Conectar
# Descrição <Clique duas vezes aqui para editar a descrição do grupo>
flatten_21 = List.Flatten(list=passthrough_4)
connectors_4 = Custom[👓 Connectors+](element=flatten_21)
isConnected_3 = MEP.Connectors.IsConnected(connector=connectors_4.Connectors)
filterByBoolMask_9 = List.FilterByBoolMask(list=connectors_4.Connectors, mask=isConnected_3)
flatten_22 = List.Flatten(list=filterByBoolMask_9.out)
location_4 = Custom[Connector.Location](connector=flatten_22)
Z = Point.Z(point=location_4)
sortByKey = List.SortByKey(list=flatten_22, keys=Z)
firstItem_3 = List.FirstItem(list=sortByKey.sortedList)
lastItem = List.LastItem(list=sortByKey.sortedList)
list_create_4 = List.Create(item0=firstItem_3, item1=lastItem)
flatten_23 = List.Flatten(list=list_create_4)
passthrough_5 = Custom[Passthrough](passThrough=uniqueItems, waitFor=start_4)
connectors_5 = Custom[👓 Connectors+](element=passthrough_5)
isConnected_4 = MEP.Connectors.IsConnected(connector=connectors_5.Connectors)
filterByBoolMask_10 = List.FilterByBoolMask(list=connectors_5.Points, mask=isConnected_4)
flatten_24 = List.Flatten(list=filterByBoolMask_10.out)
filterByBoolMask_11 = List.FilterByBoolMask(list=connectors_5.Connectors, mask=isConnected_4)
flatten_25 = List.Flatten(list=filterByBoolMask_11.out)
location_5 = Custom[Connector.Location](connector=flatten_23)

# group: Conectar > Eletroduto
# Descrição <Clique duas vezes aqui para editar a descrição do grupo>
getConnectorClosestTo_3 = MEP.Connectors.GetConnectorClosestTo(connectors=flatten_23, point=flatten_24, lacing=Shortest)

# group: Conectar > Conexão
# Descrição <Clique duas vezes aqui para editar a descrição do grupo>
getConnectorClosestTo_4 = MEP.Connectors.GetConnectorClosestTo(connectors=flatten_25, point=location_5)

# group (continued): Conectar
connectTo_2 = Custom[Connector.ConnectTo](connector=getConnectorClosestTo_3, Connector2=getConnectorClosestTo_4)

end_5 = Revit.Transaction.Transaction.End(input=connectTo_2)
start_5 = Revit.Transaction.Transaction.Start(input=end_5)
passthrough_6 = Custom[Passthrough](passThrough=byMEPCurves, waitFor=start_5)
end_6 = Revit.Transaction.Transaction.End(input=passthrough_6)
start_6 = Revit.Transaction.Transaction.Start(input=end_6)
flatten_26 = List.Flatten(list=start_6)
isNull = Object.IsNull(object=flatten_26)
firstItem_4 = List.FirstItem(list=isNull)
empty = List.Empty()
condição_if_de_lista_3 = CodeBlock(test=firstItem_4, verd=empty, fals=flatten_26)  # same code as condição_if_de_lista_2

# group: Mensagem final
count = List.Count(list=condição_if_de_lista_3.rslt)
code_block_14 = CodeBlock { 0; }
gt = count > code_block_14
code_block_15 = CodeBlock(N=count) { ["Feito! Você inseriu "+N+" emendas em seu projeto!"]; }
code_block_16 = CodeBlock { ["Nenhum emenda foi inserida"]; }
if_2 = RefactoredIf(test=gt, true=code_block_15, false=code_block_16)
condição_if_de_lista_4 = CodeBlock(test=gt, verd=code_block_15, fals=code_block_16)
# ---------- condição_if_de_lista_4.designscript (2 lines) ----------
//Condições IF
test == true ? verd : fals;
# ----------------------------------------
flatten_27 = List.Flatten(list=condição_if_de_lista_4)
fromList_2 = Python(IN[0]=flatten_27)  # "String.FromList"; IronPython2; same code as fromList
python_script = Python(IN[0]=fromList_2)  # IronPython2
# ---------- python_script.python (21 lines) ----------
# Importar as bibliotecas necessárias do Revit
import clr
clr.AddReference("RevitServices")
from RevitServices.Persistence import DocumentManager

clr.AddReference("RevitAPI")
clr.AddReference("RevitAPIUI")
from Autodesk.Revit.UI import TaskDialog

# Pegar a entrada do Dynamo
mensagem = IN[0]

# Criar a TaskDialog
task_dialog = TaskDialog("Ok")
task_dialog.MainInstruction = mensagem

# Exibir a TaskDialog
task_dialog.Show()

# Saída do script
OUT = "Sucesso!"
# ----------------------------------------

geometry = Element.Geometry(element=dropItems)
boundingBox = Element.BoundingBox(element=uniqueItems)
