# Dynamo graph 06-1_BIMACON_Inserir Luvas em eletrodutos verticais por seleção_R04_script.dyn "ok 06-1_BIMACON_Inserir Luvas em eletrodutos verticais por seleção_R04_script" (Dynamo 2.19.3.6394)
# author: Jose Nelson
# Inseri luvas em emenda entre laje e parede por seleção
# packages: Clockwork for Dynamo 1.x 1.0.2, MEPover 2022.10.30, archi-lab.net 2023.213.1722, Data-Shapes 2022.2.105, Genius Loci 2023.2.21, Data-Shapes 2025.3.118, bimorphNodes 4.2.4, DynaMEP 2.0.1, Rhythm 2023.4.2024

# group: ENTRADAS PARA O USUÁRIO
code_block = CodeBlock { "Inserção de Luva por seleção"; }
string = StringInput("LogoBimacon.png")
python_script = Python(IN[0]=string)  # IronPython2
# ---------- python_script.python (22 lines) ----------
import clr

# Adiciona referência ao ambiente .NET
clr.AddReference('System')
from System import Environment, IO

# Nome da imagem (entrada do usuário)
nome_arquivo_imagem = IN[0]

# Recupera o nome do usuário logado no Windows
usuario = Environment.UserName

# Monta o caminho completo para a pasta de imagens
caminho_base = r"C:\Users\{0}\AppData\Roaming\pyRevit\Extensions\Bimacon.extension\Bimacon.tab\Imagens_Bimacon".format(usuario)

# Junta o caminho base com o nome do arquivo
caminho_completo = IO.Path.Combine(caminho_base, nome_arquivo_imagem)

# Verifica se o arquivo existe
existe = IO.File.Exists(caminho_completo)

OUT = caminho_completo if existe else "Imagem não encontrada: {0}".format(caminho_completo)
# ----------------------------------------
file_from_path = FileObject(path=python_script)
readFromFile = Image.ReadFromFile(file=file_from_path)
string_2 = StringInput("Continuar")
string_3 = StringInput("OBS: os conduítes e a curva devem estar com o Nível de Referência correto! Ex: Se for inserir a Luva no Térreo os condúites e a luva devem estar no Térreo!")
textnote_data = Custom[TextNote Data](TextNote=string_3)  # package Data-Shapes; Create Data for TextNote input in UI.MultipleInputForm ++ . Check out www.data-shapes.net for more informations
string_4 = StringInput("Eletroduto Reforçado na Laje?")
boolean = BoolSelector(true)
string_5 = StringInput("Sim")
boolean_input = Custom[Boolean input](InputName=string_4, DefaultValue=boolean, SideText=string_5)  # package Data-Shapes; Creates a boolean input for UI.MultipleInputForm ++ . Check out www.data-shapes.net for more infos!
string_6 = StringInput("Altura da Luva")
string_7 = StringInput("2.6")
boolean_2 = BoolSelector(true)
textbox_data = Custom[TextBox Data](InputName=string_6, DefaultText=string_7, IsNumberEntry=boolean_2)  # package Data-Shapes; Create Data for TextBox input in UI.MultipleInputForm ++ . Check out www.data-shapes.net for more informations
list_create = List.Create(item0=textnote_data, item1=boolean_input, item2=textbox_data)
boolean_3 = BoolSelector(true)
string_8 = StringInput("Cancelar")
number = DoubleInput(450)
number_2 = DoubleInput(200)
multipleinputform = Custom[MultipleInputForm ++](Description_optional=code_block, Logo_optional=readFromFile, ButtonText_optional=string_2, Inputs=list_create, Toggle=boolean_3, CancelButtonText_optional=string_8, Width_optional=number, LabelWidth_optional=number_2)  # package Data-Shapes; Create a form with multiple inputs. see www.data-shapes.net for tutorials and infos!
code_block_2 = CodeBlock()  # //Data-Shapes
code_block_3 = CodeBlock()  # //archilab

end = Revit.Transaction.Transaction.End(input=multipleinputform.Was_Cancelled)
start = Revit.Transaction.Transaction.Start(input=end)
passThrough = Custom[PassThrough](passThrough=start, waitFor=end)  # package archi-lab.net; Ripped this off from Clockwork. Sorry Andy.

# group: Selecionar eletroduto
code_block_4 = CodeBlock { ["Pressione ESC para finalizar"]; }
code_block_5 = CodeBlock { ["Selecione o eletroduto"]; }
if_ = If(test=passThrough, true=code_block_4, false=code_block_5)
fromList = Python(IN[0]=if_)  # "String.FromList"; IronPython2
# ---------- fromList.python (22 lines) ----------
# Carregar as bibliotecas DesignScript e padrão do Python
import sys
import clr
clr.AddReference('ProtoGeometry')
from Autodesk.DesignScript.Geometry import *

# Função para concatenar os valores de uma lista em uma única string com múltiplas linhas
def concatenate_list_to_string(input_list, delimiter="\n"):
    # Verifica se a entrada é uma lista
    if not isinstance(input_list, list):
        return "A entrada deve ser uma lista."
    
    # Converte todos os elementos para string e junta com o delimitador especificado
    result = delimiter.join(str(item) for item in input_list)
    return result

# Entrada pelo nó do Dynamo
lista = IN[0]  # Lista de valores a serem concatenados
delimitador = IN[1] if len(IN) > 1 else "\n"  # Delimitador opcional, padrão é nova linha

# Saída para o Dynamo
OUT = concatenate_list_to_string(lista, delimitador)
# ----------------------------------------
window_prompt_with_text = Python(IN[0]=fromList)  # IronPython2
# ---------- window_prompt_with_text.python (32 lines) ----------
# Importando as bibliotecas necessárias da API do Revit
import clr
clr.AddReference('RevitServices')  # Referência aos serviços do Revit
from RevitServices.Persistence import DocumentManager

clr.AddReference('RevitAPI')  # Referência à API do Revit
clr.AddReference('RevitAPIUI')  # Referência à API de Interface de Usuário do Revit

from Autodesk.Revit.UI import TaskDialog, TaskDialogCommonButtons, TaskDialogResult

# Recebe o texto de instrução como entrada do nó
instrucoes = IN[0]

# Verifica se a entrada é "Cancelar"
if instrucoes.lower() == "Pressione ESC para finalizar":
    OUT = False
else:
    # Criando o TaskDialog
    dialog = TaskDialog("Aviso")
    dialog.MainInstruction = instrucoes
    dialog.CommonButtons = TaskDialogCommonButtons.Ok | TaskDialogCommonButtons.Cancel

    # Exibindo o dialog para o usuário e capturando a resposta
    resultado = dialog.Show()

    # Interpretando a resposta
    if resultado == TaskDialogResult.Ok:
        OUT = True
    elif resultado == TaskDialogResult.Cancel:
        OUT = False
    else:
        OUT = None
# ----------------------------------------
categories = Categories("OST_Conduit")
boolean_4 = BoolSelector(true)
boolean_5 = BoolSelector(false)
ʳʰʸᵗʰᵐ_selection_pick = Rhythm.Revit.Selection.Selection.Pick(runIt=window_prompt_with_text, category=categories, singleSelection=boolean_4, ordered=boolean_5)

mep_connector_info = Custom[MEP Connector info+](element=ʳʰʸᵗʰᵐ_selection_pick)  # package MEPover; This node will return the connectors and a lot of information about those connectors of the input elements
element_level = Custom[Element Level](element=ʳʰʸᵗʰᵐ_selection_pick)  # package Genius Loci; Gets an element's level. Based on a Clockwork's node

# group: Selecionar curvas
name = Element.Name(element=mep_connector_info.ConnectedElements)
string_9 = StringInput("Curva generica")
boolean_6 = BoolSelector(true)
contains = String.Contains(string=name, searchFor=string_9, ignoreCase=boolean_6)
filterByBoolMask = List.FilterByBoolMask(list=mep_connector_info.ConnectedElements, mask=contains)
string_10 = StringInput("Nível")
getParameterValueByName = Element.GetParameterValueByName(element=filterByBoolMask.in, parameterName=string_10)
name_2 = Level.Name(level=getParameterValueByName)
name_3 = Level.Name(level=element_level)
eq = name_2 == name_3
filterByBoolMask_2 = List.FilterByBoolMask(list=filterByBoolMask.in, mask=eq)
string_11 = StringInput("Elevação do nível")
getParameterValueByName_2 = Element.GetParameterValueByName(element=filterByBoolMask_2.in, parameterName=string_11)
boolean_7 = BoolSelector(false)

# group: Comprimento e Subcomprimento
getLocation = Element.GetLocation(element=ʳʰʸᵗʰᵐ_selection_pick, lacing=CrossProduct)
length = Curve.Length(curve=getLocation)

# group: Copia dos elementos
code_block_6 = CodeBlock { 1.5; }
div = length / code_block_6
ceiling = Math.Ceiling(number=div)
code_block_7 = CodeBlock(a=ceiling) { a>1; }
code_block_8 = CodeBlock { 2; }
code_block_9 = CodeBlock { 2; }
# note: Clockwork
if_2 = If(test=code_block_7, true=code_block_8, false=code_block_9)
cycle = List.Cycle(list=ʳʰʸᵗʰᵐ_selection_pick@L1, amount=if_2@L1, lacing=Shortest)
byCoordinates = Vector.ByCoordinates()
copyByVector = Custom[Element.CopyByVector](element=cycle@@L1, vector=byCoordinates, lacing=Longest)  # package Clockwork for Dynamo 1.x; Copies an element or a list of elements by a given vector.
flatten = List.Flatten(list=copyByVector, lacing=Longest)

# group: Separar Entradas
code_block_10 = CodeBlock { 1; }
getItemAtIndex = List.GetItemAtIndex(list=multipleinputform.User_Inputs, index=code_block_10)
code_block_11 = CodeBlock { 0; }
getItemAtIndex_2 = List.GetItemAtIndex(list=multipleinputform.User_Inputs, index=code_block_11)

categories_2 = Categories("OST_ProjectBasePoint")
all_elements_of_category = ElementsOfCategory(Category=categories_2)
code_block_12 = CodeBlock { "Elev"; }
getParameterValueByName_3 = Element.GetParameterValueByName(element=all_elements_of_category, parameterName=code_block_12, lacing=Longest)

# group: Altura para corte do eletroduto
endPoint = Curve.EndPoint(curve=getLocation)
X = Point.X(point=endPoint)
Y = Point.Y(point=endPoint)
Z = Point.Z(point=endPoint)
code_block_13 = CodeBlock(a=Z) { a>1; }
maximumItem = List.MaximumItem(list=Z)
elevation = Level.Elevation(level=element_level)
code_block_14 = CodeBlock(a=maximumItem, b=getItemAtIndex, c=elevation, d=getParameterValueByName_3) { a; b; c; d; e = d+c; f = e+b; }
if_3 = If(test=code_block_13, true=code_block_14.f, false=code_block_14.f)
byCoordinates_2 = Point.ByCoordinates(x=X, y=Y, z=if_3)
splitByPoints = Curve.SplitByPoints(curve=getLocation, points=byCoordinates_2, lacing=Shortest)
setLocation = Element.SetLocation(element=flatten, geometry=splitByPoints, lacing=Shortest)

# group: Unir conduite com conexão
code_block_15 = CodeBlock(waithFor=setLocation, Pass=flatten) { [waithFor,Pass][1]; }
code_block_16 = CodeBlock { -1; }
dropItems = List.DropItems(list=code_block_15, amount=code_block_16, lacing=Longest)
restOfItems = List.RestOfItems(list=code_block_15, lacing=Longest)
byMEPCurves = Custom[MEPFitting.ByMEPCurves](MEPCurve1=dropItems, MEPCurve2=restOfItems, lacing=Longest)  # package MEPover; Creates a UnionFitting or ElbowFitting by 2 MEPCurves (Ducts, Cable Trays, Pipes or Conduits). The output may not always be all the fittings created as Revit sometimes creates extra transition fittings outside of the node transactions.

# group: Versão Revit
code_block_17 = CodeBlock { 2021; }
version = Python()  # "Document.Version"; IronPython2; unwired: IN[0]
# ---------- version.python (13 lines) ----------
# Importa as bibliotecas necessárias do Revit
import clr
clr.AddReference('RevitServices')
from RevitServices.Persistence import DocumentManager

# Obtém o documento ativo
doc = DocumentManager.Instance.CurrentUIApplication.Application

# Obtém o número da versão do Revit
revit_version = doc.VersionNumber

# Retorna o número da versão do Revit
OUT = "A versão do Revit é: {}".format(revit_version)
# ----------------------------------------
code_block_18 = CodeBlock { " "; }
split = String.Split(string=version, separator0=code_block_18)
lastItem = List.LastItem(list=split)
toNumber = String.ToNumber(string=lastItem)

# group: Altura Eletroduto
eq_2 = code_block_17 == toNumber
n2021 = CodeBlock { "Elevação superior"; }  # "2021"
n2022_2023_2024_2025 = CodeBlock { "Elevação da parte de cima da extremidade superior"; }  # "2022 - 2023 - 2024 - 2025"
if_4 = If(test=eq_2, true=n2021, false=n2022_2023_2024_2025)

# group: Selecionar eletroduto a conectar
list_create_2 = List.Create(item0=dropItems, item1=restOfItems)
passThrough_2 = Custom[PassThrough](passThrough=list_create_2@L2, waitFor=byMEPCurves)
getParameterValueByName_4 = Element.GetParameterValueByName(element=passThrough_2, parameterName=if_4)
code_block_19 = CodeBlock { 0.12; }
sub = getParameterValueByName_2 - code_block_19
gt = getParameterValueByName_4 > sub  # lacing=Longest
boolean_8 = BoolSelector(false)
clean = List.Clean(list=gt, preserveIndices=boolean_8)
filterByBoolMask_3 = List.FilterByBoolMask(list=passThrough_2, mask=clean)

boolean_9 = BoolSelector(false)
clean_2 = List.Clean(list=filterByBoolMask_3.in, preserveIndices=boolean_9, lacing=Longest)
flatten_2 = List.Flatten(list=clean_2)
getParameterValueByName_5 = Element.GetParameterValueByName(element=flatten_2, parameterName=if_4)

# group (continued): Selecionar curvas
gt_2 = getParameterValueByName_2 > getParameterValueByName_5
filterByBoolMask_4 = List.FilterByBoolMask(list=filterByBoolMask_2.in, mask=gt_2@L2)
clean_3 = List.Clean(list=filterByBoolMask_4.in, preserveIndices=boolean_7)
watch = Watch(clean_3)

watch_2 = Watch(mep_connector_info.ConnectedElements)

# group: Deletar elemento obsoleto
# note: Archilab
code_block_20 = CodeBlock(waithFor=flatten, Pass=ʳʰʸᵗʰᵐ_selection_pick) { [waithFor,Pass][1]; }
delete = archilab.Revit.Elements.Elements.Delete(element=code_block_20)

flatten_3 = List.Flatten(list=clean_3)
code_block_21 = CodeBlock(waithFor=getParameterValueByName_5, Pass=flatten_2) { [waithFor,Pass][1]; }

# group: Tipo Eletroduto
# Descrição <Clique duas vezes aqui para editar a descrição do grupo>
element_classes = ElementTypes("ConduitType")
all_elements_of_class = ElementsOfType(element_class=element_classes)
name_4 = Element.Name(element=all_elements_of_class)
string_12 = StringInput("Laranja")
contains_2 = String.Contains(string=name_4, searchFor=string_12)
filterByBoolMask_5 = List.FilterByBoolMask(list=all_elements_of_class, mask=contains_2)
flatten_4 = List.Flatten(list=filterByBoolMask_5.in)
string_13 = StringInput("Amarelo")
contains_3 = String.Contains(string=name_4, searchFor=string_13)
filterByBoolMask_6 = List.FilterByBoolMask(list=all_elements_of_class, mask=contains_3)
flatten_5 = List.Flatten(list=filterByBoolMask_6.in)

# group: Reforçado?
condição_if_de_lista = CodeBlock(test=getItemAtIndex_2, verd=flatten_4, fals=flatten_5)
# ---------- condição_if_de_lista.designscript (3 lines) ----------
//Condições IF
indx = (test) ? 0 : 1;
rslt = [verd,fals][indx];
# ----------------------------------------

element_changetype = Custom[Element ChangeType](element=code_block_21, elementType=condição_if_de_lista.rslt)  # package Genius Loci; Changes the type of the given instance to the specified type.
watch_3 = Watch(element_changetype.SuccessElements)

# group: Unir conduite da laje com da parede
mep_connector_info_2 = Custom[MEP Connector info+](element=flatten_3)
getParameterValueByName_6 = Element.GetParameterValueByName(element=mep_connector_info_2.ConnectedElements, parameterName=if_4)
gt_3 = getParameterValueByName_6 > getParameterValueByName_2
filterByBoolMask_7 = List.FilterByBoolMask(list=mep_connector_info_2.ConnectedElements, mask=gt_3)
watch_4 = Watch(filterByBoolMask_7.in)
byMEPCurves_2 = Custom[MEPFitting.ByMEPCurves](MEPCurve1=watch_4, MEPCurve2=watch_3, lacing=CrossProduct)
flatten_6 = List.Flatten(list=watch_4, lacing=Shortest)
solids = Element.Solids(element=flatten_6)
watch_5 = Watch(mep_connector_info_2.ConnectedElements)

boolean_10 = BoolSelector(false)
clean_4 = List.Clean(list=byMEPCurves_2, preserveIndices=boolean_10)
flatten_7 = List.Flatten(list=clean_4)

# group: Conduites desconectados
code_block_22 = CodeBlock(waithFor=flatten_7, Pass=flatten) { [waithFor,Pass][1]; }
connectors = RevitModel.Element.Connectors(elements=code_block_22)
isConnected = MEP.Connectors.IsConnected(connector=connectors)
filterByBoolMask_8 = List.FilterByBoolMask(list=connectors, mask=isConnected)
flatten_8 = List.Flatten(list=filterByBoolMask_8.out)
owner = MEP.Connectors.Owner(connector=flatten_8)
flatten_9 = List.Flatten(list=filterByBoolMask_8.in)
owner_2 = MEP.Connectors.Owner(connector=flatten_9)

solids_2 = Element.Solids(element=owner)
code_block_23 = CodeBlock(waithFor=solids_2, Pass=flatten_8) { [waithFor,Pass][1]; }

# group: Todas caixas
categories_3 = Categories("OST_ElectricalFixtures")
all_elements_of_category_2 = ElementsOfCategory(Category=categories_3)
categories_4 = Categories("OST_LightingDevices")
all_elements_of_category_3 = ElementsOfCategory(Category=categories_4)
categories_5 = Categories("OST_ElectricalEquipment")
all_elements_of_category_4 = ElementsOfCategory(Category=categories_5)
list_create_3 = List.Create(item0=all_elements_of_category_2, item1=all_elements_of_category_3, item2=all_elements_of_category_4)
flatten_10 = List.Flatten(list=list_create_3)

# group: Selecionar caixas
location = MEP.Connectors.Location(connector=code_block_23)
code_block_24 = CodeBlock { 0.05; }
byCenterPointRadius = Sphere.ByCenterPointRadius(centerPoint=location, radius=code_block_24)
intersectsSolid = Revit.Element.IntersectsSolid(solids=byCenterPointRadius, elements=flatten_10)
intersectingElements = Results.SolidIntersectionResult.IntersectingElements(solidIntersectionResult=intersectsSolid)
boolean_11 = BoolSelector(true)
clean_5 = List.Clean(list=intersectingElements, preserveIndices=boolean_11)
firstItem = List.FirstItem(list=clean_5@L2)
boolean_12 = BoolSelector(false)
clean_6 = List.Clean(list=firstItem, preserveIndices=boolean_12)
flatten_11 = List.Flatten(list=clean_6)
uniqueItems = List.UniqueItems(list=flatten_11)
solids_3 = Element.Solids(element=uniqueItems)

code_block_25 = CodeBlock(waithFor=uniqueItems, Pass=owner) { [waithFor,Pass][1]; }

# group: Conectar eletrodutos e caixas
list_create_4 = List.Create(item0=code_block_25, item1=uniqueItems)
flatten_12 = List.Flatten(list=list_create_4)
python_script_2 = Python(IN[0]=flatten_12)  # IronPython2
# ---------- python_script_2.python (73 lines) ----------
import clr

clr.AddReference("RevitServices")
import RevitServices
from RevitServices.Persistence import DocumentManager
from RevitServices.Transactions import TransactionManager
doc = DocumentManager.Instance.CurrentDBDocument

clr.AddReference("RevitAPI")
from Autodesk.Revit.DB import *

clr.AddReference("RevitNodes")
import Revit
clr.ImportExtensions(Revit.Elements)
clr.ImportExtensions(Revit.GeometryConversion)

def ConnectTo(connector, conn2):
    try:
        TransactionManager.Instance.EnsureInTransaction(doc)
        connector.ConnectTo(conn2)
        TransactionManager.Instance.TransactionTaskDone()
        return 1  # Retorna 1 para indicar uma conexão feita
    except:
        return 0  # Retorna 0 para indicar uma conexão não feita

conduits = UnwrapElement(IN[0])
margin = 0.01

connectors = {}
connlist = []
connections = 0  # Variável para armazenar o número de conexões feitas

for conduit in conduits:
    if conduit is None:
        continue

    try:
        conns = conduit.ConnectorManager.Connectors
    except AttributeError:
        try:
            conns = conduit.MEPModel.ConnectorManager.Connectors
        except AttributeError:
            continue

    for conn in conns:
        if conn.IsConnected:
            continue
        connectors[conn] = None
        connlist.append(conn)

for k in connectors.keys():
    mindist = 1000000
    closest = None
    for conn in connlist:
        if conn.Owner.Id.Equals(k.Owner.Id):
            continue
        dist = k.Origin.DistanceTo(conn.Origin)
        if dist < mindist:
            mindist = dist
            closest = conn
    if mindist > margin:
        continue
    connectors[k] = closest
    connlist.remove(closest)
    try:
        del connectors[closest]
    except:
        pass

for k, v in connectors.items():
    connections += ConnectTo(k, v)  # Incrementa a variável connections com o resultado da função ConnectTo

OUT = connections  # Saída com o número total de conexões feitas
# ----------------------------------------

flatten_13 = List.Flatten(list=flatten_8)

# group: Deletar elemento obsoleto
# note: Archilab
code_block_26 = CodeBlock(waithFor=element_changetype.SuccessElements, Pass=flatten_3) { [waithFor,Pass][1]; }
delete_2 = archilab.Revit.Elements.Elements.Delete(element=code_block_26)

code_block_27 = CodeBlock(waithFor=delete_2, Pass=uniqueItems) { [waithFor,Pass][1]; }

# group: Selecionar caixa e pegar conector
connectors_2 = Custom[Element.Connectors](element=code_block_27)  # package MEPover; Returns every connector on an element (also return connectors of a System)
connectorSystemType = Custom[Connector.ConnectorSystemType](connector=connectors_2)  # package MEPover; Returns the Connector System Type of the connector
isNull = Object.IsNull(object=connectorSystemType, lacing=Longest)
filterByBoolMask_9 = List.FilterByBoolMask(list=connectors_2, mask=isNull)

location_2 = Custom[Connector.Location](connector=flatten_8)  # package MEPover; Returns the location of a connector
location_3 = Custom[Connector.Location](connector=filterByBoolMask_9.in)
flatten_14 = List.Flatten(list=location_3)

# group: Pegar conectores na mesma posição e conectar eletroduto a caixa
isAlmostEqualTo = Geometry.IsAlmostEqualTo(geometry=location_2, other=flatten_14, lacing=CrossProduct)
filterByBoolMask_10 = List.FilterByBoolMask(list=filterByBoolMask_9.in@L2, mask=isAlmostEqualTo, lacing=Longest)

flatten_15 = List.Flatten(list=filterByBoolMask_10.in)
connectTo = Custom[Connector.ConnectTo](connector=flatten_13, Connector2=flatten_15, lacing=Longest)  # package MEPover; Connects a connector to another connector. Returns True if connection succeeded
flatten_16 = List.Flatten(list=watch_3, lacing=Shortest)
