# Dynamo graph 04-3_BIMACON_Inserir Interruptor ao lado de portas-Sem Espaço_R01_script.dyn (Dynamo 2.19.3.6394)
# author: José Nelsonj
# Insere Interruptores ao lado de Portas por meio da seleção da Porta
# packages: Sparrow 2021.2.1, Data-Shapes 2022.2.105, archi-lab.net 2023.213.1722, Rhythm 2023.4.2021, Genius Loci 2023.2.21

# group: Mensagem
boolean = BoolSelector(true)
code_block = CodeBlock { ["Selecione a porta para Inserir o Interruptor"]; }
code_block_2 = CodeBlock { ["Nenhuma porta foi selecionado"]; }
if_ = If(test=boolean, true=code_block, false=code_block_2)
fromList = Python(IN[0]=if_)  # "String.FromList"; IronPython2
# ---------- fromList.python (22 lines) ----------
# Carregar as bibliotecas DesignScript e padrão do Python
import sys
import clr
clr.AddReference('ProtoGeometry')
from Autodesk.DesignScript.Geometry import *

# Função para concatenar os valores de uma lista em uma única string com múltiplas linhas
def concatenate_list_to_string(input_list, delimiter="\n"):
    # Verifica se a entrada é uma lista
    if not isinstance(input_list, list):
        return "A entrada deve ser uma lista."
    
    # Converte todos os elementos para string e junta com o delimitador especificado
    result = delimiter.join(str(item) for item in input_list)
    return result

# Entrada pelo nó do Dynamo
lista = IN[0]  # Lista de valores a serem concatenados
delimitador = IN[1] if len(IN) > 1 else "\n"  # Delimitador opcional, padrão é nova linha

# Saída para o Dynamo
OUT = concatenate_list_to_string(lista, delimitador)
# ----------------------------------------
window_prompt_with_text = Python(IN[0]=fromList)  # IronPython2
# ---------- window_prompt_with_text.python (26 lines) ----------
# Importando as bibliotecas necessárias da API do Revit
import clr
clr.AddReference('RevitServices')  # Referência aos serviços do Revit
from RevitServices.Persistence import DocumentManager

clr.AddReference('RevitAPI')  # Referência à API do Revit
clr.AddReference('RevitAPIUI')  # Referência à API de Interface de Usuário do Revit

from Autodesk.Revit.UI import TaskDialog, TaskDialogCommonButtons, TaskDialogResult

# Recebe o texto de instrução como entrada do nó
instrucoes = IN[0]

# Criando o TaskDialog
dialog = TaskDialog("Aviso")
dialog.MainInstruction = instrucoes
dialog.CommonButtons = TaskDialogCommonButtons.Ok

# Exibindo o dialog para o usuário e capturando a resposta
resultado = dialog.Show()

# Interpretando a resposta
if resultado == TaskDialogCommonButtons.Ok:
    OUT = "Ok"
else:
    OUT = "True"
# ----------------------------------------
passThrough = Custom[PassThrough](passThrough=window_prompt_with_text, waitFor=window_prompt_with_text)  # package archi-lab.net; Ripped this off from Clockwork. Sorry Andy.
categories = Categories("OST_Doors")
boolean_2 = BoolSelector(true)

ʳʰʸᵗʰᵐ_selection_pick = Rhythm.Revit.Selection.Selection.Pick(runIt=passThrough, category=categories, singleSelection=boolean_2)
elementType = Element.ElementType(element=ʳʰʸᵗʰᵐ_selection_pick)
code_block_3 = CodeBlock { "Largura"; }
getParameterValueByName = Element.GetParameterValueByName(element=elementType, parameterName=code_block_3)
dist_interruptor = DoubleInput(0.2)
getHost = FamilyInstance.GetHost(familyInstance=ʳʰʸᵗʰᵐ_selection_pick)
elementType_2 = Element.ElementType(element=getHost)
code_block_4 = CodeBlock { "Largura"; }
getParameterValueByName_2 = Element.GetParameterValueByName(element=elementType_2, parameterName=code_block_4)
number = DoubleInput(2)
div = getParameterValueByName_2 / number

# group: Linha Ref cota
getLocation = Element.GetLocation(element=ʳʰʸᵗʰᵐ_selection_pick)
facingOrientation = FamilyInstance.FacingOrientation(familyInstance=ʳʰʸᵗʰᵐ_selection_pick)
ZAxis = Vector.ZAxis()
number_2 = DoubleInput(90)
rotate = Vector.Rotate(vector=facingOrientation, axis=ZAxis, degrees=number_2)
code_block_5 = CodeBlock(a=getParameterValueByName, b=dist_interruptor) { a/2+b; }
byStartPointDirectionLength = Line.ByStartPointDirectionLength(startPoint=getLocation, direction=rotate, length=code_block_5)
firstItem = List.FirstItem(list=byStartPointDirectionLength)
firstItem_2 = List.FirstItem(list=facingOrientation)
reverse = Vector.Reverse(vector=firstItem_2)
translate = Geometry.Translate(geometry=firstItem, direction=reverse, distance=div)

endPoint = Curve.EndPoint(curve=translate)
faces = Element.Faces(element=getHost)
doesIntersect = Geometry.DoesIntersect(geometry=faces, other=endPoint)
filterByBoolMask = List.FilterByBoolMask(list=faces, mask=doesIntersect)
normalAtPoint = Surface.NormalAtPoint(surface=filterByBoolMask.in, point=endPoint)
byStartPointDirectionLength_2 = Line.ByStartPointDirectionLength(startPoint=endPoint, direction=normalAtPoint)

# group: ENTRADAS PARA O USUÁRIO
code_block_6 = CodeBlock { "Inserção de Interruptor ao lado de porta"; }
string = StringInput("LogoBimacon.png")
python_script = Python(IN[0]=string)  # IronPython2
# ---------- python_script.python (22 lines) ----------
import clr

# Adiciona referência ao ambiente .NET
clr.AddReference('System')
from System import Environment, IO

# Nome da imagem (entrada do usuário)
nome_arquivo_imagem = IN[0]

# Recupera o nome do usuário logado no Windows
usuario = Environment.UserName

# Monta o caminho completo para a pasta de imagens
caminho_base = r"C:\Users\{0}\AppData\Roaming\pyRevit\Extensions\Bimacon.extension\Bimacon.tab\Imagens_Bimacon".format(usuario)

# Junta o caminho base com o nome do arquivo
caminho_completo = IO.Path.Combine(caminho_base, nome_arquivo_imagem)

# Verifica se o arquivo existe
existe = IO.File.Exists(caminho_completo)

OUT = caminho_completo if existe else "Imagem não encontrada: {0}".format(caminho_completo)
# ----------------------------------------
file_from_path = FileObject(path=python_script)
readFromFile = Image.ReadFromFile(file=file_from_path)
string_2 = StringInput("Confirmar")
string_3 = StringInput("Tipo de Interruptor")
categories_2 = Categories("OST_LightingDevices")
obter_famílias_de_uma_categoria = Python(IN[0]=categories_2)  # "Obter Famílias de Uma Categoria - BIMACON"; IronPython2
# ---------- obter_famílias_de_uma_categoria.python (52 lines) ----------
import clr
import System

# Revit API
clr.AddReference('RevitAPI')
from Autodesk.Revit.DB import *

# RevitServices
clr.AddReference("RevitServices")
from RevitServices.Persistence import DocumentManager
from RevitServices.Transactions import TransactionManager

# RevitNodes para manipular categorias
clr.AddReference("RevitNodes")
import Revit
clr.ImportExtensions(Revit.Elements)

# Documento atual
doc = DocumentManager.Instance.CurrentDBDocument

# Função para obter BuiltInCategory de uma entrada
def obter_builtincategory(entrada):
    if isinstance(entrada, Category):
        return System.Enum.ToObject(BuiltInCategory, entrada.Id.IntegerValue)
    elif isinstance(entrada, int):
        return System.Enum.ToObject(BuiltInCategory, entrada)
    elif isinstance(entrada, BuiltInCategory):
        return entrada
    elif hasattr(entrada, "Id"):
        return System.Enum.ToObject(BuiltInCategory, entrada.Id.IntegerValue)
    else:
        return None

# Entrada
entrada = UnwrapElement(IN[0])
bic = obter_builtincategory(entrada)

# Coletar todas as famílias no documento
todas_familias = FilteredElementCollector(doc).OfClass(Family).ToElements()

# Filtrar famílias pela categoria
familias_filtradas = []
if bic:
    for fam in todas_familias:
        try:
            if fam.FamilyCategory.Id.IntegerValue == int(bic):
                familias_filtradas.append(fam)
        except:
            continue

# Saída
OUT = familias_filtradas
# ----------------------------------------
name = Family.Name(family=obter_famílias_de_uma_categoria)
code_block_7 = CodeBlock { "Interruptor"; }
contains = String.Contains(string=name, searchFor=code_block_7)
filterByBoolMask_2 = List.FilterByBoolMask(list=obter_famílias_de_uma_categoria, mask=contains)
name_2 = Family.Name(family=filterByBoolMask_2.in)
code_block_8 = CodeBlock { "x."; }
contains_2 = String.Contains(string=name_2, searchFor=code_block_8)
filterByBoolMask_3 = List.FilterByBoolMask(list=filterByBoolMask_2.in, mask=contains_2)
types = Family.Types(family=filterByBoolMask_3.out)
flatten = List.Flatten(list=types)
family = FamilyType.Family(familyType=flatten)
name_3 = Family.Name(family=family)
sortByKey = List.SortByKey(list=flatten, keys=name_3)
code_block_9 = CodeBlock { "_"; }
split = String.Split(string=sortByKey.sortedKeys, separator0=code_block_9)
code_block_10 = CodeBlock { 1; 2; }
getItemAtIndex = List.GetItemAtIndex(list=split@L2, index=code_block_10.out0)
getItemAtIndex_2 = List.GetItemAtIndex(list=split@L2, index=code_block_10.out1)
code_block_11 = CodeBlock(x=getItemAtIndex, y=getItemAtIndex_2) { x+" "+y; }
name_4 = FamilyType.Name(familyType=sortByKey.sortedList)
code_block_12 = CodeBlock(a=code_block_11, b=name_4) { a; b; a+" : "+b; }
code_block_13 = CodeBlock { 2; }
dropdown_data = Custom[DropDown Data](InputName=string_3, Keys=code_block_12.out2, Values=sortByKey.sortedList, DefaultValueIndex=code_block_13)  # package Data-Shapes; Create data for DropDown input in UI.MultiInputForm ++ . Check out www.data-shapes.net for more infos.
string_4 = StringInput("Distância do Eixo da Porta (Aprox. Larg. da Porta - 25cm)")
string_5 = StringInput("0.55")
boolean_3 = BoolSelector(true)
textbox_data = Custom[TextBox Data](InputName=string_4, DefaultText=string_5, IsNumberEntry=boolean_3)  # package Data-Shapes; Create Data for TextBox input in UI.MultipleInputForm ++ . Check out www.data-shapes.net for more informations
string_6 = StringInput("Elevação do Ponto")
string_7 = StringInput("1.2")
boolean_4 = BoolSelector(true)
textbox_data_2 = Custom[TextBox Data](InputName=string_6, DefaultText=string_7, IsNumberEntry=boolean_4)
list_create = List.Create(item0=dropdown_data, item1=textbox_data, item2=textbox_data_2)
boolean_5 = BoolSelector(true)
string_8 = StringInput("Cancelar")
number_3 = DoubleInput(600)
number_4 = DoubleInput(205)
multipleinputform = Custom[MultipleInputForm ++](Description_optional=code_block_6, Logo_optional=readFromFile, ButtonText_optional=string_2, Inputs=list_create, Toggle=boolean_5, CancelButtonText_optional=string_8, Width_optional=number_3, LabelWidth_optional=number_4)  # package Data-Shapes; Create a form with multiple inputs. see www.data-shapes.net for tutorials and infos!
code_block_14 = CodeBlock()  # //archilab
code_block_15 = CodeBlock()  # //Data-Shapes
boolean_6 = BoolSelector(true)

# group: Separar Entradas
code_block_16 = CodeBlock { 1; }
getItemAtIndex_3 = List.GetItemAtIndex(list=multipleinputform.User_Inputs, index=code_block_16)
code_block_17 = CodeBlock { 0; }
getItemAtIndex_4 = List.GetItemAtIndex(list=multipleinputform.User_Inputs, index=code_block_17)
code_block_18 = CodeBlock { 2; }
getItemAtIndex_5 = List.GetItemAtIndex(list=multipleinputform.User_Inputs, index=code_block_18)

# group: Posição Interruptor
boolean_7 = BoolSelector(true)
reverse_2 = Curve.Reverse(curve=translate)
if_2 = If(test=boolean_7, true=translate, false=reverse_2)
length = Curve.Length(curve=if_2)
closestPointTo = Geometry.ClosestPointTo(geometry=if_2, other=getLocation)
parameterAtPoint = Curve.ParameterAtPoint(curve=if_2, point=closestPointTo)
code_block_19 = CodeBlock(offset_1=getItemAtIndex_3, lenght_1=length, pap_1=parameterAtPoint) { par_1 = offset_1/lenght_1; par_2 = pap_1+par_1; pap_1; }
number_5 = DoubleInput(1)
add = code_block_19.par_2 + number_5  # lacing=Longest
code_block_20 = CodeBlock(x=add) { x>=1; x-1; x; }
if_3 = If(test=code_block_20.out0, true=code_block_20.out1, false=code_block_20.x)
pointAtParameter = Curve.PointAtParameter(curve=if_2, param=if_3, lacing=Longest)
normalAtParameter = Curve.NormalAtParameter(curve=if_2, param=if_3, lacing=Longest)
code_block_21 = CodeBlock { 1; }
byStartPointDirectionLength_3 = Line.ByStartPointDirectionLength(startPoint=pointAtParameter, direction=normalAtParameter, length=code_block_21)
element_getLevel = Custom[element_getLevel](element=ʳʰʸᵗʰᵐ_selection_pick)  # package Sparrow; This node retrieves the host level from Revit elements.
byPointAndLevel = FamilyInstance.ByPointAndLevel(familyType=getItemAtIndex_4, point=pointAtParameter, level=element_getLevel, lacing=Longest)
string_9 = StringInput("Elevação do nível")
code_block_22 = CodeBlock { 0; }
setParameterByName = Element.SetParameterByName(element=byPointAndLevel, parameterName=string_9, value=code_block_22, lacing=Longest)
string_10 = StringInput("Elevação do Ponto")
setParameterByName_2 = Element.SetParameterByName(element=setParameterByName, parameterName=string_10, value=getItemAtIndex_5, lacing=Longest)
boolean_8 = BoolSelector(false)
reverse_3 = Vector.Reverse(vector=normalAtParameter)
if_4 = If(test=boolean_8, true=normalAtParameter, false=reverse_3)
YAxis = Vector.YAxis()
ZAxis_2 = Vector.ZAxis()
angleAboutAxis = Vector.AngleAboutAxis(vector=if_4, otherVector=YAxis, rotationAxis=ZAxis_2)
setRotation = FamilyInstance.SetRotation(familyInstance=setParameterByName_2, degree=angleAboutAxis)

# group: Mensagem final
count = List.Count(list=setRotation)
passThrough_2 = Custom[PassThrough](passThrough=count, waitFor=setRotation)
code_block_23 = CodeBlock { 0; }
gt = passThrough_2 > code_block_23
code_block_24 = CodeBlock { ["Feito! Deseja Inverter o Lado do Interruptor?"]; }
code_block_25 = CodeBlock { ["Nenhum interruptor foi inserido"]; }
if_5 = If(test=gt, true=code_block_24, false=code_block_25)
flatten_2 = List.Flatten(list=if_5)
fromList_2 = Python(IN[0]=flatten_2)  # "String.FromList"; IronPython2; same code as fromList
python_script_2 = Python(IN[0]=fromList_2)  # IronPython2
# ---------- python_script_2.python (30 lines) ----------
# Importando as bibliotecas necessárias da API do Revit
import clr
clr.AddReference('RevitServices')  # Referência aos serviços do Revit
from RevitServices.Persistence import DocumentManager

clr.AddReference('RevitAPI')  # Referência à API do Revit
clr.AddReference('RevitAPIUI')  # Referência à API de Interface de Usuário do Revit

from Autodesk.Revit.UI import TaskDialog, TaskDialogCommonButtons, TaskDialogResult

# Recebe o texto de instrução como entrada do nó
instrucoes = IN[0]

# Criando o TaskDialog
dialog = TaskDialog("Aviso")
dialog.MainInstruction = instrucoes
dialog.CommonButtons = TaskDialogCommonButtons.Yes | TaskDialogCommonButtons.No | TaskDialogCommonButtons.Close

# Exibindo o dialog para o usuário e capturando a resposta
resultado = dialog.Show()

# Interpretando a resposta
if resultado == TaskDialogResult.No:
    OUT = "Não"
elif resultado == TaskDialogResult.Yes:
    OUT = "Sim"
elif resultado == TaskDialogResult.Cancel:
    OUT = "Fechar"
else:
    OUT = "Nenhuma ação"
# ----------------------------------------

# group: Inverter lado Interruptor
code_block_26 = CodeBlock { true; false; }
code_block_27 = CodeBlock(x=python_script_2, y=code_block_26.out0, z=code_block_26.out1)
# ---------- code_block_27.designscript (5 lines) ----------
//Condições IF, OR, AND
x;
y;
z;
x == "Sim" ? z : y;
# ----------------------------------------
watch = Watch(code_block_27.out3)

passThrough_3 = Custom[PassThrough](passThrough=setParameterByName_2, waitFor=code_block_27.out3)

# group (continued): Inverter lado Interruptor
delete = Element.Delete(element=passThrough_3)
passThrough_4 = Custom[PassThrough](passThrough=code_block_27.out3, waitFor=delete)

# group: Posição Interruptor
if_6 = If(test=passThrough_4, true=translate, false=reverse_2)
length_2 = Curve.Length(curve=if_6)
closestPointTo_2 = Geometry.ClosestPointTo(geometry=if_6, other=getLocation)
parameterAtPoint_2 = Curve.ParameterAtPoint(curve=if_6, point=closestPointTo_2)
code_block_28 = CodeBlock(offset_1=getItemAtIndex_3, lenght_1=length_2, pap_1=parameterAtPoint_2) { par_1 = offset_1/lenght_1; par_2 = pap_1+par_1; pap_1; }
number_6 = DoubleInput(1)
add_2 = code_block_28.par_2 + number_6  # lacing=Longest
code_block_29 = CodeBlock(x=add_2) { x>=1; x-1; x; }
if_7 = If(test=code_block_29.out0, true=code_block_29.out1, false=code_block_29.x)
pointAtParameter_2 = Curve.PointAtParameter(curve=if_6, param=if_7, lacing=Longest)
element_level = Custom[Element Level](element=ʳʰʸᵗʰᵐ_selection_pick)  # package Genius Loci; Gets an element's level. Based on a Clockwork's node
byPointAndLevel_2 = FamilyInstance.ByPointAndLevel(familyType=getItemAtIndex_4, point=pointAtParameter_2, level=element_level, lacing=Longest)
string_11 = StringInput("Elevação do nível")
code_block_30 = CodeBlock { 0; }
setParameterByName_3 = Element.SetParameterByName(element=byPointAndLevel_2, parameterName=string_11, value=code_block_30, lacing=Longest)
string_12 = StringInput("Elevação do Ponto")
setParameterByName_4 = Element.SetParameterByName(element=setParameterByName_3, parameterName=string_12, value=getItemAtIndex_5, lacing=Longest)
normalAtParameter_2 = Curve.NormalAtParameter(curve=if_6, param=if_7, lacing=Longest)
reverse_4 = Vector.Reverse(vector=normalAtParameter_2)
if_8 = If(test=passThrough_4, true=reverse_4, false=normalAtParameter_2)
YAxis_2 = Vector.YAxis()
ZAxis_3 = Vector.ZAxis()
angleAboutAxis_2 = Vector.AngleAboutAxis(vector=if_8, otherVector=YAxis_2, rotationAxis=ZAxis_3)
setRotation_2 = FamilyInstance.SetRotation(familyInstance=setParameterByName_4, degree=angleAboutAxis_2)
code_block_31 = CodeBlock { 1; }
byStartPointDirectionLength_4 = Line.ByStartPointDirectionLength(startPoint=pointAtParameter_2, direction=normalAtParameter_2, length=code_block_31)
