# Dynamo graph 2021_04-1_BIMACON_Inserir Interruptor ao lado de portas-Selecionar porta_R01_script.dyn "ok 2021_04-1_BIMACON_Inserir Interruptor ao lado de portas-Selecionar porta_R01" (Dynamo 2.6.1.8786)
# packages: Sparrow 2021.2.1, Data-Shapes 2022.2.105, Clockwork for Dynamo 2.x 2.4.0, Orchid 2.6.8.6198, archi-lab.net 2023.213.1722, Genius Loci 2023.2.21

boolean = BoolSelector(true)

# group: ENTRADAS PARA O USUÁRIO
code_block = CodeBlock { "Inserção de Interruptor ao lado de porta"; }
file_path = Filename("..\..\..\..\..\05 - BIMACON\01 - EMPRESA BIMACON\00 - Logos e imagens - BIMACON\ARTE BIMACON\reddonda-removebg-preview.png")
file_from_path = FileObject(path=file_path)
readFromFile = Image.ReadFromFile(file=file_from_path)
string = StringInput("Confirmar")
string_2 = StringInput("Selecione a Porta")
string_3 = StringInput("Selecione ")
categories = Categories("OST_Doors")
boolean_2 = BoolSelector(true)
selectmodelelements_data = Custom[SelectModelElements Data](InputName=string_2, ButtonText=string_3, CategoryFilter=categories, SelectSingleElement=boolean_2)  # package Data-Shapes; Creates a Revit element selection input for UI.MultipleInputForm++ . Check out www.data-shapes.net for more infos!
string_4 = StringInput("Selecione o Espaço")
string_5 = StringInput("Selecione ")
categories_2 = Categories("OST_MEPSpaces")
boolean_3 = BoolSelector(true)
selectmodelelements_data_2 = Custom[SelectModelElements Data](InputName=string_4, ButtonText=string_5, CategoryFilter=categories_2, SelectSingleElement=boolean_3)
string_6 = StringInput("Tipo de Interruptor")
categories_3 = Categories("OST_LightingDevices")
all_families_of_category = Custom[All Families Of Category](category=categories_3)  # package Clockwork for Dynamo 2.x; Gets all famiies of a given category in the model (does *not *work for system families)
name = Family.Name(family=all_families_of_category)
code_block_2 = CodeBlock { "Interruptor"; }
contains = String.Contains(str=name, searchFor=code_block_2)
filterByBoolMask = List.FilterByBoolMask(list=all_families_of_category, mask=contains)
name_2 = Family.Name(family=filterByBoolMask.in)
code_block_3 = CodeBlock { "x."; }
contains_2 = String.Contains(str=name_2, searchFor=code_block_3)
filterByBoolMask_2 = List.FilterByBoolMask(list=filterByBoolMask.in, mask=contains_2)
types = Family.Types(family=filterByBoolMask_2.out)
flatten = List.Flatten(list=types)
family = FamilyType.Family(familyType=flatten)
name_3 = Family.Name(family=family)
code_block_4 = CodeBlock { "_"; }
split = String.Split(str=name_3, separator0=code_block_4)
code_block_5 = CodeBlock { 1; 2; }
getItemAtIndex = List.GetItemAtIndex(list=split@L2, index=code_block_5.out0)
getItemAtIndex_2 = List.GetItemAtIndex(list=split@L2, index=code_block_5.out1)
code_block_6 = CodeBlock(x=getItemAtIndex, y=getItemAtIndex_2) { x+" "+y; }
name_4 = FamilyType.Name(familyType=flatten)
code_block_7 = CodeBlock(a=code_block_6, b=name_4) { a; b; a+" : "+b; }
code_block_8 = CodeBlock { 8; }
dropdown_data = Custom[DropDown Data](InputName=string_6, Keys=code_block_7.out2, Values=flatten, DefaultValueIndex=code_block_8)  # package Data-Shapes; Create data for DropDown input in UI.MultiInputForm ++ . Check out www.data-shapes.net for more infos.
string_7 = StringInput("Distância do Eixo da Porta (Aprox. Larg. da Porta - 20cm)")
string_8 = StringInput("0.6")
boolean_4 = BoolSelector(true)
textbox_data = Custom[TextBox Data](InputName=string_7, DefaultText=string_8, IsNumberEntry=boolean_4)  # package Data-Shapes; Create Data for TextBox input in UI.MultipleInputForm ++ . Check out www.data-shapes.net for more informations
string_9 = StringInput("Elevação do Ponto")
string_10 = StringInput("1.2")
boolean_5 = BoolSelector(true)
textbox_data_2 = Custom[TextBox Data](InputName=string_9, DefaultText=string_10, IsNumberEntry=boolean_5)
list_create = List.Create(item0=selectmodelelements_data, item1=selectmodelelements_data_2, item2=dropdown_data, item3=textbox_data, item4=textbox_data_2)
boolean_6 = BoolSelector(true)
string_11 = StringInput("Cancelar")
number = DoubleInput(500)
number_2 = DoubleInput(167)
multipleinputform = Custom[MultipleInputForm ++](Description_optional=code_block, Logo_optional=readFromFile, ButtonText_optional=string, Inputs=list_create, Toggle=boolean_6, CancelButtonText_optional=string_11, Width_optional=number, LabelWidth_optional=number_2)  # package Data-Shapes; Create a form with multiple inputs. see www.data-shapes.net for tutorials and infos!
code_block_9 = CodeBlock()  # //Data-Shapes
code_block_10 = CodeBlock()  # //archilab

# group: Separar Entradas
code_block_11 = CodeBlock { 1; }
getItemAtIndex_3 = List.GetItemAtIndex(list=multipleinputform.User_Inputs, index=code_block_11)
code_block_12 = CodeBlock { 3; }
getItemAtIndex_4 = List.GetItemAtIndex(list=multipleinputform.User_Inputs, index=code_block_12)
code_block_13 = CodeBlock { 0; }
getItemAtIndex_5 = List.GetItemAtIndex(list=multipleinputform.User_Inputs, index=code_block_13)
code_block_14 = CodeBlock { 2; }
getItemAtIndex_6 = List.GetItemAtIndex(list=multipleinputform.User_Inputs, index=code_block_14)
code_block_15 = CodeBlock { 4; }
getItemAtIndex_7 = List.GetItemAtIndex(list=multipleinputform.User_Inputs, index=code_block_15)

finishBoundary = Space.FinishBoundary(space=getItemAtIndex_3)
byJoinedCurves = PolyCurve.ByJoinedCurves(curves=finishBoundary)
reverse = Curve.Reverse(curve=byJoinedCurves)
getLocation = Element.GetLocation(element=getItemAtIndex_5)

# group: Family Type
family_2 = FamilyType.Family(familyType=getItemAtIndex_6)
types_2 = Family.Types(family=family_2)
name_5 = FamilyType.Name(familyType=getItemAtIndex_6)
name_6 = FamilyType.Name(familyType=types_2)
eq = name_5 == name_6
filterByBoolMask_3 = List.FilterByBoolMask(list=types_2, mask=eq)

# group: Posição Interruptor
if_ = If(test=boolean, true=reverse, false=byJoinedCurves)
length = Curve.Length(curve=if_)
closestPointTo = Geometry.ClosestPointTo(geometry=if_, other=getLocation)
parameterAtPoint = Curve.ParameterAtPoint(curve=if_, point=closestPointTo)
code_block_16 = CodeBlock(offset_1=getItemAtIndex_4, lenght_1=length, pap_1=parameterAtPoint) { par_1 = offset_1/lenght_1; par_2 = pap_1+par_1; pap_1; }
number_3 = DoubleInput(1)
add = code_block_16.par_2 + number_3  # lacing=Longest
code_block_17 = CodeBlock(x=add) { x>=1; x-1; x; }
if_2 = If(test=code_block_17.out0, true=code_block_17.out1, false=code_block_17.x)
pointAtParameter = Curve.PointAtParameter(curve=if_, param=if_2, lacing=Longest)
normalAtParameter = Curve.NormalAtParameter(curve=if_, param=if_2, lacing=Longest)
code_block_18 = CodeBlock { 1; }
byStartPointDirectionLength = Line.ByStartPointDirectionLength(startPoint=pointAtParameter, direction=normalAtParameter, length=code_block_18)
element_getLevel = Custom[element_getLevel](element=getItemAtIndex_5)  # package Sparrow; This node retrieves the host level from Revit elements.
byPointAndLevel = FamilyInstance.ByPointAndLevel(familyType=filterByBoolMask_3.in, point=pointAtParameter, level=element_getLevel, lacing=Longest)
string_12 = StringInput("Elevação do nível")
code_block_19 = CodeBlock { 0; }
setParameterByName = Element.SetParameterByName(element=byPointAndLevel, parameterName=string_12, value=code_block_19, lacing=Longest)
string_13 = StringInput("Elevação do Ponto")
setParameterByName_2 = Element.SetParameterByName(element=setParameterByName, parameterName=string_13, value=getItemAtIndex_7, lacing=Longest)
reverse_2 = Vector.Reverse(vector=normalAtParameter)
if_3 = If(test=boolean, true=normalAtParameter, false=reverse_2)
YAxis = Vector.YAxis()
ZAxis = Vector.ZAxis()
angleAboutAxis = Vector.AngleAboutAxis(vector=if_3, otherVector=YAxis, rotationAxis=ZAxis)
setRotation = FamilyInstance.SetRotation(familyInstance=setParameterByName_2, degree=angleAboutAxis)

# group: Mensagem final
count = List.Count(list=setRotation)
passThrough = Custom[PassThrough](passThrough=count, waitFor=setRotation)  # package archi-lab.net; Ripped this off from Clockwork. Sorry Andy.
code_block_20 = CodeBlock { 0; }
gt = passThrough > code_block_20
code_block_21 = CodeBlock { ["Feito! Deseja Inverter o Lado do Interruptor?"]; }
code_block_22 = CodeBlock { ["Nenhum interruptor foi inserido"]; }
if_4 = If(test=gt, true=code_block_21, false=code_block_22)
flatten_2 = List.Flatten(list=if_4)
o_string_fromlist = Orchid.Common.String.FromList(list=flatten_2)
python_script = Python(IN[0]=o_string_fromlist)
# ---------- python_script.python (30 lines) ----------
# Importando as bibliotecas necessárias da API do Revit
import clr
clr.AddReference('RevitServices')  # Referência aos serviços do Revit
from RevitServices.Persistence import DocumentManager

clr.AddReference('RevitAPI')  # Referência à API do Revit
clr.AddReference('RevitAPIUI')  # Referência à API de Interface de Usuário do Revit

from Autodesk.Revit.UI import TaskDialog, TaskDialogCommonButtons, TaskDialogResult

# Recebe o texto de instrução como entrada do nó
instrucoes = IN[0]

# Criando o TaskDialog
dialog = TaskDialog("Aviso")
dialog.MainInstruction = instrucoes
dialog.CommonButtons = TaskDialogCommonButtons.Yes | TaskDialogCommonButtons.No | TaskDialogCommonButtons.Close

# Exibindo o dialog para o usuário e capturando a resposta
resultado = dialog.Show()

# Interpretando a resposta
if resultado == TaskDialogResult.No:
    OUT = "Não"
elif resultado == TaskDialogResult.Yes:
    OUT = "Sim"
elif resultado == TaskDialogResult.Cancel:
    OUT = "Fechar"
else:
    OUT = "Nenhuma ação"
# ----------------------------------------

# group: Inverter lado Interruptor
code_block_23 = CodeBlock { true; false; }
code_block_24 = CodeBlock(x=python_script, y=code_block_23.out0, z=code_block_23.out1)
# ---------- code_block_24.designscript (5 lines) ----------
//Condições IF, OR, AND
x;
y;
z;
x == "Sim" ? z : y;
# ----------------------------------------
watch = Watch(code_block_24.out3)

passThrough_2 = Custom[PassThrough](passThrough=setParameterByName_2, waitFor=code_block_24.out3)

# group (continued): Inverter lado Interruptor
delete = Element.Delete(element=passThrough_2)
passThrough_3 = Custom[PassThrough](passThrough=code_block_24.out3, waitFor=delete)

# group: Posição Interruptor
if_5 = If(test=passThrough_3, true=reverse, false=byJoinedCurves)
length_2 = Curve.Length(curve=if_5)
closestPointTo_2 = Geometry.ClosestPointTo(geometry=if_5, other=getLocation)
parameterAtPoint_2 = Curve.ParameterAtPoint(curve=if_5, point=closestPointTo_2)
code_block_25 = CodeBlock(offset_1=getItemAtIndex_4, lenght_1=length_2, pap_1=parameterAtPoint_2) { par_1 = offset_1/lenght_1; par_2 = pap_1+par_1; pap_1; }
number_4 = DoubleInput(1)
add_2 = code_block_25.par_2 + number_4  # lacing=Longest
code_block_26 = CodeBlock(x=add_2) { x>=1; x-1; x; }
if_6 = If(test=code_block_26.out0, true=code_block_26.out1, false=code_block_26.x)
pointAtParameter_2 = Curve.PointAtParameter(curve=if_5, param=if_6, lacing=Longest)
normalAtParameter_2 = Curve.NormalAtParameter(curve=if_5, param=if_6, lacing=Longest)
code_block_27 = CodeBlock { 1; }
byStartPointDirectionLength_2 = Line.ByStartPointDirectionLength(startPoint=pointAtParameter_2, direction=normalAtParameter_2, length=code_block_27)
element_level = Custom[Element Level](element=getItemAtIndex_5)  # package Genius Loci; Gets an element's level. Based on a Clockwork's node
byPointAndLevel_2 = FamilyInstance.ByPointAndLevel(familyType=filterByBoolMask_3.in, point=pointAtParameter_2, level=element_level, lacing=Longest)
string_14 = StringInput("Elevação do nível")
code_block_28 = CodeBlock { 0; }
setParameterByName_3 = Element.SetParameterByName(element=byPointAndLevel_2, parameterName=string_14, value=code_block_28, lacing=Longest)
string_15 = StringInput("Elevação do Ponto")
setParameterByName_4 = Element.SetParameterByName(element=setParameterByName_3, parameterName=string_15, value=getItemAtIndex_7, lacing=Longest)
reverse_3 = Vector.Reverse(vector=normalAtParameter_2)
if_7 = If(test=passThrough_3, true=normalAtParameter_2, false=reverse_3)
YAxis_2 = Vector.YAxis()
ZAxis_2 = Vector.ZAxis()
angleAboutAxis_2 = Vector.AngleAboutAxis(vector=if_7, otherVector=YAxis_2, rotationAxis=ZAxis_2)
setRotation_2 = FamilyInstance.SetRotation(familyInstance=setParameterByName_4, degree=angleAboutAxis_2)
