# Dynamo graph 04-0_BIMACON_Inserir Interruptor ao lado de portas-LINK_R08_script.dyn "04-0_BIMACON_Inserir Interruptor ao lado de portas-LINK_R07_script" (Dynamo 3.3.0.6316)
# author: Jose Nelson
# Inseri Interruptor ao lado de portas do link
# packages: Genius Loci 2023.2.21, Data-Shapes 2022.2.105, archi-lab.net 2023.213.1722, DynamoIronPython2.7 3.2.1, DynaMEP 2.0.1, BIMCoder Nodes - 2.X 2025.1.0

boolean = BoolSelector(true)

# group: Mensagem
boolean_2 = BoolSelector(true)
code_block = CodeBlock { ["Selecione o link e depois a porta para Inserir o Interruptor"]; }
code_block_2 = CodeBlock { ["Nenhum link foi selecionado"]; }
if_ = If(test=boolean_2, true=code_block, false=code_block_2)
fromList = Python(IN[0]=if_)  # "String.FromList"; IronPython2
# ---------- fromList.python (22 lines) ----------
# Carregar as bibliotecas DesignScript e padrão do Python
import sys
import clr
clr.AddReference('ProtoGeometry')
from Autodesk.DesignScript.Geometry import *

# Função para concatenar os valores de uma lista em uma única string com múltiplas linhas
def concatenate_list_to_string(input_list, delimiter="\n"):
    # Verifica se a entrada é uma lista
    if not isinstance(input_list, list):
        return "A entrada deve ser uma lista."
    
    # Converte todos os elementos para string e junta com o delimitador especificado
    result = delimiter.join(str(item) for item in input_list)
    return result

# Entrada pelo nó do Dynamo
lista = IN[0]  # Lista de valores a serem concatenados
delimitador = IN[1] if len(IN) > 1 else "\n"  # Delimitador opcional, padrão é nova linha

# Saída para o Dynamo
OUT = concatenate_list_to_string(lista, delimitador)
# ----------------------------------------
window_prompt_with_text = Python(IN[0]=fromList)  # IronPython2
# ---------- window_prompt_with_text.python (26 lines) ----------
# Importando as bibliotecas necessárias da API do Revit
import clr
clr.AddReference('RevitServices')  # Referência aos serviços do Revit
from RevitServices.Persistence import DocumentManager

clr.AddReference('RevitAPI')  # Referência à API do Revit
clr.AddReference('RevitAPIUI')  # Referência à API de Interface de Usuário do Revit

from Autodesk.Revit.UI import TaskDialog, TaskDialogCommonButtons, TaskDialogResult

# Recebe o texto de instrução como entrada do nó
instrucoes = IN[0]

# Criando o TaskDialog
dialog = TaskDialog("Aviso")
dialog.MainInstruction = instrucoes
dialog.CommonButtons = TaskDialogCommonButtons.Ok

# Exibindo o dialog para o usuário e capturando a resposta
resultado = dialog.Show()

# Interpretando a resposta
if resultado == TaskDialogCommonButtons.Ok:
    OUT = "Ok"
else:
    OUT = "True"
# ----------------------------------------
selectLinkedElement = RevitModel.Element.SelectLinkedElement(fresh=window_prompt_with_text)

# group: Espaços
categories = Categories("OST_MEPSpaces")
all_elements_of_category = ElementsOfCategory(Category=categories)
boundingBox = Element.BoundingBox(element=all_elements_of_category)
boundingBox_2 = Element.BoundingBox(element=selectLinkedElement)
intersects = BoundingBox.Intersects(boundingBox=boundingBox, other=boundingBox_2)
filterByBoolMask = List.FilterByBoolMask(list=all_elements_of_category, mask=intersects)
name = Space.Name(space=filterByBoolMask.in)

# group: Conferir se existe espaço
boolean_3 = BoolSelector(true)
boolean_4 = BoolSelector(false)
empty_list_verificação = CodeBlock(a=name, b=boolean_3, c=boolean_4) { indx = DSCore.List.IsEmpty(a) ? 0 : 1; rslt = [b,a][indx]; rslt2 = [b,c][indx]; }
code_block_3 = CodeBlock { "Erro - Insira os Espaços antes de Executar o comando"; }
dialog_simple = Custom[👓 Dialog․Simple](message=code_block_3, toggle=empty_list_verificação.rslt2)  # package BIMCoder Nodes - 2.X; Exibe uma mensagem de alerta ao usuário, sem botões de ação.

passThrough = Custom[PassThrough](passThrough=filterByBoolMask.in, waitFor=name)  # package archi-lab.net; Ripped this off from Clockwork. Sorry Andy.
passThrough_2 = Custom[PassThrough](passThrough=window_prompt_with_text, waitFor=name)

# group: ENTRADAS PARA O USUÁRIO
code_block_4 = CodeBlock { "Inserção de Interruptor ao lado de porta do Link"; }
string = StringInput("LogoBimacon.png")
python_script = Python(IN[0]=string)  # IronPython2
# ---------- python_script.python (22 lines) ----------
import clr

# Adiciona referência ao ambiente .NET
clr.AddReference('System')
from System import Environment, IO

# Nome da imagem (entrada do usuário)
nome_arquivo_imagem = IN[0]

# Recupera o nome do usuário logado no Windows
usuario = Environment.UserName

# Monta o caminho completo para a pasta de imagens
caminho_base = r"C:\Users\{0}\AppData\Roaming\pyRevit\Extensions\Bimacon.extension\Bimacon.tab\Imagens_Bimacon".format(usuario)

# Junta o caminho base com o nome do arquivo
caminho_completo = IO.Path.Combine(caminho_base, nome_arquivo_imagem)

# Verifica se o arquivo existe
existe = IO.File.Exists(caminho_completo)

OUT = caminho_completo if existe else "Imagem não encontrada: {0}".format(caminho_completo)
# ----------------------------------------
file_from_path = FileObject(path=python_script)
readFromFile = Image.ReadFromFile(file=file_from_path)
string_2 = StringInput("Confirmar")
string_3 = StringInput("Selecione o Ambiente à Inserir o Interruptor (Espaço)")
code_block_5 = CodeBlock { 0; }
dropdown_data = Custom[DropDown Data](InputName=string_3, Keys=empty_list_verificação.rslt, Values=passThrough, DefaultValueIndex=code_block_5)  # package Data-Shapes; Create data for DropDown input in UI.MultiInputForm ++ . Check out www.data-shapes.net for more infos.
string_4 = StringInput("Tipo de Interruptor")
categories_2 = Categories("OST_LightingDevices")
obter_famílias_de_uma_categoria = Python(IN[0]=categories_2)  # "Obter Famílias de Uma Categoria - BIMACON"; IronPython2
# ---------- obter_famílias_de_uma_categoria.python (72 lines) ----------
import clr

# Revit API
clr.AddReference('RevitAPI')
from Autodesk.Revit.DB import *

# Revit Services
clr.AddReference("RevitServices")
from RevitServices.Persistence import DocumentManager

# RevitNodes (UnwrapElement)
clr.AddReference("RevitNodes")
import Revit
clr.ImportExtensions(Revit.Elements)

doc = DocumentManager.Instance.CurrentDBDocument

# ================================
# Função universal para obter o CategoryId
# Compatível com Revit 2021 até 2026
# ================================
def obter_categoria_id(entrada):
    if entrada is None:
        return None
    
    # Entrada é categoria nativa do Dynamo
    if isinstance(entrada, Category):
        return entrada.Id
    
    # Entrada é elemento do Revit
    if isinstance(entrada, Element):
        try:
            return entrada.Category.Id
        except:
            return None

    # Entrada tem propriedade Id que é um ElementId
    if hasattr(entrada, "Id") and isinstance(entrada.Id, ElementId):
        return entrada.Id

    # Entrada é ElementId puro
    if isinstance(entrada, ElementId):
        return entrada

    return None


# ================
# Entrada
# ================
entrada = UnwrapElement(IN[0])
categoria_id = obter_categoria_id(entrada)

# Caso inválido → saída vazia
if categoria_id is None:
    OUT = []
else:
    # ================
    # Coletar famílias
    # ================
    todas_familias = FilteredElementCollector(doc).OfClass(Family).ToElements()

    familias_filtradas = []

    for fam in todas_familias:
        try:
            if fam.FamilyCategory and fam.FamilyCategory.Id == categoria_id:
                familias_filtradas.append(fam)
        except:
            pass

    OUT = familias_filtradas
# ----------------------------------------
name_2 = Family.Name(family=obter_famílias_de_uma_categoria)
code_block_6 = CodeBlock { "Interruptor"; }
contains = String.Contains(string=name_2, searchFor=code_block_6)
filterByBoolMask_2 = List.FilterByBoolMask(list=obter_famílias_de_uma_categoria, mask=contains)
name_3 = Family.Name(family=filterByBoolMask_2.in)
code_block_7 = CodeBlock { "x."; }
contains_2 = String.Contains(string=name_3, searchFor=code_block_7)
filterByBoolMask_3 = List.FilterByBoolMask(list=filterByBoolMask_2.in, mask=contains_2)
types = Family.Types(family=filterByBoolMask_3.out)
flatten = List.Flatten(list=types)
family = FamilyType.Family(familyType=flatten)
name_4 = Family.Name(family=family)
sortByKey = List.SortByKey(list=flatten, keys=name_4)
code_block_8 = CodeBlock { "_"; }
split = String.Split(string=sortByKey.sortedKeys, separator0=code_block_8)
code_block_9 = CodeBlock { 1; 2; }
getItemAtIndex = List.GetItemAtIndex(list=split@L2, index=code_block_9.out0)
getItemAtIndex_2 = List.GetItemAtIndex(list=split@L2, index=code_block_9.out1)
code_block_10 = CodeBlock(x=getItemAtIndex, y=getItemAtIndex_2) { x+" "+y; }
name_5 = FamilyType.Name(familyType=sortByKey.sortedList)
code_block_11 = CodeBlock(a=code_block_10, b=name_5) { a; b; a+" : "+b; }
code_block_12 = CodeBlock { 2; }
dropdown_data_2 = Custom[DropDown Data](InputName=string_4, Keys=code_block_11.out2, Values=sortByKey.sortedList, DefaultValueIndex=code_block_12)
string_5 = StringInput("Distância do Eixo da Porta (Aprox. Larg. da Porta - 25cm)")
string_6 = StringInput("0.55")
boolean_5 = BoolSelector(true)
textbox_data = Custom[TextBox Data](InputName=string_5, DefaultText=string_6, IsNumberEntry=boolean_5)  # package Data-Shapes; Create Data for TextBox input in UI.MultipleInputForm ++ . Check out www.data-shapes.net for more informations
string_7 = StringInput("Elevação do Ponto")
string_8 = StringInput("1.2")
boolean_6 = BoolSelector(true)
textbox_data_2 = Custom[TextBox Data](InputName=string_7, DefaultText=string_8, IsNumberEntry=boolean_6)
list_create = List.Create(item0=dropdown_data, item1=dropdown_data_2, item2=textbox_data, item3=textbox_data_2)
string_9 = StringInput("Cancelar")
number = DoubleInput(600)
number_2 = DoubleInput(210)
multipleinputform = Custom[MultipleInputForm ++](Description_optional=code_block_4, Logo_optional=readFromFile, ButtonText_optional=string_2, Inputs=list_create, Toggle=passThrough_2, CancelButtonText_optional=string_9, Width_optional=number, LabelWidth_optional=number_2)  # package Data-Shapes; Create a form with multiple inputs. see www.data-shapes.net for tutorials and infos!
code_block_13 = CodeBlock()  # //archilab
code_block_14 = CodeBlock()  # //Data-Shapes
boolean_7 = BoolSelector(true)
sort = List.Sort(list=name_4)

# group: Separar Entradas
code_block_15 = CodeBlock { 0; }
getItemAtIndex_3 = List.GetItemAtIndex(list=multipleinputform.User_Inputs, index=code_block_15)
code_block_16 = CodeBlock { 2; }
getItemAtIndex_4 = List.GetItemAtIndex(list=multipleinputform.User_Inputs, index=code_block_16)
code_block_17 = CodeBlock { 1; }
getItemAtIndex_5 = List.GetItemAtIndex(list=multipleinputform.User_Inputs, index=code_block_17)
code_block_18 = CodeBlock { 3; }
getItemAtIndex_6 = List.GetItemAtIndex(list=multipleinputform.User_Inputs, index=code_block_18)

finishBoundary = Space.FinishBoundary(space=getItemAtIndex_3)
byJoinedCurves = PolyCurve.ByJoinedCurves(curves=finishBoundary)
reverse = Curve.Reverse(curve=byJoinedCurves)
passThrough_3 = Custom[PassThrough](passThrough=selectLinkedElement, waitFor=reverse)
getLocation = Element.GetLocation(element=passThrough_3)
family_2 = FamilyType.Family(familyType=getItemAtIndex_5)
types_2 = Family.Types(family=family_2)
name_6 = FamilyType.Name(familyType=getItemAtIndex_5)
name_7 = FamilyType.Name(familyType=types_2)
eq = name_6 == name_7
filterByBoolMask_4 = List.FilterByBoolMask(list=types_2, mask=eq)

# group: Posição Interruptor
if_2 = If(test=boolean, true=reverse, false=byJoinedCurves)
length = Curve.Length(curve=if_2)
closestPointTo = Geometry.ClosestPointTo(geometry=if_2, other=getLocation)
parameterAtPoint = Curve.ParameterAtPoint(curve=if_2, point=closestPointTo)
code_block_19 = CodeBlock(offset_1=getItemAtIndex_4, lenght_1=length, pap_1=parameterAtPoint) { par_1 = offset_1/lenght_1; par_2 = pap_1+par_1; pap_1; }
number_3 = DoubleInput(1)
add = code_block_19.par_2 + number_3  # lacing=Longest
code_block_20 = CodeBlock(x=add) { x>=1; x-1; x; }
if_3 = If(test=code_block_20.out0, true=code_block_20.out1, false=code_block_20.x)
pointAtParameter = Curve.PointAtParameter(curve=if_2, param=if_3, lacing=Longest)
normalAtParameter = Curve.NormalAtParameter(curve=if_2, param=if_3, lacing=Longest)
code_block_21 = CodeBlock { 1; }
byStartPointDirectionLength = Line.ByStartPointDirectionLength(startPoint=pointAtParameter, direction=normalAtParameter, length=code_block_21)
element_level = Custom[Element Level](element=getItemAtIndex_3)  # package Genius Loci; Gets an element's level. Based on a Clockwork's node
byPointAndLevel = FamilyInstance.ByPointAndLevel(familyType=filterByBoolMask_4.in, point=pointAtParameter, level=element_level, lacing=Longest)
string_10 = StringInput("Elevação do nível")
code_block_22 = CodeBlock { 0; }
setParameterByName = Element.SetParameterByName(element=byPointAndLevel, parameterName=string_10, value=code_block_22, lacing=Longest)
string_11 = StringInput("Elevação do Ponto")
setParameterByName_2 = Element.SetParameterByName(element=setParameterByName, parameterName=string_11, value=getItemAtIndex_6, lacing=Longest)
reverse_2 = Vector.Reverse(vector=normalAtParameter)
if_4 = If(test=boolean, true=normalAtParameter, false=reverse_2)
YAxis = Vector.YAxis()
ZAxis = Vector.ZAxis()
angleAboutAxis = Vector.AngleAboutAxis(vector=if_4, otherVector=YAxis, rotationAxis=ZAxis)
setRotation = FamilyInstance.SetRotation(familyInstance=setParameterByName_2, degree=angleAboutAxis)

# group: Mensagem final
count = List.Count(list=setRotation)
passThrough_4 = Custom[PassThrough](passThrough=count, waitFor=setRotation)
code_block_23 = CodeBlock { 0; }
gt = passThrough_4 > code_block_23
code_block_24 = CodeBlock { ["Feito! Deseja inverter o lado do Interruptor?"]; }
code_block_25 = CodeBlock { ["Nenhum interruptor inserido, clique em Fechar"]; }
if_5 = If(test=gt, true=code_block_24, false=code_block_25)
flatten_2 = List.Flatten(list=if_5)
fromList_2 = Python(IN[0]=flatten_2)  # "String.FromList"; IronPython2; same code as fromList
python_script_2 = Python(IN[0]=fromList_2)  # IronPython2
# ---------- python_script_2.python (30 lines) ----------
# Importando as bibliotecas necessárias da API do Revit
import clr
clr.AddReference('RevitServices')  # Referência aos serviços do Revit
from RevitServices.Persistence import DocumentManager

clr.AddReference('RevitAPI')  # Referência à API do Revit
clr.AddReference('RevitAPIUI')  # Referência à API de Interface de Usuário do Revit

from Autodesk.Revit.UI import TaskDialog, TaskDialogCommonButtons, TaskDialogResult

# Recebe o texto de instrução como entrada do nó
instrucoes = IN[0]

# Criando o TaskDialog
dialog = TaskDialog("Aviso")
dialog.MainInstruction = instrucoes
dialog.CommonButtons = TaskDialogCommonButtons.Yes | TaskDialogCommonButtons.No | TaskDialogCommonButtons.Close

# Exibindo o dialog para o usuário e capturando a resposta
resultado = dialog.Show()

# Interpretando a resposta
if resultado == TaskDialogResult.No:
    OUT = "Não"
elif resultado == TaskDialogResult.Yes:
    OUT = "Sim"
elif resultado == TaskDialogResult.Cancel:
    OUT = "Fechar"
else:
    OUT = "Nenhuma ação"
# ----------------------------------------

# group: Inverter lado Interruptor
code_block_26 = CodeBlock { true; false; }
code_block_27 = CodeBlock(x=python_script_2, y=code_block_26.out0, z=code_block_26.out1)
# ---------- code_block_27.designscript (5 lines) ----------
//Condições IF, OR, AND
x;
y;
z;
x == "Sim" ? z : y;
# ----------------------------------------
watch = Watch(code_block_27.out3)
passThrough_5 = Custom[PassThrough](passThrough=setParameterByName_2, waitFor=code_block_27.out3)
delete = Element.Delete(element=passThrough_5)
passThrough_6 = Custom[PassThrough](passThrough=code_block_27.out3, waitFor=delete)

# group: Posição Interruptor
if_6 = If(test=passThrough_6, true=reverse, false=byJoinedCurves)
length_2 = Curve.Length(curve=if_6)
closestPointTo_2 = Geometry.ClosestPointTo(geometry=if_6, other=getLocation)
parameterAtPoint_2 = Curve.ParameterAtPoint(curve=if_6, point=closestPointTo_2)
code_block_28 = CodeBlock(offset_1=getItemAtIndex_4, lenght_1=length_2, pap_1=parameterAtPoint_2) { par_1 = offset_1/lenght_1; par_2 = pap_1+par_1; pap_1; }
number_4 = DoubleInput(1)
add_2 = code_block_28.par_2 + number_4  # lacing=Longest
code_block_29 = CodeBlock(x=add_2) { x>=1; x-1; x; }
if_7 = If(test=code_block_29.out0, true=code_block_29.out1, false=code_block_29.x)
pointAtParameter_2 = Curve.PointAtParameter(curve=if_6, param=if_7, lacing=Longest)
normalAtParameter_2 = Curve.NormalAtParameter(curve=if_6, param=if_7, lacing=Longest)
code_block_30 = CodeBlock { 1; }
byStartPointDirectionLength_2 = Line.ByStartPointDirectionLength(startPoint=pointAtParameter_2, direction=normalAtParameter_2, length=code_block_30)
element_level_2 = Custom[Element Level](element=getItemAtIndex_3)
byPointAndLevel_2 = FamilyInstance.ByPointAndLevel(familyType=filterByBoolMask_4.in, point=pointAtParameter_2, level=element_level_2, lacing=Longest)
string_12 = StringInput("Elevação do nível")
code_block_31 = CodeBlock { 0; }
setParameterByName_3 = Element.SetParameterByName(element=byPointAndLevel_2, parameterName=string_12, value=code_block_31, lacing=Longest)
string_13 = StringInput("Elevação do Ponto")
setParameterByName_4 = Element.SetParameterByName(element=setParameterByName_3, parameterName=string_13, value=getItemAtIndex_6, lacing=Longest)
reverse_3 = Vector.Reverse(vector=normalAtParameter_2)
if_8 = If(test=passThrough_6, true=normalAtParameter_2, false=reverse_3)
YAxis_2 = Vector.YAxis()
ZAxis_2 = Vector.ZAxis()
angleAboutAxis_2 = Vector.AngleAboutAxis(vector=if_8, otherVector=YAxis_2, rotationAxis=ZAxis_2)
setRotation_2 = FamilyInstance.SetRotation(familyInstance=setParameterByName_4, degree=angleAboutAxis_2)
