# Dynamo graph 2021_04-2_BIMACON_Inserir Interruptor ao lado de Todas portas-LINK_R01_script.dyn "2021_04-2_BIMACON_Inserir Interruptor ao lado de Todas portas-LINK_R01" (Dynamo 2.6.1.8786)
# Inseri Interruptores ao lado de portas de arquivos Linkados
# packages: archi-lab.net 2023.213.1722, Data-Shapes 2022.2.105, Genius Loci 2023.2.21, Clockwork for Dynamo 2.x 2.4.0, Orchid 2.6.8.6198

# group: SELECIONE O MODELO ARQ LINKADO
code_block = CodeBlock { "Selecione o link para Inserir os interruptores:"; }
get_alldocuments = Custom[Get AllDocuments]()  # package Genius Loci; Get documents (linked and opened in background). The first document is the active document.
code_block_2 = CodeBlock { 0; }
dropdown_data = Custom[DropDown Data](InputName=code_block, Keys=get_alldocuments.FileName, Values=get_alldocuments.Document, DefaultValueIndex=code_block_2)  # package Data-Shapes; Create data for DropDown input in UI.MultiInputForm ++ . Check out www.data-shapes.net for more infos.

# group: ENTRADAS PARA O USUÁRIO
code_block_3 = CodeBlock { "Inserção de Interruptor ao lado de todas portas do Link"; }
file_path = Filename("..\..\..\..\..\05 - BIMACON\01 - EMPRESA BIMACON\00 - Logos e imagens - BIMACON\ARTE BIMACON\reddonda-removebg-preview.png")
file_from_path = FileObject(path=file_path)
readFromFile = Image.ReadFromFile(file=file_from_path)
string = StringInput("Confirmar")
string_2 = StringInput("Selecione o Nível")
categories = Categories("OST_Levels")
all_elements_of_category = ElementsOfCategory(Category=categories)
name = Level.Name(level=all_elements_of_category)
dropdown_data_2 = Custom[DropDown Data](InputName=string_2, Keys=name, Values=all_elements_of_category, DefaultValueIndex=code_block_2)
string_3 = StringInput("Tipo de Interruptor")
categories_2 = Categories("OST_LightingDevices")
all_families_of_category = Custom[All Families Of Category](category=categories_2)  # package Clockwork for Dynamo 2.x; Gets all famiies of a given category in the model (does *not *work for system families)
name_2 = Family.Name(family=all_families_of_category)
code_block_4 = CodeBlock { "Interruptor"; }
contains = String.Contains(str=name_2, searchFor=code_block_4)
filterByBoolMask = List.FilterByBoolMask(list=all_families_of_category, mask=contains)
name_3 = Family.Name(family=filterByBoolMask.in)
code_block_5 = CodeBlock { "x."; }
contains_2 = String.Contains(str=name_3, searchFor=code_block_5)
filterByBoolMask_2 = List.FilterByBoolMask(list=filterByBoolMask.in, mask=contains_2)
types = Family.Types(family=filterByBoolMask_2.out)
flatten = List.Flatten(list=types)
family = FamilyType.Family(familyType=flatten)
name_4 = Family.Name(family=family)
code_block_6 = CodeBlock { "_"; }
split = String.Split(str=name_4, separator0=code_block_6)
code_block_7 = CodeBlock { 1; 2; }
getItemAtIndex = List.GetItemAtIndex(list=split@L2, index=code_block_7.out0)
getItemAtIndex_2 = List.GetItemAtIndex(list=split@L2, index=code_block_7.out1)
code_block_8 = CodeBlock(x=getItemAtIndex, y=getItemAtIndex_2) { x+" "+y; }
name_5 = FamilyType.Name(familyType=flatten)
code_block_9 = CodeBlock(a=code_block_8, b=name_5) { a; b; a+" : "+b; }
code_block_10 = CodeBlock { 8; }
dropdown_data_3 = Custom[DropDown Data](InputName=string_3, Keys=code_block_9.out2, Values=flatten, DefaultValueIndex=code_block_10)
string_4 = StringInput("Distância do Eixo da Porta (Aprox. Larg. da Porta - 20cm)")
string_5 = StringInput("0.5")
boolean = BoolSelector(true)
textbox_data = Custom[TextBox Data](InputName=string_4, DefaultText=string_5, IsNumberEntry=boolean)  # package Data-Shapes; Create Data for TextBox input in UI.MultipleInputForm ++ . Check out www.data-shapes.net for more informations
string_6 = StringInput("Inverter Lado em relação a Porta")
boolean_2 = BoolSelector(true)
string_7 = StringInput("Inverter Lado")
boolean_input = Custom[Boolean input](InputName=string_6, DefaultValue=boolean_2, SideText=string_7)  # package Data-Shapes; Creates a boolean input for UI.MultipleInputForm ++ . Check out www.data-shapes.net for more infos!
string_8 = StringInput("Elevação do Ponto")
string_9 = StringInput("1.2")
boolean_3 = BoolSelector(true)
textbox_data_2 = Custom[TextBox Data](InputName=string_8, DefaultText=string_9, IsNumberEntry=boolean_3)
list_create = List.Create(item0=dropdown_data, item1=dropdown_data_2, item2=dropdown_data_3, item3=textbox_data, item4=boolean_input, item5=textbox_data_2)
boolean_4 = BoolSelector(true)
string_10 = StringInput("Cancelar")
number = DoubleInput(600)
number_2 = DoubleInput(205)
multipleinputform = Custom[MultipleInputForm ++](Description_optional=code_block_3, Logo_optional=readFromFile, ButtonText_optional=string, Inputs=list_create, Toggle=boolean_4, CancelButtonText_optional=string_10, Width_optional=number, LabelWidth_optional=number_2)  # package Data-Shapes; Create a form with multiple inputs. see www.data-shapes.net for tutorials and infos!
code_block_11 = CodeBlock()  # //archilab
code_block_12 = CodeBlock()  # //Data-Shapes

# group: Separar Entradas
code_block_13 = CodeBlock { 4; }
getItemAtIndex_3 = List.GetItemAtIndex(list=multipleinputform.User_Inputs, index=code_block_13)
code_block_14 = CodeBlock { 1; }
getItemAtIndex_4 = List.GetItemAtIndex(list=multipleinputform.User_Inputs, index=code_block_14)
code_block_15 = CodeBlock { 3; }
getItemAtIndex_5 = List.GetItemAtIndex(list=multipleinputform.User_Inputs, index=code_block_15)
code_block_16 = CodeBlock { 0; }
getItemAtIndex_6 = List.GetItemAtIndex(list=multipleinputform.User_Inputs, index=code_block_16)
code_block_17 = CodeBlock { 2; }
getItemAtIndex_7 = List.GetItemAtIndex(list=multipleinputform.User_Inputs, index=code_block_17)
code_block_18 = CodeBlock { 5; }
getItemAtIndex_8 = List.GetItemAtIndex(list=multipleinputform.User_Inputs, index=code_block_18)

# group: Espaços no Nível
categories_3 = Categories("OST_MEPSpaces")
all_elements_of_category_2 = ElementsOfCategory(Category=categories_3)
code_block_19 = CodeBlock { "Nível"; }
getParameterValueByName = Element.GetParameterValueByName(element=all_elements_of_category_2, parameterName=code_block_19)
name_6 = Level.Name(level=getItemAtIndex_4)
eq = getParameterValueByName == name_6
filterByBoolMask_3 = List.FilterByBoolMask(list=all_elements_of_category_2, mask=eq)

finishBoundary = Space.FinishBoundary(space=filterByBoolMask_3.in)
byJoinedCurves = PolyCurve.ByJoinedCurves(curves=finishBoundary)
reverse = Curve.Reverse(curve=byJoinedCurves)
if_ = If(test=getItemAtIndex_3, true=reverse, false=byJoinedCurves)
length = Curve.Length(curve=if_)
categories_4 = Categories("OST_Doors")
get_all_elements_from_linked = Custom[Get All Elements From Linked Model](linkDoc=getItemAtIndex_6, category=categories_4)  # package archi-lab.net; This node is based on code posted by Julien Benoit. Big thanks to Julien for sharing his work. This node will retrieve all elements of a given category from a given linked model.
getLocation = Element.GetLocation(element=get_all_elements_from_linked)
closestPointTo = Geometry.ClosestPointTo(geometry=if_, other=getLocation@L2)
parameterAtPoint = Curve.ParameterAtPoint(curve=if_, point=closestPointTo)
code_block_20 = CodeBlock(offset_1=getItemAtIndex_5, lenght_1=length, pap_1=parameterAtPoint) { par_1 = offset_1/lenght_1; par_2 = pap_1+par_1; pap_1; }
number_3 = DoubleInput(1)
add = code_block_20.par_2 + number_3  # lacing=Longest
code_block_21 = CodeBlock(x=add) { x>=1; x-1; x; }
if_2 = If(test=code_block_21.out0, true=code_block_21.out1, false=code_block_21.x)
pointAtParameter = Curve.PointAtParameter(curve=if_, param=if_2, lacing=Longest)
normalAtParameter = Curve.NormalAtParameter(curve=if_, param=if_2, lacing=Longest)
code_block_22 = CodeBlock { 1; }
byStartPointDirectionLength = Line.ByStartPointDirectionLength(startPoint=pointAtParameter, direction=normalAtParameter, length=code_block_22)
family_2 = FamilyType.Family(familyType=getItemAtIndex_7)
types_2 = Family.Types(family=family_2)
name_7 = FamilyType.Name(familyType=getItemAtIndex_7)
name_8 = FamilyType.Name(familyType=types_2)
eq_2 = name_7 == name_8
filterByBoolMask_4 = List.FilterByBoolMask(list=types_2, mask=eq_2)
byPointAndLevel = FamilyInstance.ByPointAndLevel(familyType=filterByBoolMask_4.in, point=pointAtParameter, level=getItemAtIndex_4, lacing=Longest)
string_11 = StringInput("Elevação do nível")
code_block_23 = CodeBlock { 0; }
setParameterByName = Element.SetParameterByName(element=byPointAndLevel, parameterName=string_11, value=code_block_23, lacing=Longest)
string_12 = StringInput("Elevação do Ponto")
setParameterByName_2 = Element.SetParameterByName(element=setParameterByName, parameterName=string_12, value=getItemAtIndex_8, lacing=Longest)
reverse_2 = Vector.Reverse(vector=normalAtParameter)
if_3 = If(test=getItemAtIndex_3, true=normalAtParameter, false=reverse_2)
YAxis = Vector.YAxis()
ZAxis = Vector.ZAxis()
angleAboutAxis = Vector.AngleAboutAxis(vector=if_3, otherVector=YAxis, rotationAxis=ZAxis)
setRotation = FamilyInstance.SetRotation(familyInstance=setParameterByName_2, degree=angleAboutAxis)

# group: Mensagem final
passThrough = Custom[PassThrough](passThrough=setRotation, waitFor=setRotation)  # package archi-lab.net; Ripped this off from Clockwork. Sorry Andy.
code_block_24 = CodeBlock { 0; }
code_block_25 = CodeBlock { ["Nenhum interruptor foi inserido"]; }

flatten_2 = List.Flatten(list=passThrough)

# group (continued): Mensagem final
count = List.Count(list=flatten_2)
gt = count > code_block_24
code_block_26 = CodeBlock(N=count) { ["Feito! Você inseriu "+N+" Interruptor em seu projeto"]; }
if_4 = If(test=gt, true=code_block_26, false=code_block_25)
flatten_3 = List.Flatten(list=if_4)
o_string_fromlist = Orchid.Common.String.FromList(list=flatten_3)
python_script = Python(IN[0]=o_string_fromlist)
# ---------- python_script.python (21 lines) ----------
# Importar as bibliotecas necessárias do Revit
import clr
clr.AddReference("RevitServices")
from RevitServices.Persistence import DocumentManager

clr.AddReference("RevitAPI")
clr.AddReference("RevitAPIUI")
from Autodesk.Revit.UI import TaskDialog

# Pegar a entrada do Dynamo
mensagem = IN[0]

# Criar a TaskDialog
task_dialog = TaskDialog("Ok")
task_dialog.MainInstruction = mensagem

# Exibir a TaskDialog
task_dialog.Show()

# Saída do script
OUT = "Sucesso!"
# ----------------------------------------
