# Dynamo graph 04-2_BIMACON_Inserir Interruptor ao lado de portas todos Espaços_R05_script.dyn (Dynamo 2.19.3.6394)
# author: Jose Nelson
# Inseri Interruptores ao lado de portas de arquivos Linkados
# packages: Data-Shapes 2022.2.105, archi-lab.net 2023.213.1722, Genius Loci 2023.2.21, Clockwork for Dynamo 2.x 2.4.0, MEPover 2022.10.30, DynaMEP 2.0.1, spring nodes 210.1.1, Crumple 2021.9.24

number = DoubleInput(6)
ZAxis = Vector.ZAxis()
ZAxis_2 = Vector.ZAxis()
code_block = CodeBlock { []; }
code_block_2 = CodeBlock { []; }
code_block_3 = CodeBlock { []; }
code_block_4 = CodeBlock { []; }

# group: ENTRADAS PARA O USUÁRIO
code_block_5 = CodeBlock()  # //archilab
code_block_6 = CodeBlock()  # //Data-Shapes
code_block_7 = CodeBlock { "Inserção de Interruptor ao lado de portas em todos Espaços"; }
string = StringInput("LogoBimacon.png")
python_script = Python(IN[0]=string)  # IronPython2
# ---------- python_script.python (22 lines) ----------
import clr

# Adiciona referência ao ambiente .NET
clr.AddReference('System')
from System import Environment, IO

# Nome da imagem (entrada do usuário)
nome_arquivo_imagem = IN[0]

# Recupera o nome do usuário logado no Windows
usuario = Environment.UserName

# Monta o caminho completo para a pasta de imagens
caminho_base = r"C:\Users\{0}\AppData\Roaming\pyRevit\Extensions\Bimacon.extension\Bimacon.tab\Imagens_Bimacon".format(usuario)

# Junta o caminho base com o nome do arquivo
caminho_completo = IO.Path.Combine(caminho_base, nome_arquivo_imagem)

# Verifica se o arquivo existe
existe = IO.File.Exists(caminho_completo)

OUT = caminho_completo if existe else "Imagem não encontrada: {0}".format(caminho_completo)
# ----------------------------------------
file_from_path = FileObject(path=python_script)
readFromFile = Image.ReadFromFile(file=file_from_path)
string_2 = StringInput("Confirmar")
get_alldocuments = Custom[Get AllDocuments]()  # package Genius Loci; Get documents (linked and opened in background). The first document is the active document.
current = Document.Current()
name = Python(IN[0]=current)  # "Document.Name"; IronPython2
# ---------- name.python (27 lines) ----------
# Carregar as bibliotecas DesignScript e padrão do Python
import sys
import clr
clr.AddReference('ProtoGeometry')
from Autodesk.DesignScript.Geometry import *

# Importando as bibliotecas necessárias
import clr

# Adicionando a referência ao Revit API e ao DocumentManager
clr.AddReference("RevitServices")
from RevitServices.Persistence import DocumentManager

clr.AddReference("RevitAPI")
from Autodesk.Revit.DB import Document

# Função para obter o nome do documento atual
def obter_nome_documento_atual():
    # Obtém o documento atual usando o DocumentManager
    doc_atual = DocumentManager.Instance.CurrentDBDocument
    if doc_atual is not None:
        return doc_atual.Title
    else:
        return "Nenhum documento ativo encontrado."

# Saída com o nome do documento atual
OUT = obter_nome_documento_atual()
# ----------------------------------------
eq = get_alldocuments.FileName == name
filterByBoolMask = List.FilterByBoolMask(list=get_alldocuments.FileName, mask=eq)
filterByBoolMask_2 = List.FilterByBoolMask(list=get_alldocuments.Document, mask=eq)
string_3 = StringInput("Selecione o Nível")
categories = Categories("OST_Levels")
all_elements_of_category = ElementsOfCategory(Category=categories)
name_2 = Level.Name(level=all_elements_of_category)
boolean = BoolSelector(false)
string_4 = StringInput("Tipo de Interruptor")
categories_2 = Categories("OST_LightingDevices")
obter_famílias_de_uma_categoria = Python(IN[0]=categories_2)  # "Obter Famílias de Uma Categoria - BIMACON"; IronPython2
# ---------- obter_famílias_de_uma_categoria.python (52 lines) ----------
import clr
import System

# Revit API
clr.AddReference('RevitAPI')
from Autodesk.Revit.DB import *

# RevitServices
clr.AddReference("RevitServices")
from RevitServices.Persistence import DocumentManager
from RevitServices.Transactions import TransactionManager

# RevitNodes para manipular categorias
clr.AddReference("RevitNodes")
import Revit
clr.ImportExtensions(Revit.Elements)

# Documento atual
doc = DocumentManager.Instance.CurrentDBDocument

# Função para obter BuiltInCategory de uma entrada
def obter_builtincategory(entrada):
    if isinstance(entrada, Category):
        return System.Enum.ToObject(BuiltInCategory, entrada.Id.IntegerValue)
    elif isinstance(entrada, int):
        return System.Enum.ToObject(BuiltInCategory, entrada)
    elif isinstance(entrada, BuiltInCategory):
        return entrada
    elif hasattr(entrada, "Id"):
        return System.Enum.ToObject(BuiltInCategory, entrada.Id.IntegerValue)
    else:
        return None

# Entrada
entrada = UnwrapElement(IN[0])
bic = obter_builtincategory(entrada)

# Coletar todas as famílias no documento
todas_familias = FilteredElementCollector(doc).OfClass(Family).ToElements()

# Filtrar famílias pela categoria
familias_filtradas = []
if bic:
    for fam in todas_familias:
        try:
            if fam.FamilyCategory.Id.IntegerValue == int(bic):
                familias_filtradas.append(fam)
        except:
            continue

# Saída
OUT = familias_filtradas
# ----------------------------------------
name_3 = Family.Name(family=obter_famílias_de_uma_categoria)
code_block_8 = CodeBlock { "Interruptor"; }
contains = String.Contains(string=name_3, searchFor=code_block_8)
filterByBoolMask_3 = List.FilterByBoolMask(list=obter_famílias_de_uma_categoria, mask=contains)
name_4 = Family.Name(family=filterByBoolMask_3.in)
code_block_9 = CodeBlock { "x."; }
contains_2 = String.Contains(string=name_4, searchFor=code_block_9)
filterByBoolMask_4 = List.FilterByBoolMask(list=filterByBoolMask_3.in, mask=contains_2)
types = Family.Types(family=filterByBoolMask_4.out)
flatten = List.Flatten(list=types)
family = FamilyType.Family(familyType=flatten)
name_5 = Family.Name(family=family)
sortByKey = List.SortByKey(list=flatten, keys=name_5)
code_block_10 = CodeBlock { "_"; }
split = String.Split(string=sortByKey.sortedKeys, separator0=code_block_10)
code_block_11 = CodeBlock { 1; 2; }
getItemAtIndex = List.GetItemAtIndex(list=split@L2, index=code_block_11.out0)
getItemAtIndex_2 = List.GetItemAtIndex(list=split@L2, index=code_block_11.out1)
code_block_12 = CodeBlock(x=getItemAtIndex, y=getItemAtIndex_2) { x+" "+y; }
name_6 = FamilyType.Name(familyType=sortByKey.sortedList)
code_block_13 = CodeBlock(a=code_block_12, b=name_6) { a; b; a+" : "+b; }
code_block_14 = CodeBlock { 2; }
dropdown_data = Custom[DropDown Data](InputName=string_4, Keys=code_block_13.out2, Values=sortByKey.sortedList, DefaultValueIndex=code_block_14)  # package Data-Shapes; Create data for DropDown input in UI.MultiInputForm ++ . Check out www.data-shapes.net for more infos.
string_5 = StringInput("Distância do Eixo da Porta (Aprox. Larg. da Porta - 25cm)")
string_6 = StringInput("0.55")
boolean_2 = BoolSelector(true)
textbox_data = Custom[TextBox Data](InputName=string_5, DefaultText=string_6, IsNumberEntry=boolean_2)  # package Data-Shapes; Create Data for TextBox input in UI.MultipleInputForm ++ . Check out www.data-shapes.net for more informations
string_7 = StringInput("Elevação do Ponto")
string_8 = StringInput("1.2")
boolean_3 = BoolSelector(true)
textbox_data_2 = Custom[TextBox Data](InputName=string_7, DefaultText=string_8, IsNumberEntry=boolean_3)
boolean_4 = BoolSelector(true)
string_9 = StringInput("Cancelar")
number_2 = DoubleInput(600)
number_3 = DoubleInput(205)

# group: ENTRADAS PARA O USUÁRIO > SELECIONE O MODELO ARQ LINKADO
code_block_15 = CodeBlock { "Selecione o link da Arquitetura"; }
code_block_16 = CodeBlock { 0; }
dropdown_data_2 = Custom[DropDown Data](InputName=code_block_15, Keys=filterByBoolMask.out, Values=filterByBoolMask_2.out, DefaultValueIndex=code_block_16)

# group (continued): ENTRADAS PARA O USUÁRIO
dropdown_data_3 = Custom[DropDown Data](InputName=string_3, Keys=name_2, Values=all_elements_of_category, DefaultValueIndex=code_block_16, Sorted_optional=boolean)
list_create = List.Create(item0=dropdown_data_2, item1=dropdown_data_3, item2=dropdown_data, item3=textbox_data, item4=textbox_data_2)
multipleinputform = Custom[MultipleInputForm ++](Description_optional=code_block_7, Logo_optional=readFromFile, ButtonText_optional=string_2, Inputs=list_create, Toggle=boolean_4, CancelButtonText_optional=string_9, Width_optional=number_2, LabelWidth_optional=number_3)  # package Data-Shapes; Create a form with multiple inputs. see www.data-shapes.net for tutorials and infos!

# group: Separar Entradas
code_block_17 = CodeBlock { 2; }
getItemAtIndex_3 = List.GetItemAtIndex(list=multipleinputform.User_Inputs, index=code_block_17)
code_block_18 = CodeBlock { 1; }
getItemAtIndex_4 = List.GetItemAtIndex(list=multipleinputform.User_Inputs, index=code_block_18)
code_block_19 = CodeBlock { 0; }
getItemAtIndex_5 = List.GetItemAtIndex(list=multipleinputform.User_Inputs, index=code_block_19)
code_block_20 = CodeBlock { 3; }
getItemAtIndex_6 = List.GetItemAtIndex(list=multipleinputform.User_Inputs, index=code_block_20)
code_block_21 = CodeBlock { 4; }
getItemAtIndex_7 = List.GetItemAtIndex(list=multipleinputform.User_Inputs, index=code_block_21)

# group: Espaços no Nível
categories_3 = Categories("OST_MEPSpaces")
all_elements_of_category_2 = ElementsOfCategory(Category=categories_3)
name_7 = Space.Name(space=all_elements_of_category_2)
code_block_22 = CodeBlock { ["Claraboia","Clarabóia"]; }
string_contains_varias_palavras = Python(IN[0]=name_7, IN[1]=code_block_22)  # IronPython2
# ---------- string_contains_varias_palavras.python (14 lines) ----------
# Entrada IN[0]: lista de nomes dos espaços
# Entrada IN[1]: lista de palavras-chave a remover

names = IN[0]
terms = IN[1]

outList = []

for name in names:
    # Verifica se qualquer termo está contido no nome (ignora maiúsculas/minúsculas)
    found = any(term.lower() in name.lower() for term in terms)
    outList.append(not found)  # True se NÃO contiver, ou seja, deve ser mantido

OUT = outList
# ----------------------------------------
filterByBoolMask_5 = List.FilterByBoolMask(list=all_elements_of_category_2, mask=string_contains_varias_palavras, lacing=Longest)
code_block_23 = CodeBlock { "Nível"; }
getParameterValueByName = Element.GetParameterValueByName(element=filterByBoolMask_5.in, parameterName=code_block_23)
name_8 = Level.Name(level=getItemAtIndex_4)
eq_2 = getParameterValueByName == name_8
filterByBoolMask_6 = List.FilterByBoolMask(list=filterByBoolMask_5.in, mask=eq_2)

finishBoundary = Space.FinishBoundary(space=filterByBoolMask_6.in)
byJoinedCurves = PolyCurve.ByJoinedCurves(curves=finishBoundary)
flatten_2 = List.Flatten(list=byJoinedCurves)
length = String.Length(string=name_8)
sub = length - number
remove = String.Remove(string=name_8, startIndex=sub, count=number)

# group: Portas
categories_4 = Categories("OST_Doors")
get_all_elements_from_linked = Custom[Get All Elements From Linked Model](linkDoc=getItemAtIndex_5, category=categories_4)  # package archi-lab.net; This node is based on code posted by Julien Benoit. Big thanks to Julien for sharing his work. This node will retrieve all elements of a given category from a given linked model.
name_9 = Element.Name(element=get_all_elements_from_linked)
string_10 = StringInput("Soleira")
contains_3 = String.Contains(string=name_9, searchFor=string_10)
filterByBoolMask_7 = List.FilterByBoolMask(list=get_all_elements_from_linked, mask=contains_3)
flatten_3 = List.Flatten(list=filterByBoolMask_7.out)
code_block_24 = CodeBlock { "Nível"; }
getParameterAsValueString = Custom[GetParameterAsValueString](Elements=flatten_3, ParameterName=code_block_24)  # package MEPover; Returns the parameter values without conversion to the revit internal unit system. The suffix boolean toggles the project units on or off
boolean_5 = BoolSelector(true)
contains_4 = String.Contains(string=getParameterAsValueString, searchFor=remove, ignoreCase=boolean_5)
filterByBoolMask_8 = List.FilterByBoolMask(list=flatten_3, mask=contains_4)
all_elements_of_category_3 = ElementsOfCategory(Category=categories_4)
name_10 = Element.Name(element=all_elements_of_category_3)
string_11 = StringInput("Soleira")
contains_5 = String.Contains(string=name_10, searchFor=string_11)
filterByBoolMask_9 = List.FilterByBoolMask(list=all_elements_of_category_3, mask=contains_5)
flatten_4 = List.Flatten(list=filterByBoolMask_9.out)
code_block_25 = CodeBlock { "Nível"; }
getParameterAsValueString_2 = Custom[GetParameterAsValueString](Elements=flatten_4, ParameterName=code_block_25)
boolean_6 = BoolSelector(true)
contains_6 = String.Contains(string=getParameterAsValueString_2, searchFor=remove, ignoreCase=boolean_6)
filterByBoolMask_10 = List.FilterByBoolMask(list=flatten_4, mask=contains_6)
list_create_2 = List.Create(item0=filterByBoolMask_8.in, item1=filterByBoolMask_10.in)
flatten_5 = List.Flatten(list=list_create_2)
uniqueItems = List.UniqueItems(list=flatten_5)
phases = Custom[Element.Phases](element=uniqueItems)  # package Clockwork for Dynamo 2.x; Gets the created and demolished phases of an element
name_11 = Element.Name(element=phases.Created)
code_block_26 = CodeBlock { ["New Construction","Nova Construcão","Nova Constrição"]; }
string_contains_varias_palavras_2 = Python(IN[0]=name_11, IN[1]=code_block_26)  # IronPython2; same code as string_contains_varias_palavras
filterByBoolMask_11 = List.FilterByBoolMask(list=uniqueItems, mask=string_contains_varias_palavras_2)
currentview = Custom[© CurrentView]()  # package Crumple; Given the current document, return the active view.
viewgetphase = Custom[© ViewGetPhase](view=currentview)  # package Crumple; Given a view or list of views, returns the phases applied to those views as elements.
door_set_handing = Custom[Door Set Handing](door=filterByBoolMask_11.out@L2, phase=viewgetphase@L1)  # package archi-lab.net; Determines door set handing (whether its a left or right handed door). Input takes doors, and output will split them into two lists (right and left).
flatten_6 = List.Flatten(list=door_set_handing.rightHandedReversed)
getLocation = Element.GetLocation(element=flatten_6)
flatten_7 = List.Flatten(list=door_set_handing.leftHandedReversed)
getLocation_2 = Element.GetLocation(element=flatten_7)

facingOrientation = FamilyInstance.FacingOrientation(familyInstance=flatten_6)
reverse = Vector.Reverse(vector=facingOrientation)

# group: Ponto da Porta DIREITA
# Descrição <Clique duas vezes aqui para editar a descrição do grupo>
deconstructPolyCurve = Geometry.Curves.DeconstructPolyCurve(polycurve=flatten_2)
closestTo = Custom[Geometry.ClosestTo](geometry=deconstructPolyCurve.Segments@L3, other=getLocation@L1, lacing=Longest)  # package Clockwork for Dynamo 2.x; Finds the closest entity in a list of geometric entities from another given entity
number_4 = DoubleInput(0.2)
compareByDistance = Geometry.Points.CompareByDistance(point1=getLocation, point2=closestTo.ClosestPoint, distance=number_4)
filterByBoolMask_12 = List.FilterByBoolMask(list=closestTo.ClosestPoint, mask=compareByDistance)
boolean_7 = BoolSelector(false)
clean = List.Clean(list=filterByBoolMask_12.in, preserveIndices=boolean_7)
firstItem = List.FirstItem(list=clean@L2)
byStartPointDirectionLength = Line.ByStartPointDirectionLength(startPoint=clean, direction=reverse)
endPoint = Curve.EndPoint(curve=byStartPointDirectionLength)
ꟿ_geometry_indexbydistance = Custom[ꟿ Geometry.IndexByDistance](geometry=endPoint, other=firstItem)  # package spring nodes; Provides the index of the closest or farthest geometry. Should prove faster than getting the geometry and finding its index in two separate operations.
getItemAtIndex_8 = List.GetItemAtIndex(list=firstItem, index=ꟿ_geometry_indexbydistance.index)
firstItem_2 = List.FirstItem(list=getItemAtIndex_8@L3)

cross = Vector.Cross(vector=facingOrientation, cross=ZAxis)
reverse_2 = Vector.Reverse(vector=cross)

# group: Posição Interruptor
# Descrição <Clique duas vezes aqui para editar a descrição do grupo>
translate = Geometry.Translate(geometry=firstItem_2, direction=reverse_2, distance=getItemAtIndex_6)
byPointAndLevel = FamilyInstance.ByPointAndLevel(familyType=getItemAtIndex_3, point=translate, level=getItemAtIndex_4, lacing=Longest)
string_12 = StringInput("Elevação do nível")
code_block_27 = CodeBlock { 0; }
setParameterByName = Element.SetParameterByName(element=byPointAndLevel, parameterName=string_12, value=code_block_27)
string_13 = StringInput("Elevação do Ponto")
setParameterByName_2 = Element.SetParameterByName(element=setParameterByName, parameterName=string_13, value=getItemAtIndex_7)
YAxis = Vector.YAxis()
ZAxis_3 = Vector.ZAxis()
angleAboutAxis = Vector.AngleAboutAxis(vector=reverse, otherVector=YAxis, rotationAxis=ZAxis_3)
round = Math.Round(number=angleAboutAxis)
setRotation = FamilyInstance.SetRotation(familyInstance=setParameterByName_2, degree=round)
flatten_8 = List.Flatten(list=setParameterByName_2)

end = Revit.Transaction.Transaction.End(input=setRotation)
start = Revit.Transaction.Transaction.Start(input=end)
facingOrientation_2 = FamilyInstance.FacingOrientation(familyInstance=flatten_7)
reverse_3 = Vector.Reverse(vector=facingOrientation_2)

# group: Ponto da Porta ESQUERDA
# Descrição <Clique duas vezes aqui para editar a descrição do grupo>
deconstructPolyCurve_2 = Geometry.Curves.DeconstructPolyCurve(polycurve=flatten_2)
closestTo_2 = Custom[Geometry.ClosestTo](geometry=deconstructPolyCurve_2.Segments@L3, other=getLocation_2@L1, lacing=Longest)
number_5 = DoubleInput(0.2)
compareByDistance_2 = Geometry.Points.CompareByDistance(point1=getLocation_2, point2=closestTo_2.ClosestPoint, distance=number_5)
filterByBoolMask_13 = List.FilterByBoolMask(list=closestTo_2.ClosestPoint, mask=compareByDistance_2)
boolean_8 = BoolSelector(false)
clean_2 = List.Clean(list=filterByBoolMask_13.in, preserveIndices=boolean_8)
firstItem_3 = List.FirstItem(list=clean_2@L2)
byStartPointDirectionLength_2 = Line.ByStartPointDirectionLength(startPoint=clean_2, direction=reverse_3)
endPoint_2 = Curve.EndPoint(curve=byStartPointDirectionLength_2)
ꟿ_geometry_indexbydistance_2 = Custom[ꟿ Geometry.IndexByDistance](geometry=endPoint_2, other=firstItem_3)
getItemAtIndex_9 = List.GetItemAtIndex(list=firstItem_3, index=ꟿ_geometry_indexbydistance_2.index)
firstItem_4 = List.FirstItem(list=getItemAtIndex_9@L3)

cross_2 = Vector.Cross(vector=facingOrientation_2, cross=ZAxis_2)

# group: Posição Interruptor
# Descrição <Clique duas vezes aqui para editar a descrição do grupo>
translate_2 = Geometry.Translate(geometry=firstItem_4, direction=cross_2, distance=getItemAtIndex_6)
byPointAndLevel_2 = FamilyInstance.ByPointAndLevel(familyType=getItemAtIndex_3, point=translate_2, level=getItemAtIndex_4, lacing=Longest)
string_14 = StringInput("Elevação do nível")
code_block_28 = CodeBlock { 0; }
setParameterByName_3 = Element.SetParameterByName(element=byPointAndLevel_2, parameterName=string_14, value=code_block_28)
string_15 = StringInput("Elevação do Ponto")
setParameterByName_4 = Element.SetParameterByName(element=setParameterByName_3, parameterName=string_15, value=getItemAtIndex_7)
YAxis_2 = Vector.YAxis()
ZAxis_4 = Vector.ZAxis()
angleAboutAxis_2 = Vector.AngleAboutAxis(vector=reverse_3, otherVector=YAxis_2, rotationAxis=ZAxis_4)
round_2 = Math.Round(number=angleAboutAxis_2)
setRotation_2 = FamilyInstance.SetRotation(familyInstance=setParameterByName_4, degree=round_2)
flatten_9 = List.Flatten(list=setParameterByName_4)

end_2 = Revit.Transaction.Transaction.End(input=setRotation_2)
start_2 = Revit.Transaction.Transaction.Start(input=end_2)
list_create_3 = List.Create(item0=start, item1=start_2)

# group: Mensagem final
flatten_10 = List.Flatten(list=list_create_3)
isNull = Object.IsNull(object=flatten_10)
code_block_29 = CodeBlock { 0; }
count = List.Count(list=flatten_10)
code_block_30 = CodeBlock(x=isNull, y=code_block_29, z=count)
# ---------- code_block_30.designscript (5 lines) ----------
//Condições se ou e
x;
y;
z;
x == true ? y : z;
# ----------------------------------------
passThrough = Custom[PassThrough](passThrough=code_block_30.out3, waitFor=list_create_3)  # package archi-lab.net; Ripped this off from Clockwork. Sorry Andy.
uniqueItems_2 = List.UniqueItems(list=passThrough)
code_block_31 = CodeBlock { 0; }
gt = uniqueItems_2 > code_block_31
code_block_32 = CodeBlock(N=uniqueItems_2) { ["Feito! Você inseriu "+N+" Interruptores em seu projeto. Deseja inverter o lado dos Interruptores?"]; }
code_block_33 = CodeBlock { ["Nenhum interruptor foi inserido"]; }
if_ = If(test=gt, true=code_block_32, false=code_block_33)
flatten_11 = List.Flatten(list=if_)
fromList = Python(IN[0]=flatten_11)  # "String.FromList"; IronPython2
# ---------- fromList.python (22 lines) ----------
# Carregar as bibliotecas DesignScript e padrão do Python
import sys
import clr
clr.AddReference('ProtoGeometry')
from Autodesk.DesignScript.Geometry import *

# Função para concatenar os valores de uma lista em uma única string com múltiplas linhas
def concatenate_list_to_string(input_list, delimiter="\n"):
    # Verifica se a entrada é uma lista
    if not isinstance(input_list, list):
        return "A entrada deve ser uma lista."
    
    # Converte todos os elementos para string e junta com o delimitador especificado
    result = delimiter.join(str(item) for item in input_list)
    return result

# Entrada pelo nó do Dynamo
lista = IN[0]  # Lista de valores a serem concatenados
delimitador = IN[1] if len(IN) > 1 else "\n"  # Delimitador opcional, padrão é nova linha

# Saída para o Dynamo
OUT = concatenate_list_to_string(lista, delimitador)
# ----------------------------------------
python_script_2 = Python(IN[0]=fromList)  # IronPython2
# ---------- python_script_2.python (30 lines) ----------
# Importando as bibliotecas necessárias da API do Revit
import clr
clr.AddReference('RevitServices')  # Referência aos serviços do Revit
from RevitServices.Persistence import DocumentManager

clr.AddReference('RevitAPI')  # Referência à API do Revit
clr.AddReference('RevitAPIUI')  # Referência à API de Interface de Usuário do Revit

from Autodesk.Revit.UI import TaskDialog, TaskDialogCommonButtons, TaskDialogResult

# Recebe o texto de instrução como entrada do nó
instrucoes = IN[0]

# Criando o TaskDialog
dialog = TaskDialog("Aviso")
dialog.MainInstruction = instrucoes
dialog.CommonButtons = TaskDialogCommonButtons.Yes | TaskDialogCommonButtons.No | TaskDialogCommonButtons.Close

# Exibindo o dialog para o usuário e capturando a resposta
resultado = dialog.Show()

# Interpretando a resposta
if resultado == TaskDialogResult.No:
    OUT = "Não"
elif resultado == TaskDialogResult.Yes:
    OUT = "Sim"
elif resultado == TaskDialogResult.Cancel:
    OUT = "Fechar"
else:
    OUT = "Nenhuma ação"
# ----------------------------------------

list_create_4 = List.Create(item0=flatten_8, item1=flatten_9)

# group: Inverter lado Interruptor
code_block_34 = CodeBlock { true; false; }
code_block_35 = CodeBlock(x=python_script_2, y=code_block_34.out0, z=code_block_34.out1)
# ---------- code_block_35.designscript (5 lines) ----------
//Condições IF, OR, AND
x;
y;
z;
x == "Sim" ? y : z;
# ----------------------------------------
watch = Watch(code_block_35.out3)
flatten_12 = List.Flatten(list=list_create_4)
passThrough_2 = Custom[PassThrough](passThrough=flatten_12, waitFor=code_block_35.out3)
code_block_36 = CodeBlock { []; }
condição_if_de_lista = CodeBlock(test=code_block_35.out3, verd=passThrough_2, fals=code_block_36)
# ---------- condição_if_de_lista.designscript (3 lines) ----------
//Condições IF
indx = (test) ? 0 : 1;
rslt = [verd,fals][indx];
# ----------------------------------------
delete = Element.Delete(element=condição_if_de_lista.rslt)

condição_if_de_lista_2 = CodeBlock(test=code_block_35.out3, verd=firstItem_2, fals=code_block)  # same code as condição_if_de_lista
condição_if_de_lista_3 = CodeBlock(test=code_block_35.out3, verd=cross, fals=code_block_2)  # same code as condição_if_de_lista

# group: Posição Interruptor
# Descrição <Clique duas vezes aqui para editar a descrição do grupo>
passThrough_3 = Custom[PassThrough](passThrough=condição_if_de_lista_2.rslt, waitFor=delete)
passThrough_4 = Custom[PassThrough](passThrough=condição_if_de_lista_3.rslt, waitFor=delete)
translate_3 = Geometry.Translate(geometry=passThrough_3, direction=passThrough_4, distance=getItemAtIndex_6)
byPointAndLevel_3 = FamilyInstance.ByPointAndLevel(familyType=getItemAtIndex_3, point=translate_3, level=getItemAtIndex_4, lacing=Longest)
string_16 = StringInput("Elevação do nível")
code_block_37 = CodeBlock { 0; }
setParameterByName_5 = Element.SetParameterByName(element=byPointAndLevel_3, parameterName=string_16, value=code_block_37)
string_17 = StringInput("Elevação do Ponto")
setParameterByName_6 = Element.SetParameterByName(element=setParameterByName_5, parameterName=string_17, value=getItemAtIndex_7)
flatten_13 = List.Flatten(list=setParameterByName_6)
YAxis_3 = Vector.YAxis()
ZAxis_5 = Vector.ZAxis()
angleAboutAxis_3 = Vector.AngleAboutAxis(vector=reverse, otherVector=YAxis_3, rotationAxis=ZAxis_5)
round_3 = Math.Round(number=angleAboutAxis_3)
setRotation_3 = FamilyInstance.SetRotation(familyInstance=setParameterByName_6, degree=round_3)

byStartPointDirectionLength_3 = Line.ByStartPointDirectionLength(startPoint=firstItem_2, direction=reverse_2)
condição_if_de_lista_4 = CodeBlock(test=code_block_35.out3, verd=firstItem_4, fals=code_block_3)  # same code as condição_if_de_lista
reverse_4 = Vector.Reverse(vector=cross_2)
condição_if_de_lista_5 = CodeBlock(test=code_block_35.out3, verd=reverse_4, fals=code_block_4)  # same code as condição_if_de_lista

# group: Posição Interruptor
# Descrição <Clique duas vezes aqui para editar a descrição do grupo>
passThrough_5 = Custom[PassThrough](passThrough=condição_if_de_lista_4.rslt, waitFor=delete)
passThrough_6 = Custom[PassThrough](passThrough=condição_if_de_lista_5.rslt, waitFor=delete)
translate_4 = Geometry.Translate(geometry=passThrough_5, direction=passThrough_6, distance=getItemAtIndex_6)
byPointAndLevel_4 = FamilyInstance.ByPointAndLevel(familyType=getItemAtIndex_3, point=translate_4, level=getItemAtIndex_4, lacing=Longest)
string_18 = StringInput("Elevação do nível")
code_block_38 = CodeBlock { 0; }
setParameterByName_7 = Element.SetParameterByName(element=byPointAndLevel_4, parameterName=string_18, value=code_block_38)
string_19 = StringInput("Elevação do Ponto")
setParameterByName_8 = Element.SetParameterByName(element=setParameterByName_7, parameterName=string_19, value=getItemAtIndex_7)
flatten_14 = List.Flatten(list=setParameterByName_8)
YAxis_4 = Vector.YAxis()
ZAxis_6 = Vector.ZAxis()
angleAboutAxis_4 = Vector.AngleAboutAxis(vector=reverse_3, otherVector=YAxis_4, rotationAxis=ZAxis_6)
round_4 = Math.Round(number=angleAboutAxis_4)
setRotation_4 = FamilyInstance.SetRotation(familyInstance=setParameterByName_8, degree=round_4)

delete_2 = archilab.Revit.Elements.Elements.Delete(element=condição_if_de_lista.rslt)  # frozen
byStartPointDirectionLength_4 = Line.ByStartPointDirectionLength(startPoint=firstItem_4, direction=cross_2)
name_12 = Space.Name(space=filterByBoolMask_5.out)
phase_filter_byname = Custom[Phase Filter ByName](Name=viewgetphase)  # package Genius Loci; Enter the name of the phase filter to get the phase filter element.
