# Dynamo graph ok 04-2_BIMACON_Inserir Interruptor ao lado de portas todos Espaços_R04_script.dyn (Dynamo 2.19.3.6394)
# author: Jose Nelson
# Inseri Interruptores ao lado de portas de arquivos Linkados
# packages: archi-lab.net 2023.213.1722, Data-Shapes 2022.2.105, Clockwork for Dynamo 2.x 2.4.0, Genius Loci 2023.2.21

ZAxis = Vector.ZAxis()
code_block = CodeBlock { []; }
code_block_2 = CodeBlock { []; }

# group: ENTRADAS PARA O USUÁRIO
code_block_3 = CodeBlock()  # //archilab
code_block_4 = CodeBlock()  # //Data-Shapes
code_block_5 = CodeBlock { "Inserção de Interruptor ao lado de portas em todos Espaços"; }
file_path = Filename("C:\Users\jneng\AppData\Roaming\pyRevit\Extensions\Bimacon.extension\Bimacon.tab\LogoBimacon.png")
file_from_path = FileObject(path=file_path)
readFromFile = Image.ReadFromFile(file=file_from_path)
string = StringInput("Confirmar")
get_alldocuments = Custom[Get AllDocuments]()  # package Genius Loci; Get documents (linked and opened in background). The first document is the active document.
current = Document.Current()
string_2 = StringInput("Selecione o Nível")
categories = Categories("OST_Levels")
all_elements_of_category = ElementsOfCategory(Category=categories)
name = Level.Name(level=all_elements_of_category)
boolean = BoolSelector(false)
string_3 = StringInput("Tipo de Interruptor")
categories_2 = Categories("OST_LightingDevices")
all_families_of_category = Custom[All Families Of Category](category=categories_2)  # package Clockwork for Dynamo 2.x; Gets all famiies of a given category in the model (does *not *work for system families)
name_2 = Family.Name(family=all_families_of_category)
code_block_6 = CodeBlock { "Interruptor"; }
contains = String.Contains(string=name_2, searchFor=code_block_6)
filterByBoolMask = List.FilterByBoolMask(list=all_families_of_category, mask=contains)
name_3 = Family.Name(family=filterByBoolMask.in)
code_block_7 = CodeBlock { "x."; }
contains_2 = String.Contains(string=name_3, searchFor=code_block_7)
filterByBoolMask_2 = List.FilterByBoolMask(list=filterByBoolMask.in, mask=contains_2)
types = Family.Types(family=filterByBoolMask_2.out)
flatten = List.Flatten(list=types)
family = FamilyType.Family(familyType=flatten)
name_4 = Family.Name(family=family)
code_block_8 = CodeBlock { "_"; }
split = String.Split(string=name_4, separator0=code_block_8)
code_block_9 = CodeBlock { 1; 2; }
getItemAtIndex = List.GetItemAtIndex(list=split@L2, index=code_block_9.out0)
getItemAtIndex_2 = List.GetItemAtIndex(list=split@L2, index=code_block_9.out1)
code_block_10 = CodeBlock(x=getItemAtIndex, y=getItemAtIndex_2) { x+" "+y; }
name_5 = FamilyType.Name(familyType=flatten)
code_block_11 = CodeBlock(a=code_block_10, b=name_5) { a; b; a+" : "+b; }
code_block_12 = CodeBlock { 8; }
dropdown_data = Custom[DropDown Data](InputName=string_3, Keys=code_block_11.out2, Values=flatten, DefaultValueIndex=code_block_12)  # package Data-Shapes; Create data for DropDown input in UI.MultiInputForm ++ . Check out www.data-shapes.net for more infos.
string_4 = StringInput("Distância do Eixo da Porta (Aprox. Larg. da Porta - 20cm)")
string_5 = StringInput("0.6")
boolean_2 = BoolSelector(true)
textbox_data = Custom[TextBox Data](InputName=string_4, DefaultText=string_5, IsNumberEntry=boolean_2)  # package Data-Shapes; Create Data for TextBox input in UI.MultipleInputForm ++ . Check out www.data-shapes.net for more informations
string_6 = StringInput("Elevação do Ponto")
string_7 = StringInput("1.2")
boolean_3 = BoolSelector(true)
textbox_data_2 = Custom[TextBox Data](InputName=string_6, DefaultText=string_7, IsNumberEntry=boolean_3)
boolean_4 = BoolSelector(true)
string_8 = StringInput("Cancelar")
number = DoubleInput(600)
number_2 = DoubleInput(205)

name_6 = Python(IN[0]=current)  # "Document.Name"; IronPython2
# ---------- name_6.python (27 lines) ----------
# Carregar as bibliotecas DesignScript e padrão do Python
import sys
import clr
clr.AddReference('ProtoGeometry')
from Autodesk.DesignScript.Geometry import *

# Importando as bibliotecas necessárias
import clr

# Adicionando a referência ao Revit API e ao DocumentManager
clr.AddReference("RevitServices")
from RevitServices.Persistence import DocumentManager

clr.AddReference("RevitAPI")
from Autodesk.Revit.DB import Document

# Função para obter o nome do documento atual
def obter_nome_documento_atual():
    # Obtém o documento atual usando o DocumentManager
    doc_atual = DocumentManager.Instance.CurrentDBDocument
    if doc_atual is not None:
        return doc_atual.Title
    else:
        return "Nenhum documento ativo encontrado."

# Saída com o nome do documento atual
OUT = obter_nome_documento_atual()
# ----------------------------------------

# group (continued): ENTRADAS PARA O USUÁRIO
eq = get_alldocuments.FileName == name_6
filterByBoolMask_3 = List.FilterByBoolMask(list=get_alldocuments.FileName, mask=eq)
filterByBoolMask_4 = List.FilterByBoolMask(list=get_alldocuments.Document, mask=eq)

# group: SELECIONE O MODELO ARQ LINKADO
code_block_13 = CodeBlock { "Selecione o link da Arquitetura"; }
code_block_14 = CodeBlock { 0; }
dropdown_data_2 = Custom[DropDown Data](InputName=code_block_13, Keys=filterByBoolMask_3.out, Values=filterByBoolMask_4.out, DefaultValueIndex=code_block_14)

# group (continued): ENTRADAS PARA O USUÁRIO
dropdown_data_3 = Custom[DropDown Data](InputName=string_2, Keys=name, Values=all_elements_of_category, DefaultValueIndex=code_block_14, Sorted_optional=boolean)
list_create = List.Create(item0=dropdown_data_2, item1=dropdown_data_3, item2=dropdown_data, item3=textbox_data, item4=textbox_data_2)
multipleinputform = Custom[MultipleInputForm ++](Description_optional=code_block_5, Logo_optional=readFromFile, ButtonText_optional=string, Inputs=list_create, Toggle=boolean_4, CancelButtonText_optional=string_8, Width_optional=number, LabelWidth_optional=number_2)  # package Data-Shapes; Create a form with multiple inputs. see www.data-shapes.net for tutorials and infos!

# group: Separar Entradas
code_block_15 = CodeBlock { 2; }
getItemAtIndex_3 = List.GetItemAtIndex(list=multipleinputform.User_Inputs, index=code_block_15)
code_block_16 = CodeBlock { 1; }
getItemAtIndex_4 = List.GetItemAtIndex(list=multipleinputform.User_Inputs, index=code_block_16)
code_block_17 = CodeBlock { 0; }
getItemAtIndex_5 = List.GetItemAtIndex(list=multipleinputform.User_Inputs, index=code_block_17)
code_block_18 = CodeBlock { 3; }
getItemAtIndex_6 = List.GetItemAtIndex(list=multipleinputform.User_Inputs, index=code_block_18)
code_block_19 = CodeBlock { 4; }
getItemAtIndex_7 = List.GetItemAtIndex(list=multipleinputform.User_Inputs, index=code_block_19)

# group: Espaços no Nível
categories_3 = Categories("OST_MEPSpaces")
all_elements_of_category_2 = ElementsOfCategory(Category=categories_3)
code_block_20 = CodeBlock { "Nível"; }
getParameterValueByName = Element.GetParameterValueByName(element=all_elements_of_category_2, parameterName=code_block_20)
name_7 = Level.Name(level=getItemAtIndex_4)
eq_2 = getParameterValueByName == name_7
filterByBoolMask_5 = List.FilterByBoolMask(list=all_elements_of_category_2, mask=eq_2)

finishBoundary = Space.FinishBoundary(space=filterByBoolMask_5.in)
byJoinedCurves = PolyCurve.ByJoinedCurves(curves=finishBoundary)
flatten_2 = List.Flatten(list=byJoinedCurves)

# group: Portas
categories_4 = Categories("OST_Doors")
get_all_elements_from_linked = Custom[Get All Elements From Linked Model](linkDoc=getItemAtIndex_5, category=categories_4)  # package archi-lab.net; This node is based on code posted by Julien Benoit. Big thanks to Julien for sharing his work. This node will retrieve all elements of a given category from a given linked model.
name_8 = Element.Name(element=get_all_elements_from_linked)
string_9 = StringInput("Soleira")
contains_3 = String.Contains(string=name_8, searchFor=string_9)
filterByBoolMask_6 = List.FilterByBoolMask(list=get_all_elements_from_linked, mask=contains_3)
all_elements_of_category_3 = ElementsOfCategory(Category=categories_4)
subComponents = archilab.Revit.Elements.Elements.SubComponents(element=all_elements_of_category_3)
contains_4 = List.Contains(list=subComponents, item=all_elements_of_category_3@L1)
filterByBoolMask_7 = List.FilterByBoolMask(list=all_elements_of_category_3, mask=contains_4)
list_create_2 = List.Create(item0=filterByBoolMask_6.out, item1=filterByBoolMask_7.out)
flatten_3 = List.Flatten(list=list_create_2)
getLocation = Element.GetLocation(element=flatten_3)

closestTo = Custom[Geometry.ClosestTo](geometry=flatten_2, other=getLocation)  # package Clockwork for Dynamo 2.x; Finds the closest entity in a list of geometric entities from another given entity
firstItem = List.FirstItem(list=closestTo.ClosestPoint@L2)
facingOrientation = FamilyInstance.FacingOrientation(familyInstance=flatten_3)
cross = Vector.Cross(vector=facingOrientation, cross=ZAxis)
reverse = Vector.Reverse(vector=cross)

# group: Posição Interruptor
# Descrição <Clique duas vezes aqui para editar a descrição do grupo>
translate = Geometry.Translate(geometry=firstItem, direction=reverse, distance=getItemAtIndex_6)
byPointAndLevel = FamilyInstance.ByPointAndLevel(familyType=getItemAtIndex_3, point=translate, level=getItemAtIndex_4, lacing=Longest)
string_10 = StringInput("Elevação do nível")
code_block_21 = CodeBlock { 0; }
setParameterByName = Element.SetParameterByName(element=byPointAndLevel, parameterName=string_10, value=code_block_21)
string_11 = StringInput("Elevação do Ponto")
setParameterByName_2 = Element.SetParameterByName(element=setParameterByName, parameterName=string_11, value=getItemAtIndex_7)
YAxis = Vector.YAxis()
ZAxis_2 = Vector.ZAxis()
angleAboutAxis = Vector.AngleAboutAxis(vector=facingOrientation, otherVector=YAxis, rotationAxis=ZAxis_2)
setRotation = FamilyInstance.SetRotation(familyInstance=setParameterByName_2, degree=angleAboutAxis)
flatten_4 = List.Flatten(list=setParameterByName_2)

# group: Mensagem final
end = Revit.Transaction.Transaction.End(input=setRotation)
start = Revit.Transaction.Transaction.Start(input=end)
flatten_5 = List.Flatten(list=start)
isNull = Object.IsNull(object=flatten_5)
code_block_22 = CodeBlock { 0; }
count = List.Count(list=flatten_5)
code_block_23 = CodeBlock(x=isNull, y=code_block_22, z=count)
# ---------- code_block_23.designscript (5 lines) ----------
//Condições se ou e
x;
y;
z;
x == true ? y : z;
# ----------------------------------------
passThrough = Custom[PassThrough](passThrough=code_block_23.out3, waitFor=start)  # package archi-lab.net; Ripped this off from Clockwork. Sorry Andy.
uniqueItems = List.UniqueItems(list=passThrough)
code_block_24 = CodeBlock { 0; }
gt = uniqueItems > code_block_24
code_block_25 = CodeBlock(N=uniqueItems) { ["Feito! Você inseriu "+N+" Interruptores em seu projeto. Deseja inverter o lado dos Interruptores?"]; }
code_block_26 = CodeBlock { ["Nenhum interruptor foi inserido"]; }
if_ = If(test=gt, true=code_block_25, false=code_block_26)
flatten_6 = List.Flatten(list=if_)
fromList = Python(IN[0]=flatten_6)  # "String.FromList"; IronPython2
# ---------- fromList.python (22 lines) ----------
# Carregar as bibliotecas DesignScript e padrão do Python
import sys
import clr
clr.AddReference('ProtoGeometry')
from Autodesk.DesignScript.Geometry import *

# Função para concatenar os valores de uma lista em uma única string com múltiplas linhas
def concatenate_list_to_string(input_list, delimiter="\n"):
    # Verifica se a entrada é uma lista
    if not isinstance(input_list, list):
        return "A entrada deve ser uma lista."
    
    # Converte todos os elementos para string e junta com o delimitador especificado
    result = delimiter.join(str(item) for item in input_list)
    return result

# Entrada pelo nó do Dynamo
lista = IN[0]  # Lista de valores a serem concatenados
delimitador = IN[1] if len(IN) > 1 else "\n"  # Delimitador opcional, padrão é nova linha

# Saída para o Dynamo
OUT = concatenate_list_to_string(lista, delimitador)
# ----------------------------------------
python_script = Python(IN[0]=fromList)  # IronPython2
# ---------- python_script.python (30 lines) ----------
# Importando as bibliotecas necessárias da API do Revit
import clr
clr.AddReference('RevitServices')  # Referência aos serviços do Revit
from RevitServices.Persistence import DocumentManager

clr.AddReference('RevitAPI')  # Referência à API do Revit
clr.AddReference('RevitAPIUI')  # Referência à API de Interface de Usuário do Revit

from Autodesk.Revit.UI import TaskDialog, TaskDialogCommonButtons, TaskDialogResult

# Recebe o texto de instrução como entrada do nó
instrucoes = IN[0]

# Criando o TaskDialog
dialog = TaskDialog("Aviso")
dialog.MainInstruction = instrucoes
dialog.CommonButtons = TaskDialogCommonButtons.Yes | TaskDialogCommonButtons.No | TaskDialogCommonButtons.Close

# Exibindo o dialog para o usuário e capturando a resposta
resultado = dialog.Show()

# Interpretando a resposta
if resultado == TaskDialogResult.No:
    OUT = "Não"
elif resultado == TaskDialogResult.Yes:
    OUT = "Sim"
elif resultado == TaskDialogResult.Cancel:
    OUT = "Fechar"
else:
    OUT = "Nenhuma ação"
# ----------------------------------------

# group: Inverter lado Interruptor
code_block_27 = CodeBlock { true; false; }
code_block_28 = CodeBlock(x=python_script, y=code_block_27.out0, z=code_block_27.out1)
# ---------- code_block_28.designscript (5 lines) ----------
//Condições IF, OR, AND
x;
y;
z;
x == "Sim" ? y : z;
# ----------------------------------------
watch = Watch(code_block_28.out3)
passThrough_2 = Custom[PassThrough](passThrough=flatten_4, waitFor=code_block_28.out3)
code_block_29 = CodeBlock { []; }
condição_if_de_lista = CodeBlock(test=code_block_28.out3, verd=passThrough_2, fals=code_block_29)
# ---------- condição_if_de_lista.designscript (3 lines) ----------
//Condições IF
indx = (test) ? 0 : 1;
rslt = [verd,fals][indx];
# ----------------------------------------
delete = Element.Delete(element=condição_if_de_lista.rslt)

condição_if_de_lista_2 = CodeBlock(test=code_block_28.out3, verd=firstItem, fals=code_block)  # same code as condição_if_de_lista
condição_if_de_lista_3 = CodeBlock(test=code_block_28.out3, verd=cross, fals=code_block_2)  # same code as condição_if_de_lista

# group: Posição Interruptor
# Descrição <Clique duas vezes aqui para editar a descrição do grupo>
passThrough_3 = Custom[PassThrough](passThrough=condição_if_de_lista_2.rslt, waitFor=delete)
passThrough_4 = Custom[PassThrough](passThrough=condição_if_de_lista_3.rslt, waitFor=delete)
translate_2 = Geometry.Translate(geometry=passThrough_3, direction=passThrough_4, distance=getItemAtIndex_6)
byPointAndLevel_2 = FamilyInstance.ByPointAndLevel(familyType=getItemAtIndex_3, point=translate_2, level=getItemAtIndex_4, lacing=Longest)
string_12 = StringInput("Elevação do nível")
code_block_30 = CodeBlock { 0; }
setParameterByName_3 = Element.SetParameterByName(element=byPointAndLevel_2, parameterName=string_12, value=code_block_30)
string_13 = StringInput("Elevação do Ponto")
setParameterByName_4 = Element.SetParameterByName(element=setParameterByName_3, parameterName=string_13, value=getItemAtIndex_7)
flatten_7 = List.Flatten(list=setParameterByName_4)
YAxis_2 = Vector.YAxis()
ZAxis_3 = Vector.ZAxis()
angleAboutAxis_2 = Vector.AngleAboutAxis(vector=facingOrientation, otherVector=YAxis_2, rotationAxis=ZAxis_3)
setRotation_2 = FamilyInstance.SetRotation(familyInstance=setParameterByName_4, degree=angleAboutAxis_2)
