# Dynamo graph ok 04-2_BIMACON_Inserir Interruptor ao lado de portas todos Espaços_R05_script.dyn "ok 04-2_BIMACON_Inserir Interruptor ao lado de portas todos Espaços_R04_script" (Dynamo 2.19.3.6394)
# author: Jose Nelson
# Inseri Interruptores ao lado de portas de arquivos Linkados
# packages: Data-Shapes 2022.2.105, Clockwork for Dynamo 2.x 2.4.0, archi-lab.net 2023.213.1722, Genius Loci 2023.2.21, MEPover 2022.10.30, DynaMEP 2.0.1, spring nodes 210.1.1

number = DoubleInput(6)
ZAxis = Vector.ZAxis()
ZAxis_2 = Vector.ZAxis()
code_block = CodeBlock { []; }
code_block_2 = CodeBlock { []; }
code_block_3 = CodeBlock { []; }
code_block_4 = CodeBlock { []; }

# group: ENTRADAS PARA O USUÁRIO
code_block_5 = CodeBlock()  # //archilab
code_block_6 = CodeBlock()  # //Data-Shapes
code_block_7 = CodeBlock { "Inserção de Interruptor ao lado de portas em todos Espaços"; }
file_path = Filename("C:\Users\jneng\AppData\Roaming\pyRevit\Extensions\Bimacon.extension\Bimacon.tab\LogoBimacon.png")
file_from_path = FileObject(path=file_path)
readFromFile = Image.ReadFromFile(file=file_from_path)
string = StringInput("Confirmar")
get_alldocuments = Custom[Get AllDocuments]()  # package Genius Loci; Get documents (linked and opened in background). The first document is the active document.
current = Document.Current()
name = Python(IN[0]=current)  # "Document.Name"; IronPython2
# ---------- name.python (27 lines) ----------
# Carregar as bibliotecas DesignScript e padrão do Python
import sys
import clr
clr.AddReference('ProtoGeometry')
from Autodesk.DesignScript.Geometry import *

# Importando as bibliotecas necessárias
import clr

# Adicionando a referência ao Revit API e ao DocumentManager
clr.AddReference("RevitServices")
from RevitServices.Persistence import DocumentManager

clr.AddReference("RevitAPI")
from Autodesk.Revit.DB import Document

# Função para obter o nome do documento atual
def obter_nome_documento_atual():
    # Obtém o documento atual usando o DocumentManager
    doc_atual = DocumentManager.Instance.CurrentDBDocument
    if doc_atual is not None:
        return doc_atual.Title
    else:
        return "Nenhum documento ativo encontrado."

# Saída com o nome do documento atual
OUT = obter_nome_documento_atual()
# ----------------------------------------
eq = get_alldocuments.FileName == name
filterByBoolMask = List.FilterByBoolMask(list=get_alldocuments.FileName, mask=eq)
filterByBoolMask_2 = List.FilterByBoolMask(list=get_alldocuments.Document, mask=eq)
string_2 = StringInput("Selecione o Nível")
categories = Categories("OST_Levels")
all_elements_of_category = ElementsOfCategory(Category=categories)
name_2 = Level.Name(level=all_elements_of_category)
boolean = BoolSelector(false)
string_3 = StringInput("Tipo de Interruptor")
categories_2 = Categories("OST_LightingDevices")
all_families_of_category = Custom[All Families Of Category](category=categories_2)  # package Clockwork for Dynamo 2.x; Gets all famiies of a given category in the model (does *not *work for system families)
name_3 = Family.Name(family=all_families_of_category)
code_block_8 = CodeBlock { "Interruptor"; }
contains = String.Contains(string=name_3, searchFor=code_block_8)
filterByBoolMask_3 = List.FilterByBoolMask(list=all_families_of_category, mask=contains)
name_4 = Family.Name(family=filterByBoolMask_3.in)
code_block_9 = CodeBlock { "x."; }
contains_2 = String.Contains(string=name_4, searchFor=code_block_9)
filterByBoolMask_4 = List.FilterByBoolMask(list=filterByBoolMask_3.in, mask=contains_2)
types = Family.Types(family=filterByBoolMask_4.out)
flatten = List.Flatten(list=types)
family = FamilyType.Family(familyType=flatten)
name_5 = Family.Name(family=family)
code_block_10 = CodeBlock { "_"; }
split = String.Split(string=name_5, separator0=code_block_10)
code_block_11 = CodeBlock { 1; 2; }
getItemAtIndex = List.GetItemAtIndex(list=split@L2, index=code_block_11.out0)
getItemAtIndex_2 = List.GetItemAtIndex(list=split@L2, index=code_block_11.out1)
code_block_12 = CodeBlock(x=getItemAtIndex, y=getItemAtIndex_2) { x+" "+y; }
name_6 = FamilyType.Name(familyType=flatten)
code_block_13 = CodeBlock(a=code_block_12, b=name_6) { a; b; a+" : "+b; }
code_block_14 = CodeBlock { 8; }
dropdown_data = Custom[DropDown Data](InputName=string_3, Keys=code_block_13.out2, Values=flatten, DefaultValueIndex=code_block_14)  # package Data-Shapes; Create data for DropDown input in UI.MultiInputForm ++ . Check out www.data-shapes.net for more infos.
string_4 = StringInput("Distância do Eixo da Porta (Aprox. Larg. da Porta - 20cm)")
string_5 = StringInput("0.5")
boolean_2 = BoolSelector(true)
textbox_data = Custom[TextBox Data](InputName=string_4, DefaultText=string_5, IsNumberEntry=boolean_2)  # package Data-Shapes; Create Data for TextBox input in UI.MultipleInputForm ++ . Check out www.data-shapes.net for more informations
string_6 = StringInput("Elevação do Ponto")
string_7 = StringInput("1.2")
boolean_3 = BoolSelector(true)
textbox_data_2 = Custom[TextBox Data](InputName=string_6, DefaultText=string_7, IsNumberEntry=boolean_3)
boolean_4 = BoolSelector(true)
string_8 = StringInput("Cancelar")
number_2 = DoubleInput(600)
number_3 = DoubleInput(205)

# group: SELECIONE O MODELO ARQ LINKADO
code_block_15 = CodeBlock { "Selecione o link da Arquitetura"; }
code_block_16 = CodeBlock { 0; }
dropdown_data_2 = Custom[DropDown Data](InputName=code_block_15, Keys=filterByBoolMask.out, Values=filterByBoolMask_2.out, DefaultValueIndex=code_block_16)

# group (continued): ENTRADAS PARA O USUÁRIO
dropdown_data_3 = Custom[DropDown Data](InputName=string_2, Keys=name_2, Values=all_elements_of_category, DefaultValueIndex=code_block_16, Sorted_optional=boolean)
list_create = List.Create(item0=dropdown_data_2, item1=dropdown_data_3, item2=dropdown_data, item3=textbox_data, item4=textbox_data_2)
multipleinputform = Custom[MultipleInputForm ++](Description_optional=code_block_7, Logo_optional=readFromFile, ButtonText_optional=string, Inputs=list_create, Toggle=boolean_4, CancelButtonText_optional=string_8, Width_optional=number_2, LabelWidth_optional=number_3)  # package Data-Shapes; Create a form with multiple inputs. see www.data-shapes.net for tutorials and infos!

# group: Separar Entradas
code_block_17 = CodeBlock { 2; }
getItemAtIndex_3 = List.GetItemAtIndex(list=multipleinputform.User_Inputs, index=code_block_17)
code_block_18 = CodeBlock { 1; }
getItemAtIndex_4 = List.GetItemAtIndex(list=multipleinputform.User_Inputs, index=code_block_18)
code_block_19 = CodeBlock { 0; }
getItemAtIndex_5 = List.GetItemAtIndex(list=multipleinputform.User_Inputs, index=code_block_19)
code_block_20 = CodeBlock { 3; }
getItemAtIndex_6 = List.GetItemAtIndex(list=multipleinputform.User_Inputs, index=code_block_20)
code_block_21 = CodeBlock { 4; }
getItemAtIndex_7 = List.GetItemAtIndex(list=multipleinputform.User_Inputs, index=code_block_21)

# group: Espaços no Nível
categories_3 = Categories("OST_MEPSpaces")
all_elements_of_category_2 = ElementsOfCategory(Category=categories_3)
code_block_22 = CodeBlock { "Nível"; }
getParameterValueByName = Element.GetParameterValueByName(element=all_elements_of_category_2, parameterName=code_block_22)
name_7 = Level.Name(level=getItemAtIndex_4)
eq_2 = getParameterValueByName == name_7
filterByBoolMask_5 = List.FilterByBoolMask(list=all_elements_of_category_2, mask=eq_2)

finishBoundary = Space.FinishBoundary(space=filterByBoolMask_5.in)
byJoinedCurves = PolyCurve.ByJoinedCurves(curves=finishBoundary)
flatten_2 = List.Flatten(list=byJoinedCurves)
length = String.Length(string=name_7)
sub = length - number
remove = String.Remove(string=name_7, startIndex=sub, count=number)

# group: Portas
categories_4 = Categories("OST_Doors")
get_all_elements_from_linked = Custom[Get All Elements From Linked Model](linkDoc=getItemAtIndex_5, category=categories_4)  # package archi-lab.net; This node is based on code posted by Julien Benoit. Big thanks to Julien for sharing his work. This node will retrieve all elements of a given category from a given linked model.
name_8 = Element.Name(element=get_all_elements_from_linked)
string_9 = StringInput("Soleira")
contains_3 = String.Contains(string=name_8, searchFor=string_9)
filterByBoolMask_6 = List.FilterByBoolMask(list=get_all_elements_from_linked, mask=contains_3)
flatten_3 = List.Flatten(list=filterByBoolMask_6.out)
code_block_23 = CodeBlock { "Nível"; }
getParameterAsValueString = Custom[GetParameterAsValueString](Elements=flatten_3, ParameterName=code_block_23)  # package MEPover; Returns the parameter values without conversion to the revit internal unit system. The suffix boolean toggles the project units on or off
boolean_5 = BoolSelector(true)
contains_4 = String.Contains(string=getParameterAsValueString, searchFor=remove, ignoreCase=boolean_5)
filterByBoolMask_7 = List.FilterByBoolMask(list=flatten_3, mask=contains_4)
select_phase = RevitPhases("Existing")
door_set_handing = Custom[Door Set Handing](door=filterByBoolMask_7.in, phase=select_phase)  # package archi-lab.net; Determines door set handing (whether its a left or right handed door). Input takes doors, and output will split them into two lists (right and left).
getLocation = Element.GetLocation(element=door_set_handing.rightHandedReversed)
getLocation_2 = Element.GetLocation(element=door_set_handing.leftHandedReversed)
getParameterValueByName_2 = Element.GetParameterValueByName()  # unwired: element, parameterName
name_9 = Level.Name(level=getParameterValueByName_2)
flatten_4 = List.Flatten()  # unwired: list
all_elements_of_category_3 = ElementsOfCategory(Category=categories_4)
subComponents = archilab.Revit.Elements.Elements.SubComponents(element=all_elements_of_category_3)
contains_5 = List.Contains(list=subComponents, item=all_elements_of_category_3@L1)
filterByBoolMask_8 = List.FilterByBoolMask(list=all_elements_of_category_3, mask=contains_5)
list_create_2 = List.Create(item0=flatten_3, item1=filterByBoolMask_8.out)

facingOrientation = FamilyInstance.FacingOrientation(familyInstance=door_set_handing.rightHandedReversed)
reverse = Vector.Reverse(vector=facingOrientation)

# group: Ponto da Porta DIREITA
# Descrição <Clique duas vezes aqui para editar a descrição do grupo>
deconstructPolyCurve = Geometry.Curves.DeconstructPolyCurve(polycurve=flatten_2)
closestTo = Custom[Geometry.ClosestTo](geometry=deconstructPolyCurve.Segments@L3, other=getLocation@L1, lacing=Longest)  # package Clockwork for Dynamo 2.x; Finds the closest entity in a list of geometric entities from another given entity
number_4 = DoubleInput(0.2)
compareByDistance = Geometry.Points.CompareByDistance(point1=getLocation, point2=closestTo.ClosestPoint, distance=number_4)
filterByBoolMask_9 = List.FilterByBoolMask(list=closestTo.ClosestPoint, mask=compareByDistance)
boolean_6 = BoolSelector(false)
clean = List.Clean(list=filterByBoolMask_9.in, preserveIndices=boolean_6)
firstItem = List.FirstItem(list=clean@L2)
byStartPointDirectionLength = Line.ByStartPointDirectionLength(startPoint=clean, direction=reverse)
endPoint = Curve.EndPoint(curve=byStartPointDirectionLength)
ꟿ_geometry_indexbydistance = Custom[ꟿ Geometry.IndexByDistance](geometry=endPoint, other=firstItem)  # package spring nodes; Provides the index of the closest or farthest geometry. Should prove faster than getting the geometry and finding its index in two separate operations.
getItemAtIndex_8 = List.GetItemAtIndex(list=firstItem, index=ꟿ_geometry_indexbydistance.index)
firstItem_2 = List.FirstItem(list=getItemAtIndex_8@L3)

cross = Vector.Cross(vector=facingOrientation, cross=ZAxis)
reverse_2 = Vector.Reverse(vector=cross)

# group: Posição Interruptor
# Descrição <Clique duas vezes aqui para editar a descrição do grupo>
translate = Geometry.Translate(geometry=firstItem_2, direction=reverse_2, distance=getItemAtIndex_6)
byPointAndLevel = FamilyInstance.ByPointAndLevel(familyType=getItemAtIndex_3, point=translate, level=getItemAtIndex_4, lacing=Longest)
string_10 = StringInput("Elevação do nível")
code_block_24 = CodeBlock { 0; }
setParameterByName = Element.SetParameterByName(element=byPointAndLevel, parameterName=string_10, value=code_block_24)
string_11 = StringInput("Elevação do Ponto")
setParameterByName_2 = Element.SetParameterByName(element=setParameterByName, parameterName=string_11, value=getItemAtIndex_7)
YAxis = Vector.YAxis()
ZAxis_3 = Vector.ZAxis()
angleAboutAxis = Vector.AngleAboutAxis(vector=reverse, otherVector=YAxis, rotationAxis=ZAxis_3)
round = Math.Round(number=angleAboutAxis)
setRotation = FamilyInstance.SetRotation(familyInstance=setParameterByName_2, degree=round)
flatten_5 = List.Flatten(list=setParameterByName_2)

end = Revit.Transaction.Transaction.End(input=setRotation)
start = Revit.Transaction.Transaction.Start(input=end)
facingOrientation_2 = FamilyInstance.FacingOrientation(familyInstance=door_set_handing.leftHandedReversed)
reverse_3 = Vector.Reverse(vector=facingOrientation_2)

# group: Ponto da Porta DIREITA
# Descrição <Clique duas vezes aqui para editar a descrição do grupo>
deconstructPolyCurve_2 = Geometry.Curves.DeconstructPolyCurve(polycurve=flatten_2)
closestTo_2 = Custom[Geometry.ClosestTo](geometry=deconstructPolyCurve_2.Segments@L3, other=getLocation_2@L1, lacing=Longest)
number_5 = DoubleInput(0.2)
compareByDistance_2 = Geometry.Points.CompareByDistance(point1=getLocation_2, point2=closestTo_2.ClosestPoint, distance=number_5)
filterByBoolMask_10 = List.FilterByBoolMask(list=closestTo_2.ClosestPoint, mask=compareByDistance_2)
boolean_7 = BoolSelector(false)
clean_2 = List.Clean(list=filterByBoolMask_10.in, preserveIndices=boolean_7)
firstItem_3 = List.FirstItem(list=clean_2@L2)
byStartPointDirectionLength_2 = Line.ByStartPointDirectionLength(startPoint=clean_2, direction=reverse_3)
endPoint_2 = Curve.EndPoint(curve=byStartPointDirectionLength_2)
ꟿ_geometry_indexbydistance_2 = Custom[ꟿ Geometry.IndexByDistance](geometry=endPoint_2, other=firstItem_3)
getItemAtIndex_9 = List.GetItemAtIndex(list=firstItem_3, index=ꟿ_geometry_indexbydistance_2.index)
firstItem_4 = List.FirstItem(list=getItemAtIndex_9@L3)

cross_2 = Vector.Cross(vector=facingOrientation_2, cross=ZAxis_2)

# group: Posição Interruptor
# Descrição <Clique duas vezes aqui para editar a descrição do grupo>
translate_2 = Geometry.Translate(geometry=firstItem_4, direction=cross_2, distance=getItemAtIndex_6)
byPointAndLevel_2 = FamilyInstance.ByPointAndLevel(familyType=getItemAtIndex_3, point=translate_2, level=getItemAtIndex_4, lacing=Longest)
string_12 = StringInput("Elevação do nível")
code_block_25 = CodeBlock { 0; }
setParameterByName_3 = Element.SetParameterByName(element=byPointAndLevel_2, parameterName=string_12, value=code_block_25)
string_13 = StringInput("Elevação do Ponto")
setParameterByName_4 = Element.SetParameterByName(element=setParameterByName_3, parameterName=string_13, value=getItemAtIndex_7)
YAxis_2 = Vector.YAxis()
ZAxis_4 = Vector.ZAxis()
angleAboutAxis_2 = Vector.AngleAboutAxis(vector=reverse_3, otherVector=YAxis_2, rotationAxis=ZAxis_4)
round_2 = Math.Round(number=angleAboutAxis_2)
setRotation_2 = FamilyInstance.SetRotation(familyInstance=setParameterByName_4, degree=round_2)
flatten_6 = List.Flatten(list=setParameterByName_4)

end_2 = Revit.Transaction.Transaction.End(input=setRotation_2)
start_2 = Revit.Transaction.Transaction.Start(input=end_2)
list_create_3 = List.Create(item0=start, item1=start_2)

# group: Mensagem final
flatten_7 = List.Flatten(list=list_create_3)
isNull = Object.IsNull(object=flatten_7)
code_block_26 = CodeBlock { 0; }
count = List.Count(list=flatten_7)
code_block_27 = CodeBlock(x=isNull, y=code_block_26, z=count)
# ---------- code_block_27.designscript (5 lines) ----------
//Condições se ou e
x;
y;
z;
x == true ? y : z;
# ----------------------------------------
passThrough = Custom[PassThrough](passThrough=code_block_27.out3, waitFor=list_create_3)  # package archi-lab.net; Ripped this off from Clockwork. Sorry Andy.
uniqueItems = List.UniqueItems(list=passThrough)
code_block_28 = CodeBlock { 0; }
gt = uniqueItems > code_block_28
code_block_29 = CodeBlock(N=uniqueItems) { ["Feito! Você inseriu "+N+" Interruptores em seu projeto. Deseja inverter o lado dos Interruptores?"]; }
code_block_30 = CodeBlock { ["Nenhum interruptor foi inserido"]; }
if_ = If(test=gt, true=code_block_29, false=code_block_30)
flatten_8 = List.Flatten(list=if_)
fromList = Python(IN[0]=flatten_8)  # "String.FromList"; IronPython2
# ---------- fromList.python (22 lines) ----------
# Carregar as bibliotecas DesignScript e padrão do Python
import sys
import clr
clr.AddReference('ProtoGeometry')
from Autodesk.DesignScript.Geometry import *

# Função para concatenar os valores de uma lista em uma única string com múltiplas linhas
def concatenate_list_to_string(input_list, delimiter="\n"):
    # Verifica se a entrada é uma lista
    if not isinstance(input_list, list):
        return "A entrada deve ser uma lista."
    
    # Converte todos os elementos para string e junta com o delimitador especificado
    result = delimiter.join(str(item) for item in input_list)
    return result

# Entrada pelo nó do Dynamo
lista = IN[0]  # Lista de valores a serem concatenados
delimitador = IN[1] if len(IN) > 1 else "\n"  # Delimitador opcional, padrão é nova linha

# Saída para o Dynamo
OUT = concatenate_list_to_string(lista, delimitador)
# ----------------------------------------
python_script = Python(IN[0]=fromList)  # IronPython2
# ---------- python_script.python (30 lines) ----------
# Importando as bibliotecas necessárias da API do Revit
import clr
clr.AddReference('RevitServices')  # Referência aos serviços do Revit
from RevitServices.Persistence import DocumentManager

clr.AddReference('RevitAPI')  # Referência à API do Revit
clr.AddReference('RevitAPIUI')  # Referência à API de Interface de Usuário do Revit

from Autodesk.Revit.UI import TaskDialog, TaskDialogCommonButtons, TaskDialogResult

# Recebe o texto de instrução como entrada do nó
instrucoes = IN[0]

# Criando o TaskDialog
dialog = TaskDialog("Aviso")
dialog.MainInstruction = instrucoes
dialog.CommonButtons = TaskDialogCommonButtons.Yes | TaskDialogCommonButtons.No | TaskDialogCommonButtons.Close

# Exibindo o dialog para o usuário e capturando a resposta
resultado = dialog.Show()

# Interpretando a resposta
if resultado == TaskDialogResult.No:
    OUT = "Não"
elif resultado == TaskDialogResult.Yes:
    OUT = "Sim"
elif resultado == TaskDialogResult.Cancel:
    OUT = "Fechar"
else:
    OUT = "Nenhuma ação"
# ----------------------------------------

list_create_4 = List.Create(item0=flatten_5, item1=flatten_6)

# group: Inverter lado Interruptor
code_block_31 = CodeBlock { true; false; }
code_block_32 = CodeBlock(x=python_script, y=code_block_31.out0, z=code_block_31.out1)
# ---------- code_block_32.designscript (5 lines) ----------
//Condições IF, OR, AND
x;
y;
z;
x == "Sim" ? y : z;
# ----------------------------------------
watch = Watch(code_block_32.out3)
flatten_9 = List.Flatten(list=list_create_4)
passThrough_2 = Custom[PassThrough](passThrough=flatten_9, waitFor=code_block_32.out3)
code_block_33 = CodeBlock { []; }
condição_if_de_lista = CodeBlock(test=code_block_32.out3, verd=passThrough_2, fals=code_block_33)
# ---------- condição_if_de_lista.designscript (3 lines) ----------
//Condições IF
indx = (test) ? 0 : 1;
rslt = [verd,fals][indx];
# ----------------------------------------
delete = Element.Delete(element=condição_if_de_lista.rslt)

condição_if_de_lista_2 = CodeBlock(test=code_block_32.out3, verd=firstItem_2, fals=code_block)  # same code as condição_if_de_lista
condição_if_de_lista_3 = CodeBlock(test=code_block_32.out3, verd=cross, fals=code_block_2)  # same code as condição_if_de_lista

# group: Posição Interruptor
# Descrição <Clique duas vezes aqui para editar a descrição do grupo>
passThrough_3 = Custom[PassThrough](passThrough=condição_if_de_lista_2.rslt, waitFor=delete)
passThrough_4 = Custom[PassThrough](passThrough=condição_if_de_lista_3.rslt, waitFor=delete)
translate_3 = Geometry.Translate(geometry=passThrough_3, direction=passThrough_4, distance=getItemAtIndex_6)
byPointAndLevel_3 = FamilyInstance.ByPointAndLevel(familyType=getItemAtIndex_3, point=translate_3, level=getItemAtIndex_4, lacing=Longest)
string_14 = StringInput("Elevação do nível")
code_block_34 = CodeBlock { 0; }
setParameterByName_5 = Element.SetParameterByName(element=byPointAndLevel_3, parameterName=string_14, value=code_block_34)
string_15 = StringInput("Elevação do Ponto")
setParameterByName_6 = Element.SetParameterByName(element=setParameterByName_5, parameterName=string_15, value=getItemAtIndex_7)
flatten_10 = List.Flatten(list=setParameterByName_6)
YAxis_3 = Vector.YAxis()
ZAxis_5 = Vector.ZAxis()
angleAboutAxis_3 = Vector.AngleAboutAxis(vector=reverse, otherVector=YAxis_3, rotationAxis=ZAxis_5)
round_3 = Math.Round(number=angleAboutAxis_3)
setRotation_3 = FamilyInstance.SetRotation(familyInstance=setParameterByName_6, degree=round_3)

byStartPointDirectionLength_3 = Line.ByStartPointDirectionLength(startPoint=firstItem_2, direction=reverse_2)
condição_if_de_lista_4 = CodeBlock(test=code_block_32.out3, verd=firstItem_4, fals=code_block_3)  # same code as condição_if_de_lista
reverse_4 = Vector.Reverse(vector=cross_2)
condição_if_de_lista_5 = CodeBlock(test=code_block_32.out3, verd=reverse_4, fals=code_block_4)  # same code as condição_if_de_lista

# group: Posição Interruptor
# Descrição <Clique duas vezes aqui para editar a descrição do grupo>
passThrough_5 = Custom[PassThrough](passThrough=condição_if_de_lista_4.rslt, waitFor=delete)
passThrough_6 = Custom[PassThrough](passThrough=condição_if_de_lista_5.rslt, waitFor=delete)
translate_4 = Geometry.Translate(geometry=passThrough_5, direction=passThrough_6, distance=getItemAtIndex_6)
byPointAndLevel_4 = FamilyInstance.ByPointAndLevel(familyType=getItemAtIndex_3, point=translate_4, level=getItemAtIndex_4, lacing=Longest)
string_16 = StringInput("Elevação do nível")
code_block_35 = CodeBlock { 0; }
setParameterByName_7 = Element.SetParameterByName(element=byPointAndLevel_4, parameterName=string_16, value=code_block_35)
string_17 = StringInput("Elevação do Ponto")
setParameterByName_8 = Element.SetParameterByName(element=setParameterByName_7, parameterName=string_17, value=getItemAtIndex_7)
flatten_11 = List.Flatten(list=setParameterByName_8)
YAxis_4 = Vector.YAxis()
ZAxis_6 = Vector.ZAxis()
angleAboutAxis_4 = Vector.AngleAboutAxis(vector=reverse_3, otherVector=YAxis_4, rotationAxis=ZAxis_6)
round_4 = Math.Round(number=angleAboutAxis_4)
setRotation_4 = FamilyInstance.SetRotation(familyInstance=setParameterByName_8, degree=round_4)

delete_2 = archilab.Revit.Elements.Elements.Delete(element=condição_if_de_lista.rslt)  # frozen
byStartPointDirectionLength_4 = Line.ByStartPointDirectionLength(startPoint=firstItem_4, direction=cross_2)
