# Dynamo graph 02-1_BIMACON_Inserir Luminárias nos forros_R01_script.dyn "ok 02-1_BIMACON_Inserir Luminárias nos forros_R01_script" (Dynamo 2.19.3.6394)
# author: Jose Nelson
# packages: archi-lab.net 2023.213.1722, Data-Shapes 2022.2.105, Genius Loci 2023.2.21

# group: ENTRADAS PARA O USUÁRIO
code_block = CodeBlock { "Inserção de Luminárias"; }
string = StringInput("LogoBimacon.png")
python_script = Python(IN[0]=string)  # IronPython2
# ---------- python_script.python (22 lines) ----------
import clr

# Adiciona referência ao ambiente .NET
clr.AddReference('System')
from System import Environment, IO

# Nome da imagem (entrada do usuário)
nome_arquivo_imagem = IN[0]

# Recupera o nome do usuário logado no Windows
usuario = Environment.UserName

# Monta o caminho completo para a pasta de imagens
caminho_base = r"C:\Users\{0}\AppData\Roaming\pyRevit\Extensions\Bimacon.extension\Bimacon.tab\Imagens_Bimacon".format(usuario)

# Junta o caminho base com o nome do arquivo
caminho_completo = IO.Path.Combine(caminho_base, nome_arquivo_imagem)

# Verifica se o arquivo existe
existe = IO.File.Exists(caminho_completo)

OUT = caminho_completo if existe else "Imagem não encontrada: {0}".format(caminho_completo)
# ----------------------------------------
file_from_path = FileObject(path=python_script)
readFromFile = Image.ReadFromFile(file=file_from_path)
string_2 = StringInput("Confirmar")
string_3 = StringInput("Selecione o Tipo de Luminária")
element_classes = ElementTypes("FamilySymbol")
all_elements_of_class = ElementsOfType(element_class=element_classes)
categories = Categories("OST_LightingFixtures")
string_from_object = FromObject(object=categories)
getCategory = Element.GetCategory(element=all_elements_of_class)
string_from_object_2 = FromObject(object=getCategory)
eq = string_from_object == string_from_object_2
filterByBoolMask = List.FilterByBoolMask(list=all_elements_of_class, mask=eq)
family = FamilyType.Family(familyType=filterByBoolMask.in)
name = Family.Name(family=family)
code_block_2 = CodeBlock { "Lum."; }
contains = String.Contains(string=name, searchFor=code_block_2)
filterByBoolMask_2 = List.FilterByBoolMask(list=family, mask=contains)
string_4 = StringInput(" ")
code_block_3 = CodeBlock { 31; }
boolean = BoolSelector(true)
string_5 = StringInput("Cancelar")
number = DoubleInput(700)
code_block_4 = CodeBlock()  # //archilab
code_block_5 = CodeBlock()  # //Data-Shapes
byName = Family.ByName(name=name)

list_sortnatural = Custom[List SortNatural](list=filterByBoolMask_2.in)  # package Genius Loci; Sorts a specified list in natural order in either ascending or descending order.

# group (continued): ENTRADAS PARA O USUÁRIO
types = Family.Types(family=list_sortnatural)
flatten = List.Flatten(list=types)
uniqueItems = List.UniqueItems(list=flatten)
family_2 = FamilyType.Family(familyType=uniqueItems)
name_2 = Family.Name(family=family_2)
add = name_2 + string_4
name_3 = FamilyType.Name(familyType=uniqueItems)
add_2 = add + name_3
dropdown_data = Custom[DropDown Data](InputName=string_3, Keys=add_2, Values=uniqueItems, DefaultValueIndex=code_block_3)  # package Data-Shapes; Create data for DropDown input in UI.MultiInputForm ++ . Check out www.data-shapes.net for more infos.
list_create = List.Create(item0=dropdown_data)
multipleinputform = Custom[MultipleInputForm ++](Description_optional=code_block, Logo_optional=readFromFile, ButtonText_optional=string_2, Inputs=list_create, Toggle=boolean, CancelButtonText_optional=string_5, Width_optional=number)  # package Data-Shapes; Create a form with multiple inputs. see www.data-shapes.net for tutorials and infos!

# group: Separar Entradas
code_block_6 = CodeBlock { 0; }
getItemAtIndex = List.GetItemAtIndex(list=multipleinputform.User_Inputs, index=code_block_6)

categories_2 = Categories("OST_Ceilings")
all_elements_of_category = ElementsOfCategory(Category=categories_2)
solids = Element.Solids(element=all_elements_of_category)
centroid = Solid.Centroid(solid=solids)
X = Point.X(point=centroid)
flatten_2 = List.Flatten(list=X)
Y = Point.Y(point=centroid)
flatten_3 = List.Flatten(list=Y)
number_2 = DoubleInput(0)
byCoordinates = Point.ByCoordinates(x=flatten_2, y=flatten_3, z=number_2)
byHostAndPoint = FamilyInstance.ByHostAndPoint(familyType=getItemAtIndex, host=all_elements_of_category, point=byCoordinates)
code_block_7 = CodeBlock { "Elevação do nível"; }
number_3 = DoubleInput(0)
setParameterByName = Element.SetParameterByName(element=byHostAndPoint, parameterName=code_block_7, value=number_3)
code_block_8 = CodeBlock { "Altura Rebaixo"; }
code_block_9 = CodeBlock { "Altura do deslocamento do nível"; }
getParameterValueByName = Element.GetParameterValueByName(element=all_elements_of_category, parameterName=code_block_9)
setParameterByName_2 = Element.SetParameterByName(element=setParameterByName, parameterName=code_block_8, value=getParameterValueByName)

# group: Mensagem final
passThrough = Custom[PassThrough](passThrough=byHostAndPoint, waitFor=setParameterByName_2)  # package archi-lab.net; Ripped this off from Clockwork. Sorry Andy.
count = List.Count(list=passThrough)
code_block_10 = CodeBlock { 0; }
empty_list_verificação = CodeBlock(a=count, b=code_block_10, x=count) { a; b; x == null ? b : a; }
gt = empty_list_verificação.out2 > code_block_10
code_block_11 = CodeBlock(N=count) { ["Feito! Você inseriu "+N+" luminárias em seu projeto"]; }
code_block_12 = CodeBlock { ["Nenhuma Luminária foi inserida"]; }
if_ = If(test=gt, true=code_block_11, false=code_block_12)
flatten_4 = List.Flatten(list=if_)
fromList = Python(IN[0]=flatten_4)  # "String.FromList"; IronPython2
# ---------- fromList.python (22 lines) ----------
# Carregar as bibliotecas DesignScript e padrão do Python
import sys
import clr
clr.AddReference('ProtoGeometry')
from Autodesk.DesignScript.Geometry import *

# Função para concatenar os valores de uma lista em uma única string com múltiplas linhas
def concatenate_list_to_string(input_list, delimiter="\n"):
    # Verifica se a entrada é uma lista
    if not isinstance(input_list, list):
        return "A entrada deve ser uma lista."
    
    # Converte todos os elementos para string e junta com o delimitador especificado
    result = delimiter.join(str(item) for item in input_list)
    return result

# Entrada pelo nó do Dynamo
lista = IN[0]  # Lista de valores a serem concatenados
delimitador = IN[1] if len(IN) > 1 else "\n"  # Delimitador opcional, padrão é nova linha

# Saída para o Dynamo
OUT = concatenate_list_to_string(lista, delimitador)
# ----------------------------------------
python_script_2 = Python(IN[0]=fromList)  # IronPython2
# ---------- python_script_2.python (21 lines) ----------
# Importar as bibliotecas necessárias do Revit
import clr
clr.AddReference("RevitServices")
from RevitServices.Persistence import DocumentManager

clr.AddReference("RevitAPI")
clr.AddReference("RevitAPIUI")
from Autodesk.Revit.UI import TaskDialog

# Pegar a entrada do Dynamo
mensagem = IN[0]

# Criar a TaskDialog
task_dialog = TaskDialog("Ok")
task_dialog.MainInstruction = mensagem

# Exibir a TaskDialog
task_dialog.Show()

# Saída do script
OUT = "Sucesso!"
# ----------------------------------------

code_block_13 = CodeBlock { "Elevação do Ponto"; }
setParameterByName_3 = Element.SetParameterByName(element=setParameterByName, parameterName=code_block_13, value=getParameterValueByName)
