# Dynamo graph 2021_02-1_BIMACON_Inserir Luminárias nos forros_R01_script.dyn (Dynamo 2.19.3.6394)
# packages: spring nodes 210.1.1, Orchid 2.6.8.6198, archi-lab.net 2023.213.1722, Data-Shapes 2022.2.105, Orchid 2.19.3.6373

categories = Categories("OST_Ceilings")
all_elements_of_category = ElementsOfCategory(Category=categories)
code_block = CodeBlock { "Altura do deslocamento do nível"; }
getParameterValueByName = Element.GetParameterValueByName(element=all_elements_of_category, parameterName=code_block)

# group: ENTRADAS PARA O USUÁRIO
code_block_2 = CodeBlock { "Inserção de Luminárias"; }
file_path = Filename("..\..\..\..\..\05 - BIMACON\01 - EMPRESA BIMACON\00 - Logos e imagens - BIMACON\ARTE BIMACON\reddonda-removebg-preview.png")
file_from_path = FileObject(path=file_path)
readFromFile = Image.ReadFromFile(file=file_from_path)
string = StringInput("Confirmar")
string_2 = StringInput("Selecione o Tipo de Luminária")
element_classes = ElementTypes("FamilySymbol")
all_elements_of_class = ElementsOfType(element_class=element_classes)
categories_2 = Categories("OST_LightingFixtures")
string_from_object = FromObject(object=categories_2)
getCategory = Element.GetCategory(element=all_elements_of_class)
string_from_object_2 = FromObject(object=getCategory)
eq = string_from_object == string_from_object_2
filterByBoolMask = List.FilterByBoolMask(list=all_elements_of_class, mask=eq)
family = FamilyType.Family(familyType=filterByBoolMask.in)
name = Family.Name(family=family)
code_block_3 = CodeBlock { "Lum."; }
contains = String.Contains(string=name, searchFor=code_block_3)
filterByBoolMask_2 = List.FilterByBoolMask(list=family, mask=contains)
sortNatural = Orchid.Common.List.SortNatural(list=filterByBoolMask_2.in)
types = Family.Types(family=sortNatural)
flatten = List.Flatten(list=types)
uniqueItems = List.UniqueItems(list=flatten)
family_2 = FamilyType.Family(familyType=uniqueItems)
name_2 = Family.Name(family=family_2)
string_3 = StringInput(" ")
add = name_2 + string_3
name_3 = FamilyType.Name(familyType=uniqueItems)
add_2 = add + name_3
code_block_4 = CodeBlock { 31; }
dropdown_data = Custom[DropDown Data](InputName=string_2, Keys=add_2, Values=family_2, DefaultValueIndex=code_block_4)  # package Data-Shapes; Create data for DropDown input in UI.MultiInputForm ++ . Check out www.data-shapes.net for more infos.
string_4 = StringInput("Espessura do Gesso (Valor negativo)")
string_5 = StringInput("-0.030")
boolean = BoolSelector(true)
textbox_data = Custom[TextBox Data](InputName=string_4, DefaultText=string_5, IsNumberEntry=boolean)  # package Data-Shapes; Create Data for TextBox input in UI.MultipleInputForm ++ . Check out www.data-shapes.net for more informations
list_create = List.Create(item0=dropdown_data, item1=textbox_data)
boolean_2 = BoolSelector(true)
string_6 = StringInput("Cancelar")
number = DoubleInput(700)
multipleinputform = Custom[MultipleInputForm ++](Description_optional=code_block_2, Logo_optional=readFromFile, ButtonText_optional=string, Inputs=list_create, Toggle=boolean_2, CancelButtonText_optional=string_6, Width_optional=number)  # package Data-Shapes; Create a form with multiple inputs. see www.data-shapes.net for tutorials and infos!
code_block_5 = CodeBlock()  # //archilab
code_block_6 = CodeBlock()  # //Data-Shapes
byName = Family.ByName(name=name)

# group: Separar Entradas
code_block_7 = CodeBlock { 0; }
getItemAtIndex = List.GetItemAtIndex(list=multipleinputform.User_Inputs, index=code_block_7)
types_2 = Family.Types(family=getItemAtIndex)
code_block_8 = CodeBlock { 0; }
getItemAtIndex_2 = List.GetItemAtIndex(list=types_2, index=code_block_8)
code_block_9 = CodeBlock { 1; }
getItemAtIndex_3 = List.GetItemAtIndex(list=multipleinputform.User_Inputs, index=code_block_9)

solids = Element.Solids(element=all_elements_of_category)
centroid = Solid.Centroid(solid=solids)
X = Point.X(point=centroid)
flatten_2 = List.Flatten(list=X)
Y = Point.Y(point=centroid)
flatten_3 = List.Flatten(list=Y)
number_2 = DoubleInput(0)
byCoordinates = Point.ByCoordinates(x=flatten_2, y=flatten_3, z=number_2)
ꟿ_familyinstance_byhostandpoint = Custom[ꟿ FamilyInstance.ByHostAndPoint](host=all_elements_of_category, type=getItemAtIndex_2, point=byCoordinates)  # package spring nodes; Creates hosted family instances(doors/windows) at the specified points. You can feed either a single family type or a unique type for each instance.
code_block_10 = CodeBlock { "Elevação do Ponto"; }
espessura_gesso = DoubleInput(-0.03)  # graph input
setParameterByName = Element.SetParameterByName(element=ꟿ_familyinstance_byhostandpoint, parameterName=code_block_10, value=espessura_gesso)

# group: Mensagem final
passThrough = Custom[PassThrough](passThrough=ꟿ_familyinstance_byhostandpoint, waitFor=setParameterByName)  # package archi-lab.net; Ripped this off from Clockwork. Sorry Andy.
count = List.Count(list=passThrough)
code_block_11 = CodeBlock { 0; }
gt = count > code_block_11
code_block_12 = CodeBlock(N=count) { ["Feito! Você inseriu "+N+" luminárias em seu projeto"]; }
code_block_13 = CodeBlock { ["Nenhuma Luminária foi inserida"]; }
if_ = If(test=gt, true=code_block_12, false=code_block_13)
flatten_4 = List.Flatten(list=if_)
o_string_fromlist = Orchid.Common.String.FromList(list=flatten_4)
python_script = Python(IN[0]=o_string_fromlist)  # IronPython2
# ---------- python_script.python (21 lines) ----------
# Importar as bibliotecas necessárias do Revit
import clr
clr.AddReference("RevitServices")
from RevitServices.Persistence import DocumentManager

clr.AddReference("RevitAPI")
clr.AddReference("RevitAPIUI")
from Autodesk.Revit.UI import TaskDialog

# Pegar a entrada do Dynamo
mensagem = IN[0]

# Criar a TaskDialog
task_dialog = TaskDialog("Ok")
task_dialog.MainInstruction = mensagem

# Exibir a TaskDialog
task_dialog.Show()

# Saída do script
OUT = "Sucesso!"
# ----------------------------------------
