# Dynamo graph 2021_02-1_BIMACON_Inserir Luminárias nos forros_script.dyn "2021_02-1_BIMACON_Inserir Luminárias nos forros" (Dynamo 2.6.1.8786)
# packages: spring nodes 210.1.1, Orchid 2.6.8.6198, archi-lab.net 2023.213.1722, Data-Shapes 2022.2.105

categories = Categories("OST_Ceilings")
all_elements_of_category = ElementsOfCategory(Category=categories)
code_block = CodeBlock { "Altura do deslocamento do nível"; }
getParameterValueByName = Element.GetParameterValueByName(element=all_elements_of_category, parameterName=code_block)

# group: ENTRADAS PARA O USUÁRIO
code_block_2 = CodeBlock { "Inserção de Luminárias"; }
file_path = Filename("..\..\..\..\..\05 - BIMACON\01 - EMPRESA BIMACON\00 - Logos e imagens - BIMACON\ARTE BIMACON\reddonda-removebg-preview.png")
file_from_path = FileObject(path=file_path)
readFromFile = Image.ReadFromFile(file=file_from_path)
string = StringInput("Confirmar")
string_2 = StringInput("Selecione o Tipo de Luminária")
categories_2 = Categories("OST_LightingFixtures")
all_elements_of_category_2 = ElementsOfCategory(Category=categories_2)
elementType = Element.ElementType(element=all_elements_of_category_2)
familyName = ElementType.FamilyName(elementType=elementType)
code_block_3 = CodeBlock { "Lum."; }
contains = String.Contains(str=familyName, searchFor=code_block_3)
filterByBoolMask = List.FilterByBoolMask(list=familyName, mask=contains)
uniqueItems = List.UniqueItems(list=filterByBoolMask.in)
byName = Family.ByName(name=familyName)
filterByBoolMask_2 = List.FilterByBoolMask(list=byName, mask=contains)
uniqueItems_2 = List.UniqueItems(list=filterByBoolMask_2.in)
code_block_4 = CodeBlock { 11; }
dropdown_data = Custom[DropDown Data](InputName=string_2, Keys=uniqueItems, Values=uniqueItems_2, DefaultValueIndex=code_block_4)  # package Data-Shapes; Create data for DropDown input in UI.MultiInputForm ++ . Check out www.data-shapes.net for more infos.
string_3 = StringInput("Espessura do Gesso (Valor negativo)")
string_4 = StringInput("-0.030")
boolean = BoolSelector(true)
textbox_data = Custom[TextBox Data](InputName=string_3, DefaultText=string_4, IsNumberEntry=boolean)  # package Data-Shapes; Create Data for TextBox input in UI.MultipleInputForm ++ . Check out www.data-shapes.net for more informations
list_create = List.Create(item0=dropdown_data, item1=textbox_data)
boolean_2 = BoolSelector(true)
string_5 = StringInput("Cancelar")
number = DoubleInput(500)
multipleinputform = Custom[MultipleInputForm ++](Description_optional=code_block_2, Logo_optional=readFromFile, ButtonText_optional=string, Inputs=list_create, Toggle=boolean_2, CancelButtonText_optional=string_5, Width_optional=number)  # package Data-Shapes; Create a form with multiple inputs. see www.data-shapes.net for tutorials and infos!
code_block_5 = CodeBlock()  # //archilab
code_block_6 = CodeBlock()  # //Data-Shapes

# group: Separar Entradas
code_block_7 = CodeBlock { 0; }
getItemAtIndex = List.GetItemAtIndex(list=multipleinputform.User_Inputs, index=code_block_7)
types = Family.Types(family=getItemAtIndex)
code_block_8 = CodeBlock { 0; }
getItemAtIndex_2 = List.GetItemAtIndex(list=types, index=code_block_8)
code_block_9 = CodeBlock { 1; }
getItemAtIndex_3 = List.GetItemAtIndex(list=multipleinputform.User_Inputs, index=code_block_9)

solids = Element.Solids(element=all_elements_of_category)
centroid = Solid.Centroid(solid=solids)
X = Point.X(point=centroid)
flatten = List.Flatten(list=X)
Y = Point.Y(point=centroid)
flatten_2 = List.Flatten(list=Y)
number_2 = DoubleInput(0)
byCoordinates = Point.ByCoordinates(x=flatten, y=flatten_2, z=number_2)
ꟿ_familyinstance_byhostandpoint = Custom[ꟿ FamilyInstance.ByHostAndPoint](host=all_elements_of_category, type=getItemAtIndex_2, point=byCoordinates)  # package spring nodes; Creates hosted family instances(doors/windows) at the specified points. You can feed either a single family type or a unique type for each instance.
code_block_10 = CodeBlock { "Elevação do Ponto"; }
espessura_gesso = DoubleInput(-0.03)  # graph input
setParameterByName = Element.SetParameterByName(element=ꟿ_familyinstance_byhostandpoint, parameterName=code_block_10, value=espessura_gesso)

# group: Mensagem final
passThrough = Custom[PassThrough](passThrough=ꟿ_familyinstance_byhostandpoint, waitFor=setParameterByName)  # package archi-lab.net; Ripped this off from Clockwork. Sorry Andy.
count = List.Count(list=passThrough)
code_block_11 = CodeBlock { 0; }
gt = count > code_block_11
code_block_12 = CodeBlock(N=count) { ["Feito! Você inseriu "+N+" luminárias em seu projeto"]; }
code_block_13 = CodeBlock { ["Nenhuma Luminária foi inserida"]; }
if_ = If(test=gt, true=code_block_12, false=code_block_13)
flatten_3 = List.Flatten(list=if_)
o_string_fromlist = Orchid.Common.String.FromList(list=flatten_3)
python_script = Python(IN[0]=o_string_fromlist)
# ---------- python_script.python (21 lines) ----------
# Importar as bibliotecas necessárias do Revit
import clr
clr.AddReference("RevitServices")
from RevitServices.Persistence import DocumentManager

clr.AddReference("RevitAPI")
clr.AddReference("RevitAPIUI")
from Autodesk.Revit.UI import TaskDialog

# Pegar a entrada do Dynamo
mensagem = IN[0]

# Criar a TaskDialog
task_dialog = TaskDialog("Ok")
task_dialog.MainInstruction = mensagem

# Exibir a TaskDialog
task_dialog.Show()

# Saída do script
OUT = "Sucesso!"
# ----------------------------------------
