# Dynamo graph ok 2021_02-1_BIMACON_Inserir Luminárias nos forros_R01_script.dyn (Dynamo 2.6.1.8786)
# packages: spring nodes 210.1.1, archi-lab.net 2023.213.1722, Data-Shapes 2022.2.105, Genius Loci 2023.2.21

categories = Categories("OST_Ceilings")
all_elements_of_category = ElementsOfCategory(Category=categories)

# group: ENTRADAS PARA O USUÁRIO
code_block = CodeBlock { "Inserção de Luminárias"; }
file_path = Filename("..\..\..\..\..\05 - BIMACON\01 - EMPRESA BIMACON\00 - Logos e imagens - BIMACON\ARTE BIMACON\reddonda-removebg-preview.png")
file_from_path = FileObject(path=file_path)
readFromFile = Image.ReadFromFile(file=file_from_path)
string = StringInput("Confirmar")
string_2 = StringInput("Selecione o Tipo de Luminária")
element_classes = ElementTypes("FamilySymbol")
all_elements_of_class = ElementsOfType(element_class=element_classes)
categories_2 = Categories("OST_LightingFixtures")
string_from_object = FromObject(object=categories_2)
getCategory = Element.GetCategory(element=all_elements_of_class)
string_from_object_2 = FromObject(object=getCategory)
eq = string_from_object == string_from_object_2
filterByBoolMask = List.FilterByBoolMask(list=all_elements_of_class, mask=eq)
family = FamilyType.Family(familyType=filterByBoolMask.in)
name = Family.Name(family=family)
code_block_2 = CodeBlock { "Lum."; }
contains = String.Contains(str=name, searchFor=code_block_2)
filterByBoolMask_2 = List.FilterByBoolMask(list=family, mask=contains)
string_3 = StringInput(" ")
code_block_3 = CodeBlock { 31; }
boolean = BoolSelector(true)
string_4 = StringInput("Cancelar")
number = DoubleInput(700)
code_block_4 = CodeBlock()  # //archilab
code_block_5 = CodeBlock()  # //Data-Shapes
byName = Family.ByName(name=name)

list_sortnatural = Custom[List SortNatural](list=filterByBoolMask_2.in)  # package Genius Loci; Sorts a specified list in natural order in either ascending or descending order.

# group (continued): ENTRADAS PARA O USUÁRIO
types = Family.Types(family=list_sortnatural)
flatten = List.Flatten(list=types)
uniqueItems = List.UniqueItems(list=flatten)
family_2 = FamilyType.Family(familyType=uniqueItems)
name_2 = Family.Name(family=family_2)
add = name_2 + string_3
name_3 = FamilyType.Name(familyType=uniqueItems)
add_2 = add + name_3
dropdown_data = Custom[DropDown Data](InputName=string_2, Keys=add_2, Values=uniqueItems, DefaultValueIndex=code_block_3)  # package Data-Shapes; Create data for DropDown input in UI.MultiInputForm ++ . Check out www.data-shapes.net for more infos.
list_create = List.Create(item0=dropdown_data)
multipleinputform = Custom[MultipleInputForm ++](Description_optional=code_block, Logo_optional=readFromFile, ButtonText_optional=string, Inputs=list_create, Toggle=boolean, CancelButtonText_optional=string_4, Width_optional=number)  # package Data-Shapes; Create a form with multiple inputs. see www.data-shapes.net for tutorials and infos!

# group: Separar Entradas
code_block_6 = CodeBlock { 0; }
getItemAtIndex = List.GetItemAtIndex(list=multipleinputform.User_Inputs, index=code_block_6)

solids = Element.Solids(element=all_elements_of_category)
centroid = Solid.Centroid(solid=solids)
X = Point.X(point=centroid)
flatten_2 = List.Flatten(list=X)
Y = Point.Y(point=centroid)
flatten_3 = List.Flatten(list=Y)
number_2 = DoubleInput(0)
byCoordinates = Point.ByCoordinates(x=flatten_2, y=flatten_3, z=number_2)
ꟿ_familyinstance_byhostandpoint = Custom[ꟿ FamilyInstance.ByHostAndPoint](host=all_elements_of_category, type=getItemAtIndex, point=byCoordinates)  # package spring nodes; Creates hosted family instances(doors/windows) at the specified points. You can feed either a single family type or a unique type for each instance.
code_block_7 = CodeBlock { "Elevação do nível"; }
number_3 = DoubleInput(0)
setParameterByName = Element.SetParameterByName(element=ꟿ_familyinstance_byhostandpoint, parameterName=code_block_7, value=number_3)
code_block_8 = CodeBlock { "Altura Rebaixo"; }
code_block_9 = CodeBlock { "Altura do deslocamento do nível"; }
getParameterValueByName = Element.GetParameterValueByName(element=all_elements_of_category, parameterName=code_block_9)
setParameterByName_2 = Element.SetParameterByName(element=setParameterByName, parameterName=code_block_8, value=getParameterValueByName)

# group: Mensagem final
passThrough = Custom[PassThrough](passThrough=ꟿ_familyinstance_byhostandpoint, waitFor=setParameterByName_2)  # package archi-lab.net; Ripped this off from Clockwork. Sorry Andy.
count = List.Count(list=passThrough)
code_block_10 = CodeBlock { 0; }
code_block_11 = CodeBlock(a=count, b=code_block_10, x=passThrough) { a; b; x == null ? b : a; }
gt = code_block_11.out2 > code_block_10
code_block_12 = CodeBlock(N=count) { ["Feito! Você inseriu "+N+" luminárias em seu projeto"]; }
code_block_13 = CodeBlock { ["Nenhuma Luminária foi inserida"]; }
if_ = If(test=gt, true=code_block_12, false=code_block_13)
flatten_4 = List.Flatten(list=if_)
fromList = Python(IN[0]=flatten_4)  # "String.FromList"
# ---------- fromList.python (22 lines) ----------
# Carregar as bibliotecas DesignScript e padrão do Python
import sys
import clr
clr.AddReference('ProtoGeometry')
from Autodesk.DesignScript.Geometry import *

# Função para concatenar os valores de uma lista em uma única string com múltiplas linhas
def concatenate_list_to_string(input_list, delimiter="\n"):
    # Verifica se a entrada é uma lista
    if not isinstance(input_list, list):
        return "A entrada deve ser uma lista."
    
    # Converte todos os elementos para string e junta com o delimitador especificado
    result = delimiter.join(str(item) for item in input_list)
    return result

# Entrada pelo nó do Dynamo
lista = IN[0]  # Lista de valores a serem concatenados
delimitador = IN[1] if len(IN) > 1 else "\n"  # Delimitador opcional, padrão é nova linha

# Saída para o Dynamo
OUT = concatenate_list_to_string(lista, delimitador)
# ----------------------------------------
python_script = Python(IN[0]=fromList)
# ---------- python_script.python (21 lines) ----------
# Importar as bibliotecas necessárias do Revit
import clr
clr.AddReference("RevitServices")
from RevitServices.Persistence import DocumentManager

clr.AddReference("RevitAPI")
clr.AddReference("RevitAPIUI")
from Autodesk.Revit.UI import TaskDialog

# Pegar a entrada do Dynamo
mensagem = IN[0]

# Criar a TaskDialog
task_dialog = TaskDialog("Ok")
task_dialog.MainInstruction = mensagem

# Exibir a TaskDialog
task_dialog.Show()

# Saída do script
OUT = "Sucesso!"
# ----------------------------------------

code_block_14 = CodeBlock { "Elevação do Ponto"; }
setParameterByName_3 = Element.SetParameterByName(element=setParameterByName, parameterName=code_block_14, value=getParameterValueByName)
