# Dynamo graph 02-2_BIMACON_Inserir Luminárias nos forros do link_R02_script.dyn "ok 02-2_BIMACON_Inserir Luminárias nos forros do link_R02_script" (Dynamo 2.19.3.6394)
# author: Jose Nelson
# packages: archi-lab.net 2023.213.1722, Data-Shapes 2022.2.105, Genius Loci 2023.2.21, Crumple 2021.9.24, Synthesize toolkit 12.5.1, MEPover 2022.10.30

# group: ENTRADAS PARA O USUÁRIO
code_block = CodeBlock { "Inserção de Luminárias"; }
string = StringInput("LogoBimacon.png")
python_script = Python(IN[0]=string)  # IronPython2
# ---------- python_script.python (22 lines) ----------
import clr

# Adiciona referência ao ambiente .NET
clr.AddReference('System')
from System import Environment, IO

# Nome da imagem (entrada do usuário)
nome_arquivo_imagem = IN[0]

# Recupera o nome do usuário logado no Windows
usuario = Environment.UserName

# Monta o caminho completo para a pasta de imagens
caminho_base = r"C:\Users\{0}\AppData\Roaming\pyRevit\Extensions\Bimacon.extension\Bimacon.tab\Imagens_Bimacon".format(usuario)

# Junta o caminho base com o nome do arquivo
caminho_completo = IO.Path.Combine(caminho_base, nome_arquivo_imagem)

# Verifica se o arquivo existe
existe = IO.File.Exists(caminho_completo)

OUT = caminho_completo if existe else "Imagem não encontrada: {0}".format(caminho_completo)
# ----------------------------------------
file_from_path = FileObject(path=python_script)
readFromFile = Image.ReadFromFile(file=file_from_path)
string_2 = StringInput("Confirmar")
code_block_2 = CodeBlock { "Selecione o arquivo para obter os forros:"; }
revitlinks = Custom[© RevitLinks]()  # package Crumple; Returns all Revit link types in the current document, as well as all instance elements of those types.
flatten = List.Flatten(list=revitlinks.linkTypes)
name = Element.Name(element=flatten)
length = String.Length(string=name)
number = DoubleInput(4)
sub = length - number
remove = String.Remove(string=name, startIndex=sub, count=number)
flatten_2 = List.Flatten(list=revitlinks.linkInstances)
code_block_3 = CodeBlock { 0; }
dropdown_data = Custom[DropDown Data](InputName=code_block_2, Keys=remove, Values=flatten_2, DefaultValueIndex=code_block_3)  # package Data-Shapes; Create data for DropDown input in UI.MultiInputForm ++ . Check out www.data-shapes.net for more infos.
string_3 = StringInput("Selecione o Tipo de Luminária")
element_classes = ElementTypes("FamilySymbol")
all_elements_of_class = ElementsOfType(element_class=element_classes)
categories = Categories("OST_LightingFixtures")
string_from_object = FromObject(object=categories)
getCategory = Element.GetCategory(element=all_elements_of_class)
string_from_object_2 = FromObject(object=getCategory)
eq = string_from_object == string_from_object_2
filterByBoolMask = List.FilterByBoolMask(list=all_elements_of_class, mask=eq)
family = FamilyType.Family(familyType=filterByBoolMask.in)
name_2 = Family.Name(family=family)
code_block_4 = CodeBlock { "Lum."; }
contains = String.Contains(string=name_2, searchFor=code_block_4)
filterByBoolMask_2 = List.FilterByBoolMask(list=family, mask=contains)
list_sortnatural = Custom[List SortNatural](list=filterByBoolMask_2.in)  # package Genius Loci; Sorts a specified list in natural order in either ascending or descending order.
types = Family.Types(family=list_sortnatural)
flatten_3 = List.Flatten(list=types)
uniqueItems = List.UniqueItems(list=flatten_3)
family_2 = FamilyType.Family(familyType=uniqueItems)
name_3 = Family.Name(family=family_2)
string_4 = StringInput(" ")
add = name_3 + string_4
name_4 = FamilyType.Name(familyType=uniqueItems)
add_2 = add + name_4
code_block_5 = CodeBlock { 31; }
dropdown_data_2 = Custom[DropDown Data](InputName=string_3, Keys=add_2, Values=uniqueItems, DefaultValueIndex=code_block_5)
list_create = List.Create(item0=dropdown_data, item1=dropdown_data_2)
boolean = BoolSelector(true)
string_5 = StringInput("Cancelar")
number_2 = DoubleInput(700)
number_3 = DoubleInput(205)
multipleinputform = Custom[MultipleInputForm ++](Description_optional=code_block, Logo_optional=readFromFile, ButtonText_optional=string_2, Inputs=list_create, Toggle=boolean, CancelButtonText_optional=string_5, Width_optional=number_2, LabelWidth_optional=number_3)  # package Data-Shapes; Create a form with multiple inputs. see www.data-shapes.net for tutorials and infos!
code_block_6 = CodeBlock()  # //archilab
code_block_7 = CodeBlock()  # //Data-Shapes
byName = Family.ByName(name=name_2)
al_get_documents = Custom[AL.Get Documents]()  # package Synthesize toolkit; Queries all linked Revit files and retrieves their Name, LinkInstance and Document properties.

# group: Separar Entradas
code_block_8 = CodeBlock { 1; }
getItemAtIndex = List.GetItemAtIndex(list=multipleinputform.User_Inputs, index=code_block_8)
code_block_9 = CodeBlock { 0; }
getItemAtIndex_2 = List.GetItemAtIndex(list=multipleinputform.User_Inputs, index=code_block_9)

categories_2 = Categories("OST_Ceilings")
selectByCateOrType = Custom[SelectByCateOrType](CategoryOrType=categories_2, docOrRevitLinkInstance=getItemAtIndex_2)  # package Genius Loci; Collect elements by Category, Element Type or Family Type in the given document. The transform CS is returned only with a LinkInstance input.
solids = Element.Solids(element=selectByCateOrType.Element)
centroid = Solid.Centroid(solid=solids)
transform = Geometry.Transform(geometry=centroid, cs=selectByCateOrType.Transform, lacing=Longest)
X = Point.X(point=transform)
flatten_4 = List.Flatten(list=X)
Y = Point.Y(point=transform)
flatten_5 = List.Flatten(list=Y)
number_4 = DoubleInput(0)
byCoordinates = Point.ByCoordinates(x=flatten_4, y=flatten_5, z=number_4)
element_classes_2 = ElementTypes("Level")
all_elements_of_class_2 = ElementsOfType(element_type=element_classes_2)
code_block_10 = CodeBlock { "Nível"; }
getParameterAsValueString = Custom[GetParameterAsValueString](Elements=selectByCateOrType.Element, ParameterName=code_block_10)  # package MEPover; Returns the parameter values without conversion to the revit internal unit system. The suffix boolean toggles the project units on or off
name_5 = Level.Name(level=all_elements_of_class_2)
length_2 = String.Length(string=name_5)
number_5 = DoubleInput(6)
sub_2 = length_2 - number_5
remove_2 = String.Remove(string=name_5, startIndex=sub_2, count=number_5)
boolean_2 = BoolSelector(true)
contains_2 = String.Contains(string=getParameterAsValueString, searchFor=remove_2, ignoreCase=boolean_2, lacing=CrossProduct)
filterByBoolMask_3 = List.FilterByBoolMask(list=all_elements_of_class_2, mask=contains_2@L2)
flatten_6 = List.Flatten(list=filterByBoolMask_3.in)
byPointAndLevel = FamilyInstance.ByPointAndLevel(familyType=getItemAtIndex, point=byCoordinates, level=flatten_6)
code_block_11 = CodeBlock { "Elevação do Ponto"; }
code_block_12 = CodeBlock { "Altura do deslocamento do nível"; }
getParameterValueByName = Element.GetParameterValueByName(element=selectByCateOrType.Element, parameterName=code_block_12)
setParameterByName = Element.SetParameterByName(element=byPointAndLevel, parameterName=code_block_11, value=getParameterValueByName)
code_block_13 = CodeBlock { "Altura Rebaixo"; }
setParameterByName_2 = Element.SetParameterByName(element=setParameterByName, parameterName=code_block_13, value=getParameterValueByName)

# group: Mensagem final
passThrough = Custom[PassThrough](passThrough=setParameterByName, waitFor=setParameterByName_2)  # package archi-lab.net; Ripped this off from Clockwork. Sorry Andy.
count = List.Count(list=passThrough)
code_block_14 = CodeBlock { 0; }
code_block_15 = CodeBlock(a=count, b=code_block_14, x=passThrough) { a; b; x == null ? b : a; }
gt = code_block_15.out2 > code_block_14
code_block_16 = CodeBlock(N=count) { ["Feito! Você inseriu "+N+" luminárias em seu projeto"]; }
code_block_17 = CodeBlock { ["Nenhuma Luminária foi inserida"]; }
if_ = If(test=gt, true=code_block_16, false=code_block_17)
flatten_7 = List.Flatten(list=if_)
fromList = Python(IN[0]=flatten_7)  # "String.FromList"; IronPython2
# ---------- fromList.python (22 lines) ----------
# Carregar as bibliotecas DesignScript e padrão do Python
import sys
import clr
clr.AddReference('ProtoGeometry')
from Autodesk.DesignScript.Geometry import *

# Função para concatenar os valores de uma lista em uma única string com múltiplas linhas
def concatenate_list_to_string(input_list, delimiter="\n"):
    # Verifica se a entrada é uma lista
    if not isinstance(input_list, list):
        return "A entrada deve ser uma lista."
    
    # Converte todos os elementos para string e junta com o delimitador especificado
    result = delimiter.join(str(item) for item in input_list)
    return result

# Entrada pelo nó do Dynamo
lista = IN[0]  # Lista de valores a serem concatenados
delimitador = IN[1] if len(IN) > 1 else "\n"  # Delimitador opcional, padrão é nova linha

# Saída para o Dynamo
OUT = concatenate_list_to_string(lista, delimitador)
# ----------------------------------------
python_script_2 = Python(IN[0]=fromList)  # IronPython2
# ---------- python_script_2.python (21 lines) ----------
# Importar as bibliotecas necessárias do Revit
import clr
clr.AddReference("RevitServices")
from RevitServices.Persistence import DocumentManager

clr.AddReference("RevitAPI")
clr.AddReference("RevitAPIUI")
from Autodesk.Revit.UI import TaskDialog

# Pegar a entrada do Dynamo
mensagem = IN[0]

# Criar a TaskDialog
task_dialog = TaskDialog("Ok")
task_dialog.MainInstruction = mensagem

# Exibir a TaskDialog
task_dialog.Show()

# Saída do script
OUT = "Sucesso!"
# ----------------------------------------

parameters = Element.Parameters(element=selectByCateOrType.Element)
Z = Point.Z(point=transform)
watch = Watch(filterByBoolMask_3.in)
