# Dynamo graph ok 2021_02-2_BIMACON_Inserir Luminárias nos forros do link_R02_script.dyn (Dynamo 2.6.1.8786)
# packages: archi-lab.net 2023.213.1722, Data-Shapes 2022.2.105, Genius Loci 2023.2.21, bimorphNodes 4.2.4, Crumple 2021.9.24

number = DoubleInput(200)

# group: ENTRADAS PARA O USUÁRIO
code_block = CodeBlock { "Inserção de Luminárias"; }
file_path = Filename("..\..\..\..\..\05 - BIMACON\01 - EMPRESA BIMACON\00 - Logos e imagens - BIMACON\ARTE BIMACON\reddonda-removebg-preview.png")
file_from_path = FileObject(path=file_path)
readFromFile = Image.ReadFromFile(file=file_from_path)
string = StringInput("Confirmar")
code_block_2 = CodeBlock { "Selecione o arquivo para obter os forros:"; }
revitlinks = Custom[© RevitLinks]()  # package Crumple; Returns all Revit link types in the current document, as well as all instance elements of those types.
number_2 = DoubleInput(4)
code_block_3 = CodeBlock { 0; }
string_2 = StringInput("Selecione o Tipo de Luminária")
element_classes = ElementTypes("FamilySymbol")
all_elements_of_class = ElementsOfType(element_class=element_classes)
categories = Categories("OST_LightingFixtures")
string_from_object = FromObject(object=categories)
getCategory = Element.GetCategory(element=all_elements_of_class)
string_from_object_2 = FromObject(object=getCategory)
eq = string_from_object == string_from_object_2
filterByBoolMask = List.FilterByBoolMask(list=all_elements_of_class, mask=eq)
family = FamilyType.Family(familyType=filterByBoolMask.in)
name = Family.Name(family=family)
code_block_4 = CodeBlock { "Lum."; }
contains = String.Contains(str=name, searchFor=code_block_4)
filterByBoolMask_2 = List.FilterByBoolMask(list=family, mask=contains)
list_sortnatural = Custom[List SortNatural](list=filterByBoolMask_2.in)  # package Genius Loci; Sorts a specified list in natural order in either ascending or descending order.
types = Family.Types(family=list_sortnatural)
flatten = List.Flatten(list=types)
uniqueItems = List.UniqueItems(list=flatten)
family_2 = FamilyType.Family(familyType=uniqueItems)
name_2 = Family.Name(family=family_2)
string_3 = StringInput(" ")
add = name_2 + string_3
name_3 = FamilyType.Name(familyType=uniqueItems)
add_2 = add + name_3
code_block_5 = CodeBlock { 31; }
dropdown_data = Custom[DropDown Data](InputName=string_2, Keys=add_2, Values=family_2, DefaultValueIndex=code_block_5)  # package Data-Shapes; Create data for DropDown input in UI.MultiInputForm ++ . Check out www.data-shapes.net for more infos.
string_4 = StringInput("Altura Rebaixo")
string_5 = StringInput("0.1")
boolean = BoolSelector(true)
textbox_data = Custom[TextBox Data](InputName=string_4, DefaultText=string_5, IsNumberEntry=boolean)  # package Data-Shapes; Create Data for TextBox input in UI.MultipleInputForm ++ . Check out www.data-shapes.net for more informations
boolean_2 = BoolSelector(true)
string_6 = StringInput("Cancelar")
number_3 = DoubleInput(700)
code_block_6 = CodeBlock()  # //archilab
code_block_7 = CodeBlock()  # //Data-Shapes
byName = Family.ByName(name=name)

flatten_2 = List.Flatten(list=revitlinks.linkTypes)

# group (continued): ENTRADAS PARA O USUÁRIO
name_4 = Element.Name(element=flatten_2)
length = String.Length(str=name_4)
sub = length - number_2
remove = String.Remove(str=name_4, startIndex=sub, count=number_2)

flatten_3 = List.Flatten(list=revitlinks.linkInstances)

# group (continued): ENTRADAS PARA O USUÁRIO
dropdown_data_2 = Custom[DropDown Data](InputName=code_block_2, Keys=remove, Values=flatten_3, DefaultValueIndex=code_block_3)
list_create = List.Create(item0=dropdown_data_2, item1=dropdown_data, item2=textbox_data)
multipleinputform = Custom[MultipleInputForm ++](Description_optional=code_block, Logo_optional=readFromFile, ButtonText_optional=string, Inputs=list_create, Toggle=boolean_2, CancelButtonText_optional=string_6, Width_optional=number_3, LabelWidth_optional=number)  # package Data-Shapes; Create a form with multiple inputs. see www.data-shapes.net for tutorials and infos!

# group: Separar Entradas
code_block_8 = CodeBlock { 1; }
getItemAtIndex = List.GetItemAtIndex(list=multipleinputform.User_Inputs, index=code_block_8)
types_2 = Family.Types(family=getItemAtIndex)
code_block_9 = CodeBlock { 0; }
getItemAtIndex_2 = List.GetItemAtIndex(list=types_2, index=code_block_9)
code_block_10 = CodeBlock { 0; }
getItemAtIndex_3 = List.GetItemAtIndex(list=multipleinputform.User_Inputs, index=code_block_10)

categories_2 = Categories("OST_Ceilings")
ofCategory = Revit.LinkElement.OfCategory(linkInstance=getItemAtIndex_3, category=categories_2)
solids = Element.Solids(element=ofCategory)
centroid = Solid.Centroid(solid=solids)
X = Point.X(point=centroid)
flatten_4 = List.Flatten(list=X)
Y = Point.Y(point=centroid)
flatten_5 = List.Flatten(list=Y)
number_4 = DoubleInput(0)
byCoordinates = Point.ByCoordinates(x=flatten_4, y=flatten_5, z=number_4)
element_classes_2 = ElementTypes("Level")
all_elements_of_class_2 = ElementsOfType(element_type=element_classes_2)
name_5 = Level.Name(level=all_elements_of_class_2)
code_block_11 = CodeBlock { "Nível"; }
getParameterValueByName = Element.GetParameterValueByName(element=ofCategory, parameterName=code_block_11)
name_6 = Level.Name(level=getParameterValueByName)
contains_2 = String.Contains(str=name_5, searchFor=name_6)
filterByBoolMask_3 = List.FilterByBoolMask(list=all_elements_of_class_2, mask=contains_2)
byHostAndPoint = archilab.Revit.Elements.FamilyInstances.ByHostAndPoint(familyType=getItemAtIndex_2, point=byCoordinates@L1, host=filterByBoolMask_3.in)
code_block_12 = CodeBlock { "Deslocamento do hospedeiro"; }
elevation = Level.Elevation(level=filterByBoolMask_3.in)
setParameterByName = Element.SetParameterByName(element=byHostAndPoint@L1, parameterName=code_block_12, value=elevation)
code_block_13 = CodeBlock { "Altura Rebaixo"; }
code_block_14 = CodeBlock { "Altura do deslocamento do nível"; }
getParameterValueByName_2 = Element.GetParameterValueByName(element=ofCategory, parameterName=code_block_14)
code_block_15 = CodeBlock { 2; }
getItemAtIndex_4 = List.GetItemAtIndex(list=multipleinputform.User_Inputs, index=code_block_15)
sub_2 = getParameterValueByName_2 - getItemAtIndex_4
setParameterByName_2 = Element.SetParameterByName(element=setParameterByName, parameterName=code_block_13, value=sub_2)

# group: Mensagem final
passThrough = Custom[PassThrough](passThrough=setParameterByName_2, waitFor=setParameterByName)  # package archi-lab.net; Ripped this off from Clockwork. Sorry Andy.
count = List.Count(list=passThrough)
code_block_16 = CodeBlock { 0; }
gt = count > code_block_16
code_block_17 = CodeBlock(N=count) { ["Feito! Você inseriu "+N+" luminárias em seu projeto"]; }
code_block_18 = CodeBlock { ["Nenhuma Luminária foi inserida"]; }
if_ = If(test=gt, true=code_block_17, false=code_block_18)
flatten_6 = List.Flatten(list=if_)
fromList = Python(IN[0]=flatten_6)  # "String.FromList"
# ---------- fromList.python (22 lines) ----------
# Carregar as bibliotecas DesignScript e padrão do Python
import sys
import clr
clr.AddReference('ProtoGeometry')
from Autodesk.DesignScript.Geometry import *

# Função para concatenar os valores de uma lista em uma única string com múltiplas linhas
def concatenate_list_to_string(input_list, delimiter="\n"):
    # Verifica se a entrada é uma lista
    if not isinstance(input_list, list):
        return "A entrada deve ser uma lista."
    
    # Converte todos os elementos para string e junta com o delimitador especificado
    result = delimiter.join(str(item) for item in input_list)
    return result

# Entrada pelo nó do Dynamo
lista = IN[0]  # Lista de valores a serem concatenados
delimitador = IN[1] if len(IN) > 1 else "\n"  # Delimitador opcional, padrão é nova linha

# Saída para o Dynamo
OUT = concatenate_list_to_string(lista, delimitador)
# ----------------------------------------
python_script = Python(IN[0]=fromList)
# ---------- python_script.python (21 lines) ----------
# Importar as bibliotecas necessárias do Revit
import clr
clr.AddReference("RevitServices")
from RevitServices.Persistence import DocumentManager

clr.AddReference("RevitAPI")
clr.AddReference("RevitAPIUI")
from Autodesk.Revit.UI import TaskDialog

# Pegar a entrada do Dynamo
mensagem = IN[0]

# Criar a TaskDialog
task_dialog = TaskDialog("Ok")
task_dialog.MainInstruction = mensagem

# Exibir a TaskDialog
task_dialog.Show()

# Saída do script
OUT = "Sucesso!"
# ----------------------------------------

flatten_7 = List.Flatten(list=centroid)
code_block_19 = CodeBlock { "Elevação do Ponto"; }
setParameterByName_3 = Element.SetParameterByName(element=setParameterByName, parameterName=code_block_19, value=getParameterValueByName_2)
