# Dynamo graph 02-0_BIMACON_Inserir Luminárias nos Ambientes(Spaces) por nível_R06_script.dyn "02-0_BIMACON_Inserir Luminárias nos Ambientes(Spaces) por nível_R05_script" (Dynamo 3.3.0.6316)
# author: Jose Nelson
# Inseri Luminárias nos centros dos Ambientes
# packages: spring nodes 210.1.1, archi-lab.net 2023.213.1722, Data-Shapes 2022.2.105, Genius Loci 2023.2.21

categories = Categories("OST_MEPSpaces")
all_elements_of_category = ElementsOfCategory(Category=categories)
name = Space.Name(space=all_elements_of_category)
code_block = CodeBlock { ["Claraboia","Clarabóia","Escada","Escadas","Elevador"]; }
string_contains_varias_palavras = Python(IN[0]=name, IN[1]=code_block)  # IronPython2
# ---------- string_contains_varias_palavras.python (14 lines) ----------
# Entrada IN[0]: lista de nomes dos espaços
# Entrada IN[1]: lista de palavras-chave a remover

names = IN[0]
terms = IN[1]

outList = []

for name in names:
    # Verifica se qualquer termo está contido no nome (ignora maiúsculas/minúsculas)
    found = any(term.lower() in name.lower() for term in terms)
    outList.append(not found)  # True se NÃO contiver, ou seja, deve ser mantido

OUT = outList
# ----------------------------------------
filterByBoolMask = List.FilterByBoolMask(list=all_elements_of_category, mask=string_contains_varias_palavras)
code_block_2 = CodeBlock { "Nível"; }
getParameterValueByName = Element.GetParameterValueByName(element=filterByBoolMask.in, parameterName=code_block_2)

# group: ENTRADAS PARA O USUÁRIO
code_block_3 = CodeBlock { "Inserção de Luminárias"; }
string = StringInput("LogoBimacon.png")
python_script = Python(IN[0]=string)  # IronPython2
# ---------- python_script.python (22 lines) ----------
import clr

# Adiciona referência ao ambiente .NET
clr.AddReference('System')
from System import Environment, IO

# Nome da imagem (entrada do usuário)
nome_arquivo_imagem = IN[0]

# Recupera o nome do usuário logado no Windows
usuario = Environment.UserName

# Monta o caminho completo para a pasta de imagens
caminho_base = r"C:\Users\{0}\AppData\Roaming\pyRevit\Extensions\Bimacon.extension\Bimacon.tab\Imagens_Bimacon".format(usuario)

# Junta o caminho base com o nome do arquivo
caminho_completo = IO.Path.Combine(caminho_base, nome_arquivo_imagem)

# Verifica se o arquivo existe
existe = IO.File.Exists(caminho_completo)

OUT = caminho_completo if existe else "Imagem não encontrada: {0}".format(caminho_completo)
# ----------------------------------------
file_from_path = FileObject(path=python_script)
readFromFile = Image.ReadFromFile(file=file_from_path)
string_2 = StringInput("Confirmar")
string_3 = StringInput("Selecione o Tipo de Luminária")
element_classes = ElementTypes("FamilySymbol")
all_elements_of_class = ElementsOfType(element_class=element_classes)
categories_2 = Categories("OST_LightingFixtures")
string_from_object = FromObject(object=categories_2)
getCategory = Element.GetCategory(element=all_elements_of_class)
string_from_object_2 = FromObject(object=getCategory)
eq = string_from_object == string_from_object_2
filterByBoolMask_2 = List.FilterByBoolMask(list=all_elements_of_class, mask=eq)
family = FamilyType.Family(familyType=filterByBoolMask_2.in)
name_2 = Family.Name(family=family)
code_block_4 = CodeBlock { "Lum."; }
contains = String.Contains(string=name_2, searchFor=code_block_4)
filterByBoolMask_3 = List.FilterByBoolMask(list=family, mask=contains)
list_sortnatural = Custom[List SortNatural](list=filterByBoolMask_3.in)  # package Genius Loci; Sorts a specified list in natural order in either ascending or descending order.
types = Family.Types(family=list_sortnatural)
flatten = List.Flatten(list=types)
uniqueItems = List.UniqueItems(list=flatten)
family_2 = FamilyType.Family(familyType=uniqueItems)
name_3 = Family.Name(family=family_2)
string_4 = StringInput(" ")
add = name_3 + string_4
name_4 = FamilyType.Name(familyType=uniqueItems)
add_2 = add + name_4
code_block_5 = CodeBlock { 34; }
dropdown_data = Custom[DropDown Data](InputName=string_3, Keys=add_2, Values=uniqueItems, DefaultValueIndex=code_block_5)  # package Data-Shapes; Create data for DropDown input in UI.MultiInputForm ++ . Check out www.data-shapes.net for more infos.
string_5 = StringInput("Altura Ponto de Luz - geralmente do piso até a parte inferior da laje ou até o forro ")
string_6 = StringInput("2.9")
boolean = BoolSelector(true)
textbox_data = Custom[TextBox Data](InputName=string_5, DefaultText=string_6, IsNumberEntry=boolean)  # package Data-Shapes; Create Data for TextBox input in UI.MultipleInputForm ++ . Check out www.data-shapes.net for more informations
string_7 = StringInput("Altura do Forro")
string_8 = StringInput("2.6")
boolean_2 = BoolSelector(true)
textbox_data_2 = Custom[TextBox Data](InputName=string_7, DefaultText=string_8, IsNumberEntry=boolean_2)
string_9 = StringInput("Selecione o Nível")
element_types = ElementTypes("Level")
all_elements_of_type = ElementsOfType(element_class=element_types)
string_10 = StringInput("Elevação")
getParameterValueByName_2 = Element.GetParameterValueByName(parameterName=string_10)  # unwired: element
sortByFunction = List.SortByFunction(list=all_elements_of_type, sortFunction=getParameterValueByName_2)
name_5 = Level.Name(level=sortByFunction)
code_block_6 = CodeBlock { 1; }
boolean_3 = BoolSelector(false)
dropdown_data_2 = Custom[DropDown Data](InputName=string_9, Keys=name_5, Values=name_5, DefaultValueIndex=code_block_6, Sorted_optional=boolean_3)
list_create = List.Create(item0=dropdown_data, item1=textbox_data, item2=textbox_data_2, item3=dropdown_data_2)
boolean_4 = BoolSelector(true)
string_11 = StringInput("Cancelar")
number = DoubleInput(700)
multipleinputform = Custom[MultipleInputForm ++](Description_optional=code_block_3, Logo_optional=readFromFile, ButtonText_optional=string_2, Inputs=list_create, Toggle=boolean_4, CancelButtonText_optional=string_11, Width_optional=number)  # package Data-Shapes; Create a form with multiple inputs. see www.data-shapes.net for tutorials and infos!
byName = Family.ByName(name=name_2)
code_block_7 = CodeBlock()  # //Data-Shapes
code_block_8 = CodeBlock()  # //archilab

# group: Separar Entradas
code_block_9 = CodeBlock { 3; }
getItemAtIndex = List.GetItemAtIndex(list=multipleinputform.User_Inputs, index=code_block_9)
code_block_10 = CodeBlock { 0; }
getItemAtIndex_2 = List.GetItemAtIndex(list=multipleinputform.User_Inputs, index=code_block_10)
code_block_11 = CodeBlock { 1; }
getItemAtIndex_3 = List.GetItemAtIndex(list=multipleinputform.User_Inputs, index=code_block_11)
code_block_12 = CodeBlock { 2; }
getItemAtIndex_4 = List.GetItemAtIndex(list=multipleinputform.User_Inputs, index=code_block_12)

eq_2 = getParameterValueByName == getItemAtIndex
filterByBoolMask_4 = List.FilterByBoolMask(list=filterByBoolMask.in, mask=eq_2)
solids = Element.Solids(element=filterByBoolMask_4.in)
code_block_13 = CodeBlock { false; }
clean = List.Clean(list=solids, preserveIndices=code_block_13)
centroid = Solid.Centroid(solid=clean)
X = Point.X(point=centroid)
flatten_2 = List.Flatten(list=X)
Y = Point.Y(point=centroid)
flatten_3 = List.Flatten(list=Y)
number_2 = DoubleInput(0)
byCoordinates = Point.ByCoordinates(x=flatten_2, y=flatten_3, z=number_2)
ꟿ_familyinstance_byhostandpoint = Custom[ꟿ FamilyInstance.ByHostAndPoint](host=filterByBoolMask_4.in, type=getItemAtIndex_2, point=byCoordinates)  # package spring nodes; Creates hosted family instances(doors/windows) at the specified points. You can feed either a single family type or a unique type for each instance.
code_block_14 = CodeBlock { "Elevação do Ponto"; }
setParameterByName = Element.SetParameterByName(element=ꟿ_familyinstance_byhostandpoint, parameterName=code_block_14, value=getItemAtIndex_3)
code_block_15 = CodeBlock { "Altura Rebaixo"; }
setParameterByName_2 = Element.SetParameterByName(element=setParameterByName, parameterName=code_block_15, value=getItemAtIndex_4)

# group: Mensagem final
passThrough = Custom[PassThrough](passThrough=ꟿ_familyinstance_byhostandpoint, waitFor=setParameterByName_2)  # package archi-lab.net; Ripped this off from Clockwork. Sorry Andy.
count = List.Count(list=passThrough)
code_block_16 = CodeBlock { 0; }
gt = count > code_block_16
code_block_17 = CodeBlock(N=count) { ["Feito! Você inseriu "+N+" luminárias em seu projeto"]; }
code_block_18 = CodeBlock { ["Nenhuma Luminária foi inserida"]; }
if_ = If(test=gt, true=code_block_17, false=code_block_18)
flatten_4 = List.Flatten(list=if_)
fromList = Python(IN[0]=flatten_4)  # "String.FromList"; IronPython2
# ---------- fromList.python (22 lines) ----------
# Carregar as bibliotecas DesignScript e padrão do Python
import sys
import clr
clr.AddReference('ProtoGeometry')
from Autodesk.DesignScript.Geometry import *

# Função para concatenar os valores de uma lista em uma única string com múltiplas linhas
def concatenate_list_to_string(input_list, delimiter="\n"):
    # Verifica se a entrada é uma lista
    if not isinstance(input_list, list):
        return "A entrada deve ser uma lista."
    
    # Converte todos os elementos para string e junta com o delimitador especificado
    result = delimiter.join(str(item) for item in input_list)
    return result

# Entrada pelo nó do Dynamo
lista = IN[0]  # Lista de valores a serem concatenados
delimitador = IN[1] if len(IN) > 1 else "\n"  # Delimitador opcional, padrão é nova linha

# Saída para o Dynamo
OUT = concatenate_list_to_string(lista, delimitador)
# ----------------------------------------
python_script_2 = Python(IN[0]=fromList)  # IronPython2
# ---------- python_script_2.python (21 lines) ----------
# Importar as bibliotecas necessárias do Revit
import clr
clr.AddReference("RevitServices")
from RevitServices.Persistence import DocumentManager

clr.AddReference("RevitAPI")
clr.AddReference("RevitAPIUI")
from Autodesk.Revit.UI import TaskDialog

# Pegar a entrada do Dynamo
mensagem = IN[0]

# Criar a TaskDialog
task_dialog = TaskDialog("Ok")
task_dialog.MainInstruction = mensagem

# Exibir a TaskDialog
task_dialog.Show()

# Saída do script
OUT = "Sucesso!"
# ----------------------------------------
