# Dynamo graph 2021_02-0_BIMACON_Inserir Luminárias nos Ambientes(Spaces) por nível_R01_script.dyn "ok 2021_02-0_BIMACON_Inserir Luminárias nos Ambientes(Spaces) por nível_R01" (Dynamo 2.6.1.8786)
# Inseri Luminárias nos centros dos Ambientes
# packages: spring nodes 210.1.1, Data-Shapes 2022.2.105, Orchid 2.6.8.6198, archi-lab.net 2023.213.1722

# group: ENTRADAS PARA O USUÁRIO
code_block = CodeBlock()  # //Data-Shapes
code_block_2 = CodeBlock { "Inserção de Luminárias"; }
file_path = Filename("..\..\..\..\..\05 - BIMACON\01 - EMPRESA BIMACON\00 - Logos e imagens - BIMACON\ARTE BIMACON\reddonda-removebg-preview.png")
file_from_path = FileObject(path=file_path)
readFromFile = Image.ReadFromFile(file=file_from_path)
string = StringInput("Confirmar")
string_2 = StringInput("Selecione o Tipo de Luminária")
categories = Categories("OST_LightingFixtures")
all_elements_of_category = ElementsOfCategory(Category=categories)
elementType = Element.ElementType(element=all_elements_of_category)
familyName = ElementType.FamilyName(elementType=elementType)
code_block_3 = CodeBlock { "Lum."; }
contains = String.Contains(str=familyName, searchFor=code_block_3)
filterByBoolMask = List.FilterByBoolMask(list=familyName, mask=contains)
uniqueItems = List.UniqueItems(list=filterByBoolMask.in)
byName = Family.ByName(name=familyName)
filterByBoolMask_2 = List.FilterByBoolMask(list=byName, mask=contains)
uniqueItems_2 = List.UniqueItems(list=filterByBoolMask_2.in)
code_block_4 = CodeBlock { 11; }
dropdown_data = Custom[DropDown Data](InputName=string_2, Keys=uniqueItems, Values=uniqueItems_2, DefaultValueIndex=code_block_4)  # package Data-Shapes; Create data for DropDown input in UI.MultiInputForm ++ . Check out www.data-shapes.net for more infos.
string_3 = StringInput("Altura Ponto de Luz")
string_4 = StringInput("2.9")
boolean = BoolSelector(true)
textbox_data = Custom[TextBox Data](InputName=string_3, DefaultText=string_4, IsNumberEntry=boolean)  # package Data-Shapes; Create Data for TextBox input in UI.MultipleInputForm ++ . Check out www.data-shapes.net for more informations
string_5 = StringInput("Selecione o Nível")
element_types = ElementTypes("Level")
all_elements_of_type = ElementsOfType(element_type=element_types)
name = Level.Name(level=all_elements_of_type)
code_block_5 = CodeBlock { 0; }
dropdown_data_2 = Custom[DropDown Data](InputName=string_5, Keys=name, Values=name, DefaultValueIndex=code_block_5)
list_create = List.Create(item0=dropdown_data, item1=textbox_data, item2=dropdown_data_2)
boolean_2 = BoolSelector(true)
string_6 = StringInput("Cancelar")
number = DoubleInput(500)
multipleinputform = Custom[MultipleInputForm ++](Description_optional=code_block_2, Logo_optional=readFromFile, ButtonText_optional=string, Inputs=list_create, Toggle=boolean_2, CancelButtonText_optional=string_6, Width_optional=number)  # package Data-Shapes; Create a form with multiple inputs. see www.data-shapes.net for tutorials and infos!
code_block_6 = CodeBlock()  # //archilab

categories_2 = Categories("OST_MEPSpaces")
all_elements_of_category_2 = ElementsOfCategory(Category=categories_2)
code_block_7 = CodeBlock { "Nível"; }
getParameterValueByName = Element.GetParameterValueByName(element=all_elements_of_category_2, parameterName=code_block_7)

# group: Separar Entradas
code_block_8 = CodeBlock { 2; }
getItemAtIndex = List.GetItemAtIndex(list=multipleinputform.User_Inputs, index=code_block_8)
code_block_9 = CodeBlock { 0; }
getItemAtIndex_2 = List.GetItemAtIndex(list=multipleinputform.User_Inputs, index=code_block_9)
types = Family.Types(family=getItemAtIndex_2)
code_block_10 = CodeBlock { 0; }
getItemAtIndex_3 = List.GetItemAtIndex(list=types, index=code_block_10)
code_block_11 = CodeBlock { 1; }
getItemAtIndex_4 = List.GetItemAtIndex(list=multipleinputform.User_Inputs, index=code_block_11)

eq = getParameterValueByName == getItemAtIndex
filterByBoolMask_3 = List.FilterByBoolMask(list=all_elements_of_category_2, mask=eq)
solids = Element.Solids(element=filterByBoolMask_3.in)
code_block_12 = CodeBlock { false; }
clean = List.Clean(list=solids, preserveIndices=code_block_12)
centroid = Solid.Centroid(solid=clean)
X = Point.X(point=centroid)
flatten = List.Flatten(list=X)
Y = Point.Y(point=centroid)
flatten_2 = List.Flatten(list=Y)
number_2 = DoubleInput(0)
byCoordinates = Point.ByCoordinates(x=flatten, y=flatten_2, z=number_2)
ꟿ_familyinstance_byhostandpoint = Custom[ꟿ FamilyInstance.ByHostAndPoint](host=filterByBoolMask_3.in, type=getItemAtIndex_3, point=byCoordinates)  # package spring nodes; Creates hosted family instances(doors/windows) at the specified points. You can feed either a single family type or a unique type for each instance.
code_block_13 = CodeBlock { "Elevação do Ponto"; }
setParameterByName = Element.SetParameterByName(element=ꟿ_familyinstance_byhostandpoint, parameterName=code_block_13, value=getItemAtIndex_4)

# group: Mensagem final
passThrough = Custom[PassThrough](passThrough=ꟿ_familyinstance_byhostandpoint, waitFor=setParameterByName)  # package archi-lab.net; Ripped this off from Clockwork. Sorry Andy.
count = List.Count(list=passThrough)
code_block_14 = CodeBlock { 0; }
gt = count > code_block_14
code_block_15 = CodeBlock(N=count) { ["Feito! Você inseriu "+N+" luminárias em seu projeto"]; }
code_block_16 = CodeBlock { ["Nenhuma Luminária foi inserida"]; }
if_ = If(test=gt, true=code_block_15, false=code_block_16)
flatten_3 = List.Flatten(list=if_)
o_string_fromlist = Orchid.Common.String.FromList(list=flatten_3)
python_script = Python(IN[0]=o_string_fromlist)
# ---------- python_script.python (21 lines) ----------
# Importar as bibliotecas necessárias do Revit
import clr
clr.AddReference("RevitServices")
from RevitServices.Persistence import DocumentManager

clr.AddReference("RevitAPI")
clr.AddReference("RevitAPIUI")
from Autodesk.Revit.UI import TaskDialog

# Pegar a entrada do Dynamo
mensagem = IN[0]

# Criar a TaskDialog
task_dialog = TaskDialog("Ok")
task_dialog.MainInstruction = mensagem

# Exibir a TaskDialog
task_dialog.Show()

# Saída do script
OUT = "Sucesso!"
# ----------------------------------------
