# Dynamo graph 2021_02-0_BIMACON_Inserir Luminárias nos Ambientes(Spaces) por nível_R03_script.dyn "ok 2021_02-0_BIMACON_Inserir Luminárias nos Ambientes(Spaces) por nível_R03_script" (Dynamo 2.19.3.6394)
# Inseri Luminárias nos centros dos Ambientes
# packages: spring nodes 210.1.1, Orchid 2.6.8.6198, archi-lab.net 2023.213.1722, Data-Shapes 2022.2.105, Orchid 2.19.3.6373

categories = Categories("OST_MEPSpaces")
all_elements_of_category = ElementsOfCategory(Category=categories)
code_block = CodeBlock { "Nível"; }
getParameterValueByName = Element.GetParameterValueByName(element=all_elements_of_category, parameterName=code_block)

# group: ENTRADAS PARA O USUÁRIO
code_block_2 = CodeBlock { "Inserção de Luminárias"; }
file_path = Filename("..\..\..\..\..\05 - BIMACON\01 - EMPRESA BIMACON\00 - Logos e imagens - BIMACON\ARTE BIMACON\reddonda-removebg-preview.png")
file_from_path = FileObject(path=file_path)
readFromFile = Image.ReadFromFile(file=file_from_path)
string = StringInput("Confirmar")
string_2 = StringInput("Selecione o Tipo de Luminária")
element_classes = ElementTypes("FamilySymbol")
all_elements_of_class = ElementsOfType(element_class=element_classes)
categories_2 = Categories("OST_LightingFixtures")
string_from_object = FromObject(object=categories_2)
getCategory = Element.GetCategory(element=all_elements_of_class)
string_from_object_2 = FromObject(object=getCategory)
eq = string_from_object == string_from_object_2
filterByBoolMask = List.FilterByBoolMask(list=all_elements_of_class, mask=eq)
family = FamilyType.Family(familyType=filterByBoolMask.in)
name = Family.Name(family=family)
code_block_3 = CodeBlock { "Lum."; }
contains = String.Contains(string=name, searchFor=code_block_3)
filterByBoolMask_2 = List.FilterByBoolMask(list=family, mask=contains)
sortNatural = Orchid.Common.List.SortNatural(list=filterByBoolMask_2.in)
types = Family.Types(family=sortNatural)
flatten = List.Flatten(list=types)
uniqueItems = List.UniqueItems(list=flatten)
family_2 = FamilyType.Family(familyType=uniqueItems)
name_2 = Family.Name(family=family_2)
string_3 = StringInput(" ")
add = name_2 + string_3
name_3 = FamilyType.Name(familyType=uniqueItems)
add_2 = add + name_3
code_block_4 = CodeBlock { 31; }
dropdown_data = Custom[DropDown Data](InputName=string_2, Keys=add_2, Values=family_2, DefaultValueIndex=code_block_4)  # package Data-Shapes; Create data for DropDown input in UI.MultiInputForm ++ . Check out www.data-shapes.net for more infos.
string_4 = StringInput("Altura Ponto de Luz")
string_5 = StringInput("2.9")
boolean = BoolSelector(true)
textbox_data = Custom[TextBox Data](InputName=string_4, DefaultText=string_5, IsNumberEntry=boolean)  # package Data-Shapes; Create Data for TextBox input in UI.MultipleInputForm ++ . Check out www.data-shapes.net for more informations
string_6 = StringInput("Selecione o Nível")
element_types = ElementTypes("Level")
all_elements_of_type = ElementsOfType(element_class=element_types)
string_7 = StringInput("Elevação")
getParameterValueByName_2 = Element.GetParameterValueByName(parameterName=string_7)  # unwired: element
sortByFunction = List.SortByFunction(list=all_elements_of_type, sortFunction=getParameterValueByName_2)
name_4 = Level.Name(level=sortByFunction)
code_block_5 = CodeBlock { 0; }
boolean_2 = BoolSelector(false)
dropdown_data_2 = Custom[DropDown Data](InputName=string_6, Keys=name_4, Values=name_4, DefaultValueIndex=code_block_5, Sorted_optional=boolean_2)
list_create = List.Create(item0=dropdown_data, item1=textbox_data, item2=dropdown_data_2)
boolean_3 = BoolSelector(true)
string_8 = StringInput("Cancelar")
number = DoubleInput(700)
multipleinputform = Custom[MultipleInputForm ++](Description_optional=code_block_2, Logo_optional=readFromFile, ButtonText_optional=string, Inputs=list_create, Toggle=boolean_3, CancelButtonText_optional=string_8, Width_optional=number)  # package Data-Shapes; Create a form with multiple inputs. see www.data-shapes.net for tutorials and infos!
byName = Family.ByName(name=name)
code_block_6 = CodeBlock()  # //Data-Shapes
code_block_7 = CodeBlock()  # //archilab

# group: Separar Entradas
code_block_8 = CodeBlock { 2; }
getItemAtIndex = List.GetItemAtIndex(list=multipleinputform.User_Inputs, index=code_block_8)
code_block_9 = CodeBlock { 0; }
getItemAtIndex_2 = List.GetItemAtIndex(list=multipleinputform.User_Inputs, index=code_block_9)
types_2 = Family.Types(family=getItemAtIndex_2)
code_block_10 = CodeBlock { 0; }
getItemAtIndex_3 = List.GetItemAtIndex(list=types_2, index=code_block_10)
code_block_11 = CodeBlock { 1; }
getItemAtIndex_4 = List.GetItemAtIndex(list=multipleinputform.User_Inputs, index=code_block_11)

eq_2 = getParameterValueByName == getItemAtIndex
filterByBoolMask_3 = List.FilterByBoolMask(list=all_elements_of_category, mask=eq_2)
solids = Element.Solids(element=filterByBoolMask_3.in)
code_block_12 = CodeBlock { false; }
clean = List.Clean(list=solids, preserveIndices=code_block_12)
centroid = Solid.Centroid(solid=clean)
X = Point.X(point=centroid)
flatten_2 = List.Flatten(list=X)
Y = Point.Y(point=centroid)
flatten_3 = List.Flatten(list=Y)
number_2 = DoubleInput(0)
byCoordinates = Point.ByCoordinates(x=flatten_2, y=flatten_3, z=number_2)
ꟿ_familyinstance_byhostandpoint = Custom[ꟿ FamilyInstance.ByHostAndPoint](host=filterByBoolMask_3.in, type=getItemAtIndex_3, point=byCoordinates)  # package spring nodes; Creates hosted family instances(doors/windows) at the specified points. You can feed either a single family type or a unique type for each instance.
code_block_13 = CodeBlock { "Elevação do Ponto"; }
setParameterByName = Element.SetParameterByName(element=ꟿ_familyinstance_byhostandpoint, parameterName=code_block_13, value=getItemAtIndex_4)

# group: Mensagem final
passThrough = Custom[PassThrough](passThrough=ꟿ_familyinstance_byhostandpoint, waitFor=setParameterByName)  # package archi-lab.net; Ripped this off from Clockwork. Sorry Andy.
count = List.Count(list=passThrough)
code_block_14 = CodeBlock { 0; }
gt = count > code_block_14
code_block_15 = CodeBlock(N=count) { ["Feito! Você inseriu "+N+" luminárias em seu projeto"]; }
code_block_16 = CodeBlock { ["Nenhuma Luminária foi inserida"]; }
if_ = If(test=gt, true=code_block_15, false=code_block_16)
flatten_4 = List.Flatten(list=if_)
o_string_fromlist = Orchid.Common.String.FromList(list=flatten_4)
python_script = Python(IN[0]=o_string_fromlist)  # IronPython2
# ---------- python_script.python (21 lines) ----------
# Importar as bibliotecas necessárias do Revit
import clr
clr.AddReference("RevitServices")
from RevitServices.Persistence import DocumentManager

clr.AddReference("RevitAPI")
clr.AddReference("RevitAPIUI")
from Autodesk.Revit.UI import TaskDialog

# Pegar a entrada do Dynamo
mensagem = IN[0]

# Criar a TaskDialog
task_dialog = TaskDialog("Ok")
task_dialog.MainInstruction = mensagem

# Exibir a TaskDialog
task_dialog.Show()

# Saída do script
OUT = "Sucesso!"
# ----------------------------------------
