# Dynamo graph 2021_03-0_BIMACON_Atribuir Potência às Luminárias_R00_script.dyn "ok 2021_03-0_BIMACON_Atribuir Potência às Luminárias" (Dynamo 2.19.3.6394)
# packages: DynaMEP 2.0.1, Rhythm 2023.4.2024, Orchid 2.6.8.6198

# group: LUMINÁRIAS
# Descrição <Clique duas vezes aqui para editar a descrição do grupo>
categories = Categories("OST_LightingFixtures")
all_elements_of_category = ElementsOfCategory(Category=categories)
elementType = Element.ElementType(element=all_elements_of_category)
family = FamilyType.Family(familyType=elementType)
name = FamilyType.Name(familyType=family)
nome_do_parâmetro = StringInput("Lum.")
contains = String.Contains(string=name, searchFor=nome_do_parâmetro)
filterByBoolMask = List.FilterByBoolMask(list=all_elements_of_category, mask=contains)
nome_do_parâmetro_2 = StringInput("Nível")
getParameterValueByName = Element.GetParameterValueByName(element=filterByBoolMask.in, parameterName=nome_do_parâmetro_2)
name_2 = Level.Name(level=getParameterValueByName)
groupByKey = List.GroupByKey(list=filterByBoolMask.in, keys=name_2)
nome_do_parâmetro_3 = StringInput("Hospedeiro")
getParameterValueByName_2 = Element.GetParameterValueByName(element=groupByKey.groups, parameterName=nome_do_parâmetro_3)
nome_do_parâmetro_4 = StringInput("Espaço")
contains_2 = String.Contains(string=getParameterValueByName_2, searchFor=nome_do_parâmetro_4)
filterByBoolMask_2 = List.FilterByBoolMask(list=groupByKey.groups, mask=contains_2)
filterByBoolMask_3 = List.FilterByBoolMask(list=getParameterValueByName_2, mask=contains_2)
code_block = CodeBlock { 4; 9; 0; }
remove = String.Remove(string=filterByBoolMask_3.in, startIndex=code_block.out2, count=code_block.out1)
sortByKey = List.SortByKey(list=filterByBoolMask_2.in, keys=remove, lacing=Longest)
length = String.Length(string=filterByBoolMask_3.in)
sub = length - code_block.out0
remove_2 = String.Remove(string=filterByBoolMask_3.in, startIndex=sub, count=code_block.out0)
sort = List.Sort(list=remove)

flatten = List.Flatten(list=sortByKey.sortedList)
nome_do_parâmetro_5 = StringInput("Potência Aparente (VA)")
flatten_2 = List.Flatten(list=sortByKey.sortedKeys)

# group: ESPAÇOS
# Descrição <Clique duas vezes aqui para editar a descrição do grupo>
categories_2 = Categories("OST_MEPSpaces")
all_elements_of_category_2 = ElementsOfCategory(Category=categories_2)
nome_do_parâmetro_6 = StringInput("Nível")
getParameterValueByName_3 = Element.GetParameterValueByName(element=all_elements_of_category_2, parameterName=nome_do_parâmetro_6)
groupByKey_2 = List.GroupByKey(list=all_elements_of_category_2, keys=getParameterValueByName_3)
name_3 = Space.Name(space=groupByKey_2.groups)
string = StringInput(" ")
add = name_3 + string
nome_do_parâmetro_7 = StringInput("Número")
getParameterValueByName_4 = Element.GetParameterValueByName(element=groupByKey_2.groups, parameterName=nome_do_parâmetro_7)
add_2 = add + getParameterValueByName_4
sortByKey_2 = List.SortByKey(list=groupByKey_2.groups, keys=add_2, lacing=Longest)
flatten_3 = List.Flatten(list=sortByKey_2.sortedList)
flatten_4 = List.Flatten(list=sortByKey_2.sortedKeys)
eq = flatten_2 == flatten_4  # lacing=CrossProduct
filterByBoolMask_4 = List.FilterByBoolMask(list=flatten_3, mask=eq@L2)
flatten_5 = List.Flatten(list=filterByBoolMask_4.in)

nome_do_parâmetro_8 = StringInput("Pot. de Iluminação (Spaces)")
ʳʰʸᵗʰᵐ_elements = Rhythm.Revit.Elements.Elements.GetParameterValueByNameTypeOrInstance(element=flatten_5, parameterName=nome_do_parâmetro_8)
unit_conversion = CodeBlock(n=ʳʰʸᵗʰᵐ_elements) { n<1>/[0.0929031299064465481842083259785]; }
setParameterValueByName = RevitModel.Element.SetParameterValueByName(element=flatten, parameterName=nome_do_parâmetro_5, values=unit_conversion)

# group: Mensagem final
count = List.Count(list=setParameterValueByName)
code_block_2 = CodeBlock { 0; }
gt = count > code_block_2
code_block_3 = CodeBlock(N=count) { ["Feito! Você atribuiu potência à "+N+" luminárias em seu projeto"]; }
code_block_4 = CodeBlock { ["Nenhuma Potência foi atribuída"]; }
if_ = If(test=gt, true=code_block_3, false=code_block_4)
flatten_6 = List.Flatten(list=if_)
o_string_fromlist = Orchid.Common.String.FromList(list=flatten_6)
python_script = Python(IN[0]=o_string_fromlist)  # IronPython2
# ---------- python_script.python (21 lines) ----------
# Importar as bibliotecas necessárias do Revit
import clr
clr.AddReference("RevitServices")
from RevitServices.Persistence import DocumentManager

clr.AddReference("RevitAPI")
clr.AddReference("RevitAPIUI")
from Autodesk.Revit.UI import TaskDialog

# Pegar a entrada do Dynamo
mensagem = IN[0]

# Criar a TaskDialog
task_dialog = TaskDialog("Ok")
task_dialog.MainInstruction = mensagem

# Exibir a TaskDialog
task_dialog.Show()

# Saída do script
OUT = "Sucesso!"
# ----------------------------------------

name_4 = Space.Name(space=flatten_5)
code_block_5 = CodeBlock { 0; }
