# Dynamo graph 2021_03-0_BIMACON_Atribuir Potência às Luminárias_script.dyn "ok 2021_03-0_BIMACON_Atribuir Potência às Luminárias" (Dynamo 2.6.1.8786)
# packages: DynaMEP 2.0.1, MEPover 2022.10.30, Rhythm 2023.4.2024, Orchid 206.6.0.5842, Orchid 2.6.8.6198

nome_do_parâmetro = StringInput("Hospedeiro")
nome_do_parâmetro_2 = StringInput("Espaço")
filterStringContains = Custom[Collector.FilterStringContains](parameter=nome_do_parâmetro, SearchValue=nome_do_parâmetro_2)  # package MEPover; Returns the most common elements (host objects and family instances) by supplying a parameter and the value to search for. Of course the parameter needs to be of type 'string' to work.
o_element_valid = Orchid.RevitProject.Elements.Element.Valid(element=filterStringContains)
nome_do_parâmetro_3 = StringInput("Potência Aparente (VA)")
categories = Categories("OST_MEPSpaces")
all_elements_of_category = ElementsOfCategory(Category=categories)
nome_do_parâmetro_4 = StringInput("Pot. de Iluminação (Spaces)")
ʳʰʸᵗʰᵐ_elements = Rhythm.Revit.Elements.Elements.GetParameterValueByNameTypeOrInstance(element=all_elements_of_category, parameterName=nome_do_parâmetro_4)
unit_conversion = CodeBlock(n=ʳʰʸᵗʰᵐ_elements) { n<1>/[0.0929031299064465481842083259785]; }
setParameterValueByName = RevitModel.Element.SetParameterValueByName(element=o_element_valid, parameterName=nome_do_parâmetro_3, values=unit_conversion)

# group: Mensagem final
count = List.Count(list=setParameterValueByName)
code_block = CodeBlock { 0; }
gt = count > code_block
code_block_2 = CodeBlock(N=count) { ["Feito! Você atribuiu potência à "+N+" luminárias em seu projeto"]; }
code_block_3 = CodeBlock { ["Nenhuma Potência foi atribuída"]; }
if_ = If(test=gt, true=code_block_2, false=code_block_3)
flatten = List.Flatten(list=if_)
o_string_fromlist = Orchid.Common.String.FromList(list=flatten)
python_script = Python(IN[0]=o_string_fromlist)
# ---------- python_script.python (21 lines) ----------
# Importar as bibliotecas necessárias do Revit
import clr
clr.AddReference("RevitServices")
from RevitServices.Persistence import DocumentManager

clr.AddReference("RevitAPI")
clr.AddReference("RevitAPIUI")
from Autodesk.Revit.UI import TaskDialog

# Pegar a entrada do Dynamo
mensagem = IN[0]

# Criar a TaskDialog
task_dialog = TaskDialog("Ok")
task_dialog.MainInstruction = mensagem

# Exibir a TaskDialog
task_dialog.Show()

# Saída do script
OUT = "Sucesso!"
# ----------------------------------------
