# Dynamo graph ok 2021_06-2_BIMACON_Deletar Luvas e Conectar eletrodutos_R02_script.dyn "ok 2021_06-2_BIMACON_Deletar Luvas e Conectar eletrodutos_R01" (Dynamo 2.6.1.8786)
# packages: MEPover 2022.10.30, archi-lab.net 2023.213.1722, bimorphNodes 4.2.4, DynaMEP 2.0.1, Data-Shapes 2022.2.105

string = StringInput("Nível")

# group: ENTRADAS PARA O USUÁRIO
code_block = CodeBlock { "Inserção de Luvas no encontro de Paredes com Lajes"; }
file_path = Filename("..\..\..\..\..\05 - BIMACON\01 - EMPRESA BIMACON\00 - Logos e imagens - BIMACON\ARTE BIMACON\reddonda-removebg-preview.png")
file_from_path = FileObject(path=file_path)
readFromFile = Image.ReadFromFile(file=file_from_path)
string_2 = StringInput("Confirmar")
string_3 = StringInput("Selecione o Nível")
categories = Categories("OST_Levels")
all_elements_of_category = ElementsOfCategory(Category=categories)
name = Level.Name(level=all_elements_of_category)
code_block_2 = CodeBlock { 0; }
dropdown_data = Custom[DropDown Data](InputName=string_3, Keys=name, Values=all_elements_of_category, DefaultValueIndex=code_block_2)  # package Data-Shapes; Create data for DropDown input in UI.MultiInputForm ++ . Check out www.data-shapes.net for more infos.
string_4 = StringInput("Altura das Luvas")
string_5 = StringInput("2.6")
boolean = BoolSelector(true)
textbox_data = Custom[TextBox Data](InputName=string_4, DefaultText=string_5, IsNumberEntry=boolean)  # package Data-Shapes; Create Data for TextBox input in UI.MultipleInputForm ++ . Check out www.data-shapes.net for more informations
string_6 = StringInput("Elevação Superior Máxima (m) Dica: Pegue a Elevação Intermediária dos Eletrodutos na Laje.")
string_7 = StringInput("2.8")
boolean_2 = BoolSelector(true)
textbox_data_2 = Custom[TextBox Data](InputName=string_6, DefaultText=string_7, IsNumberEntry=boolean_2)
list_create = List.Create(item0=dropdown_data, item1=textbox_data, item2=textbox_data_2)
boolean_3 = BoolSelector(true)
string_8 = StringInput("Cancelar")
number = DoubleInput(450)
number_2 = DoubleInput(175)
multipleinputform = Custom[MultipleInputForm ++](Description_optional=code_block, Logo_optional=readFromFile, ButtonText_optional=string_2, Inputs=list_create, Toggle=boolean_3, CancelButtonText_optional=string_8, Width_optional=number, LabelWidth_optional=number_2)  # package Data-Shapes; Create a form with multiple inputs. see www.data-shapes.net for tutorials and infos!
code_block_3 = CodeBlock()  # //Data-Shapes
code_block_4 = CodeBlock()  # //archilab

# group: Separar Entradas
code_block_5 = CodeBlock { 0; }
getItemAtIndex = List.GetItemAtIndex(list=multipleinputform.User_Inputs, index=code_block_5)
code_block_6 = CodeBlock { 1; }
getItemAtIndex_2 = List.GetItemAtIndex(list=multipleinputform.User_Inputs, index=code_block_6)
code_block_7 = CodeBlock { 2; }
getItemAtIndex_3 = List.GetItemAtIndex(list=multipleinputform.User_Inputs, index=code_block_7)

# group: Selecionar luvas
categories_2 = Categories("OST_ConduitFitting")
all_elements_of_category_2 = ElementsOfCategory(Category=categories_2)
string_9 = StringInput("Luva")
boolean_4 = BoolSelector(true)
string_10 = StringInput("Elevação do nível")

getParameterValueByName = Element.GetParameterValueByName(element=all_elements_of_category_2, parameterName=string)
name_2 = Level.Name(level=getParameterValueByName)
name_3 = Level.Name(level=getItemAtIndex)
eq = name_2 == name_3
filterByBoolMask = List.FilterByBoolMask(list=all_elements_of_category_2, mask=eq)

# group (continued): Selecionar luvas
name_4 = Element.Name(element=filterByBoolMask.in)
contains = String.Contains(str=name_4, searchFor=string_9, ignoreCase=boolean_4)
filterByBoolMask_2 = List.FilterByBoolMask(list=filterByBoolMask.in, mask=contains)
getParameterValueByName_2 = Element.GetParameterValueByName(element=filterByBoolMask_2.in, parameterName=string_10)
eq_2 = getParameterValueByName_2 == getItemAtIndex_2
filterByBoolMask_3 = List.FilterByBoolMask(list=filterByBoolMask_2.in, mask=eq_2)
watch = Watch(filterByBoolMask_3.in)

code_block_8 = CodeBlock { 0.02; }
add = getItemAtIndex_2 + code_block_8

# group: Selecionar conduite a ser deletado
mep_connector_info = Custom[MEP Connector info+](element=filterByBoolMask_3.in)  # package MEPover; This node will return the connectors and a lot of information about those connectors of the input elements
string_11 = StringInput("Elevação superior")
getParameterValueByName_3 = Element.GetParameterValueByName(element=mep_connector_info.ConnectedElements, parameterName=string_11)
gt = getParameterValueByName_3 > add
filterByBoolMask_4 = List.FilterByBoolMask(list=mep_connector_info.ConnectedElements, mask=gt)
boolean_5 = BoolSelector(false)
clean = List.Clean(list=filterByBoolMask_4.in, preserveIndices=boolean_5)
watch_2 = Watch(clean)
watch_3 = Watch(mep_connector_info.ConnectedElements)

flatten = List.Flatten(list=clean)

# group: Selecionar curva
mep_connector_info_2 = Custom[MEP Connector info+](element=flatten)
name_5 = Element.Name(element=mep_connector_info_2.ConnectedElements)
string_12 = StringInput("Curva")
boolean_6 = BoolSelector(true)
contains_2 = String.Contains(str=name_5, searchFor=string_12, ignoreCase=boolean_6)
filterByBoolMask_5 = List.FilterByBoolMask(list=mep_connector_info_2.ConnectedElements, mask=contains_2, lacing=Longest)
string_13 = StringInput("Elevação do nível")
getParameterValueByName_4 = Element.GetParameterValueByName(element=filterByBoolMask_5.in, parameterName=string_13)
gt_2 = getParameterValueByName_4 > getItemAtIndex_3
filterByBoolMask_6 = List.FilterByBoolMask(list=filterByBoolMask_5.in, mask=gt_2)
boolean_7 = BoolSelector(false)
clean_2 = List.Clean(list=filterByBoolMask_6.in, preserveIndices=boolean_7)
flatten_2 = List.Flatten(list=clean_2)
watch_4 = Watch(clean_2)

# group: Conduites a conectar
string_14 = StringInput("Elevação superior")
getParameterValueByName_5 = Element.GetParameterValueByName(element=mep_connector_info.ConnectedElements, parameterName=string_14)
le = getParameterValueByName_5 <= add
filterByBoolMask_7 = List.FilterByBoolMask(list=mep_connector_info.ConnectedElements, mask=le)
boolean_8 = BoolSelector(false)
clean_3 = List.Clean(list=filterByBoolMask_7.in, preserveIndices=boolean_8)
flatten_3 = List.Flatten(list=clean_3)
solids = Element.Solids(element=flatten_3)

# group: Unir conduite da laje com da parede
mep_connector_info_3 = Custom[MEP Connector info+](element=flatten_2)
string_15 = StringInput("Elevação superior")
getParameterValueByName_6 = Element.GetParameterValueByName(element=mep_connector_info_3.ConnectedElements, parameterName=string_15)
gt_3 = getParameterValueByName_6 > getItemAtIndex_3
filterByBoolMask_8 = List.FilterByBoolMask(list=mep_connector_info_3.ConnectedElements, mask=gt_3)
flatten_4 = List.Flatten(list=filterByBoolMask_8.in)
solids_2 = Element.Solids(element=flatten_4)
watch_5 = Watch(filterByBoolMask_8.in)
watch_6 = Watch(mep_connector_info_3.ConnectedElements)
byMEPCurves = Custom[MEPFitting.ByMEPCurves](MEPCurve1=flatten_4, MEPCurve2=flatten_3, lacing=CrossProduct)  # package MEPover; Creates a UnionFitting or ElbowFitting by 2 MEPCurves (Ducts, Cable Trays, Pipes or Conduits). The output may not always be all the fittings created as Revit sometimes creates extra transition fittings outside of the node transactions.

# group: Deletar elemento obsoleto
# note: Archilab
code_block_9 = CodeBlock(waithFor=filterByBoolMask_8.in, Pass=flatten) { [waithFor,Pass][1]; }
delete = archilab.Revit.Elements.Elements.Delete(element=code_block_9)

# group: Deletar elemento obsoleto
# note: Archilab
code_block_10 = CodeBlock(waithFor=filterByBoolMask_8.in, Pass=clean_2) { [waithFor,Pass][1]; }
delete_2 = archilab.Revit.Elements.Elements.Delete(element=code_block_10)

watch_7 = Watch(filterByBoolMask.in)
watch_8 = Watch(mep_connector_info_2.ConnectedElements)
boolean_9 = BoolSelector(false)
clean_4 = List.Clean(list=byMEPCurves, preserveIndices=boolean_9)
flatten_5 = List.Flatten(list=clean_4)

# group: Conduites desconectados
code_block_11 = CodeBlock(waithFor=flatten_5, Pass=mep_connector_info.ConnectedElements) { [waithFor,Pass][1]; }

flatten_6 = List.Flatten(list=code_block_11)

# group (continued): Conduites desconectados
connectors = RevitModel.Element.Connectors(elements=flatten_6)
isConnected = MEP.Connectors.IsConnected(connector=connectors)
filterByBoolMask_9 = List.FilterByBoolMask(list=connectors, mask=isConnected)
flatten_7 = List.Flatten(list=filterByBoolMask_9.out)
owner = MEP.Connectors.Owner(connector=flatten_7)
flatten_8 = List.Flatten(list=filterByBoolMask_9.in)
owner_2 = MEP.Connectors.Owner(connector=flatten_8)

# group: Selecionar caixas
location = MEP.Connectors.Location(connector=flatten_7)
code_block_12 = CodeBlock { 0.05; }
byCenterPointRadius = Sphere.ByCenterPointRadius(centerPoint=location, radius=code_block_12)
intersectsSolid = Revit.Element.IntersectsSolid(solids=byCenterPointRadius, elements=filterByBoolMask.in)
intersectingElements = Results.SolidIntersectionResult.IntersectingElements(solidIntersectionResult=intersectsSolid)
boolean_10 = BoolSelector(true)
clean_5 = List.Clean(list=intersectingElements, preserveIndices=boolean_10)
firstItem = List.FirstItem(list=clean_5@L2)
boolean_11 = BoolSelector(false)
clean_6 = List.Clean(list=firstItem, preserveIndices=boolean_11)
flatten_9 = List.Flatten(list=clean_6)
uniqueItems = List.UniqueItems(list=flatten_9)

# group: Conectar eletrodutos e caixas
list_create_2 = List.Create(item0=owner, item1=uniqueItems)
flatten_10 = List.Flatten(list=list_create_2)
python_script = Python(IN[0]=flatten_10)
# ---------- python_script.python (73 lines) ----------
import clr

clr.AddReference("RevitServices")
import RevitServices
from RevitServices.Persistence import DocumentManager
from RevitServices.Transactions import TransactionManager
doc = DocumentManager.Instance.CurrentDBDocument

clr.AddReference("RevitAPI")
from Autodesk.Revit.DB import *

clr.AddReference("RevitNodes")
import Revit
clr.ImportExtensions(Revit.Elements)
clr.ImportExtensions(Revit.GeometryConversion)

def ConnectTo(connector, conn2):
    try:
        TransactionManager.Instance.EnsureInTransaction(doc)
        connector.ConnectTo(conn2)
        TransactionManager.Instance.TransactionTaskDone()
        return 1  # Retorna 1 para indicar uma conexão feita
    except:
        return 0  # Retorna 0 para indicar uma conexão não feita

conduits = UnwrapElement(IN[0])
margin = 0.01

connectors = {}
connlist = []
connections = 0  # Variável para armazenar o número de conexões feitas

for conduit in conduits:
    if conduit is None:
        continue

    try:
        conns = conduit.ConnectorManager.Connectors
    except AttributeError:
        try:
            conns = conduit.MEPModel.ConnectorManager.Connectors
        except AttributeError:
            continue

    for conn in conns:
        if conn.IsConnected:
            continue
        connectors[conn] = None
        connlist.append(conn)

for k in connectors.keys():
    mindist = 1000000
    closest = None
    for conn in connlist:
        if conn.Owner.Id.Equals(k.Owner.Id):
            continue
        dist = k.Origin.DistanceTo(conn.Origin)
        if dist < mindist:
            mindist = dist
            closest = conn
    if mindist > margin:
        continue
    connectors[k] = closest
    connlist.remove(closest)
    try:
        del connectors[closest]
    except:
        pass

for k, v in connectors.items():
    connections += ConnectTo(k, v)  # Incrementa a variável connections com o resultado da função ConnectTo

OUT = connections  # Saída com o número total de conexões feitas
# ----------------------------------------

solids_3 = Element.Solids(element=owner)

# group: Deletar Luvas
# note: Archilab
code_block_13 = CodeBlock(waithFor=flatten, Pass=filterByBoolMask_3.in) { [waithFor,Pass][1]; }
delete_3 = archilab.Revit.Elements.Elements.Delete(element=code_block_13)

filterByBoolMask_10 = List.FilterByBoolMask(list=code_block_13, mask=delete_3)
count = List.Count(list=filterByBoolMask_10.in)

# group: Mensagem
count_2 = List.Count(list=flatten_5)
code_block_14 = CodeBlock { 0; }
gt_4 = count_2 > code_block_14
code_block_15 = CodeBlock { ["Nenhuma Luva foi deletada"]; }

sub = count - count_2

# group (continued): Mensagem
code_block_16 = CodeBlock(N=count, N2=count_2, N3=sub)
# ---------- code_block_16.designscript (3 lines) ----------
["Feito! você deletou "+N+" luvas e"];
[" conectou "+N2+" curvas em seu projeto"];
[" faltaram "+N3+" conexões de eletrodutos."];
# ----------------------------------------
code_block_17 = CodeBlock(N=code_block_16.out0, N2=code_block_16.out1, N3=code_block_16.out2) { N+N2+N3; }
if_ = If(test=gt_4, true=code_block_17, false=code_block_15)
flatten_11 = List.Flatten(list=if_)
fromList = Python(IN[0]=flatten_11)  # "String.FromList"
# ---------- fromList.python (22 lines) ----------
# Carregar as bibliotecas DesignScript e padrão do Python
import sys
import clr
clr.AddReference('ProtoGeometry')
from Autodesk.DesignScript.Geometry import *

# Função para concatenar os valores de uma lista em uma única string com múltiplas linhas
def concatenate_list_to_string(input_list, delimiter="\n"):
    # Verifica se a entrada é uma lista
    if not isinstance(input_list, list):
        return "A entrada deve ser uma lista."
    
    # Converte todos os elementos para string e junta com o delimitador especificado
    result = delimiter.join(str(item) for item in input_list)
    return result

# Entrada pelo nó do Dynamo
lista = IN[0]  # Lista de valores a serem concatenados
delimitador = IN[1] if len(IN) > 1 else "\n"  # Delimitador opcional, padrão é nova linha

# Saída para o Dynamo
OUT = concatenate_list_to_string(lista, delimitador)
# ----------------------------------------
python_script_2 = Python(IN[0]=fromList)
# ---------- python_script_2.python (21 lines) ----------
# Importar as bibliotecas necessárias do Revit
import clr
clr.AddReference("RevitServices")
from RevitServices.Persistence import DocumentManager

clr.AddReference("RevitAPI")
clr.AddReference("RevitAPIUI")
from Autodesk.Revit.UI import TaskDialog

# Pegar a entrada do Dynamo
mensagem = IN[0]

# Criar a TaskDialog
task_dialog = TaskDialog("Ok")
task_dialog.MainInstruction = mensagem

# Exibir a TaskDialog
task_dialog.Show()

# Saída do script
OUT = "Sucesso!"
# ----------------------------------------
