# Dynamo graph 2021_06-3_BIMACON_Deletar Luvas e Conectar eletrodutos po Seleção_R00_script.dyn "2021_06-3_BIMACON_Deletar Luvas e Conectar eletrodutos po Seleção_R00" (Dynamo 2.6.1.8786)
# packages: MEPover 2022.10.30, archi-lab.net 2023.213.1722, bimorphNodes 4.2.4, DynaMEP 2.0.1, Data-Shapes 2022.2.105, Genius Loci 2023.2.21

# group: ENTRADAS PARA O USUÁRIO
code_block = CodeBlock { "Deletar Luva por seleção"; }
file_path = Filename("..\..\..\..\..\05 - BIMACON\01 - EMPRESA BIMACON\00 - Logos e imagens - BIMACON\ARTE BIMACON\reddonda-removebg-preview.png")
file_from_path = FileObject(path=file_path)
readFromFile = Image.ReadFromFile(file=file_from_path)
string = StringInput("Confirmar")
string_2 = StringInput("Selecione a Luva a ser deletada")
string_3 = StringInput("Selecione")
categories = Categories("OST_ConduitFitting")
boolean = BoolSelector(true)
selectmodelelements_data = Custom[SelectModelElements Data](InputName=string_2, ButtonText=string_3, CategoryFilter=categories, SelectSingleElement=boolean)  # package Data-Shapes; Creates a Revit element selection input for UI.MultipleInputForm++ . Check out www.data-shapes.net for more infos!
string_4 = StringInput("Altura da Luva")
string_5 = StringInput("2.6")
boolean_2 = BoolSelector(true)
textbox_data = Custom[TextBox Data](InputName=string_4, DefaultText=string_5, IsNumberEntry=boolean_2)  # package Data-Shapes; Create Data for TextBox input in UI.MultipleInputForm ++ . Check out www.data-shapes.net for more informations
string_6 = StringInput("Elevação Superior Máxima (m) Dica: Pegue a Elevação Intermediária dos Eletrodutos na Laje.")
string_7 = StringInput("2.9")
boolean_3 = BoolSelector(true)
textbox_data_2 = Custom[TextBox Data](InputName=string_6, DefaultText=string_7, IsNumberEntry=boolean_3)
list_create = List.Create(item0=selectmodelelements_data, item1=textbox_data, item2=textbox_data_2)
boolean_4 = BoolSelector(true)
string_8 = StringInput("Cancelar")
number = DoubleInput(450)
number_2 = DoubleInput(205)
multipleinputform = Custom[MultipleInputForm ++](Description_optional=code_block, Logo_optional=readFromFile, ButtonText_optional=string, Inputs=list_create, Toggle=boolean_4, CancelButtonText_optional=string_8, Width_optional=number, LabelWidth_optional=number_2)  # package Data-Shapes; Create a form with multiple inputs. see www.data-shapes.net for tutorials and infos!
code_block_2 = CodeBlock()  # //Data-Shapes
code_block_3 = CodeBlock()  # //archilab

# group: Separar Entradas
code_block_4 = CodeBlock { 0; }
getItemAtIndex = List.GetItemAtIndex(list=multipleinputform.User_Inputs, index=code_block_4)
code_block_5 = CodeBlock { 1; }
getItemAtIndex_2 = List.GetItemAtIndex(list=multipleinputform.User_Inputs, index=code_block_5)
code_block_6 = CodeBlock { 2; }
getItemAtIndex_3 = List.GetItemAtIndex(list=multipleinputform.User_Inputs, index=code_block_6)

code_block_7 = CodeBlock { 0.02; }
add = getItemAtIndex_2 + code_block_7

# group: Selecionar conduite a ser deletado
mep_connector_info = Custom[MEP Connector info+](element=getItemAtIndex)  # package MEPover; This node will return the connectors and a lot of information about those connectors of the input elements
string_9 = StringInput("Elevação superior")
getParameterValueByName = Element.GetParameterValueByName(element=mep_connector_info.ConnectedElements, parameterName=string_9)
gt = getParameterValueByName > add
filterByBoolMask = List.FilterByBoolMask(list=mep_connector_info.ConnectedElements, mask=gt)
boolean_5 = BoolSelector(false)
clean = List.Clean(list=filterByBoolMask.in, preserveIndices=boolean_5)
watch = Watch(clean)
watch_2 = Watch(mep_connector_info.ConnectedElements)

flatten = List.Flatten(list=clean)

# group: Selecionar curva
mep_connector_info_2 = Custom[MEP Connector info+](element=flatten)
name = Element.Name(element=mep_connector_info_2.ConnectedElements)
string_10 = StringInput("Curva")
boolean_6 = BoolSelector(true)
contains = String.Contains(str=name, searchFor=string_10, ignoreCase=boolean_6)
filterByBoolMask_2 = List.FilterByBoolMask(list=mep_connector_info_2.ConnectedElements, mask=contains, lacing=Longest)
string_11 = StringInput("Elevação do nível")
getParameterValueByName_2 = Element.GetParameterValueByName(element=filterByBoolMask_2.in, parameterName=string_11)
gt_2 = getParameterValueByName_2 > getItemAtIndex_3
filterByBoolMask_3 = List.FilterByBoolMask(list=filterByBoolMask_2.in, mask=gt_2)
boolean_7 = BoolSelector(false)
clean_2 = List.Clean(list=filterByBoolMask_3.in, preserveIndices=boolean_7)
flatten_2 = List.Flatten(list=clean_2)
watch_3 = Watch(clean_2)

# group: Conduites a conectar
string_12 = StringInput("Elevação superior")
getParameterValueByName_3 = Element.GetParameterValueByName(element=mep_connector_info.ConnectedElements, parameterName=string_12)
le = getParameterValueByName_3 <= add
filterByBoolMask_4 = List.FilterByBoolMask(list=mep_connector_info.ConnectedElements, mask=le)
boolean_8 = BoolSelector(false)
clean_3 = List.Clean(list=filterByBoolMask_4.in, preserveIndices=boolean_8)
flatten_3 = List.Flatten(list=clean_3)
solids = Element.Solids(element=flatten_3)

# group: Unir conduite da laje com da parede
mep_connector_info_3 = Custom[MEP Connector info+](element=flatten_2)
string_13 = StringInput("Elevação superior")
getParameterValueByName_4 = Element.GetParameterValueByName(element=mep_connector_info_3.ConnectedElements, parameterName=string_13)
gt_3 = getParameterValueByName_4 > getItemAtIndex_3
filterByBoolMask_5 = List.FilterByBoolMask(list=mep_connector_info_3.ConnectedElements, mask=gt_3)
flatten_4 = List.Flatten(list=filterByBoolMask_5.in)
solids_2 = Element.Solids(element=flatten_4)
watch_4 = Watch(filterByBoolMask_5.in)
watch_5 = Watch(mep_connector_info_3.ConnectedElements)
byMEPCurves = Custom[MEPFitting.ByMEPCurves](MEPCurve1=flatten_4, MEPCurve2=flatten_3, lacing=CrossProduct)  # package MEPover; Creates a UnionFitting or ElbowFitting by 2 MEPCurves (Ducts, Cable Trays, Pipes or Conduits). The output may not always be all the fittings created as Revit sometimes creates extra transition fittings outside of the node transactions.

# group: Deletar elemento obsoleto
# note: Archilab
code_block_8 = CodeBlock(waithFor=filterByBoolMask_5.in, Pass=flatten) { [waithFor,Pass][1]; }
delete = archilab.Revit.Elements.Elements.Delete(element=code_block_8)

# group: Deletar Luvas
# note: Archilab
code_block_9 = CodeBlock(waithFor=flatten, Pass=getItemAtIndex) { [waithFor,Pass][1]; }
delete_2 = archilab.Revit.Elements.Elements.Delete(element=code_block_9)

# group: Deletar elemento obsoleto
# note: Archilab
code_block_10 = CodeBlock(waithFor=filterByBoolMask_5.in, Pass=clean_2) { [waithFor,Pass][1]; }
delete_3 = archilab.Revit.Elements.Elements.Delete(element=code_block_10)

watch_6 = Watch(mep_connector_info_2.ConnectedElements)
boolean_9 = BoolSelector(false)
clean_4 = List.Clean(list=byMEPCurves, preserveIndices=boolean_9)
flatten_5 = List.Flatten(list=clean_4)

# group: Conduites desconectados
code_block_11 = CodeBlock(waithFor=flatten_5, Pass=mep_connector_info.ConnectedElements) { [waithFor,Pass][1]; }

flatten_6 = List.Flatten(list=code_block_11)

# group (continued): Conduites desconectados
connectors = RevitModel.Element.Connectors(elements=flatten_6)
isConnected = MEP.Connectors.IsConnected(connector=connectors)
filterByBoolMask_6 = List.FilterByBoolMask(list=connectors, mask=isConnected)
flatten_7 = List.Flatten(list=filterByBoolMask_6.out)
owner = MEP.Connectors.Owner(connector=flatten_7)
flatten_8 = List.Flatten(list=filterByBoolMask_6.in)
owner_2 = MEP.Connectors.Owner(connector=flatten_8)

# group: Conexões de Conduite por nível
categories_2 = Categories("OST_ConduitFitting")
all_elements_of_category = ElementsOfCategory(Category=categories_2)
string_14 = StringInput("Nível")
getParameterValueByName_5 = Element.GetParameterValueByName(element=all_elements_of_category, parameterName=string_14)
name_2 = Level.Name(level=getParameterValueByName_5)
element_level = Custom[Element Level](element=getItemAtIndex)  # package Genius Loci; Gets an element's level. Based on a Clockwork's node
name_3 = Level.Name(level=element_level)
eq = name_2 == name_3
filterByBoolMask_7 = List.FilterByBoolMask(list=all_elements_of_category, mask=eq)

# group: Selecionar caixas
location = MEP.Connectors.Location(connector=flatten_7)
code_block_12 = CodeBlock { 0.05; }
byCenterPointRadius = Sphere.ByCenterPointRadius(centerPoint=location, radius=code_block_12)
intersectsSolid = Revit.Element.IntersectsSolid(solids=byCenterPointRadius, elements=filterByBoolMask_7.in)
intersectingElements = Results.SolidIntersectionResult.IntersectingElements(solidIntersectionResult=intersectsSolid)
boolean_10 = BoolSelector(true)
clean_5 = List.Clean(list=intersectingElements, preserveIndices=boolean_10)
firstItem = List.FirstItem(list=clean_5@L2)
boolean_11 = BoolSelector(false)
clean_6 = List.Clean(list=firstItem, preserveIndices=boolean_11)
flatten_9 = List.Flatten(list=clean_6)
uniqueItems = List.UniqueItems(list=flatten_9)

# group: Conectar eletrodutos e caixas
list_create_2 = List.Create(item0=owner, item1=uniqueItems)
flatten_10 = List.Flatten(list=list_create_2)
python_script = Python(IN[0]=flatten_10)
# ---------- python_script.python (73 lines) ----------
import clr

clr.AddReference("RevitServices")
import RevitServices
from RevitServices.Persistence import DocumentManager
from RevitServices.Transactions import TransactionManager
doc = DocumentManager.Instance.CurrentDBDocument

clr.AddReference("RevitAPI")
from Autodesk.Revit.DB import *

clr.AddReference("RevitNodes")
import Revit
clr.ImportExtensions(Revit.Elements)
clr.ImportExtensions(Revit.GeometryConversion)

def ConnectTo(connector, conn2):
    try:
        TransactionManager.Instance.EnsureInTransaction(doc)
        connector.ConnectTo(conn2)
        TransactionManager.Instance.TransactionTaskDone()
        return 1  # Retorna 1 para indicar uma conexão feita
    except:
        return 0  # Retorna 0 para indicar uma conexão não feita

conduits = UnwrapElement(IN[0])
margin = 0.01

connectors = {}
connlist = []
connections = 0  # Variável para armazenar o número de conexões feitas

for conduit in conduits:
    if conduit is None:
        continue

    try:
        conns = conduit.ConnectorManager.Connectors
    except AttributeError:
        try:
            conns = conduit.MEPModel.ConnectorManager.Connectors
        except AttributeError:
            continue

    for conn in conns:
        if conn.IsConnected:
            continue
        connectors[conn] = None
        connlist.append(conn)

for k in connectors.keys():
    mindist = 1000000
    closest = None
    for conn in connlist:
        if conn.Owner.Id.Equals(k.Owner.Id):
            continue
        dist = k.Origin.DistanceTo(conn.Origin)
        if dist < mindist:
            mindist = dist
            closest = conn
    if mindist > margin:
        continue
    connectors[k] = closest
    connlist.remove(closest)
    try:
        del connectors[closest]
    except:
        pass

for k, v in connectors.items():
    connections += ConnectTo(k, v)  # Incrementa a variável connections com o resultado da função ConnectTo

OUT = connections  # Saída com o número total de conexões feitas
# ----------------------------------------

solids_3 = Element.Solids(element=owner)
