# Dynamo graph ok 2021_06-5_BIMACON_Inserir Emendas em Eletrodutos Seleção_R00_script.dyn (Dynamo 3.2.1.5366)
# packages: Clockwork for Dynamo 2.x 2.4.0, MEPover 2022.10.30, Data-Shapes 2025.3.118, bimorphNodes 4.2.4, DynaMEP 2.0.1, BIMCoder Nodes - 2.X 2025.1.0, archi-lab.net 2023.213.1722, Rhythm 2023.4.2021

# group: Janela de Imputs
string = StringInput("Inserir emendas em eletrodutos/eletrocalhas por seleção")
file_path = Filename("C:\Users\jneng\Documents\logo.png")
file_from_path = FileObject(path=file_path)
readFromFile = Image.ReadFromFile(file=file_from_path)
string_2 = StringInput("Executar")
string_3 = StringInput("Número de Emendas")
string_4 = StringInput("1")
boolean = BoolSelector(true)
textbox_data = Custom[TextBox Data](InputName=string_3, DefaultText=string_4, IsNumberEntry=boolean)  # package Data-Shapes; Create Data for TextBox input in UI.MultipleInputForm ++ . Check out www.data-shapes.net for more informations
boolean_2 = BoolSelector(true)
string_5 = StringInput("http://bimacon.wix.com/bimacon")
string_6 = StringInput("Cancelar")
number = DoubleInput(480)
number_2 = DoubleInput(180)
multipleinputform = Custom[MultipleInputForm ++](Description_optional=string, Logo_optional=readFromFile, ButtonText_optional=string_2, Inputs=textbox_data, Toggle=boolean_2, LinkToHelp_optional=string_5, CancelButtonText_optional=string_6, Width_optional=number, LabelWidth_optional=number_2)  # package Data-Shapes; Create a form with multiple inputs. see www.data-shapes.net for tutorials and infos!

# group: Filter
# Descrição <Clique duas vezes aqui para editar a descrição do grupo>
code_block = CodeBlock(IN=multipleinputform.User_Inputs) { texto1 = IN[0]; }
watch = Watch(code_block)

end = Revit.Transaction.Transaction.End(input=multipleinputform.Was_Cancelled)
start = Revit.Transaction.Transaction.Start(input=end)
passThrough = Custom[PassThrough](passThrough=start, waitFor=end)  # package archi-lab.net; Ripped this off from Clockwork. Sorry Andy.

# group: Selecionar eletroduto
code_block_2 = CodeBlock { ["Pressione ESC para finalizar"]; }
code_block_3 = CodeBlock { ["Selecione o eletroduto ou Bandeja"]; }
if_ = If(test=passThrough, true=code_block_2, false=code_block_3)
fromList = Python(IN[0]=if_)  # "String.FromList"; IronPython2
# ---------- fromList.python (22 lines) ----------
# Carregar as bibliotecas DesignScript e padrão do Python
import sys
import clr
clr.AddReference('ProtoGeometry')
from Autodesk.DesignScript.Geometry import *

# Função para concatenar os valores de uma lista em uma única string com múltiplas linhas
def concatenate_list_to_string(input_list, delimiter="\n"):
    # Verifica se a entrada é uma lista
    if not isinstance(input_list, list):
        return "A entrada deve ser uma lista."
    
    # Converte todos os elementos para string e junta com o delimitador especificado
    result = delimiter.join(str(item) for item in input_list)
    return result

# Entrada pelo nó do Dynamo
lista = IN[0]  # Lista de valores a serem concatenados
delimitador = IN[1] if len(IN) > 1 else "\n"  # Delimitador opcional, padrão é nova linha

# Saída para o Dynamo
OUT = concatenate_list_to_string(lista, delimitador)
# ----------------------------------------
window_prompt_with_text = Python(IN[0]=fromList)  # IronPython2
# ---------- window_prompt_with_text.python (32 lines) ----------
# Importando as bibliotecas necessárias da API do Revit
import clr
clr.AddReference('RevitServices')  # Referência aos serviços do Revit
from RevitServices.Persistence import DocumentManager

clr.AddReference('RevitAPI')  # Referência à API do Revit
clr.AddReference('RevitAPIUI')  # Referência à API de Interface de Usuário do Revit

from Autodesk.Revit.UI import TaskDialog, TaskDialogCommonButtons, TaskDialogResult

# Recebe o texto de instrução como entrada do nó
instrucoes = IN[0]

# Verifica se a entrada é "Cancelar"
if instrucoes.lower() == "Pressione ESC para finalizar":
    OUT = False
else:
    # Criando o TaskDialog
    dialog = TaskDialog("Aviso")
    dialog.MainInstruction = instrucoes
    dialog.CommonButtons = TaskDialogCommonButtons.Ok | TaskDialogCommonButtons.Cancel

    # Exibindo o dialog para o usuário e capturando a resposta
    resultado = dialog.Show()

    # Interpretando a resposta
    if resultado == TaskDialogResult.Ok:
        OUT = True
    elif resultado == TaskDialogResult.Cancel:
        OUT = False
    else:
        OUT = None
# ----------------------------------------
categories = Categories("OST_Conduit")
categories_2 = Categories("OST_CableTray")
list_create = List.Create(item0=categories, item1=categories_2)
flatten = List.Flatten(list=list_create)
boolean_3 = BoolSelector(true)
boolean_4 = BoolSelector(false)
ʳʰʸᵗʰᵐ_selection_pick = Rhythm.Revit.Selection.Selection.Pick(runIt=window_prompt_with_text, category=flatten, singleSelection=boolean_3, ordered=boolean_4)

flatten_2 = List.Flatten(list=ʳʰʸᵗʰᵐ_selection_pick)

# group: Copy new elements
# Descrição <Clique duas vezes aqui para editar a descrição do grupo>
number_3 = DoubleInput(1)
add = code_block + number_3
cycle = List.Cycle(list=flatten_2@L1, amount=add@L1)
byCoordinates = Vector.ByCoordinates()
# note: Clockwork
copyByVector = Custom[Element.CopyByVector](element=cycle@@L1, vector=byCoordinates)  # package Clockwork for Dynamo 2.x; Copies an element or a list of elements by a given vector.
flatten_3 = List.Flatten(list=copyByVector, lacing=Longest)

getLocation = Element.GetLocation(element=flatten_2)
length = Curve.Length(curve=getLocation)

# group: split length into sublength
# Descrição <Clique duas vezes aqui para editar a descrição do grupo>
div = length / add
div_2 = div / length
code_block_4 = CodeBlock(step=div_2) { 0..1..step; }
splitByParameter = Curve.SplitByParameter(curve=getLocation, parameters=code_block_4)

setLocation = Element.SetLocation(element=flatten_3, geometry=splitByParameter)

# group: Union fittings
# Descrição <Clique duas vezes aqui para editar a descrição do grupo>
code_block_5 = CodeBlock(waithFor=setLocation, Pass=flatten_3) { [waithFor,Pass][1]; }
code_block_6 = CodeBlock { -1; }
dropItems = List.DropItems(list=code_block_5, amount=code_block_6, lacing=Longest)
restOfItems = List.RestOfItems(list=code_block_5, lacing=Longest)
byMEPCurves = Custom[MEPFitting.ByMEPCurves](MEPCurve1=dropItems, MEPCurve2=restOfItems, lacing=Longest)  # package MEPover; Creates a UnionFitting or ElbowFitting by 2 MEPCurves (Ducts, Cable Trays, Pipes or Conduits). The output may not always be all the fittings created as Revit sometimes creates extra transition fittings outside of the node transactions.

passthrough = Custom[Passthrough](passThrough=code_block_5, waitFor=byMEPCurves)  # package Clockwork for Dynamo 2.x; Forces a sequential order of execution. The node wired into the output of the Passthrough node will be executed *after* the node wired into the waitFor input (e.g. important for some Revit operations). The value of the passThrough input will be passed on to the node wired into the output port of the Passthrough node.
flatten_4 = List.Flatten(list=passthrough)
connectors = Custom[👓 Connectors+](element=flatten_4)  # package BIMCoder Nodes - 2.X; Obtém as propriedades mais relevantes dos conectores de elementos
isConnected = MEP.Connectors.IsConnected(connector=connectors.Connectors)
filterByBoolMask = List.FilterByBoolMask(list=connectors.Connectors, mask=isConnected)
flatten_5 = List.Flatten(list=filterByBoolMask.out)

# group: Bandeja/Eletroduto
connectors_2 = Custom[👓 Connectors+](element=flatten_2)

# group: Todas conexões a emendar
categories_3 = Categories("OST_CableTrayFitting")
all_elements_of_category = ElementsOfCategory(Category=categories_3)
name = Element.Name(element=all_elements_of_category)
code_block_7 = CodeBlock { ["Saida_","Porca","Arruela","Parafuso"]; }
watch_2 = Watch(code_block_7)
contains = Custom[Contains](stringList=name, filterList=watch_2)  # package archi-lab.net; This node takes a list of strings and checks if any string contains a matching string from filter input.
filterByBoolMask_2 = List.FilterByBoolMask(list=all_elements_of_category, mask=contains, lacing=Longest)
flatten_6 = List.Flatten(list=filterByBoolMask_2.out)
categories_4 = Categories("OST_ConduitFitting")
all_elements_of_category_2 = ElementsOfCategory(Category=categories_4)
name_2 = Element.Name(element=all_elements_of_category_2)
code_block_8 = CodeBlock { ["Arruela","Cabo","Conector","Caixa de Luz","Bucha","PVC 5 entradas","Unidut","Tampa","Adaptador"]; }
contains_2 = Custom[Contains](stringList=name_2, filterList=code_block_8)
filterByBoolMask_3 = List.FilterByBoolMask(list=all_elements_of_category_2, mask=contains_2)
flatten_7 = List.Flatten(list=filterByBoolMask_3.out)
categories_5 = Categories("OST_ElectricalFixtures")
all_elements_of_category_3 = ElementsOfCategory(Category=categories_5)
name_3 = Element.Name(element=all_elements_of_category_3)
code_block_9 = CodeBlock { [".Posição Livre","Haste","Disjuntor"]; }
contains_3 = Custom[Contains](stringList=name_3, filterList=code_block_9)
filterByBoolMask_4 = List.FilterByBoolMask(list=all_elements_of_category_3, mask=contains_3)
flatten_8 = List.Flatten(list=filterByBoolMask_4.out)
list_create_2 = List.Create(item0=flatten_6, item1=flatten_7, item2=flatten_8)
flatten_9 = List.Flatten(list=list_create_2)

# group: Selecionar conexões
location = MEP.Connectors.Location(connector=connectors_2.Connectors)
code_block_10 = CodeBlock { 0.11; }
byCenterPointRadius = Sphere.ByCenterPointRadius(centerPoint=location, radius=code_block_10)
intersectsSolid = Revit.Element.IntersectsSolid(solids=byCenterPointRadius, elements=flatten_9)
intersectingElements = Results.SolidIntersectionResult.IntersectingElements(solidIntersectionResult=intersectsSolid)
boolean_5 = BoolSelector(true)
clean = List.Clean(list=intersectingElements, preserveIndices=boolean_5)
firstItem = List.FirstItem(list=clean@L2)
boolean_6 = BoolSelector(false)
clean_2 = List.Clean(list=firstItem, preserveIndices=boolean_6)
flatten_10 = List.Flatten(list=clean_2)
uniqueItems = List.UniqueItems(list=flatten_10)

passthrough_2 = Custom[Passthrough](passThrough=uniqueItems, waitFor=byMEPCurves)
connectors_3 = Custom[👓 Connectors+](element=passthrough_2)
isConnected_2 = MEP.Connectors.IsConnected(connector=connectors_3.Connectors)
filterByBoolMask_5 = List.FilterByBoolMask(list=connectors_3.Points, mask=isConnected_2)
flatten_11 = List.Flatten(list=filterByBoolMask_5.out)
getConnectorClosestTo = MEP.Connectors.GetConnectorClosestTo(connectors=flatten_5, point=flatten_11, lacing=Shortest)
filterByBoolMask_6 = List.FilterByBoolMask(list=connectors_3.Connectors, mask=isConnected_2)
flatten_12 = List.Flatten(list=filterByBoolMask_6.out)
connectTo = Custom[Connector.ConnectTo](connector=getConnectorClosestTo, Connector2=flatten_12)  # package MEPover; Connects a connector to another connector. Returns True if connection succeeded
passthrough_3 = Custom[Passthrough](passThrough=byMEPCurves, waitFor=connectTo)
flatten_13 = List.Flatten(list=passthrough_3)
isNull = Object.IsNull(object=flatten_13)
firstItem_2 = List.FirstItem(list=isNull)
empty = List.Empty()
condição_if_de_lista = CodeBlock(test=firstItem_2, verd=empty, fals=flatten_13)
# ---------- condição_if_de_lista.designscript (3 lines) ----------
//Condições IF
indx = (test) ? 0 : 1;
rslt = [verd,fals][indx];
# ----------------------------------------

# group: Mensagem final
count = List.Count(list=condição_if_de_lista.rslt@L2)
code_block_11 = CodeBlock { 0; }
gt = count > code_block_11
code_block_12 = CodeBlock(N=count) { ["Feito! Você inseriu "+N+" emendas em seu projeto"]; }
code_block_13 = CodeBlock { ["Nenhum emenda foi inserida"]; }
if_2 = If(test=gt, true=code_block_12, false=code_block_13)
flatten_14 = List.Flatten(list=if_2)
fromList_2 = Python(IN[0]=flatten_14)  # "String.FromList"; IronPython2; same code as fromList
python_script = Python(IN[0]=fromList_2)  # IronPython2
# ---------- python_script.python (21 lines) ----------
# Importar as bibliotecas necessárias do Revit
import clr
clr.AddReference("RevitServices")
from RevitServices.Persistence import DocumentManager

clr.AddReference("RevitAPI")
clr.AddReference("RevitAPIUI")
from Autodesk.Revit.UI import TaskDialog

# Pegar a entrada do Dynamo
mensagem = IN[0]

# Criar a TaskDialog
task_dialog = TaskDialog("Ok")
task_dialog.MainInstruction = mensagem

# Exibir a TaskDialog
task_dialog.Show()

# Saída do script
OUT = "Sucesso!"
# ----------------------------------------

watch_3 = Watch(flatten_2)

# group: Delete outdated elements
# Descrição <Clique duas vezes aqui para editar a descrição do grupo>
code_block_14 = CodeBlock(waithFor=flatten_3, Pass=watch_3) { [waithFor,Pass][1]; }
# note: Archilab
delete = archilab.Revit.Elements.Elements.Delete(element=code_block_14)
