# Dynamo graph ok 2021_06-4_BIMACON_Inserir Luvas em Eletrodutos com mais de 3m_script.dyn "2021_06-4_BIMACON_Inserir Luvas em Eletrodutos com mais de 3m_script" (Dynamo 3.2.1.5366)
# packages: Clockwork for Dynamo 2.x 2.4.0, MEPover 2022.10.30, Data-Shapes 2025.3.118

# group: Janela de Imputs
string = StringInput("Inserir emendas em eletrodutos/eletrocalhas")
file_path = Filename("C:\Users\jneng\Documents\logo.png")
file_from_path = FileObject(path=file_path)
readFromFile = Image.ReadFromFile(file=file_from_path)
string_2 = StringInput("Executar")
string_3 = StringInput("Selecione o tipo de eletroduto ou eletrocalha:")
code_block = CodeBlock()
# ---------- code_block.designscript (14 lines) ----------
"PVC Roscável Preto Rígido";
"PVC Condulete Top Rígido";
"Alumínio_Rígido Rosca BPS";
"Aço Galvanizado_(EME)";
"Aço Galvanizado_Com Conduletes Multiplos";
"Aço Galvanizado_Com Conduletes Rosca BSP";
"Aço Galvanizado_Com Conduletes sem Rosca";
"Aço Galvanizado_Com Curvas";
"Aço Galvanizado_Rígido Rosca BSP";
"Eletrocalha Lisa";
"Eletrocalha Perfurada";
"Leito para Cabos tipo escada";
"Perfilado Perfurado";
"Perfilado";
# ----------------------------------------
list_create = List.Create(item0=code_block.out0, item1=code_block.out1, item2=code_block.out2, item3=code_block.out3, item4=code_block.out4, item5=code_block.out5, item6=code_block.out6, item7=code_block.out7, item8=code_block.out8, item9=code_block.out9, item10=code_block.out10, item11=code_block.out11)
number = DoubleInput(0)
dropdown_data = Custom[DropDown Data](InputName=string_3, Keys=list_create, Values=list_create, DefaultValueIndex=number)  # package Data-Shapes; Create data for DropDown input in UI.MultiInputForm ++ . Check out www.data-shapes.net for more infos.
string_4 = StringInput("Comprimento Máximo (m):")
string_5 = StringInput("3")
boolean = BoolSelector(true)
textbox_data = Custom[TextBox Data](InputName=string_4, DefaultText=string_5, IsNumberEntry=boolean)  # package Data-Shapes; Create Data for TextBox input in UI.MultipleInputForm ++ . Check out www.data-shapes.net for more informations
list_create_2 = List.Create(item0=dropdown_data, item1=textbox_data)
boolean_2 = BoolSelector(true)
string_6 = StringInput("http://bimacon.wix.com/bimacon")
string_7 = StringInput("Cancelar")
number_2 = DoubleInput(550)
number_3 = DoubleInput(220)
multipleinputform = Custom[MultipleInputForm ++](Description_optional=string, Logo_optional=readFromFile, ButtonText_optional=string_2, Inputs=list_create_2, Toggle=boolean_2, LinkToHelp_optional=string_6, CancelButtonText_optional=string_7, Width_optional=number_2, LabelWidth_optional=number_3)  # package Data-Shapes; Create a form with multiple inputs. see www.data-shapes.net for tutorials and infos!

# group: Filter
# Descrição <Clique duas vezes aqui para editar a descrição do grupo>
categories = Categories("OST_Conduit")  # graph input
categories_2 = Categories("OST_CableTray")  # graph input
join = List.Join(list0=categories, list1=categories_2)
all_elements_of_category = ElementsOfCategory(Category=join)
name = Element.Name(element=all_elements_of_category)
code_block_2 = CodeBlock(IN=multipleinputform.User_Inputs) { texto1 = IN[0]; texto2 = IN[1]; }
contains = String.Contains(string=name, searchFor=code_block_2.texto1)
filterByBoolMask = List.FilterByBoolMask(list=all_elements_of_category, mask=contains)
boolean_3 = BoolSelector(false)
clean = List.Clean(list=filterByBoolMask.in, preserveIndices=boolean_3)
watch = Watch(code_block_2.texto1)

# group: Find elements to split
# Descrição <Clique duas vezes aqui para editar a descrição do grupo>
code_block_3 = CodeBlock { "Comprimento"; }
getParameterValueByName = Element.GetParameterValueByName(element=clean, parameterName=code_block_3)
code_block_4 = CodeBlock(len=getParameterValueByName, comp=code_block_2.texto2, elem=clean) { len >= comp ? elem : null; }
boolean_4 = BoolSelector(false)
clean_2 = List.Clean(list=code_block_4, preserveIndices=boolean_4)

flatten = List.Flatten(list=clean_2)

# group: length and sublength
# Descrição <Clique duas vezes aqui para editar a descrição do grupo>
getLocation = Element.GetLocation(element=flatten)
length = Curve.Length(curve=getLocation)

# group: Copy new elements
# Descrição <Clique duas vezes aqui para editar a descrição do grupo>
div = length / code_block_2.texto2
ceiling = Math.Ceiling(number=div)
cycle = List.Cycle(list=flatten@L1, amount=ceiling@L1)
byCoordinates = Vector.ByCoordinates()
# note: Clockwork
copyByVector = Custom[Element.CopyByVector](element=cycle@@L1, vector=byCoordinates)  # package Clockwork for Dynamo 2.x; Copies an element or a list of elements by a given vector.
flatten_2 = List.Flatten(list=copyByVector, lacing=Longest)

# group: split length into sublength
# Descrição <Clique duas vezes aqui para editar a descrição do grupo>
div_2 = code_block_2.texto2 / length
code_block_5 = CodeBlock(step=div_2) { 0..1..step; }
splitByParameter = Curve.SplitByParameter(curve=getLocation, parameters=code_block_5)

setLocation = Element.SetLocation(element=flatten_2, geometry=splitByParameter)

# group: Union fittings
# Descrição <Clique duas vezes aqui para editar a descrição do grupo>
code_block_6 = CodeBlock(waithFor=setLocation, Pass=flatten_2) { [waithFor,Pass][1]; }
code_block_7 = CodeBlock { -1; }
dropItems = List.DropItems(list=code_block_6, amount=code_block_7, lacing=Longest)
restOfItems = List.RestOfItems(list=code_block_6, lacing=Longest)
byMEPCurves = Custom[MEPFitting.ByMEPCurves](MEPCurve1=dropItems, MEPCurve2=restOfItems, lacing=Longest)  # package MEPover; Creates a UnionFitting or ElbowFitting by 2 MEPCurves (Ducts, Cable Trays, Pipes or Conduits). The output may not always be all the fittings created as Revit sometimes creates extra transition fittings outside of the node transactions.

# group: Adjust segment length
# Descrição <Clique duas vezes aqui para editar a descrição do grupo>
code_block_8 = CodeBlock { "Comprimento da curva"; }
getParameterValueByName_2 = Element.GetParameterValueByName(element=byMEPCurves, parameterName=code_block_8)
lastItem = List.LastItem(list=getParameterValueByName_2, lacing=Longest)
add = code_block_2.texto2 + lastItem
div_3 = add / length
code_block_9 = CodeBlock(step=div_3) { 0..1..step; }
splitByParameter_2 = Curve.SplitByParameter(curve=getLocation, parameters=code_block_9)
code_block_10 = CodeBlock { -1; }
dropItems_2 = List.DropItems(list=splitByParameter_2, amount=code_block_10, lacing=Longest)
endPoint = Curve.EndPoint(curve=dropItems_2)
setLocation_2 = Element.SetLocation(element=byMEPCurves, geometry=endPoint)

# group: Delete outdated elements
# Descrição <Clique duas vezes aqui para editar a descrição do grupo>
code_block_11 = CodeBlock(waithFor=code_block_6, Pass=flatten) { [waithFor,Pass][1]; }
# note: Archilab
delete = Element.Delete(element=code_block_11)

watch_2 = Watch(clean_2)

# group: Mensagem final
count = List.Count(list=byMEPCurves@L2)
code_block_12 = CodeBlock { 0; }
gt = count > code_block_12
code_block_13 = CodeBlock(N=count) { ["Feito! Você inseriu "+N+" emendas em seu projeto"]; }
code_block_14 = CodeBlock { ["Nenhum emenda foi inserida"]; }
if_ = If(test=gt, true=code_block_13, false=code_block_14)
flatten_3 = List.Flatten(list=if_)
fromList = Python(IN[0]=flatten_3)  # "String.FromList"; IronPython2
# ---------- fromList.python (22 lines) ----------
# Carregar as bibliotecas DesignScript e padrão do Python
import sys
import clr
clr.AddReference('ProtoGeometry')
from Autodesk.DesignScript.Geometry import *

# Função para concatenar os valores de uma lista em uma única string com múltiplas linhas
def concatenate_list_to_string(input_list, delimiter="\n"):
    # Verifica se a entrada é uma lista
    if not isinstance(input_list, list):
        return "A entrada deve ser uma lista."
    
    # Converte todos os elementos para string e junta com o delimitador especificado
    result = delimiter.join(str(item) for item in input_list)
    return result

# Entrada pelo nó do Dynamo
lista = IN[0]  # Lista de valores a serem concatenados
delimitador = IN[1] if len(IN) > 1 else "\n"  # Delimitador opcional, padrão é nova linha

# Saída para o Dynamo
OUT = concatenate_list_to_string(lista, delimitador)
# ----------------------------------------
python_script = Python(IN[0]=fromList)  # IronPython2
# ---------- python_script.python (21 lines) ----------
# Importar as bibliotecas necessárias do Revit
import clr
clr.AddReference("RevitServices")
from RevitServices.Persistence import DocumentManager

clr.AddReference("RevitAPI")
clr.AddReference("RevitAPIUI")
from Autodesk.Revit.UI import TaskDialog

# Pegar a entrada do Dynamo
mensagem = IN[0]

# Criar a TaskDialog
task_dialog = TaskDialog("Ok")
task_dialog.MainInstruction = mensagem

# Exibir a TaskDialog
task_dialog.Show()

# Saída do script
OUT = "Sucesso!"
# ----------------------------------------
