# Dynamo graph ok 2021_06-0_BIMACON_Inserir Luvas em eletrodutos emenda Laje-Parede_R08_script.dyn "ok 2021_06-0_BIMACON_Inserir Luvas em eletrodutos emenda Laje-Parede_R07" (Dynamo 2.6.1.8786)
# packages: Clockwork for Dynamo 1.x 1.0.2, MEPover 2022.10.30, archi-lab.net 2023.213.1722, bimorphNodes 4.2.4, DynaMEP 2.0.1, Data-Shapes 2022.2.105

# group: ENTRADAS PARA O USUÁRIO
code_block = CodeBlock { "Inserção de Luvas no encontro de Paredes com Lajes"; }
file_path = Filename("..\..\..\..\..\05 - BIMACON\01 - EMPRESA BIMACON\00 - Logos e imagens - BIMACON\ARTE BIMACON\reddonda-removebg-preview.png")
file_from_path = FileObject(path=file_path)
readFromFile = Image.ReadFromFile(file=file_from_path)
string = StringInput("Confirmar")
string_2 = StringInput("Tipo de Eletroduto                            (Pode ser a cor)")
string_3 = StringInput("Amarelo")
boolean = BoolSelector(false)
textbox_data = Custom[TextBox Data](InputName=string_2, DefaultText=string_3, IsNumberEntry=boolean)  # package Data-Shapes; Create Data for TextBox input in UI.MultipleInputForm ++ . Check out www.data-shapes.net for more informations
string_4 = StringInput("Altura da Luva")
string_5 = StringInput("2.6")
boolean_2 = BoolSelector(true)
textbox_data_2 = Custom[TextBox Data](InputName=string_4, DefaultText=string_5, IsNumberEntry=boolean_2)
string_6 = StringInput("Selecione o Nível")
categories = Categories("OST_Levels")
all_elements_of_category = ElementsOfCategory(Category=categories)
name = Level.Name(level=all_elements_of_category)
code_block_2 = CodeBlock { 0; }
dropdown_data = Custom[DropDown Data](InputName=string_6, Keys=name, Values=all_elements_of_category, DefaultValueIndex=code_block_2)  # package Data-Shapes; Create data for DropDown input in UI.MultiInputForm ++ . Check out www.data-shapes.net for more infos.
string_7 = StringInput("Elevação Superior Máxima (m) Dica: Pegue a Elevação Intermediária dos Eletrodutos na Laje.")
string_8 = StringInput("2.8")
boolean_3 = BoolSelector(true)
textbox_data_3 = Custom[TextBox Data](InputName=string_7, DefaultText=string_8, IsNumberEntry=boolean_3)
list_create = List.Create(item0=textbox_data, item1=textbox_data_2, item2=dropdown_data, item3=textbox_data_3)
boolean_4 = BoolSelector(true)
string_9 = StringInput("Cancelar")
number = DoubleInput(290)
number_2 = DoubleInput(180)
multipleinputform = Custom[MultipleInputForm ++](Description_optional=code_block, Logo_optional=readFromFile, ButtonText_optional=string, Inputs=list_create, Toggle=boolean_4, CancelButtonText_optional=string_9, Width_optional=number, LabelWidth_optional=number_2)  # package Data-Shapes; Create a form with multiple inputs. see www.data-shapes.net for tutorials and infos!
code_block_3 = CodeBlock()  # //archilab
code_block_4 = CodeBlock()  # //Data-Shapes

# group: Separar Entradas
code_block_5 = CodeBlock { 2; }
getItemAtIndex = List.GetItemAtIndex(list=multipleinputform.User_Inputs, index=code_block_5)
code_block_6 = CodeBlock { 0; }
getItemAtIndex_2 = List.GetItemAtIndex(list=multipleinputform.User_Inputs, index=code_block_6)
code_block_7 = CodeBlock { 3; }
getItemAtIndex_3 = List.GetItemAtIndex(list=multipleinputform.User_Inputs, index=code_block_7)
code_block_8 = CodeBlock { 1; }
getItemAtIndex_4 = List.GetItemAtIndex(list=multipleinputform.User_Inputs, index=code_block_8)

# group: Conduites por pavimento
categories_2 = Categories("OST_Conduit")
all_elements_of_category_2 = ElementsOfCategory(Category=categories_2)
string_10 = StringInput("Nível de referência")
getParameterValueByName = Element.GetParameterValueByName(element=all_elements_of_category_2, parameterName=string_10)
name_2 = Level.Name(level=getParameterValueByName)
name_3 = Level.Name(level=getItemAtIndex)
eq = name_2 == name_3
filterByBoolMask = List.FilterByBoolMask(list=all_elements_of_category_2, mask=eq)

watch = Watch(filterByBoolMask.in)

# group: INPUT
elevação_inferior_mínima_m = DoubleInput(2.5)

# group: Cor do conduite
name_4 = Element.Name(element=filterByBoolMask.in)
contains = String.Contains(str=name_4, searchFor=getItemAtIndex_2)
filterByBoolMask_2 = List.FilterByBoolMask(list=filterByBoolMask.in, mask=contains)

# group: Elementos a serem cortados
code_block_9 = CodeBlock { "Elevação superior"; }
getParameterValueByName_2 = Element.GetParameterValueByName(element=filterByBoolMask_2.in, parameterName=code_block_9)
code_block_10 = CodeBlock(alturainf=elevação_inferior_mínima_m, Value=getParameterValueByName_2, elem=filterByBoolMask_2.in) { alturainf; Value >=alturainf ? elem : null; false; }
clean = List.Clean(list=code_block_10.out1, preserveIndices=code_block_10.out2)
code_block_11 = CodeBlock(alturasup=getItemAtIndex_3, Value=getParameterValueByName_2, elem=filterByBoolMask_2.in) { alturasup; Value <=alturasup ? elem : null; false; }
clean_2 = List.Clean(list=code_block_11.out1, preserveIndices=code_block_11.out2)
setIntersection = List.SetIntersection(list1=clean, list2=clean_2)

mep_connector_info = Custom[MEP Connector info+](element=setIntersection)  # package MEPover; This node will return the connectors and a lot of information about those connectors of the input elements

# group: Selecionar curvas
name_5 = Element.Name(element=mep_connector_info.ConnectedElements)
string_11 = StringInput("Curva generica")
boolean_5 = BoolSelector(true)
contains_2 = String.Contains(str=name_5, searchFor=string_11, ignoreCase=boolean_5)
filterByBoolMask_3 = List.FilterByBoolMask(list=mep_connector_info.ConnectedElements, mask=contains_2)
string_12 = StringInput("Nível")
getParameterValueByName_3 = Element.GetParameterValueByName(element=filterByBoolMask_3.in, parameterName=string_12)
name_6 = Level.Name(level=getParameterValueByName_3)
name_7 = Level.Name(level=getItemAtIndex)
eq_2 = name_6 == name_7
filterByBoolMask_4 = List.FilterByBoolMask(list=filterByBoolMask_3.in, mask=eq_2)
string_13 = StringInput("Elevação do nível")
getParameterValueByName_4 = Element.GetParameterValueByName(element=filterByBoolMask_4.in, parameterName=string_13)
gt = getParameterValueByName_4 > getItemAtIndex_3
filterByBoolMask_5 = List.FilterByBoolMask(list=filterByBoolMask_4.in, mask=gt)
boolean_6 = BoolSelector(false)
clean_3 = List.Clean(list=filterByBoolMask_5.in, preserveIndices=boolean_6)
watch_2 = Watch(clean_3)

# group: Comprimento e Subcomprimento
getLocation = Element.GetLocation(element=setIntersection, lacing=CrossProduct)
length = Curve.Length(curve=getLocation)

# group: Copia dos elementos
code_block_12 = CodeBlock { 1.5; }
div = length / code_block_12
ceiling = Math.Ceiling(number=div)
code_block_13 = CodeBlock(a=ceiling) { a>1; }
code_block_14 = CodeBlock { 2; }
code_block_15 = CodeBlock { 2; }
# note: Clockwork
if_ = If(test=code_block_13, true=code_block_14, false=code_block_15)
cycle = List.Cycle(list=setIntersection@L1, amount=if_@L1, lacing=Shortest)
byCoordinates = Vector.ByCoordinates()
copyByVector = Custom[Element.CopyByVector](element=cycle@@L1, vector=byCoordinates, lacing=Longest)  # package Clockwork for Dynamo 1.x; Copies an element or a list of elements by a given vector.
flatten = List.Flatten(list=copyByVector, lacing=Longest)

# group: Altura para corte do eletroduto
endPoint = Curve.EndPoint(curve=getLocation)
X = Point.X(point=endPoint)
Y = Point.Y(point=endPoint)
Z = Point.Z(point=endPoint)
code_block_16 = CodeBlock(a=Z) { a>1; }
maximumItem = List.MaximumItem(list=Z)
elevation = Level.Elevation(level=getItemAtIndex)
code_block_17 = CodeBlock(a=maximumItem, b=getItemAtIndex_4, e=elevation) { a; b; c = a-b; d = a-c; e; f=d+e; }
if_2 = If(test=code_block_16, true=code_block_17.f, false=code_block_17.f)
byCoordinates_2 = Point.ByCoordinates(x=X, y=Y, z=if_2)
splitByPoints = Curve.SplitByPoints(curve=getLocation, points=byCoordinates_2, lacing=Shortest)
setLocation = Element.SetLocation(element=flatten, geometry=splitByPoints, lacing=Shortest)

# group: Unir conduite com conexão
code_block_18 = CodeBlock(waithFor=setLocation, Pass=flatten) { [waithFor,Pass][1]; }
code_block_19 = CodeBlock { -1; }
dropItems = List.DropItems(list=code_block_18, amount=code_block_19, lacing=Longest)
restOfItems = List.RestOfItems(list=code_block_18, lacing=Longest)
byMEPCurves = Custom[MEPFitting.ByMEPCurves](MEPCurve1=dropItems, MEPCurve2=restOfItems, lacing=Longest)  # package MEPover; Creates a UnionFitting or ElbowFitting by 2 MEPCurves (Ducts, Cable Trays, Pipes or Conduits). The output may not always be all the fittings created as Revit sometimes creates extra transition fittings outside of the node transactions.

# group: Selecionar eletroduto a conectar
list_create_2 = List.Create(item0=dropItems, item1=restOfItems)
passThrough = Custom[PassThrough](passThrough=list_create_2@L2, waitFor=byMEPCurves)  # package archi-lab.net; Ripped this off from Clockwork. Sorry Andy.
string_14 = StringInput("Elevação superior")
getParameterValueByName_5 = Element.GetParameterValueByName(element=passThrough, parameterName=string_14)
code_block_20 = CodeBlock { 0.12; }
sub = getItemAtIndex_3 - code_block_20
gt_2 = getParameterValueByName_5 > sub

boolean_7 = BoolSelector(false)
clean_4 = List.Clean(list=gt_2, preserveIndices=boolean_7)

# group (continued): Selecionar eletroduto a conectar
filterByBoolMask_6 = List.FilterByBoolMask(list=passThrough, mask=clean_4)

watch_3 = Watch(filterByBoolMask_6.in)
flatten_2 = List.Flatten(list=watch_3, lacing=Shortest)
watch_4 = Watch(mep_connector_info.ConnectedElements)
flatten_3 = List.Flatten(list=clean_3)

# group: Unir conduite da laje com da parede
mep_connector_info_2 = Custom[MEP Connector info+](element=flatten_3)
string_15 = StringInput("Elevação superior")
getParameterValueByName_6 = Element.GetParameterValueByName(element=mep_connector_info_2.ConnectedElements, parameterName=string_15)
gt_3 = getParameterValueByName_6 > getItemAtIndex_3
filterByBoolMask_7 = List.FilterByBoolMask(list=mep_connector_info_2.ConnectedElements, mask=gt_3)
watch_5 = Watch(mep_connector_info_2.ConnectedElements)

watch_6 = Watch(filterByBoolMask_7.in)

# group (continued): Unir conduite da laje com da parede
flatten_4 = List.Flatten(list=watch_6, lacing=Shortest)
solids = Element.Solids(element=flatten_4)
byMEPCurves_2 = Custom[MEPFitting.ByMEPCurves](MEPCurve1=watch_6, MEPCurve2=watch_3, lacing=CrossProduct)

# group: Deletar elemento obsoleto
# note: Archilab
code_block_21 = CodeBlock(waithFor=flatten, Pass=setIntersection) { [waithFor,Pass][1]; }
delete = archilab.Revit.Elements.Elements.Delete(element=code_block_21)

boolean_8 = BoolSelector(false)
clean_5 = List.Clean(list=filterByBoolMask_6.in, preserveIndices=boolean_8, lacing=Longest)

# group: Deletar elemento obsoleto
# note: Archilab
code_block_22 = CodeBlock(waithFor=clean_5, Pass=flatten_3) { [waithFor,Pass][1]; }
delete_2 = archilab.Revit.Elements.Elements.Delete(element=code_block_22)

watch_7 = Watch(filterByBoolMask_2.in)
boolean_9 = BoolSelector(false)
clean_6 = List.Clean(list=byMEPCurves_2, preserveIndices=boolean_9)
flatten_5 = List.Flatten(list=clean_6)

# group: Conduites desconectados
code_block_23 = CodeBlock(waithFor=flatten_5, Pass=list_create_2) { [waithFor,Pass][1]; }
connectors = RevitModel.Element.Connectors(elements=code_block_23)
isConnected = MEP.Connectors.IsConnected(connector=connectors)
filterByBoolMask_8 = List.FilterByBoolMask(list=connectors, mask=isConnected)
flatten_6 = List.Flatten(list=filterByBoolMask_8.out)
owner = MEP.Connectors.Owner(connector=flatten_6)
flatten_7 = List.Flatten(list=filterByBoolMask_8.in)
owner_2 = MEP.Connectors.Owner(connector=flatten_7)

# group: Todas caixas
categories_3 = Categories("OST_ElectricalFixtures")
all_elements_of_category_3 = ElementsOfCategory(Category=categories_3)
categories_4 = Categories("OST_LightingDevices")
all_elements_of_category_4 = ElementsOfCategory(Category=categories_4)
categories_5 = Categories("OST_ElectricalEquipment")
all_elements_of_category_5 = ElementsOfCategory(Category=categories_5)
list_create_3 = List.Create(item0=all_elements_of_category_3, item1=all_elements_of_category_4, item2=all_elements_of_category_5)
flatten_8 = List.Flatten(list=list_create_3)

# group: Selecionar caixas
location = MEP.Connectors.Location(connector=flatten_6)
code_block_24 = CodeBlock { 0.05; }
byCenterPointRadius = Sphere.ByCenterPointRadius(centerPoint=location, radius=code_block_24)
intersectsSolid = Revit.Element.IntersectsSolid(solids=byCenterPointRadius, elements=flatten_8)
intersectingElements = Results.SolidIntersectionResult.IntersectingElements(solidIntersectionResult=intersectsSolid)
boolean_10 = BoolSelector(true)
clean_7 = List.Clean(list=intersectingElements, preserveIndices=boolean_10)
firstItem = List.FirstItem(list=clean_7@L2)
boolean_11 = BoolSelector(false)
clean_8 = List.Clean(list=firstItem, preserveIndices=boolean_11)
flatten_9 = List.Flatten(list=clean_8)
uniqueItems = List.UniqueItems(list=flatten_9)
solids_2 = Element.Solids(element=uniqueItems)

code_block_25 = CodeBlock(waithFor=uniqueItems, Pass=owner) { [waithFor,Pass][1]; }
name_8 = Element.Name(element=uniqueItems)
code_block_26 = CodeBlock { "QDC"; }
contains_3 = String.Contains(str=name_8, searchFor=code_block_26)
filterByBoolMask_9 = List.FilterByBoolMask(list=uniqueItems, mask=contains_3)

# group: Conectar eletrodutos e caixas
list_create_4 = List.Create(item0=code_block_25, item1=filterByBoolMask_9.out)
flatten_10 = List.Flatten(list=list_create_4)
python_script = Python(IN[0]=flatten_10)
# ---------- python_script.python (73 lines) ----------
import clr

clr.AddReference("RevitServices")
import RevitServices
from RevitServices.Persistence import DocumentManager
from RevitServices.Transactions import TransactionManager
doc = DocumentManager.Instance.CurrentDBDocument

clr.AddReference("RevitAPI")
from Autodesk.Revit.DB import *

clr.AddReference("RevitNodes")
import Revit
clr.ImportExtensions(Revit.Elements)
clr.ImportExtensions(Revit.GeometryConversion)

def ConnectTo(connector, conn2):
    try:
        TransactionManager.Instance.EnsureInTransaction(doc)
        connector.ConnectTo(conn2)
        TransactionManager.Instance.TransactionTaskDone()
        return 1  # Retorna 1 para indicar uma conexão feita
    except:
        return 0  # Retorna 0 para indicar uma conexão não feita

conduits = UnwrapElement(IN[0])
margin = 0.01

connectors = {}
connlist = []
connections = 0  # Variável para armazenar o número de conexões feitas

for conduit in conduits:
    if conduit is None:
        continue

    try:
        conns = conduit.ConnectorManager.Connectors
    except AttributeError:
        try:
            conns = conduit.MEPModel.ConnectorManager.Connectors
        except AttributeError:
            continue

    for conn in conns:
        if conn.IsConnected:
            continue
        connectors[conn] = None
        connlist.append(conn)

for k in connectors.keys():
    mindist = 1000000
    closest = None
    for conn in connlist:
        if conn.Owner.Id.Equals(k.Owner.Id):
            continue
        dist = k.Origin.DistanceTo(conn.Origin)
        if dist < mindist:
            mindist = dist
            closest = conn
    if mindist > margin:
        continue
    connectors[k] = closest
    connlist.remove(closest)
    try:
        del connectors[closest]
    except:
        pass

for k, v in connectors.items():
    connections += ConnectTo(k, v)  # Incrementa a variável connections com o resultado da função ConnectTo

OUT = connections  # Saída com o número total de conexões feitas
# ----------------------------------------

solids_3 = Element.Solids(element=owner)
location_2 = Custom[Connector.Location](connector=flatten_6)  # package MEPover; Returns the location of a connector

# group: Selecionar caixa e pegar conector
connectors_2 = Custom[Element.Connectors](element=filterByBoolMask_9.in)  # package MEPover; Returns every connector on an element (also return connectors of a System)
connectorSystemType = Custom[Connector.ConnectorSystemType](connector=connectors_2)  # package MEPover; Returns the Connector System Type of the connector
isNull = Object.IsNull(obj=connectorSystemType, lacing=Longest)
filterByBoolMask_10 = List.FilterByBoolMask(list=connectors_2, mask=isNull)
isConnected_2 = Custom[Connector.IsConnected](connector=filterByBoolMask_10.in)  # package MEPover; Returns a boolean indicating whether the connector is connected to a connector on different element
filterByBoolMask_11 = List.FilterByBoolMask(list=filterByBoolMask_10.in, mask=isConnected_2)
code_block_27 = CodeBlock { "Superior"; }
description = MEP.Connectors.Description(connector=filterByBoolMask_11.out)
eq_3 = code_block_27 == description
filterByBoolMask_12 = List.FilterByBoolMask(list=filterByBoolMask_11.out@L1, mask=eq_3@L1, lacing=Shortest)
location_3 = Custom[Connector.Location](connector=filterByBoolMask_12.in)

flatten_11 = List.Flatten(list=location_3)
flatten_12 = List.Flatten(list=filterByBoolMask_12.in)

# group: Pegar conectores na mesma posição e conectar eletroduto a caixa
isAlmostEqualTo = Geometry.IsAlmostEqualTo(geometry=location_2, other=flatten_11, lacing=CrossProduct)
filterByBoolMask_13 = List.FilterByBoolMask(list=flatten_12@L2, mask=isAlmostEqualTo, lacing=Longest)

filterByBoolMask_14 = List.FilterByBoolMask(list=flatten_6@L2, mask=isAlmostEqualTo, lacing=Longest)
flatten_13 = List.Flatten(list=filterByBoolMask_14.in)
flatten_14 = List.Flatten(list=filterByBoolMask_13.in)
connectTo = Custom[Connector.ConnectTo](connector=flatten_13, Connector2=flatten_14, lacing=Longest)  # package MEPover; Connects a connector to another connector. Returns True if connection succeeded
flatten_15 = List.Flatten(list=byMEPCurves)
count = List.Count(list=flatten_15)

# group: Mensagem
count_2 = List.Count(list=flatten_5)
code_block_28 = CodeBlock { 0; }
gt_4 = count_2 > code_block_28
sub_2 = count - count_2
code_block_29 = CodeBlock(N=count, N2=count_2, N3=sub_2)
# ---------- code_block_29.designscript (3 lines) ----------
["Feito! você inseriu "+N+" luvas e"];
[" "+N2+" curvas em seu projeto"];
[" faltaram "+N3+" conexões de eletrodutos."];
# ----------------------------------------
code_block_30 = CodeBlock(N=code_block_29.out0, N2=code_block_29.out1, N3=code_block_29.out2) { N+N2+N3; }
code_block_31 = CodeBlock { ["Nenhuma Luva foi inserida"]; }
if_3 = If(test=gt_4, true=code_block_30, false=code_block_31)
flatten_16 = List.Flatten(list=if_3)
fromList = Python(IN[0]=flatten_16)  # "String.FromList"
# ---------- fromList.python (22 lines) ----------
# Carregar as bibliotecas DesignScript e padrão do Python
import sys
import clr
clr.AddReference('ProtoGeometry')
from Autodesk.DesignScript.Geometry import *

# Função para concatenar os valores de uma lista em uma única string com múltiplas linhas
def concatenate_list_to_string(input_list, delimiter="\n"):
    # Verifica se a entrada é uma lista
    if not isinstance(input_list, list):
        return "A entrada deve ser uma lista."
    
    # Converte todos os elementos para string e junta com o delimitador especificado
    result = delimiter.join(str(item) for item in input_list)
    return result

# Entrada pelo nó do Dynamo
lista = IN[0]  # Lista de valores a serem concatenados
delimitador = IN[1] if len(IN) > 1 else "\n"  # Delimitador opcional, padrão é nova linha

# Saída para o Dynamo
OUT = concatenate_list_to_string(lista, delimitador)
# ----------------------------------------
python_script_2 = Python(IN[0]=fromList)
# ---------- python_script_2.python (21 lines) ----------
# Importar as bibliotecas necessárias do Revit
import clr
clr.AddReference("RevitServices")
from RevitServices.Persistence import DocumentManager

clr.AddReference("RevitAPI")
clr.AddReference("RevitAPIUI")
from Autodesk.Revit.UI import TaskDialog

# Pegar a entrada do Dynamo
mensagem = IN[0]

# Criar a TaskDialog
task_dialog = TaskDialog("Ok")
task_dialog.MainInstruction = mensagem

# Exibir a TaskDialog
task_dialog.Show()

# Saída do script
OUT = "Sucesso!"
# ----------------------------------------
