# Dynamo graph 08-0_BIMACON_Inserir Suportes por Nome da Categoria_R07_script.dyn "08-0_BIMACON_Inserir Suportes por Nome da Categoria_R06_script" (Dynamo 3.6.1.9895)
# author: Jose Nelson
# Inserção de Suportes em todos eletrpodutos ou Bandejas pela Categoria
# packages: bimorphNodes 4.2.4, DynamoIronPython2.7 3.2.1, Data-Shapes 2022.2.105, DynaMEP 2.0.1, archi-lab.net 2023.213.1722, Genius Loci 2023.2.21, BIMCoder Nodes - 2.X 2025.1.0

# group: Design
# note: Use this colour for the fuctions designed in the program (graph core)

# group: Inputs
# note: Use this color for the nodes and code blocks that represent the inputs

# group: Python
# note: Use this color for the Python nodes

# group: Project name: "Placing cable tray supports"
# note: This graph places cable trays support divided on equally distance. Have fun!!!! :D :D :D

# group: Output
# note: Use this color for the nodes that represent the output of the graph

# group: PROBLEMS TO SOLVE
# note: TRYING TO FIGURE OUT HOW TO ROTATE ALL FAMILIES IN THE CORRECT DIRECTION.
#  	sUBPOINT: RAYBOUNCE NODE DOESN'T WORK WITH find nearest point.??????

# group: ENTRADAS PARA O USUÁRIO
code_block = CodeBlock { "Inserção de Suportes em Eletrodutos ou Eletrocalhas"; }
string = StringInput("LogoBimacon.png")
python_script = Python(IN[0]=string)  # IronPython2
# ---------- python_script.python (22 lines) ----------
import clr

# Adiciona referência ao ambiente .NET
clr.AddReference('System')
from System import Environment, IO

# Nome da imagem (entrada do usuário)
nome_arquivo_imagem = IN[0]

# Recupera o nome do usuário logado no Windows
usuario = Environment.UserName

# Monta o caminho completo para a pasta de imagens
caminho_base = r"C:\Users\{0}\AppData\Roaming\pyRevit\Extensions\Bimacon.extension\Bimacon.tab\Imagens_Bimacon".format(usuario)

# Junta o caminho base com o nome do arquivo
caminho_completo = IO.Path.Combine(caminho_base, nome_arquivo_imagem)

# Verifica se o arquivo existe
existe = IO.File.Exists(caminho_completo)

OUT = caminho_completo if existe else "Imagem não encontrada: {0}".format(caminho_completo)
# ----------------------------------------
file_from_path = FileObject(path=python_script)
readFromFile = Image.ReadFromFile(file=file_from_path)
string_2 = StringInput("Confirmar")
string_3 = StringInput("Nome do eletroduto ou Bandeja de Cabos")
categories = Categories("OST_CableTray")
all_elements_of_category = ElementsOfCategory(Category=categories)
categories_2 = Categories("OST_Conduit")
all_elements_of_category_2 = ElementsOfCategory(Category=categories_2)
list_create = List.Create(item0=all_elements_of_category, item1=all_elements_of_category_2)
flatten = List.Flatten(list=list_create)
name = Element.Name(element=flatten)
uniqueItems = List.UniqueItems(list=name)
code_block_2 = CodeBlock { 0; }
dropdown_data = Custom[DropDown Data](InputName=string_3, Keys=uniqueItems, Values=uniqueItems, DefaultValueIndex=code_block_2)  # package Data-Shapes; Create data for DropDown input in UI.MultiInputForm ++ . Check out www.data-shapes.net for more infos.
string_4 = StringInput("Tipo de Suporte")
categories_3 = Categories("OST_ConduitFitting")
obter_famílias_de_uma_categoria = Python(IN[0]=categories_3)  # "Obter Famílias de Uma Categoria - BIMACON"; IronPython2
# ---------- obter_famílias_de_uma_categoria.python (119 lines) ----------
# -*- coding: utf-8 -*-

import clr
import System

# Revit API
clr.AddReference('RevitAPI')
from Autodesk.Revit.DB import *

# Revit Services
clr.AddReference('RevitServices')
from RevitServices.Persistence import DocumentManager

# Revit Nodes
clr.AddReference("RevitNodes")
import Revit
clr.ImportExtensions(Revit.Elements)

# Documento atual
doc = DocumentManager.Instance.CurrentDBDocument


# ==================================================
# FUNÇÃO PARA OBTER BuiltInCategory
# Compatível Revit 2021 até 2026
# ==================================================

def obter_builtincategory(entrada):

    # Caso já seja BuiltInCategory
    if isinstance(entrada, BuiltInCategory):
        return entrada

    # Caso seja inteiro
    if isinstance(entrada, int):
        try:
            return System.Enum.ToObject(BuiltInCategory, entrada)
        except:
            return None

    # Tenta converter Category
    try:

        # Unwrap se necessário
        entrada = UnwrapElement(entrada)

        # Se for Category
        if isinstance(entrada, Category):

            cat_id = entrada.Id

            # Compatível versões antigas e novas
            try:
                valor = cat_id.IntegerValue
            except:
                valor = cat_id.Value

            return System.Enum.ToObject(BuiltInCategory, valor)

    except:
        pass

    return None


# ==================================================
# ENTRADA
# ==================================================

entrada = IN[0]

bic = obter_builtincategory(entrada)

# ==================================================
# COLETA FAMÍLIAS
# ==================================================

familias_filtradas = []

if bic:

    familias = FilteredElementCollector(doc)\
        .OfClass(Family)\
        .ToElements()

    for fam in familias:

        try:

            cat = fam.FamilyCategory

            if cat is None:
                continue

            cat_id = cat.Id

            # Compatibilidade 2021 → 2026
            try:
                valor_categoria = cat_id.IntegerValue
            except:
                valor_categoria = cat_id.Value

            bic_familia = System.Enum.ToObject(
                BuiltInCategory,
                valor_categoria
            )

            if bic_familia == bic:
                familias_filtradas.append(fam)

        except:
            continue


# ==================================================
# SAÍDA
# ==================================================

OUT = familias_filtradas
# ----------------------------------------
categories_4 = Categories("OST_CableTrayFitting")
obter_famílias_de_uma_categoria_2 = Python(IN[0]=categories_4)  # "Obter Famílias de Uma Categoria - BIMACON"; IronPython2; same code as obter_famílias_de_uma_categoria
list_create_2 = List.Create(item0=obter_famílias_de_uma_categoria, item1=obter_famílias_de_uma_categoria_2)
boolean = BoolSelector(false)
clean = List.Clean(list=list_create_2, preserveIndices=boolean)
flatten_2 = List.Flatten(list=clean)
name_2 = Family.Name(family=flatten_2)
code_block_3 = CodeBlock { "Suporte"; }
contains = String.Contains(string=name_2, searchFor=code_block_3)
filterByBoolMask = List.FilterByBoolMask(list=flatten_2, mask=contains)
types = Family.Types(family=filterByBoolMask.in)
flatten_3 = List.Flatten(list=types)
name_3 = FamilyType.Name(familyType=flatten_3)
code_block_4 = CodeBlock { "x"; }
boolean_2 = BoolSelector(true)
contains_2 = String.Contains(string=name_3, searchFor=code_block_4, ignoreCase=boolean_2)
filterByBoolMask_2 = List.FilterByBoolMask(list=flatten_3, mask=contains_2)
flatten_4 = List.Flatten(list=filterByBoolMask_2.out)
name_4 = FamilyType.Name(familyType=flatten_4)
name_5 = Family.Name(family=filterByBoolMask.in)
code_block_5 = CodeBlock { "Mao Francesa"; }
contains_3 = String.Contains(string=name_5, searchFor=code_block_5)
filterByBoolMask_3 = List.FilterByBoolMask(list=filterByBoolMask.in, mask=contains_3)
name_6 = Family.Name(family=filterByBoolMask_3.in)
types_2 = Family.Types(family=filterByBoolMask_3.in)
name_7 = Element.Name(element=types_2)
add = name_6 + name_7
flatten_5 = List.Flatten(list=add)
list_create_3 = List.Create(item0=name_4, item1=flatten_5)
flatten_6 = List.Flatten(list=list_create_3)
clean_2 = List.Clean(list=flatten_6)
flatten_7 = List.Flatten(list=types_2)
list_create_4 = List.Create(item0=flatten_4, item1=flatten_7)
flatten_8 = List.Flatten(list=list_create_4)
clean_3 = List.Clean(list=flatten_8)
code_block_6 = CodeBlock { 0; }
dropdown_data_2 = Custom[DropDown Data](InputName=string_4, Keys=clean_2, Values=clean_3, DefaultValueIndex=code_block_6)
string_5 = StringInput("Distancia inicial primeiro Suporte (m)")
string_6 = StringInput("0.5")
boolean_3 = BoolSelector(true)
textbox_data = Custom[TextBox Data](InputName=string_5, DefaultText=string_6, IsNumberEntry=boolean_3)  # package Data-Shapes; Create Data for TextBox input in UI.MultipleInputForm ++ . Check out www.data-shapes.net for more informations
string_7 = StringInput("Espaçamento entre Suportes (m)")
string_8 = StringInput("1")
boolean_4 = BoolSelector(true)
textbox_data_2 = Custom[TextBox Data](InputName=string_7, DefaultText=string_8, IsNumberEntry=boolean_4)
list_create_5 = List.Create(item0=dropdown_data, item1=dropdown_data_2, item2=textbox_data, item3=textbox_data_2)
boolean_5 = BoolSelector(true)
string_9 = StringInput("Cancelar")
number = DoubleInput(800)
number_2 = DoubleInput(245)
multipleinputform = Custom[MultipleInputForm ++](Description_optional=code_block, Logo_optional=readFromFile, ButtonText_optional=string_2, Inputs=list_create_5, Toggle=boolean_5, CancelButtonText_optional=string_9, Width_optional=number, LabelWidth_optional=number_2)  # package Data-Shapes; Create a form with multiple inputs. see www.data-shapes.net for tutorials and infos!
code_block_7 = CodeBlock()  # //Data-Shapes
code_block_8 = CodeBlock()  # //archilab
name_8 = Family.Name(family=filterByBoolMask.in)

# group: Separar Entradas
code_block_9 = CodeBlock { 1; }
getItemAtIndex = List.GetItemAtIndex(list=multipleinputform.User_Inputs, index=code_block_9)
code_block_10 = CodeBlock { 0; }
getItemAtIndex_2 = List.GetItemAtIndex(list=multipleinputform.User_Inputs, index=code_block_10)
code_block_11 = CodeBlock { 2; }
getItemAtIndex_3 = List.GetItemAtIndex(list=multipleinputform.User_Inputs, index=code_block_11)
code_block_12 = CodeBlock { 3; }
getItemAtIndex_4 = List.GetItemAtIndex(list=multipleinputform.User_Inputs, index=code_block_12)

# group: Family Type
family = FamilyType.Family(familyType=getItemAtIndex)
types_3 = Family.Types(family=family)
name_9 = FamilyType.Name(familyType=getItemAtIndex)
name_10 = FamilyType.Name(familyType=types_3)
eq = name_9 == name_10
filterByBoolMask_4 = List.FilterByBoolMask(list=types_3, mask=eq)

# group: Selecionando Eletrodutos ou Eletrocalhas
selecione_a_categoria_de = Categories("OST_CableTray")  # "Selecione a Categoria de Conduites ou Bandeja de Cabos"
all_elements_of_category_3 = ElementsOfCategory(Category=selecione_a_categoria_de)
selecione_a_categoria_de_2 = Categories("OST_Conduit")  # "Selecione a Categoria de Conduites ou Bandeja de Cabos"
all_elements_of_category_4 = ElementsOfCategory(Category=selecione_a_categoria_de_2)
list_create_6 = List.Create(item0=all_elements_of_category_3, item1=all_elements_of_category_4)
name_11 = Element.Name(element=list_create_6)
contains_4 = String.Contains(string=name_11, searchFor=getItemAtIndex_2)
filterByBoolMask_5 = List.FilterByBoolMask(list=list_create_6, mask=contains_4)

# group: Versão Revit
code_block_13 = CodeBlock { 2021; }
version = Python()  # "Document.Version"; IronPython2; unwired: IN[0]
# ---------- version.python (13 lines) ----------
# Importa as bibliotecas necessárias do Revit
import clr
clr.AddReference('RevitServices')
from RevitServices.Persistence import DocumentManager

# Obtém o documento ativo
doc = DocumentManager.Instance.CurrentUIApplication.Application

# Obtém o número da versão do Revit
revit_version = doc.VersionNumber

# Retorna o número da versão do Revit
OUT = "A versão do Revit é: {}".format(revit_version)
# ----------------------------------------
code_block_14 = CodeBlock { " "; }
split = String.Split(string=version, separator0=code_block_14)
lastItem = List.LastItem(list=split)
toNumber = String.ToNumber(string=lastItem)

# group: Altura Eletroduto
eq_2 = code_block_13 == toNumber
n2021 = CodeBlock { "Elevação superior"; "Elevação inferior"; }  # "2021"
n2022_2023_2024_2025 = CodeBlock { "Elevação da parte de cima da extremidade superior"; "Elevação da parte de baixo da extremidade inferior"; }  # "2022 - 2023 - 2024 - 2025"
if_ = If(test=eq_2, true=n2021.out0, false=n2022_2023_2024_2025.out0)
if_2 = If(test=eq_2, true=n2021.out1, false=n2022_2023_2024_2025.out1)

getParameterValueByName = Element.GetParameterValueByName(element=filterByBoolMask_5.in, parameterName=if_, lacing=Longest)
getParameterValueByName_2 = Element.GetParameterValueByName(element=filterByBoolMask_5.in, parameterName=if_2, lacing=Longest)
sub = getParameterValueByName - getParameterValueByName_2
code_block_15 = CodeBlock { 0.21; }
gt = sub > code_block_15
filterByBoolMask_6 = List.FilterByBoolMask(list=filterByBoolMask_5.in, mask=gt, lacing=Longest)
flatten_9 = List.Flatten(list=filterByBoolMask_6.out)

# group: Filtrar os caminhos de cabos em função do comprimento mínimo
getLocation = Element.GetLocation(element=flatten_9)
length = Curve.Length(curve=getLocation)
gt_2 = length > getItemAtIndex_3
filterByBoolMask_7 = List.FilterByBoolMask(list=length, mask=gt_2)

filterByBoolMask_8 = List.FilterByBoolMask(list=getLocation, mask=gt_2)

# group: Definindo o espaçamento
code_block_16 = CodeBlock(y=filterByBoolMask_7.in) { casas_decimais = 2; list = DSCore.Math.Ceiling(y*casas_decimais)/casas_decimais; }

code_block_17 = CodeBlock { 1; }
code_block_18 = CodeBlock(vals=code_block_16.list, replace=code_block_17) { c = DSCore.List.Count(vals); DSCore.List.OfRepeatedItem(replace,c); }
code_block_19 = CodeBlock(val=code_block_16.list, replace=code_block_18.out1) { val==0?replace:val; }

# group (continued): Definindo o espaçamento
code_block_20 = CodeBlock(full_len=code_block_19, inset=getItemAtIndex_3, max_spacing=getItemAtIndex_4) { len = full_len - inset; count = len/max_spacing; req_count = DSCore.Math.Ceiling(count); spacing = len/req_count; }
code_block_21 = CodeBlock(inset=getItemAtIndex_3, count=code_block_20.count, spacing=code_block_20.spacing) { inset..count*spacing..#count; }

code_block_22 = CodeBlock { 0.2; }
python_script_2 = Python(IN[0]=code_block_21, IN[1]=code_block_22)  # IronPython2
# ---------- python_script_2.python (15 lines) ----------
# Carregar as bibliotecas DesignScript e padrão do Python
import sys
import clr
clr.AddReference('ProtoGeometry')
from Autodesk.DesignScript.Geometry import *

# Entradas
valores = IN[0]  # Lista de valores (alguns podem ser null)
replace = IN[1]  # Valor para substituir os valores null

# Função para substituir valores null
valores_substituidos = [replace if val is None else val for val in valores]

# Saída
OUT = valores_substituidos
# ----------------------------------------
filterByBoolMask_9 = List.FilterByBoolMask(list=flatten_9, mask=gt_2)

# group: Obtendo os parâmetros
code_block_23 = CodeBlock { "Diâmetro (tamanho comercial)"; "Largura"; "Altura"; }
getParameterValueByName_3 = Element.GetParameterValueByName(element=filterByBoolMask_9.in, parameterName=code_block_23.out0)
convert_between_units = DynamoConvert(getParameterValueByName_3, MeasurementType="Length", FromConversion="Millimeters", ToConversion="Meters")
getParameterValueByName_4 = Element.GetParameterValueByName(element=filterByBoolMask_9.in, parameterName=code_block_23.out1)
convert_between_units_2 = DynamoConvert(getParameterValueByName_4, MeasurementType="Length", FromConversion="Millimeters", ToConversion="Meters")
getParameterValueByName_5 = Element.GetParameterValueByName(element=filterByBoolMask_9.in, parameterName=code_block_23.out2)
convert_between_units_3 = DynamoConvert(getParameterValueByName_5, MeasurementType="Length", FromConversion="Millimeters", ToConversion="Meters")
convert_by_units = DynamoUnitConvert(MeasurementType="autodesk.unit.quantity:length-1.0.5", FromConversion="autodesk.unit.unit:millimeters-1.0.1", ToConversion="autodesk.unit.unit:meters-1.0.0")

getLocation_2 = Element.GetLocation(element=filterByBoolMask_9.in)

# group: Obtendo os pontos de posicionamento
pointAtSegmentLength = Curve.PointAtSegmentLength(curve=filterByBoolMask_8.in, segmentLength=python_script_2)
parameterAtPoint = Curve.ParameterAtPoint(curve=getLocation_2, point=pointAtSegmentLength)
normalAtParameter = Curve.NormalAtParameter(curve=getLocation_2, param=parameterAtPoint)

# group: Criando as famílias de suportes
byPoint = FamilyInstance.ByPoint(familyType=filterByBoolMask_4.in, point=pointAtSegmentLength, lacing=Longest)

# group: Parâmetro da família DN
code_block_24 = CodeBlock { "DN"; }
setParameterByName = Element.SetParameterByName(element=byPoint, parameterName=code_block_24, value=convert_between_units, lacing=Longest)

# group: Parâmetro da família Largura
code_block_25 = CodeBlock { "Largura"; }
setParameterByName_2 = Element.SetParameterByName(element=byPoint, parameterName=code_block_25, value=convert_between_units_2)

# group: Parâmetro da família Altura
code_block_26 = CodeBlock { "Altura"; }
setParameterByName_3 = Element.SetParameterByName(element=byPoint, parameterName=code_block_26, value=convert_between_units_3)

# group: Intersecção com a laje
location = FamilyInstance.Location(familyInstance=byPoint)
X = Point.X(point=location)
Y = Point.Y(point=location)
Z = Point.Z(point=location)
code_block_27 = CodeBlock { 3; }
add_2 = Z + code_block_27
byCoordinates = Point.ByCoordinates(x=X, y=Y, z=add_2)
code_block_28 = CodeBlock { 0.05; }
byPointsRadius = Cone.ByPointsRadius(startPoint=location, endPoint=byCoordinates, startRadius=code_block_28)
categories_5 = Categories("OST_Floors")
all_elements_of_category_5 = ElementsOfCategory(Category=categories_5)
intersectsSolid = Revit.Element.IntersectsSolid(solids=byPointsRadius, elements=all_elements_of_category_5)
intersectingElements = Results.SolidIntersectionResult.IntersectingElements(solidIntersectionResult=intersectsSolid)
code_block_29 = CodeBlock { "Elevação na parte inferior"; }
getParameterValueByName_6 = Element.GetParameterValueByName(element=intersectingElements, parameterName=code_block_29)
abs = Math.Abs(number=getParameterValueByName_6)
code_block_30 = CodeBlock { "Elevação do nível"; }
getParameterValueByName_7 = Element.GetParameterValueByName(element=byPoint, parameterName=code_block_30)
abs_2 = Math.Abs(number=getParameterValueByName_7)
sub_2 = abs - abs_2

# group: Parâmetro da família Distância até o Teto
code_block_31 = CodeBlock { "Distância até o Teto"; }
abs_3 = Math.Abs(number=sub_2)
setParameterByName_4 = Element.SetParameterByName(element=byPoint, parameterName=code_block_31, value=abs_3)

# group: Ângulo de orientação
X_2 = Vector.X(vector=normalAtParameter)
code_block_32 = CodeBlock { 0.0; 0.001; }
ge = X_2 >= code_block_32.out0
reverse = Vector.Reverse(vector=normalAtParameter)
condição_if_de_lista = CodeBlock(test=ge, verd=normalAtParameter, fals=reverse)
# ---------- condição_if_de_lista.designscript (2 lines) ----------
//Condições IF
test == true ? verd : fals;
# ----------------------------------------
code_block_33 = CodeBlock(Vector1=condição_if_de_lista) { Vector.YAxis(); Vector1; Vector.XAxis(); }
angleAboutAxis = Vector.AngleAboutAxis(vector=code_block_33.Vector1, otherVector=code_block_33.out0, rotationAxis=code_block_33.out2)
round = Math.Round(number=angleAboutAxis)
eq_3 = Equals(x=X_2, y=code_block_32.out0, tolerance=code_block_32.out1)

# group: Parâmetro da família - Ângulo
setRotation = FamilyInstance.SetRotation(familyInstance=byPoint, degree=round)

# group: Intersecção com a parede
boundingBox = Element.BoundingBox(element=setRotation)
minPoint = BoundingBox.MinPoint(boundingBox=boundingBox)
code_block_34 = CodeBlock { 1.5; -1.5; }
translate = Geometry.Translate(geometry=minPoint, direction=condição_if_de_lista, distance=code_block_34.out1)
X_3 = Point.X(point=translate)
Y_2 = Point.Y(point=translate)
Z_2 = Point.Z(point=minPoint)
byCoordinates_2 = Point.ByCoordinates(x=X_3, y=Y_2, z=Z_2)
maxPoint = BoundingBox.MaxPoint(boundingBox=boundingBox)
translate_2 = Geometry.Translate(geometry=maxPoint, direction=condição_if_de_lista, distance=code_block_34.out0)
X_4 = Point.X(point=translate_2)
Y_3 = Point.Y(point=translate_2)
Z_3 = Point.Z(point=maxPoint)
byCoordinates_3 = Point.ByCoordinates(x=X_4, y=Y_3, z=Z_3)
byCorners = Cuboid.ByCorners(lowPoint=byCoordinates_2, highPoint=byCoordinates_3)
categories_6 = Categories("OST_Walls")
all_elements_of_category_6 = ElementsOfCategory(Category=categories_6)
intersectsSolid_2 = Revit.Element.IntersectsSolid(solids=byCorners, elements=all_elements_of_category_6)
intersectingElements_2 = Results.SolidIntersectionResult.IntersectingElements(solidIntersectionResult=intersectsSolid_2)
solids = Element.Solids(element=intersectingElements_2)
location_2 = FamilyInstance.Location(familyInstance=setRotation)
distanceTo = Geometry.DistanceTo(geometry=solids, other=location_2)
abs_4 = Math.Abs(number=distanceTo)
center = RevitModel.BoundingBox.Center(boundingBox=boundingBox)

# group: Parâmetro da família Distância até a parede
code_block_35 = CodeBlock { "Dist. Parede"; }
setParameterByName_5 = Element.SetParameterByName(element=byPoint, parameterName=code_block_35, value=abs_4)

end = Revit.Transaction.Transaction.End(input=setParameterByName_5)
passThrough = Custom[PassThrough](passThrough=setRotation, waitFor=end)  # package archi-lab.net; Ripped this off from Clockwork. Sorry Andy.
start = Revit.Transaction.Transaction.Start(input=passThrough)

# group: Distância da parede
familyinstance_references = Custom[👓 FamilyInstance․References](familyInstance=start, lacing=Longest)  # package BIMCoder Nodes - 2.X; Obtém todas as referências de uma família de instância
string_10 = StringInput("Parede")
contains_5 = String.Contains(string=familyinstance_references.ReferenceName, searchFor=string_10)
filterByBoolMask_10 = List.FilterByBoolMask(list=familyinstance_references.Plane, mask=contains_5)
origin = Plane.Origin(plane=filterByBoolMask_10.in)
flatten_10 = List.Flatten(list=origin@L3)
distanceTo_2 = Geometry.DistanceTo(geometry=solids, other=flatten_10)
number_3 = DoubleInput(0)
replaceEmptyList = Python(IN[0]=distanceTo_2, IN[1]=number_3)  # "Lists.ReplaceEmptyList"; IronPython2
# ---------- replaceEmptyList.python (18 lines) ----------
import clr
clr.AddReference('ProtoGeometry')
import Autodesk.DesignScript.Geometry as DS

def replace_empty(lst, replacement):
    if isinstance(lst, list):
        if len(lst) == 0:
            return replacement
        else:
            return [replace_empty(item, replacement) for item in lst]
    return lst

# Entrada do Dynamo
lista = IN[0]  # Lista a ser verificada
replacement = IN[1]  # Valor de substituição para listas vazias

# Processamento
OUT = replace_empty(lista, replacement)
# ----------------------------------------
flatten_11 = List.Flatten(list=replaceEmptyList@@L4)
minimumItem = List.MinimumItem(list=flatten_11)
gt_3 = minimumItem > number_3
filterByBoolMask_11 = List.FilterByBoolMask(list=setRotation, mask=gt_3)
flatten_12 = List.Flatten(list=filterByBoolMask_11.in@L2)
filterByBoolMask_12 = List.FilterByBoolMask(list=X_2, mask=gt_3)
flatten_13 = List.Flatten(list=filterByBoolMask_12.in@L2)
number_4 = DoubleInput(0.707)
eq_4 = Equals(x=flatten_13, y=number_4, tolerance=code_block_32.out1)
number_5 = DoubleInput(-0.707)
eq_5 = Equals(x=flatten_13, y=number_5, tolerance=code_block_32.out1)

passThrough_2 = Custom[PassThrough](passThrough=flatten_12, waitFor=setParameterByName_5)
element_getrotation = Custom[Element GetRotation](element=flatten_12@L2)  # package Genius Loci; Calculates the rotation angle between the given element and the X axis. Works for point/ line/ sketch based elements and link instances.
passThrough_3 = Custom[PassThrough](passThrough=condição_if_de_lista, waitFor=setParameterByName_5)
reverse_2 = Vector.Reverse(vector=passThrough_3)
code_block_36 = CodeBlock(Vector1=reverse_2) { Vector.XAxis(); Vector1; Vector.YAxis(); }
angleAboutAxis_2 = Vector.AngleAboutAxis(vector=code_block_36.Vector1, otherVector=code_block_36.out0, rotationAxis=code_block_36.out2)
round_2 = Math.Round(number=angleAboutAxis_2)
filterByBoolMask_13 = List.FilterByBoolMask(list=round_2, mask=gt_3)

# group: Rotacionar
filterByBoolMask_14 = List.FilterByBoolMask(list=eq_3, mask=gt_3)
passThrough_4 = Custom[PassThrough](passThrough=element_getrotation, waitFor=setParameterByName_5)
code_block_37 = CodeBlock { 180; }
add_3 = passThrough_4 + code_block_37
code_block_38 = CodeBlock { -90; }
add_4 = passThrough_4 + code_block_38
code_block_39 = CodeBlock { 90; }
add_5 = passThrough_4 + code_block_39
code_block_40 = CodeBlock { 180; }
add_6 = filterByBoolMask_13.in + code_block_40
sub_3 = passThrough_4 - add_6
condição_if_de_lista_2 = CodeBlock(test=filterByBoolMask_14.in, OP1=add_3, test1=eq_4, OP2=add_4, test2=eq_5, OP3=add_5, OP4=sub_3)
# ---------- condição_if_de_lista_2.designscript (2 lines) ----------
//Condições IF
test == true ? OP1 : test1 == true ? OP2 : test2 == true ? OP3 : OP4;
# ----------------------------------------
setRotation_2 = FamilyInstance.SetRotation(familyInstance=passThrough_2, degree=condição_if_de_lista_2)

end_2 = Revit.Transaction.Transaction.End(input=setRotation_2)

# group: Mensagem Final
flatten_14 = List.Flatten(list=setRotation)
passThrough_5 = Custom[PassThrough](passThrough=flatten_14, waitFor=end_2)
count = List.Count(list=passThrough_5)
code_block_41 = CodeBlock { 0; }
gt_4 = count > code_block_41
code_block_42 = CodeBlock(N=count) { ["Feito! você inseriu "+N+" Suportes"]; }
code_block_43 = CodeBlock { ["Nenhum Suporte foi inserido"]; }
if_3 = If(test=gt_4, true=code_block_42, false=code_block_43)
flatten_15 = List.Flatten(list=if_3)
fromList = Python(IN[0]=flatten_15)  # "String.FromList"; IronPython2
# ---------- fromList.python (22 lines) ----------
# Carregar as bibliotecas DesignScript e padrão do Python
import sys
import clr
clr.AddReference('ProtoGeometry')
from Autodesk.DesignScript.Geometry import *

# Função para concatenar os valores de uma lista em uma única string com múltiplas linhas
def concatenate_list_to_string(input_list, delimiter="\n"):
    # Verifica se a entrada é uma lista
    if not isinstance(input_list, list):
        return "A entrada deve ser uma lista."
    
    # Converte todos os elementos para string e junta com o delimitador especificado
    result = delimiter.join(str(item) for item in input_list)
    return result

# Entrada pelo nó do Dynamo
lista = IN[0]  # Lista de valores a serem concatenados
delimitador = IN[1] if len(IN) > 1 else "\n"  # Delimitador opcional, padrão é nova linha

# Saída para o Dynamo
OUT = concatenate_list_to_string(lista, delimitador)
# ----------------------------------------
python_script_3 = Python(IN[0]=fromList)  # IronPython2
# ---------- python_script_3.python (21 lines) ----------
# Importar as bibliotecas necessárias do Revit
import clr
clr.AddReference("RevitServices")
from RevitServices.Persistence import DocumentManager

clr.AddReference("RevitAPI")
clr.AddReference("RevitAPIUI")
from Autodesk.Revit.UI import TaskDialog

# Pegar a entrada do Dynamo
mensagem = IN[0]

# Criar a TaskDialog
task_dialog = TaskDialog("Ok")
task_dialog.MainInstruction = mensagem

# Exibir a TaskDialog
task_dialog.Show()

# Saída do script
OUT = "Sucesso!"
# ----------------------------------------

watch = Watch(python_script_2)
watch_2 = Watch(replaceEmptyList)
