# Dynamo graph 2021_08-2_BIMACON_Inserir Suportes por Nome da Categoria_R02_script.dyn "2021_08-2_BIMACON_Inserir Suportes por Nome da Categoria_R02" (Dynamo 2.6.1.8786)
# packages: bimorphNodes 4.2.4, Orchid 2.6.8.6198, Data-Shapes 2022.2.105, Clockwork for Dynamo 2.x 2.4.0

# group: Design
# note: Use this colour for the fuctions designed in the program (graph core)

# group: Inputs
# note: Use this color for the nodes and code blocks that represent the inputs

# group: Python
# note: Use this color for the Python nodes

# group: Project name: "Placing cable tray supports"
# note: This graph places cable trays support divided on equally distance. Have fun!!!! :D :D :D

# group: Output
# note: Use this color for the nodes that represent the output of the graph

# group: PROBLEMS TO SOLVE
# note: TRYING TO FIGURE OUT HOW TO ROTATE ALL FAMILIES IN THE CORRECT DIRECTION.
#  	sUBPOINT: RAYBOUNCE NODE DOESN'T WORK WITH find nearest point.??????

string = StringInput("Nome do eletroduto ou Bandeja de Cabos")
categories = Categories("OST_CableTray")
all_elements_of_category = ElementsOfCategory(Category=categories)
categories_2 = Categories("OST_Conduit")
all_elements_of_category_2 = ElementsOfCategory(Category=categories_2)
list_create = List.Create(item0=all_elements_of_category, item1=all_elements_of_category_2)
flatten = List.Flatten(list=list_create)
name = Element.Name(element=flatten)
uniqueItems = List.UniqueItems(list=name)
code_block = CodeBlock { 0; }
dropdown_data = Custom[DropDown Data](InputName=string, Keys=uniqueItems, Values=uniqueItems, DefaultValueIndex=code_block)  # package Data-Shapes; Create data for DropDown input in UI.MultiInputForm ++ . Check out www.data-shapes.net for more infos.

# group: ENTRADAS PARA O USUÁRIO
code_block_2 = CodeBlock { "Inserção de Suportes em Eletrodutos ou eletrocalhas"; }
file_path = Filename("..\..\..\..\..\05 - BIMACON\01 - EMPRESA BIMACON\00 - Logos e imagens - BIMACON\ARTE BIMACON\reddonda-removebg-preview.png")
file_from_path = FileObject(path=file_path)
readFromFile = Image.ReadFromFile(file=file_from_path)
string_2 = StringInput("Confirmar")
string_3 = StringInput("Tipo de Suporte")
categories_3 = Categories("OST_ConduitFitting")
all_families_of_category = Custom[All Families Of Category](category=categories_3)  # package Clockwork for Dynamo 2.x; Gets all famiies of a given category in the model (does *not *work for system families)
categories_4 = Categories("OST_CableTrayFitting")
all_families_of_category_2 = Custom[All Families Of Category](category=categories_4)
list_create_2 = List.Create(item0=all_families_of_category, item1=all_families_of_category_2)
name_2 = Family.Name(family=list_create_2)
code_block_3 = CodeBlock { "Suporte"; }
contains = String.Contains(str=name_2, searchFor=code_block_3)
filterByBoolMask = List.FilterByBoolMask(list=list_create_2, mask=contains)
name_3 = Family.Name(family=filterByBoolMask.in)
code_block_4 = CodeBlock { "x"; }
contains_2 = String.Contains(str=name_3, searchFor=code_block_4)
filterByBoolMask_2 = List.FilterByBoolMask(list=filterByBoolMask.in, mask=contains_2)
types = Family.Types(family=filterByBoolMask_2.out)
flatten_2 = List.Flatten(list=types)
name_4 = FamilyType.Name(familyType=flatten_2)
code_block_5 = CodeBlock { 0; }
dropdown_data_2 = Custom[DropDown Data](InputName=string_3, Keys=name_4, Values=flatten_2, DefaultValueIndex=code_block_5)
string_4 = StringInput("Distancia inicial primeiro Suporte (m)")
string_5 = StringInput("0.5")
boolean = BoolSelector(true)
textbox_data = Custom[TextBox Data](InputName=string_4, DefaultText=string_5, IsNumberEntry=boolean)  # package Data-Shapes; Create Data for TextBox input in UI.MultipleInputForm ++ . Check out www.data-shapes.net for more informations
string_6 = StringInput("Espaçamento entre Suportes (m)")
string_7 = StringInput("0.5")
boolean_2 = BoolSelector(true)
textbox_data_2 = Custom[TextBox Data](InputName=string_6, DefaultText=string_7, IsNumberEntry=boolean_2)
list_create_3 = List.Create(item0=dropdown_data, item1=dropdown_data_2, item2=textbox_data, item3=textbox_data_2)
boolean_3 = BoolSelector(true)
string_8 = StringInput("Cancelar")
number = DoubleInput(600)
number_2 = DoubleInput(212)
multipleinputform = Custom[MultipleInputForm ++](Description_optional=code_block_2, Logo_optional=readFromFile, ButtonText_optional=string_2, Inputs=list_create_3, Toggle=boolean_3, CancelButtonText_optional=string_8, Width_optional=number, LabelWidth_optional=number_2)  # package Data-Shapes; Create a form with multiple inputs. see www.data-shapes.net for tutorials and infos!
code_block_6 = CodeBlock()  # //Data-Shapes
code_block_7 = CodeBlock()  # //archilab

# group: Separar Entradas
code_block_8 = CodeBlock { 1; }
getItemAtIndex = List.GetItemAtIndex(list=multipleinputform.User_Inputs, index=code_block_8)
code_block_9 = CodeBlock { 0; }
getItemAtIndex_2 = List.GetItemAtIndex(list=multipleinputform.User_Inputs, index=code_block_9)
code_block_10 = CodeBlock { 2; }
getItemAtIndex_3 = List.GetItemAtIndex(list=multipleinputform.User_Inputs, index=code_block_10)
code_block_11 = CodeBlock { 3; }
getItemAtIndex_4 = List.GetItemAtIndex(list=multipleinputform.User_Inputs, index=code_block_11)

# group: Family Type
family = FamilyType.Family(familyType=getItemAtIndex)
types_2 = Family.Types(family=family)
name_5 = FamilyType.Name(familyType=getItemAtIndex)
name_6 = FamilyType.Name(familyType=types_2)
eq = name_5 == name_6
filterByBoolMask_3 = List.FilterByBoolMask(list=types_2, mask=eq)

# group: Selecionando Eletrodutos ou Eletrocalhas
selecione_a_categoria_de = Categories("OST_CableTray")  # "Selecione a Categoria de Conduites ou Bandeja de Cabos"
all_elements_of_category_3 = ElementsOfCategory(Category=selecione_a_categoria_de)
selecione_a_categoria_de_2 = Categories("OST_Conduit")  # "Selecione a Categoria de Conduites ou Bandeja de Cabos"
all_elements_of_category_4 = ElementsOfCategory(Category=selecione_a_categoria_de_2)
list_create_4 = List.Create(item0=all_elements_of_category_3, item1=all_elements_of_category_4)
name_7 = Element.Name(element=list_create_4)
contains_3 = String.Contains(str=name_7, searchFor=getItemAtIndex_2)
filterByBoolMask_4 = List.FilterByBoolMask(list=list_create_4, mask=contains_3)

flatten_3 = List.Flatten(list=filterByBoolMask_4.in)
code_block_12 = CodeBlock { 0.3; }

# group: Filtrar os caminhos de cabos em função do comprimento mínimo
getLocation = Element.GetLocation(element=flatten_3)
length = Curve.Length(curve=getLocation)
gt = length > code_block_12
filterByBoolMask_5 = List.FilterByBoolMask(list=length, mask=gt)

# group: Definindo o espaçamento
code_block_13 = CodeBlock(y=filterByBoolMask_5.in) { list = DSCore.Math.Round(y); }
boolean_4 = BoolSelector(false)

code_block_14 = CodeBlock { 1; }
code_block_15 = CodeBlock(vals=code_block_13, replace=code_block_14) { c = List.Count(vals); List.OfRepeatedItem(replace,c); }
code_block_16 = CodeBlock(val=code_block_13, replace=code_block_15.out1) { val==0?replace:val; }

# group (continued): Definindo o espaçamento
code_block_17 = CodeBlock(full_len=code_block_16, inset=getItemAtIndex_3, max_spacing=getItemAtIndex_4) { len = full_len - inset; count = len/max_spacing; req_count = DSCore.Math.Ceiling(count); spacing = len/req_count; }
code_block_18 = CodeBlock(inset=getItemAtIndex_3, count=code_block_17.count, spacing=code_block_17.spacing) { inset..count*spacing..#count; }
clean = List.Clean(list=code_block_18, preserveIndices=boolean_4)  # frozen

# group: Obtendo os pontos de posicionamento
pointAtSegmentLength = Curve.PointAtSegmentLength(curve=getLocation, segmentLength=code_block_18)
parameterAtPoint = Curve.ParameterAtPoint(curve=getLocation, point=pointAtSegmentLength)
normalAtParameter = Curve.NormalAtParameter(curve=getLocation, param=parameterAtPoint)

# group: Creando as famílias de suportes
byPoint = FamilyInstance.ByPoint(familyType=filterByBoolMask_3.in, point=pointAtSegmentLength, lacing=Longest)

# group: Obtendo os parâmetros
code_block_19 = CodeBlock { "Diâmetro (tamanho comercial)"; "Largura"; "Altura"; }
getParameterValueByName = Element.GetParameterValueByName(element=flatten_3, parameterName=code_block_19.out0)
convert_between_units = DynamoConvert(getParameterValueByName, MeasurementType="Length", FromConversion="Millimeters", ToConversion="Meters")
getParameterValueByName_2 = Element.GetParameterValueByName(element=flatten_3, parameterName=code_block_19.out1)
convert_between_units_2 = DynamoConvert(getParameterValueByName_2, MeasurementType="Length", FromConversion="Millimeters", ToConversion="Meters")
getParameterValueByName_3 = Element.GetParameterValueByName(element=flatten_3, parameterName=code_block_19.out2)
convert_between_units_3 = DynamoConvert(getParameterValueByName_3, MeasurementType="Length", FromConversion="Millimeters", ToConversion="Meters")

# group: Parâmetro da família DN
code_block_20 = CodeBlock { "DN"; }
setParameterByName = Element.SetParameterByName(element=byPoint, parameterName=code_block_20, value=convert_between_units)

# group: Parâmetro da família Largura
code_block_21 = CodeBlock { "Largura"; }
setParameterByName_2 = Element.SetParameterByName(element=byPoint, parameterName=code_block_21, value=convert_between_units_2)

# group: Parâmetro da família Altura
code_block_22 = CodeBlock { "Altura"; }
setParameterByName_3 = Element.SetParameterByName(element=byPoint, parameterName=code_block_22, value=convert_between_units_3)

# group: Intersecção com a laje
location = FamilyInstance.Location(familyInstance=byPoint)
X = Point.X(point=location)
Y = Point.Y(point=location)
Z = Point.Z(point=location)
code_block_23 = CodeBlock { 3; }
add = Z + code_block_23
byCoordinates = Point.ByCoordinates(x=X, y=Y, z=add)
code_block_24 = CodeBlock { 0.05; }
byPointsRadius = Cone.ByPointsRadius(startPoint=location, endPoint=byCoordinates, startRadius=code_block_24)
categories_5 = Categories("OST_Floors")
all_elements_of_category_5 = ElementsOfCategory(Category=categories_5)
intersectsSolid = Revit.Element.IntersectsSolid(solids=byPointsRadius, elements=all_elements_of_category_5)
intersectingElements = Results.SolidIntersectionResult.IntersectingElements(solidIntersectionResult=intersectsSolid)
code_block_25 = CodeBlock { "Elevação na parte inferior"; }
getParameterValueByName_4 = Element.GetParameterValueByName(element=intersectingElements, parameterName=code_block_25)
abs = Math.Abs(number=getParameterValueByName_4)
code_block_26 = CodeBlock { "Elevação do nível"; }
getParameterValueByName_5 = Element.GetParameterValueByName(element=byPoint, parameterName=code_block_26)
abs_2 = Math.Abs(number=getParameterValueByName_5)
sub = abs - abs_2

# group: Parâmetro da família Distância até o Teto
code_block_27 = CodeBlock { "Distância até o Teto"; }
abs_3 = Math.Abs(number=sub)
setParameterByName_4 = Element.SetParameterByName(element=byPoint, parameterName=code_block_27, value=abs_3)

# group: Ângulo de orientação
X_2 = Vector.X(vector=normalAtParameter)
code_block_28 = CodeBlock { 0.707; 0.001; }
eq_2 = Equals(x=X_2, y=code_block_28.out0, tolerance=code_block_28.out1)
reverse = Vector.Reverse(vector=normalAtParameter)
if_ = If(test=eq_2, true=normalAtParameter, false=reverse)
code_block_29 = CodeBlock(Vector1=if_) { Vector.YAxis(); Vector1; Vector.XAxis(); }
angleAboutAxis = Vector.AngleAboutAxis(vector=code_block_29.Vector1, otherVector=code_block_29.out0, rotationAxis=code_block_29.out2)
round = Math.Round(number=angleAboutAxis)

# group: Parâmetro da família - Ângulo
setRotation = FamilyInstance.SetRotation(familyInstance=byPoint, degree=round)

# group: Mensagem Final
flatten_4 = List.Flatten(list=setRotation)
count = List.Count(list=flatten_4)
code_block_30 = CodeBlock { 0; }
gt_2 = count > code_block_30
code_block_31 = CodeBlock(N=count) { ["Feito! você inseriu "+N+" Suportes"]; }
code_block_32 = CodeBlock { ["Nenhum Suporte foi inserido"]; }
if_2 = If(test=gt_2, true=code_block_31, false=code_block_32)
flatten_5 = List.Flatten(list=if_2)
o_string_fromlist = Orchid.Common.String.FromList(list=flatten_5)
python_script = Python(IN[0]=o_string_fromlist)
# ---------- python_script.python (21 lines) ----------
# Importar as bibliotecas necessárias do Revit
import clr
clr.AddReference("RevitServices")
from RevitServices.Persistence import DocumentManager

clr.AddReference("RevitAPI")
clr.AddReference("RevitAPIUI")
from Autodesk.Revit.UI import TaskDialog

# Pegar a entrada do Dynamo
mensagem = IN[0]

# Criar a TaskDialog
task_dialog = TaskDialog("Ok")
task_dialog.MainInstruction = mensagem

# Exibir a TaskDialog
task_dialog.Show()

# Saída do script
OUT = "Sucesso!"
# ----------------------------------------
