# Dynamo graph ok 2021_08-0_BIMACON_Inserir Suportes por Nome da Categoria_R04_script.dyn (Dynamo 2.6.1.8786)
# packages: bimorphNodes 4.2.4, Data-Shapes 2022.2.105, Clockwork for Dynamo 2.x 2.4.0

# group: Design
# note: Use this colour for the fuctions designed in the program (graph core)

# group: Inputs
# note: Use this color for the nodes and code blocks that represent the inputs

# group: Python
# note: Use this color for the Python nodes

# group: Project name: "Placing cable tray supports"
# note: This graph places cable trays support divided on equally distance. Have fun!!!! :D :D :D

# group: Output
# note: Use this color for the nodes that represent the output of the graph

# group: PROBLEMS TO SOLVE
# note: TRYING TO FIGURE OUT HOW TO ROTATE ALL FAMILIES IN THE CORRECT DIRECTION.
#  	sUBPOINT: RAYBOUNCE NODE DOESN'T WORK WITH find nearest point.??????

# group: ENTRADAS PARA O USUÁRIO
code_block = CodeBlock { "Inserção de Suportes em Eletrodutos ou eletrocalhas"; }
file_path = Filename("..\..\..\..\..\05 - BIMACON\01 - EMPRESA BIMACON\00 - Logos e imagens - BIMACON\ARTE BIMACON\reddonda-removebg-preview.png")
file_from_path = FileObject(path=file_path)
readFromFile = Image.ReadFromFile(file=file_from_path)
string = StringInput("Confirmar")
string_2 = StringInput("Nome do eletroduto ou Bandeja de Cabos")
categories = Categories("OST_CableTray")
all_elements_of_category = ElementsOfCategory(Category=categories)
categories_2 = Categories("OST_Conduit")
all_elements_of_category_2 = ElementsOfCategory(Category=categories_2)
list_create = List.Create(item0=all_elements_of_category, item1=all_elements_of_category_2)
flatten = List.Flatten(list=list_create)
name = Element.Name(element=flatten)
uniqueItems = List.UniqueItems(list=name)
code_block_2 = CodeBlock { 0; }
dropdown_data = Custom[DropDown Data](InputName=string_2, Keys=uniqueItems, Values=uniqueItems, DefaultValueIndex=code_block_2)  # package Data-Shapes; Create data for DropDown input in UI.MultiInputForm ++ . Check out www.data-shapes.net for more infos.
string_3 = StringInput("Tipo de Suporte")
categories_3 = Categories("OST_ConduitFitting")
all_families_of_category = Custom[All Families Of Category](category=categories_3)  # package Clockwork for Dynamo 2.x; Gets all famiies of a given category in the model (does *not *work for system families)
categories_4 = Categories("OST_CableTrayFitting")
all_families_of_category_2 = Custom[All Families Of Category](category=categories_4)
list_create_2 = List.Create(item0=all_families_of_category, item1=all_families_of_category_2)
code_block_3 = CodeBlock { "Suporte"; }
code_block_4 = CodeBlock { "x"; }
boolean = BoolSelector(true)
code_block_5 = CodeBlock { "Mao Francesa"; }
code_block_6 = CodeBlock { 0; }
string_4 = StringInput("Distancia inicial primeiro Suporte (m)")
string_5 = StringInput("0.5")
boolean_2 = BoolSelector(true)
textbox_data = Custom[TextBox Data](InputName=string_4, DefaultText=string_5, IsNumberEntry=boolean_2)  # package Data-Shapes; Create Data for TextBox input in UI.MultipleInputForm ++ . Check out www.data-shapes.net for more informations
string_6 = StringInput("Espaçamento entre Suportes (m)")
string_7 = StringInput("0.5")
boolean_3 = BoolSelector(true)
textbox_data_2 = Custom[TextBox Data](InputName=string_6, DefaultText=string_7, IsNumberEntry=boolean_3)
boolean_4 = BoolSelector(true)
string_8 = StringInput("Cancelar")
number = DoubleInput(600)
number_2 = DoubleInput(212)
code_block_7 = CodeBlock()  # //Data-Shapes
code_block_8 = CodeBlock()  # //archilab

boolean_5 = BoolSelector(false)
clean = List.Clean(list=list_create_2, preserveIndices=boolean_5)
flatten_2 = List.Flatten(list=clean)

# group (continued): ENTRADAS PARA O USUÁRIO
name_2 = Family.Name(family=flatten_2)
contains = String.Contains(str=name_2, searchFor=code_block_3)
filterByBoolMask = List.FilterByBoolMask(list=flatten_2, mask=contains)
types = Family.Types(family=filterByBoolMask.in)
flatten_3 = List.Flatten(list=types)
name_3 = FamilyType.Name(familyType=flatten_3)
contains_2 = String.Contains(str=name_3, searchFor=code_block_4, ignoreCase=boolean)
filterByBoolMask_2 = List.FilterByBoolMask(list=flatten_3, mask=contains_2)
flatten_4 = List.Flatten(list=filterByBoolMask_2.out)
name_4 = FamilyType.Name(familyType=flatten_4)
name_5 = Family.Name(family=filterByBoolMask.in)
contains_3 = String.Contains(str=name_5, searchFor=code_block_5)
filterByBoolMask_3 = List.FilterByBoolMask(list=filterByBoolMask.in, mask=contains_3)
name_6 = Family.Name(family=filterByBoolMask_3.in)
types_2 = Family.Types(family=filterByBoolMask_3.in)
name_7 = Element.Name(element=types_2)
add = name_6 + name_7
flatten_5 = List.Flatten(list=add)
list_create_3 = List.Create(item0=name_4, item1=flatten_5)
flatten_6 = List.Flatten(list=types_2)
list_create_4 = List.Create(item0=flatten_4, item1=flatten_6)
name_8 = Family.Name(family=filterByBoolMask.in)

flatten_7 = List.Flatten(list=list_create_3)
clean_2 = List.Clean(list=flatten_7)
flatten_8 = List.Flatten(list=list_create_4)
clean_3 = List.Clean(list=flatten_8)

# group (continued): ENTRADAS PARA O USUÁRIO
dropdown_data_2 = Custom[DropDown Data](InputName=string_3, Keys=clean_2, Values=clean_3, DefaultValueIndex=code_block_6)
list_create_5 = List.Create(item0=dropdown_data, item1=dropdown_data_2, item2=textbox_data, item3=textbox_data_2)
multipleinputform = Custom[MultipleInputForm ++](Description_optional=code_block, Logo_optional=readFromFile, ButtonText_optional=string, Inputs=list_create_5, Toggle=boolean_4, CancelButtonText_optional=string_8, Width_optional=number, LabelWidth_optional=number_2)  # package Data-Shapes; Create a form with multiple inputs. see www.data-shapes.net for tutorials and infos!

# group: Separar Entradas
code_block_9 = CodeBlock { 1; }
getItemAtIndex = List.GetItemAtIndex(list=multipleinputform.User_Inputs, index=code_block_9)
code_block_10 = CodeBlock { 0; }
getItemAtIndex_2 = List.GetItemAtIndex(list=multipleinputform.User_Inputs, index=code_block_10)
code_block_11 = CodeBlock { 2; }
getItemAtIndex_3 = List.GetItemAtIndex(list=multipleinputform.User_Inputs, index=code_block_11)
code_block_12 = CodeBlock { 3; }
getItemAtIndex_4 = List.GetItemAtIndex(list=multipleinputform.User_Inputs, index=code_block_12)

# group: Family Type
family = FamilyType.Family(familyType=getItemAtIndex)
types_3 = Family.Types(family=family)
name_9 = FamilyType.Name(familyType=getItemAtIndex)
name_10 = FamilyType.Name(familyType=types_3)
eq = name_9 == name_10
filterByBoolMask_4 = List.FilterByBoolMask(list=types_3, mask=eq)

# group: Selecionando Eletrodutos ou Eletrocalhas
selecione_a_categoria_de = Categories("OST_CableTray")  # "Selecione a Categoria de Conduites ou Bandeja de Cabos"
all_elements_of_category_3 = ElementsOfCategory(Category=selecione_a_categoria_de)
selecione_a_categoria_de_2 = Categories("OST_Conduit")  # "Selecione a Categoria de Conduites ou Bandeja de Cabos"
all_elements_of_category_4 = ElementsOfCategory(Category=selecione_a_categoria_de_2)
list_create_6 = List.Create(item0=all_elements_of_category_3, item1=all_elements_of_category_4)
name_11 = Element.Name(element=list_create_6)
contains_4 = String.Contains(str=name_11, searchFor=getItemAtIndex_2)
filterByBoolMask_5 = List.FilterByBoolMask(list=list_create_6, mask=contains_4)

flatten_9 = List.Flatten(list=filterByBoolMask_5.in)

# group: Filtrar os caminhos de cabos em função do comprimento mínimo
getLocation = Element.GetLocation(element=flatten_9)
length = Curve.Length(curve=getLocation)
gt = length > getItemAtIndex_3
filterByBoolMask_6 = List.FilterByBoolMask(list=length, mask=gt)

filterByBoolMask_7 = List.FilterByBoolMask(list=getLocation, mask=gt)

# group: Definindo o espaçamento
code_block_13 = CodeBlock(y=filterByBoolMask_6.in) { casas_decimais = 2; list = DSCore.Math.Ceiling(y*casas_decimais)/casas_decimais; }

code_block_14 = CodeBlock { 1; }
code_block_15 = CodeBlock(vals=code_block_13.list, replace=code_block_14) { c = DSCore.List.Count(vals); DSCore.List.OfRepeatedItem(replace,c); }
code_block_16 = CodeBlock(val=code_block_13.list, replace=code_block_15.out1) { val==0?replace:val; }

# group (continued): Definindo o espaçamento
code_block_17 = CodeBlock(full_len=code_block_16, inset=getItemAtIndex_3, max_spacing=getItemAtIndex_4) { len = full_len - inset; count = len/max_spacing; req_count = DSCore.Math.Ceiling(count); spacing = len/req_count; }
code_block_18 = CodeBlock(inset=getItemAtIndex_3, count=code_block_17.count, spacing=code_block_17.spacing) { inset..count*spacing..#count; }

code_block_19 = CodeBlock { 0.2; }
python_script = Python(IN[0]=code_block_18, IN[1]=code_block_19)
# ---------- python_script.python (15 lines) ----------
# Carregar as bibliotecas DesignScript e padrão do Python
import sys
import clr
clr.AddReference('ProtoGeometry')
from Autodesk.DesignScript.Geometry import *

# Entradas
valores = IN[0]  # Lista de valores (alguns podem ser null)
replace = IN[1]  # Valor para substituir os valores null

# Função para substituir valores null
valores_substituidos = [replace if val is None else val for val in valores]

# Saída
OUT = valores_substituidos
# ----------------------------------------

# group: Obtendo os pontos de posicionamento
pointAtSegmentLength = Curve.PointAtSegmentLength(curve=filterByBoolMask_7.in, segmentLength=python_script)
parameterAtPoint = Curve.ParameterAtPoint(curve=getLocation, point=pointAtSegmentLength)
normalAtParameter = Curve.NormalAtParameter(curve=getLocation, param=parameterAtPoint)

# group: Creando as famílias de suportes
byPoint = FamilyInstance.ByPoint(familyType=filterByBoolMask_4.in, point=pointAtSegmentLength, lacing=Longest)

# group: Obtendo os parâmetros
code_block_20 = CodeBlock { "Diâmetro (tamanho comercial)"; "Largura"; "Altura"; }
getParameterValueByName = Element.GetParameterValueByName(element=flatten_9, parameterName=code_block_20.out0)
convert_between_units = DynamoConvert(getParameterValueByName, MeasurementType="Length", FromConversion="Millimeters", ToConversion="Meters")
getParameterValueByName_2 = Element.GetParameterValueByName(element=flatten_9, parameterName=code_block_20.out1)
convert_between_units_2 = DynamoConvert(getParameterValueByName_2, MeasurementType="Length", FromConversion="Millimeters", ToConversion="Meters")
getParameterValueByName_3 = Element.GetParameterValueByName(element=flatten_9, parameterName=code_block_20.out2)
convert_between_units_3 = DynamoConvert(getParameterValueByName_3, MeasurementType="Length", FromConversion="Millimeters", ToConversion="Meters")

# group: Parâmetro da família DN
code_block_21 = CodeBlock { "DN"; }
setParameterByName = Element.SetParameterByName(element=byPoint, parameterName=code_block_21, value=convert_between_units)

# group: Parâmetro da família Largura
code_block_22 = CodeBlock { "Largura"; }
setParameterByName_2 = Element.SetParameterByName(element=byPoint, parameterName=code_block_22, value=convert_between_units_2)

# group: Parâmetro da família Altura
code_block_23 = CodeBlock { "Altura"; }
setParameterByName_3 = Element.SetParameterByName(element=byPoint, parameterName=code_block_23, value=convert_between_units_3)

# group: Intersecção com a laje
location = FamilyInstance.Location(familyInstance=byPoint)
X = Point.X(point=location)
Y = Point.Y(point=location)
Z = Point.Z(point=location)
code_block_24 = CodeBlock { 3; }
add_2 = Z + code_block_24
byCoordinates = Point.ByCoordinates(x=X, y=Y, z=add_2)
code_block_25 = CodeBlock { 0.05; }
byPointsRadius = Cone.ByPointsRadius(startPoint=location, endPoint=byCoordinates, startRadius=code_block_25)
categories_5 = Categories("OST_Floors")
all_elements_of_category_5 = ElementsOfCategory(Category=categories_5)
intersectsSolid = Revit.Element.IntersectsSolid(solids=byPointsRadius, elements=all_elements_of_category_5)
intersectingElements = Results.SolidIntersectionResult.IntersectingElements(solidIntersectionResult=intersectsSolid)
code_block_26 = CodeBlock { "Elevação na parte inferior"; }
getParameterValueByName_4 = Element.GetParameterValueByName(element=intersectingElements, parameterName=code_block_26)
abs = Math.Abs(number=getParameterValueByName_4)
code_block_27 = CodeBlock { "Elevação do nível"; }
getParameterValueByName_5 = Element.GetParameterValueByName(element=byPoint, parameterName=code_block_27)
abs_2 = Math.Abs(number=getParameterValueByName_5)
sub = abs - abs_2

# group: Parâmetro da família Distância até o Teto
code_block_28 = CodeBlock { "Distância até o Teto"; }
abs_3 = Math.Abs(number=sub)
setParameterByName_4 = Element.SetParameterByName(element=byPoint, parameterName=code_block_28, value=abs_3)

# group: Ângulo de orientação
X_2 = Vector.X(vector=normalAtParameter)
code_block_29 = CodeBlock { 0.707; 0.001; }
eq_2 = Equals(x=X_2, y=code_block_29.out0, tolerance=code_block_29.out1)
reverse = Vector.Reverse(vector=normalAtParameter)
if_ = If(test=eq_2, true=normalAtParameter, false=reverse)
code_block_30 = CodeBlock(Vector1=if_) { Vector.YAxis(); Vector1; Vector.XAxis(); }
angleAboutAxis = Vector.AngleAboutAxis(vector=code_block_30.Vector1, otherVector=code_block_30.out0, rotationAxis=code_block_30.out2)
round = Math.Round(number=angleAboutAxis)

# group: Parâmetro da família - Ângulo
setRotation = FamilyInstance.SetRotation(familyInstance=byPoint, degree=round)

# group: Mensagem Final
flatten_10 = List.Flatten(list=setRotation)
count = List.Count(list=flatten_10)
code_block_31 = CodeBlock { 0; }
gt_2 = count > code_block_31
code_block_32 = CodeBlock(N=count) { ["Feito! você inseriu "+N+" Suportes"]; }
code_block_33 = CodeBlock { ["Nenhum Suporte foi inserido"]; }
if_2 = If(test=gt_2, true=code_block_32, false=code_block_33)
flatten_11 = List.Flatten(list=if_2)
fromList = Python(IN[0]=flatten_11)  # "String.FromList"
# ---------- fromList.python (22 lines) ----------
# Carregar as bibliotecas DesignScript e padrão do Python
import sys
import clr
clr.AddReference('ProtoGeometry')
from Autodesk.DesignScript.Geometry import *

# Função para concatenar os valores de uma lista em uma única string com múltiplas linhas
def concatenate_list_to_string(input_list, delimiter="\n"):
    # Verifica se a entrada é uma lista
    if not isinstance(input_list, list):
        return "A entrada deve ser uma lista."
    
    # Converte todos os elementos para string e junta com o delimitador especificado
    result = delimiter.join(str(item) for item in input_list)
    return result

# Entrada pelo nó do Dynamo
lista = IN[0]  # Lista de valores a serem concatenados
delimitador = IN[1] if len(IN) > 1 else "\n"  # Delimitador opcional, padrão é nova linha

# Saída para o Dynamo
OUT = concatenate_list_to_string(lista, delimitador)
# ----------------------------------------
python_script_2 = Python(IN[0]=fromList)
# ---------- python_script_2.python (21 lines) ----------
# Importar as bibliotecas necessárias do Revit
import clr
clr.AddReference("RevitServices")
from RevitServices.Persistence import DocumentManager

clr.AddReference("RevitAPI")
clr.AddReference("RevitAPIUI")
from Autodesk.Revit.UI import TaskDialog

# Pegar a entrada do Dynamo
mensagem = IN[0]

# Criar a TaskDialog
task_dialog = TaskDialog("Ok")
task_dialog.MainInstruction = mensagem

# Exibir a TaskDialog
task_dialog.Show()

# Saída do script
OUT = "Sucesso!"
# ----------------------------------------

# group: Intersecção com a parede
location_2 = FamilyInstance.Location(familyInstance=byPoint)
code_block_34 = CodeBlock { 0.1; 2; 0.1; }
byLengths = Cuboid.ByLengths(origin=location_2, width=code_block_34.out0, length=code_block_34.out1, height=code_block_34.out2)
categories_6 = Categories("OST_Walls")
all_elements_of_category_6 = ElementsOfCategory(Category=categories_6)
intersectsSolid_2 = Revit.Element.IntersectsSolid(solids=byLengths, elements=all_elements_of_category_6)
intersectingElements_2 = Results.SolidIntersectionResult.IntersectingElements(solidIntersectionResult=intersectsSolid_2)
solids = Element.Solids(element=intersectingElements_2)
distanceTo = Geometry.DistanceTo(geometry=solids, other=location_2)
abs_4 = Math.Abs(number=distanceTo)

# group: Parâmetro da família Distância até a parede
code_block_35 = CodeBlock { "Dist. Parede"; }
setParameterByName_5 = Element.SetParameterByName(element=byPoint, parameterName=code_block_35, value=abs_4)

watch = Watch(python_script)
