# Dynamo graph ok 08-2_BIMACON_Deletar Suportes por Seleção_R05_script.dyn "ok 2021_08-2_BIMACON_Deletar Suportes por Seleção_R05_script" (Dynamo 2.19.3.6394)
# author: Jose Nelson
# Deleta Suportes por seleção, onde pode-se fazer uma seleção Windown e somente suportes serão selecionados
# packages: archi-lab.net 2023.213.1722, Data-Shapes 2025.3.118

# group: Selecionar
categories = Categories("OST_ConduitFitting")
categories_2 = Categories("OST_CableTrayFitting")
list_create = List.Create(item0=categories, item1=categories_2)
flatten = List.Flatten(list=list_create)
boolean = BoolSelector(true)
code_block = CodeBlock { ["Selecione os suportes e clique em concluir"]; }
code_block_2 = CodeBlock { ["Pressione ESC para finalizar"]; }
if_ = If(test=boolean, true=code_block, false=code_block_2)
fromList = Python(IN[0]=if_)  # "String.FromList"; IronPython2
# ---------- fromList.python (22 lines) ----------
# Carregar as bibliotecas DesignScript e padrão do Python
import sys
import clr
clr.AddReference('ProtoGeometry')
from Autodesk.DesignScript.Geometry import *

# Função para concatenar os valores de uma lista em uma única string com múltiplas linhas
def concatenate_list_to_string(input_list, delimiter="\n"):
    # Verifica se a entrada é uma lista
    if not isinstance(input_list, list):
        return "A entrada deve ser uma lista."
    
    # Converte todos os elementos para string e junta com o delimitador especificado
    result = delimiter.join(str(item) for item in input_list)
    return result

# Entrada pelo nó do Dynamo
lista = IN[0]  # Lista de valores a serem concatenados
delimitador = IN[1] if len(IN) > 1 else "\n"  # Delimitador opcional, padrão é nova linha

# Saída para o Dynamo
OUT = concatenate_list_to_string(lista, delimitador)
# ----------------------------------------
window_prompt_with_text = Python(IN[0]=fromList)  # IronPython2
# ---------- window_prompt_with_text.python (32 lines) ----------
# Importando as bibliotecas necessárias da API do Revit
import clr
clr.AddReference('RevitServices')  # Referência aos serviços do Revit
from RevitServices.Persistence import DocumentManager

clr.AddReference('RevitAPI')  # Referência à API do Revit
clr.AddReference('RevitAPIUI')  # Referência à API de Interface de Usuário do Revit

from Autodesk.Revit.UI import TaskDialog, TaskDialogCommonButtons, TaskDialogResult

# Recebe o texto de instrução como entrada do nó
instrucoes = IN[0]

# Verifica se a entrada é "Cancelar"
if instrucoes.lower() == "Pressione ESC para finalizar":
    OUT = False
else:
    # Criando o TaskDialog
    dialog = TaskDialog("Aviso")
    dialog.MainInstruction = instrucoes
    dialog.CommonButtons = TaskDialogCommonButtons.Ok | TaskDialogCommonButtons.Cancel

    # Exibindo o dialog para o usuário e capturando a resposta
    resultado = dialog.Show()

    # Interpretando a resposta
    if resultado == TaskDialogResult.Ok:
        OUT = True
    elif resultado == TaskDialogResult.Cancel:
        OUT = False
    else:
        OUT = None
# ----------------------------------------
select_model_elements_of = Custom[Select Model Elements of Category](Categories=flatten, Toggle=window_prompt_with_text)  # package Data-Shapes; Allows to perform a manual selection with a category filter.
boolean_2 = BoolSelector(false)

getFamily = FamilyInstance.GetFamily(familyInstance=select_model_elements_of)

# group: Selecionar Suportes
name = Element.Name(element=getFamily)
string = StringInput("Suporte")
boolean_3 = BoolSelector(true)
contains = String.Contains(string=name, searchFor=string, ignoreCase=boolean_3)
filterByBoolMask = List.FilterByBoolMask(list=select_model_elements_of, mask=contains)
watch = Watch(filterByBoolMask.in)

# group: Deletar Suportes
# note: Archilab
code_block_3 = CodeBlock(waithFor=filterByBoolMask.in, Pass=watch) { [waithFor,Pass][1]; }
delete = archilab.Revit.Elements.Elements.Delete(element=code_block_3)

# group: Mensagem
countTrue = List.CountTrue(list=delete)
code_block_4 = CodeBlock { 0; }
gt = countTrue > code_block_4
code_block_5 = CodeBlock(N=countTrue) { ["Feito! você deletou "+N+" Suportes"]; }
code_block_6 = CodeBlock { ["Nenhuma Suporte foi deletado"]; }
if_2 = If(test=gt, true=code_block_5, false=code_block_6)
flatten_2 = List.Flatten(list=if_2)
fromList_2 = Python(IN[0]=flatten_2)  # "String.FromList"; IronPython2; same code as fromList
python_script = Python(IN[0]=fromList_2)  # IronPython2
# ---------- python_script.python (21 lines) ----------
# Importar as bibliotecas necessárias do Revit
import clr
clr.AddReference("RevitServices")
from RevitServices.Persistence import DocumentManager

clr.AddReference("RevitAPI")
clr.AddReference("RevitAPIUI")
from Autodesk.Revit.UI import TaskDialog

# Pegar a entrada do Dynamo
mensagem = IN[0]

# Criar a TaskDialog
task_dialog = TaskDialog("Ok")
task_dialog.MainInstruction = mensagem

# Exibir a TaskDialog
task_dialog.Show()

# Saída do script
OUT = "Sucesso!"
# ----------------------------------------
