# Dynamo graph ok 2021_08-2_BIMACON_Deletar Suportes por Seleção_R03_script.dyn (Dynamo 2.6.1.8786)
# packages: archi-lab.net 2023.213.1722, Data-Shapes 2022.2.105

# group: ENTRADAS PARA O USUÁRIO
code_block = CodeBlock { "Excluir todos Suportes em Eletrodutos ou eletrocalhas"; }
file_path = Filename("..\..\..\..\..\05 - BIMACON\01 - EMPRESA BIMACON\00 - Logos e imagens - BIMACON\ARTE BIMACON\reddonda-removebg-preview.png")
file_from_path = FileObject(path=file_path)
readFromFile = Image.ReadFromFile(file=file_from_path)
string = StringInput("Confirmar")
string_2 = StringInput("Selecione a categoria Conexão de Conduíte ou Conexão de bandeja de Cabos")
categories = Categories("OST_ConduitFitting")
categories_2 = Categories("OST_CableTrayFitting")
list_create = List.Create(item0=categories, item1=categories_2)
boolean = BoolSelector(true)
string_3 = StringInput("Cancelar")
number = DoubleInput(420)
number_2 = DoubleInput(220)
code_block_2 = CodeBlock()  # //Data-Shapes
code_block_3 = CodeBlock()  # //archilab

string_4 = StringInput("Selecione")
flatten = List.Flatten(list=list_create)
selectmodelelements_data = Custom[SelectModelElements Data](InputName=string_2, ButtonText=string_4, CategoryFilter=flatten)  # package Data-Shapes; Creates a Revit element selection input for UI.MultipleInputForm++ . Check out www.data-shapes.net for more infos!

# group (continued): ENTRADAS PARA O USUÁRIO
list_create_2 = List.Create(item0=selectmodelelements_data)
multipleinputform = Custom[MultipleInputForm ++](Description_optional=code_block, Logo_optional=readFromFile, ButtonText_optional=string, Inputs=list_create_2, Toggle=boolean, CancelButtonText_optional=string_3, Width_optional=number, LabelWidth_optional=number_2)  # package Data-Shapes; Create a form with multiple inputs. see www.data-shapes.net for tutorials and infos!

# group: Separar Entradas
code_block_4 = CodeBlock { 0; }
getItemAtIndex = List.GetItemAtIndex(list=multipleinputform.User_Inputs, index=code_block_4)

getFamily = FamilyInstance.GetFamily(familyInstance=getItemAtIndex)

# group: Selecionar Suportes
name = Element.Name(element=getFamily)
string_5 = StringInput("Suporte")
boolean_2 = BoolSelector(true)
contains = String.Contains(str=name, searchFor=string_5, ignoreCase=boolean_2)
filterByBoolMask = List.FilterByBoolMask(list=getItemAtIndex, mask=contains)
watch = Watch(filterByBoolMask.in)

# group: Deletar Suportes
# note: Archilab
code_block_5 = CodeBlock(waithFor=filterByBoolMask.in, Pass=watch) { [waithFor,Pass][1]; }
delete = archilab.Revit.Elements.Elements.Delete(element=code_block_5)

# group: Mensagem
countTrue = List.CountTrue(list=delete)
code_block_6 = CodeBlock { 0; }
gt = countTrue > code_block_6
code_block_7 = CodeBlock(N=countTrue) { ["Feito! você deletou "+N+" Suportes"]; }
code_block_8 = CodeBlock { ["Nenhuma Suporte foi deletado"]; }
if_ = If(test=gt, true=code_block_7, false=code_block_8)
flatten_2 = List.Flatten(list=if_)
fromList = Python(IN[0]=flatten_2)  # "String.FromList"
# ---------- fromList.python (22 lines) ----------
# Carregar as bibliotecas DesignScript e padrão do Python
import sys
import clr
clr.AddReference('ProtoGeometry')
from Autodesk.DesignScript.Geometry import *

# Função para concatenar os valores de uma lista em uma única string com múltiplas linhas
def concatenate_list_to_string(input_list, delimiter="\n"):
    # Verifica se a entrada é uma lista
    if not isinstance(input_list, list):
        return "A entrada deve ser uma lista."
    
    # Converte todos os elementos para string e junta com o delimitador especificado
    result = delimiter.join(str(item) for item in input_list)
    return result

# Entrada pelo nó do Dynamo
lista = IN[0]  # Lista de valores a serem concatenados
delimitador = IN[1] if len(IN) > 1 else "\n"  # Delimitador opcional, padrão é nova linha

# Saída para o Dynamo
OUT = concatenate_list_to_string(lista, delimitador)
# ----------------------------------------
python_script = Python(IN[0]=fromList)
# ---------- python_script.python (21 lines) ----------
# Importar as bibliotecas necessárias do Revit
import clr
clr.AddReference("RevitServices")
from RevitServices.Persistence import DocumentManager

clr.AddReference("RevitAPI")
clr.AddReference("RevitAPIUI")
from Autodesk.Revit.UI import TaskDialog

# Pegar a entrada do Dynamo
mensagem = IN[0]

# Criar a TaskDialog
task_dialog = TaskDialog("Ok")
task_dialog.MainInstruction = mensagem

# Exibir a TaskDialog
task_dialog.Show()

# Saída do script
OUT = "Sucesso!"
# ----------------------------------------
