# Dynamo graph 08-1_BIMACON_Inserir Suportes por Seleção_R07_script.dyn (Dynamo 3.6.1.9895)
# author: Jose Nelson
# Inserção de Suportes por seleção em Eletrodutos e Bandeja de Cabos
# packages: bimorphNodes 4.2.4, Data-Shapes 2022.2.105, DynamoIronPython2.7 3.2.1, archi-lab.net 2023.213.1722, Rhythm 2023.4.2021, DynaMEP 2.0.1, BIMCoder Nodes - 2.X 2025.1.0, Genius Loci 2023.2.21

# group: Projeto
# note: Utilize esta cor para as funções desenhadas no programa (núcleo do gráfico)

# group: Entradas
# note: Use esta cor para os nós e blocos de código que representam as entradas

# group: Python
# note: Use esta cor para os nós Python

# group: Nome do Projeto: "Colocar suportes para caminhos de cabos"
# note: Este gráfico coloca o suporte das eletrocalhas dividido em distâncias iguais. Divirta-se!!!! :D :D :D

# group: Saída
# note: Use esta cor para os nós que representam a saída do gráfico

# group: PROBLEMAS PARA RESOLVER
# note: TENTANDO DESCOBRIR COMO RODAR TODAS AS FAMÍLIAS NA DIREÇÃO CORRETA.
# SUBPONTO: NÓ RAYBUNCE NÃO FUNCIONA COM encontrar o ponto mais próximo.??????

# group: ENTRADAS PARA O USUÁRIO
code_block = CodeBlock { "Inserção de Suportes em Eletrodutos ou Bandejas de Cabos por Seleção"; }
string = StringInput("LogoBimacon.png")
python_script = Python(IN[0]=string)  # IronPython2
# ---------- python_script.python (22 lines) ----------
import clr

# Adiciona referência ao ambiente .NET
clr.AddReference('System')
from System import Environment, IO

# Nome da imagem (entrada do usuário)
nome_arquivo_imagem = IN[0]

# Recupera o nome do usuário logado no Windows
usuario = Environment.UserName

# Monta o caminho completo para a pasta de imagens
caminho_base = r"C:\Users\{0}\AppData\Roaming\pyRevit\Extensions\Bimacon.extension\Bimacon.tab\Imagens_Bimacon".format(usuario)

# Junta o caminho base com o nome do arquivo
caminho_completo = IO.Path.Combine(caminho_base, nome_arquivo_imagem)

# Verifica se o arquivo existe
existe = IO.File.Exists(caminho_completo)

OUT = caminho_completo if existe else "Imagem não encontrada: {0}".format(caminho_completo)
# ----------------------------------------
file_from_path = FileObject(path=python_script)
readFromFile = Image.ReadFromFile(file=file_from_path)
string_2 = StringInput("Confirmar")
string_3 = StringInput("Tipo de Suporte")
categories = Categories("OST_ConduitFitting")
obter_famílias_de_uma_categoria = Python(IN[0]=categories)  # "Obter Famílias de Uma Categoria - BIMACON"; IronPython2
# ---------- obter_famílias_de_uma_categoria.python (119 lines) ----------
# -*- coding: utf-8 -*-

import clr
import System

# Revit API
clr.AddReference('RevitAPI')
from Autodesk.Revit.DB import *

# Revit Services
clr.AddReference('RevitServices')
from RevitServices.Persistence import DocumentManager

# Revit Nodes
clr.AddReference("RevitNodes")
import Revit
clr.ImportExtensions(Revit.Elements)

# Documento atual
doc = DocumentManager.Instance.CurrentDBDocument


# ==================================================
# FUNÇÃO PARA OBTER BuiltInCategory
# Compatível Revit 2021 até 2026
# ==================================================

def obter_builtincategory(entrada):

    # Caso já seja BuiltInCategory
    if isinstance(entrada, BuiltInCategory):
        return entrada

    # Caso seja inteiro
    if isinstance(entrada, int):
        try:
            return System.Enum.ToObject(BuiltInCategory, entrada)
        except:
            return None

    # Tenta converter Category
    try:

        # Unwrap se necessário
        entrada = UnwrapElement(entrada)

        # Se for Category
        if isinstance(entrada, Category):

            cat_id = entrada.Id

            # Compatível versões antigas e novas
            try:
                valor = cat_id.IntegerValue
            except:
                valor = cat_id.Value

            return System.Enum.ToObject(BuiltInCategory, valor)

    except:
        pass

    return None


# ==================================================
# ENTRADA
# ==================================================

entrada = IN[0]

bic = obter_builtincategory(entrada)

# ==================================================
# COLETA FAMÍLIAS
# ==================================================

familias_filtradas = []

if bic:

    familias = FilteredElementCollector(doc)\
        .OfClass(Family)\
        .ToElements()

    for fam in familias:

        try:

            cat = fam.FamilyCategory

            if cat is None:
                continue

            cat_id = cat.Id

            # Compatibilidade 2021 → 2026
            try:
                valor_categoria = cat_id.IntegerValue
            except:
                valor_categoria = cat_id.Value

            bic_familia = System.Enum.ToObject(
                BuiltInCategory,
                valor_categoria
            )

            if bic_familia == bic:
                familias_filtradas.append(fam)

        except:
            continue


# ==================================================
# SAÍDA
# ==================================================

OUT = familias_filtradas
# ----------------------------------------
categories_2 = Categories("OST_CableTrayFitting")
obter_famílias_de_uma_categoria_2 = Python(IN[0]=categories_2)  # "Obter Famílias de Uma Categoria - BIMACON"; IronPython2; same code as obter_famílias_de_uma_categoria
list_create = List.Create(item0=obter_famílias_de_uma_categoria, item1=obter_famílias_de_uma_categoria_2)
boolean = BoolSelector(false)
clean = List.Clean(list=list_create, preserveIndices=boolean)
flatten = List.Flatten(list=clean)
name = Family.Name(family=flatten)
code_block_2 = CodeBlock { "Suporte"; }
contains = String.Contains(string=name, searchFor=code_block_2)
filterByBoolMask = List.FilterByBoolMask(list=flatten, mask=contains)
types = Family.Types(family=filterByBoolMask.in)
flatten_2 = List.Flatten(list=types)
name_2 = FamilyType.Name(familyType=flatten_2)
code_block_3 = CodeBlock { "x"; }
boolean_2 = BoolSelector(true)
contains_2 = String.Contains(string=name_2, searchFor=code_block_3, ignoreCase=boolean_2)
filterByBoolMask_2 = List.FilterByBoolMask(list=flatten_2, mask=contains_2)
flatten_3 = List.Flatten(list=filterByBoolMask_2.out)
name_3 = FamilyType.Name(familyType=flatten_3)
name_4 = Family.Name(family=filterByBoolMask.in)
code_block_4 = CodeBlock { "Mao Francesa"; }
contains_3 = String.Contains(string=name_4, searchFor=code_block_4)
filterByBoolMask_3 = List.FilterByBoolMask(list=filterByBoolMask.in, mask=contains_3)
name_5 = Family.Name(family=filterByBoolMask_3.in)
types_2 = Family.Types(family=filterByBoolMask_3.in)
name_6 = Element.Name(element=types_2)
add = name_5 + name_6
flatten_4 = List.Flatten(list=add)
list_create_2 = List.Create(item0=name_3, item1=flatten_4)
flatten_5 = List.Flatten(list=list_create_2)
clean_2 = List.Clean(list=flatten_5)
flatten_6 = List.Flatten(list=types_2)
list_create_3 = List.Create(item0=flatten_3, item1=flatten_6)
flatten_7 = List.Flatten(list=list_create_3)
clean_3 = List.Clean(list=flatten_7)
code_block_5 = CodeBlock { 0; }
dropdown_data = Custom[DropDown Data](InputName=string_3, Keys=clean_2, Values=clean_3, DefaultValueIndex=code_block_5)  # package Data-Shapes; Create data for DropDown input in UI.MultiInputForm ++ . Check out www.data-shapes.net for more infos.
string_4 = StringInput("Distancia inicial primeiro Suporte (m)")
string_5 = StringInput("0.2")
boolean_3 = BoolSelector(true)
textbox_data = Custom[TextBox Data](InputName=string_4, DefaultText=string_5, IsNumberEntry=boolean_3)  # package Data-Shapes; Create Data for TextBox input in UI.MultipleInputForm ++ . Check out www.data-shapes.net for more informations
string_6 = StringInput("Espaçamento entre Suportes (m)")
string_7 = StringInput("1")
boolean_4 = BoolSelector(true)
textbox_data_2 = Custom[TextBox Data](InputName=string_6, DefaultText=string_7, IsNumberEntry=boolean_4)
list_create_4 = List.Create(item0=dropdown_data, item1=textbox_data, item2=textbox_data_2)
boolean_5 = BoolSelector(true)
string_8 = StringInput("Cancelar")
number = DoubleInput(780)
number_2 = DoubleInput(230)
multipleinputform = Custom[MultipleInputForm ++](Description_optional=code_block, Logo_optional=readFromFile, ButtonText_optional=string_2, Inputs=list_create_4, Toggle=boolean_5, CancelButtonText_optional=string_8, Width_optional=number, LabelWidth_optional=number_2)  # package Data-Shapes; Create a form with multiple inputs. see www.data-shapes.net for tutorials and infos!
code_block_6 = CodeBlock()  # //Data-Shapes
code_block_7 = CodeBlock()  # //archilab
name_7 = Family.Name(family=filterByBoolMask.in)

# group: Separar Entradas
code_block_8 = CodeBlock { 0; }
getItemAtIndex = List.GetItemAtIndex(list=multipleinputform.User_Inputs, index=code_block_8)
code_block_9 = CodeBlock { 1; }
getItemAtIndex_2 = List.GetItemAtIndex(list=multipleinputform.User_Inputs, index=code_block_9)
code_block_10 = CodeBlock { 2; }
getItemAtIndex_3 = List.GetItemAtIndex(list=multipleinputform.User_Inputs, index=code_block_10)

# group: Family Type
family = FamilyType.Family(familyType=getItemAtIndex)
types_3 = Family.Types(family=family)
name_8 = FamilyType.Name(familyType=getItemAtIndex)
name_9 = FamilyType.Name(familyType=types_3)
eq = name_8 == name_9
filterByBoolMask_4 = List.FilterByBoolMask(list=types_3, mask=eq)

end = Revit.Transaction.Transaction.End(input=multipleinputform.Was_Cancelled)
start = Revit.Transaction.Transaction.Start(input=end)
passThrough = Custom[PassThrough](passThrough=start, waitFor=end)  # package archi-lab.net; Ripped this off from Clockwork. Sorry Andy.

# group: Selecionar
code_block_11 = CodeBlock { ["Pressione ESC para finalizar"]; }
code_block_12 = CodeBlock { ["Selecione os Eletrodutos ou Bandejas de Cabos Depois ESC para finalizar seleção"]; }
if_ = If(test=passThrough, true=code_block_11, false=code_block_12)
fromList = Python(IN[0]=if_)  # "String.FromList"; IronPython2
# ---------- fromList.python (22 lines) ----------
# Carregar as bibliotecas DesignScript e padrão do Python
import sys
import clr
clr.AddReference('ProtoGeometry')
from Autodesk.DesignScript.Geometry import *

# Função para concatenar os valores de uma lista em uma única string com múltiplas linhas
def concatenate_list_to_string(input_list, delimiter="\n"):
    # Verifica se a entrada é uma lista
    if not isinstance(input_list, list):
        return "A entrada deve ser uma lista."
    
    # Converte todos os elementos para string e junta com o delimitador especificado
    result = delimiter.join(str(item) for item in input_list)
    return result

# Entrada pelo nó do Dynamo
lista = IN[0]  # Lista de valores a serem concatenados
delimitador = IN[1] if len(IN) > 1 else "\n"  # Delimitador opcional, padrão é nova linha

# Saída para o Dynamo
OUT = concatenate_list_to_string(lista, delimitador)
# ----------------------------------------
window_prompt_with_text = Python(IN[0]=fromList)  # IronPython2
# ---------- window_prompt_with_text.python (32 lines) ----------
# Importando as bibliotecas necessárias da API do Revit
import clr
clr.AddReference('RevitServices')  # Referência aos serviços do Revit
from RevitServices.Persistence import DocumentManager

clr.AddReference('RevitAPI')  # Referência à API do Revit
clr.AddReference('RevitAPIUI')  # Referência à API de Interface de Usuário do Revit

from Autodesk.Revit.UI import TaskDialog, TaskDialogCommonButtons, TaskDialogResult

# Recebe o texto de instrução como entrada do nó
instrucoes = IN[0]

# Verifica se a entrada é "Cancelar"
if instrucoes.lower() == "Pressione ESC para finalizar":
    OUT = False
else:
    # Criando o TaskDialog
    dialog = TaskDialog("Aviso")
    dialog.MainInstruction = instrucoes
    dialog.CommonButtons = TaskDialogCommonButtons.Ok | TaskDialogCommonButtons.Cancel

    # Exibindo o dialog para o usuário e capturando a resposta
    resultado = dialog.Show()

    # Interpretando a resposta
    if resultado == TaskDialogResult.Ok:
        OUT = True
    elif resultado == TaskDialogResult.Cancel:
        OUT = False
    else:
        OUT = None
# ----------------------------------------
categories_3 = Categories("OST_Conduit")
categories_4 = Categories("OST_CableTray")
list_create_5 = List.Create(item0=categories_3, item1=categories_4)
boolean_6 = BoolSelector(true)
ʳʰʸᵗʰᵐ_selection_pick = Rhythm.Revit.Selection.Selection.Pick(runIt=window_prompt_with_text, category=list_create_5, ordered=boolean_6)
boolean_7 = BoolSelector(false)

# group: Filtrar os caminhos de cabos em função do comprimento mínimo
getLocation = Element.GetLocation(element=ʳʰʸᵗʰᵐ_selection_pick)
length = Curve.Length(curve=getLocation)
gt = length > getItemAtIndex_2
filterByBoolMask_5 = List.FilterByBoolMask(list=length, mask=gt)

filterByBoolMask_6 = List.FilterByBoolMask(list=getLocation, mask=gt)

# group: Definindo o espaçamento
code_block_13 = CodeBlock(y=filterByBoolMask_5.in) { casas_decimais = 2; list = DSCore.Math.Ceiling(y*casas_decimais)/casas_decimais; }
code_block_14 = CodeBlock(full_len=code_block_13.list, inset=getItemAtIndex_2, max_spacing=getItemAtIndex_3) { len = full_len - inset; count = len/max_spacing; req_count = DSCore.Math.Ceiling(count); spacing = len/req_count; }
code_block_15 = CodeBlock(inset=getItemAtIndex_2, count=code_block_14.count, spacing=code_block_14.spacing) { inset..count*spacing..#count; }

code_block_16 = CodeBlock { 0.2; }
python_script_2 = Python(IN[0]=code_block_15, IN[1]=code_block_16)  # IronPython2
# ---------- python_script_2.python (15 lines) ----------
# Carregar as bibliotecas DesignScript e padrão do Python
import sys
import clr
clr.AddReference('ProtoGeometry')
from Autodesk.DesignScript.Geometry import *

# Entradas
valores = IN[0]  # Lista de valores (alguns podem ser null)
replace = IN[1]  # Valor para substituir os valores null

# Função para substituir valores null
valores_substituidos = [replace if val is None else val for val in valores]

# Saída
OUT = valores_substituidos
# ----------------------------------------

# group: Obtendo os pontos de posicionamento
pointAtSegmentLength = Curve.PointAtSegmentLength(curve=filterByBoolMask_6.in, segmentLength=python_script_2)
parameterAtPoint = Curve.ParameterAtPoint(curve=getLocation, point=pointAtSegmentLength)
normalAtParameter = Curve.NormalAtParameter(curve=getLocation, param=parameterAtPoint)

# group: Criando as famílias de suportes
byPoint = FamilyInstance.ByPoint(familyType=filterByBoolMask_4.in, point=pointAtSegmentLength, lacing=Longest)

# group: Obtendo os parâmetros
code_block_17 = CodeBlock { "Diâmetro (tamanho comercial)"; "Largura"; "Altura"; }
getParameterValueByName = Element.GetParameterValueByName(element=ʳʰʸᵗʰᵐ_selection_pick, parameterName=code_block_17.out0)
convert_between_units = DynamoConvert(getParameterValueByName, MeasurementType="Length", FromConversion="Millimeters", ToConversion="Meters")
getParameterValueByName_2 = Element.GetParameterValueByName(element=ʳʰʸᵗʰᵐ_selection_pick, parameterName=code_block_17.out1)
convert_between_units_2 = DynamoConvert(getParameterValueByName_2, MeasurementType="Length", FromConversion="Millimeters", ToConversion="Meters")
getParameterValueByName_3 = Element.GetParameterValueByName(element=ʳʰʸᵗʰᵐ_selection_pick, parameterName=code_block_17.out2)
convert_between_units_3 = DynamoConvert(getParameterValueByName_3, MeasurementType="Length", FromConversion="Millimeters", ToConversion="Meters")

# group: Parâmetro da família DN
code_block_18 = CodeBlock { "DN"; }
setParameterByName = Element.SetParameterByName(element=byPoint, parameterName=code_block_18, value=convert_between_units)

# group: Parâmetro da família Largura
code_block_19 = CodeBlock { "Largura"; }
setParameterByName_2 = Element.SetParameterByName(element=byPoint, parameterName=code_block_19, value=convert_between_units_2)

# group: Parâmetro da família Altura
code_block_20 = CodeBlock { "Altura"; }
setParameterByName_3 = Element.SetParameterByName(element=byPoint, parameterName=code_block_20, value=convert_between_units_3)

# group: Intersecção com a laje
location = FamilyInstance.Location(familyInstance=byPoint)
X = Point.X(point=location)
Y = Point.Y(point=location)
Z = Point.Z(point=location)
code_block_21 = CodeBlock { 3; }
add_2 = Z + code_block_21
byCoordinates = Point.ByCoordinates(x=X, y=Y, z=add_2)
code_block_22 = CodeBlock { 0.05; }
byPointsRadius = Cone.ByPointsRadius(startPoint=location, endPoint=byCoordinates, startRadius=code_block_22)
categories_5 = Categories("OST_Floors")
all_elements_of_category = ElementsOfCategory(Category=categories_5)
intersectsSolid = Revit.Element.IntersectsSolid(solids=byPointsRadius, elements=all_elements_of_category)
intersectingElements = Results.SolidIntersectionResult.IntersectingElements(solidIntersectionResult=intersectsSolid)
firstItem = List.FirstItem(list=intersectingElements@L2)
code_block_23 = CodeBlock { "Elevação na parte inferior"; }
getParameterValueByName_4 = Element.GetParameterValueByName(element=firstItem, parameterName=code_block_23)
abs = Math.Abs(number=getParameterValueByName_4)
code_block_24 = CodeBlock { "Elevação do nível"; }
getParameterValueByName_5 = Element.GetParameterValueByName(element=byPoint, parameterName=code_block_24)
abs_2 = Math.Abs(number=getParameterValueByName_5)
sub = abs - abs_2

# group: Parâmetro da família Distância até o Teto
code_block_25 = CodeBlock { "Distância até o Teto"; }
abs_3 = Math.Abs(number=sub)
setParameterByName_4 = Element.SetParameterByName(element=byPoint, parameterName=code_block_25, value=abs_3)

watch = Watch(python_script_2)

# group: Ângulo de orientação
X_2 = Vector.X(vector=normalAtParameter)
code_block_26 = CodeBlock { 0.0; 0.001; }
ge = X_2 >= code_block_26.out0
reverse = Vector.Reverse(vector=normalAtParameter)
condição_if_de_lista = CodeBlock(test=ge, verd=normalAtParameter, fals=reverse)
# ---------- condição_if_de_lista.designscript (2 lines) ----------
//Condições IF
test == true ? verd : fals;
# ----------------------------------------
code_block_27 = CodeBlock(Vector1=condição_if_de_lista) { Vector.YAxis(); Vector1; Vector.XAxis(); }
angleAboutAxis = Vector.AngleAboutAxis(vector=code_block_27.Vector1, otherVector=code_block_27.out0, rotationAxis=code_block_27.out2)
round = Math.Round(number=angleAboutAxis)
eq_2 = Equals(x=X_2, y=code_block_26.out0, tolerance=code_block_26.out1)

# group: Parâmetro da família - Ângulo
setRotation = FamilyInstance.SetRotation(familyInstance=byPoint, degree=round)

# group: Intersecção com a parede
boundingBox = Element.BoundingBox(element=setRotation)
center = RevitModel.BoundingBox.Center(boundingBox=boundingBox)
minPoint = BoundingBox.MinPoint(boundingBox=boundingBox)
code_block_28 = CodeBlock { 1.5; -1.5; }
translate = Geometry.Translate(geometry=minPoint, direction=condição_if_de_lista, distance=code_block_28.out1)
X_3 = Point.X(point=translate)
Y_2 = Point.Y(point=translate)
Z_2 = Point.Z(point=minPoint)
byCoordinates_2 = Point.ByCoordinates(x=X_3, y=Y_2, z=Z_2)
maxPoint = BoundingBox.MaxPoint(boundingBox=boundingBox)
translate_2 = Geometry.Translate(geometry=maxPoint, direction=condição_if_de_lista, distance=code_block_28.out0)
X_4 = Point.X(point=translate_2)
Y_3 = Point.Y(point=translate_2)
Z_3 = Point.Z(point=maxPoint)
byCoordinates_3 = Point.ByCoordinates(x=X_4, y=Y_3, z=Z_3)
byCorners = Cuboid.ByCorners(lowPoint=byCoordinates_2, highPoint=byCoordinates_3)
categories_6 = Categories("OST_Walls")
all_elements_of_category_2 = ElementsOfCategory(Category=categories_6)
intersectsSolid_2 = Revit.Element.IntersectsSolid(solids=byCorners, elements=all_elements_of_category_2)
intersectingElements_2 = Results.SolidIntersectionResult.IntersectingElements(solidIntersectionResult=intersectsSolid_2)
solids = Element.Solids(element=intersectingElements_2)
location_2 = FamilyInstance.Location(familyInstance=setRotation)
distanceTo = Geometry.DistanceTo(geometry=solids, other=location_2)
abs_4 = Math.Abs(number=distanceTo)

flatten_8 = List.Flatten(list=setRotation)

# group: Parâmetro da família Distância até a parede
code_block_29 = CodeBlock { "Dist. Parede"; }
setParameterByName_5 = Element.SetParameterByName(element=byPoint, parameterName=code_block_29, value=abs_4)

end_2 = Revit.Transaction.Transaction.End(input=setParameterByName_5)
passThrough_2 = Custom[PassThrough](passThrough=setRotation, waitFor=end_2)
start_2 = Revit.Transaction.Transaction.Start(input=passThrough_2)

# group: Distância da parede
familyinstance_references = Custom[👓 FamilyInstance․References](familyInstance=start_2, lacing=Longest)  # package BIMCoder Nodes - 2.X; Obtém todas as referências de uma família de instância
string_9 = StringInput("Parede")
contains_4 = String.Contains(string=familyinstance_references.ReferenceName, searchFor=string_9)
filterByBoolMask_7 = List.FilterByBoolMask(list=familyinstance_references.Plane, mask=contains_4)
origin = Plane.Origin(plane=filterByBoolMask_7.in)
flatten_9 = List.Flatten(list=origin@L3)
distanceTo_2 = Geometry.DistanceTo(geometry=solids, other=flatten_9, lacing=Longest)
flatten_10 = List.Flatten(list=distanceTo_2@L4)
minimumItem = List.MinimumItem(list=flatten_10)
number_3 = DoubleInput(0)
gt_2 = minimumItem > number_3
filterByBoolMask_8 = List.FilterByBoolMask(list=setRotation, mask=gt_2)
flatten_11 = List.Flatten(list=filterByBoolMask_8.in@L2)
filterByBoolMask_9 = List.FilterByBoolMask(list=X_2, mask=gt_2)
number_4 = DoubleInput(0.707)
eq_3 = Equals(x=filterByBoolMask_9.in, y=number_4, tolerance=code_block_26.out1)
number_5 = DoubleInput(-0.707)
eq_4 = Equals(x=filterByBoolMask_9.in, y=number_5, tolerance=code_block_26.out1)

element_getrotation = Custom[Element GetRotation](element=flatten_11@L2)  # package Genius Loci; Calculates the rotation angle between the given element and the X axis. Works for point/ line/ sketch based elements and link instances.
passThrough_3 = Custom[PassThrough](passThrough=condição_if_de_lista, waitFor=setParameterByName_5)
reverse_2 = Vector.Reverse(vector=passThrough_3)
code_block_30 = CodeBlock(Vector1=reverse_2) { Vector.XAxis(); Vector1; Vector.YAxis(); }
angleAboutAxis_2 = Vector.AngleAboutAxis(vector=code_block_30.Vector1, otherVector=code_block_30.out0, rotationAxis=code_block_30.out2)
round_2 = Math.Round(number=angleAboutAxis_2)
filterByBoolMask_10 = List.FilterByBoolMask(list=round_2, mask=gt_2)

# group: Rotacionar
filterByBoolMask_11 = List.FilterByBoolMask(list=eq_2, mask=gt_2)
passThrough_4 = Custom[PassThrough](passThrough=element_getrotation, waitFor=setParameterByName_5)
code_block_31 = CodeBlock { 180; }
add_3 = passThrough_4 + code_block_31
code_block_32 = CodeBlock { -90; }
add_4 = passThrough_4 + code_block_32
code_block_33 = CodeBlock { 90; }
add_5 = passThrough_4 + code_block_33
code_block_34 = CodeBlock { 180; }
add_6 = filterByBoolMask_10.in + code_block_34
sub_2 = passThrough_4 - add_6
condição_if_de_lista_2 = CodeBlock(test=filterByBoolMask_11.in, OP1=add_3, test1=eq_3, OP2=add_4, test2=eq_4, OP3=add_5, OP4=sub_2)
# ---------- condição_if_de_lista_2.designscript (2 lines) ----------
//Condições IF
test == true ? OP1 : test1 == true ? OP2 : test2 == true ? OP3 : OP4;
# ----------------------------------------
setRotation_2 = FamilyInstance.SetRotation(familyInstance=flatten_11, degree=condição_if_de_lista_2)

end_3 = Revit.Transaction.Transaction.End(input=setRotation_2)
passThrough_5 = Custom[PassThrough](passThrough=flatten_8, waitFor=end_3)

# group: Mensagem final
count = List.Count(list=passThrough_5)
code_block_35 = CodeBlock { 0; }
gt_3 = count > code_block_35
code_block_36 = CodeBlock(N=count) { ["Feito! Você inseriu "+N+" Suportes em seu projeto!"]; }
code_block_37 = CodeBlock { ["Nenhum Suporte foi inserido"]; }
condição_if_de_lista_3 = CodeBlock(test=gt_3, verd=code_block_36, fals=code_block_37)  # same code as condição_if_de_lista
flatten_12 = List.Flatten(list=condição_if_de_lista_3)
fromList_2 = Python(IN[0]=flatten_12)  # "String.FromList"; IronPython2; same code as fromList
python_script_3 = Python(IN[0]=fromList_2)  # IronPython2
# ---------- python_script_3.python (21 lines) ----------
# Importar as bibliotecas necessárias do Revit
import clr
clr.AddReference("RevitServices")
from RevitServices.Persistence import DocumentManager

clr.AddReference("RevitAPI")
clr.AddReference("RevitAPIUI")
from Autodesk.Revit.UI import TaskDialog

# Pegar a entrada do Dynamo
mensagem = IN[0]

# Criar a TaskDialog
task_dialog = TaskDialog("Ok")
task_dialog.MainInstruction = mensagem

# Exibir a TaskDialog
task_dialog.Show()

# Saída do script
OUT = "Sucesso!"
# ----------------------------------------
