# Dynamo graph 2021_08-1_BIMACON_Inserir Suportes por Seleção_R03_script.dyn "ok 2021_08-1_BIMACON_Inserir Suportes por Seleção_R02" (Dynamo 2.6.1.8786)
# Inserção de Suportes por seleção em Eletrodutos e Bandeja de Cabos
# packages: bimorphNodes 4.2.4, Data-Shapes 2022.2.105, Clockwork for Dynamo 2.x 2.4.0, Orchid 2.6.8.6198

# group: Projeto
# note: Utilize esta cor para as funções desenhadas no programa (núcleo do gráfico)

# group: Entradas
# note: Use esta cor para os nós e blocos de código que representam as entradas

# group: Python
# note: Use esta cor para os nós Python

# group: Nome do Projeto: "Colocar suportes para caminhos de cabos"
# note: Este gráfico coloca o suporte das eletrocalhas dividido em distâncias iguais. Divirta-se!!!! :D :D :D

# group: Saída
# note: Use esta cor para os nós que representam a saída do gráfico

# group: PROBLEMAS PARA RESOLVER
# note: TENTANDO DESCOBRIR COMO RODAR TODAS AS FAMÍLIAS NA DIREÇÃO CORRETA.
# SUBPONTO: NÓ RAYBUNCE NÃO FUNCIONA COM encontrar o ponto mais próximo.??????

# group: ENTRADAS PARA O USUÁRIO
code_block = CodeBlock { "Inserção de Suportes em Eletrodutos ou eletrocalhas"; }
file_path = Filename("..\..\..\..\..\05 - BIMACON\01 - EMPRESA BIMACON\00 - Logos e imagens - BIMACON\ARTE BIMACON\reddonda-removebg-preview.png")
file_from_path = FileObject(path=file_path)
readFromFile = Image.ReadFromFile(file=file_from_path)
string = StringInput("Confirmar")
string_2 = StringInput("Selecione os Eletrodutos ou Bandeja de Cabos Depois clique em Concluir")
string_3 = StringInput("Selecione ")
categories = Categories("OST_Conduit")
categories_2 = Categories("OST_CableTray")
list_create = List.Create(item0=categories, item1=categories_2)
boolean = BoolSelector(false)
selectmodelelements_data = Custom[SelectModelElements Data](InputName=string_2, ButtonText=string_3, CategoryFilter=list_create, SelectSingleElement=boolean)  # package Data-Shapes; Creates a Revit element selection input for UI.MultipleInputForm++ . Check out www.data-shapes.net for more infos!
string_4 = StringInput("Tipo de Suporte")
categories_3 = Categories("OST_ConduitFitting")
all_families_of_category = Custom[All Families Of Category](category=categories_3)  # package Clockwork for Dynamo 2.x; Gets all famiies of a given category in the model (does *not *work for system families)
categories_4 = Categories("OST_CableTrayFitting")
all_families_of_category_2 = Custom[All Families Of Category](category=categories_4)
list_create_2 = List.Create(item0=all_families_of_category, item1=all_families_of_category_2)
name = Family.Name(family=list_create_2)
code_block_2 = CodeBlock { "Suporte"; }
contains = String.Contains(str=name, searchFor=code_block_2)
filterByBoolMask = List.FilterByBoolMask(list=list_create_2, mask=contains)
name_2 = Family.Name(family=filterByBoolMask.in)
code_block_3 = CodeBlock { "x"; }
contains_2 = String.Contains(str=name_2, searchFor=code_block_3)
filterByBoolMask_2 = List.FilterByBoolMask(list=filterByBoolMask.in, mask=contains_2)
types = Family.Types(family=filterByBoolMask_2.out)
flatten = List.Flatten(list=types)
name_3 = FamilyType.Name(familyType=flatten)
code_block_4 = CodeBlock { 0; }
dropdown_data = Custom[DropDown Data](InputName=string_4, Keys=name_3, Values=flatten, DefaultValueIndex=code_block_4)  # package Data-Shapes; Create data for DropDown input in UI.MultiInputForm ++ . Check out www.data-shapes.net for more infos.
string_5 = StringInput("Distancia inicial primeiro Suporte (m)")
string_6 = StringInput("0.5")
boolean_2 = BoolSelector(true)
textbox_data = Custom[TextBox Data](InputName=string_5, DefaultText=string_6, IsNumberEntry=boolean_2)  # package Data-Shapes; Create Data for TextBox input in UI.MultipleInputForm ++ . Check out www.data-shapes.net for more informations
string_7 = StringInput("Espaçamento entre Suportes (m)")
string_8 = StringInput("0.5")
boolean_3 = BoolSelector(true)
textbox_data_2 = Custom[TextBox Data](InputName=string_7, DefaultText=string_8, IsNumberEntry=boolean_3)
list_create_3 = List.Create(item0=selectmodelelements_data, item1=dropdown_data, item2=textbox_data, item3=textbox_data_2)
boolean_4 = BoolSelector(true)
string_9 = StringInput("Cancelar")
number = DoubleInput(600)
number_2 = DoubleInput(167)
multipleinputform = Custom[MultipleInputForm ++](Description_optional=code_block, Logo_optional=readFromFile, ButtonText_optional=string, Inputs=list_create_3, Toggle=boolean_4, CancelButtonText_optional=string_9, Width_optional=number, LabelWidth_optional=number_2)  # package Data-Shapes; Create a form with multiple inputs. see www.data-shapes.net for tutorials and infos!
code_block_5 = CodeBlock()  # //Data-Shapes
code_block_6 = CodeBlock()  # //archilab

# group: Separar Entradas
code_block_7 = CodeBlock { 1; }
getItemAtIndex = List.GetItemAtIndex(list=multipleinputform.User_Inputs, index=code_block_7)
code_block_8 = CodeBlock { 0; }
getItemAtIndex_2 = List.GetItemAtIndex(list=multipleinputform.User_Inputs, index=code_block_8)
code_block_9 = CodeBlock { 2; }
getItemAtIndex_3 = List.GetItemAtIndex(list=multipleinputform.User_Inputs, index=code_block_9)
code_block_10 = CodeBlock { 3; }
getItemAtIndex_4 = List.GetItemAtIndex(list=multipleinputform.User_Inputs, index=code_block_10)

# group: Family Type
family = FamilyType.Family(familyType=getItemAtIndex)
types_2 = Family.Types(family=family)
name_4 = FamilyType.Name(familyType=getItemAtIndex)
name_5 = FamilyType.Name(familyType=types_2)
eq = name_4 == name_5
filterByBoolMask_3 = List.FilterByBoolMask(list=types_2, mask=eq)

# group: Filtrar os caminhos de cabos em função do comprimento mínimo
getLocation = Element.GetLocation(element=getItemAtIndex_2)
length = Curve.Length(curve=getLocation)
number_slider = DoubleSlider(1, range=0..50 step 1)
gt = length > number_slider
filterByBoolMask_4 = List.FilterByBoolMask(list=length, mask=gt)

# group: Definindo o espaçamento
code_block_11 = CodeBlock(y=filterByBoolMask_4.in) { list = DSCore.Math.Round(y); }
code_block_12 = CodeBlock(full_len=code_block_11, inset=getItemAtIndex_3, max_spacing=getItemAtIndex_4) { len = full_len - inset; count = len/max_spacing; req_count = DSCore.Math.Ceiling(count); spacing = len/req_count; }
code_block_13 = CodeBlock(inset=getItemAtIndex_3, count=code_block_12.count, spacing=code_block_12.spacing) { inset..count*spacing..#count; }

# group: Obtendo os pontos de posicionamento
pointAtSegmentLength = Curve.PointAtSegmentLength(curve=getLocation, segmentLength=code_block_13)
parameterAtPoint = Curve.ParameterAtPoint(curve=getLocation, point=pointAtSegmentLength)
normalAtParameter = Curve.NormalAtParameter(curve=getLocation, param=parameterAtPoint)

# group: Criando as famílias de suportes
byPoint = FamilyInstance.ByPoint(familyType=filterByBoolMask_3.in, point=pointAtSegmentLength, lacing=Longest)

# group: Obtendo os parâmetros
code_block_14 = CodeBlock { "Diâmetro (tamanho comercial)"; "Largura"; "Altura"; }
getParameterValueByName = Element.GetParameterValueByName(element=getItemAtIndex_2, parameterName=code_block_14.out0)
convert_between_units = DynamoConvert(getParameterValueByName, MeasurementType="Length", FromConversion="Millimeters", ToConversion="Meters")
getParameterValueByName_2 = Element.GetParameterValueByName(element=getItemAtIndex_2, parameterName=code_block_14.out1)
convert_between_units_2 = DynamoConvert(getParameterValueByName_2, MeasurementType="Length", FromConversion="Millimeters", ToConversion="Meters")
getParameterValueByName_3 = Element.GetParameterValueByName(element=getItemAtIndex_2, parameterName=code_block_14.out2)
convert_between_units_3 = DynamoConvert(getParameterValueByName_3, MeasurementType="Length", FromConversion="Millimeters", ToConversion="Meters")

# group: Parâmetro da família DN
code_block_15 = CodeBlock { "DN"; }
setParameterByName = Element.SetParameterByName(element=byPoint, parameterName=code_block_15, value=convert_between_units)

# group: Parâmetro da família Largura
code_block_16 = CodeBlock { "Largura"; }
setParameterByName_2 = Element.SetParameterByName(element=byPoint, parameterName=code_block_16, value=convert_between_units_2)

# group: Parâmetro da família Altura
code_block_17 = CodeBlock { "Altura"; }
setParameterByName_3 = Element.SetParameterByName(element=byPoint, parameterName=code_block_17, value=convert_between_units_3)

# group: Intersecção com a laje
location = FamilyInstance.Location(familyInstance=byPoint)
X = Point.X(point=location)
Y = Point.Y(point=location)
Z = Point.Z(point=location)
code_block_18 = CodeBlock { 3; }
add = Z + code_block_18
byCoordinates = Point.ByCoordinates(x=X, y=Y, z=add)
code_block_19 = CodeBlock { 0.05; }
byPointsRadius = Cone.ByPointsRadius(startPoint=location, endPoint=byCoordinates, startRadius=code_block_19)
categories_5 = Categories("OST_Floors")
all_elements_of_category = ElementsOfCategory(Category=categories_5)
intersectsSolid = Revit.Element.IntersectsSolid(solids=byPointsRadius, elements=all_elements_of_category)
intersectingElements = Results.SolidIntersectionResult.IntersectingElements(solidIntersectionResult=intersectsSolid)
firstItem = List.FirstItem(list=intersectingElements@L2)
code_block_20 = CodeBlock { "Elevação na parte inferior"; }
getParameterValueByName_4 = Element.GetParameterValueByName(element=firstItem, parameterName=code_block_20)
abs = Math.Abs(number=getParameterValueByName_4)
code_block_21 = CodeBlock { "Elevação do nível"; }
getParameterValueByName_5 = Element.GetParameterValueByName(element=byPoint, parameterName=code_block_21)
abs_2 = Math.Abs(number=getParameterValueByName_5)
sub = abs - abs_2

# group: Parâmetro da família Distância até o Teto
code_block_22 = CodeBlock { "Distância até o Teto"; }
abs_3 = Math.Abs(number=sub)
setParameterByName_4 = Element.SetParameterByName(element=byPoint, parameterName=code_block_22, value=abs_3)

# group: Ângulo de orientação
X_2 = Vector.X(vector=normalAtParameter)
code_block_23 = CodeBlock { 0.0; 0.001; }
eq_2 = Equals(x=X_2, y=code_block_23.out0, tolerance=code_block_23.out1)
reverse = Vector.Reverse(vector=normalAtParameter)

ge = X_2 >= code_block_23.out0

# group (continued): Ângulo de orientação
if_ = If(test=ge, true=normalAtParameter, false=reverse)
code_block_24 = CodeBlock(Vector1=if_) { Vector.YAxis(); Vector1; Vector.XAxis(); }
angleAboutAxis = Vector.AngleAboutAxis(vector=code_block_24.Vector1, otherVector=code_block_24.out0, rotationAxis=code_block_24.out2)
round = Math.Round(number=angleAboutAxis)

# group: Parâmetro da família - Ângulo
setRotation = FamilyInstance.SetRotation(familyInstance=byPoint, degree=round)

# group: Mensagem Final
flatten_2 = List.Flatten(list=setRotation)
count = List.Count(list=flatten_2)
code_block_25 = CodeBlock { 0; }
gt_2 = count > code_block_25
code_block_26 = CodeBlock(N=count) { ["Feito! você inseriu "+N+" Suportes"]; }
code_block_27 = CodeBlock { ["Nenhum Suporte foi inserido"]; }
if_2 = If(test=gt_2, true=code_block_26, false=code_block_27)
flatten_3 = List.Flatten(list=if_2)
o_string_fromlist = Orchid.Common.String.FromList(list=flatten_3)
python_script = Python(IN[0]=o_string_fromlist)
# ---------- python_script.python (21 lines) ----------
# Importar as bibliotecas necessárias do Revit
import clr
clr.AddReference("RevitServices")
from RevitServices.Persistence import DocumentManager

clr.AddReference("RevitAPI")
clr.AddReference("RevitAPIUI")
from Autodesk.Revit.UI import TaskDialog

# Pegar a entrada do Dynamo
mensagem = IN[0]

# Criar a TaskDialog
task_dialog = TaskDialog("Ok")
task_dialog.MainInstruction = mensagem

# Exibir a TaskDialog
task_dialog.Show()

# Saída do script
OUT = "Sucesso!"
# ----------------------------------------

le = X_2 <= code_block_23.out0
code_block_28 = CodeBlock { 1; }
