# Dynamo graph 05-2_BIMACON_Inserir Tomadas nos Espaços_R01_script.dyn "05-2_BIMACON_Inserir Tomadas nos Espaços_R00_script" (Dynamo 3.6.1.9895)
# author: Jose Nelson
# Inseri Tomadas nos Espaços do modelo
# packages: Data-Shapes 2022.2.105, archi-lab.net 2023.213.1722, DynamoIronPython2.7 3.2.1, Genius Loci 2023.2.21, BIMCoder Nodes - 2.X 2025.1.0, Rhythm 2023.4.2024

sentido_horário = BoolSelector(true)

# group: Espaços
categories = Categories("OST_MEPSpaces")
code_block = CodeBlock { ["Selecione o Espaço e clique em Concluir"]; }
dialog_simple = Custom[👓 Dialog․Simple](message=code_block)  # package BIMCoder Nodes - 2.X; Exibe uma mensagem de alerta ao usuário, sem botões de ação.
select_model_elements_of = Custom[Select Model Elements of Category](Categories=categories, Toggle=dialog_simple)  # package Data-Shapes; Allows to perform a manual selection with a category filter.
name = Space.Name(space=select_model_elements_of)

passThrough = Custom[PassThrough](passThrough=select_model_elements_of, waitFor=name)  # package archi-lab.net; Ripped this off from Clockwork. Sorry Andy.

# group: ENTRADAS PARA O USUÁRIO
code_block_2 = CodeBlock { "Inserção de Tomadas nos Espaços"; }
string = StringInput("LogoBimacon.png")
python_script = Python(IN[0]=string)  # IronPython2
# ---------- python_script.python (22 lines) ----------
import clr

# Adiciona referência ao ambiente .NET
clr.AddReference('System')
from System import Environment, IO

# Nome da imagem (entrada do usuário)
nome_arquivo_imagem = IN[0]

# Recupera o nome do usuário logado no Windows
usuario = Environment.UserName

# Monta o caminho completo para a pasta de imagens
caminho_base = r"C:\Users\{0}\AppData\Roaming\pyRevit\Extensions\Bimacon.extension\Bimacon.tab\Imagens_Bimacon".format(usuario)

# Junta o caminho base com o nome do arquivo
caminho_completo = IO.Path.Combine(caminho_base, nome_arquivo_imagem)

# Verifica se o arquivo existe
existe = IO.File.Exists(caminho_completo)

OUT = caminho_completo if existe else "Imagem não encontrada: {0}".format(caminho_completo)
# ----------------------------------------
file_from_path = FileObject(path=python_script)
readFromFile = Image.ReadFromFile(file=file_from_path)
string_2 = StringInput("Confirmar")
string_3 = StringInput("Selecione o Espaço")
code_block_3 = CodeBlock { 0; }
dropdown_data = Custom[DropDown Data](InputName=string_3, Keys=name, Values=passThrough, DefaultValueIndex=code_block_3)  # package Data-Shapes; Create data for DropDown input in UI.MultiInputForm ++ . Check out www.data-shapes.net for more infos.
string_4 = StringInput("Quantidade de Tomadas")
string_5 = StringInput("4")
boolean = BoolSelector(true)
textbox_data = Custom[TextBox Data](InputName=string_4, DefaultText=string_5, IsNumberEntry=boolean)  # package Data-Shapes; Create Data for TextBox input in UI.MultipleInputForm ++ . Check out www.data-shapes.net for more informations
string_6 = StringInput("Tipo de Tomada")
categories_2 = Categories("OST_ElectricalFixtures")
obter_famílias_de_uma_categoria = Python(IN[0]=categories_2)  # "Obter Famílias de Uma Categoria - BIMACON"; IronPython2
# ---------- obter_famílias_de_uma_categoria.python (119 lines) ----------
# -*- coding: utf-8 -*-

import clr
import System

# Revit API
clr.AddReference('RevitAPI')
from Autodesk.Revit.DB import *

# Revit Services
clr.AddReference('RevitServices')
from RevitServices.Persistence import DocumentManager

# Revit Nodes
clr.AddReference("RevitNodes")
import Revit
clr.ImportExtensions(Revit.Elements)

# Documento atual
doc = DocumentManager.Instance.CurrentDBDocument


# ==================================================
# FUNÇÃO PARA OBTER BuiltInCategory
# Compatível Revit 2021 até 2026
# ==================================================

def obter_builtincategory(entrada):

    # Caso já seja BuiltInCategory
    if isinstance(entrada, BuiltInCategory):
        return entrada

    # Caso seja inteiro
    if isinstance(entrada, int):
        try:
            return System.Enum.ToObject(BuiltInCategory, entrada)
        except:
            return None

    # Tenta converter Category
    try:

        # Unwrap se necessário
        entrada = UnwrapElement(entrada)

        # Se for Category
        if isinstance(entrada, Category):

            cat_id = entrada.Id

            # Compatível versões antigas e novas
            try:
                valor = cat_id.IntegerValue
            except:
                valor = cat_id.Value

            return System.Enum.ToObject(BuiltInCategory, valor)

    except:
        pass

    return None


# ==================================================
# ENTRADA
# ==================================================

entrada = IN[0]

bic = obter_builtincategory(entrada)

# ==================================================
# COLETA FAMÍLIAS
# ==================================================

familias_filtradas = []

if bic:

    familias = FilteredElementCollector(doc)\
        .OfClass(Family)\
        .ToElements()

    for fam in familias:

        try:

            cat = fam.FamilyCategory

            if cat is None:
                continue

            cat_id = cat.Id

            # Compatibilidade 2021 → 2026
            try:
                valor_categoria = cat_id.IntegerValue
            except:
                valor_categoria = cat_id.Value

            bic_familia = System.Enum.ToObject(
                BuiltInCategory,
                valor_categoria
            )

            if bic_familia == bic:
                familias_filtradas.append(fam)

        except:
            continue


# ==================================================
# SAÍDA
# ==================================================

OUT = familias_filtradas
# ----------------------------------------
name_2 = Family.Name(family=obter_famílias_de_uma_categoria)
code_block_4 = CodeBlock { "Tomada"; }
contains = String.Contains(string=name_2, searchFor=code_block_4)
filterByBoolMask = List.FilterByBoolMask(list=obter_famílias_de_uma_categoria, mask=contains)
name_3 = Family.Name(family=filterByBoolMask.in)
code_block_5 = CodeBlock { "x."; }
contains_2 = String.Contains(string=name_3, searchFor=code_block_5)
filterByBoolMask_2 = List.FilterByBoolMask(list=filterByBoolMask.in, mask=contains_2)
types = Family.Types(family=filterByBoolMask_2.out)
flatten = List.Flatten(list=types)
family = FamilyType.Family(familyType=flatten)
name_4 = Family.Name(family=family)
sortByKey = List.SortByKey(list=flatten, keys=name_4)
code_block_6 = CodeBlock { "_"; }
split = String.Split(string=sortByKey.sortedKeys, separator0=code_block_6)
code_block_7 = CodeBlock { 1; 2; }
getItemAtIndex = List.GetItemAtIndex(list=split@L2, index=code_block_7.out0)
getItemAtIndex_2 = List.GetItemAtIndex(list=split@L2, index=code_block_7.out1)
code_block_8 = CodeBlock(x=getItemAtIndex, y=getItemAtIndex_2) { x+" "+y; }
name_5 = FamilyType.Name(familyType=sortByKey.sortedList)
code_block_9 = CodeBlock(a=code_block_8, b=name_5) { a; b; a+" : "+b; }
code_block_10 = CodeBlock { 0; }
boolean_2 = BoolSelector(false)
dropdown_data_2 = Custom[DropDown Data](InputName=string_6, Keys=code_block_9.out2, Values=sortByKey.sortedList, DefaultValueIndex=code_block_10, Sorted_optional=boolean_2)
string_7 = StringInput("Distância do Eixo da Porta (Aprox. Larg. da Porta - 25cm)")
string_8 = StringInput("0.55")
boolean_3 = BoolSelector(true)
textbox_data_2 = Custom[TextBox Data](InputName=string_7, DefaultText=string_8, IsNumberEntry=boolean_3)
string_9 = StringInput("Elevação do Ponto")
string_10 = StringInput("1.2")
boolean_4 = BoolSelector(true)
textbox_data_3 = Custom[TextBox Data](InputName=string_9, DefaultText=string_10, IsNumberEntry=boolean_4)
list_create = List.Create(item0=dropdown_data, item1=textbox_data, item2=dropdown_data_2, item3=textbox_data_2, item4=textbox_data_3)
boolean_5 = BoolSelector(true)
string_11 = StringInput("Cancelar")
number = DoubleInput(600)
number_2 = DoubleInput(205)
multipleinputform = Custom[MultipleInputForm ++](Description_optional=code_block_2, Logo_optional=readFromFile, ButtonText_optional=string_2, Inputs=list_create, Toggle=boolean_5, CancelButtonText_optional=string_11, Width_optional=number, LabelWidth_optional=number_2)  # package Data-Shapes; Create a form with multiple inputs. see www.data-shapes.net for tutorials and infos!
code_block_11 = CodeBlock()  # //archilab
code_block_12 = CodeBlock()  # //Data-Shapes

# group: Separar Entradas
code_block_13 = CodeBlock { 0; }
getItemAtIndex_3 = List.GetItemAtIndex(list=multipleinputform.User_Inputs, index=code_block_13)
code_block_14 = CodeBlock { 3; }
getItemAtIndex_4 = List.GetItemAtIndex(list=multipleinputform.User_Inputs, index=code_block_14)
code_block_15 = CodeBlock { 1; }
getItemAtIndex_5 = List.GetItemAtIndex(list=multipleinputform.User_Inputs, index=code_block_15)
code_block_16 = CodeBlock { 2; }
getItemAtIndex_6 = List.GetItemAtIndex(list=multipleinputform.User_Inputs, index=code_block_16)
code_block_17 = CodeBlock { 4; }
getItemAtIndex_7 = List.GetItemAtIndex(list=multipleinputform.User_Inputs, index=code_block_17)

boolean_6 = BoolSelector(true)
filterByBoolMask_3 = List.FilterByBoolMask(list=getItemAtIndex_3, mask=boolean_6)
finishBoundary = Space.FinishBoundary(space=filterByBoolMask_3.in)
byJoinedCurves = PolyCurve.ByJoinedCurves(curves=finishBoundary)
reverse = Curve.Reverse(curve=byJoinedCurves)
if_ = If(test=sentido_horário, true=reverse, false=byJoinedCurves)
length = Curve.Length(curve=if_)
end = Revit.Transaction.Transaction.End(input=name)

# group: Mensagem
code_block_18 = CodeBlock { ["Selecione a porta ou abertura de ref."]; }
passThrough_2 = Custom[PassThrough](passThrough=code_block_18, waitFor=end)
fromList = Python(IN[0]=passThrough_2)  # "String.FromList"; IronPython2
# ---------- fromList.python (22 lines) ----------
# Carregar as bibliotecas DesignScript e padrão do Python
import sys
import clr
clr.AddReference('ProtoGeometry')
from Autodesk.DesignScript.Geometry import *

# Função para concatenar os valores de uma lista em uma única string com múltiplas linhas
def concatenate_list_to_string(input_list, delimiter="\n"):
    # Verifica se a entrada é uma lista
    if not isinstance(input_list, list):
        return "A entrada deve ser uma lista."
    
    # Converte todos os elementos para string e junta com o delimitador especificado
    result = delimiter.join(str(item) for item in input_list)
    return result

# Entrada pelo nó do Dynamo
lista = IN[0]  # Lista de valores a serem concatenados
delimitador = IN[1] if len(IN) > 1 else "\n"  # Delimitador opcional, padrão é nova linha

# Saída para o Dynamo
OUT = concatenate_list_to_string(lista, delimitador)
# ----------------------------------------
window_prompt_with_text = Python(IN[0]=fromList)  # IronPython2
# ---------- window_prompt_with_text.python (26 lines) ----------
# Importando as bibliotecas necessárias da API do Revit
import clr
clr.AddReference('RevitServices')  # Referência aos serviços do Revit
from RevitServices.Persistence import DocumentManager

clr.AddReference('RevitAPI')  # Referência à API do Revit
clr.AddReference('RevitAPIUI')  # Referência à API de Interface de Usuário do Revit

from Autodesk.Revit.UI import TaskDialog, TaskDialogCommonButtons, TaskDialogResult

# Recebe o texto de instrução como entrada do nó
instrucoes = IN[0]

# Criando o TaskDialog
dialog = TaskDialog("Aviso")
dialog.MainInstruction = instrucoes
dialog.CommonButtons = TaskDialogCommonButtons.Ok

# Exibindo o dialog para o usuário e capturando a resposta
resultado = dialog.Show()

# Interpretando a resposta
if resultado == TaskDialogCommonButtons.Ok:
    OUT = "Ok"
else:
    OUT = "True"
# ----------------------------------------
boolean_7 = BoolSelector(true)
ʳʰʸᵗʰᵐ_selection_pick = Rhythm.Revit.Selection.Selection.Pick(runIt=window_prompt_with_text, singleSelection=boolean_7)

getLocation = Element.GetLocation(element=ʳʰʸᵗʰᵐ_selection_pick)
closestPointTo = Geometry.ClosestPointTo(geometry=if_, other=getLocation)
parameterAtPoint = Curve.ParameterAtPoint(curve=if_, point=closestPointTo)
code_block_19 = CodeBlock(offset_1=getItemAtIndex_4, lenght_1=length, pap_1=parameterAtPoint) { par_1 = offset_1/lenght_1; par_2 = pap_1+par_1; pap_1; }
code_block_20 = CodeBlock(x=getItemAtIndex_5) { seq_1 = 0..1..#x+1; seq_2 = DSCore.List.RemoveItemAtIndex(seq_1, x); }
add = code_block_19.par_2 + code_block_20.seq_2  # lacing=Longest
code_block_21 = CodeBlock(x=add) { x>=1; x-1; x; }
if_2 = If(test=code_block_21.out0, true=code_block_21.out1, false=code_block_21.x)
pointAtParameter = Curve.PointAtParameter(curve=if_, param=if_2, lacing=Longest)
normalAtParameter = Curve.NormalAtParameter(curve=if_, param=if_2, lacing=Longest)
code_block_22 = CodeBlock { 1; }
byStartPointDirectionLength = Line.ByStartPointDirectionLength(startPoint=pointAtParameter, direction=normalAtParameter, length=code_block_22)
family_2 = FamilyType.Family(familyType=getItemAtIndex_6)
types_2 = Family.Types(family=family_2)
name_6 = FamilyType.Name(familyType=getItemAtIndex_6)
name_7 = FamilyType.Name(familyType=types_2)
eq = name_6 == name_7
filterByBoolMask_4 = List.FilterByBoolMask(list=types_2, mask=eq)
element_level = Custom[Element Level](element=getItemAtIndex_3)  # package Genius Loci; Gets an element's level. Based on a Clockwork's node
byPointAndLevel = FamilyInstance.ByPointAndLevel(familyType=filterByBoolMask_4.in, point=pointAtParameter, level=element_level, lacing=Longest)
string_12 = StringInput("Elevação do nível")
number_3 = DoubleInput(0)
setParameterByName = Element.SetParameterByName(element=byPointAndLevel, parameterName=string_12, value=number_3, lacing=Longest)
string_13 = StringInput("Elevação do Ponto")
setParameterByName_2 = Element.SetParameterByName(element=setParameterByName, parameterName=string_13, value=getItemAtIndex_7, lacing=Longest)
reverse_2 = Vector.Reverse(vector=normalAtParameter)
if_3 = If(test=sentido_horário, true=normalAtParameter, false=reverse_2)
YAxis = Vector.YAxis()
ZAxis = Vector.ZAxis()
angleAboutAxis = Vector.AngleAboutAxis(vector=if_3, otherVector=YAxis, rotationAxis=ZAxis)
setRotation = FamilyInstance.SetRotation(familyInstance=setParameterByName_2, degree=angleAboutAxis)
end_2 = Revit.Transaction.Transaction.End(input=setRotation)
start = Revit.Transaction.Transaction.Start(input=end_2)

# group: Mensagem final
passThrough_3 = Custom[PassThrough](passThrough=start, waitFor=start)
count = List.Count(list=passThrough_3)
code_block_23 = CodeBlock { 0; }
gt = count > code_block_23
code_block_24 = CodeBlock { ["Feito! Deseja inverter o lado das Tomadas?"]; }
code_block_25 = CodeBlock { ["Nenhuma Tomada foi inserida"]; }
if_4 = If(test=gt, true=code_block_24, false=code_block_25)
flatten_2 = List.Flatten(list=if_4)
fromList_2 = Python(IN[0]=flatten_2)  # "String.FromList"; IronPython2; same code as fromList
python_script_2 = Python(IN[0]=fromList_2)  # IronPython2
# ---------- python_script_2.python (30 lines) ----------
# Importando as bibliotecas necessárias da API do Revit
import clr
clr.AddReference('RevitServices')  # Referência aos serviços do Revit
from RevitServices.Persistence import DocumentManager

clr.AddReference('RevitAPI')  # Referência à API do Revit
clr.AddReference('RevitAPIUI')  # Referência à API de Interface de Usuário do Revit

from Autodesk.Revit.UI import TaskDialog, TaskDialogCommonButtons, TaskDialogResult

# Recebe o texto de instrução como entrada do nó
instrucoes = IN[0]

# Criando o TaskDialog
dialog = TaskDialog("Aviso")
dialog.MainInstruction = instrucoes
dialog.CommonButtons = TaskDialogCommonButtons.Yes | TaskDialogCommonButtons.No | TaskDialogCommonButtons.Close

# Exibindo o dialog para o usuário e capturando a resposta
resultado = dialog.Show()

# Interpretando a resposta
if resultado == TaskDialogResult.No:
    OUT = "Não"
elif resultado == TaskDialogResult.Yes:
    OUT = "Sim"
elif resultado == TaskDialogResult.Cancel:
    OUT = "Fechar"
else:
    OUT = "Nenhuma ação"
# ----------------------------------------

# group: Inverter lado Interruptor
code_block_26 = CodeBlock { true; false; }
code_block_27 = CodeBlock(x=python_script_2, y=code_block_26.out0, z=code_block_26.out1)
# ---------- code_block_27.designscript (5 lines) ----------
//Condições IF, OR, AND
x;
y;
z;
x == "Sim" ? z : y;
# ----------------------------------------
watch = Watch(code_block_27.out3)
passThrough_4 = Custom[PassThrough](passThrough=setParameterByName_2, waitFor=code_block_27.out3)
delete = Element.Delete(element=passThrough_4)
passThrough_5 = Custom[PassThrough](passThrough=code_block_27.out3, waitFor=delete)

if_5 = If(test=passThrough_5, true=reverse, false=byJoinedCurves)
length_2 = Curve.Length(curve=if_5)
closestPointTo_2 = Geometry.ClosestPointTo(geometry=if_5, other=getLocation)
parameterAtPoint_2 = Curve.ParameterAtPoint(curve=if_5, point=closestPointTo_2)
code_block_28 = CodeBlock(offset_1=getItemAtIndex_4, lenght_1=length_2, pap_1=parameterAtPoint_2) { par_1 = offset_1/lenght_1; par_2 = pap_1+par_1; pap_1; }
code_block_29 = CodeBlock(x=getItemAtIndex_5) { seq_1 = 0..1..#x+1; seq_2 = DSCore.List.RemoveItemAtIndex(seq_1, x); }
add_2 = code_block_28.par_2 + code_block_29.seq_2  # lacing=Longest
code_block_30 = CodeBlock(x=add_2) { x>=1; x-1; x; }
if_6 = If(test=code_block_30.out0, true=code_block_30.out1, false=code_block_30.x)
pointAtParameter_2 = Curve.PointAtParameter(curve=if_5, param=if_6, lacing=Longest)
normalAtParameter_2 = Curve.NormalAtParameter(curve=if_5, param=if_6, lacing=Longest)
code_block_31 = CodeBlock { 1; }
byStartPointDirectionLength_2 = Line.ByStartPointDirectionLength(startPoint=pointAtParameter_2, direction=normalAtParameter_2, length=code_block_31)
element_level_2 = Custom[Element Level](element=getItemAtIndex_3)
byPointAndLevel_2 = FamilyInstance.ByPointAndLevel(familyType=filterByBoolMask_4.in, point=pointAtParameter_2, level=element_level_2, lacing=Longest)
string_14 = StringInput("Elevação do nível")
number_4 = DoubleInput(0)
setParameterByName_3 = Element.SetParameterByName(element=byPointAndLevel_2, parameterName=string_14, value=number_4, lacing=Longest)
string_15 = StringInput("Elevação do Ponto")
setParameterByName_4 = Element.SetParameterByName(element=setParameterByName_3, parameterName=string_15, value=getItemAtIndex_7, lacing=Longest)
reverse_3 = Vector.Reverse(vector=normalAtParameter_2)
if_7 = If(test=passThrough_5, true=normalAtParameter_2, false=reverse_3)
YAxis_2 = Vector.YAxis()
ZAxis_2 = Vector.ZAxis()
angleAboutAxis_2 = Vector.AngleAboutAxis(vector=if_7, otherVector=YAxis_2, rotationAxis=ZAxis_2)
setRotation_2 = FamilyInstance.SetRotation(familyInstance=setParameterByName_4, degree=angleAboutAxis_2)
