# Dynamo graph 2021_05-0_BIMACON_Inserir Tomadas nos Ambientes-LINK_R02_script.dyn "2021_05-0_BIMACON_Inserir Tomadas nos Ambientes-LINK_R02" (Dynamo 2.6.1.8786)
# packages: Orchid 206.6.0.5842, Data-Shapes 2022.2.105, Clockwork for Dynamo 2.x 2.4.0, Orchid 2.6.8.6198, archi-lab.net 2023.213.1722

# group: ENTRADAS PARA O USUÁRIO
code_block = CodeBlock { "Inserção de Tomadas nos Espaços"; }
file_path = Filename("..\..\..\..\..\05 - BIMACON\01 - EMPRESA BIMACON\00 - Logos e imagens - BIMACON\ARTE BIMACON\reddonda-removebg-preview.png")
file_from_path = FileObject(path=file_path)
readFromFile = Image.ReadFromFile(file=file_from_path)
string = StringInput("Confirmar")
string_2 = StringInput("Selecione o link depois a porta (ou parede) para Inserir as Tomadas")
string_3 = StringInput("Selecione ")
boolean = BoolSelector(true)
selectlinkedelement_s_data = Custom[SelectLinkedElement(s) Data](InputName=string_2, ButtonText=string_3, SelectSingleElement=boolean)  # package Data-Shapes; Create a button input for UI.MultipleInputForm++ that allows to select elements in à linked document. See www.data-shapes.net for more infos!
string_4 = StringInput("Selecione o Espaço")
string_5 = StringInput("Selecione ")
categories = Categories("OST_MEPSpaces")
boolean_2 = BoolSelector(true)
selectmodelelements_data = Custom[SelectModelElements Data](InputName=string_4, ButtonText=string_5, CategoryFilter=categories, SelectSingleElement=boolean_2)  # package Data-Shapes; Creates a Revit element selection input for UI.MultipleInputForm++ . Check out www.data-shapes.net for more infos!
string_6 = StringInput("Quantidade de Tomadas")
string_7 = StringInput("4")
boolean_3 = BoolSelector(true)
textbox_data = Custom[TextBox Data](InputName=string_6, DefaultText=string_7, IsNumberEntry=boolean_3)  # package Data-Shapes; Create Data for TextBox input in UI.MultipleInputForm ++ . Check out www.data-shapes.net for more informations
string_8 = StringInput("Tipo de Tomada")
categories_2 = Categories("OST_ElectricalFixtures")
all_families_of_category = Custom[All Families Of Category](category=categories_2)  # package Clockwork for Dynamo 2.x; Gets all famiies of a given category in the model (does *not *work for system families)
name = Family.Name(family=all_families_of_category)
code_block_2 = CodeBlock { "Tomada"; }
contains = String.Contains(str=name, searchFor=code_block_2)
filterByBoolMask = List.FilterByBoolMask(list=all_families_of_category, mask=contains)
name_2 = Family.Name(family=filterByBoolMask.in)
code_block_3 = CodeBlock { "x."; }
contains_2 = String.Contains(str=name_2, searchFor=code_block_3)
filterByBoolMask_2 = List.FilterByBoolMask(list=filterByBoolMask.in, mask=contains_2)
types = Family.Types(family=filterByBoolMask_2.out)
flatten = List.Flatten(list=types)
family = FamilyType.Family(familyType=flatten)
name_3 = Family.Name(family=family)
code_block_4 = CodeBlock { "_"; }
split = String.Split(str=name_3, separator0=code_block_4)
code_block_5 = CodeBlock { 1; 2; }
getItemAtIndex = List.GetItemAtIndex(list=split@L2, index=code_block_5.out0)
getItemAtIndex_2 = List.GetItemAtIndex(list=split@L2, index=code_block_5.out1)
code_block_6 = CodeBlock(x=getItemAtIndex, y=getItemAtIndex_2) { x+" "+y; }
name_4 = FamilyType.Name(familyType=flatten)
code_block_7 = CodeBlock(a=code_block_6, b=name_4) { a; b; a+" : "+b; }
code_block_8 = CodeBlock { 0; }
dropdown_data = Custom[DropDown Data](InputName=string_8, Keys=code_block_7.out2, Values=flatten, DefaultValueIndex=code_block_8)  # package Data-Shapes; Create data for DropDown input in UI.MultiInputForm ++ . Check out www.data-shapes.net for more infos.
string_9 = StringInput("Distância do Eixo da Porta (Aprox. Larg. da Porta - 20cm)")
string_10 = StringInput("0.8")
boolean_4 = BoolSelector(true)
textbox_data_2 = Custom[TextBox Data](InputName=string_9, DefaultText=string_10, IsNumberEntry=boolean_4)
string_11 = StringInput("Inverter Lado em relação a Porta")
boolean_5 = BoolSelector(true)
string_12 = StringInput("Inverter Lado")
boolean_input = Custom[Boolean input](InputName=string_11, DefaultValue=boolean_5, SideText=string_12)  # package Data-Shapes; Creates a boolean input for UI.MultipleInputForm ++ . Check out www.data-shapes.net for more infos!
string_13 = StringInput("Elevação do Ponto")
string_14 = StringInput("1.2")
boolean_6 = BoolSelector(true)
textbox_data_3 = Custom[TextBox Data](InputName=string_13, DefaultText=string_14, IsNumberEntry=boolean_6)
list_create = List.Create(item0=selectlinkedelement_s_data, item1=selectmodelelements_data, item2=textbox_data, item3=dropdown_data, item4=textbox_data_2, item5=boolean_input, item6=textbox_data_3)
boolean_7 = BoolSelector(true)
string_15 = StringInput("Cancelar")
number = DoubleInput(600)
number_2 = DoubleInput(205)
multipleinputform = Custom[MultipleInputForm ++](Description_optional=code_block, Logo_optional=readFromFile, ButtonText_optional=string, Inputs=list_create, Toggle=boolean_7, CancelButtonText_optional=string_15, Width_optional=number, LabelWidth_optional=number_2)  # package Data-Shapes; Create a form with multiple inputs. see www.data-shapes.net for tutorials and infos!
code_block_9 = CodeBlock()  # //archilab
code_block_10 = CodeBlock()  # //Data-Shapes

# group: Separar Entradas
code_block_11 = CodeBlock { 5; }
getItemAtIndex_3 = List.GetItemAtIndex(list=multipleinputform.User_Inputs, index=code_block_11)
code_block_12 = CodeBlock { 1; }
getItemAtIndex_4 = List.GetItemAtIndex(list=multipleinputform.User_Inputs, index=code_block_12)
code_block_13 = CodeBlock { 4; }
getItemAtIndex_5 = List.GetItemAtIndex(list=multipleinputform.User_Inputs, index=code_block_13)
code_block_14 = CodeBlock { 0; }
getItemAtIndex_6 = List.GetItemAtIndex(list=multipleinputform.User_Inputs, index=code_block_14)
code_block_15 = CodeBlock { 3; }
getItemAtIndex_7 = List.GetItemAtIndex(list=multipleinputform.User_Inputs, index=code_block_15)
code_block_16 = CodeBlock { 6; }
getItemAtIndex_8 = List.GetItemAtIndex(list=multipleinputform.User_Inputs, index=code_block_16)

boolean_8 = BoolSelector(true)
filterByBoolMask_3 = List.FilterByBoolMask(list=getItemAtIndex_4, mask=boolean_8)
finishBoundary = Space.FinishBoundary(space=filterByBoolMask_3.in)
byJoinedCurves = PolyCurve.ByJoinedCurves(curves=finishBoundary)
reverse = Curve.Reverse(curve=byJoinedCurves)
if_ = If(test=getItemAtIndex_3, true=reverse, false=byJoinedCurves)
length = Curve.Length(curve=if_)
getLocation = Element.GetLocation(element=getItemAtIndex_6)
closestPointTo = Geometry.ClosestPointTo(geometry=if_, other=getLocation)
parameterAtPoint = Curve.ParameterAtPoint(curve=if_, point=closestPointTo)
code_block_17 = CodeBlock(offset_1=getItemAtIndex_5, lenght_1=length, pap_1=parameterAtPoint) { par_1 = offset_1/lenght_1; par_2 = pap_1+par_1; pap_1; }
code_block_18 = CodeBlock { 2; }
getItemAtIndex_9 = List.GetItemAtIndex(list=multipleinputform.User_Inputs, index=code_block_18)
code_block_19 = CodeBlock(x=getItemAtIndex_9) { seq_1 = 0..1..#x+1; seq_2 = DSCore.List.RemoveItemAtIndex(seq_1, x); }
add = code_block_17.par_2 + code_block_19.seq_2  # lacing=Longest
code_block_20 = CodeBlock(x=add) { x>=1; x-1; x; }
if_2 = If(test=code_block_20.out0, true=code_block_20.out1, false=code_block_20.x)
pointAtParameter = Curve.PointAtParameter(curve=if_, param=if_2, lacing=Longest)
normalAtParameter = Curve.NormalAtParameter(curve=if_, param=if_2, lacing=Longest)
code_block_21 = CodeBlock { 1; }
byStartPointDirectionLength = Line.ByStartPointDirectionLength(startPoint=pointAtParameter, direction=normalAtParameter, length=code_block_21)
sentido_horário = BoolSelector(true)  # graph input
family_2 = FamilyType.Family(familyType=getItemAtIndex_7)
types_2 = Family.Types(family=family_2)
name_5 = FamilyType.Name(familyType=getItemAtIndex_7)
name_6 = FamilyType.Name(familyType=types_2)
eq = name_5 == name_6
filterByBoolMask_4 = List.FilterByBoolMask(list=types_2, mask=eq)
o_spatialelement_level = Orchid.RevitProject.Elements.SpatialElement.Level(spatialElement=getItemAtIndex_4)
byPointAndLevel = FamilyInstance.ByPointAndLevel(familyType=filterByBoolMask_4.in, point=pointAtParameter, level=o_spatialelement_level, lacing=Longest)
string_16 = StringInput("Elevação do nível")
number_3 = DoubleInput(0)
setParameterByName = Element.SetParameterByName(element=byPointAndLevel, parameterName=string_16, value=number_3, lacing=Longest)
string_17 = StringInput("Elevação do Ponto")
setParameterByName_2 = Element.SetParameterByName(element=setParameterByName, parameterName=string_17, value=getItemAtIndex_8, lacing=Longest)
reverse_2 = Vector.Reverse(vector=normalAtParameter)
if_3 = If(test=getItemAtIndex_3, true=normalAtParameter, false=reverse_2)
YAxis = Vector.YAxis()
ZAxis = Vector.ZAxis()
angleAboutAxis = Vector.AngleAboutAxis(vector=if_3, otherVector=YAxis, rotationAxis=ZAxis)
setRotation = FamilyInstance.SetRotation(familyInstance=setParameterByName_2, degree=angleAboutAxis)

# group: Mensagem final
passThrough = Custom[PassThrough](passThrough=setRotation, waitFor=setRotation)  # package archi-lab.net; Ripped this off from Clockwork. Sorry Andy.
count = List.Count(list=passThrough)
code_block_22 = CodeBlock { 0; }
gt = count > code_block_22
code_block_23 = CodeBlock(N=count) { ["Feito! Você inseriu "+N+" Tomadas em seu projeto"]; }
code_block_24 = CodeBlock { ["Nenhuma Tomada foi inserida"]; }
if_4 = If(test=gt, true=code_block_23, false=code_block_24)
flatten_2 = List.Flatten(list=if_4)
o_string_fromlist = Orchid.Common.String.FromList(list=flatten_2)
python_script = Python(IN[0]=o_string_fromlist)
# ---------- python_script.python (21 lines) ----------
# Importar as bibliotecas necessárias do Revit
import clr
clr.AddReference("RevitServices")
from RevitServices.Persistence import DocumentManager

clr.AddReference("RevitAPI")
clr.AddReference("RevitAPIUI")
from Autodesk.Revit.UI import TaskDialog

# Pegar a entrada do Dynamo
mensagem = IN[0]

# Criar a TaskDialog
task_dialog = TaskDialog("Ok")
task_dialog.MainInstruction = mensagem

# Exibir a TaskDialog
task_dialog.Show()

# Saída do script
OUT = "Sucesso!"
# ----------------------------------------
