# Dynamo graph 2021_05-0_BIMACON_Inserir Tomadas nos Espaços-LINK_R02_script.dyn "ok 2021_05-0_BIMACON_Inserir Tomadas nos Espaços-LINK_R02" (Dynamo 2.6.1.8786)
# packages: Orchid 206.6.0.5842, Data-Shapes 2022.2.105, Clockwork for Dynamo 2.x 2.4.0, Orchid 2.6.8.6198, archi-lab.net 2023.213.1722

sentido_horário = BoolSelector(true)

# group: ENTRADAS PARA O USUÁRIO
code_block = CodeBlock { "Inserção de Tomadas nos Espaços"; }
file_path = Filename("..\..\..\..\..\05 - BIMACON\01 - EMPRESA BIMACON\00 - Logos e imagens - BIMACON\ARTE BIMACON\reddonda-removebg-preview.png")
file_from_path = FileObject(path=file_path)
readFromFile = Image.ReadFromFile(file=file_from_path)
string = StringInput("Confirmar")
string_2 = StringInput("Selecione o link depois a porta (ou parede) para Inserir as Tomadas")
string_3 = StringInput("Selecione ")
boolean = BoolSelector(true)
selectlinkedelement_s_data = Custom[SelectLinkedElement(s) Data](InputName=string_2, ButtonText=string_3, SelectSingleElement=boolean)  # package Data-Shapes; Create a button input for UI.MultipleInputForm++ that allows to select elements in à linked document. See www.data-shapes.net for more infos!
string_4 = StringInput("Selecione o Espaço")
string_5 = StringInput("Selecione ")
categories = Categories("OST_MEPSpaces")
boolean_2 = BoolSelector(true)
selectmodelelements_data = Custom[SelectModelElements Data](InputName=string_4, ButtonText=string_5, CategoryFilter=categories, SelectSingleElement=boolean_2)  # package Data-Shapes; Creates a Revit element selection input for UI.MultipleInputForm++ . Check out www.data-shapes.net for more infos!
string_6 = StringInput("Quantidade de Tomadas")
string_7 = StringInput("4")
boolean_3 = BoolSelector(true)
textbox_data = Custom[TextBox Data](InputName=string_6, DefaultText=string_7, IsNumberEntry=boolean_3)  # package Data-Shapes; Create Data for TextBox input in UI.MultipleInputForm ++ . Check out www.data-shapes.net for more informations
string_8 = StringInput("Tipo de Tomada")
categories_2 = Categories("OST_ElectricalFixtures")
all_families_of_category = Custom[All Families Of Category](category=categories_2)  # package Clockwork for Dynamo 2.x; Gets all famiies of a given category in the model (does *not *work for system families)
name = Family.Name(family=all_families_of_category)
code_block_2 = CodeBlock { "Tomada"; }
contains = String.Contains(str=name, searchFor=code_block_2)
filterByBoolMask = List.FilterByBoolMask(list=all_families_of_category, mask=contains)
name_2 = Family.Name(family=filterByBoolMask.in)
code_block_3 = CodeBlock { "x."; }
contains_2 = String.Contains(str=name_2, searchFor=code_block_3)
filterByBoolMask_2 = List.FilterByBoolMask(list=filterByBoolMask.in, mask=contains_2)
types = Family.Types(family=filterByBoolMask_2.out)
flatten = List.Flatten(list=types)
family = FamilyType.Family(familyType=flatten)
name_3 = Family.Name(family=family)
code_block_4 = CodeBlock { "_"; }
split = String.Split(str=name_3, separator0=code_block_4)
code_block_5 = CodeBlock { 1; 2; }
getItemAtIndex = List.GetItemAtIndex(list=split@L2, index=code_block_5.out0)
getItemAtIndex_2 = List.GetItemAtIndex(list=split@L2, index=code_block_5.out1)
code_block_6 = CodeBlock(x=getItemAtIndex, y=getItemAtIndex_2) { x+" "+y; }
name_4 = FamilyType.Name(familyType=flatten)
code_block_7 = CodeBlock(a=code_block_6, b=name_4) { a; b; a+" : "+b; }
code_block_8 = CodeBlock { 0; }
dropdown_data = Custom[DropDown Data](InputName=string_8, Keys=code_block_7.out2, Values=flatten, DefaultValueIndex=code_block_8)  # package Data-Shapes; Create data for DropDown input in UI.MultiInputForm ++ . Check out www.data-shapes.net for more infos.
string_9 = StringInput("Distância do Eixo da Porta (Aprox. Larg. da Porta - 20cm)")
string_10 = StringInput("0.8")
boolean_4 = BoolSelector(true)
textbox_data_2 = Custom[TextBox Data](InputName=string_9, DefaultText=string_10, IsNumberEntry=boolean_4)
string_11 = StringInput("Elevação do Ponto")
string_12 = StringInput("1.2")
boolean_5 = BoolSelector(true)
textbox_data_3 = Custom[TextBox Data](InputName=string_11, DefaultText=string_12, IsNumberEntry=boolean_5)
list_create = List.Create(item0=selectlinkedelement_s_data, item1=selectmodelelements_data, item2=textbox_data, item3=dropdown_data, item4=textbox_data_2, item5=textbox_data_3)
boolean_6 = BoolSelector(true)
string_13 = StringInput("Cancelar")
number = DoubleInput(600)
number_2 = DoubleInput(205)
multipleinputform = Custom[MultipleInputForm ++](Description_optional=code_block, Logo_optional=readFromFile, ButtonText_optional=string, Inputs=list_create, Toggle=boolean_6, CancelButtonText_optional=string_13, Width_optional=number, LabelWidth_optional=number_2)  # package Data-Shapes; Create a form with multiple inputs. see www.data-shapes.net for tutorials and infos!
code_block_9 = CodeBlock()  # //archilab
code_block_10 = CodeBlock()  # //Data-Shapes

# group: Separar Entradas
code_block_11 = CodeBlock { 1; }
getItemAtIndex_3 = List.GetItemAtIndex(list=multipleinputform.User_Inputs, index=code_block_11)
code_block_12 = CodeBlock { 4; }
getItemAtIndex_4 = List.GetItemAtIndex(list=multipleinputform.User_Inputs, index=code_block_12)
code_block_13 = CodeBlock { 0; }
getItemAtIndex_5 = List.GetItemAtIndex(list=multipleinputform.User_Inputs, index=code_block_13)
code_block_14 = CodeBlock { 3; }
getItemAtIndex_6 = List.GetItemAtIndex(list=multipleinputform.User_Inputs, index=code_block_14)
code_block_15 = CodeBlock { 5; }
getItemAtIndex_7 = List.GetItemAtIndex(list=multipleinputform.User_Inputs, index=code_block_15)

boolean_7 = BoolSelector(true)
filterByBoolMask_3 = List.FilterByBoolMask(list=getItemAtIndex_3, mask=boolean_7)
finishBoundary = Space.FinishBoundary(space=filterByBoolMask_3.in)
byJoinedCurves = PolyCurve.ByJoinedCurves(curves=finishBoundary)
reverse = Curve.Reverse(curve=byJoinedCurves)
if_ = If(test=sentido_horário, true=reverse, false=byJoinedCurves)
length = Curve.Length(curve=if_)
getLocation = Element.GetLocation(element=getItemAtIndex_5)
closestPointTo = Geometry.ClosestPointTo(geometry=if_, other=getLocation)
parameterAtPoint = Curve.ParameterAtPoint(curve=if_, point=closestPointTo)
code_block_16 = CodeBlock(offset_1=getItemAtIndex_4, lenght_1=length, pap_1=parameterAtPoint) { par_1 = offset_1/lenght_1; par_2 = pap_1+par_1; pap_1; }
code_block_17 = CodeBlock { 2; }
getItemAtIndex_8 = List.GetItemAtIndex(list=multipleinputform.User_Inputs, index=code_block_17)
code_block_18 = CodeBlock(x=getItemAtIndex_8) { seq_1 = 0..1..#x+1; seq_2 = DSCore.List.RemoveItemAtIndex(seq_1, x); }
add = code_block_16.par_2 + code_block_18.seq_2  # lacing=Longest
code_block_19 = CodeBlock(x=add) { x>=1; x-1; x; }
if_2 = If(test=code_block_19.out0, true=code_block_19.out1, false=code_block_19.x)
pointAtParameter = Curve.PointAtParameter(curve=if_, param=if_2, lacing=Longest)
normalAtParameter = Curve.NormalAtParameter(curve=if_, param=if_2, lacing=Longest)
code_block_20 = CodeBlock { 1; }
byStartPointDirectionLength = Line.ByStartPointDirectionLength(startPoint=pointAtParameter, direction=normalAtParameter, length=code_block_20)
family_2 = FamilyType.Family(familyType=getItemAtIndex_6)
types_2 = Family.Types(family=family_2)
name_5 = FamilyType.Name(familyType=getItemAtIndex_6)
name_6 = FamilyType.Name(familyType=types_2)
eq = name_5 == name_6
filterByBoolMask_4 = List.FilterByBoolMask(list=types_2, mask=eq)
o_spatialelement_level = Orchid.RevitProject.Elements.SpatialElement.Level(spatialElement=getItemAtIndex_3)
byPointAndLevel = FamilyInstance.ByPointAndLevel(familyType=filterByBoolMask_4.in, point=pointAtParameter, level=o_spatialelement_level, lacing=Longest)
string_14 = StringInput("Elevação do nível")
number_3 = DoubleInput(0)
setParameterByName = Element.SetParameterByName(element=byPointAndLevel, parameterName=string_14, value=number_3, lacing=Longest)
string_15 = StringInput("Elevação do Ponto")
setParameterByName_2 = Element.SetParameterByName(element=setParameterByName, parameterName=string_15, value=getItemAtIndex_7, lacing=Longest)
reverse_2 = Vector.Reverse(vector=normalAtParameter)
if_3 = If(test=sentido_horário, true=normalAtParameter, false=reverse_2)
YAxis = Vector.YAxis()
ZAxis = Vector.ZAxis()
angleAboutAxis = Vector.AngleAboutAxis(vector=if_3, otherVector=YAxis, rotationAxis=ZAxis)
setRotation = FamilyInstance.SetRotation(familyInstance=setParameterByName_2, degree=angleAboutAxis)

# group: Mensagem final
passThrough = Custom[PassThrough](passThrough=setRotation, waitFor=setRotation)  # package archi-lab.net; Ripped this off from Clockwork. Sorry Andy.
count = List.Count(list=passThrough)
code_block_21 = CodeBlock { 0; }
gt = count > code_block_21
code_block_22 = CodeBlock { ["Feito! Deseja inverter o lado das Tomadas?"]; }
code_block_23 = CodeBlock { ["Nenhuma Tomada foi inserida"]; }
if_4 = If(test=gt, true=code_block_22, false=code_block_23)
flatten_2 = List.Flatten(list=if_4)
o_string_fromlist = Orchid.Common.String.FromList(list=flatten_2)

python_script = Python(IN[0]=o_string_fromlist)
# ---------- python_script.python (30 lines) ----------
# Importando as bibliotecas necessárias da API do Revit
import clr
clr.AddReference('RevitServices')  # Referência aos serviços do Revit
from RevitServices.Persistence import DocumentManager

clr.AddReference('RevitAPI')  # Referência à API do Revit
clr.AddReference('RevitAPIUI')  # Referência à API de Interface de Usuário do Revit

from Autodesk.Revit.UI import TaskDialog, TaskDialogCommonButtons, TaskDialogResult

# Recebe o texto de instrução como entrada do nó
instrucoes = IN[0]

# Criando o TaskDialog
dialog = TaskDialog("Aviso")
dialog.MainInstruction = instrucoes
dialog.CommonButtons = TaskDialogCommonButtons.Yes | TaskDialogCommonButtons.No | TaskDialogCommonButtons.Close

# Exibindo o dialog para o usuário e capturando a resposta
resultado = dialog.Show()

# Interpretando a resposta
if resultado == TaskDialogResult.No:
    OUT = "Não"
elif resultado == TaskDialogResult.Yes:
    OUT = "Sim"
elif resultado == TaskDialogResult.Cancel:
    OUT = "Fechar"
else:
    OUT = "Nenhuma ação"
# ----------------------------------------

# group: Inverter lado Interruptor
code_block_24 = CodeBlock { true; false; }
code_block_25 = CodeBlock(x=python_script, y=code_block_24.out0, z=code_block_24.out1)
# ---------- code_block_25.designscript (5 lines) ----------
//Condições IF, OR, AND
x;
y;
z;
x == "Sim" ? z : y;
# ----------------------------------------
watch = Watch(code_block_25.out3)
passThrough_2 = Custom[PassThrough](passThrough=setParameterByName_2, waitFor=code_block_25.out3)
delete = Element.Delete(element=passThrough_2)
passThrough_3 = Custom[PassThrough](passThrough=code_block_25.out3, waitFor=delete)

if_5 = If(test=passThrough_3, true=reverse, false=byJoinedCurves)
length_2 = Curve.Length(curve=if_5)
closestPointTo_2 = Geometry.ClosestPointTo(geometry=if_5, other=getLocation)
parameterAtPoint_2 = Curve.ParameterAtPoint(curve=if_5, point=closestPointTo_2)
code_block_26 = CodeBlock(offset_1=getItemAtIndex_4, lenght_1=length_2, pap_1=parameterAtPoint_2) { par_1 = offset_1/lenght_1; par_2 = pap_1+par_1; pap_1; }
code_block_27 = CodeBlock(x=getItemAtIndex_8) { seq_1 = 0..1..#x+1; seq_2 = DSCore.List.RemoveItemAtIndex(seq_1, x); }
add_2 = code_block_26.par_2 + code_block_27.seq_2  # lacing=Longest
code_block_28 = CodeBlock(x=add_2) { x>=1; x-1; x; }
if_6 = If(test=code_block_28.out0, true=code_block_28.out1, false=code_block_28.x)
pointAtParameter_2 = Curve.PointAtParameter(curve=if_5, param=if_6, lacing=Longest)
normalAtParameter_2 = Curve.NormalAtParameter(curve=if_5, param=if_6, lacing=Longest)
code_block_29 = CodeBlock { 1; }
byStartPointDirectionLength_2 = Line.ByStartPointDirectionLength(startPoint=pointAtParameter_2, direction=normalAtParameter_2, length=code_block_29)
o_spatialelement_level_2 = Orchid.RevitProject.Elements.SpatialElement.Level(spatialElement=getItemAtIndex_3)
byPointAndLevel_2 = FamilyInstance.ByPointAndLevel(familyType=filterByBoolMask_4.in, point=pointAtParameter_2, level=o_spatialelement_level_2, lacing=Longest)
string_16 = StringInput("Elevação do nível")
number_4 = DoubleInput(0)
setParameterByName_3 = Element.SetParameterByName(element=byPointAndLevel_2, parameterName=string_16, value=number_4, lacing=Longest)
string_17 = StringInput("Elevação do Ponto")
setParameterByName_4 = Element.SetParameterByName(element=setParameterByName_3, parameterName=string_17, value=getItemAtIndex_7, lacing=Longest)
reverse_3 = Vector.Reverse(vector=normalAtParameter_2)
if_7 = If(test=passThrough_3, true=normalAtParameter_2, false=reverse_3)
YAxis_2 = Vector.YAxis()
ZAxis_2 = Vector.ZAxis()
angleAboutAxis_2 = Vector.AngleAboutAxis(vector=if_7, otherVector=YAxis_2, rotationAxis=ZAxis_2)
setRotation_2 = FamilyInstance.SetRotation(familyInstance=setParameterByName_4, degree=angleAboutAxis_2)
