# Dynamo graph 05-1_BIMACON_Inserir Tomadas em Todos Espaços_R06_script.dyn "05-1_BIMACON_Inserir Tomadas em Todos Espaços_R05_script" (Dynamo 3.6.1.9895)
# Inserir Tomadas nos Ambientes através de arquivo LINKado
# packages: Data-Shapes 2022.2.105, archi-lab.net 2023.213.1722, DynamoIronPython2.7 3.2.1, Genius Loci 2023.2.21, MEPover 2022.10.30, Clockwork for Dynamo 2.x 2.4.0

boolean = BoolSelector(true)

# group: ENTRADAS PARA O USUÁRIO
code_block = CodeBlock { "Inserção de Tomadas em Todos Espaços"; }
string = StringInput("LogoBimacon.png")
python_script = Python(IN[0]=string)  # IronPython2
# ---------- python_script.python (22 lines) ----------
import clr

# Adiciona referência ao ambiente .NET
clr.AddReference('System')
from System import Environment, IO

# Nome da imagem (entrada do usuário)
nome_arquivo_imagem = IN[0]

# Recupera o nome do usuário logado no Windows
usuario = Environment.UserName

# Monta o caminho completo para a pasta de imagens
caminho_base = r"C:\Users\{0}\AppData\Roaming\pyRevit\Extensions\Bimacon.extension\Bimacon.tab\Imagens_Bimacon".format(usuario)

# Junta o caminho base com o nome do arquivo
caminho_completo = IO.Path.Combine(caminho_base, nome_arquivo_imagem)

# Verifica se o arquivo existe
existe = IO.File.Exists(caminho_completo)

OUT = caminho_completo if existe else "Imagem não encontrada: {0}".format(caminho_completo)
# ----------------------------------------
file_from_path = FileObject(path=python_script)
readFromFile = Image.ReadFromFile(file=file_from_path)
string_2 = StringInput("Confirmar")
code_block_2 = CodeBlock { "Selecione o link da Arquitetura"; }
get_alldocuments = Custom[Get AllDocuments]()  # package Genius Loci; Get documents (linked and opened in background). The first document is the active document.
current = Document.Current()
name = Python(IN[0]=current)  # "Document.Name"; IronPython2
# ---------- name.python (27 lines) ----------
# Carregar as bibliotecas DesignScript e padrão do Python
import sys
import clr
clr.AddReference('ProtoGeometry')
from Autodesk.DesignScript.Geometry import *

# Importando as bibliotecas necessárias
import clr

# Adicionando a referência ao Revit API e ao DocumentManager
clr.AddReference("RevitServices")
from RevitServices.Persistence import DocumentManager

clr.AddReference("RevitAPI")
from Autodesk.Revit.DB import Document

# Função para obter o nome do documento atual
def obter_nome_documento_atual():
    # Obtém o documento atual usando o DocumentManager
    doc_atual = DocumentManager.Instance.CurrentDBDocument
    if doc_atual is not None:
        return doc_atual.Title
    else:
        return "Nenhum documento ativo encontrado."

# Saída com o nome do documento atual
OUT = obter_nome_documento_atual()
# ----------------------------------------
eq = get_alldocuments.FileName == name
filterByBoolMask = List.FilterByBoolMask(list=get_alldocuments.FileName, mask=eq)
filterByBoolMask_2 = List.FilterByBoolMask(list=get_alldocuments.Document, mask=eq)
code_block_3 = CodeBlock { 0; }
dropdown_data = Custom[DropDown Data](InputName=code_block_2, Keys=filterByBoolMask.out, Values=filterByBoolMask_2.out, DefaultValueIndex=code_block_3)  # package Data-Shapes; Create data for DropDown input in UI.MultiInputForm ++ . Check out www.data-shapes.net for more infos.
string_3 = StringInput("Selecione o Nível")
categories = Categories("OST_Levels")
all_elements_of_category = ElementsOfCategory(Category=categories)
name_2 = Level.Name(level=all_elements_of_category)
boolean_2 = BoolSelector(false)
dropdown_data_2 = Custom[DropDown Data](InputName=string_3, Keys=name_2, Values=all_elements_of_category, DefaultValueIndex=code_block_3, Sorted_optional=boolean_2)
string_4 = StringInput("Quantidade de Tomadas")
string_5 = StringInput("4")
boolean_3 = BoolSelector(true)
textbox_data = Custom[TextBox Data](InputName=string_4, DefaultText=string_5, IsNumberEntry=boolean_3)  # package Data-Shapes; Create Data for TextBox input in UI.MultipleInputForm ++ . Check out www.data-shapes.net for more informations
string_6 = StringInput("Tipo de Tomada")
categories_2 = Categories("OST_ElectricalFixtures")
obter_famílias_de_uma_categoria = Python(IN[0]=categories_2)  # "Obter Famílias de Uma Categoria - BIMACON"; IronPython2
# ---------- obter_famílias_de_uma_categoria.python (119 lines) ----------
# -*- coding: utf-8 -*-

import clr
import System

# Revit API
clr.AddReference('RevitAPI')
from Autodesk.Revit.DB import *

# Revit Services
clr.AddReference('RevitServices')
from RevitServices.Persistence import DocumentManager

# Revit Nodes
clr.AddReference("RevitNodes")
import Revit
clr.ImportExtensions(Revit.Elements)

# Documento atual
doc = DocumentManager.Instance.CurrentDBDocument


# ==================================================
# FUNÇÃO PARA OBTER BuiltInCategory
# Compatível Revit 2021 até 2026
# ==================================================

def obter_builtincategory(entrada):

    # Caso já seja BuiltInCategory
    if isinstance(entrada, BuiltInCategory):
        return entrada

    # Caso seja inteiro
    if isinstance(entrada, int):
        try:
            return System.Enum.ToObject(BuiltInCategory, entrada)
        except:
            return None

    # Tenta converter Category
    try:

        # Unwrap se necessário
        entrada = UnwrapElement(entrada)

        # Se for Category
        if isinstance(entrada, Category):

            cat_id = entrada.Id

            # Compatível versões antigas e novas
            try:
                valor = cat_id.IntegerValue
            except:
                valor = cat_id.Value

            return System.Enum.ToObject(BuiltInCategory, valor)

    except:
        pass

    return None


# ==================================================
# ENTRADA
# ==================================================

entrada = IN[0]

bic = obter_builtincategory(entrada)

# ==================================================
# COLETA FAMÍLIAS
# ==================================================

familias_filtradas = []

if bic:

    familias = FilteredElementCollector(doc)\
        .OfClass(Family)\
        .ToElements()

    for fam in familias:

        try:

            cat = fam.FamilyCategory

            if cat is None:
                continue

            cat_id = cat.Id

            # Compatibilidade 2021 → 2026
            try:
                valor_categoria = cat_id.IntegerValue
            except:
                valor_categoria = cat_id.Value

            bic_familia = System.Enum.ToObject(
                BuiltInCategory,
                valor_categoria
            )

            if bic_familia == bic:
                familias_filtradas.append(fam)

        except:
            continue


# ==================================================
# SAÍDA
# ==================================================

OUT = familias_filtradas
# ----------------------------------------
name_3 = Family.Name(family=obter_famílias_de_uma_categoria)
code_block_4 = CodeBlock { "Tomada"; }
contains = String.Contains(string=name_3, searchFor=code_block_4)
filterByBoolMask_3 = List.FilterByBoolMask(list=obter_famílias_de_uma_categoria, mask=contains)
name_4 = Family.Name(family=filterByBoolMask_3.in)
code_block_5 = CodeBlock { "x."; }
contains_2 = String.Contains(string=name_4, searchFor=code_block_5)
filterByBoolMask_4 = List.FilterByBoolMask(list=filterByBoolMask_3.in, mask=contains_2)
types = Family.Types(family=filterByBoolMask_4.out)
flatten = List.Flatten(list=types)
family = FamilyType.Family(familyType=flatten)
name_5 = Family.Name(family=family)
sortByKey = List.SortByKey(list=flatten, keys=name_5)
code_block_6 = CodeBlock { "_"; }
split = String.Split(string=sortByKey.sortedKeys, separator0=code_block_6)
code_block_7 = CodeBlock { 1; 2; }
getItemAtIndex = List.GetItemAtIndex(list=split@L2, index=code_block_7.out0)
getItemAtIndex_2 = List.GetItemAtIndex(list=split@L2, index=code_block_7.out1)
code_block_8 = CodeBlock(x=getItemAtIndex, y=getItemAtIndex_2) { x+" "+y; }
name_6 = FamilyType.Name(familyType=sortByKey.sortedList)
code_block_9 = CodeBlock(a=code_block_8, b=name_6) { a; b; a+" : "+b; }
code_block_10 = CodeBlock { 0; }
boolean_4 = BoolSelector(false)
dropdown_data_3 = Custom[DropDown Data](InputName=string_6, Keys=code_block_9.out2, Values=sortByKey.sortedList, DefaultValueIndex=code_block_10, Sorted_optional=boolean_4)
string_7 = StringInput("Distância do Eixo da Porta (Aprox. Larg. da Porta - 25cm)")
string_8 = StringInput("0.55")
boolean_5 = BoolSelector(true)
textbox_data_2 = Custom[TextBox Data](InputName=string_7, DefaultText=string_8, IsNumberEntry=boolean_5)
string_9 = StringInput("Elevação do Ponto")
string_10 = StringInput("1.2")
boolean_6 = BoolSelector(true)
textbox_data_3 = Custom[TextBox Data](InputName=string_9, DefaultText=string_10, IsNumberEntry=boolean_6)
list_create = List.Create(item0=dropdown_data, item1=dropdown_data_2, item2=textbox_data, item3=dropdown_data_3, item4=textbox_data_2, item5=textbox_data_3)
boolean_7 = BoolSelector(true)
string_11 = StringInput("Cancelar")
number = DoubleInput(600)
number_2 = DoubleInput(205)
multipleinputform = Custom[MultipleInputForm ++](Description_optional=code_block, Logo_optional=readFromFile, ButtonText_optional=string_2, Inputs=list_create, Toggle=boolean_7, CancelButtonText_optional=string_11, Width_optional=number, LabelWidth_optional=number_2)  # package Data-Shapes; Create a form with multiple inputs. see www.data-shapes.net for tutorials and infos!
code_block_11 = CodeBlock()  # //Data-Shapes
code_block_12 = CodeBlock()  # //archilab

# group: Separar Entradas
code_block_13 = CodeBlock { 1; }
getItemAtIndex_3 = List.GetItemAtIndex(list=multipleinputform.User_Inputs, index=code_block_13)
code_block_14 = CodeBlock { 4; }
getItemAtIndex_4 = List.GetItemAtIndex(list=multipleinputform.User_Inputs, index=code_block_14)
code_block_15 = CodeBlock { 0; }
getItemAtIndex_5 = List.GetItemAtIndex(list=multipleinputform.User_Inputs, index=code_block_15)
code_block_16 = CodeBlock { 2; }
getItemAtIndex_6 = List.GetItemAtIndex(list=multipleinputform.User_Inputs, index=code_block_16)
code_block_17 = CodeBlock { 3; }
getItemAtIndex_7 = List.GetItemAtIndex(list=multipleinputform.User_Inputs, index=code_block_17)
code_block_18 = CodeBlock { 5; }
getItemAtIndex_8 = List.GetItemAtIndex(list=multipleinputform.User_Inputs, index=code_block_18)

# group: Espaços no Nível
categories_3 = Categories("OST_MEPSpaces")
all_elements_of_category_2 = ElementsOfCategory(Category=categories_3)
name_7 = Space.Name(space=all_elements_of_category_2)
code_block_19 = CodeBlock { ["Claraboia","Clarabóia","Escada","Escadas","Elevador"]; }
string_contains_varias_palavras = Python(IN[0]=name_7, IN[1]=code_block_19)  # IronPython2
# ---------- string_contains_varias_palavras.python (14 lines) ----------
# Entrada IN[0]: lista de nomes dos espaços
# Entrada IN[1]: lista de palavras-chave a remover

names = IN[0]
terms = IN[1]

outList = []

for name in names:
    # Verifica se qualquer termo está contido no nome (ignora maiúsculas/minúsculas)
    found = any(term.lower() in name.lower() for term in terms)
    outList.append(not found)  # True se NÃO contiver, ou seja, deve ser mantido

OUT = outList
# ----------------------------------------
filterByBoolMask_5 = List.FilterByBoolMask(list=all_elements_of_category_2, mask=string_contains_varias_palavras)
code_block_20 = CodeBlock { "Nível"; }
getParameterValueByName = Element.GetParameterValueByName(element=filterByBoolMask_5.in, parameterName=code_block_20)
name_8 = Level.Name(level=getItemAtIndex_3)
eq_2 = getParameterValueByName == name_8
filterByBoolMask_6 = List.FilterByBoolMask(list=filterByBoolMask_5.in, mask=eq_2)

finishBoundary = Space.FinishBoundary(space=filterByBoolMask_6.in)
byJoinedCurves = PolyCurve.ByJoinedCurves(curves=finishBoundary)
reverse = Curve.Reverse(curve=byJoinedCurves)
if_ = If(test=boolean, true=reverse, false=byJoinedCurves)
length = Curve.Length(curve=if_)
length_2 = String.Length(string=name_8)
number_3 = DoubleInput(6)
sub = length_2 - number_3
remove = String.Remove(string=name_8, startIndex=sub, count=number_3)

# group: Portas
categories_4 = Categories("OST_Doors")
get_all_elements_from_linked = Custom[Get All Elements From Linked Model](linkDoc=getItemAtIndex_5, category=categories_4)  # package archi-lab.net; This node is based on code posted by Julien Benoit. Big thanks to Julien for sharing his work. This node will retrieve all elements of a given category from a given linked model.
name_9 = Element.Name(element=get_all_elements_from_linked)
string_12 = StringInput("Soleira")
contains_3 = String.Contains(string=name_9, searchFor=string_12)
filterByBoolMask_7 = List.FilterByBoolMask(list=get_all_elements_from_linked, mask=contains_3)
flatten_2 = List.Flatten(list=filterByBoolMask_7.out)
code_block_21 = CodeBlock { "Nível"; }
getParameterAsValueString = Custom[GetParameterAsValueString](Elements=flatten_2, ParameterName=code_block_21)  # package MEPover; Returns the parameter values without conversion to the revit internal unit system. The suffix boolean toggles the project units on or off
boolean_8 = BoolSelector(true)
contains_4 = String.Contains(string=getParameterAsValueString, searchFor=remove, ignoreCase=boolean_8)
filterByBoolMask_8 = List.FilterByBoolMask(list=flatten_2, mask=contains_4)
phases = Custom[Element.Phases](element=filterByBoolMask_8.in)  # package Clockwork for Dynamo 2.x; Gets the created and demolished phases of an element
name_10 = Element.Name(element=phases.Created)
code_block_22 = CodeBlock { ["New Construction","Nova Construcão","Nova Construção","Construção nova"]; }
string_contains_varias_palavras_2 = Python(IN[0]=name_10, IN[1]=code_block_22)  # IronPython2; same code as string_contains_varias_palavras
filterByBoolMask_9 = List.FilterByBoolMask(list=filterByBoolMask_8.in, mask=string_contains_varias_palavras_2)
getLocation = Element.GetLocation(element=filterByBoolMask_9.out)

closestPointTo = Geometry.ClosestPointTo(geometry=if_, other=getLocation@L2)
parameterAtPoint = Curve.ParameterAtPoint(curve=if_, point=closestPointTo, lacing=Longest)
code_block_23 = CodeBlock(offset_1=getItemAtIndex_4, lenght_1=length, pap_1=parameterAtPoint) { par_1 = offset_1/lenght_1; par_2 = pap_1+par_1; pap_1; }
flatten_3 = List.Flatten(list=code_block_23.par_2@L2)
code_block_24 = CodeBlock(x=getItemAtIndex_6) { seq_1 = 0..1..#x+1; seq_2 = DSCore.List.RemoveItemAtIndex(seq_1, x); }
add = flatten_3 + code_block_24.seq_2  # lacing=CrossProduct
code_block_25 = CodeBlock(x=add) { x>=1; x-1; x; }
if_2 = If(test=code_block_25.out0, true=code_block_25.out1, false=code_block_25.x)
pointAtParameter = Curve.PointAtParameter(curve=if_@L1, param=if_2@L3)
normalAtParameter = Curve.NormalAtParameter(curve=if_@L1, param=if_2@L3)
code_block_26 = CodeBlock { 1; }
byStartPointDirectionLength = Line.ByStartPointDirectionLength(startPoint=pointAtParameter@L3, direction=normalAtParameter, length=code_block_26)
byPointAndLevel = FamilyInstance.ByPointAndLevel(familyType=getItemAtIndex_7, point=pointAtParameter, level=getItemAtIndex_3, lacing=Longest)
string_13 = StringInput("Elevação do nível")
number_4 = DoubleInput(0)
setParameterByName = Element.SetParameterByName(element=byPointAndLevel, parameterName=string_13, value=number_4, lacing=Longest)
string_14 = StringInput("Elevação do Ponto")
setParameterByName_2 = Element.SetParameterByName(element=setParameterByName, parameterName=string_14, value=getItemAtIndex_8, lacing=Longest)
reverse_2 = Vector.Reverse(vector=normalAtParameter)
if_3 = If(test=boolean, true=normalAtParameter, false=reverse_2)
YAxis = Vector.YAxis()
ZAxis = Vector.ZAxis()
angleAboutAxis = Vector.AngleAboutAxis(vector=if_3, otherVector=YAxis, rotationAxis=ZAxis)
setRotation = FamilyInstance.SetRotation(familyInstance=setParameterByName_2, degree=angleAboutAxis)
end = Revit.Transaction.Transaction.End(input=setRotation)
start = Revit.Transaction.Transaction.Start(input=end)
flatten_4 = List.Flatten(list=start)
isNull = Object.IsNull(object=flatten_4)
code_block_27 = CodeBlock { 0; }
count = List.Count(list=flatten_4)
code_block_28 = CodeBlock(x=isNull, y=code_block_27, z=count)
# ---------- code_block_28.designscript (5 lines) ----------
//Condições se ou e
x;
y;
z;
x == true ? y : z;
# ----------------------------------------
passThrough = Custom[PassThrough](passThrough=code_block_28.out3, waitFor=start)  # package archi-lab.net; Ripped this off from Clockwork. Sorry Andy.
firstItem = List.FirstItem(list=passThrough)
code_block_29 = CodeBlock { 0; }
gt = firstItem > code_block_29
code_block_30 = CodeBlock(N=firstItem) { ["Feito! Você inseriu "+N+" Tomadas em seu projeto. Deseja inverter o lado das Tomadas?"]; }
code_block_31 = CodeBlock { ["Nenhuma Tomada foi inserida"]; }
if_4 = If(test=gt, true=code_block_30, false=code_block_31)
flatten_5 = List.Flatten(list=if_4)
fromList = Python(IN[0]=flatten_5)  # "String.FromList"; IronPython2
# ---------- fromList.python (22 lines) ----------
# Carregar as bibliotecas DesignScript e padrão do Python
import sys
import clr
clr.AddReference('ProtoGeometry')
from Autodesk.DesignScript.Geometry import *

# Função para concatenar os valores de uma lista em uma única string com múltiplas linhas
def concatenate_list_to_string(input_list, delimiter="\n"):
    # Verifica se a entrada é uma lista
    if not isinstance(input_list, list):
        return "A entrada deve ser uma lista."
    
    # Converte todos os elementos para string e junta com o delimitador especificado
    result = delimiter.join(str(item) for item in input_list)
    return result

# Entrada pelo nó do Dynamo
lista = IN[0]  # Lista de valores a serem concatenados
delimitador = IN[1] if len(IN) > 1 else "\n"  # Delimitador opcional, padrão é nova linha

# Saída para o Dynamo
OUT = concatenate_list_to_string(lista, delimitador)
# ----------------------------------------
python_script_2 = Python(IN[0]=fromList)  # IronPython2
# ---------- python_script_2.python (30 lines) ----------
# Importando as bibliotecas necessárias da API do Revit
import clr
clr.AddReference('RevitServices')  # Referência aos serviços do Revit
from RevitServices.Persistence import DocumentManager

clr.AddReference('RevitAPI')  # Referência à API do Revit
clr.AddReference('RevitAPIUI')  # Referência à API de Interface de Usuário do Revit

from Autodesk.Revit.UI import TaskDialog, TaskDialogCommonButtons, TaskDialogResult

# Recebe o texto de instrução como entrada do nó
instrucoes = IN[0]

# Criando o TaskDialog
dialog = TaskDialog("Aviso")
dialog.MainInstruction = instrucoes
dialog.CommonButtons = TaskDialogCommonButtons.Yes | TaskDialogCommonButtons.No | TaskDialogCommonButtons.Close

# Exibindo o dialog para o usuário e capturando a resposta
resultado = dialog.Show()

# Interpretando a resposta
if resultado == TaskDialogResult.No:
    OUT = "Não"
elif resultado == TaskDialogResult.Yes:
    OUT = "Sim"
elif resultado == TaskDialogResult.Cancel:
    OUT = "Fechar"
else:
    OUT = "Nenhuma ação"
# ----------------------------------------
flatten_6 = List.Flatten(list=setParameterByName_2)

# group: Inverter lado Interruptor
code_block_32 = CodeBlock { true; false; }
code_block_33 = CodeBlock(x=python_script_2, y=code_block_32.out0, z=code_block_32.out1)
# ---------- code_block_33.designscript (5 lines) ----------
//Condições IF, OR, AND
x;
y;
z;
x == "Sim" ? z : y;
# ----------------------------------------
watch = Watch(code_block_33.out3)
passThrough_2 = Custom[PassThrough](passThrough=flatten_6, waitFor=code_block_33.out3)
delete = Element.Delete(element=passThrough_2)
passThrough_3 = Custom[PassThrough](passThrough=code_block_33.out3, waitFor=delete)

if_5 = If(test=passThrough_3, true=reverse, false=byJoinedCurves)
length_3 = Curve.Length(curve=if_5)
closestPointTo_2 = Geometry.ClosestPointTo(geometry=if_5, other=getLocation@L2)
parameterAtPoint_2 = Curve.ParameterAtPoint(curve=if_5, point=closestPointTo_2, lacing=Longest)
code_block_34 = CodeBlock(offset_1=getItemAtIndex_4, lenght_1=length_3, pap_1=parameterAtPoint_2) { par_1 = offset_1/lenght_1; par_2 = pap_1+par_1; pap_1; }
flatten_7 = List.Flatten(list=code_block_34.par_2@L2)
code_block_35 = CodeBlock(x=getItemAtIndex_6) { seq_1 = 0..1..#x+1; seq_2 = DSCore.List.RemoveItemAtIndex(seq_1, x); }
add_2 = flatten_7 + code_block_35.seq_2  # lacing=CrossProduct
code_block_36 = CodeBlock(x=add_2) { x>=1; x-1; x; }
if_6 = If(test=code_block_36.out0, true=code_block_36.out1, false=code_block_36.x)
pointAtParameter_2 = Curve.PointAtParameter(curve=if_5@L1, param=if_6@L3)
normalAtParameter_2 = Curve.NormalAtParameter(curve=if_5@L1, param=if_6@L3)
code_block_37 = CodeBlock { 1; }
byStartPointDirectionLength_2 = Line.ByStartPointDirectionLength(startPoint=pointAtParameter_2@L3, direction=normalAtParameter_2, length=code_block_37)
byPointAndLevel_2 = FamilyInstance.ByPointAndLevel(familyType=getItemAtIndex_7, point=pointAtParameter_2, level=getItemAtIndex_3, lacing=Longest)
string_15 = StringInput("Elevação do nível")
number_5 = DoubleInput(0)
setParameterByName_3 = Element.SetParameterByName(element=byPointAndLevel_2, parameterName=string_15, value=number_5, lacing=Longest)
string_16 = StringInput("Elevação do Ponto")
setParameterByName_4 = Element.SetParameterByName(element=setParameterByName_3, parameterName=string_16, value=getItemAtIndex_8, lacing=Longest)
reverse_3 = Vector.Reverse(vector=normalAtParameter_2)
if_7 = If(test=passThrough_3, true=normalAtParameter_2, false=reverse_3)
YAxis_2 = Vector.YAxis()
ZAxis_2 = Vector.ZAxis()
angleAboutAxis_2 = Vector.AngleAboutAxis(vector=if_7, otherVector=YAxis_2, rotationAxis=ZAxis_2)
setRotation_2 = FamilyInstance.SetRotation(familyInstance=setParameterByName_4, degree=angleAboutAxis_2)
uniqueItems = List.UniqueItems(list=passThrough)
watch_2 = Watch(code_block_23.par_2)
flatten_8 = List.Flatten(list=angleAboutAxis@L2)
