# Dynamo graph ok 2021_05-1_BIMACON_Inserir Tomadas em Todos Espaços_R04_script.dyn (Dynamo 2.6.1.8786)
# Inserir Tomadas nos Ambientes através de arquivo LINKado
# packages: Data-Shapes 2022.2.105, Clockwork for Dynamo 2.x 2.4.0, archi-lab.net 2023.213.1722, Genius Loci 2023.2.21

boolean = BoolSelector(true)

# group: ENTRADAS PARA O USUÁRIO
code_block = CodeBlock { "Inserção de Tomadas em Todos Espaços"; }
file_path = Filename("..\..\..\..\..\05 - BIMACON\01 - EMPRESA BIMACON\00 - Logos e imagens - BIMACON\ARTE BIMACON\reddonda-removebg-preview.png")
file_from_path = FileObject(path=file_path)
readFromFile = Image.ReadFromFile(file=file_from_path)
string = StringInput("Confirmar")
code_block_2 = CodeBlock { "Selecione o link da Arquitetura"; }
get_alldocuments = Custom[Get AllDocuments]()  # package Genius Loci; Get documents (linked and opened in background). The first document is the active document.
current = Document.Current()
code_block_3 = CodeBlock { 0; }
string_2 = StringInput("Selecione o Nível")
categories = Categories("OST_Levels")
all_elements_of_category = ElementsOfCategory(Category=categories)
name = Level.Name(level=all_elements_of_category)
dropdown_data = Custom[DropDown Data](InputName=string_2, Keys=name, Values=all_elements_of_category, DefaultValueIndex=code_block_3)  # package Data-Shapes; Create data for DropDown input in UI.MultiInputForm ++ . Check out www.data-shapes.net for more infos.
string_3 = StringInput("Quantidade de Tomadas")
string_4 = StringInput("4")
boolean_2 = BoolSelector(true)
textbox_data = Custom[TextBox Data](InputName=string_3, DefaultText=string_4, IsNumberEntry=boolean_2)  # package Data-Shapes; Create Data for TextBox input in UI.MultipleInputForm ++ . Check out www.data-shapes.net for more informations
string_5 = StringInput("Tipo de Tomada")
categories_2 = Categories("OST_ElectricalFixtures")
all_families_of_category = Custom[All Families Of Category](category=categories_2)  # package Clockwork for Dynamo 2.x; Gets all famiies of a given category in the model (does *not *work for system families)
name_2 = Family.Name(family=all_families_of_category)
code_block_4 = CodeBlock { "Tomada"; }
contains = String.Contains(str=name_2, searchFor=code_block_4)
filterByBoolMask = List.FilterByBoolMask(list=all_families_of_category, mask=contains)
name_3 = Family.Name(family=filterByBoolMask.in)
code_block_5 = CodeBlock { "x."; }
contains_2 = String.Contains(str=name_3, searchFor=code_block_5)
filterByBoolMask_2 = List.FilterByBoolMask(list=filterByBoolMask.in, mask=contains_2)
types = Family.Types(family=filterByBoolMask_2.out)
flatten = List.Flatten(list=types)
family = FamilyType.Family(familyType=flatten)
name_4 = Family.Name(family=family)
code_block_6 = CodeBlock { "_"; }
split = String.Split(str=name_4, separator0=code_block_6)
code_block_7 = CodeBlock { 1; 2; }
getItemAtIndex = List.GetItemAtIndex(list=split@L2, index=code_block_7.out0)
getItemAtIndex_2 = List.GetItemAtIndex(list=split@L2, index=code_block_7.out1)
code_block_8 = CodeBlock(x=getItemAtIndex, y=getItemAtIndex_2) { x+" "+y; }
name_5 = FamilyType.Name(familyType=flatten)
code_block_9 = CodeBlock(a=code_block_8, b=name_5) { a; b; a+" : "+b; }
code_block_10 = CodeBlock { 0; }
dropdown_data_2 = Custom[DropDown Data](InputName=string_5, Keys=code_block_9.out2, Values=flatten, DefaultValueIndex=code_block_10)
string_6 = StringInput("Distância do Eixo da Porta (Aprox. Larg. da Porta - 20cm)")
string_7 = StringInput("0.8")
boolean_3 = BoolSelector(true)
textbox_data_2 = Custom[TextBox Data](InputName=string_6, DefaultText=string_7, IsNumberEntry=boolean_3)
string_8 = StringInput("Elevação do Ponto")
string_9 = StringInput("1.2")
boolean_4 = BoolSelector(true)
textbox_data_3 = Custom[TextBox Data](InputName=string_8, DefaultText=string_9, IsNumberEntry=boolean_4)
boolean_5 = BoolSelector(true)
string_10 = StringInput("Cancelar")
number = DoubleInput(600)
number_2 = DoubleInput(205)
code_block_11 = CodeBlock()  # //Data-Shapes
code_block_12 = CodeBlock()  # //archilab

name_6 = Python(IN[0]=current)  # "Document.Name"
# ---------- name_6.python (27 lines) ----------
# Carregar as bibliotecas DesignScript e padrão do Python
import sys
import clr
clr.AddReference('ProtoGeometry')
from Autodesk.DesignScript.Geometry import *

# Importando as bibliotecas necessárias
import clr

# Adicionando a referência ao Revit API e ao DocumentManager
clr.AddReference("RevitServices")
from RevitServices.Persistence import DocumentManager

clr.AddReference("RevitAPI")
from Autodesk.Revit.DB import Document

# Função para obter o nome do documento atual
def obter_nome_documento_atual():
    # Obtém o documento atual usando o DocumentManager
    doc_atual = DocumentManager.Instance.CurrentDBDocument
    if doc_atual is not None:
        return doc_atual.Title
    else:
        return "Nenhum documento ativo encontrado."

# Saída com o nome do documento atual
OUT = obter_nome_documento_atual()
# ----------------------------------------

# group (continued): ENTRADAS PARA O USUÁRIO
eq = get_alldocuments.FileName == name_6
filterByBoolMask_3 = List.FilterByBoolMask(list=get_alldocuments.FileName, mask=eq)
filterByBoolMask_4 = List.FilterByBoolMask(list=get_alldocuments.Document, mask=eq)
dropdown_data_3 = Custom[DropDown Data](InputName=code_block_2, Keys=filterByBoolMask_3.out, Values=filterByBoolMask_4.out, DefaultValueIndex=code_block_3)
list_create = List.Create(item0=dropdown_data_3, item1=dropdown_data, item2=textbox_data, item3=dropdown_data_2, item4=textbox_data_2, item5=textbox_data_3)
multipleinputform = Custom[MultipleInputForm ++](Description_optional=code_block, Logo_optional=readFromFile, ButtonText_optional=string, Inputs=list_create, Toggle=boolean_5, CancelButtonText_optional=string_10, Width_optional=number, LabelWidth_optional=number_2)  # package Data-Shapes; Create a form with multiple inputs. see www.data-shapes.net for tutorials and infos!

# group: Separar Entradas
code_block_13 = CodeBlock { 1; }
getItemAtIndex_3 = List.GetItemAtIndex(list=multipleinputform.User_Inputs, index=code_block_13)
code_block_14 = CodeBlock { 4; }
getItemAtIndex_4 = List.GetItemAtIndex(list=multipleinputform.User_Inputs, index=code_block_14)
code_block_15 = CodeBlock { 0; }
getItemAtIndex_5 = List.GetItemAtIndex(list=multipleinputform.User_Inputs, index=code_block_15)
code_block_16 = CodeBlock { 3; }
getItemAtIndex_6 = List.GetItemAtIndex(list=multipleinputform.User_Inputs, index=code_block_16)
code_block_17 = CodeBlock { 5; }
getItemAtIndex_7 = List.GetItemAtIndex(list=multipleinputform.User_Inputs, index=code_block_17)

# group: Espaços no Nível
categories_3 = Categories("OST_MEPSpaces")
all_elements_of_category_2 = ElementsOfCategory(Category=categories_3)
code_block_18 = CodeBlock { "Nível"; }
getParameterValueByName = Element.GetParameterValueByName(element=all_elements_of_category_2, parameterName=code_block_18)
name_7 = Level.Name(level=getItemAtIndex_3)
eq_2 = getParameterValueByName == name_7
filterByBoolMask_5 = List.FilterByBoolMask(list=all_elements_of_category_2, mask=eq_2)

finishBoundary = Space.FinishBoundary(space=filterByBoolMask_5.in)
byJoinedCurves = PolyCurve.ByJoinedCurves(curves=finishBoundary@L1, lacing=CrossProduct)
code_block_19 = CodeBlock { 1; }
chop = List.Chop(list=byJoinedCurves, lengths=code_block_19)
reverse = Curve.Reverse(curve=chop)
if_ = If(test=boolean, true=reverse, false=chop)
length = Curve.Length(curve=if_)
categories_4 = Categories("OST_Doors")
get_all_elements_from_linked = Custom[Get All Elements From Linked Model](linkDoc=getItemAtIndex_5, category=categories_4)  # package archi-lab.net; This node is based on code posted by Julien Benoit. Big thanks to Julien for sharing his work. This node will retrieve all elements of a given category from a given linked model.
all_elements_of_category_3 = ElementsOfCategory(Category=categories_4)
subComponents = archilab.Revit.Elements.Elements.SubComponents(element=all_elements_of_category_3)
contains_3 = List.Contains(list=subComponents, item=all_elements_of_category_3@L1)
filterByBoolMask_6 = List.FilterByBoolMask(list=all_elements_of_category_3, mask=contains_3)
list_create_2 = List.Create(item0=get_all_elements_from_linked, item1=filterByBoolMask_6.out)
flatten_2 = List.Flatten(list=list_create_2)
getLocation = Element.GetLocation(element=flatten_2)
closestPointTo = Geometry.ClosestPointTo(geometry=if_, other=getLocation@L2)
parameterAtPoint = Curve.ParameterAtPoint(curve=if_, point=closestPointTo)
code_block_20 = CodeBlock(offset_1=getItemAtIndex_4, lenght_1=length, pap_1=parameterAtPoint) { par_1 = offset_1/lenght_1; par_2 = pap_1+par_1; pap_1; }
code_block_21 = CodeBlock { 2; }
getItemAtIndex_8 = List.GetItemAtIndex(list=multipleinputform.User_Inputs, index=code_block_21)
code_block_22 = CodeBlock(x=getItemAtIndex_8) { seq_1 = 0..1..#x+1; seq_2 = DSCore.List.RemoveItemAtIndex(seq_1, x); }
add = code_block_20.par_2 + code_block_22.seq_2  # lacing=Longest
code_block_23 = CodeBlock(x=add) { x>=1; x-1; x; }
if_2 = If(test=code_block_23.out0, true=code_block_23.out1, false=code_block_23.x)
pointAtParameter = Curve.PointAtParameter(curve=if_, param=if_2, lacing=Longest)
normalAtParameter = Curve.NormalAtParameter(curve=if_, param=if_2, lacing=Longest)
code_block_24 = CodeBlock { 1; }
byStartPointDirectionLength = Line.ByStartPointDirectionLength(startPoint=pointAtParameter, direction=normalAtParameter, length=code_block_24)

# group: Family Types
family_2 = FamilyType.Family(familyType=getItemAtIndex_6)
types_2 = Family.Types(family=family_2)
name_8 = FamilyType.Name(familyType=getItemAtIndex_6)
name_9 = FamilyType.Name(familyType=types_2)
eq_3 = name_8 == name_9
filterByBoolMask_7 = List.FilterByBoolMask(list=types_2, mask=eq_3)

byPointAndLevel = FamilyInstance.ByPointAndLevel(familyType=filterByBoolMask_7.in, point=pointAtParameter, level=getItemAtIndex_3, lacing=Longest)
string_11 = StringInput("Elevação do nível")
number_3 = DoubleInput(0)
setParameterByName = Element.SetParameterByName(element=byPointAndLevel, parameterName=string_11, value=number_3, lacing=Longest)
string_12 = StringInput("Elevação do Ponto")
setParameterByName_2 = Element.SetParameterByName(element=setParameterByName, parameterName=string_12, value=getItemAtIndex_7, lacing=Longest)
reverse_2 = Vector.Reverse(vector=normalAtParameter)
if_3 = If(test=boolean, true=normalAtParameter, false=reverse_2)
YAxis = Vector.YAxis()
ZAxis = Vector.ZAxis()
angleAboutAxis = Vector.AngleAboutAxis(vector=if_3, otherVector=YAxis, rotationAxis=ZAxis)
setRotation = FamilyInstance.SetRotation(familyInstance=setParameterByName_2, degree=angleAboutAxis)
flatten_3 = List.Flatten(list=setRotation)
isNull = Object.IsNull(obj=flatten_3)
code_block_25 = CodeBlock { 0; }
count = List.Count(list=flatten_3)
code_block_26 = CodeBlock(x=isNull, y=code_block_25, z=count)
# ---------- code_block_26.designscript (5 lines) ----------
//Condições se ou e
x;
y;
z;
x == true ? y : z;
# ----------------------------------------
passThrough = Custom[PassThrough](passThrough=code_block_26.out3, waitFor=setRotation)  # package archi-lab.net; Ripped this off from Clockwork. Sorry Andy.
firstItem = List.FirstItem(list=passThrough)
code_block_27 = CodeBlock { 0; }
gt = firstItem > code_block_27
code_block_28 = CodeBlock(N=firstItem) { ["Feito! Você inseriu "+N+" Tomadas em seu projeto. Deseja inverter o lado das Tomadas?"]; }
code_block_29 = CodeBlock { ["Nenhuma Tomada foi inserida"]; }
if_4 = If(test=gt, true=code_block_28, false=code_block_29)
flatten_4 = List.Flatten(list=if_4)
fromList = Python(IN[0]=flatten_4)  # "String.FromList"
# ---------- fromList.python (22 lines) ----------
# Carregar as bibliotecas DesignScript e padrão do Python
import sys
import clr
clr.AddReference('ProtoGeometry')
from Autodesk.DesignScript.Geometry import *

# Função para concatenar os valores de uma lista em uma única string com múltiplas linhas
def concatenate_list_to_string(input_list, delimiter="\n"):
    # Verifica se a entrada é uma lista
    if not isinstance(input_list, list):
        return "A entrada deve ser uma lista."
    
    # Converte todos os elementos para string e junta com o delimitador especificado
    result = delimiter.join(str(item) for item in input_list)
    return result

# Entrada pelo nó do Dynamo
lista = IN[0]  # Lista de valores a serem concatenados
delimitador = IN[1] if len(IN) > 1 else "\n"  # Delimitador opcional, padrão é nova linha

# Saída para o Dynamo
OUT = concatenate_list_to_string(lista, delimitador)
# ----------------------------------------
python_script = Python(IN[0]=fromList)
# ---------- python_script.python (30 lines) ----------
# Importando as bibliotecas necessárias da API do Revit
import clr
clr.AddReference('RevitServices')  # Referência aos serviços do Revit
from RevitServices.Persistence import DocumentManager

clr.AddReference('RevitAPI')  # Referência à API do Revit
clr.AddReference('RevitAPIUI')  # Referência à API de Interface de Usuário do Revit

from Autodesk.Revit.UI import TaskDialog, TaskDialogCommonButtons, TaskDialogResult

# Recebe o texto de instrução como entrada do nó
instrucoes = IN[0]

# Criando o TaskDialog
dialog = TaskDialog("Aviso")
dialog.MainInstruction = instrucoes
dialog.CommonButtons = TaskDialogCommonButtons.Yes | TaskDialogCommonButtons.No | TaskDialogCommonButtons.Close

# Exibindo o dialog para o usuário e capturando a resposta
resultado = dialog.Show()

# Interpretando a resposta
if resultado == TaskDialogResult.No:
    OUT = "Não"
elif resultado == TaskDialogResult.Yes:
    OUT = "Sim"
elif resultado == TaskDialogResult.Cancel:
    OUT = "Fechar"
else:
    OUT = "Nenhuma ação"
# ----------------------------------------
flatten_5 = List.Flatten(list=setParameterByName_2)

# group: Inverter lado Interruptor
code_block_30 = CodeBlock { true; false; }
code_block_31 = CodeBlock(x=python_script, y=code_block_30.out0, z=code_block_30.out1)
# ---------- code_block_31.designscript (5 lines) ----------
//Condições IF, OR, AND
x;
y;
z;
x == "Sim" ? z : y;
# ----------------------------------------
watch = Watch(code_block_31.out3)
passThrough_2 = Custom[PassThrough](passThrough=flatten_5, waitFor=code_block_31.out3)
delete = Element.Delete(element=passThrough_2)
passThrough_3 = Custom[PassThrough](passThrough=code_block_31.out3, waitFor=delete)

if_5 = If(test=passThrough_3, true=reverse, false=chop)
length_2 = Curve.Length(curve=if_5)
closestPointTo_2 = Geometry.ClosestPointTo(geometry=if_5, other=getLocation@L2)
parameterAtPoint_2 = Curve.ParameterAtPoint(curve=if_5, point=closestPointTo_2)
code_block_32 = CodeBlock(offset_1=getItemAtIndex_4, lenght_1=length_2, pap_1=parameterAtPoint_2) { par_1 = offset_1/lenght_1; par_2 = pap_1+par_1; pap_1; }
code_block_33 = CodeBlock(x=getItemAtIndex_8) { seq_1 = 0..1..#x+1; seq_2 = DSCore.List.RemoveItemAtIndex(seq_1, x); }
add_2 = code_block_32.par_2 + code_block_33.seq_2  # lacing=Longest
code_block_34 = CodeBlock(x=add_2) { x>=1; x-1; x; }
if_6 = If(test=code_block_34.out0, true=code_block_34.out1, false=code_block_34.x)
pointAtParameter_2 = Curve.PointAtParameter(curve=if_5, param=if_6, lacing=Longest)
normalAtParameter_2 = Curve.NormalAtParameter(curve=if_5, param=if_6, lacing=Longest)
code_block_35 = CodeBlock { 1; }
byStartPointDirectionLength_2 = Line.ByStartPointDirectionLength(startPoint=pointAtParameter_2, direction=normalAtParameter_2, length=code_block_35)
byPointAndLevel_2 = FamilyInstance.ByPointAndLevel(familyType=filterByBoolMask_7.in, point=pointAtParameter_2, level=getItemAtIndex_3, lacing=Longest)
string_13 = StringInput("Elevação do nível")
number_4 = DoubleInput(0)
setParameterByName_3 = Element.SetParameterByName(element=byPointAndLevel_2, parameterName=string_13, value=number_4, lacing=Longest)
string_14 = StringInput("Elevação do Ponto")
setParameterByName_4 = Element.SetParameterByName(element=setParameterByName_3, parameterName=string_14, value=getItemAtIndex_7, lacing=Longest)
reverse_3 = Vector.Reverse(vector=normalAtParameter_2)
if_7 = If(test=passThrough_3, true=normalAtParameter_2, false=reverse_3)
YAxis_2 = Vector.YAxis()
ZAxis_2 = Vector.ZAxis()
angleAboutAxis_2 = Vector.AngleAboutAxis(vector=if_7, otherVector=YAxis_2, rotationAxis=ZAxis_2)
setRotation_2 = FamilyInstance.SetRotation(familyInstance=setParameterByName_4, degree=angleAboutAxis_2)
uniqueItems = List.UniqueItems(list=passThrough)
code_block_36 = CodeBlock { "Nome"; }
getParameterValueByName_2 = Element.GetParameterValueByName(element=filterByBoolMask_5.in, parameterName=code_block_36)
code_block_37 = CodeBlock { "teste"; }
eq_4 = getParameterValueByName_2 == code_block_37
filterByBoolMask_8 = List.FilterByBoolMask(list=filterByBoolMask_5.in, mask=eq_4)
flatten_6 = List.Flatten(list=filterByBoolMask_8.in)
