# Dynamo graph 16-5_BIMACON_Deletar Todos Cabos das Bandejas de Cabos_R01_script.dyn "ok 2021_16-5_BIMACON_Deletar Todos Cabos das Bandejas de Cabos_R01_script" (Dynamo 2.19.3.6394)
# author: Jose Nelson
# Limpa todos os cabos lançados nas bandejas de cabos e suas conexões
# packages: Clockwork for Dynamo 2.x 2.4.0, DynaMEP 2.0.1

categories = Categories("OST_CableTray")
categories_2 = Categories("OST_CableTrayFitting")
list_create = List.Create(item0=categories, item1=categories_2)
all_families_of_category = Custom[All Families Of Category](category=categories_2)  # package Clockwork for Dynamo 2.x; Gets all famiies of a given category in the model (does *not *work for system families)
types = Family.Types(family=all_families_of_category)
all_elements_of_family_type = ElementsOfFamilyType(Family_Type=types)
all_elements_of_category = ElementsOfCategory(Category=categories)
flatten = List.Flatten(list=all_elements_of_category)
list_create_2 = List.Create(item0=all_elements_of_family_type, item1=flatten)
flatten_2 = List.Flatten(list=list_create_2)
flatten_3 = List.Flatten(list=types)
byFamilyType = FamilyInstance.ByFamilyType(familyType=flatten_3)
family = RevitModel.FamilyInstance.Family(familyinstance=byFamilyType)
flatten_4 = List.Flatten(list=family)
list_create_3 = List.Create(item0=flatten_4, item1=flatten)
flatten_5 = List.Flatten(list=list_create_3)
name = Element.Name(element=flatten_5)
string = StringInput("Eletrocalha")
contains = String.Contains(string=name, searchFor=string)
filterByBoolMask = List.FilterByBoolMask(list=flatten_2, mask=contains)
string_2 = StringInput("Leito")
contains_2 = String.Contains(string=name, searchFor=string_2)
filterByBoolMask_2 = List.FilterByBoolMask(list=flatten_2, mask=contains_2)
string_3 = StringInput("Perfilado")
contains_3 = String.Contains(string=name, searchFor=string_3)
filterByBoolMask_3 = List.FilterByBoolMask(list=flatten_2, mask=contains_3)
string_4 = StringInput("Bandeja")
contains_4 = String.Contains(string=name, searchFor=string_4)
filterByBoolMask_4 = List.FilterByBoolMask(list=flatten_2, mask=contains_4)
list_create_4 = List.Create(item0=filterByBoolMask.in, item1=filterByBoolMask_2.in, item2=filterByBoolMask_3.in, item3=filterByBoolMask_4.in)
flatten_6 = List.Flatten(list=list_create_4)
code_block = CodeBlock()
# ---------- code_block.designscript (1 lines) ----------
["1,5mm²_Fase A","1,5mm²_Fase B","1,5mm²_Fase C","1,5mm²_Neutro","1,5mm²_Retorno","1,5mm²_Terra","2,5mm²_Fase A","2,5mm²_Fase B","2,5mm²_Fase C","2,5mm²_Neutro","2,5mm²_Retorno","2,5mm²_Terra","4,0mm²_Fase A","4,0mm²_Fase B","4,0mm²_Fase C","4,0mm²_Neutro","4,0mm²_Retorno","4,0mm²_Terra","6,0mm²_Fase A","6,0mm²_Fase B","6,0mm²_Fase C","6,0mm²_Neutro","6,0mm²_Retorno","6,0mm²_Terra","10,0mm²_Fase A","10,0mm²_Fase B","10,0mm²_Fase C","10,0mm²_Neutro","10,0mm²_Terra","16,0mm²_Fase A","16,0mm²_Fase B","16,0mm²_Fase C","16,0mm²_Neutro","16,0mm²_Terra","25,0mm²_Fase A","25,0mm²_Fase B","25,0mm²_Fase C","25,0mm²_Neutro","25,0mm²_Terra","35,0mm²_Fase A","35,0mm²_Fase B","35,0mm²_Fase C","35,0mm²_Neutro","35,0mm²_Terra","50,0mm²_Fase A","50,0mm²_Fase B","50,0mm²_Fase C","50,0mm²_Neutro","50,0mm²_Terra","70,0mm²_Fase A","70,0mm²_Fase B","70,0mm²_Fase C","70,0mm²_Neutro","70,0mm²_Terra","95,0mm²_Fase A","95,0mm²_Fase B","95,0mm²_Fase C","95,0mm²_Neutro","95,0mm²_Terra","120,0mm²_Fase A","120,0mm²_Fase B","120,0mm²_Fase C","120,0mm²_Neutro","120,0mm²_Terra","150,0mm²_Fase A","150,0mm²_Fase B","150,0mm²_Fase C","150,0mm²_Neutro","150,0mm²_Terra","185,0mm²_Fase A","185,0mm²_Fase B","185,0mm²_Fase C","185,0mm²_Neutro","185,0mm²_Terra","240,0mm²_Fase A","240,0mm²_Fase B","240,0mm²_Fase C","240,0mm²_Neutro","240,0mm²_Terra","300,0mm²_Fase A","300,0mm²_Fase B","300,0mm²_Fase C","300,0mm²_Neutro","300,0mm²_Terra","400,0mm²_Fase A","400,0mm²_Fase B","400,0mm²_Fase C","400,0mm²_Neutro","400,0mm²_Terra","500,0mm²_Fase A","500,0mm²_Fase B","500,0mm²_Fase C","500,0mm²_Neutro","500,0mm²_Terra","CCI_1P","CCI_2P","CCI_3P","CCI_4P","CI_10P","CI_20P","CI_30P","CI_40P","FO_N2","FO_N4","FO_N6","FO_N8","FO_N12","FTP_CAT-6","FTP_CAT-6a","FTP_CAT-7","RG6_67%","RG6_95%","RG59_47%","RG59_67%","RG59_95%","UTP_CAT-5e","UTP_CAT-6"];
# ----------------------------------------
flatten_7 = List.Flatten(list=code_block)
getParameterValueByName = Element.GetParameterValueByName(element=flatten_6@L2, parameterName=flatten_7, lacing=Longest)
code_block_2 = CodeBlock { true; false; }
code_block_3 = CodeBlock(x=getParameterValueByName, y=code_block_2.out0, z=code_block_2.out1)
# ---------- code_block_3.designscript (5 lines) ----------
//Condições IF, OR, AND
x;
y;
z;
x == 0 || x == "" ? y : z;
# ----------------------------------------
filterByBoolMask_5 = List.FilterByBoolMask(list=flatten_6, mask=code_block_3.out3@L2)
flatten_8 = List.Flatten(list=filterByBoolMask_5.out)
number = DoubleInput(0)
setParameterValueByName = RevitModel.Element.SetParameterValueByName(element=flatten_8@L1, parameterName=flatten_7, values=number)
uniqueItems = List.UniqueItems(list=setParameterValueByName)
isEmpty = List.IsEmpty(list=uniqueItems)
code_block_4 = CodeBlock { null; }
code_block_5 = CodeBlock(x=isEmpty, y=code_block_4, z=uniqueItems)
# ---------- code_block_5.designscript (5 lines) ----------
//Condições se ou e
x;
y;
z;
x == true ? y : z;
# ----------------------------------------

# group: Mensagem
count = List.Count(list=code_block_5.z)
code_block_6 = CodeBlock { 0; }
gt = count > code_block_6
code_block_7 = CodeBlock(N=count) { ["Feito! Os Cabos de "+N+" Bandejas Foram Deletados"]; }
code_block_8 = CodeBlock { ["Nenhum cabo foi Deletado"]; }
if_ = If(test=gt, true=code_block_7, false=code_block_8)
flatten_9 = List.Flatten(list=if_)
string_fromlist_bimacon = Python(IN[0]=flatten_9)  # IronPython2
# ---------- string_fromlist_bimacon.python (22 lines) ----------
# Carregar as bibliotecas DesignScript e padrão do Python
import sys
import clr
clr.AddReference('ProtoGeometry')
from Autodesk.DesignScript.Geometry import *

# Função para concatenar os valores de uma lista em uma única string com múltiplas linhas
def concatenate_list_to_string(input_list, delimiter="\n"):
    # Verifica se a entrada é uma lista
    if not isinstance(input_list, list):
        return "A entrada deve ser uma lista."
    
    # Converte todos os elementos para string e junta com o delimitador especificado
    result = delimiter.join(str(item) for item in input_list)
    return result

# Entrada pelo nó do Dynamo
lista = IN[0]  # Lista de valores a serem concatenados
delimitador = IN[1] if len(IN) > 1 else "\n"  # Delimitador opcional, padrão é nova linha

# Saída para o Dynamo
OUT = concatenate_list_to_string(lista, delimitador)
# ----------------------------------------
python_script = Python(IN[0]=string_fromlist_bimacon)  # IronPython2
# ---------- python_script.python (21 lines) ----------
# Importar as bibliotecas necessárias do Revit
import clr
clr.AddReference("RevitServices")
from RevitServices.Persistence import DocumentManager

clr.AddReference("RevitAPI")
clr.AddReference("RevitAPIUI")
from Autodesk.Revit.UI import TaskDialog

# Pegar a entrada do Dynamo
mensagem = IN[0]

# Criar a TaskDialog
task_dialog = TaskDialog("Ok")
task_dialog.MainInstruction = mensagem

# Exibir a TaskDialog
task_dialog.Show()

# Saída do script
OUT = "Sucesso!"
# ----------------------------------------
