# Dynamo graph 13-0_BIMACON_Gerar Legenda Simbologia_R02_script.dyn (Dynamo 2.6.1.8786)
# packages: archi-lab.net 2023.213.1722

# group: CATEGORIAS
categories = Categories("OST_ConduitFitting")
categories_2 = Categories("OST_Conduit")
categories_3 = Categories("OST_CableTray")
categories_4 = Categories("OST_CableTrayFitting")
categories_5 = Categories("OST_ElectricalEquipment")
categories_6 = Categories("OST_LightingFixtures")
categories_7 = Categories("OST_CommunicationDevices")
categories_8 = Categories("OST_DataDevices")
categories_9 = Categories("OST_LightingDevices")
categories_10 = Categories("OST_SecurityDevices")
categories_11 = Categories("OST_TelephoneDevices")
categories_12 = Categories("OST_ElectricalFixtures")
categories_13 = Categories("OST_MechanicalEquipment")
list_create = List.Create(item0=categories, item1=categories_2, item2=categories_3, item3=categories_4, item4=categories_5, item5=categories_6, item6=categories_7, item7=categories_8, item8=categories_9, item9=categories_10, item10=categories_11, item11=categories_12, item12=categories_13)
flatten = List.Flatten(list=list_create)

all_elements_of_category = ElementsOfCategory(Category=list_create)
flatten_2 = List.Flatten(list=all_elements_of_category)
code_block = CodeBlock { "Bimacon_Legenda"; }
getParameterValueByName = Element.GetParameterValueByName(element=flatten_2, parameterName=code_block)
code_block_2 = CodeBlock { ""; }
eq = getParameterValueByName == code_block_2
filterByBoolMask = List.FilterByBoolMask(list=flatten_2, mask=eq)
flatten_3 = List.Flatten(list=filterByBoolMask.out)
watch = Watch(flatten_3)
code_block_3 = CodeBlock { "Imagem"; }
boolean = BoolSelector(true)
pasta_das_imagens = Python(IN[0]=boolean)
# ---------- pasta_das_imagens.python (24 lines) ----------
import clr

# Adiciona referência ao ambiente .NET
clr.AddReference('System')
from System import Environment, IO

# Entrada: booleano que define se deve ou não executar
executar = IN[0]

# Se executar for True, prossegue
if executar:
    # Recupera o nome do usuário logado no Windows
    usuario = Environment.UserName

    # Monta o caminho completo para a pasta de imagens
    caminho_base = r"C:\Users\{0}\AppData\Roaming\pyRevit\Extensions\Bimacon.extension\Bimacon.tab\Imagens_Bimacon".format(usuario)

    # Verifica se a pasta existe
    existe = IO.Directory.Exists(caminho_base)

    # Saída
    OUT = caminho_base if existe else "Pasta não encontrada: {0}".format(caminho_base)
else:
    OUT = "Execução não permitida"
# ----------------------------------------

# group: Ler do Excel
string = StringInput("SIMBOLOGIA ELÉTRICA EXPORTAR.xlsx")
pasta_da_planilha = Python(IN[0]=string)
# ---------- pasta_da_planilha.python (22 lines) ----------
import clr

# Adiciona referência ao ambiente .NET
clr.AddReference('System')
from System import Environment, IO

# Nome da imagem (entrada do usuário)
nome_arquivo_imagem = IN[0]

# Recupera o nome do usuário logado no Windows
usuario = Environment.UserName

# Monta o caminho completo para a pasta de imagens
caminho_base = r"C:\Users\{0}\AppData\Roaming\pyRevit\Extensions\Bimacon.extension\Bimacon.tab\Imagens_Bimacon".format(usuario)

# Junta o caminho base com o nome do arquivo
caminho_completo = IO.Path.Combine(caminho_base, nome_arquivo_imagem)

# Verifica se o arquivo existe
existe = IO.File.Exists(caminho_completo)

OUT = caminho_completo if existe else "Arquivo não encontrado: {0}".format(caminho_completo)
# ----------------------------------------
file_from_path = FileObject(path=pasta_da_planilha)
code_block_4 = CodeBlock { "SIMBOLOGIA ELÉTRICA EXPORTAR"; }
code_block_5 = CodeBlock { true; }
boolean_2 = BoolSelector(false)
importExcel = Data.ImportExcel(file=file_from_path, sheetName=code_block_4, readAsStrings=code_block_5, showExcel=boolean_2)
transpose = List.Transpose(lists=importExcel)
code_block_6 = CodeBlock { 0; }
removeItemAtIndex = List.RemoveItemAtIndex(list=transpose, indices=code_block_6, lacing=Longest)

code_block_7 = CodeBlock(list=removeItemAtIndex) { list[3]; }
sort = List.Sort(list=code_block_7)
filterByBoolMask_2 = List.FilterByBoolMask(list=getParameterValueByName, mask=eq)
flatten_4 = List.Flatten(list=filterByBoolMask_2.out)
code_block_8 = CodeBlock(list=removeItemAtIndex) { list[2]; }
indexOf = List.IndexOf(list=code_block_7, element=sort)
getItemAtIndex = List.GetItemAtIndex(list=code_block_8, index=indexOf)
eq_2 = flatten_4@L1 == getItemAtIndex
filterByBoolMask_3 = List.FilterByBoolMask(list=code_block_7@L2, mask=eq_2, lacing=Longest)
boolean_3 = BoolSelector(false)
clean = List.Clean(list=filterByBoolMask_3.in, preserveIndices=boolean_3)
uniqueItems = List.UniqueItems(list=clean)
flatten_5 = List.Flatten(list=uniqueItems)
sort_2 = List.Sort(list=flatten_5)

# group: Encontre a imagem certa para o nome certo
element_types = ElementTypes("ImageType")  # graph input
all_elements_of_type = ElementsOfType(element_type=element_types)
code_block_9 = CodeBlock { "Nome do tipo"; }
getParameterValueByName_2 = Element.GetParameterValueByName(element=all_elements_of_type, parameterName=code_block_9)
eq_3 = sort_2@L1 == getParameterValueByName_2
filterByBoolMask_4 = List.FilterByBoolMask(list=getParameterValueByName_2@L2, mask=eq_3, lacing=Longest)
flatten_6 = List.Flatten(list=filterByBoolMask_4.in@@L2)
filterByBoolMask_5 = List.FilterByBoolMask(list=all_elements_of_type@L2, mask=eq_3, lacing=Longest)
flatten_7 = List.Flatten(list=filterByBoolMask_5.in@@L2)

uniqueItems_2 = List.UniqueItems(list=flatten_6)
contains = List.Contains(list=uniqueItems_2, item=sort@L1)
filterByBoolMask_6 = List.FilterByBoolMask(list=sort, mask=contains@L2)
flatten_8 = List.Flatten(list=filterByBoolMask_6.out)
code_block_10 = CodeBlock(caminho=pasta_das_imagens, nome_imagem=flatten_8) { caminho + "\\" + nome_imagem; }
importar_imagens = Python(IN[0]=code_block_10)
# ---------- importar_imagens.python (33 lines) ----------
import clr
clr.AddReference('RevitServices')
from RevitServices.Persistence import DocumentManager
from RevitServices.Transactions import TransactionManager

clr.AddReference("RevitAPI")
from Autodesk.Revit.DB import *

# Entradas do Dynamo
caminhos_completos = IN[0]  # Lista com os caminhos completos das imagens

# Documento ativo
doc = DocumentManager.Instance.CurrentDBDocument

# Lista para armazenar os ImageTypes criados
imagens_importadas = []

# Início da transação
TransactionManager.Instance.EnsureInTransaction(doc)

for caminho in caminhos_completos:
    try:
        # Cria o tipo da imagem (ImageType), que importa a imagem no projeto
        image_type = ImageType.Create(doc, caminho)
        imagens_importadas.append(image_type)
    except:
        imagens_importadas.append("Erro ao importar: {}".format(caminho))

# Fim da transação
TransactionManager.Instance.TransactionTaskDone()

# Saída
OUT = imagens_importadas
# ----------------------------------------
boolean_4 = BoolSelector(false)
clean_2 = List.Clean(list=flatten_7, preserveIndices=boolean_4)
list_create_2 = List.Create(item0=importar_imagens, item1=clean_2)
flatten_9 = List.Flatten(list=list_create_2)
name = Element.Name(element=flatten_9)
sort_3 = List.Sort(list=name)
indexOf_2 = List.IndexOf(list=name, element=sort_3)
getItemAtIndex_2 = List.GetItemAtIndex(list=flatten_9, index=indexOf_2)
end = Revit.Transaction.Transaction.End(input=importar_imagens)
start = Revit.Transaction.Transaction.Start(input=end)
passThrough = Custom[PassThrough](passThrough=getItemAtIndex_2, waitFor=start)  # package archi-lab.net; Ripped this off from Clockwork. Sorry Andy.
filterByBoolMask_7 = List.FilterByBoolMask(list=passThrough@L2, mask=eq_2, lacing=Longest)
setParameterByName = Element.SetParameterByName(element=watch@L2, parameterName=code_block_3, value=filterByBoolMask_7.in)
