# Dynamo graph 13-0_BIMACON_Gerar Legenda Simbologia_script.dyn (Dynamo 2.6.1.8786)

# group: ENTRADAS PARA O USUÁRIO
categories = Categories("OST_ConduitFitting")
categories_2 = Categories("OST_Conduit")
categories_3 = Categories("OST_CableTray")
categories_4 = Categories("OST_CableTrayFitting")
categories_5 = Categories("OST_ElectricalEquipment")
categories_6 = Categories("OST_LightingFixtures")
categories_7 = Categories("OST_CommunicationDevices")
categories_8 = Categories("OST_DataDevices")
categories_9 = Categories("OST_LightingDevices")
categories_10 = Categories("OST_SecurityDevices")
categories_11 = Categories("OST_TelephoneDevices")
categories_12 = Categories("OST_ElectricalFixtures")
categories_13 = Categories("OST_MechanicalEquipment")
list_create = List.Create(item0=categories, item1=categories_2, item2=categories_3, item3=categories_4, item4=categories_5, item5=categories_6, item6=categories_7, item7=categories_8, item8=categories_9, item9=categories_10, item10=categories_11, item11=categories_12, item12=categories_13)
flatten = List.Flatten(list=list_create)

all_elements_of_category = ElementsOfCategory(Category=list_create)
flatten_2 = List.Flatten(list=all_elements_of_category)
getFamily = FamilyInstance.GetFamily(familyInstance=flatten_2)
flatten_3 = List.Flatten(list=getFamily)
string_from_object = FromObject(obj=flatten_3)
code_block = CodeBlock { ["Ponto de Força"]; }
contains = String.Contains(str=string_from_object@L2, searchFor=code_block, lacing=Longest)
filterByBoolMask = List.FilterByBoolMask(list=flatten_2@L2, mask=contains@L2)
code_block_2 = CodeBlock { ["Interruptor"]; }
contains_2 = String.Contains(str=string_from_object@L2, searchFor=code_block_2, lacing=Longest)
filterByBoolMask_2 = List.FilterByBoolMask(list=flatten_2@L2, mask=contains_2@L2)
code_block_3 = CodeBlock { ["Tomada"]; }
contains_3 = String.Contains(str=string_from_object@L2, searchFor=code_block_3, lacing=Longest)
filterByBoolMask_3 = List.FilterByBoolMask(list=flatten_2@L2, mask=contains_3@L2)
code_block_4 = CodeBlock { ["Ar condicionado"]; }
contains_4 = String.Contains(str=string_from_object@L2, searchFor=code_block_4, lacing=Longest)
filterByBoolMask_4 = List.FilterByBoolMask(list=flatten_2@L2, mask=contains_4@L2)
code_block_5 = CodeBlock { ["Caixa passagem"]; }
contains_5 = String.Contains(str=string_from_object@L2, searchFor=code_block_5, lacing=Longest)
filterByBoolMask_5 = List.FilterByBoolMask(list=flatten_2@L2, mask=contains_5@L2)
code_block_6 = CodeBlock { ["Sensor"]; }
contains_6 = String.Contains(str=string_from_object@L2, searchFor=code_block_6, lacing=Longest)
filterByBoolMask_6 = List.FilterByBoolMask(list=flatten_2@L2, mask=contains_6@L2)
code_block_7 = CodeBlock { ["Dimer"]; }
contains_7 = String.Contains(str=string_from_object@L2, searchFor=code_block_7, lacing=Longest)
filterByBoolMask_7 = List.FilterByBoolMask(list=flatten_2@L2, mask=contains_7@L2)
code_block_8 = CodeBlock { ["Luminária"]; }
contains_8 = String.Contains(str=string_from_object@L2, searchFor=code_block_8, lacing=Longest)
filterByBoolMask_8 = List.FilterByBoolMask(list=flatten_2@L2, mask=contains_8@L2)
code_block_9 = CodeBlock { ["Campainha"]; }
contains_9 = String.Contains(str=string_from_object@L2, searchFor=code_block_9, lacing=Longest)
filterByBoolMask_9 = List.FilterByBoolMask(list=flatten_2@L2, mask=contains_9@L2)
code_block_10 = CodeBlock { ["Relé"]; }
contains_10 = String.Contains(str=string_from_object@L2, searchFor=code_block_10, lacing=Longest)
filterByBoolMask_10 = List.FilterByBoolMask(list=flatten_2@L2, mask=contains_10@L2)
code_block_11 = CodeBlock { ["Caixa"]; }
contains_11 = String.Contains(str=string_from_object@L2, searchFor=code_block_11, lacing=Longest)
filterByBoolMask_11 = List.FilterByBoolMask(list=flatten_2@L2, mask=contains_11@L2)
code_block_12 = CodeBlock { ["Quadro"]; }
contains_12 = String.Contains(str=string_from_object@L2, searchFor=code_block_12, lacing=Longest)
filterByBoolMask_12 = List.FilterByBoolMask(list=flatten_2@L2, mask=contains_12@L2)
list_create_2 = List.Create(item0=filterByBoolMask.in, item1=filterByBoolMask_2.in, item2=filterByBoolMask_3.in, item3=filterByBoolMask_4.in, item4=filterByBoolMask_5.in, item5=filterByBoolMask_6.in, item6=filterByBoolMask_7.in, item7=filterByBoolMask_8.in, item8=filterByBoolMask_9.in, item9=filterByBoolMask_10.in, item10=filterByBoolMask_11.in, item11=filterByBoolMask_12.in)
flatten_4 = List.Flatten(list=list_create_2)
watch = Watch(flatten_4)
code_block_13 = CodeBlock { "Imagem"; }

# group: Ler do Excel
string = StringInput("SIMBOLOGIA ELÉTRICA EXPORTAR.xlsx")
python_script = Python(IN[0]=string)
# ---------- python_script.python (22 lines) ----------
import clr

# Adiciona referência ao ambiente .NET
clr.AddReference('System')
from System import Environment, IO

# Nome da imagem (entrada do usuário)
nome_arquivo_imagem = IN[0]

# Recupera o nome do usuário logado no Windows
usuario = Environment.UserName

# Monta o caminho completo para a pasta de imagens
caminho_base = r"C:\Users\{0}\AppData\Roaming\pyRevit\Extensions\Bimacon.extension\Bimacon.tab\Imagens_Bimacon".format(usuario)

# Junta o caminho base com o nome do arquivo
caminho_completo = IO.Path.Combine(caminho_base, nome_arquivo_imagem)

# Verifica se o arquivo existe
existe = IO.File.Exists(caminho_completo)

OUT = caminho_completo if existe else "Arquivo não encontrado: {0}".format(caminho_completo)
# ----------------------------------------
file_from_path = FileObject(path=python_script)
code_block_14 = CodeBlock { "SIMBOLOGIA ELÉTRICA EXPORTAR"; }
code_block_15 = CodeBlock { true; }
boolean = BoolSelector(false)
importExcel = Data.ImportExcel(file=file_from_path, sheetName=code_block_14, readAsStrings=code_block_15, showExcel=boolean)
transpose = List.Transpose(lists=importExcel)
code_block_16 = CodeBlock { 0; }
removeItemAtIndex = List.RemoveItemAtIndex(list=transpose, indices=code_block_16, lacing=Longest)

# group: Encontre a imagem certa para o nome certo
element_types = ElementTypes("ImageType")  # graph input
all_elements_of_type = ElementsOfType(element_type=element_types)
code_block_17 = CodeBlock(list=removeItemAtIndex) { list[3]; }
code_block_18 = CodeBlock { "Nome do tipo"; }
getParameterValueByName = Element.GetParameterValueByName(element=all_elements_of_type, parameterName=code_block_18)
eq = code_block_17@L1 == getParameterValueByName
filterByBoolMask_13 = List.FilterByBoolMask(list=all_elements_of_type@L2, mask=eq, lacing=Longest)
flatten_5 = List.Flatten(list=filterByBoolMask_13.in)

code_block_19 = CodeBlock { "Bimacon_Legenda"; }
getParameterValueByName_2 = Element.GetParameterValueByName(element=flatten_4, parameterName=code_block_19)

# group: Regra para o Tipo
code_block_20 = CodeBlock { "Tipo"; }
getParameterValueByName_3 = Element.GetParameterValueByName(element=flatten_4, parameterName=code_block_20)
string_from_object_2 = FromObject(obj=getParameterValueByName_3)
code_block_21 = CodeBlock { "Family Type: "; }
code_block_22 = CodeBlock { ""; }
replace = String.Replace(str=string_from_object_2, searchFor=code_block_21, replaceWith=code_block_22)
code_block_23 = CodeBlock { ","; }
split = String.Split(str=replace, separator0=code_block_23)
code_block_24 = CodeBlock { 0; }
getItemAtIndex = List.GetItemAtIndex(list=split, index=code_block_24, lacing=Longest)
code_block_25 = CodeBlock(list=removeItemAtIndex) { list[2]; }
eq_2 = getParameterValueByName_2@L1 == code_block_25

filterByBoolMask_14 = List.FilterByBoolMask(list=flatten_5@L2, mask=eq_2, lacing=Longest)
setParameterByName = Element.SetParameterByName(element=watch@L2, parameterName=code_block_13, value=filterByBoolMask_14.in)
flatten_6 = List.Flatten(list=filterByBoolMask_14.in)
flatten_7 = List.Flatten(list=list_create_2)
filterByBoolMask_15 = List.FilterByBoolMask(list=getParameterValueByName@L2, mask=eq, lacing=Longest)
flatten_8 = List.Flatten(list=filterByBoolMask_15.in)
code_block_26 = CodeBlock { ["Tomada"]; }
