# Dynamo graph 13-1_BIMACON_Deletar Legenda Simbologia_R01_script.dyn (Dynamo 2.6.1.8786)

# group: CATEGORIAS
categories = Categories("OST_ConduitFitting")
categories_2 = Categories("OST_Conduit")
categories_3 = Categories("OST_CableTray")
categories_4 = Categories("OST_CableTrayFitting")
categories_5 = Categories("OST_ElectricalEquipment")
categories_6 = Categories("OST_LightingFixtures")
categories_7 = Categories("OST_CommunicationDevices")
categories_8 = Categories("OST_DataDevices")
categories_9 = Categories("OST_LightingDevices")
categories_10 = Categories("OST_SecurityDevices")
categories_11 = Categories("OST_TelephoneDevices")
categories_12 = Categories("OST_ElectricalFixtures")
categories_13 = Categories("OST_MechanicalEquipment")
list_create = List.Create(item0=categories, item1=categories_2, item2=categories_3, item3=categories_4, item4=categories_5, item5=categories_6, item6=categories_7, item7=categories_8, item8=categories_9, item9=categories_10, item10=categories_11, item11=categories_12, item12=categories_13)
flatten = List.Flatten(list=list_create)

all_elements_of_category = ElementsOfCategory(Category=list_create)
flatten_2 = List.Flatten(list=all_elements_of_category)
code_block = CodeBlock { "Bimacon_Legenda"; }
getParameterValueByName = Element.GetParameterValueByName(element=flatten_2, parameterName=code_block)
code_block_2 = CodeBlock { ""; }
eq = getParameterValueByName == code_block_2
filterByBoolMask = List.FilterByBoolMask(list=flatten_2, mask=eq)
flatten_3 = List.Flatten(list=filterByBoolMask.out)

# group: Ler do Excel
string = StringInput("SIMBOLOGIA ELÉTRICA EXPORTAR.xlsx")
pasta_da_planilha = Python(IN[0]=string)
# ---------- pasta_da_planilha.python (22 lines) ----------
import clr

# Adiciona referência ao ambiente .NET
clr.AddReference('System')
from System import Environment, IO

# Nome da imagem (entrada do usuário)
nome_arquivo_imagem = IN[0]

# Recupera o nome do usuário logado no Windows
usuario = Environment.UserName

# Monta o caminho completo para a pasta de imagens
caminho_base = r"C:\Users\{0}\AppData\Roaming\pyRevit\Extensions\Bimacon.extension\Bimacon.tab\Imagens_Bimacon".format(usuario)

# Junta o caminho base com o nome do arquivo
caminho_completo = IO.Path.Combine(caminho_base, nome_arquivo_imagem)

# Verifica se o arquivo existe
existe = IO.File.Exists(caminho_completo)

OUT = caminho_completo if existe else "Arquivo não encontrado: {0}".format(caminho_completo)
# ----------------------------------------
file_from_path = FileObject(path=pasta_da_planilha)
code_block_3 = CodeBlock { "SIMBOLOGIA ELÉTRICA EXPORTAR"; }
code_block_4 = CodeBlock { true; }
boolean = BoolSelector(false)
importExcel = Data.ImportExcel(file=file_from_path, sheetName=code_block_3, readAsStrings=code_block_4, showExcel=boolean)
transpose = List.Transpose(lists=importExcel)
code_block_5 = CodeBlock { 0; }
removeItemAtIndex = List.RemoveItemAtIndex(list=transpose, indices=code_block_5, lacing=Longest)

code_block_6 = CodeBlock(list=removeItemAtIndex) { list[3]; }
sort = List.Sort(list=code_block_6)
filterByBoolMask_2 = List.FilterByBoolMask(list=getParameterValueByName, mask=eq)
flatten_4 = List.Flatten(list=filterByBoolMask_2.out)
code_block_7 = CodeBlock(list=removeItemAtIndex) { list[2]; }
indexOf = List.IndexOf(list=code_block_6, element=sort)
getItemAtIndex = List.GetItemAtIndex(list=code_block_7, index=indexOf)
eq_2 = flatten_4@L1 == getItemAtIndex
filterByBoolMask_3 = List.FilterByBoolMask(list=sort@L2, mask=eq_2, lacing=Longest)
boolean_2 = BoolSelector(false)
clean = List.Clean(list=filterByBoolMask_3.in, preserveIndices=boolean_2)
uniqueItems = List.UniqueItems(list=clean)
flatten_5 = List.Flatten(list=uniqueItems)
sort_2 = List.Sort(list=flatten_5)

# group: Encontre a imagem certa para o nome certo
element_types = ElementTypes("ImageType")  # graph input
all_elements_of_type = ElementsOfType(element_type=element_types)
code_block_8 = CodeBlock { "Nome do tipo"; }
getParameterValueByName_2 = Element.GetParameterValueByName(element=all_elements_of_type, parameterName=code_block_8)
eq_3 = sort_2@L1 == getParameterValueByName_2
filterByBoolMask_4 = List.FilterByBoolMask(list=getParameterValueByName_2@L2, mask=eq_3, lacing=Longest)
flatten_6 = List.Flatten(list=filterByBoolMask_4.in)
filterByBoolMask_5 = List.FilterByBoolMask(list=all_elements_of_type@L2, mask=eq_3, lacing=Longest)
flatten_7 = List.Flatten(list=filterByBoolMask_5.in)

delete = Element.Delete(element=flatten_7)

# group: Mensagem Final
count = List.Count(list=delete)
code_block_9 = CodeBlock { 0; }
gt = count > code_block_9
code_block_10 = CodeBlock(N=count) { ["Feito "+N+" símbolos Deletados"]; }
code_block_11 = CodeBlock { ["Nenhum símbolo Deletado"]; }
if_ = If(test=gt, true=code_block_10, false=code_block_11)
flatten_8 = List.Flatten(list=if_)
fromList = Python(IN[0]=flatten_8)  # "String.FromList"
# ---------- fromList.python (22 lines) ----------
# Carregar as bibliotecas DesignScript e padrão do Python
import sys
import clr
clr.AddReference('ProtoGeometry')
from Autodesk.DesignScript.Geometry import *

# Função para concatenar os valores de uma lista em uma única string com múltiplas linhas
def concatenate_list_to_string(input_list, delimiter="\n"):
    # Verifica se a entrada é uma lista
    if not isinstance(input_list, list):
        return "A entrada deve ser uma lista."
    
    # Converte todos os elementos para string e junta com o delimitador especificado
    result = delimiter.join(str(item) for item in input_list)
    return result

# Entrada pelo nó do Dynamo
lista = IN[0]  # Lista de valores a serem concatenados
delimitador = IN[1] if len(IN) > 1 else "\n"  # Delimitador opcional, padrão é nova linha

# Saída para o Dynamo
OUT = concatenate_list_to_string(lista, delimitador)
# ----------------------------------------
python_script = Python(IN[0]=fromList)
# ---------- python_script.python (21 lines) ----------
# Importar as bibliotecas necessárias do Revit
import clr
clr.AddReference("RevitServices")
from RevitServices.Persistence import DocumentManager

clr.AddReference("RevitAPI")
clr.AddReference("RevitAPIUI")
from Autodesk.Revit.UI import TaskDialog

# Pegar a entrada do Dynamo
mensagem = IN[0]

# Criar a TaskDialog
task_dialog = TaskDialog("Ok")
task_dialog.MainInstruction = mensagem

# Exibir a TaskDialog
task_dialog.Show()

# Saída do script
OUT = "Sucesso!"
# ----------------------------------------
