# Dynamo graph 13-1_BIMACON_Deletar Legenda Simbologia_script.dyn (Dynamo 2.6.1.8786)
# Exclui os Códigos de  Identificadores de todas conexões.

# group: ENTRADAS PARA O USUÁRIO
categories = Categories("OST_ConduitFitting")
categories_2 = Categories("OST_Conduit")
categories_3 = Categories("OST_CableTray")
categories_4 = Categories("OST_CableTrayFitting")
categories_5 = Categories("OST_ElectricalEquipment")
categories_6 = Categories("OST_LightingFixtures")
categories_7 = Categories("OST_CommunicationDevices")
categories_8 = Categories("OST_DataDevices")
categories_9 = Categories("OST_LightingDevices")
categories_10 = Categories("OST_SecurityDevices")
categories_11 = Categories("OST_TelephoneDevices")
categories_12 = Categories("OST_ElectricalFixtures")
categories_13 = Categories("OST_MechanicalEquipment")
list_create = List.Create(item0=categories, item1=categories_2, item2=categories_3, item3=categories_4, item4=categories_5, item5=categories_6, item6=categories_7, item7=categories_8, item8=categories_9, item9=categories_10, item10=categories_11, item11=categories_12, item12=categories_13)
flatten = List.Flatten(list=list_create)

all_elements_of_category = ElementsOfCategory(Category=list_create)
nome_do_parâmetro = StringInput("Imagem")  # graph input
getParameterValueByName = Element.GetParameterValueByName(element=all_elements_of_category, parameterName=nome_do_parâmetro)
code_block = CodeBlock { ""; }
eq = getParameterValueByName == code_block
filterByBoolMask = List.FilterByBoolMask(list=all_elements_of_category, mask=eq)
python_script = Python(IN[0]=filterByBoolMask.out)
# ---------- python_script.python (38 lines) ----------
import clr
clr.AddReference("RevitAPI")
clr.AddReference("RevitServices")

from Autodesk.Revit.DB import ElementId
from RevitServices.Persistence import DocumentManager
from RevitServices.Transactions import TransactionManager

clr.AddReference("RevitNodes")
import Revit
clr.ImportExtensions(Revit.Elements)

# Entrada
inputElements = IN[0]

# Garante que a lista seja achatada (flatten)
def flatten(lst):
    for item in lst:
        if isinstance(item, list):
            for sub in flatten(item):
                yield sub
        else:
            yield item

# Aplica flatten e unwrap
flatElements = [UnwrapElement(e) for e in flatten(inputElements)]

doc = DocumentManager.Instance.CurrentDBDocument
TransactionManager.Instance.EnsureInTransaction(doc)

for el in flatElements:
    param = el.LookupParameter("Imagem")
    if param and param.HasValue:
        param.Set(ElementId.InvalidElementId)  # Deixa o parâmetro como <Nenhum>

TransactionManager.Instance.TransactionTaskDone()

OUT = flatElements
# ----------------------------------------
flatten_2 = List.Flatten(list=python_script)

# group: Mensagem
count = List.Count(list=flatten_2)
code_block_2 = CodeBlock { 0; }
gt = count > code_block_2
code_block_3 = CodeBlock(N=count) { ["Feito! você deletou "+N+" Identificadores"]; }
code_block_4 = CodeBlock { ["Nenhum Identificador foi deletado"]; }
if_ = If(test=gt, true=code_block_3, false=code_block_4)
flatten_3 = List.Flatten(list=if_)
fromList = Python(IN[0]=flatten_3)  # "String.FromList"
# ---------- fromList.python (22 lines) ----------
# Carregar as bibliotecas DesignScript e padrão do Python
import sys
import clr
clr.AddReference('ProtoGeometry')
from Autodesk.DesignScript.Geometry import *

# Função para concatenar os valores de uma lista em uma única string com múltiplas linhas
def concatenate_list_to_string(input_list, delimiter="\n"):
    # Verifica se a entrada é uma lista
    if not isinstance(input_list, list):
        return "A entrada deve ser uma lista."
    
    # Converte todos os elementos para string e junta com o delimitador especificado
    result = delimiter.join(str(item) for item in input_list)
    return result

# Entrada pelo nó do Dynamo
lista = IN[0]  # Lista de valores a serem concatenados
delimitador = IN[1] if len(IN) > 1 else "\n"  # Delimitador opcional, padrão é nova linha

# Saída para o Dynamo
OUT = concatenate_list_to_string(lista, delimitador)
# ----------------------------------------
python_script_2 = Python(IN[0]=fromList)
# ---------- python_script_2.python (21 lines) ----------
# Importar as bibliotecas necessárias do Revit
import clr
clr.AddReference("RevitServices")
from RevitServices.Persistence import DocumentManager

clr.AddReference("RevitAPI")
clr.AddReference("RevitAPIUI")
from Autodesk.Revit.UI import TaskDialog

# Pegar a entrada do Dynamo
mensagem = IN[0]

# Criar a TaskDialog
task_dialog = TaskDialog("Ok")
task_dialog.MainInstruction = mensagem

# Exibir a TaskDialog
task_dialog.Show()

# Saída do script
OUT = "Sucesso!"
# ----------------------------------------
