# Dynamo graph 13-0_BIMACON_Gerar Legenda Simbologia_R04_script.dyn (Dynamo 2.16.2.5624)
# packages: archi-lab.net 2023.213.1722

# group: CATEGORIAS
categories = Categories("OST_ConduitFitting")
categories_2 = Categories("OST_Conduit")
categories_3 = Categories("OST_CableTray")
categories_4 = Categories("OST_CableTrayFitting")
categories_5 = Categories("OST_ElectricalEquipment")
categories_6 = Categories("OST_LightingFixtures")
categories_7 = Categories("OST_CommunicationDevices")
categories_8 = Categories("OST_DataDevices")
categories_9 = Categories("OST_LightingDevices")
categories_10 = Categories("OST_SecurityDevices")
categories_11 = Categories("OST_TelephoneDevices")
categories_12 = Categories("OST_ElectricalFixtures")
categories_13 = Categories("OST_MechanicalEquipment")
list_create = List.Create(item0=categories, item1=categories_2, item2=categories_3, item3=categories_4, item4=categories_5, item5=categories_6, item6=categories_7, item7=categories_8, item8=categories_9, item9=categories_10, item10=categories_11, item11=categories_12, item12=categories_13)
flatten = List.Flatten(list=list_create)

all_elements_of_category = ElementsOfCategory(Category=list_create)
flatten_2 = List.Flatten(list=all_elements_of_category)
code_block = CodeBlock { "Bimacon_Legenda"; }
getParameterValueByName = Element.GetParameterValueByName(element=flatten_2, parameterName=code_block)
code_block_2 = CodeBlock { ""; }
eq = getParameterValueByName == code_block_2
filterByBoolMask = List.FilterByBoolMask(list=flatten_2, mask=eq)
flatten_3 = List.Flatten(list=filterByBoolMask.out)
watch = Watch(flatten_3)
code_block_3 = CodeBlock { "Imagem"; }
boolean = BoolSelector(true)
pasta_das_imagens = Python(IN[0]=boolean)  # IronPython2
# ---------- pasta_das_imagens.python (24 lines) ----------
import clr

# Adiciona referência ao ambiente .NET
clr.AddReference('System')
from System import Environment, IO

# Entrada: booleano que define se deve ou não executar
executar = IN[0]

# Se executar for True, prossegue
if executar:
    # Recupera o nome do usuário logado no Windows
    usuario = Environment.UserName

    # Monta o caminho completo para a pasta de imagens
    caminho_base = r"C:\Users\{0}\AppData\Roaming\pyRevit\Extensions\Bimacon.extension\Bimacon.tab\Imagens_Bimacon".format(usuario)

    # Verifica se a pasta existe
    existe = IO.Directory.Exists(caminho_base)

    # Saída
    OUT = caminho_base if existe else "Pasta não encontrada: {0}".format(caminho_base)
else:
    OUT = "Execução não permitida"
# ----------------------------------------

# group: Ler do Excel
string = StringInput("SIMBOLOGIA ELÉTRICA EXPORTAR.xlsx")
pasta_da_planilha = Python(IN[0]=string)  # IronPython2
# ---------- pasta_da_planilha.python (22 lines) ----------
import clr

# Adiciona referência ao ambiente .NET
clr.AddReference('System')
from System import Environment, IO

# Nome da imagem (entrada do usuário)
nome_arquivo_imagem = IN[0]

# Recupera o nome do usuário logado no Windows
usuario = Environment.UserName

# Monta o caminho completo para a pasta de imagens
caminho_base = r"C:\Users\{0}\AppData\Roaming\pyRevit\Extensions\Bimacon.extension\Bimacon.tab\Imagens_Bimacon".format(usuario)

# Junta o caminho base com o nome do arquivo
caminho_completo = IO.Path.Combine(caminho_base, nome_arquivo_imagem)

# Verifica se o arquivo existe
existe = IO.File.Exists(caminho_completo)

OUT = caminho_completo if existe else "Arquivo não encontrado: {0}".format(caminho_completo)
# ----------------------------------------
file_from_path = FileObject(path=pasta_da_planilha)
code_block_4 = CodeBlock { "SIMBOLOGIA ELÉTRICA EXPORTAR"; }
code_block_5 = CodeBlock { true; }
boolean_2 = BoolSelector(false)
importExcel = Data.ImportExcel(file=file_from_path, sheetName=code_block_4, readAsStrings=code_block_5, showExcel=boolean_2)
transpose = List.Transpose(lists=importExcel)
code_block_6 = CodeBlock { 0; }
removeItemAtIndex = List.RemoveItemAtIndex(list=transpose, indices=code_block_6, lacing=Longest)

code_block_7 = CodeBlock(list=removeItemAtIndex) { list[3]; }
sort = List.Sort(list=code_block_7)
filterByBoolMask_2 = List.FilterByBoolMask(list=getParameterValueByName, mask=eq)
flatten_4 = List.Flatten(list=filterByBoolMask_2.out)
code_block_8 = CodeBlock(list=removeItemAtIndex) { list[2]; }
indexOf = List.IndexOf(list=code_block_7, element=sort)
getItemAtIndex = List.GetItemAtIndex(list=code_block_8, index=indexOf)
eq_2 = flatten_4@L1 == getItemAtIndex
filterByBoolMask_3 = List.FilterByBoolMask(list=sort@L2, mask=eq_2, lacing=Longest)
boolean_3 = BoolSelector(false)
clean = List.Clean(list=filterByBoolMask_3.in, preserveIndices=boolean_3)
uniqueItems = List.UniqueItems(list=clean)
flatten_5 = List.Flatten(list=uniqueItems)
sort_2 = List.Sort(list=flatten_5)

# group: Encontre a imagem certa para o nome certo
element_types = ElementTypes("ImageType")  # graph input
all_elements_of_type = ElementsOfType(element_type=element_types)
code_block_9 = CodeBlock { "Nome do tipo"; }
getParameterValueByName_2 = Element.GetParameterValueByName(element=all_elements_of_type, parameterName=code_block_9)
eq_3 = sort_2@L1 == getParameterValueByName_2
filterByBoolMask_4 = List.FilterByBoolMask(list=getParameterValueByName_2@L2, mask=eq_3, lacing=Longest)
flatten_6 = List.Flatten(list=filterByBoolMask_4.in@@L2)
filterByBoolMask_5 = List.FilterByBoolMask(list=all_elements_of_type@L2, mask=eq_3, lacing=Longest)
flatten_7 = List.Flatten(list=filterByBoolMask_5.in@@L2)

uniqueItems_2 = List.UniqueItems(list=flatten_6@@L2)
contains = List.Contains(list=uniqueItems_2@L2, item=sort_2, lacing=Longest)
filterByBoolMask_6 = List.FilterByBoolMask(list=sort_2, mask=contains@L2)
empty_list_verificação = CodeBlock(a=contains, b=sort_2, c=filterByBoolMask_6.out) { indx = DSCore.List.IsEmpty(a) ? 0 : 1; rslt = [b,a][indx]; rslt2 = [b,c][indx]; }
flatten_8 = List.Flatten(list=empty_list_verificação.rslt2)
code_block_10 = CodeBlock(caminho=pasta_das_imagens, nome_imagem=flatten_8) { caminho + "\\" + nome_imagem; }
importar_imagens = Python(IN[0]=code_block_10)  # IronPython2
# ---------- importar_imagens.python (33 lines) ----------
import clr
clr.AddReference('RevitServices')
from RevitServices.Persistence import DocumentManager
from RevitServices.Transactions import TransactionManager

clr.AddReference('RevitAPI')
from Autodesk.Revit.DB import *

# Entradas do Dynamo
caminhos_completos = IN[0]  # Lista de caminhos das imagens

# Documento ativo
doc = DocumentManager.Instance.CurrentDBDocument

# Lista para armazenar os ImageTypes criados
imagens_importadas = []

# Início da transação
TransactionManager.Instance.EnsureInTransaction(doc)

for caminho in caminhos_completos:
    try:
        image_options = ImageTypeOptions(caminho, False, ImageTypeSource.Import)
        image_type = ImageType.Create(doc, image_options)
        imagens_importadas.append(image_type)
    except Exception as e:
        imagens_importadas.append("Erro ao importar {}: {}".format(caminho, e))

# Fim da transação
TransactionManager.Instance.TransactionTaskDone()

# Saída
OUT = imagens_importadas
# ----------------------------------------
boolean_4 = BoolSelector(false)
clean_2 = List.Clean(list=flatten_7, preserveIndices=boolean_4)
list_create_2 = List.Create(item0=importar_imagens, item1=clean_2)
end = Revit.Transaction.Transaction.End(input=list_create_2)
start = Revit.Transaction.Transaction.Start(input=end)
watch_2 = Watch(filterByBoolMask_3.in)
passThrough = Custom[PassThrough](passThrough=watch_2, waitFor=start)  # package archi-lab.net; Ripped this off from Clockwork. Sorry Andy.

# group: Encontre a imagem certa para o nome certo
element_types_2 = ElementTypes("ImageType")  # graph input
passThrough_2 = Custom[PassThrough](passThrough=element_types_2, waitFor=start)
all_elements_of_type_2 = ElementsOfType(element_type=passThrough_2)
code_block_11 = CodeBlock { "Nome do tipo"; }
getParameterValueByName_3 = Element.GetParameterValueByName(element=all_elements_of_type_2, parameterName=code_block_11)
eq_4 = passThrough@@L1 == getParameterValueByName_3
filterByBoolMask_7 = List.FilterByBoolMask(list=all_elements_of_type_2@L3, mask=eq_4, lacing=Longest)
flatten_9 = List.Flatten(list=filterByBoolMask_7.in@@L4)
filterByBoolMask_8 = List.FilterByBoolMask(list=getParameterValueByName_3@L3, mask=eq_4, lacing=Longest)
flatten_10 = List.Flatten(list=filterByBoolMask_8.in@@L4)

setParameterByName = Element.SetParameterByName(element=watch@L2, parameterName=code_block_3, value=flatten_9@L2)
boolean_5 = BoolSelector(false)
clean_3 = List.Clean(list=setParameterByName@L2, preserveIndices=boolean_5)

# group: Mensagem Final
count = List.Count(list=clean_3@L2)
code_block_12 = CodeBlock { 0; }
gt = count > code_block_12
code_block_13 = CodeBlock(N=count) { ["Feito "+N+" elementos Com símbolos"]; }
code_block_14 = CodeBlock { ["Nenhum símbolo atribuido"]; }
if_ = If(test=gt, true=code_block_13, false=code_block_14)
flatten_11 = List.Flatten(list=if_)
fromList = Python(IN[0]=flatten_11)  # "String.FromList"; IronPython2
# ---------- fromList.python (22 lines) ----------
# Carregar as bibliotecas DesignScript e padrão do Python
import sys
import clr
clr.AddReference('ProtoGeometry')
from Autodesk.DesignScript.Geometry import *

# Função para concatenar os valores de uma lista em uma única string com múltiplas linhas
def concatenate_list_to_string(input_list, delimiter="\n"):
    # Verifica se a entrada é uma lista
    if not isinstance(input_list, list):
        return "A entrada deve ser uma lista."
    
    # Converte todos os elementos para string e junta com o delimitador especificado
    result = delimiter.join(str(item) for item in input_list)
    return result

# Entrada pelo nó do Dynamo
lista = IN[0]  # Lista de valores a serem concatenados
delimitador = IN[1] if len(IN) > 1 else "\n"  # Delimitador opcional, padrão é nova linha

# Saída para o Dynamo
OUT = concatenate_list_to_string(lista, delimitador)
# ----------------------------------------
python_script = Python(IN[0]=fromList)  # IronPython2
# ---------- python_script.python (21 lines) ----------
# Importar as bibliotecas necessárias do Revit
import clr
clr.AddReference("RevitServices")
from RevitServices.Persistence import DocumentManager

clr.AddReference("RevitAPI")
clr.AddReference("RevitAPIUI")
from Autodesk.Revit.UI import TaskDialog

# Pegar a entrada do Dynamo
mensagem = IN[0]

# Criar a TaskDialog
task_dialog = TaskDialog("Ok")
task_dialog.MainInstruction = mensagem

# Exibir a TaskDialog
task_dialog.Show()

# Saída do script
OUT = "Sucesso!"
# ----------------------------------------
