# Dynamo graph 2021_16-3_BIMACON_ Duplicar e Limpar Tabela de Cabos_R00_script.dyn "2021_16-3_BIMACON_ Duplicar e Limpar Tabela de Cabos_R00" (Dynamo 2.6.1.8786)
# Duplica uma Tabela e faz a limpeza deixando apenas os cabos que estão sendo utilizados no projeto.
# packages: bimorphNodes 4.2.4, archi-lab.net 2023.213.1722, Data-Shapes 2022.2.105

# group: ENTRADAS PARA O USUÁRIO
code_block = CodeBlock { "Duplique e Limpe a Tabela de Cabos"; }
file_path = Filename("..\..\..\..\..\05 - BIMACON\01 - EMPRESA BIMACON\00 - Logos e imagens - BIMACON\ARTE BIMACON\reddonda-removebg-preview.png")
file_from_path = FileObject(path=file_path)
readFromFile = Image.ReadFromFile(file=file_from_path)
string = StringInput("Confirmar")
string_2 = StringInput("Escolha a Tabela a ser limpa")
element_types = ElementTypes("TableView")
all_elements_of_type = ElementsOfType(element_type=element_types)
name = Element.Name(element=all_elements_of_type)
code_block_2 = CodeBlock { 0; }
string_3 = StringInput("Prefixo")
string_4 = StringInput("01 - ")
boolean = BoolSelector(false)
textbox_data = Custom[TextBox Data](InputName=string_3, DefaultText=string_4, IsNumberEntry=boolean)  # package Data-Shapes; Create Data for TextBox input in UI.MultipleInputForm ++ . Check out www.data-shapes.net for more informations
string_5 = StringInput("Sufixo")
string_6 = StringInput("- LIMPA")
boolean_2 = BoolSelector(false)
textbox_data_2 = Custom[TextBox Data](InputName=string_5, DefaultText=string_6, IsNumberEntry=boolean_2)
boolean_3 = BoolSelector(true)
string_7 = StringInput("Cancelar")
number = DoubleInput(550)
number_2 = DoubleInput(145)
code_block_3 = CodeBlock()  # //Data-Shapes
code_block_4 = CodeBlock()  # //archilab

string_8 = StringInput("SOMA Cabos")
contains = String.Contains(str=name, searchFor=string_8)
filterByBoolMask = List.FilterByBoolMask(list=all_elements_of_type, mask=contains)
name_2 = Element.Name(element=filterByBoolMask.in)

# group (continued): ENTRADAS PARA O USUÁRIO
dropdown_data = Custom[DropDown Data](InputName=string_2, Keys=name_2, Values=filterByBoolMask.in, DefaultValueIndex=code_block_2)  # package Data-Shapes; Create data for DropDown input in UI.MultiInputForm ++ . Check out www.data-shapes.net for more infos.
list_create = List.Create(item0=dropdown_data, item1=textbox_data, item2=textbox_data_2)
multipleinputform = Custom[MultipleInputForm ++](Description_optional=code_block, Logo_optional=readFromFile, ButtonText_optional=string, Inputs=list_create, Toggle=boolean_3, CancelButtonText_optional=string_7, Width_optional=number, LabelWidth_optional=number_2)  # package Data-Shapes; Create a form with multiple inputs. see www.data-shapes.net for tutorials and infos!

# group: Separar Entradas
code_block_5 = CodeBlock { 0; }
getItemAtIndex = List.GetItemAtIndex(list=multipleinputform.User_Inputs, index=code_block_5)
code_block_6 = CodeBlock { 1; }
getItemAtIndex_2 = List.GetItemAtIndex(list=multipleinputform.User_Inputs, index=code_block_6)
code_block_7 = CodeBlock { 2; }
getItemAtIndex_3 = List.GetItemAtIndex(list=multipleinputform.User_Inputs, index=code_block_7)

name_3 = Element.Name(element=getItemAtIndex)
code_block_8 = CodeBlock(a=getItemAtIndex_2, b=name_3, c=getItemAtIndex_3) { a+b+c; }
duplicate_options = DuplicateOptionsUi("Duplicate")
duplicate = archilab.Revit.Views.Views.Duplicate(view=getItemAtIndex, name=code_block_8, options=duplicate_options)
fields = ScheduleView.Fields(scheduleView=duplicate)
getData = Revit.Schedule.GetData(scheduleView=duplicate)
code_block_9 = CodeBlock { 1; }
getItemAtIndex_4 = List.GetItemAtIndex(list=getData, index=code_block_9)
string_9 = StringInput("0,00")
eq = getItemAtIndex_4 == string_9
filterByBoolMask_2 = List.FilterByBoolMask(list=fields, mask=eq)
string_10 = StringInput("0")
eq_2 = getItemAtIndex_4 == string_10
filterByBoolMask_3 = List.FilterByBoolMask(list=fields, mask=eq_2)
string_11 = StringInput("0,0")
eq_3 = getItemAtIndex_4 == string_11
filterByBoolMask_4 = List.FilterByBoolMask(list=fields, mask=eq_3)
list_create_2 = List.Create(item0=filterByBoolMask_2.in, item1=filterByBoolMask_3.in, item2=filterByBoolMask_4.in)
flatten = List.Flatten(list=list_create_2)
removeFields = ScheduleView.RemoveFields(scheduleView=duplicate, fields=flatten)
list_create_3 = List.Create(item0=filterByBoolMask_2.out, item1=filterByBoolMask_3.out, item2=filterByBoolMask_4.out)
flatten_2 = List.Flatten(list=list_create_3)
