# Dynamo graph 16-0_BIMACON_Somar Tabelas de Cabos por CORES ELE_R04_script.dyn "ok 2021_16-0_BIMACON_Somar Tabelas de Cabos por CORES ELE_R04_script" (Dynamo 2.19.3.6394)
# author: Jose Nelson
# Soma os cabos das Bandeja de Cabos, Consuiítes e das conexões
# packages: bimorphNodes 4.2.4, Clockwork for Dynamo 2.x 2.4.0, Sparrow 2021.2.1

boolean = BoolSelector(false)
views = Views("Cabos PVC ELE em Bandeja de Cabos (Cobre/Un/Isol. PVC/750V/70°C)")
code_block = CodeBlock { 1; }
getDataRows = Revit.Schedule.GetDataRows(scheduleView=views, rowIndexes=code_block, lacing=CrossProduct)
code_block_2 = CodeBlock { "0,0"; "0,01"; }
eq = code_block_2.out1 == _  # unwired: y
replaceByCondition = Replace(item=getDataRows, replaceWith=code_block_2.out0, condition=eq)
sring_tonumber_bimacon = Python(IN[0]=replaceByCondition)  # IronPython2
# ---------- sring_tonumber_bimacon.python (43 lines) ----------
# Importa as bibliotecas necessárias
import clr
clr.AddReference('RevitAPI')
from Autodesk.Revit.DB import *

# Define a função para converter a lista de strings em decimais, mantendo a estrutura
def converter_para_decimal(entrada):
  """
  Converte uma entrada (que pode ser uma lista aninhada) em uma nova lista com a mesma estrutura,
  onde as strings numéricas são substituídas por números decimais.

  Args:
    entrada: Uma lista ou string representando números decimais.

  Returns:
    Uma lista com a mesma estrutura da entrada, com os valores numéricos convertidos.
  """

  if isinstance(entrada, list):
    nova_lista = []
    for item in entrada:
      nova_lista.append(converter_para_decimal(item)) # Chamada recursiva para manter a estrutura
    return nova_lista
  elif isinstance(entrada, str):
    entrada = entrada.replace(",", ".")
    try:
      decimal = float(entrada)
      return decimal # Retorna o decimal diretamente
    except ValueError:
      print("Erro: Não foi possível converter '{}' para um número decimal.".format(entrada))
      return entrada # Retorna a string original em caso de erro
  else:
    print("Erro: A entrada '{}' não é uma string ou lista.".format(entrada))
    return entrada # Retorna o valor original em caso de erro

# Obtém a lista de strings da entrada do Dynamo
entrada = IN[0]

# Converte a lista de strings em decimais, mantendo a estrutura
lista_convertida = converter_para_decimal(entrada)

# Define a lista de decimais como saída do Dynamo
OUT = lista_convertida
# ----------------------------------------
views_2 = Views("Cabos PVC ELE em Conduítes (Cobre/Un/Isol. PVC/750V/70°C)")
code_block_3 = CodeBlock { 1; }
getDataRows_2 = Revit.Schedule.GetDataRows(scheduleView=views_2, rowIndexes=code_block_3, lacing=CrossProduct)
replaceByCondition_2 = Replace(item=getDataRows_2, replaceWith=code_block_2.out0, condition=eq)
sring_tonumber_bimacon_2 = Python(IN[0]=replaceByCondition_2)  # IronPython2; same code as sring_tonumber_bimacon
views_3 = Views("Cabos PVC ELE em Conexões (Cobre/Un/Isol. PVC/750V/70°C)")
code_block_4 = CodeBlock { 1; }
getDataRows_3 = Revit.Schedule.GetDataRows(scheduleView=views_3, rowIndexes=code_block_4, lacing=CrossProduct)
code_block_5 = CodeBlock { "0,0"; "0,02"; }
eq_2 = code_block_5.out1 == _  # unwired: y
replaceByCondition_3 = Replace(item=getDataRows_3, replaceWith=code_block_5.out0, condition=eq_2)
sring_tonumber_bimacon_3 = Python(IN[0]=replaceByCondition_3)  # IronPython2; same code as sring_tonumber_bimacon
code_block_6 = CodeBlock(a=sring_tonumber_bimacon, b=sring_tonumber_bimacon_2, c=sring_tonumber_bimacon_3) { a+b+c; }
watch = Watch(code_block_6)
boolean_2 = BoolSelector(false)

# group: Selecionar familia genérica para atribuir parâmetros SOMA
categories = Categories("OST_GenericModel")
all_elements_of_category = ElementsOfCategory(Category=categories)
string_from_object = FromObject(object=all_elements_of_category)
code_block_7 = CodeBlock { "Somatória Cabos"; }
eq_3 = string_from_object == code_block_7
filterByBoolMask = List.FilterByBoolMask(list=all_elements_of_category, mask=eq_3)

code_block_8 = CodeBlock { 0; }
boolean_3 = BoolSelector(false)
getDataRows_4 = Revit.Schedule.GetDataRows(scheduleView=views, rowIndexes=code_block_8, refresh=boolean_3)

# group: Cabos dentro de caixas e modelados como conduite
views_4 = Views("03 - Qtd. Cabos Entrada e Dentro das Caixas CEMIG")
code_block_9 = CodeBlock { 2; }
getDataColumns = Revit.Schedule.GetDataColumns(scheduleView=views_4, columnIndexes=code_block_9)
views_5 = Views("04 - Qtd. Cabos Flexíveis (conduítes)")
code_block_10 = CodeBlock { 2; }
getDataColumns_2 = Revit.Schedule.GetDataColumns(scheduleView=views_5, columnIndexes=code_block_10)
list_create = List.Create(item0=getDataColumns, item1=getDataColumns_2)
code_block_11 = CodeBlock { 0; }
getDataColumns_3 = Revit.Schedule.GetDataColumns(scheduleView=views_4, columnIndexes=code_block_11)
code_block_12 = CodeBlock { 0; }
getDataColumns_4 = Revit.Schedule.GetDataColumns(scheduleView=views_5, columnIndexes=code_block_12)
code_block_13 = CodeBlock { " "; }
add = getDataColumns_4 + code_block_13
code_block_14 = CodeBlock { 1; }
getDataColumns_5 = Revit.Schedule.GetDataColumns(scheduleView=views_5, columnIndexes=code_block_14)
string = StringInput("Vermelho 1,5mm²")
string_2 = StringInput("Vermelho 2,5mm²")
string_3 = StringInput("Vermelho 4,0mm²")
string_4 = StringInput(" Vermelho 6,0mm²")
string_5 = StringInput("Vermelho 10,0mm²")
string_6 = StringInput("Vermelho 16,0mm²")
string_7 = StringInput("Vermelho 25,0mm²")
string_8 = StringInput("Vermelho 35,0mm²")
string_9 = StringInput("Vermelho 50,0mm²")
string_10 = StringInput("Vermelho 70,0mm²")
string_11 = StringInput("Vermelho 95,0mm²")
string_12 = StringInput("Vermelho 120,0mm²")
string_13 = StringInput("Vermelho 150,0mm²")
string_14 = StringInput("Vermelho 185,0mm²")
string_15 = StringInput("Vermelho 240,0mm²")
string_16 = StringInput("Vermelho 300,0mm²")
string_17 = StringInput("Vermelho 400,0mm²")
string_18 = StringInput("Vermelho 500,0mm²")

sring_tonumber_bimacon_4 = Python(IN[0]=list_create)  # IronPython2; same code as sring_tonumber_bimacon
add_2 = add + getDataColumns_5

# group (continued): Cabos dentro de caixas e modelados como conduite
list_create_2 = List.Create(item0=getDataColumns_3, item1=add_2)
contains = String.Contains(string=list_create_2, searchFor=string)
filterByBoolMask_2 = List.FilterByBoolMask(list=sring_tonumber_bimacon_4, mask=contains)
flatten = List.Flatten(list=filterByBoolMask_2.in)
sum = Math.Sum(values=flatten)
contains_2 = String.Contains(string=list_create_2, searchFor=string_2)
contains_3 = String.Contains(string=list_create_2, searchFor=string_3)
contains_4 = String.Contains(string=list_create_2, searchFor=string_4)
contains_5 = String.Contains(string=list_create_2, searchFor=string_5)
contains_6 = String.Contains(string=list_create_2, searchFor=string_6)
contains_7 = String.Contains(string=list_create_2, searchFor=string_7)
contains_8 = String.Contains(string=list_create_2, searchFor=string_8)
contains_9 = String.Contains(string=list_create_2, searchFor=string_9)
contains_10 = String.Contains(string=list_create_2, searchFor=string_10)
contains_11 = String.Contains(string=list_create_2, searchFor=string_11)
contains_12 = String.Contains(string=list_create_2, searchFor=string_12)
contains_13 = String.Contains(string=list_create_2, searchFor=string_13)
contains_14 = String.Contains(string=list_create_2, searchFor=string_14)
contains_15 = String.Contains(string=list_create_2, searchFor=string_15)
contains_16 = String.Contains(string=list_create_2, searchFor=string_16)
contains_17 = String.Contains(string=list_create_2, searchFor=string_17)
contains_18 = String.Contains(string=list_create_2, searchFor=string_18)

sring_tonumber_bimacon_5 = Python(IN[0]=list_create)  # IronPython2; same code as sring_tonumber_bimacon

# group (continued): Cabos dentro de caixas e modelados como conduite
filterByBoolMask_3 = List.FilterByBoolMask(list=sring_tonumber_bimacon_5, mask=contains_2)
flatten_2 = List.Flatten(list=filterByBoolMask_3.in)
sum_2 = Math.Sum(values=flatten_2)

sring_tonumber_bimacon_6 = Python(IN[0]=list_create)  # IronPython2; same code as sring_tonumber_bimacon

# group (continued): Cabos dentro de caixas e modelados como conduite
filterByBoolMask_4 = List.FilterByBoolMask(list=sring_tonumber_bimacon_6, mask=contains_3)
flatten_3 = List.Flatten(list=filterByBoolMask_4.in)
sum_3 = Math.Sum(values=flatten_3)

sring_tonumber_bimacon_7 = Python(IN[0]=list_create)  # IronPython2; same code as sring_tonumber_bimacon

# group (continued): Cabos dentro de caixas e modelados como conduite
filterByBoolMask_5 = List.FilterByBoolMask(list=sring_tonumber_bimacon_7, mask=contains_4)
flatten_4 = List.Flatten(list=filterByBoolMask_5.in)
sum_4 = Math.Sum(values=flatten_4)

sring_tonumber_bimacon_8 = Python(IN[0]=list_create)  # IronPython2; same code as sring_tonumber_bimacon

# group (continued): Cabos dentro de caixas e modelados como conduite
filterByBoolMask_6 = List.FilterByBoolMask(list=sring_tonumber_bimacon_8, mask=contains_5)
flatten_5 = List.Flatten(list=filterByBoolMask_6.in)
sum_5 = Math.Sum(values=flatten_5)

sring_tonumber_bimacon_9 = Python(IN[0]=list_create)  # IronPython2; same code as sring_tonumber_bimacon

# group (continued): Cabos dentro de caixas e modelados como conduite
filterByBoolMask_7 = List.FilterByBoolMask(list=sring_tonumber_bimacon_9, mask=contains_6)
flatten_6 = List.Flatten(list=filterByBoolMask_7.in)
sum_6 = Math.Sum(values=flatten_6)

sring_tonumber_bimacon_10 = Python(IN[0]=list_create)  # IronPython2; same code as sring_tonumber_bimacon

# group (continued): Cabos dentro de caixas e modelados como conduite
filterByBoolMask_8 = List.FilterByBoolMask(list=sring_tonumber_bimacon_10, mask=contains_7)
flatten_7 = List.Flatten(list=filterByBoolMask_8.in)
sum_7 = Math.Sum(values=flatten_7)

sring_tonumber_bimacon_11 = Python(IN[0]=list_create)  # IronPython2; same code as sring_tonumber_bimacon

# group (continued): Cabos dentro de caixas e modelados como conduite
filterByBoolMask_9 = List.FilterByBoolMask(list=sring_tonumber_bimacon_11, mask=contains_8)
flatten_8 = List.Flatten(list=filterByBoolMask_9.in)
sum_8 = Math.Sum(values=flatten_8)

sring_tonumber_bimacon_12 = Python(IN[0]=list_create)  # IronPython2; same code as sring_tonumber_bimacon

# group (continued): Cabos dentro de caixas e modelados como conduite
filterByBoolMask_10 = List.FilterByBoolMask(list=sring_tonumber_bimacon_12, mask=contains_9)
flatten_9 = List.Flatten(list=filterByBoolMask_10.in)
sum_9 = Math.Sum(values=flatten_9)

sring_tonumber_bimacon_13 = Python(IN[0]=list_create)  # IronPython2; same code as sring_tonumber_bimacon

# group (continued): Cabos dentro de caixas e modelados como conduite
filterByBoolMask_11 = List.FilterByBoolMask(list=sring_tonumber_bimacon_13, mask=contains_10)
flatten_10 = List.Flatten(list=filterByBoolMask_11.in)
sum_10 = Math.Sum(values=flatten_10)

sring_tonumber_bimacon_14 = Python(IN[0]=list_create)  # IronPython2; same code as sring_tonumber_bimacon

# group (continued): Cabos dentro de caixas e modelados como conduite
filterByBoolMask_12 = List.FilterByBoolMask(list=sring_tonumber_bimacon_14, mask=contains_11)
flatten_11 = List.Flatten(list=filterByBoolMask_12.in)
sum_11 = Math.Sum(values=flatten_11)

sring_tonumber_bimacon_15 = Python(IN[0]=list_create)  # IronPython2; same code as sring_tonumber_bimacon

# group (continued): Cabos dentro de caixas e modelados como conduite
filterByBoolMask_13 = List.FilterByBoolMask(list=sring_tonumber_bimacon_15, mask=contains_12)
flatten_12 = List.Flatten(list=filterByBoolMask_13.in)
sum_12 = Math.Sum(values=flatten_12)

sring_tonumber_bimacon_16 = Python(IN[0]=list_create)  # IronPython2; same code as sring_tonumber_bimacon

# group (continued): Cabos dentro de caixas e modelados como conduite
filterByBoolMask_14 = List.FilterByBoolMask(list=sring_tonumber_bimacon_16, mask=contains_13)
flatten_13 = List.Flatten(list=filterByBoolMask_14.in)
sum_13 = Math.Sum(values=flatten_13)

sring_tonumber_bimacon_17 = Python(IN[0]=list_create)  # IronPython2; same code as sring_tonumber_bimacon

# group (continued): Cabos dentro de caixas e modelados como conduite
filterByBoolMask_15 = List.FilterByBoolMask(list=sring_tonumber_bimacon_17, mask=contains_14)
flatten_14 = List.Flatten(list=filterByBoolMask_15.in)
sum_14 = Math.Sum(values=flatten_14)

sring_tonumber_bimacon_18 = Python(IN[0]=list_create)  # IronPython2; same code as sring_tonumber_bimacon

# group (continued): Cabos dentro de caixas e modelados como conduite
filterByBoolMask_16 = List.FilterByBoolMask(list=sring_tonumber_bimacon_18, mask=contains_15)
flatten_15 = List.Flatten(list=filterByBoolMask_16.in)
sum_15 = Math.Sum(values=flatten_15)

sring_tonumber_bimacon_19 = Python(IN[0]=list_create)  # IronPython2; same code as sring_tonumber_bimacon

# group (continued): Cabos dentro de caixas e modelados como conduite
filterByBoolMask_17 = List.FilterByBoolMask(list=sring_tonumber_bimacon_19, mask=contains_16)
flatten_16 = List.Flatten(list=filterByBoolMask_17.in)
sum_16 = Math.Sum(values=flatten_16)

sring_tonumber_bimacon_20 = Python(IN[0]=list_create)  # IronPython2; same code as sring_tonumber_bimacon

# group (continued): Cabos dentro de caixas e modelados como conduite
filterByBoolMask_18 = List.FilterByBoolMask(list=sring_tonumber_bimacon_20, mask=contains_17)
flatten_17 = List.Flatten(list=filterByBoolMask_18.in)
sum_17 = Math.Sum(values=flatten_17)

sring_tonumber_bimacon_21 = Python(IN[0]=list_create)  # IronPython2; same code as sring_tonumber_bimacon

# group (continued): Cabos dentro de caixas e modelados como conduite
filterByBoolMask_19 = List.FilterByBoolMask(list=sring_tonumber_bimacon_21, mask=contains_18)
flatten_18 = List.Flatten(list=filterByBoolMask_19.in)
sum_18 = Math.Sum(values=flatten_18)
list_create_3 = List.Create(item0=sum, item1=sum_2, item2=sum_3, item3=sum_4, item4=sum_5, item5=sum_6, item6=sum_7, item7=sum_8, item8=sum_9, item9=sum_10, item10=sum_11, item11=sum_12, item12=sum_13, item13=sum_14, item14=sum_15, item15=sum_16, item16=sum_17, item17=sum_18)

# group: Cabos dentro de caixas e modelados como conduite
views_6 = Views("03 - Qtd. Cabos Entrada e Dentro das Caixas CEMIG")
code_block_15 = CodeBlock { 2; }
getDataColumns_6 = Revit.Schedule.GetDataColumns(scheduleView=views_6, columnIndexes=code_block_15)
views_7 = Views("04 - Qtd. Cabos Flexíveis (conduítes)")
code_block_16 = CodeBlock { 2; }
getDataColumns_7 = Revit.Schedule.GetDataColumns(scheduleView=views_7, columnIndexes=code_block_16)
list_create_4 = List.Create(item0=getDataColumns_6, item1=getDataColumns_7)
code_block_17 = CodeBlock { 0; }
getDataColumns_8 = Revit.Schedule.GetDataColumns(scheduleView=views_6, columnIndexes=code_block_17)
code_block_18 = CodeBlock { 0; }
getDataColumns_9 = Revit.Schedule.GetDataColumns(scheduleView=views_7, columnIndexes=code_block_18)
code_block_19 = CodeBlock { " "; }
add_3 = getDataColumns_9 + code_block_19
code_block_20 = CodeBlock { 1; }
getDataColumns_10 = Revit.Schedule.GetDataColumns(scheduleView=views_7, columnIndexes=code_block_20)
string_19 = StringInput("Branco 1,5mm²")
string_20 = StringInput("Branco 2,5mm²")
string_21 = StringInput("Branco 4,0mm²")
string_22 = StringInput(" Branco 6,0mm²")
string_23 = StringInput("Branco 10,0mm²")
string_24 = StringInput("Branco 16,0mm²")
string_25 = StringInput("Branco 25,0mm²")
string_26 = StringInput("Branco 35,0mm²")
string_27 = StringInput("Branco 50,0mm²")
string_28 = StringInput("Branco 70,0mm²")
string_29 = StringInput("Branco 95,0mm²")
string_30 = StringInput("Branco 120,0mm²")
string_31 = StringInput("Branco 150,0mm²")
string_32 = StringInput("Branco 185,0mm²")
string_33 = StringInput("Branco 240,0mm²")
string_34 = StringInput("Branco 300,0mm²")
string_35 = StringInput("Branco 400,0mm²")
sring_tonumber_bimacon_22 = Python(IN[0]=list_create_4)  # IronPython2; same code as sring_tonumber_bimacon
string_36 = StringInput("Branco 500,0mm²")

sring_tonumber_bimacon_23 = Python(IN[0]=list_create_4)  # IronPython2; same code as sring_tonumber_bimacon
add_4 = add_3 + getDataColumns_10

# group (continued): Cabos dentro de caixas e modelados como conduite
list_create_5 = List.Create(item0=getDataColumns_8, item1=add_4)
contains_19 = String.Contains(string=list_create_5, searchFor=string_19)
filterByBoolMask_20 = List.FilterByBoolMask(list=sring_tonumber_bimacon_23, mask=contains_19)
flatten_19 = List.Flatten(list=filterByBoolMask_20.in)
sum_19 = Math.Sum(values=flatten_19)
contains_20 = String.Contains(string=list_create_5, searchFor=string_20)
contains_21 = String.Contains(string=list_create_5, searchFor=string_21)
contains_22 = String.Contains(string=list_create_5, searchFor=string_22)
contains_23 = String.Contains(string=list_create_5, searchFor=string_23)
contains_24 = String.Contains(string=list_create_5, searchFor=string_24)
contains_25 = String.Contains(string=list_create_5, searchFor=string_25)
contains_26 = String.Contains(string=list_create_5, searchFor=string_26)
contains_27 = String.Contains(string=list_create_5, searchFor=string_27)
contains_28 = String.Contains(string=list_create_5, searchFor=string_28)
contains_29 = String.Contains(string=list_create_5, searchFor=string_29)
contains_30 = String.Contains(string=list_create_5, searchFor=string_30)
contains_31 = String.Contains(string=list_create_5, searchFor=string_31)
contains_32 = String.Contains(string=list_create_5, searchFor=string_32)
contains_33 = String.Contains(string=list_create_5, searchFor=string_33)
contains_34 = String.Contains(string=list_create_5, searchFor=string_34)
contains_35 = String.Contains(string=list_create_5, searchFor=string_35)
contains_36 = String.Contains(string=list_create_5, searchFor=string_36)
filterByBoolMask_21 = List.FilterByBoolMask(list=sring_tonumber_bimacon_22, mask=contains_36)
flatten_20 = List.Flatten(list=filterByBoolMask_21.in)
sum_20 = Math.Sum(values=flatten_20)

sring_tonumber_bimacon_24 = Python(IN[0]=list_create_4)  # IronPython2; same code as sring_tonumber_bimacon

# group (continued): Cabos dentro de caixas e modelados como conduite
filterByBoolMask_22 = List.FilterByBoolMask(list=sring_tonumber_bimacon_24, mask=contains_20)
flatten_21 = List.Flatten(list=filterByBoolMask_22.in)
sum_21 = Math.Sum(values=flatten_21)

sring_tonumber_bimacon_25 = Python(IN[0]=list_create_4)  # IronPython2; same code as sring_tonumber_bimacon

# group (continued): Cabos dentro de caixas e modelados como conduite
filterByBoolMask_23 = List.FilterByBoolMask(list=sring_tonumber_bimacon_25, mask=contains_21)
flatten_22 = List.Flatten(list=filterByBoolMask_23.in)
sum_22 = Math.Sum(values=flatten_22)

sring_tonumber_bimacon_26 = Python(IN[0]=list_create_4)  # IronPython2; same code as sring_tonumber_bimacon

# group (continued): Cabos dentro de caixas e modelados como conduite
filterByBoolMask_24 = List.FilterByBoolMask(list=sring_tonumber_bimacon_26, mask=contains_22)
flatten_23 = List.Flatten(list=filterByBoolMask_24.in)
sum_23 = Math.Sum(values=flatten_23)

sring_tonumber_bimacon_27 = Python(IN[0]=list_create_4)  # IronPython2; same code as sring_tonumber_bimacon

# group (continued): Cabos dentro de caixas e modelados como conduite
filterByBoolMask_25 = List.FilterByBoolMask(list=sring_tonumber_bimacon_27, mask=contains_23)
flatten_24 = List.Flatten(list=filterByBoolMask_25.in)
sum_24 = Math.Sum(values=flatten_24)

sring_tonumber_bimacon_28 = Python(IN[0]=list_create_4)  # IronPython2; same code as sring_tonumber_bimacon

# group (continued): Cabos dentro de caixas e modelados como conduite
filterByBoolMask_26 = List.FilterByBoolMask(list=sring_tonumber_bimacon_28, mask=contains_24)
flatten_25 = List.Flatten(list=filterByBoolMask_26.in)
sum_25 = Math.Sum(values=flatten_25)

sring_tonumber_bimacon_29 = Python(IN[0]=list_create_4)  # IronPython2; same code as sring_tonumber_bimacon

# group (continued): Cabos dentro de caixas e modelados como conduite
filterByBoolMask_27 = List.FilterByBoolMask(list=sring_tonumber_bimacon_29, mask=contains_25)
flatten_26 = List.Flatten(list=filterByBoolMask_27.in)
sum_26 = Math.Sum(values=flatten_26)

sring_tonumber_bimacon_30 = Python(IN[0]=list_create_4)  # IronPython2; same code as sring_tonumber_bimacon

# group (continued): Cabos dentro de caixas e modelados como conduite
filterByBoolMask_28 = List.FilterByBoolMask(list=sring_tonumber_bimacon_30, mask=contains_26)
flatten_27 = List.Flatten(list=filterByBoolMask_28.in)
sum_27 = Math.Sum(values=flatten_27)

sring_tonumber_bimacon_31 = Python(IN[0]=list_create_4)  # IronPython2; same code as sring_tonumber_bimacon

# group (continued): Cabos dentro de caixas e modelados como conduite
filterByBoolMask_29 = List.FilterByBoolMask(list=sring_tonumber_bimacon_31, mask=contains_27)
flatten_28 = List.Flatten(list=filterByBoolMask_29.in)
sum_28 = Math.Sum(values=flatten_28)

sring_tonumber_bimacon_32 = Python(IN[0]=list_create_4)  # IronPython2; same code as sring_tonumber_bimacon

# group (continued): Cabos dentro de caixas e modelados como conduite
filterByBoolMask_30 = List.FilterByBoolMask(list=sring_tonumber_bimacon_32, mask=contains_28)
flatten_29 = List.Flatten(list=filterByBoolMask_30.in)
sum_29 = Math.Sum(values=flatten_29)

sring_tonumber_bimacon_33 = Python(IN[0]=list_create_4)  # IronPython2; same code as sring_tonumber_bimacon

# group (continued): Cabos dentro de caixas e modelados como conduite
filterByBoolMask_31 = List.FilterByBoolMask(list=sring_tonumber_bimacon_33, mask=contains_29)
flatten_30 = List.Flatten(list=filterByBoolMask_31.in)
sum_30 = Math.Sum(values=flatten_30)

sring_tonumber_bimacon_34 = Python(IN[0]=list_create_4)  # IronPython2; same code as sring_tonumber_bimacon

# group (continued): Cabos dentro de caixas e modelados como conduite
filterByBoolMask_32 = List.FilterByBoolMask(list=sring_tonumber_bimacon_34, mask=contains_30)
flatten_31 = List.Flatten(list=filterByBoolMask_32.in)
sum_31 = Math.Sum(values=flatten_31)

sring_tonumber_bimacon_35 = Python(IN[0]=list_create_4)  # IronPython2; same code as sring_tonumber_bimacon

# group (continued): Cabos dentro de caixas e modelados como conduite
filterByBoolMask_33 = List.FilterByBoolMask(list=sring_tonumber_bimacon_35, mask=contains_31)
flatten_32 = List.Flatten(list=filterByBoolMask_33.in)
sum_32 = Math.Sum(values=flatten_32)

sring_tonumber_bimacon_36 = Python(IN[0]=list_create_4)  # IronPython2; same code as sring_tonumber_bimacon

# group (continued): Cabos dentro de caixas e modelados como conduite
filterByBoolMask_34 = List.FilterByBoolMask(list=sring_tonumber_bimacon_36, mask=contains_32)
flatten_33 = List.Flatten(list=filterByBoolMask_34.in)
sum_33 = Math.Sum(values=flatten_33)

sring_tonumber_bimacon_37 = Python(IN[0]=list_create_4)  # IronPython2; same code as sring_tonumber_bimacon

# group (continued): Cabos dentro de caixas e modelados como conduite
filterByBoolMask_35 = List.FilterByBoolMask(list=sring_tonumber_bimacon_37, mask=contains_33)
flatten_34 = List.Flatten(list=filterByBoolMask_35.in)
sum_34 = Math.Sum(values=flatten_34)

sring_tonumber_bimacon_38 = Python(IN[0]=list_create_4)  # IronPython2; same code as sring_tonumber_bimacon

# group (continued): Cabos dentro de caixas e modelados como conduite
filterByBoolMask_36 = List.FilterByBoolMask(list=sring_tonumber_bimacon_38, mask=contains_34)
flatten_35 = List.Flatten(list=filterByBoolMask_36.in)
sum_35 = Math.Sum(values=flatten_35)

sring_tonumber_bimacon_39 = Python(IN[0]=list_create_4)  # IronPython2; same code as sring_tonumber_bimacon

# group (continued): Cabos dentro de caixas e modelados como conduite
filterByBoolMask_37 = List.FilterByBoolMask(list=sring_tonumber_bimacon_39, mask=contains_35)
flatten_36 = List.Flatten(list=filterByBoolMask_37.in)
sum_36 = Math.Sum(values=flatten_36)
list_create_6 = List.Create(item0=sum_19, item1=sum_21, item2=sum_22, item3=sum_23, item4=sum_24, item5=sum_25, item6=sum_26, item7=sum_27, item8=sum_28, item9=sum_29, item10=sum_30, item11=sum_31, item12=sum_32, item13=sum_33, item14=sum_34, item15=sum_35, item16=sum_36, item17=sum_20)

# group: Cabos dentro de caixas e modelados como conduite
views_8 = Views("03 - Qtd. Cabos Entrada e Dentro das Caixas CEMIG")
code_block_21 = CodeBlock { 2; }
getDataColumns_11 = Revit.Schedule.GetDataColumns(scheduleView=views_8, columnIndexes=code_block_21)
views_9 = Views("04 - Qtd. Cabos Flexíveis (conduítes)")
code_block_22 = CodeBlock { 2; }
getDataColumns_12 = Revit.Schedule.GetDataColumns(scheduleView=views_9, columnIndexes=code_block_22)
list_create_7 = List.Create(item0=getDataColumns_11, item1=getDataColumns_12)
code_block_23 = CodeBlock { 0; }
getDataColumns_13 = Revit.Schedule.GetDataColumns(scheduleView=views_8, columnIndexes=code_block_23)
code_block_24 = CodeBlock { 0; }
getDataColumns_14 = Revit.Schedule.GetDataColumns(scheduleView=views_9, columnIndexes=code_block_24)
code_block_25 = CodeBlock { " "; }
add_5 = getDataColumns_14 + code_block_25
code_block_26 = CodeBlock { 1; }
getDataColumns_15 = Revit.Schedule.GetDataColumns(scheduleView=views_9, columnIndexes=code_block_26)
string_37 = StringInput("Preto 1,5mm²")
string_38 = StringInput("Preto 2,5mm²")
string_39 = StringInput("Preto 4,0mm²")
string_40 = StringInput(" Preto 6,0mm²")
string_41 = StringInput("Preto 10,0mm²")
string_42 = StringInput("Preto 16,0mm²")
string_43 = StringInput("Preto 25,0mm²")
string_44 = StringInput("Preto 35,0mm²")
string_45 = StringInput("Preto 50,0mm²")
string_46 = StringInput("Preto 70,0mm²")
string_47 = StringInput("Preto 95,0mm²")
string_48 = StringInput("Preto 120,0mm²")
string_49 = StringInput("Preto 150,0mm²")
string_50 = StringInput("Preto 185,0mm²")
string_51 = StringInput("Preto 240,0mm²")
string_52 = StringInput("Preto 300,0mm²")
string_53 = StringInput("Preto 400,0mm²")
sring_tonumber_bimacon_40 = Python(IN[0]=list_create_7)  # IronPython2; same code as sring_tonumber_bimacon
string_54 = StringInput("Preto 500,0mm²")

sring_tonumber_bimacon_41 = Python(IN[0]=list_create_7)  # IronPython2; same code as sring_tonumber_bimacon
add_6 = add_5 + getDataColumns_15

# group (continued): Cabos dentro de caixas e modelados como conduite
list_create_8 = List.Create(item0=getDataColumns_13, item1=add_6)
contains_37 = String.Contains(string=list_create_8, searchFor=string_37)
filterByBoolMask_38 = List.FilterByBoolMask(list=sring_tonumber_bimacon_41, mask=contains_37)
flatten_37 = List.Flatten(list=filterByBoolMask_38.in)
sum_37 = Math.Sum(values=flatten_37)
contains_38 = String.Contains(string=list_create_8, searchFor=string_38)
contains_39 = String.Contains(string=list_create_8, searchFor=string_39)
contains_40 = String.Contains(string=list_create_8, searchFor=string_40)
contains_41 = String.Contains(string=list_create_8, searchFor=string_41)
contains_42 = String.Contains(string=list_create_8, searchFor=string_42)
contains_43 = String.Contains(string=list_create_8, searchFor=string_43)
contains_44 = String.Contains(string=list_create_8, searchFor=string_44)
contains_45 = String.Contains(string=list_create_8, searchFor=string_45)
contains_46 = String.Contains(string=list_create_8, searchFor=string_46)
contains_47 = String.Contains(string=list_create_8, searchFor=string_47)
contains_48 = String.Contains(string=list_create_8, searchFor=string_48)
contains_49 = String.Contains(string=list_create_8, searchFor=string_49)
contains_50 = String.Contains(string=list_create_8, searchFor=string_50)
contains_51 = String.Contains(string=list_create_8, searchFor=string_51)
contains_52 = String.Contains(string=list_create_8, searchFor=string_52)
contains_53 = String.Contains(string=list_create_8, searchFor=string_53)
contains_54 = String.Contains(string=list_create_8, searchFor=string_54)
filterByBoolMask_39 = List.FilterByBoolMask(list=sring_tonumber_bimacon_40, mask=contains_54)
flatten_38 = List.Flatten(list=filterByBoolMask_39.in)
sum_38 = Math.Sum(values=flatten_38)

sring_tonumber_bimacon_42 = Python(IN[0]=list_create_7)  # IronPython2; same code as sring_tonumber_bimacon

# group (continued): Cabos dentro de caixas e modelados como conduite
filterByBoolMask_40 = List.FilterByBoolMask(list=sring_tonumber_bimacon_42, mask=contains_38)
flatten_39 = List.Flatten(list=filterByBoolMask_40.in)
sum_39 = Math.Sum(values=flatten_39)

sring_tonumber_bimacon_43 = Python(IN[0]=list_create_7)  # IronPython2; same code as sring_tonumber_bimacon

# group (continued): Cabos dentro de caixas e modelados como conduite
filterByBoolMask_41 = List.FilterByBoolMask(list=sring_tonumber_bimacon_43, mask=contains_39)
flatten_40 = List.Flatten(list=filterByBoolMask_41.in)
sum_40 = Math.Sum(values=flatten_40)

sring_tonumber_bimacon_44 = Python(IN[0]=list_create_7)  # IronPython2; same code as sring_tonumber_bimacon

# group (continued): Cabos dentro de caixas e modelados como conduite
filterByBoolMask_42 = List.FilterByBoolMask(list=sring_tonumber_bimacon_44, mask=contains_40)
flatten_41 = List.Flatten(list=filterByBoolMask_42.in)
sum_41 = Math.Sum(values=flatten_41)

sring_tonumber_bimacon_45 = Python(IN[0]=list_create_7)  # IronPython2; same code as sring_tonumber_bimacon

# group (continued): Cabos dentro de caixas e modelados como conduite
filterByBoolMask_43 = List.FilterByBoolMask(list=sring_tonumber_bimacon_45, mask=contains_41)
flatten_42 = List.Flatten(list=filterByBoolMask_43.in)
sum_42 = Math.Sum(values=flatten_42)

sring_tonumber_bimacon_46 = Python(IN[0]=list_create_7)  # IronPython2; same code as sring_tonumber_bimacon

# group (continued): Cabos dentro de caixas e modelados como conduite
filterByBoolMask_44 = List.FilterByBoolMask(list=sring_tonumber_bimacon_46, mask=contains_42)
flatten_43 = List.Flatten(list=filterByBoolMask_44.in)
sum_43 = Math.Sum(values=flatten_43)

sring_tonumber_bimacon_47 = Python(IN[0]=list_create_7)  # IronPython2; same code as sring_tonumber_bimacon

# group (continued): Cabos dentro de caixas e modelados como conduite
filterByBoolMask_45 = List.FilterByBoolMask(list=sring_tonumber_bimacon_47, mask=contains_43)
flatten_44 = List.Flatten(list=filterByBoolMask_45.in)
sum_44 = Math.Sum(values=flatten_44)

sring_tonumber_bimacon_48 = Python(IN[0]=list_create_7)  # IronPython2; same code as sring_tonumber_bimacon

# group (continued): Cabos dentro de caixas e modelados como conduite
filterByBoolMask_46 = List.FilterByBoolMask(list=sring_tonumber_bimacon_48, mask=contains_44)
flatten_45 = List.Flatten(list=filterByBoolMask_46.in)
sum_45 = Math.Sum(values=flatten_45)

sring_tonumber_bimacon_49 = Python(IN[0]=list_create_7)  # IronPython2; same code as sring_tonumber_bimacon

# group (continued): Cabos dentro de caixas e modelados como conduite
filterByBoolMask_47 = List.FilterByBoolMask(list=sring_tonumber_bimacon_49, mask=contains_45)
flatten_46 = List.Flatten(list=filterByBoolMask_47.in)
sum_46 = Math.Sum(values=flatten_46)

sring_tonumber_bimacon_50 = Python(IN[0]=list_create_7)  # IronPython2; same code as sring_tonumber_bimacon

# group (continued): Cabos dentro de caixas e modelados como conduite
filterByBoolMask_48 = List.FilterByBoolMask(list=sring_tonumber_bimacon_50, mask=contains_46)
flatten_47 = List.Flatten(list=filterByBoolMask_48.in)
sum_47 = Math.Sum(values=flatten_47)

sring_tonumber_bimacon_51 = Python(IN[0]=list_create_7)  # IronPython2; same code as sring_tonumber_bimacon

# group (continued): Cabos dentro de caixas e modelados como conduite
filterByBoolMask_49 = List.FilterByBoolMask(list=sring_tonumber_bimacon_51, mask=contains_47)
flatten_48 = List.Flatten(list=filterByBoolMask_49.in)
sum_48 = Math.Sum(values=flatten_48)

sring_tonumber_bimacon_52 = Python(IN[0]=list_create_7)  # IronPython2; same code as sring_tonumber_bimacon

# group (continued): Cabos dentro de caixas e modelados como conduite
filterByBoolMask_50 = List.FilterByBoolMask(list=sring_tonumber_bimacon_52, mask=contains_48)
flatten_49 = List.Flatten(list=filterByBoolMask_50.in)
sum_49 = Math.Sum(values=flatten_49)

sring_tonumber_bimacon_53 = Python(IN[0]=list_create_7)  # IronPython2; same code as sring_tonumber_bimacon

# group (continued): Cabos dentro de caixas e modelados como conduite
filterByBoolMask_51 = List.FilterByBoolMask(list=sring_tonumber_bimacon_53, mask=contains_49)
flatten_50 = List.Flatten(list=filterByBoolMask_51.in)
sum_50 = Math.Sum(values=flatten_50)

sring_tonumber_bimacon_54 = Python(IN[0]=list_create_7)  # IronPython2; same code as sring_tonumber_bimacon

# group (continued): Cabos dentro de caixas e modelados como conduite
filterByBoolMask_52 = List.FilterByBoolMask(list=sring_tonumber_bimacon_54, mask=contains_50)
flatten_51 = List.Flatten(list=filterByBoolMask_52.in)
sum_51 = Math.Sum(values=flatten_51)

sring_tonumber_bimacon_55 = Python(IN[0]=list_create_7)  # IronPython2; same code as sring_tonumber_bimacon

# group (continued): Cabos dentro de caixas e modelados como conduite
filterByBoolMask_53 = List.FilterByBoolMask(list=sring_tonumber_bimacon_55, mask=contains_51)
flatten_52 = List.Flatten(list=filterByBoolMask_53.in)
sum_52 = Math.Sum(values=flatten_52)

sring_tonumber_bimacon_56 = Python(IN[0]=list_create_7)  # IronPython2; same code as sring_tonumber_bimacon

# group (continued): Cabos dentro de caixas e modelados como conduite
filterByBoolMask_54 = List.FilterByBoolMask(list=sring_tonumber_bimacon_56, mask=contains_52)
flatten_53 = List.Flatten(list=filterByBoolMask_54.in)
sum_53 = Math.Sum(values=flatten_53)

sring_tonumber_bimacon_57 = Python(IN[0]=list_create_7)  # IronPython2; same code as sring_tonumber_bimacon

# group (continued): Cabos dentro de caixas e modelados como conduite
filterByBoolMask_55 = List.FilterByBoolMask(list=sring_tonumber_bimacon_57, mask=contains_53)
flatten_54 = List.Flatten(list=filterByBoolMask_55.in)
sum_54 = Math.Sum(values=flatten_54)
list_create_9 = List.Create(item0=sum_37, item1=sum_39, item2=sum_40, item3=sum_41, item4=sum_42, item5=sum_43, item6=sum_44, item7=sum_45, item8=sum_46, item9=sum_47, item10=sum_48, item11=sum_49, item12=sum_50, item13=sum_51, item14=sum_52, item15=sum_53, item16=sum_54, item17=sum_38)

# group: Neutro
views_10 = Views("03 - Qtd. Cabos Entrada e Dentro das Caixas CEMIG")
code_block_27 = CodeBlock { 2; }
getDataColumns_16 = Revit.Schedule.GetDataColumns(scheduleView=views_10, columnIndexes=code_block_27)
views_11 = Views("04 - Qtd. Cabos Flexíveis (conduítes)")
code_block_28 = CodeBlock { 2; }
getDataColumns_17 = Revit.Schedule.GetDataColumns(scheduleView=views_11, columnIndexes=code_block_28)
list_create_10 = List.Create(item0=getDataColumns_16, item1=getDataColumns_17)
code_block_29 = CodeBlock { 0; }
getDataColumns_18 = Revit.Schedule.GetDataColumns(scheduleView=views_10, columnIndexes=code_block_29)
code_block_30 = CodeBlock { 0; }
getDataColumns_19 = Revit.Schedule.GetDataColumns(scheduleView=views_11, columnIndexes=code_block_30)
code_block_31 = CodeBlock { " "; }
add_7 = getDataColumns_19 + code_block_31
code_block_32 = CodeBlock { 1; }
getDataColumns_20 = Revit.Schedule.GetDataColumns(scheduleView=views_11, columnIndexes=code_block_32)
string_55 = StringInput("Azul 1,5mm²")
string_56 = StringInput("Azul 2,5mm²")
string_57 = StringInput("Azul 4,0mm²")
string_58 = StringInput(" Azul 6,0mm²")
string_59 = StringInput("Azul 10,0mm²")
string_60 = StringInput("Azul 16,0mm²")
string_61 = StringInput("Azul 25,0mm²")
string_62 = StringInput("Azul 35,0mm²")
string_63 = StringInput("Azul 50,0mm²")
string_64 = StringInput("Azul 70,0mm²")
string_65 = StringInput("Azul 95,0mm²")
string_66 = StringInput("Azul 120,0mm²")
string_67 = StringInput("Azul 150,0mm²")
string_68 = StringInput("Azul 185,0mm²")
string_69 = StringInput("Azul 240,0mm²")
string_70 = StringInput("Azul 300,0mm²")
string_71 = StringInput("Azul 400,0mm²")
sring_tonumber_bimacon_58 = Python(IN[0]=list_create_10)  # IronPython2; same code as sring_tonumber_bimacon
string_72 = StringInput("Azul 500,0mm²")

sring_tonumber_bimacon_59 = Python(IN[0]=list_create_10)  # IronPython2; same code as sring_tonumber_bimacon
add_8 = add_7 + getDataColumns_20

# group (continued): Neutro
list_create_11 = List.Create(item0=getDataColumns_18, item1=add_8)
contains_55 = String.Contains(string=list_create_11, searchFor=string_55)
filterByBoolMask_56 = List.FilterByBoolMask(list=sring_tonumber_bimacon_59, mask=contains_55)
flatten_55 = List.Flatten(list=filterByBoolMask_56.in)
sum_55 = Math.Sum(values=flatten_55)
contains_56 = String.Contains(string=list_create_11, searchFor=string_56)
contains_57 = String.Contains(string=list_create_11, searchFor=string_57)
contains_58 = String.Contains(string=list_create_11, searchFor=string_58)
contains_59 = String.Contains(string=list_create_11, searchFor=string_59)
contains_60 = String.Contains(string=list_create_11, searchFor=string_60)
contains_61 = String.Contains(string=list_create_11, searchFor=string_61)
contains_62 = String.Contains(string=list_create_11, searchFor=string_62)
contains_63 = String.Contains(string=list_create_11, searchFor=string_63)
contains_64 = String.Contains(string=list_create_11, searchFor=string_64)
contains_65 = String.Contains(string=list_create_11, searchFor=string_65)
contains_66 = String.Contains(string=list_create_11, searchFor=string_66)
contains_67 = String.Contains(string=list_create_11, searchFor=string_67)
contains_68 = String.Contains(string=list_create_11, searchFor=string_68)
contains_69 = String.Contains(string=list_create_11, searchFor=string_69)
contains_70 = String.Contains(string=list_create_11, searchFor=string_70)
contains_71 = String.Contains(string=list_create_11, searchFor=string_71)
contains_72 = String.Contains(string=list_create_11, searchFor=string_72)
filterByBoolMask_57 = List.FilterByBoolMask(list=sring_tonumber_bimacon_58, mask=contains_72)
flatten_56 = List.Flatten(list=filterByBoolMask_57.in)
sum_56 = Math.Sum(values=flatten_56)

sring_tonumber_bimacon_60 = Python(IN[0]=list_create_10)  # IronPython2; same code as sring_tonumber_bimacon

# group (continued): Neutro
filterByBoolMask_58 = List.FilterByBoolMask(list=sring_tonumber_bimacon_60, mask=contains_56)
flatten_57 = List.Flatten(list=filterByBoolMask_58.in)
sum_57 = Math.Sum(values=flatten_57)

sring_tonumber_bimacon_61 = Python(IN[0]=list_create_10)  # IronPython2; same code as sring_tonumber_bimacon

# group (continued): Neutro
filterByBoolMask_59 = List.FilterByBoolMask(list=sring_tonumber_bimacon_61, mask=contains_57)
flatten_58 = List.Flatten(list=filterByBoolMask_59.in)
sum_58 = Math.Sum(values=flatten_58)

sring_tonumber_bimacon_62 = Python(IN[0]=list_create_10)  # IronPython2; same code as sring_tonumber_bimacon

# group (continued): Neutro
filterByBoolMask_60 = List.FilterByBoolMask(list=sring_tonumber_bimacon_62, mask=contains_58)
flatten_59 = List.Flatten(list=filterByBoolMask_60.in)
sum_59 = Math.Sum(values=flatten_59)

sring_tonumber_bimacon_63 = Python(IN[0]=list_create_10)  # IronPython2; same code as sring_tonumber_bimacon

# group (continued): Neutro
filterByBoolMask_61 = List.FilterByBoolMask(list=sring_tonumber_bimacon_63, mask=contains_59)
flatten_60 = List.Flatten(list=filterByBoolMask_61.in)
sum_60 = Math.Sum(values=flatten_60)

sring_tonumber_bimacon_64 = Python(IN[0]=list_create_10)  # IronPython2; same code as sring_tonumber_bimacon

# group (continued): Neutro
filterByBoolMask_62 = List.FilterByBoolMask(list=sring_tonumber_bimacon_64, mask=contains_60)
flatten_61 = List.Flatten(list=filterByBoolMask_62.in)
sum_61 = Math.Sum(values=flatten_61)

sring_tonumber_bimacon_65 = Python(IN[0]=list_create_10)  # IronPython2; same code as sring_tonumber_bimacon

# group (continued): Neutro
filterByBoolMask_63 = List.FilterByBoolMask(list=sring_tonumber_bimacon_65, mask=contains_61)
flatten_62 = List.Flatten(list=filterByBoolMask_63.in)
sum_62 = Math.Sum(values=flatten_62)

sring_tonumber_bimacon_66 = Python(IN[0]=list_create_10)  # IronPython2; same code as sring_tonumber_bimacon

# group (continued): Neutro
filterByBoolMask_64 = List.FilterByBoolMask(list=sring_tonumber_bimacon_66, mask=contains_62)
flatten_63 = List.Flatten(list=filterByBoolMask_64.in)
sum_63 = Math.Sum(values=flatten_63)

sring_tonumber_bimacon_67 = Python(IN[0]=list_create_10)  # IronPython2; same code as sring_tonumber_bimacon

# group (continued): Neutro
filterByBoolMask_65 = List.FilterByBoolMask(list=sring_tonumber_bimacon_67, mask=contains_63)
flatten_64 = List.Flatten(list=filterByBoolMask_65.in)
sum_64 = Math.Sum(values=flatten_64)

sring_tonumber_bimacon_68 = Python(IN[0]=list_create_10)  # IronPython2; same code as sring_tonumber_bimacon

# group (continued): Neutro
filterByBoolMask_66 = List.FilterByBoolMask(list=sring_tonumber_bimacon_68, mask=contains_64)
flatten_65 = List.Flatten(list=filterByBoolMask_66.in)
sum_65 = Math.Sum(values=flatten_65)

sring_tonumber_bimacon_69 = Python(IN[0]=list_create_10)  # IronPython2; same code as sring_tonumber_bimacon

# group (continued): Neutro
filterByBoolMask_67 = List.FilterByBoolMask(list=sring_tonumber_bimacon_69, mask=contains_65)
flatten_66 = List.Flatten(list=filterByBoolMask_67.in)
sum_66 = Math.Sum(values=flatten_66)

sring_tonumber_bimacon_70 = Python(IN[0]=list_create_10)  # IronPython2; same code as sring_tonumber_bimacon

# group (continued): Neutro
filterByBoolMask_68 = List.FilterByBoolMask(list=sring_tonumber_bimacon_70, mask=contains_66)
flatten_67 = List.Flatten(list=filterByBoolMask_68.in)
sum_67 = Math.Sum(values=flatten_67)

sring_tonumber_bimacon_71 = Python(IN[0]=list_create_10)  # IronPython2; same code as sring_tonumber_bimacon

# group (continued): Neutro
filterByBoolMask_69 = List.FilterByBoolMask(list=sring_tonumber_bimacon_71, mask=contains_67)
flatten_68 = List.Flatten(list=filterByBoolMask_69.in)
sum_68 = Math.Sum(values=flatten_68)

sring_tonumber_bimacon_72 = Python(IN[0]=list_create_10)  # IronPython2; same code as sring_tonumber_bimacon

# group (continued): Neutro
filterByBoolMask_70 = List.FilterByBoolMask(list=sring_tonumber_bimacon_72, mask=contains_68)
flatten_69 = List.Flatten(list=filterByBoolMask_70.in)
sum_69 = Math.Sum(values=flatten_69)

sring_tonumber_bimacon_73 = Python(IN[0]=list_create_10)  # IronPython2; same code as sring_tonumber_bimacon

# group (continued): Neutro
filterByBoolMask_71 = List.FilterByBoolMask(list=sring_tonumber_bimacon_73, mask=contains_69)
flatten_70 = List.Flatten(list=filterByBoolMask_71.in)
sum_70 = Math.Sum(values=flatten_70)

sring_tonumber_bimacon_74 = Python(IN[0]=list_create_10)  # IronPython2; same code as sring_tonumber_bimacon

# group (continued): Neutro
filterByBoolMask_72 = List.FilterByBoolMask(list=sring_tonumber_bimacon_74, mask=contains_70)
flatten_71 = List.Flatten(list=filterByBoolMask_72.in)
sum_71 = Math.Sum(values=flatten_71)

sring_tonumber_bimacon_75 = Python(IN[0]=list_create_10)  # IronPython2; same code as sring_tonumber_bimacon

# group (continued): Neutro
filterByBoolMask_73 = List.FilterByBoolMask(list=sring_tonumber_bimacon_75, mask=contains_71)
flatten_72 = List.Flatten(list=filterByBoolMask_73.in)
sum_72 = Math.Sum(values=flatten_72)
list_create_12 = List.Create(item0=sum_55, item1=sum_57, item2=sum_58, item3=sum_59, item4=sum_60, item5=sum_61, item6=sum_62, item7=sum_63, item8=sum_64, item9=sum_65, item10=sum_66, item11=sum_67, item12=sum_68, item13=sum_69, item14=sum_70, item15=sum_71, item16=sum_72, item17=sum_56)

# group: Proteção
views_12 = Views("03 - Qtd. Cabos Entrada e Dentro das Caixas CEMIG")
code_block_33 = CodeBlock { 2; }
getDataColumns_21 = Revit.Schedule.GetDataColumns(scheduleView=views_12, columnIndexes=code_block_33)
views_13 = Views("04 - Qtd. Cabos Flexíveis (conduítes)")
code_block_34 = CodeBlock { 2; }
getDataColumns_22 = Revit.Schedule.GetDataColumns(scheduleView=views_13, columnIndexes=code_block_34)
list_create_13 = List.Create(item0=getDataColumns_21, item1=getDataColumns_22)
code_block_35 = CodeBlock { 0; }
getDataColumns_23 = Revit.Schedule.GetDataColumns(scheduleView=views_12, columnIndexes=code_block_35)
code_block_36 = CodeBlock { 0; }
getDataColumns_24 = Revit.Schedule.GetDataColumns(scheduleView=views_13, columnIndexes=code_block_36)
code_block_37 = CodeBlock { " "; }
add_9 = getDataColumns_24 + code_block_37
code_block_38 = CodeBlock { 1; }
getDataColumns_25 = Revit.Schedule.GetDataColumns(scheduleView=views_13, columnIndexes=code_block_38)
string_73 = StringInput("Verde 1,5mm²")
string_74 = StringInput("Verde 2,5mm²")
string_75 = StringInput("Verde 4,0mm²")
string_76 = StringInput(" Verde 6,0mm²")
string_77 = StringInput("Verde 10,0mm²")
string_78 = StringInput("Verde 16,0mm²")
string_79 = StringInput("Verde 25,0mm²")
string_80 = StringInput("Verde 35,0mm²")
string_81 = StringInput("Verde 50,0mm²")
string_82 = StringInput("Verde 70,0mm²")
string_83 = StringInput("Verde 95,0mm²")
string_84 = StringInput("Verde 120,0mm²")
string_85 = StringInput("Verde 150,0mm²")
string_86 = StringInput("Verde 185,0mm²")
string_87 = StringInput("Verde 240,0mm²")
string_88 = StringInput("Verde 300,0mm²")
string_89 = StringInput("Verde 400,0mm²")
sring_tonumber_bimacon_76 = Python(IN[0]=list_create_13)  # IronPython2; same code as sring_tonumber_bimacon
string_90 = StringInput("Verde 500,0mm²")

sring_tonumber_bimacon_77 = Python(IN[0]=list_create_13)  # IronPython2; same code as sring_tonumber_bimacon
add_10 = add_9 + getDataColumns_25

# group (continued): Proteção
list_create_14 = List.Create(item0=getDataColumns_23, item1=add_10)
contains_73 = String.Contains(string=list_create_14, searchFor=string_73)
filterByBoolMask_74 = List.FilterByBoolMask(list=sring_tonumber_bimacon_77, mask=contains_73)
flatten_73 = List.Flatten(list=filterByBoolMask_74.in)
sum_73 = Math.Sum(values=flatten_73)
contains_74 = String.Contains(string=list_create_14, searchFor=string_74)
contains_75 = String.Contains(string=list_create_14, searchFor=string_75)
contains_76 = String.Contains(string=list_create_14, searchFor=string_76)
contains_77 = String.Contains(string=list_create_14, searchFor=string_77)
contains_78 = String.Contains(string=list_create_14, searchFor=string_78)
contains_79 = String.Contains(string=list_create_14, searchFor=string_79)
contains_80 = String.Contains(string=list_create_14, searchFor=string_80)
contains_81 = String.Contains(string=list_create_14, searchFor=string_81)
contains_82 = String.Contains(string=list_create_14, searchFor=string_82)
contains_83 = String.Contains(string=list_create_14, searchFor=string_83)
contains_84 = String.Contains(string=list_create_14, searchFor=string_84)
contains_85 = String.Contains(string=list_create_14, searchFor=string_85)
contains_86 = String.Contains(string=list_create_14, searchFor=string_86)
contains_87 = String.Contains(string=list_create_14, searchFor=string_87)
contains_88 = String.Contains(string=list_create_14, searchFor=string_88)
contains_89 = String.Contains(string=list_create_14, searchFor=string_89)
contains_90 = String.Contains(string=list_create_14, searchFor=string_90)
filterByBoolMask_75 = List.FilterByBoolMask(list=sring_tonumber_bimacon_76, mask=contains_90)
flatten_74 = List.Flatten(list=filterByBoolMask_75.in)
sum_74 = Math.Sum(values=flatten_74)

sring_tonumber_bimacon_78 = Python(IN[0]=list_create_13)  # IronPython2; same code as sring_tonumber_bimacon

# group (continued): Proteção
filterByBoolMask_76 = List.FilterByBoolMask(list=sring_tonumber_bimacon_78, mask=contains_74)
flatten_75 = List.Flatten(list=filterByBoolMask_76.in)
sum_75 = Math.Sum(values=flatten_75)

sring_tonumber_bimacon_79 = Python(IN[0]=list_create_13)  # IronPython2; same code as sring_tonumber_bimacon

# group (continued): Proteção
filterByBoolMask_77 = List.FilterByBoolMask(list=sring_tonumber_bimacon_79, mask=contains_75)
flatten_76 = List.Flatten(list=filterByBoolMask_77.in)
sum_76 = Math.Sum(values=flatten_76)

sring_tonumber_bimacon_80 = Python(IN[0]=list_create_13)  # IronPython2; same code as sring_tonumber_bimacon

# group (continued): Proteção
filterByBoolMask_78 = List.FilterByBoolMask(list=sring_tonumber_bimacon_80, mask=contains_76)
flatten_77 = List.Flatten(list=filterByBoolMask_78.in)
sum_77 = Math.Sum(values=flatten_77)

sring_tonumber_bimacon_81 = Python(IN[0]=list_create_13)  # IronPython2; same code as sring_tonumber_bimacon

# group (continued): Proteção
filterByBoolMask_79 = List.FilterByBoolMask(list=sring_tonumber_bimacon_81, mask=contains_77)
flatten_78 = List.Flatten(list=filterByBoolMask_79.in)
sum_78 = Math.Sum(values=flatten_78)

sring_tonumber_bimacon_82 = Python(IN[0]=list_create_13)  # IronPython2; same code as sring_tonumber_bimacon

# group (continued): Proteção
filterByBoolMask_80 = List.FilterByBoolMask(list=sring_tonumber_bimacon_82, mask=contains_78)
flatten_79 = List.Flatten(list=filterByBoolMask_80.in)
sum_79 = Math.Sum(values=flatten_79)

sring_tonumber_bimacon_83 = Python(IN[0]=list_create_13)  # IronPython2; same code as sring_tonumber_bimacon

# group (continued): Proteção
filterByBoolMask_81 = List.FilterByBoolMask(list=sring_tonumber_bimacon_83, mask=contains_79)
flatten_80 = List.Flatten(list=filterByBoolMask_81.in)
sum_80 = Math.Sum(values=flatten_80)

sring_tonumber_bimacon_84 = Python(IN[0]=list_create_13)  # IronPython2; same code as sring_tonumber_bimacon

# group (continued): Proteção
filterByBoolMask_82 = List.FilterByBoolMask(list=sring_tonumber_bimacon_84, mask=contains_80)
flatten_81 = List.Flatten(list=filterByBoolMask_82.in)
sum_81 = Math.Sum(values=flatten_81)

sring_tonumber_bimacon_85 = Python(IN[0]=list_create_13)  # IronPython2; same code as sring_tonumber_bimacon

# group (continued): Proteção
filterByBoolMask_83 = List.FilterByBoolMask(list=sring_tonumber_bimacon_85, mask=contains_81)
flatten_82 = List.Flatten(list=filterByBoolMask_83.in)
sum_82 = Math.Sum(values=flatten_82)

sring_tonumber_bimacon_86 = Python(IN[0]=list_create_13)  # IronPython2; same code as sring_tonumber_bimacon

# group (continued): Proteção
filterByBoolMask_84 = List.FilterByBoolMask(list=sring_tonumber_bimacon_86, mask=contains_82)
flatten_83 = List.Flatten(list=filterByBoolMask_84.in)
sum_83 = Math.Sum(values=flatten_83)

sring_tonumber_bimacon_87 = Python(IN[0]=list_create_13)  # IronPython2; same code as sring_tonumber_bimacon

# group (continued): Proteção
filterByBoolMask_85 = List.FilterByBoolMask(list=sring_tonumber_bimacon_87, mask=contains_83)
flatten_84 = List.Flatten(list=filterByBoolMask_85.in)
sum_84 = Math.Sum(values=flatten_84)

sring_tonumber_bimacon_88 = Python(IN[0]=list_create_13)  # IronPython2; same code as sring_tonumber_bimacon

# group (continued): Proteção
filterByBoolMask_86 = List.FilterByBoolMask(list=sring_tonumber_bimacon_88, mask=contains_84)
flatten_85 = List.Flatten(list=filterByBoolMask_86.in)
sum_85 = Math.Sum(values=flatten_85)

sring_tonumber_bimacon_89 = Python(IN[0]=list_create_13)  # IronPython2; same code as sring_tonumber_bimacon

# group (continued): Proteção
filterByBoolMask_87 = List.FilterByBoolMask(list=sring_tonumber_bimacon_89, mask=contains_85)
flatten_86 = List.Flatten(list=filterByBoolMask_87.in)
sum_86 = Math.Sum(values=flatten_86)

sring_tonumber_bimacon_90 = Python(IN[0]=list_create_13)  # IronPython2; same code as sring_tonumber_bimacon

# group (continued): Proteção
filterByBoolMask_88 = List.FilterByBoolMask(list=sring_tonumber_bimacon_90, mask=contains_86)
flatten_87 = List.Flatten(list=filterByBoolMask_88.in)
sum_87 = Math.Sum(values=flatten_87)

sring_tonumber_bimacon_91 = Python(IN[0]=list_create_13)  # IronPython2; same code as sring_tonumber_bimacon

# group (continued): Proteção
filterByBoolMask_89 = List.FilterByBoolMask(list=sring_tonumber_bimacon_91, mask=contains_87)
flatten_88 = List.Flatten(list=filterByBoolMask_89.in)
sum_88 = Math.Sum(values=flatten_88)

sring_tonumber_bimacon_92 = Python(IN[0]=list_create_13)  # IronPython2; same code as sring_tonumber_bimacon

# group (continued): Proteção
filterByBoolMask_90 = List.FilterByBoolMask(list=sring_tonumber_bimacon_92, mask=contains_88)
flatten_89 = List.Flatten(list=filterByBoolMask_90.in)
sum_89 = Math.Sum(values=flatten_89)

sring_tonumber_bimacon_93 = Python(IN[0]=list_create_13)  # IronPython2; same code as sring_tonumber_bimacon

# group (continued): Proteção
filterByBoolMask_91 = List.FilterByBoolMask(list=sring_tonumber_bimacon_93, mask=contains_89)
flatten_90 = List.Flatten(list=filterByBoolMask_91.in)
sum_90 = Math.Sum(values=flatten_90)
list_create_15 = List.Create(item0=sum_73, item1=sum_75, item2=sum_76, item3=sum_77, item4=sum_78, item5=sum_79, item6=sum_80, item7=sum_81, item8=sum_82, item9=sum_83, item10=sum_84, item11=sum_85, item12=sum_86, item13=sum_87, item14=sum_88, item15=sum_89, item16=sum_90, item17=sum_74)

# group: Selecionar familia genérica para atribuir parâmetros ARRED.
categories_2 = Categories("OST_GenericModel")
all_elements_of_category_2 = ElementsOfCategory(Category=categories_2)
string_from_object_2 = FromObject(obj=all_elements_of_category_2)
code_block_39 = CodeBlock { "Soma Arredondamento Cabos"; }
eq_4 = string_from_object_2 == code_block_39
filterByBoolMask_92 = List.FilterByBoolMask(list=all_elements_of_category_2, mask=eq_4)

# group: Retorno - Amarelo
retornos = CodeBlock { 92; 96; }
slice = List.Slice(list=getDataRows_4@L2, start=retornos.out0, end=retornos.out1)
retornos_2 = CodeBlock { 92; 96; }
slice_2 = List.Slice(list=code_block_6@L2, start=retornos_2.out0, end=retornos_2.out1)
setParameterByName = Element.SetParameterByName(element=filterByBoolMask.in, parameterName=slice, value=slice_2)
number_roundUpTo = Custom[number_roundUpTo](numbers=slice_2)  # package Sparrow; This node returns a rounded number to the ceiling of a specified multiple.
setParameterByName_2 = Element.SetParameterByName(element=filterByBoolMask_92.in, parameterName=slice, value=number_roundUpTo)

passthrough = Custom[Passthrough](passThrough=filterByBoolMask.in, waitFor=setParameterByName)  # package Clockwork for Dynamo 2.x; Forces a sequential order of execution. The node wired into the output of the Passthrough node will be executed *after* the node wired into the waitFor input (e.g. important for some Revit operations). The value of the passThrough input will be passed on to the node wired into the output port of the Passthrough node.
passthrough_2 = Custom[Passthrough](passThrough=filterByBoolMask_92.in, waitFor=setParameterByName_2)

# group: Fase A - Vermelha
fase_a = CodeBlock { 2; 20; }
slice_3 = List.Slice(list=getDataRows_4@L2, start=fase_a.out0, end=fase_a.out1)
fase_a_2 = CodeBlock { 2; 20; }
slice_4 = List.Slice(list=code_block_6@L2, start=fase_a_2.out0, end=fase_a_2.out1)
flatten_91 = List.Flatten(list=slice_4)
code_block_40 = CodeBlock(a=flatten_91, b=list_create_3) { a+b; }
list_create_16 = List.Create(item0=code_block_40)
setParameterByName_3 = Element.SetParameterByName(element=passthrough, parameterName=slice_3, value=list_create_16)
number_roundUpTo_2 = Custom[number_roundUpTo](numbers=list_create_16)
setParameterByName_4 = Element.SetParameterByName(element=passthrough_2, parameterName=slice_3, value=number_roundUpTo_2)

passthrough_3 = Custom[Passthrough](passThrough=filterByBoolMask.in, waitFor=setParameterByName_3)
passthrough_4 = Custom[Passthrough](passThrough=filterByBoolMask_92.in, waitFor=setParameterByName_4)

# group: Fase B - Branca
fase_b = CodeBlock { 20; 38; }
slice_5 = List.Slice(list=getDataRows_4@L2, start=fase_b.out0, end=fase_b.out1)
fase_b_2 = CodeBlock { 20; 38; }
slice_6 = List.Slice(list=code_block_6@L2, start=fase_b_2.out0, end=fase_b_2.out1)
flatten_92 = List.Flatten(list=slice_6)
code_block_41 = CodeBlock(a=flatten_92, b=list_create_6) { a+b; }
list_create_17 = List.Create(item0=code_block_41)
setParameterByName_5 = Element.SetParameterByName(element=passthrough_3, parameterName=slice_5, value=list_create_17)
number_roundUpTo_3 = Custom[number_roundUpTo](numbers=list_create_17)
setParameterByName_6 = Element.SetParameterByName(element=passthrough_4, parameterName=slice_5, value=number_roundUpTo_3)

passthrough_5 = Custom[Passthrough](passThrough=filterByBoolMask.in, waitFor=setParameterByName_5)
passthrough_6 = Custom[Passthrough](passThrough=filterByBoolMask_92.in, waitFor=setParameterByName_6)

# group: Fase C - Preta
fase_c = CodeBlock { 38; 56; }
slice_7 = List.Slice(list=getDataRows_4@L2, start=fase_c.out0, end=fase_c.out1)
fase_c_2 = CodeBlock { 38; 56; }
slice_8 = List.Slice(list=code_block_6@L2, start=fase_c_2.out0, end=fase_c_2.out1)
flatten_93 = List.Flatten(list=slice_8)
code_block_42 = CodeBlock(a=flatten_93, b=list_create_9) { a+b; }
list_create_18 = List.Create(item0=code_block_42)
setParameterByName_7 = Element.SetParameterByName(element=passthrough_5, parameterName=slice_7, value=list_create_18)
number_roundUpTo_4 = Custom[number_roundUpTo](numbers=list_create_18)
setParameterByName_8 = Element.SetParameterByName(element=passthrough_6, parameterName=slice_7, value=number_roundUpTo_4)

passthrough_7 = Custom[Passthrough](passThrough=filterByBoolMask.in, waitFor=setParameterByName_7)
passthrough_8 = Custom[Passthrough](passThrough=filterByBoolMask_92.in, waitFor=setParameterByName_8)

# group: Neutro - Azul
neutro = CodeBlock { 56; 74; }
slice_9 = List.Slice(list=getDataRows_4@L2, start=neutro.out0, end=neutro.out1)
neutro_2 = CodeBlock { 56; 74; }
slice_10 = List.Slice(list=code_block_6@L2, start=neutro_2.out0, end=neutro_2.out1)
flatten_94 = List.Flatten(list=slice_10)
code_block_43 = CodeBlock(a=flatten_94, b=list_create_12) { a+b; }
list_create_19 = List.Create(item0=code_block_43)
setParameterByName_9 = Element.SetParameterByName(element=passthrough_7, parameterName=slice_9, value=list_create_19)
number_roundUpTo_5 = Custom[number_roundUpTo](numbers=list_create_19)
setParameterByName_10 = Element.SetParameterByName(element=passthrough_8, parameterName=slice_9, value=number_roundUpTo_5)

passthrough_9 = Custom[Passthrough](passThrough=filterByBoolMask.in, waitFor=setParameterByName_9)
passthrough_10 = Custom[Passthrough](passThrough=filterByBoolMask_92.in, waitFor=setParameterByName_10)

# group: Proteção - Verde
proteção = CodeBlock { 74; 92; }
slice_11 = List.Slice(list=getDataRows_4@L2, start=proteção.out0, end=proteção.out1)
proteção_2 = CodeBlock { 74; 92; }
slice_12 = List.Slice(list=code_block_6@L2, start=proteção_2.out0, end=proteção_2.out1)
flatten_95 = List.Flatten(list=slice_12)
code_block_44 = CodeBlock(a=flatten_95, b=list_create_15) { a+b; }
list_create_20 = List.Create(item0=code_block_44)
setParameterByName_11 = Element.SetParameterByName(element=passthrough_9, parameterName=slice_11, value=list_create_20)
number_roundUpTo_6 = Custom[number_roundUpTo](numbers=list_create_20)
setParameterByName_12 = Element.SetParameterByName(element=passthrough_10, parameterName=slice_11, value=number_roundUpTo_6)

# group: Mensagem
count = List.Count(list=setParameterByName_11)
code_block_45 = CodeBlock { 0; }
gt = count > code_block_45
code_block_46 = CodeBlock { ["Feito! Todos Cabos Foram Somados na Tab. TOTAL POR CORES"]; }
code_block_47 = CodeBlock { ["Nenhum cabo foi somado"]; }
if_ = If(test=gt, true=code_block_46, false=code_block_47)
flatten_96 = List.Flatten(list=if_)
fromList = Python(IN[0]=flatten_96)  # "String.FromList"; IronPython2
# ---------- fromList.python (22 lines) ----------
# Carregar as bibliotecas DesignScript e padrão do Python
import sys
import clr
clr.AddReference('ProtoGeometry')
from Autodesk.DesignScript.Geometry import *

# Função para concatenar os valores de uma lista em uma única string com múltiplas linhas
def concatenate_list_to_string(input_list, delimiter="\n"):
    # Verifica se a entrada é uma lista
    if not isinstance(input_list, list):
        return "A entrada deve ser uma lista."
    
    # Converte todos os elementos para string e junta com o delimitador especificado
    result = delimiter.join(str(item) for item in input_list)
    return result

# Entrada pelo nó do Dynamo
lista = IN[0]  # Lista de valores a serem concatenados
delimitador = IN[1] if len(IN) > 1 else "\n"  # Delimitador opcional, padrão é nova linha

# Saída para o Dynamo
OUT = concatenate_list_to_string(lista, delimitador)
# ----------------------------------------
python_script = Python(IN[0]=fromList)  # IronPython2
# ---------- python_script.python (21 lines) ----------
# Importar as bibliotecas necessárias do Revit
import clr
clr.AddReference("RevitServices")
from RevitServices.Persistence import DocumentManager

clr.AddReference("RevitAPI")
clr.AddReference("RevitAPIUI")
from Autodesk.Revit.UI import TaskDialog

# Pegar a entrada do Dynamo
mensagem = IN[0]

# Criar a TaskDialog
task_dialog = TaskDialog("Ok")
task_dialog.MainInstruction = mensagem

# Exibir a TaskDialog
task_dialog.Show()

# Saída do script
OUT = "Sucesso!"
# ----------------------------------------

# group: Comprimento Real e Calculado
retornos_3 = CodeBlock { 0; 2; }
slice_13 = List.Slice(list=getDataRows_4@L2, start=retornos_3.out0, end=retornos_3.out1)
retornos_4 = CodeBlock { 0; 2; }
slice_14 = List.Slice(list=code_block_6@L2, start=retornos_4.out0, end=retornos_4.out1)
setParameterByName_13 = Element.SetParameterByName(element=filterByBoolMask.in, parameterName=slice_13, value=slice_14)
number_roundUpTo_7 = Custom[number_roundUpTo](numbers=slice_14)
setParameterByName_14 = Element.SetParameterByName(element=filterByBoolMask_92.in, parameterName=slice_13, value=number_roundUpTo_7)
