# Dynamo graph 2021_16-0_BIMACON_Somar Tabelas de Cabos por CORES ELE_R03_script.dyn "ok 2021_16-0_BIMACON_Somar Tabelas de Cabos por CORES ELE_R03_script" (Dynamo 2.6.1.8786)
# Soma os cabos das Bandeja de Cabos, Consuiítes e das conexões
# packages: bimorphNodes 4.2.4, Orchid 2.16.5.6198, Orchid 2.6.8.6198, Clockwork for Dynamo 2.x 2.4.0, Sparrow 2021.2.1, Orchid 2.6.10.6373

boolean = BoolSelector(false)
views = Views("Cabos PVC ELE em Bandeja de Cabos (Cobre/Un/Isol. PVC/750V/70°C)")
code_block = CodeBlock { 1; }
getDataRows = Revit.Schedule.GetDataRows(scheduleView=views, rowIndexes=code_block, lacing=CrossProduct)
o_string_tonumber = Orchid.Common.String.ToNumber(string=getDataRows)
views_2 = Views("Cabos PVC ELE em Conduítes (Cobre/Un/Isol. PVC/750V/70°C)")
code_block_2 = CodeBlock { 1; }
getDataRows_2 = Revit.Schedule.GetDataRows(scheduleView=views_2, rowIndexes=code_block_2, lacing=CrossProduct)
o_string_tonumber_2 = Orchid.Common.String.ToNumber(string=getDataRows_2)
views_3 = Views("Cabos PVC ELE em Conexões (Cobre/Un/Isol. PVC/750V/70°C)")
code_block_3 = CodeBlock { 1; }
getDataRows_3 = Revit.Schedule.GetDataRows(scheduleView=views_3, rowIndexes=code_block_3, lacing=CrossProduct)
o_string_tonumber_3 = Orchid.Common.String.ToNumber(string=getDataRows_3)
code_block_4 = CodeBlock(a=o_string_tonumber, b=o_string_tonumber_2, c=o_string_tonumber_3) { a+b+c; }
watch = Watch(code_block_4)
boolean_2 = BoolSelector(false)

# group: Selecionar familia genérica para atribuir parâmetros SOMA
categories = Categories("OST_GenericModel")
all_elements_of_category = ElementsOfCategory(Category=categories)
string_from_object = FromObject(object=all_elements_of_category)
code_block_5 = CodeBlock { "Somatória Cabos"; }
eq = string_from_object == code_block_5
filterByBoolMask = List.FilterByBoolMask(list=all_elements_of_category, mask=eq)

code_block_6 = CodeBlock { 0; }
boolean_3 = BoolSelector(false)
getDataRows_4 = Revit.Schedule.GetDataRows(scheduleView=views, rowIndexes=code_block_6, refresh=boolean_3)

# group: Cabos dentro de caixas e modelados como conduite
views_4 = Views("03 - Qtd. Cabos Entrada e Dentro das Caixas CEMIG")
code_block_7 = CodeBlock { 2; }
getDataColumns = Revit.Schedule.GetDataColumns(scheduleView=views_4, columnIndexes=code_block_7)
views_5 = Views("04 - Qtd. Cabos Flexíveis (conduítes)")
code_block_8 = CodeBlock { 2; }
getDataColumns_2 = Revit.Schedule.GetDataColumns(scheduleView=views_5, columnIndexes=code_block_8)
list_create = List.Create(item0=getDataColumns, item1=getDataColumns_2)
o_string_tonumber_4 = Orchid.Common.String.ToNumber(string=list_create)
code_block_9 = CodeBlock { 0; }
getDataColumns_3 = Revit.Schedule.GetDataColumns(scheduleView=views_4, columnIndexes=code_block_9)
code_block_10 = CodeBlock { 0; }
getDataColumns_4 = Revit.Schedule.GetDataColumns(scheduleView=views_5, columnIndexes=code_block_10)
code_block_11 = CodeBlock { " "; }
add = getDataColumns_4 + code_block_11
code_block_12 = CodeBlock { 1; }
getDataColumns_5 = Revit.Schedule.GetDataColumns(scheduleView=views_5, columnIndexes=code_block_12)
o_string_concat = Orchid.Common.String.Concat(string0=add, string1=getDataColumns_5)
list_create_2 = List.Create(item0=getDataColumns_3, item1=o_string_concat)
string = StringInput("Vermelho 1,5mm²")
contains = String.Contains(str=list_create_2, searchFor=string)
filterByBoolMask_2 = List.FilterByBoolMask(list=o_string_tonumber_4, mask=contains)
flatten = List.Flatten(list=filterByBoolMask_2.in)
sum = Math.Sum(values=flatten)
o_string_tonumber_5 = Orchid.Common.String.ToNumber(string=list_create)
string_2 = StringInput("Vermelho 2,5mm²")
contains_2 = String.Contains(str=list_create_2, searchFor=string_2)
filterByBoolMask_3 = List.FilterByBoolMask(list=o_string_tonumber_5, mask=contains_2)
flatten_2 = List.Flatten(list=filterByBoolMask_3.in)
sum_2 = Math.Sum(values=flatten_2)
o_string_tonumber_6 = Orchid.Common.String.ToNumber(string=list_create)
string_3 = StringInput("Vermelho 4,0mm²")
contains_3 = String.Contains(str=list_create_2, searchFor=string_3)
filterByBoolMask_4 = List.FilterByBoolMask(list=o_string_tonumber_6, mask=contains_3)
flatten_3 = List.Flatten(list=filterByBoolMask_4.in)
sum_3 = Math.Sum(values=flatten_3)
o_string_tonumber_7 = Orchid.Common.String.ToNumber(string=list_create)
string_4 = StringInput(" Vermelho 6,0mm²")
contains_4 = String.Contains(str=list_create_2, searchFor=string_4)
filterByBoolMask_5 = List.FilterByBoolMask(list=o_string_tonumber_7, mask=contains_4)
flatten_4 = List.Flatten(list=filterByBoolMask_5.in)
sum_4 = Math.Sum(values=flatten_4)
o_string_tonumber_8 = Orchid.Common.String.ToNumber(string=list_create)
string_5 = StringInput("Vermelho 10,0mm²")
contains_5 = String.Contains(str=list_create_2, searchFor=string_5)
filterByBoolMask_6 = List.FilterByBoolMask(list=o_string_tonumber_8, mask=contains_5)
flatten_5 = List.Flatten(list=filterByBoolMask_6.in)
sum_5 = Math.Sum(values=flatten_5)
o_string_tonumber_9 = Orchid.Common.String.ToNumber(string=list_create)
string_6 = StringInput("Vermelho 16,0mm²")
contains_6 = String.Contains(str=list_create_2, searchFor=string_6)
filterByBoolMask_7 = List.FilterByBoolMask(list=o_string_tonumber_9, mask=contains_6)
flatten_6 = List.Flatten(list=filterByBoolMask_7.in)
sum_6 = Math.Sum(values=flatten_6)
o_string_tonumber_10 = Orchid.Common.String.ToNumber(string=list_create)
string_7 = StringInput("Vermelho 25,0mm²")
contains_7 = String.Contains(str=list_create_2, searchFor=string_7)
filterByBoolMask_8 = List.FilterByBoolMask(list=o_string_tonumber_10, mask=contains_7)
flatten_7 = List.Flatten(list=filterByBoolMask_8.in)
sum_7 = Math.Sum(values=flatten_7)
o_string_tonumber_11 = Orchid.Common.String.ToNumber(string=list_create)
string_8 = StringInput("Vermelho 35,0mm²")
contains_8 = String.Contains(str=list_create_2, searchFor=string_8)
filterByBoolMask_9 = List.FilterByBoolMask(list=o_string_tonumber_11, mask=contains_8)
flatten_8 = List.Flatten(list=filterByBoolMask_9.in)
sum_8 = Math.Sum(values=flatten_8)
o_string_tonumber_12 = Orchid.Common.String.ToNumber(string=list_create)
string_9 = StringInput("Vermelho 50,0mm²")
contains_9 = String.Contains(str=list_create_2, searchFor=string_9)
filterByBoolMask_10 = List.FilterByBoolMask(list=o_string_tonumber_12, mask=contains_9)
flatten_9 = List.Flatten(list=filterByBoolMask_10.in)
sum_9 = Math.Sum(values=flatten_9)
o_string_tonumber_13 = Orchid.Common.String.ToNumber(string=list_create)
string_10 = StringInput("Vermelho 70,0mm²")
contains_10 = String.Contains(str=list_create_2, searchFor=string_10)
filterByBoolMask_11 = List.FilterByBoolMask(list=o_string_tonumber_13, mask=contains_10)
flatten_10 = List.Flatten(list=filterByBoolMask_11.in)
sum_10 = Math.Sum(values=flatten_10)
o_string_tonumber_14 = Orchid.Common.String.ToNumber(string=list_create)
string_11 = StringInput("Vermelho 95,0mm²")
contains_11 = String.Contains(str=list_create_2, searchFor=string_11)
filterByBoolMask_12 = List.FilterByBoolMask(list=o_string_tonumber_14, mask=contains_11)
flatten_11 = List.Flatten(list=filterByBoolMask_12.in)
sum_11 = Math.Sum(values=flatten_11)
o_string_tonumber_15 = Orchid.Common.String.ToNumber(string=list_create)
string_12 = StringInput("Vermelho 120,0mm²")
contains_12 = String.Contains(str=list_create_2, searchFor=string_12)
filterByBoolMask_13 = List.FilterByBoolMask(list=o_string_tonumber_15, mask=contains_12)
flatten_12 = List.Flatten(list=filterByBoolMask_13.in)
sum_12 = Math.Sum(values=flatten_12)
o_string_tonumber_16 = Orchid.Common.String.ToNumber(string=list_create)
string_13 = StringInput("Vermelho 150,0mm²")
contains_13 = String.Contains(str=list_create_2, searchFor=string_13)
filterByBoolMask_14 = List.FilterByBoolMask(list=o_string_tonumber_16, mask=contains_13)
flatten_13 = List.Flatten(list=filterByBoolMask_14.in)
sum_13 = Math.Sum(values=flatten_13)
o_string_tonumber_17 = Orchid.Common.String.ToNumber(string=list_create)
string_14 = StringInput("Vermelho 185,0mm²")
contains_14 = String.Contains(str=list_create_2, searchFor=string_14)
filterByBoolMask_15 = List.FilterByBoolMask(list=o_string_tonumber_17, mask=contains_14)
flatten_14 = List.Flatten(list=filterByBoolMask_15.in)
sum_14 = Math.Sum(values=flatten_14)
o_string_tonumber_18 = Orchid.Common.String.ToNumber(string=list_create)
string_15 = StringInput("Vermelho 240,0mm²")
contains_15 = String.Contains(str=list_create_2, searchFor=string_15)
filterByBoolMask_16 = List.FilterByBoolMask(list=o_string_tonumber_18, mask=contains_15)
flatten_15 = List.Flatten(list=filterByBoolMask_16.in)
sum_15 = Math.Sum(values=flatten_15)
o_string_tonumber_19 = Orchid.Common.String.ToNumber(string=list_create)
string_16 = StringInput("Vermelho 300,0mm²")
contains_16 = String.Contains(str=list_create_2, searchFor=string_16)
filterByBoolMask_17 = List.FilterByBoolMask(list=o_string_tonumber_19, mask=contains_16)
flatten_16 = List.Flatten(list=filterByBoolMask_17.in)
sum_16 = Math.Sum(values=flatten_16)
o_string_tonumber_20 = Orchid.Common.String.ToNumber(string=list_create)
string_17 = StringInput("Vermelho 400,0mm²")
contains_17 = String.Contains(str=list_create_2, searchFor=string_17)
filterByBoolMask_18 = List.FilterByBoolMask(list=o_string_tonumber_20, mask=contains_17)
flatten_17 = List.Flatten(list=filterByBoolMask_18.in)
sum_17 = Math.Sum(values=flatten_17)
o_string_tonumber_21 = Orchid.Common.String.ToNumber(string=list_create)
string_18 = StringInput("Vermelho 500,0mm²")
contains_18 = String.Contains(str=list_create_2, searchFor=string_18)
filterByBoolMask_19 = List.FilterByBoolMask(list=o_string_tonumber_21, mask=contains_18)
flatten_18 = List.Flatten(list=filterByBoolMask_19.in)
sum_18 = Math.Sum(values=flatten_18)
list_create_3 = List.Create(item0=sum, item1=sum_2, item2=sum_3, item3=sum_4, item4=sum_5, item5=sum_6, item6=sum_7, item7=sum_8, item8=sum_9, item9=sum_10, item10=sum_11, item11=sum_12, item12=sum_13, item13=sum_14, item14=sum_15, item15=sum_16, item16=sum_17, item17=sum_18)

# group: Cabos dentro de caixas e modelados como conduite
views_6 = Views("03 - Qtd. Cabos Entrada e Dentro das Caixas CEMIG")
code_block_13 = CodeBlock { 2; }
getDataColumns_6 = Revit.Schedule.GetDataColumns(scheduleView=views_6, columnIndexes=code_block_13)
views_7 = Views("04 - Qtd. Cabos Flexíveis (conduítes)")
code_block_14 = CodeBlock { 2; }
getDataColumns_7 = Revit.Schedule.GetDataColumns(scheduleView=views_7, columnIndexes=code_block_14)
list_create_4 = List.Create(item0=getDataColumns_6, item1=getDataColumns_7)
o_string_tonumber_22 = Orchid.Common.String.ToNumber(string=list_create_4)
code_block_15 = CodeBlock { 0; }
getDataColumns_8 = Revit.Schedule.GetDataColumns(scheduleView=views_6, columnIndexes=code_block_15)
code_block_16 = CodeBlock { 0; }
getDataColumns_9 = Revit.Schedule.GetDataColumns(scheduleView=views_7, columnIndexes=code_block_16)
code_block_17 = CodeBlock { " "; }
add_2 = getDataColumns_9 + code_block_17
code_block_18 = CodeBlock { 1; }
getDataColumns_10 = Revit.Schedule.GetDataColumns(scheduleView=views_7, columnIndexes=code_block_18)
o_string_concat_2 = Orchid.Common.String.Concat(string0=add_2, string1=getDataColumns_10)
list_create_5 = List.Create(item0=getDataColumns_8, item1=o_string_concat_2)
string_19 = StringInput("Branco 1,5mm²")
contains_19 = String.Contains(str=list_create_5, searchFor=string_19)
filterByBoolMask_20 = List.FilterByBoolMask(list=o_string_tonumber_22, mask=contains_19)
flatten_19 = List.Flatten(list=filterByBoolMask_20.in)
sum_19 = Math.Sum(values=flatten_19)
o_string_tonumber_23 = Orchid.Common.String.ToNumber(string=list_create_4)
string_20 = StringInput("Branco 2,5mm²")
contains_20 = String.Contains(str=list_create_5, searchFor=string_20)
filterByBoolMask_21 = List.FilterByBoolMask(list=o_string_tonumber_23, mask=contains_20)
flatten_20 = List.Flatten(list=filterByBoolMask_21.in)
sum_20 = Math.Sum(values=flatten_20)
o_string_tonumber_24 = Orchid.Common.String.ToNumber(string=list_create_4)
string_21 = StringInput("Branco 4,0mm²")
contains_21 = String.Contains(str=list_create_5, searchFor=string_21)
filterByBoolMask_22 = List.FilterByBoolMask(list=o_string_tonumber_24, mask=contains_21)
flatten_21 = List.Flatten(list=filterByBoolMask_22.in)
sum_21 = Math.Sum(values=flatten_21)
o_string_tonumber_25 = Orchid.Common.String.ToNumber(string=list_create_4)
string_22 = StringInput(" Branco 6,0mm²")
contains_22 = String.Contains(str=list_create_5, searchFor=string_22)
filterByBoolMask_23 = List.FilterByBoolMask(list=o_string_tonumber_25, mask=contains_22)
flatten_22 = List.Flatten(list=filterByBoolMask_23.in)
sum_22 = Math.Sum(values=flatten_22)
o_string_tonumber_26 = Orchid.Common.String.ToNumber(string=list_create_4)
string_23 = StringInput("Branco 10,0mm²")
contains_23 = String.Contains(str=list_create_5, searchFor=string_23)
filterByBoolMask_24 = List.FilterByBoolMask(list=o_string_tonumber_26, mask=contains_23)
flatten_23 = List.Flatten(list=filterByBoolMask_24.in)
sum_23 = Math.Sum(values=flatten_23)
o_string_tonumber_27 = Orchid.Common.String.ToNumber(string=list_create_4)
string_24 = StringInput("Branco 16,0mm²")
contains_24 = String.Contains(str=list_create_5, searchFor=string_24)
filterByBoolMask_25 = List.FilterByBoolMask(list=o_string_tonumber_27, mask=contains_24)
flatten_24 = List.Flatten(list=filterByBoolMask_25.in)
sum_24 = Math.Sum(values=flatten_24)
o_string_tonumber_28 = Orchid.Common.String.ToNumber(string=list_create_4)
string_25 = StringInput("Branco 25,0mm²")
contains_25 = String.Contains(str=list_create_5, searchFor=string_25)
filterByBoolMask_26 = List.FilterByBoolMask(list=o_string_tonumber_28, mask=contains_25)
flatten_25 = List.Flatten(list=filterByBoolMask_26.in)
sum_25 = Math.Sum(values=flatten_25)
o_string_tonumber_29 = Orchid.Common.String.ToNumber(string=list_create_4)
string_26 = StringInput("Branco 35,0mm²")
contains_26 = String.Contains(str=list_create_5, searchFor=string_26)
filterByBoolMask_27 = List.FilterByBoolMask(list=o_string_tonumber_29, mask=contains_26)
flatten_26 = List.Flatten(list=filterByBoolMask_27.in)
sum_26 = Math.Sum(values=flatten_26)
o_string_tonumber_30 = Orchid.Common.String.ToNumber(string=list_create_4)
string_27 = StringInput("Branco 50,0mm²")
contains_27 = String.Contains(str=list_create_5, searchFor=string_27)
filterByBoolMask_28 = List.FilterByBoolMask(list=o_string_tonumber_30, mask=contains_27)
flatten_27 = List.Flatten(list=filterByBoolMask_28.in)
sum_27 = Math.Sum(values=flatten_27)
o_string_tonumber_31 = Orchid.Common.String.ToNumber(string=list_create_4)
string_28 = StringInput("Branco 70,0mm²")
contains_28 = String.Contains(str=list_create_5, searchFor=string_28)
filterByBoolMask_29 = List.FilterByBoolMask(list=o_string_tonumber_31, mask=contains_28)
flatten_28 = List.Flatten(list=filterByBoolMask_29.in)
sum_28 = Math.Sum(values=flatten_28)
o_string_tonumber_32 = Orchid.Common.String.ToNumber(string=list_create_4)
string_29 = StringInput("Branco 95,0mm²")
contains_29 = String.Contains(str=list_create_5, searchFor=string_29)
filterByBoolMask_30 = List.FilterByBoolMask(list=o_string_tonumber_32, mask=contains_29)
flatten_29 = List.Flatten(list=filterByBoolMask_30.in)
sum_29 = Math.Sum(values=flatten_29)
o_string_tonumber_33 = Orchid.Common.String.ToNumber(string=list_create_4)
string_30 = StringInput("Branco 120,0mm²")
contains_30 = String.Contains(str=list_create_5, searchFor=string_30)
filterByBoolMask_31 = List.FilterByBoolMask(list=o_string_tonumber_33, mask=contains_30)
flatten_30 = List.Flatten(list=filterByBoolMask_31.in)
sum_30 = Math.Sum(values=flatten_30)
o_string_tonumber_34 = Orchid.Common.String.ToNumber(string=list_create_4)
string_31 = StringInput("Branco 150,0mm²")
contains_31 = String.Contains(str=list_create_5, searchFor=string_31)
filterByBoolMask_32 = List.FilterByBoolMask(list=o_string_tonumber_34, mask=contains_31)
flatten_31 = List.Flatten(list=filterByBoolMask_32.in)
sum_31 = Math.Sum(values=flatten_31)
o_string_tonumber_35 = Orchid.Common.String.ToNumber(string=list_create_4)
string_32 = StringInput("Branco 185,0mm²")
contains_32 = String.Contains(str=list_create_5, searchFor=string_32)
filterByBoolMask_33 = List.FilterByBoolMask(list=o_string_tonumber_35, mask=contains_32)
flatten_32 = List.Flatten(list=filterByBoolMask_33.in)
sum_32 = Math.Sum(values=flatten_32)
o_string_tonumber_36 = Orchid.Common.String.ToNumber(string=list_create_4)
string_33 = StringInput("Branco 240,0mm²")
contains_33 = String.Contains(str=list_create_5, searchFor=string_33)
filterByBoolMask_34 = List.FilterByBoolMask(list=o_string_tonumber_36, mask=contains_33)
flatten_33 = List.Flatten(list=filterByBoolMask_34.in)
sum_33 = Math.Sum(values=flatten_33)
o_string_tonumber_37 = Orchid.Common.String.ToNumber(string=list_create_4)
string_34 = StringInput("Branco 300,0mm²")
contains_34 = String.Contains(str=list_create_5, searchFor=string_34)
filterByBoolMask_35 = List.FilterByBoolMask(list=o_string_tonumber_37, mask=contains_34)
flatten_34 = List.Flatten(list=filterByBoolMask_35.in)
sum_34 = Math.Sum(values=flatten_34)
o_string_tonumber_38 = Orchid.Common.String.ToNumber(string=list_create_4)
string_35 = StringInput("Branco 400,0mm²")
contains_35 = String.Contains(str=list_create_5, searchFor=string_35)
filterByBoolMask_36 = List.FilterByBoolMask(list=o_string_tonumber_38, mask=contains_35)
flatten_35 = List.Flatten(list=filterByBoolMask_36.in)
sum_35 = Math.Sum(values=flatten_35)
o_string_tonumber_39 = Orchid.Common.String.ToNumber(string=list_create_4)
string_36 = StringInput("Branco 500,0mm²")
contains_36 = String.Contains(str=list_create_5, searchFor=string_36)
filterByBoolMask_37 = List.FilterByBoolMask(list=o_string_tonumber_39, mask=contains_36)
flatten_36 = List.Flatten(list=filterByBoolMask_37.in)
sum_36 = Math.Sum(values=flatten_36)
list_create_6 = List.Create(item0=sum_19, item1=sum_20, item2=sum_21, item3=sum_22, item4=sum_23, item5=sum_24, item6=sum_25, item7=sum_26, item8=sum_27, item9=sum_28, item10=sum_29, item11=sum_30, item12=sum_31, item13=sum_32, item14=sum_33, item15=sum_34, item16=sum_35, item17=sum_36)

# group: Cabos dentro de caixas e modelados como conduite
views_8 = Views("03 - Qtd. Cabos Entrada e Dentro das Caixas CEMIG")
code_block_19 = CodeBlock { 2; }
getDataColumns_11 = Revit.Schedule.GetDataColumns(scheduleView=views_8, columnIndexes=code_block_19)
views_9 = Views("04 - Qtd. Cabos Flexíveis (conduítes)")
code_block_20 = CodeBlock { 2; }
getDataColumns_12 = Revit.Schedule.GetDataColumns(scheduleView=views_9, columnIndexes=code_block_20)
list_create_7 = List.Create(item0=getDataColumns_11, item1=getDataColumns_12)
o_string_tonumber_40 = Orchid.Common.String.ToNumber(string=list_create_7)
code_block_21 = CodeBlock { 0; }
getDataColumns_13 = Revit.Schedule.GetDataColumns(scheduleView=views_8, columnIndexes=code_block_21)
code_block_22 = CodeBlock { 0; }
getDataColumns_14 = Revit.Schedule.GetDataColumns(scheduleView=views_9, columnIndexes=code_block_22)
code_block_23 = CodeBlock { " "; }
add_3 = getDataColumns_14 + code_block_23
code_block_24 = CodeBlock { 1; }
getDataColumns_15 = Revit.Schedule.GetDataColumns(scheduleView=views_9, columnIndexes=code_block_24)
o_string_concat_3 = Orchid.Common.String.Concat(string0=add_3, string1=getDataColumns_15)
list_create_8 = List.Create(item0=getDataColumns_13, item1=o_string_concat_3)
string_37 = StringInput("Preto 1,5mm²")
contains_37 = String.Contains(str=list_create_8, searchFor=string_37)
filterByBoolMask_38 = List.FilterByBoolMask(list=o_string_tonumber_40, mask=contains_37)
flatten_37 = List.Flatten(list=filterByBoolMask_38.in)
sum_37 = Math.Sum(values=flatten_37)
o_string_tonumber_41 = Orchid.Common.String.ToNumber(string=list_create_7)
string_38 = StringInput("Preto 2,5mm²")
contains_38 = String.Contains(str=list_create_8, searchFor=string_38)
filterByBoolMask_39 = List.FilterByBoolMask(list=o_string_tonumber_41, mask=contains_38)
flatten_38 = List.Flatten(list=filterByBoolMask_39.in)
sum_38 = Math.Sum(values=flatten_38)
o_string_tonumber_42 = Orchid.Common.String.ToNumber(string=list_create_7)
string_39 = StringInput("Preto 4,0mm²")
contains_39 = String.Contains(str=list_create_8, searchFor=string_39)
filterByBoolMask_40 = List.FilterByBoolMask(list=o_string_tonumber_42, mask=contains_39)
flatten_39 = List.Flatten(list=filterByBoolMask_40.in)
sum_39 = Math.Sum(values=flatten_39)
o_string_tonumber_43 = Orchid.Common.String.ToNumber(string=list_create_7)
string_40 = StringInput(" Preto 6,0mm²")
contains_40 = String.Contains(str=list_create_8, searchFor=string_40)
filterByBoolMask_41 = List.FilterByBoolMask(list=o_string_tonumber_43, mask=contains_40)
flatten_40 = List.Flatten(list=filterByBoolMask_41.in)
sum_40 = Math.Sum(values=flatten_40)
o_string_tonumber_44 = Orchid.Common.String.ToNumber(string=list_create_7)
string_41 = StringInput("Preto 10,0mm²")
contains_41 = String.Contains(str=list_create_8, searchFor=string_41)
filterByBoolMask_42 = List.FilterByBoolMask(list=o_string_tonumber_44, mask=contains_41)
flatten_41 = List.Flatten(list=filterByBoolMask_42.in)
sum_41 = Math.Sum(values=flatten_41)
o_string_tonumber_45 = Orchid.Common.String.ToNumber(string=list_create_7)
string_42 = StringInput("Preto 16,0mm²")
contains_42 = String.Contains(str=list_create_8, searchFor=string_42)
filterByBoolMask_43 = List.FilterByBoolMask(list=o_string_tonumber_45, mask=contains_42)
flatten_42 = List.Flatten(list=filterByBoolMask_43.in)
sum_42 = Math.Sum(values=flatten_42)
o_string_tonumber_46 = Orchid.Common.String.ToNumber(string=list_create_7)
string_43 = StringInput("Preto 25,0mm²")
contains_43 = String.Contains(str=list_create_8, searchFor=string_43)
filterByBoolMask_44 = List.FilterByBoolMask(list=o_string_tonumber_46, mask=contains_43)
flatten_43 = List.Flatten(list=filterByBoolMask_44.in)
sum_43 = Math.Sum(values=flatten_43)
o_string_tonumber_47 = Orchid.Common.String.ToNumber(string=list_create_7)
string_44 = StringInput("Preto 35,0mm²")
contains_44 = String.Contains(str=list_create_8, searchFor=string_44)
filterByBoolMask_45 = List.FilterByBoolMask(list=o_string_tonumber_47, mask=contains_44)
flatten_44 = List.Flatten(list=filterByBoolMask_45.in)
sum_44 = Math.Sum(values=flatten_44)
o_string_tonumber_48 = Orchid.Common.String.ToNumber(string=list_create_7)
string_45 = StringInput("Preto 50,0mm²")
contains_45 = String.Contains(str=list_create_8, searchFor=string_45)
filterByBoolMask_46 = List.FilterByBoolMask(list=o_string_tonumber_48, mask=contains_45)
flatten_45 = List.Flatten(list=filterByBoolMask_46.in)
sum_45 = Math.Sum(values=flatten_45)
o_string_tonumber_49 = Orchid.Common.String.ToNumber(string=list_create_7)
string_46 = StringInput("Preto 70,0mm²")
contains_46 = String.Contains(str=list_create_8, searchFor=string_46)
filterByBoolMask_47 = List.FilterByBoolMask(list=o_string_tonumber_49, mask=contains_46)
flatten_46 = List.Flatten(list=filterByBoolMask_47.in)
sum_46 = Math.Sum(values=flatten_46)
o_string_tonumber_50 = Orchid.Common.String.ToNumber(string=list_create_7)
string_47 = StringInput("Preto 95,0mm²")
contains_47 = String.Contains(str=list_create_8, searchFor=string_47)
filterByBoolMask_48 = List.FilterByBoolMask(list=o_string_tonumber_50, mask=contains_47)
flatten_47 = List.Flatten(list=filterByBoolMask_48.in)
sum_47 = Math.Sum(values=flatten_47)
o_string_tonumber_51 = Orchid.Common.String.ToNumber(string=list_create_7)
string_48 = StringInput("Preto 120,0mm²")
contains_48 = String.Contains(str=list_create_8, searchFor=string_48)
filterByBoolMask_49 = List.FilterByBoolMask(list=o_string_tonumber_51, mask=contains_48)
flatten_48 = List.Flatten(list=filterByBoolMask_49.in)
sum_48 = Math.Sum(values=flatten_48)
o_string_tonumber_52 = Orchid.Common.String.ToNumber(string=list_create_7)
string_49 = StringInput("Preto 150,0mm²")
contains_49 = String.Contains(str=list_create_8, searchFor=string_49)
filterByBoolMask_50 = List.FilterByBoolMask(list=o_string_tonumber_52, mask=contains_49)
flatten_49 = List.Flatten(list=filterByBoolMask_50.in)
sum_49 = Math.Sum(values=flatten_49)
o_string_tonumber_53 = Orchid.Common.String.ToNumber(string=list_create_7)
string_50 = StringInput("Preto 185,0mm²")
contains_50 = String.Contains(str=list_create_8, searchFor=string_50)
filterByBoolMask_51 = List.FilterByBoolMask(list=o_string_tonumber_53, mask=contains_50)
flatten_50 = List.Flatten(list=filterByBoolMask_51.in)
sum_50 = Math.Sum(values=flatten_50)
o_string_tonumber_54 = Orchid.Common.String.ToNumber(string=list_create_7)
string_51 = StringInput("Preto 240,0mm²")
contains_51 = String.Contains(str=list_create_8, searchFor=string_51)
filterByBoolMask_52 = List.FilterByBoolMask(list=o_string_tonumber_54, mask=contains_51)
flatten_51 = List.Flatten(list=filterByBoolMask_52.in)
sum_51 = Math.Sum(values=flatten_51)
o_string_tonumber_55 = Orchid.Common.String.ToNumber(string=list_create_7)
string_52 = StringInput("Preto 300,0mm²")
contains_52 = String.Contains(str=list_create_8, searchFor=string_52)
filterByBoolMask_53 = List.FilterByBoolMask(list=o_string_tonumber_55, mask=contains_52)
flatten_52 = List.Flatten(list=filterByBoolMask_53.in)
sum_52 = Math.Sum(values=flatten_52)
o_string_tonumber_56 = Orchid.Common.String.ToNumber(string=list_create_7)
string_53 = StringInput("Preto 400,0mm²")
contains_53 = String.Contains(str=list_create_8, searchFor=string_53)
filterByBoolMask_54 = List.FilterByBoolMask(list=o_string_tonumber_56, mask=contains_53)
flatten_53 = List.Flatten(list=filterByBoolMask_54.in)
sum_53 = Math.Sum(values=flatten_53)
o_string_tonumber_57 = Orchid.Common.String.ToNumber(string=list_create_7)
string_54 = StringInput("Preto 500,0mm²")
contains_54 = String.Contains(str=list_create_8, searchFor=string_54)
filterByBoolMask_55 = List.FilterByBoolMask(list=o_string_tonumber_57, mask=contains_54)
flatten_54 = List.Flatten(list=filterByBoolMask_55.in)
sum_54 = Math.Sum(values=flatten_54)
list_create_9 = List.Create(item0=sum_37, item1=sum_38, item2=sum_39, item3=sum_40, item4=sum_41, item5=sum_42, item6=sum_43, item7=sum_44, item8=sum_45, item9=sum_46, item10=sum_47, item11=sum_48, item12=sum_49, item13=sum_50, item14=sum_51, item15=sum_52, item16=sum_53, item17=sum_54)

# group: Neutro
views_10 = Views("03 - Qtd. Cabos Entrada e Dentro das Caixas CEMIG")
code_block_25 = CodeBlock { 2; }
getDataColumns_16 = Revit.Schedule.GetDataColumns(scheduleView=views_10, columnIndexes=code_block_25)
views_11 = Views("04 - Qtd. Cabos Flexíveis (conduítes)")
code_block_26 = CodeBlock { 2; }
getDataColumns_17 = Revit.Schedule.GetDataColumns(scheduleView=views_11, columnIndexes=code_block_26)
list_create_10 = List.Create(item0=getDataColumns_16, item1=getDataColumns_17)
o_string_tonumber_58 = Orchid.Common.String.ToNumber(string=list_create_10)
code_block_27 = CodeBlock { 0; }
getDataColumns_18 = Revit.Schedule.GetDataColumns(scheduleView=views_10, columnIndexes=code_block_27)
code_block_28 = CodeBlock { 0; }
getDataColumns_19 = Revit.Schedule.GetDataColumns(scheduleView=views_11, columnIndexes=code_block_28)
code_block_29 = CodeBlock { " "; }
add_4 = getDataColumns_19 + code_block_29
code_block_30 = CodeBlock { 1; }
getDataColumns_20 = Revit.Schedule.GetDataColumns(scheduleView=views_11, columnIndexes=code_block_30)
o_string_concat_4 = Orchid.Common.String.Concat(string0=add_4, string1=getDataColumns_20)
list_create_11 = List.Create(item0=getDataColumns_18, item1=o_string_concat_4)
string_55 = StringInput("Azul 1,5mm²")
contains_55 = String.Contains(str=list_create_11, searchFor=string_55)
filterByBoolMask_56 = List.FilterByBoolMask(list=o_string_tonumber_58, mask=contains_55)
flatten_55 = List.Flatten(list=filterByBoolMask_56.in)
sum_55 = Math.Sum(values=flatten_55)
o_string_tonumber_59 = Orchid.Common.String.ToNumber(string=list_create_10)
string_56 = StringInput("Azul 2,5mm²")
contains_56 = String.Contains(str=list_create_11, searchFor=string_56)
filterByBoolMask_57 = List.FilterByBoolMask(list=o_string_tonumber_59, mask=contains_56)
flatten_56 = List.Flatten(list=filterByBoolMask_57.in)
sum_56 = Math.Sum(values=flatten_56)
o_string_tonumber_60 = Orchid.Common.String.ToNumber(string=list_create_10)
string_57 = StringInput("Azul 4,0mm²")
contains_57 = String.Contains(str=list_create_11, searchFor=string_57)
filterByBoolMask_58 = List.FilterByBoolMask(list=o_string_tonumber_60, mask=contains_57)
flatten_57 = List.Flatten(list=filterByBoolMask_58.in)
sum_57 = Math.Sum(values=flatten_57)
o_string_tonumber_61 = Orchid.Common.String.ToNumber(string=list_create_10)
string_58 = StringInput(" Azul 6,0mm²")
contains_58 = String.Contains(str=list_create_11, searchFor=string_58)
filterByBoolMask_59 = List.FilterByBoolMask(list=o_string_tonumber_61, mask=contains_58)
flatten_58 = List.Flatten(list=filterByBoolMask_59.in)
sum_58 = Math.Sum(values=flatten_58)
o_string_tonumber_62 = Orchid.Common.String.ToNumber(string=list_create_10)
string_59 = StringInput("Azul 10,0mm²")
contains_59 = String.Contains(str=list_create_11, searchFor=string_59)
filterByBoolMask_60 = List.FilterByBoolMask(list=o_string_tonumber_62, mask=contains_59)
flatten_59 = List.Flatten(list=filterByBoolMask_60.in)
sum_59 = Math.Sum(values=flatten_59)
o_string_tonumber_63 = Orchid.Common.String.ToNumber(string=list_create_10)
string_60 = StringInput("Azul 16,0mm²")
contains_60 = String.Contains(str=list_create_11, searchFor=string_60)
filterByBoolMask_61 = List.FilterByBoolMask(list=o_string_tonumber_63, mask=contains_60)
flatten_60 = List.Flatten(list=filterByBoolMask_61.in)
sum_60 = Math.Sum(values=flatten_60)
o_string_tonumber_64 = Orchid.Common.String.ToNumber(string=list_create_10)
string_61 = StringInput("Azul 25,0mm²")
contains_61 = String.Contains(str=list_create_11, searchFor=string_61)
filterByBoolMask_62 = List.FilterByBoolMask(list=o_string_tonumber_64, mask=contains_61)
flatten_61 = List.Flatten(list=filterByBoolMask_62.in)
sum_61 = Math.Sum(values=flatten_61)
o_string_tonumber_65 = Orchid.Common.String.ToNumber(string=list_create_10)
string_62 = StringInput("Azul 35,0mm²")
contains_62 = String.Contains(str=list_create_11, searchFor=string_62)
filterByBoolMask_63 = List.FilterByBoolMask(list=o_string_tonumber_65, mask=contains_62)
flatten_62 = List.Flatten(list=filterByBoolMask_63.in)
sum_62 = Math.Sum(values=flatten_62)
o_string_tonumber_66 = Orchid.Common.String.ToNumber(string=list_create_10)
string_63 = StringInput("Azul 50,0mm²")
contains_63 = String.Contains(str=list_create_11, searchFor=string_63)
filterByBoolMask_64 = List.FilterByBoolMask(list=o_string_tonumber_66, mask=contains_63)
flatten_63 = List.Flatten(list=filterByBoolMask_64.in)
sum_63 = Math.Sum(values=flatten_63)
o_string_tonumber_67 = Orchid.Common.String.ToNumber(string=list_create_10)
string_64 = StringInput("Azul 70,0mm²")
contains_64 = String.Contains(str=list_create_11, searchFor=string_64)
filterByBoolMask_65 = List.FilterByBoolMask(list=o_string_tonumber_67, mask=contains_64)
flatten_64 = List.Flatten(list=filterByBoolMask_65.in)
sum_64 = Math.Sum(values=flatten_64)
o_string_tonumber_68 = Orchid.Common.String.ToNumber(string=list_create_10)
string_65 = StringInput("Azul 95,0mm²")
contains_65 = String.Contains(str=list_create_11, searchFor=string_65)
filterByBoolMask_66 = List.FilterByBoolMask(list=o_string_tonumber_68, mask=contains_65)
flatten_65 = List.Flatten(list=filterByBoolMask_66.in)
sum_65 = Math.Sum(values=flatten_65)
o_string_tonumber_69 = Orchid.Common.String.ToNumber(string=list_create_10)
string_66 = StringInput("Azul 120,0mm²")
contains_66 = String.Contains(str=list_create_11, searchFor=string_66)
filterByBoolMask_67 = List.FilterByBoolMask(list=o_string_tonumber_69, mask=contains_66)
flatten_66 = List.Flatten(list=filterByBoolMask_67.in)
sum_66 = Math.Sum(values=flatten_66)
o_string_tonumber_70 = Orchid.Common.String.ToNumber(string=list_create_10)
string_67 = StringInput("Azul 150,0mm²")
contains_67 = String.Contains(str=list_create_11, searchFor=string_67)
filterByBoolMask_68 = List.FilterByBoolMask(list=o_string_tonumber_70, mask=contains_67)
flatten_67 = List.Flatten(list=filterByBoolMask_68.in)
sum_67 = Math.Sum(values=flatten_67)
o_string_tonumber_71 = Orchid.Common.String.ToNumber(string=list_create_10)
string_68 = StringInput("Azul 185,0mm²")
contains_68 = String.Contains(str=list_create_11, searchFor=string_68)
filterByBoolMask_69 = List.FilterByBoolMask(list=o_string_tonumber_71, mask=contains_68)
flatten_68 = List.Flatten(list=filterByBoolMask_69.in)
sum_68 = Math.Sum(values=flatten_68)
o_string_tonumber_72 = Orchid.Common.String.ToNumber(string=list_create_10)
string_69 = StringInput("Azul 240,0mm²")
contains_69 = String.Contains(str=list_create_11, searchFor=string_69)
filterByBoolMask_70 = List.FilterByBoolMask(list=o_string_tonumber_72, mask=contains_69)
flatten_69 = List.Flatten(list=filterByBoolMask_70.in)
sum_69 = Math.Sum(values=flatten_69)
o_string_tonumber_73 = Orchid.Common.String.ToNumber(string=list_create_10)
string_70 = StringInput("Azul 300,0mm²")
contains_70 = String.Contains(str=list_create_11, searchFor=string_70)
filterByBoolMask_71 = List.FilterByBoolMask(list=o_string_tonumber_73, mask=contains_70)
flatten_70 = List.Flatten(list=filterByBoolMask_71.in)
sum_70 = Math.Sum(values=flatten_70)
o_string_tonumber_74 = Orchid.Common.String.ToNumber(string=list_create_10)
string_71 = StringInput("Azul 400,0mm²")
contains_71 = String.Contains(str=list_create_11, searchFor=string_71)
filterByBoolMask_72 = List.FilterByBoolMask(list=o_string_tonumber_74, mask=contains_71)
flatten_71 = List.Flatten(list=filterByBoolMask_72.in)
sum_71 = Math.Sum(values=flatten_71)
o_string_tonumber_75 = Orchid.Common.String.ToNumber(string=list_create_10)
string_72 = StringInput("Azul 500,0mm²")
contains_72 = String.Contains(str=list_create_11, searchFor=string_72)
filterByBoolMask_73 = List.FilterByBoolMask(list=o_string_tonumber_75, mask=contains_72)
flatten_72 = List.Flatten(list=filterByBoolMask_73.in)
sum_72 = Math.Sum(values=flatten_72)
list_create_12 = List.Create(item0=sum_55, item1=sum_56, item2=sum_57, item3=sum_58, item4=sum_59, item5=sum_60, item6=sum_61, item7=sum_62, item8=sum_63, item9=sum_64, item10=sum_65, item11=sum_66, item12=sum_67, item13=sum_68, item14=sum_69, item15=sum_70, item16=sum_71, item17=sum_72)

# group: Proteção
views_12 = Views("03 - Qtd. Cabos Entrada e Dentro das Caixas CEMIG")
code_block_31 = CodeBlock { 2; }
getDataColumns_21 = Revit.Schedule.GetDataColumns(scheduleView=views_12, columnIndexes=code_block_31)
views_13 = Views("04 - Qtd. Cabos Flexíveis (conduítes)")
code_block_32 = CodeBlock { 2; }
getDataColumns_22 = Revit.Schedule.GetDataColumns(scheduleView=views_13, columnIndexes=code_block_32)
list_create_13 = List.Create(item0=getDataColumns_21, item1=getDataColumns_22)
o_string_tonumber_76 = Orchid.Common.String.ToNumber(string=list_create_13)
code_block_33 = CodeBlock { 0; }
getDataColumns_23 = Revit.Schedule.GetDataColumns(scheduleView=views_12, columnIndexes=code_block_33)
code_block_34 = CodeBlock { 0; }
getDataColumns_24 = Revit.Schedule.GetDataColumns(scheduleView=views_13, columnIndexes=code_block_34)
code_block_35 = CodeBlock { " "; }
add_5 = getDataColumns_24 + code_block_35
code_block_36 = CodeBlock { 1; }
getDataColumns_25 = Revit.Schedule.GetDataColumns(scheduleView=views_13, columnIndexes=code_block_36)
o_string_concat_5 = Orchid.Common.String.Concat(string0=add_5, string1=getDataColumns_25)
list_create_14 = List.Create(item0=getDataColumns_23, item1=o_string_concat_5)
string_73 = StringInput("Verde 1,5mm²")
contains_73 = String.Contains(str=list_create_14, searchFor=string_73)
filterByBoolMask_74 = List.FilterByBoolMask(list=o_string_tonumber_76, mask=contains_73)
flatten_73 = List.Flatten(list=filterByBoolMask_74.in)
sum_73 = Math.Sum(values=flatten_73)
o_string_tonumber_77 = Orchid.Common.String.ToNumber(string=list_create_13)
string_74 = StringInput("Verde 2,5mm²")
contains_74 = String.Contains(str=list_create_14, searchFor=string_74)
filterByBoolMask_75 = List.FilterByBoolMask(list=o_string_tonumber_77, mask=contains_74)
flatten_74 = List.Flatten(list=filterByBoolMask_75.in)
sum_74 = Math.Sum(values=flatten_74)
o_string_tonumber_78 = Orchid.Common.String.ToNumber(string=list_create_13)
string_75 = StringInput("Verde 4,0mm²")
contains_75 = String.Contains(str=list_create_14, searchFor=string_75)
filterByBoolMask_76 = List.FilterByBoolMask(list=o_string_tonumber_78, mask=contains_75)
flatten_75 = List.Flatten(list=filterByBoolMask_76.in)
sum_75 = Math.Sum(values=flatten_75)
o_string_tonumber_79 = Orchid.Common.String.ToNumber(string=list_create_13)
string_76 = StringInput(" Verde 6,0mm²")
contains_76 = String.Contains(str=list_create_14, searchFor=string_76)
filterByBoolMask_77 = List.FilterByBoolMask(list=o_string_tonumber_79, mask=contains_76)
flatten_76 = List.Flatten(list=filterByBoolMask_77.in)
sum_76 = Math.Sum(values=flatten_76)
o_string_tonumber_80 = Orchid.Common.String.ToNumber(string=list_create_13)
string_77 = StringInput("Verde 10,0mm²")
contains_77 = String.Contains(str=list_create_14, searchFor=string_77)
filterByBoolMask_78 = List.FilterByBoolMask(list=o_string_tonumber_80, mask=contains_77)
flatten_77 = List.Flatten(list=filterByBoolMask_78.in)
sum_77 = Math.Sum(values=flatten_77)
o_string_tonumber_81 = Orchid.Common.String.ToNumber(string=list_create_13)
string_78 = StringInput("Verde 16,0mm²")
contains_78 = String.Contains(str=list_create_14, searchFor=string_78)
filterByBoolMask_79 = List.FilterByBoolMask(list=o_string_tonumber_81, mask=contains_78)
flatten_78 = List.Flatten(list=filterByBoolMask_79.in)
sum_78 = Math.Sum(values=flatten_78)
o_string_tonumber_82 = Orchid.Common.String.ToNumber(string=list_create_13)
string_79 = StringInput("Verde 25,0mm²")
contains_79 = String.Contains(str=list_create_14, searchFor=string_79)
filterByBoolMask_80 = List.FilterByBoolMask(list=o_string_tonumber_82, mask=contains_79)
flatten_79 = List.Flatten(list=filterByBoolMask_80.in)
sum_79 = Math.Sum(values=flatten_79)
o_string_tonumber_83 = Orchid.Common.String.ToNumber(string=list_create_13)
string_80 = StringInput("Verde 35,0mm²")
contains_80 = String.Contains(str=list_create_14, searchFor=string_80)
filterByBoolMask_81 = List.FilterByBoolMask(list=o_string_tonumber_83, mask=contains_80)
flatten_80 = List.Flatten(list=filterByBoolMask_81.in)
sum_80 = Math.Sum(values=flatten_80)
o_string_tonumber_84 = Orchid.Common.String.ToNumber(string=list_create_13)
string_81 = StringInput("Verde 50,0mm²")
contains_81 = String.Contains(str=list_create_14, searchFor=string_81)
filterByBoolMask_82 = List.FilterByBoolMask(list=o_string_tonumber_84, mask=contains_81)
flatten_81 = List.Flatten(list=filterByBoolMask_82.in)
sum_81 = Math.Sum(values=flatten_81)
o_string_tonumber_85 = Orchid.Common.String.ToNumber(string=list_create_13)
string_82 = StringInput("Verde 70,0mm²")
contains_82 = String.Contains(str=list_create_14, searchFor=string_82)
filterByBoolMask_83 = List.FilterByBoolMask(list=o_string_tonumber_85, mask=contains_82)
flatten_82 = List.Flatten(list=filterByBoolMask_83.in)
sum_82 = Math.Sum(values=flatten_82)
o_string_tonumber_86 = Orchid.Common.String.ToNumber(string=list_create_13)
string_83 = StringInput("Verde 95,0mm²")
contains_83 = String.Contains(str=list_create_14, searchFor=string_83)
filterByBoolMask_84 = List.FilterByBoolMask(list=o_string_tonumber_86, mask=contains_83)
flatten_83 = List.Flatten(list=filterByBoolMask_84.in)
sum_83 = Math.Sum(values=flatten_83)
o_string_tonumber_87 = Orchid.Common.String.ToNumber(string=list_create_13)
string_84 = StringInput("Verde 120,0mm²")
contains_84 = String.Contains(str=list_create_14, searchFor=string_84)
filterByBoolMask_85 = List.FilterByBoolMask(list=o_string_tonumber_87, mask=contains_84)
flatten_84 = List.Flatten(list=filterByBoolMask_85.in)
sum_84 = Math.Sum(values=flatten_84)
o_string_tonumber_88 = Orchid.Common.String.ToNumber(string=list_create_13)
string_85 = StringInput("Verde 150,0mm²")
contains_85 = String.Contains(str=list_create_14, searchFor=string_85)
filterByBoolMask_86 = List.FilterByBoolMask(list=o_string_tonumber_88, mask=contains_85)
flatten_85 = List.Flatten(list=filterByBoolMask_86.in)
sum_85 = Math.Sum(values=flatten_85)
o_string_tonumber_89 = Orchid.Common.String.ToNumber(string=list_create_13)
string_86 = StringInput("Verde 185,0mm²")
contains_86 = String.Contains(str=list_create_14, searchFor=string_86)
filterByBoolMask_87 = List.FilterByBoolMask(list=o_string_tonumber_89, mask=contains_86)
flatten_86 = List.Flatten(list=filterByBoolMask_87.in)
sum_86 = Math.Sum(values=flatten_86)
o_string_tonumber_90 = Orchid.Common.String.ToNumber(string=list_create_13)
string_87 = StringInput("Verde 240,0mm²")
contains_87 = String.Contains(str=list_create_14, searchFor=string_87)
filterByBoolMask_88 = List.FilterByBoolMask(list=o_string_tonumber_90, mask=contains_87)
flatten_87 = List.Flatten(list=filterByBoolMask_88.in)
sum_87 = Math.Sum(values=flatten_87)
o_string_tonumber_91 = Orchid.Common.String.ToNumber(string=list_create_13)
string_88 = StringInput("Verde 300,0mm²")
contains_88 = String.Contains(str=list_create_14, searchFor=string_88)
filterByBoolMask_89 = List.FilterByBoolMask(list=o_string_tonumber_91, mask=contains_88)
flatten_88 = List.Flatten(list=filterByBoolMask_89.in)
sum_88 = Math.Sum(values=flatten_88)
o_string_tonumber_92 = Orchid.Common.String.ToNumber(string=list_create_13)
string_89 = StringInput("Verde 400,0mm²")
contains_89 = String.Contains(str=list_create_14, searchFor=string_89)
filterByBoolMask_90 = List.FilterByBoolMask(list=o_string_tonumber_92, mask=contains_89)
flatten_89 = List.Flatten(list=filterByBoolMask_90.in)
sum_89 = Math.Sum(values=flatten_89)
o_string_tonumber_93 = Orchid.Common.String.ToNumber(string=list_create_13)
string_90 = StringInput("Verde 500,0mm²")
contains_90 = String.Contains(str=list_create_14, searchFor=string_90)
filterByBoolMask_91 = List.FilterByBoolMask(list=o_string_tonumber_93, mask=contains_90)
flatten_90 = List.Flatten(list=filterByBoolMask_91.in)
sum_90 = Math.Sum(values=flatten_90)
list_create_15 = List.Create(item0=sum_73, item1=sum_74, item2=sum_75, item3=sum_76, item4=sum_77, item5=sum_78, item6=sum_79, item7=sum_80, item8=sum_81, item9=sum_82, item10=sum_83, item11=sum_84, item12=sum_85, item13=sum_86, item14=sum_87, item15=sum_88, item16=sum_89, item17=sum_90)

# group: Selecionar familia genérica para atribuir parâmetros ARRED.
categories_2 = Categories("OST_GenericModel")
all_elements_of_category_2 = ElementsOfCategory(Category=categories_2)
string_from_object_2 = FromObject(obj=all_elements_of_category_2)
code_block_37 = CodeBlock { "Soma Arredondamento Cabos"; }
eq_2 = string_from_object_2 == code_block_37
filterByBoolMask_92 = List.FilterByBoolMask(list=all_elements_of_category_2, mask=eq_2)

# group: Retorno - Amarelo
retornos = CodeBlock { 92; 96; }
slice = List.Slice(list=getDataRows_4@L2, start=retornos.out0, end=retornos.out1)
retornos_2 = CodeBlock { 92; 96; }
slice_2 = List.Slice(list=code_block_4@L2, start=retornos_2.out0, end=retornos_2.out1)
setParameterByName = Element.SetParameterByName(element=filterByBoolMask.in, parameterName=slice, value=slice_2)
number_roundUpTo = Custom[number_roundUpTo](numbers=slice_2)  # package Sparrow; This node returns a rounded number to the ceiling of a specified multiple.
setParameterByName_2 = Element.SetParameterByName(element=filterByBoolMask_92.in, parameterName=slice, value=number_roundUpTo)

passthrough = Custom[Passthrough](passThrough=filterByBoolMask.in, waitFor=setParameterByName)  # package Clockwork for Dynamo 2.x; Forces a sequential order of execution. The node wired into the output of the Passthrough node will be executed *after* the node wired into the waitFor input (e.g. important for some Revit operations). The value of the passThrough input will be passed on to the node wired into the output port of the Passthrough node.
passthrough_2 = Custom[Passthrough](passThrough=filterByBoolMask_92.in, waitFor=setParameterByName_2)

# group: Fase A - Vermelha
fase_a = CodeBlock { 2; 20; }
slice_3 = List.Slice(list=getDataRows_4@L2, start=fase_a.out0, end=fase_a.out1)
fase_a_2 = CodeBlock { 2; 20; }
slice_4 = List.Slice(list=code_block_4@L2, start=fase_a_2.out0, end=fase_a_2.out1)
flatten_91 = List.Flatten(list=slice_4)
code_block_38 = CodeBlock(a=flatten_91, b=list_create_3) { a+b; }
list_create_16 = List.Create(item0=code_block_38)
setParameterByName_3 = Element.SetParameterByName(element=passthrough, parameterName=slice_3, value=list_create_16)
number_roundUpTo_2 = Custom[number_roundUpTo](numbers=list_create_16)
setParameterByName_4 = Element.SetParameterByName(element=passthrough_2, parameterName=slice_3, value=number_roundUpTo_2)

passthrough_3 = Custom[Passthrough](passThrough=filterByBoolMask.in, waitFor=setParameterByName_3)
passthrough_4 = Custom[Passthrough](passThrough=filterByBoolMask_92.in, waitFor=setParameterByName_4)

# group: Fase B - Branca
fase_b = CodeBlock { 20; 38; }
slice_5 = List.Slice(list=getDataRows_4@L2, start=fase_b.out0, end=fase_b.out1)
fase_b_2 = CodeBlock { 20; 38; }
slice_6 = List.Slice(list=code_block_4@L2, start=fase_b_2.out0, end=fase_b_2.out1)
flatten_92 = List.Flatten(list=slice_6)
code_block_39 = CodeBlock(a=flatten_92, b=list_create_6) { a+b; }
list_create_17 = List.Create(item0=code_block_39)
setParameterByName_5 = Element.SetParameterByName(element=passthrough_3, parameterName=slice_5, value=list_create_17)
number_roundUpTo_3 = Custom[number_roundUpTo](numbers=list_create_17)
setParameterByName_6 = Element.SetParameterByName(element=passthrough_4, parameterName=slice_5, value=number_roundUpTo_3)

passthrough_5 = Custom[Passthrough](passThrough=filterByBoolMask.in, waitFor=setParameterByName_5)
passthrough_6 = Custom[Passthrough](passThrough=filterByBoolMask_92.in, waitFor=setParameterByName_6)

# group: Fase C - Preta
fase_c = CodeBlock { 38; 56; }
slice_7 = List.Slice(list=getDataRows_4@L2, start=fase_c.out0, end=fase_c.out1)
fase_c_2 = CodeBlock { 38; 56; }
slice_8 = List.Slice(list=code_block_4@L2, start=fase_c_2.out0, end=fase_c_2.out1)
flatten_93 = List.Flatten(list=slice_8)
code_block_40 = CodeBlock(a=flatten_93, b=list_create_9) { a+b; }
list_create_18 = List.Create(item0=code_block_40)
setParameterByName_7 = Element.SetParameterByName(element=passthrough_5, parameterName=slice_7, value=list_create_18)
number_roundUpTo_4 = Custom[number_roundUpTo](numbers=list_create_18)
setParameterByName_8 = Element.SetParameterByName(element=passthrough_6, parameterName=slice_7, value=number_roundUpTo_4)

passthrough_7 = Custom[Passthrough](passThrough=filterByBoolMask.in, waitFor=setParameterByName_7)
passthrough_8 = Custom[Passthrough](passThrough=filterByBoolMask_92.in, waitFor=setParameterByName_8)

# group: Neutro - Azul
neutro = CodeBlock { 56; 74; }
slice_9 = List.Slice(list=getDataRows_4@L2, start=neutro.out0, end=neutro.out1)
neutro_2 = CodeBlock { 56; 74; }
slice_10 = List.Slice(list=code_block_4@L2, start=neutro_2.out0, end=neutro_2.out1)
flatten_94 = List.Flatten(list=slice_10)
code_block_41 = CodeBlock(a=flatten_94, b=list_create_12) { a+b; }
list_create_19 = List.Create(item0=code_block_41)
setParameterByName_9 = Element.SetParameterByName(element=passthrough_7, parameterName=slice_9, value=list_create_19)
number_roundUpTo_5 = Custom[number_roundUpTo](numbers=list_create_19)
setParameterByName_10 = Element.SetParameterByName(element=passthrough_8, parameterName=slice_9, value=number_roundUpTo_5)

passthrough_9 = Custom[Passthrough](passThrough=filterByBoolMask.in, waitFor=setParameterByName_9)
passthrough_10 = Custom[Passthrough](passThrough=filterByBoolMask_92.in, waitFor=setParameterByName_10)

# group: Proteção - Verde
proteção = CodeBlock { 74; 92; }
slice_11 = List.Slice(list=getDataRows_4@L2, start=proteção.out0, end=proteção.out1)
proteção_2 = CodeBlock { 74; 92; }
slice_12 = List.Slice(list=code_block_4@L2, start=proteção_2.out0, end=proteção_2.out1)
flatten_95 = List.Flatten(list=slice_12)
code_block_42 = CodeBlock(a=flatten_95, b=list_create_15) { a+b; }
list_create_20 = List.Create(item0=code_block_42)
setParameterByName_11 = Element.SetParameterByName(element=passthrough_9, parameterName=slice_11, value=list_create_20)
number_roundUpTo_6 = Custom[number_roundUpTo](numbers=list_create_20)
setParameterByName_12 = Element.SetParameterByName(element=passthrough_10, parameterName=slice_11, value=number_roundUpTo_6)

# group: Mensagem
count = List.Count(list=setParameterByName_11)
code_block_43 = CodeBlock { 0; }
gt = count > code_block_43
code_block_44 = CodeBlock { ["Feito! Todos Cabos Foram Somados na Tab. TOTAL POR CORES"]; }
code_block_45 = CodeBlock { ["Nenhum cabo foi somado"]; }
if_ = If(test=gt, true=code_block_44, false=code_block_45)
flatten_96 = List.Flatten(list=if_)
o_string_fromlist = Orchid.Common.String.FromList(list=flatten_96)
python_script = Python(IN[0]=o_string_fromlist)
# ---------- python_script.python (21 lines) ----------
# Importar as bibliotecas necessárias do Revit
import clr
clr.AddReference("RevitServices")
from RevitServices.Persistence import DocumentManager

clr.AddReference("RevitAPI")
clr.AddReference("RevitAPIUI")
from Autodesk.Revit.UI import TaskDialog

# Pegar a entrada do Dynamo
mensagem = IN[0]

# Criar a TaskDialog
task_dialog = TaskDialog("Ok")
task_dialog.MainInstruction = mensagem

# Exibir a TaskDialog
task_dialog.Show()

# Saída do script
OUT = "Sucesso!"
# ----------------------------------------

# group: Comprimento Real e Calculado
retornos_3 = CodeBlock { 0; 2; }
slice_13 = List.Slice(list=getDataRows_4@L2, start=retornos_3.out0, end=retornos_3.out1)
retornos_4 = CodeBlock { 0; 2; }
slice_14 = List.Slice(list=code_block_4@L2, start=retornos_4.out0, end=retornos_4.out1)
setParameterByName_13 = Element.SetParameterByName(element=filterByBoolMask.in, parameterName=slice_13, value=slice_14)
number_roundUpTo_7 = Custom[number_roundUpTo](numbers=slice_14)
setParameterByName_14 = Element.SetParameterByName(element=filterByBoolMask_92.in, parameterName=slice_13, value=number_roundUpTo_7)
