# Dynamo graph ok 2021_16-0_BIMACON_Somar Tabelas de Cabos por CORES ELE_R02_script.dyn (Dynamo 2.6.1.8786)
# Soma os cabos das Bandeja de Cabos, Consuiítes e das conexões
# packages: bimorphNodes 4.2.4, Orchid 2.16.5.6198, Orchid 2.6.8.6198, Clockwork for Dynamo 2.x 2.4.0, Sparrow 2021.2.1

boolean = BoolSelector(false)
views = Views("Cabos PVC ELE em Bandeja de Cabos (Cobre/Un/Isol. PVC/750V/70°C)")
code_block = CodeBlock { 1; }
getDataRows = Revit.Schedule.GetDataRows(scheduleView=views, rowIndexes=code_block, lacing=CrossProduct)
o_string_tonumber = Orchid.Common.String.ToNumber(string=getDataRows)
views_2 = Views("Cabos PVC ELE em Conduítes (Cobre/Un/Isol. PVC/750V/70°C)")
code_block_2 = CodeBlock { 1; }
getDataRows_2 = Revit.Schedule.GetDataRows(scheduleView=views_2, rowIndexes=code_block_2, lacing=CrossProduct)
o_string_tonumber_2 = Orchid.Common.String.ToNumber(string=getDataRows_2)
views_3 = Views("Cabos PVC ELE em Conexões (Cobre/Un/Isol. PVC/750V/70°C)")
code_block_3 = CodeBlock { 1; }
getDataRows_3 = Revit.Schedule.GetDataRows(scheduleView=views_3, rowIndexes=code_block_3, lacing=CrossProduct)
o_string_tonumber_3 = Orchid.Common.String.ToNumber(string=getDataRows_3)
code_block_4 = CodeBlock(a=o_string_tonumber, b=o_string_tonumber_2, c=o_string_tonumber_3) { a+b+c; }
watch = Watch(code_block_4)
boolean_2 = BoolSelector(false)
code_block_5 = CodeBlock { 0; }
boolean_3 = BoolSelector(false)
getDataRows_4 = Revit.Schedule.GetDataRows(scheduleView=views, rowIndexes=code_block_5, refresh=boolean_3)
fase_b = CodeBlock { 92; 96; }
slice = List.Slice(list=getDataRows_4@L2, start=fase_b.out0, end=fase_b.out1)
fase_b_2 = CodeBlock { 92; 96; }
slice_2 = List.Slice(list=code_block_4@L2, start=fase_b_2.out0, end=fase_b_2.out1)

# group: Cabos dentro de caixas e modelados como conduite
views_4 = Views("03 - Qtd. Cabos Entrada e Dentro das Caixas CEMIG")
code_block_6 = CodeBlock { 2; }
getDataColumns = Revit.Schedule.GetDataColumns(scheduleView=views_4, columnIndexes=code_block_6)
views_5 = Views("04 - Qtd. Cabos Flexíveis (conduítes)")
code_block_7 = CodeBlock { 2; }
getDataColumns_2 = Revit.Schedule.GetDataColumns(scheduleView=views_5, columnIndexes=code_block_7)
list_create = List.Create(item0=getDataColumns, item1=getDataColumns_2)
o_string_tonumber_4 = Orchid.Common.String.ToNumber(string=list_create)
code_block_8 = CodeBlock { 0; }
getDataColumns_3 = Revit.Schedule.GetDataColumns(scheduleView=views_4, columnIndexes=code_block_8)
code_block_9 = CodeBlock { 0; }
getDataColumns_4 = Revit.Schedule.GetDataColumns(scheduleView=views_5, columnIndexes=code_block_9)
code_block_10 = CodeBlock { " "; }
add = getDataColumns_4 + code_block_10
code_block_11 = CodeBlock { 1; }
getDataColumns_5 = Revit.Schedule.GetDataColumns(scheduleView=views_5, columnIndexes=code_block_11)
o_string_concat = Orchid.Common.String.Concat(string0=add, string1=getDataColumns_5)
list_create_2 = List.Create(item0=getDataColumns_3, item1=o_string_concat)
string = StringInput("Preto 1,5mm²")
contains = String.Contains(str=list_create_2, searchFor=string)
filterByBoolMask = List.FilterByBoolMask(list=o_string_tonumber_4, mask=contains)
flatten = List.Flatten(list=filterByBoolMask.in)
sum = Math.Sum(values=flatten)
o_string_tonumber_5 = Orchid.Common.String.ToNumber(string=list_create)
string_2 = StringInput("Preto 2,5mm²")
contains_2 = String.Contains(str=list_create_2, searchFor=string_2)
filterByBoolMask_2 = List.FilterByBoolMask(list=o_string_tonumber_5, mask=contains_2)
flatten_2 = List.Flatten(list=filterByBoolMask_2.in)
sum_2 = Math.Sum(values=flatten_2)
o_string_tonumber_6 = Orchid.Common.String.ToNumber(string=list_create)
string_3 = StringInput("Preto 4,0mm²")
contains_3 = String.Contains(str=list_create_2, searchFor=string_3)
filterByBoolMask_3 = List.FilterByBoolMask(list=o_string_tonumber_6, mask=contains_3)
flatten_3 = List.Flatten(list=filterByBoolMask_3.in)
sum_3 = Math.Sum(values=flatten_3)
o_string_tonumber_7 = Orchid.Common.String.ToNumber(string=list_create)
string_4 = StringInput(" Preto 6,0mm²")
contains_4 = String.Contains(str=list_create_2, searchFor=string_4)
filterByBoolMask_4 = List.FilterByBoolMask(list=o_string_tonumber_7, mask=contains_4)
flatten_4 = List.Flatten(list=filterByBoolMask_4.in)
sum_4 = Math.Sum(values=flatten_4)
o_string_tonumber_8 = Orchid.Common.String.ToNumber(string=list_create)
string_5 = StringInput("Preto 10,0mm²")
contains_5 = String.Contains(str=list_create_2, searchFor=string_5)
filterByBoolMask_5 = List.FilterByBoolMask(list=o_string_tonumber_8, mask=contains_5)
flatten_5 = List.Flatten(list=filterByBoolMask_5.in)
sum_5 = Math.Sum(values=flatten_5)
o_string_tonumber_9 = Orchid.Common.String.ToNumber(string=list_create)
string_6 = StringInput("Preto 16,0mm²")
contains_6 = String.Contains(str=list_create_2, searchFor=string_6)
filterByBoolMask_6 = List.FilterByBoolMask(list=o_string_tonumber_9, mask=contains_6)
flatten_6 = List.Flatten(list=filterByBoolMask_6.in)
sum_6 = Math.Sum(values=flatten_6)
o_string_tonumber_10 = Orchid.Common.String.ToNumber(string=list_create)
string_7 = StringInput("Preto 25,0mm²")
contains_7 = String.Contains(str=list_create_2, searchFor=string_7)
filterByBoolMask_7 = List.FilterByBoolMask(list=o_string_tonumber_10, mask=contains_7)
flatten_7 = List.Flatten(list=filterByBoolMask_7.in)
sum_7 = Math.Sum(values=flatten_7)
o_string_tonumber_11 = Orchid.Common.String.ToNumber(string=list_create)
string_8 = StringInput("Preto 35,0mm²")
contains_8 = String.Contains(str=list_create_2, searchFor=string_8)
filterByBoolMask_8 = List.FilterByBoolMask(list=o_string_tonumber_11, mask=contains_8)
flatten_8 = List.Flatten(list=filterByBoolMask_8.in)
sum_8 = Math.Sum(values=flatten_8)
o_string_tonumber_12 = Orchid.Common.String.ToNumber(string=list_create)
string_9 = StringInput("Preto 50,0mm²")
contains_9 = String.Contains(str=list_create_2, searchFor=string_9)
filterByBoolMask_9 = List.FilterByBoolMask(list=o_string_tonumber_12, mask=contains_9)
flatten_9 = List.Flatten(list=filterByBoolMask_9.in)
sum_9 = Math.Sum(values=flatten_9)
o_string_tonumber_13 = Orchid.Common.String.ToNumber(string=list_create)
string_10 = StringInput("Preto 70,0mm²")
contains_10 = String.Contains(str=list_create_2, searchFor=string_10)
filterByBoolMask_10 = List.FilterByBoolMask(list=o_string_tonumber_13, mask=contains_10)
flatten_10 = List.Flatten(list=filterByBoolMask_10.in)
sum_10 = Math.Sum(values=flatten_10)
o_string_tonumber_14 = Orchid.Common.String.ToNumber(string=list_create)
string_11 = StringInput("Preto 95,0mm²")
contains_11 = String.Contains(str=list_create_2, searchFor=string_11)
filterByBoolMask_11 = List.FilterByBoolMask(list=o_string_tonumber_14, mask=contains_11)
flatten_11 = List.Flatten(list=filterByBoolMask_11.in)
sum_11 = Math.Sum(values=flatten_11)
o_string_tonumber_15 = Orchid.Common.String.ToNumber(string=list_create)
string_12 = StringInput("Preto 120,0mm²")
contains_12 = String.Contains(str=list_create_2, searchFor=string_12)
filterByBoolMask_12 = List.FilterByBoolMask(list=o_string_tonumber_15, mask=contains_12)
flatten_12 = List.Flatten(list=filterByBoolMask_12.in)
sum_12 = Math.Sum(values=flatten_12)
o_string_tonumber_16 = Orchid.Common.String.ToNumber(string=list_create)
string_13 = StringInput("Preto 150,0mm²")
contains_13 = String.Contains(str=list_create_2, searchFor=string_13)
filterByBoolMask_13 = List.FilterByBoolMask(list=o_string_tonumber_16, mask=contains_13)
flatten_13 = List.Flatten(list=filterByBoolMask_13.in)
sum_13 = Math.Sum(values=flatten_13)
o_string_tonumber_17 = Orchid.Common.String.ToNumber(string=list_create)
string_14 = StringInput("Preto 185,0mm²")
contains_14 = String.Contains(str=list_create_2, searchFor=string_14)
filterByBoolMask_14 = List.FilterByBoolMask(list=o_string_tonumber_17, mask=contains_14)
flatten_14 = List.Flatten(list=filterByBoolMask_14.in)
sum_14 = Math.Sum(values=flatten_14)
o_string_tonumber_18 = Orchid.Common.String.ToNumber(string=list_create)
string_15 = StringInput("Preto 240,0mm²")
contains_15 = String.Contains(str=list_create_2, searchFor=string_15)
filterByBoolMask_15 = List.FilterByBoolMask(list=o_string_tonumber_18, mask=contains_15)
flatten_15 = List.Flatten(list=filterByBoolMask_15.in)
sum_15 = Math.Sum(values=flatten_15)
o_string_tonumber_19 = Orchid.Common.String.ToNumber(string=list_create)
string_16 = StringInput("Preto 300,0mm²")
contains_16 = String.Contains(str=list_create_2, searchFor=string_16)
filterByBoolMask_16 = List.FilterByBoolMask(list=o_string_tonumber_19, mask=contains_16)
flatten_16 = List.Flatten(list=filterByBoolMask_16.in)
sum_16 = Math.Sum(values=flatten_16)
o_string_tonumber_20 = Orchid.Common.String.ToNumber(string=list_create)
string_17 = StringInput("Preto 400,0mm²")
contains_17 = String.Contains(str=list_create_2, searchFor=string_17)
filterByBoolMask_17 = List.FilterByBoolMask(list=o_string_tonumber_20, mask=contains_17)
flatten_17 = List.Flatten(list=filterByBoolMask_17.in)
sum_17 = Math.Sum(values=flatten_17)
o_string_tonumber_21 = Orchid.Common.String.ToNumber(string=list_create)
string_18 = StringInput("Preto 500,0mm²")
contains_18 = String.Contains(str=list_create_2, searchFor=string_18)
filterByBoolMask_18 = List.FilterByBoolMask(list=o_string_tonumber_21, mask=contains_18)
flatten_18 = List.Flatten(list=filterByBoolMask_18.in)
sum_18 = Math.Sum(values=flatten_18)
list_create_3 = List.Create(item0=sum, item1=sum_2, item2=sum_3, item3=sum_4, item4=sum_5, item5=sum_6, item6=sum_7, item7=sum_8, item8=sum_9, item9=sum_10, item10=sum_11, item11=sum_12, item12=sum_13, item13=sum_14, item14=sum_15, item15=sum_16, item16=sum_17, item17=sum_18)

fase_c = CodeBlock { 38; 56; }
slice_3 = List.Slice(list=getDataRows_4@L2, start=fase_c.out0, end=fase_c.out1)
fase_c_2 = CodeBlock { 38; 56; }
slice_4 = List.Slice(list=code_block_4@L2, start=fase_c_2.out0, end=fase_c_2.out1)
fase_a = CodeBlock { 0; 20; }
slice_5 = List.Slice(list=getDataRows_4@L2, start=fase_a.out0, end=fase_a.out1)
fase_a_2 = CodeBlock { 0; 20; }
slice_6 = List.Slice(list=code_block_4@L2, start=fase_a_2.out0, end=fase_a_2.out1)

# group: Selecionar familia genérica para atribuir parâmetros
categories = Categories("OST_GenericModel")
all_elements_of_category = ElementsOfCategory(Category=categories)
string_from_object = FromObject(object=all_elements_of_category)
code_block_12 = CodeBlock { "Somatória Cabos"; }
eq = string_from_object == code_block_12
filterByBoolMask_19 = List.FilterByBoolMask(list=all_elements_of_category, mask=eq)
setParameterByName = Element.SetParameterByName(element=filterByBoolMask_19.in, parameterName=slice_5, value=slice_6)

setParameterByName_2 = Element.SetParameterByName(element=filterByBoolMask_19.in, parameterName=slice, value=slice_2)
passthrough = Custom[Passthrough](passThrough=filterByBoolMask_19.in, waitFor=setParameterByName_2)  # package Clockwork for Dynamo 2.x; Forces a sequential order of execution. The node wired into the output of the Passthrough node will be executed *after* the node wired into the waitFor input (e.g. important for some Revit operations). The value of the passThrough input will be passed on to the node wired into the output port of the Passthrough node.

# group: Atribuir parâmetros
fase_b_3 = CodeBlock { 20; 38; }
slice_7 = List.Slice(list=getDataRows_4@L2, start=fase_b_3.out0, end=fase_b_3.out1)
fase_b_4 = CodeBlock { 20; 38; }
slice_8 = List.Slice(list=code_block_4@L2, start=fase_b_4.out0, end=fase_b_4.out1)
flatten_19 = List.Flatten(list=slice_8)
code_block_13 = CodeBlock(a=flatten_19, b=list_create_3) { a+b; }
list_create_4 = List.Create(item0=code_block_13)
setParameterByName_3 = Element.SetParameterByName(element=passthrough, parameterName=slice_7, value=list_create_4)

setParameterByName_4 = Element.SetParameterByName(element=filterByBoolMask_19.in, parameterName=slice_3, value=slice_4)
passthrough_2 = Custom[Passthrough](passThrough=filterByBoolMask_19.in, waitFor=setParameterByName)

# group: Neutro
views_6 = Views("03 - Qtd. Cabos Entrada e Dentro das Caixas CEMIG")
code_block_14 = CodeBlock { 2; }
getDataColumns_6 = Revit.Schedule.GetDataColumns(scheduleView=views_6, columnIndexes=code_block_14)
views_7 = Views("04 - Qtd. Cabos Flexíveis (conduítes)")
code_block_15 = CodeBlock { 2; }
getDataColumns_7 = Revit.Schedule.GetDataColumns(scheduleView=views_7, columnIndexes=code_block_15)
list_create_5 = List.Create(item0=getDataColumns_6, item1=getDataColumns_7)
o_string_tonumber_22 = Orchid.Common.String.ToNumber(string=list_create_5)
code_block_16 = CodeBlock { 0; }
getDataColumns_8 = Revit.Schedule.GetDataColumns(scheduleView=views_6, columnIndexes=code_block_16)
code_block_17 = CodeBlock { 0; }
getDataColumns_9 = Revit.Schedule.GetDataColumns(scheduleView=views_7, columnIndexes=code_block_17)
code_block_18 = CodeBlock { " "; }
add_2 = getDataColumns_9 + code_block_18
code_block_19 = CodeBlock { 1; }
getDataColumns_10 = Revit.Schedule.GetDataColumns(scheduleView=views_7, columnIndexes=code_block_19)
o_string_concat_2 = Orchid.Common.String.Concat(string0=add_2, string1=getDataColumns_10)
list_create_6 = List.Create(item0=getDataColumns_8, item1=o_string_concat_2)
string_19 = StringInput("Azul 1,5mm²")
contains_19 = String.Contains(str=list_create_6, searchFor=string_19)
filterByBoolMask_20 = List.FilterByBoolMask(list=o_string_tonumber_22, mask=contains_19)
flatten_20 = List.Flatten(list=filterByBoolMask_20.in)
sum_19 = Math.Sum(values=flatten_20)
o_string_tonumber_23 = Orchid.Common.String.ToNumber(string=list_create_5)
string_20 = StringInput("Azul 2,5mm²")
contains_20 = String.Contains(str=list_create_6, searchFor=string_20)
filterByBoolMask_21 = List.FilterByBoolMask(list=o_string_tonumber_23, mask=contains_20)
flatten_21 = List.Flatten(list=filterByBoolMask_21.in)
sum_20 = Math.Sum(values=flatten_21)
o_string_tonumber_24 = Orchid.Common.String.ToNumber(string=list_create_5)
string_21 = StringInput("Azul 4,0mm²")
contains_21 = String.Contains(str=list_create_6, searchFor=string_21)
filterByBoolMask_22 = List.FilterByBoolMask(list=o_string_tonumber_24, mask=contains_21)
flatten_22 = List.Flatten(list=filterByBoolMask_22.in)
sum_21 = Math.Sum(values=flatten_22)
o_string_tonumber_25 = Orchid.Common.String.ToNumber(string=list_create_5)
string_22 = StringInput(" Azul 6,0mm²")
contains_22 = String.Contains(str=list_create_6, searchFor=string_22)
filterByBoolMask_23 = List.FilterByBoolMask(list=o_string_tonumber_25, mask=contains_22)
flatten_23 = List.Flatten(list=filterByBoolMask_23.in)
sum_22 = Math.Sum(values=flatten_23)
o_string_tonumber_26 = Orchid.Common.String.ToNumber(string=list_create_5)
string_23 = StringInput("Azul 10,0mm²")
contains_23 = String.Contains(str=list_create_6, searchFor=string_23)
filterByBoolMask_24 = List.FilterByBoolMask(list=o_string_tonumber_26, mask=contains_23)
flatten_24 = List.Flatten(list=filterByBoolMask_24.in)
sum_23 = Math.Sum(values=flatten_24)
o_string_tonumber_27 = Orchid.Common.String.ToNumber(string=list_create_5)
string_24 = StringInput("Azul 16,0mm²")
contains_24 = String.Contains(str=list_create_6, searchFor=string_24)
filterByBoolMask_25 = List.FilterByBoolMask(list=o_string_tonumber_27, mask=contains_24)
flatten_25 = List.Flatten(list=filterByBoolMask_25.in)
sum_24 = Math.Sum(values=flatten_25)
o_string_tonumber_28 = Orchid.Common.String.ToNumber(string=list_create_5)
string_25 = StringInput("Azul 25,0mm²")
contains_25 = String.Contains(str=list_create_6, searchFor=string_25)
filterByBoolMask_26 = List.FilterByBoolMask(list=o_string_tonumber_28, mask=contains_25)
flatten_26 = List.Flatten(list=filterByBoolMask_26.in)
sum_25 = Math.Sum(values=flatten_26)
o_string_tonumber_29 = Orchid.Common.String.ToNumber(string=list_create_5)
string_26 = StringInput("Azul 35,0mm²")
contains_26 = String.Contains(str=list_create_6, searchFor=string_26)
filterByBoolMask_27 = List.FilterByBoolMask(list=o_string_tonumber_29, mask=contains_26)
flatten_27 = List.Flatten(list=filterByBoolMask_27.in)
sum_26 = Math.Sum(values=flatten_27)
o_string_tonumber_30 = Orchid.Common.String.ToNumber(string=list_create_5)
string_27 = StringInput("Azul 50,0mm²")
contains_27 = String.Contains(str=list_create_6, searchFor=string_27)
filterByBoolMask_28 = List.FilterByBoolMask(list=o_string_tonumber_30, mask=contains_27)
flatten_28 = List.Flatten(list=filterByBoolMask_28.in)
sum_27 = Math.Sum(values=flatten_28)
o_string_tonumber_31 = Orchid.Common.String.ToNumber(string=list_create_5)
string_28 = StringInput("Azul 70,0mm²")
contains_28 = String.Contains(str=list_create_6, searchFor=string_28)
filterByBoolMask_29 = List.FilterByBoolMask(list=o_string_tonumber_31, mask=contains_28)
flatten_29 = List.Flatten(list=filterByBoolMask_29.in)
sum_28 = Math.Sum(values=flatten_29)
o_string_tonumber_32 = Orchid.Common.String.ToNumber(string=list_create_5)
string_29 = StringInput("Azul 95,0mm²")
contains_29 = String.Contains(str=list_create_6, searchFor=string_29)
filterByBoolMask_30 = List.FilterByBoolMask(list=o_string_tonumber_32, mask=contains_29)
flatten_30 = List.Flatten(list=filterByBoolMask_30.in)
sum_29 = Math.Sum(values=flatten_30)
o_string_tonumber_33 = Orchid.Common.String.ToNumber(string=list_create_5)
string_30 = StringInput("Azul 120,0mm²")
contains_30 = String.Contains(str=list_create_6, searchFor=string_30)
filterByBoolMask_31 = List.FilterByBoolMask(list=o_string_tonumber_33, mask=contains_30)
flatten_31 = List.Flatten(list=filterByBoolMask_31.in)
sum_30 = Math.Sum(values=flatten_31)
o_string_tonumber_34 = Orchid.Common.String.ToNumber(string=list_create_5)
string_31 = StringInput("Azul 150,0mm²")
contains_31 = String.Contains(str=list_create_6, searchFor=string_31)
filterByBoolMask_32 = List.FilterByBoolMask(list=o_string_tonumber_34, mask=contains_31)
flatten_32 = List.Flatten(list=filterByBoolMask_32.in)
sum_31 = Math.Sum(values=flatten_32)
o_string_tonumber_35 = Orchid.Common.String.ToNumber(string=list_create_5)
string_32 = StringInput("Azul 185,0mm²")
contains_32 = String.Contains(str=list_create_6, searchFor=string_32)
filterByBoolMask_33 = List.FilterByBoolMask(list=o_string_tonumber_35, mask=contains_32)
flatten_33 = List.Flatten(list=filterByBoolMask_33.in)
sum_32 = Math.Sum(values=flatten_33)
o_string_tonumber_36 = Orchid.Common.String.ToNumber(string=list_create_5)
string_33 = StringInput("Azul 240,0mm²")
contains_33 = String.Contains(str=list_create_6, searchFor=string_33)
filterByBoolMask_34 = List.FilterByBoolMask(list=o_string_tonumber_36, mask=contains_33)
flatten_34 = List.Flatten(list=filterByBoolMask_34.in)
sum_33 = Math.Sum(values=flatten_34)
o_string_tonumber_37 = Orchid.Common.String.ToNumber(string=list_create_5)
string_34 = StringInput("Azul 300,0mm²")
contains_34 = String.Contains(str=list_create_6, searchFor=string_34)
filterByBoolMask_35 = List.FilterByBoolMask(list=o_string_tonumber_37, mask=contains_34)
flatten_35 = List.Flatten(list=filterByBoolMask_35.in)
sum_34 = Math.Sum(values=flatten_35)
o_string_tonumber_38 = Orchid.Common.String.ToNumber(string=list_create_5)
string_35 = StringInput("Azul 400,0mm²")
contains_35 = String.Contains(str=list_create_6, searchFor=string_35)
filterByBoolMask_36 = List.FilterByBoolMask(list=o_string_tonumber_38, mask=contains_35)
flatten_36 = List.Flatten(list=filterByBoolMask_36.in)
sum_35 = Math.Sum(values=flatten_36)
o_string_tonumber_39 = Orchid.Common.String.ToNumber(string=list_create_5)
string_36 = StringInput("Azul 500,0mm²")
contains_36 = String.Contains(str=list_create_6, searchFor=string_36)
filterByBoolMask_37 = List.FilterByBoolMask(list=o_string_tonumber_39, mask=contains_36)
flatten_37 = List.Flatten(list=filterByBoolMask_37.in)
sum_36 = Math.Sum(values=flatten_37)
list_create_7 = List.Create(item0=sum_19, item1=sum_20, item2=sum_21, item3=sum_22, item4=sum_23, item5=sum_24, item6=sum_25, item7=sum_26, item8=sum_27, item9=sum_28, item10=sum_29, item11=sum_30, item12=sum_31, item13=sum_32, item14=sum_33, item15=sum_34, item16=sum_35, item17=sum_36)

# group: Atribuir parâmetros
fase_b_5 = CodeBlock { 56; 74; }
slice_9 = List.Slice(list=getDataRows_4@L2, start=fase_b_5.out0, end=fase_b_5.out1)
fase_b_6 = CodeBlock { 56; 74; }
slice_10 = List.Slice(list=code_block_4@L2, start=fase_b_6.out0, end=fase_b_6.out1)
flatten_38 = List.Flatten(list=slice_10)
code_block_20 = CodeBlock(a=flatten_38, b=list_create_7) { a+b; }
list_create_8 = List.Create(item0=code_block_20)
setParameterByName_5 = Element.SetParameterByName(element=passthrough_2, parameterName=slice_9, value=list_create_8)

passthrough_3 = Custom[Passthrough](passThrough=filterByBoolMask_19.in, waitFor=setParameterByName_5)
fase_b_7 = CodeBlock { 74; 92; }
slice_11 = List.Slice(list=getDataRows_4@L2, start=fase_b_7.out0, end=fase_b_7.out1)
fase_b_8 = CodeBlock { 74; 92; }
slice_12 = List.Slice(list=code_block_4@L2, start=fase_b_8.out0, end=fase_b_8.out1)
flatten_39 = List.Flatten(list=slice_12)

# group: Proteção
views_8 = Views("03 - Qtd. Cabos Entrada e Dentro das Caixas CEMIG")
code_block_21 = CodeBlock { 2; }
getDataColumns_11 = Revit.Schedule.GetDataColumns(scheduleView=views_8, columnIndexes=code_block_21)
views_9 = Views("04 - Qtd. Cabos Flexíveis (conduítes)")
code_block_22 = CodeBlock { 2; }
getDataColumns_12 = Revit.Schedule.GetDataColumns(scheduleView=views_9, columnIndexes=code_block_22)
list_create_9 = List.Create(item0=getDataColumns_11, item1=getDataColumns_12)
o_string_tonumber_40 = Orchid.Common.String.ToNumber(string=list_create_9)
code_block_23 = CodeBlock { 0; }
getDataColumns_13 = Revit.Schedule.GetDataColumns(scheduleView=views_8, columnIndexes=code_block_23)
code_block_24 = CodeBlock { 0; }
getDataColumns_14 = Revit.Schedule.GetDataColumns(scheduleView=views_9, columnIndexes=code_block_24)
code_block_25 = CodeBlock { " "; }
add_3 = getDataColumns_14 + code_block_25
code_block_26 = CodeBlock { 1; }
getDataColumns_15 = Revit.Schedule.GetDataColumns(scheduleView=views_9, columnIndexes=code_block_26)
o_string_concat_3 = Orchid.Common.String.Concat(string0=add_3, string1=getDataColumns_15)
list_create_10 = List.Create(item0=getDataColumns_13, item1=o_string_concat_3)
string_37 = StringInput("Verde 1,5mm²")
contains_37 = String.Contains(str=list_create_10, searchFor=string_37)
filterByBoolMask_38 = List.FilterByBoolMask(list=o_string_tonumber_40, mask=contains_37)
flatten_40 = List.Flatten(list=filterByBoolMask_38.in)
sum_37 = Math.Sum(values=flatten_40)
o_string_tonumber_41 = Orchid.Common.String.ToNumber(string=list_create_9)
string_38 = StringInput("Verde 2,5mm²")
contains_38 = String.Contains(str=list_create_10, searchFor=string_38)
filterByBoolMask_39 = List.FilterByBoolMask(list=o_string_tonumber_41, mask=contains_38)
flatten_41 = List.Flatten(list=filterByBoolMask_39.in)
sum_38 = Math.Sum(values=flatten_41)
o_string_tonumber_42 = Orchid.Common.String.ToNumber(string=list_create_9)
string_39 = StringInput("Verde 4,0mm²")
contains_39 = String.Contains(str=list_create_10, searchFor=string_39)
filterByBoolMask_40 = List.FilterByBoolMask(list=o_string_tonumber_42, mask=contains_39)
flatten_42 = List.Flatten(list=filterByBoolMask_40.in)
sum_39 = Math.Sum(values=flatten_42)
o_string_tonumber_43 = Orchid.Common.String.ToNumber(string=list_create_9)
string_40 = StringInput(" Verde 6,0mm²")
contains_40 = String.Contains(str=list_create_10, searchFor=string_40)
filterByBoolMask_41 = List.FilterByBoolMask(list=o_string_tonumber_43, mask=contains_40)
flatten_43 = List.Flatten(list=filterByBoolMask_41.in)
sum_40 = Math.Sum(values=flatten_43)
o_string_tonumber_44 = Orchid.Common.String.ToNumber(string=list_create_9)
string_41 = StringInput("Verde 10,0mm²")
contains_41 = String.Contains(str=list_create_10, searchFor=string_41)
filterByBoolMask_42 = List.FilterByBoolMask(list=o_string_tonumber_44, mask=contains_41)
flatten_44 = List.Flatten(list=filterByBoolMask_42.in)
sum_41 = Math.Sum(values=flatten_44)
o_string_tonumber_45 = Orchid.Common.String.ToNumber(string=list_create_9)
string_42 = StringInput("Verde 16,0mm²")
contains_42 = String.Contains(str=list_create_10, searchFor=string_42)
filterByBoolMask_43 = List.FilterByBoolMask(list=o_string_tonumber_45, mask=contains_42)
flatten_45 = List.Flatten(list=filterByBoolMask_43.in)
sum_42 = Math.Sum(values=flatten_45)
o_string_tonumber_46 = Orchid.Common.String.ToNumber(string=list_create_9)
string_43 = StringInput("Verde 25,0mm²")
contains_43 = String.Contains(str=list_create_10, searchFor=string_43)
filterByBoolMask_44 = List.FilterByBoolMask(list=o_string_tonumber_46, mask=contains_43)
flatten_46 = List.Flatten(list=filterByBoolMask_44.in)
sum_43 = Math.Sum(values=flatten_46)
o_string_tonumber_47 = Orchid.Common.String.ToNumber(string=list_create_9)
string_44 = StringInput("Verde 35,0mm²")
contains_44 = String.Contains(str=list_create_10, searchFor=string_44)
filterByBoolMask_45 = List.FilterByBoolMask(list=o_string_tonumber_47, mask=contains_44)
flatten_47 = List.Flatten(list=filterByBoolMask_45.in)
sum_44 = Math.Sum(values=flatten_47)
o_string_tonumber_48 = Orchid.Common.String.ToNumber(string=list_create_9)
string_45 = StringInput("Verde 50,0mm²")
contains_45 = String.Contains(str=list_create_10, searchFor=string_45)
filterByBoolMask_46 = List.FilterByBoolMask(list=o_string_tonumber_48, mask=contains_45)
flatten_48 = List.Flatten(list=filterByBoolMask_46.in)
sum_45 = Math.Sum(values=flatten_48)
o_string_tonumber_49 = Orchid.Common.String.ToNumber(string=list_create_9)
string_46 = StringInput("Verde 70,0mm²")
contains_46 = String.Contains(str=list_create_10, searchFor=string_46)
filterByBoolMask_47 = List.FilterByBoolMask(list=o_string_tonumber_49, mask=contains_46)
flatten_49 = List.Flatten(list=filterByBoolMask_47.in)
sum_46 = Math.Sum(values=flatten_49)
o_string_tonumber_50 = Orchid.Common.String.ToNumber(string=list_create_9)
string_47 = StringInput("Verde 95,0mm²")
contains_47 = String.Contains(str=list_create_10, searchFor=string_47)
filterByBoolMask_48 = List.FilterByBoolMask(list=o_string_tonumber_50, mask=contains_47)
flatten_50 = List.Flatten(list=filterByBoolMask_48.in)
sum_47 = Math.Sum(values=flatten_50)
o_string_tonumber_51 = Orchid.Common.String.ToNumber(string=list_create_9)
string_48 = StringInput("Verde 120,0mm²")
contains_48 = String.Contains(str=list_create_10, searchFor=string_48)
filterByBoolMask_49 = List.FilterByBoolMask(list=o_string_tonumber_51, mask=contains_48)
flatten_51 = List.Flatten(list=filterByBoolMask_49.in)
sum_48 = Math.Sum(values=flatten_51)
o_string_tonumber_52 = Orchid.Common.String.ToNumber(string=list_create_9)
string_49 = StringInput("Verde 150,0mm²")
contains_49 = String.Contains(str=list_create_10, searchFor=string_49)
filterByBoolMask_50 = List.FilterByBoolMask(list=o_string_tonumber_52, mask=contains_49)
flatten_52 = List.Flatten(list=filterByBoolMask_50.in)
sum_49 = Math.Sum(values=flatten_52)
o_string_tonumber_53 = Orchid.Common.String.ToNumber(string=list_create_9)
string_50 = StringInput("Verde 185,0mm²")
contains_50 = String.Contains(str=list_create_10, searchFor=string_50)
filterByBoolMask_51 = List.FilterByBoolMask(list=o_string_tonumber_53, mask=contains_50)
flatten_53 = List.Flatten(list=filterByBoolMask_51.in)
sum_50 = Math.Sum(values=flatten_53)
o_string_tonumber_54 = Orchid.Common.String.ToNumber(string=list_create_9)
string_51 = StringInput("Verde 240,0mm²")
contains_51 = String.Contains(str=list_create_10, searchFor=string_51)
filterByBoolMask_52 = List.FilterByBoolMask(list=o_string_tonumber_54, mask=contains_51)
flatten_54 = List.Flatten(list=filterByBoolMask_52.in)
sum_51 = Math.Sum(values=flatten_54)
o_string_tonumber_55 = Orchid.Common.String.ToNumber(string=list_create_9)
string_52 = StringInput("Verde 300,0mm²")
contains_52 = String.Contains(str=list_create_10, searchFor=string_52)
filterByBoolMask_53 = List.FilterByBoolMask(list=o_string_tonumber_55, mask=contains_52)
flatten_55 = List.Flatten(list=filterByBoolMask_53.in)
sum_52 = Math.Sum(values=flatten_55)
o_string_tonumber_56 = Orchid.Common.String.ToNumber(string=list_create_9)
string_53 = StringInput("Verde 400,0mm²")
contains_53 = String.Contains(str=list_create_10, searchFor=string_53)
filterByBoolMask_54 = List.FilterByBoolMask(list=o_string_tonumber_56, mask=contains_53)
flatten_56 = List.Flatten(list=filterByBoolMask_54.in)
sum_53 = Math.Sum(values=flatten_56)
o_string_tonumber_57 = Orchid.Common.String.ToNumber(string=list_create_9)
string_54 = StringInput("Verde 500,0mm²")
contains_54 = String.Contains(str=list_create_10, searchFor=string_54)
filterByBoolMask_55 = List.FilterByBoolMask(list=o_string_tonumber_57, mask=contains_54)
flatten_57 = List.Flatten(list=filterByBoolMask_55.in)
sum_54 = Math.Sum(values=flatten_57)
list_create_11 = List.Create(item0=sum_37, item1=sum_38, item2=sum_39, item3=sum_40, item4=sum_41, item5=sum_42, item6=sum_43, item7=sum_44, item8=sum_45, item9=sum_46, item10=sum_47, item11=sum_48, item12=sum_49, item13=sum_50, item14=sum_51, item15=sum_52, item16=sum_53, item17=sum_54)

code_block_27 = CodeBlock(a=flatten_39, b=list_create_11) { a+b; }
list_create_12 = List.Create(item0=code_block_27)
setParameterByName_6 = Element.SetParameterByName(element=passthrough_3, parameterName=slice_11, value=list_create_12)

# group: Mensagem
count = List.Count(list=setParameterByName_6)
code_block_28 = CodeBlock { 0; }
gt = count > code_block_28
code_block_29 = CodeBlock { ["Feito! Todos Cabos Foram Somados na Tab. TOTAL POR CORES"]; }
code_block_30 = CodeBlock { ["Nenhum cabo foi somado"]; }
if_ = If(test=gt, true=code_block_29, false=code_block_30)
flatten_58 = List.Flatten(list=if_)
o_string_fromlist = Orchid.Common.String.FromList(list=flatten_58)
python_script = Python(IN[0]=o_string_fromlist)
# ---------- python_script.python (21 lines) ----------
# Importar as bibliotecas necessárias do Revit
import clr
clr.AddReference("RevitServices")
from RevitServices.Persistence import DocumentManager

clr.AddReference("RevitAPI")
clr.AddReference("RevitAPIUI")
from Autodesk.Revit.UI import TaskDialog

# Pegar a entrada do Dynamo
mensagem = IN[0]

# Criar a TaskDialog
task_dialog = TaskDialog("Ok")
task_dialog.MainInstruction = mensagem

# Exibir a TaskDialog
task_dialog.Show()

# Saída do script
OUT = "Sucesso!"
# ----------------------------------------

# group: soma e arredonda
list_create_13 = List.Create(item0=list_create_4, item1=list_create_8, item2=list_create_12)
flatten_59 = List.Flatten(list=list_create_13@L2)
transpose = List.Transpose(lists=flatten_59)
sum_55 = Math.Sum(values=transpose)

code_block_31 = CodeBlock { 0; }

# group: Selecionar familia genérica para atribuir parâmetros
categories_2 = Categories("OST_GenericModel")
all_elements_of_category_2 = ElementsOfCategory(Category=categories_2)
string_from_object_2 = FromObject(obj=all_elements_of_category_2)
code_block_32 = CodeBlock { "Soma Arredondamento Cabos"; }
eq_2 = string_from_object_2 == code_block_32
filterByBoolMask_56 = List.FilterByBoolMask(list=all_elements_of_category_2, mask=eq_2)

number_roundUpTo = Custom[number_roundUpTo](numbers=slice_6)  # package Sparrow; This node returns a rounded number to the ceiling of a specified multiple.
setParameterByName_7 = Element.SetParameterByName(element=filterByBoolMask_56.in, parameterName=slice_5, value=number_roundUpTo)
number_roundUpTo_2 = Custom[number_roundUpTo](numbers=slice_4)
setParameterByName_8 = Element.SetParameterByName(element=filterByBoolMask_19.in, parameterName=slice_3, value=number_roundUpTo_2)
number_roundUpTo_3 = Custom[number_roundUpTo](numbers=slice_2)
setParameterByName_9 = Element.SetParameterByName(element=filterByBoolMask_19.in, parameterName=slice, value=number_roundUpTo_3)
passthrough_4 = Custom[Passthrough](passThrough=filterByBoolMask_56.in, waitFor=setParameterByName_9)
number_roundUpTo_4 = Custom[number_roundUpTo](numbers=list_create_4)
setParameterByName_10 = Element.SetParameterByName(element=passthrough_4, parameterName=slice_7, value=number_roundUpTo_4)
number_roundUpTo_5 = Custom[number_roundUpTo](numbers=list_create_8)
setParameterByName_11 = Element.SetParameterByName(element=passthrough_4, parameterName=slice_9, value=number_roundUpTo_5)
number_roundUpTo_6 = Custom[number_roundUpTo](numbers=list_create_12)
setParameterByName_12 = Element.SetParameterByName(element=passthrough_4, parameterName=slice_11, value=number_roundUpTo_6)
