# Dynamo graph 16-1_BIMACON_Somar Tabelas de Cabos por DIAM. ELE-R04_script.dyn "ok 2021_16-1_BIMACON_Somar Tabelas de Cabos por DIAM. ELE-R04_script" (Dynamo 2.19.3.6394)
# author: Jose Nelson
# Soma os cabos das Bandeja de Cabos, Consuiítes e das conexões
# packages: bimorphNodes 4.2.4, Sparrow 2021.2.1

views = Views("Cabos PVC ELE em Bandeja de Cabos (Cobre/Un/Isol. PVC/750V/70°C)")
code_block = CodeBlock { 0; }
boolean = BoolSelector(true)
getDataRows = Revit.Schedule.GetDataRows(scheduleView=views, rowIndexes=code_block, refresh=boolean)
boolean_2 = BoolSelector(false)
code_block_2 = CodeBlock { 1; }
getDataRows_2 = Revit.Schedule.GetDataRows(scheduleView=views, rowIndexes=code_block_2, lacing=CrossProduct)
code_block_3 = CodeBlock { "0,0"; "0,01"; }
eq = code_block_3.out1 == _  # unwired: y
replaceByCondition = Replace(item=getDataRows_2, replaceWith=code_block_3.out0, condition=eq)
sring_tonumber_bimacon = Python(IN[0]=replaceByCondition)  # IronPython2
# ---------- sring_tonumber_bimacon.python (43 lines) ----------
# Importa as bibliotecas necessárias
import clr
clr.AddReference('RevitAPI')
from Autodesk.Revit.DB import *

# Define a função para converter a lista de strings em decimais, mantendo a estrutura
def converter_para_decimal(entrada):
  """
  Converte uma entrada (que pode ser uma lista aninhada) em uma nova lista com a mesma estrutura,
  onde as strings numéricas são substituídas por números decimais.

  Args:
    entrada: Uma lista ou string representando números decimais.

  Returns:
    Uma lista com a mesma estrutura da entrada, com os valores numéricos convertidos.
  """

  if isinstance(entrada, list):
    nova_lista = []
    for item in entrada:
      nova_lista.append(converter_para_decimal(item)) # Chamada recursiva para manter a estrutura
    return nova_lista
  elif isinstance(entrada, str):
    entrada = entrada.replace(",", ".")
    try:
      decimal = float(entrada)
      return decimal # Retorna o decimal diretamente
    except ValueError:
      print("Erro: Não foi possível converter '{}' para um número decimal.".format(entrada))
      return entrada # Retorna a string original em caso de erro
  else:
    print("Erro: A entrada '{}' não é uma string ou lista.".format(entrada))
    return entrada # Retorna o valor original em caso de erro

# Obtém a lista de strings da entrada do Dynamo
entrada = IN[0]

# Converte a lista de strings em decimais, mantendo a estrutura
lista_convertida = converter_para_decimal(entrada)

# Define a lista de decimais como saída do Dynamo
OUT = lista_convertida
# ----------------------------------------
views_2 = Views("Cabos PVC ELE em Conduítes (Cobre/Un/Isol. PVC/750V/70°C)")
code_block_4 = CodeBlock { 1; }
getDataRows_3 = Revit.Schedule.GetDataRows(scheduleView=views_2, rowIndexes=code_block_4, lacing=CrossProduct)
replaceByCondition_2 = Replace(item=getDataRows_3, replaceWith=code_block_3.out0, condition=eq)
sring_tonumber_bimacon_2 = Python(IN[0]=replaceByCondition_2)  # IronPython2; same code as sring_tonumber_bimacon
views_3 = Views("Cabos PVC ELE em Conexões (Cobre/Un/Isol. PVC/750V/70°C)")
code_block_5 = CodeBlock { 1; }
getDataRows_4 = Revit.Schedule.GetDataRows(scheduleView=views_3, rowIndexes=code_block_5, lacing=CrossProduct)
code_block_6 = CodeBlock { "0,0"; "0,02"; }
eq_2 = code_block_6.out1 == _  # unwired: y
replaceByCondition_3 = Replace(item=getDataRows_4, replaceWith=code_block_6.out0, condition=eq_2)
sring_tonumber_bimacon_3 = Python(IN[0]=replaceByCondition_3)  # IronPython2; same code as sring_tonumber_bimacon
code_block_7 = CodeBlock(a=sring_tonumber_bimacon, b=sring_tonumber_bimacon_2, c=sring_tonumber_bimacon_3) { a+b+c; }
flatten = List.Flatten(list=code_block_7)
comprimento_real = CodeBlock { [0]; }
getItemAtIndex = List.GetItemAtIndex(list=flatten, index=comprimento_real)
sum = Math.Sum(values=getItemAtIndex)
list_create = List.Create(item0=sum)
flatten_2 = List.Flatten(list=list_create)
comprimento_calculado = CodeBlock { [1]; }
getItemAtIndex_2 = List.GetItemAtIndex(list=flatten, index=comprimento_calculado)
sum_2 = Math.Sum(values=getItemAtIndex_2)
list_create_2 = List.Create(item0=sum_2)
flatten_3 = List.Flatten(list=list_create_2)
watch = Watch(code_block_7)

# group: Modelo genérico
categories = Categories("OST_GenericModel")
all_elements_of_category = ElementsOfCategory(Category=categories)
string_from_object = FromObject(object=all_elements_of_category)
code_block_8 = CodeBlock { "Somatória Cabos"; }
eq_3 = string_from_object == code_block_8
filterByBoolMask = List.FilterByBoolMask(list=all_elements_of_category, mask=eq_3)

tabela_soma_cabos_pvc_ele_total = Views("SOMA Cabos PVC ELE TOTAL POR DIAM.  (Cobre/Un/Isol. PVC/750V/70°C)")  # "Tabela SOMA Cabos PVC ELE TOTAL POR DIAM."
code_block_9 = CodeBlock { 0; }
getDataRows_5 = Revit.Schedule.GetDataRows(scheduleView=tabela_soma_cabos_pvc_ele_total, rowIndexes=code_block_9)
n1_5mm² = CodeBlock { [2,20,38,56,74,92]; }  # "1,5mm²"
getItemAtIndex_3 = List.GetItemAtIndex(list=flatten, index=n1_5mm²)
views_4 = Views("03 - Qtd. Cabos Entrada e Dentro das Caixas CEMIG")
code_block_10 = CodeBlock { 2; }
getDataColumns = Revit.Schedule.GetDataColumns(scheduleView=views_4, columnIndexes=code_block_10)
views_5 = Views("04 - Qtd. Cabos Flexíveis (conduítes)")
code_block_11 = CodeBlock { 2; }
getDataColumns_2 = Revit.Schedule.GetDataColumns(scheduleView=views_5, columnIndexes=code_block_11)
list_create_3 = List.Create(item0=getDataColumns, item1=getDataColumns_2)
sring_tonumber_bimacon_4 = Python(IN[0]=list_create_3)  # IronPython2; same code as sring_tonumber_bimacon
code_block_12 = CodeBlock { 0; }
getDataColumns_3 = Revit.Schedule.GetDataColumns(scheduleView=views_4, columnIndexes=code_block_12)
code_block_13 = CodeBlock { 0; }
getDataColumns_4 = Revit.Schedule.GetDataColumns(scheduleView=views_5, columnIndexes=code_block_13)
code_block_14 = CodeBlock { " "; }
add = getDataColumns_4 + code_block_14
code_block_15 = CodeBlock { 1; }
getDataColumns_5 = Revit.Schedule.GetDataColumns(scheduleView=views_5, columnIndexes=code_block_15)
add_2 = add + getDataColumns_5
list_create_4 = List.Create(item0=getDataColumns_3, item1=add_2)
string = StringInput(" 1,5mm²")
contains = String.Contains(string=list_create_4, searchFor=string)
filterByBoolMask_2 = List.FilterByBoolMask(list=sring_tonumber_bimacon_4, mask=contains)
flatten_4 = List.Flatten(list=filterByBoolMask_2.in)
sum_3 = Math.Sum(values=flatten_4)
list_create_5 = List.Create(item0=getItemAtIndex_3, item1=sum_3)
flatten_5 = List.Flatten(list=list_create_5)
sum_4 = Math.Sum(values=flatten_5)
list_create_6 = List.Create(item0=sum_4)
flatten_6 = List.Flatten(list=list_create_6)
n2_5mm² = CodeBlock { [3,21,39,57,75,93]; }  # "2,5mm²"
getItemAtIndex_4 = List.GetItemAtIndex(list=flatten, index=n2_5mm²)
sring_tonumber_bimacon_5 = Python(IN[0]=list_create_3)  # IronPython2; same code as sring_tonumber_bimacon
string_2 = StringInput(" 2,5mm²")
contains_2 = String.Contains(string=list_create_4, searchFor=string_2)
filterByBoolMask_3 = List.FilterByBoolMask(list=sring_tonumber_bimacon_5, mask=contains_2)
flatten_7 = List.Flatten(list=filterByBoolMask_3.in)
sum_5 = Math.Sum(values=flatten_7)
list_create_7 = List.Create(item0=getItemAtIndex_4, item1=sum_5)
flatten_8 = List.Flatten(list=list_create_7)
sum_6 = Math.Sum(values=flatten_8)
list_create_8 = List.Create(item0=sum_6)
flatten_9 = List.Flatten(list=list_create_8)
n4_0mm² = CodeBlock { [4,22,40,58,76,94]; }  # "4,0mm²"
getItemAtIndex_5 = List.GetItemAtIndex(list=flatten, index=n4_0mm²)
sring_tonumber_bimacon_6 = Python(IN[0]=list_create_3)  # IronPython2; same code as sring_tonumber_bimacon
string_3 = StringInput(" 4,0mm²")
contains_3 = String.Contains(string=list_create_4, searchFor=string_3)
filterByBoolMask_4 = List.FilterByBoolMask(list=sring_tonumber_bimacon_6, mask=contains_3)
flatten_10 = List.Flatten(list=filterByBoolMask_4.in)
sum_7 = Math.Sum(values=flatten_10)
list_create_9 = List.Create(item0=getItemAtIndex_5, item1=sum_7)
flatten_11 = List.Flatten(list=list_create_9)
sum_8 = Math.Sum(values=flatten_11)
list_create_10 = List.Create(item0=sum_8)
flatten_12 = List.Flatten(list=list_create_10)
n6_0mm² = CodeBlock { [5,23,41,59,77]; }  # "6,0mm²"
getItemAtIndex_6 = List.GetItemAtIndex(list=flatten, index=n6_0mm²)
sring_tonumber_bimacon_7 = Python(IN[0]=list_create_3)  # IronPython2; same code as sring_tonumber_bimacon
string_4 = StringInput(" 6,0mm²")
contains_4 = String.Contains(string=list_create_4, searchFor=string_4)
filterByBoolMask_5 = List.FilterByBoolMask(list=sring_tonumber_bimacon_7, mask=contains_4)
flatten_13 = List.Flatten(list=filterByBoolMask_5.in)
sum_9 = Math.Sum(values=flatten_13)
list_create_11 = List.Create(item0=getItemAtIndex_6, item1=sum_9)
flatten_14 = List.Flatten(list=list_create_11)
sum_10 = Math.Sum(values=flatten_14)
list_create_12 = List.Create(item0=sum_10)
flatten_15 = List.Flatten(list=list_create_12)
n10_0mm² = CodeBlock { [6,24,42,60,78]; }  # "10,0mm²"
getItemAtIndex_7 = List.GetItemAtIndex(list=flatten, index=n10_0mm²)
sring_tonumber_bimacon_8 = Python(IN[0]=list_create_3)  # IronPython2; same code as sring_tonumber_bimacon
string_5 = StringInput("10,0mm²")
contains_5 = String.Contains(string=list_create_4, searchFor=string_5)
filterByBoolMask_6 = List.FilterByBoolMask(list=sring_tonumber_bimacon_8, mask=contains_5)
flatten_16 = List.Flatten(list=filterByBoolMask_6.in)
sum_11 = Math.Sum(values=flatten_16)
list_create_13 = List.Create(item0=getItemAtIndex_7, item1=sum_11)
flatten_17 = List.Flatten(list=list_create_13)
sum_12 = Math.Sum(values=flatten_17)
list_create_14 = List.Create(item0=sum_12)
flatten_18 = List.Flatten(list=list_create_14)
n16_0mm² = CodeBlock { [7,25,43,61,79]; }  # "16,0mm²"
getItemAtIndex_8 = List.GetItemAtIndex(list=flatten, index=n16_0mm²)
sring_tonumber_bimacon_9 = Python(IN[0]=list_create_3)  # IronPython2; same code as sring_tonumber_bimacon
string_6 = StringInput("16,0mm²")
contains_6 = String.Contains(string=list_create_4, searchFor=string_6)
filterByBoolMask_7 = List.FilterByBoolMask(list=sring_tonumber_bimacon_9, mask=contains_6)
flatten_19 = List.Flatten(list=filterByBoolMask_7.in)
sum_13 = Math.Sum(values=flatten_19)
list_create_15 = List.Create(item0=getItemAtIndex_8, item1=sum_13)
flatten_20 = List.Flatten(list=list_create_15)
sum_14 = Math.Sum(values=flatten_20)
list_create_16 = List.Create(item0=sum_14)
flatten_21 = List.Flatten(list=list_create_16)
n25_0mm² = CodeBlock { [8,26,44,62,80]; }  # "25,0mm²"
getItemAtIndex_9 = List.GetItemAtIndex(list=flatten, index=n25_0mm²)
sring_tonumber_bimacon_10 = Python(IN[0]=list_create_3)  # IronPython2; same code as sring_tonumber_bimacon
string_7 = StringInput("25,0mm²")
contains_7 = String.Contains(string=list_create_4, searchFor=string_7)
filterByBoolMask_8 = List.FilterByBoolMask(list=sring_tonumber_bimacon_10, mask=contains_7)
flatten_22 = List.Flatten(list=filterByBoolMask_8.in)
sum_15 = Math.Sum(values=flatten_22)
list_create_17 = List.Create(item0=getItemAtIndex_9, item1=sum_15)
flatten_23 = List.Flatten(list=list_create_17)
sum_16 = Math.Sum(values=flatten_23)
list_create_18 = List.Create(item0=sum_16)
flatten_24 = List.Flatten(list=list_create_18)
n35_0mm² = CodeBlock { [9,27,45,63,81]; }  # "35,0mm²"
getItemAtIndex_10 = List.GetItemAtIndex(list=flatten, index=n35_0mm²)
sring_tonumber_bimacon_11 = Python(IN[0]=list_create_3)  # IronPython2; same code as sring_tonumber_bimacon
string_8 = StringInput("35,0mm²")
contains_8 = String.Contains(string=list_create_4, searchFor=string_8)
filterByBoolMask_9 = List.FilterByBoolMask(list=sring_tonumber_bimacon_11, mask=contains_8)
flatten_25 = List.Flatten(list=filterByBoolMask_9.in)
sum_17 = Math.Sum(values=flatten_25)
list_create_19 = List.Create(item0=getItemAtIndex_10, item1=sum_17)
flatten_26 = List.Flatten(list=list_create_19)
sum_18 = Math.Sum(values=flatten_26)
list_create_20 = List.Create(item0=sum_18)
flatten_27 = List.Flatten(list=list_create_20)
n50_0mm² = CodeBlock { [10,28,46,64,82]; }  # "50,0mm²"
getItemAtIndex_11 = List.GetItemAtIndex(list=flatten, index=n50_0mm²)
sring_tonumber_bimacon_12 = Python(IN[0]=list_create_3)  # IronPython2; same code as sring_tonumber_bimacon
string_9 = StringInput("50,0mm²")
contains_9 = String.Contains(string=list_create_4, searchFor=string_9)
filterByBoolMask_10 = List.FilterByBoolMask(list=sring_tonumber_bimacon_12, mask=contains_9)
flatten_28 = List.Flatten(list=filterByBoolMask_10.in)
sum_19 = Math.Sum(values=flatten_28)
list_create_21 = List.Create(item0=getItemAtIndex_11, item1=sum_19)
flatten_29 = List.Flatten(list=list_create_21)
sum_20 = Math.Sum(values=flatten_29)
list_create_22 = List.Create(item0=sum_20)
flatten_30 = List.Flatten(list=list_create_22)
n70_0mm² = CodeBlock { [11,29,47,65,83]; }  # "70,0mm²"
getItemAtIndex_12 = List.GetItemAtIndex(list=flatten, index=n70_0mm²)
sring_tonumber_bimacon_13 = Python(IN[0]=list_create_3)  # IronPython2; same code as sring_tonumber_bimacon
string_10 = StringInput("70,0mm²")
contains_10 = String.Contains(string=list_create_4, searchFor=string_10)
filterByBoolMask_11 = List.FilterByBoolMask(list=sring_tonumber_bimacon_13, mask=contains_10)
flatten_31 = List.Flatten(list=filterByBoolMask_11.in)
sum_21 = Math.Sum(values=flatten_31)
list_create_23 = List.Create(item0=getItemAtIndex_12, item1=sum_21)
flatten_32 = List.Flatten(list=list_create_23)
sum_22 = Math.Sum(values=flatten_32)
list_create_24 = List.Create(item0=sum_22)
flatten_33 = List.Flatten(list=list_create_24)
n95_0mm² = CodeBlock { [12,30,48,66,84]; }  # "95,0mm²"
getItemAtIndex_13 = List.GetItemAtIndex(list=flatten, index=n95_0mm²)
sring_tonumber_bimacon_14 = Python(IN[0]=list_create_3)  # IronPython2; same code as sring_tonumber_bimacon
string_11 = StringInput("95,0mm²")
contains_11 = String.Contains(string=list_create_4, searchFor=string_11)
filterByBoolMask_12 = List.FilterByBoolMask(list=sring_tonumber_bimacon_14, mask=contains_11)
flatten_34 = List.Flatten(list=filterByBoolMask_12.in)
sum_23 = Math.Sum(values=flatten_34)
list_create_25 = List.Create(item0=getItemAtIndex_13, item1=sum_23)
flatten_35 = List.Flatten(list=list_create_25)
sum_24 = Math.Sum(values=flatten_35)
list_create_26 = List.Create(item0=sum_24)
flatten_36 = List.Flatten(list=list_create_26)
n120_0mm² = CodeBlock { [13,31,49,67,85]; }  # "120,0mm²"
getItemAtIndex_14 = List.GetItemAtIndex(list=flatten, index=n120_0mm²)
sring_tonumber_bimacon_15 = Python(IN[0]=list_create_3)  # IronPython2; same code as sring_tonumber_bimacon
string_12 = StringInput("120,0mm²")
contains_12 = String.Contains(string=list_create_4, searchFor=string_12)
filterByBoolMask_13 = List.FilterByBoolMask(list=sring_tonumber_bimacon_15, mask=contains_12)
flatten_37 = List.Flatten(list=filterByBoolMask_13.in)
sum_25 = Math.Sum(values=flatten_37)
list_create_27 = List.Create(item0=getItemAtIndex_14, item1=sum_25)
flatten_38 = List.Flatten(list=list_create_27)
sum_26 = Math.Sum(values=flatten_38)
list_create_28 = List.Create(item0=sum_26)
flatten_39 = List.Flatten(list=list_create_28)
n150_0mm² = CodeBlock { [14,32,50,68,86]; }  # "150,0mm²"
getItemAtIndex_15 = List.GetItemAtIndex(list=flatten, index=n150_0mm²)
sring_tonumber_bimacon_16 = Python(IN[0]=list_create_3)  # IronPython2; same code as sring_tonumber_bimacon
string_13 = StringInput("150,0mm²")
contains_13 = String.Contains(string=list_create_4, searchFor=string_13)
filterByBoolMask_14 = List.FilterByBoolMask(list=sring_tonumber_bimacon_16, mask=contains_13)
flatten_40 = List.Flatten(list=filterByBoolMask_14.in)
sum_27 = Math.Sum(values=flatten_40)
list_create_29 = List.Create(item0=getItemAtIndex_15, item1=sum_27)
flatten_41 = List.Flatten(list=list_create_29)
sum_28 = Math.Sum(values=flatten_41)
list_create_30 = List.Create(item0=sum_28)
flatten_42 = List.Flatten(list=list_create_30)
n185_0mm² = CodeBlock { [15,33,51,69,87]; }  # "185,0mm²"
getItemAtIndex_16 = List.GetItemAtIndex(list=flatten, index=n185_0mm²)
sring_tonumber_bimacon_17 = Python(IN[0]=list_create_3)  # IronPython2; same code as sring_tonumber_bimacon
string_14 = StringInput("185,0mm²")
contains_14 = String.Contains(string=list_create_4, searchFor=string_14)
filterByBoolMask_15 = List.FilterByBoolMask(list=sring_tonumber_bimacon_17, mask=contains_14)
flatten_43 = List.Flatten(list=filterByBoolMask_15.in)
sum_29 = Math.Sum(values=flatten_43)
list_create_31 = List.Create(item0=getItemAtIndex_16, item1=sum_29)
flatten_44 = List.Flatten(list=list_create_31)
sum_30 = Math.Sum(values=flatten_44)
list_create_32 = List.Create(item0=sum_30)
flatten_45 = List.Flatten(list=list_create_32)
n240_0mm² = CodeBlock { [16,34,52,70,88]; }  # "240,0mm²"
getItemAtIndex_17 = List.GetItemAtIndex(list=flatten, index=n240_0mm²)
sring_tonumber_bimacon_18 = Python(IN[0]=list_create_3)  # IronPython2; same code as sring_tonumber_bimacon
string_15 = StringInput("240,0mm²")
contains_15 = String.Contains(string=list_create_4, searchFor=string_15)
filterByBoolMask_16 = List.FilterByBoolMask(list=sring_tonumber_bimacon_18, mask=contains_15)
flatten_46 = List.Flatten(list=filterByBoolMask_16.in)
sum_31 = Math.Sum(values=flatten_46)
list_create_33 = List.Create(item0=getItemAtIndex_17, item1=sum_31)
flatten_47 = List.Flatten(list=list_create_33)
sum_32 = Math.Sum(values=flatten_47)
list_create_34 = List.Create(item0=sum_32)
flatten_48 = List.Flatten(list=list_create_34)
n300_0mm² = CodeBlock { [17,35,53,71,89]; }  # "300,0mm²"
getItemAtIndex_18 = List.GetItemAtIndex(list=flatten, index=n300_0mm²)
sring_tonumber_bimacon_19 = Python(IN[0]=list_create_3)  # IronPython2; same code as sring_tonumber_bimacon
string_16 = StringInput("300,0mm²")
contains_16 = String.Contains(string=list_create_4, searchFor=string_16)
filterByBoolMask_17 = List.FilterByBoolMask(list=sring_tonumber_bimacon_19, mask=contains_16)
flatten_49 = List.Flatten(list=filterByBoolMask_17.in)
sum_33 = Math.Sum(values=flatten_49)
list_create_35 = List.Create(item0=getItemAtIndex_18, item1=sum_33)
flatten_50 = List.Flatten(list=list_create_35)
sum_34 = Math.Sum(values=flatten_50)
list_create_36 = List.Create(item0=sum_34)
flatten_51 = List.Flatten(list=list_create_36)
n400_0mm² = CodeBlock { [18,36,54,72,90]; }  # "400,0mm²"
getItemAtIndex_19 = List.GetItemAtIndex(list=flatten, index=n400_0mm²)
sring_tonumber_bimacon_20 = Python(IN[0]=list_create_3)  # IronPython2; same code as sring_tonumber_bimacon
string_17 = StringInput("400,0mm²")
contains_17 = String.Contains(string=list_create_4, searchFor=string_17)
filterByBoolMask_18 = List.FilterByBoolMask(list=sring_tonumber_bimacon_20, mask=contains_17)
flatten_52 = List.Flatten(list=filterByBoolMask_18.in)
sum_35 = Math.Sum(values=flatten_52)
list_create_37 = List.Create(item0=getItemAtIndex_19, item1=sum_35)
flatten_53 = List.Flatten(list=list_create_37)
sum_36 = Math.Sum(values=flatten_53)
list_create_38 = List.Create(item0=sum_36)
flatten_54 = List.Flatten(list=list_create_38)
n500_0mm² = CodeBlock { [19,37,55,73,91]; }  # "500,0mm²"
getItemAtIndex_20 = List.GetItemAtIndex(list=flatten, index=n500_0mm²)
sring_tonumber_bimacon_21 = Python(IN[0]=list_create_3)  # IronPython2; same code as sring_tonumber_bimacon
string_18 = StringInput("500,0mm²")
contains_18 = String.Contains(string=list_create_4, searchFor=string_18)
filterByBoolMask_19 = List.FilterByBoolMask(list=sring_tonumber_bimacon_21, mask=contains_18)
flatten_55 = List.Flatten(list=filterByBoolMask_19.in)
sum_37 = Math.Sum(values=flatten_55)
list_create_39 = List.Create(item0=getItemAtIndex_20, item1=sum_37)
flatten_56 = List.Flatten(list=list_create_39)
sum_38 = Math.Sum(values=flatten_56)
list_create_40 = List.Create(item0=sum_38)
flatten_57 = List.Flatten(list=list_create_40)
list_create_41 = List.Create(item0=list_create, item1=list_create_2, item2=flatten_6, item3=flatten_9, item4=flatten_12, item5=flatten_15, item6=flatten_18, item7=flatten_21, item8=flatten_24, item9=flatten_27, item10=flatten_30, item11=flatten_33, item12=flatten_36, item13=flatten_39, item14=flatten_42, item15=flatten_45, item16=flatten_48, item17=flatten_51, item18=flatten_54, item19=flatten_57)
flatten_58 = List.Flatten(list=list_create_41@L3)
setParameterByName = Element.SetParameterByName(element=filterByBoolMask.in, parameterName=getDataRows_5, value=flatten_58)

# group: Mensagem
count = List.Count(list=setParameterByName)
code_block_16 = CodeBlock { 0; }
gt = count > code_block_16
code_block_17 = CodeBlock { ["Feito! Todos Cabos Foram Somados na Tab. TOTAL POR DIAM."]; }
code_block_18 = CodeBlock { ["Nenhum cabo foi somado"]; }
if_ = If(test=gt, true=code_block_17, false=code_block_18)
flatten_59 = List.Flatten(list=if_)
fromList = Python(IN[0]=flatten_59)  # "String.FromList"; IronPython2
# ---------- fromList.python (22 lines) ----------
# Carregar as bibliotecas DesignScript e padrão do Python
import sys
import clr
clr.AddReference('ProtoGeometry')
from Autodesk.DesignScript.Geometry import *

# Função para concatenar os valores de uma lista em uma única string com múltiplas linhas
def concatenate_list_to_string(input_list, delimiter="\n"):
    # Verifica se a entrada é uma lista
    if not isinstance(input_list, list):
        return "A entrada deve ser uma lista."
    
    # Converte todos os elementos para string e junta com o delimitador especificado
    result = delimiter.join(str(item) for item in input_list)
    return result

# Entrada pelo nó do Dynamo
lista = IN[0]  # Lista de valores a serem concatenados
delimitador = IN[1] if len(IN) > 1 else "\n"  # Delimitador opcional, padrão é nova linha

# Saída para o Dynamo
OUT = concatenate_list_to_string(lista, delimitador)
# ----------------------------------------
python_script = Python(IN[0]=fromList)  # IronPython2
# ---------- python_script.python (21 lines) ----------
# Importar as bibliotecas necessárias do Revit
import clr
clr.AddReference("RevitServices")
from RevitServices.Persistence import DocumentManager

clr.AddReference("RevitAPI")
clr.AddReference("RevitAPIUI")
from Autodesk.Revit.UI import TaskDialog

# Pegar a entrada do Dynamo
mensagem = IN[0]

# Criar a TaskDialog
task_dialog = TaskDialog("Ok")
task_dialog.MainInstruction = mensagem

# Exibir a TaskDialog
task_dialog.Show()

# Saída do script
OUT = "Sucesso!"
# ----------------------------------------

# group: Modelo genérico
categories_2 = Categories("OST_GenericModel")
all_elements_of_category_2 = ElementsOfCategory(Category=categories_2)
string_from_object_2 = FromObject(obj=all_elements_of_category_2)
code_block_19 = CodeBlock { "Soma Arredondamento Cabos"; }
eq_4 = string_from_object_2 == code_block_19
filterByBoolMask_20 = List.FilterByBoolMask(list=all_elements_of_category_2, mask=eq_4)

number_roundUpTo = Custom[number_roundUpTo](numbers=flatten_58)  # package Sparrow; This node returns a rounded number to the ceiling of a specified multiple.
setParameterByName_2 = Element.SetParameterByName(element=filterByBoolMask_20.in, parameterName=getDataRows_5, value=number_roundUpTo)
