# Dynamo graph 16-2_BIMACON_Somar Tabelas de Cabos TELECOM_R03_script.dyn "ok 2021_16-2_BIMACON_Somar Tabelas de Cabos TELECOM_R03_script" (Dynamo 2.19.3.6394)
# author: Jose Nelson
# Soma os cabos das Bandeja de Cabos, Conduítes e das conexões para Telecom
# packages: bimorphNodes 4.2.4, Sparrow 2021.2.1

boolean = BoolSelector(false)
boolean_2 = BoolSelector(false)
views = Views("Cabos TELECOM em Bandeja de Cabos")
code_block = CodeBlock { 1; }
getDataRows = Revit.Schedule.GetDataRows(scheduleView=views, rowIndexes=code_block, lacing=CrossProduct)
code_block_2 = CodeBlock { "0,0"; "0,01"; }
eq = code_block_2.out1 == _  # unwired: y
replaceByCondition = Replace(item=getDataRows, replaceWith=code_block_2.out0, condition=eq)
sring_tonumber_bimacon = Python(IN[0]=replaceByCondition)  # IronPython2
# ---------- sring_tonumber_bimacon.python (43 lines) ----------
# Importa as bibliotecas necessárias
import clr
clr.AddReference('RevitAPI')
from Autodesk.Revit.DB import *

# Define a função para converter a lista de strings em decimais, mantendo a estrutura
def converter_para_decimal(entrada):
  """
  Converte uma entrada (que pode ser uma lista aninhada) em uma nova lista com a mesma estrutura,
  onde as strings numéricas são substituídas por números decimais.

  Args:
    entrada: Uma lista ou string representando números decimais.

  Returns:
    Uma lista com a mesma estrutura da entrada, com os valores numéricos convertidos.
  """

  if isinstance(entrada, list):
    nova_lista = []
    for item in entrada:
      nova_lista.append(converter_para_decimal(item)) # Chamada recursiva para manter a estrutura
    return nova_lista
  elif isinstance(entrada, str):
    entrada = entrada.replace(",", ".")
    try:
      decimal = float(entrada)
      return decimal # Retorna o decimal diretamente
    except ValueError:
      print("Erro: Não foi possível converter '{}' para um número decimal.".format(entrada))
      return entrada # Retorna a string original em caso de erro
  else:
    print("Erro: A entrada '{}' não é uma string ou lista.".format(entrada))
    return entrada # Retorna o valor original em caso de erro

# Obtém a lista de strings da entrada do Dynamo
entrada = IN[0]

# Converte a lista de strings em decimais, mantendo a estrutura
lista_convertida = converter_para_decimal(entrada)

# Define a lista de decimais como saída do Dynamo
OUT = lista_convertida
# ----------------------------------------
views_2 = Views("Cabos TELECOM em Conduítes")
code_block_3 = CodeBlock { 1; }
getDataRows_2 = Revit.Schedule.GetDataRows(scheduleView=views_2, rowIndexes=code_block_3, lacing=CrossProduct)
replaceByCondition_2 = Replace(item=getDataRows_2, replaceWith=code_block_2.out0, condition=eq)
sring_tonumber_bimacon_2 = Python(IN[0]=replaceByCondition_2)  # IronPython2; same code as sring_tonumber_bimacon
views_3 = Views("Cabos TELECOM em Conexões")
code_block_4 = CodeBlock { 1; }
getDataRows_3 = Revit.Schedule.GetDataRows(scheduleView=views_3, rowIndexes=code_block_4, lacing=CrossProduct)
code_block_5 = CodeBlock { "0,0"; "0,02"; }
eq_2 = code_block_5.out1 == _  # unwired: y
replaceByCondition_3 = Replace(item=getDataRows_3, replaceWith=code_block_5.out0, condition=eq_2)
sring_tonumber_bimacon_3 = Python(IN[0]=replaceByCondition_3)  # IronPython2; same code as sring_tonumber_bimacon
code_block_6 = CodeBlock(a=sring_tonumber_bimacon, b=sring_tonumber_bimacon_2, c=sring_tonumber_bimacon_3) { a+b+c; }
watch = Watch(code_block_6)
boolean_3 = BoolSelector(false)
categories = Categories("OST_GenericModel")
all_elements_of_category = ElementsOfCategory(Category=categories)
string_from_object = FromObject(object=all_elements_of_category)
code_block_7 = CodeBlock { "Somatória Cabos"; }
eq_3 = string_from_object == code_block_7
filterByBoolMask = List.FilterByBoolMask(list=all_elements_of_category, mask=eq_3)
code_block_8 = CodeBlock { 0; }
boolean_4 = BoolSelector(false)
getDataRows_4 = Revit.Schedule.GetDataRows(scheduleView=views, rowIndexes=code_block_8, refresh=boolean_4)
setParameterByName = Element.SetParameterByName(element=filterByBoolMask.in, parameterName=getDataRows_4, value=code_block_6)

# group: Mensagem
count = List.Count(list=setParameterByName)
code_block_9 = CodeBlock { 0; }
gt = count > code_block_9
code_block_10 = CodeBlock { ["Feito! Todos Cabos Foram Somados na Tab. TELECOM"]; }
code_block_11 = CodeBlock { ["Nenhum cabo foi somado"]; }
if_ = If(test=gt, true=code_block_10, false=code_block_11)
flatten = List.Flatten(list=if_)
fromList = Python(IN[0]=flatten)  # "String.FromList"; IronPython2
# ---------- fromList.python (22 lines) ----------
# Carregar as bibliotecas DesignScript e padrão do Python
import sys
import clr
clr.AddReference('ProtoGeometry')
from Autodesk.DesignScript.Geometry import *

# Função para concatenar os valores de uma lista em uma única string com múltiplas linhas
def concatenate_list_to_string(input_list, delimiter="\n"):
    # Verifica se a entrada é uma lista
    if not isinstance(input_list, list):
        return "A entrada deve ser uma lista."
    
    # Converte todos os elementos para string e junta com o delimitador especificado
    result = delimiter.join(str(item) for item in input_list)
    return result

# Entrada pelo nó do Dynamo
lista = IN[0]  # Lista de valores a serem concatenados
delimitador = IN[1] if len(IN) > 1 else "\n"  # Delimitador opcional, padrão é nova linha

# Saída para o Dynamo
OUT = concatenate_list_to_string(lista, delimitador)
# ----------------------------------------
python_script = Python(IN[0]=fromList)  # IronPython2
# ---------- python_script.python (21 lines) ----------
# Importar as bibliotecas necessárias do Revit
import clr
clr.AddReference("RevitServices")
from RevitServices.Persistence import DocumentManager

clr.AddReference("RevitAPI")
clr.AddReference("RevitAPIUI")
from Autodesk.Revit.UI import TaskDialog

# Pegar a entrada do Dynamo
mensagem = IN[0]

# Criar a TaskDialog
task_dialog = TaskDialog("Ok")
task_dialog.MainInstruction = mensagem

# Exibir a TaskDialog
task_dialog.Show()

# Saída do script
OUT = "Sucesso!"
# ----------------------------------------

# group: Modelo genérico
categories_2 = Categories("OST_GenericModel")
all_elements_of_category_2 = ElementsOfCategory(Category=categories_2)
string_from_object_2 = FromObject(obj=all_elements_of_category_2)
code_block_12 = CodeBlock { "Soma Arredondamento Cabos"; }
eq_4 = string_from_object_2 == code_block_12
filterByBoolMask_2 = List.FilterByBoolMask(list=all_elements_of_category_2, mask=eq_4)

number_roundUpTo = Custom[number_roundUpTo](numbers=code_block_6)  # package Sparrow; This node returns a rounded number to the ceiling of a specified multiple.
setParameterByName_2 = Element.SetParameterByName(element=filterByBoolMask_2.in, parameterName=getDataRows_4, value=number_roundUpTo)
