# Dynamo graph 2021_16-2_BIMACON_Somar Tabelas de Cabos TELECOM_R01_script.dyn "2021_16-2_BIMACON_Somar Tabelas de Cabos TELECOM_R01" (Dynamo 2.6.1.8786)
# Soma os cabos das Bandeja de Cabos, Conduítes e das conexões para Telecom
# packages: bimorphNodes 4.2.4, Orchid 2.16.5.6198, Orchid 2.6.8.6198

boolean = BoolSelector(false)
boolean_2 = BoolSelector(false)
views = Views("Cabos TELECOM em Bandeja de Cabos")
code_block = CodeBlock { 1; }
getDataRows = Revit.Schedule.GetDataRows(scheduleView=views, rowIndexes=code_block, lacing=CrossProduct)
o_string_tonumber = Orchid.Common.String.ToNumber(string=getDataRows)
views_2 = Views("Cabos TELECOM em Conduítes")
code_block_2 = CodeBlock { 1; }
getDataRows_2 = Revit.Schedule.GetDataRows(scheduleView=views_2, rowIndexes=code_block_2, lacing=CrossProduct)
o_string_tonumber_2 = Orchid.Common.String.ToNumber(string=getDataRows_2)
views_3 = Views("Cabos TELECOM em Conexões")
code_block_3 = CodeBlock { 1; }
getDataRows_3 = Revit.Schedule.GetDataRows(scheduleView=views_3, rowIndexes=code_block_3, lacing=CrossProduct)
o_string_tonumber_3 = Orchid.Common.String.ToNumber(string=getDataRows_3)
code_block_4 = CodeBlock(a=o_string_tonumber, b=o_string_tonumber_2, c=o_string_tonumber_3) { a+b+c; }
watch = Watch(code_block_4)
boolean_3 = BoolSelector(false)
categories = Categories("OST_GenericModel")
all_elements_of_category = ElementsOfCategory(Category=categories)
string_from_object = FromObject(object=all_elements_of_category)
code_block_5 = CodeBlock { "Somatória Cabos"; }
eq = string_from_object == code_block_5
filterByBoolMask = List.FilterByBoolMask(list=all_elements_of_category, mask=eq)
code_block_6 = CodeBlock { 0; }
boolean_4 = BoolSelector(false)
getDataRows_4 = Revit.Schedule.GetDataRows(scheduleView=views, rowIndexes=code_block_6, refresh=boolean_4)
setParameterByName = Element.SetParameterByName(element=filterByBoolMask.in, parameterName=getDataRows_4, value=code_block_4)

# group: Mensagem
count = List.Count(list=setParameterByName)
code_block_7 = CodeBlock { 0; }
gt = count > code_block_7
code_block_8 = CodeBlock { ["Feito! Todos Cabos Foram Somados na Tab. TELECOM"]; }
code_block_9 = CodeBlock { ["Nenhum cabo foi somado"]; }
if_ = If(test=gt, true=code_block_8, false=code_block_9)
flatten = List.Flatten(list=if_)
o_string_fromlist = Orchid.Common.String.FromList(list=flatten)
python_script = Python(IN[0]=o_string_fromlist)
# ---------- python_script.python (21 lines) ----------
# Importar as bibliotecas necessárias do Revit
import clr
clr.AddReference("RevitServices")
from RevitServices.Persistence import DocumentManager

clr.AddReference("RevitAPI")
clr.AddReference("RevitAPIUI")
from Autodesk.Revit.UI import TaskDialog

# Pegar a entrada do Dynamo
mensagem = IN[0]

# Criar a TaskDialog
task_dialog = TaskDialog("Ok")
task_dialog.MainInstruction = mensagem

# Exibir a TaskDialog
task_dialog.Show()

# Saída do script
OUT = "Sucesso!"
# ----------------------------------------
