# Dynamo graph 16-3_BIMACON_ Duplicar e Limpar Tabela de Cabos_R05_script.dyn "ok 2021_16-3_BIMACON_ Duplicar e Limpar Tabela de Cabos_R05_script" (Dynamo 2.19.3.6394)
# author: Jose Nelson
# Duplica uma Tabela e faz a limpeza deixando apenas os cabos que estão sendo utilizados no projeto.
# packages: bimorphNodes 4.2.4, archi-lab.net 2023.213.1722, Data-Shapes 2022.2.105, Crumple 2021.9.24

# group: ENTRADAS PARA O USUÁRIO
code_block = CodeBlock { "Duplique e Limpe a Tabela de Cabos"; }
string = StringInput("LogoBimacon.png")
python_script = Python(IN[0]=string)  # IronPython2
# ---------- python_script.python (22 lines) ----------
import clr

# Adiciona referência ao ambiente .NET
clr.AddReference('System')
from System import Environment, IO

# Nome da imagem (entrada do usuário)
nome_arquivo_imagem = IN[0]

# Recupera o nome do usuário logado no Windows
usuario = Environment.UserName

# Monta o caminho completo para a pasta de imagens
caminho_base = r"C:\Users\{0}\AppData\Roaming\pyRevit\Extensions\Bimacon.extension\Bimacon.tab\Imagens_Bimacon".format(usuario)

# Junta o caminho base com o nome do arquivo
caminho_completo = IO.Path.Combine(caminho_base, nome_arquivo_imagem)

# Verifica se o arquivo existe
existe = IO.File.Exists(caminho_completo)

OUT = caminho_completo if existe else "Imagem não encontrada: {0}".format(caminho_completo)
# ----------------------------------------
file_from_path = FileObject(path=python_script)
readFromFile = Image.ReadFromFile(file=file_from_path)
string_2 = StringInput("Confirmar")
string_3 = StringInput("Escolha a Tabela a ser limpa")
element_types = ElementTypes("TableView")
all_elements_of_type = ElementsOfType(element_type=element_types)
name = Element.Name(element=all_elements_of_type)
string_4 = StringInput("SOMA Cabos")
contains = String.Contains(string=name, searchFor=string_4)
filterByBoolMask = List.FilterByBoolMask(list=all_elements_of_type, mask=contains)
name_2 = Element.Name(element=filterByBoolMask.in)
code_block_2 = CodeBlock { 0; }
dropdown_data = Custom[DropDown Data](InputName=string_3, Keys=name_2, Values=filterByBoolMask.in, DefaultValueIndex=code_block_2)  # package Data-Shapes; Create data for DropDown input in UI.MultiInputForm ++ . Check out www.data-shapes.net for more infos.
string_5 = StringInput("Prefixo")
string_6 = StringInput("00 - ")
boolean = BoolSelector(false)
textbox_data = Custom[TextBox Data](InputName=string_5, DefaultText=string_6, IsNumberEntry=boolean)  # package Data-Shapes; Create Data for TextBox input in UI.MultipleInputForm ++ . Check out www.data-shapes.net for more informations
string_7 = StringInput("Sufixo")
string_8 = StringInput("- LIMPA")
boolean_2 = BoolSelector(false)
textbox_data_2 = Custom[TextBox Data](InputName=string_7, DefaultText=string_8, IsNumberEntry=boolean_2)
string_9 = StringInput("Arredondar Qtd. de Cabos?")
boolean_3 = BoolSelector(true)
string_10 = StringInput("SIM")
boolean_input = Custom[Boolean input](InputName=string_9, DefaultValue=boolean_3, SideText=string_10)  # package Data-Shapes; Creates a boolean input for UI.MultipleInputForm ++ . Check out www.data-shapes.net for more infos!
list_create = List.Create(item0=dropdown_data, item1=textbox_data, item2=textbox_data_2, item3=boolean_input)
boolean_4 = BoolSelector(true)
string_11 = StringInput("Cancelar")
number = DoubleInput(650)
number_2 = DoubleInput(200)
multipleinputform = Custom[MultipleInputForm ++](Description_optional=code_block, Logo_optional=readFromFile, ButtonText_optional=string_2, Inputs=list_create, Toggle=boolean_4, CancelButtonText_optional=string_11, Width_optional=number, LabelWidth_optional=number_2)  # package Data-Shapes; Create a form with multiple inputs. see www.data-shapes.net for tutorials and infos!
code_block_3 = CodeBlock()  # //Data-Shapes
code_block_4 = CodeBlock()  # //archilab

# group: Separar Entradas
code_block_5 = CodeBlock { 0; }
getItemAtIndex = List.GetItemAtIndex(list=multipleinputform.User_Inputs, index=code_block_5)
code_block_6 = CodeBlock { 1; }
getItemAtIndex_2 = List.GetItemAtIndex(list=multipleinputform.User_Inputs, index=code_block_6)
code_block_7 = CodeBlock { 2; }
getItemAtIndex_3 = List.GetItemAtIndex(list=multipleinputform.User_Inputs, index=code_block_7)
code_block_8 = CodeBlock { 3; }
getItemAtIndex_4 = List.GetItemAtIndex(list=multipleinputform.User_Inputs, index=code_block_8)

fields = ScheduleView.Fields(scheduleView=getItemAtIndex)
restOfItems = List.RestOfItems(list=fields)
getData = Revit.Schedule.GetData(scheduleView=getItemAtIndex)
code_block_9 = CodeBlock { 1; }
getItemAtIndex_5 = List.GetItemAtIndex(list=getData, index=code_block_9)
string_12 = StringInput("0,00")
eq = getItemAtIndex_5 == string_12
filterByBoolMask_2 = List.FilterByBoolMask(list=restOfItems, mask=eq)
string_13 = StringInput("0")
eq_2 = getItemAtIndex_5 == string_13
filterByBoolMask_3 = List.FilterByBoolMask(list=restOfItems, mask=eq_2)
string_14 = StringInput("0,0")
eq_3 = getItemAtIndex_5 == string_14
filterByBoolMask_4 = List.FilterByBoolMask(list=restOfItems, mask=eq_3)
list_create_2 = List.Create(item0=filterByBoolMask_2.out, item1=filterByBoolMask_3.out, item2=filterByBoolMask_4.out)
flatten = List.Flatten(list=list_create_2)
name_3 = Element.Name(element=getItemAtIndex)
code_block_10 = CodeBlock(a=getItemAtIndex_2, b=name_3, c=getItemAtIndex_3) { a+b+c; }
duplicate_options = DuplicateOptionsUi("Duplicate")
duplicate = archilab.Revit.Views.Views.Duplicate(view=getItemAtIndex, name=code_block_10, options=duplicate_options)
list_create_3 = List.Create(item0=filterByBoolMask_2.in, item1=filterByBoolMask_3.in, item2=filterByBoolMask_4.in)
flatten_2 = List.Flatten(list=list_create_3)
removeFields = ScheduleView.RemoveFields(scheduleView=duplicate, fields=flatten_2)

# group: Mensagem
count = List.Count(list=removeFields)
code_block_11 = CodeBlock { 0; }
gt = count > code_block_11
code_block_12 = CodeBlock { ["Feito! A Tabela foi Duplicada e Resumida"]; }
code_block_13 = CodeBlock { ["Nenhuma Tabela foi Resumida"]; }
if_ = If(test=gt, true=code_block_12, false=code_block_13)
flatten_3 = List.Flatten(list=if_)
string_fromlist_bimacon = Python(IN[0]=flatten_3)  # IronPython2
# ---------- string_fromlist_bimacon.python (22 lines) ----------
# Carregar as bibliotecas DesignScript e padrão do Python
import sys
import clr
clr.AddReference('ProtoGeometry')
from Autodesk.DesignScript.Geometry import *

# Função para concatenar os valores de uma lista em uma única string com múltiplas linhas
def concatenate_list_to_string(input_list, delimiter="\n"):
    # Verifica se a entrada é uma lista
    if not isinstance(input_list, list):
        return "A entrada deve ser uma lista."
    
    # Converte todos os elementos para string e junta com o delimitador especificado
    result = delimiter.join(str(item) for item in input_list)
    return result

# Entrada pelo nó do Dynamo
lista = IN[0]  # Lista de valores a serem concatenados
delimitador = IN[1] if len(IN) > 1 else "\n"  # Delimitador opcional, padrão é nova linha

# Saída para o Dynamo
OUT = concatenate_list_to_string(lista, delimitador)
# ----------------------------------------
python_script_2 = Python(IN[0]=string_fromlist_bimacon)  # IronPython2
# ---------- python_script_2.python (21 lines) ----------
# Importar as bibliotecas necessárias do Revit
import clr
clr.AddReference("RevitServices")
from RevitServices.Persistence import DocumentManager

clr.AddReference("RevitAPI")
clr.AddReference("RevitAPIUI")
from Autodesk.Revit.UI import TaskDialog

# Pegar a entrada do Dynamo
mensagem = IN[0]

# Criar a TaskDialog
task_dialog = TaskDialog("Ok")
task_dialog.MainInstruction = mensagem

# Exibir a TaskDialog
task_dialog.Show()

# Saída do script
OUT = "Sucesso!"
# ----------------------------------------

# group: Filtro comentários
clearAllFilters = ScheduleView.ClearAllFilters(scheduleView=removeFields)
fields_2 = ScheduleView.Fields(scheduleView=clearAllFilters)
firstItem = List.FirstItem(list=fields_2)
schedule_filter_type = ScheduleFilterType("Contains")
string_15 = StringInput("TAB ARRED")
string_16 = StringInput("SOMA")
if_2 = If(test=getItemAtIndex_4, true=string_15, false=string_16)
byFieldTypeAndValue = Revit.Schedules.ScheduleFilter.ByFieldTypeAndValue(field=firstItem, filterType=schedule_filter_type, value=if_2)
addFilters = ScheduleView.AddFilters(scheduleView=clearAllFilters, scheduleFilters=byFieldTypeAndValue)

end = Revit.Transaction.Transaction.End(input=addFilters)
passThrough = Custom[PassThrough](passThrough=addFilters, waitFor=end)  # package archi-lab.net; Ripped this off from Clockwork. Sorry Andy.

# group: Retirar duas primeiras colunas
fields_3 = ScheduleView.Fields(scheduleView=addFilters)
code_block_14 = CodeBlock { 1..2; }
getItemAtIndex_6 = List.GetItemAtIndex(list=fields_3, index=code_block_14)
removeFields_2 = ScheduleView.RemoveFields(scheduleView=passThrough, fields=getItemAtIndex_6)

viewopen = Custom[© ViewOpen](view=removeFields_2)  # package Crumple; Opens a Revit view (can also be a sheet).
