# Dynamo graph 16-6_BIMACON_Zerar Tabelas de Cabos_R01_script.dyn "ok 2021_16-6_BIMACON_Zerar Tabelas de Cabos_R01_script" (Dynamo 2.19.3.6394)
# author: Jose Nelson
# Limpa todos os cabos lançados nos conduítes e suas conexões
# packages: DynaMEP 2.0.1

# group: Conduites
family_types = FamilyTypes("Somatória Cabos:Somatória Cabos")
byFamilyType = FamilyInstance.ByFamilyType(familyType=family_types)
family_types_2 = FamilyTypes("Somatória Cabos:Soma Arredondamento Cabos")
byFamilyType_2 = FamilyInstance.ByFamilyType(familyType=family_types_2)
list_create = List.Create(item0=byFamilyType, item1=byFamilyType_2)
flatten = List.Flatten(list=list_create)
code_block = CodeBlock()
# ---------- code_block.designscript (1 lines) ----------
["Comprimento Real", "Comprimento Calculado","FA-1,5mm²","FA-2,5mm²","FA-4,0mm²","FA-6,0mm²","FA-10,0mm²","FA-16,0mm²","FA-25,0mm²","FA-35,0mm²","FA-50,0mm²","FA-70,0mm²","FA-95,0mm²","FA-120,0mm²","FA-150,0mm²","FA-185,0mm²","FA-240,0mm²","FA-300,0mm²","FA-400,0mm²","FA-500,0mm²","FB-1,5mm²","FB-2,5mm²","FB-4,0mm²","FB-6,0mm²","FB-10,0mm²","FB-16,0mm²","FB-25,0mm²","FB-35,0mm²","FB-50,0mm²","FB-70,0mm²","FB-95,0mm²","FB-120,0mm²","FB-150,0mm²","FB-185,0mm²","FB-240,0mm²","FB-300,0mm²","FB-400,0mm²","FB-500,0mm²","FC-1,5mm²","FC-2,5mm²","FC-4,0mm²","FC-6,0mm²","FC-10,0mm²","FC-16,0mm²","FC-25,0mm²","FC-35,0mm²","FC-50,0mm²","FC-70,0mm²","FC-95,0mm²","FC-120,0mm²","FC-150,0mm²","FC-185,0mm²","FC-240,0mm²","FC-300,0mm²","FC-400,0mm²","FC-500,0mm²","N-1,5mm²","N-2,5mm²","N-4,0mm²","N-6,0mm²","N-10,0mm²","N-16,0mm²","N-25,0mm²","N-35,0mm²","N-50,0mm²","N-70,0mm²","N-95,0mm²","N-120,0mm²","N-150,0mm²","N-185,0mm²","N-240,0mm²","N-300,0mm²","N-400,0mm²","N-500,0mm²","PE-1,5mm²","PE-2,5mm²","PE-4,0mm²","PE-6,0mm²","PE-10,0mm²","PE-16,0mm²","PE-25,0mm²","PE-35,0mm²","PE-50,0mm²","PE-70,0mm²","PE-95,0mm²","PE-120,0mm²","PE-150,0mm²","PE-185,0mm²","PE-240,0mm²","PE-300,0mm²","PE-400,0mm²","PE-500,0mm²","Re-1,5mm²","Re-2,5mm²","Re-4,0mm²","Re-6,0mm²","Telecom_UTP_CAT-5e","Telecom_UTP_CAT-6","Telecom_FTP_CAT-6","Telecom_FTP_CAT-6a","Telecom_FTP_CAT-7","Telecom_CCI_1P","Telecom_CCI_2P","Telecom_CCI_3P","Telecom_CCI_4P","Telecom_CI_10P","Telecom_CI_20P","Telecom_CI_30P","Telecom_CI_40P","Telecom_RG59_47%","Telecom_RG59_67%","Telecom_RG59_95%","Telecom_RG6_67%","Telecom_RG6_95%","Telecom_FO_N2","Telecom_FO_N4","Telecom_FO_N6","Telecom_FO_N8","Telecom_FO_N12","1,5mm²","2,5mm²","4,0mm²","6,0mm²","10,0mm²","16,0mm²","25,0mm²","35,0mm²","50,0mm²","70,0mm²","95,0mm²","120,0mm²","150,0mm²","185,0mm²","240,0mm²","300,0mm²","400,0mm²","500,0mm²","UTP_CAT-5e","UTP_CAT-6","FTP_CAT-6","FTP_CAT-6a","FTP_CAT-7","CCI_1P","CCI_2P","CCI_3P","CCI_4P","CI_10P","CI_20P","CI_30P","CI_40P","RG59_47%","RG59_67%","RG59_95%","RG6_67%","RG6_95%","FO_N2","FO_N4","FO_N6","FO_N8","FO_N12"];
# ----------------------------------------
flatten_2 = List.Flatten(list=code_block)
getParameterValueByName = Element.GetParameterValueByName(element=flatten@L2, parameterName=flatten_2, lacing=Longest)
code_block_2 = CodeBlock { true; false; }
code_block_3 = CodeBlock(x=getParameterValueByName, y=code_block_2.out0, z=code_block_2.out1)
# ---------- code_block_3.designscript (5 lines) ----------
//Condições IF, OR, AND
x;
y;
z;
x == 0 || x=="" ? y : z;
# ----------------------------------------
filterByBoolMask = List.FilterByBoolMask(list=flatten, mask=code_block_3.out3@L2)
flatten_3 = List.Flatten(list=filterByBoolMask.out)
number = DoubleInput(0)
setParameterValueByName = RevitModel.Element.SetParameterValueByName(element=flatten_3@L1, parameterName=flatten_2, values=number)

uniqueItems = List.UniqueItems(list=setParameterValueByName)
isEmpty = List.IsEmpty(list=uniqueItems)
code_block_4 = CodeBlock { null; }
code_block_5 = CodeBlock(x=isEmpty, y=code_block_4, z=uniqueItems)
# ---------- code_block_5.designscript (5 lines) ----------
//Condições IF, OR, AND
x;
y;
z;
x == true ? y : z;
# ----------------------------------------

# group: Mensagem
count = List.Count(list=code_block_5.out3)
code_block_6 = CodeBlock { 0; }
gt = count > code_block_6
code_block_7 = CodeBlock { ["Feito! As tabelas de Cabos foram zeradas"]; }
code_block_8 = CodeBlock { ["Nenhuma Tabela foi zerada"]; }
if_ = If(test=gt, true=code_block_7, false=code_block_8)
flatten_4 = List.Flatten(list=if_)
string_fromlist_bimacon = Python(IN[0]=flatten_4)  # IronPython2
# ---------- string_fromlist_bimacon.python (22 lines) ----------
# Carregar as bibliotecas DesignScript e padrão do Python
import sys
import clr
clr.AddReference('ProtoGeometry')
from Autodesk.DesignScript.Geometry import *

# Função para concatenar os valores de uma lista em uma única string com múltiplas linhas
def concatenate_list_to_string(input_list, delimiter="\n"):
    # Verifica se a entrada é uma lista
    if not isinstance(input_list, list):
        return "A entrada deve ser uma lista."
    
    # Converte todos os elementos para string e junta com o delimitador especificado
    result = delimiter.join(str(item) for item in input_list)
    return result

# Entrada pelo nó do Dynamo
lista = IN[0]  # Lista de valores a serem concatenados
delimitador = IN[1] if len(IN) > 1 else "\n"  # Delimitador opcional, padrão é nova linha

# Saída para o Dynamo
OUT = concatenate_list_to_string(lista, delimitador)
# ----------------------------------------
python_script = Python(IN[0]=string_fromlist_bimacon)  # IronPython2
# ---------- python_script.python (21 lines) ----------
# Importar as bibliotecas necessárias do Revit
import clr
clr.AddReference("RevitServices")
from RevitServices.Persistence import DocumentManager

clr.AddReference("RevitAPI")
clr.AddReference("RevitAPIUI")
from Autodesk.Revit.UI import TaskDialog

# Pegar a entrada do Dynamo
mensagem = IN[0]

# Criar a TaskDialog
task_dialog = TaskDialog("Ok")
task_dialog.MainInstruction = mensagem

# Exibir a TaskDialog
task_dialog.Show()

# Saída do script
OUT = "Sucesso!"
# ----------------------------------------
