# Dynamo graph ok 2021_16-3_BIMACON_ Duplicar e Limpar Tabela de Cabos_R04_script.dyn (Dynamo 2.6.1.8786)
# Duplica uma Tabela e faz a limpeza deixando apenas os cabos que estão sendo utilizados no projeto.
# packages: bimorphNodes 4.2.4, archi-lab.net 2023.213.1722, Data-Shapes 2022.2.105, Orchid 2.6.10.6373

string = StringInput("SOMA Cabos")
string_2 = StringInput("Arredondar Qtd. de Cabos?")
boolean = BoolSelector(true)
string_3 = StringInput("SIM")
boolean_input = Custom[Boolean input](InputName=string_2, DefaultValue=boolean, SideText=string_3)  # package Data-Shapes; Creates a boolean input for UI.MultipleInputForm ++ . Check out www.data-shapes.net for more infos!

# group: ENTRADAS PARA O USUÁRIO
code_block = CodeBlock { "Duplique e Limpe a Tabela de Cabos"; }
file_path = Filename("..\..\..\..\..\05 - BIMACON\01 - EMPRESA BIMACON\00 - Logos e imagens - BIMACON\ARTE BIMACON\reddonda-removebg-preview.png")
file_from_path = FileObject(path=file_path)
readFromFile = Image.ReadFromFile(file=file_from_path)
string_4 = StringInput("Confirmar")
string_5 = StringInput("Escolha a Tabela a ser limpa")
element_types = ElementTypes("TableView")
all_elements_of_type = ElementsOfType(element_type=element_types)
name = Element.Name(element=all_elements_of_type)
code_block_2 = CodeBlock { 0; }
string_6 = StringInput("Prefixo")
string_7 = StringInput("00 - ")
boolean_2 = BoolSelector(false)
textbox_data = Custom[TextBox Data](InputName=string_6, DefaultText=string_7, IsNumberEntry=boolean_2)  # package Data-Shapes; Create Data for TextBox input in UI.MultipleInputForm ++ . Check out www.data-shapes.net for more informations
string_8 = StringInput("Sufixo")
string_9 = StringInput("- LIMPA")
boolean_3 = BoolSelector(false)
textbox_data_2 = Custom[TextBox Data](InputName=string_8, DefaultText=string_9, IsNumberEntry=boolean_3)
boolean_4 = BoolSelector(true)
string_10 = StringInput("Cancelar")
number = DoubleInput(550)
number_2 = DoubleInput(200)
code_block_3 = CodeBlock()  # //Data-Shapes
code_block_4 = CodeBlock()  # //archilab

contains = String.Contains(str=name, searchFor=string)
filterByBoolMask = List.FilterByBoolMask(list=all_elements_of_type, mask=contains)
name_2 = Element.Name(element=filterByBoolMask.in)

# group (continued): ENTRADAS PARA O USUÁRIO
dropdown_data = Custom[DropDown Data](InputName=string_5, Keys=name_2, Values=filterByBoolMask.in, DefaultValueIndex=code_block_2)  # package Data-Shapes; Create data for DropDown input in UI.MultiInputForm ++ . Check out www.data-shapes.net for more infos.
list_create = List.Create(item0=dropdown_data, item1=textbox_data, item2=textbox_data_2, item3=boolean_input)
multipleinputform = Custom[MultipleInputForm ++](Description_optional=code_block, Logo_optional=readFromFile, ButtonText_optional=string_4, Inputs=list_create, Toggle=boolean_4, CancelButtonText_optional=string_10, Width_optional=number, LabelWidth_optional=number_2)  # package Data-Shapes; Create a form with multiple inputs. see www.data-shapes.net for tutorials and infos!

# group: Separar Entradas
code_block_5 = CodeBlock { 0; }
getItemAtIndex = List.GetItemAtIndex(list=multipleinputform.User_Inputs, index=code_block_5)
code_block_6 = CodeBlock { 1; }
getItemAtIndex_2 = List.GetItemAtIndex(list=multipleinputform.User_Inputs, index=code_block_6)
code_block_7 = CodeBlock { 2; }
getItemAtIndex_3 = List.GetItemAtIndex(list=multipleinputform.User_Inputs, index=code_block_7)

fields = ScheduleView.Fields(scheduleView=getItemAtIndex)
restOfItems = List.RestOfItems(list=fields)
getData = Revit.Schedule.GetData(scheduleView=getItemAtIndex)
code_block_8 = CodeBlock { 1; }
getItemAtIndex_4 = List.GetItemAtIndex(list=getData, index=code_block_8)
string_11 = StringInput("0,00")
eq = getItemAtIndex_4 == string_11
filterByBoolMask_2 = List.FilterByBoolMask(list=restOfItems, mask=eq)
string_12 = StringInput("0")
eq_2 = getItemAtIndex_4 == string_12
filterByBoolMask_3 = List.FilterByBoolMask(list=restOfItems, mask=eq_2)
string_13 = StringInput("0,0")
eq_3 = getItemAtIndex_4 == string_13
filterByBoolMask_4 = List.FilterByBoolMask(list=restOfItems, mask=eq_3)
list_create_2 = List.Create(item0=filterByBoolMask_2.out, item1=filterByBoolMask_3.out, item2=filterByBoolMask_4.out)
flatten = List.Flatten(list=list_create_2)
name_3 = Element.Name(element=getItemAtIndex)
code_block_9 = CodeBlock(a=getItemAtIndex_2, b=name_3, c=getItemAtIndex_3) { a+b+c; }
duplicate_options = DuplicateOptionsUi("Duplicate")
duplicate = archilab.Revit.Views.Views.Duplicate(view=getItemAtIndex, name=code_block_9, options=duplicate_options)
list_create_3 = List.Create(item0=filterByBoolMask_2.in, item1=filterByBoolMask_3.in, item2=filterByBoolMask_4.in)
flatten_2 = List.Flatten(list=list_create_3)
removeFields = ScheduleView.RemoveFields(scheduleView=duplicate, fields=flatten_2)

# group: Mensagem
count = List.Count(list=removeFields)
code_block_10 = CodeBlock { 0; }
gt = count > code_block_10
code_block_11 = CodeBlock { ["Feito! A Tabela foi Duplicada e Resumida"]; }
code_block_12 = CodeBlock { ["Nenhuma Tabela foi Resumida"]; }
if_ = If(test=gt, true=code_block_11, false=code_block_12)
flatten_3 = List.Flatten(list=if_)
o_string_fromlist = Orchid.Common.String.FromList(list=flatten_3)
python_script = Python(IN[0]=o_string_fromlist)
# ---------- python_script.python (21 lines) ----------
# Importar as bibliotecas necessárias do Revit
import clr
clr.AddReference("RevitServices")
from RevitServices.Persistence import DocumentManager

clr.AddReference("RevitAPI")
clr.AddReference("RevitAPIUI")
from Autodesk.Revit.UI import TaskDialog

# Pegar a entrada do Dynamo
mensagem = IN[0]

# Criar a TaskDialog
task_dialog = TaskDialog("Ok")
task_dialog.MainInstruction = mensagem

# Exibir a TaskDialog
task_dialog.Show()

# Saída do script
OUT = "Sucesso!"
# ----------------------------------------

code_block_13 = CodeBlock { 3; }
getItemAtIndex_5 = List.GetItemAtIndex(list=multipleinputform.User_Inputs, index=code_block_13)

# group: Filtro comentários
clearAllFilters = ScheduleView.ClearAllFilters(scheduleView=removeFields)
fields_2 = ScheduleView.Fields(scheduleView=clearAllFilters)
code_block_14 = CodeBlock { "Comentários"; }
o_schedulefield_byname = Orchid.RevitProject.Schedules.ScheduleField.ByName(scheduleField=fields_2, name=code_block_14)
schedule_filter_type = ScheduleFilterType("Contains")
string_14 = StringInput("TAB ARRED")
string_15 = StringInput("SOMA")
if_2 = If(test=getItemAtIndex_5, true=string_14, false=string_15)
byFieldTypeAndValue = Revit.Schedules.ScheduleFilter.ByFieldTypeAndValue(field=o_schedulefield_byname, filterType=schedule_filter_type, value=if_2)
addFilters = ScheduleView.AddFilters(scheduleView=clearAllFilters, scheduleFilters=byFieldTypeAndValue)

# group: Retirar dus primeiras colunas
fields_3 = ScheduleView.Fields(scheduleView=addFilters)
code_block_15 = CodeBlock { 1..2; }
getItemAtIndex_6 = List.GetItemAtIndex(list=fields_3, index=code_block_15)
removeFields_2 = ScheduleView.RemoveFields(scheduleView=addFilters, fields=getItemAtIndex_6)

o_document_openview = Orchid.RevitProject.Common.Document.OpenView(view=removeFields_2)
