# Dynamo graph Abrir link navegador_Atual_script.dyn (Dynamo 2.6.1.8786)
# packages: Crumple 2021.9.24

string = StringInput("https://www.notion.so/Aqui-voc-acompanha-as-atualiza-es-do-Template-e-das-Rotinas-Dynamo-9a3e48dcf97a4a0da7ccb694abf1c22e?source=copy_link")
boolean = BoolSelector(true)
openurl = Custom[© OpenURL](url=string, runMe=boolean)  # package Crumple; Given a URL, will attempt to open in the default web browser used by Windows.
watch = Watch(openurl)
