# Dynamo graph ok 2021_11-3_BIMACON_Destacar Conduites Com Cabos_script.dyn "2021_16-7_BIMACON_Destacar Conduites Com Cabos_script" (Dynamo 2.6.1.8786)
# Limpa todos os cabos lançados nos conduítes e suas conexões
# packages: Orchid 2.6.10.6373, Clockwork for Dynamo 2.x 2.4.0, Crumple 2021.9.24

# group: Limpar Sobreposição
desfazer_sobreposição = BoolSelector(true)  # graph input
empty = List.Empty()
currentview = Custom[© CurrentView]()  # package Crumple; Given the current document, return the active view.

# group: Conduites
categories = Categories("OST_Conduit")
categories_2 = Categories("OST_ConduitFitting")
list_create = List.Create(item0=categories, item1=categories_2)
all_elements_of_category = ElementsOfCategory(Category=list_create)
flatten = List.Flatten(list=all_elements_of_category)
code_block = CodeBlock()
# ---------- code_block.designscript (1 lines) ----------
["1,5mm²_Fase A","1,5mm²_Fase B","1,5mm²_Fase C","1,5mm²_Neutro","1,5mm²_Retorno","1,5mm²_Terra","2,5mm²_Fase A","2,5mm²_Fase B","2,5mm²_Fase C","2,5mm²_Neutro","2,5mm²_Retorno","2,5mm²_Terra","4,0mm²_Fase A","4,0mm²_Fase B","4,0mm²_Fase C","4,0mm²_Neutro","4,0mm²_Retorno","4,0mm²_Terra","6,0mm²_Fase A","6,0mm²_Fase B","6,0mm²_Fase C","6,0mm²_Neutro","6,0mm²_Retorno","6,0mm²_Terra","10,0mm²_Fase A","10,0mm²_Fase B","10,0mm²_Fase C","10,0mm²_Neutro","10,0mm²_Terra","16,0mm²_Fase A","16,0mm²_Fase B","16,0mm²_Fase C","16,0mm²_Neutro","16,0mm²_Terra","25,0mm²_Fase A","25,0mm²_Fase B","25,0mm²_Fase C","25,0mm²_Neutro","25,0mm²_Terra","35,0mm²_Fase A","35,0mm²_Fase B","35,0mm²_Fase C","35,0mm²_Neutro","35,0mm²_Terra","50,0mm²_Fase A","50,0mm²_Fase B","50,0mm²_Fase C","50,0mm²_Neutro","50,0mm²_Terra","70,0mm²_Fase A","70,0mm²_Fase B","70,0mm²_Fase C","70,0mm²_Neutro","70,0mm²_Terra","95,0mm²_Fase A","95,0mm²_Fase B","95,0mm²_Fase C","95,0mm²_Neutro","95,0mm²_Terra","120,0mm²_Fase A","120,0mm²_Fase B","120,0mm²_Fase C","120,0mm²_Neutro","120,0mm²_Terra","150,0mm²_Fase A","150,0mm²_Fase B","150,0mm²_Fase C","150,0mm²_Neutro","150,0mm²_Terra","185,0mm²_Fase A","185,0mm²_Fase B","185,0mm²_Fase C","185,0mm²_Neutro","185,0mm²_Terra","240,0mm²_Fase A","240,0mm²_Fase B","240,0mm²_Fase C","240,0mm²_Neutro","240,0mm²_Terra","300,0mm²_Fase A","300,0mm²_Fase B","300,0mm²_Fase C","300,0mm²_Neutro","300,0mm²_Terra","400,0mm²_Fase A","400,0mm²_Fase B","400,0mm²_Fase C","400,0mm²_Neutro","400,0mm²_Terra","500,0mm²_Fase A","500,0mm²_Fase B","500,0mm²_Fase C","500,0mm²_Neutro","500,0mm²_Terra","CCI_1P","CCI_2P","CCI_3P","CCI_4P","CI_10P","CI_20P","CI_30P","CI_40P","FO_N2","FO_N4","FO_N6","FO_N8","FO_N12","FTP_CAT-6","FTP_CAT-6a","FTP_CAT-7","RG6_67%","RG6_95%","RG59_47%","RG59_67%","RG59_95%","UTP_CAT-5e","UTP_CAT-6"];
# ----------------------------------------
flatten_2 = List.Flatten(list=code_block)
getParameterValueByName = Element.GetParameterValueByName(element=flatten@L2, parameterName=flatten_2, lacing=Longest)
code_block_2 = CodeBlock { true; false; }
code_block_3 = CodeBlock(x=getParameterValueByName, y=code_block_2.out0, z=code_block_2.out1)
# ---------- code_block_3.designscript (5 lines) ----------
//Condições IF, OR, AND
x;
y;
z;
x == 0 || x=="" ? y : z;
# ----------------------------------------
filterByBoolMask = List.FilterByBoolMask(list=flatten, mask=code_block_3.out3@L2)
flatten_3 = List.Flatten(list=filterByBoolMask.out)

if_ = If(test=desfazer_sobreposição, true=flatten_3, false=empty)

# group (continued): Limpar Sobreposição
resetElementOverrides = Custom[View.ResetElementOverrides](element=if_, view=currentview)  # package Clockwork for Dynamo 2.x; Resets all overrides for an element in a given view
watch = Watch(resetElementOverrides.element)

code_block_4 = CodeBlock { 0; }

# group: Cor
color_palette = ColorPalette({R: 255, G: 0, B: 0, A: 255})
color_palette_2 = ColorPalette({R: 255, G: 0, B: 0, A: 255})
color_palette_3 = ColorPalette({R: 255, G: 0, B: 0, A: 255})
color_palette_4 = ColorPalette({R: 0, G: 0, B: 0, A: 255})

# group: Hachura
fill_patterns = FillPatterns("<Preenchimento sólido>")
fill_patterns_2 = FillPatterns("<Preenchimento sólido>")

# group: Linhas Hachura
line_patterns = LinePatterns("Alinhamento")
line_patterns_2 = LinePatterns("Alinhamento")

# group: Espessura da linha
number_slider = DoubleSlider(2, range=0..100 step 1)
number_slider_2 = DoubleSlider(2, range=0..100 step 1)

# group: Transparência
number_slider_3 = DoubleSlider(0, range=0..100 step 1)

# group: Nível de Detalhe
detail_level = DetailLevel("Fine")

boolean = BoolSelector(false)

# group: Sobreposição de Gráficos
byProperties = Revit.Filter.OverrideGraphicSettings.ByProperties(cutFillColor=color_palette, projectionFillColor=color_palette_2, cutLineColor=color_palette_3, projectionLineColor=color_palette_4, cutFillPattern=fill_patterns, projectionFillPattern=fill_patterns_2, cutLinePattern=line_patterns, projectionLinePattern=line_patterns_2, cutLineWeight=number_slider, projectionLineWeight=number_slider_2, transparency=number_slider_3, detailLevel=detail_level, halftone=boolean)
overrideInView = Element.OverrideInView(element=flatten_3, overrides=byProperties)

# group: Curvas e conduites desconectados
string_from_object = FromObject(obj=overrideInView)
code_block_5 = CodeBlock { "Curva"; }
contains = String.Contains(str=string_from_object, searchFor=code_block_5)
filterByBoolMask_2 = List.FilterByBoolMask(list=string_from_object, mask=contains)
flatten_4 = List.Flatten(list=filterByBoolMask_2.in)
string_from_object_2 = FromObject(obj=overrideInView)
code_block_6 = CodeBlock { "Conduit"; }
contains_2 = String.Contains(str=string_from_object_2, searchFor=code_block_6)
filterByBoolMask_3 = List.FilterByBoolMask(list=string_from_object_2, mask=contains_2)
flatten_5 = List.Flatten(list=filterByBoolMask_3.in)
list_create_2 = List.Create(item0=flatten_4, item1=flatten_5)
flatten_6 = List.Flatten(list=list_create_2)

# group: Mensagem Final
count = List.Count(list=flatten_6)
code_block_7 = CodeBlock { 0; }
code_block_8 = CodeBlock { ["Nenhum elemento identificado"]; }

if_2 = If(test=desfazer_sobreposição, true=code_block_4, false=count)

# group (continued): Mensagem Final
gt = if_2 > code_block_7
code_block_9 = CodeBlock(N=if_2) { [""+N+" elementos com cabos"]; }
if_3 = If(test=gt, true=code_block_9, false=code_block_8)

flatten_7 = List.Flatten(list=if_3)

# group (continued): Mensagem Final
o_string_fromlist = Orchid.Common.String.FromList(list=flatten_7)
python_script = Python(IN[0]=o_string_fromlist)
# ---------- python_script.python (21 lines) ----------
# Importar as bibliotecas necessárias do Revit
import clr
clr.AddReference("RevitServices")
from RevitServices.Persistence import DocumentManager

clr.AddReference("RevitAPI")
clr.AddReference("RevitAPIUI")
from Autodesk.Revit.UI import TaskDialog

# Pegar a entrada do Dynamo
mensagem = IN[0]

# Criar a TaskDialog
task_dialog = TaskDialog("Ok")
task_dialog.MainInstruction = mensagem

# Exibir a TaskDialog
task_dialog.Show()

# Saída do script
OUT = "Sucesso!"
# ----------------------------------------
