# Dynamo graph 15-4_BIMACON_Desfazer Cortes nas Paredes ou Pisos_R01_script.dyn "ok 2021_15-4_BIMACON_Desfazer Cortes nas Paredes ou Pisos_R01_script" (Dynamo 2.19.3.6394)
# author: Jose Nelson
# Desfaz os Cortes em Paredes ou Pisos feitos por aqruivo linkado
# packages: DynaMEP 2.0.1, archi-lab.net 2023.213.1722

current = RevitModel.Documents.Current()
categories = Categories("OST_GenericModel")  # graph input
selectByCategory = RevitModel.Element.SelectByCategory(doc=current, category=categories)
name = ElementType.Name(elementType=selectByCategory)
string = StringInput("Corte")
contains = String.Contains(string=name, searchFor=string)
filterByBoolMask = List.FilterByBoolMask(list=selectByCategory, mask=contains)
delete = archilab.Revit.Elements.Elements.Delete(element=filterByBoolMask.in)
watch = Watch(delete)

# group: Mensagem final
countTrue = List.CountTrue(list=watch)
code_block = CodeBlock { 0; }
gt = countTrue > code_block
code_block_2 = CodeBlock(N=countTrue) { ["Feito! você deletou "+N+" cortes"]; }
code_block_3 = CodeBlock { ["Nenhum corte foi deletado"]; }
if_ = If(test=gt, true=code_block_2, false=code_block_3)
flatten = List.Flatten(list=if_)
fromList = Python(IN[0]=flatten)  # "String.FromList"; IronPython2
# ---------- fromList.python (22 lines) ----------
# Carregar as bibliotecas DesignScript e padrão do Python
import sys
import clr
clr.AddReference('ProtoGeometry')
from Autodesk.DesignScript.Geometry import *

# Função para concatenar os valores de uma lista em uma única string com múltiplas linhas
def concatenate_list_to_string(input_list, delimiter="\n"):
    # Verifica se a entrada é uma lista
    if not isinstance(input_list, list):
        return "A entrada deve ser uma lista."
    
    # Converte todos os elementos para string e junta com o delimitador especificado
    result = delimiter.join(str(item) for item in input_list)
    return result

# Entrada pelo nó do Dynamo
lista = IN[0]  # Lista de valores a serem concatenados
delimitador = IN[1] if len(IN) > 1 else "\n"  # Delimitador opcional, padrão é nova linha

# Saída para o Dynamo
OUT = concatenate_list_to_string(lista, delimitador)
# ----------------------------------------
python_script = Python(IN[0]=fromList)  # IronPython2
# ---------- python_script.python (21 lines) ----------
# Importar as bibliotecas necessárias do Revit
import clr
clr.AddReference("RevitServices")
from RevitServices.Persistence import DocumentManager

clr.AddReference("RevitAPI")
clr.AddReference("RevitAPIUI")
from Autodesk.Revit.UI import TaskDialog

# Pegar a entrada do Dynamo
mensagem = IN[0]

# Criar a TaskDialog
task_dialog = TaskDialog("Ok")
task_dialog.MainInstruction = mensagem

# Exibir a TaskDialog
task_dialog.Show()

# Saída do script
OUT = "Sucesso!"
# ----------------------------------------
