# Dynamo graph 2021_15-4_BIMACON_Desfazer Cortes nas Paredes ou Pisos_script.dyn "2021_15-4_BIMACON_Desfazer Cortes nas Paredes ou Pisos" (Dynamo 2.6.1.8786)
# packages: DynaMEP 2.0.1, archi-lab.net 2023.213.1722, Orchid 2.6.10.6373

current = RevitModel.Documents.Current()
categories = Categories("OST_GenericModel")  # graph input
selectByCategory = RevitModel.Element.SelectByCategory(doc=current, category=categories)
name = ElementType.Name(elementType=selectByCategory)
corte_parede_ou_corte_piso = StringInput("Corte parede")  # graph input
eq = name == corte_parede_ou_corte_piso
filterByBoolMask = List.FilterByBoolMask(list=selectByCategory, mask=eq)
delete = archilab.Revit.Elements.Elements.Delete(element=filterByBoolMask.in)
watch = Watch(delete)

# group: Mensagem final
countTrue = List.CountTrue(list=watch)
code_block = CodeBlock { 0; }
gt = countTrue > code_block
code_block_2 = CodeBlock(N=countTrue) { ["Feito! você deletou "+N+" cortes"]; }
code_block_3 = CodeBlock { ["Nenhum corte foi deletado"]; }
if_ = If(test=gt, true=code_block_2, false=code_block_3)
flatten = List.Flatten(list=if_)
o_string_fromlist = Orchid.Common.String.FromList(list=flatten)
python_script = Python(IN[0]=o_string_fromlist)
# ---------- python_script.python (21 lines) ----------
# Importar as bibliotecas necessárias do Revit
import clr
clr.AddReference("RevitServices")
from RevitServices.Persistence import DocumentManager

clr.AddReference("RevitAPI")
clr.AddReference("RevitAPIUI")
from Autodesk.Revit.UI import TaskDialog

# Pegar a entrada do Dynamo
mensagem = IN[0]

# Criar a TaskDialog
task_dialog = TaskDialog("Ok")
task_dialog.MainInstruction = mensagem

# Exibir a TaskDialog
task_dialog.Show()

# Saída do script
OUT = "Sucesso!"
# ----------------------------------------
