# Dynamo graph ok 2021_15-0_BIMACON_Cortar elementos entre duas categorias em projeto_R01_script.dyn (Dynamo 2.6.1.8786)
# packages: Data-Shapes 2022.2.105

categories = Categories("OST_StructuralFraming")

# group: ENTRADAS PARA O USUÁRIO
code_block = CodeBlock()  # //Data-Shapes
code_block_2 = CodeBlock()  # //archilab
code_block_3 = CodeBlock { "Escolha as Categorias a serem cortadas"; }
file_path = Filename("..\..\..\..\..\05 - BIMACON\01 - EMPRESA BIMACON\00 - Logos e imagens - BIMACON\ARTE BIMACON\reddonda-removebg-preview.png")
file_from_path = FileObject(path=file_path)
readFromFile = Image.ReadFromFile(file=file_from_path)
string = StringInput("Confirmar")
string_2 = StringInput("Selecione categoria a ser cortada (ex: Paredes)")
categories_2 = Categories("OST_Walls")
categories_3 = Categories("OST_Floors")
categories_4 = Categories("OST_Furniture")
categories_5 = Categories("OST_StructuralColumns")
list_create = List.Create(item0=categories_2, item1=categories_3, item2=categories_4, item3=categories_5, item4=categories)
code_block_4 = CodeBlock { 0; }
dropdown_data = Custom[DropDown Data](InputName=string_2, Keys=list_create, Values=list_create, DefaultValueIndex=code_block_4)  # package Data-Shapes; Create data for DropDown input in UI.MultiInputForm ++ . Check out www.data-shapes.net for more infos.
string_3 = StringInput("Selecione categoria que vai cortar (ex: Dispositivos de iluminação)")
categories_list = Custom[Categories list]()  # package Data-Shapes; Gives list of all Revit categories and a matching list of their names
sort = List.Sort(list=categories_list.Category_name_s)
byName = Category.ByName(name=sort)
code_block_5 = CodeBlock { 72; }
dropdown_data_2 = Custom[DropDown Data](InputName=string_3, Keys=sort, Values=byName, DefaultValueIndex=code_block_5)
list_create_2 = List.Create(item0=dropdown_data, item1=dropdown_data_2)
boolean = BoolSelector(true)
string_4 = StringInput("Cancelar")
number = DoubleInput(480)
number_2 = DoubleInput(170)
multipleinputform = Custom[MultipleInputForm ++](Description_optional=code_block_3, Logo_optional=readFromFile, ButtonText_optional=string, Inputs=list_create_2, Toggle=boolean, CancelButtonText_optional=string_4, Width_optional=number, LabelWidth_optional=number_2)  # package Data-Shapes; Create a form with multiple inputs. see www.data-shapes.net for tutorials and infos!

# group: Separar Entradas
code_block_6 = CodeBlock { 0; }
getItemAtIndex = List.GetItemAtIndex(list=multipleinputform.User_Inputs, index=code_block_6)
code_block_7 = CodeBlock { 1; }
getItemAtIndex_2 = List.GetItemAtIndex(list=multipleinputform.User_Inputs, index=code_block_7)

all_elements_of_category = ElementsOfCategory(Category=getItemAtIndex)
all_elements_of_category_2 = ElementsOfCategory(Category=getItemAtIndex_2)
python_script = Python(IN[0]=all_elements_of_category, IN[1]=all_elements_of_category_2)
# ---------- python_script.python (44 lines) ----------
import clr
clr.AddReference('RevitAPI')
from Autodesk.Revit.DB import *
from System.Collections.Generic import *
clr.AddReference("RevitServices")
import RevitServices
from RevitServices.Persistence import DocumentManager
from RevitServices.Transactions import TransactionManager

doc = DocumentManager.Instance.CurrentDBDocument
items1 = UnwrapElement(IN[0])
items2 = UnwrapElement(IN[1])

def CutGeometry(doc, item1, item2):
    try:
        SolidSolidCutUtils.AddCutBetweenSolids(doc,item1,item2)
        return True
    except:
        try:
            InstanceVoidCutUtils.AddInstanceVoidCut(doc,item1,item2)
            return True
        except:
            return False

def CutBetweenElements(doc, elements1, elements2):
    OUT = []
    for x in elements1:
        for y in elements2:
            result = CutGeometry(doc, x, y)
            OUT.append(result)
    return OUT

TransactionManager.Instance.EnsureInTransaction(doc)
if isinstance(IN[0], list):
    if isinstance(IN[1], list):
        OUT = CutBetweenElements(doc, items1, items2)
    else:
        OUT = [CutGeometry(doc, x, items2) for x in items1]
else:
    if isinstance(IN[1], list):
        OUT = [CutGeometry(doc, items1, x) for x in items2]
    else:
        OUT = CutGeometry(doc, items1, items2)
TransactionManager.Instance.TransactionTaskDone()
# ----------------------------------------
watch = Watch(python_script)  # graph output

# group: Mensagem Final
countTrue = List.CountTrue(list=watch)
code_block_8 = CodeBlock { 0; }
gt = countTrue > code_block_8
code_block_9 = CodeBlock { ["Os elementos foram cortados"]; }
code_block_10 = CodeBlock { ["Nenhum elemento cortado"]; }
if_ = If(test=gt, true=code_block_9, false=code_block_10)
flatten = List.Flatten(list=if_)
fromList = Python(IN[0]=flatten)  # "String.FromList"
# ---------- fromList.python (22 lines) ----------
# Carregar as bibliotecas DesignScript e padrão do Python
import sys
import clr
clr.AddReference('ProtoGeometry')
from Autodesk.DesignScript.Geometry import *

# Função para concatenar os valores de uma lista em uma única string com múltiplas linhas
def concatenate_list_to_string(input_list, delimiter="\n"):
    # Verifica se a entrada é uma lista
    if not isinstance(input_list, list):
        return "A entrada deve ser uma lista."
    
    # Converte todos os elementos para string e junta com o delimitador especificado
    result = delimiter.join(str(item) for item in input_list)
    return result

# Entrada pelo nó do Dynamo
lista = IN[0]  # Lista de valores a serem concatenados
delimitador = IN[1] if len(IN) > 1 else "\n"  # Delimitador opcional, padrão é nova linha

# Saída para o Dynamo
OUT = concatenate_list_to_string(lista, delimitador)
# ----------------------------------------
python_script_2 = Python(IN[0]=fromList)
# ---------- python_script_2.python (21 lines) ----------
# Importar as bibliotecas necessárias do Revit
import clr
clr.AddReference("RevitServices")
from RevitServices.Persistence import DocumentManager

clr.AddReference("RevitAPI")
clr.AddReference("RevitAPIUI")
from Autodesk.Revit.UI import TaskDialog

# Pegar a entrada do Dynamo
mensagem = IN[0]

# Criar a TaskDialog
task_dialog = TaskDialog("Ok")
task_dialog.MainInstruction = mensagem

# Exibir a TaskDialog
task_dialog.Show()

# Saída do script
OUT = "Sucesso!"
# ----------------------------------------
