# Dynamo graph 15-2_BIMACON_Cortar Paredes e elementos do Link_R05_script.dyn "ok 2021_15-2_BIMACON_Cortar Paredes e elementos do Link_R05_script" (Dynamo 2.19.3.6394)
# author: Jose Nelson
# Corta paredes com elementos de um link (Ex: Link de Elétrica)
# packages: Data-Shapes 2022.2.105, DynaMEP 2.0.1, archi-lab.net 2023.213.1722, Clockwork for Dynamo 2.x 2.4.0, Rhythm 2023.4.2021

# group: ENTRADAS PARA O USUÁRIO
code_block = CodeBlock()  # //Data-Shapes
code_block_2 = CodeBlock()  # //archilab
code_block_3 = CodeBlock { "Cortar Parede com elementos do Link"; }
string = StringInput("LogoBimacon.png")
python_script = Python(IN[0]=string)  # IronPython2
# ---------- python_script.python (22 lines) ----------
import clr

# Adiciona referência ao ambiente .NET
clr.AddReference('System')
from System import Environment, IO

# Nome da imagem (entrada do usuário)
nome_arquivo_imagem = IN[0]

# Recupera o nome do usuário logado no Windows
usuario = Environment.UserName

# Monta o caminho completo para a pasta de imagens
caminho_base = r"C:\Users\{0}\AppData\Roaming\pyRevit\Extensions\Bimacon.extension\Bimacon.tab\Imagens_Bimacon".format(usuario)

# Junta o caminho base com o nome do arquivo
caminho_completo = IO.Path.Combine(caminho_base, nome_arquivo_imagem)

# Verifica se o arquivo existe
existe = IO.File.Exists(caminho_completo)

OUT = caminho_completo if existe else "Imagem não encontrada: {0}".format(caminho_completo)
# ----------------------------------------
file_from_path = FileObject(path=python_script)
readFromFile = Image.ReadFromFile(file=file_from_path)
string_2 = StringInput("Confirmar")
string_3 = StringInput("Selecione a Parede a ser Cortada")
string_4 = StringInput("Selecione")
categories = Categories("OST_Walls")
boolean = BoolSelector(true)
selectmodelelements_data = Custom[SelectModelElements Data](InputName=string_3, ButtonText=string_4, CategoryFilter=categories, SelectSingleElement=boolean)  # package Data-Shapes; Creates a Revit element selection input for UI.MultipleInputForm++ . Check out www.data-shapes.net for more infos!
string_5 = StringInput("Selecione o arquivo Linkado")
getLinkInstance = RevitModel.LinkedElement.GetLinkInstance()
code_block_4 = CodeBlock { 0; }
dropdown_data = Custom[DropDown Data](InputName=string_5, Keys=getLinkInstance.LinkedName, Values=getLinkInstance.Revitlinkinstance, DefaultValueIndex=code_block_4)  # package Data-Shapes; Create data for DropDown input in UI.MultiInputForm ++ . Check out www.data-shapes.net for more infos.
string_6 = StringInput("Selecione categoria que vai cortar (exemplo: Equipamento Elétrico)")
categories_2 = Categories("OST_CableTrayFitting")
categories_3 = Categories("OST_ConduitFitting")
categories_4 = Categories("OST_LightingDevices")
categories_5 = Categories("OST_ElectricalEquipment")
categories_6 = Categories("OST_ElectricalFixtures")
categories_7 = Categories("OST_LightingFixtures")
list_create = List.Create(item0=categories_2, item1=categories_3, item2=categories_4, item3=categories_5, item4=categories_6, item5=categories_7)
code_block_5 = CodeBlock { 3; }
dropdown_data_2 = Custom[DropDown Data](InputName=string_6, Keys=list_create, Values=list_create, DefaultValueIndex=code_block_5)
string_7 = StringInput("Corte Retangular ou Circular?")
code_block_6 = CodeBlock { ["Retangular","Circular"]; [1,0]; }
code_block_7 = CodeBlock { 0; }
dropdown_data_3 = Custom[DropDown Data](InputName=string_7, Keys=code_block_6.out0, Values=code_block_6.out1, DefaultValueIndex=code_block_7)
list_create_2 = List.Create(item0=selectmodelelements_data, item1=dropdown_data, item2=dropdown_data_2, item3=dropdown_data_3)
boolean_2 = BoolSelector(true)
string_8 = StringInput("Cancelar")
number = DoubleInput(480)
number_2 = DoubleInput(210)
multipleinputform = Custom[MultipleInputForm ++](Description_optional=code_block_3, Logo_optional=readFromFile, ButtonText_optional=string_2, Inputs=list_create_2, Toggle=boolean_2, CancelButtonText_optional=string_8, Width_optional=number, LabelWidth_optional=number_2)  # package Data-Shapes; Create a form with multiple inputs. see www.data-shapes.net for tutorials and infos!

# group: Separar Entradas
code_block_8 = CodeBlock { 0; }
getItemAtIndex = List.GetItemAtIndex(list=multipleinputform.User_Inputs, index=code_block_8)
code_block_9 = CodeBlock { 1; }
getItemAtIndex_2 = List.GetItemAtIndex(list=multipleinputform.User_Inputs, index=code_block_9)
code_block_10 = CodeBlock { 2; }
getItemAtIndex_3 = List.GetItemAtIndex(list=multipleinputform.User_Inputs, index=code_block_10)
code_block_11 = CodeBlock { 3; }
getItemAtIndex_4 = List.GetItemAtIndex(list=multipleinputform.User_Inputs, index=code_block_11)

# group: Categoria a cortar
python_script_2 = Python(IN[0]=getItemAtIndex_2, IN[1]=getItemAtIndex_3)  # IronPython2
# ---------- python_script_2.python (82 lines) ----------
#Desenvolvido por BIM Coder
#Versão 1.0 - 11/24

#---IMPORTAÇÕES
# Sistema e .NET
import clr
import sys
import System
from System import Array
from System.Collections.Generic import *

# Biblioteca de Geometria do Dynamo
clr.AddReference('ProtoGeometry')
from Autodesk.DesignScript.Geometry import *

# Nós do Dynamo
clr.AddReference('RevitNodes')
import Revit
clr.ImportExtensions(Revit.Elements)
clr.ImportExtensions(Revit.GeometryConversion)

# Documentos e Transações
clr.AddReference('RevitServices')
import RevitServices
from RevitServices.Persistence import DocumentManager
from RevitServices.Transactions import TransactionManager

# DB da API do Revit
import Autodesk
clr.AddReference('RevitAPI')
from Autodesk.Revit.DB import *

# Documentos e Interfaces
doc = DocumentManager.Instance.CurrentDBDocument
uiapp = DocumentManager.Instance.CurrentUIApplication
app = uiapp.Application
uidoc = uiapp.ActiveUIDocument

#---ENTRADAS

link_instance = UnwrapElement(IN[0]) # Instância do vínculo selecionada
category = (UnwrapElement(IN[1])) # Categoria do Dynamo

#---CLASSES E FUNÇÕES

# Obter a BuiltInCategory
def get_builtincategory(category):
	bic = System.Enum.GetValues(BuiltInCategory) 
	cats, bics = [], []
 	ost = None
	for i in bic:
	    try:
	        cat = Revit.Elements.Category.ById(ElementId(i).IntegerValue)
	        cats.append(cat)
	        bics.append(i)
	    except:
	        pass
	 
	for i, b in zip(cats, bics):
	    if category.Name == str(i): 
	        ost = b
	return ost

# Obter os elementos do arquivo vinculado
def get_linked_elements(link_doc, cat):
    elements = FilteredElementCollector(link_doc).OfCategory(cat).WhereElementIsNotElementType().ToElements()
    return elements


#---MAIN SCRIPT

# Documento do vínculo
link_doc = link_instance.GetLinkDocument()

# Categoria para BuiltInCategory
builtin_category = get_builtincategory(category)

# Transformação do vínculo
link_transform = link_instance.GetTotalTransform().ToCoordinateSystem(1)

# Obter os elementos
OUT = get_linked_elements(link_doc, builtin_category), link_instance, link_transform
# ----------------------------------------
code_block_12 = CodeBlock(IN=python_script_2) { IN[0]; IN[1]; IN[2]; }
getLocation = Element.GetLocation(element=code_block_12.out0)
code_block_13 = CodeBlock { 0.1; }
byCenterPointRadius = Sphere.ByCenterPointRadius(centerPoint=getLocation, radius=code_block_13)

# group: intersect
geometry = Element.Geometry(element=getItemAtIndex@L1)
doesIntersect = Geometry.DoesIntersect(geometry=byCenterPointRadius@L3, other=geometry@L1)
filterByBoolMask = List.FilterByBoolMask(list=code_block_12.out0, mask=doesIntersect@L1, lacing=Longest)
removeNulls = List.List.RemoveNulls(obj=filterByBoolMask.in)
flatten = List.Flatten(list=removeNulls)
getLocation_2 = Element.GetLocation(element=flatten)

# group: Criar abertura em torno do elemento
família_para_abertura = FamilyTypes("Corte:Corte")
faces = Element.Faces(element=getItemAtIndex)
X = Point.X(point=getLocation_2)
Y = Point.Y(point=getLocation_2)
string_9 = StringInput("Elevação do Ponto")
ʳʰʸᵗʰᵐ_elements = Rhythm.Revit.Elements.Elements.GetParameterValueByNameTypeOrInstance(element=flatten, parameterName=string_9)
Z = Point.Z(point=getLocation_2)
add = ʳʰʸᵗʰᵐ_elements + Z
byCoordinates = Point.ByCoordinates(x=X, y=Y, z=add)
code_block_14 = CodeBlock { 0.1; }
byCenterPointRadius_2 = Sphere.ByCenterPointRadius(centerPoint=byCoordinates, radius=code_block_14)
boolean_3 = BoolSelector(false)
clean = List.Clean(list=byCenterPointRadius_2, preserveIndices=boolean_3)
doesIntersect_2 = Geometry.DoesIntersect(geometry=faces, other=clean, lacing=Longest)
filterByBoolMask_2 = List.FilterByBoolMask(list=faces, mask=doesIntersect_2@L1, lacing=Longest)
flatten_2 = List.Flatten(list=filterByBoolMask_2.in)
tangentAtVParameter = Surface.TangentAtVParameter(surface=flatten_2)
byFace = FamilyInstance.ByFace(familyType=família_para_abertura, face=flatten_2, location=byCoordinates, referenceDirection=tangentAtVParameter, lacing=Longest)
clean_2 = List.Clean(list=byFace)
flatten_3 = List.Flatten(list=clean_2)
clean_3 = List.Clean(list=flatten_3)
string_10 = StringInput("Retang.")
string_11 = StringInput("DN furo")
ʳʰʸᵗʰᵐ_elements_2 = Rhythm.Revit.Elements.Elements.GetParameterValueByNameTypeOrInstance(element=flatten, parameterName=string_11)
number_3 = DoubleInput(0)
gt = ʳʰʸᵗʰᵐ_elements_2 > number_3
code_block_15 = CodeBlock { 0; 1; }
condição_if_de_lista = CodeBlock(test=gt, verd=code_block_15.out0, fals=code_block_15.out1)
# ---------- condição_if_de_lista.designscript (3 lines) ----------
//Condições IF
indx = (test) ? 0 : 1;
rslt = [verd,fals][indx];
# ----------------------------------------
ʳʰʸᵗʰᵐ_elements_3 = Rhythm.Revit.Elements.Elements.SetParameterByNameTypeOrInstance(element=clean_3, parameterName=string_10, value=condição_if_de_lista.rslt)
string_12 = StringInput("DIA")
number_4 = DoubleInput(0.008)
ʳʰʸᵗʰᵐ_elements_4 = Rhythm.Revit.Elements.Elements.SetParameterByNameTypeOrInstance(element=ʳʰʸᵗʰᵐ_elements_3, parameterName=string_12, value=number_4)
string_13 = StringInput("Altura")
string_14 = StringInput("Altura")
ʳʰʸᵗʰᵐ_elements_5 = Rhythm.Revit.Elements.Elements.GetParameterValueByNameTypeOrInstance(element=flatten, parameterName=string_14)
ʳʰʸᵗʰᵐ_elements_6 = Rhythm.Revit.Elements.Elements.SetParameterByNameTypeOrInstance(element=ʳʰʸᵗʰᵐ_elements_4, parameterName=string_13, value=ʳʰʸᵗʰᵐ_elements_5)
string_15 = StringInput("Largura")
string_16 = StringInput("Largura")
ʳʰʸᵗʰᵐ_elements_7 = Rhythm.Revit.Elements.Elements.GetParameterValueByNameTypeOrInstance(element=flatten, parameterName=string_16)
ʳʰʸᵗʰᵐ_elements_8 = Rhythm.Revit.Elements.Elements.SetParameterByNameTypeOrInstance(element=ʳʰʸᵗʰᵐ_elements_6, parameterName=string_15, value=ʳʰʸᵗʰᵐ_elements_7)
string_17 = StringInput("Profundidade")
string_18 = StringInput("Profundidade")
ʳʰʸᵗʰᵐ_elements_9 = Rhythm.Revit.Elements.Elements.GetParameterValueByNameTypeOrInstance(element=flatten, parameterName=string_18)
ʳʰʸᵗʰᵐ_elements_10 = Rhythm.Revit.Elements.Elements.SetParameterByNameTypeOrInstance(element=ʳʰʸᵗʰᵐ_elements_8, parameterName=string_17, value=ʳʰʸᵗʰᵐ_elements_9)
boolean_4 = BoolSelector(false)
replaceNull = Custom[List.ReplaceNull](seq=ʳʰʸᵗʰᵐ_elements_2, replacement=number_4)  # package Clockwork for Dynamo 2.x; Replaces all null values within a given list with a substitute
filterByBoolMask_3 = List.FilterByBoolMask(list=ʳʰʸᵗʰᵐ_elements_2, mask=gt)
byCoordinates_2 = Vector.ByCoordinates(x=X, y=Y, z=add)

clean_4 = List.Clean(list=ʳʰʸᵗʰᵐ_elements_10, preserveIndices=boolean_4)
flatten_4 = List.Flatten(list=clean_4)

# group: Mensagem Final
count = List.Count(list=flatten_4)
code_block_16 = CodeBlock { 0; }
gt_2 = count > code_block_16
code_block_17 = CodeBlock(N=count) { [""+N+" elementos cortados"]; }
code_block_18 = CodeBlock { ["Nenhum elemento cortado"]; }
if_ = If(test=gt_2, true=code_block_17, false=code_block_18)
flatten_5 = List.Flatten(list=if_)
fromList = Python(IN[0]=flatten_5)  # "String.FromList"; IronPython2
# ---------- fromList.python (22 lines) ----------
# Carregar as bibliotecas DesignScript e padrão do Python
import sys
import clr
clr.AddReference('ProtoGeometry')
from Autodesk.DesignScript.Geometry import *

# Função para concatenar os valores de uma lista em uma única string com múltiplas linhas
def concatenate_list_to_string(input_list, delimiter="\n"):
    # Verifica se a entrada é uma lista
    if not isinstance(input_list, list):
        return "A entrada deve ser uma lista."
    
    # Converte todos os elementos para string e junta com o delimitador especificado
    result = delimiter.join(str(item) for item in input_list)
    return result

# Entrada pelo nó do Dynamo
lista = IN[0]  # Lista de valores a serem concatenados
delimitador = IN[1] if len(IN) > 1 else "\n"  # Delimitador opcional, padrão é nova linha

# Saída para o Dynamo
OUT = concatenate_list_to_string(lista, delimitador)
# ----------------------------------------
python_script_3 = Python(IN[0]=fromList)  # IronPython2
# ---------- python_script_3.python (21 lines) ----------
# Importar as bibliotecas necessárias do Revit
import clr
clr.AddReference("RevitServices")
from RevitServices.Persistence import DocumentManager

clr.AddReference("RevitAPI")
clr.AddReference("RevitAPIUI")
from Autodesk.Revit.UI import TaskDialog

# Pegar a entrada do Dynamo
mensagem = IN[0]

# Criar a TaskDialog
task_dialog = TaskDialog("Ok")
task_dialog.MainInstruction = mensagem

# Exibir a TaskDialog
task_dialog.Show()

# Saída do script
OUT = "Sucesso!"
# ----------------------------------------

passThrough = Custom[PassThrough](passThrough=getItemAtIndex, waitFor=python_script_3)  # package archi-lab.net; Ripped this off from Clockwork. Sorry Andy.
passThrough_2 = Custom[PassThrough](passThrough=ʳʰʸᵗʰᵐ_elements_10, waitFor=python_script_3)
flatten_6 = List.Flatten(list=passThrough_2)
python_script_4 = Python(IN[0]=passThrough, IN[1]=flatten_6)  # IronPython2
# ---------- python_script_4.python (44 lines) ----------
import clr
clr.AddReference('RevitAPI')
from Autodesk.Revit.DB import *
from System.Collections.Generic import *
clr.AddReference("RevitServices")
import RevitServices
from RevitServices.Persistence import DocumentManager
from RevitServices.Transactions import TransactionManager

doc = DocumentManager.Instance.CurrentDBDocument
items1 = UnwrapElement(IN[0])
items2 = UnwrapElement(IN[1])

def CutGeometry(doc, item1, item2):
    try:
        SolidSolidCutUtils.AddCutBetweenSolids(doc,item1,item2)
        return True
    except:
        try:
            InstanceVoidCutUtils.AddInstanceVoidCut(doc,item1,item2)
            return True
        except:
            return False

def CutBetweenElements(doc, elements1, elements2):
    OUT = []
    for x in elements1:
        for y in elements2:
            result = CutGeometry(doc, x, y)
            OUT.append(result)
    return OUT

TransactionManager.Instance.EnsureInTransaction(doc)
if isinstance(IN[0], list):
    if isinstance(IN[1], list):
        OUT = CutBetweenElements(doc, items1, items2)
    else:
        OUT = [CutGeometry(doc, x, items2) for x in items1]
else:
    if isinstance(IN[1], list):
        OUT = [CutGeometry(doc, items1, x) for x in items2]
    else:
        OUT = CutGeometry(doc, items1, items2)
TransactionManager.Instance.TransactionTaskDone()
# ----------------------------------------
watch = Watch(python_script_4)  # graph output
