# Dynamo graph 15-3_BIMACON_Cortar Pisos e elementos do Link_R02_script.dyn "ok 2021_15-3_BIMACON_Cortar Pisos e elementos do Link_R02_script" (Dynamo 2.19.3.6394)
# author: Jose Nelson
# Corta pisos com elementos do Link
# packages: Rhythm 2023.4.2021, Data-Shapes 2022.2.105, DynaMEP 2.0.1, archi-lab.net 2023.213.1722

# group: ENTRADAS PARA O USUÁRIO
code_block = CodeBlock { "Cortar Piso com elementos do Link"; }
string = StringInput("LogoBimacon.png")
python_script = Python(IN[0]=string)  # IronPython2
# ---------- python_script.python (22 lines) ----------
import clr

# Adiciona referência ao ambiente .NET
clr.AddReference('System')
from System import Environment, IO

# Nome da imagem (entrada do usuário)
nome_arquivo_imagem = IN[0]

# Recupera o nome do usuário logado no Windows
usuario = Environment.UserName

# Monta o caminho completo para a pasta de imagens
caminho_base = r"C:\Users\{0}\AppData\Roaming\pyRevit\Extensions\Bimacon.extension\Bimacon.tab\Imagens_Bimacon".format(usuario)

# Junta o caminho base com o nome do arquivo
caminho_completo = IO.Path.Combine(caminho_base, nome_arquivo_imagem)

# Verifica se o arquivo existe
existe = IO.File.Exists(caminho_completo)

OUT = caminho_completo if existe else "Imagem não encontrada: {0}".format(caminho_completo)
# ----------------------------------------
file_from_path = FileObject(path=python_script)
readFromFile = Image.ReadFromFile(file=file_from_path)
string_2 = StringInput("Confirmar")
string_3 = StringInput("Selecione o Piso a ser Cortado")
string_4 = StringInput("Selecione")
categories = Categories("OST_Floors")
boolean = BoolSelector(true)
selectmodelelements_data = Custom[SelectModelElements Data](InputName=string_3, ButtonText=string_4, CategoryFilter=categories, SelectSingleElement=boolean)  # package Data-Shapes; Creates a Revit element selection input for UI.MultipleInputForm++ . Check out www.data-shapes.net for more infos!
string_5 = StringInput("Selecione o arquivo Linkado")
getLinkInstance = RevitModel.LinkedElement.GetLinkInstance()
code_block_2 = CodeBlock { 0; }
dropdown_data = Custom[DropDown Data](InputName=string_5, Keys=getLinkInstance.LinkedName, Values=getLinkInstance.Revitlinkinstance, DefaultValueIndex=code_block_2)  # package Data-Shapes; Create data for DropDown input in UI.MultiInputForm ++ . Check out www.data-shapes.net for more infos.
string_6 = StringInput("Selecione categoria que vai cortar (exemplo: Equipamento Elétrico)")
categories_2 = Categories("OST_CableTrayFitting")
categories_3 = Categories("OST_ConduitFitting")
categories_4 = Categories("OST_LightingDevices")
categories_5 = Categories("OST_ElectricalEquipment")
categories_6 = Categories("OST_ElectricalFixtures")
categories_7 = Categories("OST_LightingFixtures")
list_create = List.Create(item0=categories_2, item1=categories_3, item2=categories_4, item3=categories_5, item4=categories_6, item5=categories_7)
code_block_3 = CodeBlock { 3; }
dropdown_data_2 = Custom[DropDown Data](InputName=string_6, Keys=list_create, Values=list_create, DefaultValueIndex=code_block_3)
list_create_2 = List.Create(item0=selectmodelelements_data, item1=dropdown_data, item2=dropdown_data_2)
boolean_2 = BoolSelector(true)
string_7 = StringInput("Cancelar")
number = DoubleInput(480)
number_2 = DoubleInput(210)
multipleinputform = Custom[MultipleInputForm ++](Description_optional=code_block, Logo_optional=readFromFile, ButtonText_optional=string_2, Inputs=list_create_2, Toggle=boolean_2, CancelButtonText_optional=string_7, Width_optional=number, LabelWidth_optional=number_2)  # package Data-Shapes; Create a form with multiple inputs. see www.data-shapes.net for tutorials and infos!
code_block_4 = CodeBlock()  # //Data-Shapes
code_block_5 = CodeBlock()  # //archilab

# group: Separar Entradas
code_block_6 = CodeBlock { 1; }
getItemAtIndex = List.GetItemAtIndex(list=multipleinputform.User_Inputs, index=code_block_6)
code_block_7 = CodeBlock { 2; }
getItemAtIndex_2 = List.GetItemAtIndex(list=multipleinputform.User_Inputs, index=code_block_7)
code_block_8 = CodeBlock { 0; }
getItemAtIndex_3 = List.GetItemAtIndex(list=multipleinputform.User_Inputs, index=code_block_8)

# group: Categoria a cortar
python_script_2 = Python(IN[0]=getItemAtIndex, IN[1]=getItemAtIndex_2)  # IronPython2
# ---------- python_script_2.python (82 lines) ----------
#Desenvolvido por BIM Coder
#Versão 1.0 - 11/24

#---IMPORTAÇÕES
# Sistema e .NET
import clr
import sys
import System
from System import Array
from System.Collections.Generic import *

# Biblioteca de Geometria do Dynamo
clr.AddReference('ProtoGeometry')
from Autodesk.DesignScript.Geometry import *

# Nós do Dynamo
clr.AddReference('RevitNodes')
import Revit
clr.ImportExtensions(Revit.Elements)
clr.ImportExtensions(Revit.GeometryConversion)

# Documentos e Transações
clr.AddReference('RevitServices')
import RevitServices
from RevitServices.Persistence import DocumentManager
from RevitServices.Transactions import TransactionManager

# DB da API do Revit
import Autodesk
clr.AddReference('RevitAPI')
from Autodesk.Revit.DB import *

# Documentos e Interfaces
doc = DocumentManager.Instance.CurrentDBDocument
uiapp = DocumentManager.Instance.CurrentUIApplication
app = uiapp.Application
uidoc = uiapp.ActiveUIDocument

#---ENTRADAS

link_instance = UnwrapElement(IN[0]) # Instância do vínculo selecionada
category = (UnwrapElement(IN[1])) # Categoria do Dynamo

#---CLASSES E FUNÇÕES

# Obter a BuiltInCategory
def get_builtincategory(category):
	bic = System.Enum.GetValues(BuiltInCategory) 
	cats, bics = [], []
 	ost = None
	for i in bic:
	    try:
	        cat = Revit.Elements.Category.ById(ElementId(i).IntegerValue)
	        cats.append(cat)
	        bics.append(i)
	    except:
	        pass
	 
	for i, b in zip(cats, bics):
	    if category.Name == str(i): 
	        ost = b
	return ost

# Obter os elementos do arquivo vinculado
def get_linked_elements(link_doc, cat):
    elements = FilteredElementCollector(link_doc).OfCategory(cat).WhereElementIsNotElementType().ToElements()
    return elements


#---MAIN SCRIPT

# Documento do vínculo
link_doc = link_instance.GetLinkDocument()

# Categoria para BuiltInCategory
builtin_category = get_builtincategory(category)

# Transformação do vínculo
link_transform = link_instance.GetTotalTransform().ToCoordinateSystem(1)

# Obter os elementos
OUT = get_linked_elements(link_doc, builtin_category), link_instance, link_transform
# ----------------------------------------
code_block_9 = CodeBlock(IN=python_script_2) { IN[0]; IN[1]; IN[2]; }
getLocation = Element.GetLocation(element=code_block_9.out0)
code_block_10 = CodeBlock { 0.1; }
byCenterPointRadius = Sphere.ByCenterPointRadius(centerPoint=getLocation, radius=code_block_10)

# group: intersect
geometry = Element.Geometry(element=getItemAtIndex_3)
doesIntersect = Geometry.DoesIntersect(geometry=byCenterPointRadius, other=geometry@L1)
filterByBoolMask = List.FilterByBoolMask(list=code_block_9.out0@L2, mask=doesIntersect, lacing=Longest)
flatten = List.Flatten(list=filterByBoolMask.in)
getLocation_2 = Element.GetLocation(element=flatten)

# group: Criar abertura em torno do elemento
família_para_abertura = FamilyTypes("Corte:Corte")
familyInstanceByPoint = RevitModel.FamilyInstance.FamilyInstanceByPoint(point=getLocation_2, familyType=família_para_abertura)
string_8 = StringInput("Retang.")
string_9 = StringInput("Tampa Quadrada")
ʳʰʸᵗʰᵐ_elements = Rhythm.Revit.Elements.Elements.GetParameterValueByNameTypeOrInstance(element=flatten, parameterName=string_9)
ʳʰʸᵗʰᵐ_elements_2 = Rhythm.Revit.Elements.Elements.SetParameterByNameTypeOrInstance(element=familyInstanceByPoint, parameterName=string_8, value=ʳʰʸᵗʰᵐ_elements)
string_10 = StringInput("DIA")
code_block_11 = CodeBlock { 0; }
eq = ʳʰʸᵗʰᵐ_elements == code_block_11
number_3 = DoubleInput(0.3)
number_4 = DoubleInput(0.008)
if_ = If(test=eq, true=number_3, false=number_4)
ʳʰʸᵗʰᵐ_elements_3 = Rhythm.Revit.Elements.Elements.SetParameterByNameTypeOrInstance(element=familyInstanceByPoint, parameterName=string_10, value=if_)
string_11 = StringInput("Altura")
number_5 = DoubleInput(0.008)
string_12 = StringInput("Altura")
ʳʰʸᵗʰᵐ_elements_4 = Rhythm.Revit.Elements.Elements.GetParameterValueByNameTypeOrInstance(element=flatten, parameterName=string_12)
if_2 = If(test=eq, true=number_5, false=ʳʰʸᵗʰᵐ_elements_4)
ʳʰʸᵗʰᵐ_elements_5 = Rhythm.Revit.Elements.Elements.SetParameterByNameTypeOrInstance(element=ʳʰʸᵗʰᵐ_elements_3, parameterName=string_11, value=if_2)
string_13 = StringInput("Largura")
string_14 = StringInput("Largura")
ʳʰʸᵗʰᵐ_elements_6 = Rhythm.Revit.Elements.Elements.GetParameterValueByNameTypeOrInstance(element=flatten, parameterName=string_14)
if_3 = If(test=eq, true=number_5, false=ʳʰʸᵗʰᵐ_elements_6)
ʳʰʸᵗʰᵐ_elements_7 = Rhythm.Revit.Elements.Elements.SetParameterByNameTypeOrInstance(element=ʳʰʸᵗʰᵐ_elements_5, parameterName=string_13, value=if_3)
string_15 = StringInput("Profundidade")
string_16 = StringInput("Profundidade")
ʳʰʸᵗʰᵐ_elements_8 = Rhythm.Revit.Elements.Elements.GetParameterValueByNameTypeOrInstance(element=flatten, parameterName=string_16)
ʳʰʸᵗʰᵐ_elements_9 = Rhythm.Revit.Elements.Elements.SetParameterByNameTypeOrInstance(element=ʳʰʸᵗʰᵐ_elements_7, parameterName=string_15, value=ʳʰʸᵗʰᵐ_elements_8)
string_17 = StringInput("Plano de trabalho")
name = FloorType.Name(floorType=getItemAtIndex_3)
ʳʰʸᵗʰᵐ_elements_10 = Rhythm.Revit.Elements.Elements.SetParameterByNameTypeOrInstance(element=familyInstanceByPoint, parameterName=string_17, value=name)
byName = FloorType.ByName(name=name)

boolean_3 = BoolSelector(false)
clean = List.Clean(list=ʳʰʸᵗʰᵐ_elements_9, preserveIndices=boolean_3)

# group: Mensagem Final
count = List.Count(list=clean)
code_block_12 = CodeBlock { 0; }
gt = count > code_block_12
code_block_13 = CodeBlock(N=count) { [""+N+" elementos cortados"]; }
code_block_14 = CodeBlock { ["Nenhum elemento cortado"]; }
if_4 = If(test=gt, true=code_block_13, false=code_block_14)
flatten_2 = List.Flatten(list=if_4)
fromList = Python(IN[0]=flatten_2)  # "String.FromList"; IronPython2
# ---------- fromList.python (22 lines) ----------
# Carregar as bibliotecas DesignScript e padrão do Python
import sys
import clr
clr.AddReference('ProtoGeometry')
from Autodesk.DesignScript.Geometry import *

# Função para concatenar os valores de uma lista em uma única string com múltiplas linhas
def concatenate_list_to_string(input_list, delimiter="\n"):
    # Verifica se a entrada é uma lista
    if not isinstance(input_list, list):
        return "A entrada deve ser uma lista."
    
    # Converte todos os elementos para string e junta com o delimitador especificado
    result = delimiter.join(str(item) for item in input_list)
    return result

# Entrada pelo nó do Dynamo
lista = IN[0]  # Lista de valores a serem concatenados
delimitador = IN[1] if len(IN) > 1 else "\n"  # Delimitador opcional, padrão é nova linha

# Saída para o Dynamo
OUT = concatenate_list_to_string(lista, delimitador)
# ----------------------------------------
python_script_3 = Python(IN[0]=fromList)  # IronPython2
# ---------- python_script_3.python (21 lines) ----------
# Importar as bibliotecas necessárias do Revit
import clr
clr.AddReference("RevitServices")
from RevitServices.Persistence import DocumentManager

clr.AddReference("RevitAPI")
clr.AddReference("RevitAPIUI")
from Autodesk.Revit.UI import TaskDialog

# Pegar a entrada do Dynamo
mensagem = IN[0]

# Criar a TaskDialog
task_dialog = TaskDialog("Ok")
task_dialog.MainInstruction = mensagem

# Exibir a TaskDialog
task_dialog.Show()

# Saída do script
OUT = "Sucesso!"
# ----------------------------------------

passThrough = Custom[PassThrough](passThrough=getItemAtIndex_3, waitFor=python_script_3)  # package archi-lab.net; Ripped this off from Clockwork. Sorry Andy.
passThrough_2 = Custom[PassThrough](passThrough=ʳʰʸᵗʰᵐ_elements_9, waitFor=python_script_3)
flatten_3 = List.Flatten(list=passThrough_2)
python_script_4 = Python(IN[0]=passThrough, IN[1]=flatten_3)  # IronPython2
# ---------- python_script_4.python (44 lines) ----------
import clr
clr.AddReference('RevitAPI')
from Autodesk.Revit.DB import *
from System.Collections.Generic import *
clr.AddReference("RevitServices")
import RevitServices
from RevitServices.Persistence import DocumentManager
from RevitServices.Transactions import TransactionManager

doc = DocumentManager.Instance.CurrentDBDocument
items1 = UnwrapElement(IN[0])
items2 = UnwrapElement(IN[1])

def CutGeometry(doc, item1, item2):
    try:
        SolidSolidCutUtils.AddCutBetweenSolids(doc,item1,item2)
        return True
    except:
        try:
            InstanceVoidCutUtils.AddInstanceVoidCut(doc,item1,item2)
            return True
        except:
            return False

def CutBetweenElements(doc, elements1, elements2):
    OUT = []
    for x in elements1:
        for y in elements2:
            result = CutGeometry(doc, x, y)
            OUT.append(result)
    return OUT

TransactionManager.Instance.EnsureInTransaction(doc)
if isinstance(IN[0], list):
    if isinstance(IN[1], list):
        OUT = CutBetweenElements(doc, items1, items2)
    else:
        OUT = [CutGeometry(doc, x, items2) for x in items1]
else:
    if isinstance(IN[1], list):
        OUT = [CutGeometry(doc, items1, x) for x in items2]
    else:
        OUT = CutGeometry(doc, items1, items2)
TransactionManager.Instance.TransactionTaskDone()
# ----------------------------------------
watch = Watch(python_script_4)  # graph output
