# Dynamo graph Nome-da-rotina_script.dyn "Extensao1" (Dynamo 2.16.2.5624)

string = StringInput("Olá! Essa é uma mensagem de teste.")
python_script = Python(IN[0]=string)  # IronPython2
# ---------- python_script.python (21 lines) ----------
# Importar as bibliotecas necessárias do Revit
import clr
clr.AddReference("RevitServices")
from RevitServices.Persistence import DocumentManager

clr.AddReference("RevitAPI")
clr.AddReference("RevitAPIUI")
from Autodesk.Revit.UI import TaskDialog

# Pegar a entrada do Dynamo
mensagem = IN[0]

# Criar a TaskDialog
task_dialog = TaskDialog("Mensagem do Dynamo")
task_dialog.MainInstruction = mensagem

# Exibir a TaskDialog
task_dialog.Show()

# Saída do script
OUT = "TaskDialog exibida com sucesso!"
# ----------------------------------------
