# Dynamo graph 2021_15-2_BIMACON_Cortar Parede e medidores do Link_R01_script.dyn "2021_15-2_BIMACON_Cortar Paredes e elementos do Link_R01" (Dynamo 2.6.1.8786)
# packages: Rhythm 2023.4.2021, bimorphNodes 4.2.4, spring nodes 210.1.1, Orchid 2.6.10.6373, Data-Shapes 2022.2.105, DynaMEP 2.0.1

string = StringInput("Selecione a Parede a ser Cortada")
string_2 = StringInput("Selecione")
categories = Categories("OST_Walls")
boolean = BoolSelector(true)
selectmodelelements_data = Custom[SelectModelElements Data](InputName=string, ButtonText=string_2, CategoryFilter=categories, SelectSingleElement=boolean)  # package Data-Shapes; Creates a Revit element selection input for UI.MultipleInputForm++ . Check out www.data-shapes.net for more infos!
string_3 = StringInput("Selecione o arquivo Linkado")
getLinkInstance = RevitModel.LinkedElement.GetLinkInstance()
code_block = CodeBlock { 0; }
dropdown_data = Custom[DropDown Data](InputName=string_3, Keys=getLinkInstance.LinkedName, Values=getLinkInstance.Revitlinkinstance, DefaultValueIndex=code_block)  # package Data-Shapes; Create data for DropDown input in UI.MultiInputForm ++ . Check out www.data-shapes.net for more infos.

# group: ENTRADAS PARA O USUÁRIO
code_block_2 = CodeBlock { "Cortar Paredes com elementos do Link"; }
file_path = Filename("..\..\..\..\..\05 - BIMACON\01 - EMPRESA BIMACON\00 - Logos e imagens - BIMACON\ARTE BIMACON\reddonda-removebg-preview.png")
file_from_path = FileObject(path=file_path)
readFromFile = Image.ReadFromFile(file=file_from_path)
string_4 = StringInput("Confirmar")
string_5 = StringInput("Selecione categoria que vai cortar (exemplo: Equipamento Elétrico)")
categories_2 = Categories("OST_CableTrayFitting")
categories_3 = Categories("OST_ConduitFitting")
categories_4 = Categories("OST_LightingDevices")
categories_5 = Categories("OST_ElectricalEquipment")
categories_6 = Categories("OST_ElectricalFixtures")
categories_7 = Categories("OST_LightingFixtures")
list_create = List.Create(item0=categories_2, item1=categories_3, item2=categories_4, item3=categories_5, item4=categories_6, item5=categories_7)
code_block_3 = CodeBlock { 3; }
dropdown_data_2 = Custom[DropDown Data](InputName=string_5, Keys=list_create, Values=list_create, DefaultValueIndex=code_block_3)
list_create_2 = List.Create(item0=selectmodelelements_data, item1=dropdown_data, item2=dropdown_data_2)
boolean_2 = BoolSelector(true)
string_6 = StringInput("Cancelar")
number = DoubleInput(480)
number_2 = DoubleInput(210)
multipleinputform = Custom[MultipleInputForm ++](Description_optional=code_block_2, Logo_optional=readFromFile, ButtonText_optional=string_4, Inputs=list_create_2, Toggle=boolean_2, CancelButtonText_optional=string_6, Width_optional=number, LabelWidth_optional=number_2)  # package Data-Shapes; Create a form with multiple inputs. see www.data-shapes.net for tutorials and infos!
code_block_4 = CodeBlock()  # //Data-Shapes
code_block_5 = CodeBlock()  # //archilab

# group: Separar Entradas
code_block_6 = CodeBlock { 0; }
getItemAtIndex = List.GetItemAtIndex(list=multipleinputform.User_Inputs, index=code_block_6)
code_block_7 = CodeBlock { 1; }
getItemAtIndex_2 = List.GetItemAtIndex(list=multipleinputform.User_Inputs, index=code_block_7)
code_block_8 = CodeBlock { 2; }
getItemAtIndex_3 = List.GetItemAtIndex(list=multipleinputform.User_Inputs, index=code_block_8)

# group: Categoria a cortar
ofCategory = Revit.LinkElement.OfCategory(linkInstance=getItemAtIndex_2, category=getItemAtIndex_3)
getLocation = Element.GetLocation(element=ofCategory)

# group: intersect
geometry = Element.Geometry(element=getItemAtIndex)
doesIntersect = Geometry.DoesIntersect(geometry=getLocation, other=geometry@L1)
filterByBoolMask = List.FilterByBoolMask(list=ofCategory@L2, mask=doesIntersect, lacing=Longest)
flatten = List.Flatten(list=filterByBoolMask.in)
getLocation_2 = Element.GetLocation(element=flatten)

# group: Criar abertura em torno do elemento
família_para_abertura = FamilyTypes("Corte parede:Corte parede")  # graph input
ZAxis = Vector.ZAxis()
string_7 = StringInput("Elevação do Ponto")
ʳʰʸᵗʰᵐ_elements = Rhythm.Revit.Elements.Elements.GetParameterValueByNameTypeOrInstance(element=flatten, parameterName=string_7)
string_8 = StringInput("Altura")
ʳʰʸᵗʰᵐ_elements_2 = Rhythm.Revit.Elements.Elements.GetParameterValueByNameTypeOrInstance(element=flatten, parameterName=string_8)
code_block_9 = CodeBlock(a=ʳʰʸᵗʰᵐ_elements, b=ʳʰʸᵗʰᵐ_elements_2) { a-b/2; }
string_9 = StringInput("Altura")
string_10 = StringInput("Largura")
string_11 = StringInput("Largura")
ʳʰʸᵗʰᵐ_elements_3 = Rhythm.Revit.Elements.Elements.GetParameterValueByNameTypeOrInstance(element=flatten, parameterName=string_11)
string_12 = StringInput("Profundidade")
string_13 = StringInput("Profundidade")
ʳʰʸᵗʰᵐ_elements_4 = Rhythm.Revit.Elements.Elements.GetParameterValueByNameTypeOrInstance(element=flatten, parameterName=string_13)

clean = List.Clean(list=code_block_9)

# group (continued): Criar abertura em torno do elemento
translate = Geometry.Translate(geometry=getLocation_2, direction=ZAxis, distance=clean)
ꟿ_familyinstance_byhostandpoint = Custom[ꟿ FamilyInstance.ByHostAndPoint](host=getItemAtIndex, type=família_para_abertura, point=translate)  # package spring nodes; Creates hosted family instances(doors/windows) at the specified points. You can feed either a single family type or a unique type for each instance.
ʳʰʸᵗʰᵐ_elements_5 = Rhythm.Revit.Elements.Elements.SetParameterByNameTypeOrInstance(element=ꟿ_familyinstance_byhostandpoint, parameterName=string_9, value=ʳʰʸᵗʰᵐ_elements_2, lacing=Longest)
ʳʰʸᵗʰᵐ_elements_6 = Rhythm.Revit.Elements.Elements.SetParameterByNameTypeOrInstance(element=ʳʰʸᵗʰᵐ_elements_5, parameterName=string_10, value=ʳʰʸᵗʰᵐ_elements_3, lacing=Longest)
ʳʰʸᵗʰᵐ_elements_7 = Rhythm.Revit.Elements.Elements.SetParameterByNameTypeOrInstance(element=ʳʰʸᵗʰᵐ_elements_6, parameterName=string_12, value=ʳʰʸᵗʰᵐ_elements_4, lacing=Longest)

clean_2 = List.Clean(list=ʳʰʸᵗʰᵐ_elements_7)

# group: Mensagem Final
count = List.Count(list=clean_2)
code_block_10 = CodeBlock { 0; }
gt = count > code_block_10
code_block_11 = CodeBlock(N=count) { [""+N+" elementos cortados"]; }
code_block_12 = CodeBlock { ["Nenhum elemento cortado"]; }
if_ = If(test=gt, true=code_block_11, false=code_block_12)

flatten_2 = List.Flatten(list=if_)
o_string_fromlist = Orchid.Common.String.FromList(list=flatten_2)
python_script = Python(IN[0]=o_string_fromlist)
# ---------- python_script.python (21 lines) ----------
# Importar as bibliotecas necessárias do Revit
import clr
clr.AddReference("RevitServices")
from RevitServices.Persistence import DocumentManager

clr.AddReference("RevitAPI")
clr.AddReference("RevitAPIUI")
from Autodesk.Revit.UI import TaskDialog

# Pegar a entrada do Dynamo
mensagem = IN[0]

# Criar a TaskDialog
task_dialog = TaskDialog("Ok")
task_dialog.MainInstruction = mensagem

# Exibir a TaskDialog
task_dialog.Show()

# Saída do script
OUT = "Sucesso!"
# ----------------------------------------
categories_8 = Categories("OST_ConduitFitting")
categories_9 = Categories("OST_ElectricalEquipment")
categories_10 = Categories("OST_LightingFixtures")
list_create_3 = List.Create(item0=categories_8, item1=categories_9, item2=categories_10)
flatten_3 = List.Flatten(list=list_create_3)
