# Dynamo graph 11-1_BIMACON_Isolar Eletrodutos Desconectados na Vista_R03_script.dyn "ok 2021_11-1_BIMACON_Isolar Eletrodutos Desconectados na Vista_R03_script" (Dynamo 2.19.3.6394)
# author: Jose Nelson
# Isola e destaca os Elementos desconectados
# packages: Clockwork for Dynamo 2.x 2.4.0, Crumple 2021.9.24, MEPover 2022.10.30, DynaMEP 2.0.1, bimorphNodes 4.2.4

# group: Selecionar caixas
categories = Categories("OST_ElectricalFixtures")
all_elements_of_category = ElementsOfCategory(Category=categories)
categories_2 = Categories("OST_LightingDevices")
all_elements_of_category_2 = ElementsOfCategory(Category=categories_2)
categories_3 = Categories("OST_ElectricalEquipment")
all_elements_of_category_3 = ElementsOfCategory(Category=categories_3)
categories_4 = Categories("OST_ConduitFitting")
all_elements_of_category_4 = ElementsOfCategory(Category=categories_4)
list_create = List.Create(item0=all_elements_of_category, item1=all_elements_of_category_2, item2=all_elements_of_category_3, item3=all_elements_of_category_4)

flatten = List.Flatten(list=list_create)
uniqueItems = List.UniqueItems(list=flatten)

# group: Conduites desconectados
categories_5 = Categories("OST_Conduit")
all_elements_of_category_5 = ElementsOfCategory(Category=categories_5)
connectors = RevitModel.Element.Connectors(elements=all_elements_of_category_5)
isConnected = MEP.Connectors.IsConnected(connector=connectors)
filterByBoolMask = List.FilterByBoolMask(list=connectors, mask=isConnected)
flatten_2 = List.Flatten(list=filterByBoolMask.in)
flatten_3 = List.Flatten(list=filterByBoolMask.out)

owner = MEP.Connectors.Owner(connector=flatten_2)
uniqueItems_2 = List.UniqueItems(list=owner)
owner_2 = MEP.Connectors.Owner(connector=flatten_3)
uniqueItems_3 = List.UniqueItems(list=owner_2)

# group: Limpar Sobreposição
desfazer_sobreposição = BoolSelector(false)  # graph input
list_create_2 = List.Create(item0=uniqueItems, item1=uniqueItems_2, item2=uniqueItems_3)
empty = List.Empty()
condição_if = CodeBlock(x=desfazer_sobreposição, verd=list_create_2, fals=empty) { indx = (x) ? 0 : 1; rslt = [verd,fals][indx]; }
currentview = Custom[© CurrentView]()  # package Crumple; Given the current document, return the active view.
resetElementOverrides = Custom[View.ResetElementOverrides](element=condição_if.rslt, view=currentview)  # package Clockwork for Dynamo 2.x; Resets all overrides for an element in a given view
watch = Watch(resetElementOverrides.element)

code_block = CodeBlock { 0; }
location = MEP.Connectors.Location(connector=flatten_3)

# group: Curvas Desconectadas
categories_6 = Categories("OST_ConduitFitting")
all_elements_of_category_6 = ElementsOfCategory(Category=categories_6)
name = Element.Name(element=all_elements_of_category_6)
code_block_2 = CodeBlock { "Curva"; }
contains = String.Contains(string=name, searchFor=code_block_2)
filterByBoolMask_2 = List.FilterByBoolMask(list=all_elements_of_category_6, mask=contains)
flatten_4 = List.Flatten(list=filterByBoolMask_2.in)
connectors_2 = Custom[Element.Connectors](element=flatten_4)  # package MEPover; Returns every connector on an element (also return connectors of a System)
isConnected_2 = MEP.Connectors.IsConnected(connector=connectors_2)
filterByBoolMask_3 = List.FilterByBoolMask(list=connectors_2, mask=isConnected_2)
flatten_5 = List.Flatten(list=filterByBoolMask_3.out)

owner_3 = MEP.Connectors.Owner(connector=flatten_5)

# group: Filtrar caixas
solids = Element.Solids(element=owner_2)
code_block_3 = CodeBlock { 0.03; }
byCenterPointRadius = Sphere.ByCenterPointRadius(centerPoint=location, radius=code_block_3)
intersectsSolid = Revit.Element.IntersectsSolid(solids=byCenterPointRadius, elements=flatten)
intersectingElements = Results.SolidIntersectionResult.IntersectingElements(solidIntersectionResult=intersectsSolid)
boolean = BoolSelector(true)
clean = List.Clean(list=intersectingElements, preserveIndices=boolean)
flatten_6 = List.Flatten(list=clean)
list_create_3 = List.Create(item0=flatten_6, item1=owner_2, item2=owner_3)

# group: excluir ocultar
flatten_7 = List.Flatten(list=list_create_3)
string = StringInput("Tipo de Sistema")
getParameterValueByName = Element.GetParameterValueByName(element=flatten_7, parameterName=string)
string_2 = StringInput("Ocultar")
eq = getParameterValueByName == string_2
filterByBoolMask_4 = List.FilterByBoolMask(list=flatten_7, mask=eq)

# group: Cor
color_palette = ColorPalette({R: 255, G: 0, B: 0, A: 255})
color_palette_2 = ColorPalette({R: 255, G: 0, B: 0, A: 255})
color_palette_3 = ColorPalette({R: 255, G: 0, B: 0, A: 255})
color_palette_4 = ColorPalette({R: 0, G: 0, B: 0, A: 255})

# group: Hachura
fill_patterns = FillPatterns("<Preenchimento sólido>")
fill_patterns_2 = FillPatterns("<Preenchimento sólido>")

# group: Linhas Hachura
line_patterns = LinePatterns("Alinhamento")
line_patterns_2 = LinePatterns("Alinhamento")

# group: Espessura da linha
number_slider = DoubleSlider(2, range=0..100 step 1)
number_slider_2 = DoubleSlider(2, range=0..100 step 1)

# group: Transparência
number_slider_3 = DoubleSlider(0, range=0..100 step 1)

# group: Nível de Detalhe
detail_level = DetailLevel("Fine")

boolean_2 = BoolSelector(false)

# group: Sobreposição de Gráficos
byProperties = Revit.Filter.OverrideGraphicSettings.ByProperties(cutFillColor=color_palette, projectionFillColor=color_palette_2, cutLineColor=color_palette_3, projectionLineColor=color_palette_4, cutFillPattern=fill_patterns, projectionFillPattern=fill_patterns_2, cutLinePattern=line_patterns, projectionLinePattern=line_patterns_2, cutLineWeight=number_slider, projectionLineWeight=number_slider_2, transparency=number_slider_3, detailLevel=detail_level, halftone=boolean_2)
overrideInView = Element.OverrideInView(element=filterByBoolMask_4.out, overrides=byProperties)

# group: Curvas e conduites desconectados
string_from_object = FromObject(obj=overrideInView)
code_block_4 = CodeBlock { "Curva"; }
contains_2 = String.Contains(string=string_from_object, searchFor=code_block_4)
filterByBoolMask_5 = List.FilterByBoolMask(list=string_from_object, mask=contains_2)
flatten_8 = List.Flatten(list=filterByBoolMask_5.in)
string_from_object_2 = FromObject(obj=overrideInView)
code_block_5 = CodeBlock { "Conduit"; }
contains_3 = String.Contains(string=string_from_object_2, searchFor=code_block_5)
filterByBoolMask_6 = List.FilterByBoolMask(list=string_from_object_2, mask=contains_3)
flatten_9 = List.Flatten(list=filterByBoolMask_6.in)
list_create_4 = List.Create(item0=flatten_8, item1=flatten_9)
flatten_10 = List.Flatten(list=list_create_4)

# group: Mensagem Final
count = List.Count(list=flatten_10)
code_block_6 = CodeBlock { 0; }
code_block_7 = CodeBlock { ["Sobreposição desfeita"]; }

code_block_8 = CodeBlock(test=desfazer_sobreposição, z=code_block, y=count)
# ---------- code_block_8.designscript (2 lines) ----------
//Condições IF, OR, AND
test == true ? z : y;
# ----------------------------------------

# group (continued): Mensagem Final
gt = code_block_8 > code_block_6
code_block_9 = CodeBlock(N=code_block_8) { [""+N+" elementos desconectados"]; }
if_ = If(test=gt, true=code_block_9, false=code_block_7)
flatten_11 = List.Flatten(list=if_)
fromList = Python(IN[0]=flatten_11)  # "String.FromList"; IronPython2
# ---------- fromList.python (22 lines) ----------
# Carregar as bibliotecas DesignScript e padrão do Python
import sys
import clr
clr.AddReference('ProtoGeometry')
from Autodesk.DesignScript.Geometry import *

# Função para concatenar os valores de uma lista em uma única string com múltiplas linhas
def concatenate_list_to_string(input_list, delimiter="\n"):
    # Verifica se a entrada é uma lista
    if not isinstance(input_list, list):
        return "A entrada deve ser uma lista."
    
    # Converte todos os elementos para string e junta com o delimitador especificado
    result = delimiter.join(str(item) for item in input_list)
    return result

# Entrada pelo nó do Dynamo
lista = IN[0]  # Lista de valores a serem concatenados
delimitador = IN[1] if len(IN) > 1 else "\n"  # Delimitador opcional, padrão é nova linha

# Saída para o Dynamo
OUT = concatenate_list_to_string(lista, delimitador)
# ----------------------------------------
python_script = Python(IN[0]=fromList)  # IronPython2
# ---------- python_script.python (21 lines) ----------
# Importar as bibliotecas necessárias do Revit
import clr
clr.AddReference("RevitServices")
from RevitServices.Persistence import DocumentManager

clr.AddReference("RevitAPI")
clr.AddReference("RevitAPIUI")
from Autodesk.Revit.UI import TaskDialog

# Pegar a entrada do Dynamo
mensagem = IN[0]

# Criar a TaskDialog
task_dialog = TaskDialog("Ok")
task_dialog.MainInstruction = mensagem

# Exibir a TaskDialog
task_dialog.Show()

# Saída do script
OUT = "Sucesso!"
# ----------------------------------------

# group: Ocultar/Exibir
currentview_2 = Custom[© CurrentView]()
flatten_12 = List.Flatten(list=overrideInView)
temporarilyIsolateElement = Custom[View.TemporarilyIsolateElement](view=currentview_2, element=flatten_12)  # package Clockwork for Dynamo 2.x; Temporarily isolates elements in the given view
filterByBoolMask_7 = List.FilterByBoolMask(list=temporarilyIsolateElement.view, mask=desfazer_sobreposição)
disableTemporaryHideIsolate = Custom[View.DisableTemporaryHideIsolate](view=filterByBoolMask_7.in@L1)  # package Clockwork for Dynamo 2.x; Disables the temporary hide/isolate for the given view (if set)
