# Dynamo graph 19-0_BIMACON_Escala Simbolos_R02_script.dyn (Dynamo 2.6.1.8786)
# Inseri Tags de comandos dos Interruptores
# packages: Data-Shapes 2022.2.105, BIMCoder Nodes - 2.X 2025.4.0

# group: SELECIONE O MODELO DE TAGS
code_block = CodeBlock()  # //archilab
code_block_2 = CodeBlock()  # //Data-Shapes
code_block_3 = CodeBlock { 0; }
code_block_4 = CodeBlock { "Alterar Escala Símbolos"; }
string = StringInput("LogoBimacon.png")
python_script = Python(IN[0]=string)
# ---------- python_script.python (22 lines) ----------
import clr

# Adiciona referência ao ambiente .NET
clr.AddReference('System')
from System import Environment, IO

# Nome da imagem (entrada do usuário)
nome_arquivo_imagem = IN[0]

# Recupera o nome do usuário logado no Windows
usuario = Environment.UserName

# Monta o caminho completo para a pasta de imagens
caminho_base = r"C:\Users\{0}\AppData\Roaming\pyRevit\Extensions\Bimacon.extension\Bimacon.tab\Imagens_Bimacon".format(usuario)

# Junta o caminho base com o nome do arquivo
caminho_completo = IO.Path.Combine(caminho_base, nome_arquivo_imagem)

# Verifica se o arquivo existe
existe = IO.File.Exists(caminho_completo)

OUT = caminho_completo if existe else "Imagem não encontrada: {0}".format(caminho_completo)
# ----------------------------------------
file_from_path = FileObject(path=python_script)
readFromFile = Image.ReadFromFile(file=file_from_path)
string_2 = StringInput("Confirmar")
code_block_5 = CodeBlock { "Digite a Escala (Ex:50)"; }
string_3 = StringInput("50")
boolean = BoolSelector(true)
textbox_data = Custom[TextBox Data](InputName=code_block_5, DefaultText=string_3, IsNumberEntry=boolean)  # package Data-Shapes; Create Data for TextBox input in UI.MultipleInputForm ++ . Check out www.data-shapes.net for more informations
list_create = List.Create(item0=textbox_data)
boolean_2 = BoolSelector(true)
string_4 = StringInput("Cancelar")
number = DoubleInput(400)
number_2 = DoubleInput(185)
multipleinputform = Custom[MultipleInputForm ++](Description_optional=code_block_4, Logo_optional=readFromFile, ButtonText_optional=string_2, Inputs=list_create, Toggle=boolean_2, CancelButtonText_optional=string_4, Width_optional=number, LabelWidth_optional=number_2)  # package Data-Shapes; Create a form with multiple inputs. see www.data-shapes.net for tutorials and infos!

# group: Separar Entradas
code_block_6 = CodeBlock { 0; }
getItemAtIndex = List.GetItemAtIndex(list=multipleinputform.User_Inputs, index=code_block_6)

# group: Filtrar Elementos não Tagueados
categories = Categories("OST_ElectricalFixtures")
categories_2 = Categories("OST_LightingDevices")
categories_3 = Categories("OST_CommunicationDevices")
categories_4 = Categories("OST_DataDevices")
categories_5 = Categories("OST_TelephoneDevices")
categories_6 = Categories("OST_LightingFixtures")
categories_7 = Categories("OST_ConduitFitting")
categories_8 = Categories("OST_ElectricalEquipment")
categories_9 = Categories("OST_CableTrayFitting")
categories_10 = Categories("OST_MechanicalEquipment")
list_create_2 = List.Create(item0=categories, item1=categories_2, item2=categories_3, item3=categories_4, item4=categories_5, item5=categories_6, item6=categories_7, item7=categories_8, item8=categories_9, item9=categories_10)
current = Document.Current()
activeView = Document.ActiveView(document=current)
all_elements_of_category_in_view = ElementsOfCategoryInView(Category=list_create_2, View=activeView)
flatten = List.Flatten(list=all_elements_of_category_in_view)
parametro_escala_simbolo = Python(IN[0]=flatten)
# ---------- parametro_escala_simbolo.python (47 lines) ----------
import clr
clr.AddReference('RevitAPI')
from Autodesk.Revit.DB import *

elems = UnwrapElement(IN[0])
out_elems = []

# nomes possíveis (em minúsculo)
termos = [
    "escala símbolo",
    "escala simbolo",
    "escala do símbolo",
    "escala do simbolo"
]

for e in elems:
    try:
        # Ignora elementos aninhados (subcomponentes)
        if hasattr(e, "SuperComponent") and e.SuperComponent is not None:
            continue

        # percorre os parâmetros do elemento
        for p in e.Parameters:
            if not p.Definition:
                continue

            nome = p.Definition.Name.lower()

            # verifica se o nome do parâmetro é um dos procurados
            if any(t in nome for t in termos):
                val = None
                try:
                    val = p.AsDouble()
                except:
                    try:
                        val = float(p.AsValueString())
                    except:
                        pass

                # verifica se o valor é numérico e > 0
                if val is not None and val > 0:
                    out_elems.append(e)
                    break
    except:
        pass

OUT = out_elems
# ----------------------------------------
altera_parametro_escala_simbolo = Python(IN[0]=parametro_escala_simbolo, IN[1]=getItemAtIndex)
# ---------- altera_parametro_escala_simbolo.python (58 lines) ----------
import clr
clr.AddReference('RevitAPI')
clr.AddReference('RevitServices')
from Autodesk.Revit.DB import *
from RevitServices.Persistence import DocumentManager
from RevitServices.Transactions import TransactionManager

# Documento ativo
doc = DocumentManager.Instance.CurrentDBDocument

# Entradas
elems = UnwrapElement(IN[0])  # Lista de elementos
escala = float(IN[1])         # Valor da escala (ex: 75)

# Configurações base
escala_base = 50.0
valor_base_m = 0.001

# Cálculo do novo valor (inversamente proporcional à escala)
valor_novo_m = valor_base_m * (escala_base / escala)

# Converte de metros para unidade interna (pés)
proj_units = doc.GetUnits()
length_unit = proj_units.GetFormatOptions(SpecTypeId.Length).GetUnitTypeId()
valor_interno = UnitUtils.ConvertToInternalUnits(valor_novo_m, length_unit)

# Parâmetros possíveis
termos = [
    "escala símbolo",
    "escala simbolo",
    "escala do símbolo",
    "escala do simbolo"
]

TransactionManager.Instance.EnsureInTransaction(doc)

for e in elems:
    try:
        # ignora elementos aninhados
        if hasattr(e, "SuperComponent") and e.SuperComponent is not None:
            continue

        for p in e.Parameters:
            if not p.Definition:
                continue
            nome = p.Definition.Name.lower()
            if any(t in nome for t in termos):
                try:
                    p.Set(valor_interno)
                except:
                    pass
                break
    except:
        pass

TransactionManager.Instance.TransactionTaskDone()

OUT = "Escala {} → Escala Símbolo ajustada para {:.6f} m".format(escala, valor_novo_m)
# ----------------------------------------

# group: Condição If
code_block_7 = CodeBlock { "Nenhuma escala atribuida"; }
code_block_8 = CodeBlock { null; }
eq = getItemAtIndex == code_block_8
dialog_simple = Custom[👓 Dialog․Simple](message=code_block_7, toggle=eq)  # package BIMCoder Nodes - 2.X; Exibe uma mensagem de alerta ao usuário, sem botões de ação.
