# Dynamo graph 2021_10-4_BIMACON_Excluir Todos Identificadores_R00_script.dyn "2021_10-4_BIMACON_Excluir Todos Identificadores_R00" (Dynamo 2.6.1.8786)
# Exclui os Códigos de  Identificadores de todas conexões.
# packages: DynaMEP 2.0.1, Orchid 2.6.8.6198

categories = Categories("OST_CableTrayFitting")
categories_2 = Categories("OST_ConduitFitting")
list_create = List.Create(item0=categories, item1=categories_2)
all_elements_of_category = ElementsOfCategory(Category=list_create)
nome_do_parâmetro = StringInput("Identificador")  # graph input
getParameterValueByName = Element.GetParameterValueByName(element=all_elements_of_category, parameterName=nome_do_parâmetro)
code_block = CodeBlock { ""; }
eq = getParameterValueByName == code_block
filterByBoolMask = List.FilterByBoolMask(list=all_elements_of_category, mask=eq)
nome_do_parâmetro_2 = StringInput("Identificador")  # graph input
string = StringInput("")
setParameterValueByName = RevitModel.Element.SetParameterValueByName(element=filterByBoolMask.out, parameterName=nome_do_parâmetro_2, values=string)
flatten = List.Flatten(list=setParameterValueByName)

# group: Mensagem
count = List.Count(list=flatten)
code_block_2 = CodeBlock { 0; }
gt = count > code_block_2
code_block_3 = CodeBlock(N=count) { ["Feito! você deletou "+N+" Identificadores"]; }
code_block_4 = CodeBlock { ["Nenhum Identificador foi deletado"]; }
if_ = If(test=gt, true=code_block_3, false=code_block_4)
flatten_2 = List.Flatten(list=if_)
o_string_fromlist = Orchid.Common.String.FromList(list=flatten_2)
python_script = Python(IN[0]=o_string_fromlist)
# ---------- python_script.python (21 lines) ----------
# Importar as bibliotecas necessárias do Revit
import clr
clr.AddReference("RevitServices")
from RevitServices.Persistence import DocumentManager

clr.AddReference("RevitAPI")
clr.AddReference("RevitAPIUI")
from Autodesk.Revit.UI import TaskDialog

# Pegar a entrada do Dynamo
mensagem = IN[0]

# Criar a TaskDialog
task_dialog = TaskDialog("Ok")
task_dialog.MainInstruction = mensagem

# Exibir a TaskDialog
task_dialog.Show()

# Saída do script
OUT = "Sucesso!"
# ----------------------------------------
