# Dynamo graph 2021_10-2_BIMACON_Atribuir Código em Conexões_R02_script.dyn "2023_10-2_BIMACON_Atribuir Código em Conexões_R02" (Dynamo 2.16.2.5624)
# author: José Nelson Bimacon
# Inseri Identificadores nas conexões
# packages: Data-Shapes 2022.2.105, archi-lab.net 2023.213.1722

categories = Categories("OST_ConduitFitting")
categories_2 = Categories("OST_CableTrayFitting")
list_create = List.Create(item0=categories, item1=categories_2)
all_elements_of_category = ElementsOfCategory(Category=list_create)
elementType = Element.ElementType(element=all_elements_of_category)
string = StringInput("Comentários de tipos")
getParameterValueByName = Element.GetParameterValueByName(element=elementType, parameterName=string)

# group: Janela de Imputs
string_2 = StringInput("Inserir Identificadores em conexões")
file_path = Filename("C:\Users\jneng\Documents\logo.png")
file_from_path = FileObject(path=file_path)
readFromFile = Image.ReadFromFile(file=file_from_path)
string_3 = StringInput("Executar")
string_4 = StringInput("Selecione o \"Comentário de tipo\":")
code_block = CodeBlock()
# ---------- code_block.designscript (14 lines) ----------
"PVC Roscável Preto";
"PVC Corrugado Amarelo";
"PVC Corrugado Azul";
"PVC Corrugado Cinza";
"PVC Corrugado Laranja Reforçado";
"PVC Condulete TOP";
"Conduletes de Aluminio";
"Conduletes sem Rosca";
"Derivações de Eletrodutos com Rosca BSP";
"Derivações de Eletrocalhas";
"Derivações de Perfilados";
"Derivações de Leitos";
"PEAD Corrugado";
"Caixas de Passagem Elétrica";
# ----------------------------------------
list_create_2 = List.Create(item0=code_block.out0, item1=code_block.out1, item2=code_block.out2, item3=code_block.out3, item4=code_block.out4, item5=code_block.out5, item6=code_block.out6, item7=code_block.out7, item8=code_block.out8, item9=code_block.out9, item10=code_block.out10, item11=code_block.out11, item12=code_block.out12, item13=code_block.out13)
number = DoubleInput(0)
dropdown_data = Custom[DropDown Data](InputName=string_4, Keys=list_create_2, Values=list_create_2, DefaultValueIndex=number)  # package Data-Shapes; Create data for DropDown input in UI.MultiInputForm ++ . Check out www.data-shapes.net for more infos.
string_5 = StringInput("Indique o Prefixo. Ex: \"R\"")
string_6 = StringInput("R")
boolean = BoolSelector(false)
textbox_data = Custom[TextBox Data](InputName=string_5, DefaultText=string_6, IsNumberEntry=boolean)  # package Data-Shapes; Create Data for TextBox input in UI.MultipleInputForm ++ . Check out www.data-shapes.net for more informations
list_create_3 = List.Create(item0=dropdown_data, item1=textbox_data)
boolean_2 = BoolSelector(true)
string_7 = StringInput("http://bimacon.wix.com/bimacon")
string_8 = StringInput("Cancelar")
number_2 = DoubleInput(500)
number_3 = DoubleInput(220)
multipleinputform = Custom[MultipleInputForm ++](Description_optional=string_2, Logo_optional=readFromFile, ButtonText_optional=string_3, Inputs=list_create_3, Toggle=boolean_2, LinkToHelp_optional=string_7, CancelButtonText_optional=string_8, Width_optional=number_2, LabelWidth_optional=number_3)  # package Data-Shapes; Create a form with multiple inputs. see www.data-shapes.net for tutorials and infos!

code_block_2 = CodeBlock(IN=multipleinputform.User_Inputs) { texto1 = IN[0]; texto2 = IN[1]; }
contains = String.Contains(string=getParameterValueByName, searchFor=code_block_2.texto1)
filterByBoolMask = List.FilterByBoolMask(list=elementType, mask=contains)
byFamilyType = FamilyInstance.ByFamilyType(familyType=filterByBoolMask.in)
uniqueItems = List.UniqueItems(list=byFamilyType@L3)
elementType_2 = Element.ElementType(element=uniqueItems)
flatten = List.Flatten(list=elementType_2)
name = Family.Name(family=flatten)
string_9 = StringInput("generica")
contains_2 = String.Contains(string=name, searchFor=string_9)
filterByBoolMask_2 = List.FilterByBoolMask(list=flatten, mask=contains_2)
string_10 = StringInput("Descrição do Material")
getParameterValueByName_2 = Element.GetParameterValueByName(element=filterByBoolMask_2.out, parameterName=string_10)
isNullOrWhiteSpace = archilab.Core.Strings.IsNullOrWhiteSpace(str=getParameterValueByName_2)
filterByBoolMask_3 = List.FilterByBoolMask(list=filterByBoolMask_2.out, mask=isNullOrWhiteSpace)
flatten_2 = List.Flatten(list=uniqueItems)
name_2 = Family.Name(family=flatten_2)
string_11 = StringInput("generica")
contains_3 = String.Contains(string=name_2, searchFor=string_11)
filterByBoolMask_4 = List.FilterByBoolMask(list=flatten_2, mask=contains_3)
string_12 = StringInput("Descrição do Material")
getParameterValueByName_3 = Element.GetParameterValueByName(element=filterByBoolMask_4.out, parameterName=string_12)
isNullOrWhiteSpace_2 = archilab.Core.Strings.IsNullOrWhiteSpace(str=getParameterValueByName_3)
filterByBoolMask_5 = List.FilterByBoolMask(list=filterByBoolMask_4.out, mask=isNullOrWhiteSpace_2)
list_create_4 = List.Create(item0=filterByBoolMask_3.out, item1=filterByBoolMask_5.out)
boolean_3 = BoolSelector(false)
clean = List.Clean(list=list_create_4, preserveIndices=boolean_3)
list_create_5 = List.Create(item0=clean, item1=filterByBoolMask_5.in)
flatten_3 = List.Flatten(list=list_create_5)
elementType_3 = Element.ElementType(element=flatten_3)
isNull = Object.IsNull(object=elementType_3)
filterByBoolMask_6 = List.FilterByBoolMask(list=flatten_3, mask=isNull)
filterByBoolMask_7 = List.FilterByBoolMask(list=getParameterValueByName_2, mask=isNullOrWhiteSpace)
filterByBoolMask_8 = List.FilterByBoolMask(list=getParameterValueByName_3, mask=isNullOrWhiteSpace_2)
list_create_6 = List.Create(item0=filterByBoolMask_7.out, item1=filterByBoolMask_8.out)
reverse = List.Reverse(list=list_create_6)
boolean_4 = BoolSelector(false)
clean_2 = List.Clean(list=reverse, preserveIndices=boolean_4)
flatten_4 = List.Flatten(list=clean_2)
sortByKey = List.SortByKey(list=filterByBoolMask_6.out, keys=flatten_4)
groupByKey = List.GroupByKey(list=sortByKey.sortedList, keys=sortByKey.sortedKeys)
string_13 = StringInput("Identificador")
number_4 = DoubleInput(1)
count = List.Count(list=groupByKey.uniqueKeys)
range = Range(start=number_4, end=count)
string_from_object = FromObject(obj=range)
concat = String.Concat(string0=code_block_2.texto2)  # unwired: string1
map = List.Map(list=string_from_object, f_x=concat)
setParameterByName = Element.SetParameterByName(element=groupByKey.groups, parameterName=string_13, value=map)
watch = Watch(code_block_2.texto1)
watch_2 = Watch(filterByBoolMask_6.out)
watch_3 = Watch(filterByBoolMask.in)
