# Dynamo graph ok 2021_10-5_BIMACON_Excluir Letras dos Comandos_R00_script.dyn (Dynamo 2.19.3.6394)
# Inseri Identificadores nas conexões

categories = Categories("OST_LightingDevices")
categories_2 = Categories("OST_ElectricalFixtures")
list_create = List.Create(item0=categories, item1=categories_2)
all_elements_of_category = ElementsOfCategory(Category=list_create)
flatten = List.Flatten(list=all_elements_of_category)
string_from_object = FromObject(object=flatten)
code_block = CodeBlock { "Simples"; }
contains = String.Contains(string=string_from_object, searchFor=code_block)
filterByBoolMask = List.FilterByBoolMask(list=flatten, mask=contains@L2)
code_block_2 = CodeBlock { "Paralelo"; }
contains_2 = String.Contains(string=string_from_object, searchFor=code_block_2)
filterByBoolMask_2 = List.FilterByBoolMask(list=flatten, mask=contains_2@L2)
code_block_3 = CodeBlock { "Intermediário"; }
contains_3 = String.Contains(string=string_from_object, searchFor=code_block_3)
filterByBoolMask_3 = List.FilterByBoolMask(list=flatten, mask=contains_3@L2)
code_block_4 = CodeBlock { "Pulsador"; }
contains_4 = String.Contains(string=string_from_object, searchFor=code_block_4)
filterByBoolMask_4 = List.FilterByBoolMask(list=flatten, mask=contains_4@L2)
code_block_5 = CodeBlock { "Sensor"; }
contains_5 = String.Contains(string=string_from_object, searchFor=code_block_5)
filterByBoolMask_5 = List.FilterByBoolMask(list=flatten, mask=contains_5@L2)
list_create_2 = List.Create(item0=filterByBoolMask.in, item1=filterByBoolMask_2.in, item2=filterByBoolMask_3.in, item3=filterByBoolMask_4.in, item4=filterByBoolMask_5.in)
flatten_2 = List.Flatten(list=list_create_2)
uniqueItems = List.UniqueItems(list=flatten_2)
getChildElements = Element.GetChildElements(element=uniqueItems)
string_from_object_2 = FromObject(object=getChildElements)
code_block_6 = CodeBlock { ["Caixa de Luz"]; }
contains_6 = String.Contains(string=string_from_object_2@L2, searchFor=code_block_6, lacing=Longest)
filterByBoolMask_6 = List.FilterByBoolMask(list=getChildElements@L2, mask=contains_6@L2)
string_from_object_3 = FromObject(object=filterByBoolMask_6.out)
code_block_7 = CodeBlock { ["Tomada"]; }
contains_7 = String.Contains(string=string_from_object_3@L2, searchFor=code_block_7, lacing=Longest)
filterByBoolMask_7 = List.FilterByBoolMask(list=filterByBoolMask_6.out@L2, mask=contains_7@L2)
flatten_3 = List.Flatten(list=filterByBoolMask_7.out)
string = StringInput("ID do comando")
code_block_8 = CodeBlock { ""; }
setParameterByName = Element.SetParameterByName(element=flatten_3, parameterName=string, value=code_block_8)
string_2 = StringInput("ID do comando")
setParameterByName_2 = Element.SetParameterByName(element=flatten_2, parameterName=string_2, value=code_block_8)
