# Dynamo graph ok 2021_10-6_BIMACON_Tags de Comandos_script.dyn "2021_10-6_BIMACON_Tags de Comandos_script" (Dynamo 2.19.3.6394)
# packages: BIMCoder Nodes - 2.X 2025.0.15, archi-lab.net 2023.213.1722, BIMCoder Nodes - 2.X 2025.1.0

categories = Categories("OST_LightingDevices")
categories_2 = Categories("OST_ElectricalFixtures")
list_create = List.Create(item0=categories, item1=categories_2)
current = Document.Current()
activeView = Document.ActiveView(document=current)
all_elements_of_category_in_view = ElementsOfCategoryInView(Category=list_create, View=activeView)
flatten = List.Flatten(list=all_elements_of_category_in_view)
getFamily = FamilyInstance.GetFamily(familyInstance=all_elements_of_category_in_view)
flatten_2 = List.Flatten(list=getFamily)
string_from_object = FromObject(object=flatten_2)
code_block = CodeBlock { "Sensor"; }
contains = String.Contains(string=string_from_object, searchFor=code_block)
filterByBoolMask = List.FilterByBoolMask(list=flatten, mask=contains)
string_from_object_2 = FromObject(object=flatten)
code_block_2 = CodeBlock { "Simples"; }
contains_2 = String.Contains(string=string_from_object_2, searchFor=code_block_2)
filterByBoolMask_2 = List.FilterByBoolMask(list=flatten, mask=contains_2@L2)
code_block_3 = CodeBlock { "Paralelo"; }
contains_3 = String.Contains(string=string_from_object_2, searchFor=code_block_3)
filterByBoolMask_3 = List.FilterByBoolMask(list=flatten, mask=contains_3@L2)
code_block_4 = CodeBlock { "Intermediário"; }
contains_4 = String.Contains(string=string_from_object_2, searchFor=code_block_4)
filterByBoolMask_4 = List.FilterByBoolMask(list=flatten, mask=contains_4@L2)
code_block_5 = CodeBlock { "Pulsador"; }
contains_5 = String.Contains(string=string_from_object_2, searchFor=code_block_5)
filterByBoolMask_5 = List.FilterByBoolMask(list=flatten, mask=contains_5@L2)
list_create_2 = List.Create(item0=filterByBoolMask_2.in, item1=filterByBoolMask_3.in, item2=filterByBoolMask_4.in, item3=filterByBoolMask_5.in)
flatten_3 = List.Flatten(list=list_create_2)
uniqueItems = List.UniqueItems(list=flatten_3)
getChildElements = Element.GetChildElements(element=uniqueItems)
string_from_object_3 = FromObject(object=getChildElements)
code_block_6 = CodeBlock { ["Caixa de Luz"]; }
contains_6 = String.Contains(string=string_from_object_3@L2, searchFor=code_block_6, lacing=Longest)
filterByBoolMask_6 = List.FilterByBoolMask(list=getChildElements@L2, mask=contains_6@L2)
string_from_object_4 = FromObject(object=filterByBoolMask_6.out)
code_block_7 = CodeBlock { ["Tomada"]; }
contains_7 = String.Contains(string=string_from_object_4@L2, searchFor=code_block_7, lacing=Longest)
filterByBoolMask_7 = List.FilterByBoolMask(list=filterByBoolMask_6.out@L2, mask=contains_7@L2)
list_create_3 = List.Create(item0=filterByBoolMask.in, item1=filterByBoolMask_7.out)
boolean = BoolSelector(false)
clean = List.Clean(list=list_create_3, preserveIndices=boolean)
flatten_4 = List.Flatten(list=clean@L2)
getLocation = Element.GetLocation(element=clean)
flatten_5 = List.Flatten(list=getLocation@L2)
firstItem = List.FirstItem(list=flatten_5, lacing=Longest)
indexOf = List.IndexOf(list=firstItem, element=flatten_5, lacing=Longest)
getItemAtIndex = List.GetItemAtIndex(list=flatten_4, index=indexOf, lacing=Longest)
boolean_2 = BoolSelector(false)
clean_2 = List.Clean(list=getItemAtIndex, preserveIndices=boolean_2)
getLocation_2 = Element.GetLocation(element=clean_2)
facingOrientation = FamilyInstance.FacingOrientation(familyInstance=clean_2)
byStartPointDirectionLength = Line.ByStartPointDirectionLength(startPoint=getLocation_2, direction=facingOrientation)
line_upvectoratparameter = Custom[👓 Line․UpVectorAtParameter](line=byStartPointDirectionLength)  # package BIMCoder Nodes - 2.X; Cria um vetor apontando para cima dado o parâmetro
X = Vector.X(vector=line_upvectoratparameter)
code_block_8 = CodeBlock { -1; }
eq = X == code_block_8
filterByBoolMask_8 = List.FilterByBoolMask(list=clean_2, mask=eq, lacing=Longest)
filterByBoolMask_9 = List.FilterByBoolMask(list=line_upvectoratparameter, mask=eq)

# group: TAG Vertical
# Descrição <Clique duas vezes aqui para editar a descrição do grupo>
boolean_3 = BoolSelector(false)
clean_3 = List.Clean(list=filterByBoolMask_8.in, preserveIndices=boolean_3)
flatten_6 = List.Flatten(list=clean_3)
boolean_4 = BoolSelector(false)
clean_4 = List.Clean(list=filterByBoolMask_8.in, preserveIndices=boolean_4)
getLocation_3 = Element.GetLocation(element=clean_4)
boolean_5 = BoolSelector(false)
clean_5 = List.Clean(list=filterByBoolMask_9.in, preserveIndices=boolean_5)
offset_da_tag = DoubleInput(0.2)
translate = Geometry.Translate(geometry=getLocation_3, direction=clean_5, distance=offset_da_tag)
facingOrientation_2 = FamilyInstance.FacingOrientation(familyInstance=clean_4)
offset_da_2ª_tag = DoubleInput(0.1)
translate_2 = Geometry.Translate(geometry=translate, direction=facingOrientation_2, distance=offset_da_2ª_tag)
boolean_6 = BoolSelector(false)
clean_6 = List.Clean(list=translate_2, preserveIndices=boolean_6)
flatten_7 = List.Flatten(list=clean_6)
family_types = FamilyTypes("Tag Interruptor:Comando (Switch ID)")
tag_byelement = Custom[👓 Tag․ByElement](element=flatten_6, TagLocation=flatten_7, TagType=family_types)  # package BIMCoder Nodes - 2.X; Cria uma Tag em elemento(s) dado o tipo da Tag e a posição

watch = Watch(filterByBoolMask.in)
all_elements_of_category = ElementsOfCategory(Category=list_create)
current_document = Custom[Current Document]()  # package archi-lab.net; Retrieves Current Document

# group: TAG Horizontal
# Descrição <Clique duas vezes aqui para editar a descrição do grupo>
boolean_7 = BoolSelector(false)
clean_7 = List.Clean(list=filterByBoolMask_8.out, preserveIndices=boolean_7)
flatten_8 = List.Flatten(list=clean_7)
boolean_8 = BoolSelector(false)
clean_8 = List.Clean(list=filterByBoolMask_8.out, preserveIndices=boolean_8)
getLocation_4 = Element.GetLocation(element=clean_8)
boolean_9 = BoolSelector(false)
clean_9 = List.Clean(list=filterByBoolMask_9.out, preserveIndices=boolean_9)
offset_da_tag_2 = DoubleInput(0.08)
translate_3 = Geometry.Translate(geometry=getLocation_4, direction=clean_9, distance=offset_da_tag_2)
facingOrientation_3 = FamilyInstance.FacingOrientation(familyInstance=clean_8)
offset_da_2ª_tag_2 = DoubleInput(0.12)
translate_4 = Geometry.Translate(geometry=translate_3, direction=facingOrientation_3, distance=offset_da_2ª_tag_2)
boolean_10 = BoolSelector(false)
clean_10 = List.Clean(list=translate_4, preserveIndices=boolean_10)
flatten_9 = List.Flatten(list=clean_10)
family_types_2 = FamilyTypes("Tag Interruptor:Comando (Switch ID)")
tag_byelement_2 = Custom[👓 Tag․ByElement](element=flatten_8, TagLocation=flatten_9, TagType=family_types_2)

code_block_9 = CodeBlock { 1; }
getItemAtIndex_2 = List.GetItemAtIndex(list=flatten_4, index=code_block_9, lacing=Longest)
boolean_11 = BoolSelector(false)
clean_11 = List.Clean(list=getItemAtIndex_2, preserveIndices=boolean_11)
getLocation_5 = Element.GetLocation(element=clean_11)
facingOrientation_4 = FamilyInstance.FacingOrientation(familyInstance=clean_11)
byStartPointDirectionLength_2 = Line.ByStartPointDirectionLength(startPoint=getLocation_5, direction=facingOrientation_4)
line_upvectoratparameter_2 = Custom[👓 Line․UpVectorAtParameter](line=byStartPointDirectionLength_2)
X_2 = Vector.X(vector=line_upvectoratparameter_2)
code_block_10 = CodeBlock { -1; }
eq_2 = X_2 == code_block_10
filterByBoolMask_10 = List.FilterByBoolMask(list=clean_11, mask=eq_2, lacing=Longest)
filterByBoolMask_11 = List.FilterByBoolMask(list=line_upvectoratparameter_2, mask=eq_2)

# group: TAG Horizontal
# Descrição <Clique duas vezes aqui para editar a descrição do grupo>
boolean_12 = BoolSelector(false)
clean_12 = List.Clean(list=filterByBoolMask_10.out, preserveIndices=boolean_12)
flatten_10 = List.Flatten(list=clean_12)
boolean_13 = BoolSelector(false)
clean_13 = List.Clean(list=filterByBoolMask_10.out, preserveIndices=boolean_13)
getLocation_6 = Element.GetLocation(element=clean_13)
boolean_14 = BoolSelector(false)
clean_14 = List.Clean(list=filterByBoolMask_11.out, preserveIndices=boolean_14)
offset_da_tag_3 = DoubleInput(0.08)
translate_5 = Geometry.Translate(geometry=getLocation_6, direction=clean_14, distance=offset_da_tag_3)
facingOrientation_5 = FamilyInstance.FacingOrientation(familyInstance=clean_13)
offset_da_2ª_tag_3 = DoubleInput(0.3)
translate_6 = Geometry.Translate(geometry=translate_5, direction=facingOrientation_5, distance=offset_da_2ª_tag_3)
boolean_15 = BoolSelector(false)
clean_15 = List.Clean(list=translate_6, preserveIndices=boolean_15)
flatten_11 = List.Flatten(list=clean_15)
family_types_3 = FamilyTypes("Tag Interruptor:Comando (Switch ID)")
tag_byelement_3 = Custom[👓 Tag․ByElement](element=flatten_10, TagLocation=flatten_11, TagType=family_types_3)

# group: TAG Vertical
# Descrição <Clique duas vezes aqui para editar a descrição do grupo>
boolean_16 = BoolSelector(false)
clean_16 = List.Clean(list=filterByBoolMask_10.in, preserveIndices=boolean_16)
flatten_12 = List.Flatten(list=clean_16)
boolean_17 = BoolSelector(false)
clean_17 = List.Clean(list=filterByBoolMask_10.in, preserveIndices=boolean_17)
getLocation_7 = Element.GetLocation(element=clean_17)
boolean_18 = BoolSelector(false)
clean_18 = List.Clean(list=filterByBoolMask_11.in, preserveIndices=boolean_18)
offset_da_tag_4 = DoubleInput(0.2)
translate_7 = Geometry.Translate(geometry=getLocation_7, direction=clean_18, distance=offset_da_tag_4)
facingOrientation_6 = FamilyInstance.FacingOrientation(familyInstance=clean_17)
offset_da_2ª_tag_4 = DoubleInput(0.22)
translate_8 = Geometry.Translate(geometry=translate_7, direction=facingOrientation_6, distance=offset_da_2ª_tag_4)
boolean_19 = BoolSelector(false)
clean_19 = List.Clean(list=translate_8, preserveIndices=boolean_19)
flatten_13 = List.Flatten(list=clean_19)
family_types_4 = FamilyTypes("Tag Interruptor:Comando (Switch ID)")
tag_byelement_4 = Custom[👓 Tag․ByElement](element=flatten_12, TagLocation=flatten_13, TagType=family_types_4)

code_block_11 = CodeBlock { 2; }
getItemAtIndex_3 = List.GetItemAtIndex(list=flatten_4, index=code_block_11, lacing=Longest)
boolean_20 = BoolSelector(false)
clean_20 = List.Clean(list=getItemAtIndex_3, preserveIndices=boolean_20)
getLocation_8 = Element.GetLocation(element=clean_20)
facingOrientation_7 = FamilyInstance.FacingOrientation(familyInstance=clean_20)
byStartPointDirectionLength_3 = Line.ByStartPointDirectionLength(startPoint=getLocation_8, direction=facingOrientation_7)
line_upvectoratparameter_3 = Custom[👓 Line․UpVectorAtParameter](line=byStartPointDirectionLength_3)
X_3 = Vector.X(vector=line_upvectoratparameter_3)
code_block_12 = CodeBlock { -1; }
eq_3 = X_3 == code_block_12
filterByBoolMask_12 = List.FilterByBoolMask(list=clean_20, mask=eq_3, lacing=Longest)
filterByBoolMask_13 = List.FilterByBoolMask(list=line_upvectoratparameter_3, mask=eq_3)

# group: TAG Horizontal
# Descrição <Clique duas vezes aqui para editar a descrição do grupo>
boolean_21 = BoolSelector(false)
clean_21 = List.Clean(list=filterByBoolMask_12.out, preserveIndices=boolean_21)
flatten_14 = List.Flatten(list=clean_21)
boolean_22 = BoolSelector(false)
clean_22 = List.Clean(list=filterByBoolMask_12.out, preserveIndices=boolean_22)
getLocation_9 = Element.GetLocation(element=clean_22)
boolean_23 = BoolSelector(false)
clean_23 = List.Clean(list=filterByBoolMask_13.out, preserveIndices=boolean_23)
offset_da_tag_5 = DoubleInput(0.08)
translate_9 = Geometry.Translate(geometry=getLocation_9, direction=clean_23, distance=offset_da_tag_5)
facingOrientation_8 = FamilyInstance.FacingOrientation(familyInstance=clean_22)
offset_da_2ª_tag_5 = DoubleInput(0.46)
translate_10 = Geometry.Translate(geometry=translate_9, direction=facingOrientation_8, distance=offset_da_2ª_tag_5)
boolean_24 = BoolSelector(false)
clean_24 = List.Clean(list=translate_10, preserveIndices=boolean_24)
flatten_15 = List.Flatten(list=clean_24)
family_types_5 = FamilyTypes("Tag Interruptor:Comando (Switch ID)")
tag_byelement_5 = Custom[👓 Tag․ByElement](element=flatten_14, TagLocation=flatten_15, TagType=family_types_5)

# group: TAG Vertical
# Descrição <Clique duas vezes aqui para editar a descrição do grupo>
boolean_25 = BoolSelector(false)
clean_25 = List.Clean(list=filterByBoolMask_12.in, preserveIndices=boolean_25)
flatten_16 = List.Flatten(list=clean_25)
boolean_26 = BoolSelector(false)
clean_26 = List.Clean(list=filterByBoolMask_12.in, preserveIndices=boolean_26)
getLocation_10 = Element.GetLocation(element=clean_26)
boolean_27 = BoolSelector(false)
clean_27 = List.Clean(list=filterByBoolMask_13.in, preserveIndices=boolean_27)
offset_da_tag_6 = DoubleInput(0.2)
translate_11 = Geometry.Translate(geometry=getLocation_10, direction=clean_27, distance=offset_da_tag_6)
facingOrientation_9 = FamilyInstance.FacingOrientation(familyInstance=clean_26)
offset_da_2ª_tag_6 = DoubleInput(0.35)
translate_12 = Geometry.Translate(geometry=translate_11, direction=facingOrientation_9, distance=offset_da_2ª_tag_6)
boolean_28 = BoolSelector(false)
clean_28 = List.Clean(list=translate_12, preserveIndices=boolean_28)
flatten_17 = List.Flatten(list=clean_28)
family_types_6 = FamilyTypes("Tag Interruptor:Comando (Switch ID)")
tag_byelement_6 = Custom[👓 Tag․ByElement](element=flatten_16, TagLocation=flatten_17, TagType=family_types_6)
