# Dynamo graph 10-3_BIMACON_Excluir Códigos de Conexões_R02_script.dyn "ok 2021_10-3_BIMACON_Excluir Códigos de Conexões_R02_script" (Dynamo 2.19.3.6394)
# author: Jose Nelson
# Exclui os Códigos de  Identificadores de todas conexões.
# packages: DynaMEP 2.0.1, Data-Shapes 2022.2.105

categories = Categories("OST_ConduitFitting")
categories_2 = Categories("OST_CableTrayFitting")
list_create = List.Create(item0=categories, item1=categories_2)
all_elements_of_category = ElementsOfCategory(Category=list_create)
elementType = Element.ElementType(element=all_elements_of_category)
string = StringInput("Comentários de tipos")
getParameterValueByName = Element.GetParameterValueByName(element=elementType, parameterName=string)

# group: Janela de Imputs
string_2 = StringInput("Inserir Identificadores em conexões")
string_3 = StringInput("LogoBimacon.png")
python_script = Python(IN[0]=string_3)  # IronPython2
# ---------- python_script.python (22 lines) ----------
import clr

# Adiciona referência ao ambiente .NET
clr.AddReference('System')
from System import Environment, IO

# Nome da imagem (entrada do usuário)
nome_arquivo_imagem = IN[0]

# Recupera o nome do usuário logado no Windows
usuario = Environment.UserName

# Monta o caminho completo para a pasta de imagens
caminho_base = r"C:\Users\{0}\AppData\Roaming\pyRevit\Extensions\Bimacon.extension\Bimacon.tab\Imagens_Bimacon".format(usuario)

# Junta o caminho base com o nome do arquivo
caminho_completo = IO.Path.Combine(caminho_base, nome_arquivo_imagem)

# Verifica se o arquivo existe
existe = IO.File.Exists(caminho_completo)

OUT = caminho_completo if existe else "Imagem não encontrada: {0}".format(caminho_completo)
# ----------------------------------------
file_from_path = FileObject(path=python_script)
readFromFile = Image.ReadFromFile(file=file_from_path)
string_4 = StringInput("Executar")
string_5 = StringInput("Selecione o \"Comentário de tipo\":")
code_block = CodeBlock()
# ---------- code_block.designscript (14 lines) ----------
"PVC Roscável Preto";
"PVC Corrugado Amarelo";
"PVC Corrugado Azul";
"PVC Corrugado Cinza";
"PVC Corrugado Laranja Reforçado";
"PVC Condulete TOP";
"Conduletes de Aluminio";
"Conduletes sem Rosca";
"Derivações de Eletrodutos com Rosca BSP";
"Derivações de Eletrocalhas";
"Derivações de Perfilados";
"Derivações de Leitos";
"PEAD Corrugado";
"Caixas de Passagem Elétrica";
# ----------------------------------------
list_create_2 = List.Create(item0=code_block.out0, item1=code_block.out1, item2=code_block.out2, item3=code_block.out3, item4=code_block.out4, item5=code_block.out5, item6=code_block.out6, item7=code_block.out7, item8=code_block.out8, item9=code_block.out9, item10=code_block.out10, item11=code_block.out11, item12=code_block.out12, item13=code_block.out13)
number = DoubleInput(0)
dropdown_data = Custom[DropDown Data](InputName=string_5, Keys=list_create_2, Values=list_create_2, DefaultValueIndex=number)  # package Data-Shapes; Create data for DropDown input in UI.MultiInputForm ++ . Check out www.data-shapes.net for more infos.
boolean = BoolSelector(true)
string_6 = StringInput("http://bimacon.wix.com/bimacon")
string_7 = StringInput("Cancelar")
number_2 = DoubleInput(500)
number_3 = DoubleInput(220)
multipleinputform = Custom[MultipleInputForm ++](Description_optional=string_2, Logo_optional=readFromFile, ButtonText_optional=string_4, Inputs=dropdown_data, Toggle=boolean, LinkToHelp_optional=string_6, CancelButtonText_optional=string_7, Width_optional=number_2, LabelWidth_optional=number_3)  # package Data-Shapes; Create a form with multiple inputs. see www.data-shapes.net for tutorials and infos!

contains = String.Contains(string=getParameterValueByName, searchFor=multipleinputform.User_Inputs)
filterByBoolMask = List.FilterByBoolMask(list=elementType, mask=contains)
byFamilyType = FamilyInstance.ByFamilyType(familyType=filterByBoolMask.in)
nome_do_parâmetro = StringInput("Identificador")  # graph input
string_8 = StringInput("")
setParameterValueByName = RevitModel.Element.SetParameterValueByName(element=byFamilyType, parameterName=nome_do_parâmetro, values=string_8)
