# Dynamo graph 10-6_BIMACON_Excluir Letras dos Comandos_R01_script.dyn "ok 2021_10-6_BIMACON_Excluir Letras dos Comandos_R01_script" (Dynamo 2.19.3.6394)
# author: Jose Nelson
# Inseri Identificadores nas conexões

categories = Categories("OST_LightingDevices")
categories_2 = Categories("OST_ElectricalFixtures")
list_create = List.Create(item0=categories, item1=categories_2)
all_elements_of_category = ElementsOfCategory(Category=list_create)
flatten = List.Flatten(list=all_elements_of_category)
string_from_object = FromObject(object=flatten)
code_block = CodeBlock { "Simples"; }
contains = String.Contains(string=string_from_object, searchFor=code_block)
filterByBoolMask = List.FilterByBoolMask(list=flatten, mask=contains@L2)
code_block_2 = CodeBlock { "Paralelo"; }
contains_2 = String.Contains(string=string_from_object, searchFor=code_block_2)
filterByBoolMask_2 = List.FilterByBoolMask(list=flatten, mask=contains_2@L2)
code_block_3 = CodeBlock { "Intermediário"; }
contains_3 = String.Contains(string=string_from_object, searchFor=code_block_3)
filterByBoolMask_3 = List.FilterByBoolMask(list=flatten, mask=contains_3@L2)
code_block_4 = CodeBlock { "Pulsador"; }
contains_4 = String.Contains(string=string_from_object, searchFor=code_block_4)
filterByBoolMask_4 = List.FilterByBoolMask(list=flatten, mask=contains_4@L2)
code_block_5 = CodeBlock { "Sensor"; }
contains_5 = String.Contains(string=string_from_object, searchFor=code_block_5)
filterByBoolMask_5 = List.FilterByBoolMask(list=flatten, mask=contains_5@L2)
list_create_2 = List.Create(item0=filterByBoolMask.in, item1=filterByBoolMask_2.in, item2=filterByBoolMask_3.in, item3=filterByBoolMask_4.in, item4=filterByBoolMask_5.in)
flatten_2 = List.Flatten(list=list_create_2)
uniqueItems = List.UniqueItems(list=flatten_2)
getChildElements = Element.GetChildElements(element=uniqueItems)
string_from_object_2 = FromObject(object=getChildElements)
code_block_6 = CodeBlock { ["Caixa de Luz"]; }
contains_6 = String.Contains(string=string_from_object_2@L2, searchFor=code_block_6, lacing=Longest)
filterByBoolMask_6 = List.FilterByBoolMask(list=getChildElements@L2, mask=contains_6@L2)
string_from_object_3 = FromObject(object=filterByBoolMask_6.out)
code_block_7 = CodeBlock { ["Tomada"]; }
contains_7 = String.Contains(string=string_from_object_3@L2, searchFor=code_block_7, lacing=Longest)
filterByBoolMask_7 = List.FilterByBoolMask(list=filterByBoolMask_6.out@L2, mask=contains_7@L2)
flatten_3 = List.Flatten(list=filterByBoolMask_7.out)

# group: Versão Revit
code_block_8 = CodeBlock { 2021; }
version = Python()  # "Document.Version"; IronPython2; unwired: IN[0]
# ---------- version.python (13 lines) ----------
# Importa as bibliotecas necessárias do Revit
import clr
clr.AddReference('RevitServices')
from RevitServices.Persistence import DocumentManager

# Obtém o documento ativo
doc = DocumentManager.Instance.CurrentUIApplication.Application

# Obtém o número da versão do Revit
revit_version = doc.VersionNumber

# Retorna o número da versão do Revit
OUT = "A versão do Revit é: {}".format(revit_version)
# ----------------------------------------
code_block_9 = CodeBlock { " "; }
split = String.Split(string=version, separator0=code_block_9)
lastItem = List.LastItem(list=split)
toNumber = String.ToNumber(string=lastItem)

# group: Altura Eletroduto
eq = code_block_8 == toNumber
n2021 = CodeBlock { "ID da chave"; }  # "2021"
n2022_2023_2024_2025 = CodeBlock { "ID do comando"; }  # "2022 - 2023 - 2024 - 2025"
if_ = If(test=eq, true=n2021, false=n2022_2023_2024_2025)

code_block_10 = CodeBlock { ""; }
setParameterByName = Element.SetParameterByName(element=flatten_3, parameterName=if_, value=code_block_10)
setParameterByName_2 = Element.SetParameterByName(element=flatten_2, parameterName=if_, value=code_block_10)
