# Dynamo graph 10-4_BIMACON_Excluir Todos Identificadores_R02_script.dyn "10-4_BIMACON_Excluir Todos Identificadores_R01_script" (Dynamo 3.6.1.9895)
# author: Jose Nelson
# Exclui os Códigos de  Identificadores de todas conexões.
# packages: DynamoIronPython2.7 3.2.1

categories = Categories("OST_CableTrayFitting")
categories_2 = Categories("OST_ConduitFitting")
list_create = List.Create(item0=categories, item1=categories_2)
all_elements_of_category = ElementsOfCategory(Category=list_create)
nome_do_parâmetro = StringInput("Identificador")  # graph input
getParameterValueByName = Element.GetParameterValueByName(element=all_elements_of_category, parameterName=nome_do_parâmetro)
code_block = CodeBlock { ""; }
eq = getParameterValueByName == code_block
filterByBoolMask = List.FilterByBoolMask(list=all_elements_of_category, mask=eq)
nome_do_parâmetro_2 = StringInput("Identificador")  # graph input
string = StringInput("")
setParameterValueByName = Python(IN[0]=filterByBoolMask.out, IN[1]=nome_do_parâmetro_2, IN[2]=string)  # "Element.SetParameterValueByName"; IronPython2
# ---------- setParameterValueByName.python (92 lines) ----------
# -*- coding: utf-8 -*-

import clr

# Revit API
clr.AddReference('RevitAPI')
from Autodesk.Revit.DB import *

# Revit Services
clr.AddReference('RevitServices')
from RevitServices.Persistence import DocumentManager
from RevitServices.Transactions import TransactionManager

# .NET
clr.AddReference("System")
from System.Collections import IEnumerable

doc = DocumentManager.Instance.CurrentDBDocument

# ==================================================
# ENTRADAS
# ==================================================

elementos = UnwrapElement(IN[0])
nomeParametro = IN[1]
valor = IN[2]

# ==================================================
# VERIFICA SE É LISTA
# ==================================================

def is_list(obj):

    if isinstance(obj, str):
        return False

    return isinstance(obj, IEnumerable)

# ==================================================
# FUNÇÃO RECURSIVA
# ==================================================

def aplicar(item):

    # Se for lista/sublista
    if is_list(item):

        return [aplicar(x) for x in item]

    try:

        if item is None:
            return None

        parametro = item.LookupParameter(nomeParametro)

        if parametro is None:
            return "Parâmetro não encontrado"

        if parametro.IsReadOnly:
            return "Parâmetro bloqueado"

        # Apenas texto
        if parametro.StorageType == StorageType.String:

            parametro.Set(str(valor))

            return item

        else:

            return "Parâmetro não é texto"

    except Exception as e:

        return str(e)

# ==================================================
# TRANSACTION
# ==================================================

TransactionManager.Instance.EnsureInTransaction(doc)

resultado = aplicar(elementos)

TransactionManager.Instance.TransactionTaskDone()

# ==================================================
# SAÍDA
# ==================================================

OUT = resultado
# ----------------------------------------
flatten = List.Flatten(list=setParameterValueByName)

# group: Mensagem
count = List.Count(list=flatten)
code_block_2 = CodeBlock { 0; }
gt = count > code_block_2
code_block_3 = CodeBlock(N=count) { ["Feito! você deletou "+N+" Identificadores"]; }
code_block_4 = CodeBlock { ["Nenhum Identificador foi deletado"]; }
if_ = If(test=gt, true=code_block_3, false=code_block_4)
flatten_2 = List.Flatten(list=if_)
fromList = Python(IN[0]=flatten_2)  # "String.FromList"; IronPython2
# ---------- fromList.python (22 lines) ----------
# Carregar as bibliotecas DesignScript e padrão do Python
import sys
import clr
clr.AddReference('ProtoGeometry')
from Autodesk.DesignScript.Geometry import *

# Função para concatenar os valores de uma lista em uma única string com múltiplas linhas
def concatenate_list_to_string(input_list, delimiter="\n"):
    # Verifica se a entrada é uma lista
    if not isinstance(input_list, list):
        return "A entrada deve ser uma lista."
    
    # Converte todos os elementos para string e junta com o delimitador especificado
    result = delimiter.join(str(item) for item in input_list)
    return result

# Entrada pelo nó do Dynamo
lista = IN[0]  # Lista de valores a serem concatenados
delimitador = IN[1] if len(IN) > 1 else "\n"  # Delimitador opcional, padrão é nova linha

# Saída para o Dynamo
OUT = concatenate_list_to_string(lista, delimitador)
# ----------------------------------------
python_script = Python(IN[0]=fromList)  # IronPython2
# ---------- python_script.python (21 lines) ----------
# Importar as bibliotecas necessárias do Revit
import clr
clr.AddReference("RevitServices")
from RevitServices.Persistence import DocumentManager

clr.AddReference("RevitAPI")
clr.AddReference("RevitAPIUI")
from Autodesk.Revit.UI import TaskDialog

# Pegar a entrada do Dynamo
mensagem = IN[0]

# Criar a TaskDialog
task_dialog = TaskDialog("Ok")
task_dialog.MainInstruction = mensagem

# Exibir a TaskDialog
task_dialog.Show()

# Saída do script
OUT = "Sucesso!"
# ----------------------------------------
