# Dynamo graph 10-11_BIMACON_Atribuir Letras aos Comandos Por Circuito_R01_script.dyn (Dynamo 2.16.4.10216)
# Inseri Identificadores nas conexões
# packages: MEPover 2022.10.30

categories = Categories("OST_ElectricalEquipment")
all_elements_of_category = ElementsOfCategory(Category=categories)
circuitos_por_quadro = Python(IN[0]=all_elements_of_category)  # IronPython2
# ---------- circuitos_por_quadro.python (115 lines) ----------
import clr

# Revit / Document
clr.AddReference("RevitServices")
from RevitServices.Persistence import DocumentManager
doc = DocumentManager.Instance.CurrentDBDocument

# Revit API
clr.AddReference("RevitAPI")
from Autodesk.Revit.DB import *

# RevitNodes (Unwrap / ToDSType)
clr.AddReference("RevitNodes")
import Revit
clr.ImportExtensions(Revit.Elements)

# --- Helpers --------------------------------------------------------

def try_unwrap(item):
    """Tenta desempacotar um item do Dynamo para Revit; se falhar, retorna o próprio item."""
    try:
        return UnwrapElement(item)
    except:
        return item

def flatten_and_unwrap(obj):
    """Flatten de listas aninhadas e Unwrap de itens Dynamo para Revit.
       Retorna sempre uma lista (pode ser vazia)."""
    result = []
    if obj is None:
        return result
    if isinstance(obj, (list, tuple)):
        for i in obj:
            result.extend(flatten_and_unwrap(i))
    else:
        result.append(try_unwrap(obj))
    return result

def to_dynamo(el):
    """Converte um elemento Revit para o tipo Dynamo (se possível)."""
    try:
        return el.ToDSType(True)
    except:
        return el

# --- Entrada --------------------------------------------------------

raw_input = IN[0]  # lista de equipamentos (ou único equipamento)
equip_list = flatten_and_unwrap(raw_input)  # lista de Element (Revit) não-nulos

# Coleta todos os ElectricalSystem do documento (usado no fallback)
all_systems = list(FilteredElementCollector(doc).OfClass(Electrical.ElectricalSystem).ToElements())

# --- Função principal ----------------------------------------------

def get_circuitos_para_equip(equip):
    """Retorna lista de ElectricalSystem (objetos Dynamo) associados ao equipamento Revit `equip`."""
    sistemas_encontrados = []
    
    # 1) Tentar método direto para equipamento (cargas, tomadas, luminárias)
    try:
        coll = ElectricalSystem.GetElectricalSystemsForEquipment(equip)
        if coll:
            for s in list(coll):
                if s not in sistemas_encontrados:
                    sistemas_encontrados.append(s)
    except:
        # ignora - método pode lançar se tipo incompatível
        pass

    # 2) Tentar método direto para painel/quadro
    try:
        coll = ElectricalSystem.GetElectricalSystemsForPanel(equip)
        if coll:
            for s in list(coll):
                if s not in sistemas_encontrados:
                    sistemas_encontrados.append(s)
    except:
        pass

    # 3) Fallback: varrer todos os ElectricalSystem do documento e checar Panel/BaseEquipment
    if not sistemas_encontrados:
        for s in all_systems:
            try:
                # s.Panel e s.BaseEquipment podem ser None — checagens seguras
                panel = getattr(s, "Panel", None)
                baseeq = getattr(s, "BaseEquipment", None)
                if panel is not None and panel.Id == equip.Id:
                    sistemas_encontrados.append(s)
                    continue
                if baseeq is not None and baseeq.Id == equip.Id:
                    sistemas_encontrados.append(s)
                    continue
            except:
                pass

    # Converte para Dynamo types e retorna (se vazio, retorna lista vazia)
    return [to_dynamo(s) for s in sistemas_encontrados]

# --- Monta resultado ------------------------------------------------

results = []
for e in equip_list:
    # se entrada não for um Element válido, retorna vazio
    try:
        eid = e.Id
    except:
        results.append([to_dynamo(e), []])
        continue

    sistemas = get_circuitos_para_equip(e)
    results.append([to_dynamo(e), sistemas])

# Saída: lista de pares [Equipamento (Dynamo), [Circuito1, Circuito2, ...]]
OUT = results
# ----------------------------------------
flatten = List.Flatten(list=circuitos_por_quadro@L3)
restOfItems = List.RestOfItems(list=flatten@L2)
electricalcircuit_get_panels_and = Custom[ElectricalCircuit Get Panels and Elements](Electrical_Circuits=restOfItems@L2)  # package MEPover; Returns the Panels and Elements belonging to the given electrical circuits
flatten_2 = List.Flatten(list=electricalcircuit_get_panels_and.Elements@L2)

# group: Versão Revit
code_block = CodeBlock { 2021; }
version = Python()  # "Document.Version"; IronPython2; unwired: IN[0]
# ---------- version.python (13 lines) ----------
# Importa as bibliotecas necessárias do Revit
import clr
clr.AddReference('RevitServices')
from RevitServices.Persistence import DocumentManager

# Obtém o documento ativo
doc = DocumentManager.Instance.CurrentUIApplication.Application

# Obtém o número da versão do Revit
revit_version = doc.VersionNumber

# Retorna o número da versão do Revit
OUT = "A versão do Revit é: {}".format(revit_version)
# ----------------------------------------
code_block_2 = CodeBlock { " "; }
split = String.Split(string=version, separator0=code_block_2)
lastItem = List.LastItem(list=split)
toNumber = String.ToNumber(string=lastItem)

# group: comando
eq = code_block == toNumber
n2021 = CodeBlock { "ID da chave"; }  # "2021"
n2022_2023_2024_2025 = CodeBlock { "ID do comando"; }  # "2022 - 2023 - 2024 - 2025"
if_ = If(test=eq, true=n2021, false=n2022_2023_2024_2025)

dispositivos_de_iluminação = Python(IN[0]=flatten_2, IN[1]=if_)  # IronPython2
# ---------- dispositivos_de_iluminação.python (54 lines) ----------
import clr

clr.AddReference("RevitServices")
from RevitServices.Persistence import DocumentManager
doc = DocumentManager.Instance.CurrentDBDocument

clr.AddReference("RevitAPI")
from Autodesk.Revit.DB import *

clr.AddReference("RevitNodes")
import Revit
clr.ImportExtensions(Revit.Elements)

# Função auxiliar para "desempacotar" elementos do Dynamo
def Unwrap(item):
    return UnwrapElement(item)

# Verifica se o elemento possui o parâmetro
def TemParametro(elem, nome_parametro):
    if elem is None:
        return False
    try:
        return elem.LookupParameter(nome_parametro) is not None
    except:
        return False

# Verifica se o elemento é da categoria "Dispositivos de iluminação"
def EhDispositivoIluminacao(elem):
    return elem.Category.Id.IntegerValue == int(BuiltInCategory.OST_LightingDevices)

# === Entrada segura ===
entrada = IN[0]
nome_parametro = IN[1] if len(IN) > 1 else None  # Evita erro de índice

if not nome_parametro:
    OUT = None
else:
    # Garante que seja uma lista de listas
    if not isinstance(entrada, list):
        entrada = [[entrada]]
    elif not all(isinstance(sub, list) for sub in entrada):
        entrada = [entrada]

    resultado_final = []

    for sublista in entrada:
        subresultado = []
        for item in sublista:
            elem = Unwrap(item)
            if elem and TemParametro(elem, nome_parametro) and EhDispositivoIluminacao(elem):
                subresultado.append(item)
        resultado_final.append(subresultado)

    OUT = resultado_final
# ----------------------------------------
number = DoubleInput(0)
getParameterValueByName = Element.GetParameterValueByName(element=dispositivos_de_iluminação, parameterName=if_)
count = List.Count(list=getParameterValueByName@L2)
number_2 = DoubleInput(1)
range = Range(start=number, end=count, step=number_2)
python_script = Python(IN[0]=range)  # IronPython2
# ---------- python_script.python (37 lines) ----------
# Importa as bibliotecas do Revit/Dynamo
import sys
import clr

clr.AddReference('ProtoGeometry')
from Autodesk.DesignScript.Geometry import *

# Entrada do Dynamo
entrada = IN[0]  # Pode ser uma lista de índices numéricos ou uma lista de listas

# Função para converter um índice numérico em uma sequência alfabética tipo Excel
def numero_para_letras(num):
    letras = ""
    while num >= 0:
        letras = chr(97 + (num % 26)) + letras
        num = (num // 26) - 1
    return letras

# Verifica o tipo da entrada e processa de acordo
if isinstance(entrada, list):
    alfabeto_extendido = []
    for item in entrada:
        if isinstance(item, list):
            # Se o item for uma sublista, processa cada número dentro dela
            sublista_alfabetica = [numero_para_letras(i) for i in item]
            alfabeto_extendido.append(sublista_alfabetica)
        elif isinstance(item, int):
            # Se o item for um inteiro, processa diretamente
            alfabeto_extendido.append(numero_para_letras(item))
        else:
            # Lida com outros tipos de entrada, se necessário
            alfabeto_extendido.append([]) # Ou outra forma de tratamento
else:
    alfabeto_extendido = []  # Retorna lista vazia se a entrada não for uma lista

# Saída para o Dynamo
OUT = alfabeto_extendido
# ----------------------------------------
setParameterByName = Element.SetParameterByName(element=dispositivos_de_iluminação, parameterName=if_, value=python_script)
