# Dynamo graph 10-12_BIMACON_Atribuir Letras aos Comandos Por Circuito_R00_script.dyn (Dynamo 2.6.1.8786)
# Inseri Identificadores nas conexões
# packages: MEPover 2022.10.30

categories = Categories("OST_ElectricalEquipment")
all_elements_of_category = ElementsOfCategory(Category=categories)
python_script = Python(IN[0]=all_elements_of_category)
# ---------- python_script.python (41 lines) ----------
import clr

clr.AddReference("RevitServices")
import RevitServices
from RevitServices.Persistence import DocumentManager
doc = DocumentManager.Instance.CurrentDBDocument

clr.AddReference("RevitAPI")
from Autodesk.Revit.DB import *

clr.AddReference("RevitNodes")
import Revit
clr.ImportExtensions(Revit.Elements)

# Função auxiliar para desempacotar elementos
def Unwrap(item):
    return UnwrapElement(item)

# Função para processar listas aninhadas
def ProcessList(_func, _list):
    return map(lambda x: ProcessList(_func, x) if isinstance(x, list) else _func(x), _list)

# Converter entrada
equipamentos = ProcessList(Unwrap, IN[0]) if isinstance(IN[0], list) else [Unwrap(IN[0])]

# Função para obter circuitos do equipamento
def GetCircuitos(equipamento):
    if equipamento.MEPModel is not None:
        sistemas_set = equipamento.MEPModel.AssignedElectricalSystems
        if sistemas_set:
            sistemas = list(sistemas_set)  # Correção aqui!
            if len(sistemas) > 0:
                circuitos = [s.ToDSType(True) for s in sistemas]
                return [equipamento.ToDSType(True), circuitos]
    return None

# Aplicar função e filtrar nulos
resultados = [GetCircuitos(eq) for eq in equipamentos]
resultados_filtrados = [r for r in resultados if r is not None]

OUT = resultados_filtrados
# ----------------------------------------
flatten = List.Flatten(list=python_script@L3)
restOfItems = List.RestOfItems(list=flatten@L2)
electricalcircuit_get_panels_and = Custom[ElectricalCircuit Get Panels and Elements](Electrical_Circuits=restOfItems@L2)  # package MEPover; Returns the Panels and Elements belonging to the given electrical circuits
flatten_2 = List.Flatten(list=electricalcircuit_get_panels_and.Elements@L3)

# group: Versão Revit
code_block = CodeBlock { 2021; }
version = Python()  # "Document.Version"; unwired: IN[0]
# ---------- version.python (13 lines) ----------
# Importa as bibliotecas necessárias do Revit
import clr
clr.AddReference('RevitServices')
from RevitServices.Persistence import DocumentManager

# Obtém o documento ativo
doc = DocumentManager.Instance.CurrentUIApplication.Application

# Obtém o número da versão do Revit
revit_version = doc.VersionNumber

# Retorna o número da versão do Revit
OUT = "A versão do Revit é: {}".format(revit_version)
# ----------------------------------------
code_block_2 = CodeBlock { " "; }
split = String.Split(str=version, separator0=code_block_2)
lastItem = List.LastItem(list=split)
toNumber = String.ToNumber(str=lastItem)

# group: comando
eq = code_block == toNumber
n2021 = CodeBlock { "ID da chave"; }  # "2021"
n2022_2023_2024_2025 = CodeBlock { "ID do comando"; }  # "2022 - 2023 - 2024 - 2025"
if_ = If(test=eq, true=n2021, false=n2022_2023_2024_2025)

python_script_2 = Python(IN[0]=flatten_2, IN[1]=if_)
# ---------- python_script_2.python (54 lines) ----------
import clr

clr.AddReference("RevitServices")
from RevitServices.Persistence import DocumentManager
doc = DocumentManager.Instance.CurrentDBDocument

clr.AddReference("RevitAPI")
from Autodesk.Revit.DB import *

clr.AddReference("RevitNodes")
import Revit
clr.ImportExtensions(Revit.Elements)

# Função auxiliar para "desempacotar" elementos do Dynamo
def Unwrap(item):
    return UnwrapElement(item)

# Verifica se o elemento possui o parâmetro
def TemParametro(elem, nome_parametro):
    if elem is None:
        return False
    try:
        return elem.LookupParameter(nome_parametro) is not None
    except:
        return False

# Verifica se o elemento é da categoria "Dispositivos de iluminação"
def EhDispositivoIluminacao(elem):
    return elem.Category.Id.IntegerValue == int(BuiltInCategory.OST_LightingDevices)

# === Entrada segura ===
entrada = IN[0]
nome_parametro = IN[1] if len(IN) > 1 else None  # Evita erro de índice

if not nome_parametro:
    OUT = None
else:
    # Garante que seja uma lista de listas
    if not isinstance(entrada, list):
        entrada = [[entrada]]
    elif not all(isinstance(sub, list) for sub in entrada):
        entrada = [entrada]

    resultado_final = []

    for sublista in entrada:
        subresultado = []
        for item in sublista:
            elem = Unwrap(item)
            if elem and TemParametro(elem, nome_parametro) and EhDispositivoIluminacao(elem):
                subresultado.append(item)
        resultado_final.append(subresultado)

    OUT = resultado_final
# ----------------------------------------
number = DoubleInput(0)
getParameterValueByName = Element.GetParameterValueByName(element=python_script_2, parameterName=if_)
count = List.Count(list=getParameterValueByName@L2)
number_2 = DoubleInput(1)
range = Range(start=number, end=count, step=number_2)
python_script_3 = Python(IN[0]=range)
# ---------- python_script_3.python (37 lines) ----------
# Importa as bibliotecas do Revit/Dynamo
import sys
import clr

clr.AddReference('ProtoGeometry')
from Autodesk.DesignScript.Geometry import *

# Entrada do Dynamo
entrada = IN[0]  # Pode ser uma lista de índices numéricos ou uma lista de listas

# Função para converter um índice numérico em uma sequência alfabética tipo Excel
def numero_para_letras(num):
    letras = ""
    while num >= 0:
        letras = chr(97 + (num % 26)) + letras
        num = (num // 26) - 1
    return letras

# Verifica o tipo da entrada e processa de acordo
if isinstance(entrada, list):
    alfabeto_extendido = []
    for item in entrada:
        if isinstance(item, list):
            # Se o item for uma sublista, processa cada número dentro dela
            sublista_alfabetica = [numero_para_letras(i) for i in item]
            alfabeto_extendido.append(sublista_alfabetica)
        elif isinstance(item, int):
            # Se o item for um inteiro, processa diretamente
            alfabeto_extendido.append(numero_para_letras(item))
        else:
            # Lida com outros tipos de entrada, se necessário
            alfabeto_extendido.append([]) # Ou outra forma de tratamento
else:
    alfabeto_extendido = []  # Retorna lista vazia se a entrada não for uma lista

# Saída para o Dynamo
OUT = alfabeto_extendido
# ----------------------------------------
setParameterByName = Element.SetParameterByName(element=python_script_2, parameterName=if_, value=python_script_3)
