# Dynamo graph 10-5_BIMACON_Atribuir Letras aos Comandos_R01_script.dyn "ok 10-5_BIMACON_Atribuir Letras aos Comandos_R01_script" (Dynamo 2.19.3.6394)
# author: Jose Nelson
# Inseri Identificadores nas conexões

categories = Categories("OST_LightingDevices")
categories_2 = Categories("OST_ElectricalFixtures")
list_create = List.Create(item0=categories, item1=categories_2)
all_elements_of_category = ElementsOfCategory(Category=list_create)
flatten = List.Flatten(list=all_elements_of_category)
getFamily = FamilyInstance.GetFamily(familyInstance=all_elements_of_category)
flatten_2 = List.Flatten(list=getFamily)
string_from_object = FromObject(object=flatten_2)
code_block = CodeBlock { "Sensor"; }
contains = String.Contains(string=string_from_object, searchFor=code_block)
filterByBoolMask = List.FilterByBoolMask(list=flatten, mask=contains)
string_from_object_2 = FromObject(object=flatten)
code_block_2 = CodeBlock { "Simples"; }
contains_2 = String.Contains(string=string_from_object_2, searchFor=code_block_2)
filterByBoolMask_2 = List.FilterByBoolMask(list=flatten, mask=contains_2@L2)
code_block_3 = CodeBlock { "Paralelo"; }
contains_3 = String.Contains(string=string_from_object_2, searchFor=code_block_3)
filterByBoolMask_3 = List.FilterByBoolMask(list=flatten, mask=contains_3@L2)
code_block_4 = CodeBlock { "Intermediário"; }
contains_4 = String.Contains(string=string_from_object_2, searchFor=code_block_4)
filterByBoolMask_4 = List.FilterByBoolMask(list=flatten, mask=contains_4@L2)
code_block_5 = CodeBlock { "Pulsador"; }
contains_5 = String.Contains(string=string_from_object_2, searchFor=code_block_5)
filterByBoolMask_5 = List.FilterByBoolMask(list=flatten, mask=contains_5@L2)
list_create_2 = List.Create(item0=filterByBoolMask_2.in, item1=filterByBoolMask_3.in, item2=filterByBoolMask_4.in, item3=filterByBoolMask_5.in)
flatten_3 = List.Flatten(list=list_create_2)
uniqueItems = List.UniqueItems(list=flatten_3)
getChildElements = Element.GetChildElements(element=uniqueItems)
string_from_object_3 = FromObject(object=getChildElements)
code_block_6 = CodeBlock { ["Caixa de Luz"]; }
contains_6 = String.Contains(string=string_from_object_3@L2, searchFor=code_block_6, lacing=Longest)
filterByBoolMask_6 = List.FilterByBoolMask(list=getChildElements@L2, mask=contains_6@L2)
string_from_object_4 = FromObject(object=filterByBoolMask_6.out)
code_block_7 = CodeBlock { ["Tomada"]; }
contains_7 = String.Contains(string=string_from_object_4@L2, searchFor=code_block_7, lacing=Longest)
filterByBoolMask_7 = List.FilterByBoolMask(list=filterByBoolMask_6.out@L2, mask=contains_7@L2)
list_create_3 = List.Create(item0=filterByBoolMask.in, item1=filterByBoolMask_7.out)
flatten_4 = List.Flatten(list=list_create_3)

# group: Versão Revit
code_block_8 = CodeBlock { 2021; }
version = Python()  # "Document.Version"; IronPython2; unwired: IN[0]
# ---------- version.python (13 lines) ----------
# Importa as bibliotecas necessárias do Revit
import clr
clr.AddReference('RevitServices')
from RevitServices.Persistence import DocumentManager

# Obtém o documento ativo
doc = DocumentManager.Instance.CurrentUIApplication.Application

# Obtém o número da versão do Revit
revit_version = doc.VersionNumber

# Retorna o número da versão do Revit
OUT = "A versão do Revit é: {}".format(revit_version)
# ----------------------------------------
code_block_9 = CodeBlock { " "; }
split = String.Split(string=version, separator0=code_block_9)
lastItem = List.LastItem(list=split)
toNumber = String.ToNumber(string=lastItem)

# group: comando
eq = code_block_8 == toNumber
n2021 = CodeBlock { "ID da chave"; }  # "2021"
n2022_2023_2024_2025 = CodeBlock { "ID do comando"; }  # "2022 - 2023 - 2024 - 2025"
if_ = If(test=eq, true=n2021, false=n2022_2023_2024_2025)

number = DoubleInput(0)
getParameterValueByName = Element.GetParameterValueByName(element=flatten_4, parameterName=if_)
count = List.Count(list=getParameterValueByName)
number_2 = DoubleInput(1)
range = Range(start=number, end=count, step=number_2)
python_script = Python(IN[0]=range)  # IronPython2
# ---------- python_script.python (25 lines) ----------
# Importa as bibliotecas do Revit/Dynamo
import sys
import clr
clr.AddReference('ProtoGeometry')
from Autodesk.DesignScript.Geometry import *

# Entrada do Dynamo
entrada = IN[0]  # Pode ser uma lista de índices numéricos

# Função para converter um índice numérico em uma sequência alfabética tipo Excel
def numero_para_letras(num):
    letras = ""
    while num >= 0:
        letras = chr(97 + (num % 26)) + letras
        num = (num // 26) - 1
    return letras

# Verifica se a entrada é uma lista e gera a sequência alfabética correspondente
if isinstance(entrada, list) and len(entrada) > 0:
    alfabeto_extendido = [numero_para_letras(i) for i in entrada]
else:
    alfabeto_extendido = []  # Retorna lista vazia se a entrada for inválida

# Saída para o Dynamo
OUT = alfabeto_extendido
# ----------------------------------------
setParameterByName = Element.SetParameterByName(element=flatten_4, parameterName=if_, value=python_script)
watch = Watch(python_script)
watch_2 = Watch(flatten_4)
watch_3 = Watch(filterByBoolMask.in)
