# Dynamo graph 09-0_BIMACON_Mudar Circuitos de Quadro_R02_script.dyn "ok 2021_09-0_BIMACON_Mudar Circuitos de Quadro_R02_script" (Dynamo 2.19.3.6394)
# author: Jose Nelson
# Transfere Circuitos de um quadro para outro por meio da seleção dos quadros
# packages: MEPover 2022.10.30, Data-Shapes 2022.2.105

# group: ENTRADAS PARA O USUÁRIO
code_block = CodeBlock { "Mudar Circuitos de Quadro"; }
string = StringInput("LogoBimacon.png")
python_script = Python(IN[0]=string)  # IronPython2
# ---------- python_script.python (22 lines) ----------
import clr

# Adiciona referência ao ambiente .NET
clr.AddReference('System')
from System import Environment, IO

# Nome da imagem (entrada do usuário)
nome_arquivo_imagem = IN[0]

# Recupera o nome do usuário logado no Windows
usuario = Environment.UserName

# Monta o caminho completo para a pasta de imagens
caminho_base = r"C:\Users\{0}\AppData\Roaming\pyRevit\Extensions\Bimacon.extension\Bimacon.tab\Imagens_Bimacon".format(usuario)

# Junta o caminho base com o nome do arquivo
caminho_completo = IO.Path.Combine(caminho_base, nome_arquivo_imagem)

# Verifica se o arquivo existe
existe = IO.File.Exists(caminho_completo)

OUT = caminho_completo if existe else "Imagem não encontrada: {0}".format(caminho_completo)
# ----------------------------------------
file_from_path = FileObject(path=python_script)
readFromFile = Image.ReadFromFile(file=file_from_path)
string_2 = StringInput("Confirmar")
string_3 = StringInput("Selecione o Quadro a Mudar")
string_4 = StringInput("Selecione ")
categories = Categories("OST_ElectricalEquipment")
boolean = BoolSelector(true)
selectmodelelements_data = Custom[SelectModelElements Data](InputName=string_3, ButtonText=string_4, CategoryFilter=categories, SelectSingleElement=boolean)  # package Data-Shapes; Creates a Revit element selection input for UI.MultipleInputForm++ . Check out www.data-shapes.net for more infos!
string_5 = StringInput("Selecione o Novo Quadro")
string_6 = StringInput("Selecione ")
categories_2 = Categories("OST_ElectricalEquipment")
boolean_2 = BoolSelector(true)
selectmodelelements_data_2 = Custom[SelectModelElements Data](InputName=string_5, ButtonText=string_6, CategoryFilter=categories_2, SelectSingleElement=boolean_2)
list_create = List.Create(item0=selectmodelelements_data, item1=selectmodelelements_data_2)
boolean_3 = BoolSelector(true)
string_7 = StringInput("Cancelar")
number = DoubleInput(400)
number_2 = DoubleInput(180)
multipleinputform = Custom[MultipleInputForm ++](Description_optional=code_block, Logo_optional=readFromFile, ButtonText_optional=string_2, Inputs=list_create, Toggle=boolean_3, CancelButtonText_optional=string_7, Width_optional=number, LabelWidth_optional=number_2)  # package Data-Shapes; Create a form with multiple inputs. see www.data-shapes.net for tutorials and infos!
code_block_2 = CodeBlock()  # //Data-Shapes
code_block_3 = CodeBlock()  # //archilab

# group: Separar Entradas
code_block_4 = CodeBlock { 1; }
getItemAtIndex = List.GetItemAtIndex(list=multipleinputform.User_Inputs, index=code_block_4)
code_block_5 = CodeBlock { 0; }
getItemAtIndex_2 = List.GetItemAtIndex(list=multipleinputform.User_Inputs, index=code_block_5)

electricalCircuit = Custom[Element.ElectricalCircuit](element=getItemAtIndex_2)  # package MEPover; Returns the electrical circuit of the element

# group: Remover circuito do Quadro Selecionado
name = Element.Name(element=getItemAtIndex_2)
string_8 = StringInput("Nome da carga")
getParameterValueByName = Element.GetParameterValueByName(element=electricalCircuit, parameterName=string_8)
eq = name == getParameterValueByName
filterByBoolMask = List.FilterByBoolMask(list=electricalCircuit, mask=eq)

addToPanel = Custom[ElectricalSystem.AddToPanel](panel=getItemAtIndex, Circuits=filterByBoolMask.out)  # package MEPover; Adds the circuits to the panel

# group: Mensagem final
count = List.Count(list=addToPanel.Success)
code_block_6 = CodeBlock { 0; }
gt = count > code_block_6
code_block_7 = CodeBlock(N=count) { ["Feito! você mudou "+N+" circuitos para outro Quadro"]; }
code_block_8 = CodeBlock { ["Nenhum circuito foi alterado! Verifique se o Sistema de distribuição está definido para o Quadro Destino."]; }
if_ = If(test=gt, true=code_block_7, false=code_block_8)
flatten = List.Flatten(list=if_)
fromList = Python(IN[0]=flatten)  # "String.FromList"; IronPython2
# ---------- fromList.python (22 lines) ----------
# Carregar as bibliotecas DesignScript e padrão do Python
import sys
import clr
clr.AddReference('ProtoGeometry')
from Autodesk.DesignScript.Geometry import *

# Função para concatenar os valores de uma lista em uma única string com múltiplas linhas
def concatenate_list_to_string(input_list, delimiter="\n"):
    # Verifica se a entrada é uma lista
    if not isinstance(input_list, list):
        return "A entrada deve ser uma lista."
    
    # Converte todos os elementos para string e junta com o delimitador especificado
    result = delimiter.join(str(item) for item in input_list)
    return result

# Entrada pelo nó do Dynamo
lista = IN[0]  # Lista de valores a serem concatenados
delimitador = IN[1] if len(IN) > 1 else "\n"  # Delimitador opcional, padrão é nova linha

# Saída para o Dynamo
OUT = concatenate_list_to_string(lista, delimitador)
# ----------------------------------------
python_script_2 = Python(IN[0]=fromList)  # IronPython2
# ---------- python_script_2.python (21 lines) ----------
# Importar as bibliotecas necessárias do Revit
import clr
clr.AddReference("RevitServices")
from RevitServices.Persistence import DocumentManager

clr.AddReference("RevitAPI")
clr.AddReference("RevitAPIUI")
from Autodesk.Revit.UI import TaskDialog

# Pegar a entrada do Dynamo
mensagem = IN[0]

# Criar a TaskDialog
task_dialog = TaskDialog("Ok")
task_dialog.MainInstruction = mensagem

# Exibir a TaskDialog
task_dialog.Show()

# Saída do script
OUT = "Sucesso!"
# ----------------------------------------
