# Dynamo graph ok 09-3_BIMACON_Alterar FP de Circuitos_R01_script.dyn "ok 09-3_BIMACON_Alterar FP de Circuitos_script" (Dynamo 2.6.1.8786)
# packages: Data-Shapes 2022.2.105

categories = Categories("OST_ElectricalFixtures")
categories_2 = Categories("OST_LightingFixtures")
list_create = List.Create(item0=categories, item1=categories_2)
all_elements_of_category = ElementsOfCategory(Category=list_create)
flatten = List.Flatten(list=all_elements_of_category)

# group: Versão Revit
code_block = CodeBlock { 2025; }
version = Python()  # "Document.Version"; unwired: IN[0]
# ---------- version.python (13 lines) ----------
# Importa as bibliotecas necessárias do Revit
import clr
clr.AddReference('RevitServices')
from RevitServices.Persistence import DocumentManager

# Obtém o documento ativo
doc = DocumentManager.Instance.CurrentUIApplication.Application

# Obtém o número da versão do Revit
revit_version = doc.VersionNumber

# Retorna o número da versão do Revit
OUT = "A versão do Revit é: {}".format(revit_version)
# ----------------------------------------
code_block_2 = CodeBlock { " "; }
split = String.Split(str=version, separator0=code_block_2)
lastItem = List.LastItem(list=split)
toNumber = String.ToNumber(str=lastItem)

# group: Painel e Nº do circuito
le = code_block <= toNumber
n2021_2022_2023_2024_2025 = CodeBlock { ["Painel", "Número do circuito"]; }  # "2021 - 2022 - 2023 - 2024 - 2025"
n2026 = CodeBlock { ["Painel", "Número do circuito"]; }  # "2026"
if_ = If(test=le, true=n2021_2022_2023_2024_2025, false=n2026)

# group: ENTRADAS PARA O USUÁRIO
code_block_3 = CodeBlock()  # //Data-Shapes
code_block_4 = CodeBlock()  # //archilab
code_block_5 = CodeBlock { "Alterar Fator de Potência do Circuito"; }
file_path = Filename("..\..\..\..\..\05 - BIMACON\01 - EMPRESA BIMACON\00 - Logos e imagens - BIMACON\ARTE BIMACON\reddonda-removebg-preview.png")
file_from_path = FileObject(path=file_path)
readFromFile = Image.ReadFromFile(file=file_from_path)
string = StringInput("Continuar")
string_2 = StringInput("Escolha o Quadro e o circuito")
categories_3 = Categories("OST_ElectricalCircuit")
all_elements_of_category_2 = ElementsOfCategory(Category=categories_3)
parameterByName = Parameter.ParameterByName(element=all_elements_of_category_2, name=if_, lacing=CrossProduct)
transpose = List.Transpose(lists=parameterByName)
string_from_object = FromObject(object=transpose)
code_block_6 = CodeBlock { " : "; }
split_2 = String.Split(str=string_from_object, separator0=code_block_6)
code_block_7 = CodeBlock(list=split_2) { list[0] + " - " + list[1]; }
count = List.Count(list=code_block_7, lacing=Longest)
code_block_8 = CodeBlock { 1; }
gt = count > code_block_8
filterByBoolMask = List.FilterByBoolMask(list=code_block_7, mask=gt)
code_block_9 = CodeBlock { 1; }
getItemAtIndex = List.GetItemAtIndex(list=filterByBoolMask.in, index=code_block_9, lacing=CrossProduct)
boolean = BoolSelector(false)
string_3 = StringInput("Fator de Potência")
string_4 = StringInput("0.92")
boolean_2 = BoolSelector(true)
textbox_data = Custom[TextBox Data](InputName=string_3, DefaultText=string_4, IsNumberEntry=boolean_2)  # package Data-Shapes; Create Data for TextBox input in UI.MultipleInputForm ++ . Check out www.data-shapes.net for more informations
boolean_3 = BoolSelector(true)
string_5 = StringInput("Cancelar")
number = DoubleInput(450)
number_2 = DoubleInput(200)

parameterByName_2 = Parameter.ParameterByName(element=flatten, name=if_, lacing=CrossProduct)
transpose_2 = List.Transpose(lists=parameterByName_2)
string_from_object_2 = FromObject(obj=transpose_2)
code_block_10 = CodeBlock { " : "; }
split_3 = String.Split(str=string_from_object_2, separator0=code_block_10)
code_block_11 = CodeBlock(list=split_3) { list[0] + " - " + list[1]; }
code_block_12 = CodeBlock { 1; }
getItemAtIndex_2 = List.GetItemAtIndex(list=code_block_11, index=code_block_12, lacing=CrossProduct)
number_3 = DoubleInput(0)
dropdown_data = Custom[DropDown Data](InputName=string_2, Keys=getItemAtIndex, Values=getItemAtIndex, DefaultValueIndex=number_3, Sorted_optional=boolean)  # package Data-Shapes; Create data for DropDown input in UI.MultiInputForm ++ . Check out www.data-shapes.net for more infos.

# group (continued): ENTRADAS PARA O USUÁRIO
list_create_2 = List.Create(item0=dropdown_data, item1=textbox_data)
multipleinputform = Custom[MultipleInputForm ++](Description_optional=code_block_5, Logo_optional=readFromFile, ButtonText_optional=string, Inputs=list_create_2, Toggle=boolean_3, CancelButtonText_optional=string_5, Width_optional=number, LabelWidth_optional=number_2)  # package Data-Shapes; Create a form with multiple inputs. see www.data-shapes.net for tutorials and infos!

# group: Separar Entradas
code_block_13 = CodeBlock { 0; }
getItemAtIndex_3 = List.GetItemAtIndex(list=multipleinputform.User_Inputs, index=code_block_13)
code_block_14 = CodeBlock { 1; }
getItemAtIndex_4 = List.GetItemAtIndex(list=multipleinputform.User_Inputs, index=code_block_14)

eq = getItemAtIndex_2 == getItemAtIndex_3  # lacing=Longest
filterByBoolMask_2 = List.FilterByBoolMask(list=flatten, mask=eq)
getParentElement = Element.GetParentElement(element=filterByBoolMask_2.in)
isNull = Object.IsNull(obj=getParentElement)
filterByBoolMask_3 = List.FilterByBoolMask(list=filterByBoolMask_2.in, mask=isNull)
filterByBoolMask_4 = List.FilterByBoolMask(list=getParentElement, mask=isNull)
list_create_3 = List.Create(item0=filterByBoolMask_3.in, item1=filterByBoolMask_4.out)
flatten_2 = List.Flatten(list=list_create_3)
uniqueItems = List.UniqueItems(list=flatten_2)
code_block_15 = CodeBlock { "Fator de Potência"; }
setParameterByName = Element.SetParameterByName(element=uniqueItems, parameterName=code_block_15, value=getItemAtIndex_4)
code_block_16 = CodeBlock { "Tomada 1_Fator de Potência"; }
setParameterByName_2 = Element.SetParameterByName(element=uniqueItems, parameterName=code_block_16, value=getItemAtIndex_4)
code_block_17 = CodeBlock { "Tomada 2_Fator de Potência"; }
setParameterByName_3 = Element.SetParameterByName(element=uniqueItems, parameterName=code_block_17, value=getItemAtIndex_4)
code_block_18 = CodeBlock { "Tomada 3_Fator de Potência"; }
setParameterByName_4 = Element.SetParameterByName(element=uniqueItems, parameterName=code_block_18, value=getItemAtIndex_4)
list_create_4 = List.Create(item0=setParameterByName, item1=setParameterByName_2, item2=setParameterByName_3, item3=setParameterByName_4)

# group: Mensagem final
count_2 = List.Count(list=list_create_4)
code_block_19 = CodeBlock { 0; }
gt_2 = count_2 > code_block_19
code_block_20 = CodeBlock(N=count_2) { ["Feito! Você alterou o FP de "+N+" elementos"]; }
code_block_21 = CodeBlock { ["Nenhum FP alterado"]; }
if_2 = If(test=gt_2, true=code_block_20, false=code_block_21)
flatten_3 = List.Flatten(list=if_2)
fromList = Python(IN[0]=flatten_3)  # "String.FromList"
# ---------- fromList.python (22 lines) ----------
# Carregar as bibliotecas DesignScript e padrão do Python
import sys
import clr
clr.AddReference('ProtoGeometry')
from Autodesk.DesignScript.Geometry import *

# Função para concatenar os valores de uma lista em uma única string com múltiplas linhas
def concatenate_list_to_string(input_list, delimiter="\n"):
    # Verifica se a entrada é uma lista
    if not isinstance(input_list, list):
        return "A entrada deve ser uma lista."
    
    # Converte todos os elementos para string e junta com o delimitador especificado
    result = delimiter.join(str(item) for item in input_list)
    return result

# Entrada pelo nó do Dynamo
lista = IN[0]  # Lista de valores a serem concatenados
delimitador = IN[1] if len(IN) > 1 else "\n"  # Delimitador opcional, padrão é nova linha

# Saída para o Dynamo
OUT = concatenate_list_to_string(lista, delimitador)
# ----------------------------------------
python_script = Python(IN[0]=fromList)
# ---------- python_script.python (21 lines) ----------
# Importar as bibliotecas necessárias do Revit
import clr
clr.AddReference("RevitServices")
from RevitServices.Persistence import DocumentManager

clr.AddReference("RevitAPI")
clr.AddReference("RevitAPIUI")
from Autodesk.Revit.UI import TaskDialog

# Pegar a entrada do Dynamo
mensagem = IN[0]

# Criar a TaskDialog
task_dialog = TaskDialog("Ok")
task_dialog.MainInstruction = mensagem

# Exibir a TaskDialog
task_dialog.Show()

# Saída do script
OUT = "Sucesso!"
# ----------------------------------------
