# Dynamo graph 03-4_BIMACON_Alterar Fator Agrupamento ou Temperatura de Circuitos_R00_script.dyn (Dynamo 2.16.4.10216)
# author: Jose Nelson
# Altera o FP de todos pontos do Circuito
# packages: Data-Shapes 2022.2.105

code_block = CodeBlock { ["FCA","FCT"]; }

# group: Versão Revit
code_block_2 = CodeBlock { 2025; }
version = Python()  # "Document.Version"; IronPython2; unwired: IN[0]
# ---------- version.python (13 lines) ----------
# Importa as bibliotecas necessárias do Revit
import clr
clr.AddReference('RevitServices')
from RevitServices.Persistence import DocumentManager

# Obtém o documento ativo
doc = DocumentManager.Instance.CurrentUIApplication.Application

# Obtém o número da versão do Revit
revit_version = doc.VersionNumber

# Retorna o número da versão do Revit
OUT = "A versão do Revit é: {}".format(revit_version)
# ----------------------------------------
code_block_3 = CodeBlock { " "; }
split = String.Split(string=version, separator0=code_block_3)
lastItem = List.LastItem(list=split)
toNumber = String.ToNumber(string=lastItem)

# group: Painel e Nº do circuito
le = code_block_2 <= toNumber
n2026 = CodeBlock { ["Painel"]; }  # "2026"
n2021_2022_2023_2024_2025 = CodeBlock { ["Painel"]; }  # "2021 - 2022 - 2023 - 2024 - 2025"
if_ = If(test=le, true=n2026, false=n2021_2022_2023_2024_2025)
n2026_2 = CodeBlock { ["Painel", "Número do circuito","Nome da carga"]; }  # "2026"
n2021_2022_2023_2024_2025_2 = CodeBlock { ["Painel", "Número do circuito","Nome da carga"]; }  # "2021 - 2022 - 2023 - 2024 - 2025"
if_2 = If(test=le, true=n2026_2, false=n2021_2022_2023_2024_2025_2)

# group: ENTRADAS PARA O USUÁRIO
categories = Categories("OST_ElectricalCircuit")
all_elements_of_category = ElementsOfCategory(Category=categories)
code_block_4 = CodeBlock()  # //Data-Shapes
code_block_5 = CodeBlock()  # //archilab
boolean = BoolSelector(false)
parameterByName = Parameter.ParameterByName(element=all_elements_of_category, name=if_2, lacing=CrossProduct)
transpose = List.Transpose(lists=parameterByName)
string_from_object = FromObject(obj=transpose)
code_block_6 = CodeBlock { " : "; }
split_2 = String.Split(string=string_from_object, separator0=code_block_6)
code_block_7 = CodeBlock(list=split_2) { list[0] + " - " + list[1] + " - " + list[2]; }
count = List.Count(list=code_block_7, lacing=Longest)
code_block_8 = CodeBlock { 1; }
gt = count > code_block_8
filterByBoolMask = List.FilterByBoolMask(list=code_block_7, mask=gt)
code_block_9 = CodeBlock { 1; }
getItemAtIndex = List.GetItemAtIndex(list=filterByBoolMask.in@L2, index=code_block_9, lacing=CrossProduct)
code_block_10 = CodeBlock { "Alterar Fator de Potência do Circuito"; }
string = StringInput("LogoBimacon.png")
python_script = Python(IN[0]=string)  # IronPython2
# ---------- python_script.python (22 lines) ----------
import clr

# Adiciona referência ao ambiente .NET
clr.AddReference('System')
from System import Environment, IO

# Nome da imagem (entrada do usuário)
nome_arquivo_imagem = IN[0]

# Recupera o nome do usuário logado no Windows
usuario = Environment.UserName

# Monta o caminho completo para a pasta de imagens
caminho_base = r"C:\Users\{0}\AppData\Roaming\pyRevit\Extensions\Bimacon.extension\Bimacon.tab\Imagens_Bimacon".format(usuario)

# Junta o caminho base com o nome do arquivo
caminho_completo = IO.Path.Combine(caminho_base, nome_arquivo_imagem)

# Verifica se o arquivo existe
existe = IO.File.Exists(caminho_completo)

OUT = caminho_completo if existe else "Imagem não encontrada: {0}".format(caminho_completo)
# ----------------------------------------
file_from_path = FileObject(path=python_script)
readFromFile = Image.ReadFromFile(file=file_from_path)
string_2 = StringInput("Continuar")
string_3 = StringInput("Escolha o(s) Quadro(s) e Cirtuito(s)")
listview_data = Custom[Listview Data](InputName=string_3, Keys=getItemAtIndex, Values=getItemAtIndex)  # package Data-Shapes; Create data for ListView input in UI.MultiInputForm ++ . Check out www.data-shapes.net for more infos.
string_4 = StringInput("FCA - Fator de Agrupamento")
string_5 = StringInput("1")
boolean_2 = BoolSelector(true)
textbox_data = Custom[TextBox Data](InputName=string_4, DefaultText=string_5, IsNumberEntry=boolean_2)  # package Data-Shapes; Create Data for TextBox input in UI.MultipleInputForm ++ . Check out www.data-shapes.net for more informations
string_6 = StringInput("FCT - Fator de Temperatura")
string_7 = StringInput("1")
boolean_3 = BoolSelector(true)
textbox_data_2 = Custom[TextBox Data](InputName=string_6, DefaultText=string_7, IsNumberEntry=boolean_3)
list_create = List.Create(item0=listview_data, item1=textbox_data, item2=textbox_data_2)
boolean_4 = BoolSelector(true)
string_8 = StringInput("Cancelar")
number = DoubleInput(700)
number_2 = DoubleInput(220)
multipleinputform = Custom[MultipleInputForm ++](Description_optional=code_block_10, Logo_optional=readFromFile, ButtonText_optional=string_2, Inputs=list_create, Toggle=boolean_4, CancelButtonText_optional=string_8, Width_optional=number, LabelWidth_optional=number_2)  # package Data-Shapes; Create a form with multiple inputs. see www.data-shapes.net for tutorials and infos!
number_3 = DoubleInput(0)

parameterByName_2 = Parameter.ParameterByName(element=all_elements_of_category, name=code_block, lacing=CrossProduct)

# group: Separar Entradas
code_block_11 = CodeBlock { 0; }
getItemAtIndex_2 = List.GetItemAtIndex(list=multipleinputform.User_Inputs, index=code_block_11)
code_block_12 = CodeBlock { 1; }
getItemAtIndex_3 = List.GetItemAtIndex(list=multipleinputform.User_Inputs, index=code_block_12)
code_block_13 = CodeBlock { 1; }
getItemAtIndex_4 = List.GetItemAtIndex(list=multipleinputform.User_Inputs, index=code_block_13)

contains = String.Contains(string=getItemAtIndex, searchFor=getItemAtIndex_2, lacing=CrossProduct)
allFalse = List.AllFalse(list=contains@L2)
filterByBoolMask_2 = List.FilterByBoolMask(list=all_elements_of_category, mask=allFalse)
code_block_14 = CodeBlock(a=code_block) { a[0]; a[1]; }
setParameterByName = Element.SetParameterByName(element=filterByBoolMask_2.out, parameterName=code_block_14.out0, value=getItemAtIndex_3)
flatten = List.Flatten(list=setParameterByName)
boolean_5 = BoolSelector(false)
clean = List.Clean(list=flatten, preserveIndices=boolean_5)

# group: Mensagem final
count_2 = List.Count(list=clean)
code_block_15 = CodeBlock { 0; }
gt_2 = count_2 > code_block_15
code_block_16 = CodeBlock(N=count_2) { ["Feito! Você alterou o Fator de "+N+" circuitos"]; }
code_block_17 = CodeBlock { ["Nenhum Fator alterado"]; }
if_3 = If(test=gt_2, true=code_block_16, false=code_block_17)
flatten_2 = List.Flatten(list=if_3)
fromList = Python(IN[0]=flatten_2)  # "String.FromList"; IronPython2
# ---------- fromList.python (22 lines) ----------
# Carregar as bibliotecas DesignScript e padrão do Python
import sys
import clr
clr.AddReference('ProtoGeometry')
from Autodesk.DesignScript.Geometry import *

# Função para concatenar os valores de uma lista em uma única string com múltiplas linhas
def concatenate_list_to_string(input_list, delimiter="\n"):
    # Verifica se a entrada é uma lista
    if not isinstance(input_list, list):
        return "A entrada deve ser uma lista."
    
    # Converte todos os elementos para string e junta com o delimitador especificado
    result = delimiter.join(str(item) for item in input_list)
    return result

# Entrada pelo nó do Dynamo
lista = IN[0]  # Lista de valores a serem concatenados
delimitador = IN[1] if len(IN) > 1 else "\n"  # Delimitador opcional, padrão é nova linha

# Saída para o Dynamo
OUT = concatenate_list_to_string(lista, delimitador)
# ----------------------------------------
python_script_2 = Python(IN[0]=fromList)  # IronPython2
# ---------- python_script_2.python (21 lines) ----------
# Importar as bibliotecas necessárias do Revit
import clr
clr.AddReference("RevitServices")
from RevitServices.Persistence import DocumentManager

clr.AddReference("RevitAPI")
clr.AddReference("RevitAPIUI")
from Autodesk.Revit.UI import TaskDialog

# Pegar a entrada do Dynamo
mensagem = IN[0]

# Criar a TaskDialog
task_dialog = TaskDialog("Ok")
task_dialog.MainInstruction = mensagem

# Exibir a TaskDialog
task_dialog.Show()

# Saída do script
OUT = "Sucesso!"
# ----------------------------------------

setParameterByName_2 = Element.SetParameterByName(element=filterByBoolMask_2.out, parameterName=code_block_14.out1, value=getItemAtIndex_4)
string_from_object_2 = FromObject(object=parameterByName)
watch = Watch(filterByBoolMask_2.out)
