# Dynamo graph 03-1_BIMACON_Atribuir Potência Ativa (W) por Quadro_R02_script.dyn "ok 03-1_BIMACON_Atribuir Potência Ativa (W) por Quadro_R02_script" (Dynamo 2.19.3.6394)
# author: Jose Nelson
# "Atribuir Potência Ativa (W) no Quadro
# packages: DynaMEP 2.0.1, Rhythm 2023.4.2024, MEPover 2022.10.30, Rhythm 2023.4.2021, Data-Shapes 2022.2.105

# group: ENTRADAS PARA O USUÁRIO
code_block = CodeBlock { "Atribuir Potência Ativa (W) no Quadro"; }
string = StringInput("LogoBimacon.png")
python_script = Python(IN[0]=string)  # IronPython2
# ---------- python_script.python (22 lines) ----------
import clr

# Adiciona referência ao ambiente .NET
clr.AddReference('System')
from System import Environment, IO

# Nome da imagem (entrada do usuário)
nome_arquivo_imagem = IN[0]

# Recupera o nome do usuário logado no Windows
usuario = Environment.UserName

# Monta o caminho completo para a pasta de imagens
caminho_base = r"C:\Users\{0}\AppData\Roaming\pyRevit\Extensions\Bimacon.extension\Bimacon.tab\Imagens_Bimacon".format(usuario)

# Junta o caminho base com o nome do arquivo
caminho_completo = IO.Path.Combine(caminho_base, nome_arquivo_imagem)

# Verifica se o arquivo existe
existe = IO.File.Exists(caminho_completo)

OUT = caminho_completo if existe else "Imagem não encontrada: {0}".format(caminho_completo)
# ----------------------------------------
file_from_path = FileObject(path=python_script)
readFromFile = Image.ReadFromFile(file=file_from_path)
string_2 = StringInput("Confirmar")
string_3 = StringInput("Selecione o Quadro")
string_4 = StringInput("Selecione ")
categories = Categories("OST_ElectricalEquipment")
boolean = BoolSelector(true)
selectmodelelements_data = Custom[SelectModelElements Data](InputName=string_3, ButtonText=string_4, CategoryFilter=categories, SelectSingleElement=boolean)  # package Data-Shapes; Creates a Revit element selection input for UI.MultipleInputForm++ . Check out www.data-shapes.net for more infos!
list_create = List.Create(item0=selectmodelelements_data)
boolean_2 = BoolSelector(true)
string_5 = StringInput("Cancelar")
number = DoubleInput(300)
number_2 = DoubleInput(165)
multipleinputform = Custom[MultipleInputForm ++](Description_optional=code_block, Logo_optional=readFromFile, ButtonText_optional=string_2, Inputs=list_create, Toggle=boolean_2, CancelButtonText_optional=string_5, Width_optional=number, LabelWidth_optional=number_2)  # package Data-Shapes; Create a form with multiple inputs. see www.data-shapes.net for tutorials and infos!
code_block_2 = CodeBlock()  # //Data-Shapes
code_block_3 = CodeBlock()  # //archilab

# group: Separar Entradas
code_block_4 = CodeBlock { 0; }
getItemAtIndex = List.GetItemAtIndex(list=multipleinputform.User_Inputs, index=code_block_4)

# group: Versão Revit
version = Python()  # "Document.Version"; IronPython2; unwired: IN[0]
# ---------- version.python (13 lines) ----------
# Importa as bibliotecas necessárias do Revit
import clr
clr.AddReference('RevitServices')
from RevitServices.Persistence import DocumentManager

# Obtém o documento ativo
doc = DocumentManager.Instance.CurrentUIApplication.Application

# Obtém o número da versão do Revit
revit_version = doc.VersionNumber

# Retorna o número da versão do Revit
OUT = "A versão do Revit é: {}".format(revit_version)
# ----------------------------------------
code_block_5 = CodeBlock { " "; }
split = String.Split(string=version, separator0=code_block_5)
lastItem = List.LastItem(list=split)
toNumber = String.ToNumber(string=lastItem)

code_block_6 = CodeBlock { 2021; 2022; 2023; 2024; 2025; }

# group: POT EM WATTS
le = toNumber <= code_block_6.out3
n2021_2022_2023_2024 = CodeBlock { "Carga real"; }  # "2021 - 2022 - 2023 - 2024"
n2025 = CodeBlock { "Potência real"; }  # "2025"
if_ = If(test=le, true=n2021_2022_2023_2024, false=n2025)

# group: CORRENTE DEMANDA
le_2 = toNumber <= code_block_6.out3
n2021_2022_2023_2024_2 = CodeBlock { "Total conectado"; }  # "2021 - 2022 - 2023 - 2024"
n2025_2 = CodeBlock { "Potência Aparente conectada total"; }  # "2025"
if_2 = If(test=le_2, true=n2021_2022_2023_2024_2, false=n2025_2)

# group: Atribui Potência
nome_do_parâmetro = StringInput("Potência Ativa (W)")
electricalCircuit = Custom[Element.ElectricalCircuit](element=getItemAtIndex)  # package MEPover; Returns the electrical circuit of the element
ʳʰʸᵗʰᵐ_elements = Rhythm.Revit.Elements.Elements.GetParameterValueByNameTypeOrInstance(element=electricalCircuit, parameterName=if_)
maximumItem = List.MaximumItem(list=ʳʰʸᵗʰᵐ_elements)
unit_conversion = CodeBlock(n=maximumItem) { n<1>/[0.09290304]; }
setParameterValueByName = RevitModel.Element.SetParameterValueByName(element=getItemAtIndex, parameterName=nome_do_parâmetro, values=unit_conversion)
nome_do_parâmetro_2 = StringInput("Potência Aparente (VA)")
ʳʰʸᵗʰᵐ_elements_2 = Rhythm.Revit.Elements.Elements.GetParameterValueByNameTypeOrInstance(element=getItemAtIndex, parameterName=if_2)
unit_conversion_2 = CodeBlock(n=ʳʰʸᵗʰᵐ_elements_2) { n<1>/[0.09290304]; }
setParameterValueByName_2 = RevitModel.Element.SetParameterValueByName(element=getItemAtIndex, parameterName=nome_do_parâmetro_2, values=unit_conversion_2)
code_block_7 = CodeBlock { 0.1; }
code_block_8 = CodeBlock(N=ʳʰʸᵗʰᵐ_elements_2, step=code_block_7) { Maths.Round(N/step)*step; }
floor = Math.Floor(number=code_block_8)
code_block_9 = CodeBlock { 0.1; }
code_block_10 = CodeBlock(M=maximumItem, step=code_block_9) { Maths.Round(M/step)*step; }
floor_2 = Math.Floor(number=code_block_10)

# group: Mensagem Final
count = List.Count(list=setParameterValueByName_2)
code_block_11 = CodeBlock { 0; }
gt = count > code_block_11
code_block_12 = CodeBlock(N=floor, M=floor_2)
# ---------- code_block_12.designscript (2 lines) ----------
["Potência Aparente "+N+"VA
Potência Ativa "+M+"W "];
# ----------------------------------------
flatten = List.Flatten(list=[code_block_12, code_block_12, code_block_12, code_block_12, code_block_12, code_block_12, code_block_12])
code_block_13 = CodeBlock { ["Nenhuma Potência Atribuida"]; }
if_3 = If(test=gt, true=flatten, false=code_block_13)
flatten_2 = List.Flatten(list=if_3)
fromList = Python(IN[0]=flatten_2)  # "String.FromList"; IronPython2
# ---------- fromList.python (22 lines) ----------
# Carregar as bibliotecas DesignScript e padrão do Python
import sys
import clr
clr.AddReference('ProtoGeometry')
from Autodesk.DesignScript.Geometry import *

# Função para concatenar os valores de uma lista em uma única string com múltiplas linhas
def concatenate_list_to_string(input_list, delimiter="\n"):
    # Verifica se a entrada é uma lista
    if not isinstance(input_list, list):
        return "A entrada deve ser uma lista."
    
    # Converte todos os elementos para string e junta com o delimitador especificado
    result = delimiter.join(str(item) for item in input_list)
    return result

# Entrada pelo nó do Dynamo
lista = IN[0]  # Lista de valores a serem concatenados
delimitador = IN[1] if len(IN) > 1 else "\n"  # Delimitador opcional, padrão é nova linha

# Saída para o Dynamo
OUT = concatenate_list_to_string(lista, delimitador)
# ----------------------------------------
python_script_2 = Python(IN[0]=fromList)  # IronPython2
# ---------- python_script_2.python (21 lines) ----------
# Importar as bibliotecas necessárias do Revit
import clr
clr.AddReference("RevitServices")
from RevitServices.Persistence import DocumentManager

clr.AddReference("RevitAPI")
clr.AddReference("RevitAPIUI")
from Autodesk.Revit.UI import TaskDialog

# Pegar a entrada do Dynamo
mensagem = IN[0]

# Criar a TaskDialog
task_dialog = TaskDialog("Ok")
task_dialog.MainInstruction = mensagem

# Exibir a TaskDialog
task_dialog.Show()

# Saída do script
OUT = "Sucesso!"
# ----------------------------------------
