# Dynamo graph 2021_09-1_BIMACON_Atribuir Potência Ativa (W) por Quadro_R01_script.dyn "2021_09-1_BIMACON_Atribuir Potência Ativa (W) por Quadro_R01" (Dynamo 2.6.1.8786)
# packages: DynaMEP 2.0.1, Rhythm 2023.4.2024, MEPover 2022.10.30, Rhythm 2023.4.2021, Orchid 2.6.8.6198, Data-Shapes 2022.2.105

# group: ENTRADAS PARA O USUÁRIO
code_block = CodeBlock { "Atribuir Potência Ativa (W) no Quadro"; }
file_path = Filename("..\..\..\..\..\05 - BIMACON\01 - EMPRESA BIMACON\00 - Logos e imagens - BIMACON\ARTE BIMACON\reddonda-removebg-preview.png")
file_from_path = FileObject(path=file_path)
readFromFile = Image.ReadFromFile(file=file_from_path)
string = StringInput("Confirmar")
string_2 = StringInput("Selecione o Quadro")
string_3 = StringInput("Selecione ")
categories = Categories("OST_ElectricalEquipment")
boolean = BoolSelector(true)
selectmodelelements_data = Custom[SelectModelElements Data](InputName=string_2, ButtonText=string_3, CategoryFilter=categories, SelectSingleElement=boolean)  # package Data-Shapes; Creates a Revit element selection input for UI.MultipleInputForm++ . Check out www.data-shapes.net for more infos!
list_create = List.Create(item0=selectmodelelements_data)
boolean_2 = BoolSelector(true)
string_4 = StringInput("Cancelar")
number = DoubleInput(300)
number_2 = DoubleInput(165)
multipleinputform = Custom[MultipleInputForm ++](Description_optional=code_block, Logo_optional=readFromFile, ButtonText_optional=string, Inputs=list_create, Toggle=boolean_2, CancelButtonText_optional=string_4, Width_optional=number, LabelWidth_optional=number_2)  # package Data-Shapes; Create a form with multiple inputs. see www.data-shapes.net for tutorials and infos!
code_block_2 = CodeBlock()  # //Data-Shapes
code_block_3 = CodeBlock()  # //archilab

# group: Separar Entradas
code_block_4 = CodeBlock { 0; }
getItemAtIndex = List.GetItemAtIndex(list=multipleinputform.User_Inputs, index=code_block_4)

# group: Atribui Potência
nome_do_parâmetro = StringInput("Potência Ativa (W)")
electricalCircuit = Custom[Element.ElectricalCircuit](element=getItemAtIndex)  # package MEPover; Returns the electrical circuit of the element
nome_do_parâmetro_2 = StringInput("Carga real")
ʳʰʸᵗʰᵐ_elements = Rhythm.Revit.Elements.Elements.GetParameterValueByNameTypeOrInstance(element=electricalCircuit, parameterName=nome_do_parâmetro_2)
maximumItem = List.MaximumItem(list=ʳʰʸᵗʰᵐ_elements)
unit_conversion = CodeBlock(n=maximumItem) { n<1>/[0.09290304]; }
setParameterValueByName = RevitModel.Element.SetParameterValueByName(element=getItemAtIndex, parameterName=nome_do_parâmetro, values=unit_conversion)
nome_do_parâmetro_3 = StringInput("Potência Aparente (VA)")
nome_do_parâmetro_4 = StringInput("Total conectado")
ʳʰʸᵗʰᵐ_elements_2 = Rhythm.Revit.Elements.Elements.GetParameterValueByNameTypeOrInstance(element=getItemAtIndex, parameterName=nome_do_parâmetro_4)
unit_conversion_2 = CodeBlock(n=ʳʰʸᵗʰᵐ_elements_2) { n<1>/[0.09290304]; }
setParameterValueByName_2 = RevitModel.Element.SetParameterValueByName(element=getItemAtIndex, parameterName=nome_do_parâmetro_3, values=unit_conversion_2)
code_block_5 = CodeBlock { 0.1; }
code_block_6 = CodeBlock(N=ʳʰʸᵗʰᵐ_elements_2, step=code_block_5) { Maths.Round(N/step)*step; }
floor = Math.Floor(number=code_block_6)
code_block_7 = CodeBlock { 0.1; }
code_block_8 = CodeBlock(M=maximumItem, step=code_block_7) { Maths.Round(M/step)*step; }
floor_2 = Math.Floor(number=code_block_8)

# group: Mensagem Final
count = List.Count(list=setParameterValueByName_2)
code_block_9 = CodeBlock { 0; }
gt = count > code_block_9
code_block_10 = CodeBlock(N=floor, M=floor_2)
# ---------- code_block_10.designscript (2 lines) ----------
["Potência Aparente "+N+"VA
Potência Ativa "+M+"W "];
# ----------------------------------------
flatten = List.Flatten(list=[code_block_10, code_block_10, code_block_10, code_block_10, code_block_10, code_block_10, code_block_10])
code_block_11 = CodeBlock { ["Nenhuma Potência Atribuida"]; }
if_ = If(test=gt, true=flatten, false=code_block_11)
flatten_2 = List.Flatten(list=if_)
o_string_fromlist = Orchid.Common.String.FromList(list=flatten_2)
python_script = Python(IN[0]=o_string_fromlist)
# ---------- python_script.python (21 lines) ----------
# Importar as bibliotecas necessárias do Revit
import clr
clr.AddReference("RevitServices")
from RevitServices.Persistence import DocumentManager

clr.AddReference("RevitAPI")
clr.AddReference("RevitAPIUI")
from Autodesk.Revit.UI import TaskDialog

# Pegar a entrada do Dynamo
mensagem = IN[0]

# Criar a TaskDialog
task_dialog = TaskDialog("Ok")
task_dialog.MainInstruction = mensagem

# Exibir a TaskDialog
task_dialog.Show()

# Saída do script
OUT = "Sucesso!"
# ----------------------------------------
