# Dynamo graph 10-9_BIMACON_Pintar Comandos_R01_script.dyn "10-9_BIMACON_Pintar Comandos_R00_script" (Dynamo 2.6.1.8786)
# Inseri Identificadores nas conexões
# packages: archi-lab.net 2023.213.1722, MEPover 2022.10.30

categories = Categories("OST_LightingDeviceTags")
all_elements_of_category = ElementsOfCategory(Category=categories)
taggedElement = Tag.TaggedElement(tag=all_elements_of_category)
categories_2 = Categories("OST_LightingFixtureTags")
all_elements_of_category_2 = ElementsOfCategory(Category=categories_2)
taggedElement_2 = Tag.TaggedElement(tag=all_elements_of_category_2)
list_create = List.Create(item0=taggedElement, item1=taggedElement_2)
flatten = List.Flatten(list=list_create)
list_create_2 = List.Create(item0=all_elements_of_category, item1=all_elements_of_category_2)
flatten_2 = List.Flatten(list=list_create_2)
electricalCircuit = Custom[Element.ElectricalCircuit](element=flatten)  # package MEPover; Returns the electrical circuit of the element
groupByKey = List.GroupByKey(list=flatten_2, keys=electricalCircuit)
indexOf = List.IndexOf(list=flatten_2, element=groupByKey.groups)
getItemAtIndex = List.GetItemAtIndex(list=flatten, index=indexOf)

# group: Versão Revit
code_block = CodeBlock { 2021; }
version = Python()  # "Document.Version"; unwired: IN[0]
# ---------- version.python (13 lines) ----------
# Importa as bibliotecas necessárias do Revit
import clr
clr.AddReference('RevitServices')
from RevitServices.Persistence import DocumentManager

# Obtém o documento ativo
doc = DocumentManager.Instance.CurrentUIApplication.Application

# Obtém o número da versão do Revit
revit_version = doc.VersionNumber

# Retorna o número da versão do Revit
OUT = "A versão do Revit é: {}".format(revit_version)
# ----------------------------------------
code_block_2 = CodeBlock { " "; }
split = String.Split(str=version, separator0=code_block_2)
lastItem = List.LastItem(list=split)
toNumber = String.ToNumber(str=lastItem)

# group: comando
eq = code_block == toNumber
n2021 = CodeBlock { "ID da chave"; }  # "2021"
n2022_2023_2024_2025 = CodeBlock { "ID do comando"; }  # "2022 - 2023 - 2024 - 2025"
if_ = If(test=eq, true=n2021, false=n2022_2023_2024_2025)

getParameterValueByName = Element.GetParameterValueByName(element=getItemAtIndex, parameterName=if_)
groupByKey_2 = List.GroupByKey(list=getItemAtIndex@L2, keys=getParameterValueByName@L2)
restOfItems = List.RestOfItems(list=groupByKey_2.unique_keys)
boolean = BoolSelector(false)
clean = List.Clean(list=restOfItems, preserveIndices=boolean)
getItemAtIndex_2 = List.GetItemAtIndex(list=flatten_2, index=indexOf)
groupByKey_3 = List.GroupByKey(list=getItemAtIndex_2@L2, keys=getParameterValueByName@L2)
restOfItems_2 = List.RestOfItems(list=groupByKey_3.groups)
python_script = Python(IN[0]=clean)
# ---------- python_script.python (62 lines) ----------
import clr

clr.AddReference("RevitServices")
clr.AddReference("DSCoreNodes")
import DSCore
clr.ImportExtensions(DSCore.Color)
from RevitServices.Persistence import DocumentManager

# Entrada
textos = IN[0]

def texto_para_valor(texto):
    """Converte uma string alfabética para um valor numérico único"""
    base = 26
    valor = 0
    for i, c in enumerate(reversed(texto.lower())):
        if c.isalpha():
            pos = ord(c) - ord('a')  # 'a' = 0
            valor += (pos + 1) * (base ** i)
    return valor

def valor_para_cor_clara_e_viva(valor, lista_index):
    """Gera uma cor clara e viva, evitando tons cinzentos, com variação por lista"""
    # Usa o índice da lista para adicionar uma variação ao valor
    valor_modificado = valor + (lista_index * 100)  # Ajuste este fator conforme necessário

    r = 180 + (valor_modificado * 89) % 75
    g = 180 + (valor_modificado * 59) % 75
    b = 180 + (valor_modificado * 41) % 75

    # Garante que a cor não seja cinza: se os canais forem muito próximos, força contraste
    if abs(r - g) < 30: g = (g + 30) % 256
    if abs(g - b) < 30: b = (b + 30) % 256
    if abs(r - b) < 30: r = (r + 30) % 256

    return DSCore.Color.ByARGB(255, int(r), int(g), int(b))

# Processar textos
valores = []
for item in textos:
    if isinstance(item, list):
        # Se o item for uma sublista, processa cada texto dentro dela
        sublista_valores = [texto_para_valor(t) for t in item if isinstance(t, str) and t]
        valores.append(sublista_valores)
    elif isinstance(item, str) and item:
        # Se o item for uma string, processa diretamente
        valores.append(texto_para_valor(item))
    else:
        # Lida com outros tipos de entrada, se necessário
        valores.append([])

cores = []
for lista_index, lista_valores in enumerate(valores): # Adiciona o índice da lista
    if isinstance(lista_valores, list):
        sublista_cores = [valor_para_cor_clara_e_viva(v, lista_index) for v in lista_valores] # Passa o índice
        cores.append(sublista_cores)
    elif isinstance(lista_valores, (int, float)):
        cores.append(valor_para_cor_clara_e_viva(lista_valores, lista_index)) # Passa o índice
    else:
        cores.append([])

OUT = cores
# ----------------------------------------

# group: Cor
color_palette = ColorPalette({R: 0, G: 0, B: 0, A: 255})

# group: Hachura
fill_patterns = FillPatterns("<Preenchimento sólido>")
fill_patterns_2 = FillPatterns("<Preenchimento sólido>")

# group: Linhas Hachura
line_patterns = LinePatterns("Alinhamento")
line_patterns_2 = LinePatterns("Alinhamento")

# group: Espessura da linha
number_slider = DoubleSlider(1, range=0..100 step 1)
number_slider_2 = DoubleSlider(1, range=0..100 step 1)

# group: Transparência
number_slider_3 = DoubleSlider(40, range=0..100 step 1)

# group: Nível de Detalhe
detail_level = DetailLevel("Fine")

boolean_2 = BoolSelector(false)

# group: Sobreposição de Gráficos
byProperties = Revit.Filter.OverrideGraphicSettings.ByProperties(cutFillColor=python_script, projectionFillColor=python_script, cutLineColor=python_script, projectionLineColor=color_palette, cutFillPattern=fill_patterns, projectionFillPattern=fill_patterns_2, cutLinePattern=line_patterns, projectionLinePattern=line_patterns_2, cutLineWeight=number_slider, projectionLineWeight=number_slider_2, transparency=number_slider_3, detailLevel=detail_level, halftone=boolean_2)
overrideInView = Element.OverrideInView(element=restOfItems_2, overrides=byProperties)

end = Revit.Transaction.Transaction.End(input=overrideInView)
passThrough = Custom[PassThrough](passThrough=clean, waitFor=end)  # package archi-lab.net; Ripped this off from Clockwork. Sorry Andy.
flatten_3 = List.Flatten(list=passThrough)

# group: Mensagem Final
count = List.Count(list=flatten_3)
code_block_3 = CodeBlock { 0; }
gt = count > code_block_3
code_block_4 = CodeBlock(N=count) { [""+N+" Comandos foram Identificados"]; }
code_block_5 = CodeBlock { ["Nenhum Comando Identificado"]; }
if_2 = If(test=gt, true=code_block_4, false=code_block_5)
flatten_4 = List.Flatten(list=if_2)
fromList = Python(IN[0]=flatten_4)  # "String.FromList"
# ---------- fromList.python (22 lines) ----------
# Carregar as bibliotecas DesignScript e padrão do Python
import sys
import clr
clr.AddReference('ProtoGeometry')
from Autodesk.DesignScript.Geometry import *

# Função para concatenar os valores de uma lista em uma única string com múltiplas linhas
def concatenate_list_to_string(input_list, delimiter="\n"):
    # Verifica se a entrada é uma lista
    if not isinstance(input_list, list):
        return "A entrada deve ser uma lista."
    
    # Converte todos os elementos para string e junta com o delimitador especificado
    result = delimiter.join(str(item) for item in input_list)
    return result

# Entrada pelo nó do Dynamo
lista = IN[0]  # Lista de valores a serem concatenados
delimitador = IN[1] if len(IN) > 1 else "\n"  # Delimitador opcional, padrão é nova linha

# Saída para o Dynamo
OUT = concatenate_list_to_string(lista, delimitador)
# ----------------------------------------
python_script_2 = Python(IN[0]=fromList)
# ---------- python_script_2.python (21 lines) ----------
# Importar as bibliotecas necessárias do Revit
import clr
clr.AddReference("RevitServices")
from RevitServices.Persistence import DocumentManager

clr.AddReference("RevitAPI")
clr.AddReference("RevitAPIUI")
from Autodesk.Revit.UI import TaskDialog

# Pegar a entrada do Dynamo
mensagem = IN[0]

# Criar a TaskDialog
task_dialog = TaskDialog("Ok")
task_dialog.MainInstruction = mensagem

# Exibir a TaskDialog
task_dialog.Show()

# Saída do script
OUT = "Sucesso!"
# ----------------------------------------
