# Dynamo graph 10-10_BIMACON_Remover Pintura de Comandos_R01_script.dyn (Dynamo 2.6.1.8786)
# Inseri Identificadores nas conexões
# packages: MEPover 2022.10.30, Crumple 2021.9.24, Clockwork for Dynamo 2.x 2.4.0

categories = Categories("OST_LightingDeviceTags")
all_elements_of_category = ElementsOfCategory(Category=categories)
taggedElement = Tag.TaggedElement(tag=all_elements_of_category)
categories_2 = Categories("OST_LightingFixtureTags")
all_elements_of_category_2 = ElementsOfCategory(Category=categories_2)
taggedElement_2 = Tag.TaggedElement(tag=all_elements_of_category_2)
list_create = List.Create(item0=taggedElement, item1=taggedElement_2)
flatten = List.Flatten(list=list_create)
list_create_2 = List.Create(item0=all_elements_of_category, item1=all_elements_of_category_2)
flatten_2 = List.Flatten(list=list_create_2)
electricalCircuit = Custom[Element.ElectricalCircuit](element=flatten)  # package MEPover; Returns the electrical circuit of the element
groupByKey = List.GroupByKey(list=flatten_2, keys=electricalCircuit)
indexOf = List.IndexOf(list=flatten_2, element=groupByKey.groups)
getItemAtIndex = List.GetItemAtIndex(list=flatten, index=indexOf)

# group: Versão Revit
code_block = CodeBlock { 2021; }
version = Python()  # "Document.Version"; unwired: IN[0]
# ---------- version.python (13 lines) ----------
# Importa as bibliotecas necessárias do Revit
import clr
clr.AddReference('RevitServices')
from RevitServices.Persistence import DocumentManager

# Obtém o documento ativo
doc = DocumentManager.Instance.CurrentUIApplication.Application

# Obtém o número da versão do Revit
revit_version = doc.VersionNumber

# Retorna o número da versão do Revit
OUT = "A versão do Revit é: {}".format(revit_version)
# ----------------------------------------
code_block_2 = CodeBlock { " "; }
split = String.Split(str=version, separator0=code_block_2)
lastItem = List.LastItem(list=split)
toNumber = String.ToNumber(str=lastItem)

# group: comando
eq = code_block == toNumber
n2021 = CodeBlock { "ID da chave"; }  # "2021"
n2022_2023_2024_2025 = CodeBlock { "ID do comando"; }  # "2022 - 2023 - 2024 - 2025"
if_ = If(test=eq, true=n2021, false=n2022_2023_2024_2025)

getParameterValueByName = Element.GetParameterValueByName(element=getItemAtIndex, parameterName=if_)
groupByKey_2 = List.GroupByKey(list=getItemAtIndex@L2, keys=getParameterValueByName@L2)
boolean = BoolSelector(false)
clean = List.Clean(list=groupByKey_2.unique_keys, preserveIndices=boolean)
python_script = Python(IN[0]=clean)
# ---------- python_script.python (62 lines) ----------
import clr

clr.AddReference("RevitServices")
clr.AddReference("DSCoreNodes")
import DSCore
clr.ImportExtensions(DSCore.Color)
from RevitServices.Persistence import DocumentManager

# Entrada
textos = IN[0]

def texto_para_valor(texto):
    """Converte uma string alfabética para um valor numérico único"""
    base = 26
    valor = 0
    for i, c in enumerate(reversed(texto.lower())):
        if c.isalpha():
            pos = ord(c) - ord('a')  # 'a' = 0
            valor += (pos + 1) * (base ** i)
    return valor

def valor_para_cor_clara_e_viva(valor, lista_index):
    """Gera uma cor clara e viva, evitando tons cinzentos, com variação por lista"""
    # Usa o índice da lista para adicionar uma variação ao valor
    valor_modificado = valor + (lista_index * 100)  # Ajuste este fator conforme necessário

    r = 180 + (valor_modificado * 89) % 75
    g = 180 + (valor_modificado * 59) % 75
    b = 180 + (valor_modificado * 41) % 75

    # Garante que a cor não seja cinza: se os canais forem muito próximos, força contraste
    if abs(r - g) < 30: g = (g + 30) % 256
    if abs(g - b) < 30: b = (b + 30) % 256
    if abs(r - b) < 30: r = (r + 30) % 256

    return DSCore.Color.ByARGB(255, int(r), int(g), int(b))

# Processar textos
valores = []
for item in textos:
    if isinstance(item, list):
        # Se o item for uma sublista, processa cada texto dentro dela
        sublista_valores = [texto_para_valor(t) for t in item if isinstance(t, str) and t]
        valores.append(sublista_valores)
    elif isinstance(item, str) and item:
        # Se o item for uma string, processa diretamente
        valores.append(texto_para_valor(item))
    else:
        # Lida com outros tipos de entrada, se necessário
        valores.append([])

cores = []
for lista_index, lista_valores in enumerate(valores): # Adiciona o índice da lista
    if isinstance(lista_valores, list):
        sublista_cores = [valor_para_cor_clara_e_viva(v, lista_index) for v in lista_valores] # Passa o índice
        cores.append(sublista_cores)
    elif isinstance(lista_valores, (int, float)):
        cores.append(valor_para_cor_clara_e_viva(lista_valores, lista_index)) # Passa o índice
    else:
        cores.append([])

OUT = cores
# ----------------------------------------
restOfItems = List.RestOfItems(list=groupByKey_2.unique_keys)
getItemAtIndex_2 = List.GetItemAtIndex(list=flatten_2, index=indexOf)
groupByKey_3 = List.GroupByKey(list=getItemAtIndex_2@L2, keys=getParameterValueByName@L2)
clean_2 = List.Clean(list=groupByKey_3.groups, preserveIndices=boolean)
currentview = Custom[© CurrentView]()  # package Crumple; Given the current document, return the active view.
resetElementOverrides = Custom[View.ResetElementOverrides](element=clean_2, view=currentview)  # package Clockwork for Dynamo 2.x; Resets all overrides for an element in a given view
