# Dynamo graph 10-7_BIMACON_Tags de Interruptores_R00_script.dyn "ok 10-7_BIMACON_Tags de Interruptores_R00_script" (Dynamo 2.19.3.6394)
# author: José Nelson
# Inseri Tags de comandos dos Interruptores
# packages: BIMCoder Nodes - 2.X 2025.0.15, BIMCoder Nodes - 2.X 2025.1.0

categories = Categories("OST_LightingDevices")
categories_2 = Categories("OST_ElectricalFixtures")
list_create = List.Create(item0=categories, item1=categories_2)
current = Document.Current()
activeView = Document.ActiveView(document=current)
all_elements_of_category_in_view = ElementsOfCategoryInView(Category=list_create, View=activeView)
flatten = List.Flatten(list=all_elements_of_category_in_view)
getFamily = FamilyInstance.GetFamily(familyInstance=all_elements_of_category_in_view)
flatten_2 = List.Flatten(list=getFamily)
string_from_object = FromObject(object=flatten_2)
code_block = CodeBlock { "Sensor"; }
contains = String.Contains(string=string_from_object, searchFor=code_block)
filterByBoolMask = List.FilterByBoolMask(list=flatten, mask=contains)
string_from_object_2 = FromObject(object=flatten)
code_block_2 = CodeBlock { "Simples"; }
contains_2 = String.Contains(string=string_from_object_2, searchFor=code_block_2)
filterByBoolMask_2 = List.FilterByBoolMask(list=flatten, mask=contains_2@L2)
code_block_3 = CodeBlock { "Paralelo"; }
contains_3 = String.Contains(string=string_from_object_2, searchFor=code_block_3)
filterByBoolMask_3 = List.FilterByBoolMask(list=flatten, mask=contains_3@L2)
code_block_4 = CodeBlock { "Intermediário"; }
contains_4 = String.Contains(string=string_from_object_2, searchFor=code_block_4)
filterByBoolMask_4 = List.FilterByBoolMask(list=flatten, mask=contains_4@L2)
code_block_5 = CodeBlock { "Pulsador"; }
contains_5 = String.Contains(string=string_from_object_2, searchFor=code_block_5)
filterByBoolMask_5 = List.FilterByBoolMask(list=flatten, mask=contains_5@L2)
list_create_2 = List.Create(item0=filterByBoolMask_2.in, item1=filterByBoolMask_3.in, item2=filterByBoolMask_4.in, item3=filterByBoolMask_5.in)
flatten_3 = List.Flatten(list=list_create_2)
uniqueItems = List.UniqueItems(list=flatten_3)
string_from_object_3 = FromObject(object=uniqueItems)
code_block_6 = CodeBlock { ["Tomada"]; }
contains_6 = String.Contains(string=string_from_object_3@L2, searchFor=code_block_6, lacing=Longest)
filterByBoolMask_6 = List.FilterByBoolMask(list=uniqueItems@L2, mask=contains_6@L2)
string_from_object_4 = FromObject(object=filterByBoolMask_6.out)
code_block_7 = CodeBlock { ["a. 2 Teclas Simples"]; }
contains_7 = String.Contains(string=string_from_object_4@L2, searchFor=code_block_7, lacing=Longest)
filterByBoolMask_7 = List.FilterByBoolMask(list=filterByBoolMask_6.out@L2, mask=contains_7@L2)
string_from_object_5 = FromObject(object=filterByBoolMask_7.out)
code_block_8 = CodeBlock { ["a. 3 Teclas Simples"]; }
contains_8 = String.Contains(string=string_from_object_5@L2, searchFor=code_block_8, lacing=Longest)
filterByBoolMask_8 = List.FilterByBoolMask(list=filterByBoolMask_7.out@L2, mask=contains_8@L2)
getChildElements = Element.GetChildElements(element=filterByBoolMask_8.out)
string_from_object_6 = FromObject(object=getChildElements)
code_block_9 = CodeBlock { ["Caixa de Luz"]; }
contains_9 = String.Contains(string=string_from_object_6@L2, searchFor=code_block_9, lacing=Longest)
filterByBoolMask_9 = List.FilterByBoolMask(list=getChildElements@L2, mask=contains_9@L2)
string_from_object_7 = FromObject(object=filterByBoolMask_9.out)
code_block_10 = CodeBlock { ["Tomada"]; }
contains_10 = String.Contains(string=string_from_object_7@L2, searchFor=code_block_10, lacing=Longest)
filterByBoolMask_10 = List.FilterByBoolMask(list=filterByBoolMask_9.out@L2, mask=contains_10@L2)
boolean = BoolSelector(false)
clean = List.Clean(list=filterByBoolMask_10.out, preserveIndices=boolean)
getLocation = Element.GetLocation(element=clean)
Z = Point.Z(point=getLocation)
sortByKey = List.SortByKey(list=clean, keys=Z, lacing=Longest)
list_create_3 = List.Create(item0=filterByBoolMask.in, item1=sortByKey.sortedList)
boolean_2 = BoolSelector(false)
clean_2 = List.Clean(list=list_create_3, preserveIndices=boolean_2)
flatten_4 = List.Flatten(list=clean_2@L2)
code_block_11 = CodeBlock { 0; }
getItemAtIndex = List.GetItemAtIndex(list=flatten_4, index=code_block_11, lacing=Longest)
boolean_3 = BoolSelector(false)
clean_3 = List.Clean(list=getItemAtIndex, preserveIndices=boolean_3)
getLocation_2 = Element.GetLocation(element=clean_3)
facingOrientation = FamilyInstance.FacingOrientation(familyInstance=clean_3)
byStartPointDirectionLength = Line.ByStartPointDirectionLength(startPoint=getLocation_2, direction=facingOrientation)
line_upvectoratparameter = Custom[👓 Line․UpVectorAtParameter](line=byStartPointDirectionLength)  # package BIMCoder Nodes - 2.X; Cria um vetor apontando para cima dado o parâmetro
X = Vector.X(vector=line_upvectoratparameter)
code_block_12 = CodeBlock { -1; }
eq = X == code_block_12
filterByBoolMask_11 = List.FilterByBoolMask(list=clean_3, mask=eq, lacing=Longest)
filterByBoolMask_12 = List.FilterByBoolMask(list=line_upvectoratparameter, mask=eq)

# group: TAG Vertical Neg
# Descrição <Clique duas vezes aqui para editar a descrição do grupo>
boolean_4 = BoolSelector(false)
clean_4 = List.Clean(list=filterByBoolMask_11.in, preserveIndices=boolean_4)
flatten_5 = List.Flatten(list=clean_4)
boolean_5 = BoolSelector(false)
clean_5 = List.Clean(list=filterByBoolMask_11.in, preserveIndices=boolean_5)
getLocation_3 = Element.GetLocation(element=clean_5)
boolean_6 = BoolSelector(false)
clean_6 = List.Clean(list=filterByBoolMask_12.in, preserveIndices=boolean_6)
offset_da_tag = DoubleInput(0.22)
translate = Geometry.Translate(geometry=getLocation_3, direction=clean_6, distance=offset_da_tag)
facingOrientation_2 = FamilyInstance.FacingOrientation(familyInstance=clean_5)
offset_da_2ª_tag = DoubleInput(0.15)
translate_2 = Geometry.Translate(geometry=translate, direction=facingOrientation_2, distance=offset_da_2ª_tag)
boolean_7 = BoolSelector(false)
clean_7 = List.Clean(list=translate_2, preserveIndices=boolean_7)
flatten_6 = List.Flatten(list=clean_7)
family_types = FamilyTypes("Tag Interruptor:Comando (Switch ID)")
tag_byelement = Custom[👓 Tag․ByElement](element=flatten_5, TagLocation=flatten_6, TagType=family_types)  # package BIMCoder Nodes - 2.X; Cria uma Tag em elemento(s) dado o tipo da Tag e a posição

watch = Watch(filterByBoolMask.in)

# group: TAG Horizontal
# Descrição <Clique duas vezes aqui para editar a descrição do grupo>
boolean_8 = BoolSelector(false)
clean_8 = List.Clean(list=filterByBoolMask_11.out, preserveIndices=boolean_8)
flatten_7 = List.Flatten(list=clean_8)
boolean_9 = BoolSelector(false)
clean_9 = List.Clean(list=filterByBoolMask_11.out, preserveIndices=boolean_9)
getLocation_4 = Element.GetLocation(element=clean_9)
boolean_10 = BoolSelector(false)
clean_10 = List.Clean(list=filterByBoolMask_12.out, preserveIndices=boolean_10)
offset_da_tag_2 = DoubleInput(0.08)
translate_3 = Geometry.Translate(geometry=getLocation_4, direction=clean_10, distance=offset_da_tag_2)
facingOrientation_3 = FamilyInstance.FacingOrientation(familyInstance=clean_9)
offset_da_2ª_tag_2 = DoubleInput(0.12)
translate_4 = Geometry.Translate(geometry=translate_3, direction=facingOrientation_3, distance=offset_da_2ª_tag_2)
boolean_11 = BoolSelector(false)
clean_11 = List.Clean(list=translate_4, preserveIndices=boolean_11)
flatten_8 = List.Flatten(list=clean_11)
family_types_2 = FamilyTypes("Tag Interruptor:Comando (Switch ID)")
tag_byelement_2 = Custom[👓 Tag․ByElement](element=flatten_7, TagLocation=flatten_8, TagType=family_types_2)

code_block_13 = CodeBlock { 1; }
getItemAtIndex_2 = List.GetItemAtIndex(list=flatten_4, index=code_block_13, lacing=Longest)
boolean_12 = BoolSelector(false)
clean_12 = List.Clean(list=getItemAtIndex_2, preserveIndices=boolean_12)
getLocation_5 = Element.GetLocation(element=clean_12)
facingOrientation_4 = FamilyInstance.FacingOrientation(familyInstance=clean_12)
byStartPointDirectionLength_2 = Line.ByStartPointDirectionLength(startPoint=getLocation_5, direction=facingOrientation_4)
line_upvectoratparameter_2 = Custom[👓 Line․UpVectorAtParameter](line=byStartPointDirectionLength_2)
X_2 = Vector.X(vector=line_upvectoratparameter_2)
code_block_14 = CodeBlock { -1; }
eq_2 = X_2 == code_block_14
filterByBoolMask_13 = List.FilterByBoolMask(list=clean_12, mask=eq_2, lacing=Longest)
filterByBoolMask_14 = List.FilterByBoolMask(list=line_upvectoratparameter_2, mask=eq_2)

# group: TAG Horizontal
# Descrição <Clique duas vezes aqui para editar a descrição do grupo>
boolean_13 = BoolSelector(false)
clean_13 = List.Clean(list=filterByBoolMask_13.out, preserveIndices=boolean_13)
flatten_9 = List.Flatten(list=clean_13)
boolean_14 = BoolSelector(false)
clean_14 = List.Clean(list=filterByBoolMask_13.out, preserveIndices=boolean_14)
getLocation_6 = Element.GetLocation(element=clean_14)
boolean_15 = BoolSelector(false)
clean_15 = List.Clean(list=filterByBoolMask_14.out, preserveIndices=boolean_15)
offset_da_tag_3 = DoubleInput(0.08)
translate_5 = Geometry.Translate(geometry=getLocation_6, direction=clean_15, distance=offset_da_tag_3)
facingOrientation_5 = FamilyInstance.FacingOrientation(familyInstance=clean_14)
offset_da_2ª_tag_3 = DoubleInput(0.32)
translate_6 = Geometry.Translate(geometry=translate_5, direction=facingOrientation_5, distance=offset_da_2ª_tag_3)
boolean_16 = BoolSelector(false)
clean_16 = List.Clean(list=translate_6, preserveIndices=boolean_16)
flatten_10 = List.Flatten(list=clean_16)
family_types_3 = FamilyTypes("Tag Interruptor:Comando (Switch ID)")
tag_byelement_3 = Custom[👓 Tag․ByElement](element=flatten_9, TagLocation=flatten_10, TagType=family_types_3)

# group: TAG Vertical
# Descrição <Clique duas vezes aqui para editar a descrição do grupo>
boolean_17 = BoolSelector(false)
clean_17 = List.Clean(list=filterByBoolMask_13.in, preserveIndices=boolean_17)
flatten_11 = List.Flatten(list=clean_17)
boolean_18 = BoolSelector(false)
clean_18 = List.Clean(list=filterByBoolMask_13.in, preserveIndices=boolean_18)
getLocation_7 = Element.GetLocation(element=clean_18)
boolean_19 = BoolSelector(false)
clean_19 = List.Clean(list=filterByBoolMask_14.in, preserveIndices=boolean_19)
offset_da_tag_4 = DoubleInput(0.22)
translate_7 = Geometry.Translate(geometry=getLocation_7, direction=clean_19, distance=offset_da_tag_4)
facingOrientation_6 = FamilyInstance.FacingOrientation(familyInstance=clean_18)
offset_da_2ª_tag_4 = DoubleInput(0.3)
translate_8 = Geometry.Translate(geometry=translate_7, direction=facingOrientation_6, distance=offset_da_2ª_tag_4)
boolean_20 = BoolSelector(false)
clean_20 = List.Clean(list=translate_8, preserveIndices=boolean_20)
flatten_12 = List.Flatten(list=clean_20)
family_types_4 = FamilyTypes("Tag Interruptor:Comando (Switch ID)")
tag_byelement_4 = Custom[👓 Tag․ByElement](element=flatten_11, TagLocation=flatten_12, TagType=family_types_4)

code_block_15 = CodeBlock { 2; }
getItemAtIndex_3 = List.GetItemAtIndex(list=flatten_4, index=code_block_15, lacing=Longest)
boolean_21 = BoolSelector(false)
clean_21 = List.Clean(list=getItemAtIndex_3, preserveIndices=boolean_21)
getLocation_8 = Element.GetLocation(element=clean_21)
facingOrientation_7 = FamilyInstance.FacingOrientation(familyInstance=clean_21)
byStartPointDirectionLength_3 = Line.ByStartPointDirectionLength(startPoint=getLocation_8, direction=facingOrientation_7)
line_upvectoratparameter_3 = Custom[👓 Line․UpVectorAtParameter](line=byStartPointDirectionLength_3)
X_3 = Vector.X(vector=line_upvectoratparameter_3)
code_block_16 = CodeBlock { -1; }
eq_3 = X_3 == code_block_16
filterByBoolMask_15 = List.FilterByBoolMask(list=clean_21, mask=eq_3, lacing=Longest)
filterByBoolMask_16 = List.FilterByBoolMask(list=line_upvectoratparameter_3, mask=eq_3)

# group: TAG Horizontal
# Descrição <Clique duas vezes aqui para editar a descrição do grupo>
boolean_22 = BoolSelector(false)
clean_22 = List.Clean(list=filterByBoolMask_15.out, preserveIndices=boolean_22)
flatten_13 = List.Flatten(list=clean_22)
boolean_23 = BoolSelector(false)
clean_23 = List.Clean(list=filterByBoolMask_15.out, preserveIndices=boolean_23)
getLocation_9 = Element.GetLocation(element=clean_23)
boolean_24 = BoolSelector(false)
clean_24 = List.Clean(list=filterByBoolMask_16.out, preserveIndices=boolean_24)
offset_da_tag_5 = DoubleInput(0.08)
translate_9 = Geometry.Translate(geometry=getLocation_9, direction=clean_24, distance=offset_da_tag_5)
facingOrientation_8 = FamilyInstance.FacingOrientation(familyInstance=clean_23)
offset_da_2ª_tag_5 = DoubleInput(0.48)
translate_10 = Geometry.Translate(geometry=translate_9, direction=facingOrientation_8, distance=offset_da_2ª_tag_5)
boolean_25 = BoolSelector(false)
clean_25 = List.Clean(list=translate_10, preserveIndices=boolean_25)
flatten_14 = List.Flatten(list=clean_25)
family_types_5 = FamilyTypes("Tag Interruptor:Comando (Switch ID)")
tag_byelement_5 = Custom[👓 Tag․ByElement](element=flatten_13, TagLocation=flatten_14, TagType=family_types_5)

# group: TAG Vertical
# Descrição <Clique duas vezes aqui para editar a descrição do grupo>
boolean_26 = BoolSelector(false)
clean_26 = List.Clean(list=filterByBoolMask_15.in, preserveIndices=boolean_26)
flatten_15 = List.Flatten(list=clean_26)
boolean_27 = BoolSelector(false)
clean_27 = List.Clean(list=filterByBoolMask_15.in, preserveIndices=boolean_27)
getLocation_10 = Element.GetLocation(element=clean_27)
boolean_28 = BoolSelector(false)
clean_28 = List.Clean(list=filterByBoolMask_16.in, preserveIndices=boolean_28)
offset_da_tag_6 = DoubleInput(0.22)
translate_11 = Geometry.Translate(geometry=getLocation_10, direction=clean_28, distance=offset_da_tag_6)
facingOrientation_9 = FamilyInstance.FacingOrientation(familyInstance=clean_27)
offset_da_2ª_tag_6 = DoubleInput(0.45)
translate_12 = Geometry.Translate(geometry=translate_11, direction=facingOrientation_9, distance=offset_da_2ª_tag_6)
boolean_29 = BoolSelector(false)
clean_29 = List.Clean(list=translate_12, preserveIndices=boolean_29)
flatten_16 = List.Flatten(list=clean_29)
family_types_6 = FamilyTypes("Tag Interruptor:Comando (Switch ID)")
tag_byelement_6 = Custom[👓 Tag․ByElement](element=flatten_15, TagLocation=flatten_16, TagType=family_types_6)

boolean_30 = BoolSelector(false)
clean_30 = List.Clean(list=filterByBoolMask_10.in, preserveIndices=boolean_30)
getChildElements_2 = Element.GetChildElements(element=filterByBoolMask_6.in)
string_from_object_8 = FromObject(object=getChildElements_2)
code_block_17 = CodeBlock { ["Caixa de Luz"]; }
contains_11 = String.Contains(string=string_from_object_8@L2, searchFor=code_block_17, lacing=Longest)
filterByBoolMask_17 = List.FilterByBoolMask(list=getChildElements_2@L2, mask=contains_11@L2)
string_from_object_9 = FromObject(object=filterByBoolMask_17.out)
code_block_18 = CodeBlock { ["Tomada"]; }
contains_12 = String.Contains(string=string_from_object_9@L2, searchFor=code_block_18, lacing=Longest)
filterByBoolMask_18 = List.FilterByBoolMask(list=filterByBoolMask_17.out@L2, mask=contains_12@L2)
boolean_31 = BoolSelector(false)
clean_31 = List.Clean(list=filterByBoolMask_18.out, preserveIndices=boolean_31)
getLocation_11 = Element.GetLocation(element=clean_31)
Z_2 = Point.Z(point=getLocation_11)
sortByKey_2 = List.SortByKey(list=clean_31, keys=Z_2, lacing=Longest)
reverse = List.Reverse(list=sortByKey_2.sortedList, lacing=Longest)
boolean_32 = BoolSelector(false)
clean_32 = List.Clean(list=reverse, preserveIndices=boolean_32)
flatten_17 = List.Flatten(list=clean_32@L2)
code_block_19 = CodeBlock { 0; }
getItemAtIndex_4 = List.GetItemAtIndex(list=flatten_17, index=code_block_19, lacing=Longest)
boolean_33 = BoolSelector(false)
clean_33 = List.Clean(list=getItemAtIndex_4, preserveIndices=boolean_33)
facingOrientation_10 = FamilyInstance.FacingOrientation(familyInstance=clean_33)
X_4 = Vector.X(vector=facingOrientation_10)
code_block_20 = CodeBlock { -1; }
eq_4 = X_4 == code_block_20
filterByBoolMask_19 = List.FilterByBoolMask(list=clean_33, mask=eq_4, lacing=Longest)
filterByBoolMask_20 = List.FilterByBoolMask(list=facingOrientation_10, mask=eq_4)

# group: TAG Vertical Neg
# Descrição <Clique duas vezes aqui para editar a descrição do grupo>
boolean_34 = BoolSelector(false)
clean_34 = List.Clean(list=filterByBoolMask_19.in, preserveIndices=boolean_34)
flatten_18 = List.Flatten(list=clean_34)
boolean_35 = BoolSelector(false)
clean_35 = List.Clean(list=filterByBoolMask_19.in, preserveIndices=boolean_35)
getLocation_12 = Element.GetLocation(element=clean_35)
boolean_36 = BoolSelector(false)
clean_36 = List.Clean(list=filterByBoolMask_20.in, preserveIndices=boolean_36)
ZAxis = Vector.ZAxis()
cross = Vector.Cross(vector=clean_36, cross=ZAxis)
offset_da_tag_7 = DoubleInput(0.18)
translate_13 = Geometry.Translate(geometry=getLocation_12, direction=cross, distance=offset_da_tag_7)
facingOrientation_11 = FamilyInstance.FacingOrientation(familyInstance=clean_35)
offset_da_2ª_tag_7 = DoubleInput(0.2)
translate_14 = Geometry.Translate(geometry=translate_13, direction=facingOrientation_11, distance=offset_da_2ª_tag_7)
boolean_37 = BoolSelector(false)
clean_37 = List.Clean(list=translate_14, preserveIndices=boolean_37)
flatten_19 = List.Flatten(list=clean_37)
family_types_7 = FamilyTypes("Tag Interruptor:Comando (Switch ID)")
tag_byelement_7 = Custom[👓 Tag․ByElement](element=flatten_18, TagLocation=flatten_19, TagType=family_types_7)

Y = Vector.Y(vector=facingOrientation_10)
code_block_21 = CodeBlock { -1; }
eq_5 = Equals(x=Y, y=code_block_21)
filterByBoolMask_21 = List.FilterByBoolMask(list=clean_33, mask=eq_5, lacing=Longest)
filterByBoolMask_22 = List.FilterByBoolMask(list=facingOrientation_10, mask=eq_5)

# group: TAG Horizontal Pos
# Descrição <Clique duas vezes aqui para editar a descrição do grupo>
boolean_38 = BoolSelector(false)
clean_38 = List.Clean(list=filterByBoolMask_21.in, preserveIndices=boolean_38)
flatten_20 = List.Flatten(list=clean_38)
boolean_39 = BoolSelector(false)
clean_39 = List.Clean(list=filterByBoolMask_21.in, preserveIndices=boolean_39)
getLocation_13 = Element.GetLocation(element=clean_39)
boolean_40 = BoolSelector(false)
clean_40 = List.Clean(list=filterByBoolMask_22.in, preserveIndices=boolean_40)
offset_da_tag_8 = DoubleInput(0.2)
translate_15 = Geometry.Translate(geometry=getLocation_13, direction=clean_40, distance=offset_da_tag_8)
facingOrientation_12 = FamilyInstance.FacingOrientation(familyInstance=clean_39)
ZAxis_2 = Vector.ZAxis()
cross_2 = Vector.Cross(vector=facingOrientation_12, cross=ZAxis_2)
offset_da_2ª_tag_8 = DoubleInput(0.32)
translate_16 = Geometry.Translate(geometry=translate_15, direction=cross_2, distance=offset_da_2ª_tag_8)
boolean_41 = BoolSelector(false)
clean_41 = List.Clean(list=translate_16, preserveIndices=boolean_41)
flatten_21 = List.Flatten(list=clean_41)
family_types_8 = FamilyTypes("Tag Interruptor:Comando (Switch ID)")
tag_byelement_8 = Custom[👓 Tag․ByElement](element=flatten_20, TagLocation=flatten_21, TagType=family_types_8)

code_block_22 = CodeBlock { 1; }
eq_6 = X_4 == code_block_22
filterByBoolMask_23 = List.FilterByBoolMask(list=clean_33, mask=eq_6, lacing=Longest)
filterByBoolMask_24 = List.FilterByBoolMask(list=facingOrientation_10, mask=eq_6)

# group: TAG Vertical Pos
# Descrição <Clique duas vezes aqui para editar a descrição do grupo>
boolean_42 = BoolSelector(false)
clean_42 = List.Clean(list=filterByBoolMask_23.in, preserveIndices=boolean_42)
flatten_22 = List.Flatten(list=clean_42)
boolean_43 = BoolSelector(false)
clean_43 = List.Clean(list=filterByBoolMask_23.in, preserveIndices=boolean_43)
getLocation_14 = Element.GetLocation(element=clean_43)
boolean_44 = BoolSelector(false)
clean_44 = List.Clean(list=filterByBoolMask_24.in, preserveIndices=boolean_44)
ZAxis_3 = Vector.ZAxis()
cross_3 = Vector.Cross(vector=clean_44, cross=ZAxis_3)
offset_da_tag_9 = DoubleInput(0.3)
translate_17 = Geometry.Translate(geometry=getLocation_14, direction=cross_3, distance=offset_da_tag_9)
facingOrientation_13 = FamilyInstance.FacingOrientation(familyInstance=clean_43)
offset_da_2ª_tag_9 = DoubleInput(0.15)
translate_18 = Geometry.Translate(geometry=translate_17, direction=facingOrientation_13, distance=offset_da_2ª_tag_9)
boolean_45 = BoolSelector(false)
clean_45 = List.Clean(list=translate_18, preserveIndices=boolean_45)
flatten_23 = List.Flatten(list=clean_45)
family_types_9 = FamilyTypes("Tag Interruptor:Comando (Switch ID)")
tag_byelement_9 = Custom[👓 Tag․ByElement](element=flatten_22, TagLocation=flatten_23, TagType=family_types_9)

code_block_23 = CodeBlock { 1; }
eq_7 = Y == code_block_23
filterByBoolMask_25 = List.FilterByBoolMask(list=clean_33, mask=eq_7, lacing=Longest)
filterByBoolMask_26 = List.FilterByBoolMask(list=facingOrientation_10, mask=eq_7)

# group: TAG Horizontal Pos
# Descrição <Clique duas vezes aqui para editar a descrição do grupo>
boolean_46 = BoolSelector(false)
clean_46 = List.Clean(list=filterByBoolMask_25.in, preserveIndices=boolean_46)
flatten_24 = List.Flatten(list=clean_46)
boolean_47 = BoolSelector(false)
clean_47 = List.Clean(list=filterByBoolMask_25.in, preserveIndices=boolean_47)
getLocation_15 = Element.GetLocation(element=clean_47)
boolean_48 = BoolSelector(false)
clean_48 = List.Clean(list=filterByBoolMask_26.in, preserveIndices=boolean_48)
offset_da_tag_10 = DoubleInput(0.2)
translate_19 = Geometry.Translate(geometry=getLocation_15, direction=clean_48, distance=offset_da_tag_10)
facingOrientation_14 = FamilyInstance.FacingOrientation(familyInstance=clean_47)
ZAxis_4 = Vector.ZAxis()
cross_4 = Vector.Cross(vector=facingOrientation_14, cross=ZAxis_4)
offset_da_2ª_tag_10 = DoubleInput(0.2)
translate_20 = Geometry.Translate(geometry=translate_19, direction=cross_4, distance=offset_da_2ª_tag_10)
boolean_49 = BoolSelector(false)
clean_49 = List.Clean(list=translate_20, preserveIndices=boolean_49)
flatten_25 = List.Flatten(list=clean_49)
family_types_10 = FamilyTypes("Tag Interruptor:Comando (Switch ID)")
tag_byelement_10 = Custom[👓 Tag․ByElement](element=flatten_24, TagLocation=flatten_25, TagType=family_types_10)

getLocation_16 = Element.GetLocation(element=clean_33)
byStartPointDirectionLength_4 = Line.ByStartPointDirectionLength(startPoint=getLocation_16, direction=facingOrientation_10)
code_block_24 = CodeBlock { 1; }
getItemAtIndex_5 = List.GetItemAtIndex(list=flatten_17, index=code_block_24, lacing=Longest)
boolean_50 = BoolSelector(false)
clean_50 = List.Clean(list=getItemAtIndex_5, preserveIndices=boolean_50)
facingOrientation_15 = FamilyInstance.FacingOrientation(familyInstance=clean_50)
Y_2 = Vector.Y(vector=facingOrientation_15)
code_block_25 = CodeBlock { 1; }
eq_8 = Y_2 == code_block_25
filterByBoolMask_27 = List.FilterByBoolMask(list=clean_50, mask=eq_8, lacing=Longest)
filterByBoolMask_28 = List.FilterByBoolMask(list=facingOrientation_15, mask=eq_8)

# group: TAG Horizontal Pos
# Descrição <Clique duas vezes aqui para editar a descrição do grupo>
boolean_51 = BoolSelector(false)
clean_51 = List.Clean(list=filterByBoolMask_27.in, preserveIndices=boolean_51)
flatten_26 = List.Flatten(list=clean_51)
boolean_52 = BoolSelector(false)
clean_52 = List.Clean(list=filterByBoolMask_27.in, preserveIndices=boolean_52)
getLocation_17 = Element.GetLocation(element=clean_52)
boolean_53 = BoolSelector(false)
clean_53 = List.Clean(list=filterByBoolMask_28.in, preserveIndices=boolean_53)
offset_da_tag_11 = DoubleInput(0.35)
translate_21 = Geometry.Translate(geometry=getLocation_17, direction=clean_53, distance=offset_da_tag_11)
facingOrientation_16 = FamilyInstance.FacingOrientation(familyInstance=clean_52)
ZAxis_5 = Vector.ZAxis()
cross_5 = Vector.Cross(vector=facingOrientation_16, cross=ZAxis_5)
offset_da_2ª_tag_11 = DoubleInput(0.2)
translate_22 = Geometry.Translate(geometry=translate_21, direction=cross_5, distance=offset_da_2ª_tag_11)
boolean_54 = BoolSelector(false)
clean_54 = List.Clean(list=translate_22, preserveIndices=boolean_54)
flatten_27 = List.Flatten(list=clean_54)
family_types_11 = FamilyTypes("Tag Interruptor:Comando (Switch ID)")
tag_byelement_11 = Custom[👓 Tag․ByElement](element=flatten_26, TagLocation=flatten_27, TagType=family_types_11)

X_5 = Vector.X(vector=facingOrientation_15)
code_block_26 = CodeBlock { -1; }
eq_9 = X_5 == code_block_26
filterByBoolMask_29 = List.FilterByBoolMask(list=clean_50, mask=eq_9, lacing=Longest)
filterByBoolMask_30 = List.FilterByBoolMask(list=facingOrientation_15, mask=eq_9)

# group: TAG Vertical Neg
# Descrição <Clique duas vezes aqui para editar a descrição do grupo>
boolean_55 = BoolSelector(false)
clean_55 = List.Clean(list=filterByBoolMask_29.in, preserveIndices=boolean_55)
flatten_28 = List.Flatten(list=clean_55)
boolean_56 = BoolSelector(false)
clean_56 = List.Clean(list=filterByBoolMask_29.in, preserveIndices=boolean_56)
getLocation_18 = Element.GetLocation(element=clean_56)
boolean_57 = BoolSelector(false)
clean_57 = List.Clean(list=filterByBoolMask_30.in, preserveIndices=boolean_57)
ZAxis_6 = Vector.ZAxis()
cross_6 = Vector.Cross(vector=clean_57, cross=ZAxis_6)
offset_da_tag_12 = DoubleInput(0.18)
translate_23 = Geometry.Translate(geometry=getLocation_18, direction=cross_6, distance=offset_da_tag_12)
facingOrientation_17 = FamilyInstance.FacingOrientation(familyInstance=clean_56)
offset_da_2ª_tag_12 = DoubleInput(0.4)
translate_24 = Geometry.Translate(geometry=translate_23, direction=facingOrientation_17, distance=offset_da_2ª_tag_12)
boolean_58 = BoolSelector(false)
clean_58 = List.Clean(list=translate_24, preserveIndices=boolean_58)
flatten_29 = List.Flatten(list=clean_58)
family_types_12 = FamilyTypes("Tag Interruptor:Comando (Switch ID)")
tag_byelement_12 = Custom[👓 Tag․ByElement](element=flatten_28, TagLocation=flatten_29, TagType=family_types_12)

code_block_27 = CodeBlock { -1; }
eq_10 = Equals(x=Y_2, y=code_block_27)
filterByBoolMask_31 = List.FilterByBoolMask(list=clean_50, mask=eq_10, lacing=Longest)
filterByBoolMask_32 = List.FilterByBoolMask(list=facingOrientation_15, mask=eq_10)

# group: TAG Horizontal Pos
# Descrição <Clique duas vezes aqui para editar a descrição do grupo>
boolean_59 = BoolSelector(false)
clean_59 = List.Clean(list=filterByBoolMask_31.in, preserveIndices=boolean_59)
flatten_30 = List.Flatten(list=clean_59)
boolean_60 = BoolSelector(false)
clean_60 = List.Clean(list=filterByBoolMask_31.in, preserveIndices=boolean_60)
getLocation_19 = Element.GetLocation(element=clean_60)
boolean_61 = BoolSelector(false)
clean_61 = List.Clean(list=filterByBoolMask_32.in, preserveIndices=boolean_61)
offset_da_tag_13 = DoubleInput(0.4)
translate_25 = Geometry.Translate(geometry=getLocation_19, direction=clean_61, distance=offset_da_tag_13)
facingOrientation_18 = FamilyInstance.FacingOrientation(familyInstance=clean_60)
ZAxis_7 = Vector.ZAxis()
cross_7 = Vector.Cross(vector=facingOrientation_18, cross=ZAxis_7)
offset_da_2ª_tag_13 = DoubleInput(0.32)
translate_26 = Geometry.Translate(geometry=translate_25, direction=cross_7, distance=offset_da_2ª_tag_13)
boolean_62 = BoolSelector(false)
clean_62 = List.Clean(list=translate_26, preserveIndices=boolean_62)
flatten_31 = List.Flatten(list=clean_62)
family_types_13 = FamilyTypes("Tag Interruptor:Comando (Switch ID)")
tag_byelement_13 = Custom[👓 Tag․ByElement](element=flatten_30, TagLocation=flatten_31, TagType=family_types_13)

code_block_28 = CodeBlock { 1; }
eq_11 = X_5 == code_block_28
filterByBoolMask_33 = List.FilterByBoolMask(list=clean_50, mask=eq_11, lacing=Longest)
filterByBoolMask_34 = List.FilterByBoolMask(list=facingOrientation_15, mask=eq_11)

# group: TAG Vertical Pos
# Descrição <Clique duas vezes aqui para editar a descrição do grupo>
boolean_63 = BoolSelector(false)
clean_63 = List.Clean(list=filterByBoolMask_33.in, preserveIndices=boolean_63)
flatten_32 = List.Flatten(list=clean_63)
boolean_64 = BoolSelector(false)
clean_64 = List.Clean(list=filterByBoolMask_33.in, preserveIndices=boolean_64)
getLocation_20 = Element.GetLocation(element=clean_64)
boolean_65 = BoolSelector(false)
clean_65 = List.Clean(list=filterByBoolMask_34.in, preserveIndices=boolean_65)
ZAxis_8 = Vector.ZAxis()
cross_8 = Vector.Cross(vector=clean_65, cross=ZAxis_8)
offset_da_tag_14 = DoubleInput(0.3)
translate_27 = Geometry.Translate(geometry=getLocation_20, direction=cross_8, distance=offset_da_tag_14)
facingOrientation_19 = FamilyInstance.FacingOrientation(familyInstance=clean_64)
offset_da_2ª_tag_14 = DoubleInput(0.35)
translate_28 = Geometry.Translate(geometry=translate_27, direction=facingOrientation_19, distance=offset_da_2ª_tag_14)
boolean_66 = BoolSelector(false)
clean_66 = List.Clean(list=translate_28, preserveIndices=boolean_66)
flatten_33 = List.Flatten(list=clean_66)
family_types_14 = FamilyTypes("Tag Interruptor:Comando (Switch ID)")
tag_byelement_14 = Custom[👓 Tag․ByElement](element=flatten_32, TagLocation=flatten_33, TagType=family_types_14)

reverse_2 = List.Reverse(list=sortByKey.sortedList, lacing=Longest)
list_create_4 = List.Create(item0=filterByBoolMask_7.in, item1=filterByBoolMask_8.in)
flatten_34 = List.Flatten(list=list_create_4)
getChildElements_3 = Element.GetChildElements(element=flatten_34)
string_from_object_10 = FromObject(object=getChildElements_3)
code_block_29 = CodeBlock { ["Caixa de Luz"]; }
contains_13 = String.Contains(string=string_from_object_10@L2, searchFor=code_block_29, lacing=Longest)
filterByBoolMask_35 = List.FilterByBoolMask(list=getChildElements_3@L2, mask=contains_13@L2)
string_from_object_11 = FromObject(object=filterByBoolMask_35.out)
code_block_30 = CodeBlock { ["Tomada"]; }
contains_14 = String.Contains(string=string_from_object_11@L2, searchFor=code_block_30, lacing=Longest)
filterByBoolMask_36 = List.FilterByBoolMask(list=filterByBoolMask_35.out@L2, mask=contains_14@L2)
boolean_67 = BoolSelector(false)
clean_67 = List.Clean(list=filterByBoolMask_36.out, preserveIndices=boolean_67)
getLocation_21 = Element.GetLocation(element=clean_67)
Z_3 = Point.Z(point=getLocation_21)
sortByKey_3 = List.SortByKey(list=clean_67, keys=Z_3, lacing=Longest)
boolean_68 = BoolSelector(false)
clean_68 = List.Clean(list=sortByKey_3.sortedList, preserveIndices=boolean_68)
flatten_35 = List.Flatten(list=clean_68@L2)
code_block_31 = CodeBlock { 2; }
getItemAtIndex_6 = List.GetItemAtIndex(list=flatten_35, index=code_block_31, lacing=Longest)
boolean_69 = BoolSelector(false)
clean_69 = List.Clean(list=getItemAtIndex_6, preserveIndices=boolean_69)
getLocation_22 = Element.GetLocation(element=clean_69)
facingOrientation_20 = FamilyInstance.FacingOrientation(familyInstance=clean_69)
byStartPointDirectionLength_5 = Line.ByStartPointDirectionLength(startPoint=getLocation_22, direction=facingOrientation_20)
line_upvectoratparameter_4 = Custom[👓 Line․UpVectorAtParameter](line=byStartPointDirectionLength_5)
X_6 = Vector.X(vector=line_upvectoratparameter_4)
code_block_32 = CodeBlock { -1; }
eq_12 = X_6 == code_block_32
filterByBoolMask_37 = List.FilterByBoolMask(list=clean_69, mask=eq_12, lacing=Longest)
filterByBoolMask_38 = List.FilterByBoolMask(list=line_upvectoratparameter_4, mask=eq_12)

# group: TAG Horizontal
# Descrição <Clique duas vezes aqui para editar a descrição do grupo>
boolean_70 = BoolSelector(false)
clean_70 = List.Clean(list=filterByBoolMask_37.out, preserveIndices=boolean_70)
flatten_36 = List.Flatten(list=clean_70)
boolean_71 = BoolSelector(false)
clean_71 = List.Clean(list=filterByBoolMask_37.out, preserveIndices=boolean_71)
getLocation_23 = Element.GetLocation(element=clean_71)
boolean_72 = BoolSelector(false)
clean_72 = List.Clean(list=filterByBoolMask_38.out, preserveIndices=boolean_72)
reverse_3 = Vector.Reverse(vector=clean_72)
offset_da_tag_15 = DoubleInput(0.2)
translate_29 = Geometry.Translate(geometry=getLocation_23, direction=reverse_3, distance=offset_da_tag_15)
facingOrientation_21 = FamilyInstance.FacingOrientation(familyInstance=clean_71)
offset_da_2ª_tag_15 = DoubleInput(0.12)
translate_30 = Geometry.Translate(geometry=translate_29, direction=facingOrientation_21, distance=offset_da_2ª_tag_15)
boolean_73 = BoolSelector(false)
clean_73 = List.Clean(list=translate_30, preserveIndices=boolean_73)
flatten_37 = List.Flatten(list=clean_73)
family_types_15 = FamilyTypes("Tag Interruptor:Comando (Switch ID)")
tag_byelement_15 = Custom[👓 Tag․ByElement](element=flatten_36, TagLocation=flatten_37, TagType=family_types_15)

code_block_33 = CodeBlock { 0; }
getItemAtIndex_7 = List.GetItemAtIndex(list=flatten_35, index=code_block_33, lacing=Longest)
boolean_74 = BoolSelector(false)
clean_74 = List.Clean(list=getItemAtIndex_7, preserveIndices=boolean_74)
getLocation_24 = Element.GetLocation(element=clean_74)
facingOrientation_22 = FamilyInstance.FacingOrientation(familyInstance=clean_74)
byStartPointDirectionLength_6 = Line.ByStartPointDirectionLength(startPoint=getLocation_24, direction=facingOrientation_22)
line_upvectoratparameter_5 = Custom[👓 Line․UpVectorAtParameter](line=byStartPointDirectionLength_6)
X_7 = Vector.X(vector=line_upvectoratparameter_5)
code_block_34 = CodeBlock { -1; }
eq_13 = X_7 == code_block_34
filterByBoolMask_39 = List.FilterByBoolMask(list=clean_74, mask=eq_13, lacing=Longest)
filterByBoolMask_40 = List.FilterByBoolMask(list=line_upvectoratparameter_5, mask=eq_13)

# group: TAG Vertical Neg
# Descrição <Clique duas vezes aqui para editar a descrição do grupo>
boolean_75 = BoolSelector(false)
clean_75 = List.Clean(list=filterByBoolMask_39.in, preserveIndices=boolean_75)
flatten_38 = List.Flatten(list=clean_75)
boolean_76 = BoolSelector(false)
clean_76 = List.Clean(list=filterByBoolMask_39.in, preserveIndices=boolean_76)
getLocation_25 = Element.GetLocation(element=clean_76)
boolean_77 = BoolSelector(false)
clean_77 = List.Clean(list=filterByBoolMask_40.in, preserveIndices=boolean_77)
offset_da_tag_16 = DoubleInput(0.2)
translate_31 = Geometry.Translate(geometry=getLocation_25, direction=clean_77, distance=offset_da_tag_16)
facingOrientation_23 = FamilyInstance.FacingOrientation(familyInstance=clean_76)
offset_da_2ª_tag_16 = DoubleInput(0.15)
translate_32 = Geometry.Translate(geometry=translate_31, direction=facingOrientation_23, distance=offset_da_2ª_tag_16)
boolean_78 = BoolSelector(false)
clean_78 = List.Clean(list=translate_32, preserveIndices=boolean_78)
flatten_39 = List.Flatten(list=clean_78)
family_types_16 = FamilyTypes("Tag Interruptor:Comando (Switch ID)")
tag_byelement_16 = Custom[👓 Tag․ByElement](element=flatten_38, TagLocation=flatten_39, TagType=family_types_16)

# group: TAG Horizontal
# Descrição <Clique duas vezes aqui para editar a descrição do grupo>
boolean_79 = BoolSelector(false)
clean_79 = List.Clean(list=filterByBoolMask_39.out, preserveIndices=boolean_79)
flatten_40 = List.Flatten(list=clean_79)
boolean_80 = BoolSelector(false)
clean_80 = List.Clean(list=filterByBoolMask_39.out, preserveIndices=boolean_80)
getLocation_26 = Element.GetLocation(element=clean_80)
boolean_81 = BoolSelector(false)
clean_81 = List.Clean(list=filterByBoolMask_40.out, preserveIndices=boolean_81)
offset_da_tag_17 = DoubleInput(0.08)
translate_33 = Geometry.Translate(geometry=getLocation_26, direction=clean_81, distance=offset_da_tag_17)
facingOrientation_24 = FamilyInstance.FacingOrientation(familyInstance=clean_80)
offset_da_2ª_tag_17 = DoubleInput(0.12)
translate_34 = Geometry.Translate(geometry=translate_33, direction=facingOrientation_24, distance=offset_da_2ª_tag_17)
boolean_82 = BoolSelector(false)
clean_82 = List.Clean(list=translate_34, preserveIndices=boolean_82)
flatten_41 = List.Flatten(list=clean_82)
family_types_17 = FamilyTypes("Tag Interruptor:Comando (Switch ID)")
tag_byelement_17 = Custom[👓 Tag․ByElement](element=flatten_40, TagLocation=flatten_41, TagType=family_types_17)

code_block_35 = CodeBlock { 1; }
getItemAtIndex_8 = List.GetItemAtIndex(list=flatten_35, index=code_block_35, lacing=Longest)
boolean_83 = BoolSelector(false)
clean_83 = List.Clean(list=getItemAtIndex_8, preserveIndices=boolean_83)
getLocation_27 = Element.GetLocation(element=clean_83)
facingOrientation_25 = FamilyInstance.FacingOrientation(familyInstance=clean_83)
byStartPointDirectionLength_7 = Line.ByStartPointDirectionLength(startPoint=getLocation_27, direction=facingOrientation_25)
line_upvectoratparameter_6 = Custom[👓 Line․UpVectorAtParameter](line=byStartPointDirectionLength_7)
X_8 = Vector.X(vector=line_upvectoratparameter_6)
code_block_36 = CodeBlock { -1; }
eq_14 = X_8 == code_block_36
filterByBoolMask_41 = List.FilterByBoolMask(list=clean_83, mask=eq_14, lacing=Longest)
filterByBoolMask_42 = List.FilterByBoolMask(list=line_upvectoratparameter_6, mask=eq_14)

# group: TAG Horizontal
# Descrição <Clique duas vezes aqui para editar a descrição do grupo>
boolean_84 = BoolSelector(false)
clean_84 = List.Clean(list=filterByBoolMask_41.out, preserveIndices=boolean_84)
flatten_42 = List.Flatten(list=clean_84)
boolean_85 = BoolSelector(false)
clean_85 = List.Clean(list=filterByBoolMask_41.out, preserveIndices=boolean_85)
getLocation_28 = Element.GetLocation(element=clean_85)
boolean_86 = BoolSelector(false)
clean_86 = List.Clean(list=filterByBoolMask_42.out, preserveIndices=boolean_86)
offset_da_tag_18 = DoubleInput(0)
translate_35 = Geometry.Translate(geometry=getLocation_28, direction=clean_86, distance=offset_da_tag_18)
facingOrientation_26 = FamilyInstance.FacingOrientation(familyInstance=clean_85)
offset_da_2ª_tag_18 = DoubleInput(0.26)
translate_36 = Geometry.Translate(geometry=translate_35, direction=facingOrientation_26, distance=offset_da_2ª_tag_18)
boolean_87 = BoolSelector(false)
clean_87 = List.Clean(list=translate_36, preserveIndices=boolean_87)
flatten_43 = List.Flatten(list=clean_87)
family_types_18 = FamilyTypes("Tag Interruptor:Comando (Switch ID)")
tag_byelement_18 = Custom[👓 Tag․ByElement](element=flatten_42, TagLocation=flatten_43, TagType=family_types_18)

# group: TAG Vertical
# Descrição <Clique duas vezes aqui para editar a descrição do grupo>
boolean_88 = BoolSelector(false)
clean_88 = List.Clean(list=filterByBoolMask_41.in, preserveIndices=boolean_88)
flatten_44 = List.Flatten(list=clean_88)
boolean_89 = BoolSelector(false)
clean_89 = List.Clean(list=filterByBoolMask_41.in, preserveIndices=boolean_89)
getLocation_29 = Element.GetLocation(element=clean_89)
boolean_90 = BoolSelector(false)
clean_90 = List.Clean(list=filterByBoolMask_42.in, preserveIndices=boolean_90)
offset_da_tag_19 = DoubleInput(0)
translate_37 = Geometry.Translate(geometry=getLocation_29, direction=clean_90, distance=offset_da_tag_19)
facingOrientation_27 = FamilyInstance.FacingOrientation(familyInstance=clean_89)
offset_da_2ª_tag_19 = DoubleInput(0.3)
translate_38 = Geometry.Translate(geometry=translate_37, direction=facingOrientation_27, distance=offset_da_2ª_tag_19)
boolean_91 = BoolSelector(false)
clean_91 = List.Clean(list=translate_38, preserveIndices=boolean_91)
flatten_45 = List.Flatten(list=clean_91)
family_types_19 = FamilyTypes("Tag Interruptor:Comando (Switch ID)")
tag_byelement_19 = Custom[👓 Tag․ByElement](element=flatten_44, TagLocation=flatten_45, TagType=family_types_19)

# group: TAG Vertical
# Descrição <Clique duas vezes aqui para editar a descrição do grupo>
boolean_92 = BoolSelector(false)
clean_92 = List.Clean(list=filterByBoolMask_37.in, preserveIndices=boolean_92)
flatten_46 = List.Flatten(list=clean_92)
boolean_93 = BoolSelector(false)
clean_93 = List.Clean(list=filterByBoolMask_37.in, preserveIndices=boolean_93)
getLocation_30 = Element.GetLocation(element=clean_93)
boolean_94 = BoolSelector(false)
clean_94 = List.Clean(list=filterByBoolMask_38.in, preserveIndices=boolean_94)
reverse_4 = Vector.Reverse(vector=clean_94)
offset_da_tag_20 = DoubleInput(0.15)
translate_39 = Geometry.Translate(geometry=getLocation_30, direction=reverse_4, distance=offset_da_tag_20)
facingOrientation_28 = FamilyInstance.FacingOrientation(familyInstance=clean_93)
offset_da_2ª_tag_20 = DoubleInput(0.15)
translate_40 = Geometry.Translate(geometry=translate_39, direction=facingOrientation_28, distance=offset_da_2ª_tag_20)
boolean_95 = BoolSelector(false)
clean_95 = List.Clean(list=translate_40, preserveIndices=boolean_95)
flatten_47 = List.Flatten(list=clean_95)
family_types_20 = FamilyTypes("Tag Interruptor:Comando (Switch ID)")
tag_byelement_20 = Custom[👓 Tag․ByElement](element=flatten_46, TagLocation=flatten_47, TagType=family_types_20)

boolean_96 = BoolSelector(false)
clean_96 = List.Clean(list=filterByBoolMask_36.in, preserveIndices=boolean_96)
reverse_5 = List.Reverse(list=sortByKey_3.sortedList, lacing=Longest)
