# Dynamo graph 10-7_BIMACON_Tags de Interruptores_R01_script.dyn (Dynamo 2.6.1.8786)
# Inseri Tags de comandos dos Interruptores
# packages: BIMCoder Nodes - 2.X 2025.0.15, BIMCoder Nodes - 2.X 2025.1.0, Data-Shapes 2022.2.105

categories = Categories("OST_LightingDevices")
categories_2 = Categories("OST_ElectricalFixtures")
list_create = List.Create(item0=categories, item1=categories_2)
current = Document.Current()
activeView = Document.ActiveView(document=current)
all_elements_of_category_in_view = ElementsOfCategoryInView(Category=list_create, View=activeView)
flatten = List.Flatten(list=all_elements_of_category_in_view)
getFamily = FamilyInstance.GetFamily(familyInstance=flatten)
string_from_object = FromObject(object=getFamily)
code_block = CodeBlock { "Sensor"; }
contains = String.Contains(str=string_from_object, searchFor=code_block)
filterByBoolMask = List.FilterByBoolMask(list=flatten, mask=contains)
getFamily_2 = FamilyInstance.GetFamily(familyInstance=filterByBoolMask.out)
string_from_object_2 = FromObject(obj=getFamily_2)
code_block_2 = CodeBlock { "a_1 Interruptor"; }
contains_2 = String.Contains(str=string_from_object_2, searchFor=code_block_2)
filterByBoolMask_2 = List.FilterByBoolMask(list=filterByBoolMask.out, mask=contains_2)
string_from_object_3 = FromObject(object=filterByBoolMask_2.out)
code_block_3 = CodeBlock { "Simples"; }
contains_3 = String.Contains(str=string_from_object_3, searchFor=code_block_3)
filterByBoolMask_3 = List.FilterByBoolMask(list=filterByBoolMask_2.out, mask=contains_3@L2)
code_block_4 = CodeBlock { "Paralelo"; }
contains_4 = String.Contains(str=string_from_object_3, searchFor=code_block_4)
filterByBoolMask_4 = List.FilterByBoolMask(list=filterByBoolMask_2.out, mask=contains_4@L2)
code_block_5 = CodeBlock { "Intermediário"; }
contains_5 = String.Contains(str=string_from_object_3, searchFor=code_block_5)
filterByBoolMask_5 = List.FilterByBoolMask(list=filterByBoolMask_2.out, mask=contains_5@L2)
code_block_6 = CodeBlock { "Pulsador"; }
contains_6 = String.Contains(str=string_from_object_3, searchFor=code_block_6)
filterByBoolMask_6 = List.FilterByBoolMask(list=filterByBoolMask_2.out, mask=contains_6@L2)
list_create_2 = List.Create(item0=filterByBoolMask_3.in, item1=filterByBoolMask_4.in, item2=filterByBoolMask_5.in, item3=filterByBoolMask_6.in)
flatten_2 = List.Flatten(list=list_create_2)
uniqueItems = List.UniqueItems(list=flatten_2)
string_from_object_4 = FromObject(object=uniqueItems)
code_block_7 = CodeBlock { ["Tomada"]; }
contains_7 = String.Contains(str=string_from_object_4@L2, searchFor=code_block_7, lacing=Longest)
filterByBoolMask_7 = List.FilterByBoolMask(list=uniqueItems@L2, mask=contains_7@L2)
string_from_object_5 = FromObject(object=filterByBoolMask_7.out)
code_block_8 = CodeBlock { ["a. 2 Teclas Simples"]; }
contains_8 = String.Contains(str=string_from_object_5@L2, searchFor=code_block_8, lacing=Longest)
filterByBoolMask_8 = List.FilterByBoolMask(list=filterByBoolMask_7.out@L2, mask=contains_8@L2)
string_from_object_6 = FromObject(object=filterByBoolMask_8.out)
code_block_9 = CodeBlock { ["a. 3 Teclas Simples"]; }
contains_9 = String.Contains(str=string_from_object_6@L2, searchFor=code_block_9, lacing=Longest)
filterByBoolMask_9 = List.FilterByBoolMask(list=filterByBoolMask_8.out@L2, mask=contains_9@L2)
watch = Watch(filterByBoolMask_9.out)

# group: INT SIMPLES
getChildElements = Element.GetChildElements(element=watch)
string_from_object_7 = FromObject(object=getChildElements)
code_block_10 = CodeBlock { ["Caixa de Luz"]; }
contains_10 = String.Contains(str=string_from_object_7@L2, searchFor=code_block_10, lacing=Longest)
filterByBoolMask_10 = List.FilterByBoolMask(list=getChildElements@L2, mask=contains_10@L2)
string_from_object_8 = FromObject(object=filterByBoolMask_10.out)
code_block_11 = CodeBlock { ["Tomada"]; }
contains_11 = String.Contains(str=string_from_object_8@L2, searchFor=code_block_11, lacing=Longest)
filterByBoolMask_11 = List.FilterByBoolMask(list=filterByBoolMask_10.out@L2, mask=contains_11@L2)
boolean = BoolSelector(false)
clean = List.Clean(list=filterByBoolMask_11.out, preserveIndices=boolean)
getLocation = Element.GetLocation(element=clean)
Z = Point.Z(point=getLocation)
sortByKey = List.SortByKey(list=clean, keys=Z, lacing=Longest)
list_create_3 = List.Create(item0=filterByBoolMask.in, item1=sortByKey.sorted_list, item2=filterByBoolMask_2.in)
boolean_2 = BoolSelector(false)
clean_2 = List.Clean(list=list_create_3, preserveIndices=boolean_2)
flatten_3 = List.Flatten(list=clean_2@L2)
boolean_3 = BoolSelector(false)
clean_3 = List.Clean(list=filterByBoolMask_11.in, preserveIndices=boolean_3)
reverse = List.Reverse(list=sortByKey.sorted_list, lacing=Longest)

code_block_12 = CodeBlock { 0; }
getItemAtIndex = List.GetItemAtIndex(list=flatten_3, index=code_block_12, lacing=Longest)
boolean_4 = BoolSelector(false)
clean_4 = List.Clean(list=getItemAtIndex, preserveIndices=boolean_4)
getLocation_2 = Element.GetLocation(element=clean_4)
facingOrientation = FamilyInstance.FacingOrientation(familyInstance=clean_4)
byStartPointDirectionLength = Line.ByStartPointDirectionLength(startPoint=getLocation_2, direction=facingOrientation)
line_upvectoratparameter = Custom[👓 Line․UpVectorAtParameter](line=byStartPointDirectionLength)  # package BIMCoder Nodes - 2.X; Cria um vetor apontando para cima dado o parâmetro
X = Vector.X(vector=line_upvectoratparameter)
code_block_13 = CodeBlock { -1; }
eq = X == code_block_13
filterByBoolMask_12 = List.FilterByBoolMask(list=clean_4, mask=eq, lacing=Longest)
filterByBoolMask_13 = List.FilterByBoolMask(list=line_upvectoratparameter, mask=eq)

# group: SELECIONE O MODELO ARQ LINKADO
code_block_14 = CodeBlock { "Escolha o Tipo de TAG"; }
string = StringInput("LogoBimacon.png")
python_script = Python(IN[0]=string)
# ---------- python_script.python (22 lines) ----------
import clr

# Adiciona referência ao ambiente .NET
clr.AddReference('System')
from System import Environment, IO

# Nome da imagem (entrada do usuário)
nome_arquivo_imagem = IN[0]

# Recupera o nome do usuário logado no Windows
usuario = Environment.UserName

# Monta o caminho completo para a pasta de imagens
caminho_base = r"C:\Users\{0}\AppData\Roaming\pyRevit\Extensions\Bimacon.extension\Bimacon.tab\Imagens_Bimacon".format(usuario)

# Junta o caminho base com o nome do arquivo
caminho_completo = IO.Path.Combine(caminho_base, nome_arquivo_imagem)

# Verifica se o arquivo existe
existe = IO.File.Exists(caminho_completo)

OUT = caminho_completo if existe else "Imagem não encontrada: {0}".format(caminho_completo)
# ----------------------------------------
file_from_path = FileObject(path=python_script)
readFromFile = Image.ReadFromFile(file=file_from_path)
string_2 = StringInput("Confirmar")
categories_3 = Categories("OST_LightingDeviceTags")
obter_famílias_de_uma_categoria = Python(IN[0]=categories_3)  # "Obter Famílias de Uma Categoria - BIMACON"
# ---------- obter_famílias_de_uma_categoria.python (52 lines) ----------
import clr
import System

# Revit API
clr.AddReference('RevitAPI')
from Autodesk.Revit.DB import *

# RevitServices
clr.AddReference("RevitServices")
from RevitServices.Persistence import DocumentManager
from RevitServices.Transactions import TransactionManager

# RevitNodes para manipular categorias
clr.AddReference("RevitNodes")
import Revit
clr.ImportExtensions(Revit.Elements)

# Documento atual
doc = DocumentManager.Instance.CurrentDBDocument

# Função para obter BuiltInCategory de uma entrada
def obter_builtincategory(entrada):
    if isinstance(entrada, Category):
        return System.Enum.ToObject(BuiltInCategory, entrada.Id.IntegerValue)
    elif isinstance(entrada, int):
        return System.Enum.ToObject(BuiltInCategory, entrada)
    elif isinstance(entrada, BuiltInCategory):
        return entrada
    elif hasattr(entrada, "Id"):
        return System.Enum.ToObject(BuiltInCategory, entrada.Id.IntegerValue)
    else:
        return None

# Entrada
entrada = UnwrapElement(IN[0])
bic = obter_builtincategory(entrada)

# Coletar todas as famílias no documento
todas_familias = FilteredElementCollector(doc).OfClass(Family).ToElements()

# Filtrar famílias pela categoria
familias_filtradas = []
if bic:
    for fam in todas_familias:
        try:
            if fam.FamilyCategory.Id.IntegerValue == int(bic):
                familias_filtradas.append(fam)
        except:
            continue

# Saída
OUT = familias_filtradas
# ----------------------------------------
types = Family.Types(family=obter_famílias_de_uma_categoria)
name = Element.Name(element=types)
code_block_15 = CodeBlock { "Comando"; }
contains_12 = String.Contains(str=name, searchFor=code_block_15)
filterByBoolMask_14 = List.FilterByBoolMask(list=types, mask=contains_12)
boolean_5 = BoolSelector(false)
clean_5 = List.Clean(list=filterByBoolMask_14.in, preserveIndices=boolean_5)
flatten_4 = List.Flatten(list=clean_5)
code_block_16 = CodeBlock { 1; }
boolean_6 = BoolSelector(true)
string_3 = StringInput("Cancelar")
code_block_17 = CodeBlock()  # //Data-Shapes
code_block_18 = CodeBlock()  # //archilab

name_2 = Element.Name(element=flatten_4)

# group (continued): SELECIONE O MODELO ARQ LINKADO
dropdown_data = Custom[DropDown Data](Keys=name_2, Values=flatten_4, DefaultValueIndex=code_block_16)  # package Data-Shapes; Create data for DropDown input in UI.MultiInputForm ++ . Check out www.data-shapes.net for more infos.
multipleinputform = Custom[MultipleInputForm ++](Description_optional=code_block_14, Logo_optional=readFromFile, ButtonText_optional=string_2, Inputs=dropdown_data, Toggle=boolean_6, CancelButtonText_optional=string_3)  # package Data-Shapes; Create a form with multiple inputs. see www.data-shapes.net for tutorials and infos!

# group: Separar Entradas
code_block_19 = CodeBlock { 0; }
getItemAtIndex_2 = List.GetItemAtIndex(list=multipleinputform.User_Inputs, index=code_block_19)

# group: TAG Vertical Neg
boolean_7 = BoolSelector(false)
clean_6 = List.Clean(list=filterByBoolMask_12.in, preserveIndices=boolean_7)
flatten_5 = List.Flatten(list=clean_6)
boolean_8 = BoolSelector(false)
clean_7 = List.Clean(list=filterByBoolMask_12.in, preserveIndices=boolean_8)
getLocation_3 = Element.GetLocation(element=clean_7)
boolean_9 = BoolSelector(false)
clean_8 = List.Clean(list=filterByBoolMask_13.in, preserveIndices=boolean_9)
offset_da_tag = DoubleInput(0.22)
translate = Geometry.Translate(geometry=getLocation_3, direction=clean_8, distance=offset_da_tag)
facingOrientation_2 = FamilyInstance.FacingOrientation(familyInstance=clean_7)
offset_da_2ª_tag = DoubleInput(0.15)
translate_2 = Geometry.Translate(geometry=translate, direction=facingOrientation_2, distance=offset_da_2ª_tag)
boolean_10 = BoolSelector(false)
clean_9 = List.Clean(list=translate_2, preserveIndices=boolean_10)
flatten_6 = List.Flatten(list=clean_9)
tag_byelement = Custom[👓 Tag․ByElement](element=flatten_5, TagLocation=flatten_6, TagType=getItemAtIndex_2)  # package BIMCoder Nodes - 2.X; Cria uma Tag em elemento(s) dado o tipo da Tag e a posição

watch_2 = Watch(filterByBoolMask.in)

# group: TAG Horizontal
boolean_11 = BoolSelector(false)
clean_10 = List.Clean(list=filterByBoolMask_12.out, preserveIndices=boolean_11)
flatten_7 = List.Flatten(list=clean_10)
boolean_12 = BoolSelector(false)
clean_11 = List.Clean(list=filterByBoolMask_12.out, preserveIndices=boolean_12)
getLocation_4 = Element.GetLocation(element=clean_11)
boolean_13 = BoolSelector(false)
clean_12 = List.Clean(list=filterByBoolMask_13.out, preserveIndices=boolean_13)
offset_da_tag_2 = DoubleInput(0.08)
translate_3 = Geometry.Translate(geometry=getLocation_4, direction=clean_12, distance=offset_da_tag_2)
facingOrientation_3 = FamilyInstance.FacingOrientation(familyInstance=clean_11)
offset_da_2ª_tag_2 = DoubleInput(0.12)
translate_4 = Geometry.Translate(geometry=translate_3, direction=facingOrientation_3, distance=offset_da_2ª_tag_2)
boolean_14 = BoolSelector(false)
clean_13 = List.Clean(list=translate_4, preserveIndices=boolean_14)
flatten_8 = List.Flatten(list=clean_13)
tag_byelement_2 = Custom[👓 Tag․ByElement](element=flatten_7, TagLocation=flatten_8, TagType=getItemAtIndex_2)

code_block_20 = CodeBlock { 1; }
getItemAtIndex_3 = List.GetItemAtIndex(list=flatten_3, index=code_block_20, lacing=Longest)
boolean_15 = BoolSelector(false)
clean_14 = List.Clean(list=getItemAtIndex_3, preserveIndices=boolean_15)
getLocation_5 = Element.GetLocation(element=clean_14)
facingOrientation_4 = FamilyInstance.FacingOrientation(familyInstance=clean_14)
byStartPointDirectionLength_2 = Line.ByStartPointDirectionLength(startPoint=getLocation_5, direction=facingOrientation_4)
line_upvectoratparameter_2 = Custom[👓 Line․UpVectorAtParameter](line=byStartPointDirectionLength_2)
X_2 = Vector.X(vector=line_upvectoratparameter_2)
code_block_21 = CodeBlock { -1; }
eq_2 = X_2 == code_block_21
filterByBoolMask_15 = List.FilterByBoolMask(list=clean_14, mask=eq_2, lacing=Longest)
filterByBoolMask_16 = List.FilterByBoolMask(list=line_upvectoratparameter_2, mask=eq_2)

# group: TAG Horizontal
boolean_16 = BoolSelector(false)
clean_15 = List.Clean(list=filterByBoolMask_15.out, preserveIndices=boolean_16)
flatten_9 = List.Flatten(list=clean_15)
boolean_17 = BoolSelector(false)
clean_16 = List.Clean(list=filterByBoolMask_15.out, preserveIndices=boolean_17)
getLocation_6 = Element.GetLocation(element=clean_16)
boolean_18 = BoolSelector(false)
clean_17 = List.Clean(list=filterByBoolMask_16.out, preserveIndices=boolean_18)
offset_da_tag_3 = DoubleInput(0.08)
translate_5 = Geometry.Translate(geometry=getLocation_6, direction=clean_17, distance=offset_da_tag_3)
facingOrientation_5 = FamilyInstance.FacingOrientation(familyInstance=clean_16)
offset_da_2ª_tag_3 = DoubleInput(0.32)
translate_6 = Geometry.Translate(geometry=translate_5, direction=facingOrientation_5, distance=offset_da_2ª_tag_3)
boolean_19 = BoolSelector(false)
clean_18 = List.Clean(list=translate_6, preserveIndices=boolean_19)
flatten_10 = List.Flatten(list=clean_18)
tag_byelement_3 = Custom[👓 Tag․ByElement](element=flatten_9, TagLocation=flatten_10, TagType=getItemAtIndex_2)

# group: TAG Vertical
boolean_20 = BoolSelector(false)
clean_19 = List.Clean(list=filterByBoolMask_15.in, preserveIndices=boolean_20)
flatten_11 = List.Flatten(list=clean_19)
boolean_21 = BoolSelector(false)
clean_20 = List.Clean(list=filterByBoolMask_15.in, preserveIndices=boolean_21)
getLocation_7 = Element.GetLocation(element=clean_20)
boolean_22 = BoolSelector(false)
clean_21 = List.Clean(list=filterByBoolMask_16.in, preserveIndices=boolean_22)
offset_da_tag_4 = DoubleInput(0.22)
translate_7 = Geometry.Translate(geometry=getLocation_7, direction=clean_21, distance=offset_da_tag_4)
facingOrientation_6 = FamilyInstance.FacingOrientation(familyInstance=clean_20)
offset_da_2ª_tag_4 = DoubleInput(0.3)
translate_8 = Geometry.Translate(geometry=translate_7, direction=facingOrientation_6, distance=offset_da_2ª_tag_4)
boolean_23 = BoolSelector(false)
clean_22 = List.Clean(list=translate_8, preserveIndices=boolean_23)
flatten_12 = List.Flatten(list=clean_22)
tag_byelement_4 = Custom[👓 Tag․ByElement](element=flatten_11, TagLocation=flatten_12, TagType=getItemAtIndex_2)

code_block_22 = CodeBlock { 2; }
getItemAtIndex_4 = List.GetItemAtIndex(list=flatten_3, index=code_block_22, lacing=Longest)
boolean_24 = BoolSelector(false)
clean_23 = List.Clean(list=getItemAtIndex_4, preserveIndices=boolean_24)
getLocation_8 = Element.GetLocation(element=clean_23)
facingOrientation_7 = FamilyInstance.FacingOrientation(familyInstance=clean_23)
byStartPointDirectionLength_3 = Line.ByStartPointDirectionLength(startPoint=getLocation_8, direction=facingOrientation_7)
line_upvectoratparameter_3 = Custom[👓 Line․UpVectorAtParameter](line=byStartPointDirectionLength_3)
X_3 = Vector.X(vector=line_upvectoratparameter_3)
code_block_23 = CodeBlock { -1; }
eq_3 = X_3 == code_block_23
filterByBoolMask_17 = List.FilterByBoolMask(list=clean_23, mask=eq_3, lacing=Longest)
filterByBoolMask_18 = List.FilterByBoolMask(list=line_upvectoratparameter_3, mask=eq_3)

# group: TAG Horizontal
boolean_25 = BoolSelector(false)
clean_24 = List.Clean(list=filterByBoolMask_17.out, preserveIndices=boolean_25)
flatten_13 = List.Flatten(list=clean_24)
boolean_26 = BoolSelector(false)
clean_25 = List.Clean(list=filterByBoolMask_17.out, preserveIndices=boolean_26)
getLocation_9 = Element.GetLocation(element=clean_25)
boolean_27 = BoolSelector(false)
clean_26 = List.Clean(list=filterByBoolMask_18.out, preserveIndices=boolean_27)
offset_da_tag_5 = DoubleInput(0.08)
translate_9 = Geometry.Translate(geometry=getLocation_9, direction=clean_26, distance=offset_da_tag_5)
facingOrientation_8 = FamilyInstance.FacingOrientation(familyInstance=clean_25)
offset_da_2ª_tag_5 = DoubleInput(0.48)
translate_10 = Geometry.Translate(geometry=translate_9, direction=facingOrientation_8, distance=offset_da_2ª_tag_5)
boolean_28 = BoolSelector(false)
clean_27 = List.Clean(list=translate_10, preserveIndices=boolean_28)
flatten_14 = List.Flatten(list=clean_27)
tag_byelement_5 = Custom[👓 Tag․ByElement](element=flatten_13, TagLocation=flatten_14, TagType=getItemAtIndex_2)

# group: TAG Vertical
boolean_29 = BoolSelector(false)
clean_28 = List.Clean(list=filterByBoolMask_17.in, preserveIndices=boolean_29)
flatten_15 = List.Flatten(list=clean_28)
boolean_30 = BoolSelector(false)
clean_29 = List.Clean(list=filterByBoolMask_17.in, preserveIndices=boolean_30)
getLocation_10 = Element.GetLocation(element=clean_29)
boolean_31 = BoolSelector(false)
clean_30 = List.Clean(list=filterByBoolMask_18.in, preserveIndices=boolean_31)
offset_da_tag_6 = DoubleInput(0.22)
translate_11 = Geometry.Translate(geometry=getLocation_10, direction=clean_30, distance=offset_da_tag_6)
facingOrientation_9 = FamilyInstance.FacingOrientation(familyInstance=clean_29)
offset_da_2ª_tag_6 = DoubleInput(0.45)
translate_12 = Geometry.Translate(geometry=translate_11, direction=facingOrientation_9, distance=offset_da_2ª_tag_6)
boolean_32 = BoolSelector(false)
clean_31 = List.Clean(list=translate_12, preserveIndices=boolean_32)
flatten_16 = List.Flatten(list=clean_31)
tag_byelement_6 = Custom[👓 Tag․ByElement](element=flatten_15, TagLocation=flatten_16, TagType=getItemAtIndex_2)

# group: CONJUNTO INT E TOMADA
getChildElements_2 = Element.GetChildElements(element=filterByBoolMask_7.in)
string_from_object_9 = FromObject(object=getChildElements_2)
code_block_24 = CodeBlock { ["Caixa de Luz"]; }
contains_13 = String.Contains(str=string_from_object_9@L2, searchFor=code_block_24, lacing=Longest)
filterByBoolMask_19 = List.FilterByBoolMask(list=getChildElements_2@L2, mask=contains_13@L2)
string_from_object_10 = FromObject(object=filterByBoolMask_19.out)
code_block_25 = CodeBlock { ["Tomada"]; }
contains_14 = String.Contains(str=string_from_object_10@L2, searchFor=code_block_25, lacing=Longest)
filterByBoolMask_20 = List.FilterByBoolMask(list=filterByBoolMask_19.out@L2, mask=contains_14@L2)
boolean_33 = BoolSelector(false)
clean_32 = List.Clean(list=filterByBoolMask_20.out, preserveIndices=boolean_33)
getLocation_11 = Element.GetLocation(element=clean_32)
Z_2 = Point.Z(point=getLocation_11)
sortByKey_2 = List.SortByKey(list=clean_32, keys=Z_2, lacing=Longest)
reverse_2 = List.Reverse(list=sortByKey_2.sorted_list, lacing=Longest)
boolean_34 = BoolSelector(false)
clean_33 = List.Clean(list=reverse_2, preserveIndices=boolean_34)
flatten_17 = List.Flatten(list=clean_33@L2)

code_block_26 = CodeBlock { 0; }
getItemAtIndex_5 = List.GetItemAtIndex(list=flatten_17, index=code_block_26, lacing=Longest)
boolean_35 = BoolSelector(false)
clean_34 = List.Clean(list=getItemAtIndex_5, preserveIndices=boolean_35)
facingOrientation_10 = FamilyInstance.FacingOrientation(familyInstance=clean_34)
X_4 = Vector.X(vector=facingOrientation_10)
code_block_27 = CodeBlock { -1; }
eq_4 = X_4 == code_block_27
filterByBoolMask_21 = List.FilterByBoolMask(list=clean_34, mask=eq_4, lacing=Longest)
filterByBoolMask_22 = List.FilterByBoolMask(list=facingOrientation_10, mask=eq_4)

# group: TAG Vertical Neg
boolean_36 = BoolSelector(false)
clean_35 = List.Clean(list=filterByBoolMask_21.in, preserveIndices=boolean_36)
flatten_18 = List.Flatten(list=clean_35)
boolean_37 = BoolSelector(false)
clean_36 = List.Clean(list=filterByBoolMask_21.in, preserveIndices=boolean_37)
getLocation_12 = Element.GetLocation(element=clean_36)
boolean_38 = BoolSelector(false)
clean_37 = List.Clean(list=filterByBoolMask_22.in, preserveIndices=boolean_38)
ZAxis = Vector.ZAxis()
cross = Vector.Cross(vector=clean_37, cross=ZAxis)
offset_da_tag_7 = DoubleInput(0.18)
translate_13 = Geometry.Translate(geometry=getLocation_12, direction=cross, distance=offset_da_tag_7)
facingOrientation_11 = FamilyInstance.FacingOrientation(familyInstance=clean_36)
offset_da_2ª_tag_7 = DoubleInput(0.2)
translate_14 = Geometry.Translate(geometry=translate_13, direction=facingOrientation_11, distance=offset_da_2ª_tag_7)
boolean_39 = BoolSelector(false)
clean_38 = List.Clean(list=translate_14, preserveIndices=boolean_39)
flatten_19 = List.Flatten(list=clean_38)
tag_byelement_7 = Custom[👓 Tag․ByElement](element=flatten_18, TagLocation=flatten_19, TagType=getItemAtIndex_2)

Y = Vector.Y(vector=facingOrientation_10)
code_block_28 = CodeBlock { -1; }
eq_5 = Equals(x=Y, y=code_block_28)
filterByBoolMask_23 = List.FilterByBoolMask(list=clean_34, mask=eq_5, lacing=Longest)
filterByBoolMask_24 = List.FilterByBoolMask(list=facingOrientation_10, mask=eq_5)

# group: TAG Horizontal Pos
boolean_40 = BoolSelector(false)
clean_39 = List.Clean(list=filterByBoolMask_23.in, preserveIndices=boolean_40)
flatten_20 = List.Flatten(list=clean_39)
boolean_41 = BoolSelector(false)
clean_40 = List.Clean(list=filterByBoolMask_23.in, preserveIndices=boolean_41)
getLocation_13 = Element.GetLocation(element=clean_40)
boolean_42 = BoolSelector(false)
clean_41 = List.Clean(list=filterByBoolMask_24.in, preserveIndices=boolean_42)
offset_da_tag_8 = DoubleInput(0.2)
translate_15 = Geometry.Translate(geometry=getLocation_13, direction=clean_41, distance=offset_da_tag_8)
facingOrientation_12 = FamilyInstance.FacingOrientation(familyInstance=clean_40)
ZAxis_2 = Vector.ZAxis()
cross_2 = Vector.Cross(vector=facingOrientation_12, cross=ZAxis_2)
offset_da_2ª_tag_8 = DoubleInput(0.32)
translate_16 = Geometry.Translate(geometry=translate_15, direction=cross_2, distance=offset_da_2ª_tag_8)
boolean_43 = BoolSelector(false)
clean_42 = List.Clean(list=translate_16, preserveIndices=boolean_43)
flatten_21 = List.Flatten(list=clean_42)
tag_byelement_8 = Custom[👓 Tag․ByElement](element=flatten_20, TagLocation=flatten_21, TagType=getItemAtIndex_2)

code_block_29 = CodeBlock { 1; }
eq_6 = X_4 == code_block_29
filterByBoolMask_25 = List.FilterByBoolMask(list=clean_34, mask=eq_6, lacing=Longest)
filterByBoolMask_26 = List.FilterByBoolMask(list=facingOrientation_10, mask=eq_6)

# group: TAG Vertical Pos
boolean_44 = BoolSelector(false)
clean_43 = List.Clean(list=filterByBoolMask_25.in, preserveIndices=boolean_44)
flatten_22 = List.Flatten(list=clean_43)
boolean_45 = BoolSelector(false)
clean_44 = List.Clean(list=filterByBoolMask_25.in, preserveIndices=boolean_45)
getLocation_14 = Element.GetLocation(element=clean_44)
boolean_46 = BoolSelector(false)
clean_45 = List.Clean(list=filterByBoolMask_26.in, preserveIndices=boolean_46)
ZAxis_3 = Vector.ZAxis()
cross_3 = Vector.Cross(vector=clean_45, cross=ZAxis_3)
offset_da_tag_9 = DoubleInput(0.3)
translate_17 = Geometry.Translate(geometry=getLocation_14, direction=cross_3, distance=offset_da_tag_9)
facingOrientation_13 = FamilyInstance.FacingOrientation(familyInstance=clean_44)
offset_da_2ª_tag_9 = DoubleInput(0.15)
translate_18 = Geometry.Translate(geometry=translate_17, direction=facingOrientation_13, distance=offset_da_2ª_tag_9)
boolean_47 = BoolSelector(false)
clean_46 = List.Clean(list=translate_18, preserveIndices=boolean_47)
flatten_23 = List.Flatten(list=clean_46)
tag_byelement_9 = Custom[👓 Tag․ByElement](element=flatten_22, TagLocation=flatten_23, TagType=getItemAtIndex_2)

code_block_30 = CodeBlock { 1; }
eq_7 = Y == code_block_30
filterByBoolMask_27 = List.FilterByBoolMask(list=clean_34, mask=eq_7, lacing=Longest)
filterByBoolMask_28 = List.FilterByBoolMask(list=facingOrientation_10, mask=eq_7)

# group: TAG Horizontal Pos
boolean_48 = BoolSelector(false)
clean_47 = List.Clean(list=filterByBoolMask_27.in, preserveIndices=boolean_48)
flatten_24 = List.Flatten(list=clean_47)
boolean_49 = BoolSelector(false)
clean_48 = List.Clean(list=filterByBoolMask_27.in, preserveIndices=boolean_49)
getLocation_15 = Element.GetLocation(element=clean_48)
boolean_50 = BoolSelector(false)
clean_49 = List.Clean(list=filterByBoolMask_28.in, preserveIndices=boolean_50)
offset_da_tag_10 = DoubleInput(0.2)
translate_19 = Geometry.Translate(geometry=getLocation_15, direction=clean_49, distance=offset_da_tag_10)
facingOrientation_14 = FamilyInstance.FacingOrientation(familyInstance=clean_48)
ZAxis_4 = Vector.ZAxis()
cross_4 = Vector.Cross(vector=facingOrientation_14, cross=ZAxis_4)
offset_da_2ª_tag_10 = DoubleInput(0.2)
translate_20 = Geometry.Translate(geometry=translate_19, direction=cross_4, distance=offset_da_2ª_tag_10)
boolean_51 = BoolSelector(false)
clean_50 = List.Clean(list=translate_20, preserveIndices=boolean_51)
flatten_25 = List.Flatten(list=clean_50)
tag_byelement_10 = Custom[👓 Tag․ByElement](element=flatten_24, TagLocation=flatten_25, TagType=getItemAtIndex_2)

getLocation_16 = Element.GetLocation(element=clean_34)
byStartPointDirectionLength_4 = Line.ByStartPointDirectionLength(startPoint=getLocation_16, direction=facingOrientation_10)
code_block_31 = CodeBlock { 1; }
getItemAtIndex_6 = List.GetItemAtIndex(list=flatten_17, index=code_block_31, lacing=Longest)
boolean_52 = BoolSelector(false)
clean_51 = List.Clean(list=getItemAtIndex_6, preserveIndices=boolean_52)
facingOrientation_15 = FamilyInstance.FacingOrientation(familyInstance=clean_51)
Y_2 = Vector.Y(vector=facingOrientation_15)
code_block_32 = CodeBlock { 1; }
eq_8 = Y_2 == code_block_32
filterByBoolMask_29 = List.FilterByBoolMask(list=clean_51, mask=eq_8, lacing=Longest)
filterByBoolMask_30 = List.FilterByBoolMask(list=facingOrientation_15, mask=eq_8)

# group: TAG Horizontal Pos
boolean_53 = BoolSelector(false)
clean_52 = List.Clean(list=filterByBoolMask_29.in, preserveIndices=boolean_53)
flatten_26 = List.Flatten(list=clean_52)
boolean_54 = BoolSelector(false)
clean_53 = List.Clean(list=filterByBoolMask_29.in, preserveIndices=boolean_54)
getLocation_17 = Element.GetLocation(element=clean_53)
boolean_55 = BoolSelector(false)
clean_54 = List.Clean(list=filterByBoolMask_30.in, preserveIndices=boolean_55)
offset_da_tag_11 = DoubleInput(0.35)
translate_21 = Geometry.Translate(geometry=getLocation_17, direction=clean_54, distance=offset_da_tag_11)
facingOrientation_16 = FamilyInstance.FacingOrientation(familyInstance=clean_53)
ZAxis_5 = Vector.ZAxis()
cross_5 = Vector.Cross(vector=facingOrientation_16, cross=ZAxis_5)
offset_da_2ª_tag_11 = DoubleInput(0.2)
translate_22 = Geometry.Translate(geometry=translate_21, direction=cross_5, distance=offset_da_2ª_tag_11)
boolean_56 = BoolSelector(false)
clean_55 = List.Clean(list=translate_22, preserveIndices=boolean_56)
flatten_27 = List.Flatten(list=clean_55)
tag_byelement_11 = Custom[👓 Tag․ByElement](element=flatten_26, TagLocation=flatten_27, TagType=getItemAtIndex_2)

X_5 = Vector.X(vector=facingOrientation_15)
code_block_33 = CodeBlock { -1; }
eq_9 = X_5 == code_block_33
filterByBoolMask_31 = List.FilterByBoolMask(list=clean_51, mask=eq_9, lacing=Longest)
filterByBoolMask_32 = List.FilterByBoolMask(list=facingOrientation_15, mask=eq_9)

# group: TAG Vertical Neg
boolean_57 = BoolSelector(false)
clean_56 = List.Clean(list=filterByBoolMask_31.in, preserveIndices=boolean_57)
flatten_28 = List.Flatten(list=clean_56)
boolean_58 = BoolSelector(false)
clean_57 = List.Clean(list=filterByBoolMask_31.in, preserveIndices=boolean_58)
getLocation_18 = Element.GetLocation(element=clean_57)
boolean_59 = BoolSelector(false)
clean_58 = List.Clean(list=filterByBoolMask_32.in, preserveIndices=boolean_59)
ZAxis_6 = Vector.ZAxis()
cross_6 = Vector.Cross(vector=clean_58, cross=ZAxis_6)
offset_da_tag_12 = DoubleInput(0.18)
translate_23 = Geometry.Translate(geometry=getLocation_18, direction=cross_6, distance=offset_da_tag_12)
facingOrientation_17 = FamilyInstance.FacingOrientation(familyInstance=clean_57)
offset_da_2ª_tag_12 = DoubleInput(0.4)
translate_24 = Geometry.Translate(geometry=translate_23, direction=facingOrientation_17, distance=offset_da_2ª_tag_12)
boolean_60 = BoolSelector(false)
clean_59 = List.Clean(list=translate_24, preserveIndices=boolean_60)
flatten_29 = List.Flatten(list=clean_59)
tag_byelement_12 = Custom[👓 Tag․ByElement](element=flatten_28, TagLocation=flatten_29, TagType=getItemAtIndex_2)

code_block_34 = CodeBlock { -1; }
eq_10 = Equals(x=Y_2, y=code_block_34)
filterByBoolMask_33 = List.FilterByBoolMask(list=clean_51, mask=eq_10, lacing=Longest)
filterByBoolMask_34 = List.FilterByBoolMask(list=facingOrientation_15, mask=eq_10)

# group: TAG Horizontal Pos
boolean_61 = BoolSelector(false)
clean_60 = List.Clean(list=filterByBoolMask_33.in, preserveIndices=boolean_61)
flatten_30 = List.Flatten(list=clean_60)
boolean_62 = BoolSelector(false)
clean_61 = List.Clean(list=filterByBoolMask_33.in, preserveIndices=boolean_62)
getLocation_19 = Element.GetLocation(element=clean_61)
boolean_63 = BoolSelector(false)
clean_62 = List.Clean(list=filterByBoolMask_34.in, preserveIndices=boolean_63)
offset_da_tag_13 = DoubleInput(0.4)
translate_25 = Geometry.Translate(geometry=getLocation_19, direction=clean_62, distance=offset_da_tag_13)
facingOrientation_18 = FamilyInstance.FacingOrientation(familyInstance=clean_61)
ZAxis_7 = Vector.ZAxis()
cross_7 = Vector.Cross(vector=facingOrientation_18, cross=ZAxis_7)
offset_da_2ª_tag_13 = DoubleInput(0.32)
translate_26 = Geometry.Translate(geometry=translate_25, direction=cross_7, distance=offset_da_2ª_tag_13)
boolean_64 = BoolSelector(false)
clean_63 = List.Clean(list=translate_26, preserveIndices=boolean_64)
flatten_31 = List.Flatten(list=clean_63)
tag_byelement_13 = Custom[👓 Tag․ByElement](element=flatten_30, TagLocation=flatten_31, TagType=getItemAtIndex_2)

code_block_35 = CodeBlock { 1; }
eq_11 = X_5 == code_block_35
filterByBoolMask_35 = List.FilterByBoolMask(list=clean_51, mask=eq_11, lacing=Longest)
filterByBoolMask_36 = List.FilterByBoolMask(list=facingOrientation_15, mask=eq_11)

# group: TAG Vertical Pos
boolean_65 = BoolSelector(false)
clean_64 = List.Clean(list=filterByBoolMask_35.in, preserveIndices=boolean_65)
flatten_32 = List.Flatten(list=clean_64)
boolean_66 = BoolSelector(false)
clean_65 = List.Clean(list=filterByBoolMask_35.in, preserveIndices=boolean_66)
getLocation_20 = Element.GetLocation(element=clean_65)
boolean_67 = BoolSelector(false)
clean_66 = List.Clean(list=filterByBoolMask_36.in, preserveIndices=boolean_67)
ZAxis_8 = Vector.ZAxis()
cross_8 = Vector.Cross(vector=clean_66, cross=ZAxis_8)
offset_da_tag_14 = DoubleInput(0.3)
translate_27 = Geometry.Translate(geometry=getLocation_20, direction=cross_8, distance=offset_da_tag_14)
facingOrientation_19 = FamilyInstance.FacingOrientation(familyInstance=clean_65)
offset_da_2ª_tag_14 = DoubleInput(0.35)
translate_28 = Geometry.Translate(geometry=translate_27, direction=facingOrientation_19, distance=offset_da_2ª_tag_14)
boolean_68 = BoolSelector(false)
clean_67 = List.Clean(list=translate_28, preserveIndices=boolean_68)
flatten_33 = List.Flatten(list=clean_67)
tag_byelement_14 = Custom[👓 Tag․ByElement](element=flatten_32, TagLocation=flatten_33, TagType=getItemAtIndex_2)

# group: INT DUPLO E TRIPLO
list_create_4 = List.Create(item0=filterByBoolMask_8.in, item1=filterByBoolMask_9.in)
flatten_34 = List.Flatten(list=list_create_4)
getChildElements_3 = Element.GetChildElements(element=flatten_34)
string_from_object_11 = FromObject(object=getChildElements_3)
code_block_36 = CodeBlock { ["Caixa de Luz"]; }
contains_15 = String.Contains(str=string_from_object_11@L2, searchFor=code_block_36, lacing=Longest)
filterByBoolMask_37 = List.FilterByBoolMask(list=getChildElements_3@L2, mask=contains_15@L2)
string_from_object_12 = FromObject(object=filterByBoolMask_37.out)
code_block_37 = CodeBlock { ["Tomada"]; }
contains_16 = String.Contains(str=string_from_object_12@L2, searchFor=code_block_37, lacing=Longest)
filterByBoolMask_38 = List.FilterByBoolMask(list=filterByBoolMask_37.out@L2, mask=contains_16@L2)
boolean_69 = BoolSelector(false)
clean_68 = List.Clean(list=filterByBoolMask_38.out, preserveIndices=boolean_69)
getLocation_21 = Element.GetLocation(element=clean_68)
Z_3 = Point.Z(point=getLocation_21)
sortByKey_3 = List.SortByKey(list=clean_68, keys=Z_3, lacing=Longest)
boolean_70 = BoolSelector(false)
clean_69 = List.Clean(list=sortByKey_3.sorted_list, preserveIndices=boolean_70)
flatten_35 = List.Flatten(list=clean_69@L2)
boolean_71 = BoolSelector(false)
clean_70 = List.Clean(list=filterByBoolMask_38.in, preserveIndices=boolean_71)
reverse_3 = List.Reverse(list=sortByKey_3.sorted_list, lacing=Longest)

# group: INT TRIPLO 3º INTERRUPTOR
code_block_38 = CodeBlock { 2; }
getItemAtIndex_7 = List.GetItemAtIndex(list=flatten_35, index=code_block_38, lacing=Longest)
boolean_72 = BoolSelector(false)
clean_71 = List.Clean(list=getItemAtIndex_7, preserveIndices=boolean_72)
getLocation_22 = Element.GetLocation(element=clean_71)
facingOrientation_20 = FamilyInstance.FacingOrientation(familyInstance=clean_71)
byStartPointDirectionLength_5 = Line.ByStartPointDirectionLength(startPoint=getLocation_22, direction=facingOrientation_20)
line_upvectoratparameter_4 = Custom[👓 Line․UpVectorAtParameter](line=byStartPointDirectionLength_5)
X_6 = Vector.X(vector=line_upvectoratparameter_4)
code_block_39 = CodeBlock { -1; }
eq_12 = X_6 == code_block_39
filterByBoolMask_39 = List.FilterByBoolMask(list=clean_71, mask=eq_12, lacing=Longest)
filterByBoolMask_40 = List.FilterByBoolMask(list=line_upvectoratparameter_4, mask=eq_12)

# group: TAG Horizontal
boolean_73 = BoolSelector(false)
clean_72 = List.Clean(list=filterByBoolMask_39.out, preserveIndices=boolean_73)
flatten_36 = List.Flatten(list=clean_72)
boolean_74 = BoolSelector(false)
clean_73 = List.Clean(list=filterByBoolMask_39.out, preserveIndices=boolean_74)
getLocation_23 = Element.GetLocation(element=clean_73)
boolean_75 = BoolSelector(false)
clean_74 = List.Clean(list=filterByBoolMask_40.out, preserveIndices=boolean_75)
reverse_4 = Vector.Reverse(vector=clean_74)
offset_da_tag_15 = DoubleInput(0.2)
translate_29 = Geometry.Translate(geometry=getLocation_23, direction=reverse_4, distance=offset_da_tag_15)
facingOrientation_21 = FamilyInstance.FacingOrientation(familyInstance=clean_73)
offset_da_2ª_tag_15 = DoubleInput(0.12)
translate_30 = Geometry.Translate(geometry=translate_29, direction=facingOrientation_21, distance=offset_da_2ª_tag_15)
boolean_76 = BoolSelector(false)
clean_75 = List.Clean(list=translate_30, preserveIndices=boolean_76)
flatten_37 = List.Flatten(list=clean_75)
tag_byelement_15 = Custom[👓 Tag․ByElement](element=flatten_36, TagLocation=flatten_37, TagType=getItemAtIndex_2)

# group: INT DUPLO E TRIPLO 1º INTERRUPTOR
code_block_40 = CodeBlock { 0; }
getItemAtIndex_8 = List.GetItemAtIndex(list=flatten_35, index=code_block_40, lacing=Longest)
boolean_77 = BoolSelector(false)
clean_76 = List.Clean(list=getItemAtIndex_8, preserveIndices=boolean_77)
getLocation_24 = Element.GetLocation(element=clean_76)
facingOrientation_22 = FamilyInstance.FacingOrientation(familyInstance=clean_76)
byStartPointDirectionLength_6 = Line.ByStartPointDirectionLength(startPoint=getLocation_24, direction=facingOrientation_22)
line_upvectoratparameter_5 = Custom[👓 Line․UpVectorAtParameter](line=byStartPointDirectionLength_6)
X_7 = Vector.X(vector=line_upvectoratparameter_5)
code_block_41 = CodeBlock { -1; }
eq_13 = X_7 == code_block_41
filterByBoolMask_41 = List.FilterByBoolMask(list=clean_76, mask=eq_13, lacing=Longest)
filterByBoolMask_42 = List.FilterByBoolMask(list=line_upvectoratparameter_5, mask=eq_13)

# group: TAG Vertical Neg
boolean_78 = BoolSelector(false)
clean_77 = List.Clean(list=filterByBoolMask_41.in, preserveIndices=boolean_78)
flatten_38 = List.Flatten(list=clean_77)
boolean_79 = BoolSelector(false)
clean_78 = List.Clean(list=filterByBoolMask_41.in, preserveIndices=boolean_79)
getLocation_25 = Element.GetLocation(element=clean_78)
boolean_80 = BoolSelector(false)
clean_79 = List.Clean(list=filterByBoolMask_42.in, preserveIndices=boolean_80)
offset_da_tag_16 = DoubleInput(0.2)
translate_31 = Geometry.Translate(geometry=getLocation_25, direction=clean_79, distance=offset_da_tag_16)
facingOrientation_23 = FamilyInstance.FacingOrientation(familyInstance=clean_78)
offset_da_2ª_tag_16 = DoubleInput(0.15)
translate_32 = Geometry.Translate(geometry=translate_31, direction=facingOrientation_23, distance=offset_da_2ª_tag_16)
boolean_81 = BoolSelector(false)
clean_80 = List.Clean(list=translate_32, preserveIndices=boolean_81)
flatten_39 = List.Flatten(list=clean_80)
tag_byelement_16 = Custom[👓 Tag․ByElement](element=flatten_38, TagLocation=flatten_39, TagType=getItemAtIndex_2)

# group: TAG Horizontal
boolean_82 = BoolSelector(false)
clean_81 = List.Clean(list=filterByBoolMask_41.out, preserveIndices=boolean_82)
flatten_40 = List.Flatten(list=clean_81)
boolean_83 = BoolSelector(false)
clean_82 = List.Clean(list=filterByBoolMask_41.out, preserveIndices=boolean_83)
getLocation_26 = Element.GetLocation(element=clean_82)
boolean_84 = BoolSelector(false)
clean_83 = List.Clean(list=filterByBoolMask_42.out, preserveIndices=boolean_84)
offset_da_tag_17 = DoubleInput(0.08)
translate_33 = Geometry.Translate(geometry=getLocation_26, direction=clean_83, distance=offset_da_tag_17)
facingOrientation_24 = FamilyInstance.FacingOrientation(familyInstance=clean_82)
offset_da_2ª_tag_17 = DoubleInput(0.12)
translate_34 = Geometry.Translate(geometry=translate_33, direction=facingOrientation_24, distance=offset_da_2ª_tag_17)
boolean_85 = BoolSelector(false)
clean_84 = List.Clean(list=translate_34, preserveIndices=boolean_85)
flatten_41 = List.Flatten(list=clean_84)
tag_byelement_17 = Custom[👓 Tag․ByElement](element=flatten_40, TagLocation=flatten_41, TagType=getItemAtIndex_2)

# group: INT DUPLO E TRIPLO 2º INTERRUPTOR
code_block_42 = CodeBlock { 1; }
getItemAtIndex_9 = List.GetItemAtIndex(list=flatten_35, index=code_block_42, lacing=Longest)
boolean_86 = BoolSelector(false)
clean_85 = List.Clean(list=getItemAtIndex_9, preserveIndices=boolean_86)
getLocation_27 = Element.GetLocation(element=clean_85)
facingOrientation_25 = FamilyInstance.FacingOrientation(familyInstance=clean_85)
byStartPointDirectionLength_7 = Line.ByStartPointDirectionLength(startPoint=getLocation_27, direction=facingOrientation_25)
line_upvectoratparameter_6 = Custom[👓 Line․UpVectorAtParameter](line=byStartPointDirectionLength_7)
X_8 = Vector.X(vector=line_upvectoratparameter_6)
code_block_43 = CodeBlock { -1; }
eq_14 = X_8 == code_block_43
filterByBoolMask_43 = List.FilterByBoolMask(list=clean_85, mask=eq_14, lacing=Longest)
filterByBoolMask_44 = List.FilterByBoolMask(list=line_upvectoratparameter_6, mask=eq_14)

# group: TAG Horizontal
boolean_87 = BoolSelector(false)
clean_86 = List.Clean(list=filterByBoolMask_43.out, preserveIndices=boolean_87)
flatten_42 = List.Flatten(list=clean_86)
boolean_88 = BoolSelector(false)
clean_87 = List.Clean(list=filterByBoolMask_43.out, preserveIndices=boolean_88)
getLocation_28 = Element.GetLocation(element=clean_87)
boolean_89 = BoolSelector(false)
clean_88 = List.Clean(list=filterByBoolMask_44.out, preserveIndices=boolean_89)
offset_da_tag_18 = DoubleInput(0)
translate_35 = Geometry.Translate(geometry=getLocation_28, direction=clean_88, distance=offset_da_tag_18)
facingOrientation_26 = FamilyInstance.FacingOrientation(familyInstance=clean_87)
offset_da_2ª_tag_18 = DoubleInput(0.26)
translate_36 = Geometry.Translate(geometry=translate_35, direction=facingOrientation_26, distance=offset_da_2ª_tag_18)
boolean_90 = BoolSelector(false)
clean_89 = List.Clean(list=translate_36, preserveIndices=boolean_90)
flatten_43 = List.Flatten(list=clean_89)
tag_byelement_18 = Custom[👓 Tag․ByElement](element=flatten_42, TagLocation=flatten_43, TagType=getItemAtIndex_2)

# group: TAG Vertical
boolean_91 = BoolSelector(false)
clean_90 = List.Clean(list=filterByBoolMask_43.in, preserveIndices=boolean_91)
flatten_44 = List.Flatten(list=clean_90)
boolean_92 = BoolSelector(false)
clean_91 = List.Clean(list=filterByBoolMask_43.in, preserveIndices=boolean_92)
getLocation_29 = Element.GetLocation(element=clean_91)
boolean_93 = BoolSelector(false)
clean_92 = List.Clean(list=filterByBoolMask_44.in, preserveIndices=boolean_93)
offset_da_tag_19 = DoubleInput(0)
translate_37 = Geometry.Translate(geometry=getLocation_29, direction=clean_92, distance=offset_da_tag_19)
facingOrientation_27 = FamilyInstance.FacingOrientation(familyInstance=clean_91)
offset_da_2ª_tag_19 = DoubleInput(0.3)
translate_38 = Geometry.Translate(geometry=translate_37, direction=facingOrientation_27, distance=offset_da_2ª_tag_19)
boolean_94 = BoolSelector(false)
clean_93 = List.Clean(list=translate_38, preserveIndices=boolean_94)
flatten_45 = List.Flatten(list=clean_93)
tag_byelement_19 = Custom[👓 Tag․ByElement](element=flatten_44, TagLocation=flatten_45, TagType=getItemAtIndex_2)

# group: TAG Vertical
boolean_95 = BoolSelector(false)
clean_94 = List.Clean(list=filterByBoolMask_39.in, preserveIndices=boolean_95)
flatten_46 = List.Flatten(list=clean_94)
boolean_96 = BoolSelector(false)
clean_95 = List.Clean(list=filterByBoolMask_39.in, preserveIndices=boolean_96)
getLocation_30 = Element.GetLocation(element=clean_95)
boolean_97 = BoolSelector(false)
clean_96 = List.Clean(list=filterByBoolMask_40.in, preserveIndices=boolean_97)
reverse_5 = Vector.Reverse(vector=clean_96)
offset_da_tag_20 = DoubleInput(0.15)
translate_39 = Geometry.Translate(geometry=getLocation_30, direction=reverse_5, distance=offset_da_tag_20)
facingOrientation_28 = FamilyInstance.FacingOrientation(familyInstance=clean_95)
offset_da_2ª_tag_20 = DoubleInput(0.15)
translate_40 = Geometry.Translate(geometry=translate_39, direction=facingOrientation_28, distance=offset_da_2ª_tag_20)
boolean_98 = BoolSelector(false)
clean_97 = List.Clean(list=translate_40, preserveIndices=boolean_98)
flatten_47 = List.Flatten(list=clean_97)
tag_byelement_20 = Custom[👓 Tag․ByElement](element=flatten_46, TagLocation=flatten_47, TagType=getItemAtIndex_2)

watch_3 = Watch(filterByBoolMask_2.in)
code_block_44 = CodeBlock { 2; }
getItemAtIndex_10 = List.GetItemAtIndex(list=flatten_17, index=code_block_44, lacing=Longest)
boolean_99 = BoolSelector(false)
clean_98 = List.Clean(list=getItemAtIndex_10, preserveIndices=boolean_99)
facingOrientation_29 = FamilyInstance.FacingOrientation(familyInstance=clean_98)
Y_3 = Vector.Y(vector=facingOrientation_29)
code_block_45 = CodeBlock { 1; }
eq_15 = Y_3 == code_block_45
filterByBoolMask_45 = List.FilterByBoolMask(list=clean_98, mask=eq_15, lacing=Longest)
filterByBoolMask_46 = List.FilterByBoolMask(list=facingOrientation_29, mask=eq_15)

# group: TAG Horizontal Pos
boolean_100 = BoolSelector(false)
clean_99 = List.Clean(list=filterByBoolMask_45.in, preserveIndices=boolean_100)
flatten_48 = List.Flatten(list=clean_99)
boolean_101 = BoolSelector(false)
clean_100 = List.Clean(list=filterByBoolMask_45.in, preserveIndices=boolean_101)
getLocation_31 = Element.GetLocation(element=clean_100)
boolean_102 = BoolSelector(false)
clean_101 = List.Clean(list=filterByBoolMask_46.in, preserveIndices=boolean_102)
offset_da_tag_21 = DoubleInput(0.2)
translate_41 = Geometry.Translate(geometry=getLocation_31, direction=clean_101, distance=offset_da_tag_21)
facingOrientation_30 = FamilyInstance.FacingOrientation(familyInstance=clean_100)
ZAxis_9 = Vector.ZAxis()
cross_9 = Vector.Cross(vector=facingOrientation_30, cross=ZAxis_9)
offset_da_2ª_tag_21 = DoubleInput(0.12)
translate_42 = Geometry.Translate(geometry=translate_41, direction=cross_9, distance=offset_da_2ª_tag_21)
boolean_103 = BoolSelector(false)
clean_102 = List.Clean(list=translate_42, preserveIndices=boolean_103)
flatten_49 = List.Flatten(list=clean_102)
tag_byelement_21 = Custom[👓 Tag․ByElement](element=flatten_48, TagLocation=flatten_49, TagType=getItemAtIndex_2)

code_block_46 = CodeBlock { -1; }
eq_16 = Equals(x=Y_3, y=code_block_46)
filterByBoolMask_47 = List.FilterByBoolMask(list=clean_98, mask=eq_16, lacing=Longest)
filterByBoolMask_48 = List.FilterByBoolMask(list=facingOrientation_29, mask=eq_16)

# group: TAG Horizontal Pos
boolean_104 = BoolSelector(false)
clean_103 = List.Clean(list=filterByBoolMask_47.in, preserveIndices=boolean_104)
flatten_50 = List.Flatten(list=clean_103)
boolean_105 = BoolSelector(false)
clean_104 = List.Clean(list=filterByBoolMask_47.in, preserveIndices=boolean_105)
getLocation_32 = Element.GetLocation(element=clean_104)
boolean_106 = BoolSelector(false)
clean_105 = List.Clean(list=filterByBoolMask_48.in, preserveIndices=boolean_106)
offset_da_tag_22 = DoubleInput(0.4)
translate_43 = Geometry.Translate(geometry=getLocation_32, direction=clean_105, distance=offset_da_tag_22)
facingOrientation_31 = FamilyInstance.FacingOrientation(familyInstance=clean_104)
ZAxis_10 = Vector.ZAxis()
cross_10 = Vector.Cross(vector=facingOrientation_31, cross=ZAxis_10)
offset_da_2ª_tag_22 = DoubleInput(0.32)
translate_44 = Geometry.Translate(geometry=translate_43, direction=cross_10, distance=offset_da_2ª_tag_22)
boolean_107 = BoolSelector(false)
clean_106 = List.Clean(list=translate_44, preserveIndices=boolean_107)
flatten_51 = List.Flatten(list=clean_106)
tag_byelement_22 = Custom[👓 Tag․ByElement](element=flatten_50, TagLocation=flatten_51, TagType=getItemAtIndex_2)

X_9 = Vector.X(vector=facingOrientation_29)
code_block_47 = CodeBlock { 1; }
eq_17 = X_9 == code_block_47
filterByBoolMask_49 = List.FilterByBoolMask(list=clean_98, mask=eq_17, lacing=Longest)
filterByBoolMask_50 = List.FilterByBoolMask(list=facingOrientation_29, mask=eq_17)

# group: TAG Vertical Pos
boolean_108 = BoolSelector(false)
clean_107 = List.Clean(list=filterByBoolMask_49.in, preserveIndices=boolean_108)
flatten_52 = List.Flatten(list=clean_107)
boolean_109 = BoolSelector(false)
clean_108 = List.Clean(list=filterByBoolMask_49.in, preserveIndices=boolean_109)
getLocation_33 = Element.GetLocation(element=clean_108)
boolean_110 = BoolSelector(false)
clean_109 = List.Clean(list=filterByBoolMask_50.in, preserveIndices=boolean_110)
ZAxis_11 = Vector.ZAxis()
cross_11 = Vector.Cross(vector=clean_109, cross=ZAxis_11)
offset_da_tag_23 = DoubleInput(0.3)
translate_45 = Geometry.Translate(geometry=getLocation_33, direction=cross_11, distance=offset_da_tag_23)
facingOrientation_32 = FamilyInstance.FacingOrientation(familyInstance=clean_108)
offset_da_2ª_tag_23 = DoubleInput(0.35)
translate_46 = Geometry.Translate(geometry=translate_45, direction=facingOrientation_32, distance=offset_da_2ª_tag_23)
boolean_111 = BoolSelector(false)
clean_110 = List.Clean(list=translate_46, preserveIndices=boolean_111)
flatten_53 = List.Flatten(list=clean_110)
tag_byelement_23 = Custom[👓 Tag․ByElement](element=flatten_52, TagLocation=flatten_53, TagType=getItemAtIndex_2)

code_block_48 = CodeBlock { -1; }
eq_18 = X_9 == code_block_48
filterByBoolMask_51 = List.FilterByBoolMask(list=clean_98, mask=eq_18, lacing=Longest)
filterByBoolMask_52 = List.FilterByBoolMask(list=facingOrientation_29, mask=eq_18)

# group: TAG Vertical Neg
boolean_112 = BoolSelector(false)
clean_111 = List.Clean(list=filterByBoolMask_51.in, preserveIndices=boolean_112)
flatten_54 = List.Flatten(list=clean_111)
boolean_113 = BoolSelector(false)
clean_112 = List.Clean(list=filterByBoolMask_51.in, preserveIndices=boolean_113)
getLocation_34 = Element.GetLocation(element=clean_112)
boolean_114 = BoolSelector(false)
clean_113 = List.Clean(list=filterByBoolMask_52.in, preserveIndices=boolean_114)
ZAxis_12 = Vector.ZAxis()
cross_12 = Vector.Cross(vector=clean_113, cross=ZAxis_12)
offset_da_tag_24 = DoubleInput(0.18)
translate_47 = Geometry.Translate(geometry=getLocation_34, direction=cross_12, distance=offset_da_tag_24)
facingOrientation_33 = FamilyInstance.FacingOrientation(familyInstance=clean_112)
offset_da_2ª_tag_24 = DoubleInput(0.4)
translate_48 = Geometry.Translate(geometry=translate_47, direction=facingOrientation_33, distance=offset_da_2ª_tag_24)
boolean_115 = BoolSelector(false)
clean_114 = List.Clean(list=translate_48, preserveIndices=boolean_115)
flatten_55 = List.Flatten(list=clean_114)
tag_byelement_24 = Custom[👓 Tag․ByElement](element=flatten_54, TagLocation=flatten_55, TagType=getItemAtIndex_2)
