# Dynamo graph 10-7_BIMACON_Tags de Interruptores_R03_script.dyn (Dynamo 2.6.1.8786)
# Inseri Tags de comandos dos Interruptores
# packages: BIMCoder Nodes - 2.X 2025.0.15, BIMCoder Nodes - 2.X 2025.1.0, Data-Shapes 2022.2.105

# group: SELECIONE O MODELO ARQ LINKADO
code_block = CodeBlock { "TAGs Interruptores"; }
string = StringInput("LogoBimacon.png")
python_script = Python(IN[0]=string)
# ---------- python_script.python (22 lines) ----------
import clr

# Adiciona referência ao ambiente .NET
clr.AddReference('System')
from System import Environment, IO

# Nome da imagem (entrada do usuário)
nome_arquivo_imagem = IN[0]

# Recupera o nome do usuário logado no Windows
usuario = Environment.UserName

# Monta o caminho completo para a pasta de imagens
caminho_base = r"C:\Users\{0}\AppData\Roaming\pyRevit\Extensions\Bimacon.extension\Bimacon.tab\Imagens_Bimacon".format(usuario)

# Junta o caminho base com o nome do arquivo
caminho_completo = IO.Path.Combine(caminho_base, nome_arquivo_imagem)

# Verifica se o arquivo existe
existe = IO.File.Exists(caminho_completo)

OUT = caminho_completo if existe else "Imagem não encontrada: {0}".format(caminho_completo)
# ----------------------------------------
file_from_path = FileObject(path=python_script)
readFromFile = Image.ReadFromFile(file=file_from_path)
string_2 = StringInput("Confirmar")
code_block_2 = CodeBlock { "Escolha o Tipo de TAG"; }
categories = Categories("OST_LightingDeviceTags")
obter_famílias_de_uma_categoria = Python(IN[0]=categories)  # "Obter Famílias de Uma Categoria - BIMACON"
# ---------- obter_famílias_de_uma_categoria.python (52 lines) ----------
import clr
import System

# Revit API
clr.AddReference('RevitAPI')
from Autodesk.Revit.DB import *

# RevitServices
clr.AddReference("RevitServices")
from RevitServices.Persistence import DocumentManager
from RevitServices.Transactions import TransactionManager

# RevitNodes para manipular categorias
clr.AddReference("RevitNodes")
import Revit
clr.ImportExtensions(Revit.Elements)

# Documento atual
doc = DocumentManager.Instance.CurrentDBDocument

# Função para obter BuiltInCategory de uma entrada
def obter_builtincategory(entrada):
    if isinstance(entrada, Category):
        return System.Enum.ToObject(BuiltInCategory, entrada.Id.IntegerValue)
    elif isinstance(entrada, int):
        return System.Enum.ToObject(BuiltInCategory, entrada)
    elif isinstance(entrada, BuiltInCategory):
        return entrada
    elif hasattr(entrada, "Id"):
        return System.Enum.ToObject(BuiltInCategory, entrada.Id.IntegerValue)
    else:
        return None

# Entrada
entrada = UnwrapElement(IN[0])
bic = obter_builtincategory(entrada)

# Coletar todas as famílias no documento
todas_familias = FilteredElementCollector(doc).OfClass(Family).ToElements()

# Filtrar famílias pela categoria
familias_filtradas = []
if bic:
    for fam in todas_familias:
        try:
            if fam.FamilyCategory.Id.IntegerValue == int(bic):
                familias_filtradas.append(fam)
        except:
            continue

# Saída
OUT = familias_filtradas
# ----------------------------------------
types = Family.Types(family=obter_famílias_de_uma_categoria)
name = Element.Name(element=types)
code_block_3 = CodeBlock { "Comando"; }
contains = String.Contains(str=name, searchFor=code_block_3)
filterByBoolMask = List.FilterByBoolMask(list=types, mask=contains)
boolean = BoolSelector(false)
clean = List.Clean(list=filterByBoolMask.in, preserveIndices=boolean)
flatten = List.Flatten(list=clean)
name_2 = Element.Name(element=flatten)
code_block_4 = CodeBlock { 1; }
dropdown_data = Custom[DropDown Data](InputName=code_block_2, Keys=name_2, Values=flatten, DefaultValueIndex=code_block_4)  # package Data-Shapes; Create data for DropDown input in UI.MultiInputForm ++ . Check out www.data-shapes.net for more infos.
code_block_5 = CodeBlock { "Fator Distância das TAGs (1x)"; }
string_3 = StringInput("1")
boolean_2 = BoolSelector(true)
textbox_data = Custom[TextBox Data](InputName=code_block_5, DefaultText=string_3, IsNumberEntry=boolean_2)  # package Data-Shapes; Create Data for TextBox input in UI.MultipleInputForm ++ . Check out www.data-shapes.net for more informations
list_create = List.Create(item0=dropdown_data, item1=textbox_data)
boolean_3 = BoolSelector(true)
string_4 = StringInput("Cancelar")
number = DoubleInput(400)
number_2 = DoubleInput(185)
multipleinputform = Custom[MultipleInputForm ++](Description_optional=code_block, Logo_optional=readFromFile, ButtonText_optional=string_2, Inputs=list_create, Toggle=boolean_3, CancelButtonText_optional=string_4, Width_optional=number, LabelWidth_optional=number_2)  # package Data-Shapes; Create a form with multiple inputs. see www.data-shapes.net for tutorials and infos!
code_block_6 = CodeBlock()  # //Data-Shapes
code_block_7 = CodeBlock()  # //archilab

# group: Separar Entradas
code_block_8 = CodeBlock { 0; }
getItemAtIndex = List.GetItemAtIndex(list=multipleinputform.User_Inputs, index=code_block_8)
code_block_9 = CodeBlock { 1; }
getItemAtIndex_2 = List.GetItemAtIndex(list=multipleinputform.User_Inputs, index=code_block_9)

# group: Filtrar Elementos não Tagueados
categories_2 = Categories("OST_LightingDevices")
categories_3 = Categories("OST_ElectricalFixtures")
list_create_2 = List.Create(item0=categories_2, item1=categories_3)
current = Document.Current()
activeView = Document.ActiveView(document=current)
all_elements_of_category_in_view = ElementsOfCategoryInView(Category=list_create_2, View=activeView)
flatten_2 = List.Flatten(list=all_elements_of_category_in_view)
categories_4 = Categories("OST_LightingDeviceTags")
all_elements_of_category_in_view_2 = ElementsOfCategoryInView(Category=categories_4, View=activeView)
elementType = Element.ElementType(element=all_elements_of_category_in_view_2)
contains_2 = List.Contains(list=elementType, item=getItemAtIndex, lacing=Longest)
filterByBoolMask_2 = List.FilterByBoolMask(list=all_elements_of_category_in_view_2, mask=contains_2)
taggedElement = Tag.TaggedElement(tag=filterByBoolMask_2.in)
python_script_2 = Python(IN[0]=flatten_2, IN[1]=taggedElement)
# ---------- python_script_2.python (52 lines) ----------
# Importar bibliotecas
import clr
clr.AddReference('RevitServices')
from RevitServices.Persistence import DocumentManager

clr.AddReference('RevitAPI')
from Autodesk.Revit.DB import *

# Entradas
todos_elementos = IN[0]
elementos_tagueados = IN[1]

# Função segura para extrair o ID inteiro
def get_element_id(el):
    try:
        return el.Id.IntegerValue
    except:
        try:
            return el.Id
        except:
            try:
                return int(el)
            except:
                return None

# Lista de IDs dos elementos tagueados
ids_tagueados = [get_element_id(el) for el in elementos_tagueados if el is not None]

# Função recursiva para filtrar mantendo a estrutura da lista original
def filtrar_elementos_recursivo(lista):
    if isinstance(lista, list):
        return [filtrar_elementos_recursivo(item) for item in lista]
    else:
        el_id = get_element_id(lista)
        if el_id not in ids_tagueados:
            return lista
        else:
            return None  # Remove elementos tagueados

# Aplica o filtro recursivo
resultado = filtrar_elementos_recursivo(todos_elementos)

# Remove os "None" da saída final (em profundidade)
def limpar_nulos_recursivo(lista):
    if isinstance(lista, list):
        return [limpar_nulos_recursivo(x) for x in lista if x is not None]
    else:
        return lista

resultado_limpo = limpar_nulos_recursivo(resultado)

OUT = resultado_limpo
# ----------------------------------------

getFamily = FamilyInstance.GetFamily(familyInstance=python_script_2)
name_3 = Family.Name(family=getFamily)
code_block_10 = CodeBlock { "Sensor"; }
contains_3 = String.Contains(str=name_3, searchFor=code_block_10)
filterByBoolMask_3 = List.FilterByBoolMask(list=python_script_2, mask=contains_3)
getFamily_2 = FamilyInstance.GetFamily(familyInstance=filterByBoolMask_3.out)
name_4 = Family.Name(family=getFamily_2)
code_block_11 = CodeBlock { "a_1 Interruptor"; }
contains_4 = String.Contains(str=name_4, searchFor=code_block_11)
filterByBoolMask_4 = List.FilterByBoolMask(list=filterByBoolMask_3.out, mask=contains_4)
string_from_object = FromObject(object=filterByBoolMask_4.out)
code_block_12 = CodeBlock { "Simples"; }
contains_5 = String.Contains(str=string_from_object, searchFor=code_block_12)
filterByBoolMask_5 = List.FilterByBoolMask(list=filterByBoolMask_4.out, mask=contains_5@L2)
code_block_13 = CodeBlock { "Paralelo"; }
contains_6 = String.Contains(str=string_from_object, searchFor=code_block_13)
filterByBoolMask_6 = List.FilterByBoolMask(list=filterByBoolMask_4.out, mask=contains_6@L2)
code_block_14 = CodeBlock { "Intermediário"; }
contains_7 = String.Contains(str=string_from_object, searchFor=code_block_14)
filterByBoolMask_7 = List.FilterByBoolMask(list=filterByBoolMask_4.out, mask=contains_7@L2)
code_block_15 = CodeBlock { "Pulsador"; }
contains_8 = String.Contains(str=string_from_object, searchFor=code_block_15)
filterByBoolMask_8 = List.FilterByBoolMask(list=filterByBoolMask_4.out, mask=contains_8@L2)
list_create_3 = List.Create(item0=filterByBoolMask_5.in, item1=filterByBoolMask_6.in, item2=filterByBoolMask_7.in, item3=filterByBoolMask_8.in)
flatten_3 = List.Flatten(list=list_create_3)
uniqueItems = List.UniqueItems(list=flatten_3)
string_from_object_2 = FromObject(object=uniqueItems)
code_block_16 = CodeBlock { ["Tomada"]; }
contains_9 = String.Contains(str=string_from_object_2@L2, searchFor=code_block_16, lacing=Longest)
filterByBoolMask_9 = List.FilterByBoolMask(list=uniqueItems@L2, mask=contains_9@L2)
string_from_object_3 = FromObject(obj=filterByBoolMask_9.out)
code_block_17 = CodeBlock { ["USB"]; }
contains_10 = String.Contains(str=string_from_object_3@L2, searchFor=code_block_17, lacing=Longest)
filterByBoolMask_10 = List.FilterByBoolMask(list=filterByBoolMask_9.out@L2, mask=contains_10@L2)
string_from_object_4 = FromObject(object=filterByBoolMask_10.out)
code_block_18 = CodeBlock { ["a.2 Teclas Simples"]; }
contains_11 = String.Contains(str=string_from_object_4@L2, searchFor=code_block_18, lacing=Longest)
filterByBoolMask_11 = List.FilterByBoolMask(list=filterByBoolMask_10.out@L2, mask=contains_11@L2)
string_from_object_5 = FromObject(object=filterByBoolMask_11.out)
code_block_19 = CodeBlock { ["a.3 Teclas Simples"]; }
contains_12 = String.Contains(str=string_from_object_5@L2, searchFor=code_block_19, lacing=Longest)
filterByBoolMask_12 = List.FilterByBoolMask(list=filterByBoolMask_11.out@L2, mask=contains_12@L2)
watch = Watch(filterByBoolMask_12.out)

# group: INT SIMPLES
getChildElements = Element.GetChildElements(element=watch)
python_script_3 = Python(IN[0]=getChildElements, IN[1]=taggedElement)  # same code as python_script_2
string_from_object_6 = FromObject(object=python_script_3)
code_block_20 = CodeBlock { ["Caixa de Luz"]; }
contains_13 = String.Contains(str=string_from_object_6@L2, searchFor=code_block_20, lacing=Longest)
filterByBoolMask_13 = List.FilterByBoolMask(list=python_script_3@L2, mask=contains_13@L2)
string_from_object_7 = FromObject(object=filterByBoolMask_13.out)
code_block_21 = CodeBlock { ["Tomada"]; }
contains_14 = String.Contains(str=string_from_object_7@L2, searchFor=code_block_21, lacing=Longest)
filterByBoolMask_14 = List.FilterByBoolMask(list=filterByBoolMask_13.out@L2, mask=contains_14@L2)
code_block_22 = CodeBlock { ["Condulete Top"]; }
boolean_4 = BoolSelector(false)
boolean_5 = BoolSelector(false)
boolean_6 = BoolSelector(false)
clean_2 = List.Clean(list=filterByBoolMask_14.in, preserveIndices=boolean_6)

string_from_object_8 = FromObject(obj=filterByBoolMask_14.out)
code_block_23 = CodeBlock { ["Tampa"]; }
contains_15 = String.Contains(str=string_from_object_8@L2, searchFor=code_block_23, lacing=Longest)
filterByBoolMask_15 = List.FilterByBoolMask(list=filterByBoolMask_14.out@L2, mask=contains_15@L2)

# group (continued): INT SIMPLES
string_from_object_9 = FromObject(obj=filterByBoolMask_15.out)
contains_16 = String.Contains(str=string_from_object_9@L2, searchFor=code_block_22, lacing=Longest)
filterByBoolMask_16 = List.FilterByBoolMask(list=filterByBoolMask_15.out@L2, mask=contains_16@L2)
clean_3 = List.Clean(list=filterByBoolMask_16.out, preserveIndices=boolean_4)
getLocation = Element.GetLocation(element=clean_3)
Z = Point.Z(point=getLocation)
sortByKey = List.SortByKey(list=clean_3, keys=Z, lacing=Longest)
list_create_4 = List.Create(item0=filterByBoolMask_3.in, item1=sortByKey.sorted_list, item2=filterByBoolMask_4.in)
clean_4 = List.Clean(list=list_create_4, preserveIndices=boolean_5)
flatten_4 = List.Flatten(list=clean_4@L2)
reverse = List.Reverse(list=sortByKey.sorted_list, lacing=Longest)

# group: 1ª Tecla
code_block_24 = CodeBlock { 0; }
getItemAtIndex_3 = List.GetItemAtIndex(list=flatten_4, index=code_block_24, lacing=Longest)
boolean_7 = BoolSelector(false)
clean_5 = List.Clean(list=getItemAtIndex_3, preserveIndices=boolean_7)
getLocation_2 = Element.GetLocation(element=clean_5)
facingOrientation = FamilyInstance.FacingOrientation(familyInstance=clean_5)
byStartPointDirectionLength = Line.ByStartPointDirectionLength(startPoint=getLocation_2, direction=facingOrientation)
line_upvectoratparameter = Custom[👓 Line․UpVectorAtParameter](line=byStartPointDirectionLength)  # package BIMCoder Nodes - 2.X; Cria um vetor apontando para cima dado o parâmetro
X = Vector.X(vector=line_upvectoratparameter)
code_block_25 = CodeBlock { -1; }
eq = X == code_block_25
filterByBoolMask_17 = List.FilterByBoolMask(list=clean_5, mask=eq, lacing=Longest)
filterByBoolMask_18 = List.FilterByBoolMask(list=line_upvectoratparameter, mask=eq)

# group: TAG Vertical
boolean_8 = BoolSelector(false)
clean_6 = List.Clean(list=filterByBoolMask_17.in, preserveIndices=boolean_8)
flatten_5 = List.Flatten(list=clean_6)
boolean_9 = BoolSelector(false)
clean_7 = List.Clean(list=filterByBoolMask_17.in, preserveIndices=boolean_9)
getLocation_3 = Element.GetLocation(element=clean_7)
boolean_10 = BoolSelector(false)
clean_8 = List.Clean(list=filterByBoolMask_18.in, preserveIndices=boolean_10)
offset_da_tag_x = DoubleInput(0.27)
facingOrientation_2 = FamilyInstance.FacingOrientation(familyInstance=clean_7)
offset_da_tag_y = DoubleInput(0.15)
boolean_11 = BoolSelector(false)

mul = offset_da_tag_x * getItemAtIndex_2

# group (continued): TAG Vertical
translate = Geometry.Translate(geometry=getLocation_3, direction=clean_8, distance=mul)

mul_2 = offset_da_tag_y * getItemAtIndex_2

# group (continued): TAG Vertical
translate_2 = Geometry.Translate(geometry=translate, direction=facingOrientation_2, distance=mul_2)
clean_9 = List.Clean(list=translate_2, preserveIndices=boolean_11)
flatten_6 = List.Flatten(list=clean_9)
tag_byelement = Custom[👓 Tag․ByElement](element=flatten_5, TagLocation=flatten_6, TagType=getItemAtIndex)  # package BIMCoder Nodes - 2.X; Cria uma Tag em elemento(s) dado o tipo da Tag e a posição

boolean_12 = BoolSelector(false)

# group: TAG Horizontal
boolean_13 = BoolSelector(false)
clean_10 = List.Clean(list=filterByBoolMask_17.out, preserveIndices=boolean_13)
flatten_7 = List.Flatten(list=clean_10)
boolean_14 = BoolSelector(false)
clean_11 = List.Clean(list=filterByBoolMask_17.out, preserveIndices=boolean_14)
getLocation_4 = Element.GetLocation(element=clean_11)
boolean_15 = BoolSelector(false)
clean_12 = List.Clean(list=filterByBoolMask_18.out, preserveIndices=boolean_15)
offset_da_tag_y_2 = DoubleInput(0.18)
facingOrientation_3 = FamilyInstance.FacingOrientation(familyInstance=clean_11)
offset_da_tag_x_2 = DoubleInput(0.1)
boolean_16 = BoolSelector(false)

mul_3 = offset_da_tag_y_2 * getItemAtIndex_2

# group (continued): TAG Horizontal
translate_3 = Geometry.Translate(geometry=getLocation_4, direction=clean_12, distance=mul_3)

mul_4 = offset_da_tag_x_2 * getItemAtIndex_2

# group (continued): TAG Horizontal
translate_4 = Geometry.Translate(geometry=translate_3, direction=facingOrientation_3, distance=mul_4)
clean_13 = List.Clean(list=translate_4, preserveIndices=boolean_16)
flatten_8 = List.Flatten(list=clean_13)
tag_byelement_2 = Custom[👓 Tag․ByElement](element=flatten_7, TagLocation=flatten_8, TagType=getItemAtIndex, horizontal=boolean_12)

# group: 2ª Tecla
code_block_26 = CodeBlock { 1; }
getItemAtIndex_4 = List.GetItemAtIndex(list=flatten_4, index=code_block_26, lacing=Longest)
boolean_17 = BoolSelector(false)
clean_14 = List.Clean(list=getItemAtIndex_4, preserveIndices=boolean_17)
getLocation_5 = Element.GetLocation(element=clean_14)
facingOrientation_4 = FamilyInstance.FacingOrientation(familyInstance=clean_14)
byStartPointDirectionLength_2 = Line.ByStartPointDirectionLength(startPoint=getLocation_5, direction=facingOrientation_4)
line_upvectoratparameter_2 = Custom[👓 Line․UpVectorAtParameter](line=byStartPointDirectionLength_2)
X_2 = Vector.X(vector=line_upvectoratparameter_2)
code_block_27 = CodeBlock { -1; }
eq_2 = X_2 == code_block_27
filterByBoolMask_19 = List.FilterByBoolMask(list=clean_14, mask=eq_2, lacing=Longest)
filterByBoolMask_20 = List.FilterByBoolMask(list=line_upvectoratparameter_2, mask=eq_2)

# group: TAG Horizontal
boolean_18 = BoolSelector(false)
clean_15 = List.Clean(list=filterByBoolMask_19.out, preserveIndices=boolean_18)
flatten_9 = List.Flatten(list=clean_15)
boolean_19 = BoolSelector(false)
clean_16 = List.Clean(list=filterByBoolMask_19.out, preserveIndices=boolean_19)
getLocation_6 = Element.GetLocation(element=clean_16)
boolean_20 = BoolSelector(false)
clean_17 = List.Clean(list=filterByBoolMask_20.out, preserveIndices=boolean_20)
offset_da_tag_y_3 = DoubleInput(0.18)
facingOrientation_5 = FamilyInstance.FacingOrientation(familyInstance=clean_16)
offset_da_tag_x_3 = DoubleInput(0.25)
boolean_21 = BoolSelector(false)

mul_5 = offset_da_tag_y_3 * getItemAtIndex_2

# group (continued): TAG Horizontal
translate_5 = Geometry.Translate(geometry=getLocation_6, direction=clean_17, distance=mul_5)

mul_6 = offset_da_tag_x_3 * getItemAtIndex_2

# group (continued): TAG Horizontal
translate_6 = Geometry.Translate(geometry=translate_5, direction=facingOrientation_5, distance=mul_6)
clean_18 = List.Clean(list=translate_6, preserveIndices=boolean_21)
flatten_10 = List.Flatten(list=clean_18)
tag_byelement_3 = Custom[👓 Tag․ByElement](element=flatten_9, TagLocation=flatten_10, TagType=getItemAtIndex, horizontal=boolean_12)

# group: TAG Vertical
boolean_22 = BoolSelector(false)
clean_19 = List.Clean(list=filterByBoolMask_19.in, preserveIndices=boolean_22)
flatten_11 = List.Flatten(list=clean_19)
boolean_23 = BoolSelector(false)
clean_20 = List.Clean(list=filterByBoolMask_19.in, preserveIndices=boolean_23)
getLocation_7 = Element.GetLocation(element=clean_20)
boolean_24 = BoolSelector(false)
clean_21 = List.Clean(list=filterByBoolMask_20.in, preserveIndices=boolean_24)
offset_da_tag_x_4 = DoubleInput(0.27)
facingOrientation_6 = FamilyInstance.FacingOrientation(familyInstance=clean_20)
offset_da_tag_y_4 = DoubleInput(0.3)
boolean_25 = BoolSelector(false)

mul_7 = offset_da_tag_x_4 * getItemAtIndex_2

# group (continued): TAG Vertical
translate_7 = Geometry.Translate(geometry=getLocation_7, direction=clean_21, distance=mul_7)

mul_8 = offset_da_tag_y_4 * getItemAtIndex_2

# group (continued): TAG Vertical
translate_8 = Geometry.Translate(geometry=translate_7, direction=facingOrientation_6, distance=mul_8)
clean_22 = List.Clean(list=translate_8, preserveIndices=boolean_25)
flatten_12 = List.Flatten(list=clean_22)
tag_byelement_4 = Custom[👓 Tag․ByElement](element=flatten_11, TagLocation=flatten_12, TagType=getItemAtIndex)

# group: 3ª Tecla
code_block_28 = CodeBlock { 2; }
getItemAtIndex_5 = List.GetItemAtIndex(list=flatten_4, index=code_block_28, lacing=Longest)
boolean_26 = BoolSelector(false)
clean_23 = List.Clean(list=getItemAtIndex_5, preserveIndices=boolean_26)
getLocation_8 = Element.GetLocation(element=clean_23)
facingOrientation_7 = FamilyInstance.FacingOrientation(familyInstance=clean_23)
byStartPointDirectionLength_3 = Line.ByStartPointDirectionLength(startPoint=getLocation_8, direction=facingOrientation_7)
line_upvectoratparameter_3 = Custom[👓 Line․UpVectorAtParameter](line=byStartPointDirectionLength_3)
X_3 = Vector.X(vector=line_upvectoratparameter_3)
code_block_29 = CodeBlock { -1; }
eq_3 = X_3 == code_block_29
filterByBoolMask_21 = List.FilterByBoolMask(list=clean_23, mask=eq_3, lacing=Longest)
filterByBoolMask_22 = List.FilterByBoolMask(list=line_upvectoratparameter_3, mask=eq_3)

# group: TAG Horizontal
boolean_27 = BoolSelector(false)
clean_24 = List.Clean(list=filterByBoolMask_21.out, preserveIndices=boolean_27)
flatten_13 = List.Flatten(list=clean_24)
boolean_28 = BoolSelector(false)
clean_25 = List.Clean(list=filterByBoolMask_21.out, preserveIndices=boolean_28)
getLocation_9 = Element.GetLocation(element=clean_25)
boolean_29 = BoolSelector(false)
clean_26 = List.Clean(list=filterByBoolMask_22.out, preserveIndices=boolean_29)
offset_da_tag_y_5 = DoubleInput(0.18)
mul_9 = offset_da_tag_y_5 * getItemAtIndex_2
translate_9 = Geometry.Translate(geometry=getLocation_9, direction=clean_26, distance=mul_9)
facingOrientation_8 = FamilyInstance.FacingOrientation(familyInstance=clean_25)
offset_da_tag_x_5 = DoubleInput(0.4)
mul_10 = offset_da_tag_x_5 * getItemAtIndex_2
translate_10 = Geometry.Translate(geometry=translate_9, direction=facingOrientation_8, distance=mul_10)
boolean_30 = BoolSelector(false)
clean_27 = List.Clean(list=translate_10, preserveIndices=boolean_30)
flatten_14 = List.Flatten(list=clean_27)
tag_byelement_5 = Custom[👓 Tag․ByElement](element=flatten_13, TagLocation=flatten_14, TagType=getItemAtIndex, horizontal=boolean_12)

# group: TAG Vertical
boolean_31 = BoolSelector(false)
clean_28 = List.Clean(list=filterByBoolMask_21.in, preserveIndices=boolean_31)
flatten_15 = List.Flatten(list=clean_28)
boolean_32 = BoolSelector(false)
clean_29 = List.Clean(list=filterByBoolMask_21.in, preserveIndices=boolean_32)
getLocation_10 = Element.GetLocation(element=clean_29)
boolean_33 = BoolSelector(false)
clean_30 = List.Clean(list=filterByBoolMask_22.in, preserveIndices=boolean_33)
offset_da_tag_x_6 = DoubleInput(0.27)
mul_11 = offset_da_tag_x_6 * getItemAtIndex_2
translate_11 = Geometry.Translate(geometry=getLocation_10, direction=clean_30, distance=mul_11)
facingOrientation_9 = FamilyInstance.FacingOrientation(familyInstance=clean_29)
offset_da_tag_y_6 = DoubleInput(0.45)
mul_12 = offset_da_tag_y_6 * getItemAtIndex_2
translate_12 = Geometry.Translate(geometry=translate_11, direction=facingOrientation_9, distance=mul_12)
boolean_34 = BoolSelector(false)
clean_31 = List.Clean(list=translate_12, preserveIndices=boolean_34)
flatten_16 = List.Flatten(list=clean_31)
tag_byelement_6 = Custom[👓 Tag․ByElement](element=flatten_15, TagLocation=flatten_16, TagType=getItemAtIndex)

# group: CONJUNTO INT E TOMADA
list_create_5 = List.Create(item0=filterByBoolMask_9.in, item1=filterByBoolMask_10.in)
flatten_17 = List.Flatten(list=list_create_5)
getChildElements_2 = Element.GetChildElements(element=flatten_17)
code_block_30 = CodeBlock { ["Caixa de Luz"]; }
code_block_31 = CodeBlock { ["Tomada"]; }
code_block_32 = CodeBlock { ["Tampa"]; }
code_block_33 = CodeBlock { ["Condulete Top"]; }
boolean_35 = BoolSelector(false)
boolean_36 = BoolSelector(false)

python_script_4 = Python(IN[0]=getChildElements_2, IN[1]=taggedElement)  # same code as python_script_2

# group (continued): CONJUNTO INT E TOMADA
string_from_object_10 = FromObject(object=python_script_4)
contains_17 = String.Contains(str=string_from_object_10@L2, searchFor=code_block_30, lacing=Longest)
filterByBoolMask_23 = List.FilterByBoolMask(list=python_script_4@L2, mask=contains_17@L2)
string_from_object_11 = FromObject(object=filterByBoolMask_23.out)
contains_18 = String.Contains(str=string_from_object_11@L2, searchFor=code_block_31, lacing=Longest)
filterByBoolMask_24 = List.FilterByBoolMask(list=filterByBoolMask_23.out@L2, mask=contains_18@L2)
string_from_object_12 = FromObject(obj=filterByBoolMask_24.out)
contains_19 = String.Contains(str=string_from_object_12@L2, searchFor=code_block_32, lacing=Longest)
filterByBoolMask_25 = List.FilterByBoolMask(list=filterByBoolMask_24.out@L2, mask=contains_19@L2)
string_from_object_13 = FromObject(obj=filterByBoolMask_25.out)
contains_20 = String.Contains(str=string_from_object_13@L2, searchFor=code_block_33, lacing=Longest)
filterByBoolMask_26 = List.FilterByBoolMask(list=filterByBoolMask_25.out@L2, mask=contains_20@L2)
clean_32 = List.Clean(list=filterByBoolMask_26.out, preserveIndices=boolean_35)
getLocation_11 = Element.GetLocation(element=clean_32)
Z_2 = Point.Z(point=getLocation_11)
sortByKey_2 = List.SortByKey(list=clean_32, keys=Z_2, lacing=Longest)
reverse_2 = List.Reverse(list=sortByKey_2.sorted_list, lacing=Longest)
clean_33 = List.Clean(list=reverse_2, preserveIndices=boolean_36)
flatten_18 = List.Flatten(list=clean_33@L2)

# group: 1º Int
code_block_34 = CodeBlock { 0; }
getItemAtIndex_6 = List.GetItemAtIndex(list=flatten_18, index=code_block_34, lacing=Longest)
boolean_37 = BoolSelector(false)
clean_34 = List.Clean(list=getItemAtIndex_6, preserveIndices=boolean_37)
facingOrientation_10 = FamilyInstance.FacingOrientation(familyInstance=clean_34)
X_4 = Vector.X(vector=facingOrientation_10)
code_block_35 = CodeBlock { -1; }
eq_4 = X_4 == code_block_35
filterByBoolMask_27 = List.FilterByBoolMask(list=clean_34, mask=eq_4, lacing=Longest)
filterByBoolMask_28 = List.FilterByBoolMask(list=facingOrientation_10, mask=eq_4)
Y = Vector.Y(vector=facingOrientation_10)
code_block_36 = CodeBlock { -1; }
eq_5 = Equals(x=Y, y=code_block_36)
filterByBoolMask_29 = List.FilterByBoolMask(list=clean_34, mask=eq_5, lacing=Longest)
filterByBoolMask_30 = List.FilterByBoolMask(list=facingOrientation_10, mask=eq_5)
code_block_37 = CodeBlock { 1; }
eq_6 = X_4 == code_block_37
filterByBoolMask_31 = List.FilterByBoolMask(list=clean_34, mask=eq_6, lacing=Longest)
filterByBoolMask_32 = List.FilterByBoolMask(list=facingOrientation_10, mask=eq_6)
code_block_38 = CodeBlock { 1; }
eq_7 = Y == code_block_38
filterByBoolMask_33 = List.FilterByBoolMask(list=clean_34, mask=eq_7, lacing=Longest)
filterByBoolMask_34 = List.FilterByBoolMask(list=facingOrientation_10, mask=eq_7)
getLocation_12 = Element.GetLocation(element=clean_34)
byStartPointDirectionLength_4 = Line.ByStartPointDirectionLength(startPoint=getLocation_12, direction=facingOrientation_10)

# group: TAG Hor Neg
boolean_38 = BoolSelector(false)
clean_35 = List.Clean(list=filterByBoolMask_27.in, preserveIndices=boolean_38)
flatten_19 = List.Flatten(list=clean_35)
boolean_39 = BoolSelector(false)
clean_36 = List.Clean(list=filterByBoolMask_27.in, preserveIndices=boolean_39)
getLocation_13 = Element.GetLocation(element=clean_36)
boolean_40 = BoolSelector(false)
clean_37 = List.Clean(list=filterByBoolMask_28.in, preserveIndices=boolean_40)
ZAxis = Vector.ZAxis()
cross = Vector.Cross(vector=clean_37, cross=ZAxis)
offset_da_tag_y_7 = DoubleInput(0.21)
facingOrientation_11 = FamilyInstance.FacingOrientation(familyInstance=clean_36)
offset_da_tag_x_7 = DoubleInput(0.15)
boolean_41 = BoolSelector(false)

mul_13 = offset_da_tag_y_7 * getItemAtIndex_2

# group (continued): TAG Hor Neg
translate_13 = Geometry.Translate(geometry=getLocation_13, direction=cross, distance=mul_13)

mul_14 = offset_da_tag_x_7 * getItemAtIndex_2

# group (continued): TAG Hor Neg
translate_14 = Geometry.Translate(geometry=translate_13, direction=facingOrientation_11, distance=mul_14)
clean_38 = List.Clean(list=translate_14, preserveIndices=boolean_41)
flatten_20 = List.Flatten(list=clean_38)
tag_byelement_7 = Custom[👓 Tag․ByElement](element=flatten_19, TagLocation=flatten_20, TagType=getItemAtIndex)

# group: TAG Vert Neg
boolean_42 = BoolSelector(false)
clean_39 = List.Clean(list=filterByBoolMask_29.in, preserveIndices=boolean_42)
flatten_21 = List.Flatten(list=clean_39)
boolean_43 = BoolSelector(false)
clean_40 = List.Clean(list=filterByBoolMask_29.in, preserveIndices=boolean_43)
getLocation_14 = Element.GetLocation(element=clean_40)
boolean_44 = BoolSelector(false)
clean_41 = List.Clean(list=filterByBoolMask_30.in, preserveIndices=boolean_44)
offset_da_tag_y_8 = DoubleInput(0.2)
facingOrientation_12 = FamilyInstance.FacingOrientation(familyInstance=clean_40)
ZAxis_2 = Vector.ZAxis()
cross_2 = Vector.Cross(vector=facingOrientation_12, cross=ZAxis_2)
offset_da_tag_x_8 = DoubleInput(0.38)
boolean_45 = BoolSelector(false)

mul_15 = offset_da_tag_y_8 * getItemAtIndex_2

# group (continued): TAG Vert Neg
translate_15 = Geometry.Translate(geometry=getLocation_14, direction=clean_41, distance=mul_15)

mul_16 = offset_da_tag_x_8 * getItemAtIndex_2

# group (continued): TAG Vert Neg
translate_16 = Geometry.Translate(geometry=translate_15, direction=cross_2, distance=mul_16)
clean_42 = List.Clean(list=translate_16, preserveIndices=boolean_45)
flatten_22 = List.Flatten(list=clean_42)
tag_byelement_8 = Custom[👓 Tag․ByElement](element=flatten_21, TagLocation=flatten_22, TagType=getItemAtIndex)

# group: TAG Hor Pos
boolean_46 = BoolSelector(false)
clean_43 = List.Clean(list=filterByBoolMask_31.in, preserveIndices=boolean_46)
flatten_23 = List.Flatten(list=clean_43)
boolean_47 = BoolSelector(false)
clean_44 = List.Clean(list=filterByBoolMask_31.in, preserveIndices=boolean_47)
getLocation_15 = Element.GetLocation(element=clean_44)
boolean_48 = BoolSelector(false)
clean_45 = List.Clean(list=filterByBoolMask_32.in, preserveIndices=boolean_48)
ZAxis_3 = Vector.ZAxis()
cross_3 = Vector.Cross(vector=clean_45, cross=ZAxis_3)
offset_da_tag_y_9 = DoubleInput(0.3)
facingOrientation_13 = FamilyInstance.FacingOrientation(familyInstance=clean_44)
offset_da_tag_x_9 = DoubleInput(0.1)
boolean_49 = BoolSelector(false)

mul_17 = offset_da_tag_y_9 * getItemAtIndex_2

# group (continued): TAG Hor Pos
translate_17 = Geometry.Translate(geometry=getLocation_15, direction=cross_3, distance=mul_17)

mul_18 = offset_da_tag_x_9 * getItemAtIndex_2

# group (continued): TAG Hor Pos
translate_18 = Geometry.Translate(geometry=translate_17, direction=facingOrientation_13, distance=mul_18)
clean_46 = List.Clean(list=translate_18, preserveIndices=boolean_49)
flatten_24 = List.Flatten(list=clean_46)
tag_byelement_9 = Custom[👓 Tag․ByElement](element=flatten_23, TagLocation=flatten_24, TagType=getItemAtIndex)

# group: TAG Vert Pos
boolean_50 = BoolSelector(false)
clean_47 = List.Clean(list=filterByBoolMask_33.in, preserveIndices=boolean_50)
flatten_25 = List.Flatten(list=clean_47)
boolean_51 = BoolSelector(false)
clean_48 = List.Clean(list=filterByBoolMask_33.in, preserveIndices=boolean_51)
getLocation_16 = Element.GetLocation(element=clean_48)
boolean_52 = BoolSelector(false)
clean_49 = List.Clean(list=filterByBoolMask_34.in, preserveIndices=boolean_52)
offset_da_tag_y_10 = DoubleInput(0.1)
facingOrientation_14 = FamilyInstance.FacingOrientation(familyInstance=clean_48)
ZAxis_4 = Vector.ZAxis()
cross_4 = Vector.Cross(vector=facingOrientation_14, cross=ZAxis_4)
offset_da_tag_x_10 = DoubleInput(0.29)
boolean_53 = BoolSelector(false)

mul_19 = offset_da_tag_y_10 * getItemAtIndex_2

# group (continued): TAG Vert Pos
translate_19 = Geometry.Translate(geometry=getLocation_16, direction=clean_49, distance=mul_19)

mul_20 = offset_da_tag_x_10 * getItemAtIndex_2

# group (continued): TAG Vert Pos
translate_20 = Geometry.Translate(geometry=translate_19, direction=cross_4, distance=mul_20)
clean_50 = List.Clean(list=translate_20, preserveIndices=boolean_53)
flatten_26 = List.Flatten(list=clean_50)
tag_byelement_10 = Custom[👓 Tag․ByElement](element=flatten_25, TagLocation=flatten_26, TagType=getItemAtIndex)

# group: 2º Int
code_block_39 = CodeBlock { 1; }
getItemAtIndex_7 = List.GetItemAtIndex(list=flatten_18, index=code_block_39, lacing=Longest)
boolean_54 = BoolSelector(false)
clean_51 = List.Clean(list=getItemAtIndex_7, preserveIndices=boolean_54)
facingOrientation_15 = FamilyInstance.FacingOrientation(familyInstance=clean_51)
Y_2 = Vector.Y(vector=facingOrientation_15)
code_block_40 = CodeBlock { 1; }
eq_8 = Y_2 == code_block_40
filterByBoolMask_35 = List.FilterByBoolMask(list=clean_51, mask=eq_8, lacing=Longest)
filterByBoolMask_36 = List.FilterByBoolMask(list=facingOrientation_15, mask=eq_8)
X_5 = Vector.X(vector=facingOrientation_15)
code_block_41 = CodeBlock { -1; }
eq_9 = X_5 == code_block_41
filterByBoolMask_37 = List.FilterByBoolMask(list=clean_51, mask=eq_9, lacing=Longest)
filterByBoolMask_38 = List.FilterByBoolMask(list=facingOrientation_15, mask=eq_9)
code_block_42 = CodeBlock { -1; }
eq_10 = Equals(x=Y_2, y=code_block_42)
filterByBoolMask_39 = List.FilterByBoolMask(list=clean_51, mask=eq_10, lacing=Longest)
filterByBoolMask_40 = List.FilterByBoolMask(list=facingOrientation_15, mask=eq_10)
code_block_43 = CodeBlock { 1; }
eq_11 = X_5 == code_block_43
filterByBoolMask_41 = List.FilterByBoolMask(list=clean_51, mask=eq_11, lacing=Longest)
filterByBoolMask_42 = List.FilterByBoolMask(list=facingOrientation_15, mask=eq_11)

# group: TAG Vert Pos
boolean_55 = BoolSelector(false)
clean_52 = List.Clean(list=filterByBoolMask_35.in, preserveIndices=boolean_55)
flatten_27 = List.Flatten(list=clean_52)
boolean_56 = BoolSelector(false)
clean_53 = List.Clean(list=filterByBoolMask_35.in, preserveIndices=boolean_56)
getLocation_17 = Element.GetLocation(element=clean_53)
boolean_57 = BoolSelector(false)
clean_54 = List.Clean(list=filterByBoolMask_36.in, preserveIndices=boolean_57)
offset_da_tag_y_11 = DoubleInput(0.25)
facingOrientation_16 = FamilyInstance.FacingOrientation(familyInstance=clean_53)
ZAxis_5 = Vector.ZAxis()
cross_5 = Vector.Cross(vector=facingOrientation_16, cross=ZAxis_5)
offset_da_tag_x_11 = DoubleInput(0.29)
boolean_58 = BoolSelector(false)

mul_21 = offset_da_tag_y_11 * getItemAtIndex_2

# group (continued): TAG Vert Pos
translate_21 = Geometry.Translate(geometry=getLocation_17, direction=clean_54, distance=mul_21)

mul_22 = offset_da_tag_x_11 * getItemAtIndex_2

# group (continued): TAG Vert Pos
translate_22 = Geometry.Translate(geometry=translate_21, direction=cross_5, distance=mul_22)
clean_55 = List.Clean(list=translate_22, preserveIndices=boolean_58)
flatten_28 = List.Flatten(list=clean_55)
tag_byelement_11 = Custom[👓 Tag․ByElement](element=flatten_27, TagLocation=flatten_28, TagType=getItemAtIndex)

# group: TAG Hor Neg
boolean_59 = BoolSelector(false)
clean_56 = List.Clean(list=filterByBoolMask_37.in, preserveIndices=boolean_59)
flatten_29 = List.Flatten(list=clean_56)
boolean_60 = BoolSelector(false)
clean_57 = List.Clean(list=filterByBoolMask_37.in, preserveIndices=boolean_60)
getLocation_18 = Element.GetLocation(element=clean_57)
boolean_61 = BoolSelector(false)
clean_58 = List.Clean(list=filterByBoolMask_38.in, preserveIndices=boolean_61)
ZAxis_6 = Vector.ZAxis()
cross_6 = Vector.Cross(vector=clean_58, cross=ZAxis_6)
offset_da_tag_y_12 = DoubleInput(0.21)
mul_23 = offset_da_tag_y_12 * getItemAtIndex_2
translate_23 = Geometry.Translate(geometry=getLocation_18, direction=cross_6, distance=mul_23)
facingOrientation_17 = FamilyInstance.FacingOrientation(familyInstance=clean_57)
offset_da_tag_x_12 = DoubleInput(0.45)
mul_24 = offset_da_tag_x_12 * getItemAtIndex_2
translate_24 = Geometry.Translate(geometry=translate_23, direction=facingOrientation_17, distance=mul_24)
boolean_62 = BoolSelector(false)
clean_59 = List.Clean(list=translate_24, preserveIndices=boolean_62)
flatten_30 = List.Flatten(list=clean_59)
tag_byelement_12 = Custom[👓 Tag․ByElement](element=flatten_29, TagLocation=flatten_30, TagType=getItemAtIndex)

# group: TAG Vert Neg
boolean_63 = BoolSelector(false)
clean_60 = List.Clean(list=filterByBoolMask_39.in, preserveIndices=boolean_63)
flatten_31 = List.Flatten(list=clean_60)
boolean_64 = BoolSelector(false)
clean_61 = List.Clean(list=filterByBoolMask_39.in, preserveIndices=boolean_64)
getLocation_19 = Element.GetLocation(element=clean_61)
boolean_65 = BoolSelector(false)
clean_62 = List.Clean(list=filterByBoolMask_40.in, preserveIndices=boolean_65)
offset_da_tag_y_13 = DoubleInput(0.35)
mul_25 = offset_da_tag_y_13 * getItemAtIndex_2
translate_25 = Geometry.Translate(geometry=getLocation_19, direction=clean_62, distance=mul_25)
facingOrientation_18 = FamilyInstance.FacingOrientation(familyInstance=clean_61)
ZAxis_7 = Vector.ZAxis()
cross_7 = Vector.Cross(vector=facingOrientation_18, cross=ZAxis_7)
offset_da_tag_x_13 = DoubleInput(0.38)
mul_26 = offset_da_tag_x_13 * getItemAtIndex_2
translate_26 = Geometry.Translate(geometry=translate_25, direction=cross_7, distance=mul_26)
boolean_66 = BoolSelector(false)
clean_63 = List.Clean(list=translate_26, preserveIndices=boolean_66)
flatten_32 = List.Flatten(list=clean_63)
tag_byelement_13 = Custom[👓 Tag․ByElement](element=flatten_31, TagLocation=flatten_32, TagType=getItemAtIndex)

# group: TAG Hor Pos
boolean_67 = BoolSelector(false)
clean_64 = List.Clean(list=filterByBoolMask_41.in, preserveIndices=boolean_67)
flatten_33 = List.Flatten(list=clean_64)
boolean_68 = BoolSelector(false)
clean_65 = List.Clean(list=filterByBoolMask_41.in, preserveIndices=boolean_68)
getLocation_20 = Element.GetLocation(element=clean_65)
boolean_69 = BoolSelector(false)
clean_66 = List.Clean(list=filterByBoolMask_42.in, preserveIndices=boolean_69)
ZAxis_8 = Vector.ZAxis()
cross_8 = Vector.Cross(vector=clean_66, cross=ZAxis_8)
offset_da_tag_y_14 = DoubleInput(0.3)
facingOrientation_19 = FamilyInstance.FacingOrientation(familyInstance=clean_65)
offset_da_tag_x_14 = DoubleInput(0.4)
boolean_70 = BoolSelector(false)

mul_27 = offset_da_tag_y_14 * getItemAtIndex_2

# group (continued): TAG Hor Pos
translate_27 = Geometry.Translate(geometry=getLocation_20, direction=cross_8, distance=mul_27)

mul_28 = offset_da_tag_x_14 * getItemAtIndex_2

# group (continued): TAG Hor Pos
translate_28 = Geometry.Translate(geometry=translate_27, direction=facingOrientation_19, distance=mul_28)
clean_67 = List.Clean(list=translate_28, preserveIndices=boolean_70)
flatten_34 = List.Flatten(list=clean_67)
tag_byelement_14 = Custom[👓 Tag․ByElement](element=flatten_33, TagLocation=flatten_34, TagType=getItemAtIndex)

# group: INT DUPLO E TRIPLO SIMPLES
list_create_6 = List.Create(item0=filterByBoolMask_11.in, item1=filterByBoolMask_12.in)
flatten_35 = List.Flatten(list=list_create_6)
getChildElements_3 = Element.GetChildElements(element=flatten_35)
python_script_5 = Python(IN[0]=getChildElements_3, IN[1]=taggedElement)  # same code as python_script_2
string_from_object_14 = FromObject(object=python_script_5)
code_block_44 = CodeBlock { ["Caixa de Luz"]; }
contains_21 = String.Contains(str=string_from_object_14@L2, searchFor=code_block_44, lacing=Longest)
filterByBoolMask_43 = List.FilterByBoolMask(list=python_script_5@L2, mask=contains_21@L2)
string_from_object_15 = FromObject(object=filterByBoolMask_43.out)
code_block_45 = CodeBlock { ["Tomada"]; }
contains_22 = String.Contains(str=string_from_object_15@L2, searchFor=code_block_45, lacing=Longest)
filterByBoolMask_44 = List.FilterByBoolMask(list=filterByBoolMask_43.out@L2, mask=contains_22@L2)
boolean_71 = BoolSelector(false)
boolean_72 = BoolSelector(false)
boolean_73 = BoolSelector(false)

string_from_object_16 = FromObject(obj=filterByBoolMask_44.out)
code_block_46 = CodeBlock { ["Tampa"]; }
contains_23 = String.Contains(str=string_from_object_16@L2, searchFor=code_block_46, lacing=Longest)
filterByBoolMask_45 = List.FilterByBoolMask(list=filterByBoolMask_44.out@L2, mask=contains_23@L2)
string_from_object_17 = FromObject(obj=filterByBoolMask_45.out)
code_block_47 = CodeBlock { ["Condulete Top"]; }
contains_24 = String.Contains(str=string_from_object_17@L2, searchFor=code_block_47, lacing=Longest)
filterByBoolMask_46 = List.FilterByBoolMask(list=filterByBoolMask_45.out@L2, mask=contains_24@L2)

# group (continued): INT DUPLO E TRIPLO SIMPLES
clean_68 = List.Clean(list=filterByBoolMask_46.out, preserveIndices=boolean_71)
getLocation_21 = Element.GetLocation(element=clean_68)
Z_3 = Point.Z(point=getLocation_21)
sortByKey_3 = List.SortByKey(list=clean_68, keys=Z_3, lacing=Longest)
clean_69 = List.Clean(list=sortByKey_3.sorted_list, preserveIndices=boolean_72)
flatten_36 = List.Flatten(list=clean_69@L2)
clean_70 = List.Clean(list=filterByBoolMask_46.in, preserveIndices=boolean_73)
reverse_3 = List.Reverse(list=sortByKey_3.sorted_list, lacing=Longest)

# group: INT TRIPLO 3º INTERRUPTOR
code_block_48 = CodeBlock { 2; }
getItemAtIndex_8 = List.GetItemAtIndex(list=flatten_36, index=code_block_48, lacing=Longest)
boolean_74 = BoolSelector(false)
clean_71 = List.Clean(list=getItemAtIndex_8, preserveIndices=boolean_74)
getLocation_22 = Element.GetLocation(element=clean_71)
facingOrientation_20 = FamilyInstance.FacingOrientation(familyInstance=clean_71)
byStartPointDirectionLength_5 = Line.ByStartPointDirectionLength(startPoint=getLocation_22, direction=facingOrientation_20)
line_upvectoratparameter_4 = Custom[👓 Line․UpVectorAtParameter](line=byStartPointDirectionLength_5)
X_6 = Vector.X(vector=line_upvectoratparameter_4)
code_block_49 = CodeBlock { -1; }
eq_12 = X_6 == code_block_49
filterByBoolMask_47 = List.FilterByBoolMask(list=clean_71, mask=eq_12, lacing=Longest)
filterByBoolMask_48 = List.FilterByBoolMask(list=line_upvectoratparameter_4, mask=eq_12)

# group: TAG Horizontal
boolean_75 = BoolSelector(false)
clean_72 = List.Clean(list=filterByBoolMask_47.out, preserveIndices=boolean_75)
flatten_37 = List.Flatten(list=clean_72)
boolean_76 = BoolSelector(false)
clean_73 = List.Clean(list=filterByBoolMask_47.out, preserveIndices=boolean_76)
getLocation_23 = Element.GetLocation(element=clean_73)
boolean_77 = BoolSelector(false)
clean_74 = List.Clean(list=filterByBoolMask_48.out, preserveIndices=boolean_77)
reverse_4 = Vector.Reverse(vector=clean_74)
offset_da_tag_y_15 = DoubleInput(0.19)
facingOrientation_21 = FamilyInstance.FacingOrientation(familyInstance=clean_73)
offset_da_tag_x_15 = DoubleInput(0.15)
boolean_78 = BoolSelector(false)

mul_29 = offset_da_tag_y_15 * getItemAtIndex_2

# group (continued): TAG Horizontal
translate_29 = Geometry.Translate(geometry=getLocation_23, direction=reverse_4, distance=mul_29)

mul_30 = offset_da_tag_x_15 * getItemAtIndex_2

# group (continued): TAG Horizontal
translate_30 = Geometry.Translate(geometry=translate_29, direction=facingOrientation_21, distance=mul_30)
clean_75 = List.Clean(list=translate_30, preserveIndices=boolean_78)
flatten_38 = List.Flatten(list=clean_75)
tag_byelement_15 = Custom[👓 Tag․ByElement](element=flatten_37, TagLocation=flatten_38, TagType=getItemAtIndex)

# group: INT DUPLO E TRIPLO 1º INTERRUPTOR
code_block_50 = CodeBlock { 0; }
getItemAtIndex_9 = List.GetItemAtIndex(list=flatten_36, index=code_block_50, lacing=Longest)
boolean_79 = BoolSelector(false)
clean_76 = List.Clean(list=getItemAtIndex_9, preserveIndices=boolean_79)
getLocation_24 = Element.GetLocation(element=clean_76)
facingOrientation_22 = FamilyInstance.FacingOrientation(familyInstance=clean_76)
byStartPointDirectionLength_6 = Line.ByStartPointDirectionLength(startPoint=getLocation_24, direction=facingOrientation_22)
line_upvectoratparameter_5 = Custom[👓 Line․UpVectorAtParameter](line=byStartPointDirectionLength_6)
X_7 = Vector.X(vector=line_upvectoratparameter_5)
code_block_51 = CodeBlock { -1; }
eq_13 = X_7 == code_block_51
filterByBoolMask_49 = List.FilterByBoolMask(list=clean_76, mask=eq_13, lacing=Longest)
filterByBoolMask_50 = List.FilterByBoolMask(list=line_upvectoratparameter_5, mask=eq_13)

# group: TAG Vertical
boolean_80 = BoolSelector(false)
clean_77 = List.Clean(list=filterByBoolMask_49.in, preserveIndices=boolean_80)
flatten_39 = List.Flatten(list=clean_77)
boolean_81 = BoolSelector(false)
clean_78 = List.Clean(list=filterByBoolMask_49.in, preserveIndices=boolean_81)
getLocation_25 = Element.GetLocation(element=clean_78)
boolean_82 = BoolSelector(false)
clean_79 = List.Clean(list=filterByBoolMask_50.in, preserveIndices=boolean_82)
offset_da_tag_x_16 = DoubleInput(0.27)
mul_31 = offset_da_tag_x_16 * getItemAtIndex_2
translate_31 = Geometry.Translate(geometry=getLocation_25, direction=clean_79, distance=mul_31)
facingOrientation_23 = FamilyInstance.FacingOrientation(familyInstance=clean_78)
offset_da_tag_y_16 = DoubleInput(0.18)
mul_32 = offset_da_tag_y_16 * getItemAtIndex_2
translate_32 = Geometry.Translate(geometry=translate_31, direction=facingOrientation_23, distance=mul_32)
boolean_83 = BoolSelector(false)
clean_80 = List.Clean(list=translate_32, preserveIndices=boolean_83)
flatten_40 = List.Flatten(list=clean_80)
tag_byelement_16 = Custom[👓 Tag․ByElement](element=flatten_39, TagLocation=flatten_40, TagType=getItemAtIndex)

# group: TAG Horizontal
boolean_84 = BoolSelector(false)
clean_81 = List.Clean(list=filterByBoolMask_49.out, preserveIndices=boolean_84)
flatten_41 = List.Flatten(list=clean_81)
boolean_85 = BoolSelector(false)
clean_82 = List.Clean(list=filterByBoolMask_49.out, preserveIndices=boolean_85)
getLocation_26 = Element.GetLocation(element=clean_82)
boolean_86 = BoolSelector(false)
clean_83 = List.Clean(list=filterByBoolMask_50.out, preserveIndices=boolean_86)
offset_da_tag_y_17 = DoubleInput(0.11)
mul_33 = offset_da_tag_y_17 * getItemAtIndex_2
translate_33 = Geometry.Translate(geometry=getLocation_26, direction=clean_83, distance=mul_33)
facingOrientation_24 = FamilyInstance.FacingOrientation(familyInstance=clean_82)
offset_da_tag_x_17 = DoubleInput(0.15)
mul_34 = offset_da_tag_x_17 * getItemAtIndex_2
translate_34 = Geometry.Translate(geometry=translate_33, direction=facingOrientation_24, distance=mul_34)
boolean_87 = BoolSelector(false)
clean_84 = List.Clean(list=translate_34, preserveIndices=boolean_87)
flatten_42 = List.Flatten(list=clean_84)
tag_byelement_17 = Custom[👓 Tag․ByElement](element=flatten_41, TagLocation=flatten_42, TagType=getItemAtIndex)

# group: INT DUPLO E TRIPLO 2º INTERRUPTOR
code_block_52 = CodeBlock { 1; }
getItemAtIndex_10 = List.GetItemAtIndex(list=flatten_36, index=code_block_52, lacing=Longest)
boolean_88 = BoolSelector(false)
clean_85 = List.Clean(list=getItemAtIndex_10, preserveIndices=boolean_88)
getLocation_27 = Element.GetLocation(element=clean_85)
facingOrientation_25 = FamilyInstance.FacingOrientation(familyInstance=clean_85)
byStartPointDirectionLength_7 = Line.ByStartPointDirectionLength(startPoint=getLocation_27, direction=facingOrientation_25)
line_upvectoratparameter_6 = Custom[👓 Line․UpVectorAtParameter](line=byStartPointDirectionLength_7)
X_8 = Vector.X(vector=line_upvectoratparameter_6)
code_block_53 = CodeBlock { -1; }
eq_14 = X_8 == code_block_53
filterByBoolMask_51 = List.FilterByBoolMask(list=clean_85, mask=eq_14, lacing=Longest)
filterByBoolMask_52 = List.FilterByBoolMask(list=line_upvectoratparameter_6, mask=eq_14)

# group: TAG Horizontal
boolean_89 = BoolSelector(false)
clean_86 = List.Clean(list=filterByBoolMask_51.out, preserveIndices=boolean_89)
flatten_43 = List.Flatten(list=clean_86)
boolean_90 = BoolSelector(false)
clean_87 = List.Clean(list=filterByBoolMask_51.out, preserveIndices=boolean_90)
getLocation_28 = Element.GetLocation(element=clean_87)
boolean_91 = BoolSelector(false)
clean_88 = List.Clean(list=filterByBoolMask_52.out, preserveIndices=boolean_91)
offset_da_tag_y_18 = DoubleInput(-0.04)
facingOrientation_26 = FamilyInstance.FacingOrientation(familyInstance=clean_87)
offset_da_tag_x_18 = DoubleInput(0.4)
boolean_92 = BoolSelector(false)

mul_35 = offset_da_tag_y_18 * getItemAtIndex_2

# group (continued): TAG Horizontal
translate_35 = Geometry.Translate(geometry=getLocation_28, direction=clean_88, distance=mul_35)

mul_36 = offset_da_tag_x_18 * getItemAtIndex_2

# group (continued): TAG Horizontal
translate_36 = Geometry.Translate(geometry=translate_35, direction=facingOrientation_26, distance=mul_36)
clean_89 = List.Clean(list=translate_36, preserveIndices=boolean_92)
flatten_44 = List.Flatten(list=clean_89)
tag_byelement_18 = Custom[👓 Tag․ByElement](element=flatten_43, TagLocation=flatten_44, TagType=getItemAtIndex)

# group: TAG Vertical
boolean_93 = BoolSelector(false)
clean_90 = List.Clean(list=filterByBoolMask_51.in, preserveIndices=boolean_93)
flatten_45 = List.Flatten(list=clean_90)
boolean_94 = BoolSelector(false)
clean_91 = List.Clean(list=filterByBoolMask_51.in, preserveIndices=boolean_94)
getLocation_29 = Element.GetLocation(element=clean_91)
boolean_95 = BoolSelector(false)
clean_92 = List.Clean(list=filterByBoolMask_52.in, preserveIndices=boolean_95)
offset_da_tag_x_19 = DoubleInput(0.05)
facingOrientation_27 = FamilyInstance.FacingOrientation(familyInstance=clean_91)
offset_da_tag_y_19 = DoubleInput(0.33)
boolean_96 = BoolSelector(false)

mul_37 = offset_da_tag_x_19 * getItemAtIndex_2

# group (continued): TAG Vertical
translate_37 = Geometry.Translate(geometry=getLocation_29, direction=clean_92, distance=mul_37)

mul_38 = offset_da_tag_y_19 * getItemAtIndex_2

# group (continued): TAG Vertical
translate_38 = Geometry.Translate(geometry=translate_37, direction=facingOrientation_27, distance=mul_38)
clean_93 = List.Clean(list=translate_38, preserveIndices=boolean_96)
flatten_46 = List.Flatten(list=clean_93)
tag_byelement_19 = Custom[👓 Tag․ByElement](element=flatten_45, TagLocation=flatten_46, TagType=getItemAtIndex)

# group: TAG Vertical
boolean_97 = BoolSelector(false)
clean_94 = List.Clean(list=filterByBoolMask_47.in, preserveIndices=boolean_97)
flatten_47 = List.Flatten(list=clean_94)
boolean_98 = BoolSelector(false)
clean_95 = List.Clean(list=filterByBoolMask_47.in, preserveIndices=boolean_98)
getLocation_30 = Element.GetLocation(element=clean_95)
boolean_99 = BoolSelector(false)
clean_96 = List.Clean(list=filterByBoolMask_48.in, preserveIndices=boolean_99)
reverse_5 = Vector.Reverse(vector=clean_96)
offset_da_tag_x_20 = DoubleInput(0.18)
facingOrientation_28 = FamilyInstance.FacingOrientation(familyInstance=clean_95)
offset_da_tag_y_20 = DoubleInput(0.18)
boolean_100 = BoolSelector(false)

mul_39 = offset_da_tag_x_20 * getItemAtIndex_2

# group (continued): TAG Vertical
translate_39 = Geometry.Translate(geometry=getLocation_30, direction=reverse_5, distance=mul_39)

mul_40 = offset_da_tag_y_20 * getItemAtIndex_2

# group (continued): TAG Vertical
translate_40 = Geometry.Translate(geometry=translate_39, direction=facingOrientation_28, distance=mul_40)
clean_97 = List.Clean(list=translate_40, preserveIndices=boolean_100)
flatten_48 = List.Flatten(list=clean_97)
tag_byelement_20 = Custom[👓 Tag․ByElement](element=flatten_47, TagLocation=flatten_48, TagType=getItemAtIndex)

# group: 3º Int
code_block_54 = CodeBlock { 2; }
getItemAtIndex_11 = List.GetItemAtIndex(list=flatten_18, index=code_block_54, lacing=Longest)
boolean_101 = BoolSelector(false)
clean_98 = List.Clean(list=getItemAtIndex_11, preserveIndices=boolean_101)
facingOrientation_29 = FamilyInstance.FacingOrientation(familyInstance=clean_98)
Y_3 = Vector.Y(vector=facingOrientation_29)
code_block_55 = CodeBlock { 1; }
eq_15 = Y_3 == code_block_55
filterByBoolMask_53 = List.FilterByBoolMask(list=clean_98, mask=eq_15, lacing=Longest)
filterByBoolMask_54 = List.FilterByBoolMask(list=facingOrientation_29, mask=eq_15)
code_block_56 = CodeBlock { -1; }
eq_16 = Equals(x=Y_3, y=code_block_56)
filterByBoolMask_55 = List.FilterByBoolMask(list=clean_98, mask=eq_16, lacing=Longest)
filterByBoolMask_56 = List.FilterByBoolMask(list=facingOrientation_29, mask=eq_16)
X_9 = Vector.X(vector=facingOrientation_29)
code_block_57 = CodeBlock { 1; }
eq_17 = X_9 == code_block_57
filterByBoolMask_57 = List.FilterByBoolMask(list=clean_98, mask=eq_17, lacing=Longest)
filterByBoolMask_58 = List.FilterByBoolMask(list=facingOrientation_29, mask=eq_17)
code_block_58 = CodeBlock { -1; }
eq_18 = X_9 == code_block_58
filterByBoolMask_59 = List.FilterByBoolMask(list=clean_98, mask=eq_18, lacing=Longest)
filterByBoolMask_60 = List.FilterByBoolMask(list=facingOrientation_29, mask=eq_18)

# group: TAG Vert Pos
boolean_102 = BoolSelector(false)
clean_99 = List.Clean(list=filterByBoolMask_53.in, preserveIndices=boolean_102)
flatten_49 = List.Flatten(list=clean_99)
boolean_103 = BoolSelector(false)
clean_100 = List.Clean(list=filterByBoolMask_53.in, preserveIndices=boolean_103)
getLocation_31 = Element.GetLocation(element=clean_100)
boolean_104 = BoolSelector(false)
clean_101 = List.Clean(list=filterByBoolMask_54.in, preserveIndices=boolean_104)
offset_da_tag_y_21 = DoubleInput(0.4)
facingOrientation_30 = FamilyInstance.FacingOrientation(familyInstance=clean_100)
ZAxis_9 = Vector.ZAxis()
cross_9 = Vector.Cross(vector=facingOrientation_30, cross=ZAxis_9)
offset_da_tag_x_21 = DoubleInput(0.29)
boolean_105 = BoolSelector(false)

mul_41 = offset_da_tag_y_21 * getItemAtIndex_2

# group (continued): TAG Vert Pos
translate_41 = Geometry.Translate(geometry=getLocation_31, direction=clean_101, distance=mul_41)

mul_42 = offset_da_tag_x_21 * getItemAtIndex_2

# group (continued): TAG Vert Pos
translate_42 = Geometry.Translate(geometry=translate_41, direction=cross_9, distance=mul_42)
clean_102 = List.Clean(list=translate_42, preserveIndices=boolean_105)
flatten_50 = List.Flatten(list=clean_102)
tag_byelement_21 = Custom[👓 Tag․ByElement](element=flatten_49, TagLocation=flatten_50, TagType=getItemAtIndex)

# group: TAG Vert Neg
boolean_106 = BoolSelector(false)
clean_103 = List.Clean(list=filterByBoolMask_55.in, preserveIndices=boolean_106)
flatten_51 = List.Flatten(list=clean_103)
boolean_107 = BoolSelector(false)
clean_104 = List.Clean(list=filterByBoolMask_55.in, preserveIndices=boolean_107)
getLocation_32 = Element.GetLocation(element=clean_104)
boolean_108 = BoolSelector(false)
clean_105 = List.Clean(list=filterByBoolMask_56.in, preserveIndices=boolean_108)
offset_da_tag_y_22 = DoubleInput(0.5)
facingOrientation_31 = FamilyInstance.FacingOrientation(familyInstance=clean_104)
ZAxis_10 = Vector.ZAxis()
cross_10 = Vector.Cross(vector=facingOrientation_31, cross=ZAxis_10)
offset_da_tag_x_22 = DoubleInput(0.38)
boolean_109 = BoolSelector(false)

mul_43 = offset_da_tag_y_22 * getItemAtIndex_2

# group (continued): TAG Vert Neg
translate_43 = Geometry.Translate(geometry=getLocation_32, direction=clean_105, distance=mul_43)

mul_44 = offset_da_tag_x_22 * getItemAtIndex_2

# group (continued): TAG Vert Neg
translate_44 = Geometry.Translate(geometry=translate_43, direction=cross_10, distance=mul_44)
clean_106 = List.Clean(list=translate_44, preserveIndices=boolean_109)
flatten_52 = List.Flatten(list=clean_106)
tag_byelement_22 = Custom[👓 Tag․ByElement](element=flatten_51, TagLocation=flatten_52, TagType=getItemAtIndex)

# group: TAG Hor Pos
boolean_110 = BoolSelector(false)
clean_107 = List.Clean(list=filterByBoolMask_57.in, preserveIndices=boolean_110)
flatten_53 = List.Flatten(list=clean_107)
boolean_111 = BoolSelector(false)
clean_108 = List.Clean(list=filterByBoolMask_57.in, preserveIndices=boolean_111)
getLocation_33 = Element.GetLocation(element=clean_108)
boolean_112 = BoolSelector(false)
clean_109 = List.Clean(list=filterByBoolMask_58.in, preserveIndices=boolean_112)
ZAxis_11 = Vector.ZAxis()
cross_11 = Vector.Cross(vector=clean_109, cross=ZAxis_11)
offset_da_tag_y_23 = DoubleInput(0.3)
mul_45 = offset_da_tag_y_23 * getItemAtIndex_2
translate_45 = Geometry.Translate(geometry=getLocation_33, direction=cross_11, distance=mul_45)
facingOrientation_32 = FamilyInstance.FacingOrientation(familyInstance=clean_108)
offset_da_tag_x_23 = DoubleInput(0.7)
mul_46 = offset_da_tag_x_23 * getItemAtIndex_2
translate_46 = Geometry.Translate(geometry=translate_45, direction=facingOrientation_32, distance=mul_46)
boolean_113 = BoolSelector(false)
clean_110 = List.Clean(list=translate_46, preserveIndices=boolean_113)
flatten_54 = List.Flatten(list=clean_110)
tag_byelement_23 = Custom[👓 Tag․ByElement](element=flatten_53, TagLocation=flatten_54, TagType=getItemAtIndex)

# group: TAG Hor Neg
boolean_114 = BoolSelector(false)
clean_111 = List.Clean(list=filterByBoolMask_59.in, preserveIndices=boolean_114)
flatten_55 = List.Flatten(list=clean_111)
boolean_115 = BoolSelector(false)
clean_112 = List.Clean(list=filterByBoolMask_59.in, preserveIndices=boolean_115)
getLocation_34 = Element.GetLocation(element=clean_112)
boolean_116 = BoolSelector(false)
clean_113 = List.Clean(list=filterByBoolMask_60.in, preserveIndices=boolean_116)
ZAxis_12 = Vector.ZAxis()
cross_12 = Vector.Cross(vector=clean_113, cross=ZAxis_12)
offset_da_tag_y_24 = DoubleInput(0.21)
facingOrientation_33 = FamilyInstance.FacingOrientation(familyInstance=clean_112)
offset_da_tag_x_24 = DoubleInput(0.75)
boolean_117 = BoolSelector(false)

mul_47 = offset_da_tag_y_24 * getItemAtIndex_2

# group (continued): TAG Hor Neg
translate_47 = Geometry.Translate(geometry=getLocation_34, direction=cross_12, distance=mul_47)

mul_48 = offset_da_tag_x_24 * getItemAtIndex_2

# group (continued): TAG Hor Neg
translate_48 = Geometry.Translate(geometry=translate_47, direction=facingOrientation_33, distance=mul_48)
clean_114 = List.Clean(list=translate_48, preserveIndices=boolean_117)
flatten_56 = List.Flatten(list=clean_114)
tag_byelement_24 = Custom[👓 Tag․ByElement](element=flatten_55, TagLocation=flatten_56, TagType=getItemAtIndex)

# group: 3ª Tecla
code_block_59 = CodeBlock { 3; }
getItemAtIndex_12 = List.GetItemAtIndex(list=flatten_4, index=code_block_59, lacing=Longest)
boolean_118 = BoolSelector(false)
clean_115 = List.Clean(list=getItemAtIndex_12, preserveIndices=boolean_118)
getLocation_35 = Element.GetLocation(element=clean_115)
facingOrientation_34 = FamilyInstance.FacingOrientation(familyInstance=clean_115)
byStartPointDirectionLength_8 = Line.ByStartPointDirectionLength(startPoint=getLocation_35, direction=facingOrientation_34)
line_upvectoratparameter_7 = Custom[👓 Line․UpVectorAtParameter](line=byStartPointDirectionLength_8)
X_10 = Vector.X(vector=line_upvectoratparameter_7)
code_block_60 = CodeBlock { -1; }
eq_19 = X_10 == code_block_60
filterByBoolMask_61 = List.FilterByBoolMask(list=clean_115, mask=eq_19, lacing=Longest)
filterByBoolMask_62 = List.FilterByBoolMask(list=line_upvectoratparameter_7, mask=eq_19)

# group: TAG Horizontal
boolean_119 = BoolSelector(false)
clean_116 = List.Clean(list=filterByBoolMask_61.out, preserveIndices=boolean_119)
flatten_57 = List.Flatten(list=clean_116)
boolean_120 = BoolSelector(false)
clean_117 = List.Clean(list=filterByBoolMask_61.out, preserveIndices=boolean_120)
getLocation_36 = Element.GetLocation(element=clean_117)
boolean_121 = BoolSelector(false)
clean_118 = List.Clean(list=filterByBoolMask_62.out, preserveIndices=boolean_121)
offset_da_tag_y_25 = DoubleInput(-0.35)
mul_49 = offset_da_tag_y_25 * getItemAtIndex_2
translate_49 = Geometry.Translate(geometry=getLocation_36, direction=clean_118, distance=mul_49)
facingOrientation_35 = FamilyInstance.FacingOrientation(familyInstance=clean_117)
offset_da_tag_x_25 = DoubleInput(0.1)
mul_50 = offset_da_tag_x_25 * getItemAtIndex_2
translate_50 = Geometry.Translate(geometry=translate_49, direction=facingOrientation_35, distance=mul_50)
boolean_122 = BoolSelector(false)
clean_119 = List.Clean(list=translate_50, preserveIndices=boolean_122)
flatten_58 = List.Flatten(list=clean_119)
tag_byelement_25 = Custom[👓 Tag․ByElement](element=flatten_57, TagLocation=flatten_58, TagType=getItemAtIndex, horizontal=boolean_12)

# group: TAG Vertical
boolean_123 = BoolSelector(false)
clean_120 = List.Clean(list=filterByBoolMask_61.in, preserveIndices=boolean_123)
flatten_59 = List.Flatten(list=clean_120)
boolean_124 = BoolSelector(false)
clean_121 = List.Clean(list=filterByBoolMask_61.in, preserveIndices=boolean_124)
getLocation_37 = Element.GetLocation(element=clean_121)
boolean_125 = BoolSelector(false)
clean_122 = List.Clean(list=filterByBoolMask_62.in, preserveIndices=boolean_125)
offset_da_tag_x_26 = DoubleInput(-0.2)
mul_51 = offset_da_tag_x_26 * getItemAtIndex_2
translate_51 = Geometry.Translate(geometry=getLocation_37, direction=clean_122, distance=mul_51)
facingOrientation_36 = FamilyInstance.FacingOrientation(familyInstance=clean_121)
offset_da_tag_y_26 = DoubleInput(0.15)
mul_52 = offset_da_tag_y_26 * getItemAtIndex_2
translate_52 = Geometry.Translate(geometry=translate_51, direction=facingOrientation_36, distance=mul_52)
boolean_126 = BoolSelector(false)
clean_123 = List.Clean(list=translate_52, preserveIndices=boolean_126)
flatten_60 = List.Flatten(list=clean_123)
tag_byelement_26 = Custom[👓 Tag․ByElement](element=flatten_59, TagLocation=flatten_60, TagType=getItemAtIndex)

boolean_127 = BoolSelector(false)

# group: 3ª Tecla
code_block_61 = CodeBlock { 4; }
getItemAtIndex_13 = List.GetItemAtIndex(list=flatten_4, index=code_block_61, lacing=Longest)
boolean_128 = BoolSelector(false)
clean_124 = List.Clean(list=getItemAtIndex_13, preserveIndices=boolean_128)
getLocation_38 = Element.GetLocation(element=clean_124)
facingOrientation_37 = FamilyInstance.FacingOrientation(familyInstance=clean_124)
byStartPointDirectionLength_9 = Line.ByStartPointDirectionLength(startPoint=getLocation_38, direction=facingOrientation_37)
line_upvectoratparameter_8 = Custom[👓 Line․UpVectorAtParameter](line=byStartPointDirectionLength_9)
X_11 = Vector.X(vector=line_upvectoratparameter_8)
code_block_62 = CodeBlock { -1; }
eq_20 = X_11 == code_block_62
filterByBoolMask_63 = List.FilterByBoolMask(list=clean_124, mask=eq_20, lacing=Longest)
filterByBoolMask_64 = List.FilterByBoolMask(list=line_upvectoratparameter_8, mask=eq_20)

# group: TAG Horizontal
boolean_129 = BoolSelector(false)
clean_125 = List.Clean(list=filterByBoolMask_63.out, preserveIndices=boolean_129)
flatten_61 = List.Flatten(list=clean_125)
boolean_130 = BoolSelector(false)
clean_126 = List.Clean(list=filterByBoolMask_63.out, preserveIndices=boolean_130)
getLocation_39 = Element.GetLocation(element=clean_126)
boolean_131 = BoolSelector(false)
clean_127 = List.Clean(list=filterByBoolMask_64.out, preserveIndices=boolean_131)
offset_da_tag_y_27 = DoubleInput(-0.3)
mul_53 = offset_da_tag_y_27 * getItemAtIndex_2
translate_53 = Geometry.Translate(geometry=getLocation_39, direction=clean_127, distance=mul_53)
facingOrientation_38 = FamilyInstance.FacingOrientation(familyInstance=clean_126)
offset_da_tag_x_27 = DoubleInput(0.25)
mul_54 = offset_da_tag_x_27 * getItemAtIndex_2
translate_54 = Geometry.Translate(geometry=translate_53, direction=facingOrientation_38, distance=mul_54)
boolean_132 = BoolSelector(false)
clean_128 = List.Clean(list=translate_54, preserveIndices=boolean_132)
flatten_62 = List.Flatten(list=clean_128)
tag_byelement_27 = Custom[👓 Tag․ByElement](element=flatten_61, TagLocation=flatten_62, TagType=getItemAtIndex, horizontal=boolean_12)

# group: TAG Vertical
boolean_133 = BoolSelector(false)
clean_129 = List.Clean(list=filterByBoolMask_63.in, preserveIndices=boolean_133)
flatten_63 = List.Flatten(list=clean_129)
boolean_134 = BoolSelector(false)
clean_130 = List.Clean(list=filterByBoolMask_63.in, preserveIndices=boolean_134)
getLocation_40 = Element.GetLocation(element=clean_130)
boolean_135 = BoolSelector(false)
clean_131 = List.Clean(list=filterByBoolMask_64.in, preserveIndices=boolean_135)
offset_da_tag_x_28 = DoubleInput(-0.2)
mul_55 = offset_da_tag_x_28 * getItemAtIndex_2
translate_55 = Geometry.Translate(geometry=getLocation_40, direction=clean_131, distance=mul_55)
facingOrientation_39 = FamilyInstance.FacingOrientation(familyInstance=clean_130)
offset_da_tag_y_28 = DoubleInput(0.3)
mul_56 = offset_da_tag_y_28 * getItemAtIndex_2
translate_56 = Geometry.Translate(geometry=translate_55, direction=facingOrientation_39, distance=mul_56)
boolean_136 = BoolSelector(false)
clean_132 = List.Clean(list=translate_56, preserveIndices=boolean_136)
flatten_64 = List.Flatten(list=clean_132)
tag_byelement_28 = Custom[👓 Tag․ByElement](element=flatten_63, TagLocation=flatten_64, TagType=getItemAtIndex)

# group: 3ª Tecla
code_block_63 = CodeBlock { 5; }
getItemAtIndex_14 = List.GetItemAtIndex(list=flatten_4, index=code_block_63, lacing=Longest)
boolean_137 = BoolSelector(false)
clean_133 = List.Clean(list=getItemAtIndex_14, preserveIndices=boolean_137)
getLocation_41 = Element.GetLocation(element=clean_133)
facingOrientation_40 = FamilyInstance.FacingOrientation(familyInstance=clean_133)
byStartPointDirectionLength_10 = Line.ByStartPointDirectionLength(startPoint=getLocation_41, direction=facingOrientation_40)
line_upvectoratparameter_9 = Custom[👓 Line․UpVectorAtParameter](line=byStartPointDirectionLength_10)
X_12 = Vector.X(vector=line_upvectoratparameter_9)
code_block_64 = CodeBlock { -1; }
eq_21 = X_12 == code_block_64
filterByBoolMask_65 = List.FilterByBoolMask(list=clean_133, mask=eq_21, lacing=Longest)
filterByBoolMask_66 = List.FilterByBoolMask(list=line_upvectoratparameter_9, mask=eq_21)

# group: TAG Horizontal
boolean_138 = BoolSelector(false)
clean_134 = List.Clean(list=filterByBoolMask_65.out, preserveIndices=boolean_138)
flatten_65 = List.Flatten(list=clean_134)
boolean_139 = BoolSelector(false)
clean_135 = List.Clean(list=filterByBoolMask_65.out, preserveIndices=boolean_139)
getLocation_42 = Element.GetLocation(element=clean_135)
boolean_140 = BoolSelector(false)
clean_136 = List.Clean(list=filterByBoolMask_66.out, preserveIndices=boolean_140)
offset_da_tag_y_29 = DoubleInput(-0.3)
mul_57 = offset_da_tag_y_29 * getItemAtIndex_2
translate_57 = Geometry.Translate(geometry=getLocation_42, direction=clean_136, distance=mul_57)
facingOrientation_41 = FamilyInstance.FacingOrientation(familyInstance=clean_135)
offset_da_tag_x_29 = DoubleInput(0.4)
mul_58 = offset_da_tag_x_29 * getItemAtIndex_2
translate_58 = Geometry.Translate(geometry=translate_57, direction=facingOrientation_41, distance=mul_58)
boolean_141 = BoolSelector(false)
clean_137 = List.Clean(list=translate_58, preserveIndices=boolean_141)
flatten_66 = List.Flatten(list=clean_137)
tag_byelement_29 = Custom[👓 Tag․ByElement](element=flatten_65, TagLocation=flatten_66, TagType=getItemAtIndex, horizontal=boolean_12)

# group: TAG Vertical
boolean_142 = BoolSelector(false)
clean_138 = List.Clean(list=filterByBoolMask_65.in, preserveIndices=boolean_142)
flatten_67 = List.Flatten(list=clean_138)
boolean_143 = BoolSelector(false)
clean_139 = List.Clean(list=filterByBoolMask_65.in, preserveIndices=boolean_143)
getLocation_43 = Element.GetLocation(element=clean_139)
boolean_144 = BoolSelector(false)
clean_140 = List.Clean(list=filterByBoolMask_66.in, preserveIndices=boolean_144)
offset_da_tag_x_30 = DoubleInput(-0.2)
mul_59 = offset_da_tag_x_30 * getItemAtIndex_2
translate_59 = Geometry.Translate(geometry=getLocation_43, direction=clean_140, distance=mul_59)
facingOrientation_42 = FamilyInstance.FacingOrientation(familyInstance=clean_139)
offset_da_tag_y_30 = DoubleInput(0.45)
mul_60 = offset_da_tag_y_30 * getItemAtIndex_2
translate_60 = Geometry.Translate(geometry=translate_59, direction=facingOrientation_42, distance=mul_60)
boolean_145 = BoolSelector(false)
clean_141 = List.Clean(list=translate_60, preserveIndices=boolean_145)
flatten_68 = List.Flatten(list=clean_141)
tag_byelement_30 = Custom[👓 Tag․ByElement](element=flatten_67, TagLocation=flatten_68, TagType=getItemAtIndex)
