# Dynamo graph 10-8_BIMACON_Tags de Tomadas_R00_script.dyn "ok 10-8_BIMACON_Tags de Tomadas_R00_script" (Dynamo 2.19.3.6394)
# author: José Nelson
# Inseri Tags de comandos dos Interruptores
# packages: BIMCoder Nodes - 2.X 2025.1.0

categories = Categories("OST_ElectricalFixtures")
current = Document.Current()
activeView = Document.ActiveView(document=current)
all_elements_of_category_in_view = ElementsOfCategoryInView(Category=categories, View=activeView)
flatten = List.Flatten(list=all_elements_of_category_in_view)
uniqueItems = List.UniqueItems(list=flatten)
string_from_object = FromObject(object=uniqueItems)
code_block = CodeBlock { ["Tomada"]; }
contains = String.Contains(string=string_from_object@L2, searchFor=code_block, lacing=Longest)
filterByBoolMask = List.FilterByBoolMask(list=uniqueItems@L2, mask=contains@L2)
string_from_object_2 = FromObject(object=filterByBoolMask.in)
code_block_2 = CodeBlock { ["+ 1 Tomada"]; }
contains_2 = String.Contains(string=string_from_object_2@L2, searchFor=code_block_2, lacing=Longest)
filterByBoolMask_2 = List.FilterByBoolMask(list=filterByBoolMask.in@L2, mask=contains_2@L2)
getChildElements = Element.GetChildElements(element=filterByBoolMask_2.out)
string_from_object_3 = FromObject(object=getChildElements)
code_block_3 = CodeBlock { ["Caixa de Luz"]; }
contains_3 = String.Contains(string=string_from_object_3@L2, searchFor=code_block_3, lacing=Longest)
filterByBoolMask_3 = List.FilterByBoolMask(list=getChildElements@L2, mask=contains_3@L2)
string_from_object_4 = FromObject(object=filterByBoolMask_3.out)
code_block_4 = CodeBlock { ["Tomada"]; }
contains_4 = String.Contains(string=string_from_object_4@L2, searchFor=code_block_4, lacing=Longest)
filterByBoolMask_4 = List.FilterByBoolMask(list=filterByBoolMask_3.out@L2, mask=contains_4@L2)
boolean = BoolSelector(false)
clean = List.Clean(list=filterByBoolMask_4.in, preserveIndices=boolean)
getLocation = Element.GetLocation(element=clean)
Z = Point.Z(point=getLocation)
sortByKey = List.SortByKey(list=clean, keys=Z, lacing=Longest)
reverse = List.Reverse(list=sortByKey.sortedList, lacing=Longest)
getLocation_2 = Element.GetLocation(element=reverse)
flatten_2 = List.Flatten(list=getLocation_2@L2)
flatten_3 = List.Flatten(list=reverse@L2)
code_block_5 = CodeBlock { 2; }
getItemAtIndex = List.GetItemAtIndex(list=flatten_3, index=code_block_5, lacing=Longest)
boolean_2 = BoolSelector(false)
clean_2 = List.Clean(list=getItemAtIndex, preserveIndices=boolean_2)
facingOrientation = FamilyInstance.FacingOrientation(familyInstance=clean_2)
X = Vector.X(vector=facingOrientation)
code_block_6 = CodeBlock { 0; }

# group: x
lt = X < code_block_6

Y = Vector.Y(vector=facingOrientation)
code_block_7 = CodeBlock { 2; }
round = Math.Round(number=Y, digits=code_block_7)
code_block_8 = CodeBlock { 0; }

# group: y
ge = round >= code_block_8

code_block_9 = CodeBlock { true; false; }
condição_if_de_lista_aninhada = CodeBlock(x=lt, y=ge, cond1=code_block_9.out0, cond2=code_block_9.out1) { indx = (x == true) && (y == true) ? 0 : 1; resultado = [cond1, cond2][indx]; }
filterByBoolMask_5 = List.FilterByBoolMask(list=clean_2, mask=condição_if_de_lista_aninhada.resultado, lacing=Longest)
filterByBoolMask_6 = List.FilterByBoolMask(list=facingOrientation, mask=condição_if_de_lista_aninhada.resultado)

# group: TAG Vertical Neg
# Descrição <Clique duas vezes aqui para editar a descrição do grupo>
boolean_3 = BoolSelector(false)
clean_3 = List.Clean(list=filterByBoolMask_5.in, preserveIndices=boolean_3)
flatten_4 = List.Flatten(list=clean_3)
boolean_4 = BoolSelector(false)
clean_4 = List.Clean(list=filterByBoolMask_5.in, preserveIndices=boolean_4)
getLocation_3 = Element.GetLocation(element=clean_4)
boolean_5 = BoolSelector(false)
clean_5 = List.Clean(list=filterByBoolMask_6.in, preserveIndices=boolean_5)
ZAxis = Vector.ZAxis()
cross = Vector.Cross(vector=clean_5, cross=ZAxis)
offset_da_tag = DoubleInput(0.1)
translate = Geometry.Translate(geometry=getLocation_3, direction=cross, distance=offset_da_tag)
facingOrientation_2 = FamilyInstance.FacingOrientation(familyInstance=clean_4)
offset_da_2ª_tag = DoubleInput(0.45)
translate_2 = Geometry.Translate(geometry=translate, direction=facingOrientation_2, distance=offset_da_2ª_tag)
boolean_6 = BoolSelector(false)
clean_6 = List.Clean(list=translate_2, preserveIndices=boolean_6)
flatten_5 = List.Flatten(list=clean_6)
family_types = FamilyTypes("Tag Tomada N° Circ.:Tag Tomada N° Circ.")
tag_byelement = Custom[👓 Tag․ByElement](element=flatten_4, TagLocation=flatten_5, TagType=family_types)  # package BIMCoder Nodes - 2.X; Cria uma Tag em elemento(s) dado o tipo da Tag e a posição

round_2 = Math.Round(number=X, digits=code_block_7)

# group: x
le = round_2 <= code_block_6

# group: y
lt_2 = round < code_block_8

code_block_10 = CodeBlock { true; false; }
condição_if_de_lista_aninhada_2 = CodeBlock(x=le, y=lt_2, cond1=code_block_10.out0, cond2=code_block_10.out1) { indx = (x == true) && (y == true) ? 0 : 1; resultado = [cond1, cond2][indx]; }
filterByBoolMask_7 = List.FilterByBoolMask(list=clean_2, mask=condição_if_de_lista_aninhada_2.resultado, lacing=Longest)
filterByBoolMask_8 = List.FilterByBoolMask(list=facingOrientation, mask=condição_if_de_lista_aninhada_2.resultado)

# group: TAG Horizontal Pos
# Descrição <Clique duas vezes aqui para editar a descrição do grupo>
boolean_7 = BoolSelector(false)
clean_7 = List.Clean(list=filterByBoolMask_7.in, preserveIndices=boolean_7)
flatten_6 = List.Flatten(list=clean_7)
boolean_8 = BoolSelector(false)
clean_8 = List.Clean(list=filterByBoolMask_7.in, preserveIndices=boolean_8)
getLocation_4 = Element.GetLocation(element=clean_8)
boolean_9 = BoolSelector(false)
clean_9 = List.Clean(list=filterByBoolMask_8.in, preserveIndices=boolean_9)
offset_da_tag_2 = DoubleInput(0.5)
translate_3 = Geometry.Translate(geometry=getLocation_4, direction=clean_9, distance=offset_da_tag_2)
facingOrientation_3 = FamilyInstance.FacingOrientation(familyInstance=clean_8)
ZAxis_2 = Vector.ZAxis()
cross_2 = Vector.Cross(vector=facingOrientation_3, cross=ZAxis_2)
offset_da_2ª_tag_2 = DoubleInput(0.2)
translate_4 = Geometry.Translate(geometry=translate_3, direction=cross_2, distance=offset_da_2ª_tag_2)
boolean_10 = BoolSelector(false)
clean_10 = List.Clean(list=translate_4, preserveIndices=boolean_10)
flatten_7 = List.Flatten(list=clean_10)
family_types_2 = FamilyTypes("Tag Tomada N° Circ.:Tag Tomada N° Circ.")
tag_byelement_2 = Custom[👓 Tag․ByElement](element=flatten_6, TagLocation=flatten_7, TagType=family_types_2)
reverse_2 = Vector.Reverse(vector=cross_2)

# group: x
gt = round_2 > code_block_6

# group: y
le_2 = round <= code_block_8

code_block_11 = CodeBlock { true; false; }
condição_if_de_lista_aninhada_3 = CodeBlock(x=gt, y=le_2, cond1=code_block_11.out0, cond2=code_block_11.out1) { indx = (x == true) && (y == true) ? 0 : 1; resultado = [cond1, cond2][indx]; }
filterByBoolMask_9 = List.FilterByBoolMask(list=clean_2, mask=condição_if_de_lista_aninhada_3.resultado, lacing=Longest)
filterByBoolMask_10 = List.FilterByBoolMask(list=facingOrientation, mask=condição_if_de_lista_aninhada_3.resultado)

# group: TAG Vertical Pos
# Descrição <Clique duas vezes aqui para editar a descrição do grupo>
boolean_11 = BoolSelector(false)
clean_11 = List.Clean(list=filterByBoolMask_9.in, preserveIndices=boolean_11)
flatten_8 = List.Flatten(list=clean_11)
boolean_12 = BoolSelector(false)
clean_12 = List.Clean(list=filterByBoolMask_9.in, preserveIndices=boolean_12)
getLocation_5 = Element.GetLocation(element=clean_12)
boolean_13 = BoolSelector(false)
clean_13 = List.Clean(list=filterByBoolMask_10.in, preserveIndices=boolean_13)
ZAxis_3 = Vector.ZAxis()
cross_3 = Vector.Cross(vector=clean_13, cross=ZAxis_3)
offset_da_tag_3 = DoubleInput(0.22)
translate_5 = Geometry.Translate(geometry=getLocation_5, direction=cross_3, distance=offset_da_tag_3)
facingOrientation_4 = FamilyInstance.FacingOrientation(familyInstance=clean_12)
offset_da_2ª_tag_3 = DoubleInput(0.35)
translate_6 = Geometry.Translate(geometry=translate_5, direction=facingOrientation_4, distance=offset_da_2ª_tag_3)
boolean_14 = BoolSelector(false)
clean_14 = List.Clean(list=translate_6, preserveIndices=boolean_14)
flatten_9 = List.Flatten(list=clean_14)
family_types_3 = FamilyTypes("Tag Tomada N° Circ.:Tag Tomada N° Circ.")
tag_byelement_3 = Custom[👓 Tag․ByElement](element=flatten_8, TagLocation=flatten_9, TagType=family_types_3)

# group: x
ge_2 = round_2 >= code_block_6

# group: y
gt_2 = round > code_block_8

code_block_12 = CodeBlock { true; false; }
condição_if_de_lista_aninhada_4 = CodeBlock(x=ge_2, y=gt_2, cond1=code_block_12.out0, cond2=code_block_12.out1) { indx = (x == true) && (y == true) ? 0 : 1; resultado = [cond1, cond2][indx]; }
filterByBoolMask_11 = List.FilterByBoolMask(list=clean_2, mask=condição_if_de_lista_aninhada_4.resultado, lacing=Longest)
filterByBoolMask_12 = List.FilterByBoolMask(list=facingOrientation, mask=condição_if_de_lista_aninhada_4.resultado)

# group: TAG Horizontal Pos
# Descrição <Clique duas vezes aqui para editar a descrição do grupo>
boolean_15 = BoolSelector(false)
clean_15 = List.Clean(list=filterByBoolMask_11.in, preserveIndices=boolean_15)
flatten_10 = List.Flatten(list=clean_15)
boolean_16 = BoolSelector(false)
clean_16 = List.Clean(list=filterByBoolMask_11.in, preserveIndices=boolean_16)
getLocation_6 = Element.GetLocation(element=clean_16)
boolean_17 = BoolSelector(false)
clean_17 = List.Clean(list=filterByBoolMask_12.in, preserveIndices=boolean_17)
offset_da_tag_4 = DoubleInput(0.35)
translate_7 = Geometry.Translate(geometry=getLocation_6, direction=clean_17, distance=offset_da_tag_4)
facingOrientation_5 = FamilyInstance.FacingOrientation(familyInstance=clean_16)
ZAxis_4 = Vector.ZAxis()
cross_4 = Vector.Cross(vector=facingOrientation_5, cross=ZAxis_4)
offset_da_2ª_tag_4 = DoubleInput(0.05)
translate_8 = Geometry.Translate(geometry=translate_7, direction=cross_4, distance=offset_da_2ª_tag_4)
boolean_18 = BoolSelector(false)
clean_18 = List.Clean(list=translate_8, preserveIndices=boolean_18)
flatten_11 = List.Flatten(list=clean_18)
family_types_4 = FamilyTypes("Tag Tomada N° Circ.:Tag Tomada N° Circ.")
tag_byelement_4 = Custom[👓 Tag․ByElement](element=flatten_10, TagLocation=flatten_11, TagType=family_types_4)
reverse_3 = Vector.Reverse(vector=cross_4)

code_block_13 = CodeBlock { 1; }
getItemAtIndex_2 = List.GetItemAtIndex(list=flatten_3, index=code_block_13, lacing=Longest)
boolean_19 = BoolSelector(false)
clean_19 = List.Clean(list=getItemAtIndex_2, preserveIndices=boolean_19)
facingOrientation_6 = FamilyInstance.FacingOrientation(familyInstance=clean_19)
X_2 = Vector.X(vector=facingOrientation_6)
code_block_14 = CodeBlock { 2; }
round_3 = Math.Round(number=X_2, digits=code_block_14)
code_block_15 = CodeBlock { 0; }

# group: x
ge_3 = round_3 >= code_block_15

Y_2 = Vector.Y(vector=facingOrientation_6)
round_4 = Math.Round(number=Y_2, digits=code_block_14)
code_block_16 = CodeBlock { 0; }

# group: y
gt_3 = round_4 > code_block_16

code_block_17 = CodeBlock { true; false; }
condição_if_de_lista_aninhada_5 = CodeBlock(x=ge_3, y=gt_3, cond1=code_block_17.out0, cond2=code_block_17.out1) { indx = (x == true) && (y == true) ? 0 : 1; resultado = [cond1, cond2][indx]; }
filterByBoolMask_13 = List.FilterByBoolMask(list=clean_19, mask=condição_if_de_lista_aninhada_5.resultado, lacing=Longest)
filterByBoolMask_14 = List.FilterByBoolMask(list=facingOrientation_6, mask=condição_if_de_lista_aninhada_5.resultado)

# group: TAG Horizontal Pos
# Descrição <Clique duas vezes aqui para editar a descrição do grupo>
boolean_20 = BoolSelector(false)
clean_20 = List.Clean(list=filterByBoolMask_13.in, preserveIndices=boolean_20)
flatten_12 = List.Flatten(list=clean_20)
boolean_21 = BoolSelector(false)
clean_21 = List.Clean(list=filterByBoolMask_13.in, preserveIndices=boolean_21)
getLocation_7 = Element.GetLocation(element=clean_21)
boolean_22 = BoolSelector(false)
clean_22 = List.Clean(list=filterByBoolMask_14.in, preserveIndices=boolean_22)
offset_da_tag_5 = DoubleInput(0.2)
translate_9 = Geometry.Translate(geometry=getLocation_7, direction=clean_22, distance=offset_da_tag_5)
facingOrientation_7 = FamilyInstance.FacingOrientation(familyInstance=clean_21)
ZAxis_5 = Vector.ZAxis()
cross_5 = Vector.Cross(vector=facingOrientation_7, cross=ZAxis_5)
offset_da_2ª_tag_5 = DoubleInput(0.05)
translate_10 = Geometry.Translate(geometry=translate_9, direction=cross_5, distance=offset_da_2ª_tag_5)
boolean_23 = BoolSelector(false)
clean_23 = List.Clean(list=translate_10, preserveIndices=boolean_23)
flatten_13 = List.Flatten(list=clean_23)
family_types_5 = FamilyTypes("Tag Tomada N° Circ.:Tag Tomada N° Circ.")
tag_byelement_5 = Custom[👓 Tag․ByElement](element=flatten_12, TagLocation=flatten_13, TagType=family_types_5)

# group: x
lt_3 = X_2 < code_block_15

# group: y
ge_4 = round_4 >= code_block_16

code_block_18 = CodeBlock { true; false; }
condição_if_de_lista_aninhada_6 = CodeBlock(x=lt_3, y=ge_4, cond1=code_block_18.out0, cond2=code_block_18.out1) { indx = (x == true) && (y == true) ? 0 : 1; resultado = [cond1, cond2][indx]; }
filterByBoolMask_15 = List.FilterByBoolMask(list=clean_19, mask=condição_if_de_lista_aninhada_6.resultado, lacing=Longest)
filterByBoolMask_16 = List.FilterByBoolMask(list=facingOrientation_6, mask=condição_if_de_lista_aninhada_6.resultado)

# group: TAG Vertical Neg
# Descrição <Clique duas vezes aqui para editar a descrição do grupo>
boolean_24 = BoolSelector(false)
clean_24 = List.Clean(list=filterByBoolMask_15.in, preserveIndices=boolean_24)
flatten_14 = List.Flatten(list=clean_24)
boolean_25 = BoolSelector(false)
clean_25 = List.Clean(list=filterByBoolMask_15.in, preserveIndices=boolean_25)
getLocation_8 = Element.GetLocation(element=clean_25)
boolean_26 = BoolSelector(false)
clean_26 = List.Clean(list=filterByBoolMask_16.in, preserveIndices=boolean_26)
ZAxis_6 = Vector.ZAxis()
cross_6 = Vector.Cross(vector=clean_26, cross=ZAxis_6)
offset_da_tag_6 = DoubleInput(0.1)
translate_11 = Geometry.Translate(geometry=getLocation_8, direction=cross_6, distance=offset_da_tag_6)
facingOrientation_8 = FamilyInstance.FacingOrientation(familyInstance=clean_25)
offset_da_2ª_tag_6 = DoubleInput(0.3)
translate_12 = Geometry.Translate(geometry=translate_11, direction=facingOrientation_8, distance=offset_da_2ª_tag_6)
boolean_27 = BoolSelector(false)
clean_27 = List.Clean(list=translate_12, preserveIndices=boolean_27)
flatten_15 = List.Flatten(list=clean_27)
family_types_6 = FamilyTypes("Tag Tomada N° Circ.:Tag Tomada N° Circ.")
tag_byelement_6 = Custom[👓 Tag․ByElement](element=flatten_14, TagLocation=flatten_15, TagType=family_types_6)

# group: x
le_3 = round_3 <= code_block_15

# group: y
lt_4 = round_4 < code_block_16

code_block_19 = CodeBlock { true; false; }
condição_if_de_lista_aninhada_7 = CodeBlock(x=le_3, y=lt_4, cond1=code_block_19.out0, cond2=code_block_19.out1) { indx = (x == true) && (y == true) ? 0 : 1; resultado = [cond1, cond2][indx]; }
filterByBoolMask_17 = List.FilterByBoolMask(list=clean_19, mask=condição_if_de_lista_aninhada_7.resultado, lacing=Longest)
filterByBoolMask_18 = List.FilterByBoolMask(list=facingOrientation_6, mask=condição_if_de_lista_aninhada_7.resultado)

# group: TAG Horizontal Pos
# Descrição <Clique duas vezes aqui para editar a descrição do grupo>
boolean_28 = BoolSelector(false)
clean_28 = List.Clean(list=filterByBoolMask_17.in, preserveIndices=boolean_28)
flatten_16 = List.Flatten(list=clean_28)
boolean_29 = BoolSelector(false)
clean_29 = List.Clean(list=filterByBoolMask_17.in, preserveIndices=boolean_29)
getLocation_9 = Element.GetLocation(element=clean_29)
boolean_30 = BoolSelector(false)
clean_30 = List.Clean(list=filterByBoolMask_18.in, preserveIndices=boolean_30)
offset_da_tag_7 = DoubleInput(0.35)
translate_13 = Geometry.Translate(geometry=getLocation_9, direction=clean_30, distance=offset_da_tag_7)
facingOrientation_9 = FamilyInstance.FacingOrientation(familyInstance=clean_29)
ZAxis_7 = Vector.ZAxis()
cross_7 = Vector.Cross(vector=facingOrientation_9, cross=ZAxis_7)
offset_da_2ª_tag_7 = DoubleInput(0.2)
translate_14 = Geometry.Translate(geometry=translate_13, direction=cross_7, distance=offset_da_2ª_tag_7)
boolean_31 = BoolSelector(false)
clean_31 = List.Clean(list=translate_14, preserveIndices=boolean_31)
flatten_17 = List.Flatten(list=clean_31)
family_types_7 = FamilyTypes("Tag Tomada N° Circ.:Tag Tomada N° Circ.")
tag_byelement_7 = Custom[👓 Tag․ByElement](element=flatten_16, TagLocation=flatten_17, TagType=family_types_7)

# group: x
gt_4 = round_3 > code_block_15

# group: y
le_4 = round_4 <= code_block_16

code_block_20 = CodeBlock { true; false; }
condição_if_de_lista_aninhada_8 = CodeBlock(x=gt_4, y=le_4, cond1=code_block_20.out0, cond2=code_block_20.out1) { indx = (x == true) && (y == true) ? 0 : 1; resultado = [cond1, cond2][indx]; }
filterByBoolMask_19 = List.FilterByBoolMask(list=clean_19, mask=condição_if_de_lista_aninhada_8.resultado, lacing=Longest)
filterByBoolMask_20 = List.FilterByBoolMask(list=facingOrientation_6, mask=condição_if_de_lista_aninhada_8.resultado)

# group: TAG Vertical Pos
# Descrição <Clique duas vezes aqui para editar a descrição do grupo>
boolean_32 = BoolSelector(false)
clean_32 = List.Clean(list=filterByBoolMask_19.in, preserveIndices=boolean_32)
flatten_18 = List.Flatten(list=clean_32)
boolean_33 = BoolSelector(false)
clean_33 = List.Clean(list=filterByBoolMask_19.in, preserveIndices=boolean_33)
getLocation_10 = Element.GetLocation(element=clean_33)
boolean_34 = BoolSelector(false)
clean_34 = List.Clean(list=filterByBoolMask_20.in, preserveIndices=boolean_34)
ZAxis_8 = Vector.ZAxis()
cross_8 = Vector.Cross(vector=clean_34, cross=ZAxis_8)
offset_da_tag_8 = DoubleInput(0.22)
translate_15 = Geometry.Translate(geometry=getLocation_10, direction=cross_8, distance=offset_da_tag_8)
facingOrientation_10 = FamilyInstance.FacingOrientation(familyInstance=clean_33)
offset_da_2ª_tag_8 = DoubleInput(0.2)
translate_16 = Geometry.Translate(geometry=translate_15, direction=facingOrientation_10, distance=offset_da_2ª_tag_8)
boolean_35 = BoolSelector(false)
clean_35 = List.Clean(list=translate_16, preserveIndices=boolean_35)
flatten_19 = List.Flatten(list=clean_35)
family_types_8 = FamilyTypes("Tag Tomada N° Circ.:Tag Tomada N° Circ.")
tag_byelement_8 = Custom[👓 Tag․ByElement](element=flatten_18, TagLocation=flatten_19, TagType=family_types_8)

string_from_object_5 = FromObject(object=filterByBoolMask_2.out)
code_block_21 = CodeBlock { ["Tomada 2P+T"]; }
contains_5 = String.Contains(string=string_from_object_5@L2, searchFor=code_block_21, lacing=Longest)
filterByBoolMask_21 = List.FilterByBoolMask(list=filterByBoolMask_2.out@L2, mask=contains_5@L2)
boolean_36 = BoolSelector(false)
clean_36 = List.Clean(list=filterByBoolMask_21.in, preserveIndices=boolean_36)
facingOrientation_11 = FamilyInstance.FacingOrientation(familyInstance=clean_36)
X_3 = Vector.X(vector=facingOrientation_11)
code_block_22 = CodeBlock { 2; }
round_5 = Math.Round(number=X_3, digits=code_block_22)
code_block_23 = CodeBlock { 0; }

# group: x
ge_5 = round_5 >= code_block_23

Y_3 = Vector.Y(vector=facingOrientation_11)
round_6 = Math.Round(number=Y_3, digits=code_block_22)
code_block_24 = CodeBlock { 0; }

# group: y
gt_5 = round_6 > code_block_24

code_block_25 = CodeBlock { true; false; }
condição_if_de_lista_aninhada_9 = CodeBlock(x=ge_5, y=gt_5, cond1=code_block_25.out0, cond2=code_block_25.out1) { indx = (x == true) && (y == true) ? 0 : 1; resultado = [cond1, cond2][indx]; }
filterByBoolMask_22 = List.FilterByBoolMask(list=clean_36, mask=condição_if_de_lista_aninhada_9.resultado, lacing=Longest)
filterByBoolMask_23 = List.FilterByBoolMask(list=facingOrientation_11, mask=condição_if_de_lista_aninhada_9.resultado)

# group: TAG Vertical Pos
# Descrição <Clique duas vezes aqui para editar a descrição do grupo>
boolean_37 = BoolSelector(false)
clean_37 = List.Clean(list=filterByBoolMask_22.in, preserveIndices=boolean_37)
flatten_20 = List.Flatten(list=clean_37)
boolean_38 = BoolSelector(false)
clean_38 = List.Clean(list=filterByBoolMask_22.in, preserveIndices=boolean_38)
getLocation_11 = Element.GetLocation(element=clean_38)
boolean_39 = BoolSelector(false)
clean_39 = List.Clean(list=filterByBoolMask_23.in, preserveIndices=boolean_39)
offset_da_tag_9 = DoubleInput(0.1)
translate_17 = Geometry.Translate(geometry=getLocation_11, direction=clean_39, distance=offset_da_tag_9)
facingOrientation_12 = FamilyInstance.FacingOrientation(familyInstance=clean_38)
ZAxis_9 = Vector.ZAxis()
cross_9 = Vector.Cross(vector=facingOrientation_12, cross=ZAxis_9)
offset_da_2ª_tag_9 = DoubleInput(0.05)
translate_18 = Geometry.Translate(geometry=translate_17, direction=cross_9, distance=offset_da_2ª_tag_9)
boolean_40 = BoolSelector(false)
clean_40 = List.Clean(list=translate_18, preserveIndices=boolean_40)
flatten_21 = List.Flatten(list=clean_40)
family_types_9 = FamilyTypes("Tag Tomada N° Circ.:Tag Tomada N° Circ.")
tag_byelement_9 = Custom[👓 Tag․ByElement](element=flatten_20, TagLocation=flatten_21, TagType=family_types_9)

# group: x
lt_5 = X_3 < code_block_23

# group: y
ge_6 = round_6 >= code_block_24

code_block_26 = CodeBlock { true; false; }
condição_if_de_lista_aninhada_10 = CodeBlock(x=lt_5, y=ge_6, cond1=code_block_26.out0, cond2=code_block_26.out1) { indx = (x == true) && (y == true) ? 0 : 1; resultado = [cond1, cond2][indx]; }
filterByBoolMask_24 = List.FilterByBoolMask(list=clean_36, mask=condição_if_de_lista_aninhada_10.resultado, lacing=Longest)
filterByBoolMask_25 = List.FilterByBoolMask(list=facingOrientation_11, mask=condição_if_de_lista_aninhada_10.resultado)

# group: TAG Horizontal Neg
# Descrição <Clique duas vezes aqui para editar a descrição do grupo>
boolean_41 = BoolSelector(false)
clean_41 = List.Clean(list=filterByBoolMask_24.in, preserveIndices=boolean_41)
flatten_22 = List.Flatten(list=clean_41)
boolean_42 = BoolSelector(false)
clean_42 = List.Clean(list=filterByBoolMask_24.in, preserveIndices=boolean_42)
getLocation_12 = Element.GetLocation(element=clean_42)
boolean_43 = BoolSelector(false)
clean_43 = List.Clean(list=filterByBoolMask_25.in, preserveIndices=boolean_43)
ZAxis_10 = Vector.ZAxis()
cross_10 = Vector.Cross(vector=clean_43, cross=ZAxis_10)
offset_da_tag_10 = DoubleInput(0.08)
translate_19 = Geometry.Translate(geometry=getLocation_12, direction=cross_10, distance=offset_da_tag_10)
facingOrientation_13 = FamilyInstance.FacingOrientation(familyInstance=clean_42)
offset_da_2ª_tag_10 = DoubleInput(0.15)
translate_20 = Geometry.Translate(geometry=translate_19, direction=facingOrientation_13, distance=offset_da_2ª_tag_10)
boolean_44 = BoolSelector(false)
clean_44 = List.Clean(list=translate_20, preserveIndices=boolean_44)
flatten_23 = List.Flatten(list=clean_44)
family_types_10 = FamilyTypes("Tag Tomada N° Circ.:Tag Tomada N° Circ.")
tag_byelement_10 = Custom[👓 Tag․ByElement](element=flatten_22, TagLocation=flatten_23, TagType=family_types_10)

# group: x
le_5 = round_5 <= code_block_23

# group: y
lt_6 = round_6 < code_block_24

code_block_27 = CodeBlock { true; false; }
condição_if_de_lista_aninhada_11 = CodeBlock(x=le_5, y=lt_6, cond1=code_block_27.out0, cond2=code_block_27.out1) { indx = (x == true) && (y == true) ? 0 : 1; resultado = [cond1, cond2][indx]; }
filterByBoolMask_26 = List.FilterByBoolMask(list=clean_36, mask=condição_if_de_lista_aninhada_11.resultado, lacing=Longest)
filterByBoolMask_27 = List.FilterByBoolMask(list=facingOrientation_11, mask=condição_if_de_lista_aninhada_11.resultado)

# group: TAG Vertical Neg
# Descrição <Clique duas vezes aqui para editar a descrição do grupo>
boolean_45 = BoolSelector(false)
clean_45 = List.Clean(list=filterByBoolMask_26.in, preserveIndices=boolean_45)
flatten_24 = List.Flatten(list=clean_45)
boolean_46 = BoolSelector(false)
clean_46 = List.Clean(list=filterByBoolMask_26.in, preserveIndices=boolean_46)
getLocation_13 = Element.GetLocation(element=clean_46)
boolean_47 = BoolSelector(false)
clean_47 = List.Clean(list=filterByBoolMask_27.in, preserveIndices=boolean_47)
offset_da_tag_11 = DoubleInput(0.25)
translate_21 = Geometry.Translate(geometry=getLocation_13, direction=clean_47, distance=offset_da_tag_11)
facingOrientation_14 = FamilyInstance.FacingOrientation(familyInstance=clean_46)
ZAxis_11 = Vector.ZAxis()
cross_11 = Vector.Cross(vector=facingOrientation_14, cross=ZAxis_11)
offset_da_2ª_tag_11 = DoubleInput(0.2)
translate_22 = Geometry.Translate(geometry=translate_21, direction=cross_11, distance=offset_da_2ª_tag_11)
boolean_48 = BoolSelector(false)
clean_48 = List.Clean(list=translate_22, preserveIndices=boolean_48)
flatten_25 = List.Flatten(list=clean_48)
family_types_11 = FamilyTypes("Tag Tomada N° Circ.:Tag Tomada N° Circ.")
tag_byelement_11 = Custom[👓 Tag․ByElement](element=flatten_24, TagLocation=flatten_25, TagType=family_types_11)

# group: x
gt_6 = round_5 > code_block_23

# group: y
le_6 = round_6 <= code_block_24

code_block_28 = CodeBlock { true; false; }
condição_if_de_lista_aninhada_12 = CodeBlock(x=gt_6, y=le_6, cond1=code_block_28.out0, cond2=code_block_28.out1) { indx = (x == true) && (y == true) ? 0 : 1; resultado = [cond1, cond2][indx]; }
filterByBoolMask_28 = List.FilterByBoolMask(list=clean_36, mask=condição_if_de_lista_aninhada_12.resultado, lacing=Longest)
filterByBoolMask_29 = List.FilterByBoolMask(list=facingOrientation_11, mask=condição_if_de_lista_aninhada_12.resultado)

# group: TAG Horizontal Pos
# Descrição <Clique duas vezes aqui para editar a descrição do grupo>
boolean_49 = BoolSelector(false)
clean_49 = List.Clean(list=filterByBoolMask_28.in, preserveIndices=boolean_49)
flatten_26 = List.Flatten(list=clean_49)
boolean_50 = BoolSelector(false)
clean_50 = List.Clean(list=filterByBoolMask_28.in, preserveIndices=boolean_50)
getLocation_14 = Element.GetLocation(element=clean_50)
boolean_51 = BoolSelector(false)
clean_51 = List.Clean(list=filterByBoolMask_29.in, preserveIndices=boolean_51)
ZAxis_12 = Vector.ZAxis()
cross_12 = Vector.Cross(vector=clean_51, cross=ZAxis_12)
offset_da_tag_12 = DoubleInput(0.2)
translate_23 = Geometry.Translate(geometry=getLocation_14, direction=cross_12, distance=offset_da_tag_12)
facingOrientation_15 = FamilyInstance.FacingOrientation(familyInstance=clean_50)
offset_da_2ª_tag_12 = DoubleInput(0.15)
translate_24 = Geometry.Translate(geometry=translate_23, direction=facingOrientation_15, distance=offset_da_2ª_tag_12)
boolean_52 = BoolSelector(false)
clean_52 = List.Clean(list=translate_24, preserveIndices=boolean_52)
flatten_27 = List.Flatten(list=clean_52)
family_types_12 = FamilyTypes("Tag Tomada N° Circ.:Tag Tomada N° Circ.")
tag_byelement_12 = Custom[👓 Tag․ByElement](element=flatten_26, TagLocation=flatten_27, TagType=family_types_12)

getLocation_15 = Element.GetLocation(element=clean_36)
byStartPointDirectionLength = Line.ByStartPointDirectionLength(startPoint=getLocation_15, direction=facingOrientation_11)
code_block_29 = CodeBlock { 0; }
getItemAtIndex_3 = List.GetItemAtIndex(list=flatten_3, index=code_block_29, lacing=Longest)
boolean_53 = BoolSelector(false)
clean_53 = List.Clean(list=getItemAtIndex_3, preserveIndices=boolean_53)
facingOrientation_16 = FamilyInstance.FacingOrientation(familyInstance=clean_53)
X_4 = Vector.X(vector=facingOrientation_16)
code_block_30 = CodeBlock { 2; }
round_7 = Math.Round(number=X_4, digits=code_block_30)
code_block_31 = CodeBlock { 0; }

# group: x
ge_7 = round_7 >= code_block_31

Y_4 = Vector.Y(vector=facingOrientation_16)
round_8 = Math.Round(number=Y_4, digits=code_block_30)
code_block_32 = CodeBlock { 0; }

# group: y
gt_7 = round_8 > code_block_32

code_block_33 = CodeBlock { true; false; }
condição_if_de_lista_aninhada_13 = CodeBlock(x=ge_7, y=gt_7, cond1=code_block_33.out0, cond2=code_block_33.out1) { indx = (x == true) && (y == true) ? 0 : 1; resultado = [cond1, cond2][indx]; }
filterByBoolMask_30 = List.FilterByBoolMask(list=clean_53, mask=condição_if_de_lista_aninhada_13.resultado, lacing=Longest)
filterByBoolMask_31 = List.FilterByBoolMask(list=facingOrientation_16, mask=condição_if_de_lista_aninhada_13.resultado)

# group: TAG Horizontal Pos
# Descrição <Clique duas vezes aqui para editar a descrição do grupo>
boolean_54 = BoolSelector(false)
clean_54 = List.Clean(list=filterByBoolMask_30.in, preserveIndices=boolean_54)
flatten_28 = List.Flatten(list=clean_54)
boolean_55 = BoolSelector(false)
clean_55 = List.Clean(list=filterByBoolMask_30.in, preserveIndices=boolean_55)
getLocation_16 = Element.GetLocation(element=clean_55)
boolean_56 = BoolSelector(false)
clean_56 = List.Clean(list=filterByBoolMask_31.in, preserveIndices=boolean_56)
offset_da_tag_13 = DoubleInput(0.05)
translate_25 = Geometry.Translate(geometry=getLocation_16, direction=clean_56, distance=offset_da_tag_13)
facingOrientation_17 = FamilyInstance.FacingOrientation(familyInstance=clean_55)
ZAxis_13 = Vector.ZAxis()
cross_13 = Vector.Cross(vector=facingOrientation_17, cross=ZAxis_13)
offset_da_2ª_tag_13 = DoubleInput(0.05)
translate_26 = Geometry.Translate(geometry=translate_25, direction=cross_13, distance=offset_da_2ª_tag_13)
boolean_57 = BoolSelector(false)
clean_57 = List.Clean(list=translate_26, preserveIndices=boolean_57)
flatten_29 = List.Flatten(list=clean_57)
family_types_13 = FamilyTypes("Tag Tomada N° Circ.:Tag Tomada N° Circ.")
tag_byelement_13 = Custom[👓 Tag․ByElement](element=flatten_28, TagLocation=flatten_29, TagType=family_types_13)

# group: x
lt_7 = X_4 < code_block_31

# group: y
ge_8 = round_8 >= code_block_32

code_block_34 = CodeBlock { true; false; }
condição_if_de_lista_aninhada_14 = CodeBlock(x=lt_7, y=ge_8, cond1=code_block_34.out0, cond2=code_block_34.out1) { indx = (x == true) && (y == true) ? 0 : 1; resultado = [cond1, cond2][indx]; }
filterByBoolMask_32 = List.FilterByBoolMask(list=clean_53, mask=condição_if_de_lista_aninhada_14.resultado, lacing=Longest)
filterByBoolMask_33 = List.FilterByBoolMask(list=facingOrientation_16, mask=condição_if_de_lista_aninhada_14.resultado)

# group: TAG Vertical Neg
# Descrição <Clique duas vezes aqui para editar a descrição do grupo>
boolean_58 = BoolSelector(false)
clean_58 = List.Clean(list=filterByBoolMask_32.in, preserveIndices=boolean_58)
flatten_30 = List.Flatten(list=clean_58)
boolean_59 = BoolSelector(false)
clean_59 = List.Clean(list=filterByBoolMask_32.in, preserveIndices=boolean_59)
getLocation_17 = Element.GetLocation(element=clean_59)
boolean_60 = BoolSelector(false)
clean_60 = List.Clean(list=filterByBoolMask_33.in, preserveIndices=boolean_60)
ZAxis_14 = Vector.ZAxis()
cross_14 = Vector.Cross(vector=clean_60, cross=ZAxis_14)
offset_da_tag_14 = DoubleInput(0.1)
translate_27 = Geometry.Translate(geometry=getLocation_17, direction=cross_14, distance=offset_da_tag_14)
facingOrientation_18 = FamilyInstance.FacingOrientation(familyInstance=clean_59)
offset_da_2ª_tag_14 = DoubleInput(0.15)
translate_28 = Geometry.Translate(geometry=translate_27, direction=facingOrientation_18, distance=offset_da_2ª_tag_14)
boolean_61 = BoolSelector(false)
clean_61 = List.Clean(list=translate_28, preserveIndices=boolean_61)
flatten_31 = List.Flatten(list=clean_61)
family_types_14 = FamilyTypes("Tag Tomada N° Circ.:Tag Tomada N° Circ.")
tag_byelement_14 = Custom[👓 Tag․ByElement](element=flatten_30, TagLocation=flatten_31, TagType=family_types_14)

# group: x
le_7 = round_7 <= code_block_31

# group: y
lt_8 = round_8 < code_block_32

code_block_35 = CodeBlock { true; false; }
condição_if_de_lista_aninhada_15 = CodeBlock(x=le_7, y=lt_8, cond1=code_block_35.out0, cond2=code_block_35.out1) { indx = (x == true) && (y == true) ? 0 : 1; resultado = [cond1, cond2][indx]; }
filterByBoolMask_34 = List.FilterByBoolMask(list=clean_53, mask=condição_if_de_lista_aninhada_15.resultado, lacing=Longest)
filterByBoolMask_35 = List.FilterByBoolMask(list=facingOrientation_16, mask=condição_if_de_lista_aninhada_15.resultado)

# group: TAG Horizontal Pos
# Descrição <Clique duas vezes aqui para editar a descrição do grupo>
boolean_62 = BoolSelector(false)
clean_62 = List.Clean(list=filterByBoolMask_34.in, preserveIndices=boolean_62)
flatten_32 = List.Flatten(list=clean_62)
boolean_63 = BoolSelector(false)
clean_63 = List.Clean(list=filterByBoolMask_34.in, preserveIndices=boolean_63)
getLocation_18 = Element.GetLocation(element=clean_63)
boolean_64 = BoolSelector(false)
clean_64 = List.Clean(list=filterByBoolMask_35.in, preserveIndices=boolean_64)
offset_da_tag_15 = DoubleInput(0.2)
translate_29 = Geometry.Translate(geometry=getLocation_18, direction=clean_64, distance=offset_da_tag_15)
facingOrientation_19 = FamilyInstance.FacingOrientation(familyInstance=clean_63)
ZAxis_15 = Vector.ZAxis()
cross_15 = Vector.Cross(vector=facingOrientation_19, cross=ZAxis_15)
offset_da_2ª_tag_15 = DoubleInput(0.2)
translate_30 = Geometry.Translate(geometry=translate_29, direction=cross_15, distance=offset_da_2ª_tag_15)
boolean_65 = BoolSelector(false)
clean_65 = List.Clean(list=translate_30, preserveIndices=boolean_65)
flatten_33 = List.Flatten(list=clean_65)
family_types_15 = FamilyTypes("Tag Tomada N° Circ.:Tag Tomada N° Circ.")
tag_byelement_15 = Custom[👓 Tag․ByElement](element=flatten_32, TagLocation=flatten_33, TagType=family_types_15)

# group: x
gt_8 = round_7 > code_block_31

# group: y
le_8 = round_8 <= code_block_32

code_block_36 = CodeBlock { true; false; }
condição_if_de_lista_aninhada_16 = CodeBlock(x=gt_8, y=le_8, cond1=code_block_36.out0, cond2=code_block_36.out1) { indx = (x == true) && (y == true) ? 0 : 1; resultado = [cond1, cond2][indx]; }
filterByBoolMask_36 = List.FilterByBoolMask(list=clean_53, mask=condição_if_de_lista_aninhada_16.resultado, lacing=Longest)
filterByBoolMask_37 = List.FilterByBoolMask(list=facingOrientation_16, mask=condição_if_de_lista_aninhada_16.resultado)

# group: TAG Vertical Pos
# Descrição <Clique duas vezes aqui para editar a descrição do grupo>
boolean_66 = BoolSelector(false)
clean_66 = List.Clean(list=filterByBoolMask_36.in, preserveIndices=boolean_66)
flatten_34 = List.Flatten(list=clean_66)
boolean_67 = BoolSelector(false)
clean_67 = List.Clean(list=filterByBoolMask_36.in, preserveIndices=boolean_67)
getLocation_19 = Element.GetLocation(element=clean_67)
boolean_68 = BoolSelector(false)
clean_68 = List.Clean(list=filterByBoolMask_37.in, preserveIndices=boolean_68)
ZAxis_16 = Vector.ZAxis()
cross_16 = Vector.Cross(vector=clean_68, cross=ZAxis_16)
offset_da_tag_16 = DoubleInput(0.22)
translate_31 = Geometry.Translate(geometry=getLocation_19, direction=cross_16, distance=offset_da_tag_16)
facingOrientation_20 = FamilyInstance.FacingOrientation(familyInstance=clean_67)
offset_da_2ª_tag_16 = DoubleInput(0.05)
translate_32 = Geometry.Translate(geometry=translate_31, direction=facingOrientation_20, distance=offset_da_2ª_tag_16)
boolean_69 = BoolSelector(false)
clean_69 = List.Clean(list=translate_32, preserveIndices=boolean_69)
flatten_35 = List.Flatten(list=clean_69)
family_types_16 = FamilyTypes("Tag Tomada N° Circ.:Tag Tomada N° Circ.")
tag_byelement_16 = Custom[👓 Tag․ByElement](element=flatten_34, TagLocation=flatten_35, TagType=family_types_16)

getChildElements_2 = Element.GetChildElements(element=filterByBoolMask_2.in)
string_from_object_6 = FromObject(object=getChildElements_2)
code_block_37 = CodeBlock { ["Caixa de Luz"]; }
contains_6 = String.Contains(string=string_from_object_6@L2, searchFor=code_block_37, lacing=Longest)
filterByBoolMask_38 = List.FilterByBoolMask(list=getChildElements_2@L2, mask=contains_6@L2)
string_from_object_7 = FromObject(object=filterByBoolMask_38.out)
code_block_38 = CodeBlock { ["Tomada"]; }
contains_7 = String.Contains(string=string_from_object_7@L2, searchFor=code_block_38, lacing=Longest)
filterByBoolMask_39 = List.FilterByBoolMask(list=filterByBoolMask_38.out@L2, mask=contains_7@L2)
boolean_70 = BoolSelector(false)
clean_70 = List.Clean(list=filterByBoolMask_39.in, preserveIndices=boolean_70)
getLocation_20 = Element.GetLocation(element=clean_70)
Z_2 = Point.Z(point=getLocation_20)
sortByKey_2 = List.SortByKey(list=clean_70, keys=Z_2, lacing=Longest)
boolean_71 = BoolSelector(false)
clean_71 = List.Clean(list=sortByKey_2.sortedList, preserveIndices=boolean_71)
facingOrientation_21 = FamilyInstance.FacingOrientation(familyInstance=clean_71)
X_5 = Vector.X(vector=facingOrientation_21)
code_block_39 = CodeBlock { 2; }
round_9 = Math.Round(number=X_5, digits=code_block_39)
code_block_40 = CodeBlock { 0; }

# group: x
ge_9 = round_9 >= code_block_40

Y_5 = Vector.Y(vector=facingOrientation_21)
round_10 = Math.Round(number=Y_5, digits=code_block_39)
code_block_41 = CodeBlock { 0; }

# group: y
gt_9 = round_10 > code_block_41

code_block_42 = CodeBlock { true; false; }
condição_if_de_lista_aninhada_17 = CodeBlock(x=ge_9, y=gt_9, cond1=code_block_42.out0, cond2=code_block_42.out1) { indx = (x == true) && (y == true) ? 0 : 1; resultado = [cond1, cond2][indx]; }
filterByBoolMask_40 = List.FilterByBoolMask(list=clean_71, mask=condição_if_de_lista_aninhada_17.resultado, lacing=Longest)
filterByBoolMask_41 = List.FilterByBoolMask(list=facingOrientation_21, mask=condição_if_de_lista_aninhada_17.resultado)

# group: TAG Horizontal Pos
# Descrição <Clique duas vezes aqui para editar a descrição do grupo>
boolean_72 = BoolSelector(false)
clean_72 = List.Clean(list=filterByBoolMask_40.in, preserveIndices=boolean_72)
flatten_36 = List.Flatten(list=clean_72)
boolean_73 = BoolSelector(false)
clean_73 = List.Clean(list=filterByBoolMask_40.in, preserveIndices=boolean_73)
getLocation_21 = Element.GetLocation(element=clean_73)
boolean_74 = BoolSelector(false)
clean_74 = List.Clean(list=filterByBoolMask_41.in, preserveIndices=boolean_74)
offset_da_tag_17 = DoubleInput(0.15)
translate_33 = Geometry.Translate(geometry=getLocation_21, direction=clean_74, distance=offset_da_tag_17)
facingOrientation_22 = FamilyInstance.FacingOrientation(familyInstance=clean_73)
ZAxis_17 = Vector.ZAxis()
cross_17 = Vector.Cross(vector=facingOrientation_22, cross=ZAxis_17)
reverse_4 = Vector.Reverse(vector=cross_17)
offset_da_2ª_tag_17 = DoubleInput(0.25)
translate_34 = Geometry.Translate(geometry=translate_33, direction=reverse_4, distance=offset_da_2ª_tag_17)
boolean_75 = BoolSelector(false)
clean_75 = List.Clean(list=translate_34, preserveIndices=boolean_75)
flatten_37 = List.Flatten(list=clean_75)
family_types_17 = FamilyTypes("Tag Tomada N° Circ.:Tag Tomada N° Circ.")
tag_byelement_17 = Custom[👓 Tag․ByElement](element=flatten_36, TagLocation=flatten_37, TagType=family_types_17)

# group: x
lt_9 = X_5 < code_block_40

# group: y
ge_10 = round_10 >= code_block_41

code_block_43 = CodeBlock { true; false; }
condição_if_de_lista_aninhada_18 = CodeBlock(x=lt_9, y=ge_10, cond1=code_block_43.out0, cond2=code_block_43.out1) { indx = (x == true) && (y == true) ? 0 : 1; resultado = [cond1, cond2][indx]; }
filterByBoolMask_42 = List.FilterByBoolMask(list=clean_71, mask=condição_if_de_lista_aninhada_18.resultado, lacing=Longest)
filterByBoolMask_43 = List.FilterByBoolMask(list=facingOrientation_21, mask=condição_if_de_lista_aninhada_18.resultado)

# group: TAG Vertical Neg
# Descrição <Clique duas vezes aqui para editar a descrição do grupo>
boolean_76 = BoolSelector(false)
clean_76 = List.Clean(list=filterByBoolMask_42.in, preserveIndices=boolean_76)
flatten_38 = List.Flatten(list=clean_76)
boolean_77 = BoolSelector(false)
clean_77 = List.Clean(list=filterByBoolMask_42.in, preserveIndices=boolean_77)
getLocation_22 = Element.GetLocation(element=clean_77)
boolean_78 = BoolSelector(false)
clean_78 = List.Clean(list=filterByBoolMask_43.in, preserveIndices=boolean_78)
ZAxis_18 = Vector.ZAxis()
cross_18 = Vector.Cross(vector=clean_78, cross=ZAxis_18)
reverse_5 = Vector.Reverse(vector=cross_18)
offset_da_tag_18 = DoubleInput(0.3)
translate_35 = Geometry.Translate(geometry=getLocation_22, direction=reverse_5, distance=offset_da_tag_18)
facingOrientation_23 = FamilyInstance.FacingOrientation(familyInstance=clean_77)
offset_da_2ª_tag_18 = DoubleInput(0.3)
translate_36 = Geometry.Translate(geometry=translate_35, direction=facingOrientation_23, distance=offset_da_2ª_tag_18)
boolean_79 = BoolSelector(false)
clean_79 = List.Clean(list=translate_36, preserveIndices=boolean_79)
flatten_39 = List.Flatten(list=clean_79)
family_types_18 = FamilyTypes("Tag Tomada N° Circ.:Tag Tomada N° Circ.")
tag_byelement_18 = Custom[👓 Tag․ByElement](element=flatten_38, TagLocation=flatten_39, TagType=family_types_18)

# group: x
le_9 = round_9 <= code_block_40

# group: y
lt_10 = round_10 < code_block_41

code_block_44 = CodeBlock { true; false; }
condição_if_de_lista_aninhada_19 = CodeBlock(x=le_9, y=lt_10, cond1=code_block_44.out0, cond2=code_block_44.out1) { indx = (x == true) && (y == true) ? 0 : 1; resultado = [cond1, cond2][indx]; }
filterByBoolMask_44 = List.FilterByBoolMask(list=clean_71, mask=condição_if_de_lista_aninhada_19.resultado, lacing=Longest)
filterByBoolMask_45 = List.FilterByBoolMask(list=facingOrientation_21, mask=condição_if_de_lista_aninhada_19.resultado)

# group: TAG Horizontal Pos
# Descrição <Clique duas vezes aqui para editar a descrição do grupo>
boolean_80 = BoolSelector(false)
clean_80 = List.Clean(list=filterByBoolMask_44.in, preserveIndices=boolean_80)
flatten_40 = List.Flatten(list=clean_80)
boolean_81 = BoolSelector(false)
clean_81 = List.Clean(list=filterByBoolMask_44.in, preserveIndices=boolean_81)
getLocation_23 = Element.GetLocation(element=clean_81)
boolean_82 = BoolSelector(false)
clean_82 = List.Clean(list=filterByBoolMask_45.in, preserveIndices=boolean_82)
offset_da_tag_19 = DoubleInput(0.25)
translate_37 = Geometry.Translate(geometry=getLocation_23, direction=clean_82, distance=offset_da_tag_19)
facingOrientation_24 = FamilyInstance.FacingOrientation(familyInstance=clean_81)
ZAxis_19 = Vector.ZAxis()
cross_19 = Vector.Cross(vector=facingOrientation_24, cross=ZAxis_19)
reverse_6 = Vector.Reverse(vector=cross_19)
offset_da_2ª_tag_19 = DoubleInput(0.15)
translate_38 = Geometry.Translate(geometry=translate_37, direction=reverse_6, distance=offset_da_2ª_tag_19)
boolean_83 = BoolSelector(false)
clean_83 = List.Clean(list=translate_38, preserveIndices=boolean_83)
flatten_41 = List.Flatten(list=clean_83)
family_types_19 = FamilyTypes("Tag Tomada N° Circ.:Tag Tomada N° Circ.")
tag_byelement_19 = Custom[👓 Tag․ByElement](element=flatten_40, TagLocation=flatten_41, TagType=family_types_19)

# group: x
gt_10 = round_9 > code_block_40

# group: y
le_10 = round_10 <= code_block_41

code_block_45 = CodeBlock { true; false; }
condição_if_de_lista_aninhada_20 = CodeBlock(x=gt_10, y=le_10, cond1=code_block_45.out0, cond2=code_block_45.out1) { indx = (x == true) && (y == true) ? 0 : 1; resultado = [cond1, cond2][indx]; }
filterByBoolMask_46 = List.FilterByBoolMask(list=clean_71, mask=condição_if_de_lista_aninhada_20.resultado, lacing=Longest)
filterByBoolMask_47 = List.FilterByBoolMask(list=facingOrientation_21, mask=condição_if_de_lista_aninhada_20.resultado)

# group: TAG Vertical Pos
# Descrição <Clique duas vezes aqui para editar a descrição do grupo>
boolean_84 = BoolSelector(false)
clean_84 = List.Clean(list=filterByBoolMask_46.in, preserveIndices=boolean_84)
flatten_42 = List.Flatten(list=clean_84)
boolean_85 = BoolSelector(false)
clean_85 = List.Clean(list=filterByBoolMask_46.in, preserveIndices=boolean_85)
getLocation_24 = Element.GetLocation(element=clean_85)
boolean_86 = BoolSelector(false)
clean_86 = List.Clean(list=filterByBoolMask_47.in, preserveIndices=boolean_86)
ZAxis_20 = Vector.ZAxis()
cross_20 = Vector.Cross(vector=clean_86, cross=ZAxis_20)
reverse_7 = Vector.Reverse(vector=cross_20)
offset_da_tag_20 = DoubleInput(0.15)
translate_39 = Geometry.Translate(geometry=getLocation_24, direction=reverse_7, distance=offset_da_tag_20)
facingOrientation_25 = FamilyInstance.FacingOrientation(familyInstance=clean_85)
offset_da_2ª_tag_20 = DoubleInput(0.15)
translate_40 = Geometry.Translate(geometry=translate_39, direction=facingOrientation_25, distance=offset_da_2ª_tag_20)
boolean_87 = BoolSelector(false)
clean_87 = List.Clean(list=translate_40, preserveIndices=boolean_87)
flatten_43 = List.Flatten(list=clean_87)
family_types_20 = FamilyTypes("Tag Tomada N° Circ.:Tag Tomada N° Circ.")
tag_byelement_20 = Custom[👓 Tag․ByElement](element=flatten_42, TagLocation=flatten_43, TagType=family_types_20)

getLocation_25 = Element.GetLocation(element=clean_71)
byStartPointDirectionLength_2 = Line.ByStartPointDirectionLength(startPoint=getLocation_25, direction=facingOrientation_21)
string_from_object_8 = FromObject(object=uniqueItems)
code_block_46 = CodeBlock { ["Ponto de Força"]; }
contains_8 = String.Contains(string=string_from_object_8@L2, searchFor=code_block_46, lacing=Longest)
filterByBoolMask_48 = List.FilterByBoolMask(list=uniqueItems@L2, mask=contains_8@L2)
boolean_88 = BoolSelector(false)
clean_88 = List.Clean(list=filterByBoolMask_48.in, preserveIndices=boolean_88)
facingOrientation_26 = FamilyInstance.FacingOrientation(familyInstance=clean_88)
X_6 = Vector.X(vector=facingOrientation_26)
code_block_47 = CodeBlock { 2; }
round_11 = Math.Round(number=X_6, digits=code_block_47)
code_block_48 = CodeBlock { 0; }

# group: x
ge_11 = round_11 >= code_block_48

Y_6 = Vector.Y(vector=facingOrientation_26)
round_12 = Math.Round(number=Y_6, digits=code_block_47)
code_block_49 = CodeBlock { 0; }

# group: y
gt_11 = round_12 > code_block_49

code_block_50 = CodeBlock { true; false; }
condição_if_de_lista_aninhada_21 = CodeBlock(x=ge_11, y=gt_11, cond1=code_block_50.out0, cond2=code_block_50.out1) { indx = (x == true) && (y == true) ? 0 : 1; resultado = [cond1, cond2][indx]; }
filterByBoolMask_49 = List.FilterByBoolMask(list=clean_88, mask=condição_if_de_lista_aninhada_21.resultado, lacing=Longest)
filterByBoolMask_50 = List.FilterByBoolMask(list=facingOrientation_26, mask=condição_if_de_lista_aninhada_21.resultado)

# group: TAG Horizontal Pos
# Descrição <Clique duas vezes aqui para editar a descrição do grupo>
boolean_89 = BoolSelector(false)
clean_89 = List.Clean(list=filterByBoolMask_49.in, preserveIndices=boolean_89)
flatten_44 = List.Flatten(list=clean_89)
boolean_90 = BoolSelector(false)
clean_90 = List.Clean(list=filterByBoolMask_49.in, preserveIndices=boolean_90)
getLocation_26 = Element.GetLocation(element=clean_90)
boolean_91 = BoolSelector(false)
clean_91 = List.Clean(list=filterByBoolMask_50.in, preserveIndices=boolean_91)
offset_da_tag_21 = DoubleInput(0.2)
translate_41 = Geometry.Translate(geometry=getLocation_26, direction=clean_91, distance=offset_da_tag_21)
facingOrientation_27 = FamilyInstance.FacingOrientation(familyInstance=clean_90)
ZAxis_21 = Vector.ZAxis()
cross_21 = Vector.Cross(vector=facingOrientation_27, cross=ZAxis_21)
offset_da_2ª_tag_21 = DoubleInput(0.25)
translate_42 = Geometry.Translate(geometry=translate_41, direction=cross_21, distance=offset_da_2ª_tag_21)
boolean_92 = BoolSelector(false)
clean_92 = List.Clean(list=translate_42, preserveIndices=boolean_92)
flatten_45 = List.Flatten(list=clean_92)
family_types_21 = FamilyTypes()  # nothing selected
tag_byelement_21 = Custom[👓 Tag․ByElement](element=flatten_44, TagLocation=flatten_45, TagType=family_types_21)

# group: x
lt_11 = X_6 < code_block_48

# group: y
ge_12 = round_12 >= code_block_49

code_block_51 = CodeBlock { true; false; }
condição_if_de_lista_aninhada_22 = CodeBlock(x=lt_11, y=ge_12, cond1=code_block_51.out0, cond2=code_block_51.out1) { indx = (x == true) && (y == true) ? 0 : 1; resultado = [cond1, cond2][indx]; }
filterByBoolMask_51 = List.FilterByBoolMask(list=clean_88, mask=condição_if_de_lista_aninhada_22.resultado, lacing=Longest)
filterByBoolMask_52 = List.FilterByBoolMask(list=facingOrientation_26, mask=condição_if_de_lista_aninhada_22.resultado)

# group: TAG Vertical Neg
# Descrição <Clique duas vezes aqui para editar a descrição do grupo>
boolean_93 = BoolSelector(false)
clean_93 = List.Clean(list=filterByBoolMask_51.in, preserveIndices=boolean_93)
flatten_46 = List.Flatten(list=clean_93)
boolean_94 = BoolSelector(false)
clean_94 = List.Clean(list=filterByBoolMask_51.in, preserveIndices=boolean_94)
getLocation_27 = Element.GetLocation(element=clean_94)
boolean_95 = BoolSelector(false)
clean_95 = List.Clean(list=filterByBoolMask_52.in, preserveIndices=boolean_95)
ZAxis_22 = Vector.ZAxis()
cross_22 = Vector.Cross(vector=clean_95, cross=ZAxis_22)
offset_da_tag_22 = DoubleInput(0.15)
translate_43 = Geometry.Translate(geometry=getLocation_27, direction=cross_22, distance=offset_da_tag_22)
facingOrientation_28 = FamilyInstance.FacingOrientation(familyInstance=clean_94)
offset_da_2ª_tag_22 = DoubleInput(0.2)
translate_44 = Geometry.Translate(geometry=translate_43, direction=facingOrientation_28, distance=offset_da_2ª_tag_22)
boolean_96 = BoolSelector(false)
clean_96 = List.Clean(list=translate_44, preserveIndices=boolean_96)
flatten_47 = List.Flatten(list=clean_96)
family_types_22 = FamilyTypes()  # nothing selected
tag_byelement_22 = Custom[👓 Tag․ByElement](element=flatten_46, TagLocation=flatten_47, TagType=family_types_22)

# group: x
le_11 = round_11 <= code_block_48

# group: y
lt_12 = round_12 < code_block_49

code_block_52 = CodeBlock { true; false; }
condição_if_de_lista_aninhada_23 = CodeBlock(x=le_11, y=lt_12, cond1=code_block_52.out0, cond2=code_block_52.out1) { indx = (x == true) && (y == true) ? 0 : 1; resultado = [cond1, cond2][indx]; }
filterByBoolMask_53 = List.FilterByBoolMask(list=clean_88, mask=condição_if_de_lista_aninhada_23.resultado, lacing=Longest)
filterByBoolMask_54 = List.FilterByBoolMask(list=facingOrientation_26, mask=condição_if_de_lista_aninhada_23.resultado)

# group: TAG Horizontal Pos
# Descrição <Clique duas vezes aqui para editar a descrição do grupo>
boolean_97 = BoolSelector(false)
clean_97 = List.Clean(list=filterByBoolMask_53.in, preserveIndices=boolean_97)
flatten_48 = List.Flatten(list=clean_97)
boolean_98 = BoolSelector(false)
clean_98 = List.Clean(list=filterByBoolMask_53.in, preserveIndices=boolean_98)
getLocation_28 = Element.GetLocation(element=clean_98)
boolean_99 = BoolSelector(false)
clean_99 = List.Clean(list=filterByBoolMask_54.in, preserveIndices=boolean_99)
offset_da_tag_23 = DoubleInput(0.3)
translate_45 = Geometry.Translate(geometry=getLocation_28, direction=clean_99, distance=offset_da_tag_23)
facingOrientation_29 = FamilyInstance.FacingOrientation(familyInstance=clean_98)
ZAxis_23 = Vector.ZAxis()
cross_23 = Vector.Cross(vector=facingOrientation_29, cross=ZAxis_23)
offset_da_2ª_tag_23 = DoubleInput(0.25)
translate_46 = Geometry.Translate(geometry=translate_45, direction=cross_23, distance=offset_da_2ª_tag_23)
boolean_100 = BoolSelector(false)
clean_100 = List.Clean(list=translate_46, preserveIndices=boolean_100)
flatten_49 = List.Flatten(list=clean_100)
family_types_23 = FamilyTypes()  # nothing selected
tag_byelement_23 = Custom[👓 Tag․ByElement](element=flatten_48, TagLocation=flatten_49, TagType=family_types_23)

# group: x
gt_12 = round_11 > code_block_48

# group: y
le_12 = round_12 <= code_block_49

code_block_53 = CodeBlock { true; false; }
condição_if_de_lista_aninhada_24 = CodeBlock(x=gt_12, y=le_12, cond1=code_block_53.out0, cond2=code_block_53.out1) { indx = (x == true) && (y == true) ? 0 : 1; resultado = [cond1, cond2][indx]; }
filterByBoolMask_55 = List.FilterByBoolMask(list=clean_88, mask=condição_if_de_lista_aninhada_24.resultado, lacing=Longest)
filterByBoolMask_56 = List.FilterByBoolMask(list=facingOrientation_26, mask=condição_if_de_lista_aninhada_24.resultado)

# group: TAG Vertical Pos
# Descrição <Clique duas vezes aqui para editar a descrição do grupo>
boolean_101 = BoolSelector(false)
clean_101 = List.Clean(list=filterByBoolMask_55.in, preserveIndices=boolean_101)
flatten_50 = List.Flatten(list=clean_101)
boolean_102 = BoolSelector(false)
clean_102 = List.Clean(list=filterByBoolMask_55.in, preserveIndices=boolean_102)
getLocation_29 = Element.GetLocation(element=clean_102)
boolean_103 = BoolSelector(false)
clean_103 = List.Clean(list=filterByBoolMask_56.in, preserveIndices=boolean_103)
ZAxis_24 = Vector.ZAxis()
cross_24 = Vector.Cross(vector=clean_103, cross=ZAxis_24)
offset_da_tag_24 = DoubleInput(0.3)
translate_47 = Geometry.Translate(geometry=getLocation_29, direction=cross_24, distance=offset_da_tag_24)
facingOrientation_30 = FamilyInstance.FacingOrientation(familyInstance=clean_102)
offset_da_2ª_tag_24 = DoubleInput(0.2)
translate_48 = Geometry.Translate(geometry=translate_47, direction=facingOrientation_30, distance=offset_da_2ª_tag_24)
boolean_104 = BoolSelector(false)
clean_104 = List.Clean(list=translate_48, preserveIndices=boolean_104)
flatten_51 = List.Flatten(list=clean_104)
family_types_24 = FamilyTypes()  # nothing selected
tag_byelement_24 = Custom[👓 Tag․ByElement](element=flatten_50, TagLocation=flatten_51, TagType=family_types_24)

getLocation_30 = Element.GetLocation(element=clean_88)
byStartPointDirectionLength_3 = Line.ByStartPointDirectionLength(startPoint=getLocation_30, direction=facingOrientation_26)
reverse_8 = List.Reverse(list=sortByKey.sortedKeys, lacing=Longest)
getLocation_31 = Element.GetLocation(element=clean_53)
byStartPointDirectionLength_4 = Line.ByStartPointDirectionLength(startPoint=getLocation_31, direction=facingOrientation_16)
getLocation_32 = Element.GetLocation(element=clean_19)
byStartPointDirectionLength_5 = Line.ByStartPointDirectionLength(startPoint=getLocation_32, direction=facingOrientation_6)
