# Dynamo graph 10-8_BIMACON_Tags de Tomadas_R02_script.dyn "10-8_BIMACON_Tags de Tomadas_R01_script" (Dynamo 2.6.1.8786)
# Inseri Tags de comandos dos Interruptores
# packages: BIMCoder Nodes - 2.X 2025.1.0, Data-Shapes 2022.2.105

# group: SELECIONE O MODELO DE TAGS
code_block = CodeBlock { "TAGs Tomadas"; }
string = StringInput("LogoBimacon.png")
python_script = Python(IN[0]=string)
# ---------- python_script.python (22 lines) ----------
import clr

# Adiciona referência ao ambiente .NET
clr.AddReference('System')
from System import Environment, IO

# Nome da imagem (entrada do usuário)
nome_arquivo_imagem = IN[0]

# Recupera o nome do usuário logado no Windows
usuario = Environment.UserName

# Monta o caminho completo para a pasta de imagens
caminho_base = r"C:\Users\{0}\AppData\Roaming\pyRevit\Extensions\Bimacon.extension\Bimacon.tab\Imagens_Bimacon".format(usuario)

# Junta o caminho base com o nome do arquivo
caminho_completo = IO.Path.Combine(caminho_base, nome_arquivo_imagem)

# Verifica se o arquivo existe
existe = IO.File.Exists(caminho_completo)

OUT = caminho_completo if existe else "Imagem não encontrada: {0}".format(caminho_completo)
# ----------------------------------------
file_from_path = FileObject(path=python_script)
readFromFile = Image.ReadFromFile(file=file_from_path)
string_2 = StringInput("Confirmar")
code_block_2 = CodeBlock { "Escolha o Tipo de TAG"; }
categories = Categories("OST_ElectricalFixtureTags")
obter_famílias_de_uma_categoria = Python(IN[0]=categories)  # "Obter Famílias de Uma Categoria - BIMACON"
# ---------- obter_famílias_de_uma_categoria.python (52 lines) ----------
import clr
import System

# Revit API
clr.AddReference('RevitAPI')
from Autodesk.Revit.DB import *

# RevitServices
clr.AddReference("RevitServices")
from RevitServices.Persistence import DocumentManager
from RevitServices.Transactions import TransactionManager

# RevitNodes para manipular categorias
clr.AddReference("RevitNodes")
import Revit
clr.ImportExtensions(Revit.Elements)

# Documento atual
doc = DocumentManager.Instance.CurrentDBDocument

# Função para obter BuiltInCategory de uma entrada
def obter_builtincategory(entrada):
    if isinstance(entrada, Category):
        return System.Enum.ToObject(BuiltInCategory, entrada.Id.IntegerValue)
    elif isinstance(entrada, int):
        return System.Enum.ToObject(BuiltInCategory, entrada)
    elif isinstance(entrada, BuiltInCategory):
        return entrada
    elif hasattr(entrada, "Id"):
        return System.Enum.ToObject(BuiltInCategory, entrada.Id.IntegerValue)
    else:
        return None

# Entrada
entrada = UnwrapElement(IN[0])
bic = obter_builtincategory(entrada)

# Coletar todas as famílias no documento
todas_familias = FilteredElementCollector(doc).OfClass(Family).ToElements()

# Filtrar famílias pela categoria
familias_filtradas = []
if bic:
    for fam in todas_familias:
        try:
            if fam.FamilyCategory.Id.IntegerValue == int(bic):
                familias_filtradas.append(fam)
        except:
            continue

# Saída
OUT = familias_filtradas
# ----------------------------------------
types = Family.Types(family=obter_famílias_de_uma_categoria)
name = Element.Name(element=types)
code_block_3 = CodeBlock { "Tomada"; }
contains = String.Contains(str=name, searchFor=code_block_3)
filterByBoolMask = List.FilterByBoolMask(list=types, mask=contains)
boolean = BoolSelector(false)
clean = List.Clean(list=filterByBoolMask.in, preserveIndices=boolean)
flatten = List.Flatten(list=clean)
name_2 = Element.Name(element=flatten)
code_block_4 = CodeBlock { 0; }
dropdown_data = Custom[DropDown Data](InputName=code_block_2, Keys=name_2, Values=flatten, DefaultValueIndex=code_block_4)  # package Data-Shapes; Create data for DropDown input in UI.MultiInputForm ++ . Check out www.data-shapes.net for more infos.
code_block_5 = CodeBlock { "Fator Distância das TAGs (1x)"; }
string_3 = StringInput("1")
boolean_2 = BoolSelector(true)
textbox_data = Custom[TextBox Data](InputName=code_block_5, DefaultText=string_3, IsNumberEntry=boolean_2)  # package Data-Shapes; Create Data for TextBox input in UI.MultipleInputForm ++ . Check out www.data-shapes.net for more informations
list_create = List.Create(item0=dropdown_data, item1=textbox_data)
boolean_3 = BoolSelector(true)
string_4 = StringInput("Cancelar")
number = DoubleInput(400)
number_2 = DoubleInput(185)
multipleinputform = Custom[MultipleInputForm ++](Description_optional=code_block, Logo_optional=readFromFile, ButtonText_optional=string_2, Inputs=list_create, Toggle=boolean_3, CancelButtonText_optional=string_4, Width_optional=number, LabelWidth_optional=number_2)  # package Data-Shapes; Create a form with multiple inputs. see www.data-shapes.net for tutorials and infos!
code_block_6 = CodeBlock()  # //archilab
code_block_7 = CodeBlock()  # //Data-Shapes

# group: Separar Entradas
code_block_8 = CodeBlock { 0; }
getItemAtIndex = List.GetItemAtIndex(list=multipleinputform.User_Inputs, index=code_block_8)
code_block_9 = CodeBlock { 1; }
getItemAtIndex_2 = List.GetItemAtIndex(list=multipleinputform.User_Inputs, index=code_block_9)

# group: Filtrar Elementos não Tagueados
categories_2 = Categories("OST_ElectricalFixtures")
current = Document.Current()
activeView = Document.ActiveView(document=current)
all_elements_of_category_in_view = ElementsOfCategoryInView(Category=categories_2, View=activeView)
flatten_2 = List.Flatten(list=all_elements_of_category_in_view)
categories_3 = Categories("OST_ElectricalFixtureTags")
all_elements_of_category_in_view_2 = ElementsOfCategoryInView(Category=categories_3, View=activeView)
elementType = Element.ElementType(element=all_elements_of_category_in_view_2)
contains_2 = List.Contains(list=elementType, item=getItemAtIndex, lacing=Longest)
filterByBoolMask_2 = List.FilterByBoolMask(list=all_elements_of_category_in_view_2, mask=contains_2)
taggedElement = Tag.TaggedElement(tag=filterByBoolMask_2.in)
python_script_2 = Python(IN[0]=flatten_2, IN[1]=taggedElement)
# ---------- python_script_2.python (52 lines) ----------
# Importar bibliotecas
import clr
clr.AddReference('RevitServices')
from RevitServices.Persistence import DocumentManager

clr.AddReference('RevitAPI')
from Autodesk.Revit.DB import *

# Entradas
todos_elementos = IN[0]
elementos_tagueados = IN[1]

# Função segura para extrair o ID inteiro
def get_element_id(el):
    try:
        return el.Id.IntegerValue
    except:
        try:
            return el.Id
        except:
            try:
                return int(el)
            except:
                return None

# Lista de IDs dos elementos tagueados
ids_tagueados = [get_element_id(el) for el in elementos_tagueados if el is not None]

# Função recursiva para filtrar mantendo a estrutura da lista original
def filtrar_elementos_recursivo(lista):
    if isinstance(lista, list):
        return [filtrar_elementos_recursivo(item) for item in lista]
    else:
        el_id = get_element_id(lista)
        if el_id not in ids_tagueados:
            return lista
        else:
            return None  # Remove elementos tagueados

# Aplica o filtro recursivo
resultado = filtrar_elementos_recursivo(todos_elementos)

# Remove os "None" da saída final (em profundidade)
def limpar_nulos_recursivo(lista):
    if isinstance(lista, list):
        return [limpar_nulos_recursivo(x) for x in lista if x is not None]
    else:
        return lista

resultado_limpo = limpar_nulos_recursivo(resultado)

OUT = resultado_limpo
# ----------------------------------------

getFamily = FamilyInstance.GetFamily(familyInstance=python_script_2@L2)
string_from_object = FromObject(obj=getFamily)
code_block_10 = CodeBlock { ["Tomada de Piso"]; }
contains_3 = String.Contains(str=string_from_object@L2, searchFor=code_block_10, lacing=Longest)
filterByBoolMask_3 = List.FilterByBoolMask(list=python_script_2@L2, mask=contains_3@L2)
getFamily_2 = FamilyInstance.GetFamily(familyInstance=filterByBoolMask_3.out@L2)
string_from_object_2 = FromObject(obj=getFamily_2)
code_block_11 = CodeBlock { ["Tomada Face"]; }
contains_4 = String.Contains(str=string_from_object_2@L2, searchFor=code_block_11, lacing=Longest)
filterByBoolMask_4 = List.FilterByBoolMask(list=filterByBoolMask_3.out@L2, mask=contains_4@L2)
getFamily_3 = FamilyInstance.GetFamily(familyInstance=filterByBoolMask_4.out@L2)
string_from_object_3 = FromObject(obj=getFamily_3)
code_block_12 = CodeBlock { ["1 Tomada 2P+T"]; }
contains_5 = String.Contains(str=string_from_object_3@L2, searchFor=code_block_12, lacing=Longest)
filterByBoolMask_5 = List.FilterByBoolMask(list=filterByBoolMask_4.out@L2, mask=contains_5@L2)
string_from_object_4 = FromObject(obj=filterByBoolMask_5.out)
code_block_13 = CodeBlock { ["x.Módulo"]; }
contains_6 = String.Contains(str=string_from_object_4@L2, searchFor=code_block_13, lacing=Longest)
filterByBoolMask_6 = List.FilterByBoolMask(list=filterByBoolMask_5.out@L2, mask=contains_6@L2)
string_from_object_5 = FromObject(obj=filterByBoolMask_6.out)
code_block_14 = CodeBlock { ["+ 1 Tomada"]; }
contains_7 = String.Contains(str=string_from_object_5@L2, searchFor=code_block_14, lacing=Longest)
filterByBoolMask_7 = List.FilterByBoolMask(list=filterByBoolMask_6.out@L2, mask=contains_7@L2)
string_from_object_6 = FromObject(obj=filterByBoolMask_7.out)
code_block_15 = CodeBlock { ["+ 2 Tomadas"]; }
contains_8 = String.Contains(str=string_from_object_6@L2, searchFor=code_block_15, lacing=Longest)
filterByBoolMask_8 = List.FilterByBoolMask(list=filterByBoolMask_7.out@L2, mask=contains_8@L2)
string_from_object_7 = FromObject(obj=filterByBoolMask_8.out)
code_block_16 = CodeBlock { ["+ 3 Tomadas"]; }
contains_9 = String.Contains(str=string_from_object_7@L2, searchFor=code_block_16, lacing=Longest)
filterByBoolMask_9 = List.FilterByBoolMask(list=filterByBoolMask_8.out@L2, mask=contains_9@L2)
string_from_object_8 = FromObject(object=filterByBoolMask_9.out)
code_block_17 = CodeBlock { ["+ 1 USB"]; }
contains_10 = String.Contains(str=string_from_object_8@L2, searchFor=code_block_17, lacing=Longest)
filterByBoolMask_10 = List.FilterByBoolMask(list=filterByBoolMask_9.out@L2, mask=contains_10@L2)
string_from_object_9 = FromObject(object=filterByBoolMask_10.out)
code_block_18 = CodeBlock { ["Tomada"]; }
contains_11 = String.Contains(str=string_from_object_9@L2, searchFor=code_block_18, lacing=Longest)
filterByBoolMask_11 = List.FilterByBoolMask(list=filterByBoolMask_10.out@L2, mask=contains_11@L2)

# group: TOMADAS DUPLAS TRIPLAS ETC
getChildElements = Element.GetChildElements(element=filterByBoolMask_11.in@L2)
python_script_3 = Python(IN[0]=getChildElements, IN[1]=taggedElement)  # same code as python_script_2
string_from_object_10 = FromObject(object=python_script_3)
code_block_19 = CodeBlock { ["Caixa de Luz"]; }
contains_12 = String.Contains(str=string_from_object_10@L2, searchFor=code_block_19, lacing=Longest)
filterByBoolMask_12 = List.FilterByBoolMask(list=python_script_3@L2, mask=contains_12@L2)
string_from_object_11 = FromObject(object=filterByBoolMask_12.out)
code_block_20 = CodeBlock { ["Tomada"]; }
contains_13 = String.Contains(str=string_from_object_11@L2, searchFor=code_block_20, lacing=Longest)
filterByBoolMask_13 = List.FilterByBoolMask(list=filterByBoolMask_12.out@L2, mask=contains_13@L2)
boolean_4 = BoolSelector(false)
clean_2 = List.Clean(list=filterByBoolMask_13.in, preserveIndices=boolean_4)
getLocation = Element.GetLocation(element=clean_2)
Z = Point.Z(point=getLocation)
sortByKey = List.SortByKey(list=clean_2, keys=Z, lacing=Longest)
reverse = List.Reverse(list=sortByKey.sorted_list, lacing=Longest)
getLocation_2 = Element.GetLocation(element=reverse)
flatten_3 = List.Flatten(list=getLocation_2@L2)
flatten_4 = List.Flatten(list=reverse@L2)
reverse_2 = List.Reverse(list=sortByKey.sorted_keys, lacing=Longest)

# group: 3ª TOMADA
code_block_21 = CodeBlock { 2; }
getItemAtIndex_3 = List.GetItemAtIndex(list=flatten_4, index=code_block_21, lacing=Longest)
boolean_5 = BoolSelector(false)
clean_3 = List.Clean(list=getItemAtIndex_3, preserveIndices=boolean_5)
facingOrientation = FamilyInstance.FacingOrientation(familyInstance=clean_3)
X = Vector.X(vector=facingOrientation)
code_block_22 = CodeBlock { 2; }
round = Math.Round(number=X, digits=code_block_22)
code_block_23 = CodeBlock { 0; }
Y = Vector.Y(vector=facingOrientation)
round_2 = Math.Round(number=Y, digits=code_block_22)
code_block_24 = CodeBlock { 0; }
code_block_25 = CodeBlock { true; false; }
code_block_26 = CodeBlock { true; false; }
code_block_27 = CodeBlock { true; false; }
gt = round_2 > code_block_24
code_block_28 = CodeBlock { true; false; }

# group: x
lt = round < code_block_23

# group: y
ge = round_2 >= code_block_24

# group (continued): 3ª TOMADA
condição_if_de_lista_aninhada = CodeBlock(x=lt, y=ge, cond1=code_block_25.out0, cond2=code_block_25.out1) { indx = (x == true) && (y == true) ? 0 : 1; resultado = [cond1, cond2][indx]; }
filterByBoolMask_14 = List.FilterByBoolMask(list=clean_3, mask=condição_if_de_lista_aninhada.resultado, lacing=Longest)
filterByBoolMask_15 = List.FilterByBoolMask(list=facingOrientation, mask=condição_if_de_lista_aninhada.resultado)

# group: TAG Vertical Neg
boolean_6 = BoolSelector(false)
clean_4 = List.Clean(list=filterByBoolMask_14.in, preserveIndices=boolean_6)
flatten_5 = List.Flatten(list=clean_4)
boolean_7 = BoolSelector(false)
clean_5 = List.Clean(list=filterByBoolMask_14.in, preserveIndices=boolean_7)
getLocation_3 = Element.GetLocation(element=clean_5)
boolean_8 = BoolSelector(false)
clean_6 = List.Clean(list=filterByBoolMask_15.in, preserveIndices=boolean_8)
ZAxis = Vector.ZAxis()
cross = Vector.Cross(vector=clean_6, cross=ZAxis)
offset_da_tag = DoubleInput(0.05)
facingOrientation_2 = FamilyInstance.FacingOrientation(familyInstance=clean_5)
offset_da_2ª_tag = DoubleInput(0.45)
boolean_9 = BoolSelector(false)

mul = offset_da_tag * getItemAtIndex_2

# group (continued): TAG Vertical Neg
translate = Geometry.Translate(geometry=getLocation_3, direction=cross, distance=mul)

mul_2 = offset_da_2ª_tag * getItemAtIndex_2

# group (continued): TAG Vertical Neg
translate_2 = Geometry.Translate(geometry=translate, direction=facingOrientation_2, distance=mul_2)
clean_7 = List.Clean(list=translate_2, preserveIndices=boolean_9)
flatten_6 = List.Flatten(list=clean_7)
tag_byelement = Custom[👓 Tag․ByElement](element=flatten_5, TagLocation=flatten_6, TagType=getItemAtIndex)  # package BIMCoder Nodes - 2.X; Cria uma Tag em elemento(s) dado o tipo da Tag e a posição

# group: x
le = round <= code_block_23

# group: y
lt_2 = round_2 < code_block_24

# group (continued): 3ª TOMADA
condição_if_de_lista_aninhada_2 = CodeBlock(x=le, y=lt_2, cond1=code_block_26.out0, cond2=code_block_26.out1) { indx = (x == true) && (y == true) ? 0 : 1; resultado = [cond1, cond2][indx]; }
filterByBoolMask_16 = List.FilterByBoolMask(list=clean_3, mask=condição_if_de_lista_aninhada_2.resultado, lacing=Longest)
filterByBoolMask_17 = List.FilterByBoolMask(list=facingOrientation, mask=condição_if_de_lista_aninhada_2.resultado)

# group: TAG Horizontal Pos
boolean_10 = BoolSelector(false)
clean_8 = List.Clean(list=filterByBoolMask_16.in, preserveIndices=boolean_10)
flatten_7 = List.Flatten(list=clean_8)
boolean_11 = BoolSelector(false)
clean_9 = List.Clean(list=filterByBoolMask_16.in, preserveIndices=boolean_11)
getLocation_4 = Element.GetLocation(element=clean_9)
boolean_12 = BoolSelector(false)
clean_10 = List.Clean(list=filterByBoolMask_17.in, preserveIndices=boolean_12)
offset_da_tag_2 = DoubleInput(0.5)
facingOrientation_3 = FamilyInstance.FacingOrientation(familyInstance=clean_9)
ZAxis_2 = Vector.ZAxis()
cross_2 = Vector.Cross(vector=facingOrientation_3, cross=ZAxis_2)
offset_da_2ª_tag_2 = DoubleInput(0.2)
boolean_13 = BoolSelector(false)

mul_3 = offset_da_tag_2 * getItemAtIndex_2

# group (continued): TAG Horizontal Pos
translate_3 = Geometry.Translate(geometry=getLocation_4, direction=clean_10, distance=mul_3)

mul_4 = offset_da_2ª_tag_2 * getItemAtIndex_2

# group (continued): TAG Horizontal Pos
translate_4 = Geometry.Translate(geometry=translate_3, direction=cross_2, distance=mul_4)
clean_11 = List.Clean(list=translate_4, preserveIndices=boolean_13)
flatten_8 = List.Flatten(list=clean_11)
tag_byelement_2 = Custom[👓 Tag․ByElement](element=flatten_7, TagLocation=flatten_8, TagType=getItemAtIndex)

# group: x
gt_2 = round > code_block_23

# group: y
le_2 = round_2 <= code_block_24

# group (continued): 3ª TOMADA
condição_if_de_lista_aninhada_3 = CodeBlock(x=gt_2, y=le_2, cond1=code_block_27.out0, cond2=code_block_27.out1) { indx = (x == true) && (y == true) ? 0 : 1; resultado = [cond1, cond2][indx]; }
filterByBoolMask_18 = List.FilterByBoolMask(list=clean_3, mask=condição_if_de_lista_aninhada_3.resultado, lacing=Longest)
filterByBoolMask_19 = List.FilterByBoolMask(list=facingOrientation, mask=condição_if_de_lista_aninhada_3.resultado)

# group: TAG Vertical Pos
boolean_14 = BoolSelector(false)
clean_12 = List.Clean(list=filterByBoolMask_18.in, preserveIndices=boolean_14)
flatten_9 = List.Flatten(list=clean_12)
boolean_15 = BoolSelector(false)
clean_13 = List.Clean(list=filterByBoolMask_18.in, preserveIndices=boolean_15)
getLocation_5 = Element.GetLocation(element=clean_13)
boolean_16 = BoolSelector(false)
clean_14 = List.Clean(list=filterByBoolMask_19.in, preserveIndices=boolean_16)
ZAxis_3 = Vector.ZAxis()
cross_3 = Vector.Cross(vector=clean_14, cross=ZAxis_3)
offset_da_tag_3 = DoubleInput(0.22)
facingOrientation_4 = FamilyInstance.FacingOrientation(familyInstance=clean_13)
offset_da_2ª_tag_3 = DoubleInput(0.35)
boolean_17 = BoolSelector(false)

mul_5 = offset_da_tag_3 * getItemAtIndex_2

# group (continued): TAG Vertical Pos
translate_5 = Geometry.Translate(geometry=getLocation_5, direction=cross_3, distance=mul_5)

mul_6 = offset_da_2ª_tag_3 * getItemAtIndex_2

# group (continued): TAG Vertical Pos
translate_6 = Geometry.Translate(geometry=translate_5, direction=facingOrientation_4, distance=mul_6)
clean_15 = List.Clean(list=translate_6, preserveIndices=boolean_17)
flatten_10 = List.Flatten(list=clean_15)
tag_byelement_3 = Custom[👓 Tag․ByElement](element=flatten_9, TagLocation=flatten_10, TagType=getItemAtIndex)

# group: x
ge_2 = round >= code_block_23

# group (continued): 3ª TOMADA
condição_if_de_lista_aninhada_4 = CodeBlock(x=ge_2, y=gt, cond1=code_block_28.out0, cond2=code_block_28.out1) { indx = (x == true) && (y == true) ? 0 : 1; resultado = [cond1, cond2][indx]; }
filterByBoolMask_20 = List.FilterByBoolMask(list=clean_3, mask=condição_if_de_lista_aninhada_4.resultado, lacing=Longest)
filterByBoolMask_21 = List.FilterByBoolMask(list=facingOrientation, mask=condição_if_de_lista_aninhada_4.resultado)

# group: TAG Horizontal Pos
boolean_18 = BoolSelector(false)
clean_16 = List.Clean(list=filterByBoolMask_20.in, preserveIndices=boolean_18)
flatten_11 = List.Flatten(list=clean_16)
boolean_19 = BoolSelector(false)
clean_17 = List.Clean(list=filterByBoolMask_20.in, preserveIndices=boolean_19)
getLocation_6 = Element.GetLocation(element=clean_17)
boolean_20 = BoolSelector(false)
clean_18 = List.Clean(list=filterByBoolMask_21.in, preserveIndices=boolean_20)
offset_da_tag_4 = DoubleInput(0.35)
facingOrientation_5 = FamilyInstance.FacingOrientation(familyInstance=clean_17)
ZAxis_4 = Vector.ZAxis()
cross_4 = Vector.Cross(vector=facingOrientation_5, cross=ZAxis_4)
offset_da_2ª_tag_4 = DoubleInput(0.05)
boolean_21 = BoolSelector(false)

mul_7 = offset_da_tag_4 * getItemAtIndex_2

# group (continued): TAG Horizontal Pos
translate_7 = Geometry.Translate(geometry=getLocation_6, direction=clean_18, distance=mul_7)

mul_8 = offset_da_2ª_tag_4 * getItemAtIndex_2

# group (continued): TAG Horizontal Pos
translate_8 = Geometry.Translate(geometry=translate_7, direction=cross_4, distance=mul_8)
clean_19 = List.Clean(list=translate_8, preserveIndices=boolean_21)
flatten_12 = List.Flatten(list=clean_19)
tag_byelement_4 = Custom[👓 Tag․ByElement](element=flatten_11, TagLocation=flatten_12, TagType=getItemAtIndex)

# group: 2ª TOMADA
code_block_29 = CodeBlock { 1; }
getItemAtIndex_4 = List.GetItemAtIndex(list=flatten_4, index=code_block_29, lacing=Longest)
boolean_22 = BoolSelector(false)
clean_20 = List.Clean(list=getItemAtIndex_4, preserveIndices=boolean_22)
facingOrientation_6 = FamilyInstance.FacingOrientation(familyInstance=clean_20)
X_2 = Vector.X(vector=facingOrientation_6)
code_block_30 = CodeBlock { 2; }
round_3 = Math.Round(number=X_2, digits=code_block_30)
code_block_31 = CodeBlock { 0; }
Y_2 = Vector.Y(vector=facingOrientation_6)
round_4 = Math.Round(number=Y_2, digits=code_block_30)
code_block_32 = CodeBlock { 0; }
gt_3 = round_4 > code_block_32
code_block_33 = CodeBlock { true; false; }
code_block_34 = CodeBlock { true; false; }
code_block_35 = CodeBlock { true; false; }
code_block_36 = CodeBlock { true; false; }
getLocation_7 = Element.GetLocation(element=clean_20)
byStartPointDirectionLength = Line.ByStartPointDirectionLength(startPoint=getLocation_7, direction=facingOrientation_6)

# group: x
ge_3 = round_3 >= code_block_31

# group (continued): 2ª TOMADA
condição_if_de_lista_aninhada_5 = CodeBlock(x=ge_3, y=gt_3, cond1=code_block_33.out0, cond2=code_block_33.out1) { indx = (x == true) && (y == true) ? 0 : 1; resultado = [cond1, cond2][indx]; }
filterByBoolMask_22 = List.FilterByBoolMask(list=clean_20, mask=condição_if_de_lista_aninhada_5.resultado, lacing=Longest)
filterByBoolMask_23 = List.FilterByBoolMask(list=facingOrientation_6, mask=condição_if_de_lista_aninhada_5.resultado)

# group: TAG Horizontal Pos
boolean_23 = BoolSelector(false)
clean_21 = List.Clean(list=filterByBoolMask_22.in, preserveIndices=boolean_23)
flatten_13 = List.Flatten(list=clean_21)
boolean_24 = BoolSelector(false)
clean_22 = List.Clean(list=filterByBoolMask_22.in, preserveIndices=boolean_24)
getLocation_8 = Element.GetLocation(element=clean_22)
boolean_25 = BoolSelector(false)
clean_23 = List.Clean(list=filterByBoolMask_23.in, preserveIndices=boolean_25)
offset_da_tag_5 = DoubleInput(0.2)
facingOrientation_7 = FamilyInstance.FacingOrientation(familyInstance=clean_22)
ZAxis_5 = Vector.ZAxis()
cross_5 = Vector.Cross(vector=facingOrientation_7, cross=ZAxis_5)
offset_da_2ª_tag_5 = DoubleInput(0.05)
boolean_26 = BoolSelector(false)

mul_9 = offset_da_tag_5 * getItemAtIndex_2

# group (continued): TAG Horizontal Pos
translate_9 = Geometry.Translate(geometry=getLocation_8, direction=clean_23, distance=mul_9)

mul_10 = offset_da_2ª_tag_5 * getItemAtIndex_2

# group (continued): TAG Horizontal Pos
translate_10 = Geometry.Translate(geometry=translate_9, direction=cross_5, distance=mul_10)
clean_24 = List.Clean(list=translate_10, preserveIndices=boolean_26)
flatten_14 = List.Flatten(list=clean_24)
tag_byelement_5 = Custom[👓 Tag․ByElement](element=flatten_13, TagLocation=flatten_14, TagType=getItemAtIndex)

# group: x
lt_3 = round_3 < code_block_31

# group: y
ge_4 = round_4 >= code_block_32

# group (continued): 2ª TOMADA
condição_if_de_lista_aninhada_6 = CodeBlock(x=lt_3, y=ge_4, cond1=code_block_34.out0, cond2=code_block_34.out1) { indx = (x == true) && (y == true) ? 0 : 1; resultado = [cond1, cond2][indx]; }
filterByBoolMask_24 = List.FilterByBoolMask(list=clean_20, mask=condição_if_de_lista_aninhada_6.resultado, lacing=Longest)
filterByBoolMask_25 = List.FilterByBoolMask(list=facingOrientation_6, mask=condição_if_de_lista_aninhada_6.resultado)

# group: TAG Vertical Neg
boolean_27 = BoolSelector(false)
clean_25 = List.Clean(list=filterByBoolMask_24.in, preserveIndices=boolean_27)
flatten_15 = List.Flatten(list=clean_25)
boolean_28 = BoolSelector(false)
clean_26 = List.Clean(list=filterByBoolMask_24.in, preserveIndices=boolean_28)
getLocation_9 = Element.GetLocation(element=clean_26)
boolean_29 = BoolSelector(false)
clean_27 = List.Clean(list=filterByBoolMask_25.in, preserveIndices=boolean_29)
ZAxis_6 = Vector.ZAxis()
cross_6 = Vector.Cross(vector=clean_27, cross=ZAxis_6)
offset_da_tag_6 = DoubleInput(0.05)
facingOrientation_8 = FamilyInstance.FacingOrientation(familyInstance=clean_26)
offset_da_2ª_tag_6 = DoubleInput(0.3)
boolean_30 = BoolSelector(false)

mul_11 = offset_da_tag_6 * getItemAtIndex_2

# group (continued): TAG Vertical Neg
translate_11 = Geometry.Translate(geometry=getLocation_9, direction=cross_6, distance=mul_11)

mul_12 = offset_da_2ª_tag_6 * getItemAtIndex_2

# group (continued): TAG Vertical Neg
translate_12 = Geometry.Translate(geometry=translate_11, direction=facingOrientation_8, distance=mul_12)
clean_28 = List.Clean(list=translate_12, preserveIndices=boolean_30)
flatten_16 = List.Flatten(list=clean_28)
tag_byelement_6 = Custom[👓 Tag․ByElement](element=flatten_15, TagLocation=flatten_16, TagType=getItemAtIndex)

# group: x
le_3 = round_3 <= code_block_31

# group: y
lt_4 = round_4 < code_block_32

# group (continued): 2ª TOMADA
condição_if_de_lista_aninhada_7 = CodeBlock(x=le_3, y=lt_4, cond1=code_block_35.out0, cond2=code_block_35.out1) { indx = (x == true) && (y == true) ? 0 : 1; resultado = [cond1, cond2][indx]; }
filterByBoolMask_26 = List.FilterByBoolMask(list=clean_20, mask=condição_if_de_lista_aninhada_7.resultado, lacing=Longest)
filterByBoolMask_27 = List.FilterByBoolMask(list=facingOrientation_6, mask=condição_if_de_lista_aninhada_7.resultado)

# group: TAG Horizontal Pos
boolean_31 = BoolSelector(false)
clean_29 = List.Clean(list=filterByBoolMask_26.in, preserveIndices=boolean_31)
flatten_17 = List.Flatten(list=clean_29)
boolean_32 = BoolSelector(false)
clean_30 = List.Clean(list=filterByBoolMask_26.in, preserveIndices=boolean_32)
getLocation_10 = Element.GetLocation(element=clean_30)
boolean_33 = BoolSelector(false)
clean_31 = List.Clean(list=filterByBoolMask_27.in, preserveIndices=boolean_33)
offset_da_tag_7 = DoubleInput(0.35)
facingOrientation_9 = FamilyInstance.FacingOrientation(familyInstance=clean_30)
ZAxis_7 = Vector.ZAxis()
cross_7 = Vector.Cross(vector=facingOrientation_9, cross=ZAxis_7)
offset_da_2ª_tag_7 = DoubleInput(0.2)
boolean_34 = BoolSelector(false)

mul_13 = offset_da_tag_7 * getItemAtIndex_2

# group (continued): TAG Horizontal Pos
translate_13 = Geometry.Translate(geometry=getLocation_10, direction=clean_31, distance=mul_13)

mul_14 = offset_da_2ª_tag_7 * getItemAtIndex_2

# group (continued): TAG Horizontal Pos
translate_14 = Geometry.Translate(geometry=translate_13, direction=cross_7, distance=mul_14)
clean_32 = List.Clean(list=translate_14, preserveIndices=boolean_34)
flatten_18 = List.Flatten(list=clean_32)
tag_byelement_7 = Custom[👓 Tag․ByElement](element=flatten_17, TagLocation=flatten_18, TagType=getItemAtIndex)

# group: x
gt_4 = round_3 > code_block_31

# group: y
le_4 = round_4 <= code_block_32

# group (continued): 2ª TOMADA
condição_if_de_lista_aninhada_8 = CodeBlock(x=gt_4, y=le_4, cond1=code_block_36.out0, cond2=code_block_36.out1) { indx = (x == true) && (y == true) ? 0 : 1; resultado = [cond1, cond2][indx]; }
filterByBoolMask_28 = List.FilterByBoolMask(list=clean_20, mask=condição_if_de_lista_aninhada_8.resultado, lacing=Longest)
filterByBoolMask_29 = List.FilterByBoolMask(list=facingOrientation_6, mask=condição_if_de_lista_aninhada_8.resultado)

# group: TAG Vertical Pos
boolean_35 = BoolSelector(false)
clean_33 = List.Clean(list=filterByBoolMask_28.in, preserveIndices=boolean_35)
flatten_19 = List.Flatten(list=clean_33)
boolean_36 = BoolSelector(false)
clean_34 = List.Clean(list=filterByBoolMask_28.in, preserveIndices=boolean_36)
getLocation_11 = Element.GetLocation(element=clean_34)
boolean_37 = BoolSelector(false)
clean_35 = List.Clean(list=filterByBoolMask_29.in, preserveIndices=boolean_37)
ZAxis_8 = Vector.ZAxis()
cross_8 = Vector.Cross(vector=clean_35, cross=ZAxis_8)
offset_da_tag_8 = DoubleInput(0.22)
facingOrientation_10 = FamilyInstance.FacingOrientation(familyInstance=clean_34)
offset_da_2ª_tag_8 = DoubleInput(0.2)
boolean_38 = BoolSelector(false)

mul_15 = offset_da_tag_8 * getItemAtIndex_2

# group (continued): TAG Vertical Pos
translate_15 = Geometry.Translate(geometry=getLocation_11, direction=cross_8, distance=mul_15)

mul_16 = offset_da_2ª_tag_8 * getItemAtIndex_2

# group (continued): TAG Vertical Pos
translate_16 = Geometry.Translate(geometry=translate_15, direction=facingOrientation_10, distance=mul_16)
clean_36 = List.Clean(list=translate_16, preserveIndices=boolean_38)
flatten_20 = List.Flatten(list=clean_36)
tag_byelement_8 = Custom[👓 Tag․ByElement](element=flatten_19, TagLocation=flatten_20, TagType=getItemAtIndex)

# group: 1 TOMADA SIMPLES
string_from_object_12 = FromObject(object=filterByBoolMask_5.in)
code_block_37 = CodeBlock { ["Tomada 2P+T"]; }
contains_14 = String.Contains(str=string_from_object_12@L2, searchFor=code_block_37, lacing=Longest)
filterByBoolMask_30 = List.FilterByBoolMask(list=filterByBoolMask_5.in@L2, mask=contains_14@L2)
boolean_39 = BoolSelector(false)
clean_37 = List.Clean(list=filterByBoolMask_30.in, preserveIndices=boolean_39)
facingOrientation_11 = FamilyInstance.FacingOrientation(familyInstance=clean_37)
X_3 = Vector.X(vector=facingOrientation_11)
code_block_38 = CodeBlock { 2; }
round_5 = Math.Round(number=X_3, digits=code_block_38)
code_block_39 = CodeBlock { 0; }
Y_3 = Vector.Y(vector=facingOrientation_11)
round_6 = Math.Round(number=Y_3, digits=code_block_38)
code_block_40 = CodeBlock { 0; }
gt_5 = round_6 > code_block_40
code_block_41 = CodeBlock { true; false; }
code_block_42 = CodeBlock { true; false; }
code_block_43 = CodeBlock { true; false; }
code_block_44 = CodeBlock { true; false; }
getLocation_12 = Element.GetLocation(element=clean_37)
byStartPointDirectionLength_2 = Line.ByStartPointDirectionLength(startPoint=getLocation_12, direction=facingOrientation_11)

# group: x
ge_5 = round_5 >= code_block_39

# group (continued): 1 TOMADA SIMPLES
condição_if_de_lista_aninhada_9 = CodeBlock(x=ge_5, y=gt_5, cond1=code_block_41.out0, cond2=code_block_41.out1) { indx = (x == true) && (y == true) ? 0 : 1; resultado = [cond1, cond2][indx]; }
filterByBoolMask_31 = List.FilterByBoolMask(list=clean_37, mask=condição_if_de_lista_aninhada_9.resultado, lacing=Longest)
filterByBoolMask_32 = List.FilterByBoolMask(list=facingOrientation_11, mask=condição_if_de_lista_aninhada_9.resultado)

# group: TAG Vertical Pos
boolean_40 = BoolSelector(false)
clean_38 = List.Clean(list=filterByBoolMask_31.in, preserveIndices=boolean_40)
flatten_21 = List.Flatten(list=clean_38)
boolean_41 = BoolSelector(false)
clean_39 = List.Clean(list=filterByBoolMask_31.in, preserveIndices=boolean_41)
getLocation_13 = Element.GetLocation(element=clean_39)
boolean_42 = BoolSelector(false)
clean_40 = List.Clean(list=filterByBoolMask_32.in, preserveIndices=boolean_42)
offset_da_tag_9 = DoubleInput(0.1)
translate_17 = Geometry.Translate(geometry=getLocation_13, direction=clean_40, distance=offset_da_tag_9)
facingOrientation_12 = FamilyInstance.FacingOrientation(familyInstance=clean_39)
ZAxis_9 = Vector.ZAxis()
cross_9 = Vector.Cross(vector=facingOrientation_12, cross=ZAxis_9)
offset_da_2ª_tag_9 = DoubleInput(0.05)
translate_18 = Geometry.Translate(geometry=translate_17, direction=cross_9, distance=offset_da_2ª_tag_9)
boolean_43 = BoolSelector(false)
clean_41 = List.Clean(list=translate_18, preserveIndices=boolean_43)
flatten_22 = List.Flatten(list=clean_41)
tag_byelement_9 = Custom[👓 Tag․ByElement](element=flatten_21, TagLocation=flatten_22, TagType=getItemAtIndex)

# group: x
lt_5 = round_5 < code_block_39

# group: y
ge_6 = round_6 >= code_block_40

# group (continued): 1 TOMADA SIMPLES
condição_if_de_lista_aninhada_10 = CodeBlock(x=lt_5, y=ge_6, cond1=code_block_42.out0, cond2=code_block_42.out1) { indx = (x == true) && (y == true) ? 0 : 1; resultado = [cond1, cond2][indx]; }
filterByBoolMask_33 = List.FilterByBoolMask(list=clean_37, mask=condição_if_de_lista_aninhada_10.resultado, lacing=Longest)
filterByBoolMask_34 = List.FilterByBoolMask(list=facingOrientation_11, mask=condição_if_de_lista_aninhada_10.resultado)

# group: TAG Horizontal Neg
boolean_44 = BoolSelector(false)
clean_42 = List.Clean(list=filterByBoolMask_33.in, preserveIndices=boolean_44)
flatten_23 = List.Flatten(list=clean_42)
boolean_45 = BoolSelector(false)
clean_43 = List.Clean(list=filterByBoolMask_33.in, preserveIndices=boolean_45)
getLocation_14 = Element.GetLocation(element=clean_43)
boolean_46 = BoolSelector(false)
clean_44 = List.Clean(list=filterByBoolMask_34.in, preserveIndices=boolean_46)
ZAxis_10 = Vector.ZAxis()
cross_10 = Vector.Cross(vector=clean_44, cross=ZAxis_10)
offset_da_tag_10 = DoubleInput(0.08)
translate_19 = Geometry.Translate(geometry=getLocation_14, direction=cross_10, distance=offset_da_tag_10)
facingOrientation_13 = FamilyInstance.FacingOrientation(familyInstance=clean_43)
offset_da_2ª_tag_10 = DoubleInput(0.15)
translate_20 = Geometry.Translate(geometry=translate_19, direction=facingOrientation_13, distance=offset_da_2ª_tag_10)
boolean_47 = BoolSelector(false)
clean_45 = List.Clean(list=translate_20, preserveIndices=boolean_47)
flatten_24 = List.Flatten(list=clean_45)
tag_byelement_10 = Custom[👓 Tag․ByElement](element=flatten_23, TagLocation=flatten_24, TagType=getItemAtIndex)

# group: x
le_5 = round_5 <= code_block_39

# group: y
lt_6 = round_6 < code_block_40

# group (continued): 1 TOMADA SIMPLES
condição_if_de_lista_aninhada_11 = CodeBlock(x=le_5, y=lt_6, cond1=code_block_43.out0, cond2=code_block_43.out1) { indx = (x == true) && (y == true) ? 0 : 1; resultado = [cond1, cond2][indx]; }
filterByBoolMask_35 = List.FilterByBoolMask(list=clean_37, mask=condição_if_de_lista_aninhada_11.resultado, lacing=Longest)
filterByBoolMask_36 = List.FilterByBoolMask(list=facingOrientation_11, mask=condição_if_de_lista_aninhada_11.resultado)

# group: TAG Vertical Neg
boolean_48 = BoolSelector(false)
clean_46 = List.Clean(list=filterByBoolMask_35.in, preserveIndices=boolean_48)
flatten_25 = List.Flatten(list=clean_46)
boolean_49 = BoolSelector(false)
clean_47 = List.Clean(list=filterByBoolMask_35.in, preserveIndices=boolean_49)
getLocation_15 = Element.GetLocation(element=clean_47)
boolean_50 = BoolSelector(false)
clean_48 = List.Clean(list=filterByBoolMask_36.in, preserveIndices=boolean_50)
offset_da_tag_11 = DoubleInput(0.25)
translate_21 = Geometry.Translate(geometry=getLocation_15, direction=clean_48, distance=offset_da_tag_11)
facingOrientation_14 = FamilyInstance.FacingOrientation(familyInstance=clean_47)
ZAxis_11 = Vector.ZAxis()
cross_11 = Vector.Cross(vector=facingOrientation_14, cross=ZAxis_11)
offset_da_2ª_tag_11 = DoubleInput(0.2)
translate_22 = Geometry.Translate(geometry=translate_21, direction=cross_11, distance=offset_da_2ª_tag_11)
boolean_51 = BoolSelector(false)
clean_49 = List.Clean(list=translate_22, preserveIndices=boolean_51)
flatten_26 = List.Flatten(list=clean_49)
tag_byelement_11 = Custom[👓 Tag․ByElement](element=flatten_25, TagLocation=flatten_26, TagType=getItemAtIndex)

# group: x
gt_6 = round_5 > code_block_39

# group: y
le_6 = round_6 <= code_block_40

# group (continued): 1 TOMADA SIMPLES
condição_if_de_lista_aninhada_12 = CodeBlock(x=gt_6, y=le_6, cond1=code_block_44.out0, cond2=code_block_44.out1) { indx = (x == true) && (y == true) ? 0 : 1; resultado = [cond1, cond2][indx]; }
filterByBoolMask_37 = List.FilterByBoolMask(list=clean_37, mask=condição_if_de_lista_aninhada_12.resultado, lacing=Longest)
filterByBoolMask_38 = List.FilterByBoolMask(list=facingOrientation_11, mask=condição_if_de_lista_aninhada_12.resultado)

# group: TAG Horizontal Pos
boolean_52 = BoolSelector(false)
clean_50 = List.Clean(list=filterByBoolMask_37.in, preserveIndices=boolean_52)
flatten_27 = List.Flatten(list=clean_50)
boolean_53 = BoolSelector(false)
clean_51 = List.Clean(list=filterByBoolMask_37.in, preserveIndices=boolean_53)
getLocation_16 = Element.GetLocation(element=clean_51)
boolean_54 = BoolSelector(false)
clean_52 = List.Clean(list=filterByBoolMask_38.in, preserveIndices=boolean_54)
ZAxis_12 = Vector.ZAxis()
cross_12 = Vector.Cross(vector=clean_52, cross=ZAxis_12)
offset_da_tag_12 = DoubleInput(0.2)
translate_23 = Geometry.Translate(geometry=getLocation_16, direction=cross_12, distance=offset_da_tag_12)
facingOrientation_15 = FamilyInstance.FacingOrientation(familyInstance=clean_51)
offset_da_2ª_tag_12 = DoubleInput(0.15)
translate_24 = Geometry.Translate(geometry=translate_23, direction=facingOrientation_15, distance=offset_da_2ª_tag_12)
boolean_55 = BoolSelector(false)
clean_53 = List.Clean(list=translate_24, preserveIndices=boolean_55)
flatten_28 = List.Flatten(list=clean_53)
tag_byelement_12 = Custom[👓 Tag․ByElement](element=flatten_27, TagLocation=flatten_28, TagType=getItemAtIndex)

# group: 1ª TOMADA
code_block_45 = CodeBlock { 0; }
getItemAtIndex_5 = List.GetItemAtIndex(list=flatten_4, index=code_block_45, lacing=Longest)
boolean_56 = BoolSelector(false)
clean_54 = List.Clean(list=getItemAtIndex_5, preserveIndices=boolean_56)
facingOrientation_16 = FamilyInstance.FacingOrientation(familyInstance=clean_54)
X_4 = Vector.X(vector=facingOrientation_16)
code_block_46 = CodeBlock { 2; }
round_7 = Math.Round(number=X_4, digits=code_block_46)
code_block_47 = CodeBlock { 0; }
Y_4 = Vector.Y(vector=facingOrientation_16)
round_8 = Math.Round(number=Y_4, digits=code_block_46)
code_block_48 = CodeBlock { 0; }
code_block_49 = CodeBlock { true; false; }
code_block_50 = CodeBlock { true; false; }
code_block_51 = CodeBlock { true; false; }
code_block_52 = CodeBlock { true; false; }
getLocation_17 = Element.GetLocation(element=clean_54)
byStartPointDirectionLength_3 = Line.ByStartPointDirectionLength(startPoint=getLocation_17, direction=facingOrientation_16)

# group: x
ge_7 = round_7 >= code_block_47

# group: y
gt_7 = round_8 > code_block_48

# group (continued): 1ª TOMADA
condição_if_de_lista_aninhada_13 = CodeBlock(x=ge_7, y=gt_7, cond1=code_block_49.out0, cond2=code_block_49.out1) { indx = (x == true) && (y == true) ? 0 : 1; resultado = [cond1, cond2][indx]; }
filterByBoolMask_39 = List.FilterByBoolMask(list=clean_54, mask=condição_if_de_lista_aninhada_13.resultado, lacing=Longest)
filterByBoolMask_40 = List.FilterByBoolMask(list=facingOrientation_16, mask=condição_if_de_lista_aninhada_13.resultado)

# group: TAG Horizontal Pos
boolean_57 = BoolSelector(false)
clean_55 = List.Clean(list=filterByBoolMask_39.in, preserveIndices=boolean_57)
flatten_29 = List.Flatten(list=clean_55)
boolean_58 = BoolSelector(false)
clean_56 = List.Clean(list=filterByBoolMask_39.in, preserveIndices=boolean_58)
getLocation_18 = Element.GetLocation(element=clean_56)
boolean_59 = BoolSelector(false)
clean_57 = List.Clean(list=filterByBoolMask_40.in, preserveIndices=boolean_59)
offset_da_tag_13 = DoubleInput(0.05)
facingOrientation_17 = FamilyInstance.FacingOrientation(familyInstance=clean_56)
ZAxis_13 = Vector.ZAxis()
cross_13 = Vector.Cross(vector=facingOrientation_17, cross=ZAxis_13)
offset_da_2ª_tag_13 = DoubleInput(0.05)
boolean_60 = BoolSelector(false)

mul_17 = offset_da_tag_13 * getItemAtIndex_2

# group (continued): TAG Horizontal Pos
translate_25 = Geometry.Translate(geometry=getLocation_18, direction=clean_57, distance=mul_17)

mul_18 = offset_da_2ª_tag_13 * getItemAtIndex_2

# group (continued): TAG Horizontal Pos
translate_26 = Geometry.Translate(geometry=translate_25, direction=cross_13, distance=mul_18)
clean_58 = List.Clean(list=translate_26, preserveIndices=boolean_60)
flatten_30 = List.Flatten(list=clean_58)
tag_byelement_13 = Custom[👓 Tag․ByElement](element=flatten_29, TagLocation=flatten_30, TagType=getItemAtIndex)

# group: x
lt_7 = round_7 < code_block_47

# group: y
ge_8 = round_8 >= code_block_48

# group (continued): 1ª TOMADA
condição_if_de_lista_aninhada_14 = CodeBlock(x=lt_7, y=ge_8, cond1=code_block_50.out0, cond2=code_block_50.out1) { indx = (x == true) && (y == true) ? 0 : 1; resultado = [cond1, cond2][indx]; }
filterByBoolMask_41 = List.FilterByBoolMask(list=clean_54, mask=condição_if_de_lista_aninhada_14.resultado, lacing=Longest)
filterByBoolMask_42 = List.FilterByBoolMask(list=facingOrientation_16, mask=condição_if_de_lista_aninhada_14.resultado)

# group: TAG HOR Neg
boolean_61 = BoolSelector(false)
clean_59 = List.Clean(list=filterByBoolMask_41.in, preserveIndices=boolean_61)
flatten_31 = List.Flatten(list=clean_59)
boolean_62 = BoolSelector(false)
clean_60 = List.Clean(list=filterByBoolMask_41.in, preserveIndices=boolean_62)
getLocation_19 = Element.GetLocation(element=clean_60)
boolean_63 = BoolSelector(false)
clean_61 = List.Clean(list=filterByBoolMask_42.in, preserveIndices=boolean_63)
ZAxis_14 = Vector.ZAxis()
cross_14 = Vector.Cross(vector=clean_61, cross=ZAxis_14)
offset_da_tag_y = DoubleInput(0.05)
facingOrientation_18 = FamilyInstance.FacingOrientation(familyInstance=clean_60)
offset_da_2ª_tag_14 = DoubleInput(0.1)
boolean_64 = BoolSelector(false)

mul_19 = offset_da_tag_y * getItemAtIndex_2

# group (continued): TAG HOR Neg
translate_27 = Geometry.Translate(geometry=getLocation_19, direction=cross_14, distance=mul_19)

mul_20 = offset_da_2ª_tag_14 * getItemAtIndex_2

# group (continued): TAG HOR Neg
translate_28 = Geometry.Translate(geometry=translate_27, direction=facingOrientation_18, distance=mul_20)
clean_62 = List.Clean(list=translate_28, preserveIndices=boolean_64)
flatten_32 = List.Flatten(list=clean_62)
tag_byelement_14 = Custom[👓 Tag․ByElement](element=flatten_31, TagLocation=flatten_32, TagType=getItemAtIndex)

# group: x
le_7 = round_7 <= code_block_47

# group: y
lt_8 = round_8 < code_block_48

# group (continued): 1ª TOMADA
condição_if_de_lista_aninhada_15 = CodeBlock(x=le_7, y=lt_8, cond1=code_block_51.out0, cond2=code_block_51.out1) { indx = (x == true) && (y == true) ? 0 : 1; resultado = [cond1, cond2][indx]; }
filterByBoolMask_43 = List.FilterByBoolMask(list=clean_54, mask=condição_if_de_lista_aninhada_15.resultado, lacing=Longest)
filterByBoolMask_44 = List.FilterByBoolMask(list=facingOrientation_16, mask=condição_if_de_lista_aninhada_15.resultado)

# group: TAG Horizontal Pos
boolean_65 = BoolSelector(false)
clean_63 = List.Clean(list=filterByBoolMask_43.in, preserveIndices=boolean_65)
flatten_33 = List.Flatten(list=clean_63)
boolean_66 = BoolSelector(false)
clean_64 = List.Clean(list=filterByBoolMask_43.in, preserveIndices=boolean_66)
getLocation_20 = Element.GetLocation(element=clean_64)
boolean_67 = BoolSelector(false)
clean_65 = List.Clean(list=filterByBoolMask_44.in, preserveIndices=boolean_67)
offset_da_tag_14 = DoubleInput(0.2)
facingOrientation_19 = FamilyInstance.FacingOrientation(familyInstance=clean_64)
ZAxis_15 = Vector.ZAxis()
cross_15 = Vector.Cross(vector=facingOrientation_19, cross=ZAxis_15)
offset_da_2ª_tag_15 = DoubleInput(0.2)
boolean_68 = BoolSelector(false)

mul_21 = offset_da_tag_14 * getItemAtIndex_2

# group (continued): TAG Horizontal Pos
translate_29 = Geometry.Translate(geometry=getLocation_20, direction=clean_65, distance=mul_21)

mul_22 = offset_da_2ª_tag_15 * getItemAtIndex_2

# group (continued): TAG Horizontal Pos
translate_30 = Geometry.Translate(geometry=translate_29, direction=cross_15, distance=mul_22)
clean_66 = List.Clean(list=translate_30, preserveIndices=boolean_68)
flatten_34 = List.Flatten(list=clean_66)
tag_byelement_15 = Custom[👓 Tag․ByElement](element=flatten_33, TagLocation=flatten_34, TagType=getItemAtIndex)

# group: x
gt_8 = round_7 > code_block_47

# group: y
le_8 = round_8 <= code_block_48

# group (continued): 1ª TOMADA
condição_if_de_lista_aninhada_16 = CodeBlock(x=gt_8, y=le_8, cond1=code_block_52.out0, cond2=code_block_52.out1) { indx = (x == true) && (y == true) ? 0 : 1; resultado = [cond1, cond2][indx]; }
filterByBoolMask_45 = List.FilterByBoolMask(list=clean_54, mask=condição_if_de_lista_aninhada_16.resultado, lacing=Longest)
filterByBoolMask_46 = List.FilterByBoolMask(list=facingOrientation_16, mask=condição_if_de_lista_aninhada_16.resultado)

# group: TAG HOR Pos
boolean_69 = BoolSelector(false)
clean_67 = List.Clean(list=filterByBoolMask_45.in, preserveIndices=boolean_69)
flatten_35 = List.Flatten(list=clean_67)
boolean_70 = BoolSelector(false)
clean_68 = List.Clean(list=filterByBoolMask_45.in, preserveIndices=boolean_70)
getLocation_21 = Element.GetLocation(element=clean_68)
boolean_71 = BoolSelector(false)
clean_69 = List.Clean(list=filterByBoolMask_46.in, preserveIndices=boolean_71)
ZAxis_16 = Vector.ZAxis()
cross_16 = Vector.Cross(vector=clean_69, cross=ZAxis_16)
offset_da_tag_15 = DoubleInput(0.22)
facingOrientation_20 = FamilyInstance.FacingOrientation(familyInstance=clean_68)
offset_da_2ª_tag_16 = DoubleInput(0.05)
boolean_72 = BoolSelector(false)

mul_23 = offset_da_tag_15 * getItemAtIndex_2

# group (continued): TAG HOR Pos
translate_31 = Geometry.Translate(geometry=getLocation_21, direction=cross_16, distance=mul_23)

mul_24 = offset_da_2ª_tag_16 * getItemAtIndex_2

# group (continued): TAG HOR Pos
translate_32 = Geometry.Translate(geometry=translate_31, direction=facingOrientation_20, distance=mul_24)
clean_70 = List.Clean(list=translate_32, preserveIndices=boolean_72)
flatten_36 = List.Flatten(list=clean_70)
tag_byelement_16 = Custom[👓 Tag․ByElement](element=flatten_35, TagLocation=flatten_36, TagType=getItemAtIndex)

# group: CONJUNTOS + 1 OU +2 OU +3 TOMADAS
list_create_2 = List.Create(item0=filterByBoolMask_7.in, item1=filterByBoolMask_8.in, item2=filterByBoolMask_9.in, item3=filterByBoolMask_10.in)
flatten_37 = List.Flatten(list=list_create_2)
getChildElements_2 = Element.GetChildElements(element=flatten_37)
python_script_4 = Python(IN[0]=getChildElements_2, IN[1]=taggedElement)  # same code as python_script_2
string_from_object_13 = FromObject(object=python_script_4)
code_block_53 = CodeBlock { ["Caixa de Luz"]; }
contains_15 = String.Contains(str=string_from_object_13@L2, searchFor=code_block_53, lacing=Longest)
filterByBoolMask_47 = List.FilterByBoolMask(list=python_script_4@L2, mask=contains_15@L2)
string_from_object_14 = FromObject(object=filterByBoolMask_47.out)
code_block_54 = CodeBlock { ["Tomada"]; }
contains_16 = String.Contains(str=string_from_object_14@L2, searchFor=code_block_54, lacing=Longest)
filterByBoolMask_48 = List.FilterByBoolMask(list=filterByBoolMask_47.out@L2, mask=contains_16@L2)
boolean_73 = BoolSelector(false)
clean_71 = List.Clean(list=filterByBoolMask_48.in, preserveIndices=boolean_73)
getLocation_22 = Element.GetLocation(element=clean_71)
Z_2 = Point.Z(point=getLocation_22)
sortByKey_2 = List.SortByKey(list=clean_71, keys=Z_2, lacing=Longest)
boolean_74 = BoolSelector(false)
clean_72 = List.Clean(list=sortByKey_2.sorted_list, preserveIndices=boolean_74)

# group: 1ª TOMADA
code_block_55 = CodeBlock { 0; }
getItemAtIndex_6 = List.GetItemAtIndex(list=clean_72, index=code_block_55, lacing=Longest)
facingOrientation_21 = FamilyInstance.FacingOrientation(familyInstance=getItemAtIndex_6)
X_5 = Vector.X(vector=facingOrientation_21)
code_block_56 = CodeBlock { 2; }
round_9 = Math.Round(number=X_5, digits=code_block_56)
code_block_57 = CodeBlock { 0; }
Y_5 = Vector.Y(vector=facingOrientation_21)
round_10 = Math.Round(number=Y_5, digits=code_block_56)
code_block_58 = CodeBlock { 0; }
code_block_59 = CodeBlock { true; false; }
code_block_60 = CodeBlock { true; false; }
code_block_61 = CodeBlock { true; false; }
code_block_62 = CodeBlock { true; false; }
getLocation_23 = Element.GetLocation(element=getItemAtIndex_6)
byStartPointDirectionLength_4 = Line.ByStartPointDirectionLength(startPoint=getLocation_23, direction=facingOrientation_21)

# group: x
ge_9 = round_9 >= code_block_57

# group: y
gt_9 = round_10 > code_block_58

# group (continued): 1ª TOMADA
condição_if_de_lista_aninhada_17 = CodeBlock(x=ge_9, y=gt_9, cond1=code_block_59.out0, cond2=code_block_59.out1) { indx = (x == true) && (y == true) ? 0 : 1; resultado = [cond1, cond2][indx]; }
filterByBoolMask_49 = List.FilterByBoolMask(list=getItemAtIndex_6, mask=condição_if_de_lista_aninhada_17.resultado, lacing=Longest)
filterByBoolMask_50 = List.FilterByBoolMask(list=facingOrientation_21, mask=condição_if_de_lista_aninhada_17.resultado)

# group: TAG VERT Pos
boolean_75 = BoolSelector(false)
clean_73 = List.Clean(list=filterByBoolMask_49.in, preserveIndices=boolean_75)
flatten_38 = List.Flatten(list=clean_73)
boolean_76 = BoolSelector(false)
clean_74 = List.Clean(list=filterByBoolMask_49.in, preserveIndices=boolean_76)
getLocation_24 = Element.GetLocation(element=clean_74)
boolean_77 = BoolSelector(false)
clean_75 = List.Clean(list=filterByBoolMask_50.in, preserveIndices=boolean_77)
offset_da_tag_16 = DoubleInput(0.05)
mul_25 = offset_da_tag_16 * getItemAtIndex_2
translate_33 = Geometry.Translate(geometry=getLocation_24, direction=clean_75, distance=mul_25)
facingOrientation_22 = FamilyInstance.FacingOrientation(familyInstance=clean_74)
ZAxis_17 = Vector.ZAxis()
cross_17 = Vector.Cross(vector=facingOrientation_22, cross=ZAxis_17)
reverse_3 = Vector.Reverse(vector=cross_17)
offset_da_2ª_tag_17 = DoubleInput(0.31)
mul_26 = offset_da_2ª_tag_17 * getItemAtIndex_2
translate_34 = Geometry.Translate(geometry=translate_33, direction=reverse_3, distance=mul_26)
boolean_78 = BoolSelector(false)
clean_76 = List.Clean(list=translate_34, preserveIndices=boolean_78)
flatten_39 = List.Flatten(list=clean_76)
tag_byelement_17 = Custom[👓 Tag․ByElement](element=flatten_38, TagLocation=flatten_39, TagType=getItemAtIndex)

# group: x
lt_9 = round_9 < code_block_57

# group: y
ge_10 = round_10 >= code_block_58

# group (continued): 1ª TOMADA
condição_if_de_lista_aninhada_18 = CodeBlock(x=lt_9, y=ge_10, cond1=code_block_60.out0, cond2=code_block_60.out1) { indx = (x == true) && (y == true) ? 0 : 1; resultado = [cond1, cond2][indx]; }
filterByBoolMask_51 = List.FilterByBoolMask(list=getItemAtIndex_6, mask=condição_if_de_lista_aninhada_18.resultado, lacing=Longest)
filterByBoolMask_52 = List.FilterByBoolMask(list=facingOrientation_21, mask=condição_if_de_lista_aninhada_18.resultado)

# group: TAG HOR Neg
boolean_79 = BoolSelector(false)
clean_77 = List.Clean(list=filterByBoolMask_51.in, preserveIndices=boolean_79)
flatten_40 = List.Flatten(list=clean_77)
boolean_80 = BoolSelector(false)
clean_78 = List.Clean(list=filterByBoolMask_51.in, preserveIndices=boolean_80)
getLocation_25 = Element.GetLocation(element=clean_78)
boolean_81 = BoolSelector(false)
clean_79 = List.Clean(list=filterByBoolMask_52.in, preserveIndices=boolean_81)
ZAxis_18 = Vector.ZAxis()
cross_18 = Vector.Cross(vector=clean_79, cross=ZAxis_18)
reverse_4 = Vector.Reverse(vector=cross_18)
offset_da_tag_y_2 = DoubleInput(0.35)
mul_27 = offset_da_tag_y_2 * getItemAtIndex_2
translate_35 = Geometry.Translate(geometry=getLocation_25, direction=reverse_4, distance=mul_27)
facingOrientation_23 = FamilyInstance.FacingOrientation(familyInstance=clean_78)
offset_da_2ª_tag_18 = DoubleInput(0.15)
mul_28 = offset_da_2ª_tag_18 * getItemAtIndex_2
translate_36 = Geometry.Translate(geometry=translate_35, direction=facingOrientation_23, distance=mul_28)
boolean_82 = BoolSelector(false)
clean_80 = List.Clean(list=translate_36, preserveIndices=boolean_82)
flatten_41 = List.Flatten(list=clean_80)
tag_byelement_18 = Custom[👓 Tag․ByElement](element=flatten_40, TagLocation=flatten_41, TagType=getItemAtIndex)

# group: x
le_9 = round_9 <= code_block_57

# group: y
lt_10 = round_10 < code_block_58

# group (continued): 1ª TOMADA
condição_if_de_lista_aninhada_19 = CodeBlock(x=le_9, y=lt_10, cond1=code_block_61.out0, cond2=code_block_61.out1) { indx = (x == true) && (y == true) ? 0 : 1; resultado = [cond1, cond2][indx]; }
filterByBoolMask_53 = List.FilterByBoolMask(list=getItemAtIndex_6, mask=condição_if_de_lista_aninhada_19.resultado, lacing=Longest)
filterByBoolMask_54 = List.FilterByBoolMask(list=facingOrientation_21, mask=condição_if_de_lista_aninhada_19.resultado)

# group: TAG VERT Neg
boolean_83 = BoolSelector(false)
clean_81 = List.Clean(list=filterByBoolMask_53.in, preserveIndices=boolean_83)
flatten_42 = List.Flatten(list=clean_81)
boolean_84 = BoolSelector(false)
clean_82 = List.Clean(list=filterByBoolMask_53.in, preserveIndices=boolean_84)
getLocation_26 = Element.GetLocation(element=clean_82)
boolean_85 = BoolSelector(false)
clean_83 = List.Clean(list=filterByBoolMask_54.in, preserveIndices=boolean_85)
offset_da_tag_17 = DoubleInput(0.25)
mul_29 = offset_da_tag_17 * getItemAtIndex_2
translate_37 = Geometry.Translate(geometry=getLocation_26, direction=clean_83, distance=mul_29)
facingOrientation_24 = FamilyInstance.FacingOrientation(familyInstance=clean_82)
ZAxis_19 = Vector.ZAxis()
cross_19 = Vector.Cross(vector=facingOrientation_24, cross=ZAxis_19)
reverse_5 = Vector.Reverse(vector=cross_19)
offset_da_2ª_tag_19 = DoubleInput(0.17)
mul_30 = offset_da_2ª_tag_19 * getItemAtIndex_2
translate_38 = Geometry.Translate(geometry=translate_37, direction=reverse_5, distance=mul_30)
boolean_86 = BoolSelector(false)
clean_84 = List.Clean(list=translate_38, preserveIndices=boolean_86)
flatten_43 = List.Flatten(list=clean_84)
tag_byelement_19 = Custom[👓 Tag․ByElement](element=flatten_42, TagLocation=flatten_43, TagType=getItemAtIndex)

# group: x
gt_10 = round_9 > code_block_57

# group: y
le_10 = round_10 <= code_block_58

# group (continued): 1ª TOMADA
condição_if_de_lista_aninhada_20 = CodeBlock(x=gt_10, y=le_10, cond1=code_block_62.out0, cond2=code_block_62.out1) { indx = (x == true) && (y == true) ? 0 : 1; resultado = [cond1, cond2][indx]; }
filterByBoolMask_55 = List.FilterByBoolMask(list=getItemAtIndex_6, mask=condição_if_de_lista_aninhada_20.resultado, lacing=Longest)
filterByBoolMask_56 = List.FilterByBoolMask(list=facingOrientation_21, mask=condição_if_de_lista_aninhada_20.resultado)

# group: TAG HOR Pos
boolean_87 = BoolSelector(false)
clean_85 = List.Clean(list=filterByBoolMask_55.in, preserveIndices=boolean_87)
flatten_44 = List.Flatten(list=clean_85)
boolean_88 = BoolSelector(false)
clean_86 = List.Clean(list=filterByBoolMask_55.in, preserveIndices=boolean_88)
getLocation_27 = Element.GetLocation(element=clean_86)
boolean_89 = BoolSelector(false)
clean_87 = List.Clean(list=filterByBoolMask_56.in, preserveIndices=boolean_89)
ZAxis_20 = Vector.ZAxis()
cross_20 = Vector.Cross(vector=clean_87, cross=ZAxis_20)
reverse_6 = Vector.Reverse(vector=cross_20)
offset_da_tag_y_3 = DoubleInput(0.15)
mul_31 = offset_da_tag_y_3 * getItemAtIndex_2
translate_39 = Geometry.Translate(geometry=getLocation_27, direction=reverse_6, distance=mul_31)
facingOrientation_25 = FamilyInstance.FacingOrientation(familyInstance=clean_86)
offset_da_2ª_tag_20 = DoubleInput(0.1)
mul_32 = offset_da_2ª_tag_20 * getItemAtIndex_2
translate_40 = Geometry.Translate(geometry=translate_39, direction=facingOrientation_25, distance=mul_32)
boolean_90 = BoolSelector(false)
clean_88 = List.Clean(list=translate_40, preserveIndices=boolean_90)
flatten_45 = List.Flatten(list=clean_88)
tag_byelement_20 = Custom[👓 Tag․ByElement](element=flatten_44, TagLocation=flatten_45, TagType=getItemAtIndex)

# group: Ponto de Força
string_from_object_15 = FromObject(object=python_script_2)
code_block_63 = CodeBlock { ["Ponto de Força"]; }
contains_17 = String.Contains(str=string_from_object_15@L2, searchFor=code_block_63, lacing=Longest)
filterByBoolMask_57 = List.FilterByBoolMask(list=python_script_2@L2, mask=contains_17@L2)
code_block_64 = CodeBlock { ["Estação"]; }
boolean_91 = BoolSelector(false)
code_block_65 = CodeBlock { 2; }
code_block_66 = CodeBlock { 0; }
code_block_67 = CodeBlock { 0; }
code_block_68 = CodeBlock { true; false; }
code_block_69 = CodeBlock { true; false; }
code_block_70 = CodeBlock { true; false; }
code_block_71 = CodeBlock { true; false; }

getFamily_4 = FamilyInstance.GetFamily(familyInstance=filterByBoolMask_57.out@L2)
string_from_object_16 = FromObject(obj=getFamily_4)
code_block_72 = CodeBlock { ["Industrial"]; }
contains_18 = String.Contains(str=string_from_object_16@L2, searchFor=code_block_72, lacing=Longest)
filterByBoolMask_58 = List.FilterByBoolMask(list=filterByBoolMask_57.out@L2, mask=contains_18@L2)

# group (continued): Ponto de Força
string_from_object_17 = FromObject(obj=filterByBoolMask_58.out)
contains_19 = String.Contains(str=string_from_object_17@L2, searchFor=code_block_64, lacing=Longest)
filterByBoolMask_59 = List.FilterByBoolMask(list=filterByBoolMask_58.out@L2, mask=contains_19@L2)
list_create_3 = List.Create(item0=filterByBoolMask_57.in, item1=filterByBoolMask_58.in, item2=filterByBoolMask_59.in, item3=filterByBoolMask_3.in, item4=filterByBoolMask_4.in)
clean_89 = List.Clean(list=list_create_3, preserveIndices=boolean_91)

string_from_object_18 = FromObject(obj=clean_89)
code_block_73 = CodeBlock { ["x.Módulo"]; }
contains_20 = String.Contains(str=string_from_object_18@L2, searchFor=code_block_73, lacing=Longest)
filterByBoolMask_60 = List.FilterByBoolMask(list=clean_89@L2, mask=contains_20@L2)
flatten_46 = List.Flatten(list=filterByBoolMask_60.out)

# group (continued): Ponto de Força
facingOrientation_26 = FamilyInstance.FacingOrientation(familyInstance=flatten_46)
X_6 = Vector.X(vector=facingOrientation_26)
round_11 = Math.Round(number=X_6, digits=code_block_65)
Y_6 = Vector.Y(vector=facingOrientation_26)
round_12 = Math.Round(number=Y_6, digits=code_block_65)
getLocation_28 = Element.GetLocation(element=flatten_46)
byStartPointDirectionLength_5 = Line.ByStartPointDirectionLength(startPoint=getLocation_28, direction=facingOrientation_26)

# group: x
ge_11 = round_11 >= code_block_66

# group: y
gt_11 = round_12 > code_block_67

# group (continued): Ponto de Força
condição_if_de_lista_aninhada_21 = CodeBlock(x=ge_11, y=gt_11, cond1=code_block_68.out0, cond2=code_block_68.out1) { indx = (x == true) && (y == true) ? 0 : 1; resultado = [cond1, cond2][indx]; }
filterByBoolMask_61 = List.FilterByBoolMask(list=flatten_46, mask=condição_if_de_lista_aninhada_21.resultado, lacing=Longest)
filterByBoolMask_62 = List.FilterByBoolMask(list=facingOrientation_26, mask=condição_if_de_lista_aninhada_21.resultado)

# group: TAG VERT Pos
boolean_92 = BoolSelector(false)
clean_90 = List.Clean(list=filterByBoolMask_61.in, preserveIndices=boolean_92)
flatten_47 = List.Flatten(list=clean_90)
boolean_93 = BoolSelector(false)
clean_91 = List.Clean(list=filterByBoolMask_61.in, preserveIndices=boolean_93)
getLocation_29 = Element.GetLocation(element=clean_91)
boolean_94 = BoolSelector(false)
clean_92 = List.Clean(list=filterByBoolMask_62.in, preserveIndices=boolean_94)
offset_da_tag_y_4 = DoubleInput(0.1)
facingOrientation_27 = FamilyInstance.FacingOrientation(familyInstance=clean_91)
ZAxis_21 = Vector.ZAxis()
cross_21 = Vector.Cross(vector=facingOrientation_27, cross=ZAxis_21)
offset_da_2ª_tag_21 = DoubleInput(0.05)
boolean_95 = BoolSelector(false)

mul_33 = offset_da_tag_y_4 * getItemAtIndex_2

# group (continued): TAG VERT Pos
translate_41 = Geometry.Translate(geometry=getLocation_29, direction=clean_92, distance=mul_33)

mul_34 = offset_da_2ª_tag_21 * getItemAtIndex_2

# group (continued): TAG VERT Pos
translate_42 = Geometry.Translate(geometry=translate_41, direction=cross_21, distance=mul_34)
clean_93 = List.Clean(list=translate_42, preserveIndices=boolean_95)
flatten_48 = List.Flatten(list=clean_93)
tag_byelement_21 = Custom[👓 Tag․ByElement](element=flatten_47, TagLocation=flatten_48, TagType=getItemAtIndex)

# group: x
lt_11 = round_11 < code_block_66

# group: y
ge_12 = round_12 >= code_block_67

# group (continued): Ponto de Força
condição_if_de_lista_aninhada_22 = CodeBlock(x=lt_11, y=ge_12, cond1=code_block_69.out0, cond2=code_block_69.out1) { indx = (x == true) && (y == true) ? 0 : 1; resultado = [cond1, cond2][indx]; }
filterByBoolMask_63 = List.FilterByBoolMask(list=flatten_46, mask=condição_if_de_lista_aninhada_22.resultado, lacing=Longest)
filterByBoolMask_64 = List.FilterByBoolMask(list=facingOrientation_26, mask=condição_if_de_lista_aninhada_22.resultado)

# group: TAG HOR Neg
boolean_96 = BoolSelector(false)
clean_94 = List.Clean(list=filterByBoolMask_63.in, preserveIndices=boolean_96)
flatten_49 = List.Flatten(list=clean_94)
boolean_97 = BoolSelector(false)
clean_95 = List.Clean(list=filterByBoolMask_63.in, preserveIndices=boolean_97)
getLocation_30 = Element.GetLocation(element=clean_95)
boolean_98 = BoolSelector(false)
clean_96 = List.Clean(list=filterByBoolMask_64.in, preserveIndices=boolean_98)
ZAxis_22 = Vector.ZAxis()
cross_22 = Vector.Cross(vector=clean_96, cross=ZAxis_22)
offset_da_tag_y_5 = DoubleInput(0.05)
facingOrientation_28 = FamilyInstance.FacingOrientation(familyInstance=clean_95)
offset_da_2ª_tag_22 = DoubleInput(0.15)
boolean_99 = BoolSelector(false)

mul_35 = offset_da_tag_y_5 * getItemAtIndex_2

# group (continued): TAG HOR Neg
translate_43 = Geometry.Translate(geometry=getLocation_30, direction=cross_22, distance=mul_35)

mul_36 = offset_da_2ª_tag_22 * getItemAtIndex_2

# group (continued): TAG HOR Neg
translate_44 = Geometry.Translate(geometry=translate_43, direction=facingOrientation_28, distance=mul_36)
clean_97 = List.Clean(list=translate_44, preserveIndices=boolean_99)
flatten_50 = List.Flatten(list=clean_97)
tag_byelement_22 = Custom[👓 Tag․ByElement](element=flatten_49, TagLocation=flatten_50, TagType=getItemAtIndex)

# group: x
le_11 = round_11 <= code_block_66

# group: y
lt_12 = round_12 < code_block_67

# group (continued): Ponto de Força
condição_if_de_lista_aninhada_23 = CodeBlock(x=le_11, y=lt_12, cond1=code_block_70.out0, cond2=code_block_70.out1) { indx = (x == true) && (y == true) ? 0 : 1; resultado = [cond1, cond2][indx]; }
filterByBoolMask_65 = List.FilterByBoolMask(list=flatten_46, mask=condição_if_de_lista_aninhada_23.resultado, lacing=Longest)
filterByBoolMask_66 = List.FilterByBoolMask(list=facingOrientation_26, mask=condição_if_de_lista_aninhada_23.resultado)

# group: TAG VERT NEG
boolean_100 = BoolSelector(false)
clean_98 = List.Clean(list=filterByBoolMask_65.in, preserveIndices=boolean_100)
flatten_51 = List.Flatten(list=clean_98)
boolean_101 = BoolSelector(false)
clean_99 = List.Clean(list=filterByBoolMask_65.in, preserveIndices=boolean_101)
getLocation_31 = Element.GetLocation(element=clean_99)
boolean_102 = BoolSelector(false)
clean_100 = List.Clean(list=filterByBoolMask_66.in, preserveIndices=boolean_102)
offset_da_tag_y_6 = DoubleInput(0.25)
facingOrientation_29 = FamilyInstance.FacingOrientation(familyInstance=clean_99)
ZAxis_23 = Vector.ZAxis()
cross_23 = Vector.Cross(vector=facingOrientation_29, cross=ZAxis_23)
offset_da_2ª_tag_23 = DoubleInput(0.18)
boolean_103 = BoolSelector(false)

mul_37 = offset_da_tag_y_6 * getItemAtIndex_2

# group (continued): TAG VERT NEG
translate_45 = Geometry.Translate(geometry=getLocation_31, direction=clean_100, distance=mul_37)

mul_38 = offset_da_2ª_tag_23 * getItemAtIndex_2

# group (continued): TAG VERT NEG
translate_46 = Geometry.Translate(geometry=translate_45, direction=cross_23, distance=mul_38)
clean_101 = List.Clean(list=translate_46, preserveIndices=boolean_103)
flatten_52 = List.Flatten(list=clean_101)
tag_byelement_23 = Custom[👓 Tag․ByElement](element=flatten_51, TagLocation=flatten_52, TagType=getItemAtIndex)

# group: x
gt_12 = round_11 > code_block_66

# group: y
le_12 = round_12 <= code_block_67

# group (continued): Ponto de Força
condição_if_de_lista_aninhada_24 = CodeBlock(x=gt_12, y=le_12, cond1=code_block_71.out0, cond2=code_block_71.out1) { indx = (x == true) && (y == true) ? 0 : 1; resultado = [cond1, cond2][indx]; }
filterByBoolMask_67 = List.FilterByBoolMask(list=flatten_46, mask=condição_if_de_lista_aninhada_24.resultado, lacing=Longest)
filterByBoolMask_68 = List.FilterByBoolMask(list=facingOrientation_26, mask=condição_if_de_lista_aninhada_24.resultado)

# group: TAG HOR Pos
boolean_104 = BoolSelector(false)
clean_102 = List.Clean(list=filterByBoolMask_67.in, preserveIndices=boolean_104)
flatten_53 = List.Flatten(list=clean_102)
boolean_105 = BoolSelector(false)
clean_103 = List.Clean(list=filterByBoolMask_67.in, preserveIndices=boolean_105)
getLocation_32 = Element.GetLocation(element=clean_103)
boolean_106 = BoolSelector(false)
clean_104 = List.Clean(list=filterByBoolMask_68.in, preserveIndices=boolean_106)
ZAxis_24 = Vector.ZAxis()
cross_24 = Vector.Cross(vector=clean_104, cross=ZAxis_24)
offset_da_tag_y_7 = DoubleInput(0.2)
facingOrientation_30 = FamilyInstance.FacingOrientation(familyInstance=clean_103)
offset_da_2ª_tag_24 = DoubleInput(0.15)
boolean_107 = BoolSelector(false)

mul_39 = offset_da_tag_y_7 * getItemAtIndex_2

# group (continued): TAG HOR Pos
translate_47 = Geometry.Translate(geometry=getLocation_32, direction=cross_24, distance=mul_39)

mul_40 = offset_da_2ª_tag_24 * getItemAtIndex_2

# group (continued): TAG HOR Pos
translate_48 = Geometry.Translate(geometry=translate_47, direction=facingOrientation_30, distance=mul_40)
clean_105 = List.Clean(list=translate_48, preserveIndices=boolean_107)
flatten_54 = List.Flatten(list=clean_105)
tag_byelement_24 = Custom[👓 Tag․ByElement](element=flatten_53, TagLocation=flatten_54, TagType=getItemAtIndex)

watch = Watch(filterByBoolMask_5.in)
watch_2 = Watch(filterByBoolMask_7.in)
watch_3 = Watch(filterByBoolMask_9.in)
watch_4 = Watch(filterByBoolMask_10.in)
watch_5 = Watch(filterByBoolMask_8.in)

# group: 1ª TOMADA
code_block_74 = CodeBlock { 1; }
getItemAtIndex_7 = List.GetItemAtIndex(list=clean_72, index=code_block_74, lacing=Longest)
getLocation_33 = Element.GetLocation(element=getItemAtIndex_7)
facingOrientation_31 = FamilyInstance.FacingOrientation(familyInstance=getItemAtIndex_7)
byStartPointDirectionLength_6 = Line.ByStartPointDirectionLength(startPoint=getLocation_33, direction=facingOrientation_31)
X_7 = Vector.X(vector=facingOrientation_31)
code_block_75 = CodeBlock { 2; }
round_13 = Math.Round(number=X_7, digits=code_block_75)
code_block_76 = CodeBlock { 0; }
Y_7 = Vector.Y(vector=facingOrientation_31)
round_14 = Math.Round(number=Y_7, digits=code_block_75)
code_block_77 = CodeBlock { 0; }
code_block_78 = CodeBlock { true; false; }
code_block_79 = CodeBlock { true; false; }
code_block_80 = CodeBlock { true; false; }
code_block_81 = CodeBlock { true; false; }

# group: x
ge_13 = round_13 >= code_block_76

# group: y
gt_13 = round_14 > code_block_77

# group (continued): 1ª TOMADA
condição_if_de_lista_aninhada_25 = CodeBlock(x=ge_13, y=gt_13, cond1=code_block_78.out0, cond2=code_block_78.out1) { indx = (x == true) && (y == true) ? 0 : 1; resultado = [cond1, cond2][indx]; }
filterByBoolMask_69 = List.FilterByBoolMask(list=getItemAtIndex_7, mask=condição_if_de_lista_aninhada_25.resultado, lacing=Longest)
filterByBoolMask_70 = List.FilterByBoolMask(list=facingOrientation_31, mask=condição_if_de_lista_aninhada_25.resultado)

# group: TAG VERT Pos
boolean_108 = BoolSelector(false)
clean_106 = List.Clean(list=filterByBoolMask_69.in, preserveIndices=boolean_108)
flatten_55 = List.Flatten(list=clean_106)
boolean_109 = BoolSelector(false)
clean_107 = List.Clean(list=filterByBoolMask_69.in, preserveIndices=boolean_109)
getLocation_34 = Element.GetLocation(element=clean_107)
boolean_110 = BoolSelector(false)
clean_108 = List.Clean(list=filterByBoolMask_70.in, preserveIndices=boolean_110)
offset_da_tag_18 = DoubleInput(0.2)
mul_41 = offset_da_tag_18 * getItemAtIndex_2
translate_49 = Geometry.Translate(geometry=getLocation_34, direction=clean_108, distance=mul_41)
facingOrientation_32 = FamilyInstance.FacingOrientation(familyInstance=clean_107)
ZAxis_25 = Vector.ZAxis()
cross_25 = Vector.Cross(vector=facingOrientation_32, cross=ZAxis_25)
reverse_7 = Vector.Reverse(vector=cross_25)
offset_da_2ª_tag_25 = DoubleInput(0.31)
mul_42 = offset_da_2ª_tag_25 * getItemAtIndex_2
translate_50 = Geometry.Translate(geometry=translate_49, direction=reverse_7, distance=mul_42)
boolean_111 = BoolSelector(false)
clean_109 = List.Clean(list=translate_50, preserveIndices=boolean_111)
flatten_56 = List.Flatten(list=clean_109)
tag_byelement_25 = Custom[👓 Tag․ByElement](element=flatten_55, TagLocation=flatten_56, TagType=getItemAtIndex)

# group: x
lt_13 = round_13 < code_block_76

# group: y
ge_14 = round_14 >= code_block_77

# group (continued): 1ª TOMADA
condição_if_de_lista_aninhada_26 = CodeBlock(x=lt_13, y=ge_14, cond1=code_block_79.out0, cond2=code_block_79.out1) { indx = (x == true) && (y == true) ? 0 : 1; resultado = [cond1, cond2][indx]; }
filterByBoolMask_71 = List.FilterByBoolMask(list=getItemAtIndex_7, mask=condição_if_de_lista_aninhada_26.resultado, lacing=Longest)
filterByBoolMask_72 = List.FilterByBoolMask(list=facingOrientation_31, mask=condição_if_de_lista_aninhada_26.resultado)

# group: TAG HOR Neg
boolean_112 = BoolSelector(false)
clean_110 = List.Clean(list=filterByBoolMask_71.in, preserveIndices=boolean_112)
flatten_57 = List.Flatten(list=clean_110)
boolean_113 = BoolSelector(false)
clean_111 = List.Clean(list=filterByBoolMask_71.in, preserveIndices=boolean_113)
getLocation_35 = Element.GetLocation(element=clean_111)
boolean_114 = BoolSelector(false)
clean_112 = List.Clean(list=filterByBoolMask_72.in, preserveIndices=boolean_114)
ZAxis_26 = Vector.ZAxis()
cross_26 = Vector.Cross(vector=clean_112, cross=ZAxis_26)
reverse_8 = Vector.Reverse(vector=cross_26)
offset_da_tag_y_8 = DoubleInput(0.35)
mul_43 = offset_da_tag_y_8 * getItemAtIndex_2
translate_51 = Geometry.Translate(geometry=getLocation_35, direction=reverse_8, distance=mul_43)
facingOrientation_33 = FamilyInstance.FacingOrientation(familyInstance=clean_111)
offset_da_2ª_tag_26 = DoubleInput(0.33)
mul_44 = offset_da_2ª_tag_26 * getItemAtIndex_2
translate_52 = Geometry.Translate(geometry=translate_51, direction=facingOrientation_33, distance=mul_44)
boolean_115 = BoolSelector(false)
clean_113 = List.Clean(list=translate_52, preserveIndices=boolean_115)
flatten_58 = List.Flatten(list=clean_113)
tag_byelement_26 = Custom[👓 Tag․ByElement](element=flatten_57, TagLocation=flatten_58, TagType=getItemAtIndex)

# group: x
le_13 = round_13 <= code_block_76

# group: y
lt_14 = round_14 < code_block_77

# group (continued): 1ª TOMADA
condição_if_de_lista_aninhada_27 = CodeBlock(x=le_13, y=lt_14, cond1=code_block_80.out0, cond2=code_block_80.out1) { indx = (x == true) && (y == true) ? 0 : 1; resultado = [cond1, cond2][indx]; }
filterByBoolMask_73 = List.FilterByBoolMask(list=getItemAtIndex_7, mask=condição_if_de_lista_aninhada_27.resultado, lacing=Longest)
filterByBoolMask_74 = List.FilterByBoolMask(list=facingOrientation_31, mask=condição_if_de_lista_aninhada_27.resultado)

# group: TAG VERT Neg
boolean_116 = BoolSelector(false)
clean_114 = List.Clean(list=filterByBoolMask_73.in, preserveIndices=boolean_116)
flatten_59 = List.Flatten(list=clean_114)
boolean_117 = BoolSelector(false)
clean_115 = List.Clean(list=filterByBoolMask_73.in, preserveIndices=boolean_117)
getLocation_36 = Element.GetLocation(element=clean_115)
boolean_118 = BoolSelector(false)
clean_116 = List.Clean(list=filterByBoolMask_74.in, preserveIndices=boolean_118)
offset_da_tag_19 = DoubleInput(0.4)
mul_45 = offset_da_tag_19 * getItemAtIndex_2
translate_53 = Geometry.Translate(geometry=getLocation_36, direction=clean_116, distance=mul_45)
facingOrientation_34 = FamilyInstance.FacingOrientation(familyInstance=clean_115)
ZAxis_27 = Vector.ZAxis()
cross_27 = Vector.Cross(vector=facingOrientation_34, cross=ZAxis_27)
reverse_9 = Vector.Reverse(vector=cross_27)
offset_da_2ª_tag_27 = DoubleInput(0.17)
mul_46 = offset_da_2ª_tag_27 * getItemAtIndex_2
translate_54 = Geometry.Translate(geometry=translate_53, direction=reverse_9, distance=mul_46)
boolean_119 = BoolSelector(false)
clean_117 = List.Clean(list=translate_54, preserveIndices=boolean_119)
flatten_60 = List.Flatten(list=clean_117)
tag_byelement_27 = Custom[👓 Tag․ByElement](element=flatten_59, TagLocation=flatten_60, TagType=getItemAtIndex)

# group: x
gt_14 = round_13 > code_block_76

# group: y
le_14 = round_14 <= code_block_77

# group (continued): 1ª TOMADA
condição_if_de_lista_aninhada_28 = CodeBlock(x=gt_14, y=le_14, cond1=code_block_81.out0, cond2=code_block_81.out1) { indx = (x == true) && (y == true) ? 0 : 1; resultado = [cond1, cond2][indx]; }
filterByBoolMask_75 = List.FilterByBoolMask(list=getItemAtIndex_7, mask=condição_if_de_lista_aninhada_28.resultado, lacing=Longest)
filterByBoolMask_76 = List.FilterByBoolMask(list=facingOrientation_31, mask=condição_if_de_lista_aninhada_28.resultado)

# group: TAG HOR Pos
boolean_120 = BoolSelector(false)
clean_118 = List.Clean(list=filterByBoolMask_75.in, preserveIndices=boolean_120)
flatten_61 = List.Flatten(list=clean_118)
boolean_121 = BoolSelector(false)
clean_119 = List.Clean(list=filterByBoolMask_75.in, preserveIndices=boolean_121)
getLocation_37 = Element.GetLocation(element=clean_119)
boolean_122 = BoolSelector(false)
clean_120 = List.Clean(list=filterByBoolMask_76.in, preserveIndices=boolean_122)
ZAxis_28 = Vector.ZAxis()
cross_28 = Vector.Cross(vector=clean_120, cross=ZAxis_28)
reverse_10 = Vector.Reverse(vector=cross_28)
offset_da_tag_y_9 = DoubleInput(0.15)
mul_47 = offset_da_tag_y_9 * getItemAtIndex_2
translate_55 = Geometry.Translate(geometry=getLocation_37, direction=reverse_10, distance=mul_47)
facingOrientation_35 = FamilyInstance.FacingOrientation(familyInstance=clean_119)
offset_da_2ª_tag_28 = DoubleInput(0.25)
mul_48 = offset_da_2ª_tag_28 * getItemAtIndex_2
translate_56 = Geometry.Translate(geometry=translate_55, direction=facingOrientation_35, distance=mul_48)
boolean_123 = BoolSelector(false)
clean_121 = List.Clean(list=translate_56, preserveIndices=boolean_123)
flatten_62 = List.Flatten(list=clean_121)
tag_byelement_28 = Custom[👓 Tag․ByElement](element=flatten_61, TagLocation=flatten_62, TagType=getItemAtIndex)

# group: 1ª TOMADA
code_block_82 = CodeBlock { 2; }
getItemAtIndex_8 = List.GetItemAtIndex(list=clean_72, index=code_block_82, lacing=Longest)
facingOrientation_36 = FamilyInstance.FacingOrientation(familyInstance=getItemAtIndex_8)
X_8 = Vector.X(vector=facingOrientation_36)
code_block_83 = CodeBlock { 2; }
round_15 = Math.Round(number=X_8, digits=code_block_83)
code_block_84 = CodeBlock { 0; }
Y_8 = Vector.Y(vector=facingOrientation_36)
round_16 = Math.Round(number=Y_8, digits=code_block_83)
code_block_85 = CodeBlock { 0; }
code_block_86 = CodeBlock { true; false; }
code_block_87 = CodeBlock { true; false; }
code_block_88 = CodeBlock { true; false; }
getLocation_38 = Element.GetLocation(element=getItemAtIndex_8)
byStartPointDirectionLength_7 = Line.ByStartPointDirectionLength(startPoint=getLocation_38, direction=facingOrientation_36)
code_block_89 = CodeBlock { true; false; }

# group: x
ge_15 = round_15 >= code_block_84

# group: y
gt_15 = round_16 > code_block_85

# group (continued): 1ª TOMADA
condição_if_de_lista_aninhada_29 = CodeBlock(x=ge_15, y=gt_15, cond1=code_block_86.out0, cond2=code_block_86.out1) { indx = (x == true) && (y == true) ? 0 : 1; resultado = [cond1, cond2][indx]; }
filterByBoolMask_77 = List.FilterByBoolMask(list=getItemAtIndex_8, mask=condição_if_de_lista_aninhada_29.resultado, lacing=Longest)
filterByBoolMask_78 = List.FilterByBoolMask(list=facingOrientation_36, mask=condição_if_de_lista_aninhada_29.resultado)

# group: TAG VERT Pos
boolean_124 = BoolSelector(false)
clean_122 = List.Clean(list=filterByBoolMask_77.in, preserveIndices=boolean_124)
flatten_63 = List.Flatten(list=clean_122)
boolean_125 = BoolSelector(false)
clean_123 = List.Clean(list=filterByBoolMask_77.in, preserveIndices=boolean_125)
getLocation_39 = Element.GetLocation(element=clean_123)
boolean_126 = BoolSelector(false)
clean_124 = List.Clean(list=filterByBoolMask_78.in, preserveIndices=boolean_126)
offset_da_tag_20 = DoubleInput(0.35)
mul_49 = offset_da_tag_20 * getItemAtIndex_2
translate_57 = Geometry.Translate(geometry=getLocation_39, direction=clean_124, distance=mul_49)
facingOrientation_37 = FamilyInstance.FacingOrientation(familyInstance=clean_123)
ZAxis_29 = Vector.ZAxis()
cross_29 = Vector.Cross(vector=facingOrientation_37, cross=ZAxis_29)
reverse_11 = Vector.Reverse(vector=cross_29)
offset_da_2ª_tag_29 = DoubleInput(0.31)
mul_50 = offset_da_2ª_tag_29 * getItemAtIndex_2
translate_58 = Geometry.Translate(geometry=translate_57, direction=reverse_11, distance=mul_50)
boolean_127 = BoolSelector(false)
clean_125 = List.Clean(list=translate_58, preserveIndices=boolean_127)
flatten_64 = List.Flatten(list=clean_125)
tag_byelement_29 = Custom[👓 Tag․ByElement](element=flatten_63, TagLocation=flatten_64, TagType=getItemAtIndex)

# group: x
le_15 = round_15 <= code_block_84

# group: y
lt_15 = round_16 < code_block_85

# group (continued): 1ª TOMADA
condição_if_de_lista_aninhada_30 = CodeBlock(x=le_15, y=lt_15, cond1=code_block_87.out0, cond2=code_block_87.out1) { indx = (x == true) && (y == true) ? 0 : 1; resultado = [cond1, cond2][indx]; }
filterByBoolMask_79 = List.FilterByBoolMask(list=getItemAtIndex_8, mask=condição_if_de_lista_aninhada_30.resultado, lacing=Longest)
filterByBoolMask_80 = List.FilterByBoolMask(list=facingOrientation_36, mask=condição_if_de_lista_aninhada_30.resultado)

# group: TAG VERT Neg
boolean_128 = BoolSelector(false)
clean_126 = List.Clean(list=filterByBoolMask_79.in, preserveIndices=boolean_128)
flatten_65 = List.Flatten(list=clean_126)
boolean_129 = BoolSelector(false)
clean_127 = List.Clean(list=filterByBoolMask_79.in, preserveIndices=boolean_129)
getLocation_40 = Element.GetLocation(element=clean_127)
boolean_130 = BoolSelector(false)
clean_128 = List.Clean(list=filterByBoolMask_80.in, preserveIndices=boolean_130)
offset_da_tag_21 = DoubleInput(0.55)
mul_51 = offset_da_tag_21 * getItemAtIndex_2
translate_59 = Geometry.Translate(geometry=getLocation_40, direction=clean_128, distance=mul_51)
facingOrientation_38 = FamilyInstance.FacingOrientation(familyInstance=clean_127)
ZAxis_30 = Vector.ZAxis()
cross_30 = Vector.Cross(vector=facingOrientation_38, cross=ZAxis_30)
reverse_12 = Vector.Reverse(vector=cross_30)
offset_da_2ª_tag_30 = DoubleInput(0.17)
mul_52 = offset_da_2ª_tag_30 * getItemAtIndex_2
translate_60 = Geometry.Translate(geometry=translate_59, direction=reverse_12, distance=mul_52)
boolean_131 = BoolSelector(false)
clean_129 = List.Clean(list=translate_60, preserveIndices=boolean_131)
flatten_66 = List.Flatten(list=clean_129)
tag_byelement_30 = Custom[👓 Tag․ByElement](element=flatten_65, TagLocation=flatten_66, TagType=getItemAtIndex)

# group: x
gt_16 = round_15 > code_block_84

# group: y
le_16 = round_16 <= code_block_85

# group (continued): 1ª TOMADA
condição_if_de_lista_aninhada_31 = CodeBlock(x=gt_16, y=le_16, cond1=code_block_88.out0, cond2=code_block_88.out1) { indx = (x == true) && (y == true) ? 0 : 1; resultado = [cond1, cond2][indx]; }
filterByBoolMask_81 = List.FilterByBoolMask(list=getItemAtIndex_8, mask=condição_if_de_lista_aninhada_31.resultado, lacing=Longest)
filterByBoolMask_82 = List.FilterByBoolMask(list=facingOrientation_36, mask=condição_if_de_lista_aninhada_31.resultado)

# group: TAG HOR Pos
boolean_132 = BoolSelector(false)
clean_130 = List.Clean(list=filterByBoolMask_81.in, preserveIndices=boolean_132)
flatten_67 = List.Flatten(list=clean_130)
boolean_133 = BoolSelector(false)
clean_131 = List.Clean(list=filterByBoolMask_81.in, preserveIndices=boolean_133)
getLocation_41 = Element.GetLocation(element=clean_131)
boolean_134 = BoolSelector(false)
clean_132 = List.Clean(list=filterByBoolMask_82.in, preserveIndices=boolean_134)
ZAxis_31 = Vector.ZAxis()
cross_31 = Vector.Cross(vector=clean_132, cross=ZAxis_31)
reverse_13 = Vector.Reverse(vector=cross_31)
offset_da_tag_y_10 = DoubleInput(0.15)
mul_53 = offset_da_tag_y_10 * getItemAtIndex_2
translate_61 = Geometry.Translate(geometry=getLocation_41, direction=reverse_13, distance=mul_53)
facingOrientation_39 = FamilyInstance.FacingOrientation(familyInstance=clean_131)
offset_da_2ª_tag_31 = DoubleInput(0.4)
mul_54 = offset_da_2ª_tag_31 * getItemAtIndex_2
translate_62 = Geometry.Translate(geometry=translate_61, direction=facingOrientation_39, distance=mul_54)
boolean_135 = BoolSelector(false)
clean_133 = List.Clean(list=translate_62, preserveIndices=boolean_135)
flatten_68 = List.Flatten(list=clean_133)
tag_byelement_31 = Custom[👓 Tag․ByElement](element=flatten_67, TagLocation=flatten_68, TagType=getItemAtIndex)

# group: x
lt_16 = round_15 < code_block_84

# group: y
ge_16 = round_16 >= code_block_85

# group (continued): 1ª TOMADA
condição_if_de_lista_aninhada_32 = CodeBlock(x=lt_16, y=ge_16, cond1=code_block_89.out0, cond2=code_block_89.out1) { indx = (x == true) && (y == true) ? 0 : 1; resultado = [cond1, cond2][indx]; }
filterByBoolMask_83 = List.FilterByBoolMask(list=getItemAtIndex_8, mask=condição_if_de_lista_aninhada_32.resultado, lacing=Longest)
filterByBoolMask_84 = List.FilterByBoolMask(list=facingOrientation_36, mask=condição_if_de_lista_aninhada_32.resultado)

# group: TAG HOR Neg
boolean_136 = BoolSelector(false)
clean_134 = List.Clean(list=filterByBoolMask_83.in, preserveIndices=boolean_136)
flatten_69 = List.Flatten(list=clean_134)
boolean_137 = BoolSelector(false)
clean_135 = List.Clean(list=filterByBoolMask_83.in, preserveIndices=boolean_137)
getLocation_42 = Element.GetLocation(element=clean_135)
boolean_138 = BoolSelector(false)
clean_136 = List.Clean(list=filterByBoolMask_84.in, preserveIndices=boolean_138)
ZAxis_32 = Vector.ZAxis()
cross_32 = Vector.Cross(vector=clean_136, cross=ZAxis_32)
reverse_14 = Vector.Reverse(vector=cross_32)
offset_da_tag_y_11 = DoubleInput(0.35)
mul_55 = offset_da_tag_y_11 * getItemAtIndex_2
translate_63 = Geometry.Translate(geometry=getLocation_42, direction=reverse_14, distance=mul_55)
facingOrientation_40 = FamilyInstance.FacingOrientation(familyInstance=clean_135)
offset_da_2ª_tag_32 = DoubleInput(0.5)
mul_56 = offset_da_2ª_tag_32 * getItemAtIndex_2
translate_64 = Geometry.Translate(geometry=translate_63, direction=facingOrientation_40, distance=mul_56)
boolean_139 = BoolSelector(false)
clean_137 = List.Clean(list=translate_64, preserveIndices=boolean_139)
flatten_70 = List.Flatten(list=clean_137)
tag_byelement_32 = Custom[👓 Tag․ByElement](element=flatten_69, TagLocation=flatten_70, TagType=getItemAtIndex)

# group: 6ª TOMADA
code_block_90 = CodeBlock { 5; }
getItemAtIndex_9 = List.GetItemAtIndex(list=flatten_4, index=code_block_90, lacing=Longest)
boolean_140 = BoolSelector(false)
clean_138 = List.Clean(list=getItemAtIndex_9, preserveIndices=boolean_140)
facingOrientation_41 = FamilyInstance.FacingOrientation(familyInstance=clean_138)
X_9 = Vector.X(vector=facingOrientation_41)
code_block_91 = CodeBlock { 2; }
round_17 = Math.Round(number=X_9, digits=code_block_91)
code_block_92 = CodeBlock { 0; }
Y_9 = Vector.Y(vector=facingOrientation_41)
round_18 = Math.Round(number=Y_9, digits=code_block_91)
code_block_93 = CodeBlock { 0; }
gt_17 = round_18 > code_block_93
code_block_94 = CodeBlock { true; false; }
code_block_95 = CodeBlock { true; false; }
code_block_96 = CodeBlock { true; false; }
code_block_97 = CodeBlock { true; false; }

# group: x
ge_17 = round_17 >= code_block_92

# group (continued): 6ª TOMADA
condição_if_de_lista_aninhada_33 = CodeBlock(x=ge_17, y=gt_17, cond1=code_block_94.out0, cond2=code_block_94.out1) { indx = (x == true) && (y == true) ? 0 : 1; resultado = [cond1, cond2][indx]; }
filterByBoolMask_85 = List.FilterByBoolMask(list=clean_138, mask=condição_if_de_lista_aninhada_33.resultado, lacing=Longest)
filterByBoolMask_86 = List.FilterByBoolMask(list=facingOrientation_41, mask=condição_if_de_lista_aninhada_33.resultado)

# group: TAG Horizontal Pos
boolean_141 = BoolSelector(false)
clean_139 = List.Clean(list=filterByBoolMask_85.in, preserveIndices=boolean_141)
flatten_71 = List.Flatten(list=clean_139)
boolean_142 = BoolSelector(false)
clean_140 = List.Clean(list=filterByBoolMask_85.in, preserveIndices=boolean_142)
getLocation_43 = Element.GetLocation(element=clean_140)
boolean_143 = BoolSelector(false)
clean_141 = List.Clean(list=filterByBoolMask_86.in, preserveIndices=boolean_143)
offset_da_tag_22 = DoubleInput(0.35)
facingOrientation_42 = FamilyInstance.FacingOrientation(familyInstance=clean_140)
ZAxis_33 = Vector.ZAxis()
cross_33 = Vector.Cross(vector=facingOrientation_42, cross=ZAxis_33)
offset_da_2ª_tag_33 = DoubleInput(-0.3)
boolean_144 = BoolSelector(false)

mul_57 = offset_da_tag_22 * getItemAtIndex_2

# group (continued): TAG Horizontal Pos
translate_65 = Geometry.Translate(geometry=getLocation_43, direction=clean_141, distance=mul_57)

mul_58 = offset_da_2ª_tag_33 * getItemAtIndex_2

# group (continued): TAG Horizontal Pos
translate_66 = Geometry.Translate(geometry=translate_65, direction=cross_33, distance=mul_58)
clean_142 = List.Clean(list=translate_66, preserveIndices=boolean_144)
flatten_72 = List.Flatten(list=clean_142)
tag_byelement_33 = Custom[👓 Tag․ByElement](element=flatten_71, TagLocation=flatten_72, TagType=getItemAtIndex)

# group: x
lt_17 = round_17 < code_block_92

# group: y
ge_18 = round_18 >= code_block_93

# group (continued): 6ª TOMADA
condição_if_de_lista_aninhada_34 = CodeBlock(x=lt_17, y=ge_18, cond1=code_block_95.out0, cond2=code_block_95.out1) { indx = (x == true) && (y == true) ? 0 : 1; resultado = [cond1, cond2][indx]; }
filterByBoolMask_87 = List.FilterByBoolMask(list=clean_138, mask=condição_if_de_lista_aninhada_34.resultado, lacing=Longest)
filterByBoolMask_88 = List.FilterByBoolMask(list=facingOrientation_41, mask=condição_if_de_lista_aninhada_34.resultado)

# group: TAG Vertical Neg
boolean_145 = BoolSelector(false)
clean_143 = List.Clean(list=filterByBoolMask_87.in, preserveIndices=boolean_145)
flatten_73 = List.Flatten(list=clean_143)
boolean_146 = BoolSelector(false)
clean_144 = List.Clean(list=filterByBoolMask_87.in, preserveIndices=boolean_146)
getLocation_44 = Element.GetLocation(element=clean_144)
boolean_147 = BoolSelector(false)
clean_145 = List.Clean(list=filterByBoolMask_88.in, preserveIndices=boolean_147)
ZAxis_34 = Vector.ZAxis()
cross_34 = Vector.Cross(vector=clean_145, cross=ZAxis_34)
offset_da_tag_23 = DoubleInput(-0.32)
facingOrientation_43 = FamilyInstance.FacingOrientation(familyInstance=clean_144)
offset_da_2ª_tag_34 = DoubleInput(0.45)
boolean_148 = BoolSelector(false)

mul_59 = offset_da_tag_23 * getItemAtIndex_2

# group (continued): TAG Vertical Neg
translate_67 = Geometry.Translate(geometry=getLocation_44, direction=cross_34, distance=mul_59)

mul_60 = offset_da_2ª_tag_34 * getItemAtIndex_2

# group (continued): TAG Vertical Neg
translate_68 = Geometry.Translate(geometry=translate_67, direction=facingOrientation_43, distance=mul_60)
clean_146 = List.Clean(list=translate_68, preserveIndices=boolean_148)
flatten_74 = List.Flatten(list=clean_146)
tag_byelement_34 = Custom[👓 Tag․ByElement](element=flatten_73, TagLocation=flatten_74, TagType=getItemAtIndex)

# group: x
le_17 = round_17 <= code_block_92

# group: y
lt_18 = round_18 < code_block_93

# group (continued): 6ª TOMADA
condição_if_de_lista_aninhada_35 = CodeBlock(x=le_17, y=lt_18, cond1=code_block_96.out0, cond2=code_block_96.out1) { indx = (x == true) && (y == true) ? 0 : 1; resultado = [cond1, cond2][indx]; }
filterByBoolMask_89 = List.FilterByBoolMask(list=clean_138, mask=condição_if_de_lista_aninhada_35.resultado, lacing=Longest)
filterByBoolMask_90 = List.FilterByBoolMask(list=facingOrientation_41, mask=condição_if_de_lista_aninhada_35.resultado)

# group: TAG Horizontal Pos
boolean_149 = BoolSelector(false)
clean_147 = List.Clean(list=filterByBoolMask_89.in, preserveIndices=boolean_149)
flatten_75 = List.Flatten(list=clean_147)
boolean_150 = BoolSelector(false)
clean_148 = List.Clean(list=filterByBoolMask_89.in, preserveIndices=boolean_150)
getLocation_45 = Element.GetLocation(element=clean_148)
boolean_151 = BoolSelector(false)
clean_149 = List.Clean(list=filterByBoolMask_90.in, preserveIndices=boolean_151)
offset_da_tag_24 = DoubleInput(0.5)
facingOrientation_44 = FamilyInstance.FacingOrientation(familyInstance=clean_148)
ZAxis_35 = Vector.ZAxis()
cross_35 = Vector.Cross(vector=facingOrientation_44, cross=ZAxis_35)
offset_da_2ª_tag_35 = DoubleInput(-0.2)
boolean_152 = BoolSelector(false)

mul_61 = offset_da_tag_24 * getItemAtIndex_2

# group (continued): TAG Horizontal Pos
translate_69 = Geometry.Translate(geometry=getLocation_45, direction=clean_149, distance=mul_61)

mul_62 = offset_da_2ª_tag_35 * getItemAtIndex_2

# group (continued): TAG Horizontal Pos
translate_70 = Geometry.Translate(geometry=translate_69, direction=cross_35, distance=mul_62)
clean_150 = List.Clean(list=translate_70, preserveIndices=boolean_152)
flatten_76 = List.Flatten(list=clean_150)
tag_byelement_35 = Custom[👓 Tag․ByElement](element=flatten_75, TagLocation=flatten_76, TagType=getItemAtIndex)

# group: x
gt_18 = round_17 > code_block_92

# group: y
le_18 = round_18 <= code_block_93

# group (continued): 6ª TOMADA
condição_if_de_lista_aninhada_36 = CodeBlock(x=gt_18, y=le_18, cond1=code_block_97.out0, cond2=code_block_97.out1) { indx = (x == true) && (y == true) ? 0 : 1; resultado = [cond1, cond2][indx]; }
filterByBoolMask_91 = List.FilterByBoolMask(list=clean_138, mask=condição_if_de_lista_aninhada_36.resultado, lacing=Longest)
filterByBoolMask_92 = List.FilterByBoolMask(list=facingOrientation_41, mask=condição_if_de_lista_aninhada_36.resultado)

# group: TAG Vertical Pos
boolean_153 = BoolSelector(false)
clean_151 = List.Clean(list=filterByBoolMask_91.in, preserveIndices=boolean_153)
flatten_77 = List.Flatten(list=clean_151)
boolean_154 = BoolSelector(false)
clean_152 = List.Clean(list=filterByBoolMask_91.in, preserveIndices=boolean_154)
getLocation_46 = Element.GetLocation(element=clean_152)
boolean_155 = BoolSelector(false)
clean_153 = List.Clean(list=filterByBoolMask_92.in, preserveIndices=boolean_155)
ZAxis_36 = Vector.ZAxis()
cross_36 = Vector.Cross(vector=clean_153, cross=ZAxis_36)
offset_da_tag_25 = DoubleInput(-0.15)
facingOrientation_45 = FamilyInstance.FacingOrientation(familyInstance=clean_152)
offset_da_2ª_tag_36 = DoubleInput(0.35)
boolean_156 = BoolSelector(false)

mul_63 = offset_da_tag_25 * getItemAtIndex_2

# group (continued): TAG Vertical Pos
translate_71 = Geometry.Translate(geometry=getLocation_46, direction=cross_36, distance=mul_63)

mul_64 = offset_da_2ª_tag_36 * getItemAtIndex_2

# group (continued): TAG Vertical Pos
translate_72 = Geometry.Translate(geometry=translate_71, direction=facingOrientation_45, distance=mul_64)
clean_154 = List.Clean(list=translate_72, preserveIndices=boolean_156)
flatten_78 = List.Flatten(list=clean_154)
tag_byelement_36 = Custom[👓 Tag․ByElement](element=flatten_77, TagLocation=flatten_78, TagType=getItemAtIndex)

# group: 5ª TOMADA
code_block_98 = CodeBlock { 4; }
getItemAtIndex_10 = List.GetItemAtIndex(list=flatten_4, index=code_block_98, lacing=Longest)
boolean_157 = BoolSelector(false)
clean_155 = List.Clean(list=getItemAtIndex_10, preserveIndices=boolean_157)
facingOrientation_46 = FamilyInstance.FacingOrientation(familyInstance=clean_155)
X_10 = Vector.X(vector=facingOrientation_46)
code_block_99 = CodeBlock { 2; }
round_19 = Math.Round(number=X_10, digits=code_block_99)
code_block_100 = CodeBlock { 0; }
Y_10 = Vector.Y(vector=facingOrientation_46)
round_20 = Math.Round(number=Y_10, digits=code_block_99)
code_block_101 = CodeBlock { 0; }
gt_19 = round_20 > code_block_101
code_block_102 = CodeBlock { true; false; }
code_block_103 = CodeBlock { true; false; }
getLocation_47 = Element.GetLocation(element=clean_155)
byStartPointDirectionLength_8 = Line.ByStartPointDirectionLength(startPoint=getLocation_47, direction=facingOrientation_46)
code_block_104 = CodeBlock { true; false; }
code_block_105 = CodeBlock { true; false; }

# group: x
ge_19 = round_19 >= code_block_100

# group (continued): 5ª TOMADA
condição_if_de_lista_aninhada_37 = CodeBlock(x=ge_19, y=gt_19, cond1=code_block_102.out0, cond2=code_block_102.out1) { indx = (x == true) && (y == true) ? 0 : 1; resultado = [cond1, cond2][indx]; }
filterByBoolMask_93 = List.FilterByBoolMask(list=clean_155, mask=condição_if_de_lista_aninhada_37.resultado, lacing=Longest)
filterByBoolMask_94 = List.FilterByBoolMask(list=facingOrientation_46, mask=condição_if_de_lista_aninhada_37.resultado)

# group: TAG Horizontal Pos
boolean_158 = BoolSelector(false)
clean_156 = List.Clean(list=filterByBoolMask_93.in, preserveIndices=boolean_158)
flatten_79 = List.Flatten(list=clean_156)
boolean_159 = BoolSelector(false)
clean_157 = List.Clean(list=filterByBoolMask_93.in, preserveIndices=boolean_159)
getLocation_48 = Element.GetLocation(element=clean_157)
boolean_160 = BoolSelector(false)
clean_158 = List.Clean(list=filterByBoolMask_94.in, preserveIndices=boolean_160)
offset_da_tag_26 = DoubleInput(0.2)
facingOrientation_47 = FamilyInstance.FacingOrientation(familyInstance=clean_157)
ZAxis_37 = Vector.ZAxis()
cross_37 = Vector.Cross(vector=facingOrientation_47, cross=ZAxis_37)
offset_da_2ª_tag_37 = DoubleInput(-0.3)
boolean_161 = BoolSelector(false)

mul_65 = offset_da_tag_26 * getItemAtIndex_2

# group (continued): TAG Horizontal Pos
translate_73 = Geometry.Translate(geometry=getLocation_48, direction=clean_158, distance=mul_65)

mul_66 = offset_da_2ª_tag_37 * getItemAtIndex_2

# group (continued): TAG Horizontal Pos
translate_74 = Geometry.Translate(geometry=translate_73, direction=cross_37, distance=mul_66)
clean_159 = List.Clean(list=translate_74, preserveIndices=boolean_161)
flatten_80 = List.Flatten(list=clean_159)
tag_byelement_37 = Custom[👓 Tag․ByElement](element=flatten_79, TagLocation=flatten_80, TagType=getItemAtIndex)

# group: x
le_19 = round_19 <= code_block_100

# group: y
lt_19 = round_20 < code_block_101

# group (continued): 5ª TOMADA
condição_if_de_lista_aninhada_38 = CodeBlock(x=le_19, y=lt_19, cond1=code_block_103.out0, cond2=code_block_103.out1) { indx = (x == true) && (y == true) ? 0 : 1; resultado = [cond1, cond2][indx]; }
filterByBoolMask_95 = List.FilterByBoolMask(list=clean_155, mask=condição_if_de_lista_aninhada_38.resultado, lacing=Longest)
filterByBoolMask_96 = List.FilterByBoolMask(list=facingOrientation_46, mask=condição_if_de_lista_aninhada_38.resultado)

# group: TAG Horizontal Pos
boolean_162 = BoolSelector(false)
clean_160 = List.Clean(list=filterByBoolMask_95.in, preserveIndices=boolean_162)
flatten_81 = List.Flatten(list=clean_160)
boolean_163 = BoolSelector(false)
clean_161 = List.Clean(list=filterByBoolMask_95.in, preserveIndices=boolean_163)
getLocation_49 = Element.GetLocation(element=clean_161)
boolean_164 = BoolSelector(false)
clean_162 = List.Clean(list=filterByBoolMask_96.in, preserveIndices=boolean_164)
offset_da_tag_27 = DoubleInput(0.35)
facingOrientation_48 = FamilyInstance.FacingOrientation(familyInstance=clean_161)
ZAxis_38 = Vector.ZAxis()
cross_38 = Vector.Cross(vector=facingOrientation_48, cross=ZAxis_38)
offset_da_2ª_tag_38 = DoubleInput(-0.2)
boolean_165 = BoolSelector(false)

mul_67 = offset_da_tag_27 * getItemAtIndex_2

# group (continued): TAG Horizontal Pos
translate_75 = Geometry.Translate(geometry=getLocation_49, direction=clean_162, distance=mul_67)

mul_68 = offset_da_2ª_tag_38 * getItemAtIndex_2

# group (continued): TAG Horizontal Pos
translate_76 = Geometry.Translate(geometry=translate_75, direction=cross_38, distance=mul_68)
clean_163 = List.Clean(list=translate_76, preserveIndices=boolean_165)
flatten_82 = List.Flatten(list=clean_163)
tag_byelement_38 = Custom[👓 Tag․ByElement](element=flatten_81, TagLocation=flatten_82, TagType=getItemAtIndex)

# group: x
lt_20 = round_19 < code_block_100

# group: y
ge_20 = round_20 >= code_block_101

# group (continued): 5ª TOMADA
condição_if_de_lista_aninhada_39 = CodeBlock(x=lt_20, y=ge_20, cond1=code_block_104.out0, cond2=code_block_104.out1) { indx = (x == true) && (y == true) ? 0 : 1; resultado = [cond1, cond2][indx]; }
filterByBoolMask_97 = List.FilterByBoolMask(list=clean_155, mask=condição_if_de_lista_aninhada_39.resultado, lacing=Longest)
filterByBoolMask_98 = List.FilterByBoolMask(list=facingOrientation_46, mask=condição_if_de_lista_aninhada_39.resultado)

# group: TAG Vertical Neg
boolean_166 = BoolSelector(false)
clean_164 = List.Clean(list=filterByBoolMask_97.in, preserveIndices=boolean_166)
flatten_83 = List.Flatten(list=clean_164)
boolean_167 = BoolSelector(false)
clean_165 = List.Clean(list=filterByBoolMask_97.in, preserveIndices=boolean_167)
getLocation_50 = Element.GetLocation(element=clean_165)
boolean_168 = BoolSelector(false)
clean_166 = List.Clean(list=filterByBoolMask_98.in, preserveIndices=boolean_168)
ZAxis_39 = Vector.ZAxis()
cross_39 = Vector.Cross(vector=clean_166, cross=ZAxis_39)
offset_da_tag_28 = DoubleInput(-0.32)
facingOrientation_49 = FamilyInstance.FacingOrientation(familyInstance=clean_165)
offset_da_2ª_tag_39 = DoubleInput(0.3)
boolean_169 = BoolSelector(false)

mul_69 = offset_da_tag_28 * getItemAtIndex_2

# group (continued): TAG Vertical Neg
translate_77 = Geometry.Translate(geometry=getLocation_50, direction=cross_39, distance=mul_69)

mul_70 = offset_da_2ª_tag_39 * getItemAtIndex_2

# group (continued): TAG Vertical Neg
translate_78 = Geometry.Translate(geometry=translate_77, direction=facingOrientation_49, distance=mul_70)
clean_167 = List.Clean(list=translate_78, preserveIndices=boolean_169)
flatten_84 = List.Flatten(list=clean_167)
tag_byelement_39 = Custom[👓 Tag․ByElement](element=flatten_83, TagLocation=flatten_84, TagType=getItemAtIndex)

# group: x
gt_20 = round_19 > code_block_100

# group: y
le_20 = round_20 <= code_block_101

# group (continued): 5ª TOMADA
condição_if_de_lista_aninhada_40 = CodeBlock(x=gt_20, y=le_20, cond1=code_block_105.out0, cond2=code_block_105.out1) { indx = (x == true) && (y == true) ? 0 : 1; resultado = [cond1, cond2][indx]; }
filterByBoolMask_99 = List.FilterByBoolMask(list=clean_155, mask=condição_if_de_lista_aninhada_40.resultado, lacing=Longest)
filterByBoolMask_100 = List.FilterByBoolMask(list=facingOrientation_46, mask=condição_if_de_lista_aninhada_40.resultado)

# group: TAG Vertical Pos
boolean_170 = BoolSelector(false)
clean_168 = List.Clean(list=filterByBoolMask_99.in, preserveIndices=boolean_170)
flatten_85 = List.Flatten(list=clean_168)
boolean_171 = BoolSelector(false)
clean_169 = List.Clean(list=filterByBoolMask_99.in, preserveIndices=boolean_171)
getLocation_51 = Element.GetLocation(element=clean_169)
boolean_172 = BoolSelector(false)
clean_170 = List.Clean(list=filterByBoolMask_100.in, preserveIndices=boolean_172)
ZAxis_40 = Vector.ZAxis()
cross_40 = Vector.Cross(vector=clean_170, cross=ZAxis_40)
offset_da_tag_29 = DoubleInput(-0.15)
facingOrientation_50 = FamilyInstance.FacingOrientation(familyInstance=clean_169)
offset_da_2ª_tag_40 = DoubleInput(0.2)
boolean_173 = BoolSelector(false)

mul_71 = offset_da_tag_29 * getItemAtIndex_2

# group (continued): TAG Vertical Pos
translate_79 = Geometry.Translate(geometry=getLocation_51, direction=cross_40, distance=mul_71)

mul_72 = offset_da_2ª_tag_40 * getItemAtIndex_2

# group (continued): TAG Vertical Pos
translate_80 = Geometry.Translate(geometry=translate_79, direction=facingOrientation_50, distance=mul_72)
clean_171 = List.Clean(list=translate_80, preserveIndices=boolean_173)
flatten_86 = List.Flatten(list=clean_171)
tag_byelement_40 = Custom[👓 Tag․ByElement](element=flatten_85, TagLocation=flatten_86, TagType=getItemAtIndex)

# group: 4ª TOMADA
code_block_106 = CodeBlock { 3; }
getItemAtIndex_11 = List.GetItemAtIndex(list=flatten_4, index=code_block_106, lacing=Longest)
boolean_174 = BoolSelector(false)
clean_172 = List.Clean(list=getItemAtIndex_11, preserveIndices=boolean_174)
facingOrientation_51 = FamilyInstance.FacingOrientation(familyInstance=clean_172)
X_11 = Vector.X(vector=facingOrientation_51)
code_block_107 = CodeBlock { 2; }
round_21 = Math.Round(number=X_11, digits=code_block_107)
code_block_108 = CodeBlock { 0; }
Y_11 = Vector.Y(vector=facingOrientation_51)
round_22 = Math.Round(number=Y_11, digits=code_block_107)
code_block_109 = CodeBlock { 0; }
code_block_110 = CodeBlock { true; false; }
code_block_111 = CodeBlock { true; false; }
code_block_112 = CodeBlock { true; false; }
getLocation_52 = Element.GetLocation(element=clean_172)
byStartPointDirectionLength_9 = Line.ByStartPointDirectionLength(startPoint=getLocation_52, direction=facingOrientation_51)
code_block_113 = CodeBlock { true; false; }

# group: x
ge_21 = round_21 >= code_block_108

# group: y
gt_21 = round_22 > code_block_109

# group (continued): 4ª TOMADA
condição_if_de_lista_aninhada_41 = CodeBlock(x=ge_21, y=gt_21, cond1=code_block_110.out0, cond2=code_block_110.out1) { indx = (x == true) && (y == true) ? 0 : 1; resultado = [cond1, cond2][indx]; }
filterByBoolMask_101 = List.FilterByBoolMask(list=clean_172, mask=condição_if_de_lista_aninhada_41.resultado, lacing=Longest)
filterByBoolMask_102 = List.FilterByBoolMask(list=facingOrientation_51, mask=condição_if_de_lista_aninhada_41.resultado)

# group: TAG VERT Pos
boolean_175 = BoolSelector(false)
clean_173 = List.Clean(list=filterByBoolMask_101.in, preserveIndices=boolean_175)
flatten_87 = List.Flatten(list=clean_173)
boolean_176 = BoolSelector(false)
clean_174 = List.Clean(list=filterByBoolMask_101.in, preserveIndices=boolean_176)
getLocation_53 = Element.GetLocation(element=clean_174)
boolean_177 = BoolSelector(false)
clean_175 = List.Clean(list=filterByBoolMask_102.in, preserveIndices=boolean_177)
offset_da_tag_30 = DoubleInput(0.05)
facingOrientation_52 = FamilyInstance.FacingOrientation(familyInstance=clean_174)
ZAxis_41 = Vector.ZAxis()
cross_41 = Vector.Cross(vector=facingOrientation_52, cross=ZAxis_41)
offset_da_2ª_tag_41 = DoubleInput(-0.3)
boolean_178 = BoolSelector(false)

mul_73 = offset_da_tag_30 * getItemAtIndex_2

# group (continued): TAG VERT Pos
translate_81 = Geometry.Translate(geometry=getLocation_53, direction=clean_175, distance=mul_73)

mul_74 = offset_da_2ª_tag_41 * getItemAtIndex_2

# group (continued): TAG VERT Pos
translate_82 = Geometry.Translate(geometry=translate_81, direction=cross_41, distance=mul_74)
clean_176 = List.Clean(list=translate_82, preserveIndices=boolean_178)
flatten_88 = List.Flatten(list=clean_176)
tag_byelement_41 = Custom[👓 Tag․ByElement](element=flatten_87, TagLocation=flatten_88, TagType=getItemAtIndex)

# group: x
le_21 = round_21 <= code_block_108

# group: y
lt_21 = round_22 < code_block_109

# group (continued): 4ª TOMADA
condição_if_de_lista_aninhada_42 = CodeBlock(x=le_21, y=lt_21, cond1=code_block_111.out0, cond2=code_block_111.out1) { indx = (x == true) && (y == true) ? 0 : 1; resultado = [cond1, cond2][indx]; }
filterByBoolMask_103 = List.FilterByBoolMask(list=clean_172, mask=condição_if_de_lista_aninhada_42.resultado, lacing=Longest)
filterByBoolMask_104 = List.FilterByBoolMask(list=facingOrientation_51, mask=condição_if_de_lista_aninhada_42.resultado)

# group: TAG VERT NEG
boolean_179 = BoolSelector(false)
clean_177 = List.Clean(list=filterByBoolMask_103.in, preserveIndices=boolean_179)
flatten_89 = List.Flatten(list=clean_177)
boolean_180 = BoolSelector(false)
clean_178 = List.Clean(list=filterByBoolMask_103.in, preserveIndices=boolean_180)
getLocation_54 = Element.GetLocation(element=clean_178)
boolean_181 = BoolSelector(false)
clean_179 = List.Clean(list=filterByBoolMask_104.in, preserveIndices=boolean_181)
offset_da_tag_31 = DoubleInput(0.2)
facingOrientation_53 = FamilyInstance.FacingOrientation(familyInstance=clean_178)
ZAxis_42 = Vector.ZAxis()
cross_42 = Vector.Cross(vector=facingOrientation_53, cross=ZAxis_42)
offset_da_2ª_tag_42 = DoubleInput(-0.2)
boolean_182 = BoolSelector(false)

mul_75 = offset_da_tag_31 * getItemAtIndex_2

# group (continued): TAG VERT NEG
translate_83 = Geometry.Translate(geometry=getLocation_54, direction=clean_179, distance=mul_75)

mul_76 = offset_da_2ª_tag_42 * getItemAtIndex_2

# group (continued): TAG VERT NEG
translate_84 = Geometry.Translate(geometry=translate_83, direction=cross_42, distance=mul_76)
clean_180 = List.Clean(list=translate_84, preserveIndices=boolean_182)
flatten_90 = List.Flatten(list=clean_180)
tag_byelement_42 = Custom[👓 Tag․ByElement](element=flatten_89, TagLocation=flatten_90, TagType=getItemAtIndex)

# group: x
gt_22 = round_21 > code_block_108

# group: y
le_22 = round_22 <= code_block_109

# group (continued): 4ª TOMADA
condição_if_de_lista_aninhada_43 = CodeBlock(x=gt_22, y=le_22, cond1=code_block_112.out0, cond2=code_block_112.out1) { indx = (x == true) && (y == true) ? 0 : 1; resultado = [cond1, cond2][indx]; }
filterByBoolMask_105 = List.FilterByBoolMask(list=clean_172, mask=condição_if_de_lista_aninhada_43.resultado, lacing=Longest)
filterByBoolMask_106 = List.FilterByBoolMask(list=facingOrientation_51, mask=condição_if_de_lista_aninhada_43.resultado)

# group: TAG HOR Pos
boolean_183 = BoolSelector(false)
clean_181 = List.Clean(list=filterByBoolMask_105.in, preserveIndices=boolean_183)
flatten_91 = List.Flatten(list=clean_181)
boolean_184 = BoolSelector(false)
clean_182 = List.Clean(list=filterByBoolMask_105.in, preserveIndices=boolean_184)
getLocation_55 = Element.GetLocation(element=clean_182)
boolean_185 = BoolSelector(false)
clean_183 = List.Clean(list=filterByBoolMask_106.in, preserveIndices=boolean_185)
ZAxis_43 = Vector.ZAxis()
cross_43 = Vector.Cross(vector=clean_183, cross=ZAxis_43)
offset_da_tag_32 = DoubleInput(-0.15)
facingOrientation_54 = FamilyInstance.FacingOrientation(familyInstance=clean_182)
offset_da_2ª_tag_43 = DoubleInput(0.05)
boolean_186 = BoolSelector(false)

mul_77 = offset_da_tag_32 * getItemAtIndex_2

# group (continued): TAG HOR Pos
translate_85 = Geometry.Translate(geometry=getLocation_55, direction=cross_43, distance=mul_77)

mul_78 = offset_da_2ª_tag_43 * getItemAtIndex_2

# group (continued): TAG HOR Pos
translate_86 = Geometry.Translate(geometry=translate_85, direction=facingOrientation_54, distance=mul_78)
clean_184 = List.Clean(list=translate_86, preserveIndices=boolean_186)
flatten_92 = List.Flatten(list=clean_184)
tag_byelement_43 = Custom[👓 Tag․ByElement](element=flatten_91, TagLocation=flatten_92, TagType=getItemAtIndex)

# group: x
lt_22 = round_21 < code_block_108

# group: y
ge_22 = round_22 >= code_block_109

# group (continued): 4ª TOMADA
condição_if_de_lista_aninhada_44 = CodeBlock(x=lt_22, y=ge_22, cond1=code_block_113.out0, cond2=code_block_113.out1) { indx = (x == true) && (y == true) ? 0 : 1; resultado = [cond1, cond2][indx]; }
filterByBoolMask_107 = List.FilterByBoolMask(list=clean_172, mask=condição_if_de_lista_aninhada_44.resultado, lacing=Longest)
filterByBoolMask_108 = List.FilterByBoolMask(list=facingOrientation_51, mask=condição_if_de_lista_aninhada_44.resultado)

# group: TAG HOR Neg
boolean_187 = BoolSelector(false)
clean_185 = List.Clean(list=filterByBoolMask_107.in, preserveIndices=boolean_187)
flatten_93 = List.Flatten(list=clean_185)
boolean_188 = BoolSelector(false)
clean_186 = List.Clean(list=filterByBoolMask_107.in, preserveIndices=boolean_188)
getLocation_56 = Element.GetLocation(element=clean_186)
boolean_189 = BoolSelector(false)
clean_187 = List.Clean(list=filterByBoolMask_108.in, preserveIndices=boolean_189)
ZAxis_44 = Vector.ZAxis()
cross_44 = Vector.Cross(vector=clean_187, cross=ZAxis_44)
offset_da_tag_y_12 = DoubleInput(-0.32)
facingOrientation_55 = FamilyInstance.FacingOrientation(familyInstance=clean_186)
offset_da_2ª_tag_44 = DoubleInput(0.1)
boolean_190 = BoolSelector(false)

mul_79 = offset_da_tag_y_12 * getItemAtIndex_2

# group (continued): TAG HOR Neg
translate_87 = Geometry.Translate(geometry=getLocation_56, direction=cross_44, distance=mul_79)

mul_80 = offset_da_2ª_tag_44 * getItemAtIndex_2

# group (continued): TAG HOR Neg
translate_88 = Geometry.Translate(geometry=translate_87, direction=facingOrientation_55, distance=mul_80)
clean_188 = List.Clean(list=translate_88, preserveIndices=boolean_190)
flatten_94 = List.Flatten(list=clean_188)
tag_byelement_44 = Custom[👓 Tag․ByElement](element=flatten_93, TagLocation=flatten_94, TagType=getItemAtIndex)

watch_6 = Watch(filterByBoolMask_3.in)
watch_7 = Watch(filterByBoolMask_4.in)
watch_8 = Watch(clean_89)
watch_9 = Watch(filterByBoolMask_6.in)
