# Dynamo graph 03-3_BIMACON_Alterar FP de Circuitos_R03_script.dyn (Dynamo 3.3.0.6316)
# author: Jose Nelson
# Altera o FP de todos pontos do Circuito
# packages: Data-Shapes 2022.2.105

categories = Categories("OST_ElectricalFixtures")
categories_2 = Categories("OST_LightingFixtures")
categories_3 = Categories("OST_LightingDevices")
list_create = List.Create(item0=categories, item1=categories_2, item2=categories_3)
all_elements_of_category = ElementsOfCategory(Category=list_create)
flatten = List.Flatten(list=all_elements_of_category)

# group: Versão Revit
code_block = CodeBlock { 2025; }
version = Python()  # "Document.Version"; IronPython2; unwired: IN[0]
# ---------- version.python (13 lines) ----------
# Importa as bibliotecas necessárias do Revit
import clr
clr.AddReference('RevitServices')
from RevitServices.Persistence import DocumentManager

# Obtém o documento ativo
doc = DocumentManager.Instance.CurrentUIApplication.Application

# Obtém o número da versão do Revit
revit_version = doc.VersionNumber

# Retorna o número da versão do Revit
OUT = "A versão do Revit é: {}".format(revit_version)
# ----------------------------------------
code_block_2 = CodeBlock { " "; }
split = String.Split(string=version, separator0=code_block_2)
lastItem = List.LastItem(list=split)
toNumber = String.ToNumber(string=lastItem)

# group: Painel e Nº do circuito
le = code_block <= toNumber
n2026 = CodeBlock { ["Painel", "Número do circuito"]; }  # "2026"
n2021_2022_2023_2024_2025 = CodeBlock { ["Painel", "Número do circuito"]; }  # "2021 - 2022 - 2023 - 2024 - 2025"
if_ = If(test=le, true=n2026, false=n2021_2022_2023_2024_2025)
n2026_2 = CodeBlock { ["Painel", "Número do circuito","Nome da carga"]; }  # "2026"
n2021_2022_2023_2024_2025_2 = CodeBlock { ["Painel", "Número do circuito","Nome da carga"]; }  # "2021 - 2022 - 2023 - 2024 - 2025"
if_2 = If(test=le, true=n2026_2, false=n2021_2022_2023_2024_2025_2)

# group: ENTRADAS PARA O USUÁRIO
code_block_3 = CodeBlock()  # //Data-Shapes
code_block_4 = CodeBlock()  # //archilab
code_block_5 = CodeBlock { "Alterar Fator de Potência do Circuito"; }
string = StringInput("LogoBimacon.png")
python_script = Python(IN[0]=string)  # IronPython2
# ---------- python_script.python (22 lines) ----------
import clr

# Adiciona referência ao ambiente .NET
clr.AddReference('System')
from System import Environment, IO

# Nome da imagem (entrada do usuário)
nome_arquivo_imagem = IN[0]

# Recupera o nome do usuário logado no Windows
usuario = Environment.UserName

# Monta o caminho completo para a pasta de imagens
caminho_base = r"C:\Users\{0}\AppData\Roaming\pyRevit\Extensions\Bimacon.extension\Bimacon.tab\Imagens_Bimacon".format(usuario)

# Junta o caminho base com o nome do arquivo
caminho_completo = IO.Path.Combine(caminho_base, nome_arquivo_imagem)

# Verifica se o arquivo existe
existe = IO.File.Exists(caminho_completo)

OUT = caminho_completo if existe else "Imagem não encontrada: {0}".format(caminho_completo)
# ----------------------------------------
file_from_path = FileObject(path=python_script)
readFromFile = Image.ReadFromFile(file=file_from_path)
string_2 = StringInput("Continuar")
string_3 = StringInput("Escolha o Quadro e o nº do circuito")
categories_4 = Categories("OST_ElectricalCircuit")
all_elements_of_category_2 = ElementsOfCategory(Category=categories_4)
parameterByName = Parameter.ParameterByName(element=all_elements_of_category_2, name=if_2, lacing=CrossProduct)
transpose = List.Transpose(lists=parameterByName)
string_from_object = FromObject(obj=transpose)
code_block_6 = CodeBlock { " : "; }
split_2 = String.Split(string=string_from_object, separator0=code_block_6)
code_block_7 = CodeBlock(list=split_2) { list[0] + " - " + list[1] + " - " + list[2]; }
count = List.Count(list=code_block_7, lacing=Longest)
code_block_8 = CodeBlock { 1; }
gt = count > code_block_8
filterByBoolMask = List.FilterByBoolMask(list=code_block_7, mask=gt)
code_block_9 = CodeBlock { 1; }
getItemAtIndex = List.GetItemAtIndex(list=filterByBoolMask.in, index=code_block_9, lacing=CrossProduct)
parameterByName_2 = Parameter.ParameterByName(element=all_elements_of_category_2, name=if_, lacing=CrossProduct)
transpose_2 = List.Transpose(lists=parameterByName_2)
string_from_object_2 = FromObject(object=transpose_2)
code_block_10 = CodeBlock { " : "; }
split_3 = String.Split(string=string_from_object_2, separator0=code_block_10)
code_block_11 = CodeBlock(list=split_3) { list[0] + " - " + list[1]; }
count_2 = List.Count(list=code_block_11, lacing=Longest)
code_block_12 = CodeBlock { 1; }
gt_2 = count_2 > code_block_12
filterByBoolMask_2 = List.FilterByBoolMask(list=code_block_11, mask=gt_2)
code_block_13 = CodeBlock { 1; }
getItemAtIndex_2 = List.GetItemAtIndex(list=filterByBoolMask_2.in, index=code_block_13, lacing=CrossProduct)
boolean = BoolSelector(false)
string_4 = StringInput("Fator de Potência")
string_5 = StringInput("0.92")
boolean_2 = BoolSelector(true)
textbox_data = Custom[TextBox Data](InputName=string_4, DefaultText=string_5, IsNumberEntry=boolean_2)  # package Data-Shapes; Create Data for TextBox input in UI.MultipleInputForm ++ . Check out www.data-shapes.net for more informations
boolean_3 = BoolSelector(true)
string_6 = StringInput("Cancelar")
number = DoubleInput(700)
number_2 = DoubleInput(220)

parameterByName_3 = Parameter.ParameterByName(element=flatten, name=if_, lacing=CrossProduct)
transpose_3 = List.Transpose(lists=parameterByName_3)
string_from_object_3 = FromObject(obj=transpose_3)
code_block_14 = CodeBlock { " : "; }
split_4 = String.Split(string=string_from_object_3, separator0=code_block_14)
code_block_15 = CodeBlock(list=split_4) { list[0] + " - " + list[1]; }
code_block_16 = CodeBlock { 1; }
getItemAtIndex_3 = List.GetItemAtIndex(list=code_block_15, index=code_block_16, lacing=CrossProduct)
number_3 = DoubleInput(0)
dropdown_data = Custom[DropDown Data](InputName=string_3, Keys=getItemAtIndex, Values=getItemAtIndex_2, DefaultValueIndex=number_3, Sorted_optional=boolean)  # package Data-Shapes; Create data for DropDown input in UI.MultiInputForm ++ . Check out www.data-shapes.net for more infos.

# group (continued): ENTRADAS PARA O USUÁRIO
list_create_2 = List.Create(item0=dropdown_data, item1=textbox_data)
multipleinputform = Custom[MultipleInputForm ++](Description_optional=code_block_5, Logo_optional=readFromFile, ButtonText_optional=string_2, Inputs=list_create_2, Toggle=boolean_3, CancelButtonText_optional=string_6, Width_optional=number, LabelWidth_optional=number_2)  # package Data-Shapes; Create a form with multiple inputs. see www.data-shapes.net for tutorials and infos!

# group: Separar Entradas
code_block_17 = CodeBlock { 0; }
getItemAtIndex_4 = List.GetItemAtIndex(list=multipleinputform.User_Inputs, index=code_block_17)
code_block_18 = CodeBlock { 1; }
getItemAtIndex_5 = List.GetItemAtIndex(list=multipleinputform.User_Inputs, index=code_block_18)

eq = getItemAtIndex_3 == getItemAtIndex_4  # lacing=Longest
filterByBoolMask_3 = List.FilterByBoolMask(list=flatten, mask=eq)
getParentElement = Element.GetParentElement(element=filterByBoolMask_3.in)
isNull = Object.IsNull(object=getParentElement)
filterByBoolMask_4 = List.FilterByBoolMask(list=filterByBoolMask_3.in, mask=isNull)
filterByBoolMask_5 = List.FilterByBoolMask(list=getParentElement, mask=isNull)
list_create_3 = List.Create(item0=filterByBoolMask_4.out, item1=filterByBoolMask_5.out)
flatten_2 = List.Flatten(list=list_create_3)
uniqueItems = List.UniqueItems(list=flatten_2)
code_block_19 = CodeBlock { "Fator de Potência"; }
setParameterByName = Element.SetParameterByName(element=uniqueItems, parameterName=code_block_19, value=getItemAtIndex_5)
code_block_20 = CodeBlock { "Tomada_Fator de Potência"; }
setParameterByName_2 = Element.SetParameterByName(element=uniqueItems, parameterName=code_block_20, value=getItemAtIndex_5)
code_block_21 = CodeBlock { "Tomada 1_Fator de Potência"; }
setParameterByName_3 = Element.SetParameterByName(element=uniqueItems, parameterName=code_block_21, value=getItemAtIndex_5)
code_block_22 = CodeBlock { "Tomada 2_Fator de Potência"; }
setParameterByName_4 = Element.SetParameterByName(element=uniqueItems, parameterName=code_block_22, value=getItemAtIndex_5)
code_block_23 = CodeBlock { "Tomada 3_Fator de Potência"; }
setParameterByName_5 = Element.SetParameterByName(element=uniqueItems, parameterName=code_block_23, value=getItemAtIndex_5)
code_block_24 = CodeBlock { "Tomada 4_Fator de Potência"; }
setParameterByName_6 = Element.SetParameterByName(element=uniqueItems, parameterName=code_block_24, value=getItemAtIndex_5)
code_block_25 = CodeBlock { "Tomada 5_Fator de Potência"; }
setParameterByName_7 = Element.SetParameterByName(element=uniqueItems, parameterName=code_block_25, value=getItemAtIndex_5)
code_block_26 = CodeBlock { "Tomada 6_Fator de Potência"; }
setParameterByName_8 = Element.SetParameterByName(element=uniqueItems, parameterName=code_block_26, value=getItemAtIndex_5)
code_block_27 = CodeBlock { "Fator de Potência 1"; }
setParameterByName_9 = Element.SetParameterByName(element=uniqueItems, parameterName=code_block_27, value=getItemAtIndex_5)
list_create_4 = List.Create(item0=setParameterByName, item1=setParameterByName_2, item2=setParameterByName_3, item3=setParameterByName_4, item4=setParameterByName_5, item5=setParameterByName_6, item6=setParameterByName_7, item7=setParameterByName_8, item8=setParameterByName_9)
flatten_3 = List.Flatten(list=list_create_4)
boolean_4 = BoolSelector(false)
clean = List.Clean(list=flatten_3, preserveIndices=boolean_4)

# group: Mensagem final
count_3 = List.Count(list=clean)
code_block_28 = CodeBlock { 0; }
gt_3 = count_3 > code_block_28
code_block_29 = CodeBlock(N=count_3) { ["Feito! Você alterou o FP de "+N+" elementos"]; }
code_block_30 = CodeBlock { ["Nenhum FP alterado"]; }
if_3 = If(test=gt_3, true=code_block_29, false=code_block_30)
flatten_4 = List.Flatten(list=if_3)
fromList = Python(IN[0]=flatten_4)  # "String.FromList"; IronPython2
# ---------- fromList.python (22 lines) ----------
# Carregar as bibliotecas DesignScript e padrão do Python
import sys
import clr
clr.AddReference('ProtoGeometry')
from Autodesk.DesignScript.Geometry import *

# Função para concatenar os valores de uma lista em uma única string com múltiplas linhas
def concatenate_list_to_string(input_list, delimiter="\n"):
    # Verifica se a entrada é uma lista
    if not isinstance(input_list, list):
        return "A entrada deve ser uma lista."
    
    # Converte todos os elementos para string e junta com o delimitador especificado
    result = delimiter.join(str(item) for item in input_list)
    return result

# Entrada pelo nó do Dynamo
lista = IN[0]  # Lista de valores a serem concatenados
delimitador = IN[1] if len(IN) > 1 else "\n"  # Delimitador opcional, padrão é nova linha

# Saída para o Dynamo
OUT = concatenate_list_to_string(lista, delimitador)
# ----------------------------------------
python_script_2 = Python(IN[0]=fromList)  # IronPython2
# ---------- python_script_2.python (21 lines) ----------
# Importar as bibliotecas necessárias do Revit
import clr
clr.AddReference("RevitServices")
from RevitServices.Persistence import DocumentManager

clr.AddReference("RevitAPI")
clr.AddReference("RevitAPIUI")
from Autodesk.Revit.UI import TaskDialog

# Pegar a entrada do Dynamo
mensagem = IN[0]

# Criar a TaskDialog
task_dialog = TaskDialog("Ok")
task_dialog.MainInstruction = mensagem

# Exibir a TaskDialog
task_dialog.Show()

# Saída do script
OUT = "Sucesso!"
# ----------------------------------------

getChildElements = Element.GetChildElements(element=all_elements_of_category)
