# Dynamo graph 03-2_BIMACON_Atribuir Potência Ativa (W) em todas tabelas_R02_script.dyn "ok 03-2_BIMACON_Atribuir Potência Ativa (W) em todas tabelas_R02_script" (Dynamo 2.19.3.6394)
# author: Jose Nelson
# Atribui Potência Ativa em todas tabelas de painéis
# packages: DynaMEP 2.0.1, MEPover 2022.10.30, Rhythm 2023.4.2024, Rhythm 2023.4.2021

quadro_elétrico = Categories("OST_ElectricalEquipment")
all_elements_of_category = ElementsOfCategory(Category=quadro_elétrico)
nome_do_parâmetro = StringInput("Potência Aparente (VA)")

# group: Versão Revit
version = Python()  # "Document.Version"; IronPython2; unwired: IN[0]
# ---------- version.python (13 lines) ----------
# Importa as bibliotecas necessárias do Revit
import clr
clr.AddReference('RevitServices')
from RevitServices.Persistence import DocumentManager

# Obtém o documento ativo
doc = DocumentManager.Instance.CurrentUIApplication.Application

# Obtém o número da versão do Revit
revit_version = doc.VersionNumber

# Retorna o número da versão do Revit
OUT = "A versão do Revit é: {}".format(revit_version)
# ----------------------------------------
code_block = CodeBlock { " "; }
split = String.Split(string=version, separator0=code_block)
lastItem = List.LastItem(list=split)
toNumber = String.ToNumber(string=lastItem)

code_block_2 = CodeBlock { 2021; 2022; 2023; 2024; 2025; }

# group: CORRENTE DEMANDA
le = toNumber <= code_block_2.out3
n2021_2022_2023_2024 = CodeBlock { "Total conectado"; }  # "2021 - 2022 - 2023 - 2024"
n2025 = CodeBlock { "Potência Aparente conectada total"; }  # "2025"
if_ = If(test=le, true=n2021_2022_2023_2024, false=n2025)

ʳʰʸᵗʰᵐ_elements = Rhythm.Revit.Elements.Elements.GetParameterValueByNameTypeOrInstance(element=all_elements_of_category, parameterName=if_)
unit_conversion = CodeBlock(n=ʳʰʸᵗʰᵐ_elements) { n<1>/[0.09290304]; }
setParameterValueByName = RevitModel.Element.SetParameterValueByName(element=all_elements_of_category, parameterName=nome_do_parâmetro, values=unit_conversion)
nome_do_parâmetro_2 = StringInput("Potência Ativa (W)")
electricalCircuit = Custom[Element.ElectricalCircuit](element=all_elements_of_category)  # package MEPover; Returns the electrical circuit of the element

# group: POT EM WATTS
le_2 = toNumber <= code_block_2.out3
n2021_2022_2023_2024_2 = CodeBlock { "Carga real"; }  # "2021 - 2022 - 2023 - 2024"
n2025_2 = CodeBlock { "Potência real"; }  # "2025"
if_2 = If(test=le_2, true=n2021_2022_2023_2024_2, false=n2025_2)

ʳʰʸᵗʰᵐ_elements_2 = Rhythm.Revit.Elements.Elements.GetParameterValueByNameTypeOrInstance(element=electricalCircuit, parameterName=if_2)
maximumItem = List.MaximumItem(list=ʳʰʸᵗʰᵐ_elements_2)
unit_conversion_2 = CodeBlock(n=maximumItem) { n<1>/[0.09290304]; }
setParameterValueByName_2 = RevitModel.Element.SetParameterValueByName(element=all_elements_of_category, parameterName=nome_do_parâmetro_2, values=unit_conversion_2)
boolean = BoolSelector(false)
clean = List.Clean(list=setParameterValueByName_2, preserveIndices=boolean)

# group: Mensagem Final
count = List.Count(list=clean)
code_block_3 = CodeBlock { 0; }
gt = count > code_block_3
code_block_4 = CodeBlock(N=count) { ["Potências Atribuidas nas Tabelas de "+N+" Quadros"]; }
flatten = List.Flatten(list=[code_block_4, code_block_4, code_block_4, code_block_4, code_block_4, code_block_4, code_block_4, code_block_4, code_block_4, code_block_4, code_block_4, code_block_4, code_block_4, code_block_4, code_block_4, code_block_4, code_block_4, code_block_4, code_block_4, code_block_4, code_block_4])
code_block_5 = CodeBlock { ["Nenhuma Potência Atribuida"]; }
if_3 = If(test=gt, true=flatten, false=code_block_5)
flatten_2 = List.Flatten(list=if_3)
fromList = Python(IN[0]=flatten_2)  # "String.FromList"; IronPython2
# ---------- fromList.python (22 lines) ----------
# Carregar as bibliotecas DesignScript e padrão do Python
import sys
import clr
clr.AddReference('ProtoGeometry')
from Autodesk.DesignScript.Geometry import *

# Função para concatenar os valores de uma lista em uma única string com múltiplas linhas
def concatenate_list_to_string(input_list, delimiter="\n"):
    # Verifica se a entrada é uma lista
    if not isinstance(input_list, list):
        return "A entrada deve ser uma lista."
    
    # Converte todos os elementos para string e junta com o delimitador especificado
    result = delimiter.join(str(item) for item in input_list)
    return result

# Entrada pelo nó do Dynamo
lista = IN[0]  # Lista de valores a serem concatenados
delimitador = IN[1] if len(IN) > 1 else "\n"  # Delimitador opcional, padrão é nova linha

# Saída para o Dynamo
OUT = concatenate_list_to_string(lista, delimitador)
# ----------------------------------------
python_script = Python(IN[0]=fromList)  # IronPython2
# ---------- python_script.python (21 lines) ----------
# Importar as bibliotecas necessárias do Revit
import clr
clr.AddReference("RevitServices")
from RevitServices.Persistence import DocumentManager

clr.AddReference("RevitAPI")
clr.AddReference("RevitAPIUI")
from Autodesk.Revit.UI import TaskDialog

# Pegar a entrada do Dynamo
mensagem = IN[0]

# Criar a TaskDialog
task_dialog = TaskDialog("Ok")
task_dialog.MainInstruction = mensagem

# Exibir a TaskDialog
task_dialog.Show()

# Saída do script
OUT = "Sucesso!"
# ----------------------------------------

# group: DEMANDA TOTAL
eq = code_block_2.out4 == toNumber
le_3 = toNumber <= code_block_2.out2
n2021_2022_2023 = CodeBlock { "Demanda do total estimado"; }  # "2021 - 2022 - 2023"
if_4 = If(test=le_3, true=n2021_2022_2023, false=code_block_2.out1)
if_5 = If(test=eq, true=code_block_2.out4, false=code_block_2.out0)
eq_2 = if_4 == if_5
eq_3 = eq == eq_2
ge = toNumber >= code_block_2.out3
if_6 = If(test=ge, true=toNumber, false=code_block_2.out4)
ge_2 = if_6 >= if_4
n2024 = CodeBlock { "Demanda total estimada"; }  # "2024"
if_7 = If(test=ge_2, true=n2024, false=n2021_2022_2023)
n2025_3 = CodeBlock { "Potência aparente de demanda total"; }  # "2025"
if_8 = If(test=eq_3, true=if_7, false=n2025_3)
