# Dynamo graph 2021_11-0_BIMACON_Destacar Eletrodutos Desconectados_R02_script.dyn (Dynamo 2.6.1.8786)
# packages: Clockwork for Dynamo 2.x 2.4.0, Crumple 2021.9.24, MEPover 2022.10.30, DynaMEP 2.0.1, bimorphNodes 4.2.4, Orchid 2.6.8.6198

desfazer_sobreposição = BoolSelector(false)  # graph input

# group: Conduites desconectados
categories = Categories("OST_Conduit")
all_elements_of_category = ElementsOfCategory(Category=categories)

connectors = RevitModel.Element.Connectors(elements=all_elements_of_category)
isConnected = MEP.Connectors.IsConnected(connector=connectors)

# group (continued): Conduites desconectados
filterByBoolMask = List.FilterByBoolMask(list=connectors, mask=isConnected)
flatten = List.Flatten(list=filterByBoolMask.in)
flatten_2 = List.Flatten(list=filterByBoolMask.out)

owner = MEP.Connectors.Owner(connector=flatten)

# group: Curvas Desconectadas
categories_2 = Categories("OST_ConduitFitting")
all_elements_of_category_2 = ElementsOfCategory(Category=categories_2)

name = Element.Name(element=all_elements_of_category_2)
code_block = CodeBlock { "Curva"; }
contains = String.Contains(str=name, searchFor=code_block)
filterByBoolMask_2 = List.FilterByBoolMask(list=all_elements_of_category_2, mask=contains)
flatten_3 = List.Flatten(list=filterByBoolMask_2.in)
connectors_2 = Custom[Element.Connectors](element=flatten_3)  # package MEPover; Returns every connector on an element (also return connectors of a System)
isConnected_2 = MEP.Connectors.IsConnected(connector=connectors_2)

# group (continued): Curvas Desconectadas
filterByBoolMask_3 = List.FilterByBoolMask(list=connectors_2, mask=isConnected_2)
flatten_4 = List.Flatten(list=filterByBoolMask_3.out)

owner_2 = MEP.Connectors.Owner(connector=flatten_4)
owner_3 = MEP.Connectors.Owner(connector=flatten_2)

# group: Selecionar caixas
categories_3 = Categories("OST_ElectricalFixtures")
all_elements_of_category_3 = ElementsOfCategory(Category=categories_3)
categories_4 = Categories("OST_LightingDevices")
all_elements_of_category_4 = ElementsOfCategory(Category=categories_4)
categories_5 = Categories("OST_ElectricalEquipment")
all_elements_of_category_5 = ElementsOfCategory(Category=categories_5)
categories_6 = Categories("OST_ConduitFitting")
all_elements_of_category_6 = ElementsOfCategory(Category=categories_6)
list_create = List.Create(item0=all_elements_of_category_3, item1=all_elements_of_category_4, item2=all_elements_of_category_5, item3=all_elements_of_category_6)

flatten_5 = List.Flatten(list=list_create)

# group: Limpar Sobreposição
list_create_2 = List.Create(item0=owner, item1=owner_2, item2=owner_3, item3=flatten_5)
empty = List.Empty()
scopeIf = Custom[ScopeIf+](test=desfazer_sobreposição, True=list_create_2, False=empty)  # package Clockwork for Dynamo 2.x; A (hopefully) more robust implementation of ScopeIf. Tests a single boolean and returns a value accordingly.
currentview = Custom[© CurrentView]()  # package Crumple; Given the current document, return the active view.
resetElementOverrides = Custom[View.ResetElementOverrides](element=scopeIf, view=currentview)  # package Clockwork for Dynamo 2.x; Resets all overrides for an element in a given view
watch = Watch(resetElementOverrides.element)

solids = Element.Solids(element=owner_3)
code_block_2 = CodeBlock { 0; }
location = MEP.Connectors.Location(connector=flatten_2)

# group: Filtrar caixas
code_block_3 = CodeBlock { 0.03; }
byCenterPointRadius = Sphere.ByCenterPointRadius(centerPoint=location, radius=code_block_3)
boolean = BoolSelector(true)

intersectsSolid = Revit.Element.IntersectsSolid(solids=byCenterPointRadius, elements=flatten_5)
intersectingElements = Results.SolidIntersectionResult.IntersectingElements(solidIntersectionResult=intersectsSolid)

# group (continued): Filtrar caixas
clean = List.Clean(list=intersectingElements, preserveIndices=boolean)
flatten_6 = List.Flatten(list=clean)
list_create_3 = List.Create(item0=flatten_6, item1=owner_3, item2=owner_2)

# group: Cor
color_palette = ColorPalette({R: 255, G: 0, B: 0, A: 255})
color_palette_2 = ColorPalette({R: 255, G: 0, B: 0, A: 255})
color_palette_3 = ColorPalette({R: 255, G: 0, B: 0, A: 255})
color_palette_4 = ColorPalette({R: 0, G: 0, B: 0, A: 255})

# group: Hachura
fill_patterns = FillPatterns("<Preenchimento sólido>")
fill_patterns_2 = FillPatterns("<Preenchimento sólido>")

# group: Linhas Hachura
line_patterns = LinePatterns("Alinhamento")
line_patterns_2 = LinePatterns("Alinhamento")

# group: Espessura da linha
number_slider = DoubleSlider(2, range=0..100 step 1)
number_slider_2 = DoubleSlider(2, range=0..100 step 1)

# group: Transparência
number_slider_3 = DoubleSlider(0, range=0..100 step 1)

# group: Nível de Detalhe
detail_level = DetailLevel("Fine")

boolean_2 = BoolSelector(false)

# group: Sobreposição de Gráficos
byProperties = Revit.Filter.OverrideGraphicSettings.ByProperties(cutFillColor=color_palette, projectionFillColor=color_palette_2, cutLineColor=color_palette_3, projectionLineColor=color_palette_4, cutFillPattern=fill_patterns, projectionFillPattern=fill_patterns_2, cutLinePattern=line_patterns, projectionLinePattern=line_patterns_2, cutLineWeight=number_slider, projectionLineWeight=number_slider_2, transparency=number_slider_3, detailLevel=detail_level, halftone=boolean_2)
overrideInView = Element.OverrideInView(element=list_create_3, overrides=byProperties)

# group: Curvas e conduites desconectados
string_from_object = FromObject(obj=overrideInView)
code_block_4 = CodeBlock { "Curva"; }
contains_2 = String.Contains(str=string_from_object, searchFor=code_block_4)
filterByBoolMask_4 = List.FilterByBoolMask(list=string_from_object, mask=contains_2)
flatten_7 = List.Flatten(list=filterByBoolMask_4.in)
string_from_object_2 = FromObject(obj=overrideInView)
code_block_5 = CodeBlock { "Conduit"; }
contains_3 = String.Contains(str=string_from_object_2, searchFor=code_block_5)
filterByBoolMask_5 = List.FilterByBoolMask(list=string_from_object_2, mask=contains_3)
flatten_8 = List.Flatten(list=filterByBoolMask_5.in)
list_create_4 = List.Create(item0=flatten_7, item1=flatten_8)
flatten_9 = List.Flatten(list=list_create_4)

# group: Mensagem Final
count = List.Count(list=flatten_9)
code_block_6 = CodeBlock { 0; }
code_block_7 = CodeBlock { ["Nenhum eletroduto identificado"]; }

if_ = If(test=desfazer_sobreposição, true=code_block_2, false=count)

# group (continued): Mensagem Final
gt = if_ > code_block_6
code_block_8 = CodeBlock(N=if_) { [""+N+" elementos desconectados"]; }
if_2 = If(test=gt, true=code_block_8, false=code_block_7)

flatten_10 = List.Flatten(list=if_2)

# group (continued): Mensagem Final
o_string_fromlist = Orchid.Common.String.FromList(list=flatten_10)
python_script = Python(IN[0]=o_string_fromlist)
# ---------- python_script.python (21 lines) ----------
# Importar as bibliotecas necessárias do Revit
import clr
clr.AddReference("RevitServices")
from RevitServices.Persistence import DocumentManager

clr.AddReference("RevitAPI")
clr.AddReference("RevitAPIUI")
from Autodesk.Revit.UI import TaskDialog

# Pegar a entrada do Dynamo
mensagem = IN[0]

# Criar a TaskDialog
task_dialog = TaskDialog("Ok")
task_dialog.MainInstruction = mensagem

# Exibir a TaskDialog
task_dialog.Show()

# Saída do script
OUT = "Sucesso!"
# ----------------------------------------
