# Dynamo graph 2021_10-3_BIMACON_Excluir Códigos de Conexões_R01_script.dyn "2023_10-3_BIMACON_Excluir Códigos de Conexões_R01" (Dynamo 2.16.2.5624)
# author: José Nelson Bimacon
# Exclui os Códigos de  Identificadores de todas conexões.
# packages: DynaMEP 2.0.1, Data-Shapes 2022.2.105

categories = Categories("OST_ConduitFitting")
categories_2 = Categories("OST_CableTrayFitting")
list_create = List.Create(item0=categories, item1=categories_2)
all_elements_of_category = ElementsOfCategory(Category=list_create)
elementType = Element.ElementType(element=all_elements_of_category)
string = StringInput("Comentários de tipos")
getParameterValueByName = Element.GetParameterValueByName(element=elementType, parameterName=string)

# group: Janela de Imputs
string_2 = StringInput("Inserir Identificadores em conexões")
file_path = Filename("C:\Users\jneng\Documents\logo.png")
file_from_path = FileObject(path=file_path)
readFromFile = Image.ReadFromFile(file=file_from_path)
string_3 = StringInput("Executar")
string_4 = StringInput("Selecione o \"Comentário de tipo\":")
code_block = CodeBlock()
# ---------- code_block.designscript (14 lines) ----------
"PVC Roscável Preto";
"PVC Corrugado Amarelo";
"PVC Corrugado Azul";
"PVC Corrugado Cinza";
"PVC Corrugado Laranja Reforçado";
"PVC Condulete TOP";
"Conduletes de Aluminio";
"Conduletes sem Rosca";
"Derivações de Eletrodutos com Rosca BSP";
"Derivações de Eletrocalhas";
"Derivações de Perfilados";
"Derivações de Leitos";
"PEAD Corrugado";
"Caixas de Passagem Elétrica";
# ----------------------------------------
list_create_2 = List.Create(item0=code_block.out0, item1=code_block.out1, item2=code_block.out2, item3=code_block.out3, item4=code_block.out4, item5=code_block.out5, item6=code_block.out6, item7=code_block.out7, item8=code_block.out8, item9=code_block.out9, item10=code_block.out10, item11=code_block.out11, item12=code_block.out12, item13=code_block.out13)
number = DoubleInput(0)
dropdown_data = Custom[DropDown Data](InputName=string_4, Keys=list_create_2, Values=list_create_2, DefaultValueIndex=number)  # package Data-Shapes; Create data for DropDown input in UI.MultiInputForm ++ . Check out www.data-shapes.net for more infos.
boolean = BoolSelector(true)
string_5 = StringInput("http://bimacon.wix.com/bimacon")
string_6 = StringInput("Cancelar")
number_2 = DoubleInput(500)
number_3 = DoubleInput(220)
multipleinputform = Custom[MultipleInputForm ++](Description_optional=string_2, Logo_optional=readFromFile, ButtonText_optional=string_3, Inputs=dropdown_data, Toggle=boolean, LinkToHelp_optional=string_5, CancelButtonText_optional=string_6, Width_optional=number_2, LabelWidth_optional=number_3)  # package Data-Shapes; Create a form with multiple inputs. see www.data-shapes.net for tutorials and infos!

contains = String.Contains(string=getParameterValueByName, searchFor=multipleinputform.User_Inputs)
filterByBoolMask = List.FilterByBoolMask(list=elementType, mask=contains)
byFamilyType = FamilyInstance.ByFamilyType(familyType=filterByBoolMask.in)
nome_do_parâmetro = StringInput("Identificador")  # graph input
string_7 = StringInput("")
setParameterValueByName = RevitModel.Element.SetParameterValueByName(element=byFamilyType, parameterName=nome_do_parâmetro, values=string_7)
