# Dynamo graph 2021_09-2_BIMACON_Atribuir Potência Ativa (W) em todas tabelas_R01_script.dyn "2021_09-2_BIMACON_Atribuir Potência Ativa (W) em todas tabelas_R01" (Dynamo 2.6.1.8786)
# packages: DynaMEP 2.0.1, MEPover 2022.10.30, Rhythm 2023.4.2024, Rhythm 2023.4.2021, Orchid 2.6.8.6198, Crumple 2021.9.24

quadro_elétrico = Categories("OST_ElectricalEquipment")
all_elements_of_category = ElementsOfCategory(Category=quadro_elétrico)
nome_do_parâmetro = StringInput("Potência Aparente (VA)")

# group: Versão Revit
currentpath = Custom[© CurrentPath]()  # package Crumple; Returns the full file path, directory path and name of a Revit document.
o_file_info = Orchid.Common.File.Info(file=currentpath.filePath)
code_block = CodeBlock { " "; }
split = String.Split(str=o_file_info, separator0=code_block)
firstItem = List.FirstItem(list=split)
toNumber = String.ToNumber(str=firstItem)

code_block_2 = CodeBlock { 2021; 2022; 2023; 2024; 2025; }

# group: CORRENTE DEMANDA
le = toNumber <= code_block_2.out3
n2021_2022_2023_2024 = CodeBlock { "Total conectado"; }  # "2021 - 2022 - 2023 - 2024"
n2025 = CodeBlock { "Potência Aparente conectada total"; }  # "2025"
if_ = If(test=le, true=n2021_2022_2023_2024, false=n2025)

ʳʰʸᵗʰᵐ_elements = Rhythm.Revit.Elements.Elements.GetParameterValueByNameTypeOrInstance(element=all_elements_of_category, parameterName=if_)
unit_conversion = CodeBlock(n=ʳʰʸᵗʰᵐ_elements) { n<1>/[0.09290304]; }
setParameterValueByName = RevitModel.Element.SetParameterValueByName(element=all_elements_of_category, parameterName=nome_do_parâmetro, values=unit_conversion)
nome_do_parâmetro_2 = StringInput("Potência Ativa (W)")
electricalCircuit = Custom[Element.ElectricalCircuit](element=all_elements_of_category)  # package MEPover; Returns the electrical circuit of the element

# group: POT EM WATTS
le_2 = toNumber <= code_block_2.out3
n2021_2022_2023_2024_2 = CodeBlock { "Carga real"; }  # "2021 - 2022 - 2023 - 2024"
n2025_2 = CodeBlock { "Potência real"; }  # "2025"
if_2 = If(test=le_2, true=n2021_2022_2023_2024_2, false=n2025_2)

ʳʰʸᵗʰᵐ_elements_2 = Rhythm.Revit.Elements.Elements.GetParameterValueByNameTypeOrInstance(element=electricalCircuit, parameterName=if_2)
maximumItem = List.MaximumItem(list=ʳʰʸᵗʰᵐ_elements_2)
unit_conversion_2 = CodeBlock(n=maximumItem) { n<1>/[0.09290304]; }
setParameterValueByName_2 = RevitModel.Element.SetParameterValueByName(element=all_elements_of_category, parameterName=nome_do_parâmetro_2, values=unit_conversion_2)
boolean = BoolSelector(false)
clean = List.Clean(list=setParameterValueByName_2, preserveIndices=boolean)

# group: Mensagem Final
count = List.Count(list=clean)
code_block_3 = CodeBlock { 0; }
gt = count > code_block_3
code_block_4 = CodeBlock(N=count) { ["Potências Atribuidas nas Tabelas de "+N+" Quadros"]; }
flatten = List.Flatten(list=[code_block_4, code_block_4, code_block_4, code_block_4, code_block_4, code_block_4, code_block_4, code_block_4, code_block_4, code_block_4, code_block_4, code_block_4, code_block_4, code_block_4, code_block_4, code_block_4, code_block_4, code_block_4, code_block_4, code_block_4, code_block_4])
code_block_5 = CodeBlock { ["Nenhuma Potência Atribuida"]; }
if_3 = If(test=gt, true=flatten, false=code_block_5)
flatten_2 = List.Flatten(list=if_3)
o_string_fromlist = Orchid.Common.String.FromList(list=flatten_2)
python_script = Python(IN[0]=o_string_fromlist)
# ---------- python_script.python (21 lines) ----------
# Importar as bibliotecas necessárias do Revit
import clr
clr.AddReference("RevitServices")
from RevitServices.Persistence import DocumentManager

clr.AddReference("RevitAPI")
clr.AddReference("RevitAPIUI")
from Autodesk.Revit.UI import TaskDialog

# Pegar a entrada do Dynamo
mensagem = IN[0]

# Criar a TaskDialog
task_dialog = TaskDialog("Ok")
task_dialog.MainInstruction = mensagem

# Exibir a TaskDialog
task_dialog.Show()

# Saída do script
OUT = "Sucesso!"
# ----------------------------------------

# group: DEMANDA TOTAL
eq = code_block_2.out4 == toNumber
le_3 = toNumber <= code_block_2.out2
n2021_2022_2023 = CodeBlock { "Demanda do total estimado"; }  # "2021 - 2022 - 2023"
if_4 = If(test=le_3, true=n2021_2022_2023, false=code_block_2.out1)
if_5 = If(test=eq, true=code_block_2.out4, false=code_block_2.out0)
eq_2 = if_4 == if_5
eq_3 = eq == eq_2
ge = toNumber >= code_block_2.out3
if_6 = If(test=ge, true=toNumber, false=code_block_2.out4)
ge_2 = if_6 >= if_4
n2024 = CodeBlock { "Demanda total estimada"; }  # "2024"
if_7 = If(test=ge_2, true=n2024, false=n2021_2022_2023)
n2025_3 = CodeBlock { "Potência aparente de demanda total"; }  # "2025"
if_8 = If(test=eq_3, true=if_7, false=n2025_3)
