# Dynamo graph BIMACON_Deleta backup Famílias_script.dyn "BIMACON_Delete backup Famílias" (Dynamo 2.6.1.8786)

selecione_a_pasta_para_deletar = Directory("C:\Users\jneng\Desktop\teste parameter")  # "Selecione a pasta para deletar Backups de famílias"; graph input
python_script = Python(IN[0]=selecione_a_pasta_para_deletar)  # graph output
# ---------- python_script.python (18 lines) ----------
import sys
sys.path.append(r"C:\Program Files (x86)\IronPython 2.7\Lib")

import os
import re


filelist = list()
for root, dirs, files in os.walk(IN[0]):
	for file in files:
		matches = re.match(".*\.[0-9]+\.(rfa|RFA)$", file)
	
		if matches:
			backup = os.path.join(root, file)
			filelist.append(backup)
			os.remove(backup)

OUT = filelist
# ----------------------------------------
count = List.Count(list=python_script)
code_block = CodeBlock { 0; }
gt = count > code_block
code_block_2 = CodeBlock(N=count) { ["Feito! você excluiu "+N+" backups"]; }
code_block_3 = CodeBlock { ["Nenhum backup foi excluído"]; }
if_ = If(test=gt, true=code_block_2, false=code_block_3)
boolean = BoolSelector(false)
window_prompt_with_text = Python(IN[0]=if_, IN[1]=boolean)
# ---------- window_prompt_with_text.python (19 lines) ----------
import clr

clr.AddReference("System.Windows.Forms")
from System.Windows.Forms import Form,Label,FormStartPosition

def popup(text):
	form = Form()
	form.StartPosition = FormStartPosition.CenterScreen
	form.Width = 300
	form.Height = 100	
	label = Label()
	label.Text = text
	label.Width = 280
	label.Height = 70
	label.Parent = form	
	form.ShowDialog()
	
Text="\n".join(IN[0])
popup(Text)
# ----------------------------------------
watch = Watch(window_prompt_with_text)
