# Dynamo graph BIMACON_Deleta backup Rotinas_script.dyn "BIMACON_Deleta backup Rotinas" (Dynamo 2.6.1.8786)
# packages: Sastrugi 2.0.2

selecione_a_pasta_para_deletar = Directory("D:\OneDrive\00 - TUDO REVIT\J - Rotinas Dynamo\Rotinas Dynamo_BIMACON")  # "Selecione a pasta para deletar Backups dynamo"; graph input
delete_dyn_and_dyf_backup_files = Custom[❄_Delete DYN and DYF Backup Files](DirectoryPath=selecione_a_pasta_para_deletar)  # package Sastrugi; (Sastrugi_Management) This node deletes backup files created for Nodes and Scripts, from the specified directory.
watch = Watch(delete_dyn_and_dyf_backup_files)
