# Dynamo graph BIMACON_Deletar Conduítes Vazios-Lista Materiais_script.dyn "14-0_BIMACON_Deletar Conduítes Vazios-Lista Materiais" (Dynamo 2.6.1.8786)
# packages: DynaMEP 2.0.1, archi-lab.net 2023.213.1722

current = RevitModel.Documents.Current()
categories = Categories("OST_ConduitRun")  # graph input
selectByCategory = RevitModel.Element.SelectByCategory(doc=current, category=categories)
string = StringInput("Comprimento")
getParameterValueByName = Element.GetParameterValueByName(element=selectByCategory, parameterName=string)
number = DoubleInput(0)
eq = getParameterValueByName == number
filterByBoolMask = List.FilterByBoolMask(list=selectByCategory, mask=eq)
delete = archilab.Revit.Elements.Elements.Delete(element=filterByBoolMask.in)
watch = Watch(delete)

# group: Mensagem final
countTrue = List.CountTrue(list=watch)
code_block = CodeBlock { 0; }
gt = countTrue > code_block
code_block_2 = CodeBlock(N=countTrue) { ["Feito! você uniu "+N+" eletrodutos com os quadros"]; }
code_block_3 = CodeBlock { ["Nenhum elemento foi unido"]; }
if_ = If(test=gt, true=code_block_2, false=code_block_3)
boolean = BoolSelector(false)
window_prompt_with_text = Python(IN[0]=if_, IN[1]=boolean)
# ---------- window_prompt_with_text.python (19 lines) ----------
import clr

clr.AddReference("System.Windows.Forms")
from System.Windows.Forms import Form,Label,FormStartPosition

def popup(text):
	form = Form()
	form.StartPosition = FormStartPosition.CenterScreen
	form.Width = 300
	form.Height = 100	
	label = Label()
	label.Text = text
	label.Width = 280
	label.Height = 70
	label.Parent = form	
	form.ShowDialog()
	
Text="\n".join(IN[0])
popup(Text)
# ----------------------------------------
