# Dynamo graph BIMACON_Deletar Elementos Duplicados_R00_script.dyn (Dynamo 2.6.1.8786)
# packages: Crumple 2021.9.24, Orchid 2.6.10.6373

# note: Custom Node: Crumple v.2021.9.24
getwarnings = Custom[© GetWarnings]()  # package Crumple; Returns all warnings in the Revit model in their Revit db format.
warningmessage = Custom[© WarningMessage](warning=getwarnings)  # package Crumple; Given a warning element in Revit db format, will return the message associated with that warning in a generic string format.
code_block = CodeBlock { "instâncias idênticas"; true; }
contains = String.Contains(str=warningmessage, searchFor=code_block.out0, ignoreCase=code_block.out1)
filterByBoolMask = List.FilterByBoolMask(list=getwarnings, mask=contains)
warningelements = Custom[© WarningElements](warning=filterByBoolMask.in)  # package Crumple; Returns the element(s) associated with the provided warning.
code_block_2 = CodeBlock { 0; }
removeItemAtIndex = List.RemoveItemAtIndex(list=warningelements@L2, indices=code_block_2)
flatten = List.Flatten(list=removeItemAtIndex)
uniqueItems = List.UniqueItems(list=flatten)
elementdelete = Custom[© ElementDelete](elements=uniqueItems)  # package Crumple; Given a list of elements, attempt to delete them and then return true or false depending on whether it could be deleted. This script flattens the list structure before attempting.

# group: Mensagem
count = List.Count(list=elementdelete.results)
code_block_3 = CodeBlock { 0; }
gt = count > code_block_3
code_block_4 = CodeBlock(N=count) { ["Feito! Você deletou "+N+" elementos duplicados em seu projeto"]; }
code_block_5 = CodeBlock { ["Nenhum elemento foi deletado"]; }
if_ = If(test=gt, true=code_block_4, false=code_block_5)
o_string_fromlist = Orchid.Common.String.FromList(list=if_)
python_script = Python(IN[0]=o_string_fromlist)
# ---------- python_script.python (21 lines) ----------
# Importar as bibliotecas necessárias do Revit
import clr
clr.AddReference("RevitServices")
from RevitServices.Persistence import DocumentManager

clr.AddReference("RevitAPI")
clr.AddReference("RevitAPIUI")
from Autodesk.Revit.UI import TaskDialog

# Pegar a entrada do Dynamo
mensagem = IN[0]

# Criar a TaskDialog
task_dialog = TaskDialog("Ok")
task_dialog.MainInstruction = mensagem

# Exibir a TaskDialog
task_dialog.Show()

# Saída do script
OUT = "Sucesso!"
# ----------------------------------------
