# Dynamo graph BIMACON_Deletar Elementos Duplicados_script.dyn "BIMACON_Deletar Elementos Duplicados" (Dynamo 2.6.1.8786)
# packages: Clockwork for Dynamo 2.x 2.4.0, DynaMEP 2.0.1

# group: Next Step
location = FamilyInstance.Location()  # frozen; unwired: familyInstance

directory_path = Directory("No file selected.")
code_block = CodeBlock { "Sheet1"; }
code_block_2 = CodeBlock { 0; }
categories = Categories("OST_Conduit")  # graph input
all_elements_of_category = ElementsOfCategory(Category=categories)
location_2 = Custom[Element.Location+](element=all_elements_of_category)  # package Clockwork for Dynamo 2.x; Returns the location of an element as point, curve or curve loop, along with some booleans to help filtering the results. Unlike the OOTB Element.GetLocation node, it also retunrs sketch lines of sketch-based elements like floor slabs as well as the element's rotation property.
code_block_3 = CodeBlock { 0; 1; }
getItemAtIndex = List.GetItemAtIndex(list=location_2.curveEndpoints@L2, index=code_block_3.out0)
getItemAtIndex_2 = List.GetItemAtIndex(list=location_2.curveEndpoints@L2, index=code_block_3.out1)
midpoint = Geometry.Points.Midpoint(startPoint=getItemAtIndex, endPoint=getItemAtIndex_2)
python_scripts = Python(IN[0]=midpoint)
# ---------- python_scripts.python (41 lines) ----------
import clr
clr.AddReference('ProtoGeometry')
from Autodesk.DesignScript.Geometry import *

# Import DocumentManager and TransactionManager
clr.AddReference("RevitServices")
import RevitServices
from RevitServices.Persistence import DocumentManager
from RevitServices.Transactions import TransactionManager

# Import RevitAPI
clr.AddReference("RevitAPI")
import Autodesk
from Autodesk.Revit.DB import *

doc = DocumentManager.Instance.CurrentDBDocument
uiapp = DocumentManager.Instance.CurrentUIApplication
app = uiapp.Application

from System.Collections.Generic import *

# Import ToDSType(bool) extension method
clr.AddReference("RevitNodes")
import Revit
clr.ImportExtensions(Revit.Elements)

#The inputs to this node will be stored as a list in the IN variable.
dataEnteringNode = IN
mylist = IN[0]

i, seen, result = mylist, set(), []
for _index, item in enumerate(i):
    if item not in seen:
		# First time seeing the element
        seen.add(item)
    else:
		 # Already seen, add the index to the result
        result.append(_index)     

#Assign your output to the OUT variable
OUT = result
# ----------------------------------------
getItemAtIndex_3 = List.GetItemAtIndex(list=all_elements_of_category, index=python_scripts)
flatten = List.Flatten(list=getItemAtIndex_3)
id = Element.Id(element=getItemAtIndex_3)
transpose = List.Transpose(lists=id)
list_create = List.Create(item0=flatten, item1=transpose)
boolean = BoolSelector(true)
exportExcel = Data.ExportExcel(filePath=directory_path, sheetName=code_block, startRow=code_block_2, startCol=code_block_2, data=list_create, overWrite=boolean)
delete = Python(IN[0]=getItemAtIndex_3)  # "Element.Delete"
# ---------- delete.python (46 lines) ----------
import clr
clr.AddReference('ProtoGeometry')
from Autodesk.DesignScript.Geometry import *

# Import DocumentManager and TransactionManager
clr.AddReference("RevitServices")
import RevitServices
from RevitServices.Persistence import DocumentManager
from RevitServices.Transactions import TransactionManager

# Import RevitAPI
clr.AddReference("RevitAPI")
import Autodesk
from Autodesk.Revit.DB import *

doc = DocumentManager.Instance.CurrentDBDocument
uiapp = DocumentManager.Instance.CurrentUIApplication
app = uiapp.Application

from System.Collections.Generic import *

#The inputs to this node will be stored as a list in the IN variable.
dataEnteringNode = IN

elements = IN[0]

def toRvtId(_id):
	if isinstance(_id, int) or isinstance(_id, str):
		id = ElementId(int(_id))
		return id
	elif isinstance(_id, ElementId):
		return _id

#"Start" the transaction
TransactionManager.Instance.EnsureInTransaction(doc)

results = []
for i in elements:
	doc.Delete(toRvtId(i.Id))
	results.append("Family ID" + i.Id.ToString() + " was deleted.")

# "End" the transaction
TransactionManager.Instance.TransactionTaskDone()

#Assign your output to the OUT variable
OUT = results
# ----------------------------------------

# group: Mensagem
count = List.Count(list=delete)
code_block_4 = CodeBlock { 0; }
gt = count > code_block_4
code_block_5 = CodeBlock(N=count) { ["Feito! você deletou "+N+" elementos duplicados em seu projeto"]; }
code_block_6 = CodeBlock { ["Nenhum elemento foi deletado"]; }
if_ = If(test=gt, true=code_block_5, false=code_block_6)
boolean_2 = BoolSelector(false)
window_prompt_with_text = Python(IN[0]=if_, IN[1]=boolean_2)
# ---------- window_prompt_with_text.python (19 lines) ----------
import clr

clr.AddReference("System.Windows.Forms")
from System.Windows.Forms import Form,Label,FormStartPosition

def popup(text):
	form = Form()
	form.StartPosition = FormStartPosition.CenterScreen
	form.Width = 300
	form.Height = 100	
	label = Label()
	label.Text = text
	label.Width = 280
	label.Height = 70
	label.Parent = form	
	form.ShowDialog()
	
Text="\n".join(IN[0])
popup(Text)
# ----------------------------------------
