# Dynamo graph BIMACON_Deleta Elementos de Categorias no documento_script.dyn "BIMACON_Deletar Categorias no documento" (Dynamo 2.6.1.8786)
# packages: DynaMEP 2.0.1, archi-lab.net 2023.213.1722

current = RevitModel.Documents.Current()
categories = Categories("OST_ConduitRun")  # graph input
selectByCategory = RevitModel.Element.SelectByCategory(doc=current, category=categories)
delete = archilab.Revit.Elements.Elements.Delete(element=selectByCategory)
watch = Watch(delete)
