# Dynamo graph BIMACON_Deleta Familias com extensão 1_R00_script.dyn (Dynamo 2.16.2.5624)
# packages: archi-lab.net 2023.213.1722, Orchid 2.6.10.6373, Data-Shapes 2022.2.105, Genius Loci 2023.2.21

element_types = ElementTypes("Family")
all_elements_of_type = ElementsOfType(element_type=element_types)
flatten = List.Flatten(list=all_elements_of_type)
uniqueItems = List.UniqueItems(list=flatten)
name = Family.Name(family=uniqueItems)
sort = List.Sort(list=name)
byName = Family.ByName(name=sort)
code_block = CodeBlock { "1"; }
endsWith = String.EndsWith(string=sort, searchFor=code_block)
filterByBoolMask = List.FilterByBoolMask(list=byName, mask=endsWith)
name_2 = Family.Name(family=filterByBoolMask.in)
code_block_2 = CodeBlock { "01"; }
endsWith_2 = String.EndsWith(string=name_2, searchFor=code_block_2)
filterByBoolMask_2 = List.FilterByBoolMask(list=filterByBoolMask.in, mask=endsWith_2)
name_3 = Family.Name(family=filterByBoolMask_2.out)
code_block_3 = CodeBlock { " 1"; }
endsWith_3 = String.EndsWith(string=name_3, searchFor=code_block_3)
filterByBoolMask_3 = List.FilterByBoolMask(list=filterByBoolMask_2.out, mask=endsWith_3)
name_4 = Family.Name(family=filterByBoolMask_3.out)
length = String.Length(string=name_4)
code_block_4 = CodeBlock { 1; "1"; }
sub = length - code_block_4.out0
remove = String.Remove(string=name_4, startIndex=sub, count=code_block_4.out0)
byName_2 = Family.ByName(name=remove)
list_create = List.Create(item0=byName_2, item1=filterByBoolMask_3.out)
flatten_2 = List.Flatten(list=list_create)
boolean = BoolSelector(false)
clean = List.Clean(list=flatten_2, preserveIndices=boolean)
name_5 = Family.Name(family=clean)
code_block_5 = CodeBlock { 600; }

# group: SELECIONE O MODELO ARQ LINKADO
code_block_6 = CodeBlock { "Selecione as famílias a serem deletadas"; }
file_path = Filename("..\..\..\..\..\05 - BIMACON\01 - EMPRESA BIMACON\00 - Logos e imagens - BIMACON\ARTE BIMACON\reddonda-removebg-preview.png")
file_from_path = FileObject(path=file_path)
readFromFile = Image.ReadFromFile(file=file_from_path)
string = StringInput("Confirmar")
boolean_2 = BoolSelector(false)
listview_data = Custom[Listview Data](Keys=name_5, Values=clean, ShowId_optionnal=boolean_2)  # package Data-Shapes; Create data for ListView input in UI.MultiInputForm ++ . Check out www.data-shapes.net for more infos.
list_create_2 = List.Create(item0=listview_data)
boolean_3 = BoolSelector(true)
string_2 = StringInput("Cancelar")
multipleinputform = Custom[MultipleInputForm ++](Description_optional=code_block_6, Logo_optional=readFromFile, ButtonText_optional=string, Inputs=list_create_2, Toggle=boolean_3, CancelButtonText_optional=string_2, Width_optional=code_block_5)  # package Data-Shapes; Create a form with multiple inputs. see www.data-shapes.net for tutorials and infos!
code_block_7 = CodeBlock()  # //Data-Shapes
get_alldocuments = Custom[Get AllDocuments]()  # package Genius Loci; Get documents (linked and opened in background). The first document is the active document.
code_block_8 = CodeBlock()  # //archilab

code_block_9 = CodeBlock { 0; }
getItemAtIndex = List.GetItemAtIndex(list=multipleinputform.User_Inputs, index=code_block_9)
delete = archilab.Revit.Elements.Elements.Delete(element=getItemAtIndex)

# group: Mensagem Final
countTrue = List.CountTrue(list=delete)
code_block_10 = CodeBlock { 0; }
gt = countTrue > code_block_10
code_block_11 = CodeBlock(N=countTrue) { [""+N+" elementos foram deletados"]; }
code_block_12 = CodeBlock { ["Nenhum elemento deletado"]; }
if_ = If(test=gt, true=code_block_11, false=code_block_12)
flatten_3 = List.Flatten(list=if_)
o_string_fromlist = Orchid.Common.String.FromList(list=flatten_3)
python_script = Python(IN[0]=o_string_fromlist)  # IronPython2
# ---------- python_script.python (21 lines) ----------
# Importar as bibliotecas necessárias do Revit
import clr
clr.AddReference("RevitServices")
from RevitServices.Persistence import DocumentManager

clr.AddReference("RevitAPI")
clr.AddReference("RevitAPIUI")
from Autodesk.Revit.UI import TaskDialog

# Pegar a entrada do Dynamo
mensagem = IN[0]

# Criar a TaskDialog
task_dialog = TaskDialog("Ok")
task_dialog.MainInstruction = mensagem

# Exibir a TaskDialog
task_dialog.Show()

# Saída do script
OUT = "Sucesso!"
# ----------------------------------------
