# Dynamo graph BIMACON_Deleta Familias com extensão 1_script.dyn "BIMACON_Deleta Familias com extensão 1" (Dynamo 2.6.1.8786)
# packages: archi-lab.net 2023.213.1722

element_types = ElementTypes("Family")
all_elements_of_type = ElementsOfType(element_type=element_types)
flatten = List.Flatten(list=all_elements_of_type)
uniqueItems = List.UniqueItems(list=flatten)
name = Family.Name(family=uniqueItems)
code_block = CodeBlock { "1"; }
contains = String.Contains(str=name, searchFor=code_block)
filterByBoolMask = List.FilterByBoolMask(list=uniqueItems, mask=contains)
watch = Watch(filterByBoolMask.in)
code_block_2 = CodeBlock { 109; 112; 113; 114; 117..128; 130; 132..141; 102..107; 104; }
list_create = List.Create(item0=code_block_2.out8)
flatten_2 = List.Flatten(list=list_create)
getItemAtIndex = List.GetItemAtIndex(list=filterByBoolMask.in, index=flatten_2)
delete = archilab.Revit.Elements.Elements.Delete(element=getItemAtIndex)
watch_2 = Watch(delete)
