# Dynamo graph BIMACON_Pisos acompanhando Topografia_R00_script.dyn "Pisos acompanhando Topografia - R00" (Dynamo 2.16.2.5624)
# packages: Clockwork for Dynamo 2.x 2.4.0

# group: Input
# note: CATEGORIA:
# Modelagem
# DESCRIÇÃO:
# Ajusta o piso para acompanhar a topografia do local.
# ENTRADAS:
# •  Subregião (que deverá ter o mesmo contorno do piso)
# •  Piso à ser ajustado
# •  Offset do piso em relação à topografia
# OBSERVAÇÃO:
# - Não funciona no Revit 2024 por conta da modificação da topografia que agora é um Sólido Topográfico
# AUTOR:
# - Fellipe Caetano
# VERSÕES TESTADAS DO REVIT
# •   2023 e 2022
# PACOTES NECESSÁRIOS:
# - Nenhum
n01_selecione_a_subregião = DSModelElementSelection()  # "01. Selecione a Subregião"; 1 picked in the model; graph input
n03_offset = DoubleInput(0)  # "03. Offset"; graph input
n02_selecione_o_piso = DSModelElementSelection()  # "02. Selecione o Piso"; 1 picked in the model; graph input

# group: Processamento: Manipulação dos pontos da topografia
points = Topography.Points(topography=n01_selecione_a_subregião)
X = Point.X(point=points)
Y = Point.Y(point=points)
Z = Point.Z(point=points)
add = Z + n03_offset
byCoordinates = Point.ByCoordinates(x=X, y=Y, z=add)

# group: Output
slabShapeByPoints = Custom[Floor.SlabShapeByPoints](points=byCoordinates, floor=n02_selecione_o_piso)  # package Clockwork for Dynamo 2.x; Transform a slab shape based on a list of Points
