# Dynamo graph BIMACON_Pisos acompanhando Topografia_RVT 2024_R00_script.dyn "Pisos acompanhando Topografia - RVT 2024 - R00" (Dynamo 2.19.3.6394)

# group: Input
n02_selecione_o_piso = DSModelElementSelection()  # "02 - Selecione o Piso"; 1 picked in the model; graph input
n01_selecione_a_sub_região = DSModelElementSelection()  # "01 - Selecione a Sub-Região"; 1 picked in the model; graph input
n03_offset = DoubleInput(0.2)  # "03 - Offset"

# group: Obter os pontos da Subregião sólida
faces = Element.Faces(element=n01_selecione_a_sub_região)
perimeterCurves = Surface.PerimeterCurves(surface=faces)
intersect = Geometry.Intersect(geometry=perimeterCurves, other=perimeterCurves, lacing=CrossProduct)
flatten = List.Flatten(list=intersect)
code_block = CodeBlock { "Autodesk.DesignScript.Geometry.Point"; }
removeIfNot = List.RemoveIfNot(list=flatten, type=code_block)
pruneDuplicates = Point.PruneDuplicates(points=removeIfNot)

# group: Agrupar pontos coincidentes com alturas diferentes
X = Point.X(point=pruneDuplicates)
code_block_2 = CodeBlock { 2; }
round = Math.Round(number=X, digits=code_block_2)
groupByKey = List.GroupByKey(list=pruneDuplicates@L2, keys=round@L2)

# group: Obter apenas os pontos inferiores
Z = Point.Z(point=groupByKey.groups)
sortByKey = List.SortByKey(list=groupByKey.groups@L2, keys=Z@L2)
firstItem = List.FirstItem(list=sortByKey.sortedList@L2)  # frozen

# group: Inserir o Offset para o Piso
X_2 = Point.X(point=firstItem)
Y = Point.Y(point=firstItem)
Z_2 = Point.Z(point=firstItem)
add = Z_2 + n03_offset
byCoordinates = Point.ByCoordinates(x=X_2, y=Y, z=add)

# group: Inserir pontos no Piso
addPoint = Floor.AddPoint(floor=n02_selecione_o_piso, point=byCoordinates)
