# Dynamo graph BIMACON_Alinhar topografia ao piso selecionado_R00_script.dyn "Alinhar topografia ao piso selecionado-R00" (Dynamo 2.16.2.5624)
# author: karam@aecedx.com
# packages: Synthesize toolkit 12.5.1

# group: Input
n05_nearby_points_cleaning_range = DoubleInput(1)  # "05.Nearby Points Cleaning Range"; graph input
n04_spacing_between_points_to_add = DoubleInput(0.5)  # "04.Spacing Between Points To Add"; graph input
n01_select_topography = DSModelElementSelection()  # "01.Select Topography"; 1 picked in the model; graph input
n03_height_offset_of_selected = DoubleInput(0)  # "03.Height Offset Of Selected Edges"; graph input
# note: CATEGORIA:
# Documentação
# DESCRIÇÃO:
# Alinha uma topografia a um piso existente, selecionando as arestas. O processo é feito adicionando pontos de acordo com as linhas selecionadas
# ENTRADAS:
# •  Topografia
# •  Linhas do piso (edges)
# •  Altura de deslocamento da topografia a partir das linhas do piso
# •  Espaçamento entre pontos que serão adicionados
# •  Range de pontos próximos à serem limpos (suavização da topografia)
# OBSERVAÇÃO:
# - Não funciona no Revit 2024 por conta das alterações da topografia
# AUTOR:
# - Synthesize Toolkit
# VERSÕES TESTADAS DO REVIT
# •   2023 e 2022
# PACOTES NECESSÁRIOS:
# - Synthesize Toolkit
n02_select_edges = SelectEdges()  # "02.Select Edges"; 9 picked in the model; graph input

select_topography_from_subregion = Custom[Select Topography From Subregion](VARTopography=n01_select_topography)  # package Synthesize toolkit; Select Topography From Subregion
topography_auto_k_align_data = Custom[Topography Auto K-Align Data Prepare](VARNearbyPointsCleaningRange=n05_nearby_points_cleaning_range, VARSpacingBetweenPointsToAdd=n04_spacing_between_points_to_add, VARTopography=select_topography_from_subregion, VARHeightOffsetOfSelectedEdges=n03_height_offset_of_selected, VAREdges=n02_select_edges)  # package Synthesize toolkit; Topography Auto K-Align Data Prepare
python_script = Python(IN[0]=topography_auto_k_align_data.VARPointsToAdd, IN[1]=select_topography_from_subregion, IN[2]=topography_auto_k_align_data.VARMinPoints, IN[3]=topography_auto_k_align_data.VARMaxPoints, IN[4]=n05_nearby_points_cleaning_range, IN[5]=topography_auto_k_align_data.VARPointsToAdd)  # IronPython2
# ---------- python_script.python (120 lines) ----------
# Created By Karam Baki : karam@aecedx.com
# Enable Python support and load DesignScript library
# IMPORTANT : ALL DYNAMO DESIGN SCRIPT NODES ARE AS (dg)
import clr
clr.AddReference('ProtoGeometry')
from Autodesk.DesignScript import Geometry as dg

# EXTENSION Enable ToDSType
clr.AddReference('RevitNodes')
import Revit
clr.ImportExtensions(Revit.Elements)

# Enable Revit Elements
from Revit.Elements import *

# EXTENSION Enable Geometry Conversion Methods
clr.ImportExtensions(Revit.GeometryConversion)

# Enable Revit API
clr.AddReference('RevitAPI')
from Autodesk.Revit.DB import *
import Autodesk.Revit.DB
# Enable DocumentManager and TransactionManager
clr.AddReference('RevitServices')
from RevitServices.Persistence import DocumentManager
from RevitServices.Transactions import TransactionManager

# Enable ICollection List Translate
clr.AddReference("System")
import System.Collections.Generic
from System.Collections.Generic import List
doc = DocumentManager.Instance.CurrentDBDocument
uidoc = DocumentManager.Instance.CurrentUIApplication.ActiveUIDocument
uiapp = DocumentManager.Instance.CurrentUIApplication
app = uiapp.Application

class WarnSwallow(IFailuresPreprocessor):
	def PreprocessFailures(self, failuresAccessor):
		failuresAccessor.DeleteAllWarnings()
		return FailureProcessingResult.Continue

dataEnteringNode = IN
# Use UnwrapElement(IN[0]) When Translating From Dynamo to Revit
points = UnwrapElement(IN[0])
topo = UnwrapElement(IN[1])
minp = UnwrapElement(IN[2])
maxp = UnwrapElement(IN[3])
range = IN[4]
goodpts = UnwrapElement(IN[5])

if range > 0:

	count = 0
	bboxes = []
	for each in minp:
		bboxes.append(dg.BoundingBox.ByCorners(each, maxp[count]))
		count = count + 1

	allpts = topo.GetPoints()
	convpts = []
	for each in allpts:
		convpts.append(each.ToPoint())

	todelpts = []
	for eachbox in bboxes:
		for e in convpts:
			if dg.BoundingBox.Contains(eachbox,e):
				todelpts.append(e)
	uniquetodelpts = set(todelpts)
	todelpts = list(uniquetodelpts)

	todelxyz = []
	for e in todelpts:
		todelxyz.append(e.ToXyz())

	#Disposing Stuff
	for e in convpts:
		e.Dispose()

xyzconvgood = []
for each in goodpts:
	try:
		xyzconvgood.append(each.ToXyz())
	except:
		pass

failproc = WarnSwallow()
ilistofidsgood = List[Autodesk.Revit.DB.XYZ](xyzconvgood)
if range > 0:
	if len(todelxyz) > 0:
		ilistofids = List[Autodesk.Revit.DB.XYZ](todelxyz)
editsession = Architecture.TopographyEditScope(doc,"Topo K-Align")
editsessioncl = Architecture.TopographyEditScope(doc,"Topo Clean Up")

if range > 0:
	try:
		if len(todelxyz) > 0:
			Revit.Transaction.Transaction.End(doc)
			editsessioncl.Start(topo.Id)
			TransactionManager.Instance.EnsureInTransaction(doc)
			topo.DeletePoints(ilistofids)
			TransactionManager.Instance.ForceCloseTransaction()
			editsessioncl.Commit(failproc)
	except:
		pass
	Revit.Transaction.Transaction.End(doc)
	editsession.Start(topo.Id)
	TransactionManager.Instance.EnsureInTransaction(doc)
	topo.AddPoints(ilistofidsgood)
	TransactionManager.Instance.ForceCloseTransaction()
	editsession.Commit(failproc)
else:
	Revit.Transaction.Transaction.End(doc)
	editsession.Start(topo.Id)
	TransactionManager.Instance.EnsureInTransaction(doc)
	topo.AddPoints(ilistofidsgood)
	TransactionManager.Instance.ForceCloseTransaction()
	editsession.Commit(failproc)

OUT = topo
# ----------------------------------------
debug_python = Custom[Debug Python]()  # package Synthesize toolkit; Debug Python
