# Dynamo graph BIMACON_VERGA E CONTRAVERGA EM JANELAS_script.dyn "VERGA E CONTRAVERGA EM JANELAS" (Dynamo 2.6.1.8786)

categories = Categories("OST_Windows")
all_elements_of_category = ElementsOfCategory(Category=categories)
getLocation = Element.GetLocation(element=all_elements_of_category)
code_block = CodeBlock { "Altura da extremidade"; }
getParameterValueByName = Element.GetParameterValueByName(element=all_elements_of_category, parameterName=code_block)
code_block_2 = CodeBlock { "Altura do peitoril"; }
getParameterValueByName_2 = Element.GetParameterValueByName(element=all_elements_of_category, parameterName=code_block_2)
sub = getParameterValueByName - getParameterValueByName_2
translate = Geometry.Translate(geometry=getLocation, zTranslation=sub)
getHost = FamilyInstance.GetHost(familyInstance=all_elements_of_category)
getLocation_2 = Element.GetLocation(element=getHost)
direction = Line.Direction(line=getLocation_2)
elementType = Element.ElementType(element=all_elements_of_category)
code_block_3 = CodeBlock { "Largura"; }
getParameterValueByName_3 = Element.GetParameterValueByName(element=elementType, parameterName=code_block_3)
code_block_4 = CodeBlock(a=getParameterValueByName_3) { a/2; }
byStartPointDirectionLength = Line.ByStartPointDirectionLength(startPoint=translate, direction=direction, length=code_block_4)
extendStart = Curve.ExtendStart(curve=byStartPointDirectionLength, distance=code_block_4)
comp_de_apoio = DoubleInput(0.1)  # graph input
extendEnd = Curve.ExtendEnd(curve=extendStart, distance=comp_de_apoio)
extendStart_2 = Curve.ExtendStart(curve=extendEnd, distance=comp_de_apoio)
levels = Levels("01_Térreo")  # graph input
structural_framing_types = StructuralFramingTypes("14 x 20 cm (Verga)")  # graph input
beamByCurve = StructuralFraming.BeamByCurve(curve=extendStart_2, level=levels, structuralFramingType=structural_framing_types)
code_block_5 = CodeBlock { "Justificação z"; }
code_block_6 = CodeBlock { 3; }
setParameterByName = Element.SetParameterByName(element=beamByCurve, parameterName=code_block_5, value=code_block_6)
code_block_7 = CodeBlock { -1; }
mul = sub * code_block_7
translate_2 = Geometry.Translate(geometry=extendStart_2, zTranslation=mul)
beamByCurve_2 = StructuralFraming.BeamByCurve(curve=translate_2, level=levels, structuralFramingType=structural_framing_types)
code_block_8 = CodeBlock { "Justificação z"; }
code_block_9 = CodeBlock { 0; }
setParameterByName_2 = Element.SetParameterByName(element=beamByCurve_2, parameterName=code_block_8, value=code_block_9)
code_block_10 = CodeBlock { "Valor do deslocamento z"; }
code_block_11 = CodeBlock { -0.025; }
setParameterByName_3 = Element.SetParameterByName(element=beamByCurve_2, parameterName=code_block_10, value=code_block_11)
