# Dynamo graph BIMACON_VERGAS EM PORTAS_script.dyn "VERGA EM PORTAS" (Dynamo 2.6.1.8786)

categories = Categories("OST_Doors")
all_elements_of_category = ElementsOfCategory(Category=categories)
getLocation = Element.GetLocation(element=all_elements_of_category)
code_block = CodeBlock { "Altura da extremidade"; }
getParameterValueByName = Element.GetParameterValueByName(element=all_elements_of_category, parameterName=code_block)
translate = Geometry.Translate(geometry=getLocation, zTranslation=getParameterValueByName)
getHost = FamilyInstance.GetHost(familyInstance=all_elements_of_category)
getLocation_2 = Element.GetLocation(element=getHost)
direction = Line.Direction(line=getLocation_2)
elementType = Element.ElementType(element=all_elements_of_category)
code_block_2 = CodeBlock { "Largura"; }
getParameterValueByName_2 = Element.GetParameterValueByName(element=elementType, parameterName=code_block_2)
code_block_3 = CodeBlock(a=getParameterValueByName_2) { a/2; }
byStartPointDirectionLength = Line.ByStartPointDirectionLength(startPoint=translate, direction=direction, length=code_block_3)
extendStart = Curve.ExtendStart(curve=byStartPointDirectionLength, distance=code_block_3)
comp_de_apoio = DoubleInput(0.3)  # graph input
extendEnd = Curve.ExtendEnd(curve=extendStart, distance=comp_de_apoio)
extendStart_2 = Curve.ExtendStart(curve=extendEnd, distance=comp_de_apoio)
levels = Levels("Térreo / 1º Pavimento")  # graph input
structural_framing_types = StructuralFramingTypes("14 x 20 cm (Verga)")  # graph input
beamByCurve = StructuralFraming.BeamByCurve(curve=extendStart_2, level=levels, structuralFramingType=structural_framing_types)
code_block_4 = CodeBlock { "Justificação z"; }
code_block_5 = CodeBlock { 3; }
setParameterByName = Element.SetParameterByName(element=beamByCurve, parameterName=code_block_4, value=code_block_5)
